# Grasshopper definition ghpython_intro_01.gh (Grasshopper 1.0.8)
# plug-ins: Bifocals

edges = Python3Script(loops=Slider(12, range=1..12), freq=Slider(3, range=0..6))  # -> out, circles; inputs loops: Int32, freq: Int32
# ---------- edges: Python ----------
import Rhino.Geometry as rg
# Here we need to import math and itertools 
import math as m


# let's create a function that draws a circle
def draw_circle(resolution: int = 10, radius: int = 1):
    pts = [] 

    for i in range(resolution):
        theta = i/(resolution-1)*m.tau
        pts.append(
            rg.Point3d(
                radius*m.cos(theta),
                radius*m.sin(theta),
                0
            )
        )

    return rg.Curve.CreateInterpolatedCurve(
        pts,
        3
    )

# set the output list
circles = []

for i in range(loops):
    circle = draw_circle(radius=i+1)
    circles.append(circle)

# # with a twist
# def draw_cool_circle(resolution: int = 10, radius: int = 1):
#     pts = [] 

#     for i in range(resolution):
#         theta = i/(resolution-1)*m.tau
        
#         # play with the radius
#         r = radius + m.cos(theta*freq)

#         pts.append(
#             rg.Point3d(
#                 r*m.cos(theta),
#                 r*m.sin(theta),
#                 0
#             )
#         )

#     return rg.Curve.CreateInterpolatedCurve(
#         pts,
#         3
#     )

# # set the output list
# circles = []

# for i in range(loops):
#     circle = draw_cool_circle(resolution=100, radius=i+1)
#     circles.append(circle)

# # more passion, more energy!
# def draw_even_cooler_circle(resolution: int = 10, radius: int = 1):
#     pts = [] 

#     shift = 0
#     if radius%2 == 0:
#         shift = m.pi

#     for i in range(resolution):
#         theta = i/(resolution-1)*m.tau
        
#         # play with the radius

#         r = radius + m.cos(theta*freq+shift)*0.5

#         pts.append(
#             rg.Point3d(
#                 r*m.cos(theta),
#                 r*m.sin(theta),
#                 0
#             )
#         )

#     return rg.Curve.CreateInterpolatedCurve(
#         pts,
#         3
#     )

# # set the output list
# circles = []

# for i in range(loops):
#     circle = draw_even_cooler_circle(resolution=100, radius=i+1)
#     circles.append(circle)
# ---------- end edges ----------

number_slider = Slider(5, range=2..10)
number_slider_2 = Slider(9, range=2..10)
number_slider_3 = Slider(0.6, range=0..1)
number_slider_4 = Slider(8, range=0..10)

python_3_script = Python3Script(length=Slider(4, range=1..5))  # -> out, pt, box, srf, pln; inputs length: Double
# ---------- python_3_script: Python ----------
""" 
This is how you import a library 
Rhino.Geometry is what we'll use for Rhino, however there is also rhinoscriptsyntex
Check out the documentation for Rhino Common:
https://developer.rhino3d.com/api/rhinocommon/
"""
import Rhino.Geometry as rg

# This is a "input", coming from your gh doc. 
print ("The input is: ", length)

# "out" is a reserved variable for ghpython, make sure it's always there

# 0D 
pt = rg.Point3d(length,1,0) # this is a Point3d a Point in 3D cartesian space
vec = rg.Vector3d(1,1,0) # this is a Vector3d a Point in 3D cartesian space
vec *= length
# Try add another "Output" as vec, and see what will happen

# 1D 
line = rg.LineCurve(pt, pt+vec)
domain = rg.Interval(0, 100) # this is a interval, a finite 1D space of real numbers
print ("The normamlize parameter on the axes:", domain.NormalizedParameterAt(20))
print ("The parameter on the axes:", domain.ParameterAt(0.5))
print(f"your are living in {domain.NormalizedParameterAt(20)} dimention.")

# 2D
# Plane is technically two-dimensional, however it can already be use to map 3d cartesian space
pln = rg.Plane(
    pt+vec,
    rg.Vector3d.XAxis,
    rg.Vector3d.YAxis
)

# Try to find the NurbsSurface.CreateFromPlane in the API doc
srf = rg.NurbsSurface.CreateFromPlane(
    pln,
    rg.Interval(-1, 1),
    rg.Interval(-1, 1),
    1,
    1,
    2,
    2
)

# 3D
box = rg.Box(
    pln,
    rg.Interval(-1, 1),
    rg.Interval(-1, 1),
    rg.Interval(1, 2)
)
# ---------- end python_3_script ----------

edges_2 = Python3Script(segments=Slider(5, range=3..12), radius=Slider(5, range=1..5), loop=Slider(5, range=0..10))  # -> out, edges, trippy_edges; inputs segments: Int32, radius: Double, loop: Int32
# ---------- edges_2: Python ----------
import Rhino.Geometry as rg
# Here we need to import math and itertools 
import math as m

# pairwise is not in itertools until python 3.10, so if you need it you'll have to do it like this
def pairwise(iterable):
    # pairwise('ABCDEFG') → AB BC CD DE EF FG

    iterator = iter(iterable)
    a = next(iterator, None)

    for b in iterator:
        yield a, b
        a = b

# Let's draw a polygon
corners = []
for i in range(segments+1):
    # get the normalized parameter
    t = i/(segments)
    print ("corner", i)
    print (i, t)
    
    theta = t*m.tau # tau = 2*pi
    print ("Angle in radian: ", theta)
    print ("Angle in degrees: ", m.degrees(theta))
    
    corner = rg.Point3d(
        radius*m.cos(theta),
        radius*m.sin(theta),
        0
    )
    corners.append(corner)

# Connect the dots
edges = []

# say pairwise is not avaliabe
for i, corner in enumerate(corners[:-1]):
    edges.append(
        rg.LineCurve(
            corner,
            corners[i+1]
        )
    )

# Trippy
def loop_polygon(edges: list[rg.LineCurve]):
    new_edges = []
    corners = []

    for edge in edges:
        # get the interval of th linear space of the edge 
        domain = edge.Domain

        # get the specific point on this edge
        pt = edge.PointAt(domain.ParameterAt(0.1)) 
        corners.append(pt)
    
    # repeat the first conrer
    corners.append(corners[0])

    for i, corner in enumerate(corners[:-1]):
        new_edges.append(
            rg.LineCurve(
                corner,
                corners[i+1]
            )
    )
    return new_edges

# run it in loops
starting_edges = edges
trippy_edges = []

for i in range(loop):
    starting_edges = loop_polygon(starting_edges)
    trippy_edges.extend(starting_edges)
# ---------- end edges_2 ----------

remap_numbers = RemapNumbers(Value=Slider(64, range=0..100), Source="10 to 100", Target=Domain(0, 1))  # -> Mapped, Clipped
python_3_script_2 = Python3Script(edge=number_slider, radius=number_slider_2, Position=number_slider_3, loop=number_slider_4)  # -> out, trippy_shapes; inputs edge: Int32, Position: Double, loop: Int32
# ---------- python_3_script_2: Python ----------
import Rhino.Geometry as rg
import math as m


theta = m.radians(90)

pt_on_circle = rg.Point3d(
    radius * m.cos(theta),
    radius * m.sin(theta),
    0
)


pts = []
for i in range(edge+1):
    t = i/(edge)
    angle = t * m.tau #tau = pi*2
    print(m.degrees(angle))

    pt = rg.Point3d(
        radius * m.cos(angle),
        radius * m.sin(angle),
        0
        )
    
    pts.append(pt)

edges = []
#polygon = rg.Curve.CreateInterpolatedCurve(pts)

for i, corner in enumerate(pts[:-1]): #slice
    start_pt = corner
    end_pt = pts[i+1]
    crv = rg.LineCurve(
        start_pt,
        end_pt
    )

    edges.append(crv)


#draw a triangle
def baby_triangle(original_edges, Position): #You should have add position
    new_corners = []
    for edge in original_edges:
        edge.Domain = rg.Interval(0,1)
        
        new_corner = edge.PointAt(Position)
        new_corners.append(new_corner)

    new_corners.append(new_corners[0])

    baby_edges = []
    #corner the dots
    for i, corner in enumerate(new_corners[:-1]):
        start_pt = corner
        end_pt = new_corners[i+1]
        crv = rg.LineCurve(
        start_pt,
        end_pt
        )
        baby_edges.append(crv)

    return baby_edges

baby_corners = baby_triangle(edges, Position)

trippy_shapes = []
trippy_shapes.extend(edges)

for i in range(loop):
    edges = baby_triangle(edges, Position)
    trippy_shapes.extend(edges)
# ---------- end python_3_script_2 ----------
python_3_script_3 = Python3Script(edge=number_slider, radius=number_slider_2, Position=number_slider_3, loop=number_slider_4)  # -> out, edges, trippy_shapes; inputs edge: Int32, Position: Double, loop: Int32; same code as python_3_script_2
panel = Panel(remap_numbers.Mapped)
curve = Curve(python_3_script_3.trippy_shapes)
box = Box(python_3_script.box)
surface = Surface(python_3_script.srf)

# ----
# Project_B_00
number_slider_5 = Slider(4.8, range=1.2..10)
python = GhPythonScript(
    size=number_slider_5,
    max_size=Slider(5, range=1.2..10),
    number_of_shapes=Slider(27, range=0..100),
    number_of_rows=Slider(27, range=0..100),
    gap=Slider(11, range=0..300),
    Radi=Slider(53, range=0..100))  # -> out, rectangles; inputs number_of_shapes: Int32, number_of_rows: Int32
# ---------- python: Python ----------
# input
# point - starting point
# size - size of rectangles
# number_of_shapes 

# output 
# rectangles - list of rectangles

import Rhino.Geometry as rg
import math as m

my_points = []
vector = rg.Vector3d(1,0,0)
rectangles = []

# Source - https://stackoverflow.com/q/34839316
# Posted by Mini Mithi, modified by community. See post 'Timeline' for change history
# Retrieved 2026-09-22, License - CC BY-SA 4.0

def remap(old_val, old_min, old_max, new_min, new_max):
    return (new_max - new_min)*(old_val - old_min) / (old_max - old_min) + new_min

for i in range(number_of_shapes):
    for j in range(number_of_rows):
        my_point = rg.Point3d(i * gap, j * gap, 0)
        my_points.append(my_point)
        
        current_plane = rg.Plane(my_point, rg.Vector3d.XAxis, rg.Vector3d.YAxis)
        
        #size -- from min size/2 max (number_of_shapes+1) * size/2
        #to -- 3 to 5i
        remapped_size = remap(size/2* (i+j+1),
                        size/2,
                        (number_of_shapes+1) * size/2,
                        3,
                        max_size)
        #rotate the plane
        angle = m.radians(Radi)
        axis = rg.Vector3d.ZAxis
        current_plane.Rotate(angle*remapped_size, axis, my_point) #Attribute
        
        width_interval = rg.Interval(-remapped_size, remapped_size)
        height_interval = rg.Interval(-remapped_size, remapped_size)
        current_rec = rg.Rectangle3d(current_plane, width_interval, height_interval)
        rectangles.append(current_rec)
# ---------- end python ----------

# ----
# Project_B_01
number_slider_6 = Slider(5, range=1.2..10)
python_2 = GhPythonScript(
    size=Slider(4.8, range=1.2..10),
    max_size=number_slider_6,
    number_of_shapes=Slider(27, range=0..100),
    number_of_rows=Slider(27, range=0..100),
    gap=Slider(11, range=0..300),
    Radi=Slider(53, range=0..100))  # -> out, rectangles; inputs number_of_shapes: Int32, number_of_rows: Int32
# ---------- python_2: Python ----------
import Rhino.Geometry as rg
import math as m


my_points = []
vector = rg.Vector3d(1,0,0)
rectangles = []

def remap(old_val, old_min, old_max, new_min, new_max):
    return (new_max - new_min)*(old_val - old_min) / (old_max - old_min) + new_min

for i in range(number_of_shapes):
    for j in range(number_of_rows):
        my_point = rg.Point3d(i * gap, j * gap, 0)
        my_points.append(my_point)
        
        current_plane = rg.Plane(my_point, rg.Vector3d.XAxis, rg.Vector3d.YAxis)
        
        #size -- from min size/2, max (number_of_shapes+1) * size/2
        #to -- 3 to 5i
        remapped_size = remap(
                        size/2* (i+j+1)*m.cos((i+j)/1.75),
                        size/2,
                        (number_of_shapes+1) * size/2,
                        3,
                        max_size)
        #rotate the plane
        angle = m.radians(Radi)
        axis = rg.Vector3d.ZAxis
        current_plane.Rotate(angle*remapped_size, axis, my_point) #Attribute
        
        width_interval = rg.Interval(-remapped_size, remapped_size)
        height_interval = rg.Interval(-remapped_size, remapped_size)
        current_rec = rg.Rectangle3d(current_plane, width_interval, height_interval)
        rectangles.append(current_rec)
# ---------- end python_2 ----------

python_3_script_4 = Python3Script(
    seedStart=Slider(2, range=0..10),
    seedEnd=Slider(67, range=0..100),
    maxSteps=Slider(75, range=0..100),
    areaSize=Slider(100, range=0..100),
    vecMin=Slider(4, range=0..10),
    vecMax=Slider(7, range=0..10),
    sqMin=Slider(3.3, range=0..10),
    sqMax=Slider(10, range=0..10),
    randomSeed=Slider(3, range=0..10))  # -> out, Lines, Squares; inputs seedStart: Int32, seedEnd: Int32, maxSteps: Int32, areaSize: Int32, sqMax: Boolean, randomSeed: Int32
# ---------- python_3_script_4: Python ----------
import Rhino.Geometry as rg
import random
import math

lines = []      
squares = []   

DIRECTIONS = [
    rg.Vector3d(1, 0, 0),
    rg.Vector3d(0, 1, 0),
    rg.Vector3d(-1, 0, 0),
    rg.Vector3d(0, -1, 0)
]


def draw_nested_squares(center, base_size, count):
    for i in range(count):
        s = base_size * (1.0 - (i / float(count)) * 0.8)
        if s <= 0.15:
            break
        half = s / 2.0
        p0 = rg.Point3d(center.X - half, center.Y - half, 0)
        p1 = rg.Point3d(center.X + half, center.Y - half, 0)
        p2 = rg.Point3d(center.X + half, center.Y + half, 0)
        p3 = rg.Point3d(center.X - half, center.Y + half, 0)
        pts = [p0, p1, p2, p3, p0]
        squares.append(rg.PolylineCurve(pts))


def collatz_walk(n, pos, rnd, max_steps, vec_min, vec_max, sq_min, sq_max):
    steps = 0
    while n != 1 and steps < max_steps:
        length = vec_min + rnd.random() * (vec_max - vec_min)
        direction = DIRECTIONS[rnd.randint(0, 3)]

        new_pos = rg.Point3d(
            pos.X + direction.X * length,
            pos.Y + direction.Y * length,
            0
        )
        lines.append(rg.LineCurve(pos, new_pos))

        if n % 2 == 1:
            n = 3 * n + 1
            base_size = sq_min + rnd.random() * (sq_max - sq_min)
            count = rnd.randint(2, 6)
            draw_nested_squares(new_pos, base_size, count)
        else:
            n = n // 2

        pos = new_pos
        steps += 1


lines = []
squares = []

rnd = random.Random(randomSeed)
count = 0

for seed in range(seedStart, seedEnd):
    start_pos = rg.Point3d(
        (rnd.random() - 0.5) * 2 * areaSize,
        (rnd.random() - 0.5) * 2 * areaSize,
        0
    )
    collatz_walk(seed, start_pos, rnd, maxSteps, vecMin, vecMax, sqMin, sqMax)
    count += 1

Lines = lines
Squares = squares
print (count)
# ---------- end python_3_script_4 ----------
custom_preview = CustomPreview(Geometry=[python_3_script_4.Squares, python_3_script_4.Lines], Material=ColourSwatch(SwatchColor=RGB(0, 0, 0)))

point = Point(Point(134.6338451, 164.8978495, 0))

# ----
# Project_B_02
number_slider_7 = Slider(27, range=0..100)
python_3 = GhPythonScript(
    Attractor_pt=point,
    size=Slider(10, range=1.2..10),
    number_of_shapes=number_slider_7,
    gap=Slider(10, range=0..300),
    k=Slider(1.7, range=0.5..10))  # -> out, my_points, rectangles; inputs Attractor_pt: Point3d, number_of_shapes: Int32
# ---------- python_3: Python ----------
import Rhino.Geometry as rg
import math as m

my_points = []
vector = rg.Vector3d(1,0,0)
rectangles = []

def remap(old_val, old_min, old_max, new_min, new_max):
    return (new_max - new_min)*(old_val - old_min) / (old_max - old_min) + new_min

for i in range(number_of_shapes):
    for j in range(number_of_shapes):
        my_point = rg.Point3d(i * gap, j * gap, 0)
        my_points.append(my_point)
        distance = my_point.DistanceTo(Attractor_pt)
#        print(distance)
        
        current_plane = rg.Plane(my_point, rg.Vector3d.XAxis, rg.Vector3d.YAxis)
        
        #size -- from min size/2, max (number_of_shapes+1) * size/2
        #to -- 3 to 5i
#        remapped_size = remap(
#                        size/2* (i+j+1),
#                        size/2,
#                        (number_of_shapes+1) * size/2,
#                        3,
#                        max_size)
#        rotate the plane
        angle = m.radians(distance)
        print(angle)
        
        axis = rg.Vector3d.ZAxis
        current_plane.Rotate(angle*k, axis, my_point)#Attribute
        
        width_interval = rg.Interval(-size/2, size/2)
        height_interval = rg.Interval(-size/2, size/2)
        current_rec = rg.Rectangle3d(current_plane, width_interval, height_interval)
        rectangles.append(current_rec)
# ---------- end python_3 ----------

python_3_script_5 = Python3Script(
    seedStart=Slider(2, range=0..10),
    seedEnd=Slider(67, range=0..100),
    maxSteps=Slider(75, range=0..100),
    areaSize=Slider(100, range=0..100),
    vecMin=Slider(4, range=0..10),
    vecMax=Slider(7, range=0..10),
    sqMin=Slider(3.3, range=0..10),
    sqMax=Slider(10, range=0..10),
    randomSeed=Slider(3, range=0..10))  # -> out, Lines, Squares; inputs seedStart: Int32, seedEnd: Int32, maxSteps: Int32, areaSize: Int32, sqMax: Boolean, randomSeed: Int32
# ---------- python_3_script_5: Python ----------
import Rhino.Geometry as rg
import random
import math

# ========== 輸入 ==========
# seedStart, seedEnd : int    起始數字範圍(例如 2~35),每個數字各自跑一條 Collatz 路徑
# maxSteps            : int   單一路徑最多遞迴幾步(避免無限迴圈,建議 40~60)
# areaSize            : float 起始點隨機散佈的範圍(正方形邊長)
# vecMin, vecMax      : float 每步移動的隨機向量長度範圍
# sqMin, sqMax        : float 同心正方形的基礎邊長範圍
# randomSeed          : int   亂數種子,方便重現同一張圖

lines = []      # 收集所有路徑線段 (Curve)
squares = []    # 收集所有同心正方形 (Curve)

DIRECTIONS = [
    rg.Vector3d(1, 0, 0),
    rg.Vector3d(0, 1, 0),
    rg.Vector3d(-1, 0, 0),
    rg.Vector3d(0, -1, 0)
]


def draw_nested_squares(center, base_size, count):
    for i in range(count):
        s = base_size * (1.0 - (i / float(count)) * 0.8)
        if s <= 0.15:
            break
        half = s / 2.0
        p0 = rg.Point3d(center.X - half, center.Y - half, 0)
        p1 = rg.Point3d(center.X + half, center.Y - half, 0)
        p2 = rg.Point3d(center.X + half, center.Y + half, 0)
        p3 = rg.Point3d(center.X - half, center.Y + half, 0)
        pts = [p0, p1, p2, p3, p0]
        squares.append(rg.PolylineCurve(pts))


def collatz_walk(n, pos, rnd, max_steps, vec_min, vec_max, sq_min, sq_max):
    steps = 0
    while n != 1 and steps < max_steps:
        length = vec_min + rnd.random() * (vec_max - vec_min)
        direction = DIRECTIONS[rnd.randint(0, 3)]

        new_pos = rg.Point3d(
            pos.X + direction.X * length,
            pos.Y + direction.Y * length,
            0
        )
        lines.append(rg.LineCurve(pos, new_pos))

        if n % 2 == 1:
            n = 3 * n + 1
            base_size = sq_min + rnd.random() * (sq_max - sq_min)
            count = rnd.randint(2, 6)
            draw_nested_squares(new_pos, base_size, count)
        else:
            n = n // 2

        pos = new_pos
        steps += 1


# ========== 執行 ==========
lines = []
squares = []

rnd = random.Random(randomSeed)
count = 0

for seed in range(seedStart, seedEnd):
    start_pos = rg.Point3d(
        (rnd.random() - 0.5) * 2 * areaSize,
        (rnd.random() - 0.5) * 2 * areaSize,
        0
    )
    collatz_walk(seed, start_pos, rnd, maxSteps, vecMin, vecMax, sqMin, sqMax)
    count += 1
# ========== 輸出 ==========
Lines = lines
Squares = squares
print (count)
# ---------- end python_3_script_5 ----------
point_2 = Point(python_3.my_points)
curve_2 = Curve(python_3.rectangles)
custom_preview_2 = CustomPreview(Geometry=[python_3_script_5.Squares, python_3_script_5.Lines], Material=ColourSwatch(SwatchColor=RGB(0, 0, 0)))
custom_preview_3 = CustomPreview(Geometry=curve_2, Material=ColourSwatch(SwatchColor=RGB(0, 0, 0)))

# ---- group: Project A
# Project_A_02 (No rotation)
number_slider_8 = Slider(4500, range=0..10000)
number_slider_9 = Slider(532, range=0..1000)
number_slider_10 = Slider(249, range=0..300)
number_slider_11 = Slider(0, range=0..100)
number_slider_12 = Slider(13, range=1..50)
rectangle = Rectangle(Plane="5000,10000,0", XSize=number_slider_8, YSize=number_slider_8, Radius=0)  # -> Rectangle, Length
python_4 = GhPythonScript(
    rec=rectangle.Rectangle,
    size=number_slider_9,
    number_of_shapes=number_slider_10,
    Radi=number_slider_11,
    k=number_slider_12)  # -> out, rectangles; inputs rec: Rectangle3d, number_of_shapes: Int32
# ---------- python_4: Python ----------
# input
# point - starting point
# size - size of rectangles
# number_of_shapes 

# output 
# rectangles - list of rectangles

import Rhino.Geometry as rg
import math as m
import random

my_points = []
vector = rg.Vector3d(1,0,0)
rectangles = []

def remap(old_val, old_min, old_max, new_min, new_max):
    return (new_max - new_min)*(old_val - old_min) / (old_max - old_min) + new_min

crv = rec.ToNurbsCurve()
crv.Domain = rg.Interval(0,1)

pts = []
l = k+7

for i in range(number_of_shapes):
    # pt + vec is moved_points
    t = remap(i, 0, number_of_shapes, 0, 1) #remap to make the curve domain periodic
    abs(m.cos(i/10))
    current_pt = crv.PointAt(t) 
    print(t)
    pts.append(current_pt)
    current_plane = rg.Plane(current_pt, rg.Vector3d.XAxis, rg.Vector3d.YAxis)
    #rotate the plane
    angle = m.radians(Radi)
    axis = rg.Vector3d.ZAxis
    current_plane.Rotate(angle * i, axis, current_pt) 
    width_interval = rg.Interval(-size *m.cos(i/l), size *m.cos(i/l)) #With cosine's periodic property (1 to -1)
    height_interval = rg.Interval(-size *m.cos(i/k), size *m.cos(i/k))
    my_points.append(current_pt)
    current_rec = rg.Rectangle3d(current_plane, width_interval, height_interval)
    rectangles.append(current_rec)
# ---------- end python_4 ----------

# Project_A_03 (Croissant)
number_slider_13 = Slider(4500, range=0..10000)
rectangle_2 = Rectangle(Plane="12000,10000,0", XSize=number_slider_13, YSize=number_slider_13, Radius=0)  # -> Rectangle, Length
python_5 = GhPythonScript(
    rec=rectangle_2.Rectangle,
    size=number_slider_9,
    number_of_shapes=number_slider_10,
    Radi=Slider(11, range=0..100),
    k=number_slider_12)  # -> out, rectangles, pts; inputs rec: Rectangle3d, number_of_shapes: Int32
# ---------- python_5: Python ----------
# input
# point - starting point
# size - size of rectangles
# number_of_shapes 

# output 
# rectangles - list of rectangles

import Rhino.Geometry as rg
import math as m
import random

my_points = []
vector = rg.Vector3d(1,0,0)
rectangles = []

def remap(old_val, old_min, old_max, new_min, new_max):
    return (new_max - new_min)*(old_val - old_min) / (old_max - old_min) + new_min

crv = rec.ToNurbsCurve()
crv.Domain = rg.Interval(0,1)

pts = []
l = k+7

for i in range(number_of_shapes):
    # pt + vec is moved_points
    t = remap(i, 0, number_of_shapes, 0, 1) #remap to make the curve domain periodic
    #abs(m.cos(i/10))
    current_pt = crv.PointAt(t) 
    print(t)
    pts.append(current_pt)
    current_plane = rg.Plane(current_pt, rg.Vector3d.XAxis, rg.Vector3d.YAxis)
    #rotate the plane
    angle = m.radians(Radi)
    axis = rg.Vector3d.ZAxis
    current_plane.Rotate(angle * i, axis, current_pt) 
    width_interval = rg.Interval(-size *m.cos(i/l), size *m.cos(i/l)) #With cosine's periodic property (1 to -1)
    height_interval = rg.Interval(-size *m.cos(i/k), size *m.cos(i/k))
    my_points.append(current_pt)
    current_rec = rg.Rectangle3d(current_plane, width_interval, height_interval)
    rectangles.append(current_rec)
# ---------- end python_5 ----------

# ---- group: Example
# Project A-0
number_slider_14 = Slider(10, range=1.2..10)
python_6 = GhPythonScript(
    size=number_slider_14,
    number_of_shapes=Slider(98, range=0..100),
    gap=Slider(14.46, range=0..100),
    Radi=Slider(5, range=0..100))  # -> out, rectangles, current_point; inputs number_of_shapes: Int32
# ---------- python_6: Python ----------
import Rhino.Geometry as rg
import math as m

pt = rg.Point3d(0,0,0)
my_points = []
vector = rg.Vector3d(1,0,0)
rectangles = []

for i in range(number_of_shapes):
    # pt + vec is moved_points
    current_pt = pt + vector * gap * i
    current_plane = rg.Plane(current_pt, rg.Vector3d.XAxis, rg.Vector3d.YAxis)
    #rotate the plane
    angle = m.radians(Radi)
    axis = rg.Vector3d.ZAxis
    current_plane.Rotate(angle * i, axis, current_pt) #Attribute
    width_interval = rg.Interval(-size/3 *(i+1), size/3 *(i+1))
    height_interval = rg.Interval(-size/3 *(i+1), size/3 *(i+1))
    my_points.append(current_pt)
    current_rec = rg.Rectangle3d(current_plane, width_interval, height_interval)
    rectangles.append(current_rec)
# ---------- end python_6 ----------

# ---- group: Project A
# Project A-01(Croissant)
number_slider_15 = Slider(3000, range=0..10000)
circle = Circle(Plane="5000,5000,0", Radius=number_slider_15)
python_7 = GhPythonScript(
    crv=circle,
    size=Slider(461, range=0..1000),
    number_of_shapes=Slider(202, range=0..300),
    Radi=Slider(15, range=0..100),
    k=Slider(8, range=1..50))  # -> out, rectangles, current_point; inputs crv: Curve, number_of_shapes: Int32
# ---------- python_7: Python ----------
import Rhino.Geometry as rg
import math as m
import random

my_points = []
vector = rg.Vector3d(1,0,0)
rectangles = []

def remap(old_val, old_min, old_max, new_min, new_max):
    return (new_max - new_min)*(old_val - old_min) / (old_max - old_min) + new_min

crv.Domain = rg.Interval(0,1)


for i in range(number_of_shapes):
    # pt + vec is moved_points
    t = remap(i, 0, number_of_shapes, 0, 1) #remap to make the curve domain periodic
    current_pt = crv.PointAt(t) 
    current_plane = rg.Plane(current_pt, rg.Vector3d.XAxis, rg.Vector3d.YAxis)
    #rotate the plane
    angle = m.radians(Radi)
    axis = rg.Vector3d.ZAxis
    current_plane.Rotate(angle * i, axis, current_pt) 
    width_interval = rg.Interval(-size *m.cos(i/k+1), size *m.cos(i/k+1)) #With cosine's periodic property (1 to -1)
    height_interval = rg.Interval(-size *m.cos(i/k+1), size *m.cos(i/k+1))
    print(m.cos(i/k+1))
    my_points.append(current_pt)
    current_rec = rg.Rectangle3d(current_plane, width_interval, height_interval)
    rectangles.append(current_rec)
# ---------- end python_7 ----------

# ----
# Project_A_04 (DoubleCosine)
number_slider_16 = Slider(942, range=0..1000)
python_3_script_6 = Python3Script(
    size=Slider(387, range=0..1000),
    number_of_shapes=number_slider_16,
    Radi=number_slider_11,
    k=Slider(15, range=1..20),
    freq=Slider(16, range=0..100),
    amplitude=Slider(760, range=0..1000))  # -> out, new_pts, rectangle; inputs number_of_shapes: Int32, Radi: Int32
# ---------- python_3_script_6: Python ----------
import Rhino.Geometry as rg
import math as m
import random

my_points = []
vector = rg.Vector3d(1,0,0)
rectangles = []

pl = rg.Plane(rg.Vector3d(19000, 10000, 0), rg.Vector3d(0,0,1))
rec_domain = rg.Interval(0, 4500)
rec = rg.Rectangle3d(pl, rec_domain, rec_domain)

rec_cv = rec.ToNurbsCurve()
rec_cv.Domain = rg.Interval(0,1)
print(rec_cv.Domain)

def remap(old_val, old_min, old_max, new_min, new_max):
    return (new_max - new_min)*(old_val - old_min) / (old_max - old_min) + new_min

pts = []
new_pts = []
length = rec_cv.GetLength()

rectangle = []

for i in range(number_of_shapes +1):
    t = i/ number_of_shapes
   
    success, cv_param = rec_cv.NormalizedLengthParameter(t);

    pt = rec_cv.PointAt(cv_param)
    pts.append(pt)

    tangent = rec_cv.TangentAt(t)
    tangent.Unitize()

    normal = rg.Vector3d.CrossProduct(tangent, pl.ZAxis)
    normal.Unitize()
    # Make pts of rectangle swing 
    wave = amplitude * m.cos(t * m.tau * freq)
    new_pt = pt + normal * wave
    new_pts.append(new_pt)


for i in range(len(new_pts)):
    pl = rg.Plane(new_pts[i], rg.Vector3d.XAxis, rg.Vector3d.YAxis) 

    width_interval = rg.Interval(-size * m.cos(i/k), size * m.cos(i/k))
    height_interval = rg.Interval(-size * m.cos(i/k), size * m.cos(i/k))
    current_rec = rg.Rectangle3d(pl, width_interval, height_interval)
    rectangle.append(current_rec)
# ---------- end python_3_script_6 ----------
curve_3 = Curve(python_3_script_6.rectangle)
point_3 = Point(python_3_script_6.new_pts)
custom_preview_4 = CustomPreview(Geometry=curve_3, Material=ColourSwatch(SwatchColor=RGB(0, 0, 0)))

# ----
# Project_A_04 (DoubleCosine)
number_slider_17 = Slider(358, range=0..1000)
python_3_script_7 = Python3Script(
    size=number_slider_17,
    number_of_shapes=Slider(362, range=0..1000),
    Radi=number_slider_11,
    k=Slider(9, range=1..20),
    l=Slider(15, range=1..20),
    freq=Slider(7, range=0..100),
    amplitude=Slider(644, range=0..1000))  # -> out, new_pts, rectangle; inputs number_of_shapes: Int32, Radi: Int32
# ---------- python_3_script_7: Python ----------
import Rhino.Geometry as rg
import math as m
import random

my_points = []
vector = rg.Vector3d(1,0,0)
rectangles = []

pl = rg.Plane(rg.Vector3d(19000, 10000, 0), rg.Vector3d(0,0,1))
rec_domain = rg.Interval(0, 4500)
rec = rg.Rectangle3d(pl, rec_domain, rec_domain)

rec_cv = rec.ToNurbsCurve()
rec_cv.Domain = rg.Interval(0,1)
print(rec_cv.Domain)

def remap(old_val, old_min, old_max, new_min, new_max):
    return (new_max - new_min)*(old_val - old_min) / (old_max - old_min) + new_min

pts = []
new_pts = []
length = rec_cv.GetLength()

rectangle = []

for i in range(number_of_shapes +1):
    t = i/ number_of_shapes
   
    success, cv_param = rec_cv.NormalizedLengthParameter(t);

    pt = rec_cv.PointAt(cv_param)
    pts.append(pt)

    tangent = rec_cv.TangentAt(t)
    tangent.Unitize()

    normal = rg.Vector3d.CrossProduct(tangent, pl.ZAxis)
    normal.Unitize()
    # Make pts of rectangle swing 
    wave = amplitude * m.cos(t * m.tau * freq)
    new_pt = pt + normal * wave
    new_pts.append(new_pt)


for i in range(len(new_pts)):
    pl = rg.Plane(new_pts[i], rg.Vector3d.XAxis, rg.Vector3d.YAxis) 

    width_interval = rg.Interval(-size * m.cos(i/k), size * m.cos(i/k))
    height_interval = rg.Interval(-size * m.cos(i/l), size * m.cos(i/l))
    current_rec = rg.Rectangle3d(pl, width_interval, height_interval)
    rectangle.append(current_rec)
# ---------- end python_3_script_7 ----------
curve_4 = Curve(python_3_script_7.rectangle)
point_4 = Point(python_3_script_7.new_pts)
custom_preview_5 = CustomPreview(Geometry=curve_4, Material=ColourSwatch(SwatchColor=RGB(0, 0, 0)))

number_slider_18 = Slider(10, range=0..100)
divide_curve = DivideCurve(Curve=python_7.rectangles, Count=10, Kinks=False)  # -> Points, Tangents, Parameters
