# Grasshopper definition ghpython_intro_02.gh (Grasshopper 1.0.8)

# ---- group: Tiling
py3 = Python3Script(x_count=Slider(8, range=0..10), y_count=Slider(8, range=0..10), seed=Slider(0, range=0..10))  # -> out, patterns; inputs x_count: Int32, y_count: Int32, seed: Int32
# ---------- py3: Python ----------
import Rhino.Geometry as rg
import ghpythonlib.treehelpers
import math as m
import random
from typing import Optional # this is only needed with python 3.9


class Tile():
    def __init__(self, origin: rg.Point3d, size: float=1):
        self.Origin = origin
        self.Size = size
        self.Corners = self.get_corners()
        self.Edges = self.get_edges()
        self.Patterns = self.paint()
    
    def get_corners(self) -> list[rg.Point3d]:
        o = self.Origin
        size = self.Size
        return [
            rg.Point3d(o.X+size/2, o.Y+size/2, 0),
            rg.Point3d(o.X-size/2, o.Y+size/2, 0),
            rg.Point3d(o.X-size/2, o.Y-size/2, 0),
            rg.Point3d(o.X+size/2, o.Y-size/2, 0),
        ]

    def get_edges(self) -> list[rg.Curve]:
        edges = []
        for i, corner in enumerate(self.Corners):
            neighbor = self.Corners[(i+1)%len(self.Corners)]
            edges.append(rg.LineCurve(corner, neighbor))
        return edges
    
    def paint(self, flags: Optional[list[bool]] = None) -> list[rg.Curve]:
        patterns = []
        if not flags:
            flags = [random.randint(0, 1) for i in range(4)]

        for corner, flag in zip(self.Corners, flags):
            if flag:
                vec = corner - self.Origin
                arc_start = self.Origin + rg.Vector3d(vec.X,0,0)
                arc_end = self.Origin + rg.Vector3d(0, vec.Y, 0)
                tangent = self.Origin - arc_start
                arc = rg.Arc(arc_start, tangent, arc_end)

                crv = rg.Curve.JoinCurves(
                    [
                        rg.LineCurve(arc_start, corner),
                        rg.LineCurve(corner, arc_end),
                        arc.ToNurbsCurve()
                    ]
                )

                patterns.extend(crv)
        return patterns

# populate to 2D grid
patterns = []
random.seed(seed) # try to comment this out and see what happend
for i in range(x_count):
    for j in range(y_count):
        origin = rg.Point3d(i, j, 0)
        tile = Tile(origin)
        patterns.extend(tile.Patterns)
# ---------- end py3 ----------

# ----
py3_2 = Python3Script(x_count=Slider(8, range=0..10), y_count=Slider(8, range=0..10), seed=Slider(0, range=0..10))  # -> out, patterns; inputs x_count: Int32, y_count: Int32, seed: Int32
# ---------- py3_2: Python ----------
import Rhino.Geometry as rg
import ghpythonlib.treehelpers
import math as m
import random
from typing import Optional # this is only needed with python 3.9


class Tile():
    def __init__(self, origin: rg.Point3d, size: float=1, flags: Optional[list[bool]] = None):
        self.Origin = origin
        self.Size = size
        self.Corners = self.get_corners()
        self.Edges = self.get_edges()
        self.Patterns = self.paint(flags= flags)
    
    def get_corners(self) -> list[rg.Point3d]:
        o = self.Origin
        size = self.Size
        return [
            rg.Point3d(o.X+size/2, o.Y+size/2, 0),
            rg.Point3d(o.X-size/2, o.Y+size/2, 0),
            rg.Point3d(o.X-size/2, o.Y-size/2, 0),
            rg.Point3d(o.X+size/2, o.Y-size/2, 0),
        ]

    def get_edges(self) -> list[rg.Curve]:
        edges = []
        for i, corner in enumerate(self.Corners):
            neighbor = self.Corners[(i+1)%len(self.Corners)]
            edges.append(rg.LineCurve(corner, neighbor))
        return edges
    
    def paint(self, flags: Optional[list[bool]] = None) -> list[rg.Curve]:
        patterns = []
        if not flags:
            flags = [random.randint(0, 1) for i in range(4)]

        for corner, flag in zip(self.Corners, flags):
            if flag:
                vec = corner - self.Origin
                arc_start = self.Origin + rg.Vector3d(vec.X,0,0)
                arc_end = self.Origin + rg.Vector3d(0, vec.Y, 0)
                tangent = self.Origin - arc_start
                arc = rg.Arc(arc_start, tangent, arc_end)

                crv = rg.Curve.JoinCurves(
                    [
                        rg.LineCurve(arc_start, corner),
                        rg.LineCurve(corner, arc_end),
                        arc.ToNurbsCurve()
                    ]
                )

                patterns.extend(crv)
        return patterns

# populate to 2D grid
patterns = []
random.seed(seed) # try to comment this out and see what happend
for i in range(x_count):
    for j in range(y_count):
        origin = rg.Point3d(i, j, 0)
        tile = Tile(origin)
        patterns.extend(tile.Patterns)
# ---------- end py3_2 ----------
data = Data(py3_2.patterns)

crv = Curve(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)
py3_3 = Python3Script(x_count=Slider(50, range=0..50), y_count=Slider(50, range=0..50), crv=crv)  # -> out, patterns; inputs x_count: Int32, y_count: Int32, crv: Curve
# ---------- py3_3: Python ----------
import Rhino.Geometry as rg
import ghpythonlib.treehelpers
import math as m
import random
from typing import Optional # this is only needed with python 3.9


class Tile():
    def __init__(self, origin: rg.Point3d, size: float=1, flags: Optional[list[bool]] = None):
        self.Origin = origin
        self.Size = size
        self.Corners = self.get_corners()
        self.Edges = self.get_edges()
        self.Patterns = self.paint(flags= flags)
    
    def get_corners(self) -> list[rg.Point3d]:
        o = self.Origin
        size = self.Size
        return [
            rg.Point3d(o.X+size/2, o.Y+size/2, 0),
            rg.Point3d(o.X-size/2, o.Y+size/2, 0),
            rg.Point3d(o.X-size/2, o.Y-size/2, 0),
            rg.Point3d(o.X+size/2, o.Y-size/2, 0),
        ]

    def get_edges(self) -> list[rg.Curve]:
        edges = []
        for i, corner in enumerate(self.Corners):
            neighbor = self.Corners[(i+1)%len(self.Corners)]
            edges.append(rg.LineCurve(corner, neighbor))
        return edges
    
    def paint(self, flags: Optional[list[bool]] = None) -> list[rg.Curve]:
        patterns = []
        if not flags:
            flags = [random.randint(0, 1) for i in range(4)]

        for corner, flag in zip(self.Corners, flags):
            if flag:
                vec = corner - self.Origin
                arc_start = self.Origin + rg.Vector3d(vec.X,0,0)
                arc_end = self.Origin + rg.Vector3d(0, vec.Y, 0)
                tangent = self.Origin - arc_start
                arc = rg.Arc(arc_start, tangent, arc_end)

                crv = rg.Curve.JoinCurves(
                    [
                        rg.LineCurve(arc_start, corner),
                        rg.LineCurve(corner, arc_end),
                        arc.ToNurbsCurve()
                    ]
                )

                patterns.extend(crv)
        return patterns

# populate to 2D grid
patterns = []
origins = []
distances = []
for i in range(x_count):
    for j in range(y_count):
        origin = rg.Point3d(i, j, 0)
        _, t = crv.ClosestPoint(origin)
        distance = origin.DistanceTo(crv.PointAt(t))
        
        origins.append(origin)
        distances.append(distance)
    
for origin, dist in zip(origins, distances):
    flag = (1-dist/max(distances))
    flag = int(flag // 0.25)
    flag = [True]*flag + [False]*(4-flag)
    tile = Tile(origin, flags= flag)
    patterns.extend(tile.Patterns)
# ---------- end py3_3 ----------
data_2 = Data(py3_3.patterns)

# ---- group: exercise
py3_4 = Python3Script(count=Slider(8, range=2..10))  # -> out, pts; inputs count: Int32
# ---------- py3_4: Python ----------
import Rhino.Geometry as rg
import numpy as np
import ghpythonlib.treehelpers

pts = []

# for i, j in zip(np.linspace(0,1,count), np.linspace(0,1,count)):
#     pts.append(rg.Point3d(i, j, 0))

# let's make it a 2D grid
# ---------- end py3_4 ----------

# ---- group: python editor
py3_5 = Python3Script(count=Slider(8, range=2..10))  # -> out, pts; inputs count: Int32
# ---------- py3_5: Python ----------
import Rhino.Geometry as rg
import numpy as np

pts = []
for i, j in zip(np.linspace(0,1,count), np.linspace(0,1,count)):
    pts.append(rg.Point3d(i, j, 0))
# ---------- end py3_5 ----------

# ---- group: python script instance
py3_6 = Python3Script(count=Slider(8, range=2..10))  # -> out, pts; inputs count: Int32
# ---------- py3_6: Python ----------
"""Grasshopper Script Instance"""
import System
import Rhino
import Grasshopper

import rhinoscriptsyntax as rs
import Rhino.Geometry as rg
import numpy as np


class MyComponent(Grasshopper.Kernel.GH_ScriptInstance):
    def RunScript(self, count: int):
        pts = []
        for i, j in zip(np.linspace(0,1,count), np.linspace(0,1,count)):
            pts.append(rg.Point3d(i, j, 0))
        return pts
# ---------- end py3_6 ----------

# ---- group: script_mode
py3_7 = Python3Script()  # -> out, script
# ---------- py3_7: Python ----------
from pathlib import Path

# get current gresshopper definition path
dir_name = Path(ghenv.Component.OnPingDocument().FilePath).parent
print (dir_name)

# point to script_mode.py
script_file = dir_name / "script_mode.py"

# read script_mode.py
with open(script_file, 'r') as fp:
    script = fp.read()
# ---------- end py3_7 ----------
py3_8 = Python3Script(script=py3_7.script, count=Slider(8, range=2..10))  # -> out, pts; inputs count: Int32; unedited script template

# ----
pt = Point(py3_5.pts)
pt_2 = Point(py3_4.pts)
data_3 = Data(py3.patterns)
