# Grasshopper definition 01.10.2026_201_robot_motion.gh (Grasshopper 1.0.8)

# ---- group: 180 rotation
py3 = Python3Script(res="100")  # -> out, st, ed, section; inputs res: Int32
# ---------- py3: Python ----------
import Rhino.Geometry as rg
import math as m 

def remap(value, old_min, old_max, new_min, new_max):
  return (value - old_min) * (new_max - new_min) / (
      old_max - old_min
  ) + new_min

st = []
ed = []


for i in range(res):
    t = i/(res-1)
    
    pln = rg.Plane(
        rg.Point3d(remap(t, 0, 1, 0, 50), -5, 0),
        rg.Vector3d.XAxis,
        rg.Vector3d.YAxis
    )

    t = abs(abs(t-0.5)-0.5)*2
    print (t)
    angle = remap(t, 0, 1, 0, m.pi)

    pln.Rotate(
        angle,
        rg.Vector3d.ZAxis,
        pln.Origin
    )

    st.append(pln.PointAt(0, 1))
    ed.append(pln.PointAt(0, -1))

section = [rg.LineCurve(s,e) for s, e in zip(st,ed)]
# ---------- end py3 ----------
preview = CustomPreview(Geometry=py3.st, Material=ColourSwatch(SwatchColor=RGB(0, 123, 255)))
preview_2 = CustomPreview(Geometry=py3.ed, Material=ColourSwatch(SwatchColor=RGB(221, 0, 255)))

# ---- group: 360 rotation
py3_2 = Python3Script(res="100")  # -> out, st, ed, section; inputs res: Int32
# ---------- py3_2: Python ----------
import Rhino.Geometry as rg
import math as m 

def remap(value, old_min, old_max, new_min, new_max):
  return (value - old_min) * (new_max - new_min) / (
      old_max - old_min
  ) + new_min

st = []
ed = []


for i in range(res):
    t = i/(res-1)
    
    pln = rg.Plane(
        rg.Point3d(remap(t, 0, 1, 0, 50), 0, 0),
        rg.Vector3d.XAxis,
        rg.Vector3d.YAxis
    )

    angle = remap(t, 0, 1, 0, 2*m.pi)

    pln.Rotate(
        angle,
        rg.Vector3d.ZAxis,
        pln.Origin
    )

    st.append(pln.PointAt(0, 1))
    ed.append(pln.PointAt(0, -1))

section = [rg.LineCurve(s,e) for s, e in zip(st,ed)]
# ---------- end py3_2 ----------
preview_3 = CustomPreview(Geometry=py3_2.st, Material=ColourSwatch(SwatchColor=RGB(0, 123, 255)))
preview_4 = CustomPreview(Geometry=py3_2.ed, Material=ColourSwatch(SwatchColor=RGB(221, 0, 255)))

# ----
crv = Curve([<curve referenced from the Rhino model> x2])
py3_3 = Python3Script()  # -> out, targets, viz; inputs crv: Curve
# ---------- py3_3: Python ----------
import Rhino.Geometry as rg
import math as m
import numpy as np

# draw a curve
if not crv:
    crv = rg.LineCurve(
        rg.Point3d(0,0,0),
        rg.Point3d(50,0,0)
    )

def preview_strokes(plns):
    pts_a = []
    pts_b = []

    for pln in plns:
        pts_a.append(pln.PointAt(0,1,0))
        pts_b.append(pln.PointAt(0,-1,0))
    
    ca = rg.Curve.CreateInterpolatedCurve(pts_a, 3)
    cb = rg.Curve.CreateInterpolatedCurve(pts_b, 3)

    return rg.NurbsSurface.CreateRuledSurface(ca, cb)

    
def stroke(crv, res, angle=0):
    targets = []

    crv.Domain = rg.Interval(0,1)
    
    for t in np.linspace(crv.Domain.Min, crv.Domain.Max, res+1):
        origin = crv.PointAt(t)
        tangent = crv.TangentAt(t)

        angle_t = abs(abs(t-0.5)-0.5)*2

        yaxis = rg.Vector3d.CrossProduct(tangent, rg.Vector3d.ZAxis)
        xaxis = tangent
        pln = rg.Plane(
                origin,
                xaxis,
                yaxis
        )

        pln.Rotate(
            m.radians(180*angle_t),
            pln.ZAxis,
            pln.Origin
        )

        pln.Rotate(
            m.radians(angle*angle_t),
            -pln.YAxis,
            pln.Origin
        )
        
        targets.append(pln)
    return targets



targets = stroke(crv, 20, 30)
viz = preview_strokes(targets)
# ---------- end py3_3 ----------
data = Data(py3_3.targets)
data_2 = Data(py3_3.viz)

data_3 = Data(py3.section)
data_4 = Data(py3_2.section)
python_3_script = Python3Script()  # -> out, plns, viz, sections
# ---------- python_3_script: Python ----------
import Rhino.Geometry as rg
import math as m


# generate dmy dummy planes

plns = []
for i in range(10):
    plns.append(
        rg.Plane(
            rg.Point3d(i,0,0), 
            rg.Vector3d.XAxis, 
            rg.Vector3d.YAxis))


#preview stroke

def preview_stroke(plns : list[rg.Plane], brush_width:float = 1):
#collection of end points of the brush
    pts_a = []
    pts_b = []
    sections = []

    for pln in plns:
        pt_a = pln.PointAt(0, brush_width/2, 0)
        pt_b = pln.PointAt(0, - brush_width/2, 0)

        pts_a.append(pt_a)
        pts_b.append(pt_b)
    
    sections = [rg.LinecCrve(pt_a,pt_b) for pt_a,pt_b in zip(pts_a,pts_b)]
    ca = rg.Curve.CreateInterpolatedCurve(pts_a,3)
    cb = rg.Curve.CreateInterpolatedCurve(pts_b,3)

    srf = rg.NurbsSurface.CreateRuledSurface(ca,cb)

    return srf,sections

viz, sections = preview_stroke(plns, brush_width=4)
# ---------- end python_3_script ----------
python_3_script_2 = Python3Script()  # -> out, plns, viz, sections
# ---------- python_3_script_2: Python ----------
import Rhino.Geometry as rg
import math as m


# generate dmy dummy planes

plns = []
for i in range(10):
    plns.append(
        rg.Plane(
            rg.Point3d(i,0,0), 
            rg.Vector3d.XAxis, 
            rg.Vector3d.YAxis))


#preview stroke

def preview_stroke(plns : list[rg.Plane], brush_width:float = 1):
#collection of end points of the brush
    pts_a = []
    pts_b = []
    sections = []

    for pln in plns:
        pt_a = pln.PointAt(0, brush_width/2, 0)
        pt_b = pln.PointAt(0, - brush_width/2, 0)

        pts_a.append(pt_a)
        pts_b.append(pt_b)
    
    sections = [rg.LineCurve(pt_a,pt_b) for pt_a,pt_b in zip(pts_a,pts_b)]
    ca = rg.Curve.CreateInterpolatedCurve(pts_a,3)
    cb = rg.Curve.CreateInterpolatedCurve(pts_b,3)

    srf = rg.NurbsSurface.CreateRuledSurface(ca,cb)

    return srf,sections

viz, sections = preview_stroke(plns, brush_width=4)
# ---------- end python_3_script_2 ----------
python_3_script_3 = Python3Script()  # -> out, plns, viz, sections, numbers
# ---------- python_3_script_3: Python ----------
import Rhino.Geometry as rg
import math as m


# generate dmy dummy planes

numbers = []
plns = []
res = 30
for i in range(res):
    t = i/(res-1)
    print(t)
    

    pln = rg.Plane(
        rg.Point3d(t*20,0,0),
        rg.Vector3d.XAxis,
        rg.Vector3d.YAxis
    )

    angle = m.radians(t*360)
    numbers.append(t*360)
    R = rg.Transform.Rotation(
        angle,
        pln.ZAxis,
        pln.Origin )
    
    pln.Transform(R)

    plns.append(pln)

#preview stroke

def preview_stroke(plns : list[rg.Plane], brush_width:float = 1):
#collection of end points of the brush
    pts_a = []
    pts_b = []
    sections = []

    for pln in plns:
        pt_a = pln.PointAt(0, brush_width/2, 0)
        pt_b = pln.PointAt(0, - brush_width/2, 0)

        pts_a.append(pt_a)
        pts_b.append(pt_b)
    
    sections = [rg.LineCurve(pt_a,pt_b) for pt_a,pt_b in zip(pts_a,pts_b)]
    ca = rg.Curve.CreateInterpolatedCurve(pts_a,3)
    cb = rg.Curve.CreateInterpolatedCurve(pts_b,3)

    srf = rg.NurbsSurface.CreateRuledSurface(ca,cb)

    return srf,sections

viz, sections = preview_stroke(plns, brush_width=4)
# ---------- end python_3_script_3 ----------
python_3_script_4 = Python3Script()  # -> out, plns, viz, sections
# ---------- python_3_script_4: Python ----------
import Rhino.Geometry as rg
import math as m


# generate dmy dummy planes

plns = []
for i in range(10):
    plns.append(
        rg.Plane(
            rg.Point3d(i,0,0), 
            rg.Vector3d.XAxis, 
            rg.Vector3d.YAxis))


#preview stroke

def preview_stroke(plns : list[rg.Plane], brush_width:float = 1):
#collection of end points of the brush
    pts_a = []
    pts_b = []
    sections = []

    for pln in plns:
        pt_a = pln.PointAt(0, brush_width/2, 0)
        pt_b = pln.PointAt(0, - brush_width/2, 0)

        pts_a.append(pt_a)
        pts_b.append(pt_b)

    ca = rg.Curve.CreateInterpolatedCurve(pts_a,3)
    cb = rg.Curve.CreateInterpolatedCurve(pts_b,3)

    srf = rg.NurbsSurface.CreateRuledSurface(ca,cb)

    sections.append(rg.Line(pt_a,pt_b))

    return srf,sections

viz, sections = preview_stroke(plns, brush_width=4)
print(viz)
# ---------- end python_3_script_4 ----------
python_3_script_5 = Python3Script()  # -> out, plns, viz, sections, numbers
# ---------- python_3_script_5: Python ----------
import Rhino.Geometry as rg
import math as m


# generate dmy dummy planes

numbers = []
plns = []
res = 30
for i in range(res):
    t = i/(res-1)
    print(t)
    

    pln = rg.Plane(
        rg.Point3d(t*30,-5,0),
        rg.Vector3d.XAxis,
        rg.Vector3d.YAxis
    )

    t = 1-(abs(t-0.5)*2)

    angle = t*180
    numbers.append(angle)

    R = rg.Transform.Rotation(
        m.radians(angle),
        pln.ZAxis,
        pln.Origin )
    
    pln.Transform(R)
    plns.append(pln)

#preview stroke

def preview_stroke(plns : list[rg.Plane], brush_width:float = 1):
#collection of end points of the brush
    pts_a = []
    pts_b = []
    sections = []

    for pln in plns:
        pt_a = pln.PointAt(0, brush_width/2, 0)
        pt_b = pln.PointAt(0, - brush_width/2, 0)

        pts_a.append(pt_a)
        pts_b.append(pt_b)
    
    sections = [rg.LineCurve(pt_a,pt_b) for pt_a,pt_b in zip(pts_a,pts_b)]
    ca = rg.Curve.CreateInterpolatedCurve(pts_a,3)
    cb = rg.Curve.CreateInterpolatedCurve(pts_b,3)

    srf = rg.NurbsSurface.CreateRuledSurface(ca,cb)

    return srf,sections

viz, sections = preview_stroke(plns, brush_width=1)
# ---------- end python_3_script_5 ----------
end_points = EndPoints(Curve=python_3_script.sections)  # -> Start, End
end_points_2 = EndPoints(Curve=python_3_script_2.sections)  # -> Start, End
end_points_3 = EndPoints(Curve=python_3_script_3.sections)  # -> Start, End
end_points_4 = EndPoints(Curve=python_3_script_5.sections)  # -> Start, End
data_5 = Data(python_3_script.viz)
data_6 = Data(python_3_script_2.viz)
data_7 = Data(python_3_script_3.viz)
data_8 = Data(python_3_script_4.viz)
data_9 = Data(python_3_script_5.viz)
quick_graph = QuickGraph(python_3_script_3.numbers, SortOrder=0)
quick_graph_2 = QuickGraph(python_3_script_5.numbers, SortOrder=0)
curve = Curve(<curve referenced from the Rhino model>)
custom_preview = CustomPreview(
    Geometry=data_5,
    Material={diffuse=RGB(221, 160, 221), emission=RGB(66, 48, 66), shine=0.5, specular=RGB(255, 255, 255), transparency=0})
custom_preview_2 = CustomPreview(
    Geometry=end_points.Start,
    Material={diffuse=RGB(221, 160, 221), emission=RGB(66, 48, 66), shine=0.5, specular=RGB(255, 255, 255), transparency=0})
custom_preview_3 = CustomPreview(Geometry=end_points.End, Material=ColourSwatch(SwatchColor=RGB(57, 198, 255)))
custom_preview_4 = CustomPreview(
    Geometry=data_6,
    Material={diffuse=RGB(221, 160, 221), emission=RGB(66, 48, 66), shine=0.5, specular=RGB(255, 255, 255), transparency=0})
custom_preview_5 = CustomPreview(
    Geometry=data_7,
    Material={diffuse=RGB(221, 160, 221), emission=RGB(66, 48, 66), shine=0.5, specular=RGB(255, 255, 255), transparency=0})
custom_preview_6 = CustomPreview(
    Geometry=end_points_2.Start,
    Material={diffuse=RGB(221, 160, 221), emission=RGB(66, 48, 66), shine=0.5, specular=RGB(255, 255, 255), transparency=0})
custom_preview_7 = CustomPreview(
    Geometry=end_points_3.Start,
    Material={diffuse=RGB(221, 160, 221), emission=RGB(66, 48, 66), shine=0.5, specular=RGB(255, 255, 255), transparency=0})
custom_preview_8 = CustomPreview(Geometry=end_points_2.End, Material=ColourSwatch(SwatchColor=RGB(57, 198, 255)))
custom_preview_9 = CustomPreview(Geometry=end_points_3.End, Material=ColourSwatch(SwatchColor=RGB(57, 198, 255)))
custom_preview_10 = CustomPreview(
    Geometry=python_3_script_5.sections,
    Material={diffuse=RGB(221, 160, 221), emission=RGB(66, 48, 66), shine=0.5, specular=RGB(255, 255, 255), transparency=0})
custom_preview_11 = CustomPreview(
    Geometry=end_points_4.Start,
    Material={diffuse=RGB(221, 160, 221), emission=RGB(66, 48, 66), shine=0.5, specular=RGB(255, 255, 255), transparency=0})
custom_preview_12 = CustomPreview(Geometry=end_points_4.End, Material=ColourSwatch(SwatchColor=RGB(57, 198, 255)))
python_3_script_6 = Python3Script(curve=curve)  # -> out, pen, plns, viz_srf, viz_section; inputs curve: Curve
# ---------- python_3_script_6: Python ----------
import Rhino.Geometry as rg
import math as m

# create a dummy curve


if not curve:
    rg.LineCurve(
        rg.Point3d(0,0,0),
        rg.Point3d(50,0,0)
    )
    
a = curve

def create_stroke(crv,res,angle):
    crv.Domain = rg.Interval(0,1)
    plns = []

    for i in range(res):
        t  = i / (res-1)

        origin = crv.PointAt(t)
        tangent = crv.TangentAt(t)
        xaxis = tangent
        yaxis = rg.Vector3d.CrossProduct(tangent, rg.Vector3d.ZAxis)
        
        pln = rg.Plane(origin,xaxis,yaxis)

        t = 1 - abs(t-0.5)*2

        pln.Rotate(
            m.radians(180*t),
            pln.ZAxis,
            pln.Origin
            )

        pln.Rotate(
            m.radians(-angle*t),
            pln.YAxis,
            pln.Origin    
        )


        

        plns.append(pln)
    return plns

#preview stroke

def preview_stroke(plns : list[rg.Plane], brush_width:float = 1):
#collection of end points of the brush
    pts_a = []
    pts_b = []
    sections = []

    for pln in plns:
        pt_a = pln.PointAt(0, brush_width/2, 0)
        pt_b = pln.PointAt(0, - brush_width/2, 0)

        pts_a.append(pt_a)
        pts_b.append(pt_b)
    
    sections = [rg.LineCurve(pt_a,pt_b) for pt_a,pt_b in zip(pts_a,pts_b)]
    ca = rg.Curve.CreateInterpolatedCurve(pts_a,3)
    cb = rg.Curve.CreateInterpolatedCurve(pts_b,3)

    srf = rg.NurbsSurface.CreateRuledSurface(ca,cb)

    return srf,sections

plns = create_stroke(curve,res=20,angle=30)


pen = []

for pln in plns:
    p = rg.LineCurve(
        pln.Origin,
        pln.Origin + pln.ZAxis * -50,
    )

    pen.append(p)


viz_srf, viz_section = preview_stroke(plns, brush_width=2)
# ---------- end python_3_script_6 ----------
