# Grasshopper definition 101_roboting FOR U!.gh (Grasshopper 1.0.8)
# plug-ins: Bifocals

number_slider = Slider(297, range=0..1000)  # disabled
number_slider_2 = Slider(420, range=0..1000)  # disabled
number_slider_3 = Slider(3280, range=0..10000)  # disabled
number_slider_4 = Slider(37.5, range=0..100)  # disabled
number_slider_5 = Slider(50, range=0..100)  # disabled
number_slider_6 = Slider(10, range=0..10)  # disabled
number_slider_7 = Slider(25, range=0..100)  # disabled
python_3_script = Python3Script(l=number_slider_2, w=number_slider, p=number_slider_4, q=number_slider_5, r=number_slider_6, s=number_slider_7)  # -> out, bound, pt_list; inputs p: Double, r: Int32; disabled
# ---------- python_3_script: Python ----------
import Rhino.Geometry as rg
from ghpythonlib import treehelpers as th

bound = rg.Rectangle3d(rg.Plane.WorldXY,l,w)
pt_list = []
start = rg.Point3d(q,p,0)
pt_list.append(start)
for ra in range(r):
    to_end = l - 2*q
    if ra % 2 == 0:
        start += rg.Vector3d(to_end, 0, 0)
    else:
        start += rg.Vector3d(-to_end, 0, 0)
    pt_list.append(start)
    start += rg.Vector3d(0, s, 0)
    pt_list.append(start)
# ---------- end python_3_script ----------
polyline = PolyLine(Vertices=python_3_script.pt_list, Closed=False)  # -> reparameterize(Polyline); disabled
length = Length(Curve=polyline)  # disabled
discontinuity = Discontinuity(Curve=polyline, Level=1)  # -> Points, Parameters; disabled
division = Division(A=number_slider_3, B=length)  # disabled
smaller_than = SmallerThan(FirstNumber=discontinuity.Parameters, SecondNumber=division)  # -> SmallerThan, OrEqualTo; disabled
evaluate_curve = EvaluateCurve(Curve=polyline, Parameter=division)  # -> Point, Tangent, Angle; disabled
cull_pattern = CullPattern(List=discontinuity.Points, CullPattern=smaller_than.OrEqualTo)  # disabled
number_slider_8 = Slider(0, range=0..180)  # disabled
construct_point = ConstructPoint(XCoordinate=expr("x/2", number_slider_2), YCoordinate=expr("x/2", number_slider), ZCoordinate=0)  # disabled
merge = Merge(Data1=flatten(cull_pattern), Data2=flatten(evaluate_curve.Point))  # disabled
radians = Radians(Degrees=number_slider_8)  # disabled
xy_plane = XYPlane(Origin=construct_point)  # disabled
xy_plane_2 = XYPlane(Origin=merge)  # disabled
rotate = Rotate(Geometry=xy_plane_2, Angle=radians, Plane=xy_plane)  # -> Geometry, Transform; disabled

number_slider_9 = Slider(2.5, range=0..10)  # disabled
number_slider_10 = Slider(2, range=0..10)  # disabled
number_slider_11 = Slider(50, range=0..100)  # disabled
number_slider_12 = Slider(49, range=0..100)  # disabled
expression = Expression(x=number_slider_12, y=number_slider_10, Expression="x/2+x*y")  # disabled
expression_2 = Expression(x=number_slider_12, y=number_slider_9, Expression="x/2+x*y")  # disabled
number_slider_13 = Slider(45, range=0..100)  # disabled
vector_xyz = VectorXYZ(XComponent=number_slider_12, YComponent=0, ZComponent=0)  # -> expr("-x", Vector), Length; disabled
vector_xyz_2 = VectorXYZ(XComponent=0, YComponent=expr("x/2", expression), ZComponent=0)  # -> Vector, Length; disabled
vector_xyz_3 = VectorXYZ(XComponent=0, YComponent=expr("x/2", expression_2), ZComponent=0)  # -> Vector, Length; disabled
edges = Python3Script(resolution=number_slider_13, v=vector_xyz.Vector)  # -> out, pts, pls; inputs resolution: Int32, v: Vector3d; disabled
# ---------- edges: Python ----------
import Rhino.Geometry as rg
# Here we need to import math and itertools 
import math as m

pts = []
start_pt = rg.Point3d(1,0,0)
pls = []
pt = start_pt

for i in range(resolution):
    
    if i % 9 == 0:
        
        yv =  rg.Vector3d(0, 40, 0)
        pt = pt + yv

        pts.append(pt)
        # pl = rg.Plane(pt, rg.Vector3d.XAxis, rg.Vector3d.YAxis)
        pl = rg.Plane(pt, rg.Vector3d.ZAxis)
        pls.append(pl)
        v = v * (-1)
    else:
        pt = pt + v

        pts.append(pt)
        pl = rg.Plane(pt, rg.Vector3d.ZAxis)
        pls.append(pl)
# ---------- end edges ----------
plane = Plane(edges.pls)  # disabled
move = Move(Geometry=edges.pls, Motion=vector_xyz_2.Vector)  # -> Geometry, Transform; disabled
move_2 = Move(Geometry=edges.pls, Motion=vector_xyz_3.Vector)  # -> Geometry, Transform; disabled
list_item = ListItem(List=plane, Index=0, Wrap=True)  # disabled
interpolate = Interpolate(Vertices=edges.pls, Degree=1, Periodic=False, KnotStyle=1)  # -> Curve, Length, Domain; disabled

pt = ConstructPoint(XCoordinate=Slider(197, range=0..420), YCoordinate=Slider(142, range=0..297), ZCoordinate=Slider(0, range=0..100))

number_slider_14 = Slider(60, range=0..100)
number_slider_15 = Slider(10, range=0..10)
number_slider_16 = Slider(99, range=0..100)
vector_xyz_4 = VectorXYZ(XComponent=Slider(325, range=0..1000), YComponent=Slider(100, range=0..1000), ZComponent=0)  # -> Vector, Length

edges_2 = Python3Script(
    number=Slider(24, range=0..100),
    x=Slider(10, range=0..10),
    k=Slider(3, range=0..10),
    conpre_depth=Slider(-10, range=-10..10),
    move_vec=vector_xyz_4.Vector)  # -> out, pts, pls, move_pls; inputs number: Int32, k: Int32, conpre_depth: Int32, move_vec: Vector3d
# ---------- edges_2: Python ----------
import Rhino.Geometry as rg
import math as m


pts = []
pt = rg.Point3d(2,2,10)
pls = []

for i in range(number):
    v_straight = rg.Vector3d(x, 0, 0)
    v_2 = rg.Vector3d(-x, x/1.5, 0)

    if i % k == 0:
        pt = pt + v_2

        pts.append(pt)
        pl = rg.Plane(pt, rg.Vector3d.XAxis, rg.Vector3d.YAxis)
        rotate_matrix = rg.Transform.Rotation(m.radians(-10), rg.Vector3d.YAxis, pl.Origin)
        pl.Transform(rotate_matrix)
        pls.append(pl)
    else:
        pt = pt + v_straight
        # define how depth of brush conpression
        z_conpression = rg.Vector3d(0, 0, conpre_depth)
        pt += z_conpression

        pts.append(pt)
        pls.append(rg.Plane(pt, rg.Vector3d.XAxis, rg.Vector3d.YAxis))
        # pt go back
        pt -= z_conpression
        

move_pls = []
for pl in pls:
    matrix = rg.Transform.Translation(move_vec)
    pl.Transform(matrix)
    move_pls.append(pl)
# ---------- end edges_2 ----------
point = Point(edges_2.pts)
polyline_2 = PolyLine(Vertices=point, Closed=False)

point_2 = Point(Point(51.54266486, 137.1539194, 68.48068432))
point_3 = Point(Point(240.0220358, 202.6355959, 68.48068432))
point_4 = Point(Point(64.85881538, 73.47977868, 68.48068432))
brep = Brep(<brep referenced from the Rhino model>)

# ----
# 1. Transformations
# 
# original = blue
# transformed = magenta
number_slider_17 = Slider(34, range=0..100)
edges_3 = Python3Script(freq=Slider(5, range=0..6), amplitude=number_slider_17)  # -> out, flower; inputs freq: Int32
# ---------- edges_3: Python ----------
import Rhino.Geometry as rg
# Here we need to import math and itertools 
import math as m


def draw_cool_circle(resolution = 50, radius = 100, amplitude = 30, frequency = 3):
    pts = [] 

    for i in range(resolution):
        theta = i/(resolution-1)*m.tau
        
        # play with the radius
        r = radius + m.sin(theta*frequency) * amplitude

        pts.append(
            rg.Point3d(
                r*m.cos(theta),
                r*m.sin(theta),
                0
            )
        )

    return rg.Curve.CreateInterpolatedCurve(
        pts,
        3
    )

flower = draw_cool_circle(frequency = freq, amplitude= amplitude)
# ---------- end edges_3 ----------
transformations = Python3Script(curve=edges_3.flower, origin=point_4, xaxis_pt=point_3, xy_point=point_2, brep=brep)  # -> out, transformed, plane; inputs curve: Curve, origin: Point3d, xaxis_pt: Point3d, xy_point: Point3d
# ---------- transformations: Python ----------
import Rhino.Geometry as rg
import math

translation = rg.Vector3d(100, 200, 0)

# Build the transform...
T = rg.Transform.Translation(translation)
# Make a copy
transformed = curve.DuplicateCurve()
# Apply transformation
transformed.Transform(T)

curve = transformed

angle = math.pi/2 # 90 degree
axis = rg.Vector3d.ZAxis
point = rg.Point3d(0,0,0)
T = rg.Transform.Rotation(angle, axis, point)

# make a copy
transformated = curve.DuplicateCurve()
#Apply transformation 
transformed.Transform(T)

# create a plane
xvector =  xaxis_pt - origin 
yvector =  xy_point - origin  
plane = rg.Plane(origin, xvector, yvector)


# trandform from plane to plane 
T = rg.Transform.PlaneToPlane(rg.Plane.WorldXY, plane) 
# make a copy
transformated = curve.DuplicateCurve()
#Apply transformation 
transformed.Transform(T)

#get top face
# ---------- end transformations ----------
custom_preview = CustomPreview(Geometry=transformations.transformed, Material=ColourSwatch(SwatchColor=RGB(255, 0, 212)))

custom_preview_2 = CustomPreview(Geometry=edges_3.flower, Material=ColourSwatch(SwatchColor=RGB(0, 42, 255)))
unit_z = UnitZ(Factor=1)
negative = Negative(Value=unit_z)
plane_2 = Plane(transformations.plane)
plane_3 = Plane(edges_2.move_pls)

pt_2 = ConstructPoint(XCoordinate="531.89", YCoordinate="531.99", ZCoordinate="-9.55")

pt_3 = ConstructPoint(XCoordinate="112.10", YCoordinate="527.50", ZCoordinate="-8.93")

pt_4 = ConstructPoint(XCoordinate="533.99", YCoordinate="235.29", ZCoordinate="-10.39")

pt_5 = ConstructPoint(XCoordinate="531.45", YCoordinate="531.61", ZCoordinate="-9.40")

pt_6 = ConstructPoint(XCoordinate="111.85", YCoordinate="528.15", ZCoordinate="-8.55")

pt_7 = ConstructPoint(XCoordinate="534.18", YCoordinate="234.98", ZCoordinate="-9.75")

# ----
# Step 2: rotate the plane to follow tiled brush
number_slider_18 = Slider(-6, range=-20..20)
expression_3 = Expression(x=pt_5, y=pt_6, z=pt_7, Expression="1/2*(y-x) + 1/2*(z-x)")
plane_4 = Plane(plane_3)
number_slider_19 = Slider(0.1, range=0..0.1)
number_slider_20 = Slider(0.1, range=0..0.1)

# ----
# Measure in paint location
number_slider_21 = Slider(100, range=0..100)
pt_8 = ConstructPoint(XCoordinate="213.11", YCoordinate="146.73", ZCoordinate="-7.5")

# ----
# MEASURE TCP!
panel = Panel("0.63")
pt_9 = ConstructPoint(XCoordinate=panel, YCoordinate="-0.4", ZCoordinate="143.49")

number_slider_22 = Slider(-90, range=-360..360)

number_slider_23 = Slider(1, range=0..1)
number_slider_24 = Slider(1, range=0..1)

merge_2 = Merge()

# ----
# 3. Send a simple set of commands to robot
# Transform from Rhino to Robot Space
# 
# 1. Measure points on workspace as three corners
# 2. Make sure the coordinates are in "base" mode
# Generate Geometry
# Convert Planes to URScript
# Send to Robot!
number_slider_25 = Slider(9, range=0..100)
edges_4 = Python3Script(freq=Slider(6, range=0..100), amplitude=number_slider_25, radius=Slider(85, range=0..200), res=Slider(51, range=0..100))  # -> out, flower, flower_planes; inputs freq: Int32, amplitude: Int32, radius: Double, res: Int32
# ---------- edges_4: Python ----------
import Rhino.Geometry as rg
# Here we need to import math and itertools 
import math as m


def draw_cool_circle(resolution = 50, radius = 100, amplitude = 30, frequency = 3):
    pts = [] 
    circle_planes = []

    for i in range(resolution):
        theta = i/(resolution-1)*m.tau
        
        # play with the radius
        r = radius + m.sin(theta*frequency) * amplitude
        pt = rg.Point3d(
                r*m.cos(theta),
                r*m.sin(theta),
                0
            )

        pts.append(pt)
        circle_planes.append(rg.Plane(pt, rg.Vector3d.XAxis, rg.Vector3d.YAxis))

    return rg.Curve.CreateInterpolatedCurve(
        pts,
        3
    ), circle_planes

flower, flower_planes = draw_cool_circle(resolution = res, radius = radius, amplitude= amplitude, frequency = freq)
# ---------- end edges_4 ----------
fine_adjust_z_mm = Slider(-2.5, range=-5..10)

curve_closest_point = CurveClosestPoint(Point=edges_4.flower_planes, Curve=edges_4.flower)  # -> Point, Parameter, Distance
curve = Curve(edges_4.flower)
evaluate_curve_2 = EvaluateCurve(Curve=curve, Parameter=curve_closest_point.Parameter)  # -> Point, Tangent, Angle

# ----
# Step 1: Turn Y-axis to align the line (tangent)
amplitude = Amplitude(Vector=evaluate_curve_2.Tangent, Amplitude=Slider(13, range=0..100))
vector_display = VectorDisplay(Anchor=evaluate_curve_2.Point, Vector=amplitude)

construct_plane = ConstructPlane(Origin=evaluate_curve_2.Point, XAxis=negative, YAxis=evaluate_curve_2.Tangent)
rotate_3d = Rotate3D(
    Geometry=construct_plane,
    Angle=degrees(Slider(90, range=-90..90)),
    Center=evaluate_curve_2.Point,
    Axis=evaluate_curve_2.Tangent)  # -> Geometry, Transform
deconstruct_plane = DeconstructPlane(Plane=rotate_3d.Geometry)  # -> Origin, XAxis, YAxis, ZAxis
transform = Python3Script(way_planes=plane_4, wobj_origin=pt_5, wobj_xaxis=pt_6, wobj_xypoint=pt_7, z_safe_margin=fine_adjust_z_mm)  # -> out, transformed_planes; inputs way_planes: list of Plane, wobj_origin: Point3d, wobj_xaxis: Point3d, wobj_xypoint: Point3d, z_safe_margin: Double
# ---------- transform: Python ----------
import Rhino.Geometry as rg
import math

# in this step we transform our way planes to robot space
# the rhino co-ordinate system is rather abstract in the physical world
# the robot base plane assumed the base frame of robot is the origin
# we want the Rhino space to correspond to the paper space
# we transform things from our design space(Rhino World XY) to Robot Base Plane that we measure


def set_robot_base(origin, xaxis, xypoint):
    """
    set a base plane representing the robot working object plane
    """
    robot_base = rg.Plane(origin, xaxis - origin, xypoint - origin)
    # v = 1/2*(xaxis - origin) + 1/2*(xypoint - origin)
    # v_move = rg.Transform.Translation(v)
    # robot_base.Transform(v_move)
    print (robot_base)
    return (robot_base)

def rhino_to_robot_space(rhino_plane,robot_base_plane):
    """
    Transform the objects from Rhino world XY plane to robot work object plane
    """
    T_matrix = rg.Transform.PlaneToPlane(rg.Plane.WorldXY,robot_base_plane)
    robot_plane = rhino_plane.Clone()
    # Invert plane to face Z down
    R = rg.Transform.Rotation(math.pi, rhino_plane.XAxis, rhino_plane.Origin)
    robot_plane.Transform(R)
    robot_plane.Transform(T_matrix)
    return robot_plane

def set_z_safe_margin(planes_to_adjust, safety_margin):
    adjusted_way_planes = []
    for plane in planes_to_adjust:
        plane.OriginZ += safety_margin
        adjusted_way_planes.append(plane)
    return adjusted_way_planes

# ===== Robot base is set =====
robot_base =  set_robot_base(wobj_origin, wobj_xaxis, wobj_xypoint)

# ===== Set safety margin for Z height ======
safer_planes = set_z_safe_margin(way_planes, z_safe_margin)

# ===== Transforming the rhino planes into robot planes =====
transformed_planes = []
for plane in way_planes: 
    transformed_planes.append(rhino_to_robot_space(plane, robot_base))
# ---------- end transform ----------
transform_2 = Python3Script(way_planes=edges_4.flower_planes, wobj_origin=pt_5, wobj_xaxis=pt_6, wobj_xypoint=pt_7, z_safe_margin=fine_adjust_z_mm)  # -> out, transformed_planes; inputs way_planes: list of Plane, wobj_origin: Point3d, wobj_xaxis: Point3d, wobj_xypoint: Point3d, z_safe_margin: Double
# ---------- transform_2: Python ----------
import Rhino.Geometry as rg
import math

# in this step we transform our way planes to robot space
# the rhino co-ordinate system is rather abstract in the physical world
# the robot base plane assumed the base frame of robot is the origin
# we want the Rhino space to correspond to the paper space
# we transform things from our design space(Rhino World XY) to Robot Base Plane that we measure


def set_robot_base(origin, xaxis, xypoint):
    """
    set a base plane representing the robot working object plane
    """
    robot_base = rg.Plane(origin, xaxis - origin, xypoint - origin)
    v = 1/2*(xaxis - origin) + 1/2*(xypoint - origin)
    v_matrix = rg.Transform.Translation(v)
    robot_base.Transform(v_matrix)
    
    return (robot_base)

def rhino_to_robot_space(rhino_plane,robot_base_plane):
    """
    Transform the objects from Rhino world XY plane to robot work object plane
    """

    move_vector = robot_base_plane.Origin - rhino_plane.Origin
    robot_plane = robot_base_plane.Clone()
    robot_plane.Translate(move_vector)

    # Invert plane to face Z down
    # R = rg.Transform.Rotation(math.pi, rhino_plane.XAxis, rhino_plane.Origin)
    # robot_plane.Transform(R)
    # robot_plane.Transform(T_matrix)
    return robot_plane



def set_z_safe_margin(planes_to_adjust, safety_margin):
    adjusted_way_planes = []
    for plane in planes_to_adjust:
        plane.OriginZ += safety_margin
        adjusted_way_planes.append(plane)
    return adjusted_way_planes

# ===== Robot base is set =====
robot_base =  set_robot_base(wobj_origin, wobj_xaxis, wobj_xypoint)

# ===== Set safety margin for Z height ======
safer_planes = set_z_safe_margin(way_planes, z_safe_margin)

# ===== Transforming the rhino planes into robot planes =====
transformed_planes = []
for plane in way_planes: 
    transformed_planes.append(rhino_to_robot_space(plane, robot_base))
# ---------- end transform_2 ----------
rotate_3d_2 = Rotate3D(
    Geometry=rotate_3d.Geometry,
    Angle=degrees(number_slider_18),
    Center=deconstruct_plane.Origin,
    Axis=deconstruct_plane.XAxis)  # -> reverse(Geometry), Transform
shift_list = ShiftList(List=rotate_3d_2.Geometry, Shift=Slider(0, range=0..100), Wrap=True)
# Step 3: Ajust manually to fit the limits of Wrist 3
deconstruct_plane_2 = DeconstructPlane(Plane=rotate_3d_2.Geometry)  # -> Origin, XAxis, YAxis, ZAxis
rotate_3d_3 = Rotate3D(
    Geometry=rotate_3d_2.Geometry,
    Angle=degrees(Slider(-86, range=-90..0)),
    Center=deconstruct_plane_2.Origin,
    Axis=deconstruct_plane_2.ZAxis)  # -> Geometry, Transform
create_script = Python3Script(
    way_planes=transform.transformed_planes,
    tcp_measured=pt_9,
    acceleration=number_slider_24,
    velocity=number_slider_23,
    paint_location=pt_8,
    lift_distance=number_slider_21,
    r=number_slider_22)  # -> out, viz_planes, script; inputs way_planes: list of Plane, tcp_measured: Point3d, acceleration: Double, velocity: Double, paint_location: Point3d
# ---------- create_script: Python ----------
from importlib import reload
import sys, os

# find src/ relative to this Grasshopper file, so the definition
# works wherever the repo is cloned
gh_file = ghenv.Component.OnPingDocument().FilePath
src_folder = os.path.join(os.path.dirname(gh_file), "src")
sys.path.append(src_folder)

import simple_ur_script as ur
reload(ur)
import utils 
reload(utils)
import simple_comm as com
reload(com)

import Rhino.Geometry as rg
import math as m


def safety_plane(plane, distance):
    lifted = rg.Plane(plane)
    # move in world Z to lift it
    T = rg.Transform.Translation(rg.Vector3d.ZAxis * distance)
    # apply transformation
    lifted.Transform(T)
    return lifted


def dip_brush(ref_plane, paint_location, lift_distance, accel, vel):
    # a point has no orientation, we can use the default xy plane
    # flipped so the tool points down into the pot
    paint_plane = rg.Plane(paint_location, ref_plane.XAxis, ref_plane.YAxis)
    # paint_plane = rg.Plane(paint_location, -rg.Vector3d.XAxis, rg.Vector3d.YAxis)
    above_paint = safety_plane(paint_plane, lift_distance)

    # of the pot, the brush arcs above the paint and comes out dry
    dip_script = ""
    dip_script += ur.move_j([m.radians(58.17), m.radians(-51.89), m.radians(-113.89), m.radians(-105.08), m.radians(90.30), m.radians(r)],1, 1)
    dip_script += ur.move_l(above_paint, accel, vel)
    dip_script += ur.move_l(paint_plane, accel, vel)
    dip_script += ur.move_l(above_paint, accel, vel)

    dip_planes = [above_paint, paint_plane, above_paint]

    return dip_script, dip_planes


script = "" # create empty string
viz_planes = [] # every frame the tool visits, in order, to draw the path later

# Step 1: SET TCP!! MAKE SURE THIS MATCHES YOUR BRUSH
script += ur.set_tcp_by_angles(tcp_measured.X, tcp_measured.Y, tcp_measured.Z, m.radians(0.0),m.radians(0.0),m.radians(0))

# Step 1A: Make sure starting planes are very close to the orientation of the first plane
f_plane = way_planes[0]
c_plane = f_plane.Clone()
c_o, c_x, c_y, c_z = c_plane.Origin, c_plane.XAxis, c_plane.YAxis, c_plane.ZAxis

# Step 2: dip in the paint before drawing
dip_script, dip_planes = dip_brush(c_plane, paint_location, lift_distance, acceleration, velocity)
script += dip_script
viz_planes.extend(dip_planes)

# Step 3: come down onto the paper from above, instead of sliding in sideways
approach = safety_plane(way_planes[0], lift_distance)

script += ur.move_j([m.radians(70), m.radians(-94), m.radians(-123), m.radians(-59), m.radians(91), m.radians(r)],1, 1)
script += ur.move_l(approach, acceleration, velocity)
viz_planes.append(approach)

# Step 4: calculate blend for the drawing points only
blend_radii = utils.calculate_blend_radius(way_planes, 10.0)
blend_radii[0] = 0.0 # first touchdown must be exact

# Step 4b: add move_l commands to script for EACH way plane in the list of planes
for plane, radius in zip(way_planes, blend_radii):
    script += ur.move_l_blend(plane, acceleration, velocity, radius)
    viz_planes.append(plane)

# Step 5: lift straight up at the end, so the brush does not drag on the way out
retract = safety_plane(way_planes[-1], lift_distance)
script += ur.move_l(retract, acceleration, velocity)
viz_planes.append(retract)


# format the script to make it sendable
script = com.concatenate_script(script)
# ---------- end create_script ----------

create_script_2 = Python3Script(
    way_planes=transform.transformed_planes,
    tcp_measured=pt_9,
    acceleration=number_slider_24,
    velocity=number_slider_23,
    paint_location=pt_8,
    lift_distance=number_slider_21,
    R=number_slider_22)  # -> out, viz_planes, script; inputs way_planes: list of Plane, tcp_measured: Point3d, acceleration: Double, velocity: Double, paint_location: Point3d
# ---------- create_script_2: Python ----------
from importlib import reload
import sys, os

# find src/ relative to this Grasshopper file, so the definition
# works wherever the repo is cloned
gh_file = ghenv.Component.OnPingDocument().FilePath
src_folder = os.path.join(os.path.dirname(gh_file), "src")
sys.path.append(src_folder)

import simple_ur_script as ur
reload(ur)
import utils 
reload(utils)
import simple_comm as com
reload(com)

import Rhino.Geometry as rg
import math as m


def safety_plane(plane, distance):
    lifted = rg.Plane(plane)
    # move in world Z to lift it
    T = rg.Transform.Translation(rg.Vector3d.ZAxis * distance)
    # apply transformation
    lifted.Transform(T)
    return lifted


def dip_brush(paint_location, lift_distance, accel, vel):
    # a point has no orientation, we can use the default xy plane
    # flipped so the tool points down into the pot
    paint_plane = rg.Plane(paint_location, -rg.Vector3d.XAxis, rg.Vector3d.YAxis)
    above_paint = safety_plane(paint_plane, lift_distance)

    # of the pot, the brush arcs above the paint and comes out dry
    dip_script = ""
    dip_script += ur.move_j([m.radians(58.17), m.radians(-51.89), m.radians(-113.89), m.radians(-105.08), m.radians(90.30), m.radians(R)],1, 1) #set start position of robot
    dip_script += ur.move_l(above_paint, accel, vel)
    dip_script += ur.move_l(paint_plane, accel, vel)
    dip_script += ur.move_l(above_paint, accel, vel)

    dip_planes = [above_paint, paint_plane, above_paint]

    return dip_script, dip_planes


script = "" # create empty string
viz_planes = [] # every frame the tool visits, in order, to draw the path later

# Step 1: SET TCP!! MAKE SURE THIS MATCHES YOUR BRUSH
script += ur.set_tcp_by_angles(tcp_measured.X, tcp_measured.Y, tcp_measured.Z, m.radians(0.0),m.radians(0.0),m.radians(0))

# Step 2: dip in the paint before drawing
dip_script, dip_planes = dip_brush(paint_location, lift_distance,
                                    acceleration, velocity)
script += dip_script
viz_planes.extend(dip_planes)

# Step 3: come down onto the paper from above, instead of sliding in sideways
approach = safety_plane(way_planes[0], lift_distance)

script += ur.move_j([m.radians(70), m.radians(-94), m.radians(-123), m.radians(-59), m.radians(91), m.radians(R)],1, 1)
script += ur.move_l(approach, acceleration, velocity)
viz_planes.append(approach)

# Step 4: calculate blend for the drawing points only
blend_radii = utils.calculate_blend_radius(way_planes, 10.0)
blend_radii[0] = 0.0 # first touchdown must be exact

# Step 4b: add move_l commands to script for EACH way plane in the list of planes
for plane, radius in zip(way_planes, blend_radii):
    script += ur.move_l_blend(plane, acceleration, velocity, radius)
    viz_planes.append(plane)

# Step 5: lift straight up at the end, so the brush does not drag on the way out
retract = safety_plane(way_planes[-1], lift_distance)
script += ur.move_l(retract, acceleration, velocity)
viz_planes.append(retract)


# format the script to make it sendable
script = com.concatenate_script(script)
# ---------- end create_script_2 ----------
panel_2 = Panel(create_script_2.script)

# ---- group: Send UR script to Robot!
py3 = Python3Script(script=create_script_2.script, ip_address="192.168.10.10", send=Button())  # -> out, a; inputs script: String, ip_address: String, send: Boolean
# ---------- py3: Python ----------
import simple_comm as com

if send:
    com.send_script(script,ip_address)
# ---------- end py3 ----------

# ----
polyline_3 = PolyLine(Vertices=create_script_2.viz_planes, Closed=False)
custom_preview_3 = CustomPreview(Geometry=polyline_3, Material=ColourSwatch(SwatchColor=RGB(255, 0, 212)))

plane_5 = Plane(create_script_2.viz_planes)

# ----
# Plane display
plane_6 = Plane(plane_5)
deconstruct_plane_3 = DeconstructPlane(Plane=plane_6)  # -> Origin, XAxis, YAxis, ZAxis
amplitude_2 = Amplitude(Vector=deconstruct_plane_3.ZAxis, Amplitude=Slider(30, range=0..100))
vector_display_2 = VectorDisplay(Anchor=plane_6, Vector=amplitude_2)

list_item_2 = ListItem(List=create_script_2.viz_planes, Index=Slider(16, range=0..50), Wrap=True)

# ----
# 2. Calibrate robot workspace (or "workobject") and send a point to verify
# Create UR Script and send to robot!
# Transform from Rhino to Robot Space
# 
# 1. Measure points on workspace as three corners
# 2. Make sure the coordinates are in "base" mode
number_slider_26 = Slider(0.1, range=0..0.1)
number_slider_27 = Slider(0.1, range=0..0.1)
python_3_script_2 = Python3Script(point=pt, acceleration=number_slider_26, velocity=number_slider_27)  # -> out, target; inputs point: Point3d
# ---------- python_3_script_2: Python ----------
import os
import sys

import Rhino
import Rhino.Geometry as rg

# find src/ relative to this Grasshopper file
gh_file = ghenv.Component.OnPingDocument().FilePath
src_folder = os.path.join(os.path.dirname(gh_file), "src")
sys.path.append(src_folder)

import simple_ur_script as ur
import simple_comm as com


target = rg.Plane(point, rg.Vector3d(1, 0, 0), rg.Vector3d(0, -1, 0))
# ---------- end python_3_script_2 ----------
rhino = Python3Script(way_planes=python_3_script_2.target, wobj_origin=pt_5, wobj_xaxis=pt_6, wobj_xypoint=pt_7)  # -> out, transformed_planes; inputs way_planes: list of Plane, wobj_origin: Point3d, wobj_xaxis: Point3d, wobj_xypoint: Point3d
# ---------- rhino: Python ----------
import Rhino.Geometry as rg
import math

# in this step we transform our way planes to robot space
# the rhino co-ordinate system is rather abstract in the physical world
# the robot base plane assumed the base frame of robot is the origin
# we want the Rhino space to correspond to the paper space
# we transform things from our design space(Rhino World XY) to Robot Base Plane that we measure

def set_robot_base(origin, xaxis, xypoint):
    """
    set a base plane representing the robot working object plane
    """
    robot_base = rg.Plane(origin, xaxis - origin, xypoint - origin)
    print (robot_base)
    return (robot_base)

def rhino_to_robot_space(rhino_plane,robot_base_plane):
    """
    Transform the objects from Rhino world XY plane to robot work object plane
    """
    T_matrix = rg.Transform.PlaneToPlane(rg.Plane.WorldXY,robot_base_plane)
    robot_plane = rhino_plane.Clone()
    # Invert plane to face Z down
    # R = rg.Transform.Rotation(math.pi, rhino_plane.XAxis, rhino_plane.Origin)
    # robot_plane.Transform(R)
    robot_plane.Transform(T_matrix)
    return robot_plane


# ===== Robot base is set =====
robot_base =  set_robot_base(wobj_origin, wobj_xaxis, wobj_xypoint)


# ===== Transforming the rhino planes into robot planes =====
transformed_planes = []
for plane in way_planes: 
    transformed_planes.append(rhino_to_robot_space(plane, robot_base))
# ---------- end rhino ----------

deconstruct_plane_4 = DeconstructPlane(Plane=rhino.transformed_planes)  # -> Origin, XAxis, YAxis, ZAxis
amplitude_3 = Amplitude(Vector=deconstruct_plane_4.ZAxis, Amplitude=rhino.transformed_planes)
vector_display_3 = VectorDisplay(Anchor=rhino.transformed_planes, Vector=amplitude_3)
rhino_2 = Python3Script(way_planes=rhino.transformed_planes, acceleration=number_slider_19, velocity=number_slider_20)  # -> out, script; inputs way_planes: list of Plane, acceleration: Double, velocity: Double
# ---------- rhino_2: Python ----------
from importlib import reload
import sys, os

# find src/ relative to this Grasshopper file, so the definition
# works wherever the repo is cloned
gh_file = ghenv.Component.OnPingDocument().FilePath
src_folder = os.path.join(os.path.dirname(gh_file), "src")
sys.path.append(src_folder)

import simple_ur_script as ur
reload(ur)
import utils 
reload(utils)
import simple_comm as com
reload(com)

import Rhino.Geometry as rg
import math as m

script = "" # create empty string


# add move_l commands to script for each way plane
for plane in way_planes:
    script += ur.move_l(plane, acceleration, velocity)

print(script)


# format the script to make it sendable
script = com.concatenate_script(script)

print(script)
# ---------- end rhino_2 ----------

panel_3 = Panel(rhino_2.script)

# ---- group: Send UR script to Robot!
py3_2 = Python3Script(script=rhino_2.script, ip_address="192.168.10.10", send=Button())  # -> out, a; inputs script: String, ip_address: String, send: Boolean; same code as py3
