# Grasshopper definition 101_roboting.ghx (Grasshopper 1.0.8)

curve = Curve([<curve referenced from the Rhino model> x2])
frame_rotation = Slider(0, range=0..360)
pi = Pi(Factor=1)
division = Division(A=pi, B="180")
divide_distance = DivideDistance(Curve=curve, Distance=Slider(2, range=0..10))  # -> Points, Tangents, Parameters
python_3_script = Python3Script(points=divide_distance.Points, rotation=frame_rotation)  # -> out, frames; inputs points: tree
# ---------- python_3_script: Python ----------
"""
Constructs Rhino Planes (previewable in GH) at input points using orientation vectors
rotated by the specified angle (in degrees) around the Z-axis.
Supports DataTree, 2D list, 1D list, or scalar rotation inputs.
"""
import math
import clr
import Grasshopper
import Rhino.Geometry as rg
from Grasshopper import DataTree
from Grasshopper.Kernel.Data import GH_Path


def to_float(val, default=0.0):
    """Safely converts GH wrapper objects or scalars to float."""
    if val is None: return default
    if hasattr(val, "Value"): val = val.Value
    try: return float(val)
    except (TypeError, ValueError): return default


def unwrap(data):
    """Unwraps Grasshopper DataTrees, nested lists, or scalars."""
    if data is None: return []
    if hasattr(data, "Branches"):
        return [[item for item in b] for b in data.Branches]
    if isinstance(data, (list, tuple)):
        return [list(b) if isinstance(b, (list, tuple)) else b for b in data]
    return data


# 1. Parse input points
raw_points = unwrap(globals().get('points'))
is_tree = hasattr(globals().get('points'), "Branches")

if not raw_points:
    valid_layers = []
elif isinstance(raw_points, list) and raw_points and isinstance(raw_points[0], list):
    valid_layers = [lp for lp in raw_points if lp]
elif isinstance(raw_points, list):
    valid_layers = [raw_points] if raw_points else []
else:
    valid_layers = [[raw_points]]

# 2. Parse rotation input (supports scalar, list, or DataTree)
raw_rot = unwrap(globals().get('rotation'))

if isinstance(raw_rot, (int, float)) or hasattr(raw_rot, "Value"):
    rot_val = to_float(raw_rot)
    get_rotation = lambda l_idx, f_idx: rot_val
elif isinstance(raw_rot, list) and raw_rot:
    if isinstance(raw_rot[0], list):
        parsed_rot = [[to_float(v) for v in branch] for branch in raw_rot]
        def get_rotation(l_idx, f_idx):
            if l_idx < len(parsed_rot):
                branch = parsed_rot[l_idx]
                return branch[f_idx] if f_idx < len(branch) else (branch[-1] if branch else 0.0)
            return parsed_rot[-1][-1] if (parsed_rot and parsed_rot[-1]) else 0.0
    else:
        parsed_rot = [to_float(v) for v in raw_rot]
        get_rotation = lambda l_idx, f_idx: parsed_rot[f_idx] if f_idx < len(parsed_rot) else parsed_rot[-1]
else:
    get_rotation = lambda l_idx, f_idx: 0.0

# 3. Base orientation vectors (Negative Unit X and Unit Y)
base_x = rg.Vector3d(-1.0, 0.0, 0.0)
base_y = rg.Vector3d(0.0, 1.0, 0.0)

# 4. Output structure setup
frames = DataTree[object]() if is_tree else []

# 5. Generate rotated Rhino Planes per layer
for layer_idx, layer_pts in enumerate(valid_layers):
    layer_frames = []
    for f_idx, p in enumerate(layer_pts):
        if hasattr(p, "Value"): p = p.Value
        
        # Extract point coordinates
        if hasattr(p, "Location"):
            pt3d = p.Location
        elif hasattr(p, "X"):
            pt3d = rg.Point3d(float(p.X), float(p.Y), float(p.Z))
        else:
            pt3d = rg.Point3d(float(p.x), float(p.y), float(p.z))

        # Get rotation angle in radians for current point
        rot_deg = get_rotation(layer_idx, f_idx)
        rot_rad = math.radians(rot_deg)

        # Rotate vectors around global Z-axis
        x_axis = rg.Vector3d(base_x)
        y_axis = rg.Vector3d(base_y)
        x_axis.Rotate(rot_rad, rg.Vector3d.ZAxis)
        y_axis.Rotate(rot_rad, rg.Vector3d.ZAxis)

        # Create native Rhino Plane
        layer_frames.append(rg.Plane(pt3d, x_axis, y_axis))
    
    if is_tree:
        frames.AddRange(layer_frames, GH_Path(layer_idx))
    else:
        frames.append(layer_frames)
# ---------- end python_3_script ----------
multiplication = Multiplication(A=Slider(23, range=0..100), B=division)
rotate_3d = Rotate3D(Geometry=python_3_script.frames, Angle=multiplication, Center=divide_distance.Points, Axis=divide_distance.Tangents)  # -> Geometry, Transform

# ----
# 1. Transformations
# 
# original = blue
# transformed = magenta
number_slider = Slider(34, range=0..100)
edges = Python3Script(freq=Slider(5, range=0..6), amplitude=number_slider)  # -> out, flower; inputs freq: Int32
# ---------- edges: Python ----------
import Rhino.Geometry as rg
# Here we need to import math and itertools 
import math as m


def draw_cool_circle(resolution = 50, radius = 100, amplitude = 30, frequency = 3):
    pts = [] 

    for i in range(resolution):
        theta = i/(resolution-1)*m.tau
        
        # play with the radius
        r = radius + m.sin(theta*frequency) * amplitude

        pts.append(
            rg.Point3d(
                r*m.cos(theta),
                r*m.sin(theta),
                0
            )
        )

    return rg.Curve.CreateInterpolatedCurve(
        pts,
        3
    )

flower = draw_cool_circle(frequency = freq, amplitude= amplitude)
# ---------- end edges ----------
transformations = Python3Script(curve=edges.flower)  # -> out, transformed; inputs curve: Curve
# ---------- transformations: Python ----------
import Rhino.Geometry as rg

translation = rg.Vector3d(100, 0, 0)

# Build the transform...
T = rg.Transform.Translation(translation)
# Make a copy
transformed = curve.DuplicateCurve()
# Apply transformation
transformed.Transform(T)
# ---------- end transformations ----------
custom_preview = CustomPreview(Geometry=transformations.transformed, Material=ColourSwatch(SwatchColor=RGB(255, 0, 212)))

pt = ConstructPoint(XCoordinate=Slider(150, range=0..1000), YCoordinate=Slider(150, range=0..1000), ZCoordinate=Slider(5, range=5..10))

geo = Geometry(<curve referenced from the Rhino model>)
# 3. Send a simple set of commands to robot
# Generate Geometry
number_slider_2 = Slider(5, range=0..6)
py3 = Python3Script(child_curve=geo, pt_spacing=Slider(50, range=10..100))  # -> out, way_frames; inputs child_curve: Curve
# ---------- py3: Python ----------
import Rhino.Geometry as rg
# Here we need to import math and itertools 
import math as m

way_frames = []

division = []

division = child_curve.DivideByCount(pt_spacing, True)

for i in range(len(division)):
    new_point = child_curve.PointAt(division[i])
    way_frames.append(rg.Plane(new_point, rg.Vector3d.XAxis, rg.Vector3d.YAxis))
# ---------- end py3 ----------
edges_2 = Python3Script(
    freq=number_slider_2,
    amplitude=Slider(29, range=0..100),
    x_offset=Slider(209, range=0..1000),
    y_offset=Slider(99, range=0..1000),
    radius_smaller=Slider(0.49, range=0..1))  # -> out, flower, flower_planes; inputs freq: Int32
# ---------- edges_2: Python ----------
import Rhino.Geometry as rg
# Here we need to import math and itertools 
import math as m


def draw_cool_circle(resolution = 50, radius = 100, amplitude = 30, frequency = 3):
    pts = [] 
    circle_planes = []

    for i in range(resolution):
        theta = i/(resolution-1)*m.tau
        
        # play with the radius
        r = radius + m.sin(theta*frequency) * amplitude
        pt = rg.Point3d(
                x_offset+r*radius_smaller*m.cos(theta),
                y_offset+r*radius_smaller*m.sin(theta),
                0
            )
        print(pt)

        pts.append(pt)
        circle_planes.append(rg.Plane(pt, rg.Vector3d.XAxis, rg.Vector3d.YAxis))

    return rg.Curve.CreateInterpolatedCurve(
        pts,
        3
    ), circle_planes

flower, flower_planes = draw_cool_circle(frequency = freq, amplitude= amplitude)
# ---------- end edges_2 ----------
custom_preview_2 = CustomPreview(Geometry=edges.flower, Material=ColourSwatch(SwatchColor=RGB(0, 42, 255)))
fine_adjust_z_mm = Slider(0, range=-5..300)

pt_2 = ConstructPoint(XCoordinate="534.35", YCoordinate="-315.60", ZCoordinate="-9.96")

pt_3 = ConstructPoint(XCoordinate="535.90", YCoordinate="101.40", ZCoordinate="-9.39")

pt_4 = ConstructPoint(XCoordinate="246.86", YCoordinate="-314.78", ZCoordinate="-10.85")

# ----
# Transform from Rhino to Robot Space
# 
# 1. Measure points on workspace as three corners
# 2. Make sure the coordinates are in "base" mode
panel = Panel("474.64")
pt_5 = ConstructPoint(XCoordinate=panel, YCoordinate="-200.84", ZCoordinate="-9.26")

pt_6 = ConstructPoint(XCoordinate="469.34", YCoordinate="219.91", ZCoordinate="-9.77")

pt_7 = ConstructPoint(XCoordinate="314.91", YCoordinate="-202.15", ZCoordinate="-9.72")

transform = Python3Script(way_planes=rotate_3d.Geometry, wobj_origin=pt_5, wobj_xaxis=pt_6, wobj_xypoint=pt_7, z_safe_margin=fine_adjust_z_mm)  # -> out, transformed_planes; inputs way_planes: list of Plane, wobj_origin: Point3d, wobj_xaxis: Point3d, wobj_xypoint: Point3d, z_safe_margin: Double
# ---------- transform: Python ----------
import Rhino.Geometry as rg
import math

# in this step we transform our way planes to robot space
# the rhino co-ordinate system is rather abstract in the physical world
# the robot base plane assumed the base frame of robot is the origin
# we want the Rhino space to correspond to the paper space
# we transform things from our design space(Rhino World XY) to Robot Base Plane that we measure


def set_robot_base(origin, xaxis, xypoint):
    """
    set a base plane representing the robot working object plane
    """
    robot_base = rg.Plane(origin, xaxis - origin, xypoint - origin)
    print (robot_base)
    return (robot_base)

def rhino_to_robot_space(rhino_plane,robot_base_plane):
    """
    Transform the objects from Rhino world XY plane to robot work object plane
    """
    T_matrix = rg.Transform.PlaneToPlane(rg.Plane.WorldXY,robot_base_plane)
    robot_plane = rhino_plane.Clone()
    # Invert plane to face Z down
    R = rg.Transform.Rotation(math.pi, rhino_plane.XAxis, rhino_plane.Origin)
    robot_plane.Transform(R)
    robot_plane.Transform(T_matrix)
    return robot_plane

def set_z_safe_margin(planes_to_adjust, safety_margin):
    adjusted_way_planes = []
    for plane in planes_to_adjust:
        plane.OriginZ += safety_margin
        adjusted_way_planes.append(plane)
    return adjusted_way_planes

# ===== Robot base is set =====
robot_base =  set_robot_base(wobj_origin, wobj_xaxis, wobj_xypoint)

# ===== Set safety margin for Z height ======
safer_planes = set_z_safe_margin(way_planes, z_safe_margin)

# ===== Transforming the rhino planes into robot planes =====
transformed_planes = []
for plane in way_planes: 
    plane.Rotate(math.radians(180), plane.XAxis)
    transformed_planes.append(rhino_to_robot_space(plane, robot_base))
# ---------- end transform ----------
number_slider_3 = Slider(0.1, range=0..0.1)
number_slider_4 = Slider(0.1, range=0..0.1)

# ----
# Measure in paint location
number_slider_5 = Slider(100, range=0..100)
pt_8 = ConstructPoint(XCoordinate="264.47", YCoordinate="114.90", ZCoordinate="-10.43")

# ----
# MEASURE TCP!
panel_2 = Panel("129.89")
pt_9 = ConstructPoint(XCoordinate="1.38", YCoordinate="-1.92", ZCoordinate=panel_2)

number_slider_6 = Slider(0.1, range=0..0.1)
number_slider_7 = Slider(0.1, range=0..0.1)

# ----
# Convert Planes to URScript
create_script = Python3Script(
    way_planes=transform.transformed_planes,
    tcp_measured=pt_9,
    acceleration=number_slider_6,
    velocity=number_slider_7,
    paint_location=pt_8,
    lift_distance=number_slider_5)  # -> out, viz_planes, script; inputs way_planes: list of Plane, tcp_measured: Point3d, acceleration: Double, velocity: Double, paint_location: Point3d
# ---------- create_script: Python ----------
from importlib import reload
import sys, os

# find src/ relative to this Grasshopper file, so the definition
# works wherever the repo is cloned
gh_file = ghenv.Component.OnPingDocument().FilePath
src_folder = os.path.join(os.path.dirname(gh_file), "src")
sys.path.append(src_folder)

import simple_ur_script as ur
reload(ur)
import utils 
reload(utils)
import simple_comm as com
reload(com)

import Rhino.Geometry as rg
import math as m


def safety_plane(plane, distance):
    lifted = rg.Plane(plane)
    # move in world Z to lift it
    T = rg.Transform.Translation(rg.Vector3d.ZAxis * distance)
    # apply transformation
    lifted.Transform(T)
    return lifted


# def dip_brush(paint_location, lift_distance, accel, vel):
#     # a point has no orientation, we can use the default xy plane
#     # flipped so the tool points down into the pot
#     paint_plane = rg.Plane(paint_location, -rg.Vector3d.XAxis, rg.Vector3d.YAxis)
#     above_paint = safety_plane(paint_plane, lift_distance)

#     # of the pot, the brush arcs above the paint and comes out dry
#     dip_script = ""
#     dip_script += ur.move_l(above_paint, accel, vel)
#     dip_script += ur.move_l(paint_plane, accel, vel)
#     dip_script += ur.move_l(above_paint, accel, vel)

#     dip_planes = [above_paint, paint_plane, above_paint]

#     return dip_script, dip_planes


script = "" # create empty string
viz_planes = [] # every frame the tool visits, in order, to draw the path later

# Step 1: SET TCP!! MAKE SURE THIS MATCHES YOUR BRUSH
script += ur.set_tcp_by_angles(tcp_measured.X, tcp_measured.Y, tcp_measured.Z, m.radians(0.0),m.radians(0.0),m.radians(0))

# # Step 2: dip in the paint before drawing
# dip_script, dip_planes = dip_brush(paint_location, lift_distance,
#                                     acceleration, velocity)
# script += dip_script
# viz_planes.extend(dip_planes)

# Step 3: come down onto the paper from above, instead of sliding in sideways
approach = safety_plane(way_planes[0], lift_distance)
script += ur.move_l(approach, acceleration, velocity)
viz_planes.append(approach)

# Step 4: calculate blend for the drawing points only
blend_radii = utils.calculate_blend_radius(way_planes, 10.0)
blend_radii[0] = 0.0 # first touchdown must be exact

# Step 4b: add move_l commands to script for EACH way plane in the list of planes
for plane, radius in zip(way_planes, blend_radii):
    script += ur.move_l_blend(plane, acceleration, velocity, radius)
    viz_planes.append(plane)

# Step 5: lift straight up at the end, so the brush does not drag on the way out
retract = safety_plane(way_planes[-1], lift_distance)
script += ur.move_l(retract, acceleration, velocity)
viz_planes.append(retract)


# format the script to make it sendable
script = com.concatenate_script(script)
# ---------- end create_script ----------
polyline = PolyLine(Vertices=create_script.viz_planes, Closed=False)
plane = Plane(create_script.viz_planes)
custom_preview_3 = CustomPreview(Geometry=polyline, Material=ColourSwatch(SwatchColor=RGB(255, 0, 212)))
# Send to Robot!
panel_3 = Panel(create_script.script)

# ---- group: Send UR script to Robot!
py3_2 = Python3Script(script=create_script.script, ip_address="192.168.10.10", send=Button())  # -> out, a; inputs script: String, ip_address: String, send: Boolean
# ---------- py3_2: Python ----------
import simple_comm as com

if send:
    com.send_script(script,ip_address)
# ---------- end py3_2 ----------

# ----
# 2. Calibrate robot workspace (or "workobject") and send a point to verify
# Create UR Script and send to robot!
# Transform from Rhino to Robot Space
# 
# 1. Measure points on workspace as three corners
# 2. Make sure the coordinates are in "base" mode
number_slider_8 = Slider(0.1, range=0..0.1)
number_slider_9 = Slider(0.1, range=0..0.1)
python_3_script_2 = Python3Script(point=pt, acceleration=number_slider_8, velocity=number_slider_9)  # -> out, target; inputs point: Point3d
# ---------- python_3_script_2: Python ----------
import os
import sys

import Rhino
import Rhino.Geometry as rg

# find src/ relative to this Grasshopper file
gh_file = ghenv.Component.OnPingDocument().FilePath
src_folder = os.path.join(os.path.dirname(gh_file), "src")
sys.path.append(src_folder)

import simple_ur_script as ur
import simple_comm as com


target = rg.Plane(point, rg.Vector3d(1, 0, 0), rg.Vector3d(0, -1, 0))
# ---------- end python_3_script_2 ----------
rhino = Python3Script(way_planes=python_3_script_2.target, wobj_origin=pt_2, wobj_xaxis=pt_3, wobj_xypoint=pt_4)  # -> out, transformed_planes; inputs way_planes: list of Plane, wobj_origin: Point3d, wobj_xaxis: Point3d, wobj_xypoint: Point3d
# ---------- rhino: Python ----------
import Rhino.Geometry as rg
import math

# in this step we transform our way planes to robot space
# the rhino co-ordinate system is rather abstract in the physical world
# the robot base plane assumed the base frame of robot is the origin
# we want the Rhino space to correspond to the paper space
# we transform things from our design space(Rhino World XY) to Robot Base Plane that we measure

def set_robot_base(origin, xaxis, xypoint):
    """
    set a base plane representing the robot working object plane
    """
    robot_base = rg.Plane(origin, xaxis - origin, xypoint - origin)
    print (robot_base)
    return (robot_base)

def rhino_to_robot_space(rhino_plane,robot_base_plane):
    """
    Transform the objects from Rhino world XY plane to robot work object plane
    """
    T_matrix = rg.Transform.PlaneToPlane(rg.Plane.WorldXY,robot_base_plane)
    robot_plane = rhino_plane.Clone()
    # Invert plane to face Z down
    R = rg.Transform.Rotation(math.pi, rhino_plane.XAxis, rhino_plane.Origin)
    robot_plane.Transform(R)
    robot_plane.Transform(T_matrix)
    return robot_plane


# ===== Robot base is set =====
robot_base =  set_robot_base(wobj_origin, wobj_xaxis, wobj_xypoint)


# ===== Transforming the rhino planes into robot planes =====
transformed_planes = []
for plane in way_planes: 
    transformed_planes.append(rhino_to_robot_space(plane, robot_base))
# ---------- end rhino ----------

rhino_2 = Python3Script(way_planes=rhino.transformed_planes, acceleration=number_slider_3, velocity=number_slider_4)  # -> out, script; inputs way_planes: list of Plane, acceleration: Double, velocity: Double
# ---------- rhino_2: Python ----------
from importlib import reload
import sys, os

# find src/ relative to this Grasshopper file, so the definition
# works wherever the repo is cloned
gh_file = ghenv.Component.OnPingDocument().FilePath
src_folder = os.path.join(os.path.dirname(gh_file), "src")
sys.path.append(src_folder)

import simple_ur_script as ur
reload(ur)
import utils 
reload(utils)
import simple_comm as com
reload(com)

import Rhino.Geometry as rg
import math as m

script = "" # create empty string


# add move_l commands to script for each way plane
for plane in way_planes:
    script += ur.move_l(plane, acceleration, velocity)


# format the script to make it sendable
script = com.concatenate_script(script)
# ---------- end rhino_2 ----------

# ---- group: Send UR script to Robot!
py3_3 = Python3Script(script=rhino_2.script, ip_address="192.168.10.10", send=Button())  # -> out, a; inputs script: String, ip_address: String, send: Boolean; same code as py3_2

# ----
panel_4 = Panel(rhino_2.script)
