# Grasshopper definition 101_roboting_01.ghx (Grasshopper 1.0.8)

# ----
# 1. Transformations
# 
# original = blue
# transformed = magenta
number_slider = Slider(34, range=0..100)
edges = Python3Script(freq=Slider(5, range=0..6), amplitude=number_slider)  # -> out, flower; inputs freq: Int32
# ---------- edges: Python ----------
import Rhino.Geometry as rg
# Here we need to import math and itertools 
import math as m


def draw_cool_circle(resolution = 50, radius = 100, amplitude = 30, frequency = 3):
    pts = [] 

    for i in range(resolution):
        theta = i/(resolution-1)*m.tau
        
        # play with the radius
        r = radius + m.sin(theta*frequency) * amplitude

        pts.append(
            rg.Point3d(
                r*m.cos(theta),
                r*m.sin(theta),
                0
            )
        )

    return rg.Curve.CreateInterpolatedCurve(
        pts,
        3
    )

flower = draw_cool_circle(frequency = freq, amplitude= amplitude)
# ---------- end edges ----------
transformations = Python3Script(curve=edges.flower)  # -> out, transformed; inputs curve: Curve
# ---------- transformations: Python ----------
import Rhino.Geometry as rg

translation = rg.Vector3d(100, 0, 0)

# Build the transform...
T = rg.Transform.Translation(translation)
# Make a copy
transformed = curve.DuplicateCurve()
# Apply transformation
transformed.Transform(T)
# ---------- end transformations ----------
custom_preview = CustomPreview(Geometry=transformations.transformed, Material=ColourSwatch(SwatchColor=RGB(255, 0, 212)))

pt = ConstructPoint(XCoordinate=Slider(150, range=0..1000), YCoordinate=Slider(150, range=0..1000), ZCoordinate=Slider(5, range=5..10))

custom_preview_2 = CustomPreview(Geometry=edges.flower, Material=ColourSwatch(SwatchColor=RGB(0, 42, 255)))

pt_2 = ConstructPoint(XCoordinate="534.35", YCoordinate="-315.60", ZCoordinate="-9.96")

pt_3 = ConstructPoint(XCoordinate="535.90", YCoordinate="101.40", ZCoordinate="-9.39")

pt_4 = ConstructPoint(XCoordinate="246.86", YCoordinate="-314.78", ZCoordinate="-10.85")

pt_5 = ConstructPoint(XCoordinate="534.35", YCoordinate="-315.60", ZCoordinate="-9.96")

pt_6 = ConstructPoint(XCoordinate="535.90", YCoordinate="101.40", ZCoordinate="-9.39")

pt_7 = ConstructPoint(XCoordinate="246.86", YCoordinate="-314.78", ZCoordinate="-10.85")

number_slider_2 = Slider(0.1, range=0..0.1)
number_slider_3 = Slider(0.1, range=0..0.1)

# ----
# Measure in paint location
number_slider_4 = Slider(100, range=0..100)
pt_8 = ConstructPoint(XCoordinate="264.47", YCoordinate="114.90", ZCoordinate="-10.43")

# ----
# MEASURE TCP!
panel = Panel("74.33")
pt_9 = ConstructPoint(XCoordinate="0.07", YCoordinate="-0.06", ZCoordinate=panel)

number_slider_5 = Slider(0.1, range=0..0.1)
number_slider_6 = Slider(0.1, range=0..0.1)

# ----
# 3. Send a simple set of commands to robot
# Transform from Rhino to Robot Space
# 
# 1. Measure points on workspace as three corners
# 2. Make sure the coordinates are in "base" mode
# Generate Geometry
# Convert Planes to URScript
# Send to Robot!
number_slider_7 = Slider(34, range=0..100)
edges_2 = Python3Script(freq=Slider(5, range=0..6), amplitude=number_slider_7)  # -> out, flower, flower_planes; inputs freq: Int32
# ---------- edges_2: Python ----------
import Rhino.Geometry as rg
# Here we need to import math and itertools 
import math as m


def draw_cool_circle(resolution = 50, radius = 100, amplitude = 30, frequency = 3):
    pts = [] 
    circle_planes = []

    for i in range(resolution):
        theta = i/(resolution-1)*m.tau
        
        # play with the radius
        r = radius + m.sin(theta*frequency) * amplitude
        pt = rg.Point3d(
                r*m.cos(theta),
                r*m.sin(theta),
                0
            )

        pts.append(pt)
        circle_planes.append(rg.Plane(pt, rg.Vector3d.XAxis, rg.Vector3d.YAxis))

    return rg.Curve.CreateInterpolatedCurve(
        pts,
        3
    ), circle_planes

flower, flower_planes = draw_cool_circle(frequency = freq, amplitude= amplitude)
# ---------- end edges_2 ----------
fine_adjust_z_mm = Slider(0.8, range=-5..10)
transform = Python3Script(way_planes=edges_2.flower_planes, wobj_origin=pt_5, wobj_xaxis=pt_6, wobj_xypoint=pt_7, z_safe_margin=fine_adjust_z_mm)  # -> out, transformed_planes; inputs way_planes: list of Plane, wobj_origin: Point3d, wobj_xaxis: Point3d, wobj_xypoint: Point3d, z_safe_margin: Double
# ---------- transform: Python ----------
import Rhino.Geometry as rg
import math

# in this step we transform our way planes to robot space
# the rhino co-ordinate system is rather abstract in the physical world
# the robot base plane assumed the base frame of robot is the origin
# we want the Rhino space to correspond to the paper space
# we transform things from our design space(Rhino World XY) to Robot Base Plane that we measure


def set_robot_base(origin, xaxis, xypoint):
    """
    set a base plane representing the robot working object plane
    """
    robot_base = rg.Plane(origin, xaxis - origin, xypoint - origin)
    print (robot_base)
    return (robot_base)

def rhino_to_robot_space(rhino_plane,robot_base_plane):
    """
    Transform the objects from Rhino world XY plane to robot work object plane
    """
    T_matrix = rg.Transform.PlaneToPlane(rg.Plane.WorldXY,robot_base_plane)
    robot_plane = rhino_plane.Clone()
    # Invert plane to face Z down
    R = rg.Transform.Rotation(math.pi, rhino_plane.XAxis, rhino_plane.Origin)
    robot_plane.Transform(R)
    robot_plane.Transform(T_matrix)
    return robot_plane

def set_z_safe_margin(planes_to_adjust, safety_margin):
    adjusted_way_planes = []
    for plane in planes_to_adjust:
        plane.OriginZ += safety_margin
        adjusted_way_planes.append(plane)
    return adjusted_way_planes

# ===== Robot base is set =====
robot_base =  set_robot_base(wobj_origin, wobj_xaxis, wobj_xypoint)

# ===== Set safety margin for Z height ======
safer_planes = set_z_safe_margin(way_planes, z_safe_margin)

# ===== Transforming the rhino planes into robot planes =====
transformed_planes = []
for plane in way_planes: 
    transformed_planes.append(rhino_to_robot_space(plane, robot_base))
# ---------- end transform ----------
create_script = Python3Script(
    way_planes=transform.transformed_planes,
    tcp_measured=pt_9,
    acceleration=number_slider_5,
    velocity=number_slider_6,
    paint_location=pt_8,
    lift_distance=number_slider_4)  # -> out, viz_planes, script; inputs way_planes: list of Plane, tcp_measured: Point3d, acceleration: Double, velocity: Double, paint_location: Point3d
# ---------- create_script: Python ----------
from importlib import reload
import sys, os

# find src/ relative to this Grasshopper file, so the definition
# works wherever the repo is cloned
gh_file = ghenv.Component.OnPingDocument().FilePath
src_folder = os.path.join(os.path.dirname(gh_file), "src")
sys.path.append(src_folder)

import simple_ur_script as ur
reload(ur)
import utils 
reload(utils)
import simple_comm as com
reload(com)

import Rhino.Geometry as rg
import math as m


def safety_plane(plane, distance):
    lifted = rg.Plane(plane)
    # move in world Z to lift it
    T = rg.Transform.Translation(rg.Vector3d.ZAxis * distance)
    # apply transformation
    lifted.Transform(T)
    return lifted


def dip_brush(paint_location, lift_distance, accel, vel):
    # a point has no orientation, we can use the default xy plane
    # flipped so the tool points down into the pot
    paint_plane = rg.Plane(paint_location, -rg.Vector3d.XAxis, rg.Vector3d.YAxis)
    above_paint = safety_plane(paint_plane, lift_distance)

    # of the pot, the brush arcs above the paint and comes out dry
    dip_script = ""
    dip_script += ur.move_l(above_paint, accel, vel)
    dip_script += ur.move_l(paint_plane, accel, vel)
    dip_script += ur.move_l(above_paint, accel, vel)

    dip_planes = [above_paint, paint_plane, above_paint]

    return dip_script, dip_planes


script = "" # create empty string
viz_planes = [] # every frame the tool visits, in order, to draw the path later

# Step 1: SET TCP!! MAKE SURE THIS MATCHES YOUR BRUSH
script += ur.set_tcp_by_angles(tcp_measured.X, tcp_measured.Y, tcp_measured.Z, m.radians(0.0),m.radians(0.0),m.radians(0))

# Step 2: dip in the paint before drawing
dip_script, dip_planes = dip_brush(paint_location, lift_distance,
                                    acceleration, velocity)
script += dip_script
viz_planes.extend(dip_planes)

# Step 3: come down onto the paper from above, instead of sliding in sideways
approach = safety_plane(way_planes[0], lift_distance)
script += ur.move_l(approach, acceleration, velocity)
viz_planes.append(approach)

# Step 4: calculate blend for the drawing points only
blend_radii = utils.calculate_blend_radius(way_planes, 10.0)
blend_radii[0] = 0.0 # first touchdown must be exact

# Step 4b: add move_l commands to script for EACH way plane in the list of planes
for plane, radius in zip(way_planes, blend_radii):
    script += ur.move_l_blend(plane, acceleration, velocity, radius)
    viz_planes.append(plane)

# Step 5: lift straight up at the end, so the brush does not drag on the way out
retract = safety_plane(way_planes[-1], lift_distance)
script += ur.move_l(retract, acceleration, velocity)
viz_planes.append(retract)


# format the script to make it sendable
script = com.concatenate_script(script)
# ---------- end create_script ----------
panel_2 = Panel(create_script.script)

polyline = PolyLine(Vertices=create_script.viz_planes, Closed=False)
plane = Plane(create_script.viz_planes)
custom_preview_3 = CustomPreview(Geometry=polyline, Material=ColourSwatch(SwatchColor=RGB(255, 0, 212)))

# ---- group: Send UR script to Robot!
py3 = Python3Script(script=create_script.script, ip_address="192.168.10.10", send=Button())  # -> out, a; inputs script: String, ip_address: String, send: Boolean
# ---------- py3: Python ----------
import simple_comm as com

if send:
    com.send_script(script,ip_address)
# ---------- end py3 ----------

# ----
# 2. Calibrate robot workspace (or "workobject") and send a point to verify
# Create UR Script and send to robot!
# Transform from Rhino to Robot Space
# 
# 1. Measure points on workspace as three corners
# 2. Make sure the coordinates are in "base" mode
number_slider_8 = Slider(0.1, range=0..0.1)
number_slider_9 = Slider(0.1, range=0..0.1)
python_3_script = Python3Script(point=pt, acceleration=number_slider_8, velocity=number_slider_9)  # -> out, target; inputs point: Point3d
# ---------- python_3_script: Python ----------
import os
import sys

import Rhino
import Rhino.Geometry as rg

# find src/ relative to this Grasshopper file
gh_file = ghenv.Component.OnPingDocument().FilePath
src_folder = os.path.join(os.path.dirname(gh_file), "src")
sys.path.append(src_folder)

import simple_ur_script as ur
import simple_comm as com


target = rg.Plane(point, rg.Vector3d(1, 0, 0), rg.Vector3d(0, -1, 0))
# ---------- end python_3_script ----------
rhino = Python3Script(way_planes=python_3_script.target, wobj_origin=pt_2, wobj_xaxis=pt_3, wobj_xypoint=pt_4)  # -> out, transformed_planes; inputs way_planes: list of Plane, wobj_origin: Point3d, wobj_xaxis: Point3d, wobj_xypoint: Point3d
# ---------- rhino: Python ----------
import Rhino.Geometry as rg
import math

# in this step we transform our way planes to robot space
# the rhino co-ordinate system is rather abstract in the physical world
# the robot base plane assumed the base frame of robot is the origin
# we want the Rhino space to correspond to the paper space
# we transform things from our design space(Rhino World XY) to Robot Base Plane that we measure

def set_robot_base(origin, xaxis, xypoint):
    """
    set a base plane representing the robot working object plane
    """
    robot_base = rg.Plane(origin, xaxis - origin, xypoint - origin)
    print (robot_base)
    return (robot_base)

def rhino_to_robot_space(rhino_plane,robot_base_plane):
    """
    Transform the objects from Rhino world XY plane to robot work object plane
    """
    T_matrix = rg.Transform.PlaneToPlane(rg.Plane.WorldXY,robot_base_plane)
    robot_plane = rhino_plane.Clone()
    # Invert plane to face Z down
    R = rg.Transform.Rotation(math.pi, rhino_plane.XAxis, rhino_plane.Origin)
    robot_plane.Transform(R)
    robot_plane.Transform(T_matrix)
    return robot_plane


# ===== Robot base is set =====
robot_base =  set_robot_base(wobj_origin, wobj_xaxis, wobj_xypoint)


# ===== Transforming the rhino planes into robot planes =====
transformed_planes = []
for plane in way_planes: 
    transformed_planes.append(rhino_to_robot_space(plane, robot_base))
# ---------- end rhino ----------

rhino_2 = Python3Script(way_planes=rhino.transformed_planes, acceleration=number_slider_2, velocity=number_slider_3)  # -> out, script; inputs way_planes: list of Plane, acceleration: Double, velocity: Double
# ---------- rhino_2: Python ----------
from importlib import reload
import sys, os

# find src/ relative to this Grasshopper file, so the definition
# works wherever the repo is cloned
gh_file = ghenv.Component.OnPingDocument().FilePath
src_folder = os.path.join(os.path.dirname(gh_file), "src")
sys.path.append(src_folder)

import simple_ur_script as ur
reload(ur)
import utils 
reload(utils)
import simple_comm as com
reload(com)

import Rhino.Geometry as rg
import math as m

script = "" # create empty string


# add move_l commands to script for each way plane
for plane in way_planes:
    script += ur.move_l(plane, acceleration, velocity)


# format the script to make it sendable
script = com.concatenate_script(script)
# ---------- end rhino_2 ----------

# ---- group: Send UR script to Robot!
py3_2 = Python3Script(script=rhino_2.script, ip_address="192.168.10.10", send=Button())  # -> out, a; inputs script: String, ip_address: String, send: Boolean; same code as py3

# ----
panel_3 = Panel(rhino_2.script)
