# Grasshopper definition 101_roboting_MikeFlower.ghx (Grasshopper 1.0.8)

# ----
# 1. Transformations
# 
# original = blue
# transformed = magenta
number_slider = Slider(34, range=0..100)
edges = Python3Script(freq=Slider(5, range=0..6), amplitude=number_slider)  # -> out, flower; inputs freq: Int32
# ---------- edges: Python ----------
import Rhino.Geometry as rg
# Here we need to import math and itertools 
import math as m


def draw_cool_circle(resolution = 50, radius = 100, amplitude = 30, frequency = 3):
    pts = [] 

    for i in range(resolution):
        theta = i/(resolution-1)*m.tau
        
        # play with the radius
        r = radius + m.sin(theta*frequency) * amplitude

        pts.append(
            rg.Point3d(
                r*m.cos(theta),
                r*m.sin(theta),
                0
            )
        )

    return rg.Curve.CreateInterpolatedCurve(
        pts,
        3
    )

flower = draw_cool_circle(frequency = freq, amplitude= amplitude)
# ---------- end edges ----------
pt = Point(Point(-468.344902, 249.5642509, 287.2345464))
brep = Brep(<brep referenced from the Rhino model>)
pt_2 = Point(Point(-539.6457046, 494.1738174, 287.2345464))
pt_3 = Point(Point(-553.5001279, 170.5490069, 287.2345464))
transformations = Python3Script(curve=edges.flower, table_brep=brep, origin=pt, x_pt=pt_2, y_pt=pt_3)  # -> out, transformed; inputs curve: Curve, table_brep: Brep, origin: Point3d, x_pt: Point3d, y_pt: Point3d
# ---------- transformations: Python ----------
import Rhino.Geometry as rg
import math as m
import Rhino
import scriptcontext as sc

translation = rg.Vector3d(50, 50, 0)
angle = m.pi/2
axis = rg.Vector3d.ZAxis

# Build the transform...
T = rg.Transform.Translation(translation)
# Make a copy
transformed = curve.DuplicateCurve()
# Apply transformation
transformed.Transform(T)

if transformed.IsClosed and transformed.IsPlanar():
    am = rg.AreaMassProperties.Compute(transformed)
    if am is not None:
        center = am.Centroid  # This gives you the Point3d
        sc.doc.Objects.AddPoint(center)
        sc.doc.Views.Redraw()

def get_top_face(t_brep):
    top_face = max(t_brep.Faces, key= lambda f: f.GetBoundingBox(True).Max.Z)
    u_mid = top_face.Domain(0).Mid
    v_mid = top_face.Domain(1).Mid 
    success, face_plane = top_face.FrameAt(u_mid, v_mid)
    o_pt = top_face.PointAt(u_mid,v_mid)
    s_norm = top_face.NormalAt(u_mid,v_mid)
    face_plane = rg.Plane(o_pt,s_norm)
    if success:
        return top_face, face_plane
    return None, None

if table_brep:
    top_face, face_plane = get_top_face(table_brep)
    print(top_face)
    print(face_plane)

# Build the transform...
R = rg.Transform.Rotation(angle, axis, center)
# Make a copy
transformed = transformed.DuplicateCurve()
# Apply transformation
transformed.Transform(R)

x_v = x_pt - origin
y_v = y_pt - origin
plane = rg.Plane(origin, x_v, y_v)

P = rg.Transform.PlaneToPlane(rg.Plane.WorldXY, plane)
transformed = curve.DuplicateCurve()
transformed.Transform(P)
# ---------- end transformations ----------
custom_preview = CustomPreview(Geometry=transformations.transformed, Material=ColourSwatch(SwatchColor=RGB(255, 0, 212)))

pt_4 = ConstructPoint(XCoordinate=Slider(150, range=0..1000), YCoordinate=Slider(150, range=0..1000), ZCoordinate=Slider(0, range=0..50))

number_slider_2 = Slider(18, range=0..100)
number_slider_3 = Slider(3, range=0..25)
one_over_x = OneOverX(Value=number_slider_3)
range = Range(Domain=Domain(0, 1), Steps=expr("x-1", number_slider_3))
graph = GraphMapper(range, x0=0, x1=1, y0=0, y1=1, Cx=0.5601634383, Cy=0.3033571243, container_name="Conic")
number_slider_4 = Slider(0.1, range=0..0.1)
bnd = Bounds(Numbers=graph)
custom_preview_2 = CustomPreview(Geometry=edges.flower, Material=ColourSwatch(SwatchColor=RGB(0, 42, 255)))
dom = ConstructDomain(DomainStart=one_over_x, DomainEnd=Slider(1, range=0..1))
remap = RemapNumbers(Value=graph, Source=bnd, Target=dom)  # -> Mapped, Clipped
range_2 = Range(Domain=Domain(0, 1), Steps=expr("x-1", Slider(12, range=0..50)))
ellipse_grid_points = Python3Script(
    x_bound=Slider(420, range=0..1000),
    y_bound=Slider(297, range=0..1000),
    o_x=Slider(25, range=0..100),
    o_y=Slider(25, range=0..100),
    steps=number_slider_3,
    step_set=remap.Mapped)  # -> out, rectangles, split_curves, pts; inputs x_bound: Int32, y_bound: Int32, o_x: Int32, o_y: Int32, steps: Int32, step_set: list of Double
# ---------- ellipse_grid_points: Python ----------
import Rhino.Geometry as rg
import math as m
import rhinoscriptsyntax as rs
import System
from System.Collections.Generic import List

l_bound = rg.Rectangle3d(rg.Plane.WorldXY,x_bound,y_bound)
s_bound = rg.Rectangle3d(rg.Plane(rg.Point3d(o_x, o_y, 0), rg.Vector3d.XAxis, rg.Vector3d.YAxis),x_bound - 2*o_x, y_bound - 2*o_y)
ellipse = [(rg.Ellipse(rg.Plane(rg.Point3d(o_x, o_y, 0), rg.Vector3d.XAxis, rg.Vector3d.YAxis), step_set[r] * (x_bound - 2*o_x), step_set[r] * (y_bound - 2*o_y))) for r in range(len(step_set))]

# ---------- OPTIONAL: IF INCLUSIVE OF ELLIPSES BEYOND DIAGONAL ----------
# A = x_bound - 2*o_x
# B = y_bound - 2*o_y
# k = m.sqrt(2)  # scale at which the ellipse passes through s_bound's top-right corner

# plane = rg.Plane(rg.Point3d(o_x, o_y, 0), rg.Vector3d.XAxis, rg.Vector3d.YAxis)
# ellipse = [rg.Ellipse(plane, f * k * A, f * k * B) for f in step_set if f > 0]
# ------------------------------------------------------------------------

s_curve = s_bound.ToNurbsCurve()
s_curve.Domain = rg.Interval(0.0,1.0)
ellipses = [el.ToNurbsCurve() for el in ellipse]

pieces = []
inside_pieces = []

for el in ellipses:
    events = rg.Intersect.Intersection.CurveCurve(el, s_curve, 0.001, 0.001)
    params = sorted(set(ev.ParameterA for ev in events)) if events else []
    if params:
        net_params = List[System.Double]()
        for t in params:
            net_params.Add(t)
        segs = el.Split(net_params)
    else:
        segs = None
    segs = list(segs) if segs else [el]
    pieces.extend(segs)
    for s in segs:
        mid = s.PointAtNormalizedLength(0.5)
        if s_curve.Contains(mid, rg.Plane.WorldXY, 0.001) == rg.PointContainment.Inside:
            s.Domain = rg.Interval(0.0,1.0)
            inside_pieces.append(s)
split_curves = inside_pieces
rectangles = [s_bound]
# ---------- end ellipse_grid_points ----------
graph_2 = GraphMapper(range_2, x0=0, x1=1, y0=0, y1=1, Cx=0.5, Cy=0.5, container_name="Conic")
crv = Curve(ellipse_grid_points.rectangles)
ellipse_diagrid = Python3Script(base_crvs=ellipse_grid_points.split_curves, step=Slider(4, range=0..10), reso_col=graph_2, deg=Slider(2, range=0..10))  # -> out, simplify(point_grid), simplify(flip_grid), simplify(point_list), simplify(select_pts), chains, intp, nurbs; inputs base_crvs: list of Curve, step: Int32, reso_col: list of Double
# ---------- ellipse_diagrid: Python ----------
import Rhino.Geometry as rg
import math as m
from ghpythonlib import treehelpers as th

pt_g = [[base_crvs[i].PointAt(j) for j in reso_col] for i in range(len(base_crvs))]
# for n, pt_grp in enumerate(pt_g):
#     if n % 2 != 0:
#         p = pt_grp[::-1]
#         pt_g[n] = p

col_no = len(reso_col)
row_no = len(base_crvs)

# Flipped the Matrix of Points
flip_pts = [[pt_g[i][j] for i in range(row_no)] for j in range(col_no)]
print(flip_pts)

pt_l = []
for n_r, pt_r in enumerate(pt_g):
    sub_list = []
    if n_r < row_no - 1:
        if (row_no - 1) - n_r < step:
            rows = row_no - n_r
            for r_s in range(rows):
                sub_list.append(pt_g[n_r + r_s])
        else:
            for r_l in range(step):
                sub_list.append(pt_g[n_r + r_l])    
        pt_l.append(sub_list)

sel_pts = pt_l
# sel_pts = []
# for n_p, ptl in enumerate(pt_l):
#     sub_sel = []
#     sign = (1 if n_p % 2 == 0 else -1)
#     for s_p, ptl_sub in enumerate(ptl):
#         new_sub = ptl_sub[::sign]
#         sub_sel.append(new_sub)
#     sel_pts.append(sub_sel)        

chain_pts = []
for n_sp, spl in enumerate(sel_pts):
    ordered_pts = []
    for ss_p, sspl in enumerate(spl):
        if ss_p < len(spl) - 1:
            sign_l = (1 if ss_p % 2 == 0 else -1)
            spl_copy = spl
            l_1 = spl_copy[ss_p][::sign_l]
            l_2 = spl_copy[ss_p + 1][::sign_l]
            for stp in range(len(l_1)//2):
                ordered_pts.append(l_1[stp*2])
                ordered_pts.append(l_2[stp*2+1])
    chain_pts.append(ordered_pts)

intp = [rg.Curve.CreateInterpolatedCurve(pt_lst,deg) for pt_lst in chain_pts]
nbcb = [rg.NurbsCurve.Create(False,deg,pt_lst) for pt_lst in chain_pts]


point_grid = th.list_to_tree(pt_g)
flip_grid = th.list_to_tree(flip_pts)
point_list = th.list_to_tree(pt_l)
select_pts = th.list_to_tree(sel_pts)
chains = th.list_to_tree(chain_pts)
nurbs = th.list_to_tree(nbcb)
# ---------- end ellipse_diagrid ----------

pt_5 = ConstructPoint(XCoordinate="534.35", YCoordinate="-315.60", ZCoordinate="-9.96")

pt_6 = ConstructPoint(XCoordinate="535.90", YCoordinate="101.40", ZCoordinate="-9.39")

pt_7 = ConstructPoint(XCoordinate="246.86", YCoordinate="-314.78", ZCoordinate="-10.85")

interpolated = Curve(simplify(graft(ellipse_diagrid.intp)))
nurbs = Curve(simplify(graft(ellipse_diagrid.nurbs)))

pt_8 = ConstructPoint(XCoordinate="532.1", YCoordinate="532.2", ZCoordinate="-10")

pt_9 = ConstructPoint(XCoordinate="111.4", YCoordinate="530.9", ZCoordinate="-9.5")

pt_10 = ConstructPoint(XCoordinate="534.5", YCoordinate="234.6", ZCoordinate="-10.6")

panel = Panel(ellipse_diagrid.out)
points = PointList(Points=ellipse_diagrid.point_grid, Size=Slider(4, range=0..100))
merge = Merge(Data1=interpolated, Data2=nurbs)
flatten = FlattenTree(Tree=merge, Path="{0}")
xy = XYPlane(Origin=Point(0, 0, 0))
divdist = DivideDistance(Curve=flatten, Distance=Slider(12, range=0..100))  # -> Points, Tangents, Parameters
pl_origin = PlaneOrigin(Base=xy, Origin=divdist.Points)  # -> flatten(Plane)
number_slider_5 = Slider(0.1, range=0..0.1)
number_slider_6 = Slider(0.1, range=0..0.1)

# ----
# Measure in paint location
number_slider_7 = Slider(100, range=0..100)
pt_11 = ConstructPoint(XCoordinate="213.4", YCoordinate="150.3", ZCoordinate="-10.43")

# ----
# MEASURE TCP!
panel_2 = Panel("0.85")
pt_12 = ConstructPoint(XCoordinate=panel_2, YCoordinate="-0.67", ZCoordinate="143.75")

number_slider_8 = Slider(0.5, range=0..1)
number_slider_9 = Slider(0.3, range=0..1)

number_slider_10 = Slider(99, range=-359..359)

# ----
# 3. Send a simple set of commands to robot
# Transform from Rhino to Robot Space
# 
# 1. Measure points on workspace as three corners
# 2. Make sure the coordinates are in "base" mode
# Generate Geometry
# Convert Planes to URScript
# Send to Robot!
number_slider_11 = Slider(34, range=0..100)
edges_2 = Python3Script(
    x_len=Slider(420, range=0..1000),
    y_len=Slider(297, range=0..1000),
    res=Slider(86, range=0..100),
    rad=Slider(100, range=0..100),
    amp=number_slider_11,
    freq=Slider(5, range=0..6),
    tilt=Slider(19, range=0..1000))  # -> out, bound, flower_pts, flower_planes; inputs x_len: Double, y_len: Double, res: Int32, rad: Double
# ---------- edges_2: Python ----------
import Rhino.Geometry as rg
# Here we need to import math and itertools 
import math as m

bound = rg.Rectangle3d(rg.Plane.WorldXY,x_len,y_len)

def gen_points(resolution = 50, radius = 100, amplitude = 30, frequency = 3):
    pts = [] 

    for i in range(resolution):
        theta = i/(resolution-1)*m.tau
        
        # play with the radius
        r = radius + m.sin(theta*frequency) * amplitude
        pt = rg.Point3d(
                r*m.cos(theta),
                r*m.sin(theta),
                0
            )

        pts.append(pt)

    return pts

flower_pts = gen_points(resolution = res, radius = rad, amplitude = amp, frequency = freq)
flower = rg.Curve.CreateInterpolatedCurve(flower_pts,3)
flower.Domain = rg.Interval(0.0,1.0)
flower_planes = []
for f in flower_pts:
    b, f_p = flower.ClosestPoint(f)
    f_o = flower.PointAt(f_p)
    f_t = flower.TangentAt(f_p)
    f_n = f_t.Clone()
    f_n.Rotate(-m.pi / 2, rg.Vector3d.ZAxis)
    f_plane = rg.Plane(f_o, f_n, f_t)
    flo_plane = f_plane.Clone()
    flo_plane.Rotate(m.radians(tilt), f_n, f_o)
    v = rg.Vector3d(x_len/2, y_len/2, 0)
    v_move = rg.Transform.Translation(v)
    flo_plane.Transform(v_move)
    flower_planes.append(flo_plane)
# ---------- end edges_2 ----------
fine_adjust_z_mm = Slider(0, range=-5..10)
transform = Python3Script(way_planes=pl_origin, wobj_origin=pt_8, wobj_xaxis=pt_9, wobj_xypoint=pt_10, z_safe_margin=fine_adjust_z_mm)  # -> out, transformed_planes; inputs way_planes: list of Plane, wobj_origin: Point3d, wobj_xaxis: Point3d, wobj_xypoint: Point3d, z_safe_margin: Double
# ---------- transform: Python ----------
import Rhino.Geometry as rg
import math

# in this step we transform our way planes to robot space
# the rhino co-ordinate system is rather abstract in the physical world
# the robot base plane assumed the base frame of robot is the origin
# we want the Rhino space to correspond to the paper space
# we transform things from our design space(Rhino World XY) to Robot Base Plane that we measure


def set_robot_base(origin, xaxis, xypoint):
    """
    set a base plane representing the robot working object plane
    """
    robot_base = rg.Plane(origin, xaxis - origin, xypoint - origin)
    print (robot_base)
    return (robot_base)

def rhino_to_robot_space(rhino_plane,robot_base_plane):
    """
    Transform the objects from Rhino world XY plane to robot work object plane
    """
    T_matrix = rg.Transform.PlaneToPlane(rg.Plane.WorldXY,robot_base_plane)
    robot_plane = rhino_plane.Clone()
    # Invert plane to face Z down
    R = rg.Transform.Rotation(math.pi, rhino_plane.XAxis, rhino_plane.Origin)
    robot_plane.Transform(R)
    robot_plane.Transform(T_matrix)
    return robot_plane

def set_z_safe_margin(planes_to_adjust, safety_margin):
    adjusted_way_planes = []
    for plane in planes_to_adjust:
        plane.OriginZ += safety_margin
        adjusted_way_planes.append(plane)
    return adjusted_way_planes

# ===== Robot base is set =====
robot_base =  set_robot_base(wobj_origin, wobj_xaxis, wobj_xypoint)

# ===== Set safety margin for Z height ======
safer_planes = set_z_safe_margin(way_planes, z_safe_margin)

# ===== Transforming the rhino planes into robot planes =====
transformed_planes = []
for plane in way_planes: 
    transformed_planes.append(rhino_to_robot_space(plane, robot_base))

f_plane = transformed_planes[0]
# ---------- end transform ----------
create_script = Python3Script(
    way_planes=transform.transformed_planes,
    tcp_measured=pt_12,
    acceleration=number_slider_9,
    velocity=number_slider_8,
    paint_location=pt_11,
    lift_distance=number_slider_7,
    r=number_slider_10)  # -> out, viz_planes, script; inputs way_planes: list of Plane, tcp_measured: Point3d, acceleration: Double, velocity: Double, paint_location: Point3d
# ---------- create_script: Python ----------
from importlib import reload
import sys, os

# find src/ relative to this Grasshopper file, so the definition
# works wherever the repo is cloned
gh_file = ghenv.Component.OnPingDocument().FilePath
src_folder = os.path.join(os.path.dirname(gh_file), "src")
sys.path.append(src_folder)

import simple_ur_script as ur
reload(ur)
import utils 
reload(utils)
import simple_comm as com
reload(com)

import Rhino.Geometry as rg
import math as m


def safety_plane(plane, distance):
    lifted = rg.Plane(plane)
    # move in world Z to lift it
    T = rg.Transform.Translation(rg.Vector3d.ZAxis * distance)
    # apply transformation
    lifted.Transform(T)
    return lifted


def dip_brush(paint_location, lift_distance, accel, vel):
    # a point has no orientation, we can use the default xy plane
    # flipped so the tool points down into the pot
    paint_plane = rg.Plane(paint_location, -rg.Vector3d.XAxis, rg.Vector3d.YAxis)
    # paint_plane = rg.Plane(paint_location, -rg.Vector3d.XAxis, rg.Vector3d.YAxis)
    above_paint = safety_plane(paint_plane, lift_distance)

    # of the pot, the brush arcs above the paint and comes out dry
    dip_script = ""
    dip_script += ur.move_j([m.radians(58.17), m.radians(-51.89), m.radians(-113.89), m.radians(-105.08), m.radians(90.30), m.radians(r)],1, 1)
    dip_script += ur.move_l(above_paint, accel, vel)
    dip_script += ur.move_l(paint_plane, accel, vel)
    dip_script += ur.move_l(above_paint, accel, vel)

    dip_planes = [above_paint, paint_plane, above_paint]

    return dip_script, dip_planes


script = "" # create empty string
viz_planes = [] # every frame the tool visits, in order, to draw the path later

# Step 1: SET TCP!! MAKE SURE THIS MATCHES YOUR BRUSH
script += ur.set_tcp_by_angles(tcp_measured.X, tcp_measured.Y, tcp_measured.Z, m.radians(0.0),m.radians(0.0),m.radians(0))

# Step 2: dip in the paint before drawing
dip_script, dip_planes = dip_brush(paint_location, lift_distance,
                                    acceleration, velocity)
script += dip_script
viz_planes.extend(dip_planes)

# Step 3: come down onto the paper from above, instead of sliding in sideways
approach = safety_plane(way_planes[0], lift_distance)
script += ur.move_l(approach, acceleration, velocity)
viz_planes.append(approach)

# Step 4: calculate blend for the drawing points only
blend_radii = utils.calculate_blend_radius(way_planes, 10.0)
blend_radii[0] = 0.0 # first touchdown must be exact

# Step 4b: add move_l commands to script for EACH way plane in the list of planes
for plane, radius in zip(way_planes, blend_radii):
    script += ur.move_l_blend(plane, acceleration, velocity, radius)
    viz_planes.append(plane)

# Step 5: lift straight up at the end, so the brush does not drag on the way out
retract = safety_plane(way_planes[-1], lift_distance)
script += ur.move_l(retract, acceleration, velocity)
viz_planes.append(retract)


# format the script to make it sendable
script = com.concatenate_script(script)
# ---------- end create_script ----------
panel_3 = Panel(create_script.script)

# ---- group: Send UR script to Robot!
py3 = Python3Script(script=create_script.script, ip_address="192.168.10.10", send=Button())  # -> out, a; inputs script: String, ip_address: String, send: Boolean
# ---------- py3: Python ----------
import simple_comm as com

if send:
    com.send_script(script,ip_address)
# ---------- end py3 ----------

# ----
item = ListItem(List=transform.transformed_planes, Index=Slider(3000, range=0..3000), Wrap=True)
robot_ip_address = Panel("192.168.10.10")
create_script_2 = Python3Script(
    way_planes=transform.transformed_planes,
    tcp_measured=pt_12,
    acceleration=number_slider_9,
    velocity=number_slider_8,
    paint_location=pt_11,
    lift_distance=number_slider_7,
    r=number_slider_10)  # -> out, viz_planes, script; inputs way_planes: list of Plane, tcp_measured: Point3d, acceleration: Double, velocity: Double, paint_location: Point3d; same code as create_script
polyline = PolyLine(Vertices=create_script.viz_planes, Closed=False)
plane = Plane(create_script.viz_planes)
custom_preview_3 = CustomPreview(Geometry=polyline, Material=ColourSwatch(SwatchColor=RGB(255, 0, 212)))

# ----
# 2. Calibrate robot workspace (or "workobject") and send a point to verify
# Create UR Script and send to robot!
# Transform from Rhino to Robot Space
# 
# 1. Measure points on workspace as three corners
# 2. Make sure the coordinates are in "base" mode
number_slider_12 = Slider(0.1, range=0..0.1)
number_slider_13 = Slider(0.1, range=0..0.1)
python_3_script = Python3Script(point=pt_4, acceleration=number_slider_12, velocity=number_slider_13)  # -> out, target; inputs point: Point3d
# ---------- python_3_script: Python ----------
import os
import sys

import Rhino
import Rhino.Geometry as rg

# find src/ relative to this Grasshopper file
gh_file = ghenv.Component.OnPingDocument().FilePath
src_folder = os.path.join(os.path.dirname(gh_file), "src")
sys.path.append(src_folder)

import simple_ur_script as ur
import simple_comm as com


target = rg.Plane(point, rg.Vector3d(1, 0, 0), rg.Vector3d(0, -1, 0))
# Negative Y value to flip plane to match robot conventions
# ---------- end python_3_script ----------
rhino = Python3Script(way_planes=python_3_script.target, wobj_origin=pt_8, wobj_xaxis=pt_9, wobj_xypoint=pt_10)  # -> out, transformed_planes; inputs way_planes: list of Plane, wobj_origin: Point3d, wobj_xaxis: Point3d, wobj_xypoint: Point3d
# ---------- rhino: Python ----------
import Rhino.Geometry as rg
import math

# in this step we transform our way planes to robot space
# the rhino co-ordinate system is rather abstract in the physical world
# the robot base plane assumed the base frame of robot is the origin
# we want the Rhino space to correspond to the paper space
# we transform things from our design space(Rhino World XY) to Robot Base Plane that we measure

def set_robot_base(origin, xaxis, xypoint):
    """
    set a base plane representing the robot working object plane
    """
    robot_base = rg.Plane(origin, xaxis - origin, xypoint - origin)
    print (robot_base)
    return (robot_base)

def rhino_to_robot_space(rhino_plane,robot_base_plane):
    """
    Transform the objects from Rhino world XY plane to robot work object plane
    """
    T_matrix = rg.Transform.PlaneToPlane(rg.Plane.WorldXY,robot_base_plane)
    robot_plane = rhino_plane.Clone()
    # Invert plane to face Z down

    # Annotated segmemt below is if your input plane has not already been flipped
    # R = rg.Transform.Rotation(math.pi, rhino_plane.XAxis, rhino_plane.Origin)
    # robot_plane.Transform(R)

    robot_plane.Transform(T_matrix)
    return robot_plane


# ===== Robot base is set =====
robot_base =  set_robot_base(wobj_origin, wobj_xaxis, wobj_xypoint)


# ===== Transforming the rhino planes into robot planes =====
transformed_planes = []
for plane in way_planes: 
    transformed_planes.append(rhino_to_robot_space(plane, robot_base))
# ---------- end rhino ----------

rhino_2 = Python3Script(way_planes=rhino.transformed_planes, acceleration=number_slider_5, velocity=number_slider_6)  # -> out, script; inputs way_planes: list of Plane, acceleration: Double, velocity: Double
# ---------- rhino_2: Python ----------
from importlib import reload
import sys, os

# find src/ relative to this Grasshopper file, so the definition
# works wherever the repo is cloned
gh_file = ghenv.Component.OnPingDocument().FilePath
src_folder = os.path.join(os.path.dirname(gh_file), "src")
sys.path.append(src_folder)

import simple_ur_script as ur
reload(ur)
import utils 
reload(utils)
import simple_comm as com
reload(com)

import Rhino.Geometry as rg
import math as m

script = "" # create empty string


# add move_l commands to script for each way plane
for plane in way_planes:
    script += ur.move_l(plane, acceleration, velocity)

print(script) # script before conversion to sendable text

# format the script to make it sendable
script = com.concatenate_script(script)

print(script) # script after conversion to sendable text
# ---------- end rhino_2 ----------

# ---- group: Send UR script to Robot!
py3_2 = Python3Script(script=rhino_2.script, ip_address="192.168.10.10", send=Button())  # -> out, a; inputs script: String, ip_address: String, send: Boolean; same code as py3

# ----
panel_4 = Panel(rhino_2.script)
