# Grasshopper definition Mike_roboting_trials_1005.gh (Grasshopper 1.0.8)

# ----
# TEST GEOMETRY
# for wrist control
number_slider = Slider(420, range=0..1000)  # disabled
number_slider_2 = Slider(297, range=0..1000)  # disabled
number_slider_3 = Slider(500, range=0..500)  # disabled
number_slider_4 = Slider(100, range=0..100)  # disabled
number_slider_5 = Slider(34, range=0..100)  # disabled
number_slider_6 = Slider(10, range=0..20)  # disabled
number_slider_7 = Slider(-16, range=-45..45)  # disabled
edges = Python3Script(
    x_len=number_slider,
    y_len=number_slider_2,
    res=number_slider_3,
    rad=number_slider_4,
    amp=number_slider_5,
    freq=number_slider_6,
    tilt=number_slider_7)  # -> out, bound, flower_pts, flower_planes; inputs x_len: Double, y_len: Double, res: Int32, rad: Double; disabled
# ---------- edges: Python ----------
import Rhino.Geometry as rg
# Here we need to import math and itertools 
import math as m

bound = rg.Rectangle3d(rg.Plane.WorldXY,x_len,y_len)

def gen_points(resolution = 50, radius = 100, amplitude = 30, frequency = 3):
    pts = [] 

    for i in range(resolution):
        theta = i/(resolution-1)*m.tau
        
        # play with the radius
        r = radius + m.sin(theta*frequency) * amplitude
        pt = rg.Point3d(
                r*m.cos(theta),
                r*m.sin(theta),
                0
            )

        pts.append(pt)

    return pts

flower_pts = gen_points(resolution = res, radius = rad, amplitude = amp, frequency = freq)
flower = rg.Curve.CreateInterpolatedCurve(flower_pts,3)
flower.Domain = rg.Interval(0.0,1.0)
flower_planes = []

for f in flower_pts:

    # Identifying vectors and points to define tilted planes
    b, f_p = flower.ClosestPoint(f)
    f_o = flower.PointAt(f_p)
    f_t = flower.TangentAt(f_p)
    f_n = f_t.Clone()
    f_n.Rotate(-m.pi / 2, rg.Vector3d.ZAxis)
    f_plane = rg.Plane(f_o, f_n, f_t)
    flo_plane = f_plane.Clone()
    flo_plane.Rotate(m.radians(tilt), f_n, f_o)

    # Getting the flower onto the centre of the page
    v = rg.Vector3d(x_len/2, y_len/2, 0)
    v_move = rg.Transform.Translation(v)
    flo_plane.Transform(v_move)

    flower_planes.append(flo_plane)
# ---------- end edges ----------
number_slider_8 = Slider(100, range=0..100)  # disabled
partition = PartitionList(List=edges.flower_planes, Size=number_slider_8)  # disabled
path_mapper = PathMapper(partition, source="{A;B;C}", target="{0;path_index}")  # disabled

list = ValueList({"Param": 1, "Length": -1}, selected="Length")
list_2 = ValueList({"Paint": 1, "Swish": -1}, selected="Swish")
length_mm = Slider(11, range=0..100)

pt = ConstructPoint(XCoordinate=Slider(420, range=0..1000), YCoordinate=Slider(297, range=0..1000), ZCoordinate=Slider(0, range=0..50))

number_slider_9 = Slider(8, range=0..25)  # disabled
number_slider_10 = Slider(2, range=0..10)  # disabled
range = Range(Domain=Domain(0, 1), Steps=expr("x-1", number_slider_9))  # disabled
graph = GraphMapper(
    range,
    x0=0,
    x1=1,
    y0=0,
    y1=1,
    A=1,
    B=0,
    container_name="Linear",
    Graph_x0=0.25,
    Graph_x1=0.75,
    Graph_y0=0.25,
    Graph_y1=0.75)  # disabled
one_over_x = OneOverX(Value=number_slider_9)  # disabled
number_slider_11 = Slider(420, range=0..1000)  # disabled
number_slider_12 = Slider(297, range=0..1000)  # disabled
number_slider_13 = Slider(0.1, range=0..1)  # disabled
number_slider_14 = Slider(25, range=0..100)  # disabled
number_slider_15 = Slider(25, range=0..100)  # disabled
number_slider_16 = Slider(1, range=0..1)  # disabled
bnd = Bounds(Numbers=graph)  # disabled
multiplication = Multiplication(A=one_over_x, B=number_slider_10)  # disabled
dom = ConstructDomain(DomainStart=multiplication, DomainEnd=number_slider_16)  # disabled
remap = RemapNumbers(Value=graph, Source=bnd, Target=dom)  # -> Mapped, Clipped; disabled
ellipse_grid_points = Python3Script(
    x_bound=number_slider_11,
    y_bound=number_slider_12,
    psn_ratio=number_slider_13,
    o_x=number_slider_14,
    o_y=number_slider_15,
    steps=number_slider_9,
    step_set=remap.Mapped)  # -> out, org, rectangles, split_curves, pts; inputs x_bound: Int32, y_bound: Int32, o_x: Int32, o_y: Int32, steps: Int32, step_set: list of Double; disabled
# ---------- ellipse_grid_points: Python ----------
import Rhino.Geometry as rg
import math as m
import rhinoscriptsyntax as rs
import System
from System.Collections.Generic import List

org = rg.Point3d(o_x, o_y, 0)
l_bound = rg.Rectangle3d(rg.Plane.WorldXY,x_bound,y_bound)
s_bound = rg.Rectangle3d(rg.Plane(rg.Point3d(o_x, o_y, 0), rg.Vector3d.XAxis, rg.Vector3d.YAxis),x_bound - 2*o_x, y_bound - 2*o_y)
ellipse = [(rg.Ellipse(rg.Plane(rg.Point3d(o_x, o_y + psn_ratio * (y_bound - 2 * o_y), 0), rg.Vector3d.XAxis, rg.Vector3d.YAxis), step_set[r] * (x_bound - 2*o_x), step_set[r] * (y_bound - 2*o_y))) for r in range(len(step_set))]

# ---------- OPTIONAL: IF INCLUSIVE OF ELLIPSES BEYOND DIAGONAL ----------
# A = x_bound - 2*o_x
# B = y_bound - 2*o_y
# k = m.sqrt(2)  # scale at which the ellipse passes through s_bound's top-right corner

# plane = rg.Plane(rg.Point3d(o_x, o_y, 0), rg.Vector3d.XAxis, rg.Vector3d.YAxis)
# ellipse = [rg.Ellipse(plane, f * k * A, f * k * B) for f in step_set if f > 0]
# ------------------------------------------------------------------------

s_curve = s_bound.ToNurbsCurve()
s_curve.Domain = rg.Interval(0.0,1.0)
ellipses = [el.ToNurbsCurve() for el in ellipse]

pieces = []
inside_pieces = []

for el in ellipses:
    events = rg.Intersect.Intersection.CurveCurve(el, s_curve, 0.001, 0.001)
    params = sorted(set(ev.ParameterA for ev in events)) if events else []
    if params:
        net_params = List[System.Double]()
        for t in params:
            net_params.Add(t)
        segs = el.Split(net_params)
    else:
        segs = None
    segs = list(segs) if segs else [el]
    pieces.extend(segs)
    for s in segs:
        mid = s.PointAtNormalizedLength(0.5)
        if s_curve.Contains(mid, rg.Plane.WorldXY, 0.001) == rg.PointContainment.Inside:
            s.Domain = rg.Interval(0.0,1.0)
            inside_pieces.append(s)
split_curves = inside_pieces
rectangles = [s_bound]
# ---------- end ellipse_grid_points ----------

# ----
# DIAGRID INTERPOLATION
number_slider_17 = Slider(7, range=0..25)
one_over_x_2 = OneOverX(Value=number_slider_17)
range_2 = Range(Domain=Domain(0, 1), Steps=expr("x-1", number_slider_17))
graph_2 = GraphMapper(
    range_2,
    x0=0,
    x1=1,
    y0=0,
    y1=1,
    A=1,
    B=0,
    container_name="Linear",
    Graph_x0=0.25,
    Graph_x1=0.75,
    Graph_y0=0.25,
    Graph_y1=0.75)
number_slider_18 = Slider(420, range=0..1000)
number_slider_19 = Slider(297, range=0..1000)
number_slider_20 = Slider(25, range=0..100)
number_slider_21 = Slider(25, range=0..100)
multiplication_2 = Multiplication(A=one_over_x_2, B=Slider(3, range=0..10))
bnd_2 = Bounds(Numbers=graph_2)
dom_2 = ConstructDomain(DomainStart=multiplication_2, DomainEnd=Slider(1, range=0..1))
remap_2 = RemapNumbers(Value=graph_2, Source=bnd_2, Target=dom_2)  # -> Mapped, Clipped
ellipse_grid_points_2 = Python3Script(
    x_bound=number_slider_18,
    y_bound=number_slider_19,
    o_x=number_slider_20,
    o_y=number_slider_21,
    steps=number_slider_17,
    step_set=remap_2.Mapped)  # -> out, org, rectangles, split_curves, pts; inputs x_bound: Int32, y_bound: Int32, o_x: Int32, o_y: Int32, s_curve: Curve, steps: Int32, step_set: list of Double
# ---------- ellipse_grid_points_2: Python ----------
import Rhino.Geometry as rg
import math as m
import rhinoscriptsyntax as rs
import System
from System.Collections.Generic import List

org = rg.Point3d(o_x, o_y, 0)
l_bound = rg.Rectangle3d(rg.Plane.WorldXY,x_bound,y_bound)
s_bound = rg.Rectangle3d(rg.Plane(rg.Point3d(o_x, o_y, 0), rg.Vector3d.XAxis, rg.Vector3d.YAxis),x_bound - 2*o_x, y_bound - 2*o_y)
ellipse = [(rg.Ellipse(rg.Plane(rg.Point3d(o_x, o_y, 0), rg.Vector3d.XAxis, rg.Vector3d.YAxis), step_set[r] * (x_bound - 2*o_x), step_set[r] * (y_bound - 2*o_y))) for r in range(len(step_set))]

# ---------- OPTIONAL: IF INCLUSIVE OF ELLIPSES BEYOND DIAGONAL ----------
# A = x_bound - 2*o_x
# B = y_bound - 2*o_y
# k = m.sqrt(2)  # scale at which the ellipse passes through s_bound's top-right corner

# plane = rg.Plane(rg.Point3d(o_x, o_y, 0), rg.Vector3d.XAxis, rg.Vector3d.YAxis)
# ellipse = [rg.Ellipse(plane, f * k * A, f * k * B) for f in step_set if f > 0]
# ------------------------------------------------------------------------

if not s_curve:
    s_curve = s_bound.ToNurbsCurve()
s_curve.Domain = rg.Interval(0.0,1.0)
ellipses = [el.ToNurbsCurve() for el in ellipse]

pieces = []
inside_pieces = []

for el in ellipses:
    events = rg.Intersect.Intersection.CurveCurve(el, s_curve, 0.001, 0.001)
    params = sorted(set(ev.ParameterA for ev in events)) if events else []
    if params:
        net_params = List[System.Double]()
        for t in params:
            net_params.Add(t)
        segs = el.Split(net_params)
    else:
        segs = None
    segs = list(segs) if segs else [el]
    pieces.extend(segs)
    for s in segs:
        mid = s.PointAtNormalizedLength(0.5)
        if s_curve.Contains(mid, rg.Plane.WorldXY, 0.001) == rg.PointContainment.Inside:
            s.Domain = rg.Interval(0.0,1.0)
            inside_pieces.append(s)
split_curves = inside_pieces
rectangles = [s_bound]
# ---------- end ellipse_grid_points_2 ----------
range_3 = Range(Domain=Domain(0, 1), Steps=expr("x-1", Slider(10, range=0..50)))
graph_3 = GraphMapper(range_3, x0=0, x1=1, y0=0, y1=1, Cx=0.5036231875, Cy=0.4673913121, container_name="Conic")
crv = Curve(ellipse_grid_points_2.rectangles)
ellipse_diagrid = Python3Script(base_crvs=ellipse_grid_points_2.split_curves, step=Slider(3, range=0..10), reso_col=graph_3, deg=Slider(2, range=0..10))  # -> out, simplify(point_grid), simplify(flip_grid), simplify(point_list), simplify(select_pts), chains, intp, nurbs; inputs base_crvs: list of Curve, step: Int32, reso_col: list of Double
# ---------- ellipse_diagrid: Python ----------
import Rhino.Geometry as rg
import math as m
from ghpythonlib import treehelpers as th

pt_g = [[base_crvs[i].PointAt(j) for j in reso_col] for i in range(len(base_crvs))]
# for n, pt_grp in enumerate(pt_g):
#     if n % 2 != 0:
#         p = pt_grp[::-1]
#         pt_g[n] = p

col_no = len(reso_col)
row_no = len(base_crvs)

# Flipped the Matrix of Points
flip_pts = [[pt_g[i][j] for i in range(row_no)] for j in range(col_no)]

pt_l = []
for n_r, pt_r in enumerate(pt_g):
    sub_list = []
    if n_r < row_no - 1:
        if (row_no - 1) - n_r < step:
            rows = row_no - n_r
            for r_s in range(rows):
                sub_list.append(pt_g[n_r + r_s])
        else:
            for r_l in range(step):
                sub_list.append(pt_g[n_r + r_l])    
        pt_l.append(sub_list)

sel_pts = pt_l
# sel_pts = []
# for n_p, ptl in enumerate(pt_l):
#     sub_sel = []
#     sign = (1 if n_p % 2 == 0 else -1)
#     for s_p, ptl_sub in enumerate(ptl):
#         new_sub = ptl_sub[::sign]
#         sub_sel.append(new_sub)
#     sel_pts.append(sub_sel)        

chain_pts = []
for n_sp, spl in enumerate(sel_pts):
    ordered_pts = []
    chunk = 0
    for ss_p, sspl in enumerate(spl):
        if ss_p < len(spl) - 1:
            sign_l = (1 if ss_p % 2 == 0 else -1)
            spl_copy = spl
            l_1 = spl_copy[ss_p][::sign_l]
            l_2 = spl_copy[ss_p + 1][::sign_l]
            chunk = len(l_1)
            for stp in range(len(l_1)//2):
                ordered_pts.append(l_1[stp*2])
                ordered_pts.append(l_2[stp*2+1])
    o_pts = [ordered_pts[o:o + chunk] for o in range(0, len(ordered_pts),chunk)]
    chain_pts.append(o_pts)

intrp = [[rg.Curve.CreateInterpolatedCurve(o_lst,deg) for o_lst in pt_lst] for pt_lst in chain_pts]
for i, it in enumerate(intrp):
    for sub_i, sub_it in enumerate(it): 
        icurve = sub_it
        icurve.Domain = rg.Interval(0.0, 1.0)
        it[sub_i] = icurve
nbcb = [[rg.NurbsCurve.Create(False,deg,o_lst) for o_lst in pt_lst] for pt_lst in chain_pts]
for n, nb in enumerate(nbcb):
    for sub_n, sub_nb in enumerate(nb):
        ncurve = sub_nb
        ncurve.Domain = rg.Interval(0.0, 1.0)
        nb[sub_n] = ncurve

point_grid = th.list_to_tree(pt_g)
flip_grid = th.list_to_tree(flip_pts)
point_list = th.list_to_tree(pt_l)
select_pts = th.list_to_tree(sel_pts)
chains = th.list_to_tree(chain_pts)
intp = th.list_to_tree(intrp)
nurbs = th.list_to_tree(nbcb)
# ---------- end ellipse_diagrid ----------
generate_planes = Python3Script(interp=ellipse_diagrid.intp, nurbs=ellipse_diagrid.nurbs, centre=ellipse_grid_points_2.org, l=Slider(10, range=0..10))  # -> out, int_tree, int_vec, int_norm, nurb_tree, nurb_vec, nurb_norm; inputs interp: tree of Curve, nurbs: tree of Curve, centre: Point3d, l: Double
# ---------- generate_planes: Python ----------
import Rhino.Geometry as rg
import math as m
from ghpythonlib import treehelpers as th
import System

interp = th.tree_to_list(interp)
nurbs = th.tree_to_list(nurbs)

# Defining the parameters from the Interpolated Curve
inpt_param = [[list(i.DivideByLength(l,True)) for ni, i in enumerate(s)] for ns, s in enumerate(interp)]
# Defining the points along the Interpolated Curve
inpts = [[[interp[n_inpt][n_in].PointAt(i) for n_i, i in enumerate(inp)]for n_in, inp in enumerate(inpt)]for n_inpt, inpt in enumerate(inpt_param)]
# Defining the tangent vectors for the Interpolated Curve
intan = [[[interp[n_inpt][n_in].TangentAt(i) for n_i, i in enumerate(inp)]for n_in, inp in enumerate(inpt)]for n_inpt, inpt in enumerate(inpt_param)]
# Defining the normal vectors for the Interpolated Curve
innorm = [[[rg.Vector3d.CrossProduct(rg.Vector3d.ZAxis,interp[n_inpt][n_in].TangentAt(i)) for n_i, i in enumerate(inp)]for n_in, inp in enumerate(inpt)]for n_inpt, inpt in enumerate(inpt_param)]

# ----- Note to self on indentation for list comprehension -----
# lst_com = [
#     [
#         [
#             rg.Vector3d.CrossProduct(
#                 rg.Vector3d.ZAxis,
#                 interp[n_inpt][n_in],
#                 TangentAt(i)
#             ) for n_i, i in enumerate(inp)
#         ]for n_in, inp in enumerate(inpt)
#     ]for n_inpt, inpt in enumerate(inpt_param)
# ]


# Defining parameters from the Nurbs Curve
nbpt_param = [[list(i.DivideByLength(l,True)) for ni, i in enumerate(s)] for ns, s in enumerate(nurbs)]
# Defining the points along the Nurbs Curve
nbpts = [[[nurbs[n_nurb][n_nur].PointAt(j) for n_j, j in enumerate(nur)]for n_nur, nur in enumerate(nurb)]for n_nurb, nurb in enumerate(nbpt_param)]
# Defining tangent vectors for the Nurbs Curve
nbtan = [[[nurbs[n_nurb][n_nur].TangentAt(j) for n_j, j in enumerate(nur)]for n_nur, nur in enumerate(nurb)]for n_nurb, nurb in enumerate(nbpt_param)]
# Defining normal vectors for the Nurbs Curve
nbnorm = [[[rg.Vector3d.CrossProduct(rg.Vector3d.ZAxis,nurbs[n_nurb][n_nur].TangentAt(j)) for n_j, j in enumerate(nur)]for n_nur, nur in enumerate(nurb)]for n_nurb, nurb in enumerate(nbpt_param)]


# Converting all nested lists into readable GH_Python Formats
int_tree = th.list_to_tree(inpts)
int_vec = th.list_to_tree(intan)
int_norm = th.list_to_tree(innorm)
nurb_tree = th.list_to_tree(nbpts)
nurb_vec = th.list_to_tree(nbtan)
nurb_norm = th.list_to_tree(nbnorm)
# ---------- end generate_planes ----------
pl = ConstructPlane(Origin=generate_planes.int_tree, XAxis=generate_planes.int_vec, YAxis=generate_planes.int_norm)
pl_2 = ConstructPlane(Origin=generate_planes.nurb_tree, XAxis=generate_planes.nurb_vec, YAxis=generate_planes.nurb_norm)
path_mapper_2 = PathMapper(pl_2, source="{A;B;C}", target="{0;path_index}")
path_mapper_3 = PathMapper(pl, source="{A;B;C}", target="{0;path_index}")
transform_planes = Python3Script(
    plns=path_mapper_3,
    org=ellipse_grid_points_2.org,
    fine_cali=Slider(-1.96, range=-45..45),
    pitch_path=Slider(15, range=0..100),
    pitch_axial=Slider(5, range=0..100),
    pitch_side=Slider(27, range=-45..45),
    depth_z=Slider(0, range=0..1),
    stroke_bool=Toggle(True),
    stroke_psn=Slider(4, range=0..10),
    press=Slider(0.8, range=0..1),
    forward=Slider(43, range=0..100),
    lift=Slider(7, range=0..100))  # -> out, new_planes; inputs plns: tree of Plane, org: Point3d, fine_cali: Double, pitch_path: Double, pitch_axial: Double, pitch_side: Int32, press: Double, forward: Double, lift: Double
# ---------- transform_planes: Python ----------
import Rhino.Geometry as rg
import math as m
from ghpythonlib import treehelpers as th


# DEFINITIONS
def remap(t, oldmin, oldmax, newmin, newmax):
    return (t - oldmin)/(oldmax - oldmin)*(newmax - newmin)+newmin

# 0. Setting up environment
# A) Convert all incoming DataTrees to Nested Lists
pln_list = th.tree_to_list(plns)
# B) Creating an empty list to store transformed planes in
new_pln_list = []
# C) Identifying minimum and maximum distances of points from the origin
dist_set = {round(org.DistanceTo(i.Origin),3) for pln in pln_list for i in pln}
min_v, max_v = min(dist_set), max(dist_set)

# 1. Transforming Planes
for plns in pln_list:
    # Creating an empty sublist to store transformed planes in
    new_plns = []
    for i, pln in enumerate(plns):

        new_pln = pln.Clone() # Clones a plane
        path_v = new_pln.XAxis # Establish path vector
        path_v.Unitize # Ensure that it is a unit vector
        path_s = new_pln.YAxis # Establish normal vector
        path_s.Unitize # Ensure that it is a unit vector
        dist = round(org.DistanceTo(new_pln.Origin),2)
        new_pln.Rotate(m.radians(fine_cali), new_pln.ZAxis)
        new_pln.Rotate(m.radians(pitch_path), new_pln.YAxis)
        # Rotate the plane along its own YAxis
        new_pln.Rotate(m.radians(pitch_axial), new_pln.ZAxis)
        # Rotate the plane along its own ZAxis
        z_off = (1 - remap(dist, min_v, max_v, 0, 1)) * depth_z
        v_z = rg.Vector3d(0.0,0.0,z_off)
        z_trans = rg.Transform.Translation(v_z)
        new_pln.Transform(z_trans)
        # Calibrates the Z height based on how close the brush is to the origin
        # The closer it is to the origin, the higher the Z height should be
        
        # Optional: Add bounce to stroke
        if not stroke_bool:
            if i % 2 != 0:
                z_bounce = rg.Transform.Translation(rg.Vector3d(0.0,0.0,-press))
                new_pln.Transform(z_bounce)

        new_plns.append(new_pln)

# 2. Condition if stroke function is enabled i.e True
        if stroke_bool:
            if i % stroke_psn == 0:
                # A) Creates a plane slightly lower for pressing the brush
                press_pln = new_pln.Clone()
                v_press = rg.Vector3d(0,0,-press)
                pressing_v = rg.Transform.Translation(v_press)
                press_pln.Transform(pressing_v)

                # B) Creates a plane higher and angled for stroking
                stroke_pln = new_pln.Clone()
                z_lift = (1 - remap(dist, min_v, max_v, 0, 1)) * lift
                # v_lift = rg.Vector3d(0,0,z_lift)
                v_lift = rg.Vector3d(0,0,z_lift) + path_v * forward + path_s * pitch_side
                lifting_v = rg.Transform.Translation(v_lift)
                stroke_pln.Transform(lifting_v)
                stroke_pln.Rotate(m.radians(-2*pitch_path), stroke_pln.YAxis)
                stroke_pln.Rotate(m.radians(-2*pitch_axial), stroke_pln.ZAxis)
                # Adding tilts to the plane when lifting up

                # C) Adding new planes to script line
                new_plns.append(press_pln)
                new_plns.append(stroke_pln)
                new_plns.append(new_pln)
                # We need to add the last one in to prevent making dotted lines

    new_pln_list.append(new_plns)


new_planes = th.list_to_tree(new_pln_list)
# ---------- end transform_planes ----------

# ----
# DIAGRID INTERPOLATION
expression = Expression(
    x_span=number_slider_18,
    y_span=number_slider_19,
    x_offset=number_slider_20,
    y_offset=number_slider_21,
    Expression="(x_span - 2*x_offset)/(y_span - 2*y_offset)")
elliptical_spiral_or_swish = Python3Script(
    x_bound=Slider(420, range=0..1000),
    y_bound=Slider(297, range=0..1000),
    o_x=Slider(25, range=0..100),
    o_y=Slider(25, range=0..100),
    a=Slider(3, range=0..10),
    b=Slider(3, range=0..10),
    ratio=expression,
    res=Slider(34, range=0..100),
    rev=Slider(422, range=0..1000),
    deg=Slider(3, range=0..10),
    t_range=Slider(500, range=0..500),
    arc_h=Slider(13, range=0..100),
    length=length_mm,
    cuts=Slider(8, range=0..10),
    para_len=list,
    paint_swish=list_2)  # -> out, bound, pts, ellie, simplify(t_planes), all_arcs; inputs a: Double, b: Double, ratio: Double, res: Int32, rev: Int32, t_range: Int32, cuts: Int32, para_len: Int32
# ---------- elliptical_spiral_or_swish: Python ----------
import Rhino.Geometry as rg
import math as m

bound = rg.Rectangle3d(rg.Plane(rg.Point3d(o_x, o_y, 0), rg.Vector3d.XAxis, rg.Vector3d.YAxis),x_bound - 2*o_x, y_bound - 2*o_y)

t_step = m.pi/res
pts = [rg.Point3d(ratio*(a+(b*t_step*r))*m.cos(t_step*r),(a+(b*t_step*r))*m.sin(t_step*r), 0.0) for r in range(rev)]
for n, p in enumerate(pts):
    v_move = rg.Vector3d(x_bound/2, y_bound/2, 0.0) # Define vector to move to centre of workspace
    v_t = rg.Transform.Translation(v_move)
    p.Transform(v_t)
ellie = rg.Curve.CreateInterpolatedCurve(pts,deg)
ellie.Domain = rg.Interval(0.0,1.0)

# A) If we are dividing by parameters
if para_len == 1:
    t_list = [n/t_range for n in range(t_range+1)]
# B) If we are dividing by length
else:
    t_list = ellie.DivideByLength(length,True)
# Components to create planes
t_origins = [ellie.PointAt(t1) for t1 in t_list]
t_tangents = [ellie.TangentAt(t2) for t2 in t_list]
t_normals = [rg.Vector3d.CrossProduct(rg.Vector3d.ZAxis,t_t) for t_t in t_tangents]
# To ensure all vectors in place are unitized
for i, (t,n) in enumerate(zip(t_tangents,t_normals)):
    t.Unitize()
    n.Unitize()
    t_tangents[i] = t
    t_normals[i] = n

if paint_swish == 1:
# Option 1: Create Planes to Draw a Circle
    t_planes = [rg.Plane(t_o, t_t, t_n) for (t_o, t_t, t_n) in zip(t_origins, t_tangents, t_normals)]

else:
    # 2. Creating Swishes
    t_arccents = [t_o + rg.Vector3d(0.0, 0.0, arc_h) for t_o in t_origins]
    t_arcs = [rg.Arc(t_a-arc_h * 2 * t_n, t_o, t_a+arc_h *  2 * t_n) for (t_o, t_a, t_n) in zip(t_origins, t_arccents, t_normals)]
    for j, a in enumerate(t_arcs):
        b = a.ToNurbsCurve()
        b.Domain = rg.Interval(0.0, 1.0)
        t_arcs[j] = b
    c_arcs = []
    for l, nb in enumerate(t_arcs):
        if l < len(t_arcs) - 1:
            straight_line = rg.Line(t_arcs[l].PointAt(1.0), t_arcs[l+1].PointAt(0.0))
            straight_line.Domain = rg.Interval(0.0, 1.0)
            midpt = straight_line.PointAt(0.5)
            intermediate = midpt + rg.Vector3d(0.0, 0.0, -arc_h)
            temp_arc = rg.Arc(t_arcs[l].PointAt(1.0), intermediate, t_arcs[l+1].PointAt(0.0))
            inter_arc = temp_arc.ToNurbsCurve()
            inter_arc.Domain = rg.Interval(0.0, 1.0)
            c_arcs.append(inter_arc)
    all_arcs = []
    for t, c in zip(t_arcs, c_arcs):
        all_arcs.extend([t, c])
    all_arcs.extend(t_arcs[len(c_arcs):])

    t_planes = []
    for na, aa in enumerate(all_arcs):
        # Spiral direction at this arc: swish arcs are even (na = 2l), connectors odd
        t_ref = t_tangents[na // 2]
        ok, arc = aa.TryGetArc()
        if not ok:
            raise ValueError("arc %d is not circular" % na)
        for q in range(cuts):
            s_o = aa.PointAt(q / (cuts - 1))
            s_t = aa.TangentAt(q / (cuts - 1))
            s_n = arc.Center - s_o                     
            s_a = rg.Vector3d.CrossProduct(s_t, s_n)  
            if s_a * t_ref < 0:                        
                s_a = -s_a                             
            arc_plane = rg.Plane(s_o, s_a, rg.Vector3d.CrossProduct(s_n, s_a))
            t_planes.append(arc_plane)
# ---------- end elliptical_spiral_or_swish ----------
path_mapper_4 = PathMapper(elliptical_spiral_or_swish.t_planes, source="{A;B}", target="{A;B}")

x = Slider(10, range=0..100)  # disabled
lift_depth = Slider(10, range=0..100)  # disabled
y = Slider(-11, range=-20..20)  # disabled
vector_xyz = VectorXYZ(XComponent=x, YComponent=y, ZComponent=lift_depth)  # -> Vector, Length; disabled
number_slider_22 = Slider(8, range=0..100)  # disabled
stroke_angle = Slider(25, range=0..100)  # disabled
python_3_script = Python3Script(plns=transform_planes.new_planes, k=number_slider_22, vec_lifting=vector_xyz.Vector, angle=stroke_angle)  # -> out, new_plns; inputs plns: tree of Plane; disabled
# ---------- python_3_script: Python ----------
import Rhino.Geometry as rg
import math as m

from Grasshopper import DataTree
from Grasshopper.Kernel.Data import GH_Path
import ghpythonlib.treehelpers as tree


# Here to make the lifting stroke
def process_planes(pln_list, k, vec_lifting, stroke_angle):
    new_plns = []

    origins = [pln.Origin for pln in pln_list]
    crv = rg.Curve.CreateInterpolatedCurve(origins, 3)

    for i in range(len(pln_list)):
        new_pln = rg.Plane(pln_list[i]) 

        # k define which number points need lifting
        if i % k == 0: 

            matrix = rg.Transform.Translation(vec_lifting)

            success, t = crv.ClosestPoint(new_pln.Origin)
            vec_t = crv.TangentAt(t)

            # Decide where to flip stroke by dot product comparing to normal vectors of line (tangent)
            # Dot product < 0 means included angle 90° < θ ≤ 180°
            if vec_t * new_pln.XAxis < 0:
                new_pln.Transform(matrix)
                rotate_matrix = rg.Transform.Rotation(m.radians(stroke_angle), new_pln.YAxis, new_pln.Origin)
                new_pln.Transform(rotate_matrix)
            else:
                new_pln.Transform(matrix)
                rotate_matrix = rg.Transform.Rotation(m.radians(-stroke_angle), new_pln.YAxis, new_pln.Origin)
                new_pln.Transform(rotate_matrix)
    
        new_plns.append(new_pln)

    return new_plns



# data tree issue (Made by Claud)
out_tree = DataTree[object]()

for branch_idx in range(plns.BranchCount):
    path = plns.Path(branch_idx)      
    print(path)
    branch_plns = list(plns.Branch(branch_idx)) 

    result = process_planes(branch_plns, k, vec_lifting, angle)

    for pln in result:
        out_tree.Add(pln, path)

new_plns = out_tree
# ---------- end python_3_script ----------

pt_2 = ConstructPoint(XCoordinate="115.33", YCoordinate="529.84", ZCoordinate="-10.5")

pt_3 = ConstructPoint(XCoordinate="537.98", YCoordinate="237.03", ZCoordinate="-10.7")

pt_4 = ConstructPoint(XCoordinate="537.12", YCoordinate="530.46", ZCoordinate="-11")

# ----
# TESTING IF CALIBRATION WORKS
# Transform from Rhino to Robot Space
# 
# 1. Measure points on workspace as three corners
# 2. Make sure the coordinates are in "base" mode
# Create UR Script and send to robot!
number_slider_23 = Slider(0.1, range=0..0.1)
number_slider_24 = Slider(0.1, range=0..0.1)
python_3_script_2 = Python3Script(point=pt, acceleration=number_slider_23, velocity=number_slider_24)  # -> out, target; inputs point: Point3d
# ---------- python_3_script_2: Python ----------
import os
import sys

import Rhino
import Rhino.Geometry as rg

# find src/ relative to this Grasshopper file
gh_file = ghenv.Component.OnPingDocument().FilePath
src_folder = os.path.join(os.path.dirname(gh_file), "src")
sys.path.append(src_folder)

import simple_ur_script as ur
import simple_comm as com


target = rg.Plane(point, rg.Vector3d(1, 0, 0), rg.Vector3d(0, -1, 0))
# Negative Y value to flip plane to match robot conventions
# ---------- end python_3_script_2 ----------
rhino = Python3Script(way_planes=python_3_script_2.target, wobj_origin=pt_4, wobj_xaxis=pt_2, wobj_xypoint=pt_3)  # -> out, transformed_planes; inputs way_planes: list of Plane, wobj_origin: Point3d, wobj_xaxis: Point3d, wobj_xypoint: Point3d
# ---------- rhino: Python ----------
import Rhino.Geometry as rg
import math

# in this step we transform our way planes to robot space
# the rhino co-ordinate system is rather abstract in the physical world
# the robot base plane assumed the base frame of robot is the origin
# we want the Rhino space to correspond to the paper space
# we transform things from our design space(Rhino World XY) to Robot Base Plane that we measure

def set_robot_base(origin, xaxis, xypoint):
    """
    set a base plane representing the robot working object plane
    """
    robot_base = rg.Plane(origin, xaxis - origin, xypoint - origin)
    print (robot_base)
    return (robot_base)

def rhino_to_robot_space(rhino_plane,robot_base_plane):
    """
    Transform the objects from Rhino world XY plane to robot work object plane
    """
    T_matrix = rg.Transform.PlaneToPlane(rg.Plane.WorldXY,robot_base_plane)
    robot_plane = rhino_plane.Clone()
    # Invert plane to face Z down

    # Annotated segmemt below is if your input plane has not already been flipped
    # R = rg.Transform.Rotation(math.pi, rhino_plane.XAxis, rhino_plane.Origin)
    # robot_plane.Transform(R)

    robot_plane.Transform(T_matrix)
    return robot_plane


# ===== Robot base is set =====
robot_base =  set_robot_base(wobj_origin, wobj_xaxis, wobj_xypoint)


# ===== Transforming the rhino planes into robot planes =====
transformed_planes = []
for plane in way_planes: 
    transformed_planes.append(rhino_to_robot_space(plane, robot_base))
# ---------- end rhino ----------
number_slider_25 = Slider(0.1, range=0..0.1)
number_slider_26 = Slider(0.1, range=0..0.1)
rhino_2 = Python3Script(way_planes=rhino.transformed_planes, acceleration=number_slider_25, velocity=number_slider_26)  # -> out, script; inputs way_planes: list of Plane, acceleration: Double, velocity: Double
# ---------- rhino_2: Python ----------
from importlib import reload
import sys, os

# find src/ relative to this Grasshopper file, so the definition
# works wherever the repo is cloned
gh_file = ghenv.Component.OnPingDocument().FilePath
src_folder = os.path.join(os.path.dirname(gh_file), "src")
sys.path.append(src_folder)

import simple_ur_script as ur
reload(ur)
import utils 
reload(utils)
import simple_comm as com
reload(com)

import Rhino.Geometry as rg
import math as m

script = "" # create empty string


# add move_l commands to script for each way plane
for plane in way_planes:
    script += ur.move_l(plane, acceleration, velocity)

print(script) # script before conversion to sendable text

# format the script to make it sendable
script = com.concatenate_script(script)

print(script) # script after conversion to sendable text
# ---------- end rhino_2 ----------
robot_ip_address = Panel("192.168.10.10")
panel = Panel(rhino_2.script)

# ---- group: Send UR script to Robot!
py3 = Python3Script(script=rhino_2.script, ip_address="192.168.10.10", send=Button())  # -> out, a; inputs script: String, ip_address: String, send: Boolean
# ---------- py3: Python ----------
import simple_comm as com

if send:
    com.send_script(script,ip_address)
# ---------- end py3 ----------

# ----
# TCP Measurement
panel_2 = Panel("0.85")
pt_5 = ConstructPoint(XCoordinate=panel_2, YCoordinate="-0.67", ZCoordinate="143.75")

# ----
# Paint Location
panel_3 = Panel("213.4")
pt_6 = ConstructPoint(XCoordinate=panel_3, YCoordinate="150.3", ZCoordinate="-5")

# ---- group: Send UR script to Robot!
panel_4 = Panel("192.168.10.10")

# ----
# WORKING GROUP
# Convert Planes to URScript
# Send to Robot!
# TRANSFORMATION TO ROBOT SPACE
fine_adjust_z_mm = Slider(0, range=-5..10)
transform = Python3Script(way_planes=path_mapper_4, wobj_origin=pt_4, wobj_xaxis=pt_2, wobj_xypoint=pt_3, z_safe_margin=fine_adjust_z_mm)  # -> out, transformed_planes; inputs way_planes: tree of Plane, wobj_origin: Point3d, wobj_xaxis: Point3d, wobj_xypoint: Point3d, z_safe_margin: Double
# ---------- transform: Python ----------
import Rhino.Geometry as rg
import math

import ghpythonlib.treehelpers as th

way_planes = th.tree_to_list(way_planes)

# in this step we transform our way planes to robot space
# the rhino co-ordinate system is rather abstract in the physical world
# the robot base plane assumed the base frame of robot is the origin
# we want the Rhino space to correspond to the paper space
# we transform things from our design space(Rhino World XY) to Robot Base Plane that we measure


def set_robot_base(origin, xaxis, xypoint):
    """
    set a base plane representing the robot working object plane
    """
    robot_base = rg.Plane(origin, xaxis - origin, xypoint - origin)
    print (robot_base)
    return (robot_base)

def rhino_to_robot_space(rhino_plane,robot_base_plane):
    """
    Transform the objects from Rhino world XY plane to robot work object plane
    """
    T_matrix = rg.Transform.PlaneToPlane(rg.Plane.WorldXY,robot_base_plane)
    robot_plane = rhino_plane.Clone()
    # Invert plane to face Z down
    R = rg.Transform.Rotation(math.pi, rhino_plane.XAxis, rhino_plane.Origin)
    robot_plane.Transform(R)
    robot_plane.Transform(T_matrix)
    return robot_plane

def set_z_safe_margin(planes_to_adjust, safety_margin):
    adjusted_way_planes = []
    for plane in planes_to_adjust:
        plane.OriginZ += safety_margin
        adjusted_way_planes.append(plane)
    return adjusted_way_planes

# ===== Robot base is set =====
robot_base =  set_robot_base(wobj_origin, wobj_xaxis, wobj_xypoint)

# ===== Set safety margin for Z height ======
safer_planes = [set_z_safe_margin(planes, z_safe_margin) for planes in way_planes]

# ===== Transforming the rhino planes into robot planes =====
transformed_planes = []
for planes in way_planes:
    sub_planes = []
    for plane in planes: 
        sub_planes.append(rhino_to_robot_space(plane, robot_base))
    transformed_planes.append(sub_planes)

transformed_planes = th.list_to_tree(transformed_planes)

# f_plane = transformed_planes[0]
# ---------- end transform ----------
acceleration_m_s2 = Slider(1, range=0..1)
speed_m_s = Slider(1, range=0..1)
lift_distance = Slider(100, range=0..100)
w3_angle_at_reset = Slider(149.86, range=-359..359)
py3_2 = Python3Script(ip_address=panel_4)  # -> out, w3, joints
# ---------- py3_2: Python ----------
# =============================================================================
# GH Python 3 component : "W3 Read"           (Phase 1b, optional)
# -----------------------------------------------------------------------------
# Reads the robot's current joint angles once, when the button is pressed.
# Moves nothing. The pendant's Move tab shows the same values.
#
# INPUTS
#   ip_address  Item, str   <- same panel as the send component (192.168.10.10)
#   read        Item, bool  <- a Button
# OUTPUTS
#   w3      Wrist 3 in degrees (None if the read failed)
#   joints  all six joints in degrees
# =============================================================================

import sys, os

# --- 1. Make src/ importable (same pattern as your other components) --------
gh_file = ghenv.Component.OnPingDocument().FilePath
sys.path.append(os.path.join(os.path.dirname(gh_file), "src"))
import simple_comm as com

w3 = None
joints = None

# --- 2. Read only on a button press ------------------------------------------
if read:
    try:
        # listen_to_robot opens port 30003, reads one packet and closes it.
        chunks = com.listen_to_robot(ip_address)
        # 'actual_joints' is a generator that can only be used once,
        # so turn it into a list straight away.
        joints = list(chunks["actual_joints"])
        w3 = joints[5]                    # index 5 = Wrist 3
    except Exception as e:
        # Known failures inside simple_comm (not fixed, since src/ stays as is):
        #  - no connection -> NameError, because 'traceback' is not imported
        #  - a partial packet -> struct.error while unpacking
        # Pressing the button again usually works for the second one.
        print("Read failed, press again:", e)
# ---------- end py3_2 ----------

panel_5 = Panel(transform.transformed_planes)
viewer = ParamViewer(transform.transformed_planes)

# ---- group: Responsible for checking when angles break
list_3 = ValueList({"Negative": -1, "Positive": -1}, selected="Negative")
angle_after_dip = Slider(150, range=0..1000)
w3_check = Python3Script(
    way_planes=transform.transformed_planes,
    paint_location=pt_6,
    w_pot=angle_after_dip,
    w3_sign=list_3,
    limit=Slider(359, range=-360..360),
    margin=Slider(30, range=-30..30))  # -> out, status, segments, targets, w_min, w_max, report; inputs way_planes: tree of Plane, paint_location: Point3d, w_pot: Double, w3_sign: Double, limit: Double, margin: Double
# ---------- w3_check: Python ----------
# =============================================================================
# GH Python 3 component : "W3 Check"          (Phase 1a + Phase 2)
# -----------------------------------------------------------------------------
# READ-ONLY. Nothing is sent to the robot.
#
# Purpose: for every stroke, predict how far Wrist 3 turns, choose a starting
# Wrist 3 angle that keeps the whole stroke inside +-(limit - margin), and cut
# strokes into pieces when no starting angle works.
#
# Model used (an ASSUMPTION - validate it with the Phase 1b dry run):
#   * Wrist 3 changes by  w3_sign x (change of the brush heading seen from above)
#   * every move_l takes the shorter way round (a step < 180 deg)


import math
# Set an angle between two planes that makes it hard for prediction of wrist rotation
AMBIGUOUS_STEP = 150.0

# DEFINITIONS

# A) Rounding Angles
def wrap180(a):
    # Ensures that any angle computed would then be rounded to range [-180, 180]
    a = (a + 180.0) % 360.0 - 180.0
    return 180.0 if a == -180.0 else a      # keep +180 rather than -180


# B) Limiting Wrist Rotations per stroke (brush heading dependent on stroke sign)
def relative_profile(headings, sign):
    rel = [0.0]
    largest = 0.0
    for a, b in zip(headings[:-1], headings[1:]):   
        # walk neighbouring pairs
        d = wrap180(b - a)                          
        # shorter-way heading change
        largest = max(largest, abs(d))
        rel.append(rel[-1] + sign * d)              
        # accumulate as Wrist 3
    return rel, largest
    # rel: change of wrist 3 from the first plane (except r[0] which is always 0)
    # largest: biggest jump in angles between consecutive planes


# C) Choosing the angle of wrist 3 at the start of the stroke
def choose_start(w0, rel, band):
    """w0   : start angle the robot would pick on its own (shorter way from the pot)
    rel  : output of relative_profile for this stroke
    band : usable range, limit - margin
    The same brush heading can be reached at w0, w0 +- 360, w0 +- 720 ...
    We need a start w with  -band <= w + rel <= band  for every plane, i.e.
        lo = -band - min(rel)   <=   w   <=   hi = band - max(rel)
    Returns (start angle, 'OK' | 'FORCE') or (None, 'SPLIT')."""
    lo = -band - min(rel)
    hi = band - max(rel)
    if lo <= w0 <= hi:                      # the robot's own choice is already safe
        return w0, "OK"
    # try the same heading one or two full turns away
    cands = [w0 + 360.0 * k for k in (-2, -1, 1, 2) if lo <= w0 + 360.0 * k <= hi]
    if not cands:                           # no full-turn shift fits -> must split
        return None, "SPLIT"
    centre = 0.5 * (lo + hi)                # prefer the one with most room both ways
    return min(cands, key=lambda w: abs(w - centre)), "FORCE"


# -----------------------------------------------------------------------------
# SECTION 4 - Cut a stroke that turns too far
# -----------------------------------------------------------------------------
def split_ranges(rel, max_span):
    """Walk along the stroke and start a new piece just before the total Wrist 3
    turning of the current piece would exceed max_span.
    Returns a list of (first index, last index), both inclusive.
    Neighbouring pieces share the plane at the cut, so the line is continuous."""
    ranges = []
    s = 0                                   # first plane of the current piece
    lo = hi = rel[0]                        # Wrist 3 extremes of the current piece
    for j in range(1, len(rel)):
        lo2, hi2 = min(lo, rel[j]), max(hi, rel[j])
        if hi2 - lo2 > max_span:            # adding plane j would make it too long
            ranges.append((s, j - 1))       # close the piece at the previous plane
            s = j - 1                       # new piece starts at that same plane
            lo, hi = min(rel[j - 1], rel[j]), max(rel[j - 1], rel[j])
        else:
            lo, hi = lo2, hi2
    ranges.append((s, len(rel) - 1))        # the last piece runs to the end
    return ranges


# -----------------------------------------------------------------------------
# SECTION 5 - Plan all strokes
# -----------------------------------------------------------------------------
def plan_strokes(stroke_headings, h_pot, w_pot, sign, limit, margin):
    """stroke_headings : list (one per stroke) of plane headings [deg]
    h_pot  : heading of the brush above the paint pot [deg]
    w_pot  : measured Wrist 3 above the pot [deg]
    Returns one dict per (possibly split) segment."""
    band = limit - margin
    # A piece that turns Wrist 3 by at most (2 x band - 360) ALWAYS has a safe
    # start, because the window [lo, hi] is then at least 360 deg wide and must
    # contain one of w0, w0 +- 360, ...  (checked in test_w3.py)
    max_span = 2.0 * band - 360.0
    if max_span < 180.0:
        raise ValueError(
            "limit - margin = %.0f deg is too tight for this method (needs >= 270)." % band)

    plan = []
    for i, h in enumerate(stroke_headings):
        if len(h) == 0:                     # skip empty branches
            continue
        rel, largest = relative_profile(h, sign)
        # what the robot would do by itself: shorter way from the pot heading
        w0 = w_pot + sign * wrap180(h[0] - h_pot)
        target, status = choose_start(w0, rel, band)

        if target is not None:              # whole stroke fits in one piece
            pieces = [(0, len(h) - 1, target, status)]
        else:                               # cut it, then plan each piece
            pieces = []
            for a, b in split_ranges(rel, max_span):
                sub = [r - rel[a] for r in rel[a:b + 1]]          # re-zero at the cut
                w0s = w_pot + sign * wrap180(h[a] - h_pot)
                t, st = choose_start(w0s, sub, band)
                pieces.append((a, b, t, "SPLIT-" + st))

        for a, b, t, st in pieces:
            sub = [r - rel[a] for r in rel[a:b + 1]]
            _, big = relative_profile(h[a:b + 1], sign)
            if big > AMBIGUOUS_STEP:        # flag pieces the model cannot trust
                st += " + AMBIGUOUS"
            plan.append({
                "stroke": i, "start": a, "end": b, "target": t, "status": st,
                "w_min": None if t is None else t + min(sub),
                "w_max": None if t is None else t + max(sub),
            })
    return plan


# =============================================================================
# SECTION 6 - Grasshopper glue (only this part needs Rhino)
# =============================================================================
import Rhino.Geometry as rg
import ghpythonlib.treehelpers as th


def heading(plane):
    """Direction of the plane's X axis seen from above, in degrees,
    measured in the robot base frame (the planes are already in robot space)."""
    x = plane.XAxis
    return math.degrees(math.atan2(x.Y, x.X))


# --- 6a. Defaults for unconnected inputs ------------------------------------
report = []
if w_pot is None:
    w_pot = 0.0
    report.append("WARNING: w_pot not given, assumed 0. Measure it before painting.")
if w3_sign is None:
    w3_sign = -1.0
if limit is None:
    limit = 360.0
if margin is None:
    margin = 30.0
w3_sign = 1.0 if w3_sign > 0 else -1.0       # force exactly +1 or -1

# --- 6b. Read the strokes the same way 'create script' does ------------------
strokes = th.tree_to_list(way_planes)

# --- 6c. Heading above the pot: identical plane to the one in 'create script'
paint_plane = rg.Plane(paint_location, -rg.Vector3d.XAxis, rg.Vector3d.YAxis)
h_pot = heading(paint_plane)

# --- 6d. Run the plan ---------------------------------------------------------
plan = plan_strokes([[heading(p) for p in w] for w in strokes],
                    h_pot, w_pot, w3_sign, limit, margin)

# --- 6e. Outputs --------------------------------------------------------------
# each segment = a slice of its original stroke (cut planes appear in both pieces)
segments = th.list_to_tree([strokes[s["stroke"]][s["start"]:s["end"] + 1] for s in plan])
targets = [s["target"] for s in plan]
status = [s["status"] for s in plan]
w_min = [s["w_min"] for s in plan]
w_max = [s["w_max"] for s in plan]
for k, s in enumerate(plan):
    if s["target"] is None:
        report.append("seg %d (stroke %d): NO SOLUTION" % (k, s["stroke"]))
    else:
        report.append("seg %d (stroke %d, planes %d-%d): %s  start %.0f  range [%.0f, %.0f]" % (
            k, s["stroke"], s["start"], s["end"], s["status"],
            s["target"], s["w_min"], s["w_max"]))
# ---------- end w3_check ----------

# ----
branch = TreeBranch(Tree=w3_check.segments, Path="{0;1}", MaintainPaths=True)
viewer_2 = ParamViewer(w3_check.segments)

create_script = Python3Script(
    way_planes=w3_check.segments,
    tcp_measured=pt_5,
    acceleration=acceleration_m_s2,
    velocity=speed_m_s,
    paint_location=pt_6,
    lift_distance=lift_distance,
    r=w3_angle_at_reset,
    w3_targets=w3_check.targets,
    w_pot=angle_after_dip,
    w3_sign=list_3,
    max_turn_step=Slider(90, range=0..100),
    turn_acc=Slider(0.1, range=0..0.1),
    turn_vel=Slider(0.1, range=0..0.1))  # -> out, viz_planes, script; inputs way_planes: tree of Plane, tcp_measured: Point3d, acceleration: Double, velocity: Double, paint_location: Point3d, w3_targets: list of Double
# ---------- create_script: Python ----------
from importlib import reload
import sys, os
import Rhino.Geometry as rg
import math as m
import ghpythonlib.treehelpers as th

# find src/ relative to this Grasshopper file, so the definition
# works wherever the repo is cloned
gh_file = ghenv.Component.OnPingDocument().FilePath
src_folder = os.path.join(os.path.dirname(gh_file), "src")
sys.path.append(src_folder)

import simple_ur_script as ur
reload(ur)
import utils 
reload(utils)
import simple_comm as com
reload(com)

way_planes = th.tree_to_list(way_planes)


def safety_plane(plane, distance):
    lifted = rg.Plane(plane)
    # move in world Z to lift it
    T = rg.Transform.Translation(rg.Vector3d.ZAxis * distance)
    # apply transformation
    lifted.Transform(T)
    return lifted


def dip_brush(paint_location, lift_distance, accel, vel):
    # a point has no orientation, we can use the default xy plane
    # flipped so the tool points down into the pot
    paint_plane = rg.Plane(paint_location, -rg.Vector3d.XAxis, rg.Vector3d.YAxis)
    # paint_plane = rg.Plane(paint_location, -rg.Vector3d.XAxis, rg.Vector3d.YAxis)
    above_paint = safety_plane(paint_plane, lift_distance)

    # of the pot, the brush arcs above the paint and comes out dry
    dip_script = ""
    dip_script += ur.move_j([m.radians(58.17), m.radians(-51.89), m.radians(-113.89), m.radians(-105.08), m.radians(90.30), m.radians(r)],1, 1)
    dip_script += ur.move_l(above_paint, accel, vel)
    dip_script += ur.move_l(paint_plane, accel, vel)
    dip_script += ur.move_l(above_paint, accel, vel)

    dip_planes = [above_paint, paint_plane, above_paint]

    return dip_script, dip_planes


script = "" # create empty string
viz_planes = [] # every frame the tool visits, in order, to draw the path later

# Step 1: SET TCP!! MAKE SURE THIS MATCHES YOUR BRUSH
script += ur.set_tcp_by_angles(tcp_measured.X, tcp_measured.Y, tcp_measured.Z, m.radians(0.0),m.radians(0.0),m.radians(0))

print(way_planes)

for i, w in enumerate(way_planes):
    dip_script, dip_planes = dip_brush(
        paint_location,
        lift_distance,
        acceleration,
        velocity
    )
    script += dip_script
    if i == 0:
        script += ur.sleep(10)
    viz_planes.extend(dip_planes)
    approach = safety_plane(w[0], lift_distance)
    script += ur.move_l(approach, acceleration, velocity)
    viz_planes.append(approach)
    blend_radii = utils.calculate_blend_radius(w, 2)
    blend_radii[0] = 0.0
    for plane, radius in zip(w, blend_radii):
        script += ur.move_l_blend(plane, acceleration, velocity, radius)
        viz_planes.append(plane)
    
    retract = safety_plane(w[-1], lift_distance)
    script += ur.move_l(retract, acceleration, velocity)
    viz_planes.append(retract)

paint_plane = rg.Plane(paint_location, -rg.Vector3d.XAxis, rg.Vector3d.YAxis)
endpt = safety_plane(paint_plane, lift_distance)
script += ur.move_l(endpt, acceleration, velocity)

# format the script to make it sendable
script = com.concatenate_script(script)
# ---------- end create_script ----------
report = Panel(w3_check.report)
panel_6 = Panel(create_script.script)

polyline = PolyLine(Vertices=create_script.viz_planes, Closed=False)
custom_preview = CustomPreview(Geometry=polyline, Material=ColourSwatch(SwatchColor=RGB(255, 0, 212)))
plane = Plane(create_script.viz_planes)
lng = ListLength(List=w3_check.segments)
avr = Average(Input=flatten(lng))

# ---- group: Send UR script to Robot! (continued)
py3_3 = Python3Script(script=create_script.script, ip_address=panel_4, send=Button())  # -> out, a; inputs script: String, ip_address: String, send: Boolean; same code as py3

# ----
panel_7 = Panel(avr)
create_script_2 = Python3Script(
    way_planes=transform.transformed_planes,
    tcp_measured=pt_5,
    acceleration=acceleration_m_s2,
    velocity=speed_m_s,
    paint_location=pt_6,
    lift_distance=lift_distance,
    r=w3_angle_at_reset)  # -> out, viz_planes, script; inputs way_planes: tree of Plane, tcp_measured: Point3d, acceleration: Double, velocity: Double, paint_location: Point3d; same code as create_script

# ---- group: Visualisation
polyline_2 = PolyLine(Vertices=create_script_2.viz_planes, Closed=False)
custom_preview_2 = CustomPreview(Geometry=polyline_2, Material=ColourSwatch(SwatchColor=RGB(255, 0, 212)))
plane_2 = Plane(create_script_2.viz_planes)
