# Grasshopper definition (3types_bricks)brick_to_robot.gh (Grasshopper 1.0.8)
# plug-ins: Bifocals

python_3_script = Python3Script(
    row=Slider(24, range=0..100),
    layers=Slider(10, range=0..10),
    freq=Slider(50, range=0..100),
    amp=Slider(45, range=0..100),
    freq_b=Slider(5.7, range=0..15),
    amp_height=Slider(14, range=0..100),
    phase_step=Slider(37, range=0..100))  # -> out, pts; inputs row: Int32, layers: Int32
# ---------- python_3_script: Python ----------
from compas.geometry import Point
from brick_wall import Brick
import math as m

pts = []


for i in range(row):
    for k in range(layers):
            freq_k = freq * (1 + k * freq_b)
            if k == 0:
                y =  Brick.LENGTH + m.sin(i * freq + 0.3) * amp 
            else:
                y = pts[-1].y + amp_height *  m.sin(k *freq_b) 

            pt =Point(i * Brick.WIDTH, y, k * Brick.HEIGHT)
            pts.append(pt)
# ---------- end python_3_script ----------
compas_draw = COMPASDraw(cg=python_3_script.pts)  # -> rg
#   port cg: The COMPAS geometry or datastructure to be drawn.
#   port rg: The Rhino geometry object.
# ---------- compas_draw: Python ----------
# r: compas>=2.14.1
"""
Draws COMPAS geometry in Grasshopper.
"""

from typing import Any

import Grasshopper

from compas.scene import SceneObject


class CompasToRhinoGeometry(Grasshopper.Kernel.GH_ScriptInstance):
    def RunScript(self, cg):
        if not cg:
            return None

        return SceneObject(item=cg).draw()
# ---------- end compas_draw ----------

# ---- group: This is needed only ONCE in the GH definition
enable_auto_reload = Python3Script()  # -> ok
# ---------- enable_auto_reload: Python ----------
"""
------------------------------
Using VS Code as Python editor
------------------------------

The simplest way to start using VS Code as our editor, is
to place our Python code in files located IN THE SAME FOLDER as our Grasshopper file.

After we have done that, we need 2 steps: 

1. Enable the COMPAS reloader on one component. This tells Grasshopper to watch for changes in the Pythoh files and reload if changed.
2. Every other component that uses Python code from external files needs to start with a method to ensure Grasshopper knows where to load the files from.

"""
# r: compas
# venv: mas-2627

from compas_rhino.devtools import DevTools
DevTools.enable_reloader()
# ---------- end enable_auto_reload ----------

# ----
point = Point(<point referenced from the Rhino model>)
point_2 = Point(<point referenced from the Rhino model>)
point_3 = Point(<point referenced from the Rhino model>)

curve = Curve(<curve referenced from the Rhino model>)
curve_2 = Curve(<curve referenced from the Rhino model>)
gap = Slider(8.8, range=0..10)
point_4 = Point(<point referenced from the Rhino model>)
point_5 = Point(<point referenced from the Rhino model>)
point_6 = Point(<point referenced from the Rhino model>)
point_7 = Point(<point referenced from the Rhino model>)
point_8 = Point(<point referenced from the Rhino model>)
point_9 = Point(<point referenced from the Rhino model>)
construct_point = ConstructPoint(
    XCoordinate=Slider(636.12, range=0..1000),
    YCoordinate=Slider(49.37, range=0..1000),
    ZCoordinate=Slider(163.88, range=0..1000))
lamcp_bridge = LAMCPBridge(enable=Toggle(True))  # -> status; inputs enable: Boolean, port: Int32
#   port enable: Toggle to start (True) or stop (False) the local HTTP server.
#   port port: Port to listen on (loopback only). Defaults to 8765.
#   port status: Current server status string.
# ---------- lamcp_bridge: Python ----------
"""
LAMCP Bridge: local HTTP server inside Rhino 8 / Grasshopper CPython.

Exposes `POST /exec` (JSON: `{"code": "...", "timeout": 30}`) which
exec()s `code` and returns
`{"stdout": "...", "stderr": "...", "result": "...", "error": null|str}`.

Pair with the `lamcp` FastMCP server, which translates Claude's
`run_python_script` MCP tool calls into POSTs to this endpoint.

Binds to 127.0.0.1 only. NEVER expose beyond localhost â€” it exec()s
arbitrary Python with full Rhino API access.

LAMCP v0.1.0
"""

import contextlib
import io
import json
import threading
import traceback
from http.server import BaseHTTPRequestHandler
from http.server import HTTPServer

import Grasshopper
import scriptcontext as sc


SHARED_GLOBALS_KEY = "_lamcp_bridge_globals"
SERVER_KEY = "_lamcp_bridge_server"


def _exec_code(code, timeout):
    """Run `code` on the HTTP-server thread and capture stdout/stderr/result.

    NOTE: this is intentionally NOT marshalled to Rhino's UI thread for the
    spike â€” `Rhino.RhinoApp.InvokeOnUiThread` was queueing actions that
    never fired in Rhino 8 CPython. Most read-only RhinoCommon access is
    safe cross-thread; mutations may crash. Add Eto-based marshalling
    back here when we need it.
    """
    out = io.StringIO()
    err = io.StringIO()
    g = sc.sticky.setdefault(SHARED_GLOBALS_KEY, {"__name__": "__lamcp_bridge__"})
    error_text = None
    result_repr = None
    try:
        with contextlib.redirect_stdout(out), contextlib.redirect_stderr(err):
            exec(code, g, g)
            result_repr = repr(g.get("_"))
    except BaseException:
        error_text = traceback.format_exc()

    return {
        "stdout": out.getvalue(),
        "stderr": err.getvalue(),
        "result": result_repr,
        "error": error_text,
    }


class _ExecHandler(BaseHTTPRequestHandler):
    # Silence default request logging so it doesn't clog the Rhino command line.
    def log_message(self, fmt, *args):
        pass

    def _send(self, code, payload):
        body = json.dumps(payload).encode("utf-8")
        self.send_response(code)
        self.send_header("Content-Type", "application/json")
        self.send_header("Content-Length", str(len(body)))
        self.end_headers()
        self.wfile.write(body)

    def do_GET(self):
        if self.path == "/health":
            self._send(200, {"status": "ok"})
        else:
            self._send(404, {"error": "not found"})

    def do_POST(self):
        if self.path != "/exec":
            self._send(404, {"error": "not found"})
            return
        length = int(self.headers.get("Content-Length", "0"))
        try:
            raw = self.rfile.read(length).decode("utf-8")
            body = json.loads(raw)
            code = body.get("code", "")
            timeout = float(body.get("timeout", 30.0))
        except Exception as exc:
            self._send(400, {"error": "bad request: " + repr(exc)})
            return
        result = _exec_code(code, timeout)
        self._send(200, result)


def _start_server(port):
    server = HTTPServer(("127.0.0.1", port), _ExecHandler)
    thread = threading.Thread(
        target=server.serve_forever, daemon=True, name="lamcp-bridge"
    )
    thread.start()
    return {"server": server, "thread": thread, "port": port}


def _stop_server(state):
    try:
        state["server"].shutdown()
        state["server"].server_close()
    except Exception:
        pass


class LamcpBridgeComponent(Grasshopper.Kernel.GH_ScriptInstance):
    def RunScript(self, enable: bool, port: int):
        port = int(port) if port else 8765

        state = sc.sticky.get(SERVER_KEY)

        if not enable:
            if state is not None:
                _stop_server(state)
                del sc.sticky[SERVER_KEY]
            return "stopped"

        # Already running on the requested port: no-op.
        if (
            state is not None
            and state.get("port") == port
            and state["thread"].is_alive()
        ):
            return "listening on http://127.0.0.1:{}".format(port)

        # Port changed or server died: tear down and restart.
        if state is not None:
            _stop_server(state)
            del sc.sticky[SERVER_KEY]

        try:
            sc.sticky[SERVER_KEY] = _start_server(port)
        except OSError as exc:
            ghenv.Component.AddRuntimeMessage(  # noqa: F821
                Grasshopper.Kernel.GH_RuntimeMessageLevel.Error,
                "Failed to bind 127.0.0.1:{}: {}".format(port, exc),
            )
            return "error: {}".format(exc)

        return "listening on http://127.0.0.1:{}".format(port)
# ---------- end lamcp_bridge ----------

number_slider = Slider(0.6, range=0..1)  # disabled
number_slider_2 = Slider(7, range=0..10)  # disabled
# Domino
number_slider_3 = Slider(1, range=0..30)  # disabled
gap_2 = Slider(10, range=0..10)  # disabled
curve_3 = Curve(<curve referenced from the Rhino model>)  # disabled
brick_wall = Python3Script(crv=curve_3, num_layers=number_slider_3, gap=gap_2, shift=number_slider_2)  # -> bricks, geometries, frames, compas_crv, number_of_bricks; inputs crv: Curve, num_layers: Int32, gap: Double; disabled
# ---------- brick_wall: Python ----------
# r : compas 
# venv: mas-2627
from compas_rhino.devtools import DevTools
DevTools.ensure_path()

from compas.geometry import Box
from compas.geometry import Vector, cross_vectors
from compas.geometry import Frame

from compas_rhino.conversions import curve_to_compas

from brick_wall import Brick

brick = Brick(length=10, width=15, height=32)

bricks = []

compas_crv = curve_to_compas(crv)
compas_crv.translate([0,0,brick.height/2])

length = brick.length + gap
params, points= compas_crv.divide_by_length(length, True)

for param, pt in zip(params, points):
    tangent = compas_crv.tangent_at(param)
    # pt.z += brick.height
    frame = Frame(pt, xaxis = tangent, yaxis = cross_vectors(tangent, [0,0,1]))

    my_brick = Brick(frame, brick.length, brick.width, brick.height)
    bricks.append(my_brick)


geometries = []
frames = []
for brick in bricks:
    geometries.append(brick.draw())
    frames.append(brick.get_pick_frame())

number_of_bricks = len(frames)
# ---------- end brick_wall ----------
compas_draw_2 = COMPASDraw(cg=brick_wall.compas_crv)  # -> rg; disabled; same code as compas_draw
compas_draw_3 = COMPASDraw(cg=brick_wall.geometries)  # -> rg; disabled; same code as compas_draw
number_of_bricks = Panel(brick_wall.number_of_bricks)  # disabled

# ----
# Circle
number_slider_4 = Slider(3, range=0..30)
gap_3 = Slider(5.8, range=0..10)
curve_4 = Curve(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)
brick_wall_2 = Python3Script(crv=curve_4, num_layers=number_slider_4, gap=gap_3, shift=Slider(5, range=0..10))  # -> bricks, geometries, frames, number_of_bricks; inputs crv: Curve, num_layers: Int32, gap: Double
# ---------- brick_wall_2: Python ----------
# r: compas
# venv: mas-2627
from compas_rhino.devtools import DevTools
DevTools.ensure_path()

# 0. Import everything we will need
import math
from compas.geometry import Box
from compas.geometry import Point, Vector
from compas.geometry import Frame
from compas.geometry import cross_vectors
from compas.geometry import Translation

from compas_rhino.conversions import curve_to_compas


# ..also import our module "brick_wall.py", that needs to be in the same folder as our GH file
from brick_wall import Brick

# 1. Start with an empty list of bricks to be created
bricks = []

# 2. Create points on curve curve
compas_crv = curve_to_compas(crv)
print(compas_crv.point_at(0))
compas_crv.translate([0,0,Brick.HEIGHT/2])
print(compas_crv.point_at(0))

# Divide the curve
length = (Brick.LENGTH + gap)/2
params, points = compas_crv.divide_by_length(length, True)

for i in range(num_layers):
    for j, (param, pt) in enumerate(zip(params, points)):
        if i % 2 == j % 2: #briliant method
            tangent = compas_crv.tangent_at(param)
            normal = cross_vectors(tangent, [0,0,1])

            if i % 2 == 1:
                pt = pt + tangent * (- shift)
            pt.z += i * Brick.HEIGHT

            frame = Frame(pt, xaxis = tangent, yaxis = normal)

            my_brick = Brick(frame)
            bricks.append(my_brick)


# Visualize and store brick data
geometries = []
frames = []
for brick in bricks:
    geometries.append(brick.draw())
    frames.append(brick.get_pick_frame())


number_of_bricks = len(frames)
# ---------- end brick_wall_2 ----------
compas_draw_4 = COMPASDraw(cg=brick_wall_2.geometries)  # -> rg; same code as compas_draw
number_of_bricks_2 = Panel(brick_wall_2.number_of_bricks)

# ----
# Straight line
number_slider_5 = Slider(3, range=0..30)  # disabled
number_slider_6 = Slider(0.6, range=0..1)  # disabled
number_slider_7 = Slider(7, range=0..10)  # disabled
gap_4 = Slider(3, range=0..10)  # disabled
# Generate Geometry
curve_5 = Curve(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)  # disabled
brick_wall_3 = Python3Script(crv=curve_5, num_layers=number_slider_5, gap=gap_4, shift=number_slider_7)  # -> bricks, geometries, frames, compas_crv, number_of_bricks; inputs crv: Curve, num_layers: Int32, gap: Double; disabled
# ---------- brick_wall_3: Python ----------
# r: compas
# venv: mas-2627
from compas_rhino.devtools import DevTools
DevTools.ensure_path()

# 0. Import everything we will need
import math
from compas.geometry import Box
from compas.geometry import Point, Vector
from compas.geometry import Frame
from compas.geometry import cross_vectors
from compas.geometry import Translation

from compas_rhino.conversions import curve_to_compas


# ..also import our module "brick_wall.py", that needs to be in the same folder as our GH file
from brick_wall import Brick

# 1. Start with an empty list of bricks to be created
bricks = []

# 2. Create points on curve curve
compas_crv = curve_to_compas(crv)
compas_crv.translate([0,0,Brick.HEIGHT/2])

# Divide the curve
length = (Brick.LENGTH + gap)/2
params, points = compas_crv.divide_by_length(length, True)

for i in range(num_layers):
    for j, (param, pt) in enumerate(zip(params, points)):
        if i % 2 == j % 2: #briliant method
            tangent = compas_crv.tangent_at(param)
            normal = cross_vectors(tangent, [0,0,1])

            if i % 2 == 1:
                pt = pt + tangent * (- shift)
            pt.z += i * Brick.HEIGHT 

            frame = Frame(pt, xaxis = tangent, yaxis = normal)

            my_brick = Brick(frame)
            bricks.append(my_brick)


# Visualize and store brick data
geometries = []
frames = []
for brick in bricks:
    geometries.append(brick.draw())
    frames.append(brick.get_pick_frame())


number_of_bricks = len(frames)
# ---------- end brick_wall_3 ----------
compas_draw_5 = COMPASDraw(cg=brick_wall_3.compas_crv)  # -> rg; disabled; same code as compas_draw
number_of_bricks_3 = Panel(brick_wall_3.number_of_bricks)  # disabled
compas_draw_6 = COMPASDraw(cg=brick_wall_3.geometries)  # -> rg; disabled; same code as compas_draw

py3 = Python3Script(origin=point, xaxis_pt=point_4, xy_pt=point_5)  # -> out, pick_frame; inputs origin: Point3d, xaxis_pt: Point3d, xy_pt: Point3d
# ---------- py3: Python ----------
from compas.geometry import Frame, Point, Vector
from compas.geometry import Rotation

from compas_rhino.conversions import point_to_compas

origin = point_to_compas(origin)
xaxis_pt = point_to_compas(xaxis_pt)
xy_pt = point_to_compas(xy_pt)

#define pick frame
pick_frame = Frame(origin, xaxis_pt - origin, xy_pt - origin)
# ---------- end py3 ----------
py3_2 = Python3Script(origin=point_2, xaxis_pt=point_6, xy_pt=point_7)  # -> out, pick_frame; inputs origin: Point3d, xaxis_pt: Point3d, xy_pt: Point3d; same code as py3
py3_3 = Python3Script(origin=point_3, xaxis_pt=point_8, xy_pt=point_9)  # -> out, pick_frame; inputs origin: Point3d, xaxis_pt: Point3d, xy_pt: Point3d; same code as py3
brick_wall_4 = Python3Script(crv=curve_2, layers=Slider(2, range=0..10), lapping=Slider(3, range=0..5), pick_number=Slider(6, range=0..100), gap=gap)  # -> bricks, geometries, frames, number_of_bricks; inputs crv: Curve, layers: Int32, pick_number: Int32
# ---------- brick_wall_4: Python ----------
# r : compas 
# venv: mas-2627
from compas_rhino.devtools import DevTools
DevTools.ensure_path()

from compas.geometry import Box, Point
from compas.geometry import Vector, cross_vectors
from compas.geometry import Frame

from compas_rhino.conversions import curve_to_compas
import Rhino.Geometry as rg

from brick_element import Brick


# Real script
# Build the stonehenge

bricks = []

# def moving_param_with_d(crv, param, distance):
#     length_a = crv.GetLength(rg.Interval(crv.Domain.T0, param))
#     target = length_a + distance

#     ok, t_new = crv.LengthParameter(target)
#     if not ok:
#         raise ValueError("Cannot find parameter at length {}".format(target))
#     return t_new

def create_temple_base(compas_crv, param, base_layers=2, base_row=3):
    base_bricks = []
    pt = compas_crv.point_at(param)
    temp_pt = pt.copy()
    temp_pt.z += Brick.HEIGHT / 2

    yv = compas_crv.tangent_at(param)
    yv.unitize()
    zv = Vector(0,0,1)
    xv = yv.cross(zv)

    d_x = (Brick.LENGTH + 1)/2

    if base_layers == 1:
        for sign in (1, -1):
            origin_pt = temp_pt + xv * (d_x * sign)
            base_bricks.append(Brick(Frame(origin_pt, xv, yv), "laying"))
    else:
        for i in range(base_layers):
            for j in range(base_row):
                if i % 2 == j % 2:
                    for sign in (1,-1):
                            if j == 0 and sign == -1:
                                continue
                            origin_pt = temp_pt + zv * i * Brick.HEIGHT + xv * d_x *j * sign
                            laying_frame = Frame(origin_pt, xv, yv)
                            brick = Brick(laying_frame, "laying")
                            base_bricks.append(brick)
    top_center_pt = pt + zv * base_layers * Brick.HEIGHT
    return base_bricks, top_center_pt


def create_temple(compas_crv, param, top_lapping, num_layers, starting_pt= None):
    temple_bricks =[]
    if starting_pt is None:
        starting_pt = compas_crv.point_at(param)
    yv = compas_crv.tangent_at(param)
    yv.unitize()
    zv = Vector(0,0,1)
    xv = yv.cross(zv)

    d_x = Brick.LENGTH / 2 - top_lapping +  Brick.HEIGHT /2
    d_z = Brick.LENGTH
    temp_pt = starting_pt.copy()
    temp_pt.z += d_z /2

    # center pt (origin) of standing bricks
    for i in range(num_layers):
        for sign in (1, -1):
            origin_s = temp_pt + zv * d_z * (i) 
            origin_s += xv * d_x * sign
            standing_frame = Frame(origin_s, xv, yv)
            temple_bricks.append(Brick(standing_frame, "standing"))


    # center pt (origin) of laying brick (top brick)
    origin_l = temp_pt + zv * d_z * (num_layers-0.5) + zv * (Brick.HEIGHT/2)
    laying_frame = Frame(origin_l, xv, yv)
    temple_bricks.append(Brick(laying_frame, "laying"))
    return temple_bricks

def domino(compas_crv, gap, list_top=None, pick_number=None):
    domino_bricks = [] 
    length = Brick.WIDTH + gap
    crv_length = compas_crv.length()
    count = int(crv_length // length)

    params, points= compas_crv.divide_by_count(count, True)
    if pick_number is not None:
        for i in range(len(list_top)):
            for i, top in enumerate(list_top):
                points[pick_number + i] = top

    for param, pt in zip(params, points):
        tangent = compas_crv.tangent_at(param)
        origin = pt + Vector(0, 0, Brick.LENGTH / 2)
        frame = Frame(origin, xaxis = tangent, yaxis = cross_vectors(tangent, [0,0,1]))
        domino_bricks.append(Brick(frame, brick_type = "standing"))
    
    

    return domino_bricks


# ===== elements of crv =====
# reparameterize crv
# crv.Domain = rg.Interval(0,1)
compas_crv = curve_to_compas(crv)

length = Brick.WIDTH + gap
crv_length = compas_crv.length()
count = int(crv_length // length)

params, points= compas_crv.divide_by_count(count, True)

param = params[pick_number]

# moving vector
yv = compas_crv.tangent_at(param)
yv.unitize()
zv = Vector(0,0,1)
xv = yv.cross(zv)


# ===== Start putting bricks =====

base_bricks, top_base = create_temple_base(compas_crv, param, base_layers=2, base_row=3)

# moving_param = moving_param_with_d(crv, param, moving_distance)
# moving_param_n = moving_param_with_d(crv, param, moving_distance *-1)

prev_base, prev_pt = create_temple_base(compas_crv, params[pick_number-1], base_layers=1, base_row=2)
# next_base, next_pt = create_temple_base(compas_crv, params[pick_number+1], base_layers=1, base_row=2)

list_top = [prev_pt, top_base]
domino_bricks = domino(compas_crv, gap, list_top, pick_number-1)
temple_bricks = create_temple(compas_crv, param, lapping, num_layers=layers,  starting_pt = top_base)
temple_bricks_2 = create_temple(compas_crv, params[pick_number-2], lapping, num_layers=layers)

# === create brick list ===
# bricks = prev_base + base_bricks + domino_bricks+ temple_bricks_2 + temple_bricks
bricks = base_bricks +  temple_bricks
# bricks = temple_bricks_2
# ===== get pick frame =====
geometries = []
frames = []
for brick in bricks:
    geometries.append(brick.draw())
    frames.append(brick.top_frame())

number_of_bricks = len(bricks)
# ---------- end brick_wall_4 ----------
brick_wall_5 = Python3Script(crv=curve, layers=Slider(2, range=0..10), lapping=Slider(3, range=0..5), pick_number=Slider(4, range=0..100), gap=gap)  # -> bricks, geometries, frames, number_of_bricks; inputs crv: Curve, layers: Int32, pick_number: Int32
# ---------- brick_wall_5: Python ----------
# r : compas 
# venv: mas-2627
from compas_rhino.devtools import DevTools
DevTools.ensure_path()

from compas.geometry import Box, Point
from compas.geometry import Vector, cross_vectors
from compas.geometry import Frame

from compas_rhino.conversions import curve_to_compas
import Rhino.Geometry as rg

from brick_element import Brick


# Real script
# Build the stonehenge

bricks = []

# def moving_param_with_d(crv, param, distance):
#     length_a = crv.GetLength(rg.Interval(crv.Domain.T0, param))
#     target = length_a + distance

#     ok, t_new = crv.LengthParameter(target)
#     if not ok:
#         raise ValueError("Cannot find parameter at length {}".format(target))
#     return t_new

def create_temple_base(compas_crv, param, base_layers=2, base_row=3):
    base_bricks = []
    pt = compas_crv.point_at(param)
    temp_pt = pt.copy()
    temp_pt.z += Brick.HEIGHT / 2

    yv = compas_crv.tangent_at(param)
    yv.unitize()
    zv = Vector(0,0,1)
    xv = yv.cross(zv)

    d_x = (Brick.LENGTH + 1)/2

    if base_layers == 1:
        for sign in (1, -1):
            origin_pt = temp_pt + xv * (d_x * sign)
            base_bricks.append(Brick(Frame(origin_pt, xv, yv), "laying"))
    else:
        for i in range(base_layers):
            for j in range(base_row):
                if i % 2 == j % 2:
                    for sign in (1,-1):
                            if j == 0 and sign == -1:
                                continue
                            origin_pt = temp_pt + zv * i * Brick.HEIGHT + xv * d_x *j * sign
                            laying_frame = Frame(origin_pt, xv, yv)
                            brick = Brick(laying_frame, "laying")
                            base_bricks.append(brick)
    top_center_pt = pt + zv * base_layers * Brick.HEIGHT
    return base_bricks, top_center_pt


def create_temple(compas_crv, param, top_lapping, num_layers, starting_pt= None):
    temple_bricks =[]
    if starting_pt is None:
        starting_pt = compas_crv.point_at(param)
    yv = compas_crv.tangent_at(param)
    yv.unitize()
    zv = Vector(0,0,1)
    xv = yv.cross(zv)

    d_x = Brick.LENGTH / 2 - top_lapping +  Brick.HEIGHT /2
    d_z = Brick.LENGTH
    temp_pt = starting_pt.copy()
    temp_pt.z += d_z /2

    # center pt (origin) of standing bricks
    for i in range(num_layers):
        for sign in (1, -1):
            origin_s = temp_pt + zv * d_z * (i) 
            origin_s += xv * d_x * sign
            standing_frame = Frame(origin_s, xv, yv)
            temple_bricks.append(Brick(standing_frame, "standing"))


    # center pt (origin) of laying brick (top brick)
    origin_l = temp_pt + zv * d_z * (num_layers-0.5) + zv * (Brick.HEIGHT/2)
    laying_frame = Frame(origin_l, xv, yv)
    temple_bricks.append(Brick(laying_frame, "laying"))
    return temple_bricks

def domino(compas_crv, gap, list_top=None, pick_number=None):
    domino_bricks = [] 
    length = Brick.WIDTH + gap
    crv_length = compas_crv.length()
    count = int(crv_length // length)

    params, points= compas_crv.divide_by_count(count, True)
    if pick_number is not None:
        for i in range(len(list_top)):
            for i, top in enumerate(list_top):
                points[pick_number + i] = top

    for param, pt in zip(params, points):
        tangent = compas_crv.tangent_at(param)
        origin = pt + Vector(0, 0, Brick.LENGTH / 2)
        frame = Frame(origin, xaxis = tangent, yaxis = cross_vectors(tangent, [0,0,1]))
        domino_bricks.append(Brick(frame, brick_type = "standing"))
    
    

    return domino_bricks


# ===== elements of crv =====
# reparameterize crv
# crv.Domain = rg.Interval(0,1)
compas_crv = curve_to_compas(crv)

length = Brick.WIDTH + gap
crv_length = compas_crv.length()
count = int(crv_length // length)

params, points= compas_crv.divide_by_count(count, True)

param = params[pick_number]

# moving vector
yv = compas_crv.tangent_at(param)
yv.unitize()
zv = Vector(0,0,1)
xv = yv.cross(zv)


# ===== Start putting bricks =====

base_bricks, top_base = create_temple_base(compas_crv, param, base_layers=2, base_row=3)

# moving_param = moving_param_with_d(crv, param, moving_distance)
# moving_param_n = moving_param_with_d(crv, param, moving_distance *-1)

prev_base, prev_pt = create_temple_base(compas_crv, params[pick_number-1], base_layers=1, base_row=2)
next_base, next_pt = create_temple_base(compas_crv, params[pick_number+1], base_layers=1, base_row=2)

list_top = [prev_pt, top_base, next_pt]
domino_bricks = domino(compas_crv, gap, list_top, pick_number-1)
temple_bricks = create_temple(compas_crv, param, lapping, num_layers=layers,  starting_pt = top_base)
temple_bricks_2 = create_temple(compas_crv, params[pick_number-2], lapping, num_layers=layers)
temple_bricks_3 = create_temple(compas_crv, params[pick_number +4], lapping, num_layers=layers+1)
# === create brick list ===
bricks = prev_base + base_bricks  + next_base + domino_bricks+ temple_bricks_2 + temple_bricks + temple_bricks_3
# bricks = base_bricks
# ===== get pick frame =====
geometries = []
frames = []
for brick in bricks:
    geometries.append(brick.draw())
    frames.append(brick.top_frame())

number_of_bricks = len(bricks)
# ---------- end brick_wall_5 ----------
curve_6 = Curve(<curve referenced from the Rhino model>)

# ----
# Curves
number_slider_8 = Slider(2, range=0..30)
gap_5 = Slider(5.8, range=0..10)
brick_wall_6 = Python3Script(crv=curve_6, num_layers=number_slider_8, gap=gap_5, shift=Slider(5, range=0..10))  # -> bricks, geometries, frames, number_of_bricks; inputs crv: Curve, num_layers: Int32, gap: Double; same code as brick_wall_2
number_of_bricks_4 = Panel(brick_wall_6.number_of_bricks)
compas_draw_7 = COMPASDraw(cg=brick_wall_6.geometries)  # -> rg; same code as compas_draw

# ----
# laying
compas_draw_8 = COMPASDraw(cg=py3.pick_frame)  # -> rg; same code as compas_draw
# side
compas_draw_9 = COMPASDraw(cg=py3_2.pick_frame)  # -> rg; same code as compas_draw
# standing
compas_draw_10 = COMPASDraw(cg=py3_3.pick_frame)  # -> rg; same code as compas_draw

# ----
# Measure work object
point_10 = ValueList({"origin", "xaxis", "xypoint"}, selected="xypoint")  # disabled
panel = Panel("169.254.130.206")  # disabled
capture = Button()  # disabled
capture_wobj = CaptureWobj(robot_ip=panel, point_name=point_10, capture=capture)  # -> wobj_origin, wobj_xaxis, wobj_xypoint, info; disabled
# ---------- capture_wobj: Python ----------
"""
Capture the 3 points that define the work object (robot base) plane.

Jog the TCP to a point, pick its name (origin / xaxis / xypoint) and press capture.
The TCP position (robot base frame, mm) is saved to wobj_calibration.json next to
this .ghx file, so the points survive closing Grasshopper.
"""
import os
import sys
import json
import time

import scriptcontext as sc
import Rhino.Geometry as rg

NAMES = ["origin", "xaxis", "xypoint"]

gh_dir = os.path.dirname(ghenv.Component.OnPingDocument().FilePath)
src_dir = os.path.join(gh_dir, "src")
if src_dir not in sys.path:
    sys.path.append(src_dir)
import simple_comm as com

path = os.path.join(gh_dir, "wobj_calibration.json")

data = {}
if os.path.exists(path):
    with open(path) as f:
        data = json.load(f)

# keep the last status in sticky, so the message survives the button being released
status_key = "capture_status_" + str(ghenv.Component.InstanceGuid)

if capture:
    if point_name not in NAMES:
        sc.sticky[status_key] = "pick origin / xaxis / xypoint"
    else:
        try:
            x, y, z = list(com.listen_to_robot(robot_ip)["pose"])[:3]  # metres, robot base frame
            data[point_name] = [round(x * 1000, 2), round(y * 1000, 2), round(z * 1000, 2)]  # -> mm
            with open(path, "w") as f:
                json.dump(data, f, indent=2)
            sc.sticky[status_key] = "{} captured {}".format(point_name, time.strftime("%H:%M:%S"))
        except Exception as e:
            print(e)
            sc.sticky[status_key] = "robot not reachable"

ghenv.Component.Message = sc.sticky.get(status_key, "")

def pt(name):
    return rg.Point3d(*data[name]) if name in data else None

wobj_origin, wobj_xaxis, wobj_xypoint = pt("origin"), pt("xaxis"), pt("xypoint")
info = json.dumps(data, indent=2)
# ---------- end capture_wobj ----------
wobj_calibration = Panel(capture_wobj.info)  # disabled

compas_draw_11 = COMPASDraw(cg=brick_wall_4.geometries)  # -> rg; same code as compas_draw

# ----
# Measure work object
point_11 = ValueList({"origin", "xaxis", "xypoint"}, selected="xypoint")
capture_2 = Button()
capture_wobj_2 = CaptureWobj(robot_ip="169.254.130.206", point_name=point_11, capture=capture_2)  # -> wobj_origin, wobj_xaxis, wobj_xypoint, info; same code as capture_wobj
wobj_calibration_2 = Panel(capture_wobj_2.info)

panel_2 = Panel(brick_wall_5.number_of_bricks)

# ----
# Measure work object
point_12 = ValueList({"origin", "xaxis", "xypoint"}, selected="xypoint")
capture_3 = Button()
capture_wobj_3 = CaptureWobj(robot_ip="169.254.130.206", point_name=point_12, capture=capture_3)  # -> wobj_origin, wobj_xaxis, wobj_xypoint, info; same code as capture_wobj
wobj_calibration_3 = Panel(capture_wobj_3.info)

list_item = ListItem(List=brick_wall_4.bricks, Index=0, Wrap=True)
list_item_2 = ListItem(List=brick_wall_4.frames, Index=0, Wrap=True)
cull_index = CullIndex(List=brick_wall_5.frames, Indices="17", Wrap=True)
cull_index_2 = CullIndex(List=brick_wall_5.bricks, Indices="17", Wrap=True)
cull_index_3 = CullIndex(List=brick_wall_4.bricks, Indices="7", Wrap=True)
cull_index_4 = CullIndex(List=brick_wall_4.frames, Indices="7", Wrap=True)

list_item_3 = ListItem(List=compas_draw_4, Index=Slider(28, range=0..50), Wrap=True)
custom_preview = CustomPreview(Geometry=compas_draw_4, Material=ColourSwatch(SwatchColor=RGB(214, 133, 90)))

point_13 = Point(capture_wobj.wobj_xypoint)  # disabled

# ----
# Bricks
# frames
merge = Merge(Data1=brick_wall_4.frames, Data2=cull_index)  # -> flatten(Result)
merge_2 = Merge(Data1=brick_wall_4.bricks, Data2=cull_index_2)  # -> flatten(Result)

compas_draw_12 = COMPASDraw(cg=merge)  # -> rg; same code as compas_draw
list_item_4 = ListItem(List=compas_draw_12, Index=Slider(0, range=0..10), Wrap=True)  # -> flatten(Item)
point_list = PointList(Points=list_item_4, Size=Slider(6, range=0..10))

# ----
# Bricks
# frames
merge_3 = Merge(Data1=brick_wall_4.frames)
merge_4 = Merge(Data1=brick_wall_4.bricks)

point_14 = Point(capture_wobj_3.wobj_xypoint)
point_15 = Point(capture_wobj_2.wobj_origin)
point_16 = Point(capture_wobj_2.wobj_xaxis)
point_17 = Point(capture_wobj_2.wobj_xypoint)
# Adjust the height of placement
fine_adjust_z_mm = Slider(0, range=-5..10)  # disabled
# Adjust the height of placement
fine_adjust_z_mm_2 = Slider(0, range=-5..10)
data_dam = DataDam(DataDataA=merge, BufferDelay=10000000, BufferMode=0)
# Adjust the height of placement
fine_adjust_z_mm_3 = Slider(0, range=-5..10)
number_slider_9 = Slider(21.5, range=0..100)  # disabled
number_slider_10 = Slider(21, range=0..100)
number_slider_11 = Slider(20.5, range=0..100)
number_slider_12 = Slider(24.5, range=0..100)
# Transform from Rhino to Robot Space
transform = Python3Script(
    way_planes=brick_wall.frames,
    wobj_origin=capture_wobj.wobj_origin,
    wobj_xaxis=capture_wobj.wobj_xaxis,
    wobj_xypoint=capture_wobj.wobj_xypoint,
    z_safe_margin=fine_adjust_z_mm)  # -> out, robot_base, transformed_frames, first_frame, working_place; inputs way_planes: list, wobj_origin: Point3d, wobj_xaxis: Point3d, wobj_xypoint: Point3d, z_safe_margin: Double; disabled
# ---------- transform: Python ----------
from compas.geometry import Frame, Transformation, Translation, Vector
from compas.geometry import Polyline
from compas_rhino.conversions import polyline_to_rhino
#in this step we transform our way planes to robot space
#the rhino co-ordinate system is rather abstract in the physical world
#the robot base plane assumed the base frame of robot is the origin
#but rhino does not know that
#thus we transform things from our design space(Rhino World XY) to Robot Base Plane that we measure

def set_robot_base(origin, xaxis, xypoint):
    """
    set a base plane representing the robot working object plane
    """
    robot_base = Frame(origin, xaxis - origin, xypoint - origin)
    print (robot_base)
    return (robot_base)

def working_place_display(origin, xaxis, xypoint):
    a = wobj_origin
    b = wobj_xaxis
    c = wobj_xypoint
    d = b+c-a
    polyline = Polyline([a,b,d,c,a])
    display_polygon = polyline_to_rhino(polyline)
    return display_polygon
    


def rhino_to_robot_space(rhino_plane,robot_base_plane):
    """
    Transform the objects from Rhino world XY plane to robot work object plane
    """
    T_matrix = Transformation.from_frame_to_frame(Frame.worldXY(), robot_base_plane)
    robot_plane = rhino_plane.transformed(T_matrix)
    return robot_plane

def set_z_safe_margin(planes_to_adjust, safety_margin):
    adjusted = []
    T = Translation.from_vector(Vector(0, 0, safety_margin))
    for f in planes_to_adjust:
        adjusted.append(f.transformed(T))
    return adjusted

# ===== Robot base is set =====
robot_base =  set_robot_base(wobj_origin, wobj_xaxis, wobj_xypoint)

# ===== Set safety margin for Z height ======
safe_planes = set_z_safe_margin(way_planes, z_safe_margin)

# ===== Transforming the rhino planes into robot planes =====
transformed_frames = []
for plane in safe_planes: 
    transformed_frames.append(rhino_to_robot_space(plane, robot_base))

# ===== display working place
working_place = working_place_display(wobj_origin, wobj_xaxis, wobj_xypoint)

#test 
first_frame = transformed_frames[0]
# ---------- end transform ----------
# Transform from Rhino to Robot Space
transform_2 = Python3Script(
    way_planes=merge_3,
    wobj_origin=capture_wobj_2.wobj_origin,
    wobj_xaxis=capture_wobj_2.wobj_xaxis,
    wobj_xypoint=capture_wobj_2.wobj_xypoint,
    z_safe_margin=fine_adjust_z_mm_2)  # -> out, robot_base, transformed_frames, first_frame, working_place; inputs way_planes: list, wobj_origin: Point3d, wobj_xaxis: Point3d, wobj_xypoint: Point3d, z_safe_margin: Double; same code as transform
# Transform from Rhino to Robot Space
transform_3 = Python3Script(
    way_planes=brick_wall_6.frames,
    wobj_origin=capture_wobj_3.wobj_origin,
    wobj_xaxis=capture_wobj_3.wobj_xaxis,
    wobj_xypoint=capture_wobj_3.wobj_xypoint,
    z_safe_margin=fine_adjust_z_mm_3)  # -> out, robot_base, transformed_frames, first_frame, working_place; inputs way_planes: list, wobj_origin: Point3d, wobj_xaxis: Point3d, wobj_xypoint: Point3d, z_safe_margin: Double; same code as transform

panel_3 = Panel("572.15")  # disabled
panel_4 = Panel("354.27")  # disabled
panel_5 = Panel("586.98")  # disabled
panel_6 = Panel("353.48")  # disabled
panel_7 = Panel("346.96")  # disabled
panel_8 = Panel("571.8")  # disabled
pt = ConstructPoint(XCoordinate=panel_3, YCoordinate=panel_4, ZCoordinate=number_slider_9)  # disabled
pt_2 = ConstructPoint(XCoordinate=panel_5, YCoordinate=panel_6, ZCoordinate=number_slider_9)  # disabled
pt_3 = ConstructPoint(XCoordinate=panel_8, YCoordinate=panel_7, ZCoordinate=number_slider_9)  # disabled

# ----
# Measure pick up location
capture_4 = Button()  # disabled
point_18 = ValueList({"origin", "xaxis", "xypoint"}, selected="origin")  # disabled
capture_pick = CapturePick(robot_ip=panel, point_name=point_18, capture=capture_4)  # -> origin, xaxis_pt, xy_pt, info; disabled
# ---------- capture_pick: Python ----------
"""
Capture the 3 points that define the pick frame at the brick pick-up location.

Jog the TCP to a point, pick its name (origin / xaxis / xypoint) and press capture.
The TCP position (robot base frame, mm) is saved to pick_calibration.json next to
this .ghx file, so the points survive closing Grasshopper.
"""
import os
import sys
import json
import time

import scriptcontext as sc
import Rhino.Geometry as rg

NAMES = ["origin", "xaxis", "xypoint"]

gh_dir = os.path.dirname(ghenv.Component.OnPingDocument().FilePath)
src_dir = os.path.join(gh_dir, "src")
if src_dir not in sys.path:
    sys.path.append(src_dir)
import simple_comm as com

path = os.path.join(gh_dir, "pick_calibration.json")

data = {}
if os.path.exists(path):
    with open(path) as f:
        data = json.load(f)

# keep the last status in sticky, so the message survives the button being released
status_key = "capture_status_" + str(ghenv.Component.InstanceGuid)

if capture:
    if point_name not in NAMES:
        sc.sticky[status_key] = "pick origin / xaxis / xypoint"
    else:
        try:
            x, y, z = list(com.listen_to_robot(robot_ip)["pose"])[:3]  # metres, robot base frame
            data[point_name] = [round(x * 1000, 2), round(y * 1000, 2), round(z * 1000, 2)]  # -> mm
            with open(path, "w") as f:
                json.dump(data, f, indent=2)
            sc.sticky[status_key] = "{} captured {}".format(point_name, time.strftime("%H:%M:%S"))
        except Exception as e:
            print(e)
            sc.sticky[status_key] = "robot not reachable"

ghenv.Component.Message = sc.sticky.get(status_key, "")

def pt(name):
    return rg.Point3d(*data[name]) if name in data else None

origin, xaxis_pt, xy_pt = pt("origin"), pt("xaxis"), pt("xypoint")
info = json.dumps(data, indent=2)
# ---------- end capture_pick ----------
pick_calibration = Panel(capture_pick.info)  # disabled
py3_4 = Python3Script(origin=pt, xaxis_pt=pt_2, xy_pt=pt_3)  # -> out, pick_frame; inputs origin: Point3d, xaxis_pt: Point3d, xy_pt: Point3d; disabled
# ---------- py3_4: Python ----------
from compas.geometry import Frame, Point
from compas.geometry import Rotation

from compas_rhino.conversions import point_to_compas

origin = point_to_compas(origin)
xaxis_pt = point_to_compas(xaxis_pt)
xy_pt = point_to_compas(xy_pt)

#define pick frame
pick_frame = Frame(origin, xaxis_pt - origin, xy_pt - origin)
# ---------- end py3_4 ----------
compas_draw_13 = COMPASDraw(cg=py3_4.pick_frame)  # -> rg; disabled; same code as compas_draw

pt_4 = ConstructPoint(XCoordinate="442.53", YCoordinate="316.75", ZCoordinate=number_slider_12)
pt_5 = ConstructPoint(XCoordinate="442.21", YCoordinate="302", ZCoordinate=number_slider_12)
pt_6 = ConstructPoint(XCoordinate="449.86", YCoordinate="315.47", ZCoordinate=number_slider_12)

# ----
# Measure pick up location
capture_5 = Button()
point_19 = ValueList({"origin", "xaxis", "xypoint"}, selected="xaxis")
capture_pick_2 = CapturePick(robot_ip="169.254.130.206", point_name=point_19, capture=capture_5)  # -> origin, xaxis_pt, xy_pt, info; same code as capture_pick
pick_calibration_2 = Panel(capture_pick_2.info)
# pick-up location for standing brick
py3_5 = Python3Script(origin=pt_4, xaxis_pt=pt_5, xy_pt=pt_6)  # -> out, s_pick_frame, l_pick_frame; inputs origin: Point3d, xaxis_pt: Point3d, xy_pt: Point3d
# ---------- py3_5: Python ----------
from compas.geometry import Frame, Point, Vector
from compas.geometry import Rotation

from compas_rhino.conversions import point_to_compas

origin = point_to_compas(origin)
xaxis_pt = point_to_compas(xaxis_pt)
xy_pt = point_to_compas(xy_pt)

#define pick frame
l_pick_frame = Frame(origin, -(origin - xaxis_pt), -(xy_pt -origin) )
s_origin = origin.copy() + Vector(128.5,11,0)
s_pick_frame = Frame(s_origin, -(origin - xaxis_pt), -(xy_pt -origin))
# ---------- end py3_5 ----------
compas_draw_14 = COMPASDraw(cg=py3_5.s_pick_frame)  # -> rg; same code as compas_draw

pt_7 = ConstructPoint(XCoordinate="586.98", YCoordinate="355.48", ZCoordinate=number_slider_11)
pt_8 = ConstructPoint(XCoordinate="572.15", YCoordinate="356.27", ZCoordinate=number_slider_11)
pt_9 = ConstructPoint(XCoordinate="571.8", YCoordinate="348.96", ZCoordinate=number_slider_11)

curve_7 = Curve(transform.working_place)  # disabled

pt_10 = ConstructPoint(XCoordinate="572.15", YCoordinate="354.27", ZCoordinate=number_slider_10)
pt_11 = ConstructPoint(XCoordinate="586.98", YCoordinate="353.48", ZCoordinate=number_slider_10)
pt_12 = ConstructPoint(XCoordinate="571.8", YCoordinate="346.96", ZCoordinate=number_slider_10)

# ----
# Measure pick up location
capture_6 = Button()
point_20 = ValueList({"origin", "xaxis", "xypoint"}, selected="origin")
capture_pick_3 = CapturePick(robot_ip="169.254.130.206", point_name=point_20, capture=capture_6)  # -> origin, xaxis_pt, xy_pt, info; same code as capture_pick
pick_calibration_3 = Panel(capture_pick_3.info)
py3_6 = Python3Script(origin=pt_10, xaxis_pt=pt_11, xy_pt=pt_12)  # -> out, pick_frame; inputs origin: Point3d, xaxis_pt: Point3d, xy_pt: Point3d; same code as py3_4
compas_draw_15 = COMPASDraw(cg=py3_6.pick_frame)  # -> rg; same code as compas_draw

curve_8 = Curve(transform_2.working_place)
curve_9 = Curve(transform_3.working_place)
compas_draw_16 = COMPASDraw(cg=transform_2.transformed_frames)  # -> rg; same code as compas_draw
point_21 = Point(capture_pick_2.xaxis_pt)
# pick-up location for laying brick
py3_7 = Python3Script(origin=pt_8, xaxis_pt=pt_7, xy_pt=pt_9)  # -> out, pick_frame; inputs origin: Point3d, xaxis_pt: Point3d, xy_pt: Point3d; same code as py3_4

# ----
# Measure and set TCP
panel_9 = Panel("-1.71")  # disabled
panel_10 = Panel("-0.9")  # disabled
panel_11 = Panel("77.83")  # disabled
pt_13 = ConstructPoint(XCoordinate=panel_9, YCoordinate=panel_10, ZCoordinate=panel_11)  # disabled

# ----
# Measure and set TCP
panel_12 = Panel("-1.71")
pt_14 = ConstructPoint(XCoordinate=panel_12, YCoordinate="-0.9", ZCoordinate="77.83")

# ----
# Measure and set TCP
panel_13 = Panel("-1.71")
pt_15 = ConstructPoint(XCoordinate=panel_13, YCoordinate="-0.9", ZCoordinate="77.83")

compas_draw_17 = COMPASDraw(cg=py3_7.pick_frame)  # -> rg; same code as compas_draw
number_slider_13 = Slider(0.6, range=0..1)  # disabled
number_slider_14 = Slider(-15, range=-90..90)  # disabled

number_slider_15 = Slider(1, range=0..10)  # disabled
number_slider_16 = Slider(15, range=0..20)  # disabled
number_slider_17 = Slider(4, range=0..10)  # disabled
python_3_script_2 = Python3Script(layers=number_slider_15, row=number_slider_16, col=number_slider_17, pick_frame=py3_4.pick_frame)  # -> out, pts, pick_frames; inputs layers: Int32, row: Int32, col: Int32; disabled
# ---------- python_3_script_2: Python ----------
# r: compas
# venv: mas-2627
from compas_rhino.devtools import DevTools
DevTools.ensure_path()

# 0. Import everything we will need
import math
from compas.geometry import Box
from compas.geometry import Point
from compas.geometry import Frame
from compas.geometry import cross_vectors

from compas_rhino.conversions import curve_to_compas

from brick_wall import Brick
brick = Brick(length=10, width=15, height=32)

# 1. Start with an empty list of bricks to be created
bricks = []

pts = []
pick_frames = []

print(brick.length)
print(brick.width)

for i in range(row):
    for j in range(col):
        x = (pick_frame.point.x + 10) - i * brick.length
        y = (pick_frame.point.y) - j * brick.width
        z = (pick_frame.point.z - brick.length) + brick.height 
        # print(z)
        pt = Point(x, y, z)
        pts.append(pt)
        frame = Frame(pt, pick_frame.xaxis, pick_frame.yaxis)
        pick_frames.append(frame)
        # print(frame)


print(pick_frame)
# ---------- end python_3_script_2 ----------

number_slider_18 = Slider(0.6, range=0..1)
number_slider_19 = Slider(-15, range=-90..90)
list_item_5 = ListItem(List=transform.transformed_frames, Index=0, Wrap=True)  # disabled
number_slider_20 = Slider(0.1, range=0..0.1)
number_slider_21 = Slider(0.1, range=0..0.1)

number_slider_22 = Slider(4, range=0..10)
python_3_script_3 = Python3Script(layers=Slider(1, range=0..10), row=Slider(15, range=0..20), pick_frame=py3_5.l_pick_frame)  # -> out, pts, pick_frames; inputs layers: Int32, row: Int32, col: Int32
# ---------- python_3_script_3: Python ----------
# r: compas
# venv: mas-2627
from compas_rhino.devtools import DevTools
DevTools.ensure_path()

# 0. Import everything we will need
import math
from compas.geometry import Box
from compas.geometry import Point
from compas.geometry import Frame
from compas.geometry import cross_vectors

from compas_rhino.conversions import curve_to_compas

from brick_element import Brick

# 1. Start with an empty list of bricks to be created
bricks = []

pts = []
pick_frames = []


# stacks for standing bricks
def stacks_for_standing(pick_frame, row=16, col=4):
    for i in range(row):
        for j in range(col):
            x = (pick_frame.point.x) + j * Brick.WIDTH
            y = (pick_frame.point.y+9) - i * Brick.HEIGHT
            z = (pick_frame.point.z - Brick.HEIGHT) + Brick.LENGTH
            pt = Point(x, y, z)
            pts.append(pt)
            frame = Frame(pt, pick_frame.xaxis, pick_frame.yaxis)
            pick_frames.append(frame)
    return pick_frames


# stacks for standing bricks
def stacks_for_laying(pick_frame, row=5, col=4, layers=2):
    
    for k in range(layers):
        for i in range(row):
            for j in range(col):
                x = pick_frame.point.x + j * Brick.WIDTH 
                y = pick_frame.point.y - i * Brick.LENGTH
                z = pick_frame.point.z + (layers - k -1) * Brick.HEIGHT
                pt = Point(x, y, z)
                pts.append(pt)
                frame = Frame(pt, pick_frame.xaxis, pick_frame.yaxis)
                pick_frames.append(frame)
    return pick_frames

# pick_frames = stacks_for_laying(pick_frame)
pick_frames = stacks_for_standing(pick_frame)
# ---------- end python_3_script_3 ----------

python_3_script_4 = Python3Script(layers=Slider(2, range=0..10), row=Slider(5, range=0..10), col=Slider(4, range=0..10), pick_frame=py3_6.pick_frame)  # -> out, pts, pick_frames; inputs layers: Int32, row: Int32, col: Int32
# ---------- python_3_script_4: Python ----------
# r: compas
# venv: mas-2627
from compas_rhino.devtools import DevTools
DevTools.ensure_path()

# 0. Import everything we will need
import math
from compas.geometry import Box
from compas.geometry import Point
from compas.geometry import Frame
from compas.geometry import cross_vectors

from compas_rhino.conversions import curve_to_compas

from brick_wall import Brick

# 1. Start with an empty list of bricks to be created
bricks = []

pts = []
pick_frames = []

for k in range(layers):
    for i in range(row):
        for j in range(col):
            x = pick_frame.point.x - i * Brick.LENGTH
            y = pick_frame.point.y - j * Brick.WIDTH
            z = pick_frame.point.z + (layers - k -1) * Brick.HEIGHT
            pt = Point(x, y, z)
            pts.append(pt)
            frame = Frame(pt, pick_frame.xaxis, pick_frame.yaxis)
            pick_frames.append(frame)


brick = Brick()
print(pick_frame)
# ---------- end python_3_script_4 ----------

# ----
# Convert Planes to URScript
compas_draw_18 = COMPASDraw(cg=list_item_5)  # -> rg; disabled; same code as compas_draw
compas = Python3Script(
    way_frames=transform.transformed_frames,
    tcp_measured=pt_13,
    acceleration=number_slider_13,
    velocity=number_slider_13,
    pick_frames=python_3_script_2.pick_frames,
    angle=number_slider_14)  # -> out, a, vis_frames, vis_planes, pushing_frame, script; inputs way_frames: list, tcp_measured: Point3d, acceleration: Double, velocity: Double, pick_frames: list; disabled
# ---------- compas: Python ----------
from imp import reload
import sys
import os

#get current file path
path = ghenv.Component.OnPingDocument().FilePath
#get parent directory of the parent directory
parentdir = os.path.dirname(path)
#get src folder which contains classes
dire = os.path.join(parentdir,'src')

sys.path.append(dire)

import simple_ur_script as ur
reload(ur)

import utils 
reload(utils)

import simple_comm as com
reload(com)

import compas.geometry as cg
import math as m

# ===== Set global constants =======

IO = 4 # Global constant
SAFE_DIST = 100
sleep_time = 0.5

# =================================
from compas.geometry import Frame, Point, Vector, Rotation
import math as m

# Test
# frame = way_frames
# a = Frame([frame.point.x, frame.point.y, frame.point.z + SAFE_DIST], [0,1,0], [1, 0, 0])
# print(a)


def safe_location(frame, sefe_dist = SAFE_DIST):
    safe_frame = Frame([frame.point.x, frame.point.y, frame.point.z + SAFE_DIST], frame.xaxis, frame.yaxis)
    if safe_frame.zaxis.z > 0:
            safe_frame.xaxis = -safe_frame.xaxis
    return safe_frame

def pickup_brick(script, pick_up_frame):
    # Translate frame to "safe" location
    safe_frame = safe_location(pick_up_frame)
    # Move to safe frame
    script += ur.move_l(safe_frame, acceleration, velocity)
    # Move to pick location
    script += ur.move_l(pick_up_frame, acceleration, velocity)
    # Activate gripper
    script += ur.set_digital_out(IO, True)
    script += ur.sleep(sleep_time)
    # Move back to safe plane
    script += ur.move_l(safe_frame, acceleration, velocity)

    frames = [safe_frame, pick_up_frame, safe_frame]

    return script, frames


def place_brick(script, place_frame):
    
    # Safe frame for placing
    safe_frame = safe_location(place_frame)
    # Add to the path: go to the safe plane
    script += ur.move_l(safe_frame, acceleration, velocity)
    # Add to the path: go to the place plane
    script += ur.move_l(place_frame, acceleration, velocity)
    # Add to the path: turn off the vacuum and wait 1 second (hold the brick)
    script += ur.set_digital_out(IO, False)
    script += ur.sleep(sleep_time)
    # Add to the path: go back to the safe plane
    script += ur.move_l(safe_frame, acceleration, velocity)

    frames = [safe_frame, place_frame, safe_frame]
    return script, frames


def push_first_brick(script, first_frame, angle):
    # adjusted_frame = first_frame.copy()
    # v = adjusted_frame.xaxis.unitized()

    # adjusted_frame.point -= v * 11
    # adjusted_frame.point.z += 32


    end_frame = first_frame.copy()
    end_frame.point.z -= 8
    move_v = end_frame.xaxis.unitized() 
    pushing_frame = end_frame.translated(-move_v * 16)
    end_frame.translate(move_v * 10)

    safe_frame = safe_location(pushing_frame)

    matrix_r = Rotation.from_axis_and_angle(end_frame.yaxis, m.radians(angle), pushing_frame.point)
    pushing_frame.transform(matrix_r)
    matrix_r = Rotation.from_axis_and_angle(end_frame.yaxis, m.radians(-angle), end_frame.point)
    end_frame.transform(matrix_r)

    # Safe frame for pushing
    script += ur.move_l(safe_frame, acceleration, velocity)
    script += ur.move_l(pushing_frame, acceleration, velocity)
    script += ur.move_l(end_frame, acceleration + 1.5, velocity +1.5)
    script += ur.move_l(safe_frame, acceleration, velocity)

    frame = [safe_frame, pushing_frame, end_frame, safe_frame]
    return script, frame




# force pick_frame zaxis tio be negative
# if pick_frame.zaxis.z > 0:
#             pick_frame.xaxis = -pick_frame.xaxis

script = "" #create empty string

#if value given for tcp measured, then add line to script, otherwise it will take current tcp from robot
if tcp_measured is not None:
    script += ur.set_tcp_by_angles(tcp_measured.X, tcp_measured.Y, tcp_measured.Z, m.radians(0.0),m.radians(0.0),m.radians(0))


vis_frames = []
# Generate pick and place sequence

# for i, frame in enumerate(way_frames):
#     # for p in pick_frames:
#         script, f1 = pickup_brick(script, pick_frames[i])
#         script, f2 = place_brick(script, frame)
#         vis_frames.extend(f1 + f2)

script, f3 = push_first_brick(script, way_frames[0], angle)
vis_frames.extend(f3)

script = com.concatenate_script(script)


# Visualize
from compas_rhino import conversions
import Rhino.Geometry as rg

vis_planes = [conversions.frame_to_rhino(frame) for frame in vis_frames]
# ---------- end compas ----------
compas_2 = Python3Script(
    bricks=brick_wall_4.bricks,
    way_frames=transform_2.transformed_frames,
    tcp_measured=pt_14,
    acceleration=number_slider_18,
    velocity=number_slider_18,
    angle=number_slider_19,
    s_pick_frame=py3_5.s_pick_frame,
    l_pick_frame=py3_5.l_pick_frame,
    l_frame=py3.pick_frame,
    s_frame=py3_3.pick_frame,
    d_frame=py3_2.pick_frame)  # -> out, a, vis_frames, vis_planes, pushing_frame, script, s_stacks, l_stacks, prep_frame; inputs bricks: list, way_frames: list, tcp_measured: Point3d, acceleration: Double, velocity: Double
# ---------- compas_2: Python ----------
from imp import reload
import sys
import os

#get current file path
path = ghenv.Component.OnPingDocument().FilePath
#get parent directory of the parent directory
parentdir = os.path.dirname(path)
#get src folder which contains classes
dire = os.path.join(parentdir,'src')

sys.path.append(dire)

import simple_ur_script as ur
reload(ur)

import utils 
reload(utils)

import simple_comm as com
reload(com)

import compas.geometry as cg
import math as m

# ===== Set global constants =======

IO = 4 # Global constant
SAFE_DIST = 100
sleep_time = 0.5

# =================================
from compas.geometry import Frame, Point, Vector, Rotation, Translation
import math as m

from brick_element import Brick

# Test
# frame = way_frames
# a = Frame([frame.point.x, frame.point.y, frame.point.z + SAFE_DIST], [0,1,0], [1, 0, 0])
# print(a)


def safe_location(frame, sefe_dist = SAFE_DIST):
    safe_frame = Frame([frame.point.x, frame.point.y, frame.point.z + SAFE_DIST], frame.xaxis, frame.yaxis)
    if safe_frame.zaxis.z > 0:
            safe_frame.xaxis = -safe_frame.xaxis
    return safe_frame

def where_to_pick(brick_type, s_stacks, l_stacks, s_count, l_count):
    if brick_type =="laying":
        pick_up_frame = l_stacks[l_count]
        l_count += 1
    elif brick_type == "standing":
        pick_up_frame = s_stacks[s_count]
        s_count += 1
    return pick_up_frame, s_count, l_count




def adjust_brick_types(script, brick_type, origin_frame):
    
    if brick_type == "laying":
        taking_frame = l_frame
    elif brick_type =="standing":
        taking_frame = s_frame
    elif brick_type == "side":
        taking_frame = d_frame
    v_x = origin_frame.xaxis.unitized()
    v_y = origin_frame.yaxis.unitized()
    v_z = origin_frame.zaxis.unitized()
    v_trans =  v_x * 5 + v_y * 10 + v_z * (-1)
    t = Translation.from_vector(v_trans)
    trans_frame = origin_frame.transformed(t)
    safe_frame = safe_location(trans_frame)


    script += ur.move_l(safe_frame, acceleration, velocity)
    # move to transition point
    script += ur.move_l(trans_frame, acceleration, velocity)
    script += ur.set_digital_out(IO, False)
    script += ur.sleep(sleep_time)

    # move to preparing point (moving along with z)
    prep_frame = taking_frame.copy()
    prep_frame.point += prep_frame.zaxis.unitized() * (-10)
    safe_frame_p = safe_location(prep_frame, 30)

    script += ur.move_l(safe_frame_p, acceleration, velocity)
    script += ur.move_l(prep_frame, acceleration, velocity)
    # move to the taking frame 
    
    script += ur.move_l(taking_frame, acceleration, velocity)
    script += ur.set_digital_out(IO, True)
    script += ur.sleep(sleep_time)

    # go back to safe place
    script += ur.move_l(safe_frame, acceleration, velocity)

    frames = [safe_frame, trans_frame, safe_frame_p, prep_frame, taking_frame, safe_frame]


    return script, frames

def pickup_brick(script, pick_up_frame):
    # Translate frame to "safe" location
    safe_frame = safe_location(pick_up_frame)
    # Move to safe frame
    script += ur.move_l(safe_frame, acceleration, velocity)
    # Move to pick location
    script += ur.move_l(pick_up_frame, acceleration, velocity)
    # Activate gripper
    script += ur.set_digital_out(IO, True)
    script += ur.sleep(sleep_time)
    # Move back to safe plane
    script += ur.move_l(safe_frame, acceleration, velocity)

    frames = [safe_frame, pick_up_frame, safe_frame]

    return script, frames


def place_brick(script, place_frame):
    
    # Safe frame for placing
    safe_frame = safe_location(place_frame)
    # Add to the path: go to the safe plane
    script += ur.move_l(safe_frame, acceleration, velocity)
    # Add to the path: go to the place plane
    script += ur.move_l(place_frame, acceleration, velocity)
    # Add to the path: turn off the vacuum and wait 1 second (hold the brick)
    script += ur.set_digital_out(IO, False)
    script += ur.sleep(sleep_time)
    # Add to the path: go back to the safe plane
    script += ur.move_l(safe_frame, acceleration, velocity)

    frames = [safe_frame, place_frame, safe_frame]
    return script, frames


def push_first_brick(script, first_frame, angle):
    end_frame = first_frame.copy()
    end_frame.translate(Vector(0, 0, -16))
    pushing_v = end_frame.xaxis.unitized() 

    pushing_frame = end_frame.translated(-pushing_v * 16) #starting pt
    end_frame.translate(pushing_v * 10) #end pt

    safe_frame = safe_location(pushing_frame)

    # tilted the frame 
    matrix_r = Rotation.from_axis_and_angle(end_frame.yaxis, m.radians(angle), pushing_frame.point)
    pushing_frame.transform(matrix_r)
    matrix_r = Rotation.from_axis_and_angle(end_frame.yaxis, m.radians(-angle), end_frame.point)
    end_frame.transform(matrix_r)

    # Safe frame for pushing
    script += ur.move_l(safe_frame, acceleration, velocity)
    script += ur.move_l(pushing_frame, acceleration, velocity)
    script += ur.move_l(end_frame, acceleration + 1.5, velocity +1.5)
    script += ur.move_l(safe_frame, acceleration, velocity)

    frame = [safe_frame, pushing_frame, end_frame, safe_frame]
    return script, frame


# stacks for standing bricks
def stacks_for_standing(pick_frame, row=15, col=4):
    s_stacks = []
    for i in range(row):
        for j in range(col):
            x = (pick_frame.point.x) + j * Brick.WIDTH
            y = (pick_frame.point.y) - i * Brick.HEIGHT
            z = (pick_frame.point.z - Brick.HEIGHT) + Brick.LENGTH
            pt = Point(x, y, z)
            frame = Frame(pt, pick_frame.xaxis, pick_frame.yaxis)
            s_stacks.append(frame)
    return s_stacks


# stacks for standing bricks
def stacks_for_laying(pick_frame, row=5, col=4, layers=2):
    l_stacks =[]
    for k in range(layers):
        for i in range(row):
            for j in range(col):
                x = pick_frame.point.x + j * Brick.WIDTH 
                y = pick_frame.point.y - i * Brick.LENGTH
                z = pick_frame.point.z + (layers - k -1) * Brick.HEIGHT
                pt = Point(x, y, z)
                frame = Frame(pt, pick_frame.xaxis, pick_frame.yaxis)
                l_stacks.append(frame)
    return l_stacks

# force pick_frame zaxis tio be negative
# if pick_frame.zaxis.z > 0:
            # pick_frame.xaxis = -pick_frame.xaxis

script = "" #create empty string

#if value given for tcp measured, then add line to script, otherwise it will take current tcp from robot
if tcp_measured is not None:
    script += ur.set_tcp_by_angles(tcp_measured.X, tcp_measured.Y, tcp_measured.Z, m.radians(0.0),m.radians(0.0),m.radians(0))


vis_frames = []

s_count, l_count = 0, 0
l_stacks = stacks_for_laying(l_pick_frame)

# Generate pick and place sequence
for i, frame in enumerate(way_frames):
    pick_up_frame = l_stacks[i]
    # pick_up_frame, s_count, l_count = where_to_pick(bricks[i].type, s_stacks, l_stacks, s_count, l_count)
    script, f1 = pickup_brick(script, pick_up_frame)
    script, f3 = adjust_brick_types(script, bricks[i].type, l_frame)
    script, f2 = place_brick(script, frame)
    vis_frames.extend(f1+ f3+ f2)

# ===== Robot Push first brick =====
# script, f3 = push_first_brick(script, way_frames[9], angle)
# vis_frames.extend(f3)



script = com.concatenate_script(script)

# Visualize
from compas_rhino import conversions
import Rhino.Geometry as rg

vis_planes = [conversions.frame_to_rhino(frame) for frame in vis_frames]
# ---------- end compas_2 ----------
# Convert Planes to URScript
compas_3 = Python3Script(
    bricks=merge_4,
    way_frames=transform_2.transformed_frames,
    tcp_measured=pt_14,
    acceleration=number_slider_18,
    velocity=number_slider_18,
    angle=number_slider_19,
    s_pick_frame=py3_5.s_pick_frame,
    l_pick_frame=py3_5.l_pick_frame)  # -> out, a, vis_frames, vis_planes, pushing_frame, script, s_stacks, l_stacks; inputs bricks: list, way_frames: list, tcp_measured: Point3d, acceleration: Double, velocity: Double
# ---------- compas_3: Python ----------
from imp import reload
import sys
import os

#get current file path
path = ghenv.Component.OnPingDocument().FilePath
#get parent directory of the parent directory
parentdir = os.path.dirname(path)
#get src folder which contains classes
dire = os.path.join(parentdir,'src')

sys.path.append(dire)

import simple_ur_script as ur
reload(ur)

import utils 
reload(utils)

import simple_comm as com
reload(com)

import compas.geometry as cg
import math as m

# ===== Set global constants =======

IO = 4 # Global constant
SAFE_DIST = 100
sleep_time = 0.5

# =================================
from compas.geometry import Frame, Point, Vector, Rotation
import math as m

from brick_element import Brick

# Test
# frame = way_frames
# a = Frame([frame.point.x, frame.point.y, frame.point.z + SAFE_DIST], [0,1,0], [1, 0, 0])
# print(a)


def safe_location(frame, sefe_dist = SAFE_DIST):
    safe_frame = Frame([frame.point.x, frame.point.y, frame.point.z + SAFE_DIST], frame.xaxis, frame.yaxis)
    if safe_frame.zaxis.z > 0:
            safe_frame.xaxis = -safe_frame.xaxis
    return safe_frame

def where_to_pick(brick_type, s_stacks, l_stacks, s_count, l_count):
    if brick_type =="laying":
        pick_up_frame = l_stacks[l_count]
        l_count += 1
    elif brick_type == "standing":
        pick_up_frame = s_stacks[s_count]
        s_count += 1
    return pick_up_frame, s_count, l_count

def pickup_brick(script, pick_up_frame):
    # Translate frame to "safe" location
    safe_frame = safe_location(pick_up_frame)
    # Move to safe frame
    script += ur.move_l(safe_frame, acceleration, velocity)
    # Move to pick location
    script += ur.move_l(pick_up_frame, acceleration, velocity)
    # Activate gripper
    script += ur.set_digital_out(IO, True)
    script += ur.sleep(sleep_time)
    # Move back to safe plane
    script += ur.move_l(safe_frame, acceleration, velocity)

    frames = [safe_frame, pick_up_frame, safe_frame]

    return script, frames


def place_brick(script, place_frame):
    
    # Safe frame for placing
    safe_frame = safe_location(place_frame)
    # Add to the path: go to the safe plane
    script += ur.move_l(safe_frame, acceleration, velocity)
    # Add to the path: go to the place plane
    script += ur.move_l(place_frame, acceleration, velocity)
    # Add to the path: turn off the vacuum and wait 1 second (hold the brick)
    script += ur.set_digital_out(IO, False)
    script += ur.sleep(sleep_time)
    # Add to the path: go back to the safe plane
    script += ur.move_l(safe_frame, acceleration, velocity)

    frames = [safe_frame, place_frame, safe_frame]
    return script, frames


def push_first_brick(script, first_frame, angle):
    end_frame = first_frame.copy()
    end_frame.point.z -= 8
    move_v = end_frame.xaxis.unitized() 
    pushing_frame = end_frame.translated(-move_v * 16)
    end_frame.translate(move_v * 10)

    safe_frame = safe_location(pushing_frame)

    matrix_r = Rotation.from_axis_and_angle(end_frame.yaxis, m.radians(angle), pushing_frame.point)
    pushing_frame.transform(matrix_r)
    matrix_r = Rotation.from_axis_and_angle(end_frame.yaxis, m.radians(-angle), end_frame.point)
    end_frame.transform(matrix_r)

    # Safe frame for pushing
    script += ur.move_l(safe_frame, acceleration, velocity)
    script += ur.move_l(pushing_frame, acceleration, velocity)
    script += ur.move_l(end_frame, acceleration + 1.5, velocity +1.5)
    script += ur.move_l(safe_frame, acceleration, velocity)

    frame = [safe_frame, pushing_frame, end_frame, safe_frame]
    return script, frame


# stacks for standing bricks
def stacks_for_standing(pick_frame, row=15, col=4):
    s_stacks = []
    for i in range(row):
        for j in range(col):
            x = (pick_frame.point.x) + j * Brick.WIDTH
            y = (pick_frame.point.y) - i * Brick.HEIGHT
            z = (pick_frame.point.z - Brick.HEIGHT) + Brick.LENGTH
            pt = Point(x, y, z)
            frame = Frame(pt, pick_frame.xaxis, pick_frame.yaxis)
            s_stacks.append(frame)
    return s_stacks


# stacks for standing bricks
def stacks_for_laying(pick_frame, row=5, col=4, layers=2):
    l_stacks =[]
    for k in range(layers):
        for i in range(row):
            for j in range(col):
                x = pick_frame.point.x + j * Brick.WIDTH 
                y = pick_frame.point.y - i * Brick.LENGTH
                z = pick_frame.point.z + (layers - k -1) * Brick.HEIGHT
                pt = Point(x, y, z)
                frame = Frame(pt, pick_frame.xaxis, pick_frame.yaxis)
                l_stacks.append(frame)
    return l_stacks

# force pick_frame zaxis tio be negative
# if pick_frame.zaxis.z > 0:
            # pick_frame.xaxis = -pick_frame.xaxis

script = "" #create empty string

#if value given for tcp measured, then add line to script, otherwise it will take current tcp from robot
if tcp_measured is not None:
    script += ur.set_tcp_by_angles(tcp_measured.X, tcp_measured.Y, tcp_measured.Z, m.radians(0.0),m.radians(0.0),m.radians(0))


vis_frames = []

s_count, l_count = 0, 0
s_stacks = iter(stacks_for_standing(s_pick_frame))
l_stacks = iter(stacks_for_laying(l_pick_frame))

# Generate pick and place sequence

for i, frame in enumerate(way_frames):
    # for p in pick_frames:
    if bricks[i].type=="laying":
        pick_up_frame = next(l_stacks)
    else:
        pick_up_frame = next(s_stacks)
    # pick_up_frame, s_count, l_count = where_to_pick(bricks[i].type, s_stacks, l_stacks, s_count, l_count)
    script, f1 = pickup_brick(script, pick_up_frame)
    script, f2 = place_brick(script, frame)
    vis_frames.extend(f1 + f2)

# ===== Robot Push first brick =====
# script, f3 = push_first_brick(script, way_frames[0], angle)
# vis_frames.extend(f3)



script = com.concatenate_script(script)

# Visualize
from compas_rhino import conversions
import Rhino.Geometry as rg

vis_planes = [conversions.frame_to_rhino(frame) for frame in vis_frames]
# ---------- end compas_3 ----------
# Convert Planes to URScript
compas_4 = Python3Script(
    way_frames=transform_3.transformed_frames,
    tcp_measured=pt_15,
    acceleration=number_slider_20,
    velocity=number_slider_21,
    pick_frames=python_3_script_4.pick_frames)  # -> out, a, vis_frames, vis_planes, script; inputs way_frames: list, tcp_measured: Point3d, acceleration: Double, velocity: Double, pick_frames: list
# ---------- compas_4: Python ----------
from imp import reload
import sys
import os

#get current file path
path = ghenv.Component.OnPingDocument().FilePath
#get parent directory of the parent directory
parentdir = os.path.dirname(path)
#get src folder which contains classes
dire = os.path.join(parentdir,'src')

sys.path.append(dire)

import simple_ur_script as ur
reload(ur)

import utils 
reload(utils)

import simple_comm as com
reload(com)

import compas.geometry as cg
import math as m

# ===== Set global constants =======

IO = 4 # Global constant
SAFE_DIST = 100
sleep_time = 0.5

# =================================
from compas.geometry import Frame, Point

# Test
# frame = way_frames
# a = Frame([frame.point.x, frame.point.y, frame.point.z + SAFE_DIST], [0,1,0], [1, 0, 0])
# print(a)


def safe_location(frame, sefe_dist = SAFE_DIST):
    safe_frame = Frame([frame.point.x, frame.point.y, frame.point.z + SAFE_DIST], frame.xaxis, frame.yaxis)
    if safe_frame.zaxis.z > 0:
            safe_frame.xaxis = -safe_frame.xaxis
    return safe_frame

def pickup_brick(script, pick_up_frame):
    # Translate frame to "safe" location
    safe_frame = safe_location(pick_up_frame)
    # Move to safe frame
    script += ur.move_l(safe_frame, acceleration, velocity)
    # Move to pick location
    script += ur.move_l(pick_up_frame, acceleration, velocity)
    # Activate gripper
    script += ur.set_digital_out(IO, True)
    script += ur.sleep(sleep_time)
    # Move back to safe plane
    script += ur.move_l(safe_frame, acceleration, velocity)

    frames = [safe_frame, pick_up_frame, safe_frame]

    return script, frames


def place_brick(script, place_frame):
    
    # Safe frame for placing
    safe_frame = safe_location(place_frame)
    # Add to the path: go to the safe plane
    script += ur.move_l(safe_frame, acceleration, velocity)
    # Add to the path: go to the place plane
    script += ur.move_l(place_frame, acceleration, velocity)
    # Add to the path: turn off the vacuum and wait 1 second (hold the brick)
    script += ur.set_digital_out(IO, False)
    script += ur.sleep(sleep_time)
    # Add to the path: go back to the safe plane
    script += ur.move_l(safe_frame, acceleration, velocity)

    frames = [safe_frame, place_frame, safe_frame]
    return script, frames


# force pick_frame zaxis tio be negative
# if pick_frame.zaxis.z > 0:
#             pick_frame.xaxis = -pick_frame.xaxis

script = "" #create empty string

#if value given for tcp measured, then add line to script, otherwise it will take current tcp from robot
if tcp_measured is not None:
    script += ur.set_tcp_by_angles(tcp_measured.X, tcp_measured.Y, tcp_measured.Z, m.radians(0.0),m.radians(0.0),m.radians(0))


vis_frames = []
# Generate pick and place sequence

for i, frame in enumerate(way_frames):
    # for p in pick_frames:
        script, f1 = pickup_brick(script, pick_frames[i])
        script, f2 = place_brick(script, frame)
        vis_frames.extend(f1 + f2)

script = com.concatenate_script(script)


# Visualize
from compas_rhino import conversions
import Rhino.Geometry as rg

vis_planes = [conversions.frame_to_rhino(frame) for frame in vis_frames]
# ---------- end compas_4 ----------
compas_draw_19 = COMPASDraw(cg=compas.pushing_frame)  # -> rg; disabled; same code as compas_draw
point_22 = Point(compas.vis_planes)  # disabled
compas_draw_20 = COMPASDraw(cg=python_3_script_2.pick_frames)  # -> rg; disabled; same code as compas_draw

number_slider_23 = Slider(0, range=0..10)  # disabled
number_slider_24 = Slider(6, range=0..10)  # disabled
list_item_6 = ListItem(List=compas_draw_20, Index=number_slider_23, Wrap=True)  # -> flatten(Item); disabled
point_list_2 = PointList(Points=list_item_6, Size=number_slider_24)  # disabled

compas_draw_21 = COMPASDraw(cg=compas.vis_frames)  # -> rg; disabled; same code as compas_draw
compas_draw_22 = COMPASDraw(cg=compas_3.vis_frames)  # -> rg; same code as compas_draw
compas_draw_23 = COMPASDraw(cg=python_3_script_3.pick_frames)  # -> rg; same code as compas_draw

list_item_7 = ListItem(List=compas_draw_23, Index=Slider(0, range=0..10), Wrap=True)  # -> flatten(Item)
point_list_3 = PointList(Points=list_item_7, Size=Slider(6, range=0..10))

compas_draw_24 = COMPASDraw(cg=compas_2.prep_frame)  # -> rg; same code as compas_draw
point_23 = Point(compas_4.vis_planes)
compas_draw_25 = COMPASDraw(cg=python_3_script_4.pick_frames)  # -> rg; same code as compas_draw

list_item_8 = ListItem(List=compas_draw_25, Index=Slider(0, range=0..10), Wrap=True)  # -> flatten(Item)
point_list_4 = PointList(Points=list_item_8, Size=Slider(6, range=0..10))

compas_draw_26 = COMPASDraw(cg=compas_4.vis_frames)  # -> rg; same code as compas_draw
point_24 = Point(compas_2.vis_planes)
polyline = PolyLine(Vertices=point_22, Closed=False)  # disabled
point_25 = Point(compas_3.vis_planes)
polyline_2 = PolyLine(Vertices=point_23, Closed=False)
list_item_9 = ListItem(List=point_25, Index=Slider(24, range=0..100), Wrap=True)
polyline_3 = PolyLine(Vertices=point_24, Closed=False)
# Send to Robot!
point_list_5 = PointList(Points=flatten(compas_2.vis_planes), Size=Slider(10, range=0..10))
polyline_4 = PolyLine(Vertices=point_25, Closed=False)
list_item_10 = ListItem(List=point_24, Index=Slider(23, range=0..100), Wrap=True)

# ---- group: Send UR script to Robot!
button = Button()  # disabled
# Send to Robot!
py3_8 = Python3Script(script=compas.script, ip_address=panel, send=button)  # -> out, a; inputs script: String, ip_address: String, send: Boolean; disabled
# ---------- py3_8: Python ----------
import simple_comm as com

if send:
    com.send_script(script,ip_address)
# ---------- end py3_8 ----------

# ----
panel_14 = Panel(compas.script)  # disabled

# ---- group: Send UR script to Robot!
py3_9 = Python3Script(script=compas_2.script, ip_address="169.254.130.206", send=Button())  # -> out, a; inputs script: String, ip_address: String, send: Boolean; same code as py3_8

# ----
panel_15 = Panel(compas_3.script)

# ---- group: Send UR script to Robot!
# Send to Robot!
py3_10 = Python3Script(script=compas_4.script, ip_address="169.254.130.206", send=Button())  # -> out, a; inputs script: String, ip_address: String, send: Boolean; same code as py3_8

# ----
panel_16 = Panel(compas_4.script)
