# Grasshopper definition (dropping_from_air)brick_to_robot.gh (Grasshopper 1.0.8)
# plug-ins: Bifocals

# ---- group: This is needed only ONCE in the GH definition
enable_auto_reload = Python3Script()  # -> ok
# ---------- enable_auto_reload: Python ----------
"""
------------------------------
Using VS Code as Python editor
------------------------------

The simplest way to start using VS Code as our editor, is
to place our Python code in files located IN THE SAME FOLDER as our Grasshopper file.

After we have done that, we need 2 steps: 

1. Enable the COMPAS reloader on one component. This tells Grasshopper to watch for changes in the Pythoh files and reload if changed.
2. Every other component that uses Python code from external files needs to start with a method to ensure Grasshopper knows where to load the files from.

"""
# r: compas
# venv: mas-2627

from compas_rhino.devtools import DevTools
DevTools.enable_reloader()
# ---------- end enable_auto_reload ----------

# ----
point = Point(<point referenced from the Rhino model>)
point_2 = Point(<point referenced from the Rhino model>)
point_3 = Point(<point referenced from the Rhino model>)
lamcp_bridge = LAMCPBridge(enable=Toggle(True))  # -> status; inputs enable: Boolean, port: Int32
#   port enable: Toggle to start (True) or stop (False) the local HTTP server.
#   port port: Port to listen on (loopback only). Defaults to 8765.
#   port status: Current server status string.
# ---------- lamcp_bridge: Python ----------
"""
LAMCP Bridge: local HTTP server inside Rhino 8 / Grasshopper CPython.

Exposes `POST /exec` (JSON: `{"code": "...", "timeout": 30}`) which
exec()s `code` and returns
`{"stdout": "...", "stderr": "...", "result": "...", "error": null|str}`.

Pair with the `lamcp` FastMCP server, which translates Claude's
`run_python_script` MCP tool calls into POSTs to this endpoint.

Binds to 127.0.0.1 only. NEVER expose beyond localhost â€” it exec()s
arbitrary Python with full Rhino API access.

LAMCP v0.1.0
"""

import contextlib
import io
import json
import threading
import traceback
from http.server import BaseHTTPRequestHandler
from http.server import HTTPServer

import Grasshopper
import scriptcontext as sc


SHARED_GLOBALS_KEY = "_lamcp_bridge_globals"
SERVER_KEY = "_lamcp_bridge_server"


def _exec_code(code, timeout):
    """Run `code` on the HTTP-server thread and capture stdout/stderr/result.

    NOTE: this is intentionally NOT marshalled to Rhino's UI thread for the
    spike â€” `Rhino.RhinoApp.InvokeOnUiThread` was queueing actions that
    never fired in Rhino 8 CPython. Most read-only RhinoCommon access is
    safe cross-thread; mutations may crash. Add Eto-based marshalling
    back here when we need it.
    """
    out = io.StringIO()
    err = io.StringIO()
    g = sc.sticky.setdefault(SHARED_GLOBALS_KEY, {"__name__": "__lamcp_bridge__"})
    error_text = None
    result_repr = None
    try:
        with contextlib.redirect_stdout(out), contextlib.redirect_stderr(err):
            exec(code, g, g)
            result_repr = repr(g.get("_"))
    except BaseException:
        error_text = traceback.format_exc()

    return {
        "stdout": out.getvalue(),
        "stderr": err.getvalue(),
        "result": result_repr,
        "error": error_text,
    }


class _ExecHandler(BaseHTTPRequestHandler):
    # Silence default request logging so it doesn't clog the Rhino command line.
    def log_message(self, fmt, *args):
        pass

    def _send(self, code, payload):
        body = json.dumps(payload).encode("utf-8")
        self.send_response(code)
        self.send_header("Content-Type", "application/json")
        self.send_header("Content-Length", str(len(body)))
        self.end_headers()
        self.wfile.write(body)

    def do_GET(self):
        if self.path == "/health":
            self._send(200, {"status": "ok"})
        else:
            self._send(404, {"error": "not found"})

    def do_POST(self):
        if self.path != "/exec":
            self._send(404, {"error": "not found"})
            return
        length = int(self.headers.get("Content-Length", "0"))
        try:
            raw = self.rfile.read(length).decode("utf-8")
            body = json.loads(raw)
            code = body.get("code", "")
            timeout = float(body.get("timeout", 30.0))
        except Exception as exc:
            self._send(400, {"error": "bad request: " + repr(exc)})
            return
        result = _exec_code(code, timeout)
        self._send(200, result)


def _start_server(port):
    server = HTTPServer(("127.0.0.1", port), _ExecHandler)
    thread = threading.Thread(
        target=server.serve_forever, daemon=True, name="lamcp-bridge"
    )
    thread.start()
    return {"server": server, "thread": thread, "port": port}


def _stop_server(state):
    try:
        state["server"].shutdown()
        state["server"].server_close()
    except Exception:
        pass


class LamcpBridgeComponent(Grasshopper.Kernel.GH_ScriptInstance):
    def RunScript(self, enable: bool, port: int):
        port = int(port) if port else 8765

        state = sc.sticky.get(SERVER_KEY)

        if not enable:
            if state is not None:
                _stop_server(state)
                del sc.sticky[SERVER_KEY]
            return "stopped"

        # Already running on the requested port: no-op.
        if (
            state is not None
            and state.get("port") == port
            and state["thread"].is_alive()
        ):
            return "listening on http://127.0.0.1:{}".format(port)

        # Port changed or server died: tear down and restart.
        if state is not None:
            _stop_server(state)
            del sc.sticky[SERVER_KEY]

        try:
            sc.sticky[SERVER_KEY] = _start_server(port)
        except OSError as exc:
            ghenv.Component.AddRuntimeMessage(  # noqa: F821
                Grasshopper.Kernel.GH_RuntimeMessageLevel.Error,
                "Failed to bind 127.0.0.1:{}: {}".format(port, exc),
            )
            return "error: {}".format(exc)

        return "listening on http://127.0.0.1:{}".format(port)
# ---------- end lamcp_bridge ----------
curve = Curve(<curve referenced from the Rhino model>)
gap = Slider(0, range=0..10)

point_4 = Point(<point referenced from the Rhino model>)
point_5 = Point(<point referenced from the Rhino model>)
point_6 = Point(<point referenced from the Rhino model>)

point_7 = Point(<point referenced from the Rhino model>)
point_8 = Point(<point referenced from the Rhino model>)
point_9 = Point(<point referenced from the Rhino model>)
point_10 = Point(<point referenced from the Rhino model>)
point_11 = Point(<point referenced from the Rhino model>)
point_12 = Point(<point referenced from the Rhino model>)
brick_wall = Python3Script(
    crv=curve,
    layers=Slider(2, range=0..10),
    lapping=Slider(3, range=0..5),
    pick_number=Slider(6, range=0..100),
    gap=gap,
    drop_height=Slider(30, range=0..100))  # -> bricks, geometries, frames, number_of_bricks; inputs crv: Curve, layers: Int32, pick_number: Int32
# ---------- brick_wall: Python ----------
# r : compas 
# venv: mas-2627
from compas_rhino.devtools import DevTools
DevTools.ensure_path()

from compas.geometry import Box, Point
from compas.geometry import Vector, cross_vectors
from compas.geometry import Frame

from compas_rhino.conversions import curve_to_compas
import Rhino.Geometry as rg

from brick_element import Brick


# Real script
# Build the stonehenge

bricks = []

# def moving_param_with_d(crv, param, distance):
#     length_a = crv.GetLength(rg.Interval(crv.Domain.T0, param))
#     target = length_a + distance

#     ok, t_new = crv.LengthParameter(target)
#     if not ok:
#         raise ValueError("Cannot find parameter at length {}".format(target))
#     return t_new

def create_temple_base(compas_crv, param, base_layers=2, base_row=3):
    base_bricks = []
    pt = compas_crv.point_at(param)
    temp_pt = pt.copy()
    temp_pt.z += Brick.HEIGHT / 2

    yv = compas_crv.tangent_at(param)
    yv.unitize()
    zv = Vector(0,0,1)
    xv = yv.cross(zv)

    d_x = (Brick.LENGTH + 1)/2

    if base_layers == 1:
        for sign in (1, -1):
            origin_pt = temp_pt + xv * (d_x * sign)
            base_bricks.append(Brick(Frame(origin_pt, xv, yv), "laying"))
    else:
        for i in range(base_layers):
            for j in range(base_row):
                if i % 2 == j % 2:
                    for sign in (1,-1):
                            if j == 0 and sign == -1:
                                continue
                            origin_pt = temp_pt + zv * i * Brick.HEIGHT + xv * d_x *j * sign
                            laying_frame = Frame(origin_pt, xv, yv)
                            brick = Brick(laying_frame, "laying")
                            base_bricks.append(brick)
    top_center_pt = pt + zv * base_layers * Brick.HEIGHT
    return base_bricks, top_center_pt


def create_temple(compas_crv, param, top_lapping, num_layers, starting_pt= None):
    temple_bricks =[]
    if starting_pt is None:
        starting_pt = compas_crv.point_at(param)
    yv = compas_crv.tangent_at(param)
    yv.unitize()
    zv = Vector(0,0,1)
    xv = yv.cross(zv)

    d_x = Brick.LENGTH / 2 - top_lapping +  Brick.HEIGHT /2
    d_z = Brick.LENGTH
    temp_pt = starting_pt.copy()
    temp_pt.z += d_z /2

    # center pt (origin) of standing bricks
    for i in range(num_layers):
        for sign in (1, -1):
            origin_s = temp_pt + zv * d_z * (i) 
            origin_s += xv * d_x * sign
            standing_frame = Frame(origin_s, xv, yv)
            temple_bricks.append(Brick(standing_frame, "standing"))


    # center pt (origin) of laying brick (top brick)
    origin_l = temp_pt + zv * d_z * (num_layers-0.5) + zv * (Brick.HEIGHT/2)
    laying_frame = Frame(origin_l, xv, yv)
    temple_bricks.append(Brick(laying_frame, "laying"))
    return temple_bricks

def domino(compas_crv, gap, list_top=None, pick_number=None):
    domino_bricks = [] 
    length = Brick.WIDTH + gap
    crv_length = compas_crv.length()
    count = int(crv_length // length)

    params, points= compas_crv.divide_by_count(count, True)
    if pick_number is not None:
        for i in range(len(list_top)):
            for i, top in enumerate(list_top):
                points[pick_number + i] = top

    for param, pt in zip(params, points):
        tangent = compas_crv.tangent_at(param)
        origin = pt + Vector(0, 0, Brick.LENGTH / 2)
        frame = Frame(origin, xaxis = tangent, yaxis = cross_vectors(tangent, [0,0,1]))
        domino_bricks.append(Brick(frame, brick_type = "standing"))
    
    return domino_bricks


def l_along_crv(compas_crv, gap):
    laying_bricks = [] 
    length = Brick.LENGTH + gap
    crv_length = compas_crv.length()
    count = int(crv_length // length)

    params, points= compas_crv.divide_by_count(count, True)

    for param, pt in zip(params, points):
        tangent = compas_crv.tangent_at(param)
        origin = pt + Vector(0, 0, Brick.HEIGHT / 2)
        frame = Frame(origin, xaxis = tangent , yaxis= cross_vectors(tangent, [0,0,1]))
        laying_bricks.append(Brick(frame, brick_type = "laying"))
    
    return laying_bricks

def drop_bricks(compas_crv, gap, height):
    laying_bricks = [] 
    length = Brick.WIDTH + gap

    drop_crv = compas_crv.translated(Vector(0,15, height))
    crv_length = drop_crv.length()
    count = int(crv_length // length)

    params, points= drop_crv.divide_by_count(count, True)

    # params = [p for p in params][1:-1]
    # points = [p for p in points][1:-1]
    for param, pt in zip(params, points):
        tangent = drop_crv.tangent_at(param)
        origin = pt + Vector(0, 0, Brick.HEIGHT / 2)
        frame = Frame(origin, xaxis = cross_vectors(tangent, [0,0,1]), yaxis= tangent)
        laying_bricks.append(Brick(frame, brick_type = "laying"))
    
    return laying_bricks

# ===== elements of crv =====
# reparameterize crv
# crv.Domain = rg.Interval(0,1)
compas_crv = curve_to_compas(crv)
compas_crv_2 = compas_crv.translated(Vector(0,40,0))
# drop_crv = compas_crv.translated(Vector(0,15,30))


# ===== Start putting bricks =====
laying_bricks = l_along_crv(compas_crv, gap)
block_bricks = l_along_crv(compas_crv_2, gap)
drop_bricks_1 = drop_bricks(compas_crv, gap, drop_height)
drop_bricks_2 = drop_bricks(compas_crv, gap, drop_height+5)
drop_bricks_3 = drop_bricks(compas_crv, gap, drop_height+10)


# === create brick list ===
# bricks = laying_bricks +block_bricks + drop_bricks_1+ drop_bricks_2+ drop_bricks_3
bricks = laying_bricks
# ===== get pick frame =====
geometries = []
frames = []
for brick in bricks:
    geometries.append(brick.draw())
    frames.append(brick.top_frame())

number_of_bricks = len(bricks)
# ---------- end brick_wall ----------
py3 = Python3Script(origin=point_4, xaxis_pt=point_7, xy_pt=point_10)  # -> out, pick_frame; inputs origin: Point3d, xaxis_pt: Point3d, xy_pt: Point3d
# ---------- py3: Python ----------
from compas.geometry import Frame, Point, Vector
from compas.geometry import Rotation

from compas_rhino.conversions import point_to_compas

origin = point_to_compas(origin)
xaxis_pt = point_to_compas(xaxis_pt)
xy_pt = point_to_compas(xy_pt)

#define pick frame
pick_frame = Frame(origin, xaxis_pt - origin, xy_pt - origin)
# ---------- end py3 ----------
py3_2 = Python3Script(origin=point_5, xaxis_pt=point_8, xy_pt=point_11)  # -> out, pick_frame; inputs origin: Point3d, xaxis_pt: Point3d, xy_pt: Point3d; same code as py3
py3_3 = Python3Script(origin=point_6, xaxis_pt=point_9, xy_pt=point_12)  # -> out, pick_frame; inputs origin: Point3d, xaxis_pt: Point3d, xy_pt: Point3d; same code as py3
compas_draw = COMPASDraw(cg=brick_wall.geometries)  # -> rg
#   port cg: The COMPAS geometry or datastructure to be drawn.
#   port rg: The Rhino geometry object.
# ---------- compas_draw: Python ----------
# r: compas>=2.14.1
"""
Draws COMPAS geometry in Grasshopper.
"""

from typing import Any

import Grasshopper

from compas.scene import SceneObject


class CompasToRhinoGeometry(Grasshopper.Kernel.GH_ScriptInstance):
    def RunScript(self, cg):
        if not cg:
            return None

        return SceneObject(item=cg).draw()
# ---------- end compas_draw ----------
# laying
compas_draw_2 = COMPASDraw(cg=py3.pick_frame)  # -> rg; same code as compas_draw
# side
compas_draw_3 = COMPASDraw(cg=py3_2.pick_frame)  # -> rg; same code as compas_draw
# standing
compas_draw_4 = COMPASDraw(cg=py3_3.pick_frame)  # -> rg; same code as compas_draw

# ----
# Measure work object
point_13 = ValueList({"origin", "xaxis", "xypoint"}, selected="xypoint")
capture = Button()
capture_wobj = CaptureWobj(robot_ip="169.254.130.206", point_name=point_13, capture=capture)  # -> wobj_origin, wobj_xaxis, wobj_xypoint, info
# ---------- capture_wobj: Python ----------
"""
Capture the 3 points that define the work object (robot base) plane.

Jog the TCP to a point, pick its name (origin / xaxis / xypoint) and press capture.
The TCP position (robot base frame, mm) is saved to wobj_calibration.json next to
this .ghx file, so the points survive closing Grasshopper.
"""
import os
import sys
import json
import time

import scriptcontext as sc
import Rhino.Geometry as rg

NAMES = ["origin", "xaxis", "xypoint"]

gh_dir = os.path.dirname(ghenv.Component.OnPingDocument().FilePath)
src_dir = os.path.join(gh_dir, "src")
if src_dir not in sys.path:
    sys.path.append(src_dir)
import simple_comm as com

path = os.path.join(gh_dir, "wobj_calibration.json")

data = {}
if os.path.exists(path):
    with open(path) as f:
        data = json.load(f)

# keep the last status in sticky, so the message survives the button being released
status_key = "capture_status_" + str(ghenv.Component.InstanceGuid)

if capture:
    if point_name not in NAMES:
        sc.sticky[status_key] = "pick origin / xaxis / xypoint"
    else:
        try:
            x, y, z = list(com.listen_to_robot(robot_ip)["pose"])[:3]  # metres, robot base frame
            data[point_name] = [round(x * 1000, 2), round(y * 1000, 2), round(z * 1000, 2)]  # -> mm
            with open(path, "w") as f:
                json.dump(data, f, indent=2)
            sc.sticky[status_key] = "{} captured {}".format(point_name, time.strftime("%H:%M:%S"))
        except Exception as e:
            print(e)
            sc.sticky[status_key] = "robot not reachable"

ghenv.Component.Message = sc.sticky.get(status_key, "")

def pt(name):
    return rg.Point3d(*data[name]) if name in data else None

wobj_origin, wobj_xaxis, wobj_xypoint = pt("origin"), pt("xaxis"), pt("xypoint")
info = json.dumps(data, indent=2)
# ---------- end capture_wobj ----------
wobj_calibration = Panel(capture_wobj.info)

panel = Panel("7")

# ----
# Bricks
# frames
merge = Merge(Data1=brick_wall.bricks)
merge_2 = Merge(Data1=brick_wall.frames)

number_slider = Slider(0, range=0..10)
compas_draw_5 = COMPASDraw()  # -> rg; same code as compas_draw
list_item = ListItem(List=compas_draw_5, Index=Slider(4, range=0..10), Wrap=True)  # -> flatten(Item)
point_list = PointList(Points=list_item, Size=Slider(6, range=0..10))

point_14 = Point(capture_wobj.wobj_origin)
point_15 = Point(capture_wobj.wobj_xaxis)
point_16 = Point(capture_wobj.wobj_xypoint)
# Adjust the height of placement
fine_adjust_z_mm = Slider(0, range=-5..10)
number_slider_2 = Slider(20.5, range=0..100)
number_slider_3 = Slider(24.5, range=0..100)
# Transform from Rhino to Robot Space
transform = Python3Script(
    way_planes=merge_2,
    wobj_origin=capture_wobj.wobj_origin,
    wobj_xaxis=capture_wobj.wobj_xaxis,
    wobj_xypoint=capture_wobj.wobj_xypoint,
    z_safe_margin=fine_adjust_z_mm)  # -> out, robot_base, transformed_frames, first_frame, working_place; inputs way_planes: list, wobj_origin: Point3d, wobj_xaxis: Point3d, wobj_xypoint: Point3d, z_safe_margin: Double
# ---------- transform: Python ----------
from compas.geometry import Frame, Transformation, Translation, Vector
from compas.geometry import Polyline
from compas_rhino.conversions import polyline_to_rhino
#in this step we transform our way planes to robot space
#the rhino co-ordinate system is rather abstract in the physical world
#the robot base plane assumed the base frame of robot is the origin
#but rhino does not know that
#thus we transform things from our design space(Rhino World XY) to Robot Base Plane that we measure

def set_robot_base(origin, xaxis, xypoint):
    """
    set a base plane representing the robot working object plane
    """
    robot_base = Frame(origin, xaxis - origin, xypoint - origin)
    print (robot_base)
    return (robot_base)

def working_place_display(origin, xaxis, xypoint):
    a = wobj_origin
    b = wobj_xaxis
    c = wobj_xypoint
    d = b+c-a
    polyline = Polyline([a,b,d,c,a])
    display_polygon = polyline_to_rhino(polyline)
    return display_polygon
    


def rhino_to_robot_space(rhino_plane,robot_base_plane):
    """
    Transform the objects from Rhino world XY plane to robot work object plane
    """
    T_matrix = Transformation.from_frame_to_frame(Frame.worldXY(), robot_base_plane)
    robot_plane = rhino_plane.transformed(T_matrix)
    return robot_plane

def set_z_safe_margin(planes_to_adjust, safety_margin):
    adjusted = []
    T = Translation.from_vector(Vector(0, 0, safety_margin))
    for f in planes_to_adjust:
        adjusted.append(f.transformed(T))
    return adjusted

# ===== Robot base is set =====
robot_base =  set_robot_base(wobj_origin, wobj_xaxis, wobj_xypoint)

# ===== Set safety margin for Z height ======
safe_planes = set_z_safe_margin(way_planes, z_safe_margin)

# ===== Transforming the rhino planes into robot planes =====
transformed_frames = []
for plane in safe_planes: 
    transformed_frames.append(rhino_to_robot_space(plane, robot_base))

# ===== display working place
working_place = working_place_display(wobj_origin, wobj_xaxis, wobj_xypoint)

#test 
first_frame = transformed_frames[0]
# ---------- end transform ----------

pt = ConstructPoint(XCoordinate="442.53", YCoordinate="316.75", ZCoordinate=number_slider_3)
pt_2 = ConstructPoint(XCoordinate="442.21", YCoordinate="302", ZCoordinate=number_slider_3)
pt_3 = ConstructPoint(XCoordinate="449.86", YCoordinate="315.47", ZCoordinate=number_slider_3)

# ----
# Measure pick up location
capture_2 = Button()
point_17 = ValueList({"origin", "xaxis", "xypoint"}, selected="xaxis")
capture_pick = CapturePick(robot_ip="169.254.130.206", point_name=point_17, capture=capture_2)  # -> origin, xaxis_pt, xy_pt, info
# ---------- capture_pick: Python ----------
"""
Capture the 3 points that define the pick frame at the brick pick-up location.

Jog the TCP to a point, pick its name (origin / xaxis / xypoint) and press capture.
The TCP position (robot base frame, mm) is saved to pick_calibration.json next to
this .ghx file, so the points survive closing Grasshopper.
"""
import os
import sys
import json
import time

import scriptcontext as sc
import Rhino.Geometry as rg

NAMES = ["origin", "xaxis", "xypoint"]

gh_dir = os.path.dirname(ghenv.Component.OnPingDocument().FilePath)
src_dir = os.path.join(gh_dir, "src")
if src_dir not in sys.path:
    sys.path.append(src_dir)
import simple_comm as com

path = os.path.join(gh_dir, "pick_calibration.json")

data = {}
if os.path.exists(path):
    with open(path) as f:
        data = json.load(f)

# keep the last status in sticky, so the message survives the button being released
status_key = "capture_status_" + str(ghenv.Component.InstanceGuid)

if capture:
    if point_name not in NAMES:
        sc.sticky[status_key] = "pick origin / xaxis / xypoint"
    else:
        try:
            x, y, z = list(com.listen_to_robot(robot_ip)["pose"])[:3]  # metres, robot base frame
            data[point_name] = [round(x * 1000, 2), round(y * 1000, 2), round(z * 1000, 2)]  # -> mm
            with open(path, "w") as f:
                json.dump(data, f, indent=2)
            sc.sticky[status_key] = "{} captured {}".format(point_name, time.strftime("%H:%M:%S"))
        except Exception as e:
            print(e)
            sc.sticky[status_key] = "robot not reachable"

ghenv.Component.Message = sc.sticky.get(status_key, "")

def pt(name):
    return rg.Point3d(*data[name]) if name in data else None

origin, xaxis_pt, xy_pt = pt("origin"), pt("xaxis"), pt("xypoint")
info = json.dumps(data, indent=2)
# ---------- end capture_pick ----------
pick_calibration = Panel(capture_pick.info)
# pick-up location for standing brick
py3_4 = Python3Script(origin=pt, xaxis_pt=pt_2, xy_pt=pt_3)  # -> out, s_pick_frame, l_pick_frame; inputs origin: Point3d, xaxis_pt: Point3d, xy_pt: Point3d
# ---------- py3_4: Python ----------
from compas.geometry import Frame, Point, Vector
from compas.geometry import Rotation

from compas_rhino.conversions import point_to_compas

origin = point_to_compas(origin)
xaxis_pt = point_to_compas(xaxis_pt)
xy_pt = point_to_compas(xy_pt)

#define pick frame
l_pick_frame = Frame(origin, -(origin - xaxis_pt), -(xy_pt -origin) )
s_origin = origin.copy() + Vector(128.5,11,0)
s_pick_frame = Frame(s_origin, -(origin - xaxis_pt), -(xy_pt -origin))
# ---------- end py3_4 ----------
compas_draw_6 = COMPASDraw(cg=py3_4.s_pick_frame)  # -> rg; same code as compas_draw

pt_4 = ConstructPoint(XCoordinate="586.98", YCoordinate="355.48", ZCoordinate=number_slider_2)
pt_5 = ConstructPoint(XCoordinate="572.15", YCoordinate="356.27", ZCoordinate=number_slider_2)
pt_6 = ConstructPoint(XCoordinate="571.8", YCoordinate="348.96", ZCoordinate=number_slider_2)

curve_2 = Curve(transform.working_place)
compas_draw_7 = COMPASDraw(cg=transform.transformed_frames)  # -> rg; same code as compas_draw
point_18 = Point(capture_pick.xaxis_pt)
# pick-up location for laying brick
py3_5 = Python3Script(origin=pt_5, xaxis_pt=pt_4, xy_pt=pt_6)  # -> out, pick_frame; inputs origin: Point3d, xaxis_pt: Point3d, xy_pt: Point3d
# ---------- py3_5: Python ----------
from compas.geometry import Frame, Point
from compas.geometry import Rotation

from compas_rhino.conversions import point_to_compas

origin = point_to_compas(origin)
xaxis_pt = point_to_compas(xaxis_pt)
xy_pt = point_to_compas(xy_pt)

#define pick frame
pick_frame = Frame(origin, xaxis_pt - origin, xy_pt - origin)
# ---------- end py3_5 ----------

# ----
# Measure and set TCP
panel_2 = Panel("-1.71")
pt_7 = ConstructPoint(XCoordinate=panel_2, YCoordinate="-0.9", ZCoordinate="77.83")

compas_draw_8 = COMPASDraw(cg=py3_5.pick_frame)  # -> rg; same code as compas_draw
number_slider_4 = Slider(0.6, range=0..1)

number_slider_5 = Slider(4, range=0..10)
python_3_script = Python3Script(layers=Slider(1, range=0..10), row=Slider(15, range=0..20), pick_frame=py3_4.l_pick_frame)  # -> out, pts, pick_frames; inputs layers: Int32, row: Int32, col: Int32
# ---------- python_3_script: Python ----------
# r: compas
# venv: mas-2627
from compas_rhino.devtools import DevTools
DevTools.ensure_path()

# 0. Import everything we will need
import math
from compas.geometry import Box
from compas.geometry import Point
from compas.geometry import Frame
from compas.geometry import cross_vectors

from compas_rhino.conversions import curve_to_compas

from brick_element import Brick

# 1. Start with an empty list of bricks to be created
bricks = []

pts = []
pick_frames = []


# stacks for standing bricks
def stacks_for_standing(pick_frame, row=16, col=4):
    for i in range(row):
        for j in range(col):
            x = (pick_frame.point.x) + j * Brick.WIDTH
            y = (pick_frame.point.y+9) - i * Brick.HEIGHT
            z = (pick_frame.point.z - Brick.HEIGHT) + Brick.LENGTH
            pt = Point(x, y, z)
            pts.append(pt)
            frame = Frame(pt, pick_frame.xaxis, pick_frame.yaxis)
            pick_frames.append(frame)
    return pick_frames


# stacks for standing bricks
def stacks_for_laying(pick_frame, row=5, col=4, layers=2):
    
    for k in range(layers):
        for i in range(row):
            for j in range(col):
                x = pick_frame.point.x + j * Brick.WIDTH 
                y = pick_frame.point.y - i * Brick.LENGTH
                z = pick_frame.point.z + (layers - k -1) * Brick.HEIGHT
                pt = Point(x, y, z)
                pts.append(pt)
                frame = Frame(pt, pick_frame.xaxis, pick_frame.yaxis)
                pick_frames.append(frame)
    return pick_frames

# pick_frames = stacks_for_laying(pick_frame)
pick_frames = stacks_for_standing(pick_frame)
# ---------- end python_3_script ----------

compas = Python3Script(
    bricks=merge,
    way_frames=transform.transformed_frames,
    tcp_measured=pt_7,
    acceleration=number_slider_4,
    velocity=number_slider_4,
    angle=Slider(-15, range=-90..90),
    s_pick_frame=py3_4.s_pick_frame,
    l_pick_frame=py3_4.l_pick_frame,
    l_frame=py3.pick_frame,
    s_frame=py3_3.pick_frame,
    d_frame=py3_2.pick_frame)  # -> out, a, vis_frames, vis_planes, pushing_frame, script, s_stacks, l_stacks, prep_frame; inputs bricks: list, way_frames: list, tcp_measured: Point3d, acceleration: Double, velocity: Double
# ---------- compas: Python ----------
from imp import reload
import sys
import os

#get current file path
path = ghenv.Component.OnPingDocument().FilePath
#get parent directory of the parent directory
parentdir = os.path.dirname(path)
#get src folder which contains classes
dire = os.path.join(parentdir,'src')

sys.path.append(dire)

import simple_ur_script as ur
reload(ur)

import utils 
reload(utils)

import simple_comm as com
reload(com)

import compas.geometry as cg
import math as m

# ===== Set global constants =======

IO = 4 # Global constant
SAFE_DIST = 100
sleep_time = 0.5

# =================================
from compas.geometry import Frame, Point, Vector, Rotation, Translation
import math as m

from brick_element import Brick

# Test
# frame = way_frames
# a = Frame([frame.point.x, frame.point.y, frame.point.z + SAFE_DIST], [0,1,0], [1, 0, 0])
# print(a)


def safe_location(frame, sefe_dist = SAFE_DIST):
    safe_frame = Frame([frame.point.x, frame.point.y, frame.point.z + SAFE_DIST], frame.xaxis, frame.yaxis)
    if safe_frame.zaxis.z > 0:
            safe_frame.xaxis = -safe_frame.xaxis
    return safe_frame

def where_to_pick(brick_type, s_stacks, l_stacks, s_count, l_count):
    if brick_type =="laying":
        pick_up_frame = l_stacks[l_count]
        l_count += 1
    elif brick_type == "standing":
        pick_up_frame = s_stacks[s_count]
        s_count += 1
    return pick_up_frame, s_count, l_count




def adjust_brick_types(script, brick_type, origin_frame):
    
    if brick_type == "laying":
        taking_frame = l_frame
    elif brick_type =="standing":
        taking_frame = s_frame
    elif brick_type == "side":
        taking_frame = d_frame
    v_x = origin_frame.xaxis.unitized()
    v_y = origin_frame.yaxis.unitized()
    v_z = origin_frame.zaxis.unitized()
    v_trans =  v_x * 5 + v_y * 10 + v_z * (-1)
    t = Translation.from_vector(v_trans)
    trans_frame = origin_frame.transformed(t)
    safe_frame = safe_location(trans_frame)


    script += ur.move_l(safe_frame, acceleration, velocity)
    # move to transition point
    script += ur.move_l(trans_frame, acceleration, velocity)
    script += ur.set_digital_out(IO, False)
    script += ur.sleep(sleep_time)

    # move to preparing point (moving along with z)
    prep_frame = taking_frame.copy()
    prep_frame.point += prep_frame.zaxis.unitized() * (-10)
    safe_frame_p = safe_location(prep_frame, 30)

    script += ur.move_l(safe_frame_p, acceleration, velocity)
    script += ur.move_l(prep_frame, acceleration, velocity)
    # move to the taking frame 
    
    script += ur.move_l(taking_frame, acceleration, velocity)
    script += ur.set_digital_out(IO, True)
    script += ur.sleep(sleep_time)

    # go back to safe place
    script += ur.move_l(safe_frame, acceleration, velocity)

    frames = [safe_frame, trans_frame, safe_frame_p, prep_frame, taking_frame, safe_frame]


    return script, frames

def pickup_brick(script, pick_up_frame):
    # Translate frame to "safe" location
    safe_frame = safe_location(pick_up_frame)
    # Move to safe frame
    script += ur.move_l(safe_frame, acceleration, velocity)
    # Move to pick location
    script += ur.move_l(pick_up_frame, acceleration, velocity)
    # Activate gripper
    script += ur.set_digital_out(IO, True)
    script += ur.sleep(sleep_time)
    # Move back to safe plane
    script += ur.move_l(safe_frame, acceleration, velocity)

    frames = [safe_frame, pick_up_frame, safe_frame]

    return script, frames


def place_brick(script, place_frame):
    
    # Safe frame for placing
    safe_frame = safe_location(place_frame)
    # Add to the path: go to the safe plane
    script += ur.move_l(safe_frame, acceleration, velocity)
    # Add to the path: go to the place plane
    script += ur.move_l(place_frame, acceleration, velocity)
    # Add to the path: turn off the vacuum and wait 1 second (hold the brick)
    script += ur.set_digital_out(IO, False)
    script += ur.sleep(sleep_time)
    # Add to the path: go back to the safe plane
    script += ur.move_l(safe_frame, acceleration, velocity)

    frames = [safe_frame, place_frame, safe_frame]
    return script, frames


def push_first_brick(script, first_frame, angle):
    end_frame = first_frame.copy()
    end_frame.translate(Vector(0, 0, -16))
    pushing_v = end_frame.xaxis.unitized() 

    pushing_frame = end_frame.translated(-pushing_v * 16) #starting pt
    end_frame.translate(pushing_v * 10) #end pt

    safe_frame = safe_location(pushing_frame)

    # tilted the frame 
    matrix_r = Rotation.from_axis_and_angle(end_frame.yaxis, m.radians(angle), pushing_frame.point)
    pushing_frame.transform(matrix_r)
    matrix_r = Rotation.from_axis_and_angle(end_frame.yaxis, m.radians(-angle), end_frame.point)
    end_frame.transform(matrix_r)

    # Safe frame for pushing
    script += ur.move_l(safe_frame, acceleration, velocity)
    script += ur.move_l(pushing_frame, acceleration, velocity)
    script += ur.move_l(end_frame, acceleration + 1.5, velocity +1.5)
    script += ur.move_l(safe_frame, acceleration, velocity)

    frame = [safe_frame, pushing_frame, end_frame, safe_frame]
    return script, frame

def drop_brick(script, pick_up_frame,angle):

    # Translate frame to "safe" location
    safe_frame = safe_location(pick_up_frame)

    drop_frame = safe_frame.translated(Vector(0, 150, 100))
    matrix_r = Rotation.from_axis_and_angle(drop_frame.yaxis, m.radians(angle), drop_frame.point)
    drop_frame.transform(matrix_r)
    # Move to safe frame
    script += ur.move_l(safe_frame, acceleration, velocity)
    # Move to pick location
    script += ur.move_l(pick_up_frame, acceleration, velocity)
    # Activate gripper
    script += ur.set_digital_out(IO, True)
    script += ur.sleep(sleep_time)
    # Move back to safe plane
    script += ur.move_l(safe_frame, acceleration, velocity)
    script += ur.move_l(drop_frame, acceleration+4, velocity+4)
    script += ur.set_digital_out(IO, False)
    frames = [safe_frame, pick_up_frame, safe_frame, drop_frame]

    return script, frames

# stacks for standing bricks
def stacks_for_standing(pick_frame, row=15, col=4):
    s_stacks = []
    for i in range(row):
        for j in range(col):
            x = (pick_frame.point.x) + j * Brick.WIDTH
            y = (pick_frame.point.y) - i * Brick.HEIGHT
            z = (pick_frame.point.z - Brick.HEIGHT) + Brick.LENGTH
            pt = Point(x, y, z)
            frame = Frame(pt, pick_frame.xaxis, pick_frame.yaxis)
            s_stacks.append(frame)
    return s_stacks


# stacks for standing bricks
def stacks_for_laying(pick_frame, row=5, col=4, layers=2):
    l_stacks =[]
    for k in range(layers):
        for i in range(row):
            for j in range(col):
                x = pick_frame.point.x + j * Brick.WIDTH 
                y = pick_frame.point.y - i * Brick.LENGTH
                z = pick_frame.point.z + (layers - k -1) * Brick.HEIGHT
                pt = Point(x, y, z)
                frame = Frame(pt, pick_frame.xaxis, pick_frame.yaxis)
                l_stacks.append(frame)
    return l_stacks

# force pick_frame zaxis tio be negative
# if pick_frame.zaxis.z > 0:
            # pick_frame.xaxis = -pick_frame.xaxis

script = "" #create empty string

#if value given for tcp measured, then add line to script, otherwise it will take current tcp from robot
if tcp_measured is not None:
    script += ur.set_tcp_by_angles(tcp_measured.X, tcp_measured.Y, tcp_measured.Z, m.radians(0.0),m.radians(0.0),m.radians(0))


vis_frames = []

s_count, l_count = 0, 0
l_stacks = stacks_for_laying(l_pick_frame)

# Generate pick and place sequence
for i, frame in enumerate(way_frames):
    pick_up_frame = l_stacks[i%len(l_stacks)]
    # pick_up_frame, s_count, l_count = where_to_pick(bricks[i].type, s_stacks, l_stacks, s_count, l_count)
    # script, f1 = pickup_brick(script, pick_up_frame)
    script, f2 = drop_brick(script, pick_up_frame,-50)
    # script, f2 = place_brick(script, frame)
    vis_frames.extend(f2)

# ===== Robot Push first brick =====
# script, f3 = push_first_brick(script, way_frames[9], angle)
# vis_frames.extend(f3)



script = com.concatenate_script(script)

# Visualize
from compas_rhino import conversions
import Rhino.Geometry as rg

vis_planes = [conversions.frame_to_rhino(frame) for frame in vis_frames]
# ---------- end compas ----------
compas_draw_9 = COMPASDraw(cg=python_3_script.pick_frames)  # -> rg; same code as compas_draw

list_item_2 = ListItem(List=compas_draw_9, Index=Slider(0, range=0..10), Wrap=True)  # -> flatten(Item)
point_list_2 = PointList(Points=list_item_2, Size=Slider(6, range=0..10))

point_19 = Point(compas.vis_planes)
compas_draw_10 = COMPASDraw(cg=compas.vis_frames)  # -> rg; same code as compas_draw

# ----
# Send to Robot!
list_item_3 = ListItem(List=compas_draw_10, Index=Slider(3, range=0..10), Wrap=True)  # -> flatten(Item)
point_list_3 = PointList(Points=list_item_3, Size=Slider(6, range=0..10))

polyline = PolyLine(Vertices=point_19, Closed=False)
point_list_4 = PointList(Points=flatten(compas.vis_planes), Size=Slider(10, range=0..10))

# ---- group: Send UR script to Robot!
py3_6 = Python3Script(script=compas.script, ip_address="169.254.130.206", send=Button())  # -> out, a; inputs script: String, ip_address: String, send: Boolean
# ---------- py3_6: Python ----------
import simple_comm as com

if send:
    com.send_script(script,ip_address)
# ---------- end py3_6 ----------

# ----
panel_3 = Panel(compas.script)
