# Grasshopper definition (putting_stacks)brick_to_robot.ghx (Grasshopper 1.0.8)
# plug-ins: Bifocals

# ---- group: This is needed only ONCE in the GH definition
enable_auto_reload = Python3Script()  # -> ok
# ---------- enable_auto_reload: Python ----------
"""
------------------------------
Using VS Code as Python editor
------------------------------

The simplest way to start using VS Code as our editor, is
to place our Python code in files located IN THE SAME FOLDER as our Grasshopper file.

After we have done that, we need 2 steps: 

1. Enable the COMPAS reloader on one component. This tells Grasshopper to watch for changes in the Pythoh files and reload if changed.
2. Every other component that uses Python code from external files needs to start with a method to ensure Grasshopper knows where to load the files from.

"""
# r: compas
# venv: mas-2627

from compas_rhino.devtools import DevTools
DevTools.enable_reloader()
# ---------- end enable_auto_reload ----------

# ----
number_slider = Slider(3, range=0..30)
number_slider_2 = Slider(0.6, range=0..1)
gap = Slider(3, range=0..10)
curve = Curve(<curve referenced from the Rhino model>)

# ----
# Measure work object
point = ValueList({"origin", "xaxis", "xypoint"}, selected="xypoint")
capture = Button()
capture_wobj = CaptureWobj(robot_ip="169.254.130.206", point_name=point, capture=capture)  # -> wobj_origin, wobj_xaxis, wobj_xypoint, info
# ---------- capture_wobj: Python ----------
"""
Capture the 3 points that define the work object (robot base) plane.

Jog the TCP to a point, pick its name (origin / xaxis / xypoint) and press capture.
The TCP position (robot base frame, mm) is saved to wobj_calibration.json next to
this .ghx file, so the points survive closing Grasshopper.
"""
import os
import sys
import json
import time

import scriptcontext as sc
import Rhino.Geometry as rg

NAMES = ["origin", "xaxis", "xypoint"]

gh_dir = os.path.dirname(ghenv.Component.OnPingDocument().FilePath)
src_dir = os.path.join(gh_dir, "src")
if src_dir not in sys.path:
    sys.path.append(src_dir)
import simple_comm as com

path = os.path.join(gh_dir, "wobj_calibration.json")

data = {}
if os.path.exists(path):
    with open(path) as f:
        data = json.load(f)

# keep the last status in sticky, so the message survives the button being released
status_key = "capture_status_" + str(ghenv.Component.InstanceGuid)

if capture:
    if point_name not in NAMES:
        sc.sticky[status_key] = "pick origin / xaxis / xypoint"
    else:
        try:
            x, y, z = list(com.listen_to_robot(robot_ip)["pose"])[:3]  # metres, robot base frame
            data[point_name] = [round(x * 1000, 2), round(y * 1000, 2), round(z * 1000, 2)]  # -> mm
            with open(path, "w") as f:
                json.dump(data, f, indent=2)
            sc.sticky[status_key] = "{} captured {}".format(point_name, time.strftime("%H:%M:%S"))
        except Exception as e:
            print(e)
            sc.sticky[status_key] = "robot not reachable"

ghenv.Component.Message = sc.sticky.get(status_key, "")

def pt(name):
    return rg.Point3d(*data[name]) if name in data else None

wobj_origin, wobj_xaxis, wobj_xypoint = pt("origin"), pt("xaxis"), pt("xypoint")
info = json.dumps(data, indent=2)
# ---------- end capture_wobj ----------
wobj_calibration = Panel(capture_wobj.info)

# ----
# Generate Geometry
brick_wall = Python3Script(crv=curve, num_layers=number_slider, gap=gap, shift=Slider(7, range=0..10))  # -> bricks, geometries, frames, compas_crv, number_of_bricks; inputs crv: Curve, num_layers: Int32, gap: Double
# ---------- brick_wall: Python ----------
# r: compas
# venv: mas-2627
from compas_rhino.devtools import DevTools
DevTools.ensure_path()

# 0. Import everything we will need
import math
from compas.geometry import Box
from compas.geometry import Point, Vector
from compas.geometry import Frame
from compas.geometry import cross_vectors
from compas.geometry import Translation

from compas_rhino.conversions import curve_to_compas


# ..also import our module "brick_wall.py", that needs to be in the same folder as our GH file
from brick_wall import Brick

# 1. Start with an empty list of bricks to be created
bricks = []

# 2. Create points on curve curve
compas_crv = curve_to_compas(crv)
print(compas_crv.point_at(0))
compas_crv.translate([0,0,Brick.HEIGHT/2])
print(compas_crv.point_at(0))

# Divide the curve
length = (Brick.LENGTH + gap)/2
params, points = compas_crv.divide_by_length(length, True)

for i in range(num_layers):
    for j, (param, pt) in enumerate(zip(params, points)):
        if i % 2 == j % 2: #briliant method
            tangent = compas_crv.tangent_at(param)
            normal = cross_vectors(tangent, [0,0,1])

            if i % 2 == 1:
                pt = pt + tangent * (- shift)
            pt.z += i * Brick.HEIGHT

            frame = Frame(pt, xaxis = tangent, yaxis = normal)

            my_brick = Brick(frame)
            bricks.append(my_brick)


# Visualize and store brick data
geometries = []
frames = []
for brick in bricks:
    geometries.append(brick.draw())
    frames.append(brick.get_pick_frame())


number_of_bricks = len(frames)
# ---------- end brick_wall ----------
brick_wall_2 = Python3Script(crv=curve, num_layers=number_slider, gap=gap)  # -> bricks, geometries, frames, compas_crv; inputs crv: Curve, num_layers: Int32, gap: Double
# ---------- brick_wall_2: Python ----------
# r: compas
# venv: mas-2627
from compas_rhino.devtools import DevTools
DevTools.ensure_path()

# 0. Import everything we will need
import math
from compas.geometry import Box
from compas.geometry import Point
from compas.geometry import Frame
from compas.geometry import cross_vectors
from compas.geometry import Translation

from compas_rhino.conversions import curve_to_compas


# ..also import our module "brick_wall.py", that needs to be in the same folder as our GH file
from brick_wall import Brick

# 1. Start with an empty list of bricks to be created
bricks = []

# 2. Create points on curve curve
compas_crv = curve_to_compas(crv)
print(compas_crv.point_at(0))
compas_crv.translate([0,0,Brick.HEIGHT/2])
print(compas_crv.point_at(0))

# Divide the curve
length = Brick.LENGTH + gap
params, points = compas_crv.divide_by_length(length, True)

params = list(params)

for i in range(num_layers):
    if i % 2 == 0:
        layer_params = params
    else: 
        layer_params = [(a + b)/2  for a, b in zip(params, params[1:])]

    for param in layer_params :
        pt = compas_crv.point_at(param)  
        tangent = compas_crv.tangent_at(param)
        normal = cross_vectors(tangent, [0,0,1])
        pt.z += i * Brick.HEIGHT

        frame = Frame(pt, xaxis = tangent, yaxis = normal)

        my_brick = Brick(frame)
        bricks.append(my_brick)


# Visualize and store brick data
geometries = []
frames = []
for brick in bricks:
    geometries.append(brick.draw())
    frames.append(brick.get_pick_frame())
# ---------- end brick_wall_2 ----------
number_of_bricks = Panel(brick_wall.number_of_bricks)
compas_draw = COMPASDraw(cg=brick_wall.compas_crv)  # -> rg
#   port cg: The COMPAS geometry or datastructure to be drawn.
#   port rg: The Rhino geometry object.
# ---------- compas_draw: Python ----------
# r: compas>=2.14.1
"""
Draws COMPAS geometry in Grasshopper.
"""

from typing import Any

import Grasshopper

from compas.scene import SceneObject


class CompasToRhinoGeometry(Grasshopper.Kernel.GH_ScriptInstance):
    def RunScript(self, cg):
        if not cg:
            return None

        return SceneObject(item=cg).draw()
# ---------- end compas_draw ----------
compas_draw_2 = COMPASDraw(cg=brick_wall.geometries)  # -> rg; same code as compas_draw
point_2 = Point(capture_wobj.wobj_xypoint)
# Transform from Rhino to Robot Space
# Adjust the height of placement
fine_adjust_z_mm = Slider(0, range=-5..10)
number_slider_3 = Slider(21, range=0..100)
transform = Python3Script(
    way_planes=brick_wall.frames,
    wobj_origin=capture_wobj.wobj_origin,
    wobj_xaxis=capture_wobj.wobj_xaxis,
    wobj_xypoint=capture_wobj.wobj_xypoint,
    z_safe_margin=fine_adjust_z_mm)  # -> out, robot_base, transformed_frames, first_frame, working_place; inputs way_planes: list, wobj_origin: Point3d, wobj_xaxis: Point3d, wobj_xypoint: Point3d, z_safe_margin: Double
# ---------- transform: Python ----------
from compas.geometry import Frame, Transformation, Translation, Vector
from compas.geometry import Polyline
from compas_rhino.conversions import polyline_to_rhino
#in this step we transform our way planes to robot space
#the rhino co-ordinate system is rather abstract in the physical world
#the robot base plane assumed the base frame of robot is the origin
#but rhino does not know that
#thus we transform things from our design space(Rhino World XY) to Robot Base Plane that we measure

def set_robot_base(origin, xaxis, xypoint):
    """
    set a base plane representing the robot working object plane
    """
    robot_base = Frame(origin, xaxis - origin, xypoint - origin)
    print (robot_base)
    return (robot_base)

def working_place_display(origin, xaxis, xypoint):
    a = wobj_origin
    b = wobj_xaxis
    c = wobj_xypoint
    d = b+c-a
    polyline = Polyline([a,b,d,c,a])
    display_polygon = polyline_to_rhino(polyline)
    return display_polygon
    


def rhino_to_robot_space(rhino_plane,robot_base_plane):
    """
    Transform the objects from Rhino world XY plane to robot work object plane
    """
    T_matrix = Transformation.from_frame_to_frame(Frame.worldXY(), robot_base_plane)
    robot_plane = rhino_plane.transformed(T_matrix)
    return robot_plane

def set_z_safe_margin(planes_to_adjust, safety_margin):
    adjusted = []
    T = Translation.from_vector(Vector(0, 0, safety_margin))
    for f in planes_to_adjust:
        adjusted.append(f.transformed(T))
    return adjusted

# ===== Robot base is set =====
robot_base =  set_robot_base(wobj_origin, wobj_xaxis, wobj_xypoint)

# ===== Set safety margin for Z height ======
safe_planes = set_z_safe_margin(way_planes, z_safe_margin)

# ===== Transforming the rhino planes into robot planes =====
transformed_frames = []
for plane in safe_planes: 
    transformed_frames.append(rhino_to_robot_space(plane, robot_base))

# ===== display working place
working_place = working_place_display(wobj_origin, wobj_xaxis, wobj_xypoint)

#test 
first_frame = transformed_frames[0]
# ---------- end transform ----------

pt = ConstructPoint(XCoordinate="572.15", YCoordinate="354.27", ZCoordinate=number_slider_3)
pt_2 = ConstructPoint(XCoordinate="586.98", YCoordinate="353.48", ZCoordinate=number_slider_3)
pt_3 = ConstructPoint(XCoordinate="571.8", YCoordinate="346.96", ZCoordinate=number_slider_3)

# ----
# Measure pick up location
capture_2 = Button()
point_3 = ValueList({"origin", "xaxis", "xypoint"}, selected="origin")
capture_pick = CapturePick(robot_ip="169.254.130.206", point_name=point_3, capture=capture_2)  # -> origin, xaxis_pt, xy_pt, info; disabled
# ---------- capture_pick: Python ----------
"""
Capture the 3 points that define the pick frame at the brick pick-up location.

Jog the TCP to a point, pick its name (origin / xaxis / xypoint) and press capture.
The TCP position (robot base frame, mm) is saved to pick_calibration.json next to
this .ghx file, so the points survive closing Grasshopper.
"""
import os
import sys
import json
import time

import scriptcontext as sc
import Rhino.Geometry as rg

NAMES = ["origin", "xaxis", "xypoint"]

gh_dir = os.path.dirname(ghenv.Component.OnPingDocument().FilePath)
src_dir = os.path.join(gh_dir, "src")
if src_dir not in sys.path:
    sys.path.append(src_dir)
import simple_comm as com

path = os.path.join(gh_dir, "pick_calibration.json")

data = {}
if os.path.exists(path):
    with open(path) as f:
        data = json.load(f)

# keep the last status in sticky, so the message survives the button being released
status_key = "capture_status_" + str(ghenv.Component.InstanceGuid)

if capture:
    if point_name not in NAMES:
        sc.sticky[status_key] = "pick origin / xaxis / xypoint"
    else:
        try:
            x, y, z = list(com.listen_to_robot(robot_ip)["pose"])[:3]  # metres, robot base frame
            data[point_name] = [round(x * 1000, 2), round(y * 1000, 2), round(z * 1000, 2)]  # -> mm
            with open(path, "w") as f:
                json.dump(data, f, indent=2)
            sc.sticky[status_key] = "{} captured {}".format(point_name, time.strftime("%H:%M:%S"))
        except Exception as e:
            print(e)
            sc.sticky[status_key] = "robot not reachable"

ghenv.Component.Message = sc.sticky.get(status_key, "")

def pt(name):
    return rg.Point3d(*data[name]) if name in data else None

origin, xaxis_pt, xy_pt = pt("origin"), pt("xaxis"), pt("xypoint")
info = json.dumps(data, indent=2)
# ---------- end capture_pick ----------
pick_calibration = Panel(capture_pick.info)
py3 = Python3Script(origin=pt, xaxis_pt=pt_2, xy_pt=pt_3)  # -> out, pick_frame; inputs origin: Point3d, xaxis_pt: Point3d, xy_pt: Point3d
# ---------- py3: Python ----------
from compas.geometry import Frame, Point
from compas.geometry import Rotation

from compas_rhino.conversions import point_to_compas

origin = point_to_compas(origin)
xaxis_pt = point_to_compas(xaxis_pt)
xy_pt = point_to_compas(xy_pt)

#define pick frame
pick_frame = Frame(origin, xaxis_pt - origin, xy_pt - origin)
# ---------- end py3 ----------
compas_draw_3 = COMPASDraw(cg=py3.pick_frame)  # -> rg; same code as compas_draw

curve_2 = Curve(transform.working_place)

# ----
# Measure and set TCP
panel = Panel("-1.71")
pt_4 = ConstructPoint(XCoordinate=panel, YCoordinate="-0.9", ZCoordinate="77.83")

number_slider_4 = Slider(0.1, range=0..0.1)
number_slider_5 = Slider(0.1, range=0..0.1)

python_3_script = Python3Script(layers=Slider(2, range=0..10), row=Slider(5, range=0..10), col=Slider(4, range=0..10), pick_frame=py3.pick_frame)  # -> out, pts, pick_frames; inputs layers: Int32, row: Int32, col: Int32
# ---------- python_3_script: Python ----------
# r: compas
# venv: mas-2627
from compas_rhino.devtools import DevTools
DevTools.ensure_path()

# 0. Import everything we will need
import math
from compas.geometry import Box
from compas.geometry import Point
from compas.geometry import Frame
from compas.geometry import cross_vectors

from compas_rhino.conversions import curve_to_compas

from brick_wall import Brick

# 1. Start with an empty list of bricks to be created
bricks = []

pts = []
pick_frames = []

for k in range(layers):
    for i in range(row):
        for j in range(col):
            x = pick_frame.point.x - i * Brick.LENGTH
            y = pick_frame.point.y - j * Brick.WIDTH
            z = pick_frame.point.z + (layers - k -1) * Brick.HEIGHT
            pt = Point(x, y, z)
            pts.append(pt)
            frame = Frame(pt, pick_frame.xaxis, pick_frame.yaxis)
            pick_frames.append(frame)


brick = Brick()
print(pick_frame)
# ---------- end python_3_script ----------

# ----
# Convert Planes to URScript
compas = Python3Script(
    way_frames=transform.transformed_frames,
    tcp_measured=pt_4,
    acceleration=number_slider_4,
    velocity=number_slider_5,
    pick_frames=python_3_script.pick_frames)  # -> out, a, vis_frames, vis_planes, script; inputs way_frames: list, tcp_measured: Point3d, acceleration: Double, velocity: Double, pick_frames: list
# ---------- compas: Python ----------
from imp import reload
import sys
import os

#get current file path
path = ghenv.Component.OnPingDocument().FilePath
#get parent directory of the parent directory
parentdir = os.path.dirname(path)
#get src folder which contains classes
dire = os.path.join(parentdir,'src')

sys.path.append(dire)

import simple_ur_script as ur
reload(ur)

import utils 
reload(utils)

import simple_comm as com
reload(com)

import compas.geometry as cg
import math as m

# ===== Set global constants =======

IO = 4 # Global constant
SAFE_DIST = 100
sleep_time = 0.5

# =================================
from compas.geometry import Frame, Point

# Test
# frame = way_frames
# a = Frame([frame.point.x, frame.point.y, frame.point.z + SAFE_DIST], [0,1,0], [1, 0, 0])
# print(a)


def safe_location(frame, sefe_dist = SAFE_DIST):
    safe_frame = Frame([frame.point.x, frame.point.y, frame.point.z + SAFE_DIST], frame.xaxis, frame.yaxis)
    if safe_frame.zaxis.z > 0:
            safe_frame.xaxis = -safe_frame.xaxis
    return safe_frame

def pickup_brick(script, pick_up_frame):
    # Translate frame to "safe" location
    safe_frame = safe_location(pick_up_frame)
    # Move to safe frame
    script += ur.move_l(safe_frame, acceleration, velocity)
    # Move to pick location
    script += ur.move_l(pick_up_frame, acceleration, velocity)
    # Activate gripper
    script += ur.set_digital_out(IO, True)
    script += ur.sleep(sleep_time)
    # Move back to safe plane
    script += ur.move_l(safe_frame, acceleration, velocity)

    frames = [safe_frame, pick_up_frame, safe_frame]

    return script, frames


def place_brick(script, place_frame):
    
    # Safe frame for placing
    safe_frame = safe_location(place_frame)
    # Add to the path: go to the safe plane
    script += ur.move_l(safe_frame, acceleration, velocity)
    # Add to the path: go to the place plane
    script += ur.move_l(place_frame, acceleration, velocity)
    # Add to the path: turn off the vacuum and wait 1 second (hold the brick)
    script += ur.set_digital_out(IO, False)
    script += ur.sleep(sleep_time)
    # Add to the path: go back to the safe plane
    script += ur.move_l(safe_frame, acceleration, velocity)

    frames = [safe_frame, place_frame, safe_frame]
    return script, frames


# force pick_frame zaxis tio be negative
# if pick_frame.zaxis.z > 0:
#             pick_frame.xaxis = -pick_frame.xaxis

script = "" #create empty string

#if value given for tcp measured, then add line to script, otherwise it will take current tcp from robot
if tcp_measured is not None:
    script += ur.set_tcp_by_angles(tcp_measured.X, tcp_measured.Y, tcp_measured.Z, m.radians(0.0),m.radians(0.0),m.radians(0))


vis_frames = []
# Generate pick and place sequence

for i, frame in enumerate(way_frames):
    # for p in pick_frames:
        script, f1 = pickup_brick(script, pick_frames[i])
        script, f2 = place_brick(script, frame)
        vis_frames.extend(f1 + f2)

script = com.concatenate_script(script)


# Visualize
from compas_rhino import conversions
import Rhino.Geometry as rg

vis_planes = [conversions.frame_to_rhino(frame) for frame in vis_frames]
# ---------- end compas ----------
point_4 = Point(compas.vis_planes)
compas_draw_4 = COMPASDraw(cg=python_3_script.pick_frames)  # -> rg; same code as compas_draw

list_item = ListItem(List=compas_draw_4, Index=Slider(0, range=0..10), Wrap=True)  # -> flatten(Item)
point_list = PointList(Points=list_item, Size=Slider(6, range=0..10))

compas_draw_5 = COMPASDraw(cg=compas.vis_frames)  # -> rg; same code as compas_draw
polyline = PolyLine(Vertices=point_4, Closed=False)

# ---- group: Send UR script to Robot!
# Send to Robot!
py3_2 = Python3Script(script=compas.script, ip_address="169.254.130.206", send=Button())  # -> out, a; inputs script: String, ip_address: String, send: Boolean
# ---------- py3_2: Python ----------
import simple_comm as com

if send:
    com.send_script(script,ip_address)
# ---------- end py3_2 ----------

# ----
panel_2 = Panel(compas.script)
