# Grasshopper definition (video)brick_to_robot.ghx (Grasshopper 1.0.8)
# plug-ins: Bifocals

# ---- group: This is needed only ONCE in the GH definition
enable_auto_reload = Python3Script()  # -> ok
# ---------- enable_auto_reload: Python ----------
"""
------------------------------
Using VS Code as Python editor
------------------------------

The simplest way to start using VS Code as our editor, is
to place our Python code in files located IN THE SAME FOLDER as our Grasshopper file.

After we have done that, we need 2 steps: 

1. Enable the COMPAS reloader on one component. This tells Grasshopper to watch for changes in the Pythoh files and reload if changed.
2. Every other component that uses Python code from external files needs to start with a method to ensure Grasshopper knows where to load the files from.

"""
# r: compas
# venv: mas-2627

from compas_rhino.devtools import DevTools
DevTools.enable_reloader()
# ---------- end enable_auto_reload ----------

# ----
lamcp_bridge = LAMCPBridge(enable=Toggle(True))  # -> status; inputs enable: Boolean, port: Int32
#   port enable: Toggle to start (True) or stop (False) the local HTTP server.
#   port port: Port to listen on (loopback only). Defaults to 8765.
#   port status: Current server status string.
# ---------- lamcp_bridge: Python ----------
"""
LAMCP Bridge: local HTTP server inside Rhino 8 / Grasshopper CPython.

Exposes `POST /exec` (JSON: `{"code": "...", "timeout": 30}`) which
exec()s `code` and returns
`{"stdout": "...", "stderr": "...", "result": "...", "error": null|str}`.

Pair with the `lamcp` FastMCP server, which translates Claude's
`run_python_script` MCP tool calls into POSTs to this endpoint.

Binds to 127.0.0.1 only. NEVER expose beyond localhost â€” it exec()s
arbitrary Python with full Rhino API access.

LAMCP v0.1.0
"""

import contextlib
import io
import json
import threading
import traceback
from http.server import BaseHTTPRequestHandler
from http.server import HTTPServer

import Grasshopper
import scriptcontext as sc


SHARED_GLOBALS_KEY = "_lamcp_bridge_globals"
SERVER_KEY = "_lamcp_bridge_server"


def _exec_code(code, timeout):
    """Run `code` on the HTTP-server thread and capture stdout/stderr/result.

    NOTE: this is intentionally NOT marshalled to Rhino's UI thread for the
    spike â€” `Rhino.RhinoApp.InvokeOnUiThread` was queueing actions that
    never fired in Rhino 8 CPython. Most read-only RhinoCommon access is
    safe cross-thread; mutations may crash. Add Eto-based marshalling
    back here when we need it.
    """
    out = io.StringIO()
    err = io.StringIO()
    g = sc.sticky.setdefault(SHARED_GLOBALS_KEY, {"__name__": "__lamcp_bridge__"})
    error_text = None
    result_repr = None
    try:
        with contextlib.redirect_stdout(out), contextlib.redirect_stderr(err):
            exec(code, g, g)
            result_repr = repr(g.get("_"))
    except BaseException:
        error_text = traceback.format_exc()

    return {
        "stdout": out.getvalue(),
        "stderr": err.getvalue(),
        "result": result_repr,
        "error": error_text,
    }


class _ExecHandler(BaseHTTPRequestHandler):
    # Silence default request logging so it doesn't clog the Rhino command line.
    def log_message(self, fmt, *args):
        pass

    def _send(self, code, payload):
        body = json.dumps(payload).encode("utf-8")
        self.send_response(code)
        self.send_header("Content-Type", "application/json")
        self.send_header("Content-Length", str(len(body)))
        self.end_headers()
        self.wfile.write(body)

    def do_GET(self):
        if self.path == "/health":
            self._send(200, {"status": "ok"})
        else:
            self._send(404, {"error": "not found"})

    def do_POST(self):
        if self.path != "/exec":
            self._send(404, {"error": "not found"})
            return
        length = int(self.headers.get("Content-Length", "0"))
        try:
            raw = self.rfile.read(length).decode("utf-8")
            body = json.loads(raw)
            code = body.get("code", "")
            timeout = float(body.get("timeout", 30.0))
        except Exception as exc:
            self._send(400, {"error": "bad request: " + repr(exc)})
            return
        result = _exec_code(code, timeout)
        self._send(200, result)


def _start_server(port):
    server = HTTPServer(("127.0.0.1", port), _ExecHandler)
    thread = threading.Thread(
        target=server.serve_forever, daemon=True, name="lamcp-bridge"
    )
    thread.start()
    return {"server": server, "thread": thread, "port": port}


def _stop_server(state):
    try:
        state["server"].shutdown()
        state["server"].server_close()
    except Exception:
        pass


class LamcpBridgeComponent(Grasshopper.Kernel.GH_ScriptInstance):
    def RunScript(self, enable: bool, port: int):
        port = int(port) if port else 8765

        state = sc.sticky.get(SERVER_KEY)

        if not enable:
            if state is not None:
                _stop_server(state)
                del sc.sticky[SERVER_KEY]
            return "stopped"

        # Already running on the requested port: no-op.
        if (
            state is not None
            and state.get("port") == port
            and state["thread"].is_alive()
        ):
            return "listening on http://127.0.0.1:{}".format(port)

        # Port changed or server died: tear down and restart.
        if state is not None:
            _stop_server(state)
            del sc.sticky[SERVER_KEY]

        try:
            sc.sticky[SERVER_KEY] = _start_server(port)
        except OSError as exc:
            ghenv.Component.AddRuntimeMessage(  # noqa: F821
                Grasshopper.Kernel.GH_RuntimeMessageLevel.Error,
                "Failed to bind 127.0.0.1:{}: {}".format(port, exc),
            )
            return "error: {}".format(exc)

        return "listening on http://127.0.0.1:{}".format(port)
# ---------- end lamcp_bridge ----------
n_domino = Slider(6, range=0..20)
step = Slider(1, range=0..12)
number_slider = Slider(3, range=0..5)
curve = Curve(<curve referenced from the Rhino model>)
curve_2 = Curve(<curve referenced from the Rhino model>)
number_slider_2 = Slider(2, range=0..10)
number_slider_3 = Slider(6, range=0..100)
gap = Slider(8.8, range=0..10)
brick_wall = Python3Script(crv=curve_2, layers=number_slider_2, lapping=number_slider, pick_number=number_slider_3, gap=gap)  # -> bricks, geometries, frames, number_of_bricks; inputs crv: Curve, layers: Int32, pick_number: Int32
# ---------- brick_wall: Python ----------
# r : compas 
# venv: mas-2627
from compas_rhino.devtools import DevTools
DevTools.ensure_path()

from compas.geometry import Box, Point
from compas.geometry import Vector, cross_vectors
from compas.geometry import Frame

from compas_rhino.conversions import curve_to_compas
import Rhino.Geometry as rg

from brick_element import Brick


# Real script
# Build the stonehenge

bricks = []

# def moving_param_with_d(crv, param, distance):
#     length_a = crv.GetLength(rg.Interval(crv.Domain.T0, param))
#     target = length_a + distance

#     ok, t_new = crv.LengthParameter(target)
#     if not ok:
#         raise ValueError("Cannot find parameter at length {}".format(target))
#     return t_new

def create_temple_base(compas_crv, param, base_layers=2, base_row=3):
    base_bricks = []
    pt = compas_crv.point_at(param)
    temp_pt = pt.copy()
    temp_pt.z += Brick.HEIGHT / 2

    yv = compas_crv.tangent_at(param)
    yv.unitize()
    zv = Vector(0,0,1)
    xv = yv.cross(zv)

    d_x = (Brick.LENGTH + 1)/2

    if base_layers == 1:
        for sign in (1, -1):
            origin_pt = temp_pt + xv * (d_x * sign)
            base_bricks.append(Brick(Frame(origin_pt, xv, yv), "laying"))
    else:
        for i in range(base_layers):
            for j in range(base_row):
                if i % 2 == j % 2:
                    for sign in (1,-1):
                            if j == 0 and sign == -1:
                                continue
                            origin_pt = temp_pt + zv * i * Brick.HEIGHT + xv * d_x *j * sign
                            laying_frame = Frame(origin_pt, xv, yv)
                            brick = Brick(laying_frame, "laying")
                            base_bricks.append(brick)
    top_center_pt = pt + zv * base_layers * Brick.HEIGHT
    return base_bricks, top_center_pt


def create_temple(compas_crv, param, top_lapping, num_layers, starting_pt= None):
    temple_bricks =[]
    if starting_pt is None:
        starting_pt = compas_crv.point_at(param)
    yv = compas_crv.tangent_at(param)
    yv.unitize()
    zv = Vector(0,0,1)
    xv = yv.cross(zv)

    d_x = Brick.LENGTH / 2 - top_lapping +  Brick.HEIGHT /2
    d_z = Brick.LENGTH
    temp_pt = starting_pt.copy()
    temp_pt.z += d_z /2

    # center pt (origin) of standing bricks
    for i in range(num_layers):
        for sign in (1, -1):
            origin_s = temp_pt + zv * d_z * (i) 
            origin_s += xv * d_x * sign
            standing_frame = Frame(origin_s, xv, yv)
            temple_bricks.append(Brick(standing_frame, "standing"))


    # center pt (origin) of laying brick (top brick)
    origin_l = temp_pt + zv * d_z * (num_layers-0.5) + zv * (Brick.HEIGHT/2)
    laying_frame = Frame(origin_l, xv, yv)
    temple_bricks.append(Brick(laying_frame, "laying"))
    return temple_bricks

def domino(compas_crv, gap, list_top=None, pick_number=None):
    domino_bricks = [] 
    length = Brick.WIDTH + gap
    crv_length = compas_crv.length()
    count = int(crv_length // length)

    params, points= compas_crv.divide_by_count(count, True)
    if pick_number is not None:
        for i in range(len(list_top)):
            for i, top in enumerate(list_top):
                points[pick_number + i] = top

    for param, pt in zip(params, points):
        tangent = compas_crv.tangent_at(param)
        origin = pt + Vector(0, 0, Brick.LENGTH / 2)
        frame = Frame(origin, xaxis = tangent, yaxis = cross_vectors(tangent, [0,0,1]))
        domino_bricks.append(Brick(frame, brick_type = "standing"))
    
    

    return domino_bricks


# ===== elements of crv =====
# reparameterize crv
# crv.Domain = rg.Interval(0,1)
compas_crv = curve_to_compas(crv)

length = Brick.WIDTH + gap
crv_length = compas_crv.length()
count = int(crv_length // length)

params, points= compas_crv.divide_by_count(count, True)

param = params[pick_number]

# moving vector
yv = compas_crv.tangent_at(param)
yv.unitize()
zv = Vector(0,0,1)
xv = yv.cross(zv)


# ===== Start putting bricks =====

base_bricks, top_base = create_temple_base(compas_crv, param, base_layers=2, base_row=3)

# moving_param = moving_param_with_d(crv, param, moving_distance)
# moving_param_n = moving_param_with_d(crv, param, moving_distance *-1)

prev_base, prev_pt = create_temple_base(compas_crv, params[pick_number-1], base_layers=1, base_row=2)
# next_base, next_pt = create_temple_base(compas_crv, params[pick_number+1], base_layers=1, base_row=2)

list_top = [prev_pt, top_base]
domino_bricks = domino(compas_crv, gap, list_top, pick_number-1)
temple_bricks = create_temple(compas_crv, param, lapping, num_layers=layers,  starting_pt = top_base)
temple_bricks_2 = create_temple(compas_crv, params[pick_number-2], lapping, num_layers=layers)

# === create brick list ===
# bricks = prev_base + base_bricks + domino_bricks+ temple_bricks_2 + temple_bricks
bricks = base_bricks +  temple_bricks
# bricks = temple_bricks_2
# ===== get pick frame =====
geometries = []
frames = []
for brick in bricks:
    geometries.append(brick.draw())
    frames.append(brick.top_frame())

number_of_bricks = len(bricks)
# ---------- end brick_wall ----------
temple_animation = Python3Script(
    crv=curve_2,
    layers=number_slider_2,
    lapping=number_slider,
    pick_number=number_slider_3,
    gap=gap,
    n_domino=n_domino,
    step=step,
    export=Toggle(True))  # -> n_steps, placed, current, sheet, sheet_dashed, caption, paths; inputs crv: Curve, layers: Int32, pick_number: Int32, n_domino: Int32, step: Int32
# ---------- temple_animation: Python ----------
# r : compas
# venv: mas-2627
"""
"Temple animation" component in (video)brick_to_robot.ghx (Python 3 Script).

INPUTS
    crv, layers, lapping, pick_number, gap   same sources as the temple "Brick wall" component
    n_domino     dominos on each side of the temple
    step         0 .. n_steps-1, one build stage per step
    export       True -> write the whole frame sequence
    folder       output folder (default: temple_animation_frames next to the .ghx)
    fmt          "png" (default) or "svg"

OUTPUTS
    n_steps      number of animation states
    placed       boxes built in earlier stages
    current      boxes added in this stage
    sheet        2D line drawing of this step (XY plane, 0.1 scale)
    sheet_dashed dashed lines of the drawing
    caption      stage title of this step
    paths        exported frame files
"""

from compas_rhino.devtools import DevTools
DevTools.ensure_path()

import os
import sys
import importlib

import Rhino.Geometry as rg
from compas_rhino.conversions import curve_to_compas

FOLDER = os.path.dirname(ghenv.Component.OnPingDocument().FilePath or "")
if FOLDER and FOLDER not in sys.path:
    sys.path.append(FOLDER)

import wall_animation
import temple_design
import temple_animation
importlib.reload(wall_animation)
importlib.reload(temple_design)
importlib.reload(temple_animation)

dims = temple_animation.dims


def to_box(brick):
    f = brick.frame
    L, W, H = dims(brick)
    plane = rg.Plane(rg.Point3d(f.point.x, f.point.y, f.point.z),
                     rg.Vector3d(f.xaxis.x, f.xaxis.y, f.xaxis.z),
                     rg.Vector3d(f.yaxis.x, f.yaxis.y, f.yaxis.z))
    return rg.Box(plane, rg.Interval(-L / 2, L / 2),
                  rg.Interval(-W / 2, W / 2), rg.Interval(-H / 2, H / 2))


stages, tangent = temple_design.temple_scene(
    curve_to_compas(crv),
    gap=float(gap),
    pick_number=int(pick_number),
    lapping=float(lapping),
    layers=int(layers),
    n_domino=6 if n_domino is None else int(n_domino))

states = temple_animation.build_states(stages)
n_steps = len(states)

s = 0 if step is None else max(0, min(int(step), n_steps - 1))
state = states[s]

placed = [to_box(b) for b in state["placed"]]
current = [to_box(b) for b in state["current"]]
caption = state["title"]

canvas = wall_animation.RhinoCanvas(1920, 1080, scale=0.1)
temple_animation.render(state, canvas, tangent)
sheet, sheet_dashed = canvas.curves, canvas.dashed

paths = []
if export:
    out = folder or os.path.join(FOLDER, "temple_animation_frames")
    paths = temple_animation.export_frames(states, tangent, out, fmt=fmt or "png")
    print("wrote %d frames to %s" % (len(paths), out))
# ---------- end temple_animation ----------
brick_wall_2 = Python3Script(crv=curve, layers=Slider(2, range=0..10), lapping=Slider(3, range=0..5), pick_number=Slider(4, range=0..100), gap=gap)  # -> bricks, geometries, frames, number_of_bricks; inputs crv: Curve, layers: Int32, pick_number: Int32
# ---------- brick_wall_2: Python ----------
# r : compas 
# venv: mas-2627
from compas_rhino.devtools import DevTools
DevTools.ensure_path()

from compas.geometry import Box, Point
from compas.geometry import Vector, cross_vectors
from compas.geometry import Frame

from compas_rhino.conversions import curve_to_compas
import Rhino.Geometry as rg

from brick_element import Brick


# Real script
# Build the stonehenge

bricks = []

# def moving_param_with_d(crv, param, distance):
#     length_a = crv.GetLength(rg.Interval(crv.Domain.T0, param))
#     target = length_a + distance

#     ok, t_new = crv.LengthParameter(target)
#     if not ok:
#         raise ValueError("Cannot find parameter at length {}".format(target))
#     return t_new

def create_temple_base(compas_crv, param, base_layers=2, base_row=3):
    base_bricks = []
    pt = compas_crv.point_at(param)
    temp_pt = pt.copy()
    temp_pt.z += Brick.HEIGHT / 2

    yv = compas_crv.tangent_at(param)
    yv.unitize()
    zv = Vector(0,0,1)
    xv = yv.cross(zv)

    d_x = (Brick.LENGTH + 1)/2

    if base_layers == 1:
        for sign in (1, -1):
            origin_pt = temp_pt + xv * (d_x * sign)
            base_bricks.append(Brick(Frame(origin_pt, xv, yv), "laying"))
    else:
        for i in range(base_layers):
            for j in range(base_row):
                if i % 2 == j % 2:
                    for sign in (1,-1):
                            if j == 0 and sign == -1:
                                continue
                            origin_pt = temp_pt + zv * i * Brick.HEIGHT + xv * d_x *j * sign
                            laying_frame = Frame(origin_pt, xv, yv)
                            brick = Brick(laying_frame, "laying")
                            base_bricks.append(brick)
    top_center_pt = pt + zv * base_layers * Brick.HEIGHT
    return base_bricks, top_center_pt


def create_temple(compas_crv, param, top_lapping, num_layers, starting_pt= None):
    temple_bricks =[]
    if starting_pt is None:
        starting_pt = compas_crv.point_at(param)
    yv = compas_crv.tangent_at(param)
    yv.unitize()
    zv = Vector(0,0,1)
    xv = yv.cross(zv)

    d_x = Brick.LENGTH / 2 - top_lapping +  Brick.HEIGHT /2
    d_z = Brick.LENGTH
    temp_pt = starting_pt.copy()
    temp_pt.z += d_z /2

    # center pt (origin) of standing bricks
    for i in range(num_layers):
        for sign in (1, -1):
            origin_s = temp_pt + zv * d_z * (i) 
            origin_s += xv * d_x * sign
            standing_frame = Frame(origin_s, xv, yv)
            temple_bricks.append(Brick(standing_frame, "standing"))


    # center pt (origin) of laying brick (top brick)
    origin_l = temp_pt + zv * d_z * (num_layers-0.5) + zv * (Brick.HEIGHT/2)
    laying_frame = Frame(origin_l, xv, yv)
    temple_bricks.append(Brick(laying_frame, "laying"))
    return temple_bricks

def domino(compas_crv, gap, list_top=None, pick_number=None):
    domino_bricks = [] 
    length = Brick.WIDTH + gap
    crv_length = compas_crv.length()
    count = int(crv_length // length)

    params, points= compas_crv.divide_by_count(count, True)
    if pick_number is not None:
        for i in range(len(list_top)):
            for i, top in enumerate(list_top):
                points[pick_number + i] = top

    for param, pt in zip(params, points):
        tangent = compas_crv.tangent_at(param)
        origin = pt + Vector(0, 0, Brick.LENGTH / 2)
        frame = Frame(origin, xaxis = tangent, yaxis = cross_vectors(tangent, [0,0,1]))
        domino_bricks.append(Brick(frame, brick_type = "standing"))
    
    

    return domino_bricks


# ===== elements of crv =====
# reparameterize crv
# crv.Domain = rg.Interval(0,1)
compas_crv = curve_to_compas(crv)

length = Brick.WIDTH + gap
crv_length = compas_crv.length()
count = int(crv_length // length)

params, points= compas_crv.divide_by_count(count, True)

param = params[pick_number]

# moving vector
yv = compas_crv.tangent_at(param)
yv.unitize()
zv = Vector(0,0,1)
xv = yv.cross(zv)


# ===== Start putting bricks =====

base_bricks, top_base = create_temple_base(compas_crv, param, base_layers=2, base_row=3)

# moving_param = moving_param_with_d(crv, param, moving_distance)
# moving_param_n = moving_param_with_d(crv, param, moving_distance *-1)

prev_base, prev_pt = create_temple_base(compas_crv, params[pick_number-1], base_layers=1, base_row=2)
next_base, next_pt = create_temple_base(compas_crv, params[pick_number+1], base_layers=1, base_row=2)

list_top = [prev_pt, top_base, next_pt]
domino_bricks = domino(compas_crv, gap, list_top, pick_number-1)
temple_bricks = create_temple(compas_crv, param, lapping, num_layers=layers,  starting_pt = top_base)
temple_bricks_2 = create_temple(compas_crv, params[pick_number-2], lapping, num_layers=layers)
temple_bricks_3 = create_temple(compas_crv, params[pick_number +4], lapping, num_layers=layers+1)
# === create brick list ===
bricks = prev_base + base_bricks  + next_base + domino_bricks+ temple_bricks_2 + temple_bricks + temple_bricks_3
# bricks = base_bricks
# ===== get pick frame =====
geometries = []
frames = []
for brick in bricks:
    geometries.append(brick.draw())
    frames.append(brick.top_frame())

number_of_bricks = len(bricks)
# ---------- end brick_wall_2 ----------
brep = Brep(temple_animation.current)
curve_3 = Curve(temple_animation.sheet)
compas_draw = COMPASDraw(cg=brick_wall.geometries)  # -> rg
#   port cg: The COMPAS geometry or datastructure to be drawn.
#   port rg: The Rhino geometry object.
# ---------- compas_draw: Python ----------
# r: compas>=2.14.1
"""
Draws COMPAS geometry in Grasshopper.
"""

from typing import Any

import Grasshopper

from compas.scene import SceneObject


class CompasToRhinoGeometry(Grasshopper.Kernel.GH_ScriptInstance):
    def RunScript(self, cg):
        if not cg:
            return None

        return SceneObject(item=cg).draw()
# ---------- end compas_draw ----------
panel = Panel(brick_wall_2.number_of_bricks)
list_item = ListItem(List=brick_wall.bricks, Index=0, Wrap=True)
list_item_2 = ListItem(List=brick_wall.frames, Index=0, Wrap=True)
cull_index = CullIndex(List=brick_wall_2.frames, Indices="17", Wrap=True)
cull_index_2 = CullIndex(List=brick_wall_2.bricks, Indices="17", Wrap=True)
cull_index_3 = CullIndex(List=brick_wall.bricks, Indices="7", Wrap=True)
cull_index_4 = CullIndex(List=brick_wall.frames, Indices="7", Wrap=True)
