# Grasshopper definition 101_brick_to_robot-Nikitha wall.gh (Grasshopper 1.0.8)

number_slider = Slider(30, range=0..100)  # disabled
number_slider_2 = Slider(420, range=0..1000)
number_slider_3 = Slider(594, range=0..1000)
rectangle = Rectangle(Plane=PlaneXY(0, 0, 0), XSize=number_slider_2, YSize=number_slider_3, Radius=0)  # -> Rectangle, Length
crv = Curve(rectangle.Rectangle)

# ---- group: This is needed only ONCE in the GH definition
enable_auto_reload = Python3Script()  # -> ok
# ---------- enable_auto_reload: Python ----------
"""
------------------------------
Using VS Code as Python editor
------------------------------

The simplest way to start using VS Code as our editor, is
to place our Python code in files located IN THE SAME FOLDER as our Grasshopper file.

After we have done that, we need 2 steps: 

1. Enable the COMPAS reloader on one component. This tells Grasshopper to watch for changes in the Pythoh files and reload if changed.
2. Every other component that uses Python code from external files needs to start with a method to ensure Grasshopper knows where to load the files from.

"""
# r: compas
# venv: mas-2627

from compas_rhino.devtools import DevTools
DevTools.enable_reloader()
# ---------- end enable_auto_reload ----------

# ----
curve = Curve(<curve referenced from the Rhino model>)
bricks = Python3Script(
    crv=curve,
    num_layers=Slider(7, range=0..30),
    gap=Slider(4, range=0..30),
    rotation=Slider(0, range=0..30),
    work_x=number_slider_2,
    work_y=number_slider_3,
    work_area=crv)  # -> out, geometries, bricks, frames; inputs crv: Curve, num_layers: Int32, gap: Int32, rotation: Int32
# ---------- bricks: Python ----------
# r: compas
# venv: mas-2627
from compas_rhino.devtools import DevTools
DevTools.ensure_path()

import math
import ghpythonlib.treehelpers as th
from compas.geometry import Frame
from compas.geometry import Point
from compas.geometry import Vector
from compas.geometry import Rotation
from compas.geometry import cross_vectors

from compas_rhino.conversions import curve_to_compas 
from brick_wall import Brick

# brick list
bricks = []
frames = []

# convert curve
compas_crv = curve_to_compas(crv)

# half brick to interloack
full_spacing = Brick.LENGTH + gap 
half_spacing = full_spacing / 2.0
params, points = compas_crv.divide_by_length(half_spacing, True)

# layer patterns
# 1. horizontal
# 2. chnaged
patterns = {
    "even": [1, 2, 1],
    "odd":  [1, 1, 2]
}

# bricks in each layer
for i in range(num_layers):
    z = i * Brick.HEIGHT
    
    angle = math.radians(i * rotation) if 'rotation' in globals() else 0.0
    R = Rotation.from_axis_and_angle([0, 0, 1], angle)

    # even, odd
    is_even = (i % 2 == 0)
    pattern = patterns["even"] if is_even else patterns["odd"]
    subbricks = []
    subframes = []

    for j, (param, pt) in enumerate(zip(params, points)):
        
        # interlocking
        if (j % 2 == 0) != is_even:
            continue
            
        # pattern list
        modular_index = (j // 2) % len(pattern)
        brick_type = pattern[modular_index]

        # position
        brick_point = Point(pt.x, pt.y, z)

        # direction and perpendicular
        tangent_base = compas_crv.tangent_at(param)
        normal_base = Vector(*cross_vectors([0, 0, 1], tangent_base))

        # transformation
        tangent = tangent_base.transformed(R)
        normal = normal_base.transformed(R)

        # orientations:
        if brick_type == 1:
            # 1. horizontal
            frame = Frame(brick_point, xaxis=tangent, yaxis=normal)
        elif brick_type == 2:
            # 2. vertical
            frame = Frame(brick_point, xaxis=-normal, yaxis=tangent)
        
        frame.point += (Vector(0.0,0.0,1/2*Brick.HEIGHT))
        # bruck frame
        brick = Brick(frame)
        subbricks.append(brick)
        subframes.append(frame)

    bricks.append(subbricks)
    frames.append(subframes)

geometries = [[b.draw() for b in subb] for subb in bricks]
# frames = [[b.get_pick_frame() for b in subb] for subb in bricks]
geometries = th.list_to_tree(geometries)
frames = th.list_to_tree(frames)


# geometries = []
# frames = []
# ---------- end bricks ----------
compas_draw = COMPASDraw(cg=bricks.geometries)  # -> rg
#   port cg: The COMPAS geometry or datastructure to be drawn.
#   port rg: The Rhino geometry object.
# ---------- compas_draw: Python ----------
# r: compas>=2.14.1
"""
Draws COMPAS geometry in Grasshopper.
"""

from typing import Any

import Grasshopper

from compas.scene import SceneObject


class CompasToRhinoGeometry(Grasshopper.Kernel.GH_ScriptInstance):
    def RunScript(self, cg):
        if not cg:
            return None

        return SceneObject(item=cg).draw()
# ---------- end compas_draw ----------
compas_draw_2 = COMPASDraw(cg=bricks.frames)  # -> rg; same code as compas_draw

gap = Slider(7.9, range=0..10)

# ---- group: can try this- no wave
curve_2 = Curve(<curve referenced from the Rhino model>)
bricks_2 = Python3Script(
    crv=curve_2,
    num_layers=Slider(7, range=0..30),
    gap=Slider(16, range=0..30),
    rotation=Slider(6, range=0..30),
    work_x=number_slider_2,
    work_area=crv)  # -> out, geometries, bricks, frames; inputs crv: Curve, num_layers: Int32, gap: Int32, rotation: Int32
# ---------- bricks_2: Python ----------
# r: compas
# venv: mas-2627
from compas_rhino.devtools import DevTools
DevTools.ensure_path()

# Import everything we will need
import math
import ghpythonlib.treehelpers as th
from compas.geometry import Frame
from compas.geometry import Point
from compas.geometry import Vector
from compas.geometry import Rotation

# import curve from compas
from compas_rhino.conversions import curve_to_compas 
from compas.geometry import cross_vectors

from brick_wall import Brick


# Creating empty lists 
bricks = []
frames = []

# Convert curve
compas_crv = curve_to_compas(crv)

# Spacing, dividing curve into positions
spacing = (Brick.LENGTH + gap) / 1.5
params, points = compas_crv.divide_by_length(spacing, True)

# Bricks in each layer 
for i in range(num_layers):
    z = i * Brick.HEIGHT
    angle = math.radians(i * rotation) if 'rotation' in globals() else 0.0
    R = Rotation.from_axis_and_angle([0, 0, 1], angle)
    
    subbricks = []
    subframes = []

    for j, (param, pt) in enumerate(zip(params, points)):

        # Brick type orientation pattern based on layer (i) and position (j)
        if j % 2 == i % 2:
            brick_type = 1
        else:
            brick_type = 2

        # Position 
        brick_point = Point(pt.x, pt.y, z)

        # Direction along the curve (using [0, 0, 1] cross tangent to ensure Z-up)
        tangent_base = compas_crv.tangent_at(param)
        normal_base = Vector(*cross_vectors([0, 0, 1], tangent_base))

        # Transformation
        tangent = tangent_base.transformed(R)
        normal = normal_base.transformed(R)

        # Orientations (maintaining Z-axis pointing strictly up for robot tool alignment)
        if brick_type == 1:
            frame = Frame(brick_point, xaxis=tangent, yaxis=normal)
        elif brick_type == 2:
            frame = Frame(brick_point, xaxis=-normal, yaxis=tangent)

        # Shift the frame vertically so the brick sits on top of the plane and builds upwards
        frame.point += Vector(0.0, 0.0, 0.5 * Brick.HEIGHT)

        # Brick and store
        brick = Brick(frame)
        subbricks.append(brick)
        subframes.append(frame)

    bricks.append(subbricks)
    frames.append(subframes)

# Output geometries and frames (as trees for Grasshopper if needed)
geometries = [[b.draw() for b in subb] for subb in bricks]
geometries = th.list_to_tree(geometries)
frames = th.list_to_tree(frames)
# ---------- end bricks_2 ----------
compas_draw_3 = COMPASDraw(cg=bricks_2.geometries)  # -> rg; same code as compas_draw
compas_draw_4 = COMPASDraw(cg=bricks_2.frames)  # -> rg; same code as compas_draw

# ---- group: executed one
curve_3 = Curve(<curve referenced from the Rhino model>)
bricks_3 = Python3Script(
    crv=curve_3,
    num_layers=Slider(7, range=0..30),
    gap=Slider(15, range=0..30),
    rotation=Slider(6, range=0..30),
    work_x=number_slider_2,
    work_area=crv)  # -> out, geometries, bricks, frames; inputs crv: Curve, num_layers: Int32, gap: Int32, rotation: Int32
# ---------- bricks_3: Python ----------
# r: compas
# venv: mas-2627
from compas_rhino.devtools import DevTools
DevTools.ensure_path()

# Import everything we will need
import math
import ghpythonlib.treehelpers as th
from compas.geometry import Frame
from compas.geometry import Point
from compas.geometry import Vector
from compas.geometry import Rotation

# import curve from compas
from compas_rhino.conversions import curve_to_compas 
from compas.geometry import cross_vectors

from brick_wall import Brick

# Convert curve
compas_crv = curve_to_compas(crv)

# Spacing, dividing curve into positions
spacing = (Brick.LENGTH + gap) / 1.5
params, points = compas_crv.divide_by_length(spacing, True)

# Undulation parameters (adjust these to change the wave shape and height)
base_layers = 10       # Minimum number of layers
wave_amplitude = 4     # Height variation magnitude 
frequency = 2.0        # Number of waves along the curve

# 1. Pre-calculate the maximum height (in layers) for every position along the curve
curve_length = compas_crv.length()
local_heights = []
for param in params:
    normalized_param = param / curve_length if curve_length > 0 else param
    wave_factor = math.sin(normalized_param * math.pi * frequency)
    l_layers = max(1, int(base_layers + wave_amplitude * wave_factor))
    local_heights.append(l_layers)

max_layers = max(local_heights)

# Creating empty lists for layers
bricks = []
frames = []

# 2. Outer loop: Iterate layer by layer (building upwards)
for i in range(max_layers):
    subbricks = []
    subframes = []

    # Inner loop: Iterate position by position along the curve for this specific layer
    for j, (param, pt) in enumerate(zip(params, points)):

        # Only place a brick if this position's wave height reaches layer i
        if i < local_heights[j]:
            z = i * Brick.HEIGHT
            angle = math.radians(i * rotation) if 'rotation' in globals() else 0.0
            R = Rotation.from_axis_and_angle([0, 0, 1], angle)

            # Brick type orientation pattern based on layer (i) and position (j)
            if j % 2 == i % 2:
                brick_type = 1
            else:
                brick_type = 2

            # Position 
            brick_point = Point(pt.x, pt.y, z)

            # Direction along the curve (using [0, 0, 1] cross tangent to ensure Z-up)
            tangent_base = compas_crv.tangent_at(param)
            normal_base = Vector(*cross_vectors([0, 0, 1], tangent_base))

            # Transformation
            tangent = tangent_base.transformed(R)
            normal = normal_base.transformed(R)

            # Orientations (maintaining Z-axis pointing strictly up for robot tool alignment)
            if brick_type == 1:
                frame = Frame(brick_point, xaxis=tangent, yaxis=normal)
            elif brick_type == 2:
                frame = Frame(brick_point, xaxis=-normal, yaxis=tangent)

            # Shift the frame vertically so the first layer sits on top of the ground and builds upwards
            frame.point += Vector(0.0, 0.0, 0.5 * Brick.HEIGHT)

            # Brick and store
            brick = Brick(frame)
            subbricks.append(brick)
            subframes.append(frame)

    bricks.append(subbricks)
    frames.append(subframes)

# Output geometries and frames (as trees grouped by layer for the robot sequence)
geometries = [[b.draw() for b in subb] for subb in bricks]
geometries = th.list_to_tree(geometries)
frames = th.list_to_tree(frames)
# ---------- end bricks_3 ----------
compas_draw_5 = COMPASDraw(cg=bricks_3.geometries)  # -> rg; same code as compas_draw
compas_draw_6 = COMPASDraw(cg=bricks_3.frames)  # -> rg; same code as compas_draw

# ----
curve_4 = Curve(<curve referenced from the Rhino model>)
# Generate Geometry
brick_wall = Python3Script(crv=curve_4, num_layers=Slider(6, range=0..30), gap=gap, work_x=number_slider_2, work_y=number_slider_3, work_area=crv)  # -> para, T, bricks, geometries, frames, work_area; inputs crv: Curve, num_layers: Int32, gap: Double, work_area: Polyline
# ---------- brick_wall: Python ----------
# r: compas
# venv: mas-2627
from compas_rhino.devtools import DevTools
DevTools.ensure_path()

# 0. Import everything we will need
import math
from compas_rhino.conversions import curve_to_compas
import ghpythonlib.treehelpers as th
from compas.geometry import Curve, Polygon
from compas.geometry import Box
from compas.geometry import Point, Vector
from compas.geometry import Frame, Transformation, Translation
from compas_rhino.conversions import polyline_to_compas
from compas_rhino.conversions import polyline_to_rhino_curve


# ..also import our module "brick_wall.py", that needs to be in the same folder as our GH file
from brick_wall import Brick

# 1. Start with an empty list of bricks to be created
bricks = []
frames = []
# 2. Create points on curve curve
work_area = polyline_to_compas(work_area)

crv = curve_to_compas(crv)
t,p = crv.divide_by_length((Brick.LENGTH + gap)/2, True) # Boolean to set if we also return the exact points as well. If not it will just return params
# Since there is a gap, we would need to include it in length calculation so that our bricks would be placed in the right spots
para = list(t)
work_pt = Point(work_x/2, work_y/2, 0.0)
# mid point of workspace
work_f = Frame(work_pt, Vector.Xaxis(), Vector.Yaxis())
# frame built on midpoint
T = 0

for r in range(num_layers):

    # Ensure odd layers keep odd bricks, even layers keep even bricks 
    tang = [crv.tangent_at(para) for i, para in enumerate(t) if r % 2 == i % 2]
    pts = [pt for j, pt in enumerate(p) if r % 2 == j % 2]
    # or if abs(r - j) % 2 == 0
    # Adjust the height of brick laid given its row

    for pp in pts:
        pp.z = r*Brick.HEIGHT
    # Establish its different qualities based on the values
    norm = Vector.cross_vectors([Vector.Zaxis() for i in range(len(tang))], tang)

    subframes = [Frame(pt, tt, nn) for (pt,tt,nn) in zip(pts,tang,norm)]

    T = Transformation.from_frame_to_frame(Frame.worldXY(), work_f)

    moveframes = [f.transformed(Translation.from_vector(Vector(0.0,0.0,1/2*Brick.HEIGHT))) for f in subframes]

    transframes = [mf.transformed(T) for mf in moveframes]

    subbricks = [Brick(f) for f in transframes]

    bricks.append(subbricks)
    frames.append(transframes)

work_area = polyline_to_rhino_curve(work_area)
geometries = th.list_to_tree([[b.draw() for b in subbricks] for subbricks in bricks])
frames = th.list_to_tree([[f for f in tras] for tras in frames])
# Visualize and store brick data
# ---------- end brick_wall ----------
lng = ListLength(List=flatten(brick_wall.frames))  # disabled
compas_draw_7 = COMPASDraw(cg=brick_wall.frames)  # -> rg; same code as compas_draw
crv_2 = Curve(brick_wall.work_area)
compas_draw_8 = COMPASDraw(cg=brick_wall.geometries)  # -> rg; same code as compas_draw

# ---- group: IP ADDRESS
panel = Panel("192.168.10.10")

# ----
# Measure work object
capture = Button()
point = ValueList({"origin", "xaxis", "xypoint"}, selected="xypoint")
capture_wobj = CaptureWobj(robot_ip=panel, point_name=point, capture=capture)  # -> wobj_origin, wobj_xaxis, wobj_xypoint, info
# ---------- capture_wobj: Python ----------
"""
Capture the 3 points that define the work object (robot base) plane.

Jog the TCP to a point, pick its name (origin / xaxis / xypoint) and press capture.
The TCP position (robot base frame, mm) is saved to wobj_calibration.json next to
this .ghx file, so the points survive closing Grasshopper.
"""
import os
import sys
import json
import time

import scriptcontext as sc
import Rhino.Geometry as rg

NAMES = ["origin", "xaxis", "xypoint"]

gh_dir = os.path.dirname(ghenv.Component.OnPingDocument().FilePath)
src_dir = os.path.join(gh_dir, "src")
if src_dir not in sys.path:
    sys.path.append(src_dir)
import simple_comm as com

path = os.path.join(gh_dir, "wobj_calibration.json")

data = {}
if os.path.exists(path):
    with open(path) as f:
        data = json.load(f)

# keep the last status in sticky, so the message survives the button being released
status_key = "capture_status_" + str(ghenv.Component.InstanceGuid)

if capture:
    if point_name not in NAMES:
        sc.sticky[status_key] = "pick origin / xaxis / xypoint"
    else:
        try:
            x, y, z = list(com.listen_to_robot(robot_ip)["pose"])[:3]  # metres, robot base frame
            data[point_name] = [round(x * 1000, 2), round(y * 1000, 2), round(z * 1000, 2)]  # -> mm
            with open(path, "w") as f:
                json.dump(data, f, indent=2)
            sc.sticky[status_key] = "{} captured {}".format(point_name, time.strftime("%H:%M:%S"))
        except Exception as e:
            print(e)
            sc.sticky[status_key] = "robot not reachable"

ghenv.Component.Message = sc.sticky.get(status_key, "")

def pt(name):
    return rg.Point3d(*data[name]) if name in data else None

wobj_origin, wobj_xaxis, wobj_xypoint = pt("origin"), pt("xaxis"), pt("xypoint")
info = json.dumps(data, indent=2)
# ---------- end capture_wobj ----------
wobj_calibration = Panel(capture_wobj.info)

# ----
# Measure pick up location
point_2 = ValueList({"origin", "xaxis", "xypoint"}, selected="xypoint")
capture_2 = Button()
capture_pick = CapturePick(robot_ip=panel, point_name=point_2, capture=capture_2)  # -> origin, xaxis_pt, xy_pt, info
# ---------- capture_pick: Python ----------
"""
Capture the 3 points that define the pick frame at the brick pick-up location.

Jog the TCP to a point, pick its name (origin / xaxis / xypoint) and press capture.
The TCP position (robot base frame, mm) is saved to pick_calibration.json next to
this .ghx file, so the points survive closing Grasshopper.
"""
import os
import sys
import json
import time

import scriptcontext as sc
import Rhino.Geometry as rg

NAMES = ["origin", "xaxis", "xypoint"]

gh_dir = os.path.dirname(ghenv.Component.OnPingDocument().FilePath)
src_dir = os.path.join(gh_dir, "src")
if src_dir not in sys.path:
    sys.path.append(src_dir)
import simple_comm as com

path = os.path.join(gh_dir, "pick_tray_calibration.json")

data = {}
if os.path.exists(path):
    with open(path) as f:
        data = json.load(f)

# keep the last status in sticky, so the message survives the button being released
status_key = "capture_status_" + str(ghenv.Component.InstanceGuid)

if capture:
    if point_name not in NAMES:
        sc.sticky[status_key] = "pick origin / xaxis / xypoint"
    else:
        try:
            x, y, z = list(com.listen_to_robot(robot_ip)["pose"])[:3]  # metres, robot base frame
            data[point_name] = [round(x * 1000, 2), round(y * 1000, 2), round(z * 1000, 2)]  # -> mm
            with open(path, "w") as f:
                json.dump(data, f, indent=2)
            sc.sticky[status_key] = "{} captured {}".format(point_name, time.strftime("%H:%M:%S"))
        except Exception as e:
            print(e)
            sc.sticky[status_key] = "robot not reachable"

ghenv.Component.Message = sc.sticky.get(status_key, "")

def pt(name):
    return rg.Point3d(*data[name]) if name in data else None

origin, xaxis_pt, xy_pt = pt("origin"), pt("xaxis"), pt("xypoint")
info = json.dumps(data, indent=2)
# ---------- end capture_pick ----------
pick_calibration = Panel(capture_pick.info)

# ----
# Measure slide top location
point_3 = ValueList({"origin", "xaxis", "xypoint"}, selected="xypoint")
capture_3 = Button()
capture_pick_2 = CapturePick(robot_ip=panel, point_name=point_3, capture=capture_3)  # -> origin, xaxis_pt, xy_pt, info
# ---------- capture_pick_2: Python ----------
"""
Capture the 3 points that define the pick frame at the brick pick-up location.

Jog the TCP to a point, pick its name (origin / xaxis / xypoint) and press capture.
The TCP position (robot base frame, mm) is saved to pick_calibration.json next to
this .ghx file, so the points survive closing Grasshopper.
"""
import os
import sys
import json
import time

import scriptcontext as sc
import Rhino.Geometry as rg

NAMES = ["origin", "xaxis", "xypoint"]

gh_dir = os.path.dirname(ghenv.Component.OnPingDocument().FilePath)
src_dir = os.path.join(gh_dir, "src")
if src_dir not in sys.path:
    sys.path.append(src_dir)
import simple_comm as com

path = os.path.join(gh_dir, "place_slide_calibration.json")

data = {}
if os.path.exists(path):
    with open(path) as f:
        data = json.load(f)

# keep the last status in sticky, so the message survives the button being released
status_key = "capture_status_" + str(ghenv.Component.InstanceGuid)

if capture:
    if point_name not in NAMES:
        sc.sticky[status_key] = "pick origin / xaxis / xypoint"
    else:
        try:
            x, y, z = list(com.listen_to_robot(robot_ip)["pose"])[:3]  # metres, robot base frame
            data[point_name] = [round(x * 1000, 2), round(y * 1000, 2), round(z * 1000, 2)]  # -> mm
            with open(path, "w") as f:
                json.dump(data, f, indent=2)
            sc.sticky[status_key] = "{} captured {}".format(point_name, time.strftime("%H:%M:%S"))
        except Exception as e:
            print(e)
            sc.sticky[status_key] = "robot not reachable"

ghenv.Component.Message = sc.sticky.get(status_key, "")

def pt(name):
    return rg.Point3d(*data[name]) if name in data else None

origin, xaxis_pt, xy_pt = pt("origin"), pt("xaxis"), pt("xypoint")
info = json.dumps(data, indent=2)
# ---------- end capture_pick_2 ----------
pick_calibration_2 = Panel(capture_pick_2.info)

# ----
# Measure slide bottom location 1
point_4 = ValueList({"origin", "xaxis", "xypoint"}, selected="xypoint")
capture_4 = Button()
capture_pick_3 = CapturePick(robot_ip=panel, point_name=point_4, capture=capture_4)  # -> origin, xaxis_pt, xy_pt, info
# ---------- capture_pick_3: Python ----------
"""
Capture the 3 points that define the pick frame at the brick pick-up location.

Jog the TCP to a point, pick its name (origin / xaxis / xypoint) and press capture.
The TCP position (robot base frame, mm) is saved to pick_calibration.json next to
this .ghx file, so the points survive closing Grasshopper.
"""
import os
import sys
import json
import time

import scriptcontext as sc
import Rhino.Geometry as rg

NAMES = ["origin", "xaxis", "xypoint"]

gh_dir = os.path.dirname(ghenv.Component.OnPingDocument().FilePath)
src_dir = os.path.join(gh_dir, "src")
if src_dir not in sys.path:
    sys.path.append(src_dir)
import simple_comm as com

path = os.path.join(gh_dir, "pick_slide_calibration_1.json")

data = {}
if os.path.exists(path):
    with open(path) as f:
        data = json.load(f)

# keep the last status in sticky, so the message survives the button being released
status_key = "capture_status_" + str(ghenv.Component.InstanceGuid)

if capture:
    if point_name not in NAMES:
        sc.sticky[status_key] = "pick origin / xaxis / xypoint"
    else:
        try:
            x, y, z = list(com.listen_to_robot(robot_ip)["pose"])[:3]  # metres, robot base frame
            data[point_name] = [round(x * 1000, 2), round(y * 1000, 2), round(z * 1000, 2)]  # -> mm
            with open(path, "w") as f:
                json.dump(data, f, indent=2)
            sc.sticky[status_key] = "{} captured {}".format(point_name, time.strftime("%H:%M:%S"))
        except Exception as e:
            print(e)
            sc.sticky[status_key] = "robot not reachable"

ghenv.Component.Message = sc.sticky.get(status_key, "")

def pt(name):
    return rg.Point3d(*data[name]) if name in data else None

origin, xaxis_pt, xy_pt = pt("origin"), pt("xaxis"), pt("xypoint")
info = json.dumps(data, indent=2)
# ---------- end capture_pick_3 ----------
pick_calibration_3 = Panel(capture_pick_3.info)

# ----
# Measure slide bottom location 2
point_5 = ValueList({"origin", "xaxis", "xypoint"}, selected="xypoint")
capture_5 = Button()
capture_pick_4 = CapturePick(robot_ip=panel, point_name=point_5, capture=capture_5)  # -> origin, xaxis_pt, xy_pt, info; same code as capture_pick_3
pick_calibration_4 = Panel(capture_pick_4.info)

py3 = Python3Script(list_len=lng, no_per_row=number_slider, origin=capture_pick.origin)  # -> out, no_row, tray_grid; disabled
# ---------- py3: Python ----------
import math as m
import Rhino.Geometry as rg
from brick_wall import Brick

no_row = list_len//no_per_row + 1
b_h = Brick().HEIGHT
b_l = Brick().LENGTH
b_w = Brick().WIDTH
# ---------- end py3 ----------

# ---- group: Origin
pt = ConstructPoint(XCoordinate="-35.73", YCoordinate="393.10", ZCoordinate="200.65")

pt_2 = ConstructPoint(XCoordinate="-139.76", YCoordinate="282.1", ZCoordinate="88.57")

# ---- group: xaxis
pt_3 = ConstructPoint(XCoordinate="-140.29", YCoordinate="297.79", ZCoordinate="89.42")

# ---- group: yaxis
pt_4 = ConstructPoint(XCoordinate="-136.12", YCoordinate="282.35", ZCoordinate="82.19")

# ---- group: Origin
pt_5 = ConstructPoint(XCoordinate="-131.59", YCoordinate="283.06", ZCoordinate="75.46")

# ---- group: xaxis
pt_6 = ConstructPoint(XCoordinate="-130.97", YCoordinate="298.06", ZCoordinate="75.38")

# ---- group: yaxis
pt_7 = ConstructPoint(XCoordinate="-128.56", YCoordinate="253.3", ZCoordinate="68.46")

# ---- group: Origin
pt_8 = ConstructPoint(XCoordinate="-135.14", YCoordinate="281.07", ZCoordinate="75.86")

# ---- group: yaxis
pt_9 = ConstructPoint(XCoordinate="-129.52", YCoordinate="283.06", ZCoordinate="78.75")

# ---- group: xaxis
pt_10 = ConstructPoint(XCoordinate="-134.99", YCoordinate="296.40", ZCoordinate="76.52")

# ---- group: Origin
pt_11 = ConstructPoint(XCoordinate="534.15", YCoordinate="530.96", ZCoordinate="-9.26")

# ---- group: xaxis
pt_12 = ConstructPoint(XCoordinate="113.63", YCoordinate="528.18", ZCoordinate="-8.75")

# ---- group: yaxis
# Measure work object
panel_2 = Panel("-9.72")
pt_13 = ConstructPoint(XCoordinate="535.01", YCoordinate="325.62", ZCoordinate=panel_2)

# ---- group: xaxis
pt_14 = ConstructPoint(XCoordinate="60.31", YCoordinate="392.86", ZCoordinate="200.15")

# ---- group: yaxis
pt_15 = ConstructPoint(XCoordinate="-36.81", YCoordinate="517.32", ZCoordinate="200.39")

# ----
# Measure and set TCP Gripper
panel_3 = Panel("0.12")
pt_16 = ConstructPoint(XCoordinate=panel_3, YCoordinate="0.64", ZCoordinate="121.84")

# ----
# Measure and set TCP Suction
panel_4 = Panel("-65.64")
pt_17 = ConstructPoint(XCoordinate=panel_4, YCoordinate="35.36", ZCoordinate="96.7")

# ----
# Measure pick up location
# Measure pick up location
py3_2 = Python3Script(origin=pt, xaxis_pt=pt_14, xy_pt=pt_15)  # -> out, pick_frame; inputs origin: Point3d, xaxis_pt: Point3d, xy_pt: Point3d
# ---------- py3_2: Python ----------
from compas.geometry import Frame, Point
from compas.geometry import Rotation

from compas_rhino.conversions import point_to_compas

origin = point_to_compas(origin)
xaxis_pt = point_to_compas(xaxis_pt)
xy_pt = point_to_compas(xy_pt)

#define pick frame
pick_frame = Frame(origin, -(xaxis_pt - origin), xy_pt - origin)
# ---------- end py3_2 ----------
compas_draw_9 = COMPASDraw(cg=py3_2.pick_frame)  # -> rg; same code as compas_draw

# ----
# Transform from Rhino to Robot Space
# Insert way_planes as grasshopper tree
fine_adjust_z_mm = Slider(5, range=-5..100)
transform_geom = Python3Script(way_planes=bricks_3.frames, wobj_origin=pt_11, wobj_xaxis=pt_12, wobj_xypoint=pt_13, z_safe_margin=fine_adjust_z_mm)  # -> out, transformed_frames; inputs way_planes: tree, wobj_origin: Point3d, wobj_xaxis: Point3d, wobj_xypoint: Point3d, z_safe_margin: Double
# ---------- transform_geom: Python ----------
from compas.geometry import Frame, Transformation, Translation, Vector, Rotation
import math as m
from ghpythonlib import treehelpers as th
#in this step we transform our way planes to robot space
#the rhino co-ordinate system is rather abstract in the physical world
#the robot base plane assumed the base frame of robot is the origin
#but rhino does not know that
#thus we transform things from our design space(Rhino World XY) to Robot Base Plane that we measure

def set_robot_base(origin, xaxis, xypoint):
    """
    set a base plane representing the robot working object plane
    """
    robot_base = Frame(origin, xaxis - origin, xypoint - origin)
    return (robot_base)

def rhino_to_robot_space(rhino_plane,robot_base_plane):
    """
    Transform the objects from Rhino world XY plane to robot work object plane
    """
    T_matrix = Transformation.from_frame_to_frame(Frame.worldXY(), robot_base_plane)
    robot_plane = rhino_plane.transformed(T_matrix)
    robot_plane = robot_plane.rotated(m.pi,robot_plane.yaxis, robot_plane.point)
    # rotates plane by 180 degress around y axis
    return robot_plane

def set_z_safe_margin(planes_to_adjust, safety_margin):
    adjusted = []
    T = Translation.from_vector(Vector(0, 0, safety_margin))
    for f in planes_to_adjust:
        adjusted.append(f.transformed(T))
    return adjusted

# ===== Tree conversion to List =====
way_planes = th.tree_to_list(way_planes)

# ===== Robot base is set =====
robot_base =  set_robot_base(wobj_origin, wobj_xaxis, wobj_xypoint)

# ===== Set safety margin for Z height ======
safe_planes = [set_z_safe_margin(wy, z_safe_margin) for wy in way_planes]

# ===== Transforming the rhino planes into robot planes =====
transformed_frames = []
for plane in safe_planes: 
    sub_transformed = []
    for pln in plane:
        sub_transformed.append(rhino_to_robot_space(pln, robot_base))
    transformed_frames.append(sub_transformed)

transformed_frames = th.list_to_tree(transformed_frames)
# ---------- end transform_geom ----------
compas_draw_10 = COMPASDraw(cg=transform_geom.transformed_frames)  # -> rg; same code as compas_draw

# ----
# Measure slide top location
py3_3 = Python3Script(origin=pt_2, xaxis_pt=pt_3, xy_pt=pt_4)  # -> out, pick_frame; inputs origin: Point3d, xaxis_pt: Point3d, xy_pt: Point3d
# ---------- py3_3: Python ----------
from compas.geometry import Frame, Point
from compas.geometry import Rotation

from compas_rhino.conversions import point_to_compas

origin = point_to_compas(origin)
xaxis_pt = point_to_compas(xaxis_pt)
xy_pt = point_to_compas(xy_pt)

#define pick frame
pick_frame = Frame(origin, xaxis_pt - origin, xy_pt - origin)
# ---------- end py3_3 ----------
compas_draw_11 = COMPASDraw(cg=py3_3.pick_frame)  # -> rg; same code as compas_draw

# ----
# Measure slide bottom location 1
# (for configuration 1)
py3_4 = Python3Script(origin=pt_5, xaxis_pt=pt_6, xy_pt=pt_7)  # -> out, pick_frame; inputs origin: Point3d, xaxis_pt: Point3d, xy_pt: Point3d; same code as py3_3
compas_draw_12 = COMPASDraw(cg=py3_4.pick_frame)  # -> rg; same code as compas_draw

# ----
# Measure slide bottom location 2
# (for configuration 2)
py3_5 = Python3Script(origin=pt_8, xaxis_pt=pt_10, xy_pt=pt_9)  # -> out, pick_frame; inputs origin: Point3d, xaxis_pt: Point3d, xy_pt: Point3d; same code as py3_3
compas_draw_13 = COMPASDraw(cg=py3_5.pick_frame)  # -> rg; same code as compas_draw

panel_5 = Panel("""0
0""")
python_3_script = Python3Script(origin_frame=py3_2.pick_frame, levels=Slider(20, range=0..100))  # -> out, brick_frame, pick_frames; inputs levels: Int32
# ---------- python_3_script: Python ----------
from brick_wall import Brick
import math as m
from compas.geometry import Vector


COLS = 4
ROWS = 9
LAYER_CAPACITY = COLS * ROWS - 1

pick_frames = []

for i in range(LAYER_CAPACITY * levels):

    layer = i // LAYER_CAPACITY
    index = i % LAYER_CAPACITY

    col = index % COLS
    row = index // COLS
    dx = -col * Brick.LENGTH
    dy = row * Brick.WIDTH
    dz = -layer * Brick.HEIGHT

    brick_frame = origin_frame.copy()
    brickpt = brick_frame.point

    brick_frame.point += (
        origin_frame.xaxis * dx
        + origin_frame.yaxis * dy
        + Vector(0, 0, dz)
    )

    # brick = Brick(brick_frame)
    pick_frames.append(brick_frame)
# ---------- end python_3_script ----------
number_slider_4 = Slider(1, range=0..5)
number_slider_5 = Slider(1, range=0..5)
orientation_setter = Python3Script(frame_list=transform_geom.transformed_frames, ori=panel_5)  # -> out, branch_count, orientation; inputs frame_list: tree, ori: list of Int32
# ---------- orientation_setter: Python ----------
import ghpythonlib.treehelpers as th
frame_list = th.tree_to_list(frame_list)
branch_count = len(frame_list)
orientation = [ori[0] if n % 2 == 0 else ori[1] for n, f in enumerate(frame_list)]
# ---------- end orientation_setter ----------
compas_draw_14 = COMPASDraw(cg=python_3_script.brick_frame)  # -> rg; same code as compas_draw
compas_draw_15 = COMPASDraw(cg=python_3_script.pick_frames)  # -> rg; same code as compas_draw
compas = Python3Script(
    way_frames=transform_geom.transformed_frames,
    orientation=orientation_setter.orientation,
    safe_distance=Slider(50, range=0..500),
    tcp_measured=pt_17,
    tcp2_measured=pt_16,
    acceleration=number_slider_4,
    velocity=number_slider_5,
    pick_frame=python_3_script.pick_frames,
    place_slide_frame=py3_3.pick_frame,
    pick_slide_frame=py3_4.pick_frame,
    pick_slide_2_frame=py3_5.pick_frame,
    sleep_time=Slider(0.4, range=0..1),
    press_f=Slider(0.9, range=0..2))  # -> out, vis_frames, vis_planes, script; inputs way_frames: tree, orientation: list, safe_distance: Double, tcp_measured: Point3d, acceleration: Double, velocity: Double, pick_frame: list, sleep_time: Double, press_f: Double
# ---------- compas: Python ----------
from imp import reload
import sys
import os
import ghpythonlib.treehelpers as th

#get current file path
path = ghenv.Component.OnPingDocument().FilePath
#get parent directory of the parent directory
parentdir = os.path.dirname(path)
#get src folder which contains classes
dire = os.path.join(parentdir,'src')

sys.path.append(dire)

import simple_ur_script as ur
reload(ur)

import utils 
reload(utils)

import simple_comm as com
reload(com)

import compas.geometry as cg
import math as m

# ===== Set global constants =======

IO = 4 # Global constant
# IO Off: Gripper Closed, Suction Off
# IO On: Gripper Open, Suction On
# check IO number before setting

SAFE_DIST = safe_distance
SUCTION_ANGLES = (
    m.radians(-30.0),
    m.radians(0.0),
    m.radians(45.0)
)
GRIPPER_ANGLES_ONE = (
    m.radians(0.0),
    m.radians(0.0),
    m.radians(45.0)
)
GRIPPER_ANGLES_TWO = (
    m.radians(0.0),
    m.radians(0.0),
    m.radians(45.0)
)

script = ''
vis_frames = []

# =================================

def set_suction_tcp(script):
    """Set TCP to Vacuum Suction Tool Tip"""
    suction_script = ""
    suction_script += ur.set_tcp_by_angles(
        tcp_measured.X,
        tcp_measured.Y,
        tcp_measured.Z,
        *SUCTION_ANGLES
    )
    suction_script += ur.sleep(sleep_time) 
    return suction_script

def set_gripper_tcp(script, ori):
    """Set TCP to Gripper Tool Tip"""
    gripper_ang = GRIPPER_ANGLES_ONE if ori == 0 else GRIPPER_ANGLES_TWO
    gripper_script = ""
    gripper_script += ur.set_tcp_by_angles(
        tcp2_measured.X,
        tcp2_measured.Y,
        tcp2_measured.Z,
        *gripper_ang
    )
    gripper_script += ur.sleep(sleep_time) 
    return gripper_script

def safety_frame(frame, safety_distance):
    return frame.translated(frame.zaxis * -safety_distance)
    # negative zaxis since robot frame is pointing down

def suction_press(frame):
    return frame.translated(frame.zaxis * press_f)
    # we keep this positive as we want this to go down onto the brick

def reset_frame(script):
    reset_script = ""
    # reset_script += ur.move_j([m.radians(-125.03), m.radians(-106.41), m.radians(63.78), m.radians(-43.07), m.radians(-83.56), m.radians(8.40)],1, 1)
    reset_script += ur.move_j([m.radians(-122.26), m.radians(-126.48), m.radians(83.87), m.radians(-45.03), m.radians(-86.12), m.radians(17.54)],1, 1)
    return reset_script

def pickup_brick_tray(script,pick_up_frame):
    
    pickbrick_script = ""
    # Move J in case of faulting
    pickbrick_script += reset_frame(script)
    # Translate frame to "safe" location
    above_pick_tray = safety_frame(pick_up_frame, SAFE_DIST)
    # Move to safe frame
    pickbrick_script += ur.move_l(above_pick_tray, acceleration, velocity)
    # Move to pick location
    pickbrick_script += ur.move_l(pick_up_frame, acceleration, velocity)
    # Move down a little to guarantee pick
    press_down = suction_press(pick_up_frame)
    pickbrick_script += ur.move_l(press_down, acceleration, velocity)
    # Add to the path: turn on the vacuum and wait 
    pickbrick_script += ur.set_digital_out(IO, True)
    pickbrick_script += ur.sleep(sleep_time)
    # Move back to safe plane
    pickbrick_script += ur.move_l(above_pick_tray, acceleration, velocity)
    # Move J in case of faulting
    pickbrick_script += reset_frame(script)  

    picktray_frames = [above_pick_tray, pick_up_frame, above_pick_tray]

    return pickbrick_script, picktray_frames

def place_brick_slide(script, place_slide_frame):
    
    placeslide_script = ""
    # Move J in case of faulting
    placeslide_script += reset_frame(script)
    # Safe frame for placing
    above_slide_top = safety_frame(place_slide_frame, SAFE_DIST)
    # Add to the path: go to the safe plane
    placeslide_script += ur.move_l(above_slide_top, acceleration, velocity)
    # Add to the path: go to the place plane
    placeslide_script += ur.move_l(place_slide_frame, acceleration, velocity)
    # Add to the path: turn off the vacuum and wait 
    placeslide_script += ur.set_digital_out(IO, False)
    placeslide_script += ur.sleep(sleep_time)
    # Add to the path: go back to the safe plane
    placeslide_script += ur.move_l(above_slide_top, acceleration, velocity)
    # Move J in case of faulting
    placeslide_script += reset_frame(script)   

    placeslide_frames = [above_slide_top, place_slide_frame, above_slide_top]

    return placeslide_script, placeslide_frames

def pick_brick_slide(script, f1, f2, orient):

    pick_slide_frame = f1 if orient == 0 else f2

    pickslide_script = ""
    # Safe frame for picking
    above_slide_bottom = safety_frame(pick_slide_frame, SAFE_DIST)
    # Add to the path: open gripper and wait
    pickslide_script += ur.set_digital_out(IO, True)
    pickslide_script += ur.sleep(sleep_time) 
    # Add to the path: go to the safe plane
    pickslide_script += ur.move_l(above_slide_bottom, acceleration, velocity)    
    # Add to the path: go to the place plane
    pickslide_script += ur.move_l(pick_slide_frame, acceleration, velocity)    
    # Add to the path: close gripper and wait
    pickslide_script += ur.set_digital_out(IO, False)
    pickslide_script += ur.sleep(sleep_time) 
    # Add to the path: go back to the safe plane
    pickslide_script += ur.move_l(above_slide_bottom, acceleration, velocity)
    # Move J in case of faulting
    pickslide_script += reset_frame(script)   
    
    pickslide_frames = [above_slide_bottom, pick_slide_frame, above_slide_bottom]

    return pickslide_script, pickslide_frames

def place_position(script, position_frame):
    
    place_script = ""
    # Safe frame for placing
    above_place_position = safety_frame(position_frame, SAFE_DIST)
    # Add to the path: go to the safe plane
    place_script += ur.move_l(above_place_position, acceleration, velocity)    
    # Add to the path: go to the place plane
    place_script += ur.move_l(position_frame, acceleration, velocity)    
    # Add to the path: open gripper and wait
    place_script += ur.set_digital_out(IO, True)
    place_script += ur.sleep(sleep_time) 
    # Add to the path: go back to the safe plane
    place_script += ur.move_l(above_place_position, acceleration, velocity)  
    # Add to the path: close gripper and wait
    place_script += ur.set_digital_out(IO, False)
    place_script += ur.sleep(sleep_time)

    place_frames = [above_place_position, position_frame, above_place_position]

    return place_script, place_frames

script = ""
vis_frames = []
way_frames = th.tree_to_list(way_frames)
count_pick = 0

#if value given for tcp measured, then add line to script, otherwise it will take current tcp from robot
for num_wy, sub_wy in enumerate(way_frames):
    # num_wy: index of row of bricks to place
    # sub_wy: nested list of bricks per row    
    for n_way, wy in enumerate(sub_wy):
        # n_way: index of brick/frame
        # wy: way frame
        if tcp_measured is not None:

            # 1. Set to suction tcp and add it to script
            set_suction = set_suction_tcp(script)         
            script += set_suction

            # 2. Picking: Call variables for picking script and frames
            pickingplace = pick_frame[count_pick]
            pickbrick_script, picktray_frames = pickup_brick_tray(script, pickingplace)
            script += pickbrick_script
            vis_frames.extend(picktray_frames)
            count_pick += 1
            print(count_pick)

            # 2. Placing: Call variables for placing script and frames
            placeslide_script, placeslide_frames = place_brick_slide(script, place_slide_frame)
            script += placeslide_script
            vis_frames.extend(placeslide_frames)

            # 4. Set to gripper tcp and add it to script
            set_gripper = set_gripper_tcp(script,orientation[num_wy])
            script += set_gripper

            # 5. Gripping: Call variables for gripping(pick) script and frames
            pickslide_script, pickslide_frames = pick_brick_slide(script, pick_slide_frame, pick_slide_2_frame, orientation[num_wy])
            script += pickslide_script
            vis_frames.extend(pickslide_frames)

            # 6. Positioning: Call variables for positioning script and frames
            place_script, place_frames = place_position(script, wy)
            script += place_script
            vis_frames.extend(place_frames)


# Format the script to make it sendable
script = com.concatenate_script(script)

# Visualize
from compas_rhino import conversions
import Rhino.Geometry as rg

vis_planes = [conversions.frame_to_rhino(frame) for frame in vis_frames]
# ---------- end compas ----------

# ---- group: Send UR script to Robot!
# Convert Planes to URScript
py3_6 = Python3Script(script=compas.script, ip_address=panel, send=Button())  # -> out, a; inputs script: String, ip_address: String, send: Boolean
# ---------- py3_6: Python ----------
import simple_comm as com

if send:
    com.send_script(script,ip_address)
# ---------- end py3_6 ----------

# ----
panel_6 = Panel(compas.script)  # disabled
polyline = PolyLine(Vertices=compas.vis_planes, Closed=False)
compas_draw_16 = COMPASDraw(cg=compas.vis_frames)  # -> rg; same code as compas_draw
custom_preview = CustomPreview(Geometry=polyline, Material=ColourSwatch(SwatchColor=RGB(255, 0, 212)))  # disabled
number_slider_6 = Slider(7, range=0..100)  # disabled
# Send to Robot!
points = PointList(Points=compas.vis_planes, Size=number_slider_6)  # disabled
