# Grasshopper definition 101_brick_to_robot.ghx (Grasshopper 1.0.8)
# plug-ins: Bifocals

# ---- group: This is needed only ONCE in the GH definition
enable_auto_reload = Python3Script()  # -> ok
# ---------- enable_auto_reload: Python ----------
"""
------------------------------
Using VS Code as Python editor
------------------------------

The simplest way to start using VS Code as our editor, is
to place our Python code in files located IN THE SAME FOLDER as our Grasshopper file.

After we have done that, we need 2 steps: 

1. Enable the COMPAS reloader on one component. This tells Grasshopper to watch for changes in the Pythoh files and reload if changed.
2. Every other component that uses Python code from external files needs to start with a method to ensure Grasshopper knows where to load the files from.

"""
# r: compas
# venv: mas-2627

from compas_rhino.devtools import DevTools
DevTools.enable_reloader()
# ---------- end enable_auto_reload ----------

# ----
gap = Slider(5, range=0..10)
# Generate Geometry
geo = Geometry(<curve referenced from the Rhino model>)
brick_wall = Python3Script(crv=geo, num_layers=Slider(4, range=0..30), gap=gap)  # -> bricks, geometries, frames; inputs crv: Curve, num_layers: Int32, gap: Double
# ---------- brick_wall: Python ----------
# r: compas
# venv: mas-2627
from compas_rhino.devtools import DevTools
DevTools.ensure_path()


# 0. Import everything we will need
import math
from compas.geometry import Box
from compas.geometry import Point
from compas.geometry import Frame
from compas.geometry import cross_vectors

from compas_rhino.conversions import curve_to_compas


# ..also import our module "brick_wall.py", that needs to be in the same folder as our GH file
from brick_wall import Brick


# 1. Start with an empty list of bricks to be created
brick_list = []


# 2. Create points on curve curve
compas_crv = curve_to_compas(crv)


# Divide the curve
length = Brick.LENGTH + gap
params, points = compas_crv.divide_by_length(length/3, True)

for i in range(num_layers):
    for j, (param, pt) in enumerate(zip(params, points)):
        
        if i % 2 == 0 and j % 3 == 0:
            tangent = compas_crv.tangent_at(param)
            normal = cross_vectors(tangent, [0,0,1])
            pt.z = i * Brick.HEIGHT
            frame = Frame(pt, xaxis = tangent, yaxis = normal)
            my_brick = Brick(frame)
            brick_list.append(my_brick)
            
            
        
        elif i % 2 == 1 and j % 3 == 1:
            tangent = compas_crv.tangent_at(param)
            normal = cross_vectors(tangent, [0,0,1])
            pt.z = i * Brick.HEIGHT
            frame = Frame(pt, xaxis = tangent, yaxis = normal)
            my_brick = Brick(frame)
            brick_list.append(my_brick)
        
        
print(len(brick_list))


# Visualize and store brick data
geometries = []
frames = []
for i, brick in enumerate(brick_list):
    geometries.append(brick.draw())
    frames.append(brick.get_pick_frame())
# ---------- end brick_wall ----------
compas_draw = COMPASDraw(cg=brick_wall.geometries)  # -> rg
#   port cg: The COMPAS geometry or datastructure to be drawn.
#   port rg: The Rhino geometry object.
# ---------- compas_draw: Python ----------
# r: compas>=2.14.1
"""
Draws COMPAS geometry in Grasshopper.
"""

from typing import Any

import Grasshopper

from compas.scene import SceneObject


class CompasToRhinoGeometry(Grasshopper.Kernel.GH_ScriptInstance):
    def RunScript(self, cg):
        if not cg:
            return None

        return SceneObject(item=cg).draw()
# ---------- end compas_draw ----------
compas_draw_2 = COMPASDraw(cg=brick_wall.frames)  # -> rg; same code as compas_draw

# ----
# Measure work object
point = ValueList({"origin", "xaxis", "xypoint"}, selected="origin")
capture = Button()
capture_wobj = CaptureWobj(robot_ip="192.168.10.10", point_name=point, capture=capture)  # -> wobj_origin, wobj_xaxis, wobj_xypoint, info
# ---------- capture_wobj: Python ----------
"""
Capture the 3 points that define the work object (robot base) plane.

Jog the TCP to a point, pick its name (origin / xaxis / xypoint) and press capture.
The TCP position (robot base frame, mm) is saved to wobj_calibration.json next to
this .ghx file, so the points survive closing Grasshopper.
"""
import os
import sys
import json
import time

import scriptcontext as sc
import Rhino.Geometry as rg

NAMES = ["origin", "xaxis", "xypoint"]

gh_dir = os.path.dirname(ghenv.Component.OnPingDocument().FilePath)
src_dir = os.path.join(gh_dir, "src")
if src_dir not in sys.path:
    sys.path.append(src_dir)
import simple_comm as com

path = os.path.join(gh_dir, "wobj_calibration.json")

data = {}
if os.path.exists(path):
    with open(path) as f:
        data = json.load(f)

# keep the last status in sticky, so the message survives the button being released
status_key = "capture_status_" + str(ghenv.Component.InstanceGuid)

if capture:
    if point_name not in NAMES:
        sc.sticky[status_key] = "pick origin / xaxis / xypoint"
    else:
        try:
            x, y, z = list(com.listen_to_robot(robot_ip)["pose"])[:3]  # metres, robot base frame
            data[point_name] = [round(x * 1000, 2), round(y * 1000, 2), round(z * 1000, 2)]  # -> mm
            with open(path, "w") as f:
                json.dump(data, f, indent=2)
            sc.sticky[status_key] = "{} captured {}".format(point_name, time.strftime("%H:%M:%S"))
        except Exception as e:
            print(e)
            sc.sticky[status_key] = "robot not reachable"

ghenv.Component.Message = sc.sticky.get(status_key, "")

def pt(name):
    return rg.Point3d(*data[name]) if name in data else None

wobj_origin, wobj_xaxis, wobj_xypoint = pt("origin"), pt("xaxis"), pt("xypoint")
info = json.dumps(data, indent=2)
# ---------- end capture_wobj ----------
wobj_calibration = Panel(capture_wobj.info)

fine_adjust_z_mm = Slider(-5.5, range=-5.5..10)
# Transform from Rhino to Robot Space
transform = Python3Script(
    way_planes=brick_wall.frames,
    wobj_origin=capture_wobj.wobj_origin,
    wobj_xaxis=capture_wobj.wobj_xaxis,
    wobj_xypoint=capture_wobj.wobj_xypoint,
    z_safe_margin=fine_adjust_z_mm)  # -> out, transformed_frames; inputs way_planes: list, wobj_origin: Point3d, wobj_xaxis: Point3d, wobj_xypoint: Point3d, z_safe_margin: Double
# ---------- transform: Python ----------
from compas.geometry import Frame, Transformation, Translation, Vector
#in this step we transform our way planes to robot space
#the rhino co-ordinate system is rather abstract in the physical world
#the robot base plane assumed the base frame of robot is the origin
#but rhino does not know that
#thus we transform things from our design space(Rhino World XY) to Robot Base Plane that we measure

def set_robot_base(origin, xaxis, xypoint):
    """
    set a base plane representing the robot working object plane
    """
    robot_base = Frame(origin, xaxis - origin, xypoint - origin)
    print (robot_base)
    return (robot_base)

def rhino_to_robot_space(rhino_plane,robot_base_plane):
    """
    Transform the objects from Rhino world XY plane to robot work object plane
    """
    T_matrix = Transformation.from_frame_to_frame(Frame.worldXY(), robot_base_plane)
    robot_plane = rhino_plane.transformed(T_matrix)
    return robot_plane

def set_z_safe_margin(planes_to_adjust, safety_margin):
    adjusted = []
    T = Translation.from_vector(Vector(0, 0, safety_margin))
    for f in planes_to_adjust:
        adjusted.append(f.transformed(T))
    return adjusted

# ===== Robot base is set =====
robot_base =  set_robot_base(wobj_origin, wobj_xaxis, wobj_xypoint)

# ===== Set safety margin for Z height ======
safe_planes = set_z_safe_margin(way_planes, z_safe_margin)

# ===== Transforming the rhino planes into robot planes =====
transformed_frames = []
for plane in safe_planes: 
    transformed_frames.append(rhino_to_robot_space(plane, robot_base))
# ---------- end transform ----------
compas_draw_3 = COMPASDraw(cg=transform.transformed_frames)  # -> rg; same code as compas_draw

# ----
# Measure pick up location
point_2 = ValueList({"origin", "xaxis", "xypoint"}, selected="xypoint")
capture_2 = Button()
capture_pick = CapturePick(robot_ip="192.168.10.10", point_name=point_2, capture=capture_2)  # -> origin, xaxis_pt, xy_pt, info
# ---------- capture_pick: Python ----------
"""
Capture the 3 points that define the pick frame at the brick pick-up location.

Jog the TCP to a point, pick its name (origin / xaxis / xypoint) and press capture.
The TCP position (robot base frame, mm) is saved to pick_calibration.json next to
this .ghx file, so the points survive closing Grasshopper.
"""
import os
import sys
import json
import time

import scriptcontext as sc
import Rhino.Geometry as rg

NAMES = ["origin", "xaxis", "xypoint"]

gh_dir = os.path.dirname(ghenv.Component.OnPingDocument().FilePath)
src_dir = os.path.join(gh_dir, "src")
if src_dir not in sys.path:
    sys.path.append(src_dir)
import simple_comm as com

path = os.path.join(gh_dir, "pick_calibration.json")

data = {}
if os.path.exists(path):
    with open(path) as f:
        data = json.load(f)

# keep the last status in sticky, so the message survives the button being released
status_key = "capture_status_" + str(ghenv.Component.InstanceGuid)

if capture:
    if point_name not in NAMES:
        sc.sticky[status_key] = "pick origin / xaxis / xypoint"
    else:
        try:
            x, y, z = list(com.listen_to_robot(robot_ip)["pose"])[:3]  # metres, robot base frame
            data[point_name] = [round(x * 1000, 2), round(y * 1000, 2), round(z * 1000, 2)]  # -> mm
            with open(path, "w") as f:
                json.dump(data, f, indent=2)
            sc.sticky[status_key] = "{} captured {}".format(point_name, time.strftime("%H:%M:%S"))
        except Exception as e:
            print(e)
            sc.sticky[status_key] = "robot not reachable"

ghenv.Component.Message = sc.sticky.get(status_key, "")

def pt(name):
    return rg.Point3d(*data[name]) if name in data else None

origin, xaxis_pt, xy_pt = pt("origin"), pt("xaxis"), pt("xypoint")
info = json.dumps(data, indent=2)
# ---------- end capture_pick ----------
pick_calibration = Panel(capture_pick.info)
py3 = Python3Script(z_tune=Slider(1, range=1..10), origin=capture_pick.origin, xaxis_pt=capture_pick.xaxis_pt, xy_pt=capture_pick.xy_pt)  # -> out, pick_frame; inputs z_tune: Double, origin: Point3d, xaxis_pt: Point3d, xy_pt: Point3d
# ---------- py3: Python ----------
from compas.geometry import Frame, Point
from compas.geometry import Rotation

import math as m

from compas_rhino.conversions import point_to_compas

origin = point_to_compas(origin)
xaxis_pt = point_to_compas(xaxis_pt)
xy_pt = point_to_compas(xy_pt)

#define pick frame
pick_frame = Frame(origin, xaxis_pt - origin, xy_pt - origin)
pick_frame = pick_frame.rotated(m.pi/2, pick_frame.zaxis, pick_frame.point)
pick_frame = pick_frame.translated(pick_frame.zaxis * z_tune)
# ---------- end py3 ----------
compas_draw_4 = COMPASDraw(cg=py3.pick_frame)  # -> rg; same code as compas_draw

# ----
# Measure and set TCP
panel = Panel("-.46")
pt = ConstructPoint(XCoordinate=panel, YCoordinate="0.06", ZCoordinate="149.37")

number_slider = Slider(1, range=0..1)
number_slider_2 = Slider(1, range=0..1)
# Convert Planes to URScript
compas = Python3Script(
    way_frames=transform.transformed_frames,
    tcp_measured=pt,
    acceleration=number_slider,
    velocity=number_slider_2,
    pick_frame=py3.pick_frame)  # -> out, vis_frames, vis_planes, script; inputs way_frames: list, tcp_measured: Point3d, acceleration: Double, velocity: Double
# ---------- compas: Python ----------
from imp import reload
import sys
import os

#get current file path
path = ghenv.Component.OnPingDocument().FilePath
#get parent directory of the parent directory
parentdir = os.path.dirname(path)
#get src folder which contains classes
dire = os.path.join(parentdir,'src')

sys.path.append(dire)

import simple_ur_script as ur
reload(ur)

import utils 
reload(utils)

import simple_comm as com
reload(com)

import compas.geometry as cg
import math as m

# ===== Set global constants =======

IO = 4 # Global constant
SAFE_DIST = 50
BLEND_RAD = 10

# =================================

# script to activate vacuum
# script += ur.set_digital_out(IO, signal=True)
# script += ur.sleep(20)
# script += ur.set_digital_out(IO, signal=False)

script = "" #create empty string

def pickup_brick(script,pick_up_frame):
    frames = []
    # Translate frame to "safe" location
    safe_frame = pick_up_frame.translated(pick_up_frame.zaxis * -SAFE_DIST)

    # Move to safe frame
    script += ur.move_j([-2.13, -1.73, 1.84, -1.75, -1.63, 0.06], acceleration, velocity)
    # Move to pick location
    script += ur.move_l(pick_up_frame, acceleration, velocity)
    # Activate gripper
    script += ur.set_digital_out(IO, signal=True)
    script += ur.sleep(2)
    # Move back to safe plane
    script += ur.move_l(safe_frame, acceleration, velocity)
    script += ur.move_j([-2.13, -1.73, 1.84, -1.75, -1.63, 0.06], acceleration, velocity)
    return script, frames


def place_brick(script, place_frame):
    frames = []
    
    # Safe frame for placing
    safe_frame = place_frame.translated(place_frame.zaxis * -SAFE_DIST)
    # Add to the path: go to the safe plane
    script += ur.move_l_blend(safe_frame, acceleration, velocity, BLEND_RAD)
    # Add to the path: go to the place plane
    script += ur.move_l_blend(place_frame, acceleration/4, velocity/4, BLEND_RAD)
    # Add to the path: turn off the vacuum and wait 1 second (hold the brick)
    script += ur.sleep(1)
    script += ur.set_digital_out(IO, signal=False)
    # Add to the path: go back to the safe plane
    script += ur.move_l_blend(safe_frame, acceleration/4, velocity/4, BLEND_RAD)
    return script,frames


#if value given for tcp measured, then add line to script, otherwise it will take current tcp from robot
if tcp_measured is not None:
    script += ur.set_tcp_by_angles(tcp_measured.X, tcp_measured.Y, tcp_measured.Z, m.radians(0.0),m.radians(0.0),m.radians(0))


vis_frames = []

# Generate pick and place sequence


for i in range(len(way_frames)):
    script, _ = pickup_brick(script, pick_frame)
    script, _ = place_brick(script, way_frames[i])
    if i % 10 == 0 and i > 8:
        # popup_script = ur.popup(">:0 gimme BRICK", "ATTENTION", blocking=True)
        script += '\tpopup(">:0 gimme BRICK", title="ATTENTION", blocking=True)\n'

# Format the script to make it sendable
script += ur.move_j([-2.13, -1.73, 1.84, -1.75, -1.63, 0.06], acceleration, velocity)
script = com.concatenate_script(script)


# Visualize
from compas_rhino import conversions
import Rhino.Geometry as rg

vis_planes = [conversions.frame_to_rhino(frame) for frame in vis_frames]
# ---------- end compas ----------
compas_draw_5 = COMPASDraw(cg=compas.vis_frames)  # -> rg; same code as compas_draw
points = PointList(Points=compas.vis_planes, Size=Slider(1, range=0..100))
panel_2 = Panel(compas.script)
# Send to Robot!
py3_2 = Python3Script()  # -> out, a
# ---------- py3_2: Python ----------
from importlib import reload
import sys, os

# find src/ relative to this Grasshopper file, so the definition
# works wherever the repo is cloned
gh_file = ghenv.Component.OnPingDocument().FilePath
src_folder = os.path.join(os.path.dirname(gh_file), "src")
sys.path.append(src_folder)

import simple_ur_script as ur
reload(ur)
import utils 
reload(utils)
import simple_comm as com
reload(com)

import Rhino.Geometry as rg
import math as m


def safety_plane(plane, distance):
    lifted = rg.Plane(plane)
    # move in world Z to lift it
    T = rg.Transform.Translation(rg.Vector3d.ZAxis * distance)
    # apply transformation
    lifted.Transform(T)
    return lifted


def dip_brush(paint_location, lift_distance, accel, vel):
    # a point has no orientation, we can use the default xy plane
    # flipped so the tool points down into the pot
    paint_plane = rg.Plane(paint_location, -rg.Vector3d.XAxis, rg.Vector3d.YAxis)
    above_paint = safety_plane(paint_plane, lift_distance)

    # of the pot, the brush arcs above the paint and comes out dry
    dip_script = ""
    dip_script += ur.move_l(above_paint, accel, vel)
    dip_script += ur.move_l(paint_plane, accel, vel)
    dip_script += ur.move_l(above_paint, accel, vel)

    dip_planes = [above_paint, paint_plane, above_paint]

    return dip_script, dip_planes


script = "" # create empty string
viz_planes = [] # every frame the tool visits, in order, to draw the path later

# Step 1: SET TCP!! MAKE SURE THIS MATCHES YOUR BRUSH
script += ur.set_tcp_by_angles(tcp_measured.X, tcp_measured.Y, tcp_measured.Z, m.radians(0.0),m.radians(0.0),m.radians(0))

# Step 2: dip in the paint before drawing
dip_script, dip_planes = dip_brush(paint_location, lift_distance,
                                    acceleration, velocity)
script += dip_script
viz_planes.extend(dip_planes)

# Step 3: come down onto the paper from above, instead of sliding in sideways
approach = safety_plane(way_planes[0], lift_distance)
script += ur.move_l(approach, acceleration, velocity)
viz_planes.append(approach)

# Step 4: calculate blend for the drawing points only
blend_radii = utils.calculate_blend_radius(way_planes, 10.0)
blend_radii[0] = 0.0 # first touchdown must be exact

# Step 4b: add move_l commands to script for EACH way plane in the list of planes
for plane, radius in zip(way_planes, blend_radii):
    script += ur.move_l_blend(plane, acceleration, velocity, radius)
    viz_planes.append(plane)

# Step 5: lift straight up at the end, so the brush does not drag on the way out
retract = safety_plane(way_planes[-1], lift_distance)
script += ur.move_l(retract, acceleration, velocity)
viz_planes.append(retract)


# format the script to make it sendable
script = com.concatenate_script(script)
# ---------- end py3_2 ----------

# ---- group: Send UR script to Robot!
py3_3 = Python3Script(script=compas.script, ip_address="192.168.10.10", send=Button())  # -> out, a; inputs script: String, ip_address: String, send: Boolean
# ---------- py3_3: Python ----------
import simple_comm as com

if send:
    com.send_script(script,ip_address)
# ---------- end py3_3 ----------
