# Grasshopper definition 101_brick_to_robot_20261020_added slide, gripper_despina.gh (Grasshopper 1.0.8)

gap = Slider(7.6, range=0..10)
curve = Curve(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)
# Generate Geometry
curve_2 = Curve(<curve referenced from the Rhino model>)
brick_wall = Python3Script(crv=curve_2, num_layers=Slider(3, range=0..30), gap=gap)  # -> bricks, geometries, frames; inputs crv: Curve, num_layers: Int32, gap: Double
# ---------- brick_wall: Python ----------
# r: compas
# venv: mas-2627
from compas_rhino.devtools import DevTools
DevTools.ensure_path()

# 0. Import everything we will need
import math
from compas.geometry import Box
from compas.geometry import Point
from compas.geometry import Frame

# import curve from compas
from compas_rhino.conversions import curve_to_compas 
from compas.geometry import cross_vectors


# ..also import our module "brick_wall.py", that needs to be in the same folder as our GH file
from brick_wall import Brick


# 1. Start with an empty list of bricks to be created
bricks = []


# 2. Create points on curve curve
print(crv)

# divide by length
compas_crv = curve_to_compas(crv)

length = (Brick.LENGTH + gap)/2
params, points = compas_crv.divide_by_length(length, True)

# frames, points on each of them 
for i in range(num_layers):
    for j,(param, pt) in enumerate(zip(params, points)):
        if i%2 == j%2:
            tangent = compas_crv.tangent_at(param)
            # cross prosuct gives perpendicaular 
            normal = cross_vectors(tangent, [0,0,1])
            pt.z = i*Brick.HEIGHT
            frame = Frame(pt, xaxis = tangent, yaxis = normal)
            # chnage location of frame for z axis / points 


        my_brick = Brick(frame)
        bricks.append(my_brick)



# Visualize and store brick data
geometries = []
frames = []

for brick in bricks:
    geometries.append(brick.draw())
    frames.append(brick.get_pick_frame())


# # list comprehension
# geometries = [brick.draw() for brick in bricks]
# frames = [brick.get_pick_frame() for brick in bricks]

# rot = cos(att_point.distance_to_point(brick_origin)) * rotation_factor
#         brick.frame.rotate(radians(rot), point = brick_origin)
# ---------- end brick_wall ----------

# ----
# Measure work object
point = ValueList({"origin", "xaxis", "xypoint"}, selected="origin")
capture = Button()
capture_wobj = CaptureWobj(robot_ip="192.168.10.10", point_name=point, capture=capture)  # -> wobj_origin, wobj_xaxis, wobj_xypoint, info
# ---------- capture_wobj: Python ----------
"""
Capture the 3 points that define the work object (robot base) plane.

Jog the TCP to a point, pick its name (origin / xaxis / xypoint) and press capture.
The TCP position (robot base frame, mm) is saved to wobj_calibration.json next to
this .ghx file, so the points survive closing Grasshopper.
"""
import os
import sys
import json
import time

import scriptcontext as sc
import Rhino.Geometry as rg

NAMES = ["origin", "xaxis", "xypoint"]

gh_dir = os.path.dirname(ghenv.Component.OnPingDocument().FilePath)
src_dir = os.path.join(gh_dir, "src")
if src_dir not in sys.path:
    sys.path.append(src_dir)
import simple_comm as com

path = os.path.join(gh_dir, "wobj_calibration.json")

data = {}
if os.path.exists(path):
    with open(path) as f:
        data = json.load(f)

# keep the last status in sticky, so the message survives the button being released
status_key = "capture_status_" + str(ghenv.Component.InstanceGuid)

if capture:
    if point_name not in NAMES:
        sc.sticky[status_key] = "pick origin / xaxis / xypoint"
    else:
        try:
            x, y, z = list(com.listen_to_robot(robot_ip)["pose"])[:3]  # metres, robot base frame
            data[point_name] = [round(x * 1000, 2), round(y * 1000, 2), round(z * 1000, 2)]  # -> mm
            with open(path, "w") as f:
                json.dump(data, f, indent=2)
            sc.sticky[status_key] = "{} captured {}".format(point_name, time.strftime("%H:%M:%S"))
        except Exception as e:
            print(e)
            sc.sticky[status_key] = "robot not reachable"

ghenv.Component.Message = sc.sticky.get(status_key, "")

def pt(name):
    return rg.Point3d(*data[name]) if name in data else None

wobj_origin, wobj_xaxis, wobj_xypoint = pt("origin"), pt("xaxis"), pt("xypoint")
info = json.dumps(data, indent=2)
# ---------- end capture_wobj ----------
wobj_calibration = Panel(capture_wobj.info)

compas_draw = COMPASDraw(cg=brick_wall.frames)  # -> rg
#   port cg: The COMPAS geometry or datastructure to be drawn.
#   port rg: The Rhino geometry object.
# ---------- compas_draw: Python ----------
# r: compas>=2.14.1
"""
Draws COMPAS geometry in Grasshopper.
"""

from typing import Any

import Grasshopper

from compas.scene import SceneObject


class CompasToRhinoGeometry(Grasshopper.Kernel.GH_ScriptInstance):
    def RunScript(self, cg):
        if not cg:
            return None

        return SceneObject(item=cg).draw()
# ---------- end compas_draw ----------
compas_draw_2 = COMPASDraw(cg=brick_wall.geometries)  # -> rg; same code as compas_draw
fine_adjust_z_mm = Slider(5, range=-5..10)
# Transform from Rhino to Robot Space
rectangle_3pt = Rectangle3Pt(PointA=capture_wobj.wobj_origin, PointB=capture_wobj.wobj_xaxis, PointC=capture_wobj.wobj_xypoint)  # -> Rectangle, Length
transform = Python3Script(
    way_planes=brick_wall.frames,
    wobj_origin=capture_wobj.wobj_origin,
    wobj_xaxis=capture_wobj.wobj_xaxis,
    wobj_xypoint=capture_wobj.wobj_xypoint,
    z_safe_margin=fine_adjust_z_mm)  # -> out, transformed_frames; inputs way_planes: list, wobj_origin: Point3d, wobj_xaxis: Point3d, wobj_xypoint: Point3d, z_safe_margin: Double
# ---------- transform: Python ----------
from compas.geometry import Frame, Transformation, Translation, Vector
#in this step we transform our way planes to robot space
#the rhino co-ordinate system is rather abstract in the physical world
#the robot base plane assumed the base frame of robot is the origin
#but rhino does not know that
#thus we transform things from our design space(Rhino World XY) to Robot Base Plane that we measure

def set_robot_base(origin, xaxis, xypoint):
    """
    set a base plane representing the robot working object plane
    """
    robot_base = Frame(origin, xaxis - origin, xypoint - origin)
    v = 0.5 * (xaxis - origin) + 0.5 * (xypoint - origin)
    v_move = Translation.from_vector(v)
    robot_base.transform(v_move) #sel.Transform(v)
    print (robot_base)
    return (robot_base)

def rhino_to_robot_space(rhino_plane,robot_base_plane):
    """
    Transform the objects from Rhino world XY plane to robot work object plane
    """
    T_matrix = Transformation.from_frame_to_frame(Frame.worldXY(), robot_base_plane)
    robot_plane = rhino_plane.transformed(T_matrix)
    return robot_plane

def set_z_safe_margin(planes_to_adjust, safety_margin):
    adjusted = []
    T = Translation.from_vector(Vector(0, 0, safety_margin))
    for f in planes_to_adjust:
        adjusted.append(f.transformed(T))
    return adjusted

# ===== Robot base is set =====
robot_base =  set_robot_base(wobj_origin, wobj_xaxis, wobj_xypoint)

# ===== Set safety margin for Z height ======
safe_planes = set_z_safe_margin(way_planes, z_safe_margin)


# ===== Transforming the rhino planes into robot planes =====
transformed_frames = []
for plane in safe_planes: 
    transformed_frames.append(rhino_to_robot_space(plane, robot_base))
# ---------- end transform ----------

# ----
# Measure slide bottom location
point_2 = ValueList({"origin", "xaxis", "xypoint"}, selected="xypoint")
capture_2 = Button()
capture_pick = CapturePick(robot_ip="192.168.10.10", point_name=point_2, capture=capture_2)  # -> origin, xaxis_pt, xy_pt, info
# ---------- capture_pick: Python ----------
"""
Capture the 3 points that define the pick frame at the brick pick-up location.

Jog the TCP to a point, pick its name (origin / xaxis / xypoint) and press capture.
The TCP position (robot base frame, mm) is saved to pick_calibration.json next to
this .ghx file, so the points survive closing Grasshopper.
"""
import os
import sys
import json
import time

import scriptcontext as sc
import Rhino.Geometry as rg

NAMES = ["origin", "xaxis", "xypoint"]

gh_dir = os.path.dirname(ghenv.Component.OnPingDocument().FilePath)
src_dir = os.path.join(gh_dir, "src")
if src_dir not in sys.path:
    sys.path.append(src_dir)
import simple_comm as com

path = os.path.join(gh_dir, "pick_calibration.json")

data = {}
if os.path.exists(path):
    with open(path) as f:
        data = json.load(f)

# keep the last status in sticky, so the message survives the button being released
status_key = "capture_status_" + str(ghenv.Component.InstanceGuid)

if capture:
    if point_name not in NAMES:
        sc.sticky[status_key] = "pick origin / xaxis / xypoint"
    else:
        try:
            x, y, z = list(com.listen_to_robot(robot_ip)["pose"])[:3]  # metres, robot base frame
            data[point_name] = [round(x * 1000, 2), round(y * 1000, 2), round(z * 1000, 2)]  # -> mm
            with open(path, "w") as f:
                json.dump(data, f, indent=2)
            sc.sticky[status_key] = "{} captured {}".format(point_name, time.strftime("%H:%M:%S"))
        except Exception as e:
            print(e)
            sc.sticky[status_key] = "robot not reachable"

ghenv.Component.Message = sc.sticky.get(status_key, "")

def pt(name):
    return rg.Point3d(*data[name]) if name in data else None

origin, xaxis_pt, xy_pt = pt("origin"), pt("xaxis"), pt("xypoint")
info = json.dumps(data, indent=2)
# ---------- end capture_pick ----------
pick_calibration = Panel(capture_pick.info)
py3 = Python3Script(origin=capture_pick.origin, xaxis_pt=capture_pick.xaxis_pt, xy_pt=capture_pick.xy_pt)  # -> out, pick_frame; inputs origin: Point3d, xaxis_pt: Point3d, xy_pt: Point3d
# ---------- py3: Python ----------
from compas.geometry import Frame, Point
from compas.geometry import Rotation

from compas_rhino.conversions import point_to_compas

origin = point_to_compas(origin)
xaxis_pt = point_to_compas(xaxis_pt)
xy_pt = point_to_compas(xy_pt)

#define pick frame
pick_frame = Frame(origin, xaxis_pt - origin, xy_pt - origin)
# ---------- end py3 ----------
compas_draw_3 = COMPASDraw(cg=py3.pick_frame)  # -> rg; same code as compas_draw

# ----
# Measure brick pick up location
point_3 = ValueList({"origin", "xaxis", "xypoint"}, selected="xypoint")
capture_3 = Button()
capture_pick_2 = CapturePick(robot_ip="192.168.10.10", point_name=point_3, capture=capture_3)  # -> origin, xaxis_pt, xy_pt, info; same code as capture_pick
pick_calibration_2 = Panel(capture_pick_2.info)
py3_2 = Python3Script(origin=capture_pick_2.origin, xaxis_pt=capture_pick_2.xaxis_pt, xy_pt=capture_pick_2.xy_pt)  # -> out, pick_frame; inputs origin: Point3d, xaxis_pt: Point3d, xy_pt: Point3d; same code as py3
compas_draw_4 = COMPASDraw(cg=py3_2.pick_frame)  # -> rg; same code as compas_draw

# ----
# Measure slide top location
point_4 = ValueList({"origin", "xaxis", "xypoint"}, selected="xypoint")
capture_4 = Button()
capture_pick_3 = CapturePick(robot_ip="192.168.10.10", point_name=point_4, capture=capture_4)  # -> origin, xaxis_pt, xy_pt, info; same code as capture_pick
pick_calibration_3 = Panel(capture_pick_3.info)
py3_3 = Python3Script(origin=capture_pick_3.origin, xaxis_pt=capture_pick_3.xaxis_pt, xy_pt=capture_pick_3.xy_pt)  # -> out, pick_frame; inputs origin: Point3d, xaxis_pt: Point3d, xy_pt: Point3d; same code as py3
compas_draw_5 = COMPASDraw(cg=py3_3.pick_frame)  # -> rg; same code as compas_draw

compas_draw_6 = COMPASDraw(cg=transform.transformed_frames)  # -> rg; same code as compas_draw

# ----
# Measure and set TCP gripper
panel = Panel("0.13")
pt = ConstructPoint(XCoordinate=panel, YCoordinate="0.4", ZCoordinate="129.01")

# ----
# Measure and set TCP
panel_2 = Panel("-66.09")
pt_2 = ConstructPoint(XCoordinate=panel_2, YCoordinate="34.64", ZCoordinate="96.88")

number_slider = Slider(0.1, range=0..0.1)
number_slider_2 = Slider(0.1, range=0..0.1)
compas = Python3Script(
    way_frames=transform.transformed_frames,
    tcp_measured=pt_2,
    tcp_gripper_measured=pt,
    acceleration=number_slider,
    velocity=number_slider_2,
    tray_origin=py3_2.pick_frame,
    slide_top_frame=py3_3.pick_frame,
    slide_bottom_frame=py3.pick_frame)  # -> out, vis_frames, vis_planes, script; inputs way_frames: list, tcp_measured: Point3d, tcp_gripper_measured: Point3d, acceleration: Double, velocity: Double
# ---------- compas: Python ----------
# r: compas
# venv: mas-2627

import sys
import os
import math as m
from importlib import reload

import Rhino.Geometry as rg
from compas.geometry import Translation, Vector, Frame


# ==================================================
# 1. LOAD MODULES
# ==================================================

path = ghenv.Component.OnPingDocument().FilePath
parentdir = os.path.dirname(path)
src_dir = os.path.join(parentdir, "src")

if src_dir not in sys.path:
    sys.path.append(src_dir)

import simple_ur_script as ur
import utils
import simple_comm as com

reload(ur)
reload(utils)
reload(com)


# ==================================================
# 2. SETTINGS
# ==================================================

IO = 4
SAFE_DIST = 40
SLIDE_WAIT = 2.0

COLS = 4
ROWS = 2
TOTAL_LAYERS = 1

BRICK_LENGTH = 32.2
BRICK_BREADTH = 15.16
BRICK_HEIGHT = 9.84

# Initialise outputs
script = ""
vis_frames = []
vis_planes = []
out = "Not generated"


# ==================================================
# 3. INPUT VALIDATION
# ==================================================

required_inputs = [
    "way_frames",
    "tray_origin",
    "slide_top_frame",
    "slide_bottom_frame",
    "tcp_measured",
    "tcp_gripper",
    "acceleration",
    "velocity",
    "gripper_rx_deg",
    "gripper_ry_deg",
    "gripper_rz_deg"
]

missing = [
    name for name in required_inputs
    if name not in globals() or globals()[name] is None
]

run_enabled = globals().get("run", False)


# ==================================================
# 4. TCP SETTINGS
# ==================================================

VACUUM_RX = -30
VACUUM_RY = 0
VACUUM_RZ = 45


def check_point(point, name):
    """Check that a TCP input has X, Y and Z coordinates."""

    if not all(hasattr(point, axis) for axis in ("X", "Y", "Z")):
        raise ValueError(
            "{} must be a Rhino point with X, Y and Z.".format(name)
        )


def check_frame(frame, name):
    """Check that an input is a COMPAS Frame."""

    if not isinstance(frame, Frame):
        raise TypeError(
            "{} must be a COMPAS Frame, not {}.".format(
                name, type(frame).__name__
            )
        )


def set_vacuum_tcp():
    check_point(tcp_measured, "tcp_measured")

    return ur.set_tcp_by_angles(
        tcp_measured.X,
        tcp_measured.Y,
        tcp_measured.Z,
        m.radians(VACUUM_RX),
        m.radians(VACUUM_RY),
        m.radians(VACUUM_RZ)
    )


def set_gripper_tcp():
    check_point(tcp_gripper, "tcp_gripper")

    return ur.set_tcp_by_angles(
        tcp_gripper.X,
        tcp_gripper.Y,
        tcp_gripper.Z,
        m.radians(gripper_rx_deg),
        m.radians(gripper_ry_deg),
        m.radians(gripper_rz_deg)
    )


# ==================================================
# 5. SAFE APPROACH FRAME
# ==================================================

def make_safe_frame(target_frame):

    check_frame(target_frame, "target_frame")

    translation = Translation.from_vector(
        Vector(0, 0, SAFE_DIST)
    )

    return target_frame.transformed(translation)


# ==================================================
# 6. PICK BRICK
# ==================================================

def pickup_brick(robot_script, pick_frame):

    safe_frame = make_safe_frame(pick_frame)

    robot_script += ur.move_l(
        safe_frame, accel=acceleration, vel=velocity
    )

    robot_script += ur.move_l(
        pick_frame, accel=acceleration, vel=velocity
    )

    robot_script += ur.set_digital_out(IO, True)
    robot_script += ur.sleep(0.8)

    robot_script += ur.move_l(
        safe_frame, accel=acceleration, vel=velocity
    )

    return robot_script, [
        safe_frame,
        pick_frame,
        safe_frame
    ]


# ==================================================
# 7. PLACE BRICK
# ==================================================

def place_brick(robot_script, place_frame):

    safe_frame = make_safe_frame(place_frame)

    robot_script += ur.move_l(
        safe_frame, accel=acceleration, vel=velocity
    )

    robot_script += ur.move_l(
        place_frame, accel=acceleration, vel=velocity
    )

    robot_script += ur.set_digital_out(IO, False)
    robot_script += ur.sleep(0.8)

    robot_script += ur.move_l(
        safe_frame, accel=acceleration, vel=velocity
    )

    return robot_script, [
        safe_frame,
        place_frame,
        safe_frame
    ]


# ==================================================
# 8. CALCULATE TRAY PICK FRAME
# ==================================================

def get_tray_pick_frame(i):

    check_frame(tray_origin, "tray_origin")

    layer_capacity = COLS * ROWS

    col = i % COLS
    row = (i // COLS) % ROWS
    layer = i // layer_capacity

    dx = col * BRICK_BREADTH
    dy = row * BRICK_LENGTH
    dz = layer * BRICK_HEIGHT

    brick_point = (
        tray_origin.point
        + tray_origin.xaxis * dx
        + tray_origin.yaxis * dy
        - tray_origin.zaxis * dz
    )

    return Frame(
        brick_point,
        tray_origin.xaxis,
        tray_origin.yaxis
    )


# ==================================================
# 9. MAIN SEQUENCE
# ==================================================

try:

    if missing:
        out = "Missing inputs: " + ", ".join(missing)

    elif not run_enabled:
        out = "Ready. Connect a Boolean True to run."

    elif way_frames is None or len(way_frames) == 0:
        out = "No wall frames supplied."

    else:

        # Validate all frame inputs before generating commands
        check_frame(tray_origin, "tray_origin")
        check_frame(slide_top_frame, "slide_top_frame")
        check_frame(slide_bottom_frame, "slide_bottom_frame")

        for i, frame in enumerate(way_frames):
            check_frame(frame, "way_frames[{}]".format(i))

        check_point(tcp_measured, "tcp_measured")
        check_point(tcp_gripper, "tcp_gripper")

        max_capacity = COLS * ROWS * TOTAL_LAYERS
        count = 0

        # Start with vacuum TCP and release vacuum
        script += set_vacuum_tcp()
        script += ur.set_digital_out(IO, False)

        for i, place_frame in enumerate(way_frames):

            if i >= max_capacity:
                break

            # STEP 1: Pick from tray
            current_pick_frame = get_tray_pick_frame(i)

            script, frames = pickup_brick(
                script, current_pick_frame
            )
            vis_frames.extend(frames)

            # STEP 2: Place at top of slide
            script, frames = place_brick(
                script, slide_top_frame
            )
            vis_frames.extend(frames)

            # STEP 3: Wait for slide
            script += ur.sleep(SLIDE_WAIT)

            # STEP 4: Change to gripper TCP
            script += set_gripper_tcp()

            # STEP 5: Pick from bottom of slide
            script, frames = pickup_brick(
                script, slide_bottom_frame
            )
            vis_frames.extend(frames)

            # STEP 6: Place at wall
            script, frames = place_brick(
                script, place_frame
            )
            vis_frames.extend(frames)

            # STEP 7: Restore vacuum TCP
            script += set_vacuum_tcp()

            count += 1

        script = com.concatenate_script(script)

        out = "Generated {} brick cycles.".format(count)

        if len(way_frames) > max_capacity:
            out += (
                " WARNING: only {} of {} wall frames processed."
                .format(max_capacity, len(way_frames))
            )


    # ==================================================
    # 10. CONVERT COMPAS FRAMES TO RHINO PLANES
    # ==================================================

    for f in vis_frames:

        plane = rg.Plane(
            rg.Point3d(f.point.x, f.point.y, f.point.z),
            rg.Vector3d(f.xaxis.x, f.xaxis.y, f.xaxis.z),
            rg.Vector3d(f.yaxis.x, f.yaxis.y, f.yaxis.z)
        )

        vis_planes.append(plane)


except Exception as e:

    # Show the real error instead of silently returning blank outputs
    out = "ERROR: {}: {}".format(
        type(e).__name__, str(e)
    )

    # Avoid displaying a partial robot program after an error
    script = ""
    vis_frames = []
    vis_planes = []


# ==================================================
# 11. GRASSHOPPER OUTPUTS
# ==================================================

a = out
b = script
c = vis_planes
# ---------- end compas ----------
# Convert Planes to URScript
compas_2 = Python3Script()  # -> out, vis_frames, vis_planes, script; inputs way_frames: list, tcp_measured: Point3d, acceleration: Double, velocity: Double
# ---------- compas_2: Python ----------
# r: compas
# venv: mas-2627

import sys
import os
import math as m
from importlib import reload

import Rhino.Geometry as rg
from compas.geometry import Translation, Vector, Frame


# ==================================================
# 1. LOAD MODULES
# ==================================================

path = ghenv.Component.OnPingDocument().FilePath
parentdir = os.path.dirname(path)
src_dir = os.path.join(parentdir, "src")

if src_dir not in sys.path:
    sys.path.append(src_dir)

import simple_ur_script as ur
reload(ur)

import utils
reload(utils)

import simple_comm as com
reload(com)


# ==================================================
# 2. SETTINGS
# ==================================================

IO = 4
SAFE_DIST = 40
SLIDE_WAIT = 2.0

COLS = 4
ROWS = 2
TOTAL_LAYERS = 1

BRICK_LENGTH = 32.2
BRICK_BREADTH = 15.16
BRICK_HEIGHT = 9.84

script = ""
vis_frames = []
vis_planes = []
out = "Not generated"


# ==================================================
# 3. TCP SETTINGS
# ==================================================

# Vacuum TCP: existing calibration
VACUUM_RX = -30
VACUUM_RY = 0
VACUUM_RZ = 45

# Gripper TCP: measured values from robot
# Inputs: gripper_rx_deg, gripper_ry_deg, gripper_rz_deg


def set_vacuum_tcp():

    return ur.set_tcp_by_angles(
        tcp_measured.X,
        tcp_measured.Y,
        tcp_measured.Z,
        m.radians(VACUUM_RX),
        m.radians(VACUUM_RY),
        m.radians(VACUUM_RZ)
    )


def set_gripper_tcp():

    return ur.set_tcp_by_angles(
        tcp_gripper.X,
        tcp_gripper.Y,
        tcp_gripper.Z,
        m.radians(gripper_rx_deg),
        m.radians(gripper_ry_deg),
        m.radians(gripper_rz_deg)
    )


# ==================================================
# 4. CREATE SAFE FRAME
# ==================================================

def make_safe_frame(target_frame):

    T_safe = Translation.from_vector(
        Vector(0, 0, SAFE_DIST)
    )

    return target_frame.transformed(T_safe)


# ==================================================
# 5. PICKUP BRICK
# ==================================================

def pickup_brick(script, pick_frame):

    safe_frame = make_safe_frame(pick_frame)

    # Approach
    script += ur.move_l(
        safe_frame,
        accel=acceleration,
        vel=velocity
    )

    # Move to brick
    script += ur.move_l(
        pick_frame,
        accel=acceleration,
        vel=velocity
    )

    # Vacuum ON / Gripper CLOSED
    script += ur.set_digital_out(IO, True)
    script += ur.sleep(0.8)

    # Retreat
    script += ur.move_l(
        safe_frame,
        accel=acceleration,
        vel=velocity
    )

    frames = [
        safe_frame,
        pick_frame,
        safe_frame
    ]

    return script, frames


# ==================================================
# 6. PLACE BRICK
# ==================================================

def place_brick(script, place_frame):

    safe_frame = make_safe_frame(place_frame)

    # Approach
    script += ur.move_l(
        safe_frame,
        accel=acceleration,
        vel=velocity
    )

    # Move to destination
    script += ur.move_l(
        place_frame,
        accel=acceleration,
        vel=velocity
    )

    # Vacuum OFF / Gripper OPEN
    script += ur.set_digital_out(IO, False)
    script += ur.sleep(0.8)

    # Retreat
    script += ur.move_l(
        safe_frame,
        accel=acceleration,
        vel=velocity
    )

    frames = [
        safe_frame,
        place_frame,
        safe_frame
    ]

    return script, frames


# ==================================================
# 7. CALCULATE TRAY PICK FRAME
# ==================================================

def get_tray_pick_frame(i):

    layer_capacity = COLS * ROWS

    col = i % COLS
    row = (i // COLS) % ROWS
    layer = i // layer_capacity

    dx = col * BRICK_BREADTH
    dy = row * BRICK_LENGTH
    dz = layer * BRICK_HEIGHT

    brick_point = (
        tray_origin.point
        + tray_origin.xaxis * dx
        + tray_origin.yaxis * dy
        - tray_origin.zaxis * dz
    )

    return Frame(
        brick_point,
        tray_origin.xaxis,
        tray_origin.yaxis
    )


# ==================================================
# 8. VALIDATE INPUTS
# ==================================================

required_inputs = [
    "way_frames",
    "tray_origin",
    "slide_top_frame",
    "slide_bottom_frame",
    "tcp_measured",
    "tcp_gripper",
    "acceleration",
    "velocity",
    "gripper_rx_deg",
    "gripper_ry_deg",
    "gripper_rz_deg"
]

missing = [
    name for name in required_inputs
    if name not in globals() or globals()[name] is None
]

run_enabled = globals().get("run", False)


# ==================================================
# 9. MAIN PICK-AND-PLACE SEQUENCE
# ==================================================

if missing:

    out = "Missing inputs: " + ", ".join(missing)

elif not run_enabled:

    out = "Ready. Set run=True to generate script."

elif not way_frames:

    out = "No wall frames supplied."

else:

    max_capacity = COLS * ROWS * TOTAL_LAYERS

    # Initial TCP: VACUUM
    script += set_vacuum_tcp()

    # Vacuum OFF / Gripper OPEN
    script += ur.set_digital_out(IO, False)

    count = 0

    for i, place_frame in enumerate(way_frames):

        if i >= max_capacity:
            print("Tray capacity exceeded.")
            break

        # ------------------------------------------
        # STEP 1: PICK FROM TRAY WITH VACUUM
        # ------------------------------------------

        current_pick_frame = get_tray_pick_frame(i)

        script, frames = pickup_brick(
            script,
            current_pick_frame
        )

        vis_frames.extend(frames)

        # ------------------------------------------
        # STEP 2: DROP AT TOP OF SLIDE
        # ------------------------------------------

        script, frames = place_brick(
            script,
            slide_top_frame
        )

        vis_frames.extend(frames)

        # ------------------------------------------
        # STEP 3: WAIT FOR BRICK TO SLIDE
        # ------------------------------------------

        script += ur.sleep(SLIDE_WAIT)

        # ------------------------------------------
        # STEP 4: SWITCH TO GRIPPER TCP
        # ------------------------------------------

        script += set_gripper_tcp()

        # ------------------------------------------
        # STEP 5: PICK FROM BOTTOM OF SLIDE
        # ------------------------------------------

        script, frames = pickup_brick(
            script,
            slide_bottom_frame
        )

        vis_frames.extend(frames)

        # ------------------------------------------
        # STEP 6: PLACE BRICK AT WALL
        # ------------------------------------------

        script, frames = place_brick(
            script,
            place_frame
        )

        vis_frames.extend(frames)

        # ------------------------------------------
        # STEP 7: SWITCH BACK TO VACUUM TCP
        # ------------------------------------------

        script += set_vacuum_tcp()

        count += 1

    out = "Generated {} brick cycles.".format(count)

    # ----------------------------------------------
    # FORMAT ROBOT SCRIPT
    # ----------------------------------------------

    script = com.concatenate_script(script)


# ==================================================
# 10. VISUALIZE FRAMES IN RHINO
# ==================================================

for f in vis_frames:

    plane = rg.Plane(
        rg.Point3d(
            f.point.x,
            f.point.y,
            f.point.z
        ),
        rg.Vector3d(
            f.xaxis.x,
            f.xaxis.y,
            f.xaxis.z
        ),
        rg.Vector3d(
            f.yaxis.x,
            f.yaxis.y,
            f.yaxis.z
        )
    )

    vis_planes.append(plane)
# ---------- end compas_2 ----------
compas_draw_7 = COMPASDraw(cg=compas.vis_frames)  # -> rg; same code as compas_draw
compas_draw_8 = COMPASDraw(cg=compas.vis_planes)  # -> rg; same code as compas_draw
# Send to Robot!
polyline = PolyLine(Vertices=compas.vis_planes, Closed=False)
points = PointList(Points=compas.vis_planes, Size=Slider(0, range=0..100))
panel_3 = Panel(compas.script)

# ---- group: Send UR script to Robot!
py3_4 = Python3Script(script=compas.script, ip_address="192.168.10.10", send=Button())  # -> out, a; inputs script: String, ip_address: String, send: Boolean
# ---------- py3_4: Python ----------
import simple_comm as com

if send:
    com.send_script(script,ip_address)
# ---------- end py3_4 ----------
