# Grasshopper definition 101_brick_to_robot_Despoina_trials.gh (Grasshopper 1.0.8)

number_slider = Slider(30, range=0..100)  # disabled
lng = ListLength()  # disabled
number_slider_2 = Slider(594, range=0..1000)
number_slider_3 = Slider(420, range=0..1000)
rectangle = Rectangle(Plane=PlaneXY(0, 0, 0), XSize=number_slider_3, YSize=number_slider_2, Radius=0)  # -> Rectangle, Length
crv = Curve(rectangle.Rectangle)
rectangle_2 = Rectangle(Plane=PlaneXY(0, 0, 0), XSize=Slider(420, range=0..1000), YSize=Slider(594, range=0..1000), Radius=0)  # -> Rectangle, Length
crv_2 = Curve(rectangle_2.Rectangle)
crv_3 = Curve(<curve referenced from the Rhino model>)
gap = Slider(0.5, range=0..10)

# ---- group: This is needed only ONCE in the GH definition
enable_auto_reload = Python3Script()  # -> ok
# ---------- enable_auto_reload: Python ----------
"""
------------------------------
Using VS Code as Python editor
------------------------------

The simplest way to start using VS Code as our editor, is
to place our Python code in files located IN THE SAME FOLDER as our Grasshopper file.

After we have done that, we need 2 steps: 

1. Enable the COMPAS reloader on one component. This tells Grasshopper to watch for changes in the Pythoh files and reload if changed.
2. Every other component that uses Python code from external files needs to start with a method to ensure Grasshopper knows where to load the files from.

"""
# r: compas
# venv: mas-2627

from compas_rhino.devtools import DevTools
DevTools.enable_reloader()
# ---------- end enable_auto_reload ----------

# ----
gap_2 = Slider(3, range=0..10)
crv_4 = Curve(<curve referenced from the Rhino model>)
# Despoina Geometry
brick_wall = Python3Script(
    crv=crv_3,
    num_layers=Slider(7, range=0..30),
    gap=gap,
    work_x=number_slider_3,
    work_y=number_slider_2,
    work_area=crv,
    rotation=Slider(30, range=0..100))  # -> para, T, bricks, geometries, frames, work_area; inputs crv: Curve, num_layers: Int32, gap: Double, work_area: Polyline
# ---------- brick_wall: Python ----------
# r: compas
# venv: mas-2627

from compas_rhino.devtools import DevTools
DevTools.ensure_path()

import math
import ghpythonlib.treehelpers as th

from compas.geometry import (
    Point,
    Vector,
    Frame,
    Transformation,
    Rotation
)

from compas_rhino.conversions import (
    curve_to_compas,
    polyline_to_compas,
    polyline_to_rhino_curve
)

from brick_wall import Brick


# ----------------------------------------
# 1. INITIALIZATION
# ----------------------------------------

bricks = []
frames = []

# Convert Rhino geometry to COMPAS
work_area = polyline_to_compas(work_area)
crv = curve_to_compas(crv)

# Rotation input from Grasshopper
rotation_angle = (
    float(rotation)
    if rotation is not None
    else 45.0
)

# Pattern: (configuration, rotation)
pattern = [
    (0, 0),
    (1, rotation_angle),
    (0, 0),
    (1, rotation_angle),
    (1, -rotation_angle),
    (0, 0)
]


# ----------------------------------------
# 2. WORKSPACE TRANSFORMATION
# ----------------------------------------

work_pt = Point(
    work_x / 2,
    work_y / 2,
    0.0
)

work_f = Frame(
    work_pt,
    Vector.Xaxis(),
    Vector.Yaxis()
)

T = Transformation.from_frame_to_frame(
    Frame.worldXY(),
    work_f
)


# ----------------------------------------
# 3. FIXED BRICK POSITIONS
# ----------------------------------------

# Calculate positions only once
# All layers will use the same positions

base_spacing = Brick.LENGTH + gap

base_parameters, base_points = crv.divide_by_length(
    base_spacing,
    True
)

base_parameters = list(base_parameters)
base_points = list(base_points)

num_bricks = len(base_points)


# ----------------------------------------
# 4. GENERATE WALL
# ----------------------------------------

current_z = 0.0

for r in range(int(num_layers)):

    # Get configuration and rotation
    config, angle_deg = pattern[r % len(pattern)]

    # Determine layer dimensions
    if config == 0:
        layer_height = Brick.HEIGHT
    else:
        layer_height = Brick.WIDTH

    angle_rad = math.radians(angle_deg)

    # Same positions for every layer
    parameters = base_parameters
    points = base_points

    layer_bricks = []
    layer_frames = []

    # ------------------------------------
    # 5. CREATE EACH BRICK
    # ------------------------------------

    for param, pt in zip(parameters, points):

        # Tangent along curve
        tangent = crv.tangent_at(param)
        tangent.unitize()

        # Normal perpendicular to tangent
        normal = Vector.Zaxis().cross(tangent)
        normal.unitize()

        # Centre point of brick
        brick_pt = Point(
            pt.x,
            pt.y,
            current_z + layer_height / 2.0
        )

        # Create local brick frame
        brick_frame = Frame(
            brick_pt,
            tangent,
            normal
        )

        # Rotate around vertical Z axis
        if abs(angle_deg) > 1e-9:

            R = Rotation.from_axis_and_angle(
                Vector.Zaxis(),
                angle_rad,
                point=brick_pt
            )

            brick_frame.transform(R)

        # Transform to workspace
        final_frame = brick_frame.transformed(T)

        # Create brick
        brick = Brick(final_frame)

        # Apply brick configuration
        brick.configuration(config)

        # Store brick and frame
        layer_bricks.append(brick)
        layer_frames.append(final_frame)

    bricks.append(layer_bricks)
    frames.append(layer_frames)

    # Increase height for next layer
    current_z += layer_height


# ----------------------------------------
# 6. OUTPUTS
# ----------------------------------------

work_area = polyline_to_rhino_curve(
    work_area
)

geometries = th.list_to_tree([
    [b.draw() for b in layer]
    for layer in bricks
])

frames = th.list_to_tree(frames)
# ---------- end brick_wall ----------
# Despoina Geometry_2
brick_wall_2 = Python3Script(
    crv=crv_4,
    num_layers=Slider(7, range=0..30),
    gap=gap_2,
    work_x=number_slider_3,
    work_y=number_slider_2,
    work_area=crv,
    rotation=Slider(30, range=0..100))  # -> para, T, bricks, geometries, frames, work_area; inputs crv: Curve, num_layers: Int32, gap: Double, work_area: Polyline
# ---------- brick_wall_2: Python ----------
# r: compas
# venv: mas-2627

from compas_rhino.devtools import DevTools
DevTools.ensure_path()

import math
import Rhino.Geometry as rg
import ghpythonlib.treehelpers as th

from compas.geometry import (
    Point, Vector, Frame,
    Transformation, Rotation
)

from compas_rhino.conversions import (
    polyline_to_compas,
    polyline_to_rhino_curve
)

from brick_wall import Brick


# ========================================
# 1. PARAMETERS
# ========================================

# IMPORTANT:
# Rhino units must match Brick dimensions.
#
# If Brick dimensions are in cm but Rhino
# is in mm, change brick_wall.py to:
#
# LENGTH = 320.0
# WIDTH  = 152.0
# HEIGHT = 98.5
#
# Do not scale twice.

rotation_angle = (
    float(rotation)
    if rotation is not None
    else 45.0
)

gap = float(gap)
num_layers = min(6, max(0, int(num_layers)))

# Pattern:
# configuration, angle, stagger

pattern = [
    (0, 0.0, 0.0),
    (0, 0.0, 0.5),
    (1, rotation_angle, 0.0),
    (0, 0.0, 0.0),
    (0, 0.0, 0.5),
    (1, -rotation_angle, 0.0)
]

# Extra space for diagonal bricks
diagonal_extra_gap = 0.0

# Minimum supported footprint fraction
# Only a preliminary geometric threshold
min_support_ratio = 0.65

# Minimum edge margin for projected centre
support_margin = 0.0

bricks = []
frames = []
layer_configs = []
support_ratios = []
warnings = []


# ========================================
# 2. WORKSPACE
# ========================================

work_area_compas = polyline_to_compas(
    work_area
)

work_pt = Point(
    work_x / 2.0,
    work_y / 2.0,
    0.0
)

work_f = Frame(
    work_pt,
    Vector.Xaxis(),
    Vector.Yaxis()
)

T = Transformation.from_frame_to_frame(
    Frame.worldXY(),
    work_f
)


# ========================================
# 3. CURVE SAMPLING
# ========================================

# Use original Rhino curve input
rhino_crv = crv

curve_length = rhino_crv.GetLength()

if curve_length <= 0:
    raise ValueError("Curve length must be positive.")


def sample_curve(distance):

    success, parameter = (
        rhino_crv.LengthParameter(distance)
    )

    if not success:
        return None, None

    p = rhino_crv.PointAt(parameter)
    t = rhino_crv.TangentAt(parameter)

    # The wall is assumed to be planar in XY.
    tangent = Vector(t.X, t.Y, 0.0)

    if tangent.length < 1e-9:
        return None, None

    tangent.unitize()

    pt = Point(p.X, p.Y, p.Z)

    return pt, tangent


# ========================================
# 4. GEOMETRY HELPERS
# ========================================

def brick_corners_xy(brick):

    f = brick.frame

    corners = []

    for sx, sy in [
        (-1, -1),
        (1, -1),
        (1, 1),
        (-1, 1)
    ]:

        x = (
            f.point.x
            + sx * brick.length / 2.0 * f.xaxis.x
            + sy * brick.width / 2.0 * f.yaxis.x
        )

        y = (
            f.point.y
            + sx * brick.length / 2.0 * f.xaxis.y
            + sy * brick.width / 2.0 * f.yaxis.y
        )

        corners.append((x, y))

    return corners


def polygon_area(poly):

    area = 0.0

    for i in range(len(poly)):
        x1, y1 = poly[i]
        x2, y2 = poly[(i + 1) % len(poly)]

        area += x1 * y2 - x2 * y1

    return abs(area) / 2.0


def signed_area(poly):

    result = 0.0

    for i in range(len(poly)):
        x1, y1 = poly[i]
        x2, y2 = poly[(i + 1) % len(poly)]

        result += x1 * y2 - x2 * y1

    return result / 2.0


def polygon_clip(subject, clip):

    # Convex polygon clipping
    # Sutherland-Hodgman algorithm

    if not subject or not clip:
        return []

    orientation = (
        1.0 if signed_area(clip) >= 0
        else -1.0
    )

    def cross(a, b, p):
        return (
            (b[0] - a[0]) * (p[1] - a[1])
            - (b[1] - a[1]) * (p[0] - a[0])
        )

    def inside(p, a, b):
        return orientation * cross(a, b, p) >= -1e-8

    def intersection(s, e, a, b):

        dx1 = e[0] - s[0]
        dy1 = e[1] - s[1]

        dx2 = b[0] - a[0]
        dy2 = b[1] - a[1]

        den = dx1 * dy2 - dy1 * dx2

        if abs(den) < 1e-12:
            return e

        qx = a[0] - s[0]
        qy = a[1] - s[1]

        t = (qx * dy2 - qy * dx2) / den

        return (
            s[0] + t * dx1,
            s[1] + t * dy1
        )

    output = list(subject)

    for i in range(len(clip)):

        a = clip[i]
        b = clip[(i + 1) % len(clip)]

        input_poly = output
        output = []

        if not input_poly:
            break

        s = input_poly[-1]

        for e in input_poly:

            e_inside = inside(e, a, b)
            s_inside = inside(s, a, b)

            if e_inside:

                if not s_inside:
                    output.append(
                        intersection(s, e, a, b)
                    )

                output.append(e)

            elif s_inside:

                output.append(
                    intersection(s, e, a, b)
                )

            s = e

    return output


def overlap_area(brick_a, brick_b):

    pa = brick_corners_xy(brick_a)
    pb = brick_corners_xy(brick_b)

    intersection = polygon_clip(pa, pb)

    if len(intersection) < 3:
        return 0.0

    return polygon_area(intersection)


# ========================================
# 5. SUPPORT CHECK
# ========================================

def check_support(brick, previous_layer):

    if not previous_layer:
        return 0.0, False

    footprint = brick_corners_xy(brick)

    brick_area = polygon_area(footprint)

    if brick_area <= 1e-9:
        return 0.0, False

    # Sum contact areas with bricks below.
    # Assumes bricks in previous layer
    # have non-overlapping footprints.

    total_contact = 0.0
    contact_polygons = []

    for lower in previous_layer:

        lower_poly = brick_corners_xy(lower)

        intersection = polygon_clip(
            footprint,
            lower_poly
        )

        if len(intersection) >= 3:

            area = polygon_area(intersection)

            if area > 1e-8:
                total_contact += area
                contact_polygons.append(
                    intersection
                )

    ratio = min(
        1.0,
        total_contact / brick_area
    )

    # Centre projection must lie inside
    # at least one contact polygon.
    # This is a conservative geometric
    # approximation, not a stability proof.

    centre = (
        brick.frame.point.x,
        brick.frame.point.y
    )

    def point_in_convex(poly, p):

        if len(poly) < 3:
            return False

        sign = (
            1.0 if signed_area(poly) >= 0
            else -1.0
        )

        for i in range(len(poly)):

            a = poly[i]
            b = poly[(i + 1) % len(poly)]

            edge_length = math.hypot(
                b[0] - a[0],
                b[1] - a[1]
            )

            if edge_length < 1e-9:
                continue

            cross_value = (
                (b[0] - a[0]) * (p[1] - a[1])
                - (b[1] - a[1]) * (p[0] - a[0])
            )

            distance = (
                sign * cross_value / edge_length
            )

            if distance < support_margin:
                return False

        return True

    centre_supported = any(
        point_in_convex(poly, centre)
        for poly in contact_polygons
    )

    valid = (
        ratio >= min_support_ratio
        and centre_supported
    )

    return ratio, valid


# ========================================
# 6. GENERATE WALL
# ========================================

current_z = 0.0

for r in range(num_layers):

    config, angle_deg, stagger = pattern[r]

    if config == 0:
        layer_height = Brick.HEIGHT
        layer_width = Brick.WIDTH
    else:
        layer_height = Brick.WIDTH
        layer_width = Brick.HEIGHT

    angle_rad = math.radians(angle_deg)

    projected_length = (
        abs(Brick.LENGTH * math.cos(angle_rad))
        + abs(layer_width * math.sin(angle_rad))
    )

    spacing = projected_length + gap

    if config == 1:
        spacing += diagonal_extra_gap

    # Shift alternate horizontal rows
    distance = (
        spacing / 2.0
        + stagger * (Brick.LENGTH + gap)
    )

    layer_bricks = []
    layer_frames = []
    layer_support = []

    brick_index = 0

    while distance <= curve_length - spacing / 2.0:

        pt, tangent = sample_curve(distance)

        if pt is None:
            break

        normal = Vector.Zaxis().cross(tangent)
        normal.unitize()

        centre = Point(
            pt.x,
            pt.y,
            current_z + layer_height / 2.0
        )

        brick_frame = Frame(
            centre,
            tangent,
            normal
        )

        if abs(angle_deg) > 1e-9:

            R = Rotation.from_axis_and_angle(
                Vector.Zaxis(),
                angle_rad,
                point=centre
            )

            brick_frame.transform(R)

        final_frame = brick_frame.transformed(T)

        brick = Brick(final_frame)
        brick.configuration(config)

        # Check overlap within same layer
        clash = any(
            overlap_area(brick, other) > 1e-6
            for other in layer_bricks
        )

        if clash:

            warnings.append(
                "Layer {} brick {}: collision".format(
                    r + 1,
                    brick_index + 1
                )
            )

        # Check support
        if r == 0:

            ratio = 1.0
            supported = True

        else:

            ratio, supported = check_support(
                brick,
                bricks[r - 1]
            )

            if not supported:

                warnings.append(
                    "Layer {} brick {}: "
                    "insufficient support ({:.1f}%)".format(
                        r + 1,
                        brick_index + 1,
                        ratio * 100.0
                    )
                )

        layer_bricks.append(brick)
        layer_frames.append(final_frame)
        layer_support.append(ratio)

        distance += spacing
        brick_index += 1

    bricks.append(layer_bricks)
    frames.append(layer_frames)
    layer_configs.append(config)
    support_ratios.append(layer_support)

    current_z += layer_height


# ========================================
# 7. OUTPUTS
# ========================================

work_area = polyline_to_rhino_curve(
    work_area_compas
)

geometries = th.list_to_tree([
    [b.draw() for b in layer]
    for layer in bricks
])

frames = th.list_to_tree(frames)

support_ratios = th.list_to_tree(
    support_ratios
)

total_height = current_z

# This flag is only a geometry diagnostic.
# It does NOT certify structural stability.
geometry_check_passed = (len(warnings) == 0)
# ---------- end brick_wall_2 ----------
compas_draw = COMPASDraw(cg=brick_wall.geometries)  # -> rg
#   port cg: The COMPAS geometry or datastructure to be drawn.
#   port rg: The Rhino geometry object.
# ---------- compas_draw: Python ----------
# r: compas>=2.14.1
"""
Draws COMPAS geometry in Grasshopper.
"""

from typing import Any

import Grasshopper

from compas.scene import SceneObject


class CompasToRhinoGeometry(Grasshopper.Kernel.GH_ScriptInstance):
    def RunScript(self, cg):
        if not cg:
            return None

        return SceneObject(item=cg).draw()
# ---------- end compas_draw ----------
compas_draw_2 = COMPASDraw(cg=brick_wall.frames)  # -> rg; same code as compas_draw
crv_5 = Curve(brick_wall.work_area)
compas_draw_3 = COMPASDraw(cg=brick_wall_2.frames)  # -> rg; same code as compas_draw
compas_draw_4 = COMPASDraw(cg=brick_wall_2.geometries)  # -> rg; same code as compas_draw

# ---- group: IP ADDRESS
panel = Panel("192.168.10.10")

# ----
# Measure work object
capture = Button()
point = ValueList({"origin", "xaxis", "xypoint"}, selected="xypoint")
capture_wobj = CaptureWobj(robot_ip=panel, point_name=point, capture=capture)  # -> wobj_origin, wobj_xaxis, wobj_xypoint, info
# ---------- capture_wobj: Python ----------
"""
Capture the 3 points that define the work object (robot base) plane.

Jog the TCP to a point, pick its name (origin / xaxis / xypoint) and press capture.
The TCP position (robot base frame, mm) is saved to wobj_calibration.json next to
this .ghx file, so the points survive closing Grasshopper.
"""
import os
import sys
import json
import time

import scriptcontext as sc
import Rhino.Geometry as rg

NAMES = ["origin", "xaxis", "xypoint"]

gh_dir = os.path.dirname(ghenv.Component.OnPingDocument().FilePath)
src_dir = os.path.join(gh_dir, "src")
if src_dir not in sys.path:
    sys.path.append(src_dir)
import simple_comm as com

path = os.path.join(gh_dir, "wobj_calibration.json")

data = {}
if os.path.exists(path):
    with open(path) as f:
        data = json.load(f)

# keep the last status in sticky, so the message survives the button being released
status_key = "capture_status_" + str(ghenv.Component.InstanceGuid)

if capture:
    if point_name not in NAMES:
        sc.sticky[status_key] = "pick origin / xaxis / xypoint"
    else:
        try:
            x, y, z = list(com.listen_to_robot(robot_ip)["pose"])[:3]  # metres, robot base frame
            data[point_name] = [round(x * 1000, 2), round(y * 1000, 2), round(z * 1000, 2)]  # -> mm
            with open(path, "w") as f:
                json.dump(data, f, indent=2)
            sc.sticky[status_key] = "{} captured {}".format(point_name, time.strftime("%H:%M:%S"))
        except Exception as e:
            print(e)
            sc.sticky[status_key] = "robot not reachable"

ghenv.Component.Message = sc.sticky.get(status_key, "")

def pt(name):
    return rg.Point3d(*data[name]) if name in data else None

wobj_origin, wobj_xaxis, wobj_xypoint = pt("origin"), pt("xaxis"), pt("xypoint")
info = json.dumps(data, indent=2)
# ---------- end capture_wobj ----------
wobj_calibration = Panel(capture_wobj.info)

# ----
# Measure pick up location
point_2 = ValueList({"origin", "xaxis", "xypoint"}, selected="xypoint")
capture_2 = Button()
capture_pick = CapturePick(robot_ip=panel, point_name=point_2, capture=capture_2)  # -> origin, xaxis_pt, xy_pt, info
# ---------- capture_pick: Python ----------
"""
Capture the 3 points that define the pick frame at the brick pick-up location.

Jog the TCP to a point, pick its name (origin / xaxis / xypoint) and press capture.
The TCP position (robot base frame, mm) is saved to pick_calibration.json next to
this .ghx file, so the points survive closing Grasshopper.
"""
import os
import sys
import json
import time

import scriptcontext as sc
import Rhino.Geometry as rg

NAMES = ["origin", "xaxis", "xypoint"]

gh_dir = os.path.dirname(ghenv.Component.OnPingDocument().FilePath)
src_dir = os.path.join(gh_dir, "src")
if src_dir not in sys.path:
    sys.path.append(src_dir)
import simple_comm as com

path = os.path.join(gh_dir, "pick_tray_calibration.json")

data = {}
if os.path.exists(path):
    with open(path) as f:
        data = json.load(f)

# keep the last status in sticky, so the message survives the button being released
status_key = "capture_status_" + str(ghenv.Component.InstanceGuid)

if capture:
    if point_name not in NAMES:
        sc.sticky[status_key] = "pick origin / xaxis / xypoint"
    else:
        try:
            x, y, z = list(com.listen_to_robot(robot_ip)["pose"])[:3]  # metres, robot base frame
            data[point_name] = [round(x * 1000, 2), round(y * 1000, 2), round(z * 1000, 2)]  # -> mm
            with open(path, "w") as f:
                json.dump(data, f, indent=2)
            sc.sticky[status_key] = "{} captured {}".format(point_name, time.strftime("%H:%M:%S"))
        except Exception as e:
            print(e)
            sc.sticky[status_key] = "robot not reachable"

ghenv.Component.Message = sc.sticky.get(status_key, "")

def pt(name):
    return rg.Point3d(*data[name]) if name in data else None

origin, xaxis_pt, xy_pt = pt("origin"), pt("xaxis"), pt("xypoint")
info = json.dumps(data, indent=2)
# ---------- end capture_pick ----------
pick_calibration = Panel(capture_pick.info)

# ----
# Measure slide top location
point_3 = ValueList({"origin", "xaxis", "xypoint"}, selected="xypoint")
capture_3 = Button()
capture_pick_2 = CapturePick(robot_ip=panel, point_name=point_3, capture=capture_3)  # -> origin, xaxis_pt, xy_pt, info
# ---------- capture_pick_2: Python ----------
"""
Capture the 3 points that define the pick frame at the brick pick-up location.

Jog the TCP to a point, pick its name (origin / xaxis / xypoint) and press capture.
The TCP position (robot base frame, mm) is saved to pick_calibration.json next to
this .ghx file, so the points survive closing Grasshopper.
"""
import os
import sys
import json
import time

import scriptcontext as sc
import Rhino.Geometry as rg

NAMES = ["origin", "xaxis", "xypoint"]

gh_dir = os.path.dirname(ghenv.Component.OnPingDocument().FilePath)
src_dir = os.path.join(gh_dir, "src")
if src_dir not in sys.path:
    sys.path.append(src_dir)
import simple_comm as com

path = os.path.join(gh_dir, "place_slide_calibration.json")

data = {}
if os.path.exists(path):
    with open(path) as f:
        data = json.load(f)

# keep the last status in sticky, so the message survives the button being released
status_key = "capture_status_" + str(ghenv.Component.InstanceGuid)

if capture:
    if point_name not in NAMES:
        sc.sticky[status_key] = "pick origin / xaxis / xypoint"
    else:
        try:
            x, y, z = list(com.listen_to_robot(robot_ip)["pose"])[:3]  # metres, robot base frame
            data[point_name] = [round(x * 1000, 2), round(y * 1000, 2), round(z * 1000, 2)]  # -> mm
            with open(path, "w") as f:
                json.dump(data, f, indent=2)
            sc.sticky[status_key] = "{} captured {}".format(point_name, time.strftime("%H:%M:%S"))
        except Exception as e:
            print(e)
            sc.sticky[status_key] = "robot not reachable"

ghenv.Component.Message = sc.sticky.get(status_key, "")

def pt(name):
    return rg.Point3d(*data[name]) if name in data else None

origin, xaxis_pt, xy_pt = pt("origin"), pt("xaxis"), pt("xypoint")
info = json.dumps(data, indent=2)
# ---------- end capture_pick_2 ----------
pick_calibration_2 = Panel(capture_pick_2.info)

# ----
# Measure slide bottom location 1
point_4 = ValueList({"origin", "xaxis", "xypoint"}, selected="xypoint")
capture_4 = Button()
capture_pick_3 = CapturePick(robot_ip=panel, point_name=point_4, capture=capture_4)  # -> origin, xaxis_pt, xy_pt, info
# ---------- capture_pick_3: Python ----------
"""
Capture the 3 points that define the pick frame at the brick pick-up location.

Jog the TCP to a point, pick its name (origin / xaxis / xypoint) and press capture.
The TCP position (robot base frame, mm) is saved to pick_calibration.json next to
this .ghx file, so the points survive closing Grasshopper.
"""
import os
import sys
import json
import time

import scriptcontext as sc
import Rhino.Geometry as rg

NAMES = ["origin", "xaxis", "xypoint"]

gh_dir = os.path.dirname(ghenv.Component.OnPingDocument().FilePath)
src_dir = os.path.join(gh_dir, "src")
if src_dir not in sys.path:
    sys.path.append(src_dir)
import simple_comm as com

path = os.path.join(gh_dir, "pick_slide_calibration_1.json")

data = {}
if os.path.exists(path):
    with open(path) as f:
        data = json.load(f)

# keep the last status in sticky, so the message survives the button being released
status_key = "capture_status_" + str(ghenv.Component.InstanceGuid)

if capture:
    if point_name not in NAMES:
        sc.sticky[status_key] = "pick origin / xaxis / xypoint"
    else:
        try:
            x, y, z = list(com.listen_to_robot(robot_ip)["pose"])[:3]  # metres, robot base frame
            data[point_name] = [round(x * 1000, 2), round(y * 1000, 2), round(z * 1000, 2)]  # -> mm
            with open(path, "w") as f:
                json.dump(data, f, indent=2)
            sc.sticky[status_key] = "{} captured {}".format(point_name, time.strftime("%H:%M:%S"))
        except Exception as e:
            print(e)
            sc.sticky[status_key] = "robot not reachable"

ghenv.Component.Message = sc.sticky.get(status_key, "")

def pt(name):
    return rg.Point3d(*data[name]) if name in data else None

origin, xaxis_pt, xy_pt = pt("origin"), pt("xaxis"), pt("xypoint")
info = json.dumps(data, indent=2)
# ---------- end capture_pick_3 ----------
pick_calibration_3 = Panel(capture_pick_3.info)

# ----
# Measure slide bottom location 2
point_5 = ValueList({"origin", "xaxis", "xypoint"}, selected="xypoint")
capture_5 = Button()
capture_pick_4 = CapturePick(robot_ip=panel, point_name=point_5, capture=capture_5)  # -> origin, xaxis_pt, xy_pt, info; same code as capture_pick_3
pick_calibration_4 = Panel(capture_pick_4.info)

py3 = Python3Script(list_len=lng, no_per_row=number_slider, origin=capture_pick.origin)  # -> out, no_row, tray_grid; disabled
# ---------- py3: Python ----------
import math as m
import Rhino.Geometry as rg
from brick_wall import Brick

no_row = list_len//no_per_row + 1
b_h = Brick().HEIGHT
b_l = Brick().LENGTH
b_w = Brick().WIDTH
# ---------- end py3 ----------
crv_6 = Curve(brick_wall_2.work_area)

# ---- group: Origin
pt = ConstructPoint(XCoordinate="-35.73", YCoordinate="393.10", ZCoordinate="200.65")

pt_2 = ConstructPoint(XCoordinate="-139.76", YCoordinate="282.1", ZCoordinate="88.57")

# ---- group: xaxis
pt_3 = ConstructPoint(XCoordinate="-140.29", YCoordinate="297.79", ZCoordinate="89.42")

# ---- group: yaxis
pt_4 = ConstructPoint(XCoordinate="-136.12", YCoordinate="282.35", ZCoordinate="82.19")

# ---- group: Origin
pt_5 = ConstructPoint(XCoordinate="-131.59", YCoordinate="283.06", ZCoordinate="75.46")

# ---- group: xaxis
pt_6 = ConstructPoint(XCoordinate="-130.97", YCoordinate="298.06", ZCoordinate="75.38")

# ---- group: yaxis
pt_7 = ConstructPoint(XCoordinate="-128.56", YCoordinate="253.3", ZCoordinate="68.46")

# ---- group: Origin
pt_8 = ConstructPoint(XCoordinate="-135.14", YCoordinate="281.07", ZCoordinate="75.86")

# ---- group: yaxis
pt_9 = ConstructPoint(XCoordinate="-129.52", YCoordinate="283.06", ZCoordinate="78.75")

# ---- group: xaxis
pt_10 = ConstructPoint(XCoordinate="-134.99", YCoordinate="296.40", ZCoordinate="76.52")

pt_11 = ConstructPoint(XCoordinate="60.31", YCoordinate="392.86", ZCoordinate="200.15")

# ---- group: yaxis
pt_12 = ConstructPoint(XCoordinate="-36.81", YCoordinate="517.32", ZCoordinate="200.39")

# ----
# Measure and set TCP Gripper
panel_2 = Panel("0.12")
pt_13 = ConstructPoint(XCoordinate=panel_2, YCoordinate="0.64", ZCoordinate="121.84")

# ----
# Measure and set TCP Suction
panel_3 = Panel("-65.64")
pt_14 = ConstructPoint(XCoordinate=panel_3, YCoordinate="35.36", ZCoordinate="96.7")

# ---- group: Origin
pt_15 = ConstructPoint(XCoordinate="534.15", YCoordinate="530.96", ZCoordinate="-9.26")

# ---- group: xaxis
pt_16 = ConstructPoint(XCoordinate="113.63", YCoordinate="528.18", ZCoordinate="-8.75")

# ---- group: yaxis
# Measure work object
panel_4 = Panel("-9.72")
pt_17 = ConstructPoint(XCoordinate="535.01", YCoordinate="325.62", ZCoordinate=panel_4)

# ----
# Measure pick up location
# Measure pick up location
py3_2 = Python3Script(origin=pt, xaxis_pt=pt_11, xy_pt=pt_12)  # -> out, pick_frame; inputs origin: Point3d, xaxis_pt: Point3d, xy_pt: Point3d
# ---------- py3_2: Python ----------
from compas.geometry import Frame, Point
from compas.geometry import Rotation

from compas_rhino.conversions import point_to_compas

origin = point_to_compas(origin)
xaxis_pt = point_to_compas(xaxis_pt)
xy_pt = point_to_compas(xy_pt)

#define pick frame
pick_frame = Frame(origin, -(xaxis_pt - origin), xy_pt - origin)
# ---------- end py3_2 ----------
compas_draw_5 = COMPASDraw(cg=py3_2.pick_frame)  # -> rg; same code as compas_draw

# ----
# Measure slide top location
py3_3 = Python3Script(origin=pt_2, xaxis_pt=pt_3, xy_pt=pt_4)  # -> out, pick_frame; inputs origin: Point3d, xaxis_pt: Point3d, xy_pt: Point3d
# ---------- py3_3: Python ----------
from compas.geometry import Frame, Point
from compas.geometry import Rotation

from compas_rhino.conversions import point_to_compas

origin = point_to_compas(origin)
xaxis_pt = point_to_compas(xaxis_pt)
xy_pt = point_to_compas(xy_pt)

#define pick frame
pick_frame = Frame(origin, xaxis_pt - origin, xy_pt - origin)
# ---------- end py3_3 ----------
compas_draw_6 = COMPASDraw(cg=py3_3.pick_frame)  # -> rg; same code as compas_draw

# ----
# Measure slide bottom location 1
# (for configuration 1)
py3_4 = Python3Script(origin=pt_5, xaxis_pt=pt_6, xy_pt=pt_7)  # -> out, pick_frame; inputs origin: Point3d, xaxis_pt: Point3d, xy_pt: Point3d; same code as py3_3
compas_draw_7 = COMPASDraw(cg=py3_4.pick_frame)  # -> rg; same code as compas_draw

# ----
# Measure slide bottom location 2
# (for configuration 2)
py3_5 = Python3Script(origin=pt_8, xaxis_pt=pt_10, xy_pt=pt_9)  # -> out, pick_frame; inputs origin: Point3d, xaxis_pt: Point3d, xy_pt: Point3d; same code as py3_3
compas_draw_8 = COMPASDraw(cg=py3_5.pick_frame)  # -> rg; same code as compas_draw

# ----
# Transform from Rhino to Robot Space
# Insert way_planes as grasshopper tree
fine_adjust_z_mm = Slider(5, range=-5..100)
transform_geom = Python3Script(way_planes=brick_wall.frames, wobj_origin=pt_15, wobj_xaxis=pt_16, wobj_xypoint=pt_17, z_safe_margin=fine_adjust_z_mm)  # -> out, transformed_frames; inputs way_planes: tree, wobj_origin: Point3d, wobj_xaxis: Point3d, wobj_xypoint: Point3d, z_safe_margin: Double
# ---------- transform_geom: Python ----------
from compas.geometry import Frame, Transformation, Translation, Vector, Rotation
import math as m
from ghpythonlib import treehelpers as th
#in this step we transform our way planes to robot space
#the rhino co-ordinate system is rather abstract in the physical world
#the robot base plane assumed the base frame of robot is the origin
#but rhino does not know that
#thus we transform things from our design space(Rhino World XY) to Robot Base Plane that we measure

def set_robot_base(origin, xaxis, xypoint):
    """
    set a base plane representing the robot working object plane
    """
    robot_base = Frame(origin, xaxis - origin, xypoint - origin)
    return (robot_base)

def rhino_to_robot_space(rhino_plane,robot_base_plane):
    """
    Transform the objects from Rhino world XY plane to robot work object plane
    """
    T_matrix = Transformation.from_frame_to_frame(Frame.worldXY(), robot_base_plane)
    robot_plane = rhino_plane.transformed(T_matrix)
    robot_plane = robot_plane.rotated(m.pi,robot_plane.yaxis, robot_plane.point)
    # rotates plane by 180 degress around y axis
    return robot_plane

def set_z_safe_margin(planes_to_adjust, safety_margin):
    adjusted = []
    T = Translation.from_vector(Vector(0, 0, safety_margin))
    for f in planes_to_adjust:
        adjusted.append(f.transformed(T))
    return adjusted

# ===== Tree conversion to List =====
way_planes = th.tree_to_list(way_planes)

# ===== Robot base is set =====
robot_base =  set_robot_base(wobj_origin, wobj_xaxis, wobj_xypoint)

# ===== Set safety margin for Z height ======
safe_planes = [set_z_safe_margin(wy, z_safe_margin) for wy in way_planes]

# ===== Transforming the rhino planes into robot planes =====
transformed_frames = []
for plane in safe_planes: 
    sub_transformed = []
    for pln in plane:
        sub_transformed.append(rhino_to_robot_space(pln, robot_base))
    transformed_frames.append(sub_transformed)

transformed_frames = th.list_to_tree(transformed_frames)
# ---------- end transform_geom ----------
compas_draw_9 = COMPASDraw(cg=transform_geom.transformed_frames)  # -> rg; same code as compas_draw

orientation_setter = Python3Script(frame_list=transform_geom.transformed_frames)  # -> out, branch_count, orientation; inputs frame_list: tree
# ---------- orientation_setter: Python ----------
import ghpythonlib.treehelpers as th

frame_list = th.tree_to_list(frame_list)

branch_count = len(frame_list)

# Gripper orientation for each layer
pattern = [0, 1, 0, 1, 1, 0]

orientation = [
    pattern[n % len(pattern)]
    for n in range(branch_count)
]
# ---------- end orientation_setter ----------
py3_6 = Python3Script(origin_frame=py3_2.pick_frame, levels=Slider(20, range=0..100))  # -> out, brick_frame, pick_frames; inputs levels: Int32
# ---------- py3_6: Python ----------
from brick_wall import Brick
import math as m
from compas.geometry import Vector


COLS = 4
ROWS = 9
LAYER_CAPACITY = COLS * ROWS - 1

pick_frames = []

for i in range(LAYER_CAPACITY * levels):

    layer = i // LAYER_CAPACITY
    index = i % LAYER_CAPACITY

    col = index % COLS
    row = index // COLS
    dx = -col * Brick.LENGTH
    dy = row * Brick.WIDTH
    dz = -layer * Brick.HEIGHT

    brick_frame = origin_frame.copy()
    brickpt = brick_frame.point

    brick_frame.point += (
        origin_frame.xaxis * dx
        + origin_frame.yaxis * dy
        + Vector(0, 0, dz)
    )

    # brick = Brick(brick_frame)
    pick_frames.append(brick_frame)
# ---------- end py3_6 ----------
number_slider_4 = Slider(0.8, range=0..5)
number_slider_5 = Slider(0.8, range=0..5)
compas_draw_10 = COMPASDraw(cg=py3_6.brick_frame)  # -> rg; same code as compas_draw
compas_draw_11 = COMPASDraw(cg=py3_6.pick_frames)  # -> rg; same code as compas_draw
compas = Python3Script(
    way_frames=transform_geom.transformed_frames,
    orientation=orientation_setter.orientation,
    safe_distance=Slider(50, range=0..500),
    tcp_measured=pt_14,
    tcp2_measured=pt_13,
    acceleration=number_slider_4,
    velocity=number_slider_5,
    pick_frame=py3_6.pick_frames,
    place_slide_frame=py3_3.pick_frame,
    pick_slide_frame=py3_4.pick_frame,
    pick_slide_2_frame=py3_5.pick_frame,
    sleep_time=Slider(0.4, range=0..1),
    press_f=Slider(0.9, range=0..2))  # -> out, vis_frames, vis_planes, script; inputs way_frames: tree, orientation: list, safe_distance: Double, tcp_measured: Point3d, acceleration: Double, velocity: Double, pick_frame: list, sleep_time: Double, press_f: Double
# ---------- compas: Python ----------
from imp import reload
import sys
import os
import ghpythonlib.treehelpers as th

#get current file path
path = ghenv.Component.OnPingDocument().FilePath
#get parent directory of the parent directory
parentdir = os.path.dirname(path)
#get src folder which contains classes
dire = os.path.join(parentdir,'src')

sys.path.append(dire)

import simple_ur_script as ur
reload(ur)

import utils 
reload(utils)

import simple_comm as com
reload(com)

import compas.geometry as cg
import math as m

# ===== Set global constants =======

IO = 4 # Global constant
# IO Off: Gripper Closed, Suction Off
# IO On: Gripper Open, Suction On
# check IO number before setting

SAFE_DIST = safe_distance
SUCTION_ANGLES = (
    m.radians(-30.0),
    m.radians(0.0),
    m.radians(45.0)
)
GRIPPER_ANGLES_ONE = (
    m.radians(0.0),
    m.radians(0.0),
    m.radians(45.0)
)
GRIPPER_ANGLES_TWO = (
    m.radians(0.0),
    m.radians(0.0),
    m.radians(45.0)
)

script = ''
vis_frames = []

# =================================

def set_suction_tcp(script):
    """Set TCP to Vacuum Suction Tool Tip"""
    suction_script = ""
    suction_script += ur.set_tcp_by_angles(
        tcp_measured.X,
        tcp_measured.Y,
        tcp_measured.Z,
        *SUCTION_ANGLES
    )
    suction_script += ur.sleep(sleep_time) 
    return suction_script

def set_gripper_tcp(script, ori):
    """Set TCP to Gripper Tool Tip"""
    gripper_ang = GRIPPER_ANGLES_ONE if ori == 0 else GRIPPER_ANGLES_TWO
    gripper_script = ""
    gripper_script += ur.set_tcp_by_angles(
        tcp2_measured.X,
        tcp2_measured.Y,
        tcp2_measured.Z,
        *gripper_ang
    )
    gripper_script += ur.sleep(sleep_time) 
    return gripper_script

def safety_frame(frame, safety_distance):
    return frame.translated(frame.zaxis * -safety_distance)
    # negative zaxis since robot frame is pointing down

def suction_press(frame):
    return frame.translated(frame.zaxis * press_f)
    # we keep this positive as we want this to go down onto the brick

def reset_frame(script):
    reset_script = ""
    # reset_script += ur.move_j([m.radians(-125.03), m.radians(-106.41), m.radians(63.78), m.radians(-43.07), m.radians(-83.56), m.radians(8.40)],1, 1)
    reset_script += ur.move_j([m.radians(-122.26), m.radians(-126.48), m.radians(83.87), m.radians(-45.03), m.radians(-86.12), m.radians(17.54)],1, 1)
    return reset_script

def pickup_brick_tray(script,pick_up_frame):
    
    pickbrick_script = ""
    # Move J in case of faulting
    pickbrick_script += reset_frame(script)
    # Translate frame to "safe" location
    above_pick_tray = safety_frame(pick_up_frame, SAFE_DIST)
    # Move to safe frame
    pickbrick_script += ur.move_l(above_pick_tray, acceleration, velocity)
    # Move to pick location
    pickbrick_script += ur.move_l(pick_up_frame, acceleration, velocity)
    # Move down a little to guarantee pick
    press_down = suction_press(pick_up_frame)
    pickbrick_script += ur.move_l(press_down, acceleration, velocity)
    # Add to the path: turn on the vacuum and wait 
    pickbrick_script += ur.set_digital_out(IO, True)
    pickbrick_script += ur.sleep(sleep_time)
    # Move back to safe plane
    pickbrick_script += ur.move_l(above_pick_tray, acceleration, velocity)
    # Move J in case of faulting
    pickbrick_script += reset_frame(script)  

    picktray_frames = [above_pick_tray, pick_up_frame, above_pick_tray]

    return pickbrick_script, picktray_frames

def place_brick_slide(script, place_slide_frame):
    
    placeslide_script = ""
    # Move J in case of faulting
    placeslide_script += reset_frame(script)
    # Safe frame for placing
    above_slide_top = safety_frame(place_slide_frame, SAFE_DIST)
    # Add to the path: go to the safe plane
    placeslide_script += ur.move_l(above_slide_top, acceleration, velocity)
    # Add to the path: go to the place plane
    placeslide_script += ur.move_l(place_slide_frame, acceleration, velocity)
    # Add to the path: turn off the vacuum and wait 
    placeslide_script += ur.set_digital_out(IO, False)
    placeslide_script += ur.sleep(sleep_time)
    # Add to the path: go back to the safe plane
    placeslide_script += ur.move_l(above_slide_top, acceleration, velocity)
    # Move J in case of faulting
    placeslide_script += reset_frame(script)   

    placeslide_frames = [above_slide_top, place_slide_frame, above_slide_top]

    return placeslide_script, placeslide_frames

def pick_brick_slide(script, f1, f2, orient):

    pick_slide_frame = f1 if orient == 0 else f2

    pickslide_script = ""
    # Safe frame for picking
    above_slide_bottom = safety_frame(pick_slide_frame, SAFE_DIST)
    # Add to the path: open gripper and wait
    pickslide_script += ur.set_digital_out(IO, True)
    pickslide_script += ur.sleep(sleep_time) 
    # Add to the path: go to the safe plane
    pickslide_script += ur.move_l(above_slide_bottom, acceleration, velocity)    
    # Add to the path: go to the place plane
    pickslide_script += ur.move_l(pick_slide_frame, acceleration, velocity)    
    # Add to the path: close gripper and wait
    pickslide_script += ur.set_digital_out(IO, False)
    pickslide_script += ur.sleep(sleep_time) 
    # Add to the path: go back to the safe plane
    pickslide_script += ur.move_l(above_slide_bottom, acceleration, velocity)
    # Move J in case of faulting
    pickslide_script += reset_frame(script)   
    
    pickslide_frames = [above_slide_bottom, pick_slide_frame, above_slide_bottom]

    return pickslide_script, pickslide_frames

def place_position(script, position_frame):
    
    place_script = ""
    # Safe frame for placing
    above_place_position = safety_frame(position_frame, SAFE_DIST)
    # Add to the path: go to the safe plane
    place_script += ur.move_l(above_place_position, acceleration, velocity)    
    # Add to the path: go to the place plane
    place_script += ur.move_l(position_frame, acceleration, velocity)    
    # Add to the path: open gripper and wait
    place_script += ur.set_digital_out(IO, True)
    place_script += ur.sleep(sleep_time) 
    # Add to the path: go back to the safe plane
    place_script += ur.move_l(above_place_position, acceleration, velocity)  
    # Add to the path: close gripper and wait
    place_script += ur.set_digital_out(IO, False)
    place_script += ur.sleep(sleep_time)

    place_frames = [above_place_position, position_frame, above_place_position]

    return place_script, place_frames

script = ""
vis_frames = []
way_frames = th.tree_to_list(way_frames)
count_pick = 0

#if value given for tcp measured, then add line to script, otherwise it will take current tcp from robot
for num_wy, sub_wy in enumerate(way_frames):
    # num_wy: index of row of bricks to place
    # sub_wy: nested list of bricks per row    
    for n_way, wy in enumerate(sub_wy):
        # n_way: index of brick/frame
        # wy: way frame
        if tcp_measured is not None:

            # 1. Set to suction tcp and add it to script
            set_suction = set_suction_tcp(script)         
            script += set_suction

            # 2. Picking: Call variables for picking script and frames
            pickingplace = pick_frame[count_pick]
            pickbrick_script, picktray_frames = pickup_brick_tray(script, pickingplace)
            script += pickbrick_script
            vis_frames.extend(picktray_frames)
            count_pick += 1
            print(count_pick)

            # 2. Placing: Call variables for placing script and frames
            placeslide_script, placeslide_frames = place_brick_slide(script, place_slide_frame)
            script += placeslide_script
            vis_frames.extend(placeslide_frames)

            # 4. Set to gripper tcp and add it to script
            set_gripper = set_gripper_tcp(script,orientation[num_wy])
            script += set_gripper

            # 5. Gripping: Call variables for gripping(pick) script and frames
            pickslide_script, pickslide_frames = pick_brick_slide(script, pick_slide_frame, pick_slide_2_frame, orientation[num_wy])
            script += pickslide_script
            vis_frames.extend(pickslide_frames)

            # 6. Positioning: Call variables for positioning script and frames
            place_script, place_frames = place_position(script, wy)
            script += place_script
            vis_frames.extend(place_frames)


# Format the script to make it sendable
script = com.concatenate_script(script)

# Visualize
from compas_rhino import conversions
import Rhino.Geometry as rg

vis_planes = [conversions.frame_to_rhino(frame) for frame in vis_frames]
# ---------- end compas ----------

# ---- group: Send UR script to Robot!
# Convert Planes to URScript
py3_7 = Python3Script(script=compas.script, ip_address=panel, send=Button())  # -> out, a; inputs script: String, ip_address: String, send: Boolean
# ---------- py3_7: Python ----------
import simple_comm as com

if send:
    com.send_script(script,ip_address)
# ---------- end py3_7 ----------

# ----
panel_5 = Panel(compas.script)
compas_draw_12 = COMPASDraw(cg=compas.vis_frames)  # -> rg; same code as compas_draw
pline = PolyLine(Vertices=compas.vis_planes, Closed=False)
preview = CustomPreview(Geometry=pline, Material=ColourSwatch(SwatchColor=RGB(255, 0, 212)))
number_slider_6 = Slider(7, range=0..100)  # disabled
# Send to Robot!
points = PointList(Points=compas.vis_planes, Size=number_slider_6)  # disabled
