# Grasshopper definition 101_brick_to_robot_Mike 3.gh (Grasshopper 1.0.8)

lamcp = LAMCPBridge(enable=Toggle(True))  # -> status; inputs enable: Boolean, port: Int32
#   port enable: Toggle to start (True) or stop (False) the local HTTP server.
#   port port: Port to listen on (loopback only). Defaults to 8765.
#   port status: Current server status string.
# ---------- lamcp: Python ----------
"""
LAMCP Bridge: local HTTP server inside Rhino 8 / Grasshopper CPython.

Exposes `POST /exec` (JSON: `{"code": "...", "timeout": 30}`) which
exec()s `code` and returns
`{"stdout": "...", "stderr": "...", "result": "...", "error": null|str}`.

Pair with the `lamcp` FastMCP server, which translates Claude's
`run_python_script` MCP tool calls into POSTs to this endpoint.

Binds to 127.0.0.1 only. NEVER expose beyond localhost â€” it exec()s
arbitrary Python with full Rhino API access.

LAMCP v0.1.0
"""

import contextlib
import io
import json
import threading
import traceback
from http.server import BaseHTTPRequestHandler
from http.server import HTTPServer

import Grasshopper
import scriptcontext as sc


SHARED_GLOBALS_KEY = "_lamcp_bridge_globals"
SERVER_KEY = "_lamcp_bridge_server"


def _exec_code(code, timeout):
    """Run `code` on the HTTP-server thread and capture stdout/stderr/result.

    NOTE: this is intentionally NOT marshalled to Rhino's UI thread for the
    spike â€” `Rhino.RhinoApp.InvokeOnUiThread` was queueing actions that
    never fired in Rhino 8 CPython. Most read-only RhinoCommon access is
    safe cross-thread; mutations may crash. Add Eto-based marshalling
    back here when we need it.
    """
    out = io.StringIO()
    err = io.StringIO()
    g = sc.sticky.setdefault(SHARED_GLOBALS_KEY, {"__name__": "__lamcp_bridge__"})
    error_text = None
    result_repr = None
    try:
        with contextlib.redirect_stdout(out), contextlib.redirect_stderr(err):
            exec(code, g, g)
            result_repr = repr(g.get("_"))
    except BaseException:
        error_text = traceback.format_exc()

    return {
        "stdout": out.getvalue(),
        "stderr": err.getvalue(),
        "result": result_repr,
        "error": error_text,
    }


class _ExecHandler(BaseHTTPRequestHandler):
    # Silence default request logging so it doesn't clog the Rhino command line.
    def log_message(self, fmt, *args):
        pass

    def _send(self, code, payload):
        body = json.dumps(payload).encode("utf-8")
        self.send_response(code)
        self.send_header("Content-Type", "application/json")
        self.send_header("Content-Length", str(len(body)))
        self.end_headers()
        self.wfile.write(body)

    def do_GET(self):
        if self.path == "/health":
            self._send(200, {"status": "ok"})
        else:
            self._send(404, {"error": "not found"})

    def do_POST(self):
        if self.path != "/exec":
            self._send(404, {"error": "not found"})
            return
        length = int(self.headers.get("Content-Length", "0"))
        try:
            raw = self.rfile.read(length).decode("utf-8")
            body = json.loads(raw)
            code = body.get("code", "")
            timeout = float(body.get("timeout", 30.0))
        except Exception as exc:
            self._send(400, {"error": "bad request: " + repr(exc)})
            return
        result = _exec_code(code, timeout)
        self._send(200, result)


def _start_server(port):
    server = HTTPServer(("127.0.0.1", port), _ExecHandler)
    thread = threading.Thread(
        target=server.serve_forever, daemon=True, name="lamcp-bridge"
    )
    thread.start()
    return {"server": server, "thread": thread, "port": port}


def _stop_server(state):
    try:
        state["server"].shutdown()
        state["server"].server_close()
    except Exception:
        pass


class LamcpBridgeComponent(Grasshopper.Kernel.GH_ScriptInstance):
    def RunScript(self, enable: bool, port: int):
        port = int(port) if port else 8765

        state = sc.sticky.get(SERVER_KEY)

        if not enable:
            if state is not None:
                _stop_server(state)
                del sc.sticky[SERVER_KEY]
            return "stopped"

        # Already running on the requested port: no-op.
        if (
            state is not None
            and state.get("port") == port
            and state["thread"].is_alive()
        ):
            return "listening on http://127.0.0.1:{}".format(port)

        # Port changed or server died: tear down and restart.
        if state is not None:
            _stop_server(state)
            del sc.sticky[SERVER_KEY]

        try:
            sc.sticky[SERVER_KEY] = _start_server(port)
        except OSError as exc:
            ghenv.Component.AddRuntimeMessage(  # noqa: F821
                Grasshopper.Kernel.GH_RuntimeMessageLevel.Error,
                "Failed to bind 127.0.0.1:{}: {}".format(port, exc),
            )
            return "error: {}".format(exc)

        return "listening on http://127.0.0.1:{}".format(port)
# ---------- end lamcp ----------
panel = Panel(lamcp)

# ---- group: This is needed only ONCE in the GH definition
enable_auto_reload = Python3Script()  # -> ok
# ---------- enable_auto_reload: Python ----------
"""
------------------------------
Using VS Code as Python editor
------------------------------

The simplest way to start using VS Code as our editor, is
to place our Python code in files located IN THE SAME FOLDER as our Grasshopper file.

After we have done that, we need 2 steps: 

1. Enable the COMPAS reloader on one component. This tells Grasshopper to watch for changes in the Pythoh files and reload if changed.
2. Every other component that uses Python code from external files needs to start with a method to ensure Grasshopper knows where to load the files from.

"""
# r: compas
# venv: mas-2627

from compas_rhino.devtools import DevTools
DevTools.enable_reloader()
# ---------- end enable_auto_reload ----------

# ---- group: IP ADDRESS
panel_2 = Panel("192.168.10.10")

# ----
path = FilePath("C:\Users\micha\Dropbox\MY_Projects\100_ETH\REPOS\CLONED\MAS_LLM_BRICKS\MAS_LLM_Bricks\input\brick_file.json")

# ---- group: Origin
pt = ConstructPoint(XCoordinate="-35.73", YCoordinate="393.10", ZCoordinate="200.65")

pt_2 = ConstructPoint(XCoordinate="-139.76", YCoordinate="282.1", ZCoordinate="88.57")

# ---- group: xaxis
pt_3 = ConstructPoint(XCoordinate="-140.29", YCoordinate="297.79", ZCoordinate="89.42")

# ---- group: yaxis
pt_4 = ConstructPoint(XCoordinate="-136.12", YCoordinate="282.35", ZCoordinate="82.19")

# ---- group: Origin
pt_5 = ConstructPoint(XCoordinate="-131.59", YCoordinate="283.06", ZCoordinate="75.46")

# ---- group: xaxis
pt_6 = ConstructPoint(XCoordinate="-130.97", YCoordinate="298.06", ZCoordinate="75.38")

# ---- group: yaxis
pt_7 = ConstructPoint(XCoordinate="-128.56", YCoordinate="253.3", ZCoordinate="68.46")

# ---- group: Origin
panel_3 = Panel("-135.14")
panel_4 = Panel("75.86")
panel_5 = Panel("281.07")
pt_8 = ConstructPoint(XCoordinate="-140.11", YCoordinate="283.15", ZCoordinate="77.71")

# ---- group: yaxis
panel_6 = Panel("-129.52")
panel_7 = Panel("283.06")
panel_8 = Panel("78.75")
pt_9 = ConstructPoint(XCoordinate="-134.93", YCoordinate="284.28", ZCoordinate="81.30")

# ---- group: xaxis
panel_9 = Panel("-134.99")
panel_10 = Panel("296.40")
panel_11 = Panel("76.52")
pt_10 = ConstructPoint(XCoordinate="-139.09", YCoordinate="300.31", ZCoordinate="79.47")

# ---- group: Origin
pt_11 = ConstructPoint(XCoordinate="534.15", YCoordinate="530.96", ZCoordinate="-9.26")

# ---- group: xaxis
pt_12 = ConstructPoint(XCoordinate="113.63", YCoordinate="528.18", ZCoordinate="-8.75")

# ---- group: yaxis
# Measure work object
panel_12 = Panel("-9.72")
pt_13 = ConstructPoint(XCoordinate="535.01", YCoordinate="325.62", ZCoordinate=panel_12)

# ---- group: xaxis
pt_14 = ConstructPoint(XCoordinate="60.31", YCoordinate="392.86", ZCoordinate="200.15")

# ---- group: yaxis
pt_15 = ConstructPoint(XCoordinate="-36.81", YCoordinate="517.32", ZCoordinate="200.39")

# ----
# Measure and set TCP Gripper
panel_13 = Panel("0.12")
pt_16 = ConstructPoint(XCoordinate=panel_13, YCoordinate="0.64", ZCoordinate="121.84")

# ----
# Measure and set TCP Suction
panel_14 = Panel("-65.64")
pt_17 = ConstructPoint(XCoordinate=panel_14, YCoordinate="35.36", ZCoordinate="96.7")

# ----
# xaxis_pt and xy_pt were recorded differently
# brick was placed in three locations:
# 1. first point where brick would be picked
# 2. furthest position in the X direction
# 3. furthest position in the Y direction
# in the script, the xaxis was defined as origin - xaxis instead of the other way round
# Measure pick up location
py3 = Python3Script(origin=pt, xaxis_pt=pt_14, xy_pt=pt_15)  # -> out, pick_frame; inputs origin: Point3d, xaxis_pt: Point3d, xy_pt: Point3d
# ---------- py3: Python ----------
from compas.geometry import Frame, Point
from compas.geometry import Rotation

from compas_rhino.conversions import point_to_compas

origin = point_to_compas(origin)
xaxis_pt = point_to_compas(xaxis_pt)
xy_pt = point_to_compas(xy_pt)

#define pick frame
pick_frame = Frame(origin, -(xaxis_pt - origin), xy_pt - origin)
# ---------- end py3 ----------
compas_draw = COMPASDraw(cg=py3.pick_frame)  # -> rg
#   port cg: The COMPAS geometry or datastructure to be drawn.
#   port rg: The Rhino geometry object.
# ---------- compas_draw: Python ----------
# r: compas>=2.14.1
"""
Draws COMPAS geometry in Grasshopper.
"""

from typing import Any

import Grasshopper

from compas.scene import SceneObject


class CompasToRhinoGeometry(Grasshopper.Kernel.GH_ScriptInstance):
    def RunScript(self, cg):
        if not cg:
            return None

        return SceneObject(item=cg).draw()
# ---------- end compas_draw ----------
pickup_frame_3d_grid = Python3Script(origin_frame=py3.pick_frame, levels=Slider(20, range=0..100))  # -> out, brick_frame, pick_frames; inputs levels: Int32
# ---------- pickup_frame_3d_grid: Python ----------
from brick_wall import Brick
import math as m
from compas.geometry import Vector


COLS = 4
ROWS = 9
LAYER_CAPACITY = COLS * ROWS - 1

pick_frames = []

for i in range(LAYER_CAPACITY * levels):

    layer = i // LAYER_CAPACITY
    index = i % LAYER_CAPACITY

    col = index % COLS
    row = index // COLS
    dx = -col * Brick.LENGTH
    dy = row * Brick.WIDTH
    dz = -layer * Brick.HEIGHT

    brick_frame = origin_frame.copy()
    brickpt = brick_frame.point

    brick_frame.point += (
        origin_frame.xaxis * dx
        + origin_frame.yaxis * dy
        + Vector(0, 0, dz)
    )

    # brick = Brick(brick_frame)
    pick_frames.append(brick_frame)
# ---------- end pickup_frame_3d_grid ----------
compas_draw_2 = COMPASDraw(cg=pickup_frame_3d_grid.brick_frame)  # -> rg; same code as compas_draw
compas_draw_3 = COMPASDraw(cg=pickup_frame_3d_grid.pick_frames)  # -> rg; same code as compas_draw

# ----
# Measure slide top location
py3_2 = Python3Script(origin=pt_2, xaxis_pt=pt_3, xy_pt=pt_4)  # -> out, pick_frame; inputs origin: Point3d, xaxis_pt: Point3d, xy_pt: Point3d
# ---------- py3_2: Python ----------
from compas.geometry import Frame, Point
from compas.geometry import Rotation

from compas_rhino.conversions import point_to_compas

origin = point_to_compas(origin)
xaxis_pt = point_to_compas(xaxis_pt)
xy_pt = point_to_compas(xy_pt)

#define pick frame
pick_frame = Frame(origin, xaxis_pt - origin, xy_pt - origin)
# ---------- end py3_2 ----------
compas_draw_4 = COMPASDraw(cg=py3_2.pick_frame)  # -> rg; same code as compas_draw

# ----
# Measure slide bottom location 1
# (for configuration 1)
py3_3 = Python3Script(origin=pt_5, xaxis_pt=pt_6, xy_pt=pt_7)  # -> out, pick_frame; inputs origin: Point3d, xaxis_pt: Point3d, xy_pt: Point3d; same code as py3_2
compas_draw_5 = COMPASDraw(cg=py3_3.pick_frame)  # -> rg; same code as compas_draw

# ----
# Measure slide bottom location 2
# (for configuration 2)
py3_4 = Python3Script(origin=pt_8, xaxis_pt=pt_10, xy_pt=pt_9)  # -> out, pick_frame; inputs origin: Point3d, xaxis_pt: Point3d, xy_pt: Point3d; same code as py3_2
compas_draw_6 = COMPASDraw(cg=py3_4.pick_frame)  # -> rg; same code as compas_draw

# ---- group: Max number of frames for a single Batch
number_slider = Slider(135, range=0..1000)

# ----
number_slider_2 = Slider(0.9, range=0..2)
number_slider_3 = Slider(2, range=0..5)
number_slider_4 = Slider(50, range=0..500)
number_slider_5 = Slider(2, range=0..5)
number_slider_6 = Slider(0.4, range=0..1)
colour_swatch = ColourSwatch(SwatchColor=RGB(255, 0, 212))  # disabled
number_slider_7 = Slider(7, range=0..100)  # disabled

# ----
# GEOMETRY GENERATION
number_slider_8 = Slider(594, range=0..1000)
no_layers = Slider(7, range=0..10)
list = ValueList({"Config 1": 0, "Config 2": 1, "Config 3": 2}, selected="Config 1")
list_2 = ValueList({"Config 1": 0, "Config 2": 1, "Config 3": 2}, selected="Config 2")
number_slider_9 = Slider(420, range=0..1000)
brick_dimensions = Python3Script(orientation=list)  # -> out, length, width, height, orient
# ---------- brick_dimensions: Python ----------
# r: compas
# venv: mas-2627
from compas_rhino.devtools import DevTools
DevTools.ensure_path()

from brick_wall import Brick

samplebrick = Brick()
samplebrick.configuration(orientation)

length = samplebrick.length
width = samplebrick.width
height = samplebrick.height
orient = orientation
# ---------- end brick_dimensions ----------
brick_dimensions_2 = Python3Script(orientation=list_2)  # -> out, length, width, height, orient; same code as brick_dimensions
rectangle = Rectangle(Plane=PlaneXY(0, 0, 0), XSize=number_slider_9, YSize=number_slider_8, Radius=0)  # -> Rectangle, Length
pt_18 = ConstructPoint(XCoordinate=expr("x/2", number_slider_9), YCoordinate=expr("x/2", number_slider_8), ZCoordinate=0)
lines_pts = LinesPts(C=rectangle.Rectangle, D=Slider(50, range=0..100), N=Slider(100, range=0..100))  # -> P, L, C_2
shift = ShiftList(List=lines_pts.L, Shift=1, Wrap=True)
expression = Expression(
    one_length=brick_dimensions.length,
    two_width=brick_dimensions_2.width,
    gap=Slider(19, range=0..20),
    Expression="one_length+two_width+gap")
no_layers_2 = Slider(10, range=0..20)
number_slider_10 = Slider(90, range=0..200)
circle = CircleCNR(Center=pt_18, Normal=Vector(0, 0, 1), Radius=number_slider_10)
crv = Curve(reparameterize(circle))

rad = Radians(Degrees=Slider(30, range=0..1000))
rad_2 = Radians(Degrees=Slider(0, range=0..1000))
shift_and_subtract = ShiftAndSubtract(L=lines_pts.L, I="-1")  # -> L_2, L_3
clampangle = ClampAngle(LineA=shift_and_subtract.L_2, LineB=shift_and_subtract.L_3, UpperLimit=rad, LowerLimit=rad_2, Strength=1)

boundary = BoundarySurfaces(Edges=lines_pts.C_2)
mesh_uv = MeshSurface(Surface=boundary, UCount=5, VCount=5, Overhang=True, Equalize=False)
onmesh = OnMesh(Points=lines_pts.P, Mesh=mesh_uv, Strength=Slider(100, range=0..100000))

length_line = LengthLine(Line=lines_pts.L, Length=brick_dimensions.length, Strength=Slider(100, range=0..100))

index = ItemIndex(List=lines_pts.P, Item=lines_pts.P)
shift_2 = ShiftList(List=index, Shift=1, Wrap=True)  # -> simplify(List)
collider = Collider(Objects=lines_pts.P, Radii=brick_dimensions.length, IgnoreA=index, IgnoreB=shift_2, Strength=Slider(10, range=0..100))

# ---- group: Steps between modules
expression_2 = Expression(h1=brick_dimensions.height, h2=brick_dimensions_2.height, Expression="h1+h2")

# ----
merge = Merge(Data1=onmesh, Data2=length_line, Data3=collider, Data4=clampangle)  # -> flatten(Result)
bouncysolver = BouncySolver(
    GoalObjects=flatten(merge),
    Reset=Button(),
    Threshold=1e-15,
    Tolerance=0.0001,
    Damping=Slider(0.084, range=0..1),
    Iterations=10,
    On=Toggle(False))  # -> I, V, O

# ---- group: Translation Vectors per module
series = Series(Start=0, Step=1, Count=no_layers)
multiplication = Multiplication(A=expression_2, B=series)
Z = UnitZ(Factor=multiplication)

# ----
# Play this to update geometry
dam = DataDam(DataA=bouncysolver.V, BufferDelay=10000000, BufferMode=0)

nurbs = NurbsCurve(Vertices=dam, Degree=3, Periodic=False)  # -> reparameterize(Curve), Length, Domain

cluster = Cluster(h1=brick_dimensions.height, h2=brick_dimensions_2.height)
divlength = DivideLength(Curve=nurbs.Curve, Length=expr("x/2", expression))  # -> Points, Tangents, Parameters
shift_and_subtract_2 = ShiftAndSubtract(L=divlength.Parameters, I="-1")  # -> L_2, L_3
subtraction = Subtraction(A=shift_and_subtract_2.L_3, B=shift_and_subtract_2.L_2)
Z_2 = UnitZ(Factor=cluster)
lng = ListLength(List=Z)
avr = Average(Input=subtraction)
number_slider_11 = Slider(4, range=0..10)
move = Move(Geometry=nurbs.Curve, Motion=Z_2)  # -> Geometry, Transform
division = Division(A=avr, B=no_layers)
lng_2 = ListLength(List=Z_2)
move_2 = Move(Geometry=move.Geometry, Motion=graft(Z))  # -> simplify(graft(Geometry)), Transform
series_2 = Series(Start=0, Step=division, Count=lng)  # -> graft(Series)
path_mapper = PathMapper(move_2.Geometry, source="{A;B}", target="{path_index}")
repeat = RepeatData(Data=series_2, Length=lng_2)  # -> simplify(graft(Data))
viewer = ParamViewer(repeat)
path_mapper_2 = PathMapper(repeat, source="{A;B}", target="{path_index}")
expression_3 = Expression(t=divlength.Parameters, dl=path_mapper_2, Expression="(t+dl)")  # -> simplify(R)
path_mapper_3 = PathMapper(expression_3, source="{A}(B)", target="{0;A}(B)")
Z_3 = UnitZ(Factor=1)
py3_5 = Python3Script(p_list=path_mapper_3)  # -> out, rev_p; inputs p_list: tree of Double
# ---------- py3_5: Python ----------
import ghpythonlib.treehelpers as th
import math as m
import Rhino.Geometry as rg

p_list = th.tree_to_list(p_list)
rps = [[p for n, p in enumerate(ps) if p <= 1.0] for np, ps in enumerate(p_list)]
rev_p = th.list_to_tree(rps)
# ---------- end py3_5 ----------
eval = EvaluateCurve(Curve=reparameterize(simplify(path_mapper)), Parameter=simplify(py3_5.rev_p))  # -> Point, Tangent, Angle
xprod = CrossProduct(VectorA=Z_3, VectorB=eval.Tangent, Unitize=True)  # -> Vector, Length
path_mapper_4 = PathMapper(eval.Point, source="{A}(B)", target="{0;A}(B)")
pl = ConstructPlane(Origin=eval.Point, XAxis=eval.Tangent, YAxis=xprod.Vector)
path_mapper_5 = PathMapper(pl, source="{A}(B)", target="{0;A}(B)")
item = ListItem(List=multiplication, Index=expr("-1", 0), Wrap=True)
py3_6 = Python3Script(pts_list=path_mapper_4, pln_list=path_mapper_5)  # -> out, rev_pts, rev_plns; inputs pts_list: tree of Point3d, pln_list: tree of Plane
# ---------- py3_6: Python ----------
import ghpythonlib.treehelpers as th

pts_list = th.tree_to_list(pts_list)
pln_list = th.tree_to_list(pln_list)

rps = [[p for n, p in enumerate(pts) if n % 2 == np % 2] for np, pts in enumerate(pts_list)]
rplns = [[q for m, q in enumerate(plns) if m % 2 == mp % 2] for mp, plns in enumerate(pln_list)]

rev_pts = th.list_to_tree(rps)
rev_plns = th.list_to_tree(rplns)
# ---------- end py3_6 ----------
py3_7 = Python3Script(pts_list=path_mapper_4)  # -> out, orientations; inputs pts_list: tree of Point3d
# ---------- py3_7: Python ----------
import ghpythonlib.treehelpers as th
import math as m
import Rhino.Geometry as rg

pts_list = th.tree_to_list(pts_list)
ori = []
for n in range(len(pts_list)):
    if n % 4 != 1 and n % 4 != 2:
        ori.append(0)
    else:
        ori.append(1)

orientations = th.list_to_tree(ori)
# ---------- end py3_7 ----------
py3_8 = Python3Script(orientations=py3_7.orientations)  # -> out, rotations; inputs orientations: list of Int32
# ---------- py3_8: Python ----------
import ghpythonlib.treehelpers as th
import math as m
import Rhino.Geometry as rg

orient = []
for o in orientations:
    a = 2
    if o == 0:
        a = 0
    else:
        a = m.pi/2
    orient.append(a)

rotations = th.list_to_tree(orient)
# ---------- end py3_8 ----------
bnd = Bounds(Numbers=py3_6.rev_pts)
dom = ConstructDomain(DomainStart=expr("0.25*x", item), DomainEnd=item)
remap = RemapNumbers(Value=py3_6.rev_pts, Source=bnd, Target=Domain(0, 1))  # -> Mapped, Clipped
pdecon = Deconstruct(Point=py3_6.rev_pts)  # -> XComponent, YComponent, ZComponent
graph = GraphMapper(
    remap.Mapped,
    x0=0,
    x1=1,
    y0=0,
    y1=1,
    container_name="Sinc",
    Equation_X0=0.2585823536,
    Equation_X1=0.4224238694,
    Equation_Y0=0.7358154058,
    Equation_Y1=0.4105070829)
bnd_2 = Bounds(Numbers=graph)
remap_2 = RemapNumbers(Value=graph, Source=bnd_2, Target=dom)  # -> Mapped, Clipped
smaller = SmallerThan(FirstNumber=pdecon.ZComponent, SecondNumber=remap_2.Mapped)  # -> SmallerThan, OrEqualTo
cull = CullPattern(List=py3_6.rev_pts, CullPattern=smaller.OrEqualTo)
cull_2 = CullPattern(List=py3_6.rev_plns, CullPattern=smaller.OrEqualTo)
clean = CleanTree(RemoveNulls=True, RemoveInvalid=True, RemoveEmpty=True, Tree=cull)
clean_2 = CleanTree(RemoveNulls=True, RemoveInvalid=True, RemoveEmpty=True, Tree=cull_2)

ellipse = Ellipse(Plane=pt_18, Radius1=number_slider_10, Radius2=Slider(181, range=0..200))  # -> reparameterize(Ellipse), Focus1, Focus2
expression_4 = Expression(
    one_length=brick_dimensions.length,
    two_width=brick_dimensions_2.width,
    gap=Slider(15, range=0..20),
    Expression="one_length+two_width+gap")
divlength_2 = DivideLength(Curve=ellipse.Ellipse, Length=expr("x/2", expression_4))  # -> Points, Tangents, Parameters
expression_5 = Expression(h1=brick_dimensions.height, h2=brick_dimensions_2.height, Expression="h1+h2")
series_3 = Series(Start=0, Step=1, Count=no_layers_2)
multiplication_2 = Multiplication(A=expression_5, B=series_3)
Z_4 = UnitZ(Factor=multiplication_2)
height_configurations_module = Cluster(h1=brick_dimensions.height, h2=brick_dimensions_2.height)
Z_5 = UnitZ(Factor=height_configurations_module)
move_3 = Move(Geometry=ellipse.Ellipse, Motion=Z_5)  # -> Geometry, Transform
lng_3 = ListLength(List=Z_5)
move_4 = Move(Geometry=move_3.Geometry, Motion=graft(Z_4))  # -> simplify(graft(Geometry)), Transform
path_mapper_6 = PathMapper(move_4.Geometry, source="{A;B}", target="{path_index}")
Z_6 = UnitZ(Factor=1)
item_2 = ListItem(List=multiplication_2, Index=expr("-1", 0), Wrap=True)
dom_2 = ConstructDomain(DomainStart=expr("0.25*x", item_2), DomainEnd=item_2)

clamp_to_even = ClampToEven(L=divlength_2.Parameters)
item_3 = ListItem(List=divlength_2.Parameters, Index=clamp_to_even, Wrap=True)

shift_and_subtract_3 = ShiftAndSubtract(L=item_3, I="-1")  # -> L_2, L_3
subtraction_2 = Subtraction(A=shift_and_subtract_3.L_3, B=shift_and_subtract_3.L_2)
avr_2 = Average(Input=subtraction_2)
division_2 = Division(A=avr_2, B=no_layers_2)
series_4 = Series(Start=0, Step=division_2, Count=no_layers_2)  # -> graft(Series)
repeat_2 = RepeatData(Data=series_4, Length=lng_3)  # -> simplify(graft(Data))
viewer_2 = ParamViewer(repeat_2)
path_mapper_7 = PathMapper(repeat_2, source="{A;B}", target="{path_index}")
expression_6 = Expression(t=item_3, dl=path_mapper_7, Expression="(t+0*dl)")  # -> simplify(R)
path_mapper_8 = PathMapper(expression_6, source="{A}(B)", target="{0;A}(B)")
py3_9 = Python3Script(p_list=path_mapper_8)  # -> out, rev_p; inputs p_list: tree of Double; same code as py3_5
eval_2 = EvaluateCurve(Curve=reparameterize(simplify(path_mapper_6)), Parameter=simplify(py3_9.rev_p))  # -> Point, Tangent, Angle
xprod_2 = CrossProduct(VectorA=Z_6, VectorB=eval_2.Tangent, Unitize=True)  # -> Vector, Length
path_mapper_9 = PathMapper(eval_2.Point, source="{A}(B)", target="{0;A}(B)")
pl_2 = ConstructPlane(Origin=eval_2.Point, XAxis=eval_2.Tangent, YAxis=xprod_2.Vector)
path_mapper_10 = PathMapper(pl_2, source="{A}(B)", target="{0;A}(B)")
py3_10 = Python3Script(pts_list=path_mapper_9, pln_list=path_mapper_10)  # -> out, rev_pts, rev_plns; inputs pts_list: tree of Point3d, pln_list: tree of Plane; same code as py3_6
bnd_3 = Bounds(Numbers=py3_10.rev_pts)
remap_3 = RemapNumbers(Value=py3_10.rev_pts, Source=bnd_3, Target=Domain(0, 1))  # -> Mapped, Clipped
pdecon_2 = Deconstruct(Point=py3_10.rev_pts)  # -> XComponent, YComponent, ZComponent
py3_11 = Python3Script(pts_list=path_mapper_9)  # -> out, orientations; inputs pts_list: tree of Point3d; same code as py3_7
graph_2 = GraphMapper(remap_3.Mapped, x0=0, x1=1, y0=0, y1=1, Cx=0.3613138795, Cy=0.7318840623, container_name="Conic")
py3_12 = Python3Script(orientations=py3_11.orientations)  # -> out, rotations; inputs orientations: list of Int32; same code as py3_8
bnd_4 = Bounds(Numbers=graph_2)
remap_4 = RemapNumbers(Value=graph_2, Source=bnd_4, Target=dom_2)  # -> Mapped, Clipped
smaller_2 = SmallerThan(FirstNumber=pdecon_2.ZComponent, SecondNumber=remap_4.Mapped)  # -> SmallerThan, OrEqualTo
cull_3 = CullPattern(List=py3_10.rev_pts, CullPattern=smaller_2.OrEqualTo)
cull_4 = CullPattern(List=py3_10.rev_plns, CullPattern=smaller_2.OrEqualTo)
clean_3 = CleanTree(RemoveNulls=True, RemoveInvalid=True, RemoveEmpty=True, Tree=cull_3)
clean_4 = CleanTree(RemoveNulls=True, RemoveInvalid=True, RemoveEmpty=True, Tree=cull_4)

panel_15 = Panel(repeat_2)

py3_13 = Python3Script(planes=clean_4, orient=py3_11.orientations, rotate=py3_12.rotations)  # -> out, way_frames; inputs planes: tree, orient: list, rotate: list
# ---------- py3_13: Python ----------
# r: compas
# venv: mas-2627
from compas_rhino.devtools import DevTools
DevTools.ensure_path()

import Rhino.Geometry as rg
# from
from compas.geometry import Frame, Vector, Point
from compas_rhino.conversions import plane_to_compas_frame
from compas.geometry import Transformation, Translation, Rotation
import math as m
import ghpythonlib.treehelpers as th
from brick_wall import Brick

planes = th.tree_to_list(planes)

way_frames = []
for npl, plns in enumerate(planes):
    sub_rot_frames = []
    ori = orient[npl] * rotate[npl]
    print(ori)
    for n, pl in enumerate(plns):
        if n < len(plns)-1:
            frame = plane_to_compas_frame(pl)
            frame.rotate(ori, frame.zaxis, frame.point)
            sub_rot_frames.append(frame)
    way_frames.append(sub_rot_frames)

for wayf in way_frames:
    for w in wayf:
        w.point += Vector(0.0,0.0,1/2*Brick.HEIGHT)

way_frames = th.list_to_tree(way_frames)
# ---------- end py3_13 ----------
draw = COMPASDraw(cg=py3_13.way_frames)  # -> rg; same code as compas_draw

brick_dimensions_3 = Python3Script(frames=py3_13.way_frames, orientation=py3_11.orientations, rotation=py3_12.rotations)  # -> out, geometries, js; inputs frames: tree, orientation: list, rotation: list
# ---------- brick_dimensions_3: Python ----------
# r: compas
# venv: mas-2627
from compas_rhino.devtools import DevTools
DevTools.ensure_path()

import os
import math as m
from compas_rhino.conversions import box_to_rhino
from compas.geometry import Frame, Vector
import ghpythonlib.treehelpers as th
from brick_wall import Brick

frames = th.tree_to_list(frames)
bricks = []
for n, frame_set in enumerate(frames):
    sub_bricks = []
    for fr in frame_set:
        samplebrick = Brick(fr)
        samplebrick.configuration(orientation[n])
        # samplebrick.rotate(m.degrees(rotation[n]), Vector(0.0,0.0,1.0))
        sub_bricks.append(samplebrick)
    bricks.append(sub_bricks)

export_dir = r"C:\Users\micha\Dropbox\MY_Projects\100_ETH\REPOS\CLONED\MAS-2627\04_RoboticBricks\Michael\jsons"
os.makedirs(export_dir, exist_ok=True)

geoms = []
for n, sub in enumerate(bricks):
    sub_geoms = []
    for i, b in enumerate(sub):
        box = b.draw()
        file_path = os.path.join(export_dir, f"brick_{n}_{i}.json")
        box.to_json(file_path)
        sub_geoms.append(box)
    geoms.append(sub_geoms)

# Convert list tree back to Grasshopper DataTree
geometries = th.list_to_tree(geoms)
# ---------- end brick_dimensions_3 ----------
py3_14 = Python3Script(bricks=brick_dimensions_3.geometries, ori=py3_11.orientations, path=path, write=Button())  # -> out, brick_data; inputs bricks: tree, ori: list
# ---------- py3_14: Python ----------
import ghpythonlib.treehelpers as th
import json
from compas.geometry import angle_vectors, Vector, Point

bricks = th.tree_to_list(bricks)

data = []
i = 0
for nb, brick in enumerate(bricks):
    for b in brick:
        brick_data = dict(position = [], rotation = [], orientation = int())
        origin = b.frame.point
        rot = b.frame.euler_angles()
        brick_data['position'] = list(origin/1000)
        brick_data['rotation'] = rot
        brick_data['orientation'] = ori[nb]
        data.append(brick_data)
        i+=1

print(i)
if write:
    with open(path, 'w') as fp:
        print(type(fp))
        json.dump(data, fp, indent = 4)
# ---------- end py3_14 ----------
to_json = COMPASToJSON(data=flatten(brick_dimensions_3.geometries), filepath=path, pretty=Toggle(True))  # -> json; inputs filepath: String, pretty: Boolean; disabled
#   port data: COMPAS data objects to serialize.
#   port filepath: File path where to store the JSON file. If empty, it will not store to disk but instead return the JSON string.
#   port pretty: If True, JSON data will be formatted with indentation and key sorting.
#   port json: JSON file path or JSON string.
# ---------- to_json: Python ----------
# r: compas>=2.14.1
"""
Serializes COMPAS objects to JSON.
"""

from typing import Any

import Grasshopper

import compas


class CompasDumpToJson(Grasshopper.Kernel.GH_ScriptInstance):
    def RunScript(self, data, filepath: str, pretty: bool):
        json = filepath

        if filepath:
            compas.json_dump(data, filepath, pretty)
        else:
            json = compas.json_dumps(data, pretty)

        return json
# ---------- end to_json ----------
draw_2 = COMPASDraw(cg=brick_dimensions_3.geometries)  # -> rg; same code as compas_draw

# ----
# Play this to update geometry
dam_2 = DataDam(DataA=py3_13.way_frames, BufferDelay=10000000, BufferMode=0)

panel_16 = Panel(py3_14.out)

# ----
# Transform from Rhino to Robot Space
# Insert way_planes as grasshopper tree
fine_adjust_z_mm = Slider(5, range=-5..100)
transform_geom = Python3Script(way_planes=dam_2, wobj_origin=pt_11, wobj_xaxis=pt_12, wobj_xypoint=pt_13, z_safe_margin=fine_adjust_z_mm)  # -> out, transformed_frames; inputs way_planes: tree, wobj_origin: Point3d, wobj_xaxis: Point3d, wobj_xypoint: Point3d, z_safe_margin: Double
# ---------- transform_geom: Python ----------
from compas.geometry import Frame, Transformation, Translation, Vector, Rotation
import math as m
from ghpythonlib import treehelpers as th
#in this step we transform our way planes to robot space
#the rhino co-ordinate system is rather abstract in the physical world
#the robot base plane assumed the base frame of robot is the origin
#but rhino does not know that
#thus we transform things from our design space(Rhino World XY) to Robot Base Plane that we measure

def set_robot_base(origin, xaxis, xypoint):
    """
    set a base plane representing the robot working object plane
    """
    robot_base = Frame(origin, xaxis - origin, xypoint - origin)
    return (robot_base)

def rhino_to_robot_space(rhino_plane,robot_base_plane):
    """
    Transform the objects from Rhino world XY plane to robot work object plane
    """
    T_matrix = Transformation.from_frame_to_frame(Frame.worldXY(), robot_base_plane)
    robot_plane = rhino_plane.transformed(T_matrix)
    robot_plane = robot_plane.rotated(m.pi,robot_plane.yaxis, robot_plane.point)
    # rotates plane by 180 degress around y axis
    return robot_plane

def set_z_safe_margin(planes_to_adjust, safety_margin):
    adjusted = []
    T = Translation.from_vector(Vector(0, 0, safety_margin))
    for f in planes_to_adjust:
        adjusted.append(f.transformed(T))
    return adjusted

# ===== Tree conversion to List =====
way_planes = th.tree_to_list(way_planes)

# ===== Robot base is set =====
robot_base =  set_robot_base(wobj_origin, wobj_xaxis, wobj_xypoint)

# ===== Set safety margin for Z height ======
safe_planes = [set_z_safe_margin(wy, z_safe_margin) for wy in way_planes]

# ===== Transforming the rhino planes into robot planes =====
transformed_frames = []
for plane in safe_planes: 
    sub_transformed = []
    for pln in plane:
        sub_transformed.append(rhino_to_robot_space(pln, robot_base))
    transformed_frames.append(sub_transformed)

transformed_frames = th.list_to_tree(transformed_frames)
# ---------- end transform_geom ----------
compas_draw_7 = COMPASDraw(cg=transform_geom.transformed_frames)  # -> rg; same code as compas_draw

# ----
# Brick Statistics
flatten = FlattenTree(Tree=transform_geom.transformed_frames, Path="{0}")
lng_4 = ListLength(List=pickup_frame_3d_grid.pick_frames)
lng_5 = ListLength(List=flatten)
py3_15 = Python3Script(capacity=lng_4, brick_count=lng_5)  # -> out, a
# ---------- py3_15: Python ----------
import math as m
if capacity >= brick_count:
    print(f"You have enough bricks and an excess of {capacity - brick_count}")
else:
    print(f"You have overshot by {abs(capacity - brick_count)}. Please reduce the number of bricks")
# ---------- end py3_15 ----------
number_of_bricks = Panel(lng_5)
panel_17 = Panel(py3_15.out)
brick_tower_count = Panel(lng_4)

# ----
# Here is the suction one
compas_suction = Python3Script(
    way_frames=transform_geom.transformed_frames,
    safe_distance=number_slider_4,
    tcp_measured=pt_17,
    acceleration=number_slider_5,
    velocity=number_slider_3,
    pick_frame=pickup_frame_3d_grid.pick_frames,
    sleep_time=number_slider_6,
    press_f=number_slider_2)  # -> out, vis_frames, vis_planes, script; inputs way_frames: tree, safe_distance: Double, tcp_measured: Point3d, acceleration: Double, velocity: Double, pick_frame: list, sleep_time: Double, press_f: Double; disabled
# ---------- compas_suction: Python ----------
from imp import reload
import sys
import os
import ghpythonlib.treehelpers as th

#get current file path
path = ghenv.Component.OnPingDocument().FilePath
#get parent directory of the parent directory
parentdir = os.path.dirname(path)
#get src folder which contains classes
dire = os.path.join(parentdir,'src')

sys.path.append(dire)

import simple_ur_script as ur
reload(ur)

import utils 
reload(utils)

import simple_comm as com
reload(com)

import compas.geometry as cg
import math as m

# ===== Set global constants =======

IO = 4 # Global constant
# IO Off: Gripper Closed, Suction Off
# IO On: Gripper Open, Suction On
# check IO number before setting

SAFE_DIST = safe_distance
SUCTION_ANGLES = (
    m.radians(-30.0),
    m.radians(0.0),
    m.radians(45.0)
)

script = ''
vis_frames = []

# =================================

def set_suction_tcp(script):
    """Set TCP to Vacuum Suction Tool Tip"""
    suction_script = ""
    suction_script += ur.set_tcp_by_angles(
        tcp_measured.X,
        tcp_measured.Y,
        tcp_measured.Z,
        *SUCTION_ANGLES
    )
    suction_script += ur.sleep(sleep_time) 
    return suction_script

def safety_frame(frame, safety_distance):
    return frame.translated(frame.zaxis * -safety_distance)
    # negative zaxis since robot frame is pointing down

def suction_press(frame):
    return frame.translated(frame.zaxis * press_f)
    # we keep this positive as we want this to go down onto the brick

def reset_frame(script):
    reset_script = ""
    reset_script += ur.move_j([m.radians(-122.26), m.radians(-126.48), m.radians(83.87), m.radians(-45.03), m.radians(-86.12), m.radians(17.54)],1, 1)
    return reset_script

def safe_place_frame(script):
    # This is the one that will appear above the paper space
    # Freeze robot at reset frame, then adjust to above the paper space
    safe_place_script = ""
    # Record the joint angles down in the below sequence
    safe_place_script += ur.move_j([m.radians(-173.83), m.radians(-102.71), m.radians(96.35), m.radians(-84.52), m.radians(-86.11), m.radians(89.34)],1, 1)
    return safe_place_script

def pickup_brick_tray(script,pick_up_frame):
    
    pickbrick_script = ""
    # Move J in case of faulting
    pickbrick_script += reset_frame(script)
    # Translate frame to "safe" location
    above_pick_tray = safety_frame(pick_up_frame, SAFE_DIST)
    # Move to safe frame
    pickbrick_script += ur.move_l(above_pick_tray, acceleration, velocity)
    # Move to pick location
    pickbrick_script += ur.move_l(pick_up_frame, acceleration, velocity)
    # Move down a little to guarantee pick
    press_down = suction_press(pick_up_frame)
    pickbrick_script += ur.move_l(press_down, acceleration, velocity)
    # Add to the path: turn on the vacuum and wait 
    pickbrick_script += ur.set_digital_out(IO, True)
    pickbrick_script += ur.sleep(sleep_time)
    # Move back to safe plane
    pickbrick_script += ur.move_l(above_pick_tray, acceleration, velocity)

    picktray_frames = [above_pick_tray, pick_up_frame, above_pick_tray]

    return pickbrick_script, picktray_frames

def place_position(script, position_frame):
    
    place_script = ""
    # Move J to above paper space
    place_script += safe_place_frame(script)
    # Safe frame for placing
    above_place_position = safety_frame(position_frame, SAFE_DIST)
    # Add to the path: go to the safe plane
    place_script += ur.move_l(above_place_position, acceleration, velocity)    
    # Add to the path: go to the place plane
    place_script += ur.move_l(position_frame, acceleration, velocity)    
    # Add to the path: open gripper and wait
    place_script += ur.set_digital_out(IO, True)
    place_script += ur.sleep(sleep_time) 
    # Add to the path: go back to the safe plane
    place_script += ur.move_l(above_place_position, acceleration, velocity)  
    # Add to the path: close gripper and wait
    place_script += ur.set_digital_out(IO, False)
    place_script += ur.sleep(sleep_time)

    place_frames = [above_place_position, position_frame, above_place_position]

    return place_script, place_frames

script = ""
vis_frames = []
way_frames = th.tree_to_list(way_frames)
count_pick = 0

#if value given for tcp measured, then add line to script, otherwise it will take current tcp from robot
for num_wy, sub_wy in enumerate(way_frames):
    # num_wy: index of row of bricks to place
    # sub_wy: nested list of bricks per row    
    for n_way, wy in enumerate(sub_wy):
        # n_way: index of brick/frame
        # wy: way frame
        if tcp_measured is not None:

            # 1. Set to suction tcp and add it to script
            set_suction = set_suction_tcp(script)         
            script += set_suction
            
            # 2. Picking: Call variables for picking script and frames
            pickingplace = pick_frame[count_pick]
            pickbrick_script, picktray_frames = pickup_brick_tray(script, pickingplace)
            script += pickbrick_script
            vis_frames.extend(picktray_frames)
            count_pick += 1

            # 2. Positioning: Call variables for positioning script and frames
            place_script, place_frames = place_position(script, wy)
            script += place_script
            vis_frames.extend(place_frames)


# Format the script to make it sendable
script = com.concatenate_script(script)

# Visualize
from compas_rhino import conversions
import Rhino.Geometry as rg

vis_planes = [conversions.frame_to_rhino(frame) for frame in vis_frames]
# ---------- end compas_suction ----------
compas_draw_8 = COMPASDraw(cg=compas_suction.vis_frames)  # -> rg; disabled; same code as compas_draw

# ----
# Batching Algorithm
branch_sorter = Python3Script(transformed=transform_geom.transformed_frames, threshold=number_slider)  # -> out, number_batches, simplify(branch_lists), lengths_list; inputs transformed: tree, threshold: Int32
# ---------- branch_sorter: Python ----------
from compas.geometry import Frame
import math as m
import ghpythonlib.treehelpers as th

transformed = th.tree_to_list(transformed)

total_frames = 0
start_branch = 0
branch_lists = []
lengths_list = []
for t, transforms in enumerate(transformed):
    sub_branch = []
    set_length = len(transforms)
    if total_frames + set_length > threshold:
        n = total_frames
        lengths_list.append(n)
        branch_lists.append(list(range(start_branch, t)))
        start_branch = t
        total_frames = set_length
    elif t == len(transformed)-1:
        n = total_frames + set_length
        lengths_list.append(n)
        branch_lists.append(list(range(start_branch, t+1)))   
    else:
        total_frames += set_length

number_batches = len(branch_lists)
branch_lists = th.list_to_tree(branch_lists)
# ---------- end branch_sorter ----------
batch_checker = Python3Script(threshold=number_slider, brick_count=lng_5, batch_count=branch_sorter.number_batches)  # -> out, a
# ---------- batch_checker: Python ----------
import math as m
if threshold >= brick_count:
    print(f"You have enough bricks to run a single batch")
else:
    print(f"You need to run multiple batches. Use the modules below to run {batch_count} batches")
# ---------- end batch_checker ----------
orientation_setter = Python3Script(frame_list=transform_geom.transformed_frames, ori=py3_11.orientations)  # -> out, branch_count, orientation; inputs frame_list: tree, ori: list of Int32
# ---------- orientation_setter: Python ----------
import ghpythonlib.treehelpers as th
frame_list = th.tree_to_list(frame_list)
branch_count = len(frame_list)
orientation = [ori[n] for n in range(branch_count)]
# ---------- end orientation_setter ----------
partition = PartitionList(List=pickup_frame_3d_grid.pick_frames, Size=branch_sorter.lengths_list)  # -> simplify(Chunks)

# ---- group: If need multiple Batches, use these and slide Batch number based on progress
batch_number = Slider(0, range=0..10)
number_of_batches = Panel(branch_sorter.number_batches)
message = Panel(batch_checker.out)

# ----
branch = TreeBranch(Tree=branch_sorter.branch_lists, Path=batch_number, MaintainPaths=True)
selected_batch = Python3Script(transformed=transform_geom.transformed_frames, branch_no=branch)  # -> out, sel_frames, a; inputs transformed: tree, branch_no: list
# ---------- selected_batch: Python ----------
import ghpythonlib.treehelpers as th

transformed = th.tree_to_list(transformed)
rev_frames = []
for bn, trans in enumerate(transformed):
    if bn in branch_no:
        rev_frames.append(trans)

sel_frames = th.list_to_tree(rev_frames)
# ---------- end selected_batch ----------
branch_2 = TreeBranch(Tree=partition, Path=batch_number, MaintainPaths=True)
item_4 = ListItem(List=orientation_setter.orientation, Index=branch, Wrap=True)

panel_18 = Panel(selected_batch.sel_frames)
panel_19 = Panel(item_4)

# ----
# Here is the suction + gripper one
compas_suction_gripper = Python3Script(
    way_frames=selected_batch.sel_frames,
    orientation=item_4,
    safe_distance=number_slider_4,
    tcp_measured=pt_17,
    tcp2_measured=pt_16,
    acceleration=number_slider_5,
    velocity=number_slider_3,
    pick_frame=branch_2,
    place_slide_frame=py3_2.pick_frame,
    pick_slide_frame=py3_3.pick_frame,
    pick_slide_2_frame=py3_4.pick_frame,
    sleep_time=number_slider_6,
    press_f=number_slider_2)  # -> out, vis_frames, vis_planes, script; inputs way_frames: tree, orientation: list, safe_distance: Double, tcp_measured: Point3d, acceleration: Double, velocity: Double, pick_frame: list, sleep_time: Double, press_f: Double
# ---------- compas_suction_gripper: Python ----------
from imp import reload
import sys
import os
import ghpythonlib.treehelpers as th

#get current file path
path = ghenv.Component.OnPingDocument().FilePath
#get parent directory of the parent directory
parentdir = os.path.dirname(path)
#get src folder which contains classes
dire = os.path.join(parentdir,'src')

sys.path.append(dire)

import simple_ur_script as ur
reload(ur)

import utils 
reload(utils)

import simple_comm as com
reload(com)

import compas.geometry as cg
import math as m

# ===== Set global constants =======

IO = 4 # Global constant
# IO Off: Gripper Closed, Suction Off
# IO On: Gripper Open, Suction On
# check IO number before setting

SAFE_DIST = safe_distance
SUCTION_ANGLES = (
    m.radians(-30.0),
    m.radians(0.0),
    m.radians(45.0)
)
GRIPPER_ANGLES_ONE = (
    m.radians(0.0),
    m.radians(0.0),
    m.radians(45.0)
)
GRIPPER_ANGLES_TWO = (
    m.radians(0.0),
    m.radians(0.0),
    m.radians(45.0)
)

script = ''
vis_frames = []

# =================================

def set_suction_tcp(script):
    """Set TCP to Vacuum Suction Tool Tip"""
    suction_script = ""
    suction_script += ur.set_tcp_by_angles(
        tcp_measured.X,
        tcp_measured.Y,
        tcp_measured.Z,
        *SUCTION_ANGLES
    )
    suction_script += ur.sleep(sleep_time) 
    return suction_script

def set_gripper_tcp(script, ori):
    """Set TCP to Gripper Tool Tip"""
    gripper_ang = GRIPPER_ANGLES_ONE if ori == 0 else GRIPPER_ANGLES_TWO
    gripper_script = ""
    gripper_script += ur.set_tcp_by_angles(
        tcp2_measured.X,
        tcp2_measured.Y,
        tcp2_measured.Z,
        *gripper_ang
    )
    gripper_script += ur.sleep(sleep_time) 
    return gripper_script

def safety_frame(frame, safety_distance):
    return frame.translated(frame.zaxis * -safety_distance)
    # negative zaxis since robot frame is pointing down

def suction_press(frame):
    return frame.translated(frame.zaxis * press_f)
    # we keep this positive as we want this to go down onto the brick

def reset_frame(script):
    reset_script = ""
    reset_script += ur.move_j([m.radians(-122.26), m.radians(-126.48), m.radians(83.87), m.radians(-45.03), m.radians(-86.12), m.radians(17.54)],1, 1)
    return reset_script

def safe_place_frame(script):
    # This is the one that will appear above the paper space
    # Freeze robot at reset frame, then adjust to above the paper space
    safe_place_script = ""
    # Record the joint angles down in the below sequence
    safe_place_script += ur.move_j([m.radians(-173.83), m.radians(-102.71), m.radians(96.35), m.radians(-84.52), m.radians(-86.11), m.radians(89.34)],1, 1)
    return safe_place_script

def pickup_brick_tray(script,pick_up_frame):
    
    pickbrick_script = ""
    # Move J in case of faulting
    pickbrick_script += reset_frame(script)
    # Translate frame to "safe" location
    above_pick_tray = safety_frame(pick_up_frame, SAFE_DIST)
    # Move to safe frame
    pickbrick_script += ur.move_l(above_pick_tray, acceleration, velocity)
    # Move to pick location
    pickbrick_script += ur.move_l(pick_up_frame, acceleration, velocity)
    # Move down a little to guarantee pick
    press_down = suction_press(pick_up_frame)
    pickbrick_script += ur.move_l(press_down, acceleration, velocity)
    # Add to the path: turn on the vacuum and wait 
    pickbrick_script += ur.set_digital_out(IO, True)
    pickbrick_script += ur.sleep(sleep_time)
    # Move back to safe plane
    pickbrick_script += ur.move_l(above_pick_tray, acceleration, velocity)

    picktray_frames = [above_pick_tray, pick_up_frame, above_pick_tray]

    return pickbrick_script, picktray_frames

def place_brick_slide(script, place_slide_frame):
    
    placeslide_script = ""
    # Move J in case of faulting
    placeslide_script += reset_frame(script)
    # Safe frame for placing
    above_slide_top = safety_frame(place_slide_frame, SAFE_DIST)
    # Add to the path: go to the safe plane
    placeslide_script += ur.move_l(above_slide_top, acceleration, velocity)
    # Add to the path: go to the place plane
    placeslide_script += ur.move_l(place_slide_frame, acceleration, velocity)
    # Add to the path: turn off the vacuum and wait 
    placeslide_script += ur.set_digital_out(IO, False)
    placeslide_script += ur.sleep(sleep_time)
    # Add to the path: go back to the safe plane
    placeslide_script += ur.move_l(above_slide_top, acceleration, velocity)

    placeslide_frames = [above_slide_top, place_slide_frame, above_slide_top]

    return placeslide_script, placeslide_frames

def pick_brick_slide(script, f1, f2, orient):

    pick_slide_frame = f1 if orient == 0 else f2

    pickslide_script = ""
    # Move J in case of faulting
    pickslide_script += reset_frame(script)
    # Safe frame for picking
    above_slide_bottom = safety_frame(pick_slide_frame, SAFE_DIST)
    # Add to the path: open gripper and wait
    pickslide_script += ur.set_digital_out(IO, True)
    pickslide_script += ur.sleep(sleep_time) 
    # Add to the path: go to the safe plane
    pickslide_script += ur.move_l(above_slide_bottom, acceleration, velocity)    
    # Add to the path: go to the place plane
    pickslide_script += ur.move_l(pick_slide_frame, acceleration, velocity)    
    # Add to the path: close gripper and wait
    pickslide_script += ur.set_digital_out(IO, False)
    pickslide_script += ur.sleep(sleep_time) 
    # Add to the path: go back to the safe plane
    pickslide_script += ur.move_l(above_slide_bottom, acceleration, velocity)
    
    pickslide_frames = [above_slide_bottom, pick_slide_frame, above_slide_bottom]

    return pickslide_script, pickslide_frames

def place_position(script, position_frame):
    
    place_script = ""
    # Move J to above paper space
    place_script += safe_place_frame(script)
    # Safe frame for placing
    above_place_position = safety_frame(position_frame, SAFE_DIST)
    # Add to the path: go to the safe plane
    place_script += ur.move_l(above_place_position, acceleration, velocity)    
    # Add to the path: go to the place plane
    place_script += ur.move_l(position_frame, acceleration, velocity)    
    # Add to the path: open gripper and wait
    place_script += ur.set_digital_out(IO, True)
    place_script += ur.sleep(sleep_time) 
    # Add to the path: go back to the safe plane
    place_script += ur.move_l(above_place_position, acceleration, velocity)  
    # Add to the path: close gripper and wait
    place_script += ur.set_digital_out(IO, False)
    place_script += ur.sleep(sleep_time)

    place_frames = [above_place_position, position_frame, above_place_position]

    return place_script, place_frames

script = ""
vis_frames = []
way_frames = th.tree_to_list(way_frames)
count_pick = 0

#if value given for tcp measured, then add line to script, otherwise it will take current tcp from robot
for num_wy, sub_wy in enumerate(way_frames):
    # num_wy: index of row of bricks to place
    # sub_wy: nested list of bricks per row    
    for n_way, wy in enumerate(sub_wy):
        # n_way: index of brick/frame
        # wy: way frame
        if tcp_measured is not None:

            # 1. Set to suction tcp and add it to script
            set_suction = set_suction_tcp(script)         
            script += set_suction
            print(count_pick)
            # 2. Picking: Call variables for picking script and frames
            pickingplace = pick_frame[count_pick]
            pickbrick_script, picktray_frames = pickup_brick_tray(script, pickingplace)
            script += pickbrick_script
            vis_frames.extend(picktray_frames)
            count_pick += 1

            # 2. Placing: Call variables for placing script and frames
            placeslide_script, placeslide_frames = place_brick_slide(script, place_slide_frame)
            script += placeslide_script
            vis_frames.extend(placeslide_frames)

            # 4. Set to gripper tcp and add it to script
            set_gripper = set_gripper_tcp(script,orientation[num_wy])
            script += set_gripper

            # 5. Gripping: Call variables for gripping(pick) script and frames
            pickslide_script, pickslide_frames = pick_brick_slide(script, pick_slide_frame, pick_slide_2_frame, orientation[num_wy])
            script += pickslide_script
            vis_frames.extend(pickslide_frames)

            # 6. Positioning: Call variables for positioning script and frames
            place_script, place_frames = place_position(script, wy)
            script += place_script
            vis_frames.extend(place_frames)


# Format the script to make it sendable
script = com.concatenate_script(script)

# Visualize
from compas_rhino import conversions
import Rhino.Geometry as rg

vis_planes = [conversions.frame_to_rhino(frame) for frame in vis_frames]
# ---------- end compas_suction_gripper ----------

# ---- group: Send UR script to Robot!
# Convert Planes to URScript
py3_16 = Python3Script(script=compas_suction_gripper.script, ip_address=panel_2, send=Button())  # -> out, a; inputs script: String, ip_address: String, send: Boolean
# ---------- py3_16: Python ----------
import simple_comm as com

if send:
    com.send_script(script,ip_address)
# ---------- end py3_16 ----------

# ----
panel_20 = Panel(compas_suction_gripper.script)  # disabled
polyline = PolyLine(Vertices=compas_suction_gripper.vis_planes, Closed=False)  # disabled
compas_draw_9 = COMPASDraw(cg=compas_suction_gripper.vis_frames)  # -> rg; same code as compas_draw
custom_preview = CustomPreview(Geometry=polyline, Material=colour_swatch)  # disabled
points = PointList(Points=compas_suction_gripper.vis_planes, Size=number_slider_7)  # disabled

# ==== cluster LinesPts
C = ClusterInput()
D = ClusterInput()
N = ClusterInput()
offset = OffsetCurve(Curve=C, Distance=expr("-x", D), Corners=1)
cp = ControlPoints(Curve=offset)  # -> Points, Weights, Knots
cull_i = CullIndex(List=cp.Points, Indices="-1", Wrap=True)
index = ItemIndex(List=cull_i, Item=cull_i)
equals = Equality(FirstNumber=expr("x%2", index), SecondNumber=0)  # -> Equality, Inequality
cull = CullPattern(List=cull_i, CullPattern=equals.Equality)
pline = PolyLine(Vertices=cull, Closed=False)
divide = DivideCurve(Curve=pline, Count=N, Kinks=False)  # -> Points, Tangents, Parameters
shift_and_subtract = ShiftAndSubtract(L=divide.Points, I="-1")  # -> L_2, L_3
ln = Line(StartPoint=shift_and_subtract.L_2, EndPoint=shift_and_subtract.L_3)
C_2 = ClusterOutput(offset)
P = ClusterOutput(divide.Points)
L = ClusterOutput(ln)

# ==== cluster Cluster
h1 = ClusterInput()
h2 = ClusterInput()
expression = Expression(h1=h1, h2=h2, Expression="1/2*(abs(h1-h2))")
expression_2 = Expression(h1=h1, h2=h2, Expression="1/2*(h1+h2)")
expression_3 = Expression(h1=h1, h2=h2, Expression="max(h1,h2)")
merge = Merge(Data1=0, Data2=expression, Data3=expression_2, Data4=expression_3)
R = ClusterOutput(merge)

# ==== cluster ClampToEven
L = ClusterInput()
lng = ListLength(List=L)
expression = Expression(x=lng, Expression="x\2*2")
series = Series(Start=0, Step=1, Count=expression)
S = ClusterOutput(series)

# ==== cluster ShiftAndSubtract
L = ClusterInput()
I = ClusterInput()
shift = ShiftList(List=L, Shift=1, Wrap=True)
cull_i = CullIndex(List=L, Indices=I, Wrap=True)
cull_i_2 = CullIndex(List=shift, Indices=I, Wrap=True)
L_2 = ClusterOutput(cull_i)
L_3 = ClusterOutput(cull_i_2)
