# Grasshopper definition 261015_101_brick_to_robot_IA01.gh (Grasshopper 1.0.8)
# plug-ins: Moonlight, Bifocals

moonlight = Moonlight(Mode=False)

# ---- group: This is needed only ONCE in the GH definition
enable_auto_reload = Python3Script()  # -> ok
# ---------- enable_auto_reload: Python ----------
"""
------------------------------
Using VS Code as Python editor
------------------------------

The simplest way to start using VS Code as our editor, is
to place our Python code in files located IN THE SAME FOLDER as our Grasshopper file.

After we have done that, we need 2 steps: 

1. Enable the COMPAS reloader on one component. This tells Grasshopper to watch for changes in the Pythoh files and reload if changed.
2. Every other component that uses Python code from external files needs to start with a method to ensure Grasshopper knows where to load the files from.

"""
# r: compas
# venv: mas-2627

from compas_rhino.devtools import DevTools
DevTools.enable_reloader()
# ---------- end enable_auto_reload ----------

# ----
python_3_script = Python3Script(
    x=Slider(2, range=0..10),
    z=Slider(30, range=0..100),
    w=Slider(15, range=0..100),
    h=Slider(10, range=0..10),
    l=Slider(32, range=0..100))  # -> bricks, frames; inputs x: Int32, z: Int32, w: Double, h: Double, l: Double
# ---------- python_3_script: Python ----------
import Rhino.Geometry as rg
import math as m
from compas.geometry import Box, Frame, Point, Vector

bricks = []
frames = []
gap = 1  # Define your mortar gap thickness here

for k in range(z):
    # Calculate the row's shared center (including the gaps)
    total_row_width = x * w + (x - 1) * gap
    row_center_x = total_row_width / 2.0
    row_center_z = k * h
    row_centroid = Point(row_center_x, 0, row_center_z)
    
    # Calculate rotation angle
    t = k / (z - 1) if z > 1 else 0
    a = t * m.tau
    axis = Vector(0, 0, 1)

    for i in range(x):
        # Shift brick centers outward by the gap amount
        brick_center_x = (i * (w + gap)) + (w / 2.0)
        pt = Point(brick_center_x, 0, k * (h))
        
        f = Frame(pt,[1, 0, 0], [0, -1, 0])
        # Shrink the box width slightly so the physical gap appears
        box = Box(w - gap, l, h, f)
        box.rotate(a, axis, row_centroid)
        f.rotate(a, axis, row_centroid)

        bricks.append(box)
        frames.append(f)
# ---------- end python_3_script ----------
compas_draw = COMPASDraw(cg=python_3_script.bricks)  # -> rg
#   port cg: The COMPAS geometry or datastructure to be drawn.
#   port rg: The Rhino geometry object.
# ---------- compas_draw: Python ----------
# r: compas>=2.14.1
"""
Draws COMPAS geometry in Grasshopper.
"""

from typing import Any

import Grasshopper

from compas.scene import SceneObject


class CompasToRhinoGeometry(Grasshopper.Kernel.GH_ScriptInstance):
    def RunScript(self, cg):
        if not cg:
            return None

        return SceneObject(item=cg).draw()
# ---------- end compas_draw ----------
preview = CustomPreview(
    Geometry=compas_draw,
    Material={diffuse=RGB(197, 130, 64), emission=RGB(68, 53, 68), shine=0.5, specular=RGB(255, 254, 254), transparency=0})

lamcp_bridge = LAMCPBridge(enable=Toggle(True))  # -> status; inputs enable: Boolean, port: Int32
#   port enable: Toggle to start (True) or stop (False) the local HTTP server.
#   port port: Port to listen on (loopback only). Defaults to 8765.
#   port status: Current server status string.
# ---------- lamcp_bridge: Python ----------
"""
LAMCP Bridge: local HTTP server inside Rhino 8 / Grasshopper CPython.

Exposes `POST /exec` (JSON: `{"code": "...", "timeout": 30}`) which
exec()s `code` and returns
`{"stdout": "...", "stderr": "...", "result": "...", "error": null|str}`.

Pair with the `lamcp` FastMCP server, which translates Claude's
`run_python_script` MCP tool calls into POSTs to this endpoint.

Binds to 127.0.0.1 only. NEVER expose beyond localhost â€” it exec()s
arbitrary Python with full Rhino API access.

LAMCP v0.1.0
"""

import contextlib
import io
import json
import threading
import traceback
from http.server import BaseHTTPRequestHandler
from http.server import HTTPServer

import Grasshopper
import scriptcontext as sc


SHARED_GLOBALS_KEY = "_lamcp_bridge_globals"
SERVER_KEY = "_lamcp_bridge_server"


def _exec_code(code, timeout):
    """Run `code` on the HTTP-server thread and capture stdout/stderr/result.

    NOTE: this is intentionally NOT marshalled to Rhino's UI thread for the
    spike â€” `Rhino.RhinoApp.InvokeOnUiThread` was queueing actions that
    never fired in Rhino 8 CPython. Most read-only RhinoCommon access is
    safe cross-thread; mutations may crash. Add Eto-based marshalling
    back here when we need it.
    """
    out = io.StringIO()
    err = io.StringIO()
    g = sc.sticky.setdefault(SHARED_GLOBALS_KEY, {"__name__": "__lamcp_bridge__"})
    error_text = None
    result_repr = None
    try:
        with contextlib.redirect_stdout(out), contextlib.redirect_stderr(err):
            exec(code, g, g)
            result_repr = repr(g.get("_"))
    except BaseException:
        error_text = traceback.format_exc()

    return {
        "stdout": out.getvalue(),
        "stderr": err.getvalue(),
        "result": result_repr,
        "error": error_text,
    }


class _ExecHandler(BaseHTTPRequestHandler):
    # Silence default request logging so it doesn't clog the Rhino command line.
    def log_message(self, fmt, *args):
        pass

    def _send(self, code, payload):
        body = json.dumps(payload).encode("utf-8")
        self.send_response(code)
        self.send_header("Content-Type", "application/json")
        self.send_header("Content-Length", str(len(body)))
        self.end_headers()
        self.wfile.write(body)

    def do_GET(self):
        if self.path == "/health":
            self._send(200, {"status": "ok"})
        else:
            self._send(404, {"error": "not found"})

    def do_POST(self):
        if self.path != "/exec":
            self._send(404, {"error": "not found"})
            return
        length = int(self.headers.get("Content-Length", "0"))
        try:
            raw = self.rfile.read(length).decode("utf-8")
            body = json.loads(raw)
            code = body.get("code", "")
            timeout = float(body.get("timeout", 30.0))
        except Exception as exc:
            self._send(400, {"error": "bad request: " + repr(exc)})
            return
        result = _exec_code(code, timeout)
        self._send(200, result)


def _start_server(port):
    server = HTTPServer(("127.0.0.1", port), _ExecHandler)
    thread = threading.Thread(
        target=server.serve_forever, daemon=True, name="lamcp-bridge"
    )
    thread.start()
    return {"server": server, "thread": thread, "port": port}


def _stop_server(state):
    try:
        state["server"].shutdown()
        state["server"].server_close()
    except Exception:
        pass


class LamcpBridgeComponent(Grasshopper.Kernel.GH_ScriptInstance):
    def RunScript(self, enable: bool, port: int):
        port = int(port) if port else 8765

        state = sc.sticky.get(SERVER_KEY)

        if not enable:
            if state is not None:
                _stop_server(state)
                del sc.sticky[SERVER_KEY]
            return "stopped"

        # Already running on the requested port: no-op.
        if (
            state is not None
            and state.get("port") == port
            and state["thread"].is_alive()
        ):
            return "listening on http://127.0.0.1:{}".format(port)

        # Port changed or server died: tear down and restart.
        if state is not None:
            _stop_server(state)
            del sc.sticky[SERVER_KEY]

        try:
            sc.sticky[SERVER_KEY] = _start_server(port)
        except OSError as exc:
            ghenv.Component.AddRuntimeMessage(  # noqa: F821
                Grasshopper.Kernel.GH_RuntimeMessageLevel.Error,
                "Failed to bind 127.0.0.1:{}: {}".format(port, exc),
            )
            return "error: {}".format(exc)

        return "listening on http://127.0.0.1:{}".format(port)
# ---------- end lamcp_bridge ----------
panel = Panel(lamcp_bridge)

gap = Slider(5, range=0..10)
reference_curve = Curve(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)
brick_wall = Python3Script(crv=reference_curve, num_layers=Slider(20, range=0..30), gap=gap)  # -> bricks, geometries, frames; inputs crv: Curve, num_layers: Int32, gap: Double
# ---------- brick_wall: Python ----------
# r: compas
# venv: mas-2627
from compas_rhino.devtools import DevTools
DevTools.ensure_path()

# 0. Import everything we will need
import math
from compas.geometry import Box
from compas.geometry import Point
from compas.geometry import Frame
from compas_rhino.conversions import curve_to_compas
from compas_rhino.conversions import curve_to_rhino
from compas.geometry import cross_vectors


# ..also import our module "brick_wall.py", that needs to be in the same folder as our GH file
from brick_wall import Brick

# 1. Start with an empty list of bricks to be created

bricks = []

# 2. Create points on curve curve

# convert the curve to a compas geometry

compas_crv = curve_to_compas(crv)

# divide the curve by the points

length = (Brick.LENGTH + gap)/2
params, points = compas_crv.divide_by_length(length, True) # unpack the list 


for i in range(num_layers):
    for j, (param, pt) in enumerate(zip(params, points)):

        if i % 2 == j % 2:

            tangent = compas_crv.tangent_at(param)
            normal = cross_vectors(tangent, [0,0,1])
            pt.z = i * Brick.HEIGHT + Brick.HEIGHT/2
            f = Frame(pt, xaxis = tangent , yaxis = normal)
            my_brick = Brick(f)
            bricks.append(my_brick)


# Visualize and store brick data

geometries =[]
frames = []

for brick in bricks:

    geometries.append(brick.draw())
    frames.append(brick.get_pick_frame())

# list comprehension

geometries = [brick.draw() for brick in bricks]
frames = [brick.get_pick_frame() for brick in bricks]
# ---------- end brick_wall ----------
compas_draw_2 = COMPASDraw(cg=brick_wall.geometries)  # -> rg; same code as compas_draw

python_3_script_2 = Python3Script(
    n=Slider(9, range=0..100),
    z=Slider(12, range=0..100),
    l=Slider(32, range=0..100),
    b=Slider(15, range=0..100),
    h=Slider(10, range=0..10))  # -> points, bricks, frame; inputs n: Int32, z: Int32, l: Double, b: Double, h: Double
# ---------- python_3_script_2: Python ----------
from compas.geometry import Point, Frame, Box
import math as m
from compas_rhino.conversions import box_to_rhino

points = []
bricks = []
frame = []
angle_step = m.tau / n
r = 50

for k in range(z):
    for i in range(n):

        if k%2 == 0:
            angle = angle_step * i

        else:
            angle = (i * angle_step) + angle_step/2

        x = r * m.cos(angle)
        y = r * m.sin(angle)
        z = k *h

        pt = Point(x,y,z)
        points.append(pt)

                # Calculate local orientation vectors so bricks curve with the cylinder
        xaxis = [m.cos(angle + m.pi/2), m.sin(angle + m.pi/2), 0] # Tangent to ring
        yaxis = [m.cos(angle), m.sin(angle), 0]                  # Radial from center
        
        f = Frame(pt, xaxis, yaxis) # Create oriented frame at the point
        brick = Box(l, b, h, f)      # Brick using your GH l, b, h slider variables
        
        # Convert directly to Rhino geometry and append to flat lists
        brick_rhino = box_to_rhino(brick)
        bricks.append(brick_rhino)
        points.append(pt)

        frame.append(f)
# ---------- end python_3_script_2 ----------
preview_2 = CustomPreview(
    Geometry=python_3_script_2.bricks,
    Material={diffuse=RGB(197, 130, 64), emission=RGB(68, 53, 68), shine=0.5, specular=RGB(255, 254, 254), transparency=0})

# ---- group: frame -> plane (preview)
frame_to_plane = Python3Script(frames=python_3_script.frames)  # -> planes; inputs frames: list
# ---------- frame_to_plane: Python ----------
"""
Convert COMPAS Frames to Rhino Planes for preview.
    Input:  frames (List Access, No Type Hint)
    Output: planes
"""
import Rhino.Geometry as rg
from compas.geometry import Frame
from compas_rhino.conversions import frame_to_rhino_plane


def to_plane(item):
    if item is None:
        return None
    if isinstance(item, rg.Plane):
        return item
    if isinstance(item, Frame):
        return frame_to_rhino_plane(item)
    raise TypeError("Not a COMPAS Frame: {}".format(type(item)))


def flatten(items):
    for item in items:
        if isinstance(item, (list, tuple)):
            for sub in flatten(item):
                yield sub
        else:
            yield item


planes = [to_plane(f) for f in flatten(frames or [])]
ghenv.Component.Message = "{} planes".format(len(planes))
# ---------- end frame_to_plane ----------

# ----
# Measure robo base
point = ValueList({"origin", "xaxis", "xypoint"}, selected="xypoint")
capture = Button()
capture_wobj = CaptureWobj(robot_ip="192.168.10.10", point_name=point, capture=capture)  # -> wobj_origin, wobj_xaxis, wobj_xypoint, info
# ---------- capture_wobj: Python ----------
"""
Capture the 3 points that define the work object (robot base) plane.

Jog the TCP to a point, pick its name (origin / xaxis / xypoint) and press capture.
The TCP position (robot base frame, mm) is saved to wobj_calibration.json next to
this .ghx file, so the points survive closing Grasshopper.
"""
import os
import sys
import json
import time

import scriptcontext as sc
import Rhino.Geometry as rg

NAMES = ["origin", "xaxis", "xypoint"]

gh_dir = os.path.dirname(ghenv.Component.OnPingDocument().FilePath)
src_dir = os.path.join(gh_dir, "src")
if src_dir not in sys.path:
    sys.path.append(src_dir)
import simple_comm as com

path = os.path.join(gh_dir, "wobj_calibration.json")

data = {}
if os.path.exists(path):
    with open(path) as f:
        data = json.load(f)

# keep the last status in sticky, so the message survives the button being released
status_key = "capture_status_" + str(ghenv.Component.InstanceGuid)

if capture:
    if point_name not in NAMES:
        sc.sticky[status_key] = "pick origin / xaxis / xypoint"
    else:
        try:
            x, y, z = list(com.listen_to_robot(robot_ip)["pose"])[:3]  # metres, robot base frame
            data[point_name] = [round(x * 1000, 2), round(y * 1000, 2), round(z * 1000, 2)]  # -> mm
            with open(path, "w") as f:
                json.dump(data, f, indent=2)
            sc.sticky[status_key] = "{} captured {}".format(point_name, time.strftime("%H:%M:%S"))
        except Exception as e:
            print(e)
            sc.sticky[status_key] = "robot not reachable"

ghenv.Component.Message = sc.sticky.get(status_key, "")

def pt(name):
    return rg.Point3d(*data[name]) if name in data else None

wobj_origin, wobj_xaxis, wobj_xypoint = pt("origin"), pt("xaxis"), pt("xypoint")
info = json.dumps(data, indent=2)
# ---------- end capture_wobj ----------

vector_2pt = Vector2Pt(PointA=capture_wobj.wobj_origin, PointB=capture_wobj.wobj_xypoint, Unitize=False)  # -> Vector, Length
wobj_corner = Move(Geometry=capture_wobj.wobj_xaxis, Motion=vector_2pt.Vector)  # -> Geometry, Transform
_4point_surface = _4PointSurface(
    CornerA=capture_wobj.wobj_origin,
    CornerB=capture_wobj.wobj_xaxis,
    CornerC=wobj_corner.Geometry,
    CornerD=capture_wobj.wobj_xypoint)

fine_adjust_z_mm = Slider(45, range=-5..500)
transform = Python3Script(
    way_planes=python_3_script.frames,
    wobj_origin=capture_wobj.wobj_origin,
    wobj_xaxis=capture_wobj.wobj_xaxis,
    wobj_xypoint=capture_wobj.wobj_xypoint,
    z_safe_margin=fine_adjust_z_mm)  # -> out, flatten(transformed_frames); inputs way_planes: list, wobj_origin: Point3d, wobj_xaxis: Point3d, wobj_xypoint: Point3d, z_safe_margin: Double
# ---------- transform: Python ----------
from compas.geometry import Frame, Transformation, Translation, Vector
#in this step we transform our way planes to robot space
#the rhino co-ordinate system is rather abstract in the physical world
#the robot base plane assumed the base frame of robot is the origin
#but rhino does not know that
#thus we transform things from our design space(Rhino World XY) to Robot Base Plane that we measure

def set_robot_base(origin, xaxis, xypoint):
    """
    set a base plane representing the robot working object plane
    """
     # 1. Extracted the vectors from the corner origin
    vec_x =  xaxis - origin
    vec_y =  xypoint - origin
    
    # 2. Calculated the center point (halfway along X and Y)
    center_origin = origin + vec_x * 0.5 + vec_y * 0.5

    robot_base = Frame(center_origin, vec_x, vec_y)
    print (robot_base)
    return (robot_base)

def rhino_to_robot_space(rhino_plane,robot_base_plane):

    """
    Transform the objects from Rhino world XY plane to robot work object plane
    """
    T_matrix = Transformation.from_frame_to_frame(Frame.worldXY(), robot_base_plane)
    robot_plane = rhino_plane.transformed(T_matrix)
    return robot_plane

def set_z_safe_margin(planes_to_adjust, safety_margin):
    adjusted = []
    T = Translation.from_vector(Vector(0, 0, safety_margin))
    for f in planes_to_adjust:
        adjusted.append(f.transformed(T))
    return adjusted

# ===== Robot base is set =====
robot_base =  set_robot_base(wobj_origin, wobj_xaxis, wobj_xypoint)

# ===== Set safety margin for Z height ======
safe_planes = set_z_safe_margin(way_planes, z_safe_margin)


# ===== Transforming the rhino planes into robot planes =====
transformed_frames = []
for plane in safe_planes: 
    transformed_frames.append(rhino_to_robot_space(plane, robot_base))
# ---------- end transform ----------

# ---- group: frame -> plane (preview)
frame_to_plane_2 = Python3Script(frames=transform.transformed_frames)  # -> planes; inputs frames: list; same code as frame_to_plane

# ----
# Measure pick up location
point_2 = ValueList({"origin", "xaxis", "xypoint"}, selected="xaxis")
capture_2 = Button()
capture_pick = CapturePick(robot_ip="192.168.10.10", point_name=point_2, capture=capture_2)  # -> origin, xaxis_pt, xy_pt, info
# ---------- capture_pick: Python ----------
"""
Capture the 3 points that define the pick frame at the brick pick-up location.

Jog the TCP to a point, pick its name (origin / xaxis / xypoint) and press capture.
The TCP position (robot base frame, mm) is saved to pick_calibration.json next to
this .ghx file, so the points survive closing Grasshopper.
"""
import os
import sys
import json
import time

import scriptcontext as sc
import Rhino.Geometry as rg

NAMES = ["origin", "xaxis", "xypoint"]

gh_dir = os.path.dirname(ghenv.Component.OnPingDocument().FilePath)
src_dir = os.path.join(gh_dir, "src")
if src_dir not in sys.path:
    sys.path.append(src_dir)
import simple_comm as com

path = os.path.join(gh_dir, "pick_calibration.json")

data = {}
if os.path.exists(path):
    with open(path) as f:
        data = json.load(f)

# keep the last status in sticky, so the message survives the button being released
status_key = "capture_status_" + str(ghenv.Component.InstanceGuid)

if capture:
    if point_name not in NAMES:
        sc.sticky[status_key] = "pick origin / xaxis / xypoint"
    else:
        try:
            x, y, z = list(com.listen_to_robot(robot_ip)["pose"])[:3]  # metres, robot base frame
            data[point_name] = [round(x * 1000, 2), round(y * 1000, 2), round(z * 1000, 2)]  # -> mm
            with open(path, "w") as f:
                json.dump(data, f, indent=2)
            sc.sticky[status_key] = "{} captured {}".format(point_name, time.strftime("%H:%M:%S"))
        except Exception as e:
            print(e)
            sc.sticky[status_key] = "robot not reachable"

ghenv.Component.Message = sc.sticky.get(status_key, "")

def pt(name):
    return rg.Point3d(*data[name]) if name in data else None

origin, xaxis_pt, xy_pt = pt("origin"), pt("xaxis"), pt("xypoint")
info = json.dumps(data, indent=2)
# ---------- end capture_pick ----------

# ----
# Generate Geometry
# Transform geometry to robobase
wobj_calibration = Panel(capture_wobj.info)
pick_calibration = Panel(capture_pick.info)

# ----
# pickup_base_rhino for reference
vector_2pt_2 = Vector2Pt(PointA=capture_pick.origin, PointB=capture_pick.xy_pt, Unitize=False)  # -> Vector, Length
pick_corner = Move(Geometry=capture_pick.xaxis_pt, Motion=vector_2pt_2.Vector)  # -> Geometry, Transform
_4point_surface_2 = _4PointSurface(CornerA=capture_pick.origin, CornerB=capture_pick.xaxis_pt, CornerC=pick_corner.Geometry, CornerD=capture_pick.xy_pt)

point_3 = Point(capture_pick.origin)
python_3_script_3 = Python3Script(pt=point_3, n_x=Slider(3, range=0..10), n_y=Slider(5, range=0..100))  # -> out, frames, ref_pt; inputs pt: Point3d, n_x: Int32, n_y: Int32
# ---------- python_3_script_3: Python ----------
from compas.geometry import Point, Frame, Vector
from compas.geometry import Polygon
from compas_rhino.conversions import point_to_compas

# Rename your input reference point to avoid overwriting it
ref_pt = point_to_compas(pt)  

frames = []
l = 32
w = 15
h = 45
offset_x = 28
offset_y = 15

# i iterates over x-axis, j iterates over y-axis
for i in range(n_x):
    for j in range(n_y):

        # Calculate coordinates relative to the original reference point
        x = ref_pt.x  - j*30 - offset_y
        y = ref_pt.y +  i*50 + offset_x
        z = ref_pt.z + h

        
        # Create the grid point and frame
        grid_pt = Point(x, y, z)
        # Keeps X normal, flips Y, which forces the Z-axis to point downwards
        f = Frame(grid_pt, [1, 0, 0], [0, -1, 0])

    
        
        frames.append(f)
# ---------- end python_3_script_3 ----------

# ----
# Measure the TCP
panel_2 = Panel("-0.98")
pt = ConstructPoint(XCoordinate="-0.24", YCoordinate=panel_2, ZCoordinate="129.8")

number_slider = Slider(0.5, range=0..1)

# ----
# Convert Planes to URScript
compas = Python3Script(
    way_frames=transform.transformed_frames,
    tcp_measured=pt,
    a=number_slider,
    v=number_slider,
    pickup_frames=python_3_script_3.frames)  # -> out, vis_frames, vis_planes, script; inputs way_frames: list, tcp_measured: Point3d, a: Double, v: Double, pickup_frames: list
# ---------- compas: Python ----------
from imp import reload
import sys
import os

#get current file path
path = ghenv.Component.OnPingDocument().FilePath
#get parent directory of the parent directory
parentdir = os.path.dirname(path)
#get src folder which contains classes
dire = os.path.join(parentdir,'src')

sys.path.append(dire)

import simple_ur_script as ur
reload(ur)

import utils 
reload(utils)

import simple_comm as com
reload(com)

import compas.geometry as cg
import math as m

# ===== Set global constants =======

IO = 0 # Global constant
sd = 50

# =================================

script = "" #create empty string

def pickup_brick(script, pick_frame):

    frames = []

    # Translate frame to "safe" location
    safe_pick_frame = pick_frame.copy()
    safe_pick_frame.point.z += sd

    # Move to safe frame
    script += ur.move_l(safe_pick_frame, a, v)

    # Move to pick location
    script += ur.move_l(pick_frame, a, v)

    # Activate gripper
    script += ur.set_digital_out(IO, True)
    script += ur.sleep(1.5)

    # Move back to safe plane
    script += ur.move_l(safe_pick_frame, a, v)

    frames.extend([safe_pick_frame, pick_frame, safe_pick_frame])

    return script, frames


def place_brick(script, place_frame):
    frames = []
    
    # Safe frame for placing
    safe_place_frame = place_frame.copy()
    safe_place_frame.point.z += sd

    # Add to the path: go to the safe plane
    script += ur.move_l(safe_place_frame, a, v)

    # Add to the path: go to the place plane
    script += ur.move_l(place_frame, a, v)
    
    # Add to the path: turn off the vacuum and wait 1 second (hold the brick)
    script += ur.set_digital_out(IO, False)
    script += ur.sleep(1.5)
    
    # Add to the path: go back to the safe plane
    script += ur.move_l(safe_place_frame, a, v)

    frames.extend([safe_place_frame, place_frame, safe_place_frame])
    
    return script, frames


#if value given for tcp measured, then add line to script, otherwise it will take current tcp from robot
if tcp_measured is not None:
    script += ur.set_tcp_by_angles(tcp_measured.X, tcp_measured.Y, tcp_measured.Z, m.radians(0.0), m.radians(0.0), m.radians(45))


vis_frames = []

# ===== Generate pick and place sequence =====
# Loops exactly 220 times (once for each position in way_frames)
for i in range(len(way_frames)):
    
    # 1. Grab the current place frame
    current_place_frame = way_frames[i]
    
    # 2. Cycle through the 40 pickup frames smoothly (0 to 39, then wraps back to 0)
    pickup_index = i % len(pickup_frames)
    current_pick_frame = pickup_frames[pickup_index]

    # 3. Generate the pickup script actions
    script, pif = pickup_brick(script, current_pick_frame)
    vis_frames.extend(pif)
    
    # 4. Generate the placement script actions
    script, place_frames_list = place_brick(script, current_place_frame)
    vis_frames.extend(place_frames_list)
    print(place_frames_list)


# Format the script to make it sendable
script = com.concatenate_script(script)

# Visualize
from compas_rhino import conversions
import Rhino.Geometry as rg

vis_planes = [conversions.frame_to_rhino(frame) for frame in vis_frames]
# ---------- end compas ----------

frame_to_plane_3 = Python3Script(frames=compas.vis_frames)  # -> planes; inputs frames: list; same code as frame_to_plane
pline = PolyLine(Vertices=compas.vis_planes, Closed=False)
points = PointList(Points=compas.vis_planes, Size=Slider(5, range=0..100))

# ----
# Send to Robot
panel_3 = Panel("192.168.10.10")
py3 = Python3Script(script=compas.script, ip_address=panel_3, send=Button())  # -> out, a; inputs script: String, ip_address: String, send: Boolean
# ---------- py3: Python ----------
import simple_comm as com

if send:
    com.send_script(script,ip_address)
# ---------- end py3 ----------
