# Grasshopper definition 261020_brick_to_robot_IA02.gh (Grasshopper 1.0.8)
# plug-ins: Moonlight

moonlight = Moonlight(Mode=False)

# ---- group: This is needed only ONCE in the GH definition
# // UR Scipt for flemish bond brick wall
enable_auto_reload = Python3Script()  # -> ok
# ---------- enable_auto_reload: Python ----------
"""
------------------------------
Using VS Code as Python editor
------------------------------

The simplest way to start using VS Code as our editor, is
to place our Python code in files located IN THE SAME FOLDER as our Grasshopper file.

After we have done that, we need 2 steps: 

1. Enable the COMPAS reloader on one component. This tells Grasshopper to watch for changes in the Pythoh files and reload if changed.
2. Every other component that uses Python code from external files needs to start with a method to ensure Grasshopper knows where to load the files from.

"""
# r: compas
# venv: mas-2627

from compas_rhino.devtools import DevTools
DevTools.enable_reloader()
# ---------- end enable_auto_reload ----------

# ---- group: flemish brick bond rotated with attractor point
att_pt = Point(<point referenced from the Rhino model>)
python_3_script = Python3Script(
    n_x=Slider(7, range=0..100),
    n_z=Slider(10, range=0..100),
    length=Slider(32, range=0..100),
    width=Slider(15, range=0..100),
    height=Slider(10, range=0..10),
    att_pt=att_pt)  # -> bricks, points, frames; inputs n_x: Int32, n_z: Int32, length: Double, height: Double, att_pt: Point3d
# ---------- python_3_script: Python ----------
from compas.geometry import Point, Box, Frame, Translation, Rotation, midpoint_point_point, Point
from compas_rhino.conversions import point_to_rhino
import math as m


bricks = []
points = []
gap = 7.5

for j in range(n_z):
    # 1. Calculate Z position for the current layer
    z = j * height
    
    
    for i in range(n_x):
        if i % 2 == 0:
            x = ( (i/2 * (length + width)) + length/2 ) + gap*i
        else:
            x = ( (((i+1)/2) * length) + (((i-1)/2) * width) + (width/2) ) + gap*i
            

        # 4. Construct your point or box using (final_x, y, z) here...
        pt = Point(x,width/2 ,j*height,z)
        f = Frame(pt)
        points.append(pt)
        if j % 2 == i % 2:
            b = Box(width, length, height, f) # Stretcher
        else:
            b = Box(length, width, height, f) # Header

        bricks.append(b)

for b in bricks:
    pt = b.frame.point
    r_pt = point_to_rhino(pt)
    dist = att_pt.DistanceTo(r_pt) * 0.1
    b.rotate(m.radians(dist),(0,0,1),r_pt)
    print(dist)

frames = []

for b in bricks:
    pt = b.frame.point
    f = Frame(pt, [1,0,0], [0,-1,0])
    frames.append(f)
# ---------- end python_3_script ----------
compas_draw = COMPASDraw(cg=python_3_script.bricks)  # -> rg
#   port cg: The COMPAS geometry or datastructure to be drawn.
#   port rg: The Rhino geometry object.
# ---------- compas_draw: Python ----------
# r: compas>=2.14.1
"""
Draws COMPAS geometry in Grasshopper.
"""

from typing import Any

import Grasshopper

from compas.scene import SceneObject


class CompasToRhinoGeometry(Grasshopper.Kernel.GH_ScriptInstance):
    def RunScript(self, cg):
        if not cg:
            return None

        return SceneObject(item=cg).draw()
# ---------- end compas_draw ----------
compas_draw_2 = COMPASDraw(cg=python_3_script.points)  # -> rg; same code as compas_draw
custom_preview = CustomPreview(
    Geometry=compas_draw,
    Material={diffuse=RGB(221, 160, 221), emission=RGB(66, 48, 66), shine=0.5, specular=RGB(255, 255, 255), transparency=0})

# ----
python_3_script_2 = Python3Script(
    n=Slider(9, range=0..100),
    z=Slider(12, range=0..100),
    l=Slider(32, range=0..100),
    b=Slider(15, range=0..100),
    h=Slider(10, range=0..10))  # -> points, bricks, frame; inputs n: Int32, z: Int32, l: Double, b: Double, h: Double
# ---------- python_3_script_2: Python ----------
from compas.geometry import Point, Frame, Box
import math as m
from compas_rhino.conversions import box_to_rhino

points = []
bricks = []
frame = []
angle_step = m.tau / n
r = 50

for k in range(z):
    for i in range(n):

        if k%2 == 0:
            angle = angle_step * i

        else:
            angle = (i * angle_step) + angle_step/2

        x = r * m.cos(angle)
        y = r * m.sin(angle)
        z = k *h

        pt = Point(x,y,z)
        points.append(pt)

                # Calculate local orientation vectors so bricks curve with the cylinder
        xaxis = [m.cos(angle + m.pi/2), m.sin(angle + m.pi/2), 0] # Tangent to ring
        yaxis = [m.cos(angle), m.sin(angle), 0]                  # Radial from center
        
        f = Frame(pt, xaxis, yaxis) # Create oriented frame at the point
        brick = Box(l, b, h, f)      # Brick using your GH l, b, h slider variables
        
        # Convert directly to Rhino geometry and append to flat lists
        brick_rhino = box_to_rhino(brick)
        bricks.append(brick_rhino)
        points.append(pt)

        frame.append(f)
# ---------- end python_3_script_2 ----------
preview = CustomPreview(
    Geometry=python_3_script_2.bricks,
    Material={diffuse=RGB(197, 130, 64), emission=RGB(68, 53, 68), shine=0.5, specular=RGB(255, 254, 254), transparency=0})

python_3_script_3 = Python3Script(
    x=Slider(4, range=0..10),
    z=Slider(30, range=0..100),
    w=Slider(15, range=0..100),
    h=Slider(10, range=0..10),
    l=Slider(32, range=0..100))  # -> bricks, frames; inputs x: Int32, z: Int32, w: Double, h: Double, l: Double
# ---------- python_3_script_3: Python ----------
import Rhino.Geometry as rg
import math as m
from compas.geometry import Box, Frame, Point, Vector

bricks = []
frames = []
gap = 2  # Define your mortar gap thickness here

for k in range(z):
    # Calculate the row's shared center (including the gaps)
    total_row_width = x * w + (x - 1) * gap
    row_center_x = total_row_width / 2.0
    row_center_z = k * h
    row_centroid = Point(row_center_x, 0, row_center_z)
    
    # Calculate rotation angle
    t = k / (z - 1) if z > 1 else 0
    a = t * m.tau
    axis = Vector(0, 0, 1)

    for i in range(x):
        # Shift brick centers outward by the gap amount
        brick_center_x = (i * (w + gap)) + (w / 2.0)
        pt = Point(brick_center_x, 0, k * (h))
        
        f = Frame(pt,[1, 0, 0], [0, -1, 0])
        # Shrink the box width slightly so the physical gap appears
        box = Box(w - gap, l, h, f)
        box.rotate(a, axis, row_centroid)
        f.rotate(a, axis, row_centroid)
        f.rotate(m.radians(90), f.zaxis, f.point)

        bricks.append(box)
        frames.append(f)
# ---------- end python_3_script_3 ----------
compas_draw_3 = COMPASDraw(cg=python_3_script_3.bricks)  # -> rg; same code as compas_draw
preview_2 = CustomPreview(
    Geometry=compas_draw_3,
    Material={diffuse=RGB(197, 130, 64), emission=RGB(68, 53, 68), shine=0.5, specular=RGB(255, 254, 254), transparency=0})

gap = Slider(5, range=0..10)
reference_curve = Curve(<curve referenced from the Rhino model>)
brick_wall = Python3Script(crv=reference_curve, num_layers=Slider(20, range=0..30), gap=gap)  # -> bricks, geometries, frames; inputs crv: Curve, num_layers: Int32, gap: Double
# ---------- brick_wall: Python ----------
# r: compas
# venv: mas-2627
from compas_rhino.devtools import DevTools
DevTools.ensure_path()

# 0. Import everything we will need
import math
from compas.geometry import Box
from compas.geometry import Point
from compas.geometry import Frame
from compas_rhino.conversions import curve_to_compas
from compas_rhino.conversions import curve_to_rhino
from compas.geometry import cross_vectors


# ..also import our module "brick_wall.py", that needs to be in the same folder as our GH file
from brick_wall import Brick

# 1. Start with an empty list of bricks to be created

bricks = []

# 2. Create points on curve curve

# convert the curve to a compas geometry

compas_crv = curve_to_compas(crv)

# divide the curve by the points

length = (Brick.LENGTH + gap)/2
params, points = compas_crv.divide_by_length(length, True) # unpack the list 


for i in range(num_layers):
    for j, (param, pt) in enumerate(zip(params, points)):

        if i % 2 == j % 2:

            tangent = compas_crv.tangent_at(param)
            normal = cross_vectors(tangent, [0,0,1])
            pt.z = i * Brick.HEIGHT + Brick.HEIGHT/2
            f = Frame(pt, xaxis = tangent , yaxis = normal)
            my_brick = Brick(f)
            bricks.append(my_brick)


# Visualize and store brick data

geometries =[]
frames = []

for brick in bricks:

    geometries.append(brick.draw())
    frames.append(brick.get_pick_frame())

# list comprehension

geometries = [brick.draw() for brick in bricks]
frames = [brick.get_pick_frame() for brick in bricks]
# ---------- end brick_wall ----------
compas_draw_4 = COMPASDraw(cg=brick_wall.geometries)  # -> rg; same code as compas_draw

compas_draw_5 = COMPASDraw(cg=python_3_script_3.frames)  # -> rg; same code as compas_draw

point = ValueList({"origin", "xaxis", "xypoint"}, selected="xypoint")
capture = Button()
capture_wobj = CaptureWobj(robot_ip="192.168.10.10", point_name=point, capture=capture)  # -> wobj_origin, wobj_xaxis, wobj_xypoint, info
# ---------- capture_wobj: Python ----------
"""
Capture the 3 points that define the work object (robot base) plane.

Jog the TCP to a point, pick its name (origin / xaxis / xypoint) and press capture.
The TCP position (robot base frame, mm) is saved to wobj_calibration.json next to
this .ghx file, so the points survive closing Grasshopper.
"""
import os
import sys
import json
import time

import scriptcontext as sc
import Rhino.Geometry as rg

NAMES = ["origin", "xaxis", "xypoint"]

gh_dir = os.path.dirname(ghenv.Component.OnPingDocument().FilePath)
src_dir = os.path.join(gh_dir, "src")
if src_dir not in sys.path:
    sys.path.append(src_dir)
import simple_comm as com

path = os.path.join(gh_dir, "wobj_calibration.json")

data = {}
if os.path.exists(path):
    with open(path) as f:
        data = json.load(f)

# keep the last status in sticky, so the message survives the button being released
status_key = "capture_status_" + str(ghenv.Component.InstanceGuid)

if capture:
    if point_name not in NAMES:
        sc.sticky[status_key] = "pick origin / xaxis / xypoint"
    else:
        try:
            x, y, z = list(com.listen_to_robot(robot_ip)["pose"])[:3]  # metres, robot base frame
            data[point_name] = [round(x * 1000, 2), round(y * 1000, 2), round(z * 1000, 2)]  # -> mm
            with open(path, "w") as f:
                json.dump(data, f, indent=2)
            sc.sticky[status_key] = "{} captured {}".format(point_name, time.strftime("%H:%M:%S"))
        except Exception as e:
            print(e)
            sc.sticky[status_key] = "robot not reachable"

ghenv.Component.Message = sc.sticky.get(status_key, "")

def pt(name):
    return rg.Point3d(*data[name]) if name in data else None

wobj_origin, wobj_xaxis, wobj_xypoint = pt("origin"), pt("xaxis"), pt("xypoint")
info = json.dumps(data, indent=2)
# ---------- end capture_wobj ----------

# ---- group: rotating alternate brick planes by 90 degrees for the 2 tcps
python_3_script_4 = Python3Script(frames=python_3_script.frames)  # -> out, flatten(rot_frames); inputs frames: list
# ---------- python_3_script_4: Python ----------
import math as m
from compas.geometry import Rotation, Vector, Point

rot_frames = []

for i, f in enumerate(frames):
    
    if i % 2 == 0:
        modified_frame = f
    else:
        # Use .rotated() to return a copy, and f.zaxis to spin around its own center
        modified_frame = f.rotated(m.radians(90), f.zaxis, f.point)
        
    rot_frames.append(modified_frame)
# ---------- end python_3_script_4 ----------

# ----
python_3_script_5 = Python3Script(
    n_x=Slider(5, range=0..100),
    n_z=Slider(10, range=0..100),
    length=Slider(32, range=0..100),
    width=Slider(15, range=0..100),
    height=Slider(10, range=0..10))  # -> bricks, points, frames; inputs n_x: Int32, n_z: Int32, length: Double, height: Double
# ---------- python_3_script_5: Python ----------
from compas.geometry import Point, Box, Frame, Translation, Rotation, midpoint_point_point
import math as m


bricks = []
points = []
gap = 1.5

for j in range(n_z):
    # 1. Calculate Z position for the current layer
    z = j * height
    
    
    for i in range(n_x):
        if i % 2 == 0:
            x = ( (i/2 * (length + width)) + length/2 ) + gap*i
        else:
            x = ( (((i+1)/2) * length) + (((i-1)/2) * width) + (width/2) ) + gap*i
            

        # 4. Construct your point or box using (final_x, y, z) here...
        pt = Point(x,width/2 ,j*height,z)
        f = Frame(pt)
        points.append(pt)
        if j % 2 == i % 2:
            b = Box(width, length, height, f) # Stretcher
        else:
            b = Box(length, width, height, f) # Header

        bricks.append(b)


frames = []

for b in bricks:
    pt = b.frame.point
    f = Frame(pt, [1,0,0], [0,-1,0])
    frames.append(f)
# ---------- end python_3_script_5 ----------
compas_draw_6 = COMPASDraw(cg=python_3_script_5.bricks)  # -> rg; same code as compas_draw
compas_draw_7 = COMPASDraw(cg=python_3_script_5.points)  # -> rg; same code as compas_draw

pt = ConstructPoint(XCoordinate="12.54", YCoordinate="12.48", ZCoordinate="116.01")

# ---- group: create pickup planes from the brick depot
xypoint = Panel("""-62.52,
367.39,
-4.51""")
xaxis = Panel("""90.04,
521.78,
-4.83""")
origin = Panel("""90.32,
367.78,
-4.14""")
python_3_script_6 = Python3Script(
    pickup_base_origin=origin,
    n_z=Slider(5, range=0..10),
    tol_x=Slider(-0.5, range=-20..20),
    tol_y=Slider(-0.5, range=-20..20),
    tol_z=Slider(4, range=-20..20))  # -> out, frames, points, depot_frame; inputs pickup_base_origin: Point3d, n_z: Int32
# ---------- python_3_script_6: Python ----------
from compas.geometry import Point, Frame, Vector
from compas.geometry import Polygon
from compas_rhino.conversions import point_to_compas
import math as m

# convert the origin point of pickup base to a compas point
ref_pt = point_to_compas(pickup_base_origin)  

frames = [] # empty list for frames w.r.t origin
points = [] # empty list for grid of points w.r.t origin

# brick dimensions
l = 32
w = 15
h = 10

# frame offsets w.r.t the pickup base
offset_x = 17.5 + tol_x
offset_y = 27.5 + tol_y
offset_z = 4 + tol_z

# Depot size
n_x = 3
n_y = 5

#  Loop through Z from top layer down to the bottom layer
for k in reversed(range(n_z)):
    for j in range(n_y):
        for i in range(n_x):

            # Calculate coordinates relative to the original reference point
            x = ref_pt.x - j*30 - offset_x
            y = ref_pt.y + i*50 + offset_y
            z = ref_pt.z + k*12 + offset_z
            
            # Create the grid point and frame
            grid_pt = Point(x, y, z)
            
            # Keeps X normal, flips Y, which forces the Z-axis to point downwards
            f = Frame(grid_pt, [-1, 0, 0], [0, 1, 0])
            # Custom rotation wrt the T.C.P
            f = f.rotated(m.radians(90), axis=f.zaxis, point=f.point)
            
            frames.append(f)
            points.append(grid_pt)


# Dump frames to dump the depot frame. We will create this frame after every 15 points

centroid_frame = frames[7].copy()
centroid_frame.point.z += 12/2
centroid_frame.rotate(m.radians(90), centroid_frame.zaxis, centroid_frame.point)

for i in range(n_z):
#      Copy the centroid frame as dump frame
    dump_frame = centroid_frame.copy()
    dump_frame.point.z -= (12) * (i)   
     # Calculate the exact insertion index
    insert_index = ((i) * 15) + i   
    frames.insert(insert_index, dump_frame)

# for i in range(n_z-1):
# #      Copy the centroid frame as dump frame
#     dump_frame = centroid_frame.copy()
#     dump_frame.point.z -= (12) * (i+1)   
#      # Calculate the exact insertion index
#     insert_index = ((i+1) * 15) + i   
#     frames.insert(insert_index, dump_frame)



 # 3. Re-generate the points list to keep it synchronized with the new frames
points = [f.point for f in frames]
# ---------- end python_3_script_6 ----------
python_3_script_7 = Python3Script(Origin=origin, Xaxis=xaxis, XYpoint=xypoint)  # -> out, Rectangle; inputs Origin: Point3d, Xaxis: Point3d, XYpoint: Point3d
# ---------- python_3_script_7: Python ----------
import Rhino.Geometry as rg

# Create plane from origin and axis vectors
plane = rg.Plane(Origin, Xaxis - Origin, XYpoint - Origin)

# Calculate distances (width and height)
x_size = Origin.DistanceTo(Xaxis)
y_size = Origin.DistanceTo(XYpoint)

# Output the rectangle as a curve to 'Rectangle'
Rectangle = rg.Rectangle3d(plane, x_size, y_size).ToNurbsCurve()
# ---------- end python_3_script_7 ----------
compas_draw_8 = COMPASDraw(cg=python_3_script_6.points)  # -> rg; same code as compas_draw
points = PointList(Points=compas_draw_8, Size=Slider(4, range=0..10))

# ---- group: transform rhino planes to robo base
fine_adjust_z_mm = Slider(22, range=-5..500)
xaxis_2 = Panel("""535.83,
513.91,
-12.43""")
xypoint_2 = Panel("""229.24,
-79.84,
-11.39""")
origin_2 = Panel("""535.77,
-80.72,
-11.6""")
transform = Python3Script(
    way_planes=python_3_script_4.rot_frames,
    wobj_origin=origin_2,
    wobj_xaxis=xaxis_2,
    wobj_xypoint=xypoint_2,
    z_safe_margin=fine_adjust_z_mm)  # -> out, flatten(transformed_frames); inputs way_planes: list, wobj_origin: Point3d, wobj_xaxis: Point3d, wobj_xypoint: Point3d, z_safe_margin: Double
# ---------- transform: Python ----------
from compas.geometry import Frame, Transformation, Translation, Vector
#in this step we transform our way planes to robot space
#the rhino co-ordinate system is rather abstract in the physical world
#the robot base plane assumed the base frame of robot is the origin
#but rhino does not know that
#thus we transform things from our design space(Rhino World XY) to Robot Base Plane that we measure

def set_robot_base(origin, xaxis, xypoint):
    """
    set a base plane representing the robot working object plane
    """
     # 1. Extracted the vectors from the corner origin
    vec_x =  xaxis - origin
    vec_y =  xypoint - origin
    
    # 2. Calculated the center point (halfway along X and Y)
    center_origin = origin + vec_x * 0.5 + vec_y * 0.5

    robot_base = Frame(center_origin, vec_x, vec_y)
    print (robot_base)
    return (robot_base)

def rhino_to_robot_space(rhino_plane,robot_base_plane):

    """
    Transform the objects from Rhino world XY plane to robot work object plane
    """
    T_matrix = Transformation.from_frame_to_frame(Frame.worldXY(), robot_base_plane)
    robot_plane = rhino_plane.transformed(T_matrix)
    return robot_plane

def set_z_safe_margin(planes_to_adjust, safety_margin):
    adjusted = []
    T = Translation.from_vector(Vector(0, 0, safety_margin))
    for f in planes_to_adjust:
        adjusted.append(f.transformed(T))
    return adjusted

# ===== Robot base is set =====
robot_base =  set_robot_base(wobj_origin, wobj_xaxis, wobj_xypoint)

# ===== Set safety margin for Z height ======
safe_planes = set_z_safe_margin(way_planes, z_safe_margin)


# ===== Transforming the rhino planes into robot planes =====
transformed_frames = []
for plane in safe_planes: 
    transformed_frames.append(rhino_to_robot_space(plane, robot_base))
# ---------- end transform ----------
python_3_script_8 = Python3Script(Origin=origin_2, Xaxis=xaxis_2, XYpoint=xypoint_2)  # -> out, Rectangle; inputs Origin: Point3d, Xaxis: Point3d, XYpoint: Point3d; same code as python_3_script_7
compas_draw_9 = COMPASDraw(cg=transform.transformed_frames)  # -> rg; same code as compas_draw

# ----
origin_3 = Panel("""535.77,
-80.72,
-11.6""")
xaxis_3 = Panel("""535.83,
513.91,
-12.43""")
xypoint_3 = Panel("""229.24,
-79.84,
-11.39""")

value_list = ValueList({"Sine": 0, "Cosine": 1}, selected="Sine")
python_3_script_9 = Python3Script(
    length=Slider(32, range=0..100),
    width=Slider(15, range=0..100),
    height=Slider(10, range=0..100),
    n_x=Slider(6, range=0..10),
    n_z=Slider(50, range=0..100))  # -> all_bricks, way_planes; inputs length: Double, n_x: Int32, n_z: Int32
# ---------- python_3_script_9: Python ----------
import math as m
import Rhino.Geometry as rg
from compas.geometry import Box,Frame,Point, Vector, Rotation, Translation
from compas_rhino.conversions import point_to_compas

# Define the radius for the circle
# Divide the circle into sectors
# using sin function get the radius, using the angle and segmen length


points = []
edges = []

r = length / (2 * m.sin(m.pi /n_x))



for i in range(n_x):

    t = i/n_x
    a = t * m.tau

    x = r * m.cos(a)
    y = r * m.sin(a)
    
    pt = rg.Point3d(x,y,0)
    points.append(pt)

# for i,pt in enumerate(points[ : -1]):
#     print(pt)
#     edge = rg.LineCurve(pt,points[i+1])
#     edges.append(edge)

bricks = []
compas_pts = []
frames =[]

for pt in points:
    compas_pt = point_to_compas(pt)
    compas_pts.append(compas_pt)

from compas.geometry import midpoint_point_point
from compas.geometry import midpoint_point_point, Vector



for i, compas_pt in enumerate(compas_pts):
    next_pt = compas_pts[(i + 1) % n_x]
    
    # 1. Standard midpoint on the polygon edge
    mid_pt = midpoint_point_point(compas_pt, next_pt)
    
    v1 = Vector.from_start_end(compas_pt, next_pt)
    v2 = v1.cross([0, 0, 1])
    
    # 2. Normalize v2 to ensure its unit length is exactly 1.0
    v2.unitize()
    
    # 3. Shift the center point OUTWARD by half the brick's width
    # Note: If they shift inward instead, change the "+" to a "-" below
    shifted_center = mid_pt + v2 * ((width / 2.0) + 0)
    
    # 4. Construct the frame at the new outside-shifted center
    f = Frame(shifted_center, v1, v2)
    frames.append(f)
    
    b = Box(length, width, height, f)
    bricks.append(b)



all_bricks = []

# Outer loop: Iterates through each layer index (0, 1, 2, ... n-1)
for layer in range(n_z):
    
    # Calculate the exact Z translation distance for this specific layer
    z_shift = layer * height
    translation = Translation.from_vector([0, 0, z_shift])
    t = layer/(n_z) 
    a = (m.tau * t)
    rotation = Rotation.from_axis_and_angle([0, 0, 1], a)
    layer_transformation = translation * rotation

    # Inner loop: Iterate through your 5 original base boxes
    for base_box in bricks:
        # Create a translated copy of the box and add it to the final list
        shifted_box = base_box.transformed(layer_transformation)
        all_bricks.append(shifted_box)

way_planes = []

for brick in all_bricks:
    f = brick.frame
    f.rotate(m.pi, axis=f.zaxis, point=f.point)
    way_planes.append(f)
# ---------- end python_3_script_9 ----------
compas_draw_10 = COMPASDraw(cg=python_3_script_9.way_planes)  # -> rg; same code as compas_draw
compas_draw_11 = COMPASDraw(cg=python_3_script_9.all_bricks)  # -> rg; same code as compas_draw
custom_preview_2 = CustomPreview(
    Geometry=compas_draw_11,
    Material={diffuse=RGB(221, 160, 221), emission=RGB(66, 48, 66), shine=0.5, specular=RGB(255, 255, 255), transparency=0})

vector_2pt = Vector2Pt(PointA=capture_wobj.wobj_origin, PointB=capture_wobj.wobj_xypoint, Unitize=False)  # -> Vector, Length
distance = Distance(PointA=capture_wobj.wobj_origin, PointB=capture_wobj.wobj_xypoint)
distance_2 = Distance(PointA=capture_wobj.wobj_origin, PointB=capture_wobj.wobj_xaxis)
vector_2pt_2 = Vector2Pt(PointA=capture_wobj.wobj_origin, PointB=capture_wobj.wobj_xaxis, Unitize=False)  # -> Vector, Length
construct_plane = ConstructPlane(Origin=capture_wobj.wobj_origin, XAxis=vector_2pt_2.Vector, YAxis=vector_2pt.Vector)
rectangle = Rectangle(Plane=construct_plane, XSize=distance_2, YSize=distance, Radius=0)  # -> Rectangle, Length

pt_2 = ConstructPoint(XCoordinate="-14.21", YCoordinate="-14.75", ZCoordinate="116.68")

dump_plane_reference_point = Point(<point referenced from the Rhino model>)
python_3_script_10 = Python3Script(pt=dump_plane_reference_point)  # -> f; inputs pt: Point3d
# ---------- python_3_script_10: Python ----------
from compas.geometry import Point, Frame
from compas_rhino.conversions import point_to_compas

compas_pt = point_to_compas(pt)
f = Frame(compas_pt, [1, 0, 0], [0, -1, 0])
# ---------- end python_3_script_10 ----------

compas_draw_12 = COMPASDraw(cg=python_3_script_5.frames)  # -> rg; same code as compas_draw

fine_adjust_z_mm_2 = Slider(8, range=-5..500)
transform_2 = Python3Script(
    way_planes=python_3_script_3.frames,
    wobj_origin=capture_wobj.wobj_origin,
    wobj_xaxis=capture_wobj.wobj_xaxis,
    wobj_xypoint=capture_wobj.wobj_xypoint,
    z_safe_margin=fine_adjust_z_mm_2)  # -> out, flatten(transformed_frames); inputs way_planes: list, wobj_origin: Point3d, wobj_xaxis: Point3d, wobj_xypoint: Point3d, z_safe_margin: Double; same code as transform
compas_draw_13 = COMPASDraw(cg=transform_2.transformed_frames)  # -> rg; same code as compas_draw

custom_preview_3 = CustomPreview(
    Geometry=compas_draw_6,
    Material={diffuse=RGB(221, 160, 221), emission=RGB(66, 48, 66), shine=0.5, specular=RGB(255, 255, 255), transparency=0})

# ---- group: selects tcp 1 for odd way_planes and tcp 2 for even way_planes
compas = Python3Script(
    way_frames=transform.transformed_frames,
    pickup_frames=python_3_script_6.frames,
    tcp_1=pt,
    tcp_2=pt_2,
    dump_frame=python_3_script_10,
    a=Slider(0.2, range=0..1),
    v=Slider(1, range=0..1))  # -> out, vis_frames, vis_planes, script; inputs way_frames: list, pickup_frames: list, tcp_1: Point3d, tcp_2: Point3d, a: Double, v: Double, grb_pos: Int32
# ---------- compas: Python ----------
from imp import reload
import sys
import os

#get current file path
path = ghenv.Component.OnPingDocument().FilePath
#get parent directory of the parent directory
parentdir = os.path.dirname(path)
#get src folder which contains classes
dire = os.path.join(parentdir,'src')

sys.path.append(dire)

import simple_ur_script as ur
reload(ur)

import utils 
reload(utils)

import simple_comm as com
reload(com)

import compas.geometry as cg
import math as m

# ===== Set global constants =======

IO = 0 # Global constant
sd = 120

# =================================

script = "" #create empty string

def pickup_brick(script, pick_frame):

    frames = []

    # Translate frame to "safe" location
    safe_pick_frame = pick_frame.copy()
    safe_pick_frame.point.z += sd

    # Move to safe frame
    script += ur.move_l(safe_pick_frame, a, v)

    # Move to pick location
    script += ur.move_l(pick_frame, a, v)

    # Activate gripper
    script += ur.set_digital_out(IO, True)
    script += ur.sleep(1.5)

    # Move back to safe plane
    script += ur.move_l(safe_pick_frame, a, v)
    script += (ur.move_j([m.radians(253.70), m.radians(-90.63), m.radians(118.09), m.radians(-118.02), m.radians(-90.78), m.radians(28.16)], 1.2, 1.2))
    frames.extend([safe_pick_frame, pick_frame, safe_pick_frame])

    return script, frames


def place_brick(script, place_frame):
    frames = []
    
    # Safe frame for placing
    safe_place_frame = place_frame.copy()
    safe_place_frame.point.z += sd

    # Add to the path: go to the safe plane
    script += ur.move_l(safe_place_frame, a, v)

    # Add to the path: go to the place plane
    script += ur.move_l(place_frame, a, v)
    
    # Add to the path: turn off the vacuum and wait 1 second (hold the brick)
    script += ur.set_digital_out(IO, False)
    script += ur.sleep(1.5)
    
    # Add to the path: go back to the safe plane
    script += ur.move_l(safe_place_frame, a, v)

    frames.extend([safe_place_frame, place_frame, safe_place_frame])
    
    return script, frames


def depot_action(script, depot_frame, dump_frame):
    frames = []

    # 1. & 2. Copy the depot frame and raise its Z position by 20 units
    safe_depot_frame = depot_frame.copy()
    safe_depot_frame.point.z += 120

    # 3. UR Linear motions: approach safe position, then drop down to the depot point
    script += ur.move_l(safe_depot_frame, a, v)
    script += ur.move_l(depot_frame, a, v)

    # 4. Trigger I/O to TRUE (Grip/Activate)
    script += ur.set_digital_out(IO, True)
    script += ur.sleep(1.5)

    # 5. Move back up to the safe depot clearance height
    script += ur.move_l(safe_depot_frame, a, v)
    
    # 6. Move to the custom dump plane inputted from Grasshopper
    script += ur.move_l(dump_frame, a, v)
    
    # 7. Trigger I/O to FALSE (Release/Open)
    script += ur.set_digital_out(IO, False)
    script += ur.sleep(1.5)

    # Keep track of the generated motion sequence path for visual feedback
    frames.extend([safe_depot_frame, depot_frame, safe_depot_frame, dump_frame])

    return script, frames


vis_frames = [] 
place_counter = 0 # Track sequential progress through structural drop planes

# ===== Generate pick, place, and depot sequence =====
for i in range(len(way_frames)):
    
    # 1. TRIGGER DEPOT AFTER EVERY (i*15)+i INTERVAL (0, 16, 32...) AT THE SAME LOCATION
    if i % 16 == 0:
        depot_index = i % len(pickup_frames)
        target_depot_frame = pickup_frames[depot_index]
        
        script, depot_frames_list = depot_action(script, target_depot_frame, dump_frame)
        vis_frames.extend(depot_frames_list)
        
    # 2. RUN NORMAL PICK & PLACE ONLY ON NON-DEPOT ITERATIONS
    else:
        if place_counter < len(way_frames):
            # Target structural planes continuously using the decoupled index pointer
            current_place_frame = way_frames[place_counter]
            
            pickup_index = i % len(pickup_frames)
            current_pick_frame = pickup_frames[pickup_index]
            

            # 1. Set the correct TCP first (Even = TCP 2, Odd = TCP 1)
            if place_counter % 2 == 0:
                if tcp_2 is not None:
                    script += ur.set_tcp_by_angles(tcp_2.X, tcp_2.Y, tcp_2.Z, m.radians(0), m.radians(-45), m.radians(45))
            else:
                if tcp_1 is not None:
                    script += ur.set_tcp_by_angles(tcp_1.X, tcp_1.Y, tcp_1.Z, m.radians(-45), m.radians(0), m.radians(-45))

            # 2. Pick up the brick using that TCP
            script, pif = pickup_brick(script, current_pick_frame)
            vis_frames.extend(pif)
            
            # 3. Drop the brick using the same TCP
            script, place_frames_list = place_brick(script, current_place_frame)
            vis_frames.extend(place_frames_list)  # <--- ADD THIS MISSING LINE HERE

            # Step the structural placement pointer forward
            place_counter += 1


# Format the script to make it sendable
script = com.concatenate_script(script)

# Visualize
from compas_rhino import conversions
import Rhino.Geometry as rg
vis_planes = [conversions.frame_to_rhino(frame) for frame in vis_frames]



# Visualize
from compas_rhino import conversions
import Rhino.Geometry as rg

vis_planes = [conversions.frame_to_rhino(frame) for frame in vis_frames]
# ---------- end compas ----------
compas_draw_14 = COMPASDraw(cg=compas.vis_frames)  # -> rg; same code as compas_draw
pline = PolyLine(Vertices=compas.vis_planes, Closed=False)
points_2 = PointList(Points=compas.vis_planes, Size=Slider(7, range=0..100))

# ----
python_3_script_11 = Python3Script(x=transform_2.transformed_frames)  # -> out, a; inputs x: list
# ---------- python_3_script_11: Python ----------
import compas
import Rhino.Geometry as rg

a = []
for frame in x:
    a.append(
        rg.Plane(
            rg.Point3d(*frame.point), 
            rg.Vector3d(*frame.xaxis), 
            rg.Vector3d(*frame.yaxis)
        )
    )
# ---------- end python_3_script_11 ----------

# ---- group: This is needed only ONCE in the GH definition
enable_auto_reload_2 = Python3Script()  # -> ok; same code as enable_auto_reload

# ----
python_3_script_12 = Python3Script(
    x=Slider(4, range=0..10),
    z=Slider(30, range=0..100),
    w=Slider(15, range=0..100),
    h=Slider(10, range=0..10),
    l=Slider(32, range=0..100))  # -> bricks, frames; inputs x: Int32, z: Int32, w: Double, h: Double, l: Double; same code as python_3_script_3
compas_draw_15 = COMPASDraw(cg=python_3_script_12.bricks)  # -> rg; same code as compas_draw
compas_draw_16 = COMPASDraw(cg=python_3_script_12.frames)  # -> rg; same code as compas_draw
preview_3 = CustomPreview(
    Geometry=compas_draw_15,
    Material={diffuse=RGB(197, 130, 64), emission=RGB(68, 53, 68), shine=0.5, specular=RGB(255, 254, 254), transparency=0})

data = Data(compas_draw_13)

# ----
# Robot base
# // flemish brick wall along a straight line with point attractor
# Pickup base
# brick wall design
# Create script for UR Robot
# Run script
# TCP 1
# TCP 2
# Dump plane
panel = Panel(compas.script)

py3 = Python3Script(script=compas.script, ip_address="192.168.10.10", send=Button())  # -> out, a; inputs script: String, ip_address: String, send: Boolean
# ---------- py3: Python ----------
import simple_comm as com

if send:
    com.send_script(script,ip_address)
# ---------- end py3 ----------

point_2 = ValueList({"origin", "xaxis", "xypoint"}, selected="xypoint")
capture_2 = Button()
capture_pick = CapturePick(robot_ip="192.168.10.10", point_name=point_2, capture=capture_2)  # -> origin, xaxis_pt, xy_pt, info
# ---------- capture_pick: Python ----------
"""
Capture the 3 points that define the pick frame at the brick pick-up location.

Jog the TCP to a point, pick its name (origin / xaxis / xypoint) and press capture.
The TCP position (robot base frame, mm) is saved to pick_calibration.json next to
this .ghx file, so the points survive closing Grasshopper.
"""
import os
import sys
import json
import time

import scriptcontext as sc
import Rhino.Geometry as rg

NAMES = ["origin", "xaxis", "xypoint"]

gh_dir = os.path.dirname(ghenv.Component.OnPingDocument().FilePath)
src_dir = os.path.join(gh_dir, "src")
if src_dir not in sys.path:
    sys.path.append(src_dir)
import simple_comm as com

path = os.path.join(gh_dir, "pick_calibration.json")

data = {}
if os.path.exists(path):
    with open(path) as f:
        data = json.load(f)

# keep the last status in sticky, so the message survives the button being released
status_key = "capture_status_" + str(ghenv.Component.InstanceGuid)

if capture:
    if point_name not in NAMES:
        sc.sticky[status_key] = "pick origin / xaxis / xypoint"
    else:
        try:
            x, y, z = list(com.listen_to_robot(robot_ip)["pose"])[:3]  # metres, robot base frame
            data[point_name] = [round(x * 1000, 2), round(y * 1000, 2), round(z * 1000, 2)]  # -> mm
            with open(path, "w") as f:
                json.dump(data, f, indent=2)
            sc.sticky[status_key] = "{} captured {}".format(point_name, time.strftime("%H:%M:%S"))
        except Exception as e:
            print(e)
            sc.sticky[status_key] = "robot not reachable"

ghenv.Component.Message = sc.sticky.get(status_key, "")

def pt(name):
    return rg.Point3d(*data[name]) if name in data else None

origin, xaxis_pt, xy_pt = pt("origin"), pt("xaxis"), pt("xypoint")
info = json.dumps(data, indent=2)
# ---------- end capture_pick ----------
pick_calibration = Panel(capture_pick.info)
py3_2 = Python3Script(origin=capture_pick.origin, xaxis_pt=capture_pick.xaxis_pt, xy_pt=capture_pick.xy_pt, h=Slider(15, range=0..100))  # -> out, pick_frames, pt; inputs origin: Point3d, xaxis_pt: Point3d, xy_pt: Point3d
# ---------- py3_2: Python ----------
from compas.geometry import Frame, Point, Vector
from compas_rhino.conversions import point_to_compas

# Convert Rhino points to COMPAS points
origin = point_to_compas(origin)
xaxis_pt = point_to_compas(xaxis_pt)
xy_pt = point_to_compas(xy_pt) # Assuming this is your Y-axis point

# Define the X and Y direction vectors
vx = Vector.from_start_end(origin, xaxis_pt)
vy = Vector.from_start_end(origin, xy_pt)

# Calculate the center point of the rectangle
center = origin + vx * 0.5 + vy * 0.5
center.z += h

# Define the pick frame at the center
pick_frames = Frame(center, -vx, vy)
pt = center
# ---------- end py3_2 ----------
compas_draw_17 = COMPASDraw(cg=py3_2.pick_frames)  # -> rg; same code as compas_draw

panel_2 = Panel(data)
origin_4 = Panel("""90.32,
367,78,
-4.14""")
xaxis_4 = Panel("""90.04,
521.78,
-4.83""")
xypoint_4 = Panel("""-62.52,
367.39,
-4.51""")
python_3_script_13 = Python3Script(frames=python_3_script_5.frames)  # -> out, flatten(rot_frames); inputs frames: list; same code as python_3_script_4

vector_2pt_3 = Vector2Pt(PointA=capture_pick.origin, PointB=capture_pick.xy_pt, Unitize=False)  # -> Vector, Length
distance_3 = Distance(PointA=capture_pick.origin, PointB=capture_pick.xy_pt)
distance_4 = Distance(PointA=capture_pick.origin, PointB=capture_pick.xaxis_pt)
vector_2pt_4 = Vector2Pt(PointA=capture_pick.origin, PointB=capture_pick.xaxis_pt, Unitize=False)  # -> Vector, Length
construct_plane_2 = ConstructPlane(Origin=capture_pick.origin, XAxis=vector_2pt_4.Vector, YAxis=vector_2pt_3.Vector)
rectangle_2 = Rectangle(Plane=construct_plane_2, XSize=distance_4, YSize=distance_3, Radius=0)  # -> Rectangle, Length

panel_3 = Panel("13.76")
panel_4 = Panel("14.02")
panel_5 = Panel("116.76")

# ----
# BRICK DEPOT
number_slider = Slider(-0.5, range=-20..20)
origin_5 = Panel("""90.32,
367.78,
-4.14""")
xaxis_5 = Panel("""90.04,
521.78,
-4.83""")
xypoint_5 = Panel("""-62.52,
367.39,
-4.51""")
python_3_script_14 = Python3Script(
    pickup_base_origin=origin_5,
    n_z=Slider(4, range=0..10),
    tol_x=Slider(-0.5, range=-20..20),
    tol_y=number_slider,
    tol_z=Slider(4, range=-20..20))  # -> out, frames, points, depot_frame; inputs pickup_base_origin: Point3d, n_z: Int32; same code as python_3_script_6
python_3_script_15 = Python3Script(Origin=origin_5, Xaxis=xaxis_5, XYpoint=xypoint_5)  # -> out, Rectangle; inputs Origin: Point3d, Xaxis: Point3d, XYpoint: Point3d; same code as python_3_script_7
compas_draw_18 = COMPASDraw(cg=python_3_script_14.points)  # -> rg; same code as compas_draw
points_3 = PointList(Points=compas_draw_18, Size=Slider(4, range=0..10))

# ----
# TCP 1
panel_6 = Panel("12.54")
pt_3 = ConstructPoint(XCoordinate=panel_6, YCoordinate="12.48", ZCoordinate="116.01")

# ----
# ROBOT TABLE
fine_adjust_z_mm_3 = Slider(22, range=-5..500)
xaxis_6 = Panel("""535.83,
513.91,
-12.43""")
origin_6 = Panel("""535.77,
-80.72,
-11.6""")
xypoint_6 = Panel("""229.24,
-79.84,
-11.39""")
transform_3 = Python3Script(
    way_planes=python_3_script_13.rot_frames,
    wobj_origin=origin_6,
    wobj_xaxis=xaxis_6,
    wobj_xypoint=xypoint_6,
    z_safe_margin=fine_adjust_z_mm_3)  # -> out, flatten(transformed_frames); inputs way_planes: list, wobj_origin: Point3d, wobj_xaxis: Point3d, wobj_xypoint: Point3d, z_safe_margin: Double; same code as transform
compas_draw_19 = COMPASDraw(cg=transform_3.transformed_frames)  # -> rg; same code as compas_draw

pt_4 = ConstructPoint(XCoordinate="13.76", YCoordinate="14.02", ZCoordinate="116.76")

# ----
# TCP 2
panel_7 = Panel("-14.21")
pt_5 = ConstructPoint(XCoordinate=panel_7, YCoordinate="-14.75", ZCoordinate="116.68")

# ----
# DUMP POINT
dump_plane_reference_point_2 = Point(<point referenced from the Rhino model>)
python_3_script_16 = Python3Script(pt=dump_plane_reference_point_2)  # -> f; inputs pt: Point3d; same code as python_3_script_10

# ---- group: compas plane for dump location
dump_plane_reference_point_3 = Point(<point referenced from the Rhino model>)
python_3_script_17 = Python3Script(pt=dump_plane_reference_point_3)  # -> f; inputs pt: Point3d; same code as python_3_script_10

# ----
python_3_script_18 = Python3Script(
    pickup_base_origin=capture_pick.origin,
    n_x=Slider(3, range=0..10),
    n_y=Slider(5, range=0..100),
    n_z=Slider(4, range=0..10),
    tol_x=Slider(-0.5, range=-20..20),
    tol_y=Slider(-0.5, range=-20..20),
    tol_z=Slider(2, range=-20..20),
    n=Slider(4, range=0..10))  # -> out, frames, points, depot_frame; inputs pickup_base_origin: Point3d, n_x: Int32, n_y: Int32, n_z: Int32, n: Int32
# ---------- python_3_script_18: Python ----------
from compas.geometry import Point, Frame, Vector
from compas.geometry import Polygon
from compas_rhino.conversions import point_to_compas
import math as m

# convert the origin point of pickup base to a compas point
ref_pt = point_to_compas(pickup_base_origin)  

frames = [] # empty list for frames w.r.t origin
points = [] # empty list for grid of points w.r.t origin

# brick dimensions
l = 32
w = 15
h = 10

# frame offsets w.r.t the pickup base
offset_x = 17.5 + tol_x
offset_y = 27.5 + tol_y
offset_z = 4 + tol_z

#  Loop through Z from top layer down to the bottom layer
for k in reversed(range(n_z)):
    for j in range(n_y):
        for i in range(n_x):

            # Calculate coordinates relative to the original reference point
            x = ref_pt.x - j*30 - offset_x
            y = ref_pt.y + i*50 + offset_y
            z = ref_pt.z + k*12 + offset_z
            
            # Create the grid point and frame
            grid_pt = Point(x, y, z)
            
            # Keeps X normal, flips Y, which forces the Z-axis to point downwards
            f = Frame(grid_pt, [-1, 0, 0], [0, 1, 0])
            # Custom rotation wrt the T.C.P
            f = f.rotated(m.radians(90), axis=f.zaxis, point=f.point)
            
            frames.append(f)
            points.append(grid_pt)


# Dump frames to dump the depot frame. We will create this frame after every 15 points

centroid_frame = frames[7].copy()
centroid_frame.point.z += 12/2
centroid_frame.rotate(m.radians(90), centroid_frame.zaxis, centroid_frame.point)

for i in range(n):

#      Copy the centroid frame as dump frame

    dump_frame = centroid_frame.copy()

    dump_frame.point.z -= (12) * (i)
    
     # Calculate the exact insertion index
    insert_index = ((i) * 15) + i
    

    frames.insert(insert_index, dump_frame)

 # 3. Re-generate the points list to keep it synchronized with the new frames
points = [f.point for f in frames]
# ---------- end python_3_script_18 ----------
panel_8 = Panel(transform_3.transformed_frames)

# ----
# ASSEMBLE CODE
number_slider_2 = Slider(1, range=0..1)
grb_pos = Panel("2")
compas_2 = Python3Script(
    way_frames=transform_3.transformed_frames,
    pickup_frames=python_3_script_14.frames,
    dump_frame=python_3_script_16,
    tcp_1=pt_3,
    tcp_2=pt_5,
    a=Slider(0.2, range=0..1),
    v=number_slider_2)  # -> out, vis_frames, vis_planes, script; inputs way_frames: list, pickup_frames: list, tcp_1: Point3d, tcp_2: Point3d, a: Double, v: Double, grb_pos: Int32; same code as compas
compas_draw_20 = COMPASDraw(cg=compas_2.vis_frames)  # -> rg; same code as compas_draw
pline_2 = PolyLine(Vertices=compas_2.vis_planes, Closed=False)
points_4 = PointList(Points=compas_2.vis_planes, Size=Slider(7, range=0..100))

python_3_script_19 = Python3Script(Origin=origin_6, Xaxis=xaxis_6, XYpoint=xypoint_6)  # -> out, Rectangle; inputs Origin: Point3d, Xaxis: Point3d, XYpoint: Point3d; same code as python_3_script_7
panel_9 = Panel(compas_2.script)

number_slider_3 = Slider(0.1, range=0..0.1)
compas_3 = Python3Script(
    way_frames=transform_2.transformed_frames,
    tcp_measured=pt_4,
    a=Slider(0.5, range=0..1),
    v=Slider(1, range=0..1),
    pickup_frames=python_3_script_18.frames,
    dump_frame=python_3_script_17)  # -> out, vis_frames, vis_planes, script; inputs way_frames: list, tcp_measured: Point3d, a: Double, v: Double, pickup_frames: list
# ---------- compas_3: Python ----------
from imp import reload
import sys
import os

#get current file path
path = ghenv.Component.OnPingDocument().FilePath
#get parent directory of the parent directory
parentdir = os.path.dirname(path)
#get src folder which contains classes
dire = os.path.join(parentdir,'src')

sys.path.append(dire)

import simple_ur_script as ur
reload(ur)

import utils 
reload(utils)

import simple_comm as com
reload(com)

import compas.geometry as cg
import math as m

# ===== Set global constants =======

IO = 0 # Global constant
sd = 120

# =================================

script = "" #create empty string

def pickup_brick(script, pick_frame):

    frames = []

    # Translate frame to "safe" location
    safe_pick_frame = pick_frame.copy()
    safe_pick_frame.point.z += sd

    # Move to safe frame
    script += ur.move_l(safe_pick_frame, a, v)

    # Move to pick location
    script += ur.move_l(pick_frame, a, v)

    # Activate gripper
    script += ur.set_digital_out(IO, True)
    script += ur.sleep(1.5)

    # Move back to safe plane
    script += ur.move_l(safe_pick_frame, a, v)

    frames.extend([safe_pick_frame, pick_frame, safe_pick_frame])

    return script, frames


def place_brick(script, place_frame):
    frames = []
    
    # Safe frame for placing
    safe_place_frame = place_frame.copy()
    safe_place_frame.point.z += sd

    # Add to the path: go to the safe plane
    script += ur.move_l(safe_place_frame, a, v)

    # Add to the path: go to the place plane
    script += ur.move_l(place_frame, a, v)
    
    # Add to the path: turn off the vacuum and wait 1 second (hold the brick)
    script += ur.set_digital_out(IO, False)
    script += ur.sleep(1.5)
    
    # Add to the path: go back to the safe plane
    script += ur.move_l(safe_place_frame, a, v)

    frames.extend([safe_place_frame, place_frame, safe_place_frame])
    
    return script, frames


def depot_action(script, depot_frame, dump_frame):
    frames = []

    # 1. & 2. Copy the depot frame and raise its Z position by 20 units
    safe_depot_frame = depot_frame.copy()
    safe_depot_frame.point.z += 120

    # 3. UR Linear motions: approach safe position, then drop down to the depot point
    script += ur.move_l(safe_depot_frame, a, v)
    script += ur.move_l(depot_frame, a, v)

    # 4. Trigger I/O to TRUE (Grip/Activate)
    script += ur.set_digital_out(IO, True)
    script += ur.sleep(1.5)

    # 5. Move back up to the safe depot clearance height
    script += ur.move_l(safe_depot_frame, a, v)
    
    # 6. Move to the custom dump plane inputted from Grasshopper
    script += ur.move_l(dump_frame, a, v)
    
    # 7. Trigger I/O to FALSE (Release/Open)
    script += ur.set_digital_out(IO, False)
    script += ur.sleep(1.5)

    # Keep track of the generated motion sequence path for visual feedback
    frames.extend([safe_depot_frame, depot_frame, safe_depot_frame, dump_frame])

    return script, frames


#if value given for tcp measured, then add line to script, otherwise it will take current tcp from robot
if tcp_measured is not None:
    script += ur.set_tcp_by_angles(tcp_measured.X, tcp_measured.Y, tcp_measured.Z, m.radians(-45), m.radians(0), m.radians(-45))


vis_frames = [] 
place_counter = 0 # Track sequential progress through structural drop planes

# ===== Generate pick, place, and depot sequence =====
for i in range(len(way_frames)):
    
    # 1. TRIGGER DEPOT AFTER EVERY (i*15)+i INTERVAL (0, 16, 32...) AT THE SAME LOCATION
    if i % 16 == 0:
        depot_index = i % len(pickup_frames)
        target_depot_frame = pickup_frames[depot_index]
        
        script, depot_frames_list = depot_action(script, target_depot_frame, dump_frame)
        vis_frames.extend(depot_frames_list)
        
    # 2. RUN NORMAL PICK & PLACE ONLY ON NON-DEPOT ITERATIONS
    else:
        if place_counter < len(way_frames):
            # Target structural planes continuously using the decoupled index pointer
            current_place_frame = way_frames[place_counter]
            
            pickup_index = i % len(pickup_frames)
            current_pick_frame = pickup_frames[pickup_index]
            
            script, pif = pickup_brick(script, current_pick_frame)
            vis_frames.extend(pif)
            
            script, place_frames_list = place_brick(script, current_place_frame)
            vis_frames.extend(place_frames_list)
            
            # Step the structural placement pointer forward
            place_counter += 1

# Format the script to make it sendable
script = com.concatenate_script(script)

# Visualize
from compas_rhino import conversions
import Rhino.Geometry as rg
vis_planes = [conversions.frame_to_rhino(frame) for frame in vis_frames]



# Visualize
from compas_rhino import conversions
import Rhino.Geometry as rg

vis_planes = [conversions.frame_to_rhino(frame) for frame in vis_frames]
# ---------- end compas_3 ----------
pline_3 = PolyLine(Vertices=compas_3.vis_planes, Closed=False)
compas_draw_21 = COMPASDraw(cg=compas_3.vis_frames)  # -> rg; same code as compas_draw
points_5 = PointList(Points=compas_3.vis_planes, Size=Slider(5, range=0..100))

# ----
# Transform geometry to robobase
# Convert Planes to URScript
# Send to Robot
# Measure robo base
# robo_base_rhino for reference
# Measure pick up location
# pickup_base_rhino for reference
wobj_calibration = Panel(capture_wobj.info)
python_3_script_20 = Python3Script(
    pt=capture_pick.origin,
    n_x=Slider(3, range=0..10),
    n_y=Slider(5, range=0..100),
    n_z=Slider(3, range=0..10),
    l=Slider(4, range=0..10),
    d=Slider(12, range=0..100))  # -> out, clean_frames, points, depot_frame; inputs pt: Point3d, n_x: Int32, n_y: Int32, n_z: Int32
# ---------- python_3_script_20: Python ----------
from compas.geometry import Point, Frame, Vector
from compas.geometry import Polygon
from compas_rhino.conversions import point_to_compas
import math as m

# Rename your input reference point to avoid overwriting it
ref_pt = point_to_compas(pt)  

r_frames = []
points = []
l = 32
w = 15
offset_h = -1
offset_x = 28.5
offset_y = 15

# i iterates over x-axis, j iterates over y-axis
for k in range(n_z):
    for j in range(n_y):
        for i in range(n_x):

            # Calculate coordinates relative to the original reference point
            x = ref_pt.x  - j*30 - offset_y
            y = ref_pt.y +  i*50 + offset_x
            z = ref_pt.z +  (k+1)*12 + offset_h

            
            # Create the grid point and frame
            grid_pt = Point(x, y, z)
            # Keeps X normal, flips Y, which forces the Z-axis to point downwards
            f = Frame(grid_pt, [-1, 0, 0], [0, 1, 0])
            f = f.rotated(m.radians(90), axis=f.zaxis, point=f.point)
            r_frames.append(f)
            frames = r_frames[ : :-1]


# 1. ALWAYS copy the input list to prevent accumulation bugs
clean_frames = list(frames)

depot_frame = clean_frames[7]  # or whichever index you are targeting
# Use .copy() so you don't accidentally lower the height of the original frame 7
depot_frame = depot_frame.copy() 
depot_frame.point.z -= (10/2 + 2)
depot_frame.rotate(m.radians(90), axis=depot_frame.zaxis, point=depot_frame.point)




for i in range(l):
    
    current_frame = depot_frame.copy()
    
    current_frame.point.z -= (i) * d
    
    insert_index = ((i + 1) * 15) + i
    
    if insert_index <= len(clean_frames):
        clean_frames.insert(insert_index, current_frame)

points = []
for f in clean_frames:
    points.append(f.point)

a = clean_frames
# ---------- end python_3_script_20 ----------
compas_draw_22 = COMPASDraw(cg=python_3_script_20.points)  # -> rg; same code as compas_draw
panel_10 = Panel(compas_3.script)

compas_draw_23 = COMPASDraw(cg=python_3_script_20.clean_frames)  # -> rg; same code as compas_draw
compas_draw_24 = COMPASDraw(cg=python_3_script_18.frames)  # -> rg; same code as compas_draw
compas_draw_25 = COMPASDraw(cg=python_3_script_18.points)  # -> rg; same code as compas_draw

# ---- group: order for pickup planes
points_6 = PointList(Points=compas_draw_22, Size=Slider(3, range=0..100))

# ----
points_7 = PointList(Points=compas_draw_25, Size=Slider(5, range=0..10))

# ----
# RUN CODE
panel_11 = Panel("192.168.10.10")
py3_3 = Python3Script(script=compas_2.script, ip_address=panel_11, send=Button())  # -> out, a; inputs script: String, ip_address: String, send: Boolean; same code as py3

data_2 = Data(compas_3.vis_planes)
list_item = ListItem(List=data_2, Index=Slider(14, range=0..20), Wrap=True)

py3_4 = Python3Script(script=compas_3.script, ip_address="192.168.10.10", send=Button())  # -> out, a; inputs script: String, ip_address: String, send: Boolean; same code as py3
