# Grasshopper definition 261020_flemish_bond_IA01.gh (Grasshopper 1.0.8)
# plug-ins: Moonlight

moonlight = Moonlight(Mode=False)

# ---- group: This is needed only ONCE in the GH definition
# // UR Scipt for flemish bond brick wall
enable_auto_reload = Python3Script()  # -> ok
# ---------- enable_auto_reload: Python ----------
"""
------------------------------
Using VS Code as Python editor
------------------------------

The simplest way to start using VS Code as our editor, is
to place our Python code in files located IN THE SAME FOLDER as our Grasshopper file.

After we have done that, we need 2 steps: 

1. Enable the COMPAS reloader on one component. This tells Grasshopper to watch for changes in the Pythoh files and reload if changed.
2. Every other component that uses Python code from external files needs to start with a method to ensure Grasshopper knows where to load the files from.

"""
# r: compas
# venv: mas-2627

from compas_rhino.devtools import DevTools
DevTools.enable_reloader()
# ---------- end enable_auto_reload ----------

# ---- group: flemish brick bond rotated with attractor point
att_pt = Point(Point(118, 64, 0))
python_3_script = Python3Script(
    n_x=Slider(7, range=0..100),
    n_z=Slider(10, range=0..100),
    length=Slider(32, range=0..100),
    width=Slider(15, range=0..100),
    height=Slider(10, range=0..10),
    att_pt=att_pt)  # -> bricks, points, frames; inputs n_x: Int32, n_z: Int32, length: Double, height: Double, att_pt: Point3d
# ---------- python_3_script: Python ----------
from compas.geometry import Point, Box, Frame, Translation, Rotation, midpoint_point_point, Point
from compas_rhino.conversions import point_to_rhino
import math as m


bricks = []
points = []
gap = 7.5

for j in range(n_z):
    # 1. Calculate Z position for the current layer
    z = j * height
    
    
    for i in range(n_x):
        if i % 2 == 0:
            x = ( (i/2 * (length + width)) + length/2 ) + gap*i
        else:
            x = ( (((i+1)/2) * length) + (((i-1)/2) * width) + (width/2) ) + gap*i
            

        # 4. Construct your point or box using (final_x, y, z) here...
        pt = Point(x,width/2 ,j*height,z)
        f = Frame(pt)
        points.append(pt)
        if j % 2 == i % 2:
            b = Box(width, length, height, f) # Stretcher
        else:
            b = Box(length, width, height, f) # Header

        bricks.append(b)

for b in bricks:
    pt = b.frame.point
    r_pt = point_to_rhino(pt)
    dist = att_pt.DistanceTo(r_pt) * 0.1
    b.rotate(m.radians(dist),(0,0,1),r_pt)
    print(dist)

frames = []

for b in bricks:
    pt = b.frame.point
    f = Frame(pt, [1,0,0], [0,-1,0])
    frames.append(f)
# ---------- end python_3_script ----------
compas_draw = COMPASDraw(cg=python_3_script.bricks)  # -> rg
#   port cg: The COMPAS geometry or datastructure to be drawn.
#   port rg: The Rhino geometry object.
# ---------- compas_draw: Python ----------
# r: compas>=2.14.1
"""
Draws COMPAS geometry in Grasshopper.
"""

from typing import Any

import Grasshopper

from compas.scene import SceneObject


class CompasToRhinoGeometry(Grasshopper.Kernel.GH_ScriptInstance):
    def RunScript(self, cg):
        if not cg:
            return None

        return SceneObject(item=cg).draw()
# ---------- end compas_draw ----------
compas_draw_2 = COMPASDraw(cg=python_3_script.points)  # -> rg; same code as compas_draw
custom_preview = CustomPreview(
    Geometry=compas_draw,
    Material={diffuse=RGB(221, 160, 221), emission=RGB(66, 48, 66), shine=0.5, specular=RGB(255, 255, 255), transparency=0})

# ---- group: rotating alternate brick planes by 90 degrees for the 2 tcps
python_3_script_2 = Python3Script(frames=python_3_script.frames)  # -> out, flatten(rot_frames); inputs frames: list
# ---------- python_3_script_2: Python ----------
import math as m
from compas.geometry import Rotation, Vector, Point

rot_frames = []

for i, f in enumerate(frames):
    
    if i % 2 == 0:
        modified_frame = f
    else:
        # Use .rotated() to return a copy, and f.zaxis to spin around its own center
        modified_frame = f.rotated(m.radians(90), f.zaxis, f.point)
        
    rot_frames.append(modified_frame)
# ---------- end python_3_script_2 ----------

# ----
pt = ConstructPoint(XCoordinate="12.54", YCoordinate="12.48", ZCoordinate="116.01")

# ---- group: create pickup planes from the brick depot
xypoint = Panel("""-62.52,
367.39,
-4.51""")
xaxis = Panel("""90.04,
521.78,
-4.83""")
origin = Panel("""90.32,
367.78,
-4.14""")
python_3_script_3 = Python3Script(
    pickup_base_origin=origin,
    n_z=Slider(5, range=0..10),
    tol_x=Slider(-0.5, range=-20..20),
    tol_y=Slider(-0.5, range=-20..20),
    tol_z=Slider(4, range=-20..20))  # -> out, frames, points, depot_frame; inputs pickup_base_origin: Point3d, n_z: Int32
# ---------- python_3_script_3: Python ----------
from compas.geometry import Point, Frame, Vector
from compas.geometry import Polygon
from compas_rhino.conversions import point_to_compas
import math as m

# convert the origin point of pickup base to a compas point
ref_pt = point_to_compas(pickup_base_origin)  

frames = [] # empty list for frames w.r.t origin
points = [] # empty list for grid of points w.r.t origin

# brick dimensions
l = 32
w = 15
h = 10

# frame offsets w.r.t the pickup base
offset_x = 17.5 + tol_x
offset_y = 27.5 + tol_y
offset_z = 4 + tol_z

# Depot size
n_x = 3
n_y = 5

#  Loop through Z from top layer down to the bottom layer
for k in reversed(range(n_z)):
    for j in range(n_y):
        for i in range(n_x):

            # Calculate coordinates relative to the original reference point
            x = ref_pt.x - j*30 - offset_x
            y = ref_pt.y + i*50 + offset_y
            z = ref_pt.z + k*12 + offset_z
            
            # Create the grid point and frame
            grid_pt = Point(x, y, z)
            
            # Keeps X normal, flips Y, which forces the Z-axis to point downwards
            f = Frame(grid_pt, [-1, 0, 0], [0, 1, 0])
            # Custom rotation wrt the T.C.P
            f = f.rotated(m.radians(90), axis=f.zaxis, point=f.point)
            
            frames.append(f)
            points.append(grid_pt)


# Dump frames to dump the depot frame. We will create this frame after every 15 points

centroid_frame = frames[7].copy()
centroid_frame.point.z += 12/2
centroid_frame.rotate(m.radians(90), centroid_frame.zaxis, centroid_frame.point)

for i in range(n_z):
#      Copy the centroid frame as dump frame
    dump_frame = centroid_frame.copy()
    dump_frame.point.z -= (12) * (i)   
     # Calculate the exact insertion index
    insert_index = ((i) * 15) + i   
    frames.insert(insert_index, dump_frame)

# for i in range(n_z-1):
# #      Copy the centroid frame as dump frame
#     dump_frame = centroid_frame.copy()
#     dump_frame.point.z -= (12) * (i+1)   
#      # Calculate the exact insertion index
#     insert_index = ((i+1) * 15) + i   
#     frames.insert(insert_index, dump_frame)



 # 3. Re-generate the points list to keep it synchronized with the new frames
points = [f.point for f in frames]
# ---------- end python_3_script_3 ----------
python_3_script_4 = Python3Script(Origin=origin, Xaxis=xaxis, XYpoint=xypoint)  # -> out, Rectangle; inputs Origin: Point3d, Xaxis: Point3d, XYpoint: Point3d
# ---------- python_3_script_4: Python ----------
import Rhino.Geometry as rg

# Create plane from origin and axis vectors
plane = rg.Plane(Origin, Xaxis - Origin, XYpoint - Origin)

# Calculate distances (width and height)
x_size = Origin.DistanceTo(Xaxis)
y_size = Origin.DistanceTo(XYpoint)

# Output the rectangle as a curve to 'Rectangle'
Rectangle = rg.Rectangle3d(plane, x_size, y_size).ToNurbsCurve()
# ---------- end python_3_script_4 ----------
compas_draw_3 = COMPASDraw(cg=python_3_script_3.points)  # -> rg; same code as compas_draw
points = PointList(Points=compas_draw_3, Size=Slider(4, range=0..10))

# ---- group: transform rhino planes to robo base
fine_adjust_z_mm = Slider(22, range=-5..500)
xaxis_2 = Panel("""535.83,
513.91,
-12.43""")
xypoint_2 = Panel("""229.24,
-79.84,
-11.39""")
origin_2 = Panel("""535.77,
-80.72,
-11.6""")
transform = Python3Script(
    way_planes=python_3_script_2.rot_frames,
    wobj_origin=origin_2,
    wobj_xaxis=xaxis_2,
    wobj_xypoint=xypoint_2,
    z_safe_margin=fine_adjust_z_mm)  # -> out, flatten(transformed_frames); inputs way_planes: list, wobj_origin: Point3d, wobj_xaxis: Point3d, wobj_xypoint: Point3d, z_safe_margin: Double
# ---------- transform: Python ----------
from compas.geometry import Frame, Transformation, Translation, Vector
#in this step we transform our way planes to robot space
#the rhino co-ordinate system is rather abstract in the physical world
#the robot base plane assumed the base frame of robot is the origin
#but rhino does not know that
#thus we transform things from our design space(Rhino World XY) to Robot Base Plane that we measure

def set_robot_base(origin, xaxis, xypoint):
    """
    set a base plane representing the robot working object plane
    """
     # 1. Extracted the vectors from the corner origin
    vec_x =  xaxis - origin
    vec_y =  xypoint - origin
    
    # 2. Calculated the center point (halfway along X and Y)
    center_origin = origin + vec_x * 0.5 + vec_y * 0.5

    robot_base = Frame(center_origin, vec_x, vec_y)
    print (robot_base)
    return (robot_base)

def rhino_to_robot_space(rhino_plane,robot_base_plane):

    """
    Transform the objects from Rhino world XY plane to robot work object plane
    """
    T_matrix = Transformation.from_frame_to_frame(Frame.worldXY(), robot_base_plane)
    robot_plane = rhino_plane.transformed(T_matrix)
    return robot_plane

def set_z_safe_margin(planes_to_adjust, safety_margin):
    adjusted = []
    T = Translation.from_vector(Vector(0, 0, safety_margin))
    for f in planes_to_adjust:
        adjusted.append(f.transformed(T))
    return adjusted

# ===== Robot base is set =====
robot_base =  set_robot_base(wobj_origin, wobj_xaxis, wobj_xypoint)

# ===== Set safety margin for Z height ======
safe_planes = set_z_safe_margin(way_planes, z_safe_margin)


# ===== Transforming the rhino planes into robot planes =====
transformed_frames = []
for plane in safe_planes: 
    transformed_frames.append(rhino_to_robot_space(plane, robot_base))
# ---------- end transform ----------
python_3_script_5 = Python3Script(Origin=origin_2, Xaxis=xaxis_2, XYpoint=xypoint_2)  # -> out, Rectangle; inputs Origin: Point3d, Xaxis: Point3d, XYpoint: Point3d; same code as python_3_script_4
compas_draw_4 = COMPASDraw(cg=transform.transformed_frames)  # -> rg; same code as compas_draw

# ----
pt_2 = ConstructPoint(XCoordinate="-14.21", YCoordinate="-14.75", ZCoordinate="116.68")

dump_plane_reference_point = Point(<point referenced from the Rhino model>)
python_3_script_6 = Python3Script(pt=dump_plane_reference_point)  # -> f; inputs pt: Point3d
# ---------- python_3_script_6: Python ----------
from compas.geometry import Point, Frame
from compas_rhino.conversions import point_to_compas

compas_pt = point_to_compas(pt)
f = Frame(compas_pt, [1, 0, 0], [0, -1, 0])
# ---------- end python_3_script_6 ----------

# ---- group: selects tcp 1 for odd way_planes and tcp 2 for even way_planes
compas = Python3Script(
    way_frames=transform.transformed_frames,
    pickup_frames=python_3_script_3.frames,
    tcp_1=pt,
    tcp_2=pt_2,
    dump_frame=python_3_script_6,
    a=Slider(0.2, range=0..1),
    v=Slider(1, range=0..1))  # -> out, vis_frames, vis_planes, script; inputs way_frames: list, pickup_frames: list, tcp_1: Point3d, tcp_2: Point3d, a: Double, v: Double, grb_pos: Int32
# ---------- compas: Python ----------
from imp import reload
import sys
import os

#get current file path
path = ghenv.Component.OnPingDocument().FilePath
#get parent directory of the parent directory
parentdir = os.path.dirname(path)
#get src folder which contains classes
dire = os.path.join(parentdir,'src')

sys.path.append(dire)

import simple_ur_script as ur
reload(ur)

import utils 
reload(utils)

import simple_comm as com
reload(com)

import compas.geometry as cg
import math as m

# ===== Set global constants =======

IO = 0 # Global constant
sd = 120

# =================================

script = "" #create empty string

def pickup_brick(script, pick_frame):

    frames = []

    # Translate frame to "safe" location
    safe_pick_frame = pick_frame.copy()
    safe_pick_frame.point.z += sd

    # Move to safe frame
    script += ur.move_l(safe_pick_frame, a, v)

    # Move to pick location
    script += ur.move_l(pick_frame, a, v)

    # Activate gripper
    script += ur.set_digital_out(IO, True)
    script += ur.sleep(1.5)

    # Move back to safe plane
    script += ur.move_l(safe_pick_frame, a, v)
    script += (ur.move_j([m.radians(253.70), m.radians(-90.63), m.radians(118.09), m.radians(-118.02), m.radians(-90.78), m.radians(28.16)], 1.2, 1.2))
    frames.extend([safe_pick_frame, pick_frame, safe_pick_frame])

    return script, frames


def place_brick(script, place_frame):
    frames = []
    
    # Safe frame for placing
    safe_place_frame = place_frame.copy()
    safe_place_frame.point.z += sd

    # Add to the path: go to the safe plane
    script += ur.move_l(safe_place_frame, a, v)

    # Add to the path: go to the place plane
    script += ur.move_l(place_frame, a, v)
    
    # Add to the path: turn off the vacuum and wait 1 second (hold the brick)
    script += ur.set_digital_out(IO, False)
    script += ur.sleep(1.5)
    
    # Add to the path: go back to the safe plane
    script += ur.move_l(safe_place_frame, a, v)

    frames.extend([safe_place_frame, place_frame, safe_place_frame])
    
    return script, frames


def depot_action(script, depot_frame, dump_frame):
    frames = []

    # 1. & 2. Copy the depot frame and raise its Z position by 20 units
    safe_depot_frame = depot_frame.copy()
    safe_depot_frame.point.z += 120

    # 3. UR Linear motions: approach safe position, then drop down to the depot point
    script += ur.move_l(safe_depot_frame, a, v)
    script += ur.move_l(depot_frame, a, v)

    # 4. Trigger I/O to TRUE (Grip/Activate)
    script += ur.set_digital_out(IO, True)
    script += ur.sleep(1.5)

    # 5. Move back up to the safe depot clearance height
    script += ur.move_l(safe_depot_frame, a, v)
    
    # 6. Move to the custom dump plane inputted from Grasshopper
    script += ur.move_l(dump_frame, a, v)
    
    # 7. Trigger I/O to FALSE (Release/Open)
    script += ur.set_digital_out(IO, False)
    script += ur.sleep(1.5)

    # Keep track of the generated motion sequence path for visual feedback
    frames.extend([safe_depot_frame, depot_frame, safe_depot_frame, dump_frame])

    return script, frames


vis_frames = [] 
place_counter = 0 # Track sequential progress through structural drop planes

# ===== Generate pick, place, and depot sequence =====
for i in range(len(way_frames)):
    
    # 1. TRIGGER DEPOT AFTER EVERY (i*15)+i INTERVAL (0, 16, 32...) AT THE SAME LOCATION
    if i % 16 == 0:
        depot_index = i % len(pickup_frames)
        target_depot_frame = pickup_frames[depot_index]
        
        script, depot_frames_list = depot_action(script, target_depot_frame, dump_frame)
        vis_frames.extend(depot_frames_list)
        
    # 2. RUN NORMAL PICK & PLACE ONLY ON NON-DEPOT ITERATIONS
    else:
        if place_counter < len(way_frames):
            # Target structural planes continuously using the decoupled index pointer
            current_place_frame = way_frames[place_counter]
            
            pickup_index = i % len(pickup_frames)
            current_pick_frame = pickup_frames[pickup_index]
            

            # 1. Set the correct TCP first (Even = TCP 2, Odd = TCP 1)
            if place_counter % 2 == 0:
                if tcp_2 is not None:
                    script += ur.set_tcp_by_angles(tcp_2.X, tcp_2.Y, tcp_2.Z, m.radians(0), m.radians(-45), m.radians(45))
            else:
                if tcp_1 is not None:
                    script += ur.set_tcp_by_angles(tcp_1.X, tcp_1.Y, tcp_1.Z, m.radians(-45), m.radians(0), m.radians(-45))

            # 2. Pick up the brick using that TCP
            script, pif = pickup_brick(script, current_pick_frame)
            vis_frames.extend(pif)
            
            # 3. Drop the brick using the same TCP
            script, place_frames_list = place_brick(script, current_place_frame)
            vis_frames.extend(place_frames_list)  # <--- ADD THIS MISSING LINE HERE

            # Step the structural placement pointer forward
            place_counter += 1


# Format the script to make it sendable
script = com.concatenate_script(script)

# Visualize
from compas_rhino import conversions
import Rhino.Geometry as rg
vis_planes = [conversions.frame_to_rhino(frame) for frame in vis_frames]



# Visualize
from compas_rhino import conversions
import Rhino.Geometry as rg

vis_planes = [conversions.frame_to_rhino(frame) for frame in vis_frames]
# ---------- end compas ----------
compas_draw_5 = COMPASDraw(cg=compas.vis_frames)  # -> rg; same code as compas_draw
pline = PolyLine(Vertices=compas.vis_planes, Closed=False)
points_2 = PointList(Points=compas.vis_planes, Size=Slider(7, range=0..100))

# ----
# Robot base
# // flemish brick wall along a straight line with point attractor
# Pickup base
# brick wall design
# Create script for UR Robot
# Run script
# TCP 1
# TCP 2
# Dump plane
panel = Panel(compas.script)

py3 = Python3Script(script=compas.script, ip_address="192.168.10.10", send=Button())  # -> out, a; inputs script: String, ip_address: String, send: Boolean
# ---------- py3: Python ----------
import simple_comm as com

if send:
    com.send_script(script,ip_address)
# ---------- end py3 ----------
