# Grasshopper definition 261021_brick_pier_IA02.gh (Grasshopper 1.0.8)
# plug-ins: Moonlight

moonlight = Moonlight(Mode=True)

python_3_script = Python3Script(
    length=Slider(32, range=0..100),
    width=Slider(15, range=0..100),
    height=Slider(10, range=0..100),
    n_x=Slider(5, range=0..10),
    n_z=Slider(20, range=0..100),
    gap=Slider(2, range=0..100))  # -> all_bricks, way_planes; inputs length: Double, n_x: Int32, n_z: Int32, gap: Int32
# ---------- python_3_script: Python ----------
import math as m
import Rhino.Geometry as rg
from compas.geometry import Box,Frame,Point, Vector, Rotation, Translation
from compas_rhino.conversions import point_to_compas

# Define the radius for the circle
# Divide the circle into sectors
# using sin function get the radius, using the angle and segmen length


points = []
edges = []

r = length / (2 * m.sin(m.pi /n_x))


for i in range(n_x):

    t = i/n_x
    a = t * m.tau

    x = r * m.cos(a)
    y = r * m.sin(a)
    
    pt = rg.Point3d(x,y,0)
    points.append(pt)

# for i,pt in enumerate(points[ : -1]):
#     print(pt)
#     edge = rg.LineCurve(pt,points[i+1])
#     edges.append(edge)

bricks = []
compas_pts = []
frames =[]

for pt in points:
    compas_pt = point_to_compas(pt)
    compas_pts.append(compas_pt)

from compas.geometry import midpoint_point_point
from compas.geometry import midpoint_point_point, Vector



for i, compas_pt in enumerate(compas_pts):
    next_pt = compas_pts[(i + 1) % n_x]
    
    # 1. Standard midpoint on the polygon edge
    mid_pt = midpoint_point_point(compas_pt, next_pt)
    
    v1 = Vector.from_start_end(compas_pt, next_pt)
    v2 = v1.cross([0, 0, 1])
    
    # 2. Normalize v2 to ensure its unit length is exactly 1.0
    v2.unitize()
    
    # 3. Shift the center point OUTWARD by half the brick's width
    # Note: If they shift inward instead, change the "+" to a "-" below
    shifted_center = mid_pt + v2 * ((width / 2.0) + gap)
    
    # 4. Construct the frame at the new outside-shifted center
    f = Frame(shifted_center, v1, v2)
    frames.append(f)
    
    b = Box(length, width, height, f)
    bricks.append(b)



all_bricks = []

# Outer loop: Iterates through each layer index (0, 1, 2, ... n-1)
for layer in range(n_z):
    
    # Calculate the exact Z translation distance for this specific layer
    z_shift = layer * height
    translation = Translation.from_vector([0, 0, z_shift])
    t = layer/(n_z) 
    a = m.sin(m.tau * t) * 0.8
    rotation = Rotation.from_axis_and_angle([0, 0, 1], a)
    layer_transformation = translation * rotation

    # Inner loop: Iterate through your 5 original base boxes
    for base_box in bricks:
        # Create a translated copy of the box and add it to the final list
        shifted_box = base_box.transformed(layer_transformation)
        all_bricks.append(shifted_box)

way_planes = []

for brick in all_bricks:
    f = brick.frame
    way_planes.append(f)
# ---------- end python_3_script ----------
compas_draw = COMPASDraw(cg=python_3_script.way_planes)  # -> rg
#   port cg: The COMPAS geometry or datastructure to be drawn.
#   port rg: The Rhino geometry object.
# ---------- compas_draw: Python ----------
# r: compas>=2.14.1
"""
Draws COMPAS geometry in Grasshopper.
"""

from typing import Any

import Grasshopper

from compas.scene import SceneObject


class CompasToRhinoGeometry(Grasshopper.Kernel.GH_ScriptInstance):
    def RunScript(self, cg):
        if not cg:
            return None

        return SceneObject(item=cg).draw()
# ---------- end compas_draw ----------
compas_draw_2 = COMPASDraw(cg=python_3_script.all_bricks)  # -> rg; same code as compas_draw
# // UR Scipt for brick pier using TCP 2 for bricks and TCP 1 for depot frame
custom_preview = CustomPreview(Geometry=compas_draw_2, Material=ColourSwatch(SwatchColor=RGB(202, 221, 238)))

# ---- group: This is needed only ONCE in the GH definition
# // UR Scipt for flemish bond brick wall
enable_auto_reload = Python3Script()  # -> ok
# ---------- enable_auto_reload: Python ----------
"""
------------------------------
Using VS Code as Python editor
------------------------------

The simplest way to start using VS Code as our editor, is
to place our Python code in files located IN THE SAME FOLDER as our Grasshopper file.

After we have done that, we need 2 steps: 

1. Enable the COMPAS reloader on one component. This tells Grasshopper to watch for changes in the Pythoh files and reload if changed.
2. Every other component that uses Python code from external files needs to start with a method to ensure Grasshopper knows where to load the files from.

"""
# r: compas
# venv: mas-2627

from compas_rhino.devtools import DevTools
DevTools.enable_reloader()
# ---------- end enable_auto_reload ----------

# ----
python_3_script_2 = Python3Script(
    length=Slider(32, range=0..100),
    width=Slider(15, range=0..100),
    height=Slider(10, range=0..100),
    n_x=Slider(4, range=0..10),
    n_z=Slider(10, range=0..100),
    gap=Slider(2, range=-100..100),
    amplitude=Slider(6, range=-3..10))  # -> bricks, way_planes, points; inputs length: Double, n_x: Int32, n_z: Int32, gap: Double, amplitude: Int32
# ---------- python_3_script_2: Python ----------
import math as m
import Rhino.Geometry as rg
from compas.geometry import Box, Frame, Point, Vector, Rotation, Translation
from compas_rhino.conversions import point_to_compas

points = []
bricks = []

# Step 1 - Creating a list of points for the polygon
# Loop through each layer from bottom (j=0) to top (j=n_z-1)

for j in range(n_z):

    # 1. Calculate integer point count per layer (linearly increasing)
    current_n = n_z + j
    
    # 2. Calculate base radius based strictly on the point count
    r = length / (2 * m.sin(m.pi / current_n))
    
    # Generate all point coordinates for the current layer first 
    # so we can easily look up sequential pairs to find midpoints

    layer_points = []

    for i in range(current_n):
        t = i / current_n
        a = t * m.tau
        
        # Calculate the next angle parameters for the adjacent vertex mathematically
        t_next = ((i + 1) % current_n) / current_n
        a_next = t_next * m.tau
        
        # Define current and next points right here
        pt_current = Point(r * m.cos(a), r * m.sin(a), j * height)
        pt_next = Point(r * m.cos(a_next), r * m.sin(a_next), j * height)
        
        # Store for your Rhino points list output
        points.append(rg.Point3d(pt_current.x, pt_current.y, pt_current.z))

        # Calculate the exact midpoint of the two layout points
        midpoint = Point(
            (pt_current.x + pt_next.x) / 2.0,
            (pt_current.y + pt_next.y) / 2.0,
            (pt_current.z + pt_next.z) / 2.0
        )
        
        # Define local axes based on the brick segment orientation
        local_xaxis = Vector.from_start_end(pt_current, pt_next)
        local_xaxis.unitize()
        
        # Local Y-axis points radially outward
        local_yaxis = Vector(local_xaxis.y, -local_xaxis.x, 0)
        local_yaxis.unitize()
        
        # Move the center point outside by half-thickness + gap
        shifted_center = midpoint + local_yaxis * ((width / 2.0) + gap)
        
        # Create the frame and box
        f = Frame(shifted_center, local_xaxis, local_yaxis)
        b = Box(length, width, height, f)
        
        bricks.append(b)

way_planes = []
for brick in bricks:
    f = brick.frame
    way_planes.append(f)
# ---------- end python_3_script_2 ----------
compas_draw_3 = COMPASDraw(cg=python_3_script_2.bricks)  # -> rg; same code as compas_draw
custom_preview_2 = CustomPreview(Geometry=compas_draw_3, Material=ColourSwatch(SwatchColor=RGB(202, 221, 238)))

# ----
# // UR Scipt for brick pier defining TCP ids
number_slider = Slider(15, range=0..100)
python_3_script_3 = Python3Script(
    length=Slider(32, range=0..100),
    width=number_slider,
    height=Slider(10, range=0..100),
    n_x=Slider(4, range=0..10),
    n_z=Slider(10, range=0..100),
    gap=Slider(2, range=-100..100),
    amplitude=Slider(6, range=-3..10))  # -> bricks, way_planes, points; inputs length: Double, n_x: Int32, n_z: Int32, gap: Double, amplitude: Int32; same code as python_3_script_2
compas_draw_4 = COMPASDraw(cg=python_3_script_3.bricks)  # -> rg; same code as compas_draw
custom_preview_3 = CustomPreview(Geometry=compas_draw_4, Material=ColourSwatch(SwatchColor=RGB(202, 221, 238)))

point = Point(<point referenced from the Rhino model>)

# ---- group: flemish brick bond rotated with attractor point
att_pt = Point(<point referenced from the Rhino model>)
python_3_script_4 = Python3Script(
    n_x=Slider(7, range=0..100),
    n_z=Slider(10, range=0..100),
    length=Slider(32, range=0..100),
    width=Slider(15, range=0..100),
    height=Slider(10, range=0..10),
    att_pt=point)  # -> bricks, points, frames; inputs n_x: Int32, n_z: Int32, length: Double, height: Double, att_pt: Point3d
# ---------- python_3_script_4: Python ----------
from compas.geometry import Point, Box, Frame, Translation, Rotation, midpoint_point_point, Point
from compas_rhino.conversions import point_to_rhino
import math as m


bricks = []
points = []
gap = 7.5

for j in range(n_z):
    # 1. Calculate Z position for the current layer
    z = j * height
    
    
    for i in range(n_x):
        if i % 2 == 0:
            x = ( (i/2 * (length + width)) + length/2 ) + gap*i
        else:
            x = ( (((i+1)/2) * length) + (((i-1)/2) * width) + (width/2) ) + gap*i
            

        # 4. Construct your point or box using (final_x, y, z) here...
        pt = Point(x,width/2 ,j*height,z)
        f = Frame(pt)
        points.append(pt)
        if j % 2 == i % 2:
            b = Box(width, length, height, f) # Stretcher
        else:
            b = Box(length, width, height, f) # Header

        bricks.append(b)

for b in bricks:
    pt = b.frame.point
    r_pt = point_to_rhino(pt)
    dist = att_pt.DistanceTo(r_pt) * 0.5
    b.rotate(m.radians(dist),(0,0,1),r_pt)
    print(dist)

frames = []

for b in bricks:
    pt = b.frame.point
    f = Frame(pt, [1,0,0], [0,-1,0])
    frames.append(f)
# ---------- end python_3_script_4 ----------
compas_draw_5 = COMPASDraw(cg=python_3_script_4.bricks)  # -> rg; same code as compas_draw
compas_draw_6 = COMPASDraw(cg=python_3_script_4.points)  # -> rg; same code as compas_draw
custom_preview_4 = CustomPreview(
    Geometry=compas_draw_5,
    Material={diffuse=RGB(221, 160, 221), emission=RGB(66, 48, 66), shine=0.5, specular=RGB(255, 255, 255), transparency=0})

# ----
pt = ConstructPoint(XCoordinate="12.54", YCoordinate="12.48", ZCoordinate="116.01")

pt_2 = ConstructPoint(XCoordinate="12.54", YCoordinate="12.48", ZCoordinate="116.01")

xypoint = Panel("""-62.52,
367.39,
-4.51""")
xaxis = Panel("""90.04,
521.78,
-4.83""")
origin = Panel("""90.32,
367.78,
-4.14""")
python_3_script_5 = Python3Script(
    pickup_base_origin=origin,
    n_z=Slider(6, range=0..10),
    tol_x=Slider(-0.5, range=-20..20),
    tol_y=Slider(-0.5, range=-20..20),
    tol_z=Slider(5, range=-20..20))  # -> out, frames, points, depot_frame; inputs pickup_base_origin: Point3d, n_z: Int32
# ---------- python_3_script_5: Python ----------
from compas.geometry import Point, Frame, Vector
from compas.geometry import Polygon
from compas_rhino.conversions import point_to_compas
import math as m

# convert the origin point of pickup base to a compas point
ref_pt = point_to_compas(pickup_base_origin)  

frames = [] # empty list for frames w.r.t origin
points = [] # empty list for grid of points w.r.t origin

# brick dimensions
l = 32
w = 15
h = 10

# frame offsets w.r.t the pickup base
offset_x = 17.5 + tol_x
offset_y = 27.5 + tol_y
offset_z = 4 + tol_z

# Depot size
n_x = 3
n_y = 5

#  Loop through Z from top layer down to the bottom layer
for k in reversed(range(n_z)):
    for j in range(n_y):
        for i in range(n_x):

            # Calculate coordinates relative to the original reference point
            x = ref_pt.x - j*30 - offset_x
            y = ref_pt.y + i*50 + offset_y
            z = ref_pt.z + k*12 + offset_z
            
            # Create the grid point and frame
            grid_pt = Point(x, y, z)
            
            # Keeps X normal, flips Y, which forces the Z-axis to point downwards
            f = Frame(grid_pt, [-1, 0, 0], [0, 1, 0])
            # Custom rotation wrt the T.C.P
            f = f.rotated(m.radians(90), axis=f.zaxis, point=f.point)
            
            frames.append(f)
            points.append(grid_pt)


# Dump frames to dump the depot frame. We will create this frame after every 15 points

centroid_frame = frames[7].copy()
centroid_frame.point.z += 12/2
centroid_frame.rotate(m.radians(90), centroid_frame.zaxis, centroid_frame.point)

for i in range(n_z):
#      Copy the centroid frame as dump frame
    dump_frame = centroid_frame.copy()
    dump_frame.point.z -= (12) * (i)   
     # Calculate the exact insertion index
    insert_index = ((i) * 15) + i   
    frames.insert(insert_index, dump_frame)

# for i in range(n_z-1):
# #      Copy the centroid frame as dump frame
#     dump_frame = centroid_frame.copy()
#     dump_frame.point.z -= (12) * (i+1)   
#      # Calculate the exact insertion index
#     insert_index = ((i+1) * 15) + i   
#     frames.insert(insert_index, dump_frame)



 # 3. Re-generate the points list to keep it synchronized with the new frames
points = [f.point for f in frames]
# ---------- end python_3_script_5 ----------
python_3_script_6 = Python3Script(Origin=origin, Xaxis=xaxis, XYpoint=xypoint)  # -> out, Rectangle; inputs Origin: Point3d, Xaxis: Point3d, XYpoint: Point3d
# ---------- python_3_script_6: Python ----------
import Rhino.Geometry as rg

# Create plane from origin and axis vectors
plane = rg.Plane(Origin, Xaxis - Origin, XYpoint - Origin)

# Calculate distances (width and height)
x_size = Origin.DistanceTo(Xaxis)
y_size = Origin.DistanceTo(XYpoint)

# Output the rectangle as a curve to 'Rectangle'
Rectangle = rg.Rectangle3d(plane, x_size, y_size).ToNurbsCurve()
# ---------- end python_3_script_6 ----------
compas_draw_7 = COMPASDraw(cg=python_3_script_5.points)  # -> rg; same code as compas_draw
points = PointList(Points=compas_draw_7, Size=Slider(4, range=0..10))

fine_adjust_z_mm = Slider(22, range=-5..500)
xaxis_2 = Panel("""535.83,
513.91,
-12.43""")
origin_2 = Panel("""535.77,
-80.72,
-11.6""")
xypoint_2 = Panel("""229.24,
-79.84,
-11.39""")
transform = Python3Script(
    way_planes=python_3_script.way_planes,
    wobj_origin=origin_2,
    wobj_xaxis=xaxis_2,
    wobj_xypoint=xypoint_2,
    z_safe_margin=fine_adjust_z_mm)  # -> out, flatten(transformed_frames); inputs way_planes: list, wobj_origin: Point3d, wobj_xaxis: Point3d, wobj_xypoint: Point3d, z_safe_margin: Double
# ---------- transform: Python ----------
from compas.geometry import Frame, Transformation, Translation, Vector
#in this step we transform our way planes to robot space
#the rhino co-ordinate system is rather abstract in the physical world
#the robot base plane assumed the base frame of robot is the origin
#but rhino does not know that
#thus we transform things from our design space(Rhino World XY) to Robot Base Plane that we measure

def set_robot_base(origin, xaxis, xypoint):
    """
    set a base plane representing the robot working object plane
    """
     # 1. Extracted the vectors from the corner origin
    vec_x =  xaxis - origin
    vec_y =  xypoint - origin
    
    # 2. Calculated the center point (halfway along X and Y)
    center_origin = origin + vec_x * 0.5 + vec_y * 0.5

    robot_base = Frame(center_origin, vec_x, vec_y)
    print (robot_base)
    return (robot_base)

def rhino_to_robot_space(rhino_plane,robot_base_plane):

    """
    Transform the objects from Rhino world XY plane to robot work object plane
    """
    T_matrix = Transformation.from_frame_to_frame(Frame.worldXY(), robot_base_plane)
    robot_plane = rhino_plane.transformed(T_matrix)
    return robot_plane

def set_z_safe_margin(planes_to_adjust, safety_margin):
    adjusted = []
    T = Translation.from_vector(Vector(0, 0, safety_margin))
    for f in planes_to_adjust:
        adjusted.append(f.transformed(T))
    return adjusted

# ===== Robot base is set =====
robot_base =  set_robot_base(wobj_origin, wobj_xaxis, wobj_xypoint)

# ===== Set safety margin for Z height ======
safe_planes = set_z_safe_margin(way_planes, z_safe_margin)


# ===== Transforming the rhino planes into robot planes =====
transformed_frames = []
for plane in safe_planes: 
    transformed_frames.append(rhino_to_robot_space(plane, robot_base))
# ---------- end transform ----------
python_3_script_7 = Python3Script(Origin=origin_2, Xaxis=xaxis_2, XYpoint=xypoint_2)  # -> out, Rectangle; inputs Origin: Point3d, Xaxis: Point3d, XYpoint: Point3d; same code as python_3_script_6
compas_draw_8 = COMPASDraw(cg=transform.transformed_frames)  # -> rg; same code as compas_draw

xypoint_3 = Panel("""-62.52,
367.39,
-4.51""")
xaxis_3 = Panel("""90.04,
521.78,
-4.83""")
origin_3 = Panel("""90.32,
367.78,
-4.14""")
python_3_script_8 = Python3Script(
    pickup_base_origin=origin_3,
    n_z=Slider(5, range=0..10),
    tol_x=Slider(-0.5, range=-20..20),
    tol_y=Slider(-0.5, range=-20..20),
    tol_z=Slider(4, range=-20..20))  # -> out, frames, points, depot_frame; inputs pickup_base_origin: Point3d, n_z: Int32; same code as python_3_script_5
python_3_script_9 = Python3Script(Origin=origin_3, Xaxis=xaxis_3, XYpoint=xypoint_3)  # -> out, Rectangle; inputs Origin: Point3d, Xaxis: Point3d, XYpoint: Point3d; same code as python_3_script_6
compas_draw_9 = COMPASDraw(cg=python_3_script_8.points)  # -> rg; same code as compas_draw
points_2 = PointList(Points=compas_draw_9, Size=Slider(4, range=0..10))

fine_adjust_z_mm_2 = Slider(19, range=-5..500)
xaxis_4 = Panel("""535.83,
513.91,
-12.43""")
origin_4 = Panel("""535.77,
-80.72,
-11.6""")
xypoint_4 = Panel("""229.24,
-79.84,
-11.39""")
transform_2 = Python3Script(
    way_planes=python_3_script_3.way_planes,
    wobj_origin=origin_4,
    wobj_xaxis=xaxis_4,
    wobj_xypoint=xypoint_4,
    z_safe_margin=fine_adjust_z_mm_2)  # -> out, flatten(transformed_frames); inputs way_planes: list, wobj_origin: Point3d, wobj_xaxis: Point3d, wobj_xypoint: Point3d, z_safe_margin: Double; same code as transform
python_3_script_10 = Python3Script(Origin=origin_4, Xaxis=xaxis_4, XYpoint=xypoint_4)  # -> out, Rectangle; inputs Origin: Point3d, Xaxis: Point3d, XYpoint: Point3d; same code as python_3_script_6
compas_draw_10 = COMPASDraw(cg=transform_2.transformed_frames)  # -> rg; same code as compas_draw

# ---- group: rotating alternate brick planes by 90 degrees for the 2 tcps
python_3_script_11 = Python3Script(frames=python_3_script_4.frames)  # -> out, flatten(rot_frames); inputs frames: list
# ---------- python_3_script_11: Python ----------
import math as m
from compas.geometry import Rotation, Vector, Point

rot_frames = []

for i, f in enumerate(frames):
    
    if i % 2 == 0:
        modified_frame = f
    else:
        # Use .rotated() to return a copy, and f.zaxis to spin around its own center
        modified_frame = f.rotated(m.radians(90), f.zaxis, f.point)
        
    rot_frames.append(modified_frame)
# ---------- end python_3_script_11 ----------

# ----
python_3_script_12 = Python3Script(bricks=python_3_script_4.bricks)  # -> tcp_ids; inputs bricks: list
# ---------- python_3_script_12: Python ----------
import Rhino.Geometry as rg

# define the gripper width -- If the next brick is closer than 10mm, change TCP id
gripper_width = 2.5

# Create empty lists for tracking tool geometry and assignments
offset_curves = []
tcp_ids = []

# Step 01 - Generate physical 2D clearance curves for every brick using shorter axis
for b in bricks:
    f = b.frame  # Native COMPAS Frame object
    c = f.point  # Native COMPAS Point object (uses lowercase .x, .y, .z)
    
    # Check for shorter axis to find gripper axis, then offset sides perpendicular to it
    if b.xsize < b.ysize:
        vx_extend = f.xaxis * ((b.xsize / 2.0) + gripper_width)
        vy_extend = f.yaxis * (b.ysize / 2.0)
    else:
        vx_extend = f.xaxis * (b.xsize / 2.0)
        vy_extend = f.yaxis * ((b.ysize / 2.0) + gripper_width)

    # Calculate the 4 extended corner points using COMPAS mathematics
    cp1 = c + vx_extend + vy_extend
    cp2 = c - vx_extend + vy_extend
    cp3 = c - vx_extend - vy_extend
    cp4 = c + vx_extend - vy_extend

    # Build flat 2D point collections at Z=0 for clean intersection tracking
    # FIXED: Changed uppercase .X/.Y to lowercase .x/.y for COMPAS compatibility
    offset_boundary_points = [
        rg.Point3d(cp1.x, cp1.y, 0.0),
        rg.Point3d(cp2.x, cp2.y, 0.0),
        rg.Point3d(cp3.x, cp3.y, 0.0),
        rg.Point3d(cp4.x, cp4.y, 0.0)
    ]
    
    # Append the first point to close the path before creating the polyline curve
    offset_boundary_points.append(offset_boundary_points[0])
    
    offset_curves.append(rg.PolylineCurve(offset_boundary_points))

# Step 02 - Checking for intersection between current brick offsets and neighbor brick offsets
for i, (curve_i, brick) in enumerate(zip(offset_curves, bricks)):
    intersected = False
    
    for j, (curve_j, other) in enumerate(zip(offset_curves, bricks)):
        # Layer Filter: Skip checking itself or bricks on completely different row levels
        # FIXED: Changed .Z to lowercase .z for COMPAS point properties
        if j == i or abs(other.frame.point.z - brick.frame.point.z) >= brick.zsize / 2.0:
            continue
            
        # Check for intersection between clearance curves
        intersection_events = rg.Intersect.Intersection.CurveCurve(curve_i, curve_j, 0.001, 0.0)
        if intersection_events and intersection_events.Count > 0:
            intersected = True
            break # Stop checking this brick's other neighbors if a collision is found
            
    # Assign the tool code based on intersection rules
    tcp_ids.append(1 if intersected else 2)

# Update the visualization message on the bottom of the Grasshopper Component icon
ghenv.Component.Message = "TCP1: {}  TCP2: {}".format(tcp_ids.count(1), tcp_ids.count(2))
# ---------- end python_3_script_12 ----------
python_3_script_13 = Python3Script(bricks=compas_draw_4)  # -> out, tcp_ids; inputs bricks: list of Brep
# ---------- python_3_script_13: Python ----------
# import Rhino.Geometry as rg

# GRIPPER_WIDTH = 10  # mm clearance needed

# tcp_ids = []
# gaps = []

# # =====================================================================
# # 1. WHAT YOU UNDERSTOOD: Pre-calculating clean 2D footprints
# #    Instead of doing heavy 3D math, you flatten every brick into a 
# #    simple 2D rectangle of 4 clear corner points at its center plane.
# # =====================================================================
# all_corners = []

# for b in bricks:
#     f = b.frame
#     vx = f.xaxis * (b.xsize / 2.0)  # Vector from center to left/right edge
#     vy = f.yaxis * (b.ysize / 2.0)  # Vector from center to front/back edge
#     c = f.point                     # Absolute 3D center point
    
#     # You chose this highly readable, loop-free corner tracking method:
#     p1 = c + vx + vy  # Top-Right corner
#     p2 = c - vx + vy  # Top-Left corner
#     p3 = c - vx - vy  # Bottom-Left corner
#     p4 = c + vx - vy  # Bottom-Right corner
    
#     corners = [(p1.x, p1.y), (p2.x, p2.y), (p3.x, p3.y), (p4.x, p4.y)]
#     all_corners.append(corners)

# # =====================================================================
# # 2. WHAT YOU UNDERSTOOD: The Main Target Processing Loop
# #    You optimized this loop using `enumerate(zip(...))` to elegantly 
# #    pair the brick objects with their pre-calculated 2D corners.
# # =====================================================================
# for i, (corners_i, brick) in enumerate(zip(all_corners, bricks)):
    
#     # 3. WHAT YOU UNDERSTOOD: Finding the Gripper Direction
#     #    You renamed this to 'gripper_axis' because it programmatically 
#     #    detects the short side of the brick where the robot clamps.
#     if brick.xsize <= brick.ysize:
#         gripper_axis = brick.frame.xaxis
#     else:
#         gripper_axis = brick.frame.yaxis



import Rhino.Geometry as rg

# define the gripper width -- If the next brick is closer than 100mm to target brick's face, gripper cannot fit and will change TCP id

gripper_width = 10

# Create lists 

all_corners = []
all_u_axes =[]
all_v_axes = []

# Looping through all input rg bricks

# Step 01 - Creating 2d rectangular frames at the orientation frame for each brick and getting their corners, uv, axes etc.

for b in bricks:

    f = b.frame # Calculate frame for the brick
    c = f.point # Center point of the brick
    vx = f.xaxis * (b.xsize / 2.0 ) # Calculate directional vector from brick center to half width
    vy = f.yaxis * (b.ysize / 2.0 ) # Calculate directional vector from brick center to half length

    # Calculate the corner points for every brick's orientation plane at centre using centre and vectors

    p1 = c + vx + vy  # Top-Right
    p2 = c - vx + vy  # Top-Left
    p3 = c - vx - vy  # Bottom-Left
    p4 = c + vx - vy  # Bottom-Right

    # Store the 2D corners for neighbor clearance checks later

    corners = [p1, p2, p3, p4]
    all_corners.append(corners) # list of lists of corners of all orientation planes

    # Flatten vectors to Z=0 to safely ignore any brick tilt.
    # This lets us use the simple '*' symbol for fast, automatic dot products.

    u = rg.Vector3d(f.xaxis.X, f.xaxis.Y, 0.0)
    v = rg.Vector3d(f.yaxis.X, f.yaxis.Y, 0.0)
    
    all_u_axes.append(u)
    all_v_axes.append(v)

# Step 02 - Checking for grapper and brick collisions to assign the TCP ids

# Create empty lists for tcp ids and gaps between brick faces

tcp_ids = []
gaps = []
# ---------- end python_3_script_13 ----------

pt_3 = ConstructPoint(XCoordinate="-14.21", YCoordinate="-14.75", ZCoordinate="116.68")

pt_4 = ConstructPoint(XCoordinate="-14.21", YCoordinate="-14.75", ZCoordinate="116.68")

panel = Panel(python_3_script_12)

dump_plane_reference_point = Point(<point referenced from the Rhino model>)
python_3_script_14 = Python3Script(pt=dump_plane_reference_point)  # -> f; inputs pt: Point3d
# ---------- python_3_script_14: Python ----------
from compas.geometry import Point, Frame
from compas_rhino.conversions import point_to_compas

compas_pt = point_to_compas(pt)
f = Frame(compas_pt, [1, 0, 0], [0, -1, 0])
# ---------- end python_3_script_14 ----------

pt_5 = ConstructPoint(XCoordinate="12.54", YCoordinate="12.48", ZCoordinate="116.01")

dump_plane_reference_point_2 = Point(<point referenced from the Rhino model>)
python_3_script_15 = Python3Script(pt=dump_plane_reference_point_2)  # -> f; inputs pt: Point3d; same code as python_3_script_14

# ---- group: create pickup planes from the brick depot
xypoint_5 = Panel("""-62.52,
367.39,
-4.51""")
xaxis_5 = Panel("""90.04,
521.78,
-4.83""")
origin_5 = Panel("""90.32,
367.78,
-4.14""")
python_3_script_16 = Python3Script(
    pickup_base_origin=origin_5,
    n_z=Slider(5, range=0..10),
    tol_x=Slider(-0.5, range=-20..20),
    tol_y=Slider(-0.5, range=-20..20),
    tol_z=Slider(4, range=-20..20))  # -> out, frames, points, depot_frame; inputs pickup_base_origin: Point3d, n_z: Int32; same code as python_3_script_5
python_3_script_17 = Python3Script(Origin=origin_5, Xaxis=xaxis_5, XYpoint=xypoint_5)  # -> out, Rectangle; inputs Origin: Point3d, Xaxis: Point3d, XYpoint: Point3d; same code as python_3_script_6
compas_draw_11 = COMPASDraw(cg=python_3_script_16.points)  # -> rg; same code as compas_draw
points_3 = PointList(Points=compas_draw_11, Size=Slider(4, range=0..10))

# ---- group: transform rhino planes to robo base
fine_adjust_z_mm_3 = Slider(22, range=-5..500)
xaxis_6 = Panel("""535.83,
513.91,
-12.43""")
xypoint_6 = Panel("""229.24,
-79.84,
-11.39""")
origin_6 = Panel("""535.77,
-80.72,
-11.6""")
transform_3 = Python3Script(
    way_planes=python_3_script_11.rot_frames,
    wobj_origin=origin_6,
    wobj_xaxis=xaxis_6,
    wobj_xypoint=xypoint_6,
    z_safe_margin=fine_adjust_z_mm_3)  # -> out, flatten(transformed_frames); inputs way_planes: list, wobj_origin: Point3d, wobj_xaxis: Point3d, wobj_xypoint: Point3d, z_safe_margin: Double; same code as transform
python_3_script_18 = Python3Script(Origin=origin_6, Xaxis=xaxis_6, XYpoint=xypoint_6)  # -> out, Rectangle; inputs Origin: Point3d, Xaxis: Point3d, XYpoint: Point3d; same code as python_3_script_6
compas_draw_12 = COMPASDraw(cg=transform_3.transformed_frames)  # -> rg; same code as compas_draw

# ----
pt_6 = ConstructPoint(XCoordinate="-14.21", YCoordinate="-14.75", ZCoordinate="116.68")

# ----
# ASSEMBLE CODE
number_slider_2 = Slider(1, range=0..1)
grb_pos = Panel("2")
compas = Python3Script(
    way_frames=transform.transformed_frames,
    pickup_frames=python_3_script_5.frames,
    dump_frame=python_3_script_14,
    tcp_1=pt,
    tcp_2=pt_3,
    a=Slider(0.8, range=0..1),
    v=number_slider_2,
    grb_pos=grb_pos)  # -> out, vis_frames, vis_planes, script; inputs way_frames: list, pickup_frames: list, tcp_1: Point3d, tcp_2: Point3d, a: Double, v: Double, grb_pos: Int32
# ---------- compas: Python ----------
from imp import reload
import sys
import os

#get current file path
path = ghenv.Component.OnPingDocument().FilePath
#get parent directory of the parent directory
parentdir = os.path.dirname(path)
#get src folder which contains classes
dire = os.path.join(parentdir,'src')

sys.path.append(dire)

import simple_ur_script as ur
reload(ur)

import utils 
reload(utils)

import simple_comm as com
reload(com)

import compas.geometry as cg
import math as m

# ===== Set global constants =======

IO = 0 # Global constant
sd = 120

# =================================

script = "" #create empty string

def pickup_brick(script, pick_frame):

    frames = []

    # Translate frame to "safe" location
    safe_pick_frame = pick_frame.copy()
    safe_pick_frame.point.z += sd

    # Move to safe frame
    script += ur.move_l(safe_pick_frame, a, v)

    # Move to pick location
    script += ur.move_l(pick_frame, a, v)

    # Activate gripper
    script += ur.set_digital_out(IO, True)
    script += ur.sleep(1.5)

    # Move back to safe plane
    script += ur.move_l(safe_pick_frame, a, v)
    script += (ur.move_j([m.radians(253.70), m.radians(-90.63), m.radians(118.09), m.radians(-118.02), m.radians(-90.78), m.radians(28.16)], 1.2, 1.2))
    frames.extend([safe_pick_frame, pick_frame, safe_pick_frame])

    return script, frames


def place_brick(script, place_frame):
    frames = []
    
    # Safe frame for placing
    safe_place_frame = place_frame.copy()
    safe_place_frame.point.z += sd

    # Add to the path: go to the safe plane
    script += ur.move_l(safe_place_frame, a, v)

    # Add to the path: go to the place plane
    script += ur.move_l(place_frame, a, v)
    
    # Add to the path: turn off the vacuum and wait 1 second (hold the brick)
    script += ur.set_digital_out(IO, False)
    script += ur.sleep(1.5)
    
    # Add to the path: go back to the safe plane
    script += ur.move_l(safe_place_frame, a, v)

    frames.extend([safe_place_frame, place_frame, safe_place_frame])
    
    return script, frames


def depot_action(script, depot_frame, dump_frame):
    frames = []

    # 1. & 2. Copy the depot frame and raise its Z position by 20 units
    safe_depot_frame = depot_frame.copy()
    safe_depot_frame.point.z += 120

    # 3. UR Linear motions: approach safe position, then drop down to the depot point
    script += ur.move_l(safe_depot_frame, a, v)
    script += ur.move_l(depot_frame, a, v)

    # 4. Trigger I/O to TRUE (Grip/Activate)
    script += ur.set_digital_out(IO, True)
    script += ur.sleep(1.5)

    # 5. Move back up to the safe depot clearance height
    script += ur.move_l(safe_depot_frame, a, v)
    
    # 6. Move to the custom dump plane inputted from Grasshopper
    script += ur.move_l(dump_frame, a, v)
    
    # 7. Trigger I/O to FALSE (Release/Open)
    script += ur.set_digital_out(IO, False)
    script += ur.sleep(1.5)

    # Keep track of the generated motion sequence path for visual feedback
    frames.extend([safe_depot_frame, depot_frame, safe_depot_frame, dump_frame])

    return script, frames


# ===== INITIALIZE GLOBAL DESIGN TCP =====
# Force the script to execute using TCP 2 natively from the start
if tcp_2 is not None:
    script += ur.set_tcp_by_angles(tcp_2.X, tcp_2.Y, tcp_2.Z, m.radians(0), m.radians(-45), m.radians(45))

vis_frames = [] 
place_counter = 0 # Track sequential progress through structural drop planes

# ===== Generate pick, place, and depot sequence =====
for i in range(len(way_frames)):
    
    # 1. TRIGGER DEPOT AFTER EVERY (i*15)+i INTERVAL (0, 16, 32...) AT THE SAME LOCATION
    if i % 16 == 0:
        depot_index = i % len(pickup_frames)
        target_depot_frame = pickup_frames[depot_index]
        
        # --- OVERRIDE: Switch to TCP 1 specifically for the Depot Action ---
        if tcp_1 is not None:
            script += ur.set_tcp_by_angles(tcp_1.X, tcp_1.Y, tcp_1.Z, m.radians(-45), m.radians(0), m.radians(-45))
        
        # Execute the depot action under TCP 1 execution context
        script, depot_frames_list = depot_action(script, target_depot_frame, dump_frame)
        vis_frames.extend(depot_frames_list)
        
        # --- RESTORE OVERRIDE: Re-engage global TCP 2 right after Depot completes ---
        if tcp_2 is not None:
            script += ur.set_tcp_by_angles(tcp_2.X, tcp_2.Y, tcp_2.Z, m.radians(0), m.radians(-45), m.radians(45))
        
    # 2. RUN NORMAL PICK & PLACE ONLY ON NON-DEPOT ITERATIONS
    else:
        if place_counter < len(way_frames):
            # Target structural planes continuously using the decoupled index pointer
            current_place_frame = way_frames[place_counter]
            
            pickup_index = i % len(pickup_frames)
            current_pick_frame = pickup_frames[pickup_index]
            
            script, pif = pickup_brick(script, current_pick_frame)
            vis_frames.extend(pif)
            
            script, place_frames_list = place_brick(script, current_place_frame)
            vis_frames.extend(place_frames_list)
            
            # Step the structural placement pointer forward
            place_counter += 1


# Format the script to make it sendable
script = com.concatenate_script(script)


# Visualize
from compas_rhino import conversions
import Rhino.Geometry as rg

vis_planes = [conversions.frame_to_rhino(frame) for frame in vis_frames]
# ---------- end compas ----------
compas_draw_13 = COMPASDraw(cg=compas.vis_frames)  # -> rg; same code as compas_draw
pline = PolyLine(Vertices=compas.vis_planes, Closed=False)
points_4 = PointList(Points=compas.vis_planes, Size=Slider(7, range=0..100))

# ----
# ASSEMBLE CODE
number_slider_3 = Slider(1, range=0..1)
grb_pos_2 = Panel("2")
compas_2 = Python3Script(
    way_frames=transform_2.transformed_frames,
    pickup_frames=python_3_script_8.frames,
    dump_frame=python_3_script_15,
    tcp_1=pt_2,
    tcp_2=pt_4,
    a=Slider(0.7, range=0..1),
    v=number_slider_3,
    grb_pos=grb_pos_2)  # -> out, vis_frames, vis_planes, script; inputs way_frames: list, pickup_frames: list, tcp_1: Point3d, tcp_2: Point3d, a: Double, v: Double, grb_pos: Int32; same code as compas
compas_draw_14 = COMPASDraw(cg=compas_2.vis_frames)  # -> rg; same code as compas_draw
pline_2 = PolyLine(Vertices=compas_2.vis_planes, Closed=False)
points_5 = PointList(Points=compas_2.vis_planes, Size=Slider(7, range=0..100))

dump_plane_reference_point_3 = Point(<point referenced from the Rhino model>)
python_3_script_19 = Python3Script(pt=dump_plane_reference_point_3)  # -> f; inputs pt: Point3d; same code as python_3_script_14

# ---- group: selects tcp 1 for odd way_planes and tcp 2 for even way_planes
compas_3 = Python3Script(
    way_frames=transform_3.transformed_frames,
    pickup_frames=python_3_script_16.frames,
    tcp_1=pt_5,
    tcp_2=pt_6,
    dump_frame=python_3_script_19,
    a=Slider(0.2, range=0..1),
    v=Slider(1, range=0..1))  # -> out, vis_frames, vis_planes, script; inputs way_frames: list, pickup_frames: list, tcp_1: Point3d, tcp_2: Point3d, a: Double, v: Double, grb_pos: Int32
# ---------- compas_3: Python ----------
from imp import reload
import sys
import os

#get current file path
path = ghenv.Component.OnPingDocument().FilePath
#get parent directory of the parent directory
parentdir = os.path.dirname(path)
#get src folder which contains classes
dire = os.path.join(parentdir,'src')

sys.path.append(dire)

import simple_ur_script as ur
reload(ur)

import utils 
reload(utils)

import simple_comm as com
reload(com)

import compas.geometry as cg
import math as m

# ===== Set global constants =======

IO = 0 # Global constant
sd = 120

# =================================

script = "" #create empty string

def pickup_brick(script, pick_frame):

    frames = []

    # Translate frame to "safe" location
    safe_pick_frame = pick_frame.copy()
    safe_pick_frame.point.z += sd

    # Move to safe frame
    script += ur.move_l(safe_pick_frame, a, v)

    # Move to pick location
    script += ur.move_l(pick_frame, a, v)

    # Activate gripper
    script += ur.set_digital_out(IO, True)
    script += ur.sleep(1.5)

    # Move back to safe plane
    script += ur.move_l(safe_pick_frame, a, v)
    script += (ur.move_j([m.radians(253.70), m.radians(-90.63), m.radians(118.09), m.radians(-118.02), m.radians(-90.78), m.radians(28.16)], 1.2, 1.2))
    frames.extend([safe_pick_frame, pick_frame, safe_pick_frame])

    return script, frames


def place_brick(script, place_frame):
    frames = []
    
    # Safe frame for placing
    safe_place_frame = place_frame.copy()
    safe_place_frame.point.z += sd

    # Add to the path: go to the safe plane
    script += ur.move_l(safe_place_frame, a, v)

    # Add to the path: go to the place plane
    script += ur.move_l(place_frame, a, v)
    
    # Add to the path: turn off the vacuum and wait 1 second (hold the brick)
    script += ur.set_digital_out(IO, False)
    script += ur.sleep(1.5)
    
    # Add to the path: go back to the safe plane
    script += ur.move_l(safe_place_frame, a, v)

    frames.extend([safe_place_frame, place_frame, safe_place_frame])
    
    return script, frames


def depot_action(script, depot_frame, dump_frame):
    frames = []

    # 1. & 2. Copy the depot frame and raise its Z position by 20 units
    safe_depot_frame = depot_frame.copy()
    safe_depot_frame.point.z += 120

    # 3. UR Linear motions: approach safe position, then drop down to the depot point
    script += ur.move_l(safe_depot_frame, a, v)
    script += ur.move_l(depot_frame, a, v)

    # 4. Trigger I/O to TRUE (Grip/Activate)
    script += ur.set_digital_out(IO, True)
    script += ur.sleep(1.5)

    # 5. Move back up to the safe depot clearance height
    script += ur.move_l(safe_depot_frame, a, v)
    
    # 6. Move to the custom dump plane inputted from Grasshopper
    script += ur.move_l(dump_frame, a, v)
    
    # 7. Trigger I/O to FALSE (Release/Open)
    script += ur.set_digital_out(IO, False)
    script += ur.sleep(1.5)

    # Keep track of the generated motion sequence path for visual feedback
    frames.extend([safe_depot_frame, depot_frame, safe_depot_frame, dump_frame])

    return script, frames


vis_frames = [] 
place_counter = 0 # Track sequential progress through structural drop planes

# ===== Generate pick, place, and depot sequence =====
for i in range(len(way_frames)):
    
    # 1. TRIGGER DEPOT AFTER EVERY (i*15)+i INTERVAL (0, 16, 32...) AT THE SAME LOCATION
    if i % 16 == 0:
        depot_index = i % len(pickup_frames)
        target_depot_frame = pickup_frames[depot_index]
        
        script, depot_frames_list = depot_action(script, target_depot_frame, dump_frame)
        vis_frames.extend(depot_frames_list)
        
    # 2. RUN NORMAL PICK & PLACE ONLY ON NON-DEPOT ITERATIONS
    else:
        if place_counter < len(way_frames):
            # Target structural planes continuously using the decoupled index pointer
            current_place_frame = way_frames[place_counter]
            
            pickup_index = i % len(pickup_frames)
            current_pick_frame = pickup_frames[pickup_index]
            

            # 1. Set the correct TCP first (Even = TCP 2, Odd = TCP 1)
            if place_counter % 2 == 0:
                if tcp_2 is not None:
                    script += ur.set_tcp_by_angles(tcp_2.X, tcp_2.Y, tcp_2.Z, m.radians(0), m.radians(-45), m.radians(45))
            else:
                if tcp_1 is not None:
                    script += ur.set_tcp_by_angles(tcp_1.X, tcp_1.Y, tcp_1.Z, m.radians(-45), m.radians(0), m.radians(-45))

            # 2. Pick up the brick using that TCP
            script, pif = pickup_brick(script, current_pick_frame)
            vis_frames.extend(pif)
            
            # 3. Drop the brick using the same TCP
            script, place_frames_list = place_brick(script, current_place_frame)
            vis_frames.extend(place_frames_list)  # <--- ADD THIS MISSING LINE HERE

            # Step the structural placement pointer forward
            place_counter += 1


# Format the script to make it sendable
script = com.concatenate_script(script)

# Visualize
from compas_rhino import conversions
import Rhino.Geometry as rg
vis_planes = [conversions.frame_to_rhino(frame) for frame in vis_frames]



# Visualize
from compas_rhino import conversions
import Rhino.Geometry as rg

vis_planes = [conversions.frame_to_rhino(frame) for frame in vis_frames]
# ---------- end compas_3 ----------
compas_draw_15 = COMPASDraw(cg=compas_3.vis_frames)  # -> rg; same code as compas_draw
pline_3 = PolyLine(Vertices=compas_3.vis_planes, Closed=False)
points_6 = PointList(Points=compas_3.vis_planes, Size=Slider(7, range=0..100))

# ----
py3 = Python3Script(script=compas.script, ip_address="192.168.10.10", send=Button())  # -> out, a; inputs script: String, ip_address: String, send: Boolean
# ---------- py3: Python ----------
import simple_comm as com

if send:
    com.send_script(script,ip_address)
# ---------- end py3 ----------

# ----
# Robot base
# brick wall design
# Pickup base
# TCP 1
# TCP 2
# Dump plane
# Run script
panel_2 = Panel(compas.script)

py3_2 = Python3Script(script=compas_2.script, ip_address="192.168.10.10", send=Button())  # -> out, a; inputs script: String, ip_address: String, send: Boolean; same code as py3

# ----
# Robot base
# brick wall design
# Pickup base
# TCP 1
# TCP 2
# Dump plane
# Run script
panel_3 = Panel(compas_2.script)

# ----
# Robot base
# // flemish brick wall along a straight line with point attractor
# Pickup base
# brick wall design
# Create script for UR Robot
# Run script
# TCP 1
# TCP 2
# Dump plane
panel_4 = Panel(compas_3.script)

py3_3 = Python3Script(script=compas_3.script, ip_address="192.168.10.10", send=Button())  # -> out, a; inputs script: String, ip_address: String, send: Boolean; same code as py3
