# Grasshopper definition 261021_bricks_from_Srf_Robot_Script_with_PushBricks.gh (Grasshopper 1.0.8)
# plug-ins: Bifocals

number_slider = Slider(0.6, range=0..1)
gap = Slider(10, range=0..10)
# Domino
curve = Curve(<curve referenced from the Rhino model>)
brick_wall = Python3Script(crv=curve, num_layers=Slider(1, range=0..30), gap=gap, shift=Slider(7, range=0..10))  # -> bricks, geometries, frames, compas_crv, number_of_bricks; inputs crv: Curve, num_layers: Int32, gap: Double
# ---------- brick_wall: Python ----------
# r : compas 
# venv: mas-2627
from compas_rhino.devtools import DevTools
DevTools.ensure_path()

from compas.geometry import Box
from compas.geometry import Vector, cross_vectors
from compas.geometry import Frame

from compas_rhino.conversions import curve_to_compas

from brick_wall import Brick

brick = Brick(length=10, width=15, height=32)

bricks = []

compas_crv = curve_to_compas(crv)
compas_crv.translate([0,0,brick.height/2])

length = brick.length + gap
params, points= compas_crv.divide_by_length(length, True)

for param, pt in zip(params, points):
    tangent = compas_crv.tangent_at(param)
    # pt.z += brick.height
    frame = Frame(pt, xaxis = tangent, yaxis = cross_vectors(tangent, [0,0,1]))

    my_brick = Brick(frame, brick.length, brick.width, brick.height)
    bricks.append(my_brick)

geometries = []
frames = []
for brick in bricks:
    geometries.append(brick.draw())
    frames.append(brick.get_pick_frame())

number_of_bricks = len(frames)
# ---------- end brick_wall ----------
compas_draw = COMPASDraw(cg=brick_wall.compas_crv)  # -> rg
#   port cg: The COMPAS geometry or datastructure to be drawn.
#   port rg: The Rhino geometry object.
# ---------- compas_draw: Python ----------
# r: compas>=2.14.1
"""
Draws COMPAS geometry in Grasshopper.
"""

from typing import Any

import Grasshopper

from compas.scene import SceneObject


class CompasToRhinoGeometry(Grasshopper.Kernel.GH_ScriptInstance):
    def RunScript(self, cg):
        if not cg:
            return None

        return SceneObject(item=cg).draw()
# ---------- end compas_draw ----------
compas_draw_2 = COMPASDraw(cg=brick_wall.geometries)  # -> rg; same code as compas_draw
number_of_bricks = Panel(brick_wall.number_of_bricks)

# ---- group: This is needed only ONCE in the GH definition
enable_auto_reload = Python3Script()  # -> ok
# ---------- enable_auto_reload: Python ----------
"""
------------------------------
Using VS Code as Python editor
------------------------------

The simplest way to start using VS Code as our editor, is
to place our Python code in files located IN THE SAME FOLDER as our Grasshopper file.

After we have done that, we need 2 steps: 

1. Enable the COMPAS reloader on one component. This tells Grasshopper to watch for changes in the Pythoh files and reload if changed.
2. Every other component that uses Python code from external files needs to start with a method to ensure Grasshopper knows where to load the files from.

"""
# r: compas
# venv: mas-2627

from compas_rhino.devtools import DevTools
DevTools.enable_reloader()
# ---------- end enable_auto_reload ----------

# ----
lamcp_bridge = LAMCPBridge(enable=Toggle(True))  # -> status; inputs enable: Boolean, port: Int32
#   port enable: Toggle to start (True) or stop (False) the local HTTP server.
#   port port: Port to listen on (loopback only). Defaults to 8765.
#   port status: Current server status string.
# ---------- lamcp_bridge: Python ----------
"""
LAMCP Bridge: local HTTP server inside Rhino 8 / Grasshopper CPython.

Exposes `POST /exec` (JSON: `{"code": "...", "timeout": 30}`) which
exec()s `code` and returns
`{"stdout": "...", "stderr": "...", "result": "...", "error": null|str}`.

Pair with the `lamcp` FastMCP server, which translates Claude's
`run_python_script` MCP tool calls into POSTs to this endpoint.

Binds to 127.0.0.1 only. NEVER expose beyond localhost â€” it exec()s
arbitrary Python with full Rhino API access.

LAMCP v0.1.0
"""

import contextlib
import io
import json
import threading
import traceback
from http.server import BaseHTTPRequestHandler
from http.server import HTTPServer

import Grasshopper
import scriptcontext as sc


SHARED_GLOBALS_KEY = "_lamcp_bridge_globals"
SERVER_KEY = "_lamcp_bridge_server"


def _exec_code(code, timeout):
    """Run `code` on the HTTP-server thread and capture stdout/stderr/result.

    NOTE: this is intentionally NOT marshalled to Rhino's UI thread for the
    spike â€” `Rhino.RhinoApp.InvokeOnUiThread` was queueing actions that
    never fired in Rhino 8 CPython. Most read-only RhinoCommon access is
    safe cross-thread; mutations may crash. Add Eto-based marshalling
    back here when we need it.
    """
    out = io.StringIO()
    err = io.StringIO()
    g = sc.sticky.setdefault(SHARED_GLOBALS_KEY, {"__name__": "__lamcp_bridge__"})
    error_text = None
    result_repr = None
    try:
        with contextlib.redirect_stdout(out), contextlib.redirect_stderr(err):
            exec(code, g, g)
            result_repr = repr(g.get("_"))
    except BaseException:
        error_text = traceback.format_exc()

    return {
        "stdout": out.getvalue(),
        "stderr": err.getvalue(),
        "result": result_repr,
        "error": error_text,
    }


class _ExecHandler(BaseHTTPRequestHandler):
    # Silence default request logging so it doesn't clog the Rhino command line.
    def log_message(self, fmt, *args):
        pass

    def _send(self, code, payload):
        body = json.dumps(payload).encode("utf-8")
        self.send_response(code)
        self.send_header("Content-Type", "application/json")
        self.send_header("Content-Length", str(len(body)))
        self.end_headers()
        self.wfile.write(body)

    def do_GET(self):
        if self.path == "/health":
            self._send(200, {"status": "ok"})
        else:
            self._send(404, {"error": "not found"})

    def do_POST(self):
        if self.path != "/exec":
            self._send(404, {"error": "not found"})
            return
        length = int(self.headers.get("Content-Length", "0"))
        try:
            raw = self.rfile.read(length).decode("utf-8")
            body = json.loads(raw)
            code = body.get("code", "")
            timeout = float(body.get("timeout", 30.0))
        except Exception as exc:
            self._send(400, {"error": "bad request: " + repr(exc)})
            return
        result = _exec_code(code, timeout)
        self._send(200, result)


def _start_server(port):
    server = HTTPServer(("127.0.0.1", port), _ExecHandler)
    thread = threading.Thread(
        target=server.serve_forever, daemon=True, name="lamcp-bridge"
    )
    thread.start()
    return {"server": server, "thread": thread, "port": port}


def _stop_server(state):
    try:
        state["server"].shutdown()
        state["server"].server_close()
    except Exception:
        pass


class LamcpBridgeComponent(Grasshopper.Kernel.GH_ScriptInstance):
    def RunScript(self, enable: bool, port: int):
        port = int(port) if port else 8765

        state = sc.sticky.get(SERVER_KEY)

        if not enable:
            if state is not None:
                _stop_server(state)
                del sc.sticky[SERVER_KEY]
            return "stopped"

        # Already running on the requested port: no-op.
        if (
            state is not None
            and state.get("port") == port
            and state["thread"].is_alive()
        ):
            return "listening on http://127.0.0.1:{}".format(port)

        # Port changed or server died: tear down and restart.
        if state is not None:
            _stop_server(state)
            del sc.sticky[SERVER_KEY]

        try:
            sc.sticky[SERVER_KEY] = _start_server(port)
        except OSError as exc:
            ghenv.Component.AddRuntimeMessage(  # noqa: F821
                Grasshopper.Kernel.GH_RuntimeMessageLevel.Error,
                "Failed to bind 127.0.0.1:{}: {}".format(port, exc),
            )
            return "error: {}".format(exc)

        return "listening on http://127.0.0.1:{}".format(port)
# ---------- end lamcp_bridge ----------

# ----
# Circle
number_slider_2 = Slider(3, range=0..30)
gap_2 = Slider(5.8, range=0..10)
curve_2 = Curve(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)
brick_wall_2 = Python3Script(crv=curve_2, num_layers=number_slider_2, gap=gap_2, shift=Slider(5, range=0..10))  # -> bricks, geometries, frames, number_of_bricks; inputs crv: Curve, num_layers: Int32, gap: Double
# ---------- brick_wall_2: Python ----------
# r: compas
# venv: mas-2627
from compas_rhino.devtools import DevTools
DevTools.ensure_path()

# 0. Import everything we will need
import math
from compas.geometry import Box
from compas.geometry import Point, Vector
from compas.geometry import Frame
from compas.geometry import cross_vectors
from compas.geometry import Translation

from compas_rhino.conversions import curve_to_compas


# ..also import our module "brick_wall.py", that needs to be in the same folder as our GH file
from brick_wall import Brick

# 1. Start with an empty list of bricks to be created
bricks = []

# 2. Create points on curve curve
compas_crv = curve_to_compas(crv)
print(compas_crv.point_at(0))
compas_crv.translate([0,0,Brick.HEIGHT/2])
print(compas_crv.point_at(0))

# Divide the curve
length = (Brick.LENGTH + gap)/2
params, points = compas_crv.divide_by_length(length, True)

for i in range(num_layers):
    for j, (param, pt) in enumerate(zip(params, points)):
        if i % 2 == j % 2: #briliant method
            tangent = compas_crv.tangent_at(param)
            normal = cross_vectors(tangent, [0,0,1])

            if i % 2 == 1:
                pt = pt + tangent * (- shift)
            pt.z += i * Brick.HEIGHT

            frame = Frame(pt, xaxis = tangent, yaxis = normal)

            my_brick = Brick(frame)
            bricks.append(my_brick)


# Visualize and store brick data
geometries = []
frames = []
for brick in bricks:
    geometries.append(brick.draw())
    frames.append(brick.get_pick_frame())


number_of_bricks = len(frames)
# ---------- end brick_wall_2 ----------
compas_draw_3 = COMPASDraw(cg=brick_wall_2.geometries)  # -> rg; same code as compas_draw
number_of_bricks_2 = Panel(brick_wall_2.number_of_bricks)

# ----
# Straight line
number_slider_3 = Slider(3, range=0..30)
number_slider_4 = Slider(0.6, range=0..1)
gap_3 = Slider(3, range=0..10)
# Generate Geometry
curve_3 = Curve(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)
brick_wall_3 = Python3Script(crv=curve_3, num_layers=number_slider_3, gap=gap_3, shift=Slider(7, range=0..10))  # -> bricks, geometries, frames, compas_crv, number_of_bricks; inputs crv: Curve, num_layers: Int32, gap: Double
# ---------- brick_wall_3: Python ----------
# r: compas
# venv: mas-2627
from compas_rhino.devtools import DevTools
DevTools.ensure_path()

# 0. Import everything we will need
import math
from compas.geometry import Box
from compas.geometry import Point, Vector
from compas.geometry import Frame
from compas.geometry import cross_vectors
from compas.geometry import Translation

from compas_rhino.conversions import curve_to_compas


# ..also import our module "brick_wall.py", that needs to be in the same folder as our GH file
from brick_wall import Brick

# 1. Start with an empty list of bricks to be created
bricks = []

# 2. Create points on curve curve
compas_crv = curve_to_compas(crv)
compas_crv.translate([0,0,Brick.HEIGHT/2])

# Divide the curve
length = (Brick.LENGTH + gap)/2
params, points = compas_crv.divide_by_length(length, True)

for i in range(num_layers):
    for j, (param, pt) in enumerate(zip(params, points)):
        if i % 2 == j % 2: #briliant method
            tangent = compas_crv.tangent_at(param)
            normal = cross_vectors(tangent, [0,0,1])

            if i % 2 == 1:
                pt = pt + tangent * (- shift)
            pt.z += i * Brick.HEIGHT 

            frame = Frame(pt, xaxis = tangent, yaxis = normal)

            my_brick = Brick(frame)
            bricks.append(my_brick)


# Visualize and store brick data
geometries = []
frames = []
for brick in bricks:
    geometries.append(brick.draw())
    frames.append(brick.get_pick_frame())


number_of_bricks = len(frames)
# ---------- end brick_wall_3 ----------
compas_draw_4 = COMPASDraw(cg=brick_wall_3.compas_crv)  # -> rg; same code as compas_draw
number_of_bricks_3 = Panel(brick_wall_3.number_of_bricks)
compas_draw_5 = COMPASDraw(cg=brick_wall_3.geometries)  # -> rg; same code as compas_draw

curve_4 = Curve(<curve referenced from the Rhino model>)

# ----
# Curves
number_slider_5 = Slider(2, range=0..30)
gap_4 = Slider(5.8, range=0..10)
brick_wall_4 = Python3Script(crv=curve_4, num_layers=number_slider_5, gap=gap_4, shift=Slider(5, range=0..10))  # -> bricks, geometries, frames, number_of_bricks; inputs crv: Curve, num_layers: Int32, gap: Double; same code as brick_wall_2
number_of_bricks_4 = Panel(brick_wall_4.number_of_bricks)
compas_draw_6 = COMPASDraw(cg=brick_wall_4.geometries)  # -> rg; same code as compas_draw

# ----
# Measure work object
point = ValueList({"origin", "xaxis", "xypoint"}, selected="xypoint")
capture = Button()
capture_wobj = CaptureWobj(robot_ip="169.254.130.206", point_name=point, capture=capture)  # -> wobj_origin, wobj_xaxis, wobj_xypoint, info
# ---------- capture_wobj: Python ----------
"""
Capture the 3 points that define the work object (robot base) plane.

Jog the TCP to a point, pick its name (origin / xaxis / xypoint) and press capture.
The TCP position (robot base frame, mm) is saved to wobj_calibration.json next to
this .ghx file, so the points survive closing Grasshopper.
"""
import os
import sys
import json
import time

import scriptcontext as sc
import Rhino.Geometry as rg

NAMES = ["origin", "xaxis", "xypoint"]

gh_dir = os.path.dirname(ghenv.Component.OnPingDocument().FilePath)
src_dir = os.path.join(gh_dir, "src")
if src_dir not in sys.path:
    sys.path.append(src_dir)
import simple_comm as com

path = os.path.join(gh_dir, "wobj_calibration.json")

data = {}
if os.path.exists(path):
    with open(path) as f:
        data = json.load(f)

# keep the last status in sticky, so the message survives the button being released
status_key = "capture_status_" + str(ghenv.Component.InstanceGuid)

if capture:
    if point_name not in NAMES:
        sc.sticky[status_key] = "pick origin / xaxis / xypoint"
    else:
        try:
            x, y, z = list(com.listen_to_robot(robot_ip)["pose"])[:3]  # metres, robot base frame
            data[point_name] = [round(x * 1000, 2), round(y * 1000, 2), round(z * 1000, 2)]  # -> mm
            with open(path, "w") as f:
                json.dump(data, f, indent=2)
            sc.sticky[status_key] = "{} captured {}".format(point_name, time.strftime("%H:%M:%S"))
        except Exception as e:
            print(e)
            sc.sticky[status_key] = "robot not reachable"

ghenv.Component.Message = sc.sticky.get(status_key, "")

def pt(name):
    return rg.Point3d(*data[name]) if name in data else None

wobj_origin, wobj_xaxis, wobj_xypoint = pt("origin"), pt("xaxis"), pt("xypoint")
info = json.dumps(data, indent=2)
# ---------- end capture_wobj ----------
wobj_calibration = Panel(capture_wobj.info)

# ----
# Measure work object
point_2 = ValueList({"origin", "xaxis", "xypoint"}, selected="xypoint")
capture_2 = Button()
capture_wobj_2 = CaptureWobj(robot_ip="169.254.130.206", point_name=point_2, capture=capture_2)  # -> wobj_origin, wobj_xaxis, wobj_xypoint, info; same code as capture_wobj
wobj_calibration_2 = Panel(capture_wobj_2.info)

pt = ConstructPoint(XCoordinate="1031.05", YCoordinate="11.64", ZCoordinate="6.48")
pt_2 = ConstructPoint(XCoordinate="998.4", YCoordinate="282.89", ZCoordinate="6.92")
pt_3 = ConstructPoint(XCoordinate="774.22", YCoordinate="-17.5", ZCoordinate="5.17")

list_item = ListItem(List=compas_draw_3, Index=Slider(28, range=0..50), Wrap=True)
custom_preview = CustomPreview(Geometry=compas_draw_3, Material=ColourSwatch(SwatchColor=RGB(214, 133, 90)))

point_3 = Point(capture_wobj.wobj_xypoint)
point_4 = Point(capture_wobj_2.wobj_xypoint)
number_slider_6 = Slider(21.5, range=0..100)

x = Slider(10, range=0..100)
y = Slider(-11, range=-20..20)
lift_depth = Slider(10, range=0..100)
# Note: fine_adjust_Z(mm) means pressing depth
#           Also the acceleration and speed affect
stroke_angle = Slider(20, range=0..100)
vector_xyz = VectorXYZ(XComponent=x, YComponent=y, ZComponent=lift_depth)  # -> Vector, Length
# Stroke
python_3_script = Python3Script(k=Slider(4, range=0..100), vec_lifting=vector_xyz.Vector, angle=stroke_angle)  # -> out, new_plns; inputs plns: tree of Plane
# ---------- python_3_script: Python ----------
import Rhino.Geometry as rg
import math as m

from Grasshopper import DataTree
from Grasshopper.Kernel.Data import GH_Path
import ghpythonlib.treehelpers as tree


# Here to make the lifting stroke
def process_planes(pln_list, k, vec_lifting, stroke_angle):
    new_plns = []

    origins = [pln.Origin for pln in pln_list]
    crv = rg.Curve.CreateInterpolatedCurve(origins, 3)

    for i in range(len(pln_list)):
        new_pln = rg.Plane(pln_list[i]) 

        # k define which number points need lifting
        if i % k == 0: 

            matrix = rg.Transform.Translation(vec_lifting)

            success, t = crv.ClosestPoint(new_pln.Origin)
            vec_t = crv.TangentAt(t)

            # Decide where to flip stroke by dot product comparing to normal vectors of line (tangent)
            # Dot product < 0 means included angle 90° < θ ≤ 180°
            if vec_t * new_pln.XAxis < 0:
                new_pln.Transform(matrix)
                rotate_matrix = rg.Transform.Rotation(m.radians(stroke_angle), new_pln.YAxis, new_pln.Origin)
                new_pln.Transform(rotate_matrix)
            else:
                new_pln.Transform(matrix)
                rotate_matrix = rg.Transform.Rotation(m.radians(-stroke_angle), new_pln.YAxis, new_pln.Origin)
                new_pln.Transform(rotate_matrix)
    
        new_plns.append(new_pln)

    return new_plns



# data tree issue (Made by Claud)
out_tree = DataTree[object]()

for branch_idx in range(plns.BranchCount):
    path = plns.Path(branch_idx)      
    branch_plns = list(plns.Branch(branch_idx)) 

    result = process_planes(branch_plns, k, vec_lifting, angle)

    for pln in result:
        out_tree.Add(pln, path)

new_plns = out_tree
# ---------- end python_3_script ----------

# ----
# Adjust the height of placement
fine_adjust_z_mm = Slider(0, range=-5..10)
# Adjust the height of placement
fine_adjust_z_mm_2 = Slider(0, range=-5..10)
number_slider_7 = Slider(21.5, range=0..100)

pt_4 = ConstructPoint(XCoordinate="572.15", YCoordinate="354.27", ZCoordinate=number_slider_6)
pt_5 = ConstructPoint(XCoordinate="586.98", YCoordinate="353.48", ZCoordinate=number_slider_6)
pt_6 = ConstructPoint(XCoordinate="571.8", YCoordinate="346.96", ZCoordinate=number_slider_6)

number_slider_8 = Slider(21.5, range=0..100)

# ----
# Measure pick up location
capture_3 = Button()
point_5 = ValueList({"origin", "xaxis", "xypoint"}, selected="origin")
capture_pick = CapturePick(robot_ip="169.254.130.206", point_name=point_5, capture=capture_3)  # -> origin, xaxis_pt, xy_pt, info; disabled
# ---------- capture_pick: Python ----------
"""
Capture the 3 points that define the pick frame at the brick pick-up location.

Jog the TCP to a point, pick its name (origin / xaxis / xypoint) and press capture.
The TCP position (robot base frame, mm) is saved to pick_calibration.json next to
this .ghx file, so the points survive closing Grasshopper.
"""
import os
import sys
import json
import time

import scriptcontext as sc
import Rhino.Geometry as rg

NAMES = ["origin", "xaxis", "xypoint"]

gh_dir = os.path.dirname(ghenv.Component.OnPingDocument().FilePath)
src_dir = os.path.join(gh_dir, "src")
if src_dir not in sys.path:
    sys.path.append(src_dir)
import simple_comm as com

path = os.path.join(gh_dir, "pick_calibration.json")

data = {}
if os.path.exists(path):
    with open(path) as f:
        data = json.load(f)

# keep the last status in sticky, so the message survives the button being released
status_key = "capture_status_" + str(ghenv.Component.InstanceGuid)

if capture:
    if point_name not in NAMES:
        sc.sticky[status_key] = "pick origin / xaxis / xypoint"
    else:
        try:
            x, y, z = list(com.listen_to_robot(robot_ip)["pose"])[:3]  # metres, robot base frame
            data[point_name] = [round(x * 1000, 2), round(y * 1000, 2), round(z * 1000, 2)]  # -> mm
            with open(path, "w") as f:
                json.dump(data, f, indent=2)
            sc.sticky[status_key] = "{} captured {}".format(point_name, time.strftime("%H:%M:%S"))
        except Exception as e:
            print(e)
            sc.sticky[status_key] = "robot not reachable"

ghenv.Component.Message = sc.sticky.get(status_key, "")

def pt(name):
    return rg.Point3d(*data[name]) if name in data else None

origin, xaxis_pt, xy_pt = pt("origin"), pt("xaxis"), pt("xypoint")
info = json.dumps(data, indent=2)
# ---------- end capture_pick ----------
pick_calibration = Panel(capture_pick.info)
py3 = Python3Script(origin=pt_4, xaxis_pt=pt_5, xy_pt=pt_6)  # -> out, pick_frame; inputs origin: Point3d, xaxis_pt: Point3d, xy_pt: Point3d
# ---------- py3: Python ----------
from compas.geometry import Frame, Point
from compas.geometry import Rotation

from compas_rhino.conversions import point_to_compas

origin = point_to_compas(origin)
xaxis_pt = point_to_compas(xaxis_pt)
xy_pt = point_to_compas(xy_pt)

#define pick frame
pick_frame = Frame(origin, xaxis_pt - origin, xy_pt - origin)
# ---------- end py3 ----------
compas_draw_7 = COMPASDraw(cg=py3.pick_frame)  # -> rg; same code as compas_draw

# ----
# Transform from Rhino to Robot Space
transform = Python3Script(
    way_planes=brick_wall_4.frames,
    wobj_origin=capture_wobj_2.wobj_origin,
    wobj_xaxis=capture_wobj_2.wobj_xaxis,
    wobj_xypoint=capture_wobj_2.wobj_xypoint,
    z_safe_margin=fine_adjust_z_mm_2)  # -> out, robot_base, transformed_frames, first_frame, working_place; inputs way_planes: list, wobj_origin: Point3d, wobj_xaxis: Point3d, wobj_xypoint: Point3d, z_safe_margin: Double
# ---------- transform: Python ----------
from compas.geometry import Frame, Transformation, Translation, Vector
from compas.geometry import Polyline
from compas_rhino.conversions import polyline_to_rhino
#in this step we transform our way planes to robot space
#the rhino co-ordinate system is rather abstract in the physical world
#the robot base plane assumed the base frame of robot is the origin
#but rhino does not know that
#thus we transform things from our design space(Rhino World XY) to Robot Base Plane that we measure

def set_robot_base(origin, xaxis, xypoint):
    """
    set a base plane representing the robot working object plane
    """
    robot_base = Frame(origin, xaxis - origin, xypoint - origin)
    print (robot_base)
    return (robot_base)

def working_place_display(origin, xaxis, xypoint):
    a = wobj_origin
    b = wobj_xaxis
    c = wobj_xypoint
    d = b+c-a
    polyline = Polyline([a,b,d,c,a])
    display_polygon = polyline_to_rhino(polyline)
    return display_polygon
    


def rhino_to_robot_space(rhino_plane,robot_base_plane):
    """
    Transform the objects from Rhino world XY plane to robot work object plane
    """
    T_matrix = Transformation.from_frame_to_frame(Frame.worldXY(), robot_base_plane)
    robot_plane = rhino_plane.transformed(T_matrix)
    return robot_plane

def set_z_safe_margin(planes_to_adjust, safety_margin):
    adjusted = []
    T = Translation.from_vector(Vector(0, 0, safety_margin))
    for f in planes_to_adjust:
        adjusted.append(f.transformed(T))
    return adjusted

# ===== Robot base is set =====
robot_base =  set_robot_base(wobj_origin, wobj_xaxis, wobj_xypoint)

# ===== Set safety margin for Z height ======
safe_planes = set_z_safe_margin(way_planes, z_safe_margin)

# ===== Transforming the rhino planes into robot planes =====
transformed_frames = []
for plane in safe_planes: 
    transformed_frames.append(rhino_to_robot_space(plane, robot_base))

# ===== display working place
working_place = working_place_display(wobj_origin, wobj_xaxis, wobj_xypoint)

#test 
first_frame = transformed_frames[0]
# ---------- end transform ----------

pt_7 = ConstructPoint(XCoordinate="569.05", YCoordinate="354.87", ZCoordinate=number_slider_7)
pt_8 = ConstructPoint(XCoordinate="586.98", YCoordinate="353.48", ZCoordinate=number_slider_7)
pt_9 = ConstructPoint(XCoordinate="571.8", YCoordinate="346.96", ZCoordinate=number_slider_7)

pt_10 = ConstructPoint(XCoordinate="570.05", YCoordinate="354.83", ZCoordinate=number_slider_8)
pt_11 = ConstructPoint(XCoordinate="586.98", YCoordinate="353.48", ZCoordinate=number_slider_8)
pt_12 = ConstructPoint(XCoordinate="571.8", YCoordinate="346.96", ZCoordinate=number_slider_8)

# ----
# Measure pick up location
capture_4 = Button()
point_6 = ValueList({"origin", "xaxis", "xypoint"}, selected="origin")
capture_pick_2 = CapturePick(robot_ip="169.254.130.206", point_name=point_6, capture=capture_4)  # -> origin, xaxis_pt, xy_pt, info; disabled; same code as capture_pick
pick_calibration_2 = Panel(capture_pick_2.info)
py3_2 = Python3Script(origin=pt_10, xaxis_pt=pt_11, xy_pt=pt_12)  # -> out, pick_frame; inputs origin: Point3d, xaxis_pt: Point3d, xy_pt: Point3d; same code as py3
compas_draw_8 = COMPASDraw(cg=py3_2.pick_frame)  # -> rg; same code as compas_draw

curve_5 = Curve(transform.working_place)

# ----
# Measure and set TCP
panel = Panel("-1.71")
pt_13 = ConstructPoint(XCoordinate=panel, YCoordinate="-0.9", ZCoordinate="77.83")

number_slider_9 = Slider(0.4, range=0..1)

# ----
# Measure and set TCP
panel_2 = Panel("-1.71")
pt_14 = ConstructPoint(XCoordinate=panel_2, YCoordinate="-0.9", ZCoordinate="77.83")

number_slider_10 = Slider(0.1, range=0..0.1)
number_slider_11 = Slider(0.1, range=0..0.1)

python_3_script_2 = Python3Script(layers=Slider(1, range=0..10), row=Slider(15, range=0..20), col=Slider(4, range=0..10), pick_frame=py3.pick_frame)  # -> out, pts, pick_frames; inputs layers: Int32, row: Int32, col: Int32
# ---------- python_3_script_2: Python ----------
# r: compas
# venv: mas-2627
from compas_rhino.devtools import DevTools
DevTools.ensure_path()

# 0. Import everything we will need
import math
from compas.geometry import Box
from compas.geometry import Point
from compas.geometry import Frame
from compas.geometry import cross_vectors

from compas_rhino.conversions import curve_to_compas

from brick_wall import Brick
brick = Brick(length=10, width=15, height=32)

# 1. Start with an empty list of bricks to be created
bricks = []

pts = []
pick_frames = []

print(brick.length)
print(brick.width)

for i in range(row):
    for j in range(col):
        x = (pick_frame.point.x + 10) - i * brick.length
        y = (pick_frame.point.y) - j * brick.width
        z = (pick_frame.point.z - brick.length) + brick.height 
        # print(z)
        pt = Point(x, y, z)
        pts.append(pt)
        frame = Frame(pt, pick_frame.xaxis, pick_frame.yaxis)
        pick_frames.append(frame)
        # print(frame)


print(pick_frame)
# ---------- end python_3_script_2 ----------

python_3_script_3 = Python3Script(layers=Slider(2, range=0..10), row=Slider(5, range=0..10), col=Slider(4, range=0..10), pick_frame=py3_2.pick_frame)  # -> out, pts, pick_frames; inputs layers: Int32, row: Int32, col: Int32
# ---------- python_3_script_3: Python ----------
# r: compas
# venv: mas-2627
from compas_rhino.devtools import DevTools
DevTools.ensure_path()

# 0. Import everything we will need
import math
from compas.geometry import Box
from compas.geometry import Point
from compas.geometry import Frame
from compas.geometry import cross_vectors

from compas_rhino.conversions import curve_to_compas

from brick_wall import Brick

# 1. Start with an empty list of bricks to be created
bricks = []

pts = []
pick_frames = []

for k in range(layers):
    for i in range(row):
        for j in range(col):
            x = pick_frame.point.x - i * Brick.LENGTH
            y = pick_frame.point.y - j * Brick.WIDTH
            z = pick_frame.point.z + (layers - k -1) * Brick.HEIGHT
            pt = Point(x, y, z)
            pts.append(pt)
            frame = Frame(pt, pick_frame.xaxis, pick_frame.yaxis)
            pick_frames.append(frame)


brick = Brick()
print(pick_frame)
# ---------- end python_3_script_3 ----------

# ----
# Convert Planes to URScript
compas = Python3Script(
    way_frames=transform.transformed_frames,
    tcp_measured=pt_14,
    acceleration=number_slider_10,
    velocity=number_slider_11,
    pick_frames=python_3_script_3.pick_frames)  # -> out, a, vis_frames, vis_planes, script; inputs way_frames: list, tcp_measured: Point3d, acceleration: Double, velocity: Double, pick_frames: list
# ---------- compas: Python ----------
from imp import reload
import sys
import os

#get current file path
path = ghenv.Component.OnPingDocument().FilePath
#get parent directory of the parent directory
parentdir = os.path.dirname(path)
#get src folder which contains classes
dire = os.path.join(parentdir,'src')

sys.path.append(dire)

import simple_ur_script as ur
reload(ur)

import utils 
reload(utils)

import simple_comm as com
reload(com)

import compas.geometry as cg
import math as m

# ===== Set global constants =======

IO = 4 # Global constant
SAFE_DIST = 100
sleep_time = 0.5

# =================================
from compas.geometry import Frame, Point

# Test
# frame = way_frames
# a = Frame([frame.point.x, frame.point.y, frame.point.z + SAFE_DIST], [0,1,0], [1, 0, 0])
# print(a)


def safe_location(frame, sefe_dist = SAFE_DIST):
    safe_frame = Frame([frame.point.x, frame.point.y, frame.point.z + SAFE_DIST], frame.xaxis, frame.yaxis)
    if safe_frame.zaxis.z > 0:
            safe_frame.xaxis = -safe_frame.xaxis
    return safe_frame

def pickup_brick(script, pick_up_frame):
    # Translate frame to "safe" location
    safe_frame = safe_location(pick_up_frame)
    # Move to safe frame
    script += ur.move_l(safe_frame, acceleration, velocity)
    # Move to pick location
    script += ur.move_l(pick_up_frame, acceleration, velocity)
    # Activate gripper
    script += ur.set_digital_out(IO, True)
    script += ur.sleep(sleep_time)
    # Move back to safe plane
    script += ur.move_l(safe_frame, acceleration, velocity)

    frames = [safe_frame, pick_up_frame, safe_frame]

    return script, frames


def place_brick(script, place_frame):
    
    # Safe frame for placing
    safe_frame = safe_location(place_frame)
    # Add to the path: go to the safe plane
    script += ur.move_l(safe_frame, acceleration, velocity)
    # Add to the path: go to the place plane
    script += ur.move_l(place_frame, acceleration, velocity)
    # Add to the path: turn off the vacuum and wait 1 second (hold the brick)
    script += ur.set_digital_out(IO, False)
    script += ur.sleep(sleep_time)
    # Add to the path: go back to the safe plane
    script += ur.move_l(safe_frame, acceleration, velocity)

    frames = [safe_frame, place_frame, safe_frame]
    return script, frames


# force pick_frame zaxis tio be negative
# if pick_frame.zaxis.z > 0:
#             pick_frame.xaxis = -pick_frame.xaxis

script = "" #create empty string

#if value given for tcp measured, then add line to script, otherwise it will take current tcp from robot
if tcp_measured is not None:
    script += ur.set_tcp_by_angles(tcp_measured.X, tcp_measured.Y, tcp_measured.Z, m.radians(0.0),m.radians(0.0),m.radians(0))


vis_frames = []
# Generate pick and place sequence

for i, frame in enumerate(way_frames):
    # for p in pick_frames:
        script, f1 = pickup_brick(script, pick_frames[i])
        script, f2 = place_brick(script, frame)
        vis_frames.extend(f1 + f2)

script = com.concatenate_script(script)


# Visualize
from compas_rhino import conversions
import Rhino.Geometry as rg

vis_planes = [conversions.frame_to_rhino(frame) for frame in vis_frames]
# ---------- end compas ----------
compas_draw_9 = COMPASDraw(cg=python_3_script_2.pick_frames)  # -> rg; same code as compas_draw

list_item_2 = ListItem(List=compas_draw_9, Index=Slider(0, range=0..10), Wrap=True)  # -> flatten(Item)
point_list = PointList(Points=list_item_2, Size=Slider(6, range=0..10))

compas_draw_10 = COMPASDraw(cg=python_3_script_3.pick_frames)  # -> rg; same code as compas_draw

list_item_3 = ListItem(List=compas_draw_10, Index=Slider(0, range=0..10), Wrap=True)  # -> flatten(Item)
point_list_2 = PointList(Points=list_item_3, Size=Slider(6, range=0..10))

point_7 = Point(compas.vis_planes)
compas_draw_11 = COMPASDraw(cg=compas.vis_frames)  # -> rg; same code as compas_draw
polyline = PolyLine(Vertices=point_7, Closed=False)

# ---- group: Send UR script to Robot!
# Send to Robot!
py3_3 = Python3Script(script=compas.script, ip_address="169.254.130.206", send=Button())  # -> out, a; inputs script: String, ip_address: String, send: Boolean
# ---------- py3_3: Python ----------
import simple_comm as com

if send:
    com.send_script(script,ip_address)
# ---------- end py3_3 ----------

# ----
panel_3 = Panel(compas.script)

curve_6 = Curve(graft(<curve referenced from the Rhino model>))
# Bricks from any surface
curve_b = Curve(graft(<curve referenced from the Rhino model>))
loft = Loft(
    Curves=[curve_6, curve_b],
    Options={Adjust=False, Closed=False, LoftEnds=0, LoftSimp=0, LoftType=0, Rebuild=10, Refit=0.01})
gap_5 = Slider(20, range=0..50)

brep = Brep(loft)

brick_wall_5 = Python3Script(srf=brep, num_layers=Slider(10, range=0..30), gap=gap_5)  # -> bricks, geometries, frames; inputs srf: Surface, num_layers: Int32, gap: Double
# ---------- brick_wall_5: Python ----------
# r: compas
# venv: mas-2627
from compas_rhino.devtools import DevTools
DevTools.ensure_path()

import Rhino.Geometry as rg
from compas.geometry import Point, Frame, cross_vectors
from brick_wall import Brick

bricks = []
geometries = []
frames = []

pitch = Brick.LENGTH + float(gap)
if pitch <= 0:
    raise ValueError('Brick.LENGTH + gap must be positive')

brep = srf.ToBrep() if hasattr(srf, 'ToBrep') else srf
bbox = brep.GetBoundingBox(True)
bottom = bbox.Min.Z
available = max(0, int((bbox.Max.Z - bottom) / Brick.HEIGHT))
count = min(max(0, int(num_layers)), available)

layers = []
for i in range(count):
    z = bottom + (i + 0.5) * Brick.HEIGHT
    plane = rg.Plane(rg.Point3d(0, 0, z), rg.Vector3d(0, 0, 1))
    result = rg.Intersect.Intersection.BrepPlane(brep, plane, 0.01)
    if result is None:
        continue
    ok, contours, _ = result
    if ok and contours:
        for curve in contours:
            if curve.GetLength() >= Brick.LENGTH:
                layers.append((i, curve.DuplicateCurve()))

if layers:
    # Fix the number-of-bricks parity across courses.
    # Opposite parity means the centres alternate by half a module
    # when the contours have similar lengths.
    lowest = min(i for i, _ in layers)
    base = max((c for i, c in layers if i == lowest),
               key=lambda c: c.GetLength())
    base_max = int((base.GetLength() - Brick.LENGTH) / pitch) + 1
    base_parity = base_max % 2

    for i, curve in layers:
        if curve.PointAtStart.X > curve.PointAtEnd.X:
            curve.Reverse()
        L = curve.GetLength()
        max_n = int((L - Brick.LENGTH) / pitch) + 1
        if max_n < 1:
            continue

        # Even courses use the base count parity; odd courses
        # use the opposite parity. This is the critical difference
        # from the previous (broken) centring approach.
        wanted_parity = (base_parity + i - lowest) % 2
        n = max_n
        if n % 2 != wanted_parity:
            n -= 1
        if n < 1:
            continue

        occupied = Brick.LENGTH + (n - 1) * pitch
        first = (L - occupied) / 2.0 + Brick.LENGTH / 2.0

        for j in range(n):
            distance = first + j * pitch
            ok, t = curve.LengthParameter(distance)
            if not ok:
                continue
            p = curve.PointAt(t)
            v = curve.TangentAt(t)
            direction = [v.X, v.Y, 0]
            if direction[0]**2 + direction[1]**2 <= 1e-10:
                continue
            normal = cross_vectors(direction, [0, 0, 1])
            frame = Frame(Point(p.X, p.Y, p.Z),
                          xaxis=direction, yaxis=normal)
            bricks.append(Brick(frame))

for brick in bricks:
    geometries.append(brick.draw())
    frames.append(brick.get_pick_frame())
# ---------- end brick_wall_5 ----------
compas_draw_12 = COMPASDraw(cg=brick_wall_5.frames)  # -> rg; same code as compas_draw
compas_draw_13 = COMPASDraw(cg=brick_wall_5.geometries)  # -> rg; same code as compas_draw

# ----
# Transform from Rhino to Robot Space
transform_2 = Python3Script(way_planes=brick_wall_5.frames, wobj_origin=pt, wobj_xaxis=pt_2, wobj_xypoint=pt_3, z_safe_margin=fine_adjust_z_mm)  # -> out, robot_base, transformed_frames, first_frame, working_place; inputs way_planes: list, wobj_origin: Point3d, wobj_xaxis: Point3d, wobj_xypoint: Point3d, z_safe_margin: Double; same code as transform
curve_7 = Curve(transform_2.working_place)
compas_draw_14 = COMPASDraw(cg=transform_2.transformed_frames)  # -> rg; same code as compas_draw
# Convert Planes to URScript
list_item_4 = ListItem(List=transform_2.transformed_frames, Index=0, Wrap=True)
compas_2 = Python3Script(
    way_frames=transform_2.transformed_frames,
    tcp_measured=pt_13,
    acceleration=number_slider_9,
    velocity=number_slider_9,
    pick_frames=python_3_script_3.pick_frames,
    angle=Slider(-15, range=-90..90))  # -> out, a, vis_frames, vis_planes, pushing_frame, script; inputs way_frames: list, tcp_measured: Point3d, acceleration: Double, velocity: Double, pick_frames: list
# ---------- compas_2: Python ----------
from imp import reload
import sys
import os

#get current file path
path = ghenv.Component.OnPingDocument().FilePath
#get parent directory of the parent directory
parentdir = os.path.dirname(path)
#get src folder which contains classes
dire = os.path.join(parentdir,'src')

sys.path.append(dire)

import simple_ur_script as ur
reload(ur)

import utils 
reload(utils)

import simple_comm as com
reload(com)

import compas.geometry as cg
import math as m

# ===== Set global constants =======

IO = 4 # Global constant
SAFE_DIST = 100
sleep_time = 0.5

# =================================
from compas.geometry import Frame, Point, Vector, Rotation
import math as m

# Test
# frame = way_frames
# a = Frame([frame.point.x, frame.point.y, frame.point.z + SAFE_DIST], [0,1,0], [1, 0, 0])
# print(a)


def safe_location(frame, sefe_dist = SAFE_DIST):
    safe_frame = Frame([frame.point.x, frame.point.y, frame.point.z + SAFE_DIST], frame.xaxis, frame.yaxis)
    if safe_frame.zaxis.z > 0:
            safe_frame.xaxis = -safe_frame.xaxis
    return safe_frame

def pickup_brick(script, pick_up_frame):
    # Translate frame to "safe" location
    safe_frame = safe_location(pick_up_frame)
    # Move to safe frame
    script += ur.move_l(safe_frame, acceleration, velocity)
    # Move to pick location
    script += ur.move_l(pick_up_frame, acceleration, velocity)
    # Activate gripper
    script += ur.set_digital_out(IO, True)
    script += ur.sleep(sleep_time)
    # Move back to safe plane
    script += ur.move_l(safe_frame, acceleration, velocity)

    frames = [safe_frame, pick_up_frame, safe_frame]

    return script, frames


def place_brick(script, place_frame):
    
    # Safe frame for placing
    safe_frame = safe_location(place_frame)
    # Add to the path: go to the safe plane
    script += ur.move_l(safe_frame, acceleration, velocity)
    # Add to the path: go to the place plane
    script += ur.move_l(place_frame, acceleration, velocity)
    # Add to the path: turn off the vacuum and wait 1 second (hold the brick)
    script += ur.set_digital_out(IO, False)
    script += ur.sleep(sleep_time)
    # Add to the path: go back to the safe plane
    script += ur.move_l(safe_frame, acceleration, velocity)

    frames = [safe_frame, place_frame, safe_frame]
    return script, frames


def push_first_brick(script, first_frame, angle):
    ad_frame =first_frame.copy()
    v = ad_frame.xaxis.unitized()

    ad_frame.point -= v * 11
    ad_frame.point.z +=32

    end_frame = ad_frame.copy()
    end_frame.point.z -= 8
    move_v = end_frame.xaxis.unitized() 
    pushing_frame = end_frame.translated(-move_v * 16)
    end_frame.translate(move_v * 10)

    safe_frame = safe_location(pushing_frame)

    matrix_r = Rotation.from_axis_and_angle(end_frame.yaxis, m.radians(angle), pushing_frame.point)
    pushing_frame.transform(matrix_r)
    matrix_r = Rotation.from_axis_and_angle(end_frame.yaxis, m.radians(-angle), end_frame.point)
    end_frame.transform(matrix_r)

    # Safe frame for pushing
    script += ur.move_l(safe_frame, acceleration, velocity)
    script += ur.move_l(pushing_frame, acceleration, velocity)
    script += ur.move_l(end_frame, acceleration + 1.5, velocity +1.5)
    script += ur.move_l(safe_frame, acceleration, velocity)

    frame = [safe_frame, pushing_frame, end_frame, safe_frame]
    return script, frame




# force pick_frame zaxis tio be negative
# if pick_frame.zaxis.z > 0:
#             pick_frame.xaxis = -pick_frame.xaxis

script = "" #create empty string

#if value given for tcp measured, then add line to script, otherwise it will take current tcp from robot
if tcp_measured is not None:
    script += ur.set_tcp_by_angles(tcp_measured.X, tcp_measured.Y, tcp_measured.Z, m.radians(0.0),m.radians(0.0),m.radians(0))


vis_frames = []
# Generate pick and place sequence

for i, frame in enumerate(way_frames):
    # for p in pick_frames:
        script, f1 = pickup_brick(script, pick_frames[i])
        script, f2 = place_brick(script, frame)
        vis_frames.extend(f1 + f2)

#Push the first brick
# script, f3 = push_first_brick(script, way_frames[0], angle)
# vis_frames.extend(f3)

script = com.concatenate_script(script)


# Visualize
from compas_rhino import conversions
import Rhino.Geometry as rg

vis_planes = [conversions.frame_to_rhino(frame) for frame in vis_frames]
# ---------- end compas_2 ----------
compas_draw_15 = COMPASDraw(cg=list_item_4)  # -> rg; same code as compas_draw
compas_draw_16 = COMPASDraw(cg=compas_2.pushing_frame)  # -> rg; same code as compas_draw
point_8 = Point(compas_2.vis_planes)
compas_draw_17 = COMPASDraw(cg=compas_2.vis_frames)  # -> rg; same code as compas_draw
polyline_2 = PolyLine(Vertices=point_8, Closed=False)

# ---- group: Send UR script to Robot!
# Send to Robot!
py3_4 = Python3Script(script=compas_2.script, ip_address="169.254.130.206", send=Button())  # -> out, a; inputs script: String, ip_address: String, send: Boolean; same code as py3_3

# ----
panel_4 = Panel(compas_2.script)
