# Grasshopper definition 261022_brick_to_robot_Nils.gh (Grasshopper 1.0.8)
# plug-ins: Moonlight

moonlight = Moonlight(Mode=False)

python_3_script = Python3Script(
    length="32",
    width="15",
    hight="10",
    gap="1.5",
    n="3",
    t="0",
    levels_1="15",
    levels_2="14",
    angle_factor_1=Slider(-0.32, range=-1..1),
    angle_factor_2=Slider(0.26, range=-1..1),
    offset_1=Slider(0.3, range=-10..10),
    offset_2=Slider(5.47, range=-10..10),
    base_level=Toggle(True),
    angle_factor_base=Slider(0.39, range=-1..1),
    gap_base=Slider(6.15, range=0.01..10),
    invert_growth=Toggle(False),
    bottom_levels=Slider(4, range=0..10))  # -> out, circles, points, polygons, planes, boxes, compas_bricks, compas_planes, orientations; inputs length: Double, width: Double, hight: Double, gap: Double, n: Int32, t: Int32, levels_1: Int32, levels_2: Int32, angle_factor_1: Double, angle_factor_2: Double, offset_1: Double, offset_2: Double, base_level: Boolean, angle_factor_base: Double, gap_base: Double, invert_growth: Boolean, bottom_levels: Int32
# ---------- python_3_script: Python ----------
import math
import Rhino.Geometry as rg
import ghpythonlib.treehelpers as th  # Hilfsbibliothek für Grasshopper DataTrees

# COMPAS-Geometrie importieren
try:
    from compas.geometry import Box as CompasBox, Frame, Point, Vector
    compas_available = True
except ImportError:
    compas_available = False
    print("Hinweis: COMPAS ist in dieser Python-Umgebung nicht installiert.")

def calculate_r_chord(length, width, gap, n, t):
    # Minimaler Radius: r_min > max(length, width, gap) / 2
    r_min = max(length, width, gap) / 2.0 + 1e-9
    
    # Zielfunktion: Summe aller Mittelpunktswinkel minus 360° (2*pi)
    def f(r_val):
        alpha = 2 * math.asin(length / (2 * r_val))
        beta  = 2 * math.asin(gap / (2 * r_val))
        gamma = 2 * math.asin(width / (2 * r_val)) if t > 0 else 0.0
        return n * alpha + (n + t) * beta + t * gamma - 2 * math.pi

    # Prüfen, ob bei r_min 360° erreicht werden können
    f_min = f(r_min)
    if f_min < 0:
        max_winkel = math.degrees(f_min + 2 * math.pi)
        return None, "Fehler: Max. erreichbarer Winkel zu klein ({:.1f}° < 360°)".format(max_winkel)

    # Obere Suchgrenze ermitteln
    r_low = r_min
    r_high = max(length, width, gap) * 2.0
    while f(r_high) > 0:
        r_high *= 2.0
        if r_high > 1e12:
            return None, "Fehler: Keine Schranke gefunden"

    # Bisektionsverfahren (Intervallschachtelung)
    for _ in range(100):
        r_mid = (r_low + r_high) / 2.0
        val = f(r_mid)
        if abs(val) < 1e-9 or (r_high - r_low) < 1e-9:
            return r_mid, "OK"
        if val > 0:
            r_low = r_mid
        else:
            r_high = r_mid

    return (r_low + r_high) / 2.0, "OK"

# Flexible Auswertung der neuen Variablen bottom_levels
try:
    num_bottom = int(bottom_levels)
except NameError:
    try:
        num_bottom = int(extra_bottom_levels)
    except NameError:
        try:
            num_bottom = int(base_blocks)
        except NameError:
            num_bottom = 0

num_bottom = max(0, num_bottom)

# Flexible Auswertung des Boolean-Inputs für die Umkehrung der Phasen
try:
    invert_dir = bool(invert_growth)
except NameError:
    try:
        invert_dir = bool(invert_phases)
    except NameError:
        try:
            invert_dir = bool(invert_radius)
        except NameError:
            invert_dir = False

# Flexible Auswertung des Boolean-Inputs für die optionale Basis-Ebene
try:
    has_base = bool(base_level)
except NameError:
    try:
        has_base = bool(first_level)
    except NameError:
        try:
            has_base = bool(add_base)
        except NameError:
            has_base = False

# Flexible Auswertung von levels_1 und levels_2
try:
    l1 = int(levels_1)
except NameError:
    try:
        l1 = int(levels)
    except NameError:
        l1 = 5

try:
    l2 = int(levels_2)
except NameError:
    l2 = 0

total_main_levels = l1 + l2
total_iterations = (total_main_levels + 1) if has_base else total_main_levels

# Flexible Auswertung des Haupt-Gaps und des Basis-Gaps
try:
    gap_main_val = float(gap)
except NameError:
    gap_main_val = 0.0

try:
    gap_base_val = float(gap_base)
except NameError:
    try:
        gap_base_val = float(base_gap)
    except NameError:
        try:
            gap_base_val = float(gap_0)
        except NameError:
            gap_base_val = gap_main_val

# Flexible Auswertung von angle_factor_1 und angle_factor_2
try:
    fac_1 = float(angle_factor_1)
except NameError:
    try:
        fac_1 = float(angle_factor)
    except NameError:
        try:
            fac_1 = float(angle)
        except NameError:
            fac_1 = 0.5

try:
    fac_2 = float(angle_factor_2)
except NameError:
    fac_2 = fac_1

# Flexible Auswertung von angle_factor_base für die Basis-Ebene
try:
    fac_base = float(angle_factor_base)
except NameError:
    try:
        fac_base = float(angle_factor_0)
    except NameError:
        try:
            fac_base = float(base_angle_factor)
        except NameError:
            fac_base = fac_1

# Vorzeichenwechsel aller angle_factors bei invert_growth = True
if invert_dir:
    fac_1 = -fac_1
    fac_2 = -fac_2
    fac_base = -fac_base

# Flexible Auswertung von offset_1 und offset_2
try:
    off_val_1 = float(offset_1)
except NameError:
    try:
        off_val_1 = float(offset)
    except NameError:
        off_val_1 = 0.0

try:
    off_val_2 = float(offset_2)
except NameError:
    off_val_2 = off_val_1

# Zustand am Ende von Phase 1 berechnen
p1_last_step = max(0, l1 - 1)
t_start_val = int(t) % 2
n_start_val = int(n)

t_p1_end = (t_start_val + p1_last_step) % 2
if invert_dir:
    n_p1_end = max(2, n_start_val - (p1_last_step + 1 - t_start_val) // 2)
else:
    n_p1_end = n_start_val + (p1_last_step + t_start_val) // 2

# Initialisierung der Ausgabe-Listen
circles = []
polygons = []         # Liste der geschlossenen Polylines
py_points = []        # Temporäre Liste für Punkte
py_planes = []        # Temporäre Liste für die Rhino-Ebenen
py_boxes = []         # Temporäre Liste für die Rhino-Boxen
py_orientations = []  # Temporäre Liste für Ausrichtungscodes (1=length, 2=width)
py_compas_bricks = [] # Temporäre Liste für COMPAS Boxen (Bricks)
py_compas_planes = [] # Temporäre Liste für COMPAS Planes (Frames)
radii = []

# Exakte Block-X-Achsenrichtung der allerersten Ebene darüber berechnen
if has_base:
    r_first, _ = calculate_r_chord(length, width, gap_base_val, 2, 0)
    alpha_first = 2 * math.asin(length / (2 * r_first)) if r_first else 0.0
    rot_first_level = fac_base * alpha_first
else:
    t_0 = t_start_val
    n_0 = max(2, n_start_val - (1 - t_start_val) // 2) if invert_dir else n_start_val + t_start_val // 2
    r_first, _ = calculate_r_chord(length, width, gap_main_val, n_0, t_0)
    alpha_first = 2 * math.asin(length / (2 * r_first)) if r_first else 0.0
    rot_first_level = fac_1 * alpha_first

# Exakter X-Achsen-Winkel der Blöcke in dieser Referenzebene
ref_block_orientation = rot_first_level + (alpha_first * 0.5) + (math.pi / 2.0)

# -----------------------------------------------------------------------------
# TEIL 1: Zusätzliche untere Ebenen erzeugen (einzelne Blöcke im Zentrum)
# -----------------------------------------------------------------------------
for b_idx in range(num_bottom):
    z_b = b_idx * float(hight)
    
    steps_below = num_bottom - b_idx
    b_rotation = ref_block_orientation + steps_below * (math.pi / 2.0)
    
    center_pt = rg.Point3d(0, 0, z_b)
    plane_center = rg.Plane(center_pt, rg.Vector3d.ZAxis)
    plane_center.Rotate(b_rotation, plane_center.ZAxis)
    
    vec_x = plane_center.XAxis
    vec_y = plane_center.YAxis
    vec_y_flipped = -vec_y
    
    dim_x = float(length)
    dim_y = float(width)
    dim_z = float(hight)
    
    block_plane = rg.Plane(center_pt, vec_x, vec_y_flipped)
    interval_x = rg.Interval(-dim_x * 0.5, dim_x * 0.5)
    interval_y = rg.Interval(-dim_y * 0.5, dim_y * 0.5)
    interval_z = rg.Interval(-dim_z * 0.5, dim_z * 0.5)
    box = rg.Box(block_plane, interval_x, interval_y, interval_z)
    
    p0 = block_plane.PointAt(-dim_x * 0.5, -dim_y * 0.5, 0)
    p1 = block_plane.PointAt( dim_x * 0.5, -dim_y * 0.5, 0)
    p2 = block_plane.PointAt( dim_x * 0.5,  dim_y * 0.5, 0)
    p3 = block_plane.PointAt(-dim_x * 0.5,  dim_y * 0.5, 0)
    level_pts = [p0, p1, p2, p3]
    
    py_points.append(level_pts)
    polygons.append(rg.Polyline(level_pts + [p0]))
    circles.append(rg.Circle(plane_center, max(dim_x, dim_y) * 0.5))
    radii.append(max(dim_x, dim_y) * 0.5)
    
    py_planes.append([block_plane])
    py_boxes.append([box])
    py_orientations.append([1])
    
    if compas_available:
        compas_point = Point(0, 0, z_b)
        compas_xaxis = Vector(vec_x.X, vec_x.Y, vec_x.Z)
        compas_yaxis = Vector(vec_y_flipped.X, vec_y_flipped.Y, vec_y_flipped.Z)
        compas_frame = Frame(compas_point, compas_xaxis, compas_yaxis)
        compas_brick = CompasBox(xsize=dim_x, ysize=dim_y, zsize=dim_z, frame=compas_frame)
        
        py_compas_planes.append([compas_frame])
        py_compas_bricks.append([compas_brick])

# -----------------------------------------------------------------------------
# TEIL 2: Hauptgeometrie erzeugen
# -----------------------------------------------------------------------------
accumulated_rotation_main = 0.0

for level_idx in range(total_iterations):
    is_base_iteration = has_base and (level_idx == 0)
    z = (num_bottom + level_idx) * float(hight)
    
    if is_base_iteration:
        n_i = 2
        t_i = 0
        current_fac = fac_base
        current_off = off_val_1
        current_gap = gap_base_val
    else:
        main_idx = (level_idx - 1) if has_base else level_idx
        is_phase_1 = (main_idx < l1)
        
        if is_phase_1:
            k = main_idx
            current_fac = fac_1
            current_off = off_val_1
            t_i = (t_start_val + k) % 2
            
            if invert_dir:
                n_i = max(2, n_start_val - (k + 1 - t_start_val) // 2)
            else:
                n_i = n_start_val + (k + t_start_val) // 2
        else:
            p2_step = main_idx - l1
            k = p2_step + 1
            current_fac = fac_2
            current_off = off_val_2
            t_i = (t_p1_end + k) % 2
            
            if invert_dir:
                n_i = n_p1_end + (k + t_p1_end) // 2
            else:
                n_i = max(2, n_p1_end - (k + 1 - t_p1_end) // 2)
                
        current_gap = gap_main_val
    
    # Radius r_i berechnen
    r_i, msg = calculate_r_chord(length, width, current_gap, n_i, t_i)
    
    if r_i is None:
        print("Abbruch bei Ebene {}: {}".format(level_idx, msg))
        break
        
    radii.append(r_i)
    
    # Winkel berechnen
    alpha = 2 * math.asin(length / (2 * r_i))
    beta  = 2 * math.asin(current_gap / (2 * r_i))
    gamma = 2 * math.asin(width / (2 * r_i)) if t_i > 0 else 0.0
    
    # Entkoppelte Rotationsberechnung: base_level rotiert unabhängig
    if is_base_iteration:
        current_rotation = current_fac * alpha
    else:
        accumulated_rotation_main += current_fac * alpha
        current_rotation = accumulated_rotation_main
    
    # 1. Haupt-Ebene und Kreis erzeugen
    center = rg.Point3d(0, 0, z)
    main_plane = rg.Plane(center, rg.Vector3d.ZAxis)
    main_plane.Rotate(current_rotation, main_plane.ZAxis)
    circle_i = rg.Circle(main_plane, r_i)
    circles.append(circle_i)
    
    # 2. Abfolge der Winkel UND Segment-Typen erzeugen
    angle_sequence = []
    segment_types = []
    
    for _ in range(n_i):
        angle_sequence.append(alpha)
        segment_types.append('length')
        angle_sequence.append(beta)
        segment_types.append('gap')
        
    for _ in range(t_i):
        angle_sequence.append(gamma)
        segment_types.append('width')
        angle_sequence.append(beta)
        segment_types.append('gap')
        
    # 3. Punkte erzeugen
    level_pts = []
    current_angle = current_rotation
    
    start_pt = rg.Point3d(r_i * math.cos(current_angle), r_i * math.sin(current_angle), z)
    level_pts.append(start_pt)
    
    for j in range(len(angle_sequence) - 1):
        current_angle += angle_sequence[j]
        pt = rg.Point3d(r_i * math.cos(current_angle), r_i * math.sin(current_angle), z)
        level_pts.append(pt)
        
    py_points.append(level_pts)
    
    # 4. Polygon erzeugen
    closed_pts = level_pts + [level_pts[0]]
    polygon_i = rg.Polyline(closed_pts)
    polygons.append(polygon_i)
    
    # 5. Planes, Boxen & COMPAS-Geometrien erzeugen
    level_planes = []
    level_boxes = []
    level_orientations = []
    level_compas_bricks = []
    level_compas_planes = []
    num_pts = len(level_pts)
    
    for j in range(num_pts):
        seg_type = segment_types[j]
        if seg_type in ['length', 'width']:
            pt_a = level_pts[j]
            pt_b = level_pts[(j + 1) % num_pts]
            
            mid_pt = rg.Point3d((pt_a.X + pt_b.X) * 0.5, (pt_a.Y + pt_b.Y) * 0.5, z)
            
            vec_y = rg.Vector3d(center - mid_pt)
            vec_y.Unitize()
            vec_z = rg.Vector3d.ZAxis
            vec_x = rg.Vector3d.CrossProduct(vec_y, vec_z)
            vec_x.Unitize()
            
            if seg_type == 'length':
                shift_dist = float(width) / 2.0
                dim_x = float(length)
                dim_y = float(width)
                orient_code = 1
            else: # 'width'
                shift_dist = current_off
                dim_x = float(width)
                dim_y = float(length)
                orient_code = 2
                
            dim_z = float(hight)
            shifted_mid_pt = mid_pt - (vec_y * shift_dist)
            vec_y_flipped = -vec_y
            
            # Rhino Plane & Box
            edge_plane = rg.Plane(shifted_mid_pt, vec_x, vec_y_flipped)
            level_planes.append(edge_plane)
            
            interval_x = rg.Interval(-dim_x * 0.5, dim_x * 0.5)
            interval_y = rg.Interval(-dim_y * 0.5, dim_y * 0.5)
            interval_z = rg.Interval(-dim_z * 0.5, dim_z * 0.5)
            box = rg.Box(edge_plane, interval_x, interval_y, interval_z)
            level_boxes.append(box)
            level_orientations.append(orient_code)
            
            # COMPAS Frame & Box
            if compas_available:
                compas_point = Point(shifted_mid_pt.X, shifted_mid_pt.Y, shifted_mid_pt.Z)
                compas_xaxis = Vector(vec_x.X, vec_x.Y, vec_x.Z)
                compas_yaxis = Vector(vec_y_flipped.X, vec_y_flipped.Y, vec_y_flipped.Z)
                compas_frame = Frame(compas_point, compas_xaxis, compas_yaxis)
                
                compas_brick = CompasBox(xsize=dim_x, ysize=dim_y, zsize=dim_z, frame=compas_frame)
                
                level_compas_planes.append(compas_frame)
                level_compas_bricks.append(compas_brick)
            
    py_planes.append(level_planes)
    py_boxes.append(level_boxes)
    py_orientations.append(level_orientations)
    py_compas_bricks.append(level_compas_bricks)
    py_compas_planes.append(level_compas_planes)

# DataTrees ausgeben
points = th.list_to_tree(py_points)
planes = th.list_to_tree(py_planes)
boxes = th.list_to_tree(py_boxes)
orientations = th.list_to_tree(py_orientations)
compas_bricks = th.list_to_tree(py_compas_bricks)
compas_planes = th.list_to_tree(py_compas_planes)
# ---------- end python_3_script ----------
preview = CustomPreview(
    Geometry=python_3_script.boxes,
    Material={diffuse=RGB(197, 130, 64), emission=RGB(68, 53, 68), shine=0.5, specular=RGB(255, 254, 254), transparency=0})

python_3_script_2 = Python3Script(
    x=Slider(4, range=0..10),
    z=Slider(30, range=0..100),
    w=Slider(15, range=0..100),
    h=Slider(10, range=0..10),
    l=Slider(32, range=0..100))  # -> bricks, frames; inputs x: Int32, z: Int32, w: Double, h: Double, l: Double
# ---------- python_3_script_2: Python ----------
import Rhino.Geometry as rg
import math as m
from compas.geometry import Box, Frame, Point, Vector

bricks = []
frames = []
gap = 2  # Define your mortar gap thickness here

for k in range(z):
    # Calculate the row's shared center (including the gaps)
    total_row_width = x * w + (x - 1) * gap
    row_center_x = total_row_width / 2.0
    row_center_z = k * h
    row_centroid = Point(row_center_x, 0, row_center_z)
    
    # Calculate rotation angle
    t = k / (z - 1) if z > 1 else 0
    a = t * m.tau
    axis = Vector(0, 0, 1)

    for i in range(x):
        # Shift brick centers outward by the gap amount
        brick_center_x = (i * (w + gap)) + (w / 2.0)
        pt = Point(brick_center_x, 0, k * (h))
        
        f = Frame(pt,[1, 0, 0], [0, -1, 0])
        # Shrink the box width slightly so the physical gap appears
        box = Box(w - gap, l, h, f)
        box.rotate(a, axis, row_centroid)
        f.rotate(a, axis, row_centroid)
        f.rotate(m.radians(90), f.zaxis, f.point)

        bricks.append(box)
        frames.append(f)
# ---------- end python_3_script_2 ----------
compas_draw = COMPASDraw(cg=python_3_script_2.bricks)  # -> rg
#   port cg: The COMPAS geometry or datastructure to be drawn.
#   port rg: The Rhino geometry object.
# ---------- compas_draw: Python ----------
# r: compas>=2.14.1
"""
Draws COMPAS geometry in Grasshopper.
"""

from typing import Any

import Grasshopper

from compas.scene import SceneObject


class CompasToRhinoGeometry(Grasshopper.Kernel.GH_ScriptInstance):
    def RunScript(self, cg):
        if not cg:
            return None

        return SceneObject(item=cg).draw()
# ---------- end compas_draw ----------
compas_draw_2 = COMPASDraw(cg=python_3_script_2.frames)  # -> rg; same code as compas_draw
preview_2 = CustomPreview(
    Geometry=compas_draw,
    Material={diffuse=RGB(197, 130, 64), emission=RGB(68, 53, 68), shine=0.5, specular=RGB(255, 254, 254), transparency=0})

# ---- group: This is needed only ONCE in the GH definition
enable_auto_reload = Python3Script()  # -> ok
# ---------- enable_auto_reload: Python ----------
"""
------------------------------
Using VS Code as Python editor
------------------------------

The simplest way to start using VS Code as our editor, is
to place our Python code in files located IN THE SAME FOLDER as our Grasshopper file.

After we have done that, we need 2 steps: 

1. Enable the COMPAS reloader on one component. This tells Grasshopper to watch for changes in the Pythoh files and reload if changed.
2. Every other component that uses Python code from external files needs to start with a method to ensure Grasshopper knows where to load the files from.

"""
# r: compas
# venv: mas-2627

from compas_rhino.devtools import DevTools
DevTools.enable_reloader()
# ---------- end enable_auto_reload ----------

# ----
# BRICK DEPOT
number_slider = Slider(2, range=-20..20)
xypoint = Panel("""-62.52,
367.39,
-4.51""")
origin = Panel("""90.32,
367.78,
-4.14""")
xaxis = Panel("""90.04,
521.78,
-4.83""")
python_3_script_3 = Python3Script(
    pickup_base_origin=origin,
    n_z=Slider(7, range=0..10),
    tol_x=Slider(-0.5, range=-20..20),
    tol_y=Slider(-0.5, range=-20..20),
    tol_z=number_slider)  # -> out, frames, points, depot_frame; inputs pickup_base_origin: Point3d, n_z: Int32
# ---------- python_3_script_3: Python ----------
from compas.geometry import Point, Frame, Vector
from compas.geometry import Polygon
from compas_rhino.conversions import point_to_compas
import math as m

# convert the origin point of pickup base to a compas point
ref_pt = point_to_compas(pickup_base_origin)  

frames = [] # empty list for frames w.r.t origin
points = [] # empty list for grid of points w.r.t origin

# brick dimensions
l = 32
w = 15
h = 10

# frame offsets w.r.t the pickup base
offset_x = 17.5 + tol_x
offset_y = 27.5 + tol_y
offset_z = 4 + tol_z

# Depot size
n_x = 3
n_y = 5

#  Loop through Z from top layer down to the bottom layer
for k in reversed(range(n_z)):
    for j in range(n_y):
        for i in range(n_x):

            # Calculate coordinates relative to the original reference point
            x = ref_pt.x - j*30 - offset_x
            y = ref_pt.y + i*50 + offset_y
            z = ref_pt.z + k*12 + offset_z
            
            # Create the grid point and frame
            grid_pt = Point(x, y, z)
            
            # Keeps X normal, flips Y, which forces the Z-axis to point downwards
            f = Frame(grid_pt, [-1, 0, 0], [0, 1, 0])
            # Custom rotation wrt the T.C.P
            f = f.rotated(m.radians(90), axis=f.zaxis, point=f.point)
            
            frames.append(f)
            points.append(grid_pt)


# Dump frames to dump the depot frame. We will create this frame after every 15 points

centroid_frame = frames[7].copy()
centroid_frame.point.z += 12/2
centroid_frame.rotate(m.radians(90), centroid_frame.zaxis, centroid_frame.point)

for i in range(n_z):
#      Copy the centroid frame as dump frame
    dump_frame = centroid_frame.copy()
    dump_frame.point.z -= (12) * (i)   
     # Calculate the exact insertion index
    insert_index = ((i) * 15) + i   
    frames.insert(insert_index, dump_frame)

# for i in range(n_z-1):
# #      Copy the centroid frame as dump frame
#     dump_frame = centroid_frame.copy()
#     dump_frame.point.z -= (12) * (i+1)   
#      # Calculate the exact insertion index
#     insert_index = ((i+1) * 15) + i   
#     frames.insert(insert_index, dump_frame)



 # 3. Re-generate the points list to keep it synchronized with the new frames
points = [f.point for f in frames]
# ---------- end python_3_script_3 ----------
python_3_script_4 = Python3Script(Origin=origin, Xaxis=xaxis, XYpoint=xypoint)  # -> out, Rectangle; inputs Origin: Point3d, Xaxis: Point3d, XYpoint: Point3d
# ---------- python_3_script_4: Python ----------
import Rhino.Geometry as rg

# Create plane from origin and axis vectors
plane = rg.Plane(Origin, Xaxis - Origin, XYpoint - Origin)

# Calculate distances (width and height)
x_size = Origin.DistanceTo(Xaxis)
y_size = Origin.DistanceTo(XYpoint)

# Output the rectangle as a curve to 'Rectangle'
Rectangle = rg.Rectangle3d(plane, x_size, y_size).ToNurbsCurve()
# ---------- end python_3_script_4 ----------
compas_draw_3 = COMPASDraw(cg=python_3_script_3.points)  # -> rg; same code as compas_draw
points = PointList(Points=compas_draw_3, Size=Slider(4, range=0..10))

# ----
# TCP 1
panel = Panel("12.54")
pt = ConstructPoint(XCoordinate=panel, YCoordinate="12.48", ZCoordinate="116.01")

# ----
# ROBOT TABLE
fine_adjust_z_mm = Slider(8, range=-5..500)
xaxis_2 = Panel("""535.83,
513.91,
-12.43""")
origin_2 = Panel("""535.77,
-80.72,
-11.6""")
xypoint_2 = Panel("""229.24,
-79.84,
-11.39""")
relay = Relay()
transform = Python3Script(way_planes=relay, wobj_origin=origin_2, wobj_xaxis=xaxis_2, wobj_xypoint=xypoint_2, z_safe_margin=fine_adjust_z_mm)  # -> out, flatten(transformed_frames); inputs way_planes: tree, wobj_origin: Point3d, wobj_xaxis: Point3d, wobj_xypoint: Point3d, z_safe_margin: Double
# ---------- transform: Python ----------
from compas.geometry import Frame, Transformation, Translation, Vector, Point
import ghpythonlib.treehelpers as th  # Zur Handhabung von DataTrees

def ensure_compas_point(pt):
    """
    Konvertiert Rhino Point3d oder Koordinaten-Tupel sicher in COMPAS Point
    """
    if hasattr(pt, 'X'):
        return Point(pt.X, pt.Y, pt.Z)
    return Point(pt[0], pt[1], pt[2])

def set_robot_base(origin, xaxis, xypoint):
    """
    Erstellt die Robot Workobject Base Plane aus COMPAS Punkten/Vektoren
    """
    p_orig = ensure_compas_point(origin)
    p_x = ensure_compas_point(xaxis)
    p_xy = ensure_compas_point(xypoint)

    vec_x = p_x - p_orig
    vec_y = p_xy - p_orig
    
    # Mittelpunkt berechnen
    center_origin = p_orig + vec_x * 0.5 + vec_y * 0.5

    robot_base = Frame(center_origin, vec_x, vec_y)
    return robot_base

# 1. Wandle den eingehenden DataTree in eine verschachtelte Python-Liste um
py_way_planes = th.tree_to_list(way_planes)

# 2. Robot Base Frame erzeugen
robot_base = set_robot_base(wobj_origin, wobj_xaxis, wobj_xypoint)

# 3. Transformations-Matrizen EINMALIG vorbereiten (hohe Performance)
T_safe = Translation.from_vector(Vector(0, 0, float(z_safe_margin)))
T_robot = Transformation.from_frame_to_frame(Frame.worldXY(), robot_base)

# 4. Rekursive Funktion zur Transformation beliebig verschachtelter Listen (DataTree)
def process_frames_recursively(item):
    if isinstance(item, list):
        # Wenn es eine Liste/Branch ist, iteriere durch die Elemente
        return [process_frames_recursively(sub_item) for sub_item in item]
    elif hasattr(item, 'transformed'):
        # Wenn es ein COMPAS Frame ist: erst Sicherheitsabstand Z, dann Robot Transformation
        safe_frame = item.transformed(T_safe)
        robot_frame = safe_frame.transformed(T_robot)
        return robot_frame
    return item

# 5. Transformation auf den gesamten DataTree anwenden
py_transformed_frames = process_frames_recursively(py_way_planes)

# 6. Wieder in einen echten Grasshopper DataTree umwandeln
transformed_frames = th.list_to_tree(py_transformed_frames)
# ---------- end transform ----------
compas_draw_4 = COMPASDraw(cg=transform.transformed_frames)  # -> rg; same code as compas_draw

# ----
# TCP 2
panel_2 = Panel("-14.21")
pt_2 = ConstructPoint(XCoordinate=panel_2, YCoordinate="-14.75", ZCoordinate="116.68")

# ----
# DUMP POINT
dump_plane_reference_point = Point(<point referenced from the Rhino model>)
python_3_script_5 = Python3Script(pt=dump_plane_reference_point)  # -> f; inputs pt: Point3d
# ---------- python_3_script_5: Python ----------
from compas.geometry import Point, Frame
from compas_rhino.conversions import point_to_compas

compas_pt = point_to_compas(pt)
f = Frame(compas_pt, [1, 0, 0], [0, -1, 0])
# ---------- end python_3_script_5 ----------

# ----
# ASSEMBLE CODE
number_slider_2 = Slider(1, range=0..1)
grb_pos = Panel("2")
compas = Python3Script(
    way_frames=transform.transformed_frames,
    pickup_frames=python_3_script_3.frames,
    dump_frame=python_3_script_5,
    tcp_1=pt,
    tcp_2=pt_2,
    a=Slider(0.5, range=0..1),
    v=number_slider_2)  # -> out, vis_frames, vis_planes, script; inputs way_frames: list, pickup_frames: list, tcp_1: Point3d, tcp_2: Point3d, a: Double, v: Double, grb_pos: list of Int32
# ---------- compas: Python ----------
from imp import reload
import sys
import os

#get current file path
path = ghenv.Component.OnPingDocument().FilePath
#get parent directory of the parent directory
parentdir = os.path.dirname(path)
#get src folder which contains classes
dire = os.path.join(parentdir,'src')

sys.path.append(dire)

import simple_ur_script as ur
reload(ur)

import utils 
reload(utils)

import simple_comm as com
reload(com)

import compas.geometry as cg
import math as m

# ===== Set global constants =======

IO = 0 # Global constant
sd = 120

# =================================

script = "" #create empty string

def pickup_brick(script, pick_frame):

    frames = []

    # Translate frame to "safe" location
    safe_pick_frame = pick_frame.copy()
    safe_pick_frame.point.z += sd

    # Move to safe frame
    script += ur.move_l(safe_pick_frame, a, v)

    # Move to pick location
    script += ur.move_l(pick_frame, a, v)

    # Activate gripper
    script += ur.set_digital_out(IO, True)
    script += ur.sleep(1.5)

    # Move back to safe plane
    script += ur.move_l(safe_pick_frame, a, v)

    frames.extend([safe_pick_frame, pick_frame, safe_pick_frame])

    return script, frames


def place_brick(script, place_frame):
    frames = []
    
    # Safe frame for placing
    safe_place_frame = place_frame.copy()
    safe_place_frame.point.z += sd

    # Add to the path: go to the safe plane
    script += ur.move_l(safe_place_frame, a, v)

    # Add to the path: go to the place plane
    script += ur.move_l(place_frame, a, v)
    
    # Add to the path: turn off the vacuum and wait 1 second (hold the brick)
    script += ur.set_digital_out(IO, False)
    script += ur.sleep(1.5)
    
    # Add to the path: go back to the safe plane
    script += ur.move_l(safe_place_frame, a, v)

    frames.extend([safe_place_frame, place_frame, safe_place_frame])
    
    return script, frames


def depot_action(script, depot_frame, dump_frame):
    frames = []

    # 1. & 2. Copy the depot frame and raise its Z position by 20 units
    safe_depot_frame = depot_frame.copy()
    safe_depot_frame.point.z += 120

    # 3. UR Linear motions: approach safe position, then drop down to the depot point
    script += ur.move_l(safe_depot_frame, a, v)
    script += ur.move_l(depot_frame, a, v)

    # 4. Trigger I/O to TRUE (Grip/Activate)
    script += ur.set_digital_out(IO, True)
    script += ur.sleep(1.5)

    # 5. Move back up to the safe depot clearance height
    script += ur.move_l(safe_depot_frame, a, v)
    
    # 6. Move to the custom dump plane inputted from Grasshopper
    script += ur.move_l(dump_frame, a, v)
    
    # 7. Trigger I/O to FALSE (Release/Open)
    script += ur.set_digital_out(IO, False)
    script += ur.sleep(1.5)

    # Keep track of the generated motion sequence path for visual feedback
    frames.extend([safe_depot_frame, depot_frame, safe_depot_frame, dump_frame])

    return script, frames


#if value given for tcp measured, then add line to script, otherwise it will take current tcp from robot

if tcp_1 is not None:
    if grb_pos == 1:
        script += ur.set_tcp_by_angles(tcp_1.X, tcp_1.Y, tcp_1.Z, m.radians(-45), m.radians(0), m.radians(-45))

if tcp_2 is not None:
    if grb_pos == 2:
        script += ur.set_tcp_by_angles(tcp_2.X, tcp_2.Y, tcp_2.Z, m.radians(0), m.radians(-45), m.radians(45))

vis_frames = [] 
place_counter = 0 # Track sequential progress through structural drop planes

# ===== Generate pick, place, and depot sequence =====
for i in range(len(way_frames)):
    
    # 1. TRIGGER DEPOT AFTER EVERY (i*15)+i INTERVAL (0, 16, 32...) AT THE SAME LOCATION
    if i % 16 == 0:
        depot_index = i % len(pickup_frames)
        target_depot_frame = pickup_frames[depot_index]
        
        script, depot_frames_list = depot_action(script, target_depot_frame, dump_frame)
        vis_frames.extend(depot_frames_list)
        
    # 2. RUN NORMAL PICK & PLACE ONLY ON NON-DEPOT ITERATIONS
    else:
        if place_counter < len(way_frames):
            # Target structural planes continuously using the decoupled index pointer
            current_place_frame = way_frames[place_counter]
            
            pickup_index = i % len(pickup_frames)
            current_pick_frame = pickup_frames[pickup_index]
            
            script, pif = pickup_brick(script, current_pick_frame)
            vis_frames.extend(pif)
            
            script, place_frames_list = place_brick(script, current_place_frame)
            vis_frames.extend(place_frames_list)
            
            # Step the structural placement pointer forward
            place_counter += 1

# Format the script to make it sendable
script = com.concatenate_script(script)

# Visualize
from compas_rhino import conversions
import Rhino.Geometry as rg
vis_planes = [conversions.frame_to_rhino(frame) for frame in vis_frames]



# Visualize
from compas_rhino import conversions
import Rhino.Geometry as rg

vis_planes = [conversions.frame_to_rhino(frame) for frame in vis_frames]
# ---------- end compas ----------
compas_draw_5 = COMPASDraw(cg=compas.vis_frames)  # -> rg; same code as compas_draw
pline = PolyLine(Vertices=compas.vis_planes, Closed=False)
points_2 = PointList(Points=compas.vis_planes, Size=Slider(7, range=0..100))

python_3_script_6 = Python3Script(Origin=origin_2, Xaxis=xaxis_2, XYpoint=xypoint_2)  # -> out, Rectangle; inputs Origin: Point3d, Xaxis: Point3d, XYpoint: Point3d; same code as python_3_script_4
panel_3 = Panel(compas.script)

# ----
# RUN CODE
panel_4 = Panel("192.168.10.10")
py3 = Python3Script(script=compas.script, ip_address=panel_4, send=Button())  # -> out, a; inputs script: String, ip_address: String, send: Boolean
# ---------- py3: Python ----------
import simple_comm as com

if send:
    com.send_script(script,ip_address)
# ---------- end py3 ----------
