# Grasshopper definition 261025_brick_pier_IA01.gh (Grasshopper 1.0.8)
# plug-ins: Robots, Moonlight

moonlight = Moonlight(Mode=True)

python_3_script = Python3Script(
    length=Slider(32, range=0..100),
    width=Slider(15, range=0..100),
    height=Slider(10, range=0..100),
    n_x=Slider(7, range=0..10),
    n_z=Slider(45, range=0..100),
    gap=Slider(1, range=-100..100),
    amplitude=Slider(3, range=-3..10))  # -> bricks, way_planes, all_bricks; inputs length: Double, n_x: Int32, n_z: Int32, gap: Double, amplitude: Int32
# ---------- python_3_script: Python ----------
import math as m
import Rhino.Geometry as rg
from compas.geometry import Box, Frame, Point, Vector, Rotation, Translation
from compas_rhino.conversions import point_to_compas

points = []
bricks = []

# 1. Calculate the ideal start and end radii mathematically


for j in range(n_z):

 # 1. Find the middle layer index
    midpoint = n_z // 2
    
    # 2. Calculate a linear factor (0.0 at the ends, 1.0 at the midpoint)
    if j <= midpoint:
        factor = j / float(midpoint) if midpoint > 0 else 0.0
    else:
        factor = (n_z - 1 - j) / float(n_z - 1 - midpoint) if (n_z - 1 - midpoint) > 0 else 0.0
    
    # 3. Scale the brick count growth using your amplitude slider
    current_n = int(round(n_x + amplitude * factor))
    
    # 4. Calculate base radius based strictly on the point count
    r = length / (2 * m.sin(m.pi / current_n))
    

    layer_points = []

    for i in range(current_n):
        t = i / current_n
        a = t * m.tau
        
        # Calculate the next angle parameters for the adjacent vertex mathematically
        t_next = ((i + 1) % current_n) / current_n
        a_next = t_next * m.tau
        
        # Define current and next points right here
        pt_current = Point(r * m.cos(a), r * m.sin(a), j * height)
        pt_next = Point(r * m.cos(a_next), r * m.sin(a_next), j * height)
        
        # Store for your Rhino points list output
        points.append(rg.Point3d(pt_current.x, pt_current.y, pt_current.z))

        # Calculate the exact midpoint of the two layout points
        midpoint = Point(
            (pt_current.x + pt_next.x) / 2.0,
            (pt_current.y + pt_next.y) / 2.0,
            (pt_current.z + pt_next.z) / 2.0
        )
        
        # Define local axes based on the brick segment orientation
        local_xaxis = Vector.from_start_end(pt_current, pt_next)
        local_xaxis.unitize()
        
        # Local Y-axis points radially outward
        local_yaxis = Vector(local_xaxis.y, -local_xaxis.x, 0)
        local_yaxis.unitize()
        
        # Move the center point outside by half-thickness + gap
        shifted_center = midpoint + local_yaxis * ((width / 2.0) + gap)
        
        # Create the frame and box
        f = Frame(shifted_center, local_xaxis, local_yaxis)
        b = Box(length, width, height, f)
        
        bricks.append(b)



all_bricks = []
way_planes = []
rotated_points = []  # New list for your rotated Rhino points

# Track the index position in the original bricks list
start_idx = 0

for j in range(n_z):
    # 1. Re-calculate the exact brick count for this layer to slice the list correctly
    midpoint = n_z // 2
    if j <= midpoint:
        factor = j / float(midpoint) if midpoint > 0 else 0.0
    else:
        factor = (n_z - 1 - j) / float(n_z - 1 - midpoint) if (n_z - 1 - midpoint) > 0 else 0.0
    current_n = int(round(n_x + amplitude * factor))
    
    # 2. Extract only the bricks belonging to the current layer
    layer_bricks = bricks[start_idx : start_idx + current_n]
    
    # 3. Calculate the exact rotation transformation for this layer
    t = j / float(n_z) 
    a = m.sin(m.tau * t) * 4
    layer_transformation = Rotation.from_axis_and_angle([0, 0, 1], a)
    
    # 4. Transform the bricks and update outputs
    for base_box in layer_bricks:
        shifted_box = base_box.transformed(layer_transformation)
        all_bricks.append(shifted_box)
        way_planes.append(shifted_box.frame)
        
    # Advance the index pointer to the next layer
    start_idx += current_n

# Update your final brick output reference if needed
bricks = all_bricks
# ---------- end python_3_script ----------
compas_draw = COMPASDraw(cg=python_3_script.bricks)  # -> rg
#   port cg: The COMPAS geometry or datastructure to be drawn.
#   port rg: The Rhino geometry object.
# ---------- compas_draw: Python ----------
# r: compas>=2.14.1
"""
Draws COMPAS geometry in Grasshopper.
"""

from typing import Any

import Grasshopper

from compas.scene import SceneObject


class CompasToRhinoGeometry(Grasshopper.Kernel.GH_ScriptInstance):
    def RunScript(self, cg):
        if not cg:
            return None

        return SceneObject(item=cg).draw()
# ---------- end compas_draw ----------
custom_preview = CustomPreview(Geometry=compas_draw, Material=ColourSwatch(SwatchColor=RGB(202, 221, 238)))

# ---- group: This is needed only ONCE in the GH definition
# // UR Scipt for flemish bond brick wall
enable_auto_reload = Python3Script()  # -> ok
# ---------- enable_auto_reload: Python ----------
"""
------------------------------
Using VS Code as Python editor
------------------------------

The simplest way to start using VS Code as our editor, is
to place our Python code in files located IN THE SAME FOLDER as our Grasshopper file.

After we have done that, we need 2 steps: 

1. Enable the COMPAS reloader on one component. This tells Grasshopper to watch for changes in the Pythoh files and reload if changed.
2. Every other component that uses Python code from external files needs to start with a method to ensure Grasshopper knows where to load the files from.

"""
# r: compas
# venv: mas-2627

from compas_rhino.devtools import DevTools
DevTools.enable_reloader()
# ---------- end enable_auto_reload ----------

# ---- group: flemish brick bond rotated with attractor point
python_3_script_2 = Python3Script(
    n_x=Slider(7, range=0..100),
    n_z=Slider(10, range=0..100),
    length=Slider(32, range=0..100),
    width=Slider(15, range=0..100),
    height=Slider(10, range=0..10))  # -> bricks, points, frames; inputs n_x: Int32, n_z: Int32, length: Double, height: Double, att_pt: Point3d
# ---------- python_3_script_2: Python ----------
from compas.geometry import Point, Box, Frame, Translation, Rotation, midpoint_point_point, Point
from compas_rhino.conversions import point_to_rhino
import math as m


bricks = []
points = []
gap = 7.5

for j in range(n_z):
    # 1. Calculate Z position for the current layer
    z = j * height
    
    
    for i in range(n_x):
        if i % 2 == 0:
            x = ( (i/2 * (length + width)) + length/2 ) + gap*i
        else:
            x = ( (((i+1)/2) * length) + (((i-1)/2) * width) + (width/2) ) + gap*i
            

        # 4. Construct your point or box using (final_x, y, z) here...
        pt = Point(x,width/2 ,j*height,z)
        f = Frame(pt)
        points.append(pt)
        if j % 2 == i % 2:
            b = Box(width, length, height, f) # Stretcher
        else:
            b = Box(length, width, height, f) # Header

        bricks.append(b)

# for b in bricks:
#     pt = b.frame.point
#     r_pt = point_to_rhino(pt)
#     dist = att_pt.DistanceTo(r_pt) * 0.5
#     b.rotate(m.radians(dist),(0,0,1),r_pt)
#     print(dist)

frames = []

for b in bricks:
    pt = b.frame.point
    f = Frame(pt, [1,0,0], [0,-1,0])
    frames.append(f)
# ---------- end python_3_script_2 ----------
compas_draw_2 = COMPASDraw(cg=python_3_script_2.bricks)  # -> rg; same code as compas_draw
compas_draw_3 = COMPASDraw(cg=python_3_script_2.points)  # -> rg; same code as compas_draw
custom_preview_2 = CustomPreview(
    Geometry=compas_draw_2,
    Material={diffuse=RGB(221, 160, 221), emission=RGB(66, 48, 66), shine=0.5, specular=RGB(255, 255, 255), transparency=0})

# ----
python_3_script_3 = Python3Script(
    length=Slider(32, range=0..100),
    width=Slider(15, range=0..100),
    height=Slider(10, range=0..100),
    n_x=Slider(4, range=0..10),
    n_z=Slider(10, range=0..100),
    gap=Slider(2, range=-100..100),
    amplitude=Slider(6, range=-3..10))  # -> bricks, way_planes, points; inputs length: Double, n_x: Int32, n_z: Int32, gap: Double, amplitude: Int32
# ---------- python_3_script_3: Python ----------
import math as m
import Rhino.Geometry as rg
from compas.geometry import Box, Frame, Point, Vector, Rotation, Translation
from compas_rhino.conversions import point_to_compas

points = []
bricks = []

# Step 1 - Creating a list of points for the polygon
# Loop through each layer from bottom (j=0) to top (j=n_z-1)

for j in range(n_z):

    # 1. Calculate integer point count per layer (linearly increasing)
    current_n = n_z + j
    
    # 2. Calculate base radius based strictly on the point count
    r = length / (2 * m.sin(m.pi / current_n))
    
    # Generate all point coordinates for the current layer first 
    # so we can easily look up sequential pairs to find midpoints

    layer_points = []

    for i in range(current_n):
        t = i / current_n
        a = t * m.tau
        
        # Calculate the next angle parameters for the adjacent vertex mathematically
        t_next = ((i + 1) % current_n) / current_n
        a_next = t_next * m.tau
        
        # Define current and next points right here
        pt_current = Point(r * m.cos(a), r * m.sin(a), j * height)
        pt_next = Point(r * m.cos(a_next), r * m.sin(a_next), j * height)
        
        # Store for your Rhino points list output
        points.append(rg.Point3d(pt_current.x, pt_current.y, pt_current.z))

        # Calculate the exact midpoint of the two layout points
        midpoint = Point(
            (pt_current.x + pt_next.x) / 2.0,
            (pt_current.y + pt_next.y) / 2.0,
            (pt_current.z + pt_next.z) / 2.0
        )
        
        # Define local axes based on the brick segment orientation
        local_xaxis = Vector.from_start_end(pt_current, pt_next)
        local_xaxis.unitize()
        
        # Local Y-axis points radially outward
        local_yaxis = Vector(local_xaxis.y, -local_xaxis.x, 0)
        local_yaxis.unitize()
        
        # Move the center point outside by half-thickness + gap
        shifted_center = midpoint + local_yaxis * ((width / 2.0) + gap)
        
        # Create the frame and box
        f = Frame(shifted_center, local_xaxis, local_yaxis)
        b = Box(length, width, height, f)
        
        bricks.append(b)

way_planes = []
for brick in bricks:
    f = brick.frame
    way_planes.append(f)
# ---------- end python_3_script_3 ----------
compas_draw_4 = COMPASDraw(cg=python_3_script_3.bricks)  # -> rg; same code as compas_draw
custom_preview_3 = CustomPreview(Geometry=compas_draw_4, Material=ColourSwatch(SwatchColor=RGB(202, 221, 238)))

python_3_script_4 = Python3Script(
    length="32",
    width="15",
    hight="10",
    gap="1.5",
    n="10",
    t="0",
    levels_1="15",
    levels_2="10",
    angle_factor_1=Slider(-0.32, range=-1..1),
    angle_factor_2=Slider(0.26, range=-1..1),
    offset_1=Slider(0.3, range=-10..10),
    offset_2=Slider(5.47, range=-10..10),
    base_level=Toggle(False),
    angle_factor_base=Slider(0.68, range=-1..1),
    gap_base=Slider(7.5, range=0.01..10),
    invert_growth=Toggle(True),
    bottom_levels=Slider(0, range=0..10))  # -> out, circles, points, polygons, planes, boxes, compas_bricks, compas_planes, orientations; inputs length: Double, width: Double, hight: Double, gap: Double, n: Int32, t: Int32, levels_1: Int32, levels_2: Int32, angle_factor_1: Double, angle_factor_2: Double, offset_1: Double, offset_2: Double, base_level: Boolean, angle_factor_base: Double, gap_base: Double, invert_growth: Boolean, bottom_levels: Int32
# ---------- python_3_script_4: Python ----------
import math
import Rhino.Geometry as rg
import ghpythonlib.treehelpers as th  # Hilfsbibliothek für Grasshopper DataTrees

# COMPAS-Geometrie importieren
try:
    from compas.geometry import Box as CompasBox, Frame, Point, Vector
    compas_available = True
except ImportError:
    compas_available = False
    print("Hinweis: COMPAS ist in dieser Python-Umgebung nicht installiert.")

def calculate_r_chord(length, width, gap, n, t):
    # Minimaler Radius: r_min > max(length, width, gap) / 2
    r_min = max(length, width, gap) / 2.0 + 1e-9
    
    # Zielfunktion: Summe aller Mittelpunktswinkel minus 360° (2*pi)
    def f(r_val):
        alpha = 2 * math.asin(length / (2 * r_val))
        beta  = 2 * math.asin(gap / (2 * r_val))
        gamma = 2 * math.asin(width / (2 * r_val)) if t > 0 else 0.0
        return n * alpha + (n + t) * beta + t * gamma - 2 * math.pi

    # Prüfen, ob bei r_min 360° erreicht werden können
    f_min = f(r_min)
    if f_min < 0:
        max_winkel = math.degrees(f_min + 2 * math.pi)
        return None, "Fehler: Max. erreichbarer Winkel zu klein ({:.1f}° < 360°)".format(max_winkel)

    # Obere Suchgrenze ermitteln
    r_low = r_min
    r_high = max(length, width, gap) * 2.0
    while f(r_high) > 0:
        r_high *= 2.0
        if r_high > 1e12:
            return None, "Fehler: Keine Schranke gefunden"

    # Bisektionsverfahren (Intervallschachtelung)
    for _ in range(100):
        r_mid = (r_low + r_high) / 2.0
        val = f(r_mid)
        if abs(val) < 1e-9 or (r_high - r_low) < 1e-9:
            return r_mid, "OK"
        if val > 0:
            r_low = r_mid
        else:
            r_high = r_mid

    return (r_low + r_high) / 2.0, "OK"

# Flexible Auswertung der neuen Variablen bottom_levels
try:
    num_bottom = int(bottom_levels)
except NameError:
    try:
        num_bottom = int(extra_bottom_levels)
    except NameError:
        try:
            num_bottom = int(base_blocks)
        except NameError:
            num_bottom = 0

num_bottom = max(0, num_bottom)

# Flexible Auswertung des Boolean-Inputs für die Umkehrung der Phasen
try:
    invert_dir = bool(invert_growth)
except NameError:
    try:
        invert_dir = bool(invert_phases)
    except NameError:
        try:
            invert_dir = bool(invert_radius)
        except NameError:
            invert_dir = False

# Flexible Auswertung des Boolean-Inputs für die optionale Basis-Ebene
try:
    has_base = bool(base_level)
except NameError:
    try:
        has_base = bool(first_level)
    except NameError:
        try:
            has_base = bool(add_base)
        except NameError:
            has_base = False

# Flexible Auswertung von levels_1 und levels_2
try:
    l1 = int(levels_1)
except NameError:
    try:
        l1 = int(levels)
    except NameError:
        l1 = 5

try:
    l2 = int(levels_2)
except NameError:
    l2 = 0

total_main_levels = l1 + l2
total_iterations = (total_main_levels + 1) if has_base else total_main_levels

# Flexible Auswertung des Haupt-Gaps und des Basis-Gaps
try:
    gap_main_val = float(gap)
except NameError:
    gap_main_val = 0.0

try:
    gap_base_val = float(gap_base)
except NameError:
    try:
        gap_base_val = float(base_gap)
    except NameError:
        try:
            gap_base_val = float(gap_0)
        except NameError:
            gap_base_val = gap_main_val

# Flexible Auswertung von angle_factor_1 und angle_factor_2
try:
    fac_1 = float(angle_factor_1)
except NameError:
    try:
        fac_1 = float(angle_factor)
    except NameError:
        try:
            fac_1 = float(angle)
        except NameError:
            fac_1 = 0.5

try:
    fac_2 = float(angle_factor_2)
except NameError:
    fac_2 = fac_1

# Flexible Auswertung von angle_factor_base für die Basis-Ebene
try:
    fac_base = float(angle_factor_base)
except NameError:
    try:
        fac_base = float(angle_factor_0)
    except NameError:
        try:
            fac_base = float(base_angle_factor)
        except NameError:
            fac_base = fac_1

# Vorzeichenwechsel aller angle_factors bei invert_growth = True
if invert_dir:
    fac_1 = -fac_1
    fac_2 = -fac_2
    fac_base = -fac_base

# Flexible Auswertung von offset_1 und offset_2
try:
    off_val_1 = float(offset_1)
except NameError:
    try:
        off_val_1 = float(offset)
    except NameError:
        off_val_1 = 0.0

try:
    off_val_2 = float(offset_2)
except NameError:
    off_val_2 = off_val_1

# Zustand am Ende von Phase 1 berechnen
p1_last_step = max(0, l1 - 1)
t_start_val = int(t) % 2
n_start_val = int(n)

t_p1_end = (t_start_val + p1_last_step) % 2
if invert_dir:
    n_p1_end = max(2, n_start_val - (p1_last_step + 1 - t_start_val) // 2)
else:
    n_p1_end = n_start_val + (p1_last_step + t_start_val) // 2

# Initialisierung der Ausgabe-Listen
circles = []
polygons = []         # Liste der geschlossenen Polylines
py_points = []        # Temporäre Liste für Punkte
py_planes = []        # Temporäre Liste für die Rhino-Ebenen
py_boxes = []         # Temporäre Liste für die Rhino-Boxen
py_orientations = []  # Temporäre Liste für Ausrichtungscodes (1=length, 2=width)
py_compas_bricks = [] # Temporäre Liste für COMPAS Boxen (Bricks)
py_compas_planes = [] # Temporäre Liste für COMPAS Planes (Frames)
radii = []

# Exakte Block-X-Achsenrichtung der allerersten Ebene darüber berechnen
if has_base:
    r_first, _ = calculate_r_chord(length, width, gap_base_val, 2, 0)
    alpha_first = 2 * math.asin(length / (2 * r_first)) if r_first else 0.0
    rot_first_level = fac_base * alpha_first
else:
    t_0 = t_start_val
    n_0 = max(2, n_start_val - (1 - t_start_val) // 2) if invert_dir else n_start_val + t_start_val // 2
    r_first, _ = calculate_r_chord(length, width, gap_main_val, n_0, t_0)
    alpha_first = 2 * math.asin(length / (2 * r_first)) if r_first else 0.0
    rot_first_level = fac_1 * alpha_first

# Exakter X-Achsen-Winkel der Blöcke in dieser Referenzebene
ref_block_orientation = rot_first_level + (alpha_first * 0.5) + (math.pi / 2.0)

# -----------------------------------------------------------------------------
# TEIL 1: Zusätzliche untere Ebenen erzeugen (einzelne Blöcke im Zentrum)
# -----------------------------------------------------------------------------
for b_idx in range(num_bottom):
    z_b = b_idx * float(hight)
    
    steps_below = num_bottom - b_idx
    b_rotation = ref_block_orientation + steps_below * (math.pi / 2.0)
    
    center_pt = rg.Point3d(0, 0, z_b)
    plane_center = rg.Plane(center_pt, rg.Vector3d.ZAxis)
    plane_center.Rotate(b_rotation, plane_center.ZAxis)
    
    vec_x = plane_center.XAxis
    vec_y = plane_center.YAxis
    vec_y_flipped = -vec_y
    
    dim_x = float(length)
    dim_y = float(width)
    dim_z = float(hight)
    
    block_plane = rg.Plane(center_pt, vec_x, vec_y_flipped)
    interval_x = rg.Interval(-dim_x * 0.5, dim_x * 0.5)
    interval_y = rg.Interval(-dim_y * 0.5, dim_y * 0.5)
    interval_z = rg.Interval(-dim_z * 0.5, dim_z * 0.5)
    box = rg.Box(block_plane, interval_x, interval_y, interval_z)
    
    p0 = block_plane.PointAt(-dim_x * 0.5, -dim_y * 0.5, 0)
    p1 = block_plane.PointAt( dim_x * 0.5, -dim_y * 0.5, 0)
    p2 = block_plane.PointAt( dim_x * 0.5,  dim_y * 0.5, 0)
    p3 = block_plane.PointAt(-dim_x * 0.5,  dim_y * 0.5, 0)
    level_pts = [p0, p1, p2, p3]
    
    py_points.append(level_pts)
    polygons.append(rg.Polyline(level_pts + [p0]))
    circles.append(rg.Circle(plane_center, max(dim_x, dim_y) * 0.5))
    radii.append(max(dim_x, dim_y) * 0.5)
    
    py_planes.append([block_plane])
    py_boxes.append([box])
    py_orientations.append([1])
    
    if compas_available:
        compas_point = Point(0, 0, z_b)
        compas_xaxis = Vector(vec_x.X, vec_x.Y, vec_x.Z)
        compas_yaxis = Vector(vec_y_flipped.X, vec_y_flipped.Y, vec_y_flipped.Z)
        compas_frame = Frame(compas_point, compas_xaxis, compas_yaxis)
        compas_brick = CompasBox(xsize=dim_x, ysize=dim_y, zsize=dim_z, frame=compas_frame)
        
        py_compas_planes.append([compas_frame])
        py_compas_bricks.append([compas_brick])

# -----------------------------------------------------------------------------
# TEIL 2: Hauptgeometrie erzeugen
# -----------------------------------------------------------------------------
accumulated_rotation_main = 0.0

for level_idx in range(total_iterations):
    is_base_iteration = has_base and (level_idx == 0)
    z = (num_bottom + level_idx) * float(hight)
    
    if is_base_iteration:
        n_i = 2
        t_i = 0
        current_fac = fac_base
        current_off = off_val_1
        current_gap = gap_base_val
    else:
        main_idx = (level_idx - 1) if has_base else level_idx
        is_phase_1 = (main_idx < l1)
        
        if is_phase_1:
            k = main_idx
            current_fac = fac_1
            current_off = off_val_1
            t_i = (t_start_val + k) % 2
            
            if invert_dir:
                n_i = max(2, n_start_val - (k + 1 - t_start_val) // 2)
            else:
                n_i = n_start_val + (k + t_start_val) // 2
        else:
            p2_step = main_idx - l1
            k = p2_step + 1
            current_fac = fac_2
            current_off = off_val_2
            t_i = (t_p1_end + k) % 2
            
            if invert_dir:
                n_i = n_p1_end + (k + t_p1_end) // 2
            else:
                n_i = max(2, n_p1_end - (k + 1 - t_p1_end) // 2)
                
        current_gap = gap_main_val
    
    # Radius r_i berechnen
    r_i, msg = calculate_r_chord(length, width, current_gap, n_i, t_i)
    
    if r_i is None:
        print("Abbruch bei Ebene {}: {}".format(level_idx, msg))
        break
        
    radii.append(r_i)
    
    # Winkel berechnen
    alpha = 2 * math.asin(length / (2 * r_i))
    beta  = 2 * math.asin(current_gap / (2 * r_i))
    gamma = 2 * math.asin(width / (2 * r_i)) if t_i > 0 else 0.0
    
    # Entkoppelte Rotationsberechnung: base_level rotiert unabhängig
    if is_base_iteration:
        current_rotation = current_fac * alpha
    else:
        accumulated_rotation_main += current_fac * alpha
        current_rotation = accumulated_rotation_main
    
    # 1. Haupt-Ebene und Kreis erzeugen
    center = rg.Point3d(0, 0, z)
    main_plane = rg.Plane(center, rg.Vector3d.ZAxis)
    main_plane.Rotate(current_rotation, main_plane.ZAxis)
    circle_i = rg.Circle(main_plane, r_i)
    circles.append(circle_i)
    
    # 2. Abfolge der Winkel UND Segment-Typen erzeugen
    angle_sequence = []
    segment_types = []
    
    for _ in range(n_i):
        angle_sequence.append(alpha)
        segment_types.append('length')
        angle_sequence.append(beta)
        segment_types.append('gap')
        
    for _ in range(t_i):
        angle_sequence.append(gamma)
        segment_types.append('width')
        angle_sequence.append(beta)
        segment_types.append('gap')
        
    # 3. Punkte erzeugen
    level_pts = []
    current_angle = current_rotation
    
    start_pt = rg.Point3d(r_i * math.cos(current_angle), r_i * math.sin(current_angle), z)
    level_pts.append(start_pt)
    
    for j in range(len(angle_sequence) - 1):
        current_angle += angle_sequence[j]
        pt = rg.Point3d(r_i * math.cos(current_angle), r_i * math.sin(current_angle), z)
        level_pts.append(pt)
        
    py_points.append(level_pts)
    
    # 4. Polygon erzeugen
    closed_pts = level_pts + [level_pts[0]]
    polygon_i = rg.Polyline(closed_pts)
    polygons.append(polygon_i)
    
    # 5. Planes, Boxen & COMPAS-Geometrien erzeugen
    level_planes = []
    level_boxes = []
    level_orientations = []
    level_compas_bricks = []
    level_compas_planes = []
    num_pts = len(level_pts)
    
    for j in range(num_pts):
        seg_type = segment_types[j]
        if seg_type in ['length', 'width']:
            pt_a = level_pts[j]
            pt_b = level_pts[(j + 1) % num_pts]
            
            mid_pt = rg.Point3d((pt_a.X + pt_b.X) * 0.5, (pt_a.Y + pt_b.Y) * 0.5, z)
            
            vec_y = rg.Vector3d(center - mid_pt)
            vec_y.Unitize()
            vec_z = rg.Vector3d.ZAxis
            vec_x = rg.Vector3d.CrossProduct(vec_y, vec_z)
            vec_x.Unitize()
            
            if seg_type == 'length':
                shift_dist = float(width) / 2.0
                dim_x = float(length)
                dim_y = float(width)
                orient_code = 1
            else: # 'width'
                shift_dist = current_off
                dim_x = float(width)
                dim_y = float(length)
                orient_code = 2
                
            dim_z = float(hight)
            shifted_mid_pt = mid_pt - (vec_y * shift_dist)
            vec_y_flipped = -vec_y
            
            # Rhino Plane & Box
            edge_plane = rg.Plane(shifted_mid_pt, vec_x, vec_y_flipped)
            level_planes.append(edge_plane)
            
            interval_x = rg.Interval(-dim_x * 0.5, dim_x * 0.5)
            interval_y = rg.Interval(-dim_y * 0.5, dim_y * 0.5)
            interval_z = rg.Interval(-dim_z * 0.5, dim_z * 0.5)
            box = rg.Box(edge_plane, interval_x, interval_y, interval_z)
            level_boxes.append(box)
            level_orientations.append(orient_code)
            
            # COMPAS Frame & Box
            if compas_available:
                compas_point = Point(shifted_mid_pt.X, shifted_mid_pt.Y, shifted_mid_pt.Z)
                compas_xaxis = Vector(vec_x.X, vec_x.Y, vec_x.Z)
                compas_yaxis = Vector(vec_y_flipped.X, vec_y_flipped.Y, vec_y_flipped.Z)
                compas_frame = Frame(compas_point, compas_xaxis, compas_yaxis)
                
                compas_brick = CompasBox(xsize=dim_x, ysize=dim_y, zsize=dim_z, frame=compas_frame)
                
                level_compas_planes.append(compas_frame)
                level_compas_bricks.append(compas_brick)
            
    py_planes.append(level_planes)
    py_boxes.append(level_boxes)
    py_orientations.append(level_orientations)
    py_compas_bricks.append(level_compas_bricks)
    py_compas_planes.append(level_compas_planes)

# DataTrees ausgeben
points = th.list_to_tree(py_points)
planes = th.list_to_tree(py_planes)
boxes = th.list_to_tree(py_boxes)
orientations = th.list_to_tree(py_orientations)
compas_bricks = th.list_to_tree(py_compas_bricks)
compas_planes = th.list_to_tree(py_compas_planes)
# ---------- end python_3_script_4 ----------
preview = CustomPreview(
    Geometry=python_3_script_4.boxes,
    Material={diffuse=RGB(197, 130, 64), emission=RGB(68, 53, 68), shine=0.5, specular=RGB(255, 254, 254), transparency=0})

number_slider = Slider(11, range=0..100)

# ----
# // stretcher bond + rotate
number_slider_2 = Slider(10, range=0..10)
attractor_point = Point(Point(72, -36, 0))
python_3_script_5 = Python3Script(
    n_x=Slider(5, range=0..100),
    n_z=number_slider_2,
    l=Slider(31, range=0..100),
    b=Slider(15, range=0..100),
    h=Slider(10, range=0..10),
    att_pt=attractor_point,
    gap=Slider(4, range=0..10))  # -> bricks, frames; inputs n_x: Int32, n_z: Int32, l: Double, b: Double, h: Double, att_pt: Point3d
# ---------- python_3_script_5: Python ----------
from compas.geometry import Box
from compas.geometry import Point
from compas.geometry import Frame
from compas_rhino.conversions import box_to_rhino, point_to_rhino
import math as m

# make an empty list for bricks
bricks = []
r = 0.2


for i in range(n_z): # for every row i.e z = k, calculate points
    for j in range(n_x): 

        if i%2 == 0: # if the row is even

            pt = Point(j*l + gap*j ,b,i*h)            
        
        else: # if row is odd

            pt = Point(j*l - l/2 + gap*j, b ,i*h) # get staggered points


        f = Frame(pt) # create frame at the points
        brick = Box(l,b,h,f) # brick using the frame and dimensions
        bricks.append(brick)
        pt_centre = brick.frame.point

frames = []

for b in bricks:
    pt = b.frame.point
    r_pt = point_to_rhino(pt)
    dist = att_pt.DistanceTo(r_pt)
    
    # 1. Rotate the box (rotates its internal frame axes)
    b.rotate(m.radians(dist) * r, (0, 0, 1), pt)
    
    # 2. Get the rotated local axes
    xaxis = b.frame.xaxis
    yaxis = b.frame.yaxis
    
    # 3. Create a new frame at the same center point, 
    # but invert the Y-axis to force the Z-axis to point DOWN
    f_down = Frame(b.frame.point, xaxis, [-y for y in yaxis])
    
    frames.append(f_down)
# ---------- end python_3_script_5 ----------
compas_draw_5 = COMPASDraw(cg=python_3_script_5.bricks)  # -> rg; same code as compas_draw
preview_2 = CustomPreview(
    Geometry=compas_draw_5,
    Material={diffuse=RGB(197, 130, 64), emission=RGB(68, 53, 68), shine=0.5, specular=RGB(255, 254, 254), transparency=0})

compas_draw_6 = COMPASDraw(cg=python_3_script_5.frames)  # -> rg; same code as compas_draw
compas_draw_7 = COMPASDraw(cg=python_3_script_4.compas_bricks)  # -> rg; same code as compas_draw
plane = Plane(compas_draw_6)
att_pt = Point(<point referenced from the Rhino model>)

# ----
# // UR Scipt for brick pier using TCP 2 for bricks and TCP 1 for depot frame
# brick wall design opt_01
number_slider_3 = Slider(32, range=0..100)
python_3_script_6 = Python3Script(
    length=number_slider_3,
    width=Slider(15, range=0..100),
    height=Slider(10, range=0..100),
    n_x=Slider(5, range=0..10),
    n_z=Slider(20, range=0..100),
    gap=Slider(2, range=0..100))  # -> all_bricks, way_planes; inputs length: Double, n_x: Int32, n_z: Int32, gap: Int32
# ---------- python_3_script_6: Python ----------
import math as m
import Rhino.Geometry as rg
from compas.geometry import Box,Frame,Point, Vector, Rotation, Translation
from compas_rhino.conversions import point_to_compas

# Define the radius for the circle
# Divide the circle into sectors
# using sin function get the radius, using the angle and segmen length


points = []
edges = []

r = length / (2 * m.sin(m.pi /n_x))


for i in range(n_x):

    t = i/n_x
    a = t * m.tau

    x = r * m.cos(a)
    y = r * m.sin(a)
    
    pt = rg.Point3d(x,y,0)
    points.append(pt)

# for i,pt in enumerate(points[ : -1]):
#     print(pt)
#     edge = rg.LineCurve(pt,points[i+1])
#     edges.append(edge)

bricks = []
compas_pts = []
frames =[]

for pt in points:
    compas_pt = point_to_compas(pt)
    compas_pts.append(compas_pt)

from compas.geometry import midpoint_point_point
from compas.geometry import midpoint_point_point, Vector



for i, compas_pt in enumerate(compas_pts):
    next_pt = compas_pts[(i + 1) % n_x]
    
    # 1. Standard midpoint on the polygon edge
    mid_pt = midpoint_point_point(compas_pt, next_pt)
    
    v1 = Vector.from_start_end(compas_pt, next_pt)
    v2 = v1.cross([0, 0, 1])
    
    # 2. Normalize v2 to ensure its unit length is exactly 1.0
    v2.unitize()
    
    # 3. Shift the center point OUTWARD by half the brick's width
    # Note: If they shift inward instead, change the "+" to a "-" below
    shifted_center = mid_pt + v2 * ((width / 2.0) + gap)
    
    # 4. Construct the frame at the new outside-shifted center
    f = Frame(shifted_center, v1, v2)
    frames.append(f)
    
    b = Box(length, width, height, f)
    bricks.append(b)



all_bricks = []

# Outer loop: Iterates through each layer index (0, 1, 2, ... n-1)
for layer in range(n_z):
    
    # Calculate the exact Z translation distance for this specific layer
    z_shift = layer * height
    translation = Translation.from_vector([0, 0, z_shift])
    t = layer/(n_z) 
    a = m.sin(m.tau * t) * 0.8
    rotation = Rotation.from_axis_and_angle([0, 0, 1], a)
    layer_transformation = translation * rotation

    # Inner loop: Iterate through your 5 original base boxes
    for base_box in bricks:
        # Create a translated copy of the box and add it to the final list
        shifted_box = base_box.transformed(layer_transformation)
        all_bricks.append(shifted_box)

way_planes = []

for brick in all_bricks:
    f = brick.frame
    way_planes.append(f)
# ---------- end python_3_script_6 ----------
compas_draw_8 = COMPASDraw(cg=python_3_script_6.way_planes)  # -> rg; same code as compas_draw
compas_draw_9 = COMPASDraw(cg=python_3_script_6.all_bricks)  # -> rg; same code as compas_draw
custom_preview_4 = CustomPreview(Geometry=compas_draw_9, Material=ColourSwatch(SwatchColor=RGB(202, 221, 238)))

# ---- group: generate TCP ids based on th distance between the bricks
# Assigning TCPs based on distance between bricks
python_3_script_7 = Python3Script(bricks=python_3_script_4.compas_bricks)  # -> tcp_ids, offset_curves; inputs bricks: list
# ---------- python_3_script_7: Python ----------
import Rhino.Geometry as rg

# Gripper dimensions simplified
PAD_WIDTH = 15.0         # Width of the gripper pad (15mm)
GRIPPER_EXTENSION = 12.5 # Unified extension distance for both TCPs (12.5mm)

tcp_ids = []
visual_curves = []       # Outputs to Grasshopper viewport

# Process each brick sequentially
for i, brick in enumerate(bricks):
    f = brick.frame
    c = f.point
    
    # Identify longer and shorter axes of the current brick
    if brick.xsize >= brick.ysize:
        long_axis = f.xaxis
        short_axis = f.yaxis
        half_long = brick.xsize / 2.0
        half_short = brick.ysize / 2.0
    else:
        long_axis = f.yaxis
        short_axis = f.xaxis
        half_long = brick.ysize / 2.0
        half_short = brick.xsize / 2.0

    # Rule 1: First brick always starts using TCP 1
    if i == 0:
        tcp_ids.append(1)
        continue

    # --- GENERATE TCP 1 (SHORT-SIDE GRAB) BOXES ---
    tcp1_boxes = []
    for sign in [1.0, -1.0]:
        pad_center = c + (long_axis * sign * (half_long + (GRIPPER_EXTENSION / 2.0)))
        p1 = pad_center + (short_axis * (PAD_WIDTH / 2.0)) + (long_axis * sign * (GRIPPER_EXTENSION / 2.0))
        p2 = pad_center - (short_axis * (PAD_WIDTH / 2.0)) + (long_axis * sign * (GRIPPER_EXTENSION / 2.0))
        p3 = pad_center - (short_axis * (PAD_WIDTH / 2.0)) - (long_axis * sign * (GRIPPER_EXTENSION / 2.0))
        p4 = pad_center + (short_axis * (PAD_WIDTH / 2.0)) - (long_axis * sign * (GRIPPER_EXTENSION / 2.0))
        
        box_pts = [rg.Point3d(p1.x, p1.y, 0.0), rg.Point3d(p2.x, p2.y, 0.0),
                   rg.Point3d(p3.x, p3.y, 0.0), rg.Point3d(p4.x, p4.y, 0.0)]
        box_pts.append(box_pts[0])  # Explicitly close the path on its own line
        tcp1_boxes.append(rg.PolylineCurve(box_pts))

    # --- GENERATE TCP 2 (LONG-SIDE GRAB) BOXES ---
    tcp2_boxes = []
    for sign in [1.0, -1.0]:
        pad_center = c + (short_axis * sign * (half_short + (GRIPPER_EXTENSION / 2.0)))
        p1 = pad_center + (long_axis * (PAD_WIDTH / 2.0)) + (short_axis * sign * (GRIPPER_EXTENSION / 2.0))
        p2 = pad_center - (long_axis * (PAD_WIDTH / 2.0)) + (short_axis * sign * (GRIPPER_EXTENSION / 2.0))
        p3 = pad_center - (long_axis * (PAD_WIDTH / 2.0)) - (short_axis * sign * (GRIPPER_EXTENSION / 2.0))
        p4 = pad_center + (long_axis * (PAD_WIDTH / 2.0)) - (short_axis * sign * (GRIPPER_EXTENSION / 2.0))
        
        box_pts = [rg.Point3d(p1.x, p1.y, 0.0), rg.Point3d(p2.x, p2.y, 0.0),
                   rg.Point3d(p3.x, p3.y, 0.0), rg.Point3d(p4.x, p4.y, 0.0)]
        box_pts.append(box_pts[0])  # Explicitly close the path on its own line
        tcp2_boxes.append(rg.PolylineCurve(box_pts))

    # --- CHECK INTERSECTIONS DIRECTLY AGAINST PRIOR BRICK GEOMETRY ---
    tcp1_intersects = False
    tcp2_intersects = False
    
    for j in range(i):
        other = bricks[j]
        
        # Height filter: Only check bricks on the same layer row level
        if abs(other.frame.point.z - brick.frame.point.z) >= brick.zsize / 2.0:
            continue
            
        # Dynamically build the single comparison brick boundary curve on-the-fly
        ox = other.frame.xaxis * (other.xsize / 2.0)
        oy = other.frame.yaxis * (other.ysize / 2.0)
        oc = other.frame.point
        
        prev_pts = [
            rg.Point3d((oc + ox + oy).x, (oc + ox + oy).y, 0.0),
            rg.Point3d((oc - ox + oy).x, (oc - ox + oy).y, 0.0),
            rg.Point3d((oc - ox - oy).x, (oc - ox - oy).y, 0.0),
            rg.Point3d((oc + ox - oy).x, (oc + ox - oy).y, 0.0)
        ]
        prev_pts.append(prev_pts[0])  # Explicitly close the path on its own line
        prev_boundary = rg.PolylineCurve(prev_pts)
        
        # Test TCP 1 Clearance Boxes
        if not tcp1_intersects:
            for pad_box in tcp1_boxes:
                events = rg.Intersect.Intersection.CurveCurve(pad_box, prev_boundary, 0.001, 0.0)
                if events and events.Count > 0:
                    tcp1_intersects = True
                    break
                    
        # Test TCP 2 Clearance Boxes
        if not tcp2_intersects:
            for pad_box in tcp2_boxes:
                events = rg.Intersect.Intersection.CurveCurve(pad_box, prev_boundary, 0.001, 0.0)
                if events and events.Count > 0:
                    tcp2_intersects = True
                    break

    # --- ASSIGN TCP VALUE BASED ON FREEDOM ---
    if not tcp2_intersects:
        tcp_ids.append(2)
        visual_curves.extend(tcp2_boxes)
    elif not tcp1_intersects:
        tcp_ids.append(1)
        visual_curves.extend(tcp1_boxes)
    else:
        tcp_ids.append(1)  # Absolute fallback
        visual_curves.extend(tcp1_boxes)

# Expose layout geometries to Grasshopper
offset_curves = visual_curves
ghenv.Component.Message = "TCP1: {} | TCP2: {}".format(tcp_ids.count(1), tcp_ids.count(2))
# ---------- end python_3_script_7 ----------

# ----
pt = ConstructPoint(XCoordinate="12.54", YCoordinate="12.48", ZCoordinate="116.01")

xypoint = Panel("""-62.52,
367.39,
-4.51""")
xaxis = Panel("""90.04,
521.78,
-4.83""")
origin = Panel("""90.32,
367.78,
-4.14""")
python_3_script_8 = Python3Script(
    pickup_base_origin=origin,
    n_z=Slider(9, range=0..10),
    tol_x=Slider(-0.5, range=-20..20),
    tol_y=Slider(-0.5, range=-20..20),
    tol_z=Slider(5, range=-20..20))  # -> out, frames, points, depot_frame; inputs pickup_base_origin: Point3d, n_z: Int32
# ---------- python_3_script_8: Python ----------
from compas.geometry import Point, Frame, Vector
from compas.geometry import Polygon
from compas_rhino.conversions import point_to_compas
import math as m

# convert the origin point of pickup base to a compas point
ref_pt = point_to_compas(pickup_base_origin)  

frames = [] # empty list for frames w.r.t origin
points = [] # empty list for grid of points w.r.t origin

# brick dimensions
l = 32
w = 15
h = 10

# frame offsets w.r.t the pickup base
offset_x = 17.5 + tol_x
offset_y = 27.5 + tol_y
offset_z = 4 + tol_z

# Depot size
n_x = 3
n_y = 5

#  Loop through Z from top layer down to the bottom layer
for k in reversed(range(n_z)):
    for j in range(n_y):
        for i in range(n_x):

            # Calculate coordinates relative to the original reference point
            x = ref_pt.x - j*30 - offset_x
            y = ref_pt.y + i*50 + offset_y
            z = ref_pt.z + k*12 + offset_z
            
            # Create the grid point and frame
            grid_pt = Point(x, y, z)
            
            # Keeps X normal, flips Y, which forces the Z-axis to point downwards
            f = Frame(grid_pt, [-1, 0, 0], [0, 1, 0])
            # Custom rotation wrt the T.C.P
            f = f.rotated(m.radians(90), axis=f.zaxis, point=f.point)
            
            frames.append(f)
            points.append(grid_pt)


# Dump frames to dump the depot frame. We will create this frame after every 15 points

centroid_frame = frames[7].copy()
centroid_frame.point.z += 12/2
centroid_frame.rotate(m.radians(90), centroid_frame.zaxis, centroid_frame.point)

for i in range(n_z):
#      Copy the centroid frame as dump frame
    dump_frame = centroid_frame.copy()
    dump_frame.point.z -= (12) * (i)   
     # Calculate the exact insertion index
    insert_index = ((i) * 15) + i   
    frames.insert(insert_index, dump_frame)

# for i in range(n_z-1):
# #      Copy the centroid frame as dump frame
#     dump_frame = centroid_frame.copy()
#     dump_frame.point.z -= (12) * (i+1)   
#      # Calculate the exact insertion index
#     insert_index = ((i+1) * 15) + i   
#     frames.insert(insert_index, dump_frame)



 # 3. Re-generate the points list to keep it synchronized with the new frames
points = [f.point for f in frames]
# ---------- end python_3_script_8 ----------
python_3_script_9 = Python3Script(Origin=origin, Xaxis=xaxis, XYpoint=xypoint)  # -> out, Rectangle; inputs Origin: Point3d, Xaxis: Point3d, XYpoint: Point3d
# ---------- python_3_script_9: Python ----------
import Rhino.Geometry as rg

# Create plane from origin and axis vectors
plane = rg.Plane(Origin, Xaxis - Origin, XYpoint - Origin)

# Calculate distances (width and height)
x_size = Origin.DistanceTo(Xaxis)
y_size = Origin.DistanceTo(XYpoint)

# Output the rectangle as a curve to 'Rectangle'
Rectangle = rg.Rectangle3d(plane, x_size, y_size).ToNurbsCurve()
# ---------- end python_3_script_9 ----------
compas_draw_10 = COMPASDraw(cg=python_3_script_8.points)  # -> rg; same code as compas_draw
points = PointList(Points=compas_draw_10, Size=Slider(4, range=0..10))

fine_adjust_z_mm = Slider(12.5, range=-5..500)
xaxis_2 = Panel("""535.83,
513.91,
-12.43""")
origin_2 = Panel("""535.77,
-80.72,
-11.6""")
xypoint_2 = Panel("""229.24,
-79.84,
-11.39""")
transform = Python3Script(
    way_planes=python_3_script.way_planes,
    wobj_origin=origin_2,
    wobj_xaxis=xaxis_2,
    wobj_xypoint=xypoint_2,
    z_safe_margin=fine_adjust_z_mm)  # -> out, flatten(transformed_frames); inputs way_planes: list, wobj_origin: Point3d, wobj_xaxis: Point3d, wobj_xypoint: Point3d, z_safe_margin: Double
# ---------- transform: Python ----------
from compas.geometry import Frame, Transformation, Translation, Vector
#in this step we transform our way planes to robot space
#the rhino co-ordinate system is rather abstract in the physical world
#the robot base plane assumed the base frame of robot is the origin
#but rhino does not know that
#thus we transform things from our design space(Rhino World XY) to Robot Base Plane that we measure

def set_robot_base(origin, xaxis, xypoint):
    """
    set a base plane representing the robot working object plane
    """
     # 1. Extracted the vectors from the corner origin
    vec_x =  xaxis - origin
    vec_y =  xypoint - origin
    
    # 2. Calculated the center point (halfway along X and Y)
    center_origin = origin + vec_x * 0.5 + vec_y * 0.5

    robot_base = Frame(center_origin, vec_x, vec_y)
    print (robot_base)
    return (robot_base)

def rhino_to_robot_space(rhino_plane,robot_base_plane):

    """
    Transform the objects from Rhino world XY plane to robot work object plane
    """
    T_matrix = Transformation.from_frame_to_frame(Frame.worldXY(), robot_base_plane)
    robot_plane = rhino_plane.transformed(T_matrix)
    return robot_plane

def set_z_safe_margin(planes_to_adjust, safety_margin):
    adjusted = []
    T = Translation.from_vector(Vector(0, 0, safety_margin))
    for f in planes_to_adjust:
        adjusted.append(f.transformed(T))
    return adjusted

# ===== Robot base is set =====
robot_base =  set_robot_base(wobj_origin, wobj_xaxis, wobj_xypoint)

# ===== Set safety margin for Z height ======
safe_planes = set_z_safe_margin(way_planes, z_safe_margin)


# ===== Transforming the rhino planes into robot planes =====
transformed_frames = []
for plane in safe_planes: 
    transformed_frames.append(rhino_to_robot_space(plane, robot_base))
# ---------- end transform ----------
python_3_script_10 = Python3Script(Origin=origin_2, Xaxis=xaxis_2, XYpoint=xypoint_2)  # -> out, Rectangle; inputs Origin: Point3d, Xaxis: Point3d, XYpoint: Point3d; same code as python_3_script_9
compas_draw_11 = COMPASDraw(cg=transform.transformed_frames)  # -> rg; same code as compas_draw

# ---- group: rotating alternate brick planes by 90 degrees for the 2 tcps
python_3_script_11 = Python3Script(frames=python_3_script_2.frames)  # -> out, flatten(rot_frames); inputs frames: list
# ---------- python_3_script_11: Python ----------
import math as m
from compas.geometry import Rotation, Vector, Point

rot_frames = []

for i, f in enumerate(frames):
    
    if i % 2 == 0:
        modified_frame = f
    else:
        # Use .rotated() to return a copy, and f.zaxis to spin around its own center
        modified_frame = f.rotated(m.radians(90), f.zaxis, f.point)
        
    rot_frames.append(modified_frame)
# ---------- end python_3_script_11 ----------

# ---- group: add TCP 1 at 0,16,32..
python_3_script_12 = Python3Script(tcp_ids=python_3_script_7.tcp_ids)  # -> out, flatten(final_tcp_ids); inputs tcp_ids: list of Int32
# ---------- python_3_script_12: Python ----------
"""
Inputs:
    tcp_ids (List, int): The calculated tool IDs from your clearance script
Outputs:
    final_tcp_ids (List, int): The sequence with TCP 1 inserted at 0, 16, 32...
"""

# Create a copy of the input list so you don't overwrite the original data
final_tcp_ids = list(tcp_ids)

# Calculate how many inserts you need based on the length of your list
# Every insertion shifts subsequent indices, so we use a tracking multiplier
for step in range(len(final_tcp_ids)):
    target_index = step * 16
    
    # Stop inserting once the target index exceeds the expanding list size
    if target_index > len(final_tcp_ids):
        break
        
    # Insert TCP 1 exactly at 0, 16, 32, 48...
    final_tcp_ids.insert(target_index, 1)
# ---------- end python_3_script_12 ----------

# ----
pt_2 = ConstructPoint(XCoordinate="-14.21", YCoordinate="-14.75", ZCoordinate="116.68")

# ---- group: TCP Ids
panel = Panel(python_3_script_12.final_tcp_ids)

# ----
dump_plane_reference_point = Point(<point referenced from the Rhino model>)
python_3_script_13 = Python3Script(pt=dump_plane_reference_point)  # -> f; inputs pt: Point3d
# ---------- python_3_script_13: Python ----------
from compas.geometry import Point, Frame
from compas_rhino.conversions import point_to_compas

compas_pt = point_to_compas(pt)
f = Frame(compas_pt, [1, 0, 0], [0, -1, 0])
# ---------- end python_3_script_13 ----------

pt_3 = ConstructPoint(XCoordinate="12.54", YCoordinate="12.48", ZCoordinate="116.01")

# ---- group: create pickup planes from the brick depot
xypoint_3 = Panel("""-62.52,
367.39,
-4.51""")
xaxis_3 = Panel("""90.04,
521.78,
-4.83""")
origin_3 = Panel("""90.32,
367.78,
-4.14""")
python_3_script_14 = Python3Script(
    pickup_base_origin=origin_3,
    n_z=Slider(5, range=0..10),
    tol_x=Slider(-0.5, range=-20..20),
    tol_y=Slider(-0.5, range=-20..20),
    tol_z=Slider(4, range=-20..20))  # -> out, frames, points, depot_frame; inputs pickup_base_origin: Point3d, n_z: Int32; same code as python_3_script_8
python_3_script_15 = Python3Script(Origin=origin_3, Xaxis=xaxis_3, XYpoint=xypoint_3)  # -> out, Rectangle; inputs Origin: Point3d, Xaxis: Point3d, XYpoint: Point3d; same code as python_3_script_9
compas_draw_12 = COMPASDraw(cg=python_3_script_14.points)  # -> rg; same code as compas_draw
points_2 = PointList(Points=compas_draw_12, Size=Slider(4, range=0..10))

# ---- group: transform rhino planes to robo base
fine_adjust_z_mm_2 = Slider(22, range=-5..500)
xaxis_4 = Panel("""535.83,
513.91,
-12.43""")
xypoint_4 = Panel("""229.24,
-79.84,
-11.39""")
origin_4 = Panel("""535.77,
-80.72,
-11.6""")
transform_2 = Python3Script(
    way_planes=python_3_script_11.rot_frames,
    wobj_origin=origin_4,
    wobj_xaxis=xaxis_4,
    wobj_xypoint=xypoint_4,
    z_safe_margin=fine_adjust_z_mm_2)  # -> out, flatten(transformed_frames); inputs way_planes: list, wobj_origin: Point3d, wobj_xaxis: Point3d, wobj_xypoint: Point3d, z_safe_margin: Double; same code as transform
python_3_script_16 = Python3Script(Origin=origin_4, Xaxis=xaxis_4, XYpoint=xypoint_4)  # -> out, Rectangle; inputs Origin: Point3d, Xaxis: Point3d, XYpoint: Point3d; same code as python_3_script_9
compas_draw_13 = COMPASDraw(cg=transform_2.transformed_frames)  # -> rg; same code as compas_draw

# ----
pt_4 = ConstructPoint(XCoordinate="12.54", YCoordinate="12.48", ZCoordinate="116.01")

xaxis_5 = Panel("""90.04,
521.78,
-4.83""")
xypoint_5 = Panel("""-62.52,
367.39,
-4.51""")
origin_5 = Panel("""90.32,
367.78,
-4.14""")
python_3_script_17 = Python3Script(
    pickup_base_origin=origin_5,
    n_z=Slider(9, range=0..10),
    tol_x=Slider(-1.5, range=-20..20),
    tol_y=Slider(-1, range=-20..20),
    tol_z=Slider(4, range=-20..20))  # -> out, frames, points, depot_frame; inputs pickup_base_origin: Point3d, n_z: Int32; same code as python_3_script_8
python_3_script_18 = Python3Script(Origin=origin_5, Xaxis=xaxis_5, XYpoint=xypoint_5)  # -> out, Rectangle; inputs Origin: Point3d, Xaxis: Point3d, XYpoint: Point3d; same code as python_3_script_9
compas_draw_14 = COMPASDraw(cg=python_3_script_17.points)  # -> rg; same code as compas_draw
points_3 = PointList(Points=compas_draw_14, Size=Slider(4, range=0..10))

fine_adjust_z_mm_3 = Slider(20, range=-5..500)
xaxis_6 = Panel("""535.83,
513.91,
-12.43""")
origin_6 = Panel("""535.77,
-80.72,
-11.6""")
xypoint_6 = Panel("""229.24,
-79.84,
-11.39""")
transform_3 = Python3Script(
    way_planes=python_3_script_4.compas_planes,
    wobj_origin=origin_6,
    wobj_xaxis=xaxis_6,
    wobj_xypoint=xypoint_6,
    z_safe_margin=fine_adjust_z_mm_3)  # -> out, flatten(transformed_frames); inputs way_planes: list, wobj_origin: Point3d, wobj_xaxis: Point3d, wobj_xypoint: Point3d, z_safe_margin: Double; same code as transform
python_3_script_19 = Python3Script(Origin=origin_6, Xaxis=xaxis_6, XYpoint=xypoint_6)  # -> out, Rectangle; inputs Origin: Point3d, Xaxis: Point3d, XYpoint: Point3d; same code as python_3_script_9
compas_draw_15 = COMPASDraw(cg=transform_3.transformed_frames)  # -> rg; same code as compas_draw

pt_5 = ConstructPoint(XCoordinate="-14.21", YCoordinate="-14.75", ZCoordinate="116.68")

pt_6 = ConstructPoint(XCoordinate="-14.21", YCoordinate="-14.75", ZCoordinate="116.68")

# ----
# ASSEMBLE CODE
number_slider_4 = Slider(1, range=0..1)
grb_pos = Panel("2")
compas = Python3Script(
    way_frames=transform.transformed_frames,
    pickup_frames=python_3_script_8.frames,
    dump_frame=python_3_script_13,
    tcp_1=pt,
    tcp_2=pt_2,
    a=Slider(0.8, range=0..1),
    v=number_slider_4,
    grb_pos=grb_pos)  # -> out, vis_frames, vis_planes, script; inputs way_frames: list, pickup_frames: list, tcp_1: Point3d, tcp_2: Point3d, a: Double, v: Double, grb_pos: Int32
# ---------- compas: Python ----------
from imp import reload
import sys
import os

#get current file path
path = ghenv.Component.OnPingDocument().FilePath
#get parent directory of the parent directory
parentdir = os.path.dirname(path)
#get src folder which contains classes
dire = os.path.join(parentdir,'src')

sys.path.append(dire)

import simple_ur_script as ur
reload(ur)

import utils 
reload(utils)

import simple_comm as com
reload(com)

import compas.geometry as cg
import math as m

# ===== Set global constants =======

IO = 0 # Global constant
sd = 120

# =================================

script = "" #create empty string

def pickup_brick(script, pick_frame):

    frames = []

    # Translate frame to "safe" location
    safe_pick_frame = pick_frame.copy()
    safe_pick_frame.point.z += sd

    # Move to safe frame
    script += ur.move_l(safe_pick_frame, a, v)

    # Move to pick location
    script += ur.move_l(pick_frame, a, v)

    # Activate gripper
    script += ur.set_digital_out(IO, True)
    script += ur.sleep(1.5)

    # Move back to safe plane
    script += ur.move_l(safe_pick_frame, a, v)
    script += (ur.move_j([m.radians(253.70), m.radians(-90.63), m.radians(118.09), m.radians(-118.02), m.radians(-90.78), m.radians(28.16)], 1.2, 1.2))
    frames.extend([safe_pick_frame, pick_frame, safe_pick_frame])

    return script, frames


def place_brick(script, place_frame):
    frames = []
    
    # Safe frame for placing
    safe_place_frame = place_frame.copy()
    safe_place_frame.point.z += sd

    # Add to the path: go to the safe plane
    script += ur.move_l(safe_place_frame, a, v)

    # Add to the path: go to the place plane
    script += ur.move_l(place_frame, a, v)
    
    # Add to the path: turn off the vacuum and wait 1 second (hold the brick)
    script += ur.set_digital_out(IO, False)
    script += ur.sleep(1.5)
    
    # Add to the path: go back to the safe plane
    script += ur.move_l(safe_place_frame, a, v)

    frames.extend([safe_place_frame, place_frame, safe_place_frame])
    
    return script, frames


def depot_action(script, depot_frame, dump_frame):
    frames = []

    # 1. & 2. Copy the depot frame and raise its Z position by 20 units
    safe_depot_frame = depot_frame.copy()
    safe_depot_frame.point.z += 120

    # 3. UR Linear motions: approach safe position, then drop down to the depot point
    script += ur.move_l(safe_depot_frame, a, v)
    script += ur.move_l(depot_frame, a, v)

    # 4. Trigger I/O to TRUE (Grip/Activate)
    script += ur.set_digital_out(IO, True)
    script += ur.sleep(1.5)

    # 5. Move back up to the safe depot clearance height
    script += ur.move_l(safe_depot_frame, a, v)
    
    # 6. Move to the custom dump plane inputted from Grasshopper
    script += ur.move_l(dump_frame, a, v)
    
    # 7. Trigger I/O to FALSE (Release/Open)
    script += ur.set_digital_out(IO, False)
    script += ur.sleep(1.5)

    # Keep track of the generated motion sequence path for visual feedback
    frames.extend([safe_depot_frame, depot_frame, safe_depot_frame, dump_frame])

    return script, frames


# ===== INITIALIZE GLOBAL DESIGN TCP =====
# Force the script to execute using TCP 2 natively from the start
if tcp_2 is not None:
    script += ur.set_tcp_by_angles(tcp_2.X, tcp_2.Y, tcp_2.Z, m.radians(0), m.radians(-45), m.radians(45))

vis_frames = [] 
place_counter = 0 # Track sequential progress through structural drop planes

# ===== Generate pick, place, and depot sequence =====
for i in range(len(way_frames)):
    
    # 1. TRIGGER DEPOT AFTER EVERY (i*15)+i INTERVAL (0, 16, 32...) AT THE SAME LOCATION
    if i % 16 == 0:
        depot_index = i % len(pickup_frames)
        target_depot_frame = pickup_frames[depot_index]
        
        # --- OVERRIDE: Switch to TCP 1 specifically for the Depot Action ---
        if tcp_1 is not None:
            script += ur.set_tcp_by_angles(tcp_1.X, tcp_1.Y, tcp_1.Z, m.radians(-45), m.radians(0), m.radians(-45))
        
        # Execute the depot action under TCP 1 execution context
        script, depot_frames_list = depot_action(script, target_depot_frame, dump_frame)
        vis_frames.extend(depot_frames_list)
        
        # --- RESTORE OVERRIDE: Re-engage global TCP 2 right after Depot completes ---
        if tcp_2 is not None:
            script += ur.set_tcp_by_angles(tcp_2.X, tcp_2.Y, tcp_2.Z, m.radians(0), m.radians(-45), m.radians(45))
        
    # 2. RUN NORMAL PICK & PLACE ONLY ON NON-DEPOT ITERATIONS
    else:
        if place_counter < len(way_frames):
            # Target structural planes continuously using the decoupled index pointer
            current_place_frame = way_frames[place_counter]
            
            pickup_index = i % len(pickup_frames)
            current_pick_frame = pickup_frames[pickup_index]
            
            script, pif = pickup_brick(script, current_pick_frame)
            vis_frames.extend(pif)
            
            script, place_frames_list = place_brick(script, current_place_frame)
            vis_frames.extend(place_frames_list)
            
            # Step the structural placement pointer forward
            place_counter += 1


# Format the script to make it sendable
script = com.concatenate_script(script)


# Visualize
from compas_rhino import conversions
import Rhino.Geometry as rg

vis_planes = [conversions.frame_to_rhino(frame) for frame in vis_frames]
# ---------- end compas ----------
compas_draw_16 = COMPASDraw(cg=compas.vis_frames)  # -> rg; same code as compas_draw
pline = PolyLine(Vertices=compas.vis_planes, Closed=False)
points_4 = PointList(Points=compas.vis_planes, Size=Slider(7, range=0..100))

dump_plane_reference_point_2 = Point(<point referenced from the Rhino model>)
python_3_script_20 = Python3Script(pt=dump_plane_reference_point_2)  # -> f; inputs pt: Point3d; same code as python_3_script_13

dump_plane_reference_point_3 = Point(<point referenced from the Rhino model>)
python_3_script_21 = Python3Script(pt=dump_plane_reference_point_3)  # -> f; inputs pt: Point3d; same code as python_3_script_13

# ---- group: selects tcp 1 for odd way_planes and tcp 2 for even way_planes
compas_2 = Python3Script(
    way_frames=transform_2.transformed_frames,
    pickup_frames=python_3_script_14.frames,
    tcp_1=pt_3,
    tcp_2=pt_5,
    dump_frame=python_3_script_20,
    a=Slider(0.2, range=0..1),
    v=Slider(1, range=0..1))  # -> out, vis_frames, vis_planes, script; inputs way_frames: list, pickup_frames: list, tcp_1: Point3d, tcp_2: Point3d, a: Double, v: Double, grb_pos: Int32
# ---------- compas_2: Python ----------
from imp import reload
import sys
import os

#get current file path
path = ghenv.Component.OnPingDocument().FilePath
#get parent directory of the parent directory
parentdir = os.path.dirname(path)
#get src folder which contains classes
dire = os.path.join(parentdir,'src')

sys.path.append(dire)

import simple_ur_script as ur
reload(ur)

import utils 
reload(utils)

import simple_comm as com
reload(com)

import compas.geometry as cg
import math as m

# ===== Set global constants =======

IO = 0 # Global constant
sd = 120

# =================================

script = "" #create empty string

def pickup_brick(script, pick_frame):

    frames = []

    # Translate frame to "safe" location
    safe_pick_frame = pick_frame.copy()
    safe_pick_frame.point.z += sd

    # Move to safe frame
    script += ur.move_l(safe_pick_frame, a, v)

    # Move to pick location
    script += ur.move_l(pick_frame, a, v)

    # Activate gripper
    script += ur.set_digital_out(IO, True)
    script += ur.sleep(1.5)

    # Move back to safe plane
    script += ur.move_l(safe_pick_frame, a, v)
    script += (ur.move_j([m.radians(253.70), m.radians(-90.63), m.radians(118.09), m.radians(-118.02), m.radians(-90.78), m.radians(28.16)], 1.2, 1.2))
    frames.extend([safe_pick_frame, pick_frame, safe_pick_frame])

    return script, frames


def place_brick(script, place_frame):
    frames = []
    
    # Safe frame for placing
    safe_place_frame = place_frame.copy()
    safe_place_frame.point.z += sd

    # Add to the path: go to the safe plane
    script += ur.move_l(safe_place_frame, a, v)

    # Add to the path: go to the place plane
    script += ur.move_l(place_frame, a, v)
    
    # Add to the path: turn off the vacuum and wait 1 second (hold the brick)
    script += ur.set_digital_out(IO, False)
    script += ur.sleep(1.5)
    
    # Add to the path: go back to the safe plane
    script += ur.move_l(safe_place_frame, a, v)

    frames.extend([safe_place_frame, place_frame, safe_place_frame])
    
    return script, frames


def depot_action(script, depot_frame, dump_frame):
    frames = []

    # 1. & 2. Copy the depot frame and raise its Z position by 20 units
    safe_depot_frame = depot_frame.copy()
    safe_depot_frame.point.z += 120

    # 3. UR Linear motions: approach safe position, then drop down to the depot point
    script += ur.move_l(safe_depot_frame, a, v)
    script += ur.move_l(depot_frame, a, v)

    # 4. Trigger I/O to TRUE (Grip/Activate)
    script += ur.set_digital_out(IO, True)
    script += ur.sleep(1.5)

    # 5. Move back up to the safe depot clearance height
    script += ur.move_l(safe_depot_frame, a, v)
    
    # 6. Move to the custom dump plane inputted from Grasshopper
    script += ur.move_l(dump_frame, a, v)
    
    # 7. Trigger I/O to FALSE (Release/Open)
    script += ur.set_digital_out(IO, False)
    script += ur.sleep(1.5)

    # Keep track of the generated motion sequence path for visual feedback
    frames.extend([safe_depot_frame, depot_frame, safe_depot_frame, dump_frame])

    return script, frames


vis_frames = [] 
place_counter = 0 # Track sequential progress through structural drop planes

# ===== Generate pick, place, and depot sequence =====
for i in range(len(way_frames)):
    
    # 1. TRIGGER DEPOT AFTER EVERY (i*15)+i INTERVAL (0, 16, 32...) AT THE SAME LOCATION
    if i % 16 == 0:
        depot_index = i % len(pickup_frames)
        target_depot_frame = pickup_frames[depot_index]
        
        script, depot_frames_list = depot_action(script, target_depot_frame, dump_frame)
        vis_frames.extend(depot_frames_list)
        
    # 2. RUN NORMAL PICK & PLACE ONLY ON NON-DEPOT ITERATIONS
    else:
        if place_counter < len(way_frames):
            # Target structural planes continuously using the decoupled index pointer
            current_place_frame = way_frames[place_counter]
            
            pickup_index = i % len(pickup_frames)
            current_pick_frame = pickup_frames[pickup_index]
            

            # 1. Set the correct TCP first (Even = TCP 2, Odd = TCP 1)
            if place_counter % 2 == 0:
                if tcp_2 is not None:
                    script += ur.set_tcp_by_angles(tcp_2.X, tcp_2.Y, tcp_2.Z, m.radians(0), m.radians(-45), m.radians(45))
            else:
                if tcp_1 is not None:
                    script += ur.set_tcp_by_angles(tcp_1.X, tcp_1.Y, tcp_1.Z, m.radians(-45), m.radians(0), m.radians(-45))

            # 2. Pick up the brick using that TCP
            script, pif = pickup_brick(script, current_pick_frame)
            vis_frames.extend(pif)
            
            # 3. Drop the brick using the same TCP
            script, place_frames_list = place_brick(script, current_place_frame)
            vis_frames.extend(place_frames_list)  # <--- ADD THIS MISSING LINE HERE

            # Step the structural placement pointer forward
            place_counter += 1


# Format the script to make it sendable
script = com.concatenate_script(script)

# Visualize
from compas_rhino import conversions
import Rhino.Geometry as rg
vis_planes = [conversions.frame_to_rhino(frame) for frame in vis_frames]



# Visualize
from compas_rhino import conversions
import Rhino.Geometry as rg

vis_planes = [conversions.frame_to_rhino(frame) for frame in vis_frames]
# ---------- end compas_2 ----------
compas_draw_17 = COMPASDraw(cg=compas_2.vis_frames)  # -> rg; same code as compas_draw
pline_2 = PolyLine(Vertices=compas_2.vis_planes, Closed=False)
points_5 = PointList(Points=compas_2.vis_planes, Size=Slider(7, range=0..100))

# ----
py3 = Python3Script(script=compas.script, ip_address="192.168.10.10", send=Button())  # -> out, a; inputs script: String, ip_address: String, send: Boolean
# ---------- py3: Python ----------
import simple_comm as com

if send:
    com.send_script(script,ip_address)
# ---------- end py3 ----------

# ----
# Robot base
# brick wall design opt_02
# Pickup base
# TCP 1
# TCP 2
# Dump plane
# Run script
panel_2 = Panel(compas.script)

# ----
# ASSEMBLE CODE
number_slider_5 = Slider(1, range=0..1)
compas_3 = Python3Script(
    way_frames=transform_3.transformed_frames,
    pickup_frames=python_3_script_17.frames,
    dump_frame=python_3_script_21,
    tcp_1=pt_4,
    tcp_2=pt_6,
    a=Slider(0.6, range=0..1),
    v=number_slider_5,
    tcp_ids=python_3_script_12.final_tcp_ids)  # -> out, vis_frames, vis_planes, script; inputs way_frames: list, pickup_frames: list, tcp_1: Point3d, tcp_2: Point3d, a: Double, v: Double, tcp_ids: list of Int32
# ---------- compas_3: Python ----------
from imp import reload
import sys
import os

#get current file path
path = ghenv.Component.OnPingDocument().FilePath
#get parent directory of the parent directory
parentdir = os.path.dirname(path)
#get src folder which contains classes
dire = os.path.join(parentdir,'src')

sys.path.append(dire)

import simple_ur_script as ur
reload(ur)

import utils 
reload(utils)

import simple_comm as com
reload(com)

import compas.geometry as cg
import math as m

# ===== Set global constants =======

IO = 0 # Global constant
sd = 120

# =================================

script = "" #create empty string

def pickup_brick(script, pick_frame):

    frames = []

    # Translate frame to "safe" location
    safe_pick_frame = pick_frame.copy()
    safe_pick_frame.point.z += sd

    # Move to safe frame
    script += ur.move_l(safe_pick_frame, a, v)

    # Move to pick location
    script += ur.move_l(pick_frame, a, v)

    # Activate gripper
    script += ur.set_digital_out(IO, True)
    script += ur.sleep(1.5)

    # Move back to safe plane
    script += ur.move_l(safe_pick_frame, a, v)
    script += (ur.move_j([m.radians(253.70), m.radians(-90.63), m.radians(118.09), m.radians(-118.02), m.radians(-90.78), m.radians(28.16)], 1.2, 1.2))
    frames.extend([safe_pick_frame, pick_frame, safe_pick_frame])

    return script, frames


def place_brick(script, place_frame):
    frames = []
    
    # Safe frame for placing
    safe_place_frame = place_frame.copy()
    safe_place_frame.point.z += sd

    # Add to the path: go to the safe plane
    script += ur.move_l(safe_place_frame, a, v)

    # Add to the path: go to the place plane
    script += ur.move_l(place_frame, a, v)
    
    # Add to the path: turn off the vacuum and wait 1 second (hold the brick)
    script += ur.set_digital_out(IO, False)
    script += ur.sleep(1.5)
    
    # Add to the path: go back to the safe plane
    script += ur.move_l(safe_place_frame, a, v)

    frames.extend([safe_place_frame, place_frame, safe_place_frame])
    
    return script, frames


def depot_action(script, depot_frame, dump_frame):
    frames = []

    # 1. & 2. Copy the depot frame and raise its Z position by 20 units
    safe_depot_frame = depot_frame.copy()
    safe_depot_frame.point.z += 120

    # 3. UR Linear motions: approach safe position, then drop down to the depot point
    script += ur.move_l(safe_depot_frame, a, v)
    script += ur.move_l(depot_frame, a, v)

    # 4. Trigger I/O to TRUE (Grip/Activate)
    script += ur.set_digital_out(IO, True)
    script += ur.sleep(1.5)

    # 5. Move back up to the safe depot clearance height
    script += ur.move_l(safe_depot_frame, a, v)
    
    # 6. Move to the custom dump plane inputted from Grasshopper
    script += ur.move_l(dump_frame, a, v)
    
    # 7. Trigger I/O to FALSE (Release/Open)
    script += ur.set_digital_out(IO, False)
    script += ur.sleep(1.5)

    # Keep track of the generated motion sequence path for visual feedback
    frames.extend([safe_depot_frame, depot_frame, safe_depot_frame, dump_frame])

    return script, frames


vis_frames = [] 
place_counter = 0 # Track sequential progress through structural drop planes

# ===== Generate pick, place, and depot sequence =====
for i in range(len(way_frames)):
    
    # 1. TRIGGER DEPOT AFTER EVERY (i*15)+i INTERVAL (0, 16, 32...) AT THE SAME LOCATION
    if i % 16 == 0:
        depot_index = i % len(pickup_frames)
        target_depot_frame = pickup_frames[depot_index]
        
        # --- OVERRIDE: Switch to TCP 1 specifically for the Depot Action ---
        if tcp_1 is not None:
            script += ur.set_tcp_by_angles(tcp_1.X, tcp_1.Y, tcp_1.Z, m.radians(-45), m.radians(0), m.radians(-45))
        
        # Execute the depot action under TCP 1 execution context
        script, depot_frames_list = depot_action(script, target_depot_frame, dump_frame)
        vis_frames.extend(depot_frames_list)
        
    # 2. RUN NORMAL PICK & PLACE ONLY ON NON-DEPOT ITERATIONS
    else:
        if place_counter < len(way_frames):
            # Target structural planes continuously using the decoupled index pointer
            current_place_frame = way_frames[place_counter]
            
            pickup_index = i % len(pickup_frames)
            current_pick_frame = pickup_frames[pickup_index]
            
            # --- DYNAMIC TCP SELECTION FROM YOUR INPUT LIST ---
            # Look up the custom tool configuration for this exact step
            current_tcp_id = tcp_ids[i] if i < len(tcp_ids) else 2
            
            if current_tcp_id == 1 and tcp_1 is not None:
                script += ur.set_tcp_by_angles(tcp_1.X, tcp_1.Y, tcp_1.Z, m.radians(-45), m.radians(0), m.radians(-45))
            elif current_tcp_id == 2 and tcp_2 is not None:
                script += ur.set_tcp_by_angles(tcp_2.X, tcp_2.Y, tcp_2.Z, m.radians(0), m.radians(-45), m.radians(45))
            
            script, pif = pickup_brick(script, current_pick_frame)
            vis_frames.extend(pif)
            
            script, place_frames_list = place_brick(script, current_place_frame)
            vis_frames.extend(place_frames_list)
            
            # Step the structural placement pointer forward
            place_counter += 1


# Format the script to make it sendable
script = com.concatenate_script(script)


# Visualize
from compas_rhino import conversions
import Rhino.Geometry as rg

vis_planes = [conversions.frame_to_rhino(frame) for frame in vis_frames]
# ---------- end compas_3 ----------
compas_draw_18 = COMPASDraw(cg=compas_3.vis_frames)  # -> rg; same code as compas_draw
pline_3 = PolyLine(Vertices=compas_3.vis_planes, Closed=False)
points_6 = PointList(Points=compas_3.vis_planes, Size=Slider(7, range=0..100))

# ----
# Robot base
# brick wall design
# Pickup base
# TCP 1
# TCP 2
# Dump plane
# Run script
att_pt_2 = Point(<point referenced from the Rhino model>)
list_item = ListItem(List=compas_draw_5, Index=0, Wrap=True)  # -> Item, Item1, Item2, Item3, Item4, Item5, Item6, Item7
list_item_2 = ListItem(List=python_3_script_7.offset_curves, Index=0, Wrap=True)  # -> Item, Item1, Item2, Item3, Item4, Item5, Item6, Item7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
panel_3 = Panel(compas_3.script)

# ---- group: flemish brick bond rotated with attractor point
# // UR Scipt for brick pier defining TCP ids
number_slider_6 = Slider(10, range=0..100)
python_3_script_22 = Python3Script(
    n_x=Slider(7, range=0..100),
    n_z=number_slider_6,
    length=Slider(32, range=0..100),
    width=Slider(15, range=0..100),
    height=Slider(10, range=0..10),
    att_pt=att_pt_2)  # -> flatten(bricks), points, frames; inputs n_x: Int32, n_z: Int32, length: Double, height: Double, att_pt: Point3d
# ---------- python_3_script_22: Python ----------
from compas.geometry import Point, Box, Frame, Rotation
from compas_rhino.conversions import point_to_rhino
import math as m

bricks = []
points = []
gap = 10

for j in range(n_z):
    z = j * height
    for i in range(n_x):
        if i % 2 == 0:
            x = ( (i/2 * (length + width)) + length/2 ) + gap*i
        else:
            x = ( (((i+1)/2) * length) + (((i-1)/2) * width) + (width/2) ) + gap*i
            
        pt = Point(x, width/2, z) # Note: Fixed the 4 arguments error here (removed extra z)
        f = Frame(pt)
        points.append(pt)
        
        if j % 2 == i % 2:
            b = Box(width, length, height, f) # Stretcher
        else:
            b = Box(length, width, height, f) # Header

        bricks.append(b)

# Create an empty list to store your correctly transformed frames
frames = []

for b in bricks:
    pt = b.frame.point
    r_pt = point_to_rhino(pt)
    dist = att_pt.DistanceTo(r_pt) * 0.5
    
    # 1. Define the rotation transformation using COMPAS Geometry
    # We use b.frame.point instead of r_pt to keep it in COMPAS native types
    R = Rotation.from_axis_and_angle([0, 0, 1], m.radians(dist), b.frame.point)
    
    # 2. Transform the brick geometry
    b.transform(R)
    
    # 3. Create your base orientation frame and transform it by the same matrix
    # This ensures your frame perfectly matches the visual rotation of the brick
    f = Frame(b.frame.point, [1, 0, 0], [0, -1, 0])
    f.transform(R)
    frames.append(f)
    
    print(dist)
# ---------- end python_3_script_22 ----------
compas_draw_19 = COMPASDraw(cg=python_3_script_22.bricks)  # -> flatten(rg); same code as compas_draw
compas_draw_20 = COMPASDraw(cg=python_3_script_22.frames)  # -> rg; same code as compas_draw
custom_preview_5 = CustomPreview(
    Geometry=compas_draw_19,
    Material={diffuse=RGB(221, 160, 221), emission=RGB(66, 48, 66), shine=0.5, specular=RGB(255, 255, 255), transparency=0})

# ----
# Robot base
# // flemish brick wall along a straight line with point attractor
# Pickup base
# brick wall design
# Create script for UR Robot
# Run script
# TCP 1
# TCP 2
# Dump plane
panel_4 = Panel(compas_2.script)

py3_2 = Python3Script(script=compas_2.script, ip_address="192.168.10.10", send=Button())  # -> out, a; inputs script: String, ip_address: String, send: Boolean; same code as py3

py3_3 = Python3Script(script=compas_3.script, ip_address="192.168.10.10", send=Button())  # -> out, a; inputs script: String, ip_address: String, send: Boolean; same code as py3

radians = Radians(Degrees=Slider(270, range=0..360))
panel_5 = Panel("0,0,0")
point = Point(<point referenced from the Rhino model>)
point_2 = Point(<point referenced from the Rhino model>)
plane_2 = Plane(point)
number_slider_7 = Slider(1, range=0..1000)
program_simulation = ProgramSimulation(Time=0, Normalized=True)  # -> SystemMeshes, JointRotations, Plane, Index, Time, Program, Errors

point_3 = Point(<point referenced from the Rhino model>)
geometry = Geometry(<extrusion referenced from the Rhino model>)
list = RobotsLibrary({"UR5e (missing)": "UR5e"}, selected="UR5e (missing)", Type=0)
point_4 = Point(<point referenced from the Rhino model>)
plane_3 = Plane(point_4)
flip_plane = FlipPlane(Plane=plane_2, ReverseX=False, ReverseY=False, SwapAxes=True)

plane_4 = Plane(point_3)
boundary_volume = BoundaryVolume(Boundaries=geometry)
rotate_plane = RotatePlane(Plane=plane_4, Angle=radians)

mesh = Mesh(boundary_volume)
load_robot_system = LoadRobotSystem(Name=list, Base=rotate_plane)
create_tool = CreateTool(Name="A", TCP=plane_3, Weight=0, Mesh=mesh)  # -> Tool, TCP
create_target = CreateTarget(Joints="0,0,0,0,0,0", Tool=create_tool.Tool, Speed=Slider(100, range=0..100), IsCartesian=False)
create_program = CreateProgram(Name="b", RobotSystem=load_robot_system, Targets=create_target, StepSize=1)  # -> Program, Code, Duration, Warnings, Errors
panel_6 = Panel(create_program.Errors)
program_simulation_2 = ProgramSimulation(Program=create_program.Program, Time=Slider(0.177, range=0..1), Normalized=True)  # -> SystemMeshes, JointRotations, Plane, Index, Time, Program, Errors

panel_7 = Panel(create_program.Warnings)
