# Grasshopper definition Brick Pile.gh (Grasshopper 1.0.8)

brick_dimensions = Python3Script()  # -> out, bricks
# ---------- brick_dimensions: Python ----------
# r: compas
# venv: mas-2627
from compas_rhino.devtools import DevTools
DevTools.ensure_path()

from compas.geometry import Point, Vector, Box, Frame

from brick_wall import Brick

init_fr = Frame(Point(0.0,0.0,0.0), Vector.Xaxis(), Vector.Yaxis())
print(init_fr)
bricks = []
for c in range(3):
    b = Brick(init_fr)
    b.configuration(c)
    bricks.append(b)
    print(b.frame.point)
# ---------- end brick_dimensions ----------
rotation_deg = Slider(360, range=0..360)
brick_setup = Python3Script(
    no_bricks=Slider(19, range=0..100),
    brick_config=brick_dimensions.bricks,
    rotation=rotation_deg,
    gap=Slider(6, range=0..50))  # -> out, geometries; inputs no_bricks: Int32, brick_config: list, rotation: Double, gap: Double
# ---------- brick_setup: Python ----------
from compas.geometry import bounding_box, Point, Vector, Frame, Box
import ghpythonlib.treehelpers as th
from brick_wall import Brick

bricks = []
heights = [b.height for b in brick_config]
min_height = min(heights)
for n in range(no_bricks):
    brick = (brick_config[n % len(brick_config)]).copy()
    brick.rotate((n/(no_bricks-1))*rotation,Vector.Zaxis())
    brick.move(Point(0.0,0.0,abs(1/2*(brick.height))))
    if n > 0:
        prev_brick = bricks[-1]
        v = prev_brick.diagonal_vector()
        unit_v = v.unitized()
        diag_vector = (1/2 * (prev_brick.length + brick.length) + gap) * unit_v
        move_v = Vector(diag_vector.x, diag_vector.y, 0.0)
        move_p = prev_brick.frame.point + move_v
        edit_p = Point(move_p.x, move_p.y, brick.frame.point.z)
        brick.move(edit_p)
        bricks.append(brick)
    else:
        bricks.append(brick)

geometries = [b.draw() for b in bricks]
# ---------- end brick_setup ----------
draw = COMPASDraw(cg=brick_setup.geometries)  # -> rg
#   port cg: The COMPAS geometry or datastructure to be drawn.
#   port rg: The Rhino geometry object.
# ---------- draw: Python ----------
# r: compas>=2.14.1
"""
Draws COMPAS geometry in Grasshopper.
"""

from typing import Any

import Grasshopper

from compas.scene import SceneObject


class CompasToRhinoGeometry(Grasshopper.Kernel.GH_ScriptInstance):
    def RunScript(self, cg):
        if not cg:
            return None

        return SceneObject(item=cg).draw()
# ---------- end draw ----------
