# Grasshopper definition HR_brick_to_robot_slope.ghx (Grasshopper 1.0.8)

# ---- group: This is needed only ONCE in the GH definition
enable_auto_reload = Python3Script()  # -> ok
# ---------- enable_auto_reload: Python ----------
"""
------------------------------
Using VS Code as Python editor
------------------------------

The simplest way to start using VS Code as our editor, is
to place our Python code in files located IN THE SAME FOLDER as our Grasshopper file.

After we have done that, we need 2 steps: 

1. Enable the COMPAS reloader on one component. This tells Grasshopper to watch for changes in the Pythoh files and reload if changed.
2. Every other component that uses Python code from external files needs to start with a method to ensure Grasshopper knows where to load the files from.

"""
# r: compas
# venv: mas-2627

from compas_rhino.devtools import DevTools
DevTools.enable_reloader()
# ---------- end enable_auto_reload ----------

# ---- group: slope
crv = Curve(<curve referenced from the Rhino model>)
slope = Python3Script(
    crv=crv,
    spacing=Slider(25, range=0..30),
    max_height=Slider(50, range=10..50),
    min_peak_height=Slider(41, range=0..100),
    min_height=Slider(0, range=0..50),
    num_peaks=Slider(2, range=0..10))  # -> out, slope_bricks, support_frames, brick_frames, layer_counts; inputs crv: Curve, spacing: Double, max_height: Double, min_peak_height: Double, min_height: Double, num_peaks: Int32
# ---------- slope: Python ----------
import os
import sys
from importlib import reload

# ====================================
# 1. IMPORT
# ====================================

path = ghenv.Component.OnPingDocument().FilePath
folder = os.path.dirname(path)

if folder not in sys.path:
    sys.path.append(folder)

import slope_design
reload(slope_design)

# ====================================
# 2. BRICK SETTINGS
# ====================================

BRICK_HEIGHT = 10.0

# ====================================
# 3. INPUT PARAMETERS
# ====================================

BRICK_GAP = float(spacing)

MAX_LAYERS = int(
    round(float(max_height) / BRICK_HEIGHT)
)

MIN_PEAK_LAYERS = int(
    round(float(min_peak_height) / BRICK_HEIGHT)
)

MIN_LAYERS = int(
    round(float(min_height) / BRICK_HEIGHT)
)

NUM_PEAKS = int(num_peaks)

# ====================================
# 4. VALIDATION
# ====================================

if crv is None:
    raise ValueError("Curve is missing")

if BRICK_GAP < 0:
    raise ValueError("Spacing must be >= 0")

if MAX_LAYERS < 1:
    raise ValueError("Maximum height must be >= 10 mm")

if not (
    0 <= MIN_LAYERS
    <= MIN_PEAK_LAYERS
    <= MAX_LAYERS
):
    raise ValueError(
        "Required: min_height <= "
        "min_peak_height <= max_height"
    )

if NUM_PEAKS < 1:
    raise ValueError("At least one peak required")

# ====================================
# 5. GENERATE SLOPE
# ====================================

(
    slope_bricks,
    support_frames,
    brick_frames,
    layer_counts
) = slope_design.generate_sloped_wall(
    crv,
    max_layers=MAX_LAYERS,
    min_layers=MIN_LAYERS,
    gap=BRICK_GAP,
    num_peaks=NUM_PEAKS,
    min_peak_layers=MIN_PEAK_LAYERS,
    min_connected_bricks=3
)

# ====================================
# 6. INFORMATION
# ====================================

print("=== SLOPE PARAMETERS ===")
print("Spacing:", BRICK_GAP, "mm")
print("Highest peak:", MAX_LAYERS * 10, "mm")
print("Lowest peak:", MIN_PEAK_LAYERS * 10, "mm")
print("Minimum valley:", MIN_LAYERS * 10, "mm")
print("Number of peaks:", NUM_PEAKS)

print("=== RESULTS ===")
print("Bricks per layer:", layer_counts)
print("Total bricks:", len(slope_bricks))
# ---------- end slope ----------

# ----
len = Length(Curve=crv)
# Generate Geometry
panel = Panel(len)
draw = COMPASDraw(cg=slope.slope_bricks)  # -> rg
#   port cg: The COMPAS geometry or datastructure to be drawn.
#   port rg: The Rhino geometry object.
# ---------- draw: Python ----------
# r: compas>=2.14.1
"""
Draws COMPAS geometry in Grasshopper.
"""

from typing import Any

import Grasshopper

from compas.scene import SceneObject


class CompasToRhinoGeometry(Grasshopper.Kernel.GH_ScriptInstance):
    def RunScript(self, cg):
        if not cg:
            return None

        return SceneObject(item=cg).draw()
# ---------- end draw ----------
preview = CustomPreview(
    Geometry=draw,
    Material={diffuse=RGB(221, 160, 221), emission=RGB(66, 48, 66), shine=0.5, specular=RGB(255, 255, 255), transparency=0})

# ----
# Measure work object
point = ValueList({"origin", "xaxis", "xypoint"}, selected="xypoint")
capture = Button()
capture_wobj = CaptureWobj(robot_ip="169.254.130.206", point_name=point, capture=capture)  # -> wobj_origin, wobj_xaxis, wobj_xypoint, info
# ---------- capture_wobj: Python ----------
"""
Capture the 3 points that define the work object (robot base) plane.

Jog the TCP to a point, pick its name (origin / xaxis / xypoint) and press capture.
The TCP position (robot base frame, mm) is saved to wobj_calibration.json next to
this .ghx file, so the points survive closing Grasshopper.
"""
import os
import sys
import json
import time

import scriptcontext as sc
import Rhino.Geometry as rg

NAMES = ["origin", "xaxis", "xypoint"]

gh_dir = os.path.dirname(ghenv.Component.OnPingDocument().FilePath)
src_dir = os.path.join(gh_dir, "src")
if src_dir not in sys.path:
    sys.path.append(src_dir)
import simple_comm as com

path = os.path.join(gh_dir, "wobj_calibration.json")

data = {}
if os.path.exists(path):
    with open(path) as f:
        data = json.load(f)

# keep the last status in sticky, so the message survives the button being released
status_key = "capture_status_" + str(ghenv.Component.InstanceGuid)

if capture:
    if point_name not in NAMES:
        sc.sticky[status_key] = "pick origin / xaxis / xypoint"
    else:
        try:
            x, y, z = list(com.listen_to_robot(robot_ip)["pose"])[:3]  # metres, robot base frame
            data[point_name] = [round(x * 1000, 2), round(y * 1000, 2), round(z * 1000, 2)]  # -> mm
            with open(path, "w") as f:
                json.dump(data, f, indent=2)
            sc.sticky[status_key] = "{} captured {}".format(point_name, time.strftime("%H:%M:%S"))
        except Exception as e:
            print(e)
            sc.sticky[status_key] = "robot not reachable"

ghenv.Component.Message = sc.sticky.get(status_key, "")

def pt(name):
    return rg.Point3d(*data[name]) if name in data else None

wobj_origin, wobj_xaxis, wobj_xypoint = pt("origin"), pt("xaxis"), pt("xypoint")
info = json.dumps(data, indent=2)
# ---------- end capture_wobj ----------
wobj_calibration = Panel(capture_wobj.info)

# ----
# Transform from Rhino to Robot Space
fine_adjust_z_mm = Slider(5, range=-5..10)
transform = Python3Script(
    way_planes=slope.brick_frames,
    wobj_origin=capture_wobj.wobj_origin,
    wobj_xaxis=capture_wobj.wobj_xaxis,
    wobj_xypoint=capture_wobj.wobj_xypoint,
    z_safe_margin=fine_adjust_z_mm)  # -> out, transformed_frames; inputs way_planes: list, wobj_origin: Point3d, wobj_xaxis: Point3d, wobj_xypoint: Point3d, z_safe_margin: Double
# ---------- transform: Python ----------
from compas.geometry import Frame, Transformation, Translation, Vector
#in this step we transform our way planes to robot space
#the rhino co-ordinate system is rather abstract in the physical world
#the robot base plane assumed the base frame of robot is the origin
#but rhino does not know that
#thus we transform things from our design space(Rhino World XY) to Robot Base Plane that we measure

def set_robot_base(origin, xaxis, xypoint):
    """
    set a base plane representing the robot working object plane
    """
    robot_base = Frame(origin, xaxis - origin, xypoint - origin)
    print (robot_base)
    return (robot_base)

def rhino_to_robot_space(rhino_plane,robot_base_plane):
    """
    Transform the objects from Rhino world XY plane to robot work object plane
    """
    T_matrix = Transformation.from_frame_to_frame(Frame.worldXY(), robot_base_plane)
    robot_plane = rhino_plane.transformed(T_matrix)
    return robot_plane

def set_z_safe_margin(planes_to_adjust, safety_margin):
    adjusted = []
    T = Translation.from_vector(Vector(0, 0, safety_margin))
    for f in planes_to_adjust:
        adjusted.append(f.transformed(T))
    return adjusted

# ===== Robot base is set =====
robot_base =  set_robot_base(wobj_origin, wobj_xaxis, wobj_xypoint)

# ===== Set safety margin for Z height ======
safe_planes = set_z_safe_margin(way_planes, z_safe_margin)

# ===== Transforming the rhino planes into robot planes =====
transformed_frames = []
for plane in safe_planes: 
    transformed_frames.append(rhino_to_robot_space(plane, robot_base))
# ---------- end transform ----------

# ----
# Measure pick up location
point_2 = ValueList({"origin", "xaxis", "xypoint"}, selected="xypoint")
capture_2 = Button()
capture_pick = CapturePick(robot_ip="169.254.130.206", point_name=point_2, capture=capture_2)  # -> origin, xaxis_pt, xy_pt, info
# ---------- capture_pick: Python ----------
"""
Capture the 3 points that define the pick frame at the brick pick-up location.

Jog the TCP to a point, pick its name (origin / xaxis / xypoint) and press capture.
The TCP position (robot base frame, mm) is saved to pick_calibration.json next to
this .ghx file, so the points survive closing Grasshopper.
"""
import os
import sys
import json
import time

import scriptcontext as sc
import Rhino.Geometry as rg

NAMES = ["origin", "xaxis", "xypoint"]

gh_dir = os.path.dirname(ghenv.Component.OnPingDocument().FilePath)
src_dir = os.path.join(gh_dir, "src")
if src_dir not in sys.path:
    sys.path.append(src_dir)
import simple_comm as com

path = os.path.join(gh_dir, "pick_calibration.json")

data = {}
if os.path.exists(path):
    with open(path) as f:
        data = json.load(f)

# keep the last status in sticky, so the message survives the button being released
status_key = "capture_status_" + str(ghenv.Component.InstanceGuid)

if capture:
    if point_name not in NAMES:
        sc.sticky[status_key] = "pick origin / xaxis / xypoint"
    else:
        try:
            x, y, z = list(com.listen_to_robot(robot_ip)["pose"])[:3]  # metres, robot base frame
            data[point_name] = [round(x * 1000, 2), round(y * 1000, 2), round(z * 1000, 2)]  # -> mm
            with open(path, "w") as f:
                json.dump(data, f, indent=2)
            sc.sticky[status_key] = "{} captured {}".format(point_name, time.strftime("%H:%M:%S"))
        except Exception as e:
            print(e)
            sc.sticky[status_key] = "robot not reachable"

ghenv.Component.Message = sc.sticky.get(status_key, "")

def pt(name):
    return rg.Point3d(*data[name]) if name in data else None

origin, xaxis_pt, xy_pt = pt("origin"), pt("xaxis"), pt("xypoint")
info = json.dumps(data, indent=2)
# ---------- end capture_pick ----------
pick_calibration = Panel(capture_pick.info)
py3 = Python3Script(origin=capture_pick.origin, xaxis_pt=capture_pick.xaxis_pt, xy_pt=capture_pick.xy_pt)  # -> out, pick_frame; inputs origin: Point3d, xaxis_pt: Point3d, xy_pt: Point3d
# ---------- py3: Python ----------
from compas.geometry import Frame, Point
from compas.geometry import Rotation

from compas_rhino.conversions import point_to_compas

origin = point_to_compas(origin)
xaxis_pt = point_to_compas(xaxis_pt)
xy_pt = point_to_compas(xy_pt)

#define pick frame
pick_frame = Frame(origin, origin - xaxis_pt ,  origin - xy_pt)
# ---------- end py3 ----------
compas_draw = COMPASDraw(cg=py3.pick_frame)  # -> rg; same code as draw

list_item = ListItem(List=transform.transformed_frames, Index=0, Wrap=True)
compas_draw_2 = COMPASDraw(cg=list_item)  # -> rg; same code as draw
pt = Point(capture_pick.xaxis_pt)
pt_2 = Point(capture_pick.origin)
pt_3 = Point(capture_pick.xy_pt)

# ----
# Measure and set TCP
panel_2 = Panel("-1.71")
pt_4 = ConstructPoint(XCoordinate=panel_2, YCoordinate="-0.9", ZCoordinate="77.83")

number_slider = Slider(0.1, range=0..0.1)
number_slider_2 = Slider(0.1, range=0..0.1)
# Convert Planes to URScript
list_item_2 = ListItem(List=transform.transformed_frames, Index=0, Wrap=True)
compas = Python3Script(
    way_frames=transform.transformed_frames,
    tcp_measured=pt_4,
    acceleration=number_slider,
    velocity=number_slider_2,
    pick_frame=py3.pick_frame)  # -> out, a, vis_frames, vis_planes, script; inputs way_frames: list, tcp_measured: Point3d, acceleration: Double, velocity: Double
# ---------- compas: Python ----------
from imp import reload
import sys
import os
import math as m

# ==========================================
# 1. IMPORT MODULES
# ==========================================

path = ghenv.Component.OnPingDocument().FilePath
parentdir = os.path.dirname(path)
dire = os.path.join(parentdir, 'src')

if dire not in sys.path:
    sys.path.append(dire)

import simple_ur_script as ur
reload(ur)

import utils
reload(utils)

import simple_comm as com
reload(com)

import compas.geometry as cg


# ==========================================
# 2. GLOBAL SETTINGS
# ==========================================

IO = 4
SAFE_DIST = 100
sleep_time = 0.5

# Dispenser: 5 rows x 4 columns x 2 layers
ROWS = 5
COLS = 4
LAYERS = 2

# Brick spacing (mm)
ROW_STEP = 32.0
COL_STEP = 15.0
BRICK_HEIGHT = 10.0

# Dispenser directions
ROW_AXIS = "x"
COL_AXIS = "y"

ROW_SIGN = 1
COL_SIGN = -1

# Measured pick frame is on bottom layer
PICK_FRAME_IS_TOP = False

# Generate URScript
GENERATE_SCRIPT = True

# Maximum available bricks
BRICKS_TO_PROCESS = 40


# ==========================================
# 3. SAFE LOCATION
# ==========================================

def safe_location(frame, safe_dist=SAFE_DIST):

    safe_frame = frame.copy()

    # Move upward in Robot Base Z
    safe_frame.point.z += safe_dist

    # Keep original orientation
    return safe_frame


# ==========================================
# 4. PICKUP BRICK
# ==========================================

def pickup_brick(script, pick_up_frame):

    safe_frame = safe_location(pick_up_frame)

    # Move to safe pickup position
    script += ur.move_l(
        safe_frame, acceleration, velocity
    )

    # Move to pickup position
    script += ur.move_l(
        pick_up_frame, acceleration, velocity
    )

    # Activate vacuum
    script += ur.set_digital_out(IO, True)
    script += ur.sleep(sleep_time)

    # Lift brick
    script += ur.move_l(
        safe_frame, acceleration, velocity
    )

    frames = [
        safe_frame,
        pick_up_frame,
        safe_frame
    ]

    return script, frames


# ==========================================
# 5. PLACE BRICK
# ==========================================

def place_brick(script, place_frame):

    safe_frame = safe_location(place_frame)

    # Move to safe placement position
    script += ur.move_l(
        safe_frame, acceleration, velocity
    )

    # Move to placement position
    script += ur.move_l(
        place_frame, acceleration, velocity
    )

    # Release vacuum
    script += ur.set_digital_out(IO, False)
    script += ur.sleep(sleep_time)

    # Move back to safe position
    script += ur.move_l(
        safe_frame, acceleration, velocity
    )

    frames = [
        safe_frame,
        place_frame,
        safe_frame
    ]

    return script, frames


# ==========================================
# 6. DISPENSER GRID
# ==========================================

def horizontal_direction(vector):

    length = m.sqrt(
        vector.x ** 2 + vector.y ** 2
    )

    if length < 0.000001:
        raise ValueError(
            "Grid axis is not horizontal"
        )

    return cg.Vector(
        vector.x / length,
        vector.y / length,
        0
    )


def generate_pick_positions(reference_frame):

    positions = []

    reference = reference_frame.copy()

    # Keep the established Z-down orientation
    if reference.zaxis.z > 0:
        reference.xaxis = -reference.xaxis

    axes = {
        "x": reference.xaxis,
        "y": reference.yaxis
    }

    row_dir = horizontal_direction(
        axes[ROW_AXIS]
    )

    col_dir = horizontal_direction(
        axes[COL_AXIS]
    )

    reference_layer = (
        1 if PICK_FRAME_IS_TOP else 0
    )

    # Top layer first, bottom layer second
    for layer in range(LAYERS - 1, -1, -1):

        for col in range(COLS):

            for row in range(ROWS):

                frame = reference.copy()

                dx = (
                    row_dir.x * ROW_STEP
                    * ROW_SIGN * row
                    + col_dir.x * COL_STEP
                    * COL_SIGN * col
                )

                dy = (
                    row_dir.y * ROW_STEP
                    * ROW_SIGN * row
                    + col_dir.y * COL_STEP
                    * COL_SIGN * col
                )

                dz = (
                    layer - reference_layer
                ) * BRICK_HEIGHT

                frame.point = cg.Point(
                    reference.point.x + dx,
                    reference.point.y + dy,
                    reference.point.z + dz
                )

                positions.append(frame)

    return positions


# ==========================================
# 7. GENERATE PICK & PLACE SEQUENCE
# ==========================================

script = ""
vis_frames = []
pick_positions = []

# Generate all dispenser positions
if pick_frame is not None:

    pick_positions = generate_pick_positions(
        pick_frame
    )

print("Available pickup positions:",
      len(pick_positions))


# ==========================================
# 8. SCRIPT GENERATION
# ==========================================

if GENERATE_SCRIPT:

    if pick_frame is None or way_frames is None:
        raise ValueError(
            "Missing pickup or placement frames"
        )

    # Automatically adjust to available bricks
    number_to_process = min(
        BRICKS_TO_PROCESS,
        len(pick_positions),
        len(way_frames)
    )

    print("Dispenser bricks:",
          len(pick_positions))

    print("Wall placement frames:",
          len(way_frames))

    print("Bricks to process:",
          number_to_process)

    if number_to_process == 0:
        raise ValueError(
            "No valid pick/place sequence"
        )

    if number_to_process < len(way_frames):
        print(
            "WARNING: Not enough dispenser bricks "
            "to complete the entire wall"
        )

    # Set measured TCP
    if tcp_measured is not None:

        script += ur.set_tcp_by_angles(
            tcp_measured.X,
            tcp_measured.Y,
            tcp_measured.Z,
            m.radians(0.0),
            m.radians(0.0),
            m.radians(0.0)
        )

    # Generate pickup and placement cycles
    for i in range(number_to_process):

        current_pick = pick_positions[i]
        current_place = way_frames[i]

        # Pickup brick
        script, f1 = pickup_brick(
            script, current_pick
        )

        # Place brick
        script, f2 = place_brick(
            script, current_place
        )

        # Store movement frames
        vis_frames.extend(f1 + f2)

    # Format URScript
    script = com.concatenate_script(script)

    print("Generated robot cycles:",
          number_to_process)


# ==========================================
# 9. PREVIEW MODE
# ==========================================

else:

    script = ""

    if way_frames is not None:

        number_to_process = min(
            BRICKS_TO_PROCESS,
            len(pick_positions),
            len(way_frames)
        )

        for i in range(number_to_process):

            current_pick = pick_positions[i]
            current_place = way_frames[i]

            pick_safe = safe_location(current_pick)
            place_safe = safe_location(current_place)

            vis_frames.extend([
                pick_safe,
                current_pick,
                pick_safe,
                place_safe,
                current_place,
                place_safe
            ])

    print("Preview mode only")


# ==========================================
# 10. VISUALIZATION
# ==========================================

from compas_rhino import conversions
import Rhino.Geometry as rg

vis_planes = [
    conversions.frame_to_rhino(frame)
    for frame in vis_frames
]

print("Total visualized frames:",
      len(vis_planes))

print("Script enabled:",
      GENERATE_SCRIPT)
# ---------- end compas ----------
point_3 = Point(compas.vis_planes)
polyline = PolyLine(Vertices=point_3, Closed=False)
compas_draw_3 = COMPASDraw(cg=compas.vis_frames)  # -> rg; same code as draw
# Send to Robot!
list_item_3 = ListItem(List=compas_draw_3, Index=Slider(3, range=0..10), Wrap=True)
points = PointList(Points=compas.vis_planes, Size=Slider(7, range=0..100))
panel_3 = Panel(compas.script)

# ---- group: Send UR script to Robot!
py3_2 = Python3Script(script=compas.script, ip_address="169.254.130.206", send=Button())  # -> out, a; inputs script: String, ip_address: String, send: Boolean
# ---------- py3_2: Python ----------
import simple_comm as com

if send:
    com.send_script(script,ip_address)
# ---------- end py3_2 ----------
