# Grasshopper definition HR_brick_to_robot_slope_domino.ghx (Grasshopper 1.0.8)

# ---- group: This is needed only ONCE in the GH definition
enable_auto_reload = Python3Script()  # -> ok
# ---------- enable_auto_reload: Python ----------
"""
------------------------------
Using VS Code as Python editor
------------------------------

The simplest way to start using VS Code as our editor, is
to place our Python code in files located IN THE SAME FOLDER as our Grasshopper file.

After we have done that, we need 2 steps: 

1. Enable the COMPAS reloader on one component. This tells Grasshopper to watch for changes in the Pythoh files and reload if changed.
2. Every other component that uses Python code from external files needs to start with a method to ensure Grasshopper knows where to load the files from.

"""
# r: compas
# venv: mas-2627

from compas_rhino.devtools import DevTools
DevTools.enable_reloader()
# ---------- end enable_auto_reload ----------

# ---- group: slope
crv = Curve(<curve referenced from the Rhino model>)
slope = Python3Script(
    crv=crv,
    spacing=Slider(25, range=0..30),
    max_height=Slider(50, range=10..50),
    min_peak_height=Slider(24, range=0..100),
    min_height=Slider(0, range=0..50),
    num_peaks=Slider(2, range=0..10))  # -> out, slope_bricks, support_frames, brick_frames, layer_counts; inputs crv: Curve, spacing: Double, max_height: Double, min_peak_height: Double, min_height: Double, num_peaks: Int32
# ---------- slope: Python ----------
import os
import sys
from importlib import reload

# ====================================
# 1. IMPORT
# ====================================

path = ghenv.Component.OnPingDocument().FilePath
folder = os.path.dirname(path)

if folder not in sys.path:
    sys.path.append(folder)

import slope_design
reload(slope_design)

# ====================================
# 2. BRICK SETTINGS
# ====================================

BRICK_HEIGHT = 10.0

# ====================================
# 3. INPUT PARAMETERS
# ====================================

BRICK_GAP = float(spacing)

MAX_LAYERS = int(
    round(float(max_height) / BRICK_HEIGHT)
)

MIN_PEAK_LAYERS = int(
    round(float(min_peak_height) / BRICK_HEIGHT)
)

MIN_LAYERS = int(
    round(float(min_height) / BRICK_HEIGHT)
)

NUM_PEAKS = int(num_peaks)

# ====================================
# 4. VALIDATION
# ====================================

if crv is None:
    raise ValueError("Curve is missing")

if BRICK_GAP < 0:
    raise ValueError("Spacing must be >= 0")

if MAX_LAYERS < 1:
    raise ValueError("Maximum height must be >= 10 mm")

if not (
    0 <= MIN_LAYERS
    <= MIN_PEAK_LAYERS
    <= MAX_LAYERS
):
    raise ValueError(
        "Required: min_height <= "
        "min_peak_height <= max_height"
    )

if NUM_PEAKS < 1:
    raise ValueError("At least one peak required")

# ====================================
# 5. GENERATE SLOPE
# ====================================

(
    slope_bricks,
    support_frames,
    brick_frames,
    layer_counts
) = slope_design.generate_sloped_wall(
    crv,
    max_layers=MAX_LAYERS,
    min_layers=MIN_LAYERS,
    gap=BRICK_GAP,
    num_peaks=NUM_PEAKS,
    min_peak_layers=MIN_PEAK_LAYERS,
    min_connected_bricks=3
)

# ====================================
# 6. INFORMATION
# ====================================

print("=== SLOPE PARAMETERS ===")
print("Spacing:", BRICK_GAP, "mm")
print("Highest peak:", MAX_LAYERS * 10, "mm")
print("Lowest peak:", MIN_PEAK_LAYERS * 10, "mm")
print("Minimum valley:", MIN_LAYERS * 10, "mm")
print("Number of peaks:", NUM_PEAKS)

print("=== RESULTS ===")
print("Bricks per layer:", layer_counts)
print("Total bricks:", len(slope_bricks))
# ---------- end slope ----------

# ----
len = Length(Curve=crv)
# Generate Geometry
panel = Panel(len)
dominon = Python3Script(crv=crv, slope_bricks=slope.slope_bricks, domino_spacing=Slider(35, range=0..100), min_spacing=Slider(17, range=0..100))  # -> out, domino_bricks, domino_frames, domino_types, warnings; inputs crv: Curve, slope_bricks: list, domino_spacing: Double, min_spacing: Double
# ---------- dominon: Python ----------
import os
import sys
from importlib import reload

# =====================================
# 1. IMPORT MODULE
# =====================================

path = ghenv.Component.OnPingDocument().FilePath
folder = os.path.dirname(path)

if folder not in sys.path:
    sys.path.insert(0, folder)

import domino_design
reload(domino_design)

# =====================================
# 2. GENERATE DOMINOES
# =====================================

(
    domino_bricks,
    domino_frames,
    domino_types,
    warnings
) = domino_design.generate_dominoes(
    crv,
    slope_bricks,
    floor_spacing=float(domino_spacing),
    min_spacing=float(min_spacing)
)

# =====================================
# 3. INFORMATION
# =====================================

print("=== DOMINO GENERATION ===")
print("Total dominoes:", len(domino_bricks))
print("On supports:", domino_types.count("support"))
print("On floor:", domino_types.count("floor"))

for warning in warnings:
    print("WARNING:", warning)
# ---------- end dominon ----------
draw = COMPASDraw(cg=slope.slope_bricks)  # -> rg
#   port cg: The COMPAS geometry or datastructure to be drawn.
#   port rg: The Rhino geometry object.
# ---------- draw: Python ----------
# r: compas>=2.14.1
"""
Draws COMPAS geometry in Grasshopper.
"""

from typing import Any

import Grasshopper

from compas.scene import SceneObject


class CompasToRhinoGeometry(Grasshopper.Kernel.GH_ScriptInstance):
    def RunScript(self, cg):
        if not cg:
            return None

        return SceneObject(item=cg).draw()
# ---------- end draw ----------
preview = CustomPreview(
    Geometry=draw,
    Material={diffuse=RGB(221, 160, 221), emission=RGB(66, 48, 66), shine=0.5, specular=RGB(255, 255, 255), transparency=0})

# ----
# Measure work object
point = ValueList({"origin", "xaxis", "xypoint"}, selected="xypoint")
capture = Button()
capture_wobj = CaptureWobj(robot_ip="169.254.130.206", point_name=point, capture=capture)  # -> wobj_origin, wobj_xaxis, wobj_xypoint, info
# ---------- capture_wobj: Python ----------
"""
Capture the 3 points that define the work object (robot base) plane.

Jog the TCP to a point, pick its name (origin / xaxis / xypoint) and press capture.
The TCP position (robot base frame, mm) is saved to wobj_calibration.json next to
this .ghx file, so the points survive closing Grasshopper.
"""
import os
import sys
import json
import time

import scriptcontext as sc
import Rhino.Geometry as rg

NAMES = ["origin", "xaxis", "xypoint"]

gh_dir = os.path.dirname(ghenv.Component.OnPingDocument().FilePath)
src_dir = os.path.join(gh_dir, "src")
if src_dir not in sys.path:
    sys.path.append(src_dir)
import simple_comm as com

path = os.path.join(gh_dir, "wobj_calibration.json")

data = {}
if os.path.exists(path):
    with open(path) as f:
        data = json.load(f)

# keep the last status in sticky, so the message survives the button being released
status_key = "capture_status_" + str(ghenv.Component.InstanceGuid)

if capture:
    if point_name not in NAMES:
        sc.sticky[status_key] = "pick origin / xaxis / xypoint"
    else:
        try:
            x, y, z = list(com.listen_to_robot(robot_ip)["pose"])[:3]  # metres, robot base frame
            data[point_name] = [round(x * 1000, 2), round(y * 1000, 2), round(z * 1000, 2)]  # -> mm
            with open(path, "w") as f:
                json.dump(data, f, indent=2)
            sc.sticky[status_key] = "{} captured {}".format(point_name, time.strftime("%H:%M:%S"))
        except Exception as e:
            print(e)
            sc.sticky[status_key] = "robot not reachable"

ghenv.Component.Message = sc.sticky.get(status_key, "")

def pt(name):
    return rg.Point3d(*data[name]) if name in data else None

wobj_origin, wobj_xaxis, wobj_xypoint = pt("origin"), pt("xaxis"), pt("xypoint")
info = json.dumps(data, indent=2)
# ---------- end capture_wobj ----------
wobj_calibration = Panel(capture_wobj.info)

standing_place_frames = Python3Script(domino_frames=dominon.domino_frames)  # -> out, standing_place_frames, standing_place_planes; inputs domino_frames: list
# ---------- standing_place_frames: Python ----------
from compas.geometry import Frame, Point
import math

# Standing brick height
DOMINO_HEIGHT = 32.0

standing_place_frames = []

for frame in domino_frames:

    # Center of the top face
    top_point = Point(
        frame.point.x,
        frame.point.y,
        frame.point.z + DOMINO_HEIGHT / 2.0
    )

    # Horizontal orientation follows
    # the domino's local Y direction.
    ux = frame.yaxis.x
    uy = frame.yaxis.y

    length = math.sqrt(ux**2 + uy**2)

    if length < 0.000001:
        raise ValueError(
            "Invalid domino orientation"
        )

    ux = ux / length
    uy = uy / length

    # Construct a downward-facing frame
    target = Frame(
        top_point,
        [ux, uy, 0],
        [uy, -ux, 0]
    )

    standing_place_frames.append(target)

print(
    "Standing placement frames:",
    len(standing_place_frames)
)

from compas_rhino import conversions

standing_place_planes = [
    conversions.frame_to_rhino(frame)
    for frame in standing_place_frames
]
# ---------- end standing_place_frames ----------
draw_2 = COMPASDraw(cg=dominon.domino_bricks)  # -> rg; same code as draw
preview_2 = CustomPreview(Geometry=draw_2, Material=ColourSwatch(SwatchColor=RGB(0, 255, 255)))
fine_adjust_z_mm = Slider(5, range=-5..10)
# Transform from Rhino to Robot Space
fine_adjust_z_mm_2 = Slider(5, range=-5..10)
transform = Python3Script(
    way_planes=standing_place_frames.standing_place_frames,
    wobj_origin=capture_wobj.wobj_origin,
    wobj_xaxis=capture_wobj.wobj_xaxis,
    wobj_xypoint=capture_wobj.wobj_xypoint,
    z_safe_margin=fine_adjust_z_mm)  # -> out, transformed_frames; inputs way_planes: list, wobj_origin: Point3d, wobj_xaxis: Point3d, wobj_xypoint: Point3d, z_safe_margin: Double
# ---------- transform: Python ----------
from compas.geometry import Frame, Transformation, Translation, Vector
#in this step we transform our way planes to robot space
#the rhino co-ordinate system is rather abstract in the physical world
#the robot base plane assumed the base frame of robot is the origin
#but rhino does not know that
#thus we transform things from our design space(Rhino World XY) to Robot Base Plane that we measure

def set_robot_base(origin, xaxis, xypoint):
    """
    set a base plane representing the robot working object plane
    """
    robot_base = Frame(origin, xaxis - origin, xypoint - origin)
    print (robot_base)
    return (robot_base)

def rhino_to_robot_space(rhino_plane,robot_base_plane):
    """
    Transform the objects from Rhino world XY plane to robot work object plane
    """
    T_matrix = Transformation.from_frame_to_frame(Frame.worldXY(), robot_base_plane)
    robot_plane = rhino_plane.transformed(T_matrix)
    return robot_plane

def set_z_safe_margin(planes_to_adjust, safety_margin):
    adjusted = []
    T = Translation.from_vector(Vector(0, 0, safety_margin))
    for f in planes_to_adjust:
        adjusted.append(f.transformed(T))
    return adjusted

# ===== Robot base is set =====
robot_base =  set_robot_base(wobj_origin, wobj_xaxis, wobj_xypoint)

# ===== Set safety margin for Z height ======
safe_planes = set_z_safe_margin(way_planes, z_safe_margin)

# ===== Transforming the rhino planes into robot planes =====
transformed_frames = []
for plane in safe_planes: 
    transformed_frames.append(rhino_to_robot_space(plane, robot_base))
# ---------- end transform ----------
transform_2 = Python3Script(
    way_planes=slope.brick_frames,
    wobj_origin=capture_wobj.wobj_origin,
    wobj_xaxis=capture_wobj.wobj_xaxis,
    wobj_xypoint=capture_wobj.wobj_xypoint,
    z_safe_margin=fine_adjust_z_mm_2)  # -> out, transformed_frames; inputs way_planes: list, wobj_origin: Point3d, wobj_xaxis: Point3d, wobj_xypoint: Point3d, z_safe_margin: Double; same code as transform
list_item = ListItem(List=transform.transformed_frames, Index=0, Wrap=True)

# ----
# Measure pick up location
point_2 = ValueList({"origin", "xaxis", "xypoint"}, selected="xypoint")
capture_2 = Button()
capture_pick = CapturePick(robot_ip="169.254.130.206", point_name=point_2, capture=capture_2)  # -> origin, xaxis_pt, xy_pt, info
# ---------- capture_pick: Python ----------
"""
Capture the 3 points that define the pick frame at the brick pick-up location.

Jog the TCP to a point, pick its name (origin / xaxis / xypoint) and press capture.
The TCP position (robot base frame, mm) is saved to pick_calibration.json next to
this .ghx file, so the points survive closing Grasshopper.
"""
import os
import sys
import json
import time

import scriptcontext as sc
import Rhino.Geometry as rg

NAMES = ["origin", "xaxis", "xypoint"]

gh_dir = os.path.dirname(ghenv.Component.OnPingDocument().FilePath)
src_dir = os.path.join(gh_dir, "src")
if src_dir not in sys.path:
    sys.path.append(src_dir)
import simple_comm as com

path = os.path.join(gh_dir, "pick_calibration.json")

data = {}
if os.path.exists(path):
    with open(path) as f:
        data = json.load(f)

# keep the last status in sticky, so the message survives the button being released
status_key = "capture_status_" + str(ghenv.Component.InstanceGuid)

if capture:
    if point_name not in NAMES:
        sc.sticky[status_key] = "pick origin / xaxis / xypoint"
    else:
        try:
            x, y, z = list(com.listen_to_robot(robot_ip)["pose"])[:3]  # metres, robot base frame
            data[point_name] = [round(x * 1000, 2), round(y * 1000, 2), round(z * 1000, 2)]  # -> mm
            with open(path, "w") as f:
                json.dump(data, f, indent=2)
            sc.sticky[status_key] = "{} captured {}".format(point_name, time.strftime("%H:%M:%S"))
        except Exception as e:
            print(e)
            sc.sticky[status_key] = "robot not reachable"

ghenv.Component.Message = sc.sticky.get(status_key, "")

def pt(name):
    return rg.Point3d(*data[name]) if name in data else None

origin, xaxis_pt, xy_pt = pt("origin"), pt("xaxis"), pt("xypoint")
info = json.dumps(data, indent=2)
# ---------- end capture_pick ----------
py3 = Python3Script(origin=capture_pick.origin, xaxis_pt=capture_pick.xaxis_pt, xy_pt=capture_pick.xy_pt)  # -> out, pick_frame; inputs origin: Point3d, xaxis_pt: Point3d, xy_pt: Point3d
# ---------- py3: Python ----------
from compas.geometry import Frame, Point
from compas.geometry import Rotation

from compas_rhino.conversions import point_to_compas

origin = point_to_compas(origin)
xaxis_pt = point_to_compas(xaxis_pt)
xy_pt = point_to_compas(xy_pt)

#define pick frame
pick_frame = Frame(origin, origin - xaxis_pt ,  origin - xy_pt)
# ---------- end py3 ----------
pick_calibration = Panel(capture_pick.info)
compas_draw = COMPASDraw(cg=py3.pick_frame)  # -> rg; same code as draw

# ----
# Measure pick up location
point_3 = ValueList({"origin", "xaxis", "xypoint"}, selected="xypoint")
capture_3 = Button()
capture_pick_2 = CapturePick(robot_ip="169.254.130.206", point_name=point_3, capture=capture_3)  # -> origin, xaxis_pt, xy_pt, info; same code as capture_pick
py3_2 = Python3Script(origin=capture_pick_2.origin, xaxis_pt=capture_pick_2.xaxis_pt, xy_pt=capture_pick_2.xy_pt)  # -> out, pick_frame; inputs origin: Point3d, xaxis_pt: Point3d, xy_pt: Point3d; same code as py3
pick_calibration_2 = Panel(capture_pick_2.info)
compas_draw_2 = COMPASDraw(cg=py3_2.pick_frame)  # -> rg; same code as draw

list_item_2 = ListItem(List=transform_2.transformed_frames, Index=0, Wrap=True)
compas_draw_3 = COMPASDraw(cg=list_item)  # -> rg; same code as draw
compas_draw_4 = COMPASDraw(cg=list_item_2)  # -> rg; same code as draw
pt = Point(capture_pick.xaxis_pt)
pt_2 = Point(capture_pick.origin)
pt_3 = Point(capture_pick.xy_pt)
pt_4 = Point(capture_pick_2.xaxis_pt)
pt_5 = Point(capture_pick_2.origin)
pt_6 = Point(capture_pick_2.xy_pt)

# ----
# Measure and set TCP
panel_2 = Panel("-1.71")
pt_7 = ConstructPoint(XCoordinate=panel_2, YCoordinate="-0.9", ZCoordinate="77.83")

list_item_3 = ListItem(List=transform.transformed_frames, Index=0, Wrap=True)
number_slider = Slider(0.1, range=0..0.1)
number_slider_2 = Slider(0.1, range=0..0.1)
# Convert Planes to URScript
list_item_4 = ListItem(List=transform_2.transformed_frames, Index=0, Wrap=True)
compas = Python3Script(
    lying_way_frames=transform_2.transformed_frames,
    standing_way_frames=transform.transformed_frames,
    lying_pick_frame=py3.pick_frame,
    standing_pick_frame=py3_2.pick_frame,
    tcp_measured=pt_7,
    acceleration=number_slider,
    velocity=number_slider_2)  # -> out, lying_pick_planes, standing_pick_planes, lying_path_planes, standing_path_planes, lying_path_frames, standing_path_frames, lying_reload_steps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; inputs lying_way_frames: list, standing_way_frames: list, tcp_measured: Point3d, acceleration: Double, velocity: Double
# ---------- compas: Python ----------
from importlib import reload
import sys
import os
import math as m

import compas.geometry as cg
from compas_rhino import conversions


# ==========================================
# 1. IMPORT ROBOT MODULES
# ==========================================

path = ghenv.Component.OnPingDocument().FilePath
parentdir = os.path.dirname(path)
dire = os.path.join(parentdir, "src")

if dire not in sys.path:
    sys.path.insert(0, dire)

import simple_ur_script as ur
reload(ur)

import utils
reload(utils)

import simple_comm as com
reload(com)


# ==========================================
# 2. ROBOT SETTINGS
# ==========================================

IO = 4
SAFE_DIST = 100.0
sleep_time = 0.5

# Generate complete URScript
GENERATE_SCRIPT = True

# Operator confirmations
CONFIRM_BEFORE_START = True
CONFIRM_STAGE_CHANGE = True
CONFIRM_RELOAD = True

# Robot tool should approach vertically
# from above, in Robot BASE coordinates.
FIX_PICK_Z_DOWN = True
FIX_PLACE_Z_DOWN = True


# ==========================================
# 3. MEASURED DISPENSER STEPS
# ==========================================

# LYING P1:
# X=567.32, Y=355.12, Z=-50.67
#
# LYING P2:
# X=532.60, Y=352.69, Z=-50.35

LYING_DX = -34.72
LYING_DY = -2.43
LYING_DZ = 0.32

# STANDING P1:
# X=576.82, Y=227.08, Z=-37.33
#
# STANDING P2:
# X=566.17, Y=226.08, Z=-38.04

STANDING_DX = -10.65
STANDING_DY = -1.00
STANDING_DZ = -0.71


# ==========================================
# 4. DISPENSER SETTINGS
# ==========================================

# LYING: 5 x 4 x 2 = 40
L_COLS = 5
L_ROWS = 4
L_LAYERS = 2

# STANDING: 15 x 2 = 30
S_COLS = 15
S_ROWS = 2

# Temporary values - verify physically
L_ROW_PITCH = 15.0
S_ROW_PITCH = 15.0

L_ROW_SIGN = -1
S_ROW_SIGN = -1

# Lying layer height
L_LAYER_PITCH = 10.0

# The captured Lying reference is
# assumed to be on the BOTTOM layer.
L_P1_IS_BOTTOM = True

# Keep original order:
# Top layer first, bottom layer second.
LYING_TOP_FIRST = True

# Do not accumulate measured Z noise
USE_MEASURED_Z_STEP = False


# ==========================================
# 5. GRASSHOPPER INPUT HELPERS
# ==========================================

def flatten_input(value):

    if value is None:
        return []

    if hasattr(value, "Branches"):

        result = []

        for branch in value.Branches:
            result.extend(list(branch))

        return [
            item for item in result
            if item is not None
        ]

    if isinstance(value, (list, tuple)):

        return [
            item for item in value
            if item is not None
        ]

    return [value]


def is_compas_frame(frame):

    return (
        hasattr(frame, "point")
        and hasattr(frame, "xaxis")
        and hasattr(frame, "yaxis")
        and hasattr(frame, "zaxis")
    )


def normalize_single_frame(value, name):

    items = flatten_input(value)

    if len(items) != 1:
        raise ValueError(
            name + " must contain one Frame"
        )

    frame = items[0]

    if not is_compas_frame(frame):
        raise TypeError(
            name + " must be a COMPAS Frame"
        )

    return frame.copy()


def normalize_frame_list(value, name):

    items = flatten_input(value)

    result = []

    for frame in items:

        if not is_compas_frame(frame):
            raise TypeError(
                name + " has an invalid Frame"
            )

        result.append(frame.copy())

    return result


# ==========================================
# 6. FIX FRAME Z AXIS
# ==========================================

def fix_z_down(frame):

    corrected = frame.copy()
    was_flipped = False

    # Invert local X to reverse local Z.
    # This preserves the same origin.
    if corrected.zaxis.z > 0:

        corrected.xaxis = -corrected.xaxis
        was_flipped = True

    return corrected, was_flipped


def fix_frame_list(frames, label):

    corrected_frames = []
    flipped_count = 0

    for frame in frames:

        if FIX_PLACE_Z_DOWN:

            fixed, flipped = fix_z_down(frame)

            if flipped:
                flipped_count += 1

        else:
            fixed = frame.copy()

        corrected_frames.append(fixed)

    print(
        label,
        "place frames flipped:",
        flipped_count,
        "/",
        len(frames)
    )

    return corrected_frames


# ==========================================
# 7. MEASURED DISPENSER DIRECTION
# ==========================================

def measured_direction(dx, dy):

    pitch = m.sqrt(
        dx * dx + dy * dy
    )

    if pitch < 0.000001:
        raise ValueError(
            "Invalid measured step"
        )

    across = cg.Vector(
        -dy / pitch,
        dx / pitch,
        0
    )

    return across, pitch


# ==========================================
# 8. GENERATE PICKUP GRID
# ==========================================

def generate_grid(
    reference,
    cols,
    rows,
    layers,
    dx,
    dy,
    dz,
    row_pitch,
    row_sign,
    layer_pitch,
    p1_is_bottom,
    top_first
):

    across, pitch = measured_direction(
        dx, dy
    )

    positions = []

    reference = reference.copy()

    # Fix pickup tool orientation
    if FIX_PICK_Z_DOWN:
        reference, _ = fix_z_down(reference)

    # Choose vertical pickup sequence
    if top_first:
        layer_order = range(
            layers - 1, -1, -1
        )
    else:
        layer_order = range(layers)

    for layer in layer_order:

        for row in range(rows):

            for col in range(cols):

                frame = reference.copy()

                # Measured P1 -> P2 direction
                x = (
                    reference.point.x
                    + col * dx
                    + row * row_pitch
                    * row_sign * across.x
                )

                y = (
                    reference.point.y
                    + col * dy
                    + row * row_pitch
                    * row_sign * across.y
                )

                # Layer height
                if p1_is_bottom:
                    layer_offset = (
                        layer * layer_pitch
                    )
                else:
                    layer_offset = (
                        layer - (layers - 1)
                    ) * layer_pitch

                z = (
                    reference.point.z
                    + layer_offset
                )

                if USE_MEASURED_Z_STEP:
                    z += col * dz

                frame.point = cg.Point(
                    x, y, z
                )

                positions.append(frame)

    return positions, pitch


# ==========================================
# 9. READ GRASSHOPPER INPUTS
# ==========================================

lying_reference = normalize_single_frame(
    lying_pick_frame,
    "lying_pick_frame"
)

standing_reference = normalize_single_frame(
    standing_pick_frame,
    "standing_pick_frame"
)

lying_places_raw = normalize_frame_list(
    lying_way_frames,
    "lying_way_frames"
)

standing_places_raw = normalize_frame_list(
    standing_way_frames,
    "standing_way_frames"
)

if not lying_places_raw:
    raise ValueError(
        "Lying placement frames are missing"
    )

if not standing_places_raw:
    raise ValueError(
        "Standing placement frames are missing"
    )

if tcp_measured is None:
    raise ValueError(
        "TCP measurement is missing"
    )

if acceleration is None or velocity is None:
    raise ValueError(
        "Robot speed inputs are missing"
    )

if float(acceleration) <= 0:
    raise ValueError(
        "Acceleration must be positive"
    )

if float(velocity) <= 0:
    raise ValueError(
        "Velocity must be positive"
    )


# ==========================================
# 10. FIX PLACE FRAME ORIENTATIONS
# ==========================================

lying_places = fix_frame_list(
    lying_places_raw,
    "LYING"
)

standing_places = fix_frame_list(
    standing_places_raw,
    "STANDING"
)


# ==========================================
# 11. LYING PICKUP FRAMES
# ==========================================

lying_picks, lying_pitch = generate_grid(
    lying_reference,
    L_COLS,
    L_ROWS,
    L_LAYERS,
    LYING_DX,
    LYING_DY,
    LYING_DZ,
    L_ROW_PITCH,
    L_ROW_SIGN,
    L_LAYER_PITCH,
    L_P1_IS_BOTTOM,
    LYING_TOP_FIRST
)


# ==========================================
# 12. STANDING PICKUP FRAMES
# ==========================================

standing_picks, standing_pitch = generate_grid(
    standing_reference,
    S_COLS,
    S_ROWS,
    1,
    STANDING_DX,
    STANDING_DY,
    STANDING_DZ,
    S_ROW_PITCH,
    S_ROW_SIGN,
    0.0,
    True,
    True
)


# ==========================================
# 13. FRAME DIAGNOSTICS
# ==========================================

def print_frame_info(name, frame):

    p = frame.point
    z = frame.zaxis

    print(
        name,
        "Point:",
        round(p.x, 2),
        round(p.y, 2),
        round(p.z, 2)
    )

    print(
        name,
        "Z axis:",
        round(z.x, 3),
        round(z.y, 3),
        round(z.z, 3)
    )


def compare_pair(name, pick, place):

    pick_z = pick.zaxis
    place_z = place.zaxis

    dot = (
        pick_z.x * place_z.x
        + pick_z.y * place_z.y
        + pick_z.z * place_z.z
    )

    print(
        name,
        "Pick/Place Z dot:",
        round(dot, 4)
    )

    if pick_z.z > -0.7:
        print(
            "WARNING:",
            name,
            "pick is not near vertical Z-down"
        )

    if place_z.z > -0.7:
        print(
            "WARNING:",
            name,
            "place is not near vertical Z-down"
        )


print("========== FRAME CHECK ==========")

print_frame_info(
    "LYING REFERENCE",
    lying_reference
)

print_frame_info(
    "LYING FIRST PICK",
    lying_picks[0]
)

print_frame_info(
    "LYING FIRST PLACE",
    lying_places[0]
)

print_frame_info(
    "STANDING REFERENCE",
    standing_reference
)

print_frame_info(
    "STANDING FIRST PICK",
    standing_picks[0]
)

print_frame_info(
    "STANDING FIRST PLACE",
    standing_places[0]
)

compare_pair(
    "LYING",
    lying_picks[0],
    lying_places[0]
)

compare_pair(
    "STANDING",
    standing_picks[0],
    standing_places[0]
)

print(
    "LYING first pick minus reference Z:",
    round(
        lying_picks[0].point.z
        - lying_reference.point.z,
        3
    ),
    "mm"
)

print("=================================")


# ==========================================
# 14. SHARED TRAVEL HEIGHT
# ==========================================

all_frames = (
    lying_picks
    + standing_picks
    + lying_places
    + standing_places
)

TRAVEL_Z = max(
    frame.point.z
    for frame in all_frames
) + SAFE_DIST


def safe_location(frame):

    safe = frame.copy()

    safe.point = cg.Point(
        frame.point.x,
        frame.point.y,
        TRAVEL_Z
    )

    return safe


# ==========================================
# 15. PICKUP BRICK
# ==========================================

def pickup_brick(script_text, pick_frame):

    safe = safe_location(pick_frame)

    script_text += ur.move_l(
        safe,
        acceleration,
        velocity
    )

    script_text += ur.move_l(
        pick_frame,
        acceleration,
        velocity
    )

    # Vacuum ON
    script_text += ur.set_digital_out(
        IO, True
    )

    script_text += ur.sleep(sleep_time)

    # Retract
    script_text += ur.move_l(
        safe,
        acceleration,
        velocity
    )

    return script_text


# ==========================================
# 16. PLACE BRICK
# ==========================================

def place_brick(script_text, place_frame):

    safe = safe_location(place_frame)

    script_text += ur.move_l(
        safe,
        acceleration,
        velocity
    )

    script_text += ur.move_l(
        place_frame,
        acceleration,
        velocity
    )

    # Vacuum OFF
    script_text += ur.set_digital_out(
        IO, False
    )

    script_text += ur.sleep(sleep_time)

    # Retract
    script_text += ur.move_l(
        safe,
        acceleration,
        velocity
    )

    return script_text


# ==========================================
# 17. OPERATOR CONFIRMATION
# ==========================================

def add_confirmation(text, message, title):

    popup_line = (
        'popup("{}", title="{}", '
        'warning=True, blocking=True)\n'
    ).format(message, title)

    return text + popup_line


# ==========================================
# 18. PROGRAM HEADER
# ==========================================

def start_program(stage):

    text = ""

    text += ur.set_tcp_by_angles(
        tcp_measured.X,
        tcp_measured.Y,
        tcp_measured.Z,
        m.radians(0),
        m.radians(0),
        m.radians(0)
    )

    text += ur.set_digital_out(
        IO, False
    )

    if CONFIRM_BEFORE_START:

        text = add_confirmation(
            text,
            "Check calibration and robot area",
            stage + " preflight"
        )

    return text


# ==========================================
# 19. COMPLETE ONE STAGE
# ==========================================

def add_stage(
    text,
    pick_frames,
    place_frames,
    stage
):

    capacity = len(pick_frames)

    for i, place in enumerate(place_frames):

        pick_index = i % capacity

        # Dispenser reload
        if i > 0 and pick_index == 0:

            text += ur.set_digital_out(
                IO, False
            )

            if CONFIRM_RELOAD:

                text = add_confirmation(
                    text,
                    "Refill " + stage
                    + " dispenser and check area",
                    stage + " reload"
                )

        pick = pick_frames[pick_index]

        text = pickup_brick(
            text,
            pick
        )

        text = place_brick(
            text,
            place
        )

    return text


# ==========================================
# 20. PROGRAM FOOTER
# ==========================================

def finish_program(text):

    text += ur.set_digital_out(
        IO, False
    )

    return com.concatenate_script(text)


# ==========================================
# 21. RELOAD CALCULATION
# ==========================================

def get_reload_steps(total, capacity):

    result = []

    for i in range(1, total):

        if i % capacity == 0:
            result.append(i + 1)

    return result


lying_reload_steps = get_reload_steps(
    len(lying_places),
    len(lying_picks)
)

standing_reload_steps = get_reload_steps(
    len(standing_places),
    len(standing_picks)
)


# ==========================================
# 22. PATH PREVIEW
# ==========================================

def create_preview(picks, places):

    result = []

    for i, place in enumerate(places):

        pick = picks[i % len(picks)]

        result.extend([
            safe_location(pick),
            pick,
            safe_location(pick),
            safe_location(place),
            place,
            safe_location(place)
        ])

    return result


lying_path_frames = create_preview(
    lying_picks,
    lying_places
)

standing_path_frames = create_preview(
    standing_picks,
    standing_places
)


# ==========================================
# 23. GENERATE URSCRIPTS
# ==========================================

lying_script = ""
standing_script = ""
script = ""

if GENERATE_SCRIPT:

    # LYING ONLY
    lying_text = start_program("LYING")

    lying_text = add_stage(
        lying_text,
        lying_picks,
        lying_places,
        "LYING"
    )

    lying_script = finish_program(
        lying_text
    )

    # STANDING ONLY
    standing_text = start_program("STANDING")

    standing_text = add_stage(
        standing_text,
        standing_picks,
        standing_places,
        "STANDING"
    )

    standing_script = finish_program(
        standing_text
    )

    # COMBINED SCRIPT
    combined_text = start_program("COMBINED")

    combined_text = add_stage(
        combined_text,
        lying_picks,
        lying_places,
        "LYING"
    )

    combined_text += ur.set_digital_out(
        IO, False
    )

    if CONFIRM_STAGE_CHANGE:

        combined_text = add_confirmation(
            combined_text,
            "Verify lying wall before standing",
            "STANDING phase"
        )

    combined_text = add_stage(
        combined_text,
        standing_picks,
        standing_places,
        "STANDING"
    )

    script = finish_program(
        combined_text
    )


# ==========================================
# 24. RHINO VISUALIZATION
# ==========================================

lying_pick_planes = [
    conversions.frame_to_rhino(f)
    for f in lying_picks
]

standing_pick_planes = [
    conversions.frame_to_rhino(f)
    for f in standing_picks
]

lying_path_planes = [
    conversions.frame_to_rhino(f)
    for f in lying_path_frames
]

standing_path_planes = [
    conversions.frame_to_rhino(f)
    for f in standing_path_frames
]


# ==========================================
# 25. FINAL REPORT
# ==========================================

print("========== ROBOT REPORT ==========")

print("Lying pickups:", len(lying_picks))
print("Standing pickups:", len(standing_picks))

print("Lying placements:", len(lying_places))
print("Standing placements:", len(standing_places))

print("Lying pitch:", round(lying_pitch, 3))
print("Standing pitch:", round(standing_pitch, 3))

print("Lying reload:", lying_reload_steps)
print("Standing reload:", standing_reload_steps)

print("TRAVEL_Z:", round(TRAVEL_Z, 3))

print("Lying URScript length:", len(lying_script))
print("Standing URScript length:", len(standing_script))
print("Combined URScript length:", len(script))

print("==================================")
# ---------- end compas ----------
deplane = DeconstructPlane(Plane=compas.lying_path_planes)  # -> Origin, XAxis, YAxis, ZAxis
deplane_2 = DeconstructPlane(Plane=compas.standing_path_planes)  # -> Origin, XAxis, YAxis, ZAxis
polyline = PolyLine(Vertices=flatten(deplane.Origin), Closed=False)
polyline_2 = PolyLine(Vertices=flatten(deplane_2.Origin), Closed=False)

# ---- group: Send UR script to Robot!
py3_3 = Python3Script(script=compas.script, ip_address="169.254.130.206", send=Button())  # -> out, a; inputs script: String, ip_address: String, send: Boolean
# ---------- py3_3: Python ----------
import simple_comm as com

if send:
    com.send_script(script,ip_address)
# ---------- end py3_3 ----------

# ----
preview_3 = CustomPreview(
    Geometry=polyline_2,
    Material={diffuse=RGB(221, 160, 221), emission=RGB(66, 48, 66), shine=0.5, specular=RGB(255, 255, 255), transparency=0})
preview_4 = CustomPreview(Geometry=polyline, Material=ColourSwatch(SwatchColor=RGB(15, 0, 255)))
# Send to Robot!
panel_3 = Panel(compas.script)
