# Grasshopper definition HR_brick_to_robot_slope_domino_push first brick_PS environment.ghx (Grasshopper 1.0.8)

# ---- group: This is needed only ONCE in the GH definition
enable_auto_reload = Python3Script()  # -> ok
# ---------- enable_auto_reload: Python ----------
"""
------------------------------
Using VS Code as Python editor
------------------------------

The simplest way to start using VS Code as our editor, is
to place our Python code in files located IN THE SAME FOLDER as our Grasshopper file.

After we have done that, we need 2 steps: 

1. Enable the COMPAS reloader on one component. This tells Grasshopper to watch for changes in the Pythoh files and reload if changed.
2. Every other component that uses Python code from external files needs to start with a method to ensure Grasshopper knows where to load the files from.

"""
# r: compas
# venv: mas-2627

from compas_rhino.devtools import DevTools
DevTools.enable_reloader()
# ---------- end enable_auto_reload ----------

# ----
# Generate Geometry
number_slider = Slider(25, range=0..30)
crv = Curve(<curve referenced from the Rhino model>)
slope = Python3Script(
    crv=crv,
    spacing=number_slider,
    max_height=Slider(50, range=10..50),
    min_peak_height=Slider(19, range=0..100),
    min_height=Slider(0, range=0..50),
    num_peaks=Slider(1, range=0..10))  # -> out, slope_bricks, support_frames, brick_frames, layer_counts; inputs crv: Curve, spacing: Double, max_height: Double, min_peak_height: Double, min_height: Double, num_peaks: Int32
# ---------- slope: Python ----------
import os
import sys
from importlib import reload

# ====================================
# 1. IMPORT
# ====================================

path = ghenv.Component.OnPingDocument().FilePath
folder = os.path.dirname(path)

if folder not in sys.path:
    sys.path.append(folder)

import slope_design
reload(slope_design)

# ====================================
# 2. BRICK SETTINGS
# ====================================

BRICK_HEIGHT = 10.0

# ====================================
# 3. INPUT PARAMETERS
# ====================================

BRICK_GAP = float(spacing)

MAX_LAYERS = int(
    round(float(max_height) / BRICK_HEIGHT)
)

MIN_PEAK_LAYERS = int(
    round(float(min_peak_height) / BRICK_HEIGHT)
)

MIN_LAYERS = int(
    round(float(min_height) / BRICK_HEIGHT)
)

NUM_PEAKS = int(num_peaks)

# ====================================
# 4. VALIDATION
# ====================================

if crv is None:
    raise ValueError("Curve is missing")

if BRICK_GAP < 0:
    raise ValueError("Spacing must be >= 0")

if MAX_LAYERS < 1:
    raise ValueError("Maximum height must be >= 10 mm")

if not (
    0 <= MIN_LAYERS
    <= MIN_PEAK_LAYERS
    <= MAX_LAYERS
):
    raise ValueError(
        "Required: min_height <= "
        "min_peak_height <= max_height"
    )

if NUM_PEAKS < 1:
    raise ValueError("At least one peak required")

# ====================================
# 5. GENERATE SLOPE
# ====================================

(
    slope_bricks,
    support_frames,
    brick_frames,
    layer_counts
) = slope_design.generate_sloped_wall(
    crv,
    max_layers=MAX_LAYERS,
    min_layers=MIN_LAYERS,
    gap=BRICK_GAP,
    num_peaks=NUM_PEAKS,
    min_peak_layers=MIN_PEAK_LAYERS,
    min_connected_bricks=3
)

# ====================================
# 6. INFORMATION
# ====================================

print("=== SLOPE PARAMETERS ===")
print("Spacing:", BRICK_GAP, "mm")
print("Highest peak:", MAX_LAYERS * 10, "mm")
print("Lowest peak:", MIN_PEAK_LAYERS * 10, "mm")
print("Minimum valley:", MIN_LAYERS * 10, "mm")
print("Number of peaks:", NUM_PEAKS)

print("=== RESULTS ===")
print("Bricks per layer:", layer_counts)
print("Total bricks:", len(slope_bricks))
# ---------- end slope ----------

len = Length(Curve=crv)
panel = Panel(len)
draw = COMPASDraw(cg=slope.slope_bricks)  # -> rg
#   port cg: The COMPAS geometry or datastructure to be drawn.
#   port rg: The Rhino geometry object.
# ---------- draw: Python ----------
# r: compas>=2.14.1
"""
Draws COMPAS geometry in Grasshopper.
"""

from typing import Any

import Grasshopper

from compas.scene import SceneObject


class CompasToRhinoGeometry(Grasshopper.Kernel.GH_ScriptInstance):
    def RunScript(self, cg):
        if not cg:
            return None

        return SceneObject(item=cg).draw()
# ---------- end draw ----------
preview = CustomPreview(
    Geometry=draw,
    Material={diffuse=RGB(221, 160, 221), emission=RGB(66, 48, 66), shine=0.5, specular=RGB(255, 255, 255), transparency=0})
draw_2 = COMPASDraw(cg=slope.brick_frames)  # -> rg; same code as draw
preview_2 = CustomPreview(
    Geometry=draw_2,
    Material={diffuse=RGB(221, 160, 221), emission=RGB(66, 48, 66), shine=0.5, specular=RGB(255, 255, 255), transparency=0})

# ----
# Measure work object
point = ValueList({"origin", "xaxis", "xypoint"}, selected="xypoint")
capture = Button()
capture_wobj = CaptureWobj(robot_ip="169.254.130.206", point_name=point, capture=capture)  # -> wobj_origin, wobj_xaxis, wobj_xypoint, info
# ---------- capture_wobj: Python ----------
"""
Capture the 3 points that define the work object (robot base) plane.

Jog the TCP to a point, pick its name (origin / xaxis / xypoint) and press capture.
The TCP position (robot base frame, mm) is saved to wobj_calibration.json next to
this .ghx file, so the points survive closing Grasshopper.
"""
import os
import sys
import json
import time

import scriptcontext as sc
import Rhino.Geometry as rg

NAMES = ["origin", "xaxis", "xypoint"]

gh_dir = os.path.dirname(ghenv.Component.OnPingDocument().FilePath)
src_dir = os.path.join(gh_dir, "src")
if src_dir not in sys.path:
    sys.path.append(src_dir)
import simple_comm as com

path = os.path.join(gh_dir, "wobj_calibration.json")

data = {}
if os.path.exists(path):
    with open(path) as f:
        data = json.load(f)

# keep the last status in sticky, so the message survives the button being released
status_key = "capture_status_" + str(ghenv.Component.InstanceGuid)

if capture:
    if point_name not in NAMES:
        sc.sticky[status_key] = "pick origin / xaxis / xypoint"
    else:
        try:
            x, y, z = list(com.listen_to_robot(robot_ip)["pose"])[:3]  # metres, robot base frame
            data[point_name] = [round(x * 1000, 2), round(y * 1000, 2), round(z * 1000, 2)]  # -> mm
            with open(path, "w") as f:
                json.dump(data, f, indent=2)
            sc.sticky[status_key] = "{} captured {}".format(point_name, time.strftime("%H:%M:%S"))
        except Exception as e:
            print(e)
            sc.sticky[status_key] = "robot not reachable"

ghenv.Component.Message = sc.sticky.get(status_key, "")

def pt(name):
    return rg.Point3d(*data[name]) if name in data else None

wobj_origin, wobj_xaxis, wobj_xypoint = pt("origin"), pt("xaxis"), pt("xypoint")
info = json.dumps(data, indent=2)
# ---------- end capture_wobj ----------
wobj_calibration = Panel(capture_wobj.info)

fine_adjust_z_mm = Slider(0.5, range=-5..10)
# Transform from Rhino to Robot Space
fine_adjust_z_mm_2 = Slider(5, range=-5..10)

number_slider_2 = Slider(43, range=0..100)

number_slider_3 = Slider(23, range=0..100)

pt = ConstructPoint(XCoordinate="582.81", YCoordinate="195.91", ZCoordinate=number_slider_2)

pt_2 = ConstructPoint(XCoordinate="587.87", YCoordinate="196.01", ZCoordinate=number_slider_2)

pt_3 = ConstructPoint(XCoordinate="582.89", YCoordinate="188.91", ZCoordinate=number_slider_2)

# ----
# Measure pick up location
point_2 = ValueList({"origin", "xaxis", "xypoint"}, selected="xypoint")
capture_2 = Button()
capture_pick = CapturePick(robot_ip="169.254.130.206", point_name=point_2, capture=capture_2)  # -> origin, xaxis_pt, xy_pt, info
# ---------- capture_pick: Python ----------
"""
Capture the 3 points that define the pick frame at the brick pick-up location.

Jog the TCP to a point, pick its name (origin / xaxis / xypoint) and press capture.
The TCP position (robot base frame, mm) is saved to pick_calibration.json next to
this .ghx file, so the points survive closing Grasshopper.
"""
import os
import sys
import json
import time

import scriptcontext as sc
import Rhino.Geometry as rg

NAMES = ["origin", "xaxis", "xypoint"]

gh_dir = os.path.dirname(ghenv.Component.OnPingDocument().FilePath)
src_dir = os.path.join(gh_dir, "src")
if src_dir not in sys.path:
    sys.path.append(src_dir)
import simple_comm as com

path = os.path.join(gh_dir, "pick_calibration.json")

data = {}
if os.path.exists(path):
    with open(path) as f:
        data = json.load(f)

# keep the last status in sticky, so the message survives the button being released
status_key = "capture_status_" + str(ghenv.Component.InstanceGuid)

if capture:
    if point_name not in NAMES:
        sc.sticky[status_key] = "pick origin / xaxis / xypoint"
    else:
        try:
            x, y, z = list(com.listen_to_robot(robot_ip)["pose"])[:3]  # metres, robot base frame
            data[point_name] = [round(x * 1000, 2), round(y * 1000, 2), round(z * 1000, 2)]  # -> mm
            with open(path, "w") as f:
                json.dump(data, f, indent=2)
            sc.sticky[status_key] = "{} captured {}".format(point_name, time.strftime("%H:%M:%S"))
        except Exception as e:
            print(e)
            sc.sticky[status_key] = "robot not reachable"

ghenv.Component.Message = sc.sticky.get(status_key, "")

def pt(name):
    return rg.Point3d(*data[name]) if name in data else None

origin, xaxis_pt, xy_pt = pt("origin"), pt("xaxis"), pt("xypoint")
info = json.dumps(data, indent=2)
# ---------- end capture_pick ----------
py3 = Python3Script(origin=pt, xaxis_pt=pt_2, xy_pt=pt_3)  # -> out, pick_frame; inputs origin: Point3d, xaxis_pt: Point3d, xy_pt: Point3d
# ---------- py3: Python ----------
from compas.geometry import Frame, Point
from compas.geometry import Rotation

from compas_rhino.conversions import point_to_compas

origin = point_to_compas(origin)
xaxis_pt = point_to_compas(xaxis_pt)
xy_pt = point_to_compas(xy_pt)

#define pick frame
pick_frame = Frame(origin, origin - xaxis_pt ,  origin - xy_pt)
# ---------- end py3 ----------
pick_calibration = Panel(capture_pick.info)
compas_draw = COMPASDraw(cg=py3.pick_frame)  # -> rg; same code as draw

pt_4 = Point(capture_pick.xaxis_pt)
pt_5 = Point(capture_pick.origin)
pt_6 = Point(capture_pick.xy_pt)

panel_2 = Panel("22")
pt_7 = ConstructPoint(XCoordinate="572.15", YCoordinate="354.27", ZCoordinate=number_slider_3)

pt_8 = ConstructPoint(XCoordinate="586.98", YCoordinate="353.48", ZCoordinate=number_slider_3)

pt_9 = ConstructPoint(XCoordinate="571.8", YCoordinate="346.96", ZCoordinate=number_slider_3)

# ----
# Measure pick up location
point_3 = ValueList({"origin", "xaxis", "xypoint"}, selected="xypoint")
capture_3 = Button()
capture_pick_2 = CapturePick(robot_ip="169.254.130.206", point_name=point_3, capture=capture_3)  # -> origin, xaxis_pt, xy_pt, info; same code as capture_pick
py3_2 = Python3Script(origin=pt_7, xaxis_pt=pt_8, xy_pt=pt_9)  # -> out, pick_frame; inputs origin: Point3d, xaxis_pt: Point3d, xy_pt: Point3d; same code as py3
pick_calibration_2 = Panel(capture_pick_2.info)
compas_draw_2 = COMPASDraw(cg=py3_2.pick_frame)  # -> rg; same code as draw

pt_10 = Point(capture_pick_2.xaxis_pt)
pt_11 = Point(capture_pick_2.origin)
pt_12 = Point(capture_pick_2.xy_pt)

# ----
# Measure and set TCP
panel_5 = Panel("-1.71")
pt_13 = ConstructPoint(XCoordinate=panel_5, YCoordinate="-0.9", ZCoordinate="77.83")

number_slider_4 = Slider(0.6, range=0..1)
number_slider_5 = Slider(0.6, range=0..1)

curve_b = Curve(graft(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))
# Bricks from any surface
curve = Curve(graft(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))
gap = Slider(20, range=0..50)
loft = Loft(
    Curves=[curve, curve_b],
    Options={Adjust=False, Closed=False, LoftEnds=0, LoftSimp=0, LoftType=0, Rebuild=10, Refit=0.01})

brep = Brep(loft)

brick_wall = Python3Script(srf=brep, num_layers=Slider(10, range=0..30), gap=gap)  # -> bricks, geometries, frames; inputs srf: Surface, num_layers: Int32, gap: Double
# ---------- brick_wall: Python ----------
# r: compas
# venv: mas-2627
from compas_rhino.devtools import DevTools
DevTools.ensure_path()

import Rhino.Geometry as rg
from compas.geometry import Point, Frame, cross_vectors
from brick_wall import Brick

bricks = []
geometries = []
frames = []

pitch = Brick.LENGTH + float(gap)
if pitch <= 0:
    raise ValueError('Brick.LENGTH + gap must be positive')

brep = srf.ToBrep() if hasattr(srf, 'ToBrep') else srf
bbox = brep.GetBoundingBox(True)
bottom = bbox.Min.Z
available = max(0, int((bbox.Max.Z - bottom) / Brick.HEIGHT))
count = min(max(0, int(num_layers)), available)

layers = []
for i in range(count):
    z = bottom + (i + 0.5) * Brick.HEIGHT
    plane = rg.Plane(rg.Point3d(0, 0, z), rg.Vector3d(0, 0, 1))
    result = rg.Intersect.Intersection.BrepPlane(brep, plane, 0.01)
    if result is None:
        continue
    ok, contours, _ = result
    if ok and contours:
        for curve in contours:
            if curve.GetLength() >= Brick.LENGTH:
                layers.append((i, curve.DuplicateCurve()))

if layers:
    # Fix the number-of-bricks parity across courses.
    # Opposite parity means the centres alternate by half a module
    # when the contours have similar lengths.
    lowest = min(i for i, _ in layers)
    base = max((c for i, c in layers if i == lowest),
               key=lambda c: c.GetLength())
    base_max = int((base.GetLength() - Brick.LENGTH) / pitch) + 1
    base_parity = base_max % 2

    for i, curve in layers:
        if curve.PointAtStart.X > curve.PointAtEnd.X:
            curve.Reverse()
        L = curve.GetLength()
        max_n = int((L - Brick.LENGTH) / pitch) + 1
        if max_n < 1:
            continue

        # Even courses use the base count parity; odd courses
        # use the opposite parity. This is the critical difference
        # from the previous (broken) centring approach.
        wanted_parity = (base_parity + i - lowest) % 2
        n = max_n
        if n % 2 != wanted_parity:
            n -= 1
        if n < 1:
            continue

        occupied = Brick.LENGTH + (n - 1) * pitch
        first = (L - occupied) / 2.0 + Brick.LENGTH / 2.0

        for j in range(n):
            distance = first + j * pitch
            ok, t = curve.LengthParameter(distance)
            if not ok:
                continue
            p = curve.PointAt(t)
            v = curve.TangentAt(t)
            direction = [v.X, v.Y, 0]
            if direction[0]**2 + direction[1]**2 <= 1e-10:
                continue
            normal = cross_vectors(direction, [0, 0, 1])
            frame = Frame(Point(p.X, p.Y, p.Z),
                          xaxis=direction, yaxis=normal)
            bricks.append(Brick(frame))

for brick in bricks:
    geometries.append(brick.draw())
    frames.append(brick.get_pick_frame())
# ---------- end brick_wall ----------
compas_draw_3 = COMPASDraw(cg=brick_wall.geometries)  # -> rg; same code as draw
compas_draw_4 = COMPASDraw(cg=brick_wall.frames)  # -> rg; same code as draw

preview_3 = CustomPreview(Geometry=compas_draw_3, Material=ColourSwatch(SwatchColor=RGB(117, 167, 255)))
preview_4 = CustomPreview(Geometry=compas_draw_4, Material=ColourSwatch(SwatchColor=RGB(230, 255, 255)))
dominon = Python3Script(
    crv=curve_b,
    slope_bricks=brick_wall.geometries,
    domino_spacing=Slider(21, range=0..100),
    min_spacing=Slider(17, range=0..100))  # -> out, domino_bricks, domino_frames, domino_types, warnings; inputs crv: Curve, slope_bricks: list, domino_spacing: Double, min_spacing: Double
# ---------- dominon: Python ----------
import os
import sys
from importlib import reload

# =====================================
# 1. IMPORT MODULE
# =====================================

path = ghenv.Component.OnPingDocument().FilePath
folder = os.path.dirname(path)

if folder not in sys.path:
    sys.path.insert(0, folder)

import domino_design
reload(domino_design)

# =====================================
# 2. GENERATE DOMINOES
# =====================================

(
    domino_bricks,
    domino_frames,
    domino_types,
    warnings
) = domino_design.generate_dominoes(
    crv,
    slope_bricks,
    floor_spacing=float(domino_spacing),
    min_spacing=float(min_spacing)
)

# =====================================
# 3. INFORMATION
# =====================================

print("=== DOMINO GENERATION ===")
print("Total dominoes:", len(domino_bricks))
print("On supports:", domino_types.count("support"))
print("On floor:", domino_types.count("floor"))

for warning in warnings:
    print("WARNING:", warning)
# ---------- end dominon ----------
standing_place_frames = Python3Script(domino_frames=dominon.domino_frames)  # -> out, standing_place_frames, standing_place_planes; inputs domino_frames: list
# ---------- standing_place_frames: Python ----------
from compas.geometry import Frame, Point
import math

# Standing brick height
DOMINO_HEIGHT = 32.0

standing_place_frames = []

for frame in domino_frames:

    # Center of the top face
    top_point = Point(
        frame.point.x,
        frame.point.y,
        frame.point.z + DOMINO_HEIGHT / 2.0
    )

    # Horizontal orientation follows
    # the domino's local Y direction.
    ux = frame.yaxis.x
    uy = frame.yaxis.y

    length = math.sqrt(ux**2 + uy**2)

    if length < 0.000001:
        raise ValueError(
            "Invalid domino orientation"
        )

    ux = ux / length
    uy = uy / length

    # Construct a downward-facing frame
    target = Frame(
        top_point,
        [ux, uy, 0],
        [uy, -ux, 0]
    )

    standing_place_frames.append(target)

print(
    "Standing placement frames:",
    len(standing_place_frames)
)

from compas_rhino import conversions

standing_place_planes = [
    conversions.frame_to_rhino(frame)
    for frame in standing_place_frames
]
# ---------- end standing_place_frames ----------
draw_3 = COMPASDraw(cg=dominon.domino_bricks)  # -> rg; same code as draw
preview_5 = CustomPreview(Geometry=draw_3, Material=ColourSwatch(SwatchColor=RGB(0, 255, 255)))
transform = Python3Script(
    way_planes=standing_place_frames.standing_place_frames,
    wobj_origin=capture_wobj.wobj_origin,
    wobj_xaxis=capture_wobj.wobj_xaxis,
    wobj_xypoint=capture_wobj.wobj_xypoint,
    z_safe_margin=fine_adjust_z_mm)  # -> out, transformed_frames; inputs way_planes: list, wobj_origin: Point3d, wobj_xaxis: Point3d, wobj_xypoint: Point3d, z_safe_margin: Double
# ---------- transform: Python ----------
from compas.geometry import Frame, Transformation, Translation, Vector
#in this step we transform our way planes to robot space
#the rhino co-ordinate system is rather abstract in the physical world
#the robot base plane assumed the base frame of robot is the origin
#but rhino does not know that
#thus we transform things from our design space(Rhino World XY) to Robot Base Plane that we measure

def set_robot_base(origin, xaxis, xypoint):
    """
    set a base plane representing the robot working object plane
    """
    robot_base = Frame(origin, xaxis - origin, xypoint - origin)
    print (robot_base)
    return (robot_base)

def rhino_to_robot_space(rhino_plane,robot_base_plane):
    """
    Transform the objects from Rhino world XY plane to robot work object plane
    """
    T_matrix = Transformation.from_frame_to_frame(Frame.worldXY(), robot_base_plane)
    robot_plane = rhino_plane.transformed(T_matrix)
    return robot_plane

def set_z_safe_margin(planes_to_adjust, safety_margin):
    adjusted = []
    T = Translation.from_vector(Vector(0, 0, safety_margin))
    for f in planes_to_adjust:
        adjusted.append(f.transformed(T))
    return adjusted

# ===== Robot base is set =====
robot_base =  set_robot_base(wobj_origin, wobj_xaxis, wobj_xypoint)

# ===== Set safety margin for Z height ======
safe_planes = set_z_safe_margin(way_planes, z_safe_margin)

# ===== Transforming the rhino planes into robot planes =====
transformed_frames = []
for plane in safe_planes: 
    transformed_frames.append(rhino_to_robot_space(plane, robot_base))
# ---------- end transform ----------
transform_2 = Python3Script(
    way_planes=brick_wall.frames,
    wobj_origin=capture_wobj.wobj_origin,
    wobj_xaxis=capture_wobj.wobj_xaxis,
    wobj_xypoint=capture_wobj.wobj_xypoint,
    z_safe_margin=fine_adjust_z_mm_2)  # -> out, transformed_frames; inputs way_planes: list, wobj_origin: Point3d, wobj_xaxis: Point3d, wobj_xypoint: Point3d, z_safe_margin: Double; same code as transform
list_item = ListItem(List=transform.transformed_frames, Index=0, Wrap=True)
list_item_2 = ListItem(List=transform_2.transformed_frames, Index=0, Wrap=True)
compas_draw_5 = COMPASDraw(cg=list_item)  # -> rg; same code as draw
compas_draw_6 = COMPASDraw(cg=list_item_2)  # -> rg; same code as draw
list_item_3 = ListItem(List=transform.transformed_frames, Index=0, Wrap=True)
# Convert Planes to URScript
list_item_4 = ListItem(List=transform_2.transformed_frames, Index=0, Wrap=True)
compas = Python3Script(
    lying_way_frames=transform_2.transformed_frames,
    standing_way_frames=transform.transformed_frames,
    lying_pick_frame=py3_2.pick_frame,
    standing_pick_frame=py3.pick_frame,
    tcp_measured=pt_13,
    acceleration=number_slider_5,
    velocity=number_slider_5)  # -> out, lying_pick_planes, standing_pick_planes, lying_path_planes, standing_path_planes, lying_path_frames, standing_path_frames, lying_reload_steps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; inputs lying_way_frames: list, standing_way_frames: list, tcp_measured: Point3d, acceleration: Double, velocity: Double
# ---------- compas: Python ----------
from importlib import reload
import sys
import os
import math

import compas.geometry as cg
from compas_rhino import conversions


# ==========================================
# 1. IMPORT ROBOT MODULES
# ==========================================

path = ghenv.Component.OnPingDocument().FilePath
folder = os.path.dirname(path)
src = os.path.join(folder, "src")

if src not in sys.path:
    sys.path.insert(0, src)

import simple_ur_script as ur
reload(ur)

import simple_comm as com
reload(com)

import utils
reload(utils)


# ==========================================
# 2. ROBOT SETTINGS
# ==========================================

IO = 4
SAFE_DIST = 100.0
SLEEP_TIME = 0.5

GENERATE_SCRIPT = True

CONFIRM_BEFORE_START = True
CONFIRM_STAGE_CHANGE = True
CONFIRM_RELOAD = True

# Orient the tool Z axis downward
FIX_PLACE_Z_DOWN = True
FIX_PICK_Z_DOWN = True

# Reject strongly tilted approach frames
REQUIRE_VERTICAL_TOOL = True


# ==========================================
# 3. BRICK DIMENSIONS (mm)
# ==========================================

BRICK_LENGTH = 32.0
BRICK_WIDTH = 15.0
BRICK_THICKNESS = 10.0


# ==========================================
# 4. LYING DISPENSER
# ==========================================

L_COLS = 5
L_ROWS = 4
L_LAYERS = 2

# Along the 32 mm brick dimension
L_COLUMN_GAP = 0
L_COLUMN_PITCH = (
    BRICK_LENGTH + L_COLUMN_GAP
)

# Across the 15 mm brick dimension
L_ROW_GAP = 0.0
L_ROW_PITCH = (
    BRICK_WIDTH + L_ROW_GAP
)

# Independent orientation of dispenser
L_GRID_YAW_DEG = 0.0

# Image order:
# Position 1 -> 2 moves left
# Next row moves upward
L_COLUMN_SIGN = -1
L_ROW_SIGN = -1

# Layer spacing
L_LAYER_PITCH = BRICK_THICKNESS

# 0 = bottom layer
# 1 = upper layer
L_REFERENCE_LAYER = 0

# Pick top 20, then bottom 20
L_TOP_FIRST = True


# ==========================================
# 5. STANDING DISPENSER
# ==========================================

S_COLS = 15
S_ROWS = 2
S_LAYERS = 1

# Along the 10 mm dimension
S_COLUMN_GAP = 0
S_COLUMN_PITCH = (
    BRICK_THICKNESS + S_COLUMN_GAP
)

# Across the 15 mm dimension
S_ROW_GAP = 0.0
S_ROW_PITCH = (
    BRICK_WIDTH + S_ROW_GAP
)

# Independent orientation of dispenser
S_GRID_YAW_DEG = 0.0

S_COLUMN_SIGN = -1
S_ROW_SIGN = -1


# ==========================================
# 6. GRASSHOPPER INPUT HELPERS
# ==========================================

def flatten_input(value):

    if value is None:
        return []

    if hasattr(value, "Branches"):

        items = []

        for branch in value.Branches:
            items.extend(list(branch))

        return [
            item for item in items
            if item is not None
        ]

    if isinstance(value, (list, tuple)):

        return [
            item for item in value
            if item is not None
        ]

    return [value]


def is_frame(value):

    return (
        hasattr(value, "point")
        and hasattr(value, "xaxis")
        and hasattr(value, "yaxis")
        and hasattr(value, "zaxis")
    )


def single_frame(value, name):

    items = flatten_input(value)

    if len(items) != 1:
        raise ValueError(
            name + " requires exactly one Frame"
        )

    if not is_frame(items[0]):
        raise TypeError(
            name + " must be a COMPAS Frame"
        )

    return items[0].copy()


def frame_list(value, name):

    items = flatten_input(value)
    result = []

    for item in items:

        if not is_frame(item):
            raise TypeError(
                name + " contains invalid Frame"
            )

        result.append(item.copy())

    return result


# ==========================================
# 7. TOOL ORIENTATION
# ==========================================

def prepare_tool_frame(
    frame,
    fix_down,
    label
):

    result = frame.copy()

    if fix_down and result.zaxis.z > 0:
        result.xaxis = -result.xaxis

    if REQUIRE_VERTICAL_TOOL:

        if result.zaxis.z > -0.90:
            raise ValueError(
                label +
                ": Tool Z is not near vertical down"
            )

    return result


def prepare_place_frames(frames, name):

    result = []

    for i, frame in enumerate(frames):

        corrected = prepare_tool_frame(
            frame,
            FIX_PLACE_Z_DOWN,
            name + " " + str(i + 1)
        )

        result.append(corrected)

    return result


# ==========================================
# 8. INDEPENDENT GRID AXES
# ==========================================

def grid_axes(yaw_deg):

    angle = math.radians(yaw_deg)

    # First axis, horizontal XY
    ux = math.cos(angle)
    uy = math.sin(angle)

    # Second axis = exact 90 degrees
    vx = -math.sin(angle)
    vy = math.cos(angle)

    return ux, uy, vx, vy


# ==========================================
# 9. NEW GRID GENERATOR
# ==========================================

def generate_grid(
    reference,
    columns,
    rows,
    layers,
    column_pitch,
    row_pitch,
    yaw_deg,
    column_sign,
    row_sign,
    layer_pitch,
    reference_layer,
    top_first,
    name
):

    if column_pitch <= 0 or row_pitch <= 0:
        raise ValueError(
            name + ": Invalid grid spacing"
        )

    if reference_layer < 0 or reference_layer >= layers:
        raise ValueError(
            name + ": Invalid reference layer"
        )

    # TOOL frame and GRID axes
    # are deliberately independent.

    reference = prepare_tool_frame(
        reference,
        FIX_PICK_Z_DOWN,
        name + " pickup"
    )

    ux, uy, vx, vy = grid_axes(yaw_deg)

    positions = []
    labels = []

    if top_first:
        layer_order = range(
            layers - 1, -1, -1
        )
    else:
        layer_order = range(layers)

    for layer in layer_order:

        for row in range(rows):

            for col in range(columns):

                # Numbered 1, 2, 3...
                # Each row resets to its
                # original column position.

                dx = (
                    col * column_pitch
                    * column_sign * ux
                    +
                    row * row_pitch
                    * row_sign * vx
                )

                dy = (
                    col * column_pitch
                    * column_sign * uy
                    +
                    row * row_pitch
                    * row_sign * vy
                )

                dz = (
                    layer - reference_layer
                ) * layer_pitch

                point = cg.Point(
                    reference.point.x + dx,
                    reference.point.y + dy,
                    reference.point.z + dz
                )

                # Same orientation for every
                # pickup position.
                frame = reference.copy()
                frame.point = point

                positions.append(frame)

                labels.append(
                    "Layer {} / Row {} / Position {}".format(
                        layer + 1,
                        row + 1,
                        col + 1
                    )
                )

    return positions, labels


# ==========================================
# 10. READ INPUTS
# ==========================================

lying_reference = single_frame(
    lying_pick_frame,
    "lying_pick_frame"
)

standing_reference = single_frame(
    standing_pick_frame,
    "standing_pick_frame"
)

lying_places = prepare_place_frames(
    frame_list(
        lying_way_frames,
        "lying_way_frames"
    ),
    "LYING PLACE"
)

standing_places = prepare_place_frames(
    frame_list(
        standing_way_frames,
        "standing_way_frames"
    ),
    "STANDING PLACE"
)

if not lying_places:
    raise ValueError(
        "Missing Lying placement frames"
    )

if not standing_places:
    raise ValueError(
        "Missing Standing placement frames"
    )

if tcp_measured is None:
    raise ValueError(
        "Missing TCP measurement"
    )

if acceleration is None or velocity is None:
    raise ValueError(
        "Missing speed inputs"
    )

if float(acceleration) <= 0:
    raise ValueError(
        "Acceleration must be positive"
    )

if float(velocity) <= 0:
    raise ValueError(
        "Velocity must be positive"
    )


# ==========================================
# 11. LYING PICKUP GRID
# ==========================================

lying_picks, lying_labels = generate_grid(
    reference=lying_reference,
    columns=L_COLS,
    rows=L_ROWS,
    layers=L_LAYERS,
    column_pitch=L_COLUMN_PITCH,
    row_pitch=L_ROW_PITCH,
    yaw_deg=L_GRID_YAW_DEG,
    column_sign=L_COLUMN_SIGN,
    row_sign=L_ROW_SIGN,
    layer_pitch=L_LAYER_PITCH,
    reference_layer=L_REFERENCE_LAYER,
    top_first=L_TOP_FIRST,
    name="LYING"
)


# ==========================================
# 12. STANDING PICKUP GRID
# ==========================================

standing_picks, standing_labels = generate_grid(
    reference=standing_reference,
    columns=S_COLS,
    rows=S_ROWS,
    layers=S_LAYERS,
    column_pitch=S_COLUMN_PITCH,
    row_pitch=S_ROW_PITCH,
    yaw_deg=S_GRID_YAW_DEG,
    column_sign=S_COLUMN_SIGN,
    row_sign=S_ROW_SIGN,
    layer_pitch=0.0,
    reference_layer=0,
    top_first=True,
    name="STANDING"
)


# ==========================================
# ROTATE STANDING PICKUP FRAMES 90 DEGREES
# ==========================================

rotated_standing_picks = []

for frame in standing_picks:

    rotated = cg.Frame(
        frame.point,
        -frame.yaxis,
        frame.xaxis
    )

    rotated_standing_picks.append(rotated)

standing_picks = rotated_standing_picks


# ==========================================
# 13. GRID DEBUGGING
# ==========================================

def show_grid_checks(
    name,
    picks,
    labels,
    reference,
    indices
):

    print("========", name, "========")

    print("Measured P1:", reference.point)
    print("Pickup positions:", len(picks))
    print("First pickup Z axis:", picks[0].zaxis)

    for n in indices:

        if 1 <= n <= len(picks):

            print(
                "Pickup",
                n,
                labels[n - 1],
                picks[n - 1].point
            )

    print(
        "First pickup Z minus reference Z:",
        round(
            picks[0].point.z
            - reference.point.z,
            3
        ),
        "mm"
    )


show_grid_checks(
    "LYING",
    lying_picks,
    lying_labels,
    lying_reference,
    [1, 2, 5, 6, 10, 20, 21, 40]
)

show_grid_checks(
    "STANDING",
    standing_picks,
    standing_labels,
    standing_reference,
    [1, 2, 15, 16, 30]
)


# ==========================================
# 14. TRAVEL HEIGHT
# ==========================================

all_frames = (
    lying_picks
    + standing_picks
    + lying_places
    + standing_places
)

TRAVEL_Z = max(
    frame.point.z
    for frame in all_frames
) + SAFE_DIST


def safe_location(frame):

    result = frame.copy()

    result.point = cg.Point(
        frame.point.x,
        frame.point.y,
        TRAVEL_Z
    )

    return result


# ==========================================
# 15. PICKUP
# ==========================================

def pickup_brick(text, pick):

    safe = safe_location(pick)

    text += ur.move_l(
        safe, acceleration, velocity
    )

    text += ur.move_l(
        pick, acceleration, velocity
    )

    text += ur.set_digital_out(
        IO, True
    )

    text += ur.sleep(SLEEP_TIME)

    text += ur.move_l(
        safe, acceleration, velocity
    )

    return text


# ==========================================
# 16. PLACE
# ==========================================

def place_brick(text, place):

    safe = safe_location(place)

    text += ur.move_l(
        safe, acceleration, velocity
    )

    text += ur.move_l(
        place, acceleration, velocity
    )

    text += ur.set_digital_out(
        IO, False
    )

    text += ur.sleep(SLEEP_TIME)

    text += ur.move_l(
        safe, acceleration, velocity
    )

    return text


# ==========================================
# 17. OPERATOR CONFIRMATION
# ==========================================

def confirmation(text, message, title):

    return text + (
        'popup("{}", title="{}", '
        'warning=True, blocking=True)\n'
    ).format(message, title)


# ==========================================
# 18. SCRIPT INITIALIZATION
# ==========================================

def start_script(stage):

    text = ""

    text += ur.set_tcp_by_angles(
        tcp_measured.X,
        tcp_measured.Y,
        tcp_measured.Z,
        0.0, 0.0, 0.0
    )

    text += ur.set_digital_out(
        IO, False
    )

    if CONFIRM_BEFORE_START:

        text = confirmation(
            text,
            "Check calibration and robot area",
            stage + " preflight"
        )

    return text


# ==========================================
# 19. ADD COMPLETE STAGE
# ==========================================

def add_stage(text, picks, places, stage):

    capacity = len(picks)

    for i, place in enumerate(places):

        pick_index = i % capacity

        # Pause before reusing dispenser
        if i > 0 and pick_index == 0:

            text += ur.set_digital_out(
                IO, False
            )

            if CONFIRM_RELOAD:

                text = confirmation(
                    text,
                    "Refill " + stage
                    + " dispenser",
                    stage + " reload"
                )

        pick = picks[pick_index]

        text = pickup_brick(text, pick)
        text = place_brick(text, place)

    return text


# ==========================================
# 20. SCRIPT FOOTER
# ==========================================

def finish_script(text):

    text += ur.set_digital_out(
        IO, False
    )

    return com.concatenate_script(text)


# ==========================================
# 21. RELOAD STEPS
# ==========================================

def reload_steps(total, capacity):

    return [
        i + 1
        for i in range(1, total)
        if i % capacity == 0
    ]


lying_reload_steps = reload_steps(
    len(lying_places),
    len(lying_picks)
)

standing_reload_steps = reload_steps(
    len(standing_places),
    len(standing_picks)
)


# ==========================================
# 22. PREVIEW PATHS
# ==========================================

def preview_path(picks, places):

    frames = []

    for i, place in enumerate(places):

        pick = picks[i % len(picks)]

        frames.extend([
            safe_location(pick),
            pick,
            safe_location(pick),
            safe_location(place),
            place,
            safe_location(place)
        ])

    return frames


lying_path_frames = preview_path(
    lying_picks,
    lying_places
)

standing_path_frames = preview_path(
    standing_picks,
    standing_places
)


# ==========================================
# 23. GENERATE URSCRIPTS
# ==========================================

lying_script = ""
standing_script = ""
script = ""

if GENERATE_SCRIPT:

    lying_text = start_script("LYING")

    lying_text = add_stage(
        lying_text,
        lying_picks,
        lying_places,
        "LYING"
    )

    lying_script = finish_script(
        lying_text
    )

    standing_text = start_script("STANDING")

    standing_text = add_stage(
        standing_text,
        standing_picks,
        standing_places,
        "STANDING"
    )

    standing_script = finish_script(
        standing_text
    )

    combined_text = start_script("COMBINED")

    combined_text = add_stage(
        combined_text,
        lying_picks,
        lying_places,
        "LYING"
    )

    combined_text += ur.set_digital_out(
        IO, False
    )

    if CONFIRM_STAGE_CHANGE:

        combined_text = confirmation(
            combined_text,
            "Verify lying wall before standing",
            "STANDING phase"
        )

    combined_text = add_stage(
        combined_text,
        standing_picks,
        standing_places,
        "STANDING"
    )

    script = finish_script(
        combined_text
    )


# ==========================================
# 24. RHINO VISUALIZATION
# ==========================================

lying_pick_planes = [
    conversions.frame_to_rhino(f)
    for f in lying_picks
]

standing_pick_planes = [
    conversions.frame_to_rhino(f)
    for f in standing_picks
]

lying_path_planes = [
    conversions.frame_to_rhino(f)
    for f in lying_path_frames
]

standing_path_planes = [
    conversions.frame_to_rhino(f)
    for f in standing_path_frames
]

def push_first_brick(script, first_frame, angle):
    end_frame = first_frame.copy()
    end_frame.point.z -= 8
    move_v = end_frame.yaxis.unitized() 
    pushing_frame = end_frame.translated(-move_v * 16)
    end_frame.translate(move_v * 10)

    safe_frame = safe_location(pushing_frame)

    matrix_r = cg.Rotation.from_axis_and_angle(
        end_frame.xaxis,
        math.radians(angle),
        pushing_frame.point
    )
    pushing_frame.transform(matrix_r)
    matrix_r = cg.Rotation.from_axis_and_angle(
        end_frame.xaxis,
        math.radians(-angle),
        end_frame.point
    )
    end_frame.transform(matrix_r)

    # Safe frame for pushing
    script += ur.move_l(safe_frame, acceleration, velocity)
    script += ur.move_l(pushing_frame, acceleration, velocity)
    script += ur.move_l(end_frame, acceleration + 1.5, velocity +1.5)
    script += ur.move_l(safe_frame, acceleration, velocity)

    frame = [safe_frame, pushing_frame, end_frame, safe_frame]
    return script, frame



# ==========================================
# PUSH FIRST BRICK - PREVIEW ONLY
# ==========================================

PUSH_ANGLE = 15.0

push_frames = []
push_planes = []
pushing_script = ""

print("PUSH PREVIEW START")

if len(standing_places) > 0:

    first_frame = standing_places[0].copy()

    print("First standing frame:", first_frame.point)

    preview_script, push_frames = push_first_brick(
        "",
        first_frame,
        PUSH_ANGLE
    )

    print("Generated push frames:", len(push_frames))

    push_planes = [
        conversions.frame_to_rhino(f)
        for f in push_frames
    ]

    print("Generated push planes:", len(push_planes))


    # =====================================
    # GENERATE STANDALONE PUSHING URSCRIPT
    # =====================================

    pushing_text = ""

    # Set measured TCP
    if tcp_measured is not None:
        pushing_text += ur.set_tcp_by_angles(
            tcp_measured.X,
            tcp_measured.Y,
            tcp_measured.Z,
            0.0, 0.0, 0.0
        )

    # Ensure vacuum is off
    pushing_text += ur.set_digital_out(IO, False)

    # Require operator confirmation
    pushing_text += (
        'popup("Verify first domino and push path", '
        'title="PUSH preflight", '
        'warning=True, blocking=True)\n'
    )

    # Use the push movements generated in preview
    pushing_text += preview_script

    # Finish with vacuum off
    pushing_text += ur.set_digital_out(IO, False)

    # Generate standalone URScript
    pushing_script = com.concatenate_script(
        pushing_text
    )

    print("Pushing script length:", len(pushing_script))


else:
    print("ERROR: No standing placement frames")

print("PUSH PREVIEW END")




# ==========================================
# 25. FINAL REPORT
# ==========================================

print("========== GRID V3 ==========")

print("Lying pickup count:", len(lying_picks))
print("Standing pickup count:", len(standing_picks))

print("Lying column pitch:", L_COLUMN_PITCH)
print("Lying row pitch:", L_ROW_PITCH)

print("Standing column pitch:", S_COLUMN_PITCH)
print("Standing row pitch:", S_ROW_PITCH)

print("Lying placement count:", len(lying_places))
print("Standing placement count:", len(standing_places))

print("Lying reload:", lying_reload_steps)
print("Standing reload:", standing_reload_steps)

print("Safe travel Z:", TRAVEL_Z)

print("Lying script length:", len(lying_script))
print("Standing script length:", len(standing_script))
print("Combined script length:", len(script))

print("================================")
# ---------- end compas ----------
deplane = DeconstructPlane(Plane=compas.lying_path_planes)  # -> Origin, XAxis, YAxis, ZAxis
deplane_2 = DeconstructPlane(Plane=compas.standing_path_planes)  # -> Origin, XAxis, YAxis, ZAxis
polyline = PolyLine(Vertices=flatten(deplane.Origin), Closed=False)
polyline_2 = PolyLine(Vertices=flatten(deplane_2.Origin), Closed=False)
deplane_3 = DeconstructPlane(Plane=compas.push_planes)  # -> Origin, XAxis, YAxis, ZAxis

# ---- group: Send UR script to Robot!
py3_3 = Python3Script(script=compas.pushing_script, ip_address="169.254.130.206", send=Button())  # -> out, a; inputs script: String, ip_address: String, send: Boolean
# ---------- py3_3: Python ----------
import simple_comm as com

if send:
    com.send_script(script,ip_address)
# ---------- end py3_3 ----------

# ----
pline = PolyLine(Vertices=flatten(deplane_3.Origin), Closed=Toggle(False))
preview_6 = CustomPreview(
    Geometry=polyline_2,
    Material={diffuse=RGB(221, 160, 221), emission=RGB(66, 48, 66), shine=0.5, specular=RGB(255, 255, 255), transparency=0})
preview_7 = CustomPreview(Geometry=polyline, Material=ColourSwatch(SwatchColor=RGB(15, 0, 255)))
# Send to Robot!
panel_6 = Panel(compas.pushing_script)
