# Grasshopper definition 101_brick_to_robot_Mike.gh (Grasshopper 1.0.8)

list = ValueList({"Config 1": 0, "Config 2": 1, "Config 3": 2}, selected="Config 1")
list_2 = ValueList({"Config 1": 0, "Config 2": 1, "Config 3": 2}, selected="Config 2")
brick_dimensions = Python3Script(orientation=list)  # -> out, length, width, height, orient
# ---------- brick_dimensions: Python ----------
# r: compas
# venv: mas-2627
from compas_rhino.devtools import DevTools
DevTools.ensure_path()

from brick_wall import Brick

samplebrick = Brick()
samplebrick.configuration(orientation)

length = samplebrick.length
width = samplebrick.width
height = samplebrick.height
orient = orientation
# ---------- end brick_dimensions ----------
brick_dimensions_2 = Python3Script(orientation=list_2)  # -> out, length, width, height, orient; same code as brick_dimensions
number_slider = Slider(420, range=0..1000)
number_slider_2 = Slider(594, range=0..1000)
no_layers = Slider(4, range=0..10)
rectangle = Rectangle(Plane=PlaneXY(0, 0, 0), XSize=number_slider, YSize=number_slider_2, Radius=0)  # -> Rectangle, Length
pt = ConstructPoint(XCoordinate=expr("x/2", number_slider), YCoordinate=expr("x/2", number_slider_2), ZCoordinate=0)
lines_pts = LinesPts(C=rectangle.Rectangle, D=Slider(25, range=0..100), N=Slider(100, range=0..100))  # -> P, L, C_2

rad = Radians(Degrees=Slider(30, range=0..1000))
rad_2 = Radians(Degrees=Slider(0, range=0..1000))
shift_and_subtract = ShiftAndSubtract(L=lines_pts.L, I="-1")  # -> L_2, L_3
clampangle = ClampAngle(LineA=shift_and_subtract.L_2, LineB=shift_and_subtract.L_3, UpperLimit=rad, LowerLimit=rad_2, Strength=1)

shift = ShiftList(List=lines_pts.L, Shift=1, Wrap=True)

boundary = BoundarySurfaces(Edges=lines_pts.C_2)
mesh_uv = MeshSurface(Surface=boundary, UCount=5, VCount=5, Overhang=True, Equalize=False)
onmesh = OnMesh(Points=lines_pts.P, Mesh=mesh_uv, Strength=Slider(100, range=0..100000))

length_line = LengthLine(Line=lines_pts.L, Length=brick_dimensions.length, Strength=Slider(100, range=0..100))

index = ItemIndex(List=lines_pts.P, Item=lines_pts.P)
shift_2 = ShiftList(List=index, Shift=1, Wrap=True)  # -> simplify(List)
collider = Collider(Objects=lines_pts.P, Radii=brick_dimensions.length, IgnoreA=index, IgnoreB=shift_2, Strength=Slider(10, range=0..100))

expression = Expression(
    one_length=brick_dimensions.length,
    two_width=brick_dimensions_2.width,
    gap=Slider(4, range=0..10),
    Expression="one_length+two_width+gap")

# ---- group: Steps between modules
expression_2 = Expression(h1=brick_dimensions.height, h2=brick_dimensions_2.height, Expression="h1+h2")

# ----
merge = Merge(Data1=onmesh, Data2=length_line, Data3=collider, Data4=clampangle)  # -> flatten(Result)
bouncysolver = BouncySolver(
    GoalObjects=flatten(merge),
    Reset=Button(),
    Threshold=1e-15,
    Tolerance=0.0001,
    Damping=Slider(0.084, range=0..1),
    Iterations=10,
    On=Toggle(False))  # -> I, V, O

# ---- group: Translation Vectors per module
series = Series(Start=0, Step=1, Count=no_layers)
multiplication = Multiplication(A=expression_2, B=series)
Z = UnitZ(Factor=multiplication)

# ----
dam = DataDam(DataA=bouncysolver.V, BufferDelay=10000000, BufferMode=0)
nurbs = NurbsCurve(Vertices=dam, Degree=3, Periodic=False)  # -> reparameterize(Curve), Length, Domain

cluster = Cluster(h1=brick_dimensions.height, h2=brick_dimensions_2.height)
divlength = DivideLength(Curve=nurbs.Curve, Length=expr("x/2", expression))  # -> Points, Tangents, Parameters
shift_and_subtract_2 = ShiftAndSubtract(L=divlength.Parameters, I="-1")  # -> L_2, L_3
subtraction = Subtraction(A=shift_and_subtract_2.L_3, B=shift_and_subtract_2.L_2)
Z_2 = UnitZ(Factor=cluster)
lng = ListLength(List=Z)
number_slider_3 = Slider(4, range=0..10)
avr = Average(Input=subtraction)
move = Move(Geometry=nurbs.Curve, Motion=Z_2)  # -> Geometry, Transform
division = Division(A=avr, B=no_layers)
lng_2 = ListLength(List=Z_2)
move_2 = Move(Geometry=move.Geometry, Motion=graft(Z))  # -> simplify(graft(Geometry)), Transform
series_2 = Series(Start=0, Step=division, Count=lng)  # -> graft(Series)
path_mapper = PathMapper(move_2.Geometry, source="{A;B}", target="{path_index}")
repeat = RepeatData(Data=series_2, Length=lng_2)  # -> simplify(graft(Data))
viewer = ParamViewer(repeat)
path_mapper_2 = PathMapper(repeat, source="{A;B}", target="{path_index}")
expression_3 = Expression(t=divlength.Parameters, dl=path_mapper_2, Expression="(t+dl)")  # -> simplify(R)
path_mapper_3 = PathMapper(expression_3, source="{A}(B)", target="{0;A}(B)")
Z_3 = UnitZ(Factor=1)
py3 = Python3Script(p_list=path_mapper_3)  # -> out, rev_p; inputs p_list: tree of Double
# ---------- py3: Python ----------
import ghpythonlib.treehelpers as th
import math as m
import Rhino.Geometry as rg

p_list = th.tree_to_list(p_list)
rps = [[p for n, p in enumerate(ps) if p <= 1.0] for np, ps in enumerate(p_list)]
rev_p = th.list_to_tree(rps)
# ---------- end py3 ----------
eval = EvaluateCurve(Curve=reparameterize(simplify(path_mapper)), Parameter=simplify(py3.rev_p))  # -> Point, Tangent, Angle
xprod = CrossProduct(VectorA=Z_3, VectorB=eval.Tangent, Unitize=True)  # -> Vector, Length
path_mapper_4 = PathMapper(eval.Point, source="{A}(B)", target="{0;A}(B)")
pl = ConstructPlane(Origin=eval.Point, XAxis=eval.Tangent, YAxis=xprod.Vector)
path_mapper_5 = PathMapper(pl, source="{A}(B)", target="{0;A}(B)")
item = ListItem(List=multiplication, Index=expr("-1", 0), Wrap=True)
py3_2 = Python3Script(pts_list=path_mapper_4, pln_list=path_mapper_5)  # -> out, rev_pts, rev_plns; inputs pts_list: tree of Point3d, pln_list: tree of Plane
# ---------- py3_2: Python ----------
import ghpythonlib.treehelpers as th

pts_list = th.tree_to_list(pts_list)
pln_list = th.tree_to_list(pln_list)

rps = [[p for n, p in enumerate(pts) if n % 2 == np % 2] for np, pts in enumerate(pts_list)]
rplns = [[q for m, q in enumerate(plns) if m % 2 == mp % 2] for mp, plns in enumerate(pln_list)]

rev_pts = th.list_to_tree(rps)
rev_plns = th.list_to_tree(rplns)
# ---------- end py3_2 ----------
py3_3 = Python3Script(pts_list=path_mapper_4)  # -> out, orientations; inputs pts_list: tree of Point3d
# ---------- py3_3: Python ----------
import ghpythonlib.treehelpers as th
import math as m
import Rhino.Geometry as rg

pts_list = th.tree_to_list(pts_list)
ori = []
for n in range(len(pts_list)):
    if n % 4 != 1 and n % 4 != 2:
        ori.append(0)
    else:
        ori.append(1)

orientations = th.list_to_tree(ori)
# ---------- end py3_3 ----------
py3_4 = Python3Script(orientations=py3_3.orientations)  # -> out, rotations; inputs orientations: list of Int32
# ---------- py3_4: Python ----------
import ghpythonlib.treehelpers as th
import math as m
import Rhino.Geometry as rg

orient = []
for o in orientations:
    a = 2
    if o == 0:
        a = 0
    else:
        a = m.pi/2
    orient.append(a)

rotations = th.list_to_tree(orient)
# ---------- end py3_4 ----------
bnd = Bounds(Numbers=py3_2.rev_pts)
dom = ConstructDomain(DomainStart=expr("0.25*x", item), DomainEnd=item)
remap = RemapNumbers(Value=py3_2.rev_pts, Source=bnd, Target=Domain(0, 1))  # -> Mapped, Clipped
pdecon = Deconstruct(Point=py3_2.rev_pts)  # -> XComponent, YComponent, ZComponent
graph = GraphMapper(
    remap.Mapped,
    x0=0,
    x1=1,
    y0=0,
    y1=1,
    container_name="Sinc",
    Equation_X0=0.2585823536,
    Equation_X1=0.4224238694,
    Equation_Y0=0.7358154058,
    Equation_Y1=0.4105070829)
bnd_2 = Bounds(Numbers=graph)
remap_2 = RemapNumbers(Value=graph, Source=bnd_2, Target=dom)  # -> Mapped, Clipped
smaller = SmallerThan(FirstNumber=pdecon.ZComponent, SecondNumber=remap_2.Mapped)  # -> SmallerThan, OrEqualTo
cull = CullPattern(List=py3_2.rev_pts, CullPattern=smaller.OrEqualTo)
cull_2 = CullPattern(List=py3_2.rev_plns, CullPattern=smaller.OrEqualTo)
clean = CleanTree(RemoveNulls=True, RemoveInvalid=True, RemoveEmpty=True, Tree=cull)
clean_2 = CleanTree(RemoveNulls=True, RemoveInvalid=True, RemoveEmpty=True, Tree=cull_2)

# ---- group: This is needed only ONCE in the GH definition
enable_auto_reload = Python3Script()  # -> ok
# ---------- enable_auto_reload: Python ----------
"""
------------------------------
Using VS Code as Python editor
------------------------------

The simplest way to start using VS Code as our editor, is
to place our Python code in files located IN THE SAME FOLDER as our Grasshopper file.

After we have done that, we need 2 steps: 

1. Enable the COMPAS reloader on one component. This tells Grasshopper to watch for changes in the Pythoh files and reload if changed.
2. Every other component that uses Python code from external files needs to start with a method to ensure Grasshopper knows where to load the files from.

"""
# r: compas
# venv: mas-2627

from compas_rhino.devtools import DevTools
DevTools.enable_reloader()
# ---------- end enable_auto_reload ----------

# ----
number_slider_4 = Slider(420, range=0..1000)
number_slider_5 = Slider(594, range=0..1000)

# ---- group: IP ADDRESS
panel = Panel("192.168.10.10")

# ----
rectangle_2 = Rectangle(Plane=PlaneXY(0, 0, 0), XSize=number_slider_4, YSize=number_slider_5, Radius=0)  # -> Rectangle, Length
crv = Curve(rectangle_2.Rectangle)

# ---- group: works!
# Generate Geometry
number_slider_6 = Slider(3, range=0..30)  # disabled
number_slider_7 = Slider(4, range=0..30)  # disabled
number_slider_8 = Slider(4, range=0..30)  # disabled
curve = Curve(<curve referenced from the Rhino model>)  # disabled
bricks = Python3Script(
    crv=curve,
    num_layers=number_slider_7,
    gap=number_slider_6,
    rotation=number_slider_8,
    work_x=number_slider_4,
    work_y=number_slider_5,
    work_area=crv)  # -> out, geometries, bricks, frames; inputs crv: Curve, num_layers: Int32, gap: Int32, rotation: Int32; disabled
# ---------- bricks: Python ----------
# r: compas
# venv: mas-2627
from compas_rhino.devtools import DevTools
DevTools.ensure_path()

import math
import ghpythonlib.treehelpers as th
from compas.geometry import Frame
from compas.geometry import Point
from compas.geometry import Vector
from compas.geometry import Rotation
from compas.geometry import cross_vectors

from compas_rhino.conversions import curve_to_compas 
from brick_wall import Brick

# brick list
bricks = []
frames = []

# convert curve
compas_crv = curve_to_compas(crv)

# half brick to interloack
full_spacing = Brick.LENGTH + gap 
half_spacing = full_spacing / 2.0
params, points = compas_crv.divide_by_length(half_spacing, True)

# layer patterns
# 1. horizontal
# 2. chnaged
patterns = {
    "even": [1, 2, 1],
    "odd":  [1, 1, 2]
}

# bricks in each layer
for i in range(num_layers):
    z = i * Brick.HEIGHT
    
    angle = math.radians(i * rotation) if 'rotation' in globals() else 0.0
    R = Rotation.from_axis_and_angle([0, 0, 1], angle)

    # even, odd
    is_even = (i % 2 == 0)
    pattern = patterns["even"] if is_even else patterns["odd"]
    subbricks = []
    subframes = []

    for j, (param, pt) in enumerate(zip(params, points)):
        
        # interlocking
        if (j % 2 == 0) != is_even:
            continue
            
        # pattern list
        modular_index = (j // 2) % len(pattern)
        brick_type = pattern[modular_index]

        # position
        brick_point = Point(pt.x, pt.y, z)

        # direction and perpendicular
        tangent_base = compas_crv.tangent_at(param)
        normal_base = Vector(*cross_vectors([0, 0, 1], tangent_base))

        # transformation
        tangent = tangent_base.transformed(R)
        normal = normal_base.transformed(R)

        # orientations:
        if brick_type == 1:
            # 1. horizontal
            frame = Frame(brick_point, xaxis=tangent, yaxis=normal)
        elif brick_type == 2:
            # 2. vertical
            frame = Frame(brick_point, xaxis=-normal, yaxis=tangent)
        
        frame.point += (Vector(0.0,0.0,1/2*Brick.HEIGHT))
        # bruck frame
        brick = Brick(frame)
        subbricks.append(brick)
        subframes.append(frame)

    bricks.append(subbricks)
    frames.append(subframes)

geometries = [[b.draw() for b in subb] for subb in bricks]
# frames = [[b.get_pick_frame() for b in subb] for subb in bricks]
geometries = th.list_to_tree(geometries)
frames = th.list_to_tree(frames)


# geometries = []
# frames = []



# for brick in bricks:
#     geometries.append(brick.draw())
#     frames.append(brick.get_pick_frame())
# ---------- end bricks ----------
compas_draw = COMPASDraw(cg=bricks.geometries)  # -> rg; disabled
#   port cg: The COMPAS geometry or datastructure to be drawn.
#   port rg: The Rhino geometry object.
# ---------- compas_draw: Python ----------
# r: compas>=2.14.1
"""
Draws COMPAS geometry in Grasshopper.
"""

from typing import Any

import Grasshopper

from compas.scene import SceneObject


class CompasToRhinoGeometry(Grasshopper.Kernel.GH_ScriptInstance):
    def RunScript(self, cg):
        if not cg:
            return None

        return SceneObject(item=cg).draw()
# ---------- end compas_draw ----------
compas_draw_2 = COMPASDraw(cg=bricks.frames)  # -> rg; disabled; same code as compas_draw

# ----
py3_5 = Python3Script(planes=clean_2, orient=py3_3.orientations, rotate=py3_4.rotations)  # -> out, way_frames; inputs planes: tree, orient: list, rotate: list
# ---------- py3_5: Python ----------
# r: compas
# venv: mas-2627
from compas_rhino.devtools import DevTools
DevTools.ensure_path()

import Rhino.Geometry as rg
# from
from compas.geometry import Frame, Vector, Point
from compas_rhino.conversions import plane_to_compas_frame
from compas.geometry import Transformation, Translation, Rotation
import math as m
import ghpythonlib.treehelpers as th
from brick_wall import Brick

planes = th.tree_to_list(planes)

way_frames = []
for npl, plns in enumerate(planes):
    sub_rot_frames = []
    ori = orient[npl] * rotate[npl]
    for n, pl in enumerate(plns):
        frame = plane_to_compas_frame(pl)
        rot_frame = frame.rotated(ori, frame.zaxis, frame.point)
        sub_rot_frames.append(rot_frame)
    way_frames.append(sub_rot_frames)

for wayf in way_frames:
    for w in wayf:
        w.point += Vector(0.0,0.0,1/2*Brick.HEIGHT)

way_frames = th.list_to_tree(way_frames)
# ---------- end py3_5 ----------
draw = COMPASDraw(cg=py3_5.way_frames)  # -> rg; same code as compas_draw

# ---- group: Origin
pt_2 = ConstructPoint(XCoordinate="-35.73", YCoordinate="393.10", ZCoordinate="200.65")

pt_3 = ConstructPoint(XCoordinate="-139.76", YCoordinate="282.1", ZCoordinate="88.57")

# ---- group: xaxis
pt_4 = ConstructPoint(XCoordinate="-140.29", YCoordinate="297.79", ZCoordinate="89.42")

# ---- group: yaxis
pt_5 = ConstructPoint(XCoordinate="-136.12", YCoordinate="282.35", ZCoordinate="82.19")

# ---- group: Origin
pt_6 = ConstructPoint(XCoordinate="-131.59", YCoordinate="283.06", ZCoordinate="75.46")

# ---- group: xaxis
pt_7 = ConstructPoint(XCoordinate="-130.97", YCoordinate="298.06", ZCoordinate="75.38")

# ---- group: yaxis
pt_8 = ConstructPoint(XCoordinate="-128.56", YCoordinate="253.3", ZCoordinate="68.46")

# ---- group: Origin
pt_9 = ConstructPoint(XCoordinate="-135.14", YCoordinate="281.07", ZCoordinate="75.86")

# ---- group: yaxis
pt_10 = ConstructPoint(XCoordinate="-129.52", YCoordinate="283.06", ZCoordinate="78.75")

# ---- group: xaxis
pt_11 = ConstructPoint(XCoordinate="-134.99", YCoordinate="296.40", ZCoordinate="76.52")

# ---- group: Origin
pt_12 = ConstructPoint(XCoordinate="534.15", YCoordinate="530.96", ZCoordinate="-9.26")

# ---- group: xaxis
pt_13 = ConstructPoint(XCoordinate="113.63", YCoordinate="528.18", ZCoordinate="-8.75")

# ---- group: yaxis
# Measure work object
panel_2 = Panel("-9.72")
pt_14 = ConstructPoint(XCoordinate="535.01", YCoordinate="325.62", ZCoordinate=panel_2)

# ---- group: xaxis
pt_15 = ConstructPoint(XCoordinate="60.31", YCoordinate="392.86", ZCoordinate="200.15")

# ---- group: yaxis
pt_16 = ConstructPoint(XCoordinate="-36.81", YCoordinate="517.32", ZCoordinate="200.39")

# ----
# Measure and set TCP Gripper
panel_3 = Panel("0.12")
pt_17 = ConstructPoint(XCoordinate=panel_3, YCoordinate="0.64", ZCoordinate="121.84")

# ----
# Measure and set TCP Suction
panel_4 = Panel("-65.64")
pt_18 = ConstructPoint(XCoordinate=panel_4, YCoordinate="35.36", ZCoordinate="96.7")

# ----
# xaxis_pt and xy_pt were recorded differently
# brick was placed in three locations:
# 1. first point where brick would be picked
# 2. furthest position in the X direction
# 3. furthest position in the Y direction
# in the script, the xaxis was defined as origin - xaxis instead of the other way round
# Measure pick up location
py3_6 = Python3Script(origin=pt_2, xaxis_pt=pt_15, xy_pt=pt_16)  # -> out, pick_frame; inputs origin: Point3d, xaxis_pt: Point3d, xy_pt: Point3d
# ---------- py3_6: Python ----------
from compas.geometry import Frame, Point
from compas.geometry import Rotation

from compas_rhino.conversions import point_to_compas

origin = point_to_compas(origin)
xaxis_pt = point_to_compas(xaxis_pt)
xy_pt = point_to_compas(xy_pt)

#define pick frame
pick_frame = Frame(origin, -(xaxis_pt - origin), xy_pt - origin)
# ---------- end py3_6 ----------
compas_draw_3 = COMPASDraw(cg=py3_6.pick_frame)  # -> rg; same code as compas_draw
pickup_frame_3d_grid = Python3Script(origin_frame=py3_6.pick_frame, levels=Slider(20, range=0..100))  # -> out, brick_frame, pick_frames; inputs levels: Int32
# ---------- pickup_frame_3d_grid: Python ----------
from brick_wall import Brick
import math as m
from compas.geometry import Vector


COLS = 4
ROWS = 9
LAYER_CAPACITY = COLS * ROWS - 1

pick_frames = []

for i in range(LAYER_CAPACITY * levels):

    layer = i // LAYER_CAPACITY
    index = i % LAYER_CAPACITY

    col = index % COLS
    row = index // COLS
    dx = -col * Brick.LENGTH
    dy = row * Brick.WIDTH
    dz = -layer * Brick.HEIGHT

    brick_frame = origin_frame.copy()
    brickpt = brick_frame.point

    brick_frame.point += (
        origin_frame.xaxis * dx
        + origin_frame.yaxis * dy
        + Vector(0, 0, dz)
    )

    # brick = Brick(brick_frame)
    pick_frames.append(brick_frame)
# ---------- end pickup_frame_3d_grid ----------
compas_draw_4 = COMPASDraw(cg=pickup_frame_3d_grid.brick_frame)  # -> rg; same code as compas_draw
compas_draw_5 = COMPASDraw(cg=pickup_frame_3d_grid.pick_frames)  # -> rg; same code as compas_draw

# ----
# Transform from Rhino to Robot Space
# Insert way_planes as grasshopper tree
fine_adjust_z_mm = Slider(5, range=-5..100)
transform_geom = Python3Script(way_planes=py3_5.way_frames, wobj_origin=pt_12, wobj_xaxis=pt_13, wobj_xypoint=pt_14, z_safe_margin=fine_adjust_z_mm)  # -> out, transformed_frames; inputs way_planes: tree, wobj_origin: Point3d, wobj_xaxis: Point3d, wobj_xypoint: Point3d, z_safe_margin: Double
# ---------- transform_geom: Python ----------
from compas.geometry import Frame, Transformation, Translation, Vector, Rotation
import math as m
from ghpythonlib import treehelpers as th
#in this step we transform our way planes to robot space
#the rhino co-ordinate system is rather abstract in the physical world
#the robot base plane assumed the base frame of robot is the origin
#but rhino does not know that
#thus we transform things from our design space(Rhino World XY) to Robot Base Plane that we measure

def set_robot_base(origin, xaxis, xypoint):
    """
    set a base plane representing the robot working object plane
    """
    robot_base = Frame(origin, xaxis - origin, xypoint - origin)
    return (robot_base)

def rhino_to_robot_space(rhino_plane,robot_base_plane):
    """
    Transform the objects from Rhino world XY plane to robot work object plane
    """
    T_matrix = Transformation.from_frame_to_frame(Frame.worldXY(), robot_base_plane)
    robot_plane = rhino_plane.transformed(T_matrix)
    robot_plane = robot_plane.rotated(m.pi,robot_plane.yaxis, robot_plane.point)
    # rotates plane by 180 degress around y axis
    return robot_plane

def set_z_safe_margin(planes_to_adjust, safety_margin):
    adjusted = []
    T = Translation.from_vector(Vector(0, 0, safety_margin))
    for f in planes_to_adjust:
        adjusted.append(f.transformed(T))
    return adjusted

# ===== Tree conversion to List =====
way_planes = th.tree_to_list(way_planes)

# ===== Robot base is set =====
robot_base =  set_robot_base(wobj_origin, wobj_xaxis, wobj_xypoint)

# ===== Set safety margin for Z height ======
safe_planes = [set_z_safe_margin(wy, z_safe_margin) for wy in way_planes]

# ===== Transforming the rhino planes into robot planes =====
transformed_frames = []
for plane in safe_planes: 
    sub_transformed = []
    for pln in plane:
        sub_transformed.append(rhino_to_robot_space(pln, robot_base))
    transformed_frames.append(sub_transformed)

transformed_frames = th.list_to_tree(transformed_frames)
# ---------- end transform_geom ----------
compas_draw_6 = COMPASDraw(cg=transform_geom.transformed_frames)  # -> rg; same code as compas_draw

# ----
# Measure slide top location
py3_7 = Python3Script(origin=pt_3, xaxis_pt=pt_4, xy_pt=pt_5)  # -> out, pick_frame; inputs origin: Point3d, xaxis_pt: Point3d, xy_pt: Point3d
# ---------- py3_7: Python ----------
from compas.geometry import Frame, Point
from compas.geometry import Rotation

from compas_rhino.conversions import point_to_compas

origin = point_to_compas(origin)
xaxis_pt = point_to_compas(xaxis_pt)
xy_pt = point_to_compas(xy_pt)

#define pick frame
pick_frame = Frame(origin, xaxis_pt - origin, xy_pt - origin)
# ---------- end py3_7 ----------
compas_draw_7 = COMPASDraw(cg=py3_7.pick_frame)  # -> rg; same code as compas_draw

# ----
# Measure slide bottom location 1
# (for configuration 1)
py3_8 = Python3Script(origin=pt_6, xaxis_pt=pt_7, xy_pt=pt_8)  # -> out, pick_frame; inputs origin: Point3d, xaxis_pt: Point3d, xy_pt: Point3d; same code as py3_7
compas_draw_8 = COMPASDraw(cg=py3_8.pick_frame)  # -> rg; same code as compas_draw

# ----
# Measure slide bottom location 2
# (for configuration 2)
py3_9 = Python3Script(origin=pt_9, xaxis_pt=pt_11, xy_pt=pt_10)  # -> out, pick_frame; inputs origin: Point3d, xaxis_pt: Point3d, xy_pt: Point3d; same code as py3_7
compas_draw_9 = COMPASDraw(cg=py3_9.pick_frame)  # -> rg; same code as compas_draw

panel_5 = Panel("""0
0""")
number_slider_9 = Slider(0.4, range=0..5)
orientation_setter = Python3Script(frame_list=transform_geom.transformed_frames, ori=py3_3.orientations)  # -> out, branch_count, orientation; inputs frame_list: tree, ori: list of Int32
# ---------- orientation_setter: Python ----------
import ghpythonlib.treehelpers as th
frame_list = th.tree_to_list(frame_list)
branch_count = len(frame_list)
orientation = [ori[n] for n in range(branch_count)]
# ---------- end orientation_setter ----------
number_slider_10 = Slider(0.4, range=0..5)
compas = Python3Script(
    way_frames=transform_geom.transformed_frames,
    orientation=orientation_setter.orientation,
    safe_distance=Slider(50, range=0..500),
    tcp_measured=pt_18,
    tcp2_measured=pt_17,
    acceleration=number_slider_10,
    velocity=number_slider_9,
    pick_frame=pickup_frame_3d_grid.pick_frames,
    place_slide_frame=py3_7.pick_frame,
    pick_slide_frame=py3_8.pick_frame,
    pick_slide_2_frame=py3_9.pick_frame,
    sleep_time=Slider(0.4, range=0..1),
    press_f=Slider(0.9, range=0..2))  # -> out, vis_frames, vis_planes, script; inputs way_frames: tree, orientation: list, safe_distance: Double, tcp_measured: Point3d, acceleration: Double, velocity: Double, pick_frame: list, sleep_time: Double, press_f: Double
# ---------- compas: Python ----------
from imp import reload
import sys
import os
import ghpythonlib.treehelpers as th

#get current file path
path = ghenv.Component.OnPingDocument().FilePath
#get parent directory of the parent directory
parentdir = os.path.dirname(path)
#get src folder which contains classes
dire = os.path.join(parentdir,'src')

sys.path.append(dire)

import simple_ur_script as ur
reload(ur)

import utils 
reload(utils)

import simple_comm as com
reload(com)

import compas.geometry as cg
import math as m

# ===== Set global constants =======

IO = 4 # Global constant
# IO Off: Gripper Closed, Suction Off
# IO On: Gripper Open, Suction On
# check IO number before setting

SAFE_DIST = safe_distance
SUCTION_ANGLES = (
    m.radians(-30.0),
    m.radians(0.0),
    m.radians(45.0)
)
GRIPPER_ANGLES_ONE = (
    m.radians(0.0),
    m.radians(0.0),
    m.radians(45.0)
)
GRIPPER_ANGLES_TWO = (
    m.radians(0.0),
    m.radians(0.0),
    m.radians(45.0)
)

script = ''
vis_frames = []

# =================================

def set_suction_tcp(script):
    """Set TCP to Vacuum Suction Tool Tip"""
    suction_script = ""
    suction_script += ur.set_tcp_by_angles(
        tcp_measured.X,
        tcp_measured.Y,
        tcp_measured.Z,
        *SUCTION_ANGLES
    )
    suction_script += ur.sleep(sleep_time) 
    return suction_script

def set_gripper_tcp(script, ori):
    """Set TCP to Gripper Tool Tip"""
    gripper_ang = GRIPPER_ANGLES_ONE if ori == 0 else GRIPPER_ANGLES_TWO
    gripper_script = ""
    gripper_script += ur.set_tcp_by_angles(
        tcp2_measured.X,
        tcp2_measured.Y,
        tcp2_measured.Z,
        *gripper_ang
    )
    gripper_script += ur.sleep(sleep_time) 
    return gripper_script

def safety_frame(frame, safety_distance):
    return frame.translated(frame.zaxis * -safety_distance)
    # negative zaxis since robot frame is pointing down

def suction_press(frame):
    return frame.translated(frame.zaxis * press_f)
    # we keep this positive as we want this to go down onto the brick

def reset_frame(script):
    reset_script = ""
    reset_script += ur.move_j([m.radians(-122.26), m.radians(-126.48), m.radians(83.87), m.radians(-45.03), m.radians(-86.12), m.radians(17.54)],1, 1)
    return reset_script

def safe_place_frame(script):
    # This is the one that will appear above the paper space
    # Freeze robot at reset frame, then adjust to above the paper space
    safe_place_script = ""
    # Record the joint angles down in the below sequence
    safe_place_script += ur.move_j([m.radians(0.00), m.radians(0.00), m.radians(0.00), m.radians(0.00), m.radians(0.00), m.radians(0.00)],1, 1)
    return safe_place_script

def pickup_brick_tray(script,pick_up_frame):
    
    pickbrick_script = ""
    # Move J in case of faulting
    pickbrick_script += reset_frame(script)
    # Translate frame to "safe" location
    above_pick_tray = safety_frame(pick_up_frame, SAFE_DIST)
    # Move to safe frame
    pickbrick_script += ur.move_l(above_pick_tray, acceleration, velocity)
    # Move to pick location
    pickbrick_script += ur.move_l(pick_up_frame, acceleration, velocity)
    # Move down a little to guarantee pick
    press_down = suction_press(pick_up_frame)
    pickbrick_script += ur.move_l(press_down, acceleration, velocity)
    # Add to the path: turn on the vacuum and wait 
    pickbrick_script += ur.set_digital_out(IO, True)
    pickbrick_script += ur.sleep(sleep_time)
    # Move back to safe plane
    pickbrick_script += ur.move_l(above_pick_tray, acceleration, velocity)

    picktray_frames = [above_pick_tray, pick_up_frame, above_pick_tray]

    return pickbrick_script, picktray_frames

def place_brick_slide(script, place_slide_frame):
    
    placeslide_script = ""
    # Move J in case of faulting
    placeslide_script += reset_frame(script)
    # Safe frame for placing
    above_slide_top = safety_frame(place_slide_frame, SAFE_DIST)
    # Add to the path: go to the safe plane
    placeslide_script += ur.move_l(above_slide_top, acceleration, velocity)
    # Add to the path: go to the place plane
    placeslide_script += ur.move_l(place_slide_frame, acceleration, velocity)
    # Add to the path: turn off the vacuum and wait 
    placeslide_script += ur.set_digital_out(IO, False)
    placeslide_script += ur.sleep(sleep_time)
    # Add to the path: go back to the safe plane
    placeslide_script += ur.move_l(above_slide_top, acceleration, velocity)

    placeslide_frames = [above_slide_top, place_slide_frame, above_slide_top]

    return placeslide_script, placeslide_frames

def pick_brick_slide(script, f1, f2, orient):

    pick_slide_frame = f1 if orient == 0 else f2

    pickslide_script = ""
    # Move J in case of faulting
    pickslide_script += reset_frame(script)
    # Safe frame for picking
    above_slide_bottom = safety_frame(pick_slide_frame, SAFE_DIST)
    # Add to the path: open gripper and wait
    pickslide_script += ur.set_digital_out(IO, True)
    pickslide_script += ur.sleep(sleep_time) 
    # Add to the path: go to the safe plane
    pickslide_script += ur.move_l(above_slide_bottom, acceleration, velocity)    
    # Add to the path: go to the place plane
    pickslide_script += ur.move_l(pick_slide_frame, acceleration, velocity)    
    # Add to the path: close gripper and wait
    pickslide_script += ur.set_digital_out(IO, False)
    pickslide_script += ur.sleep(sleep_time) 
    # Add to the path: go back to the safe plane
    pickslide_script += ur.move_l(above_slide_bottom, acceleration, velocity)
    
    pickslide_frames = [above_slide_bottom, pick_slide_frame, above_slide_bottom]

    return pickslide_script, pickslide_frames

def place_position(script, position_frame):
    
    place_script = ""
    # Move J to above paper space
    place_script += safe_place_frame(script)
    # Safe frame for placing
    above_place_position = safety_frame(position_frame, SAFE_DIST)
    # Add to the path: go to the safe plane
    place_script += ur.move_l(above_place_position, acceleration, velocity)    
    # Add to the path: go to the place plane
    place_script += ur.move_l(position_frame, acceleration, velocity)    
    # Add to the path: open gripper and wait
    place_script += ur.set_digital_out(IO, True)
    place_script += ur.sleep(sleep_time) 
    # Add to the path: go back to the safe plane
    place_script += ur.move_l(above_place_position, acceleration, velocity)  
    # Add to the path: close gripper and wait
    place_script += ur.set_digital_out(IO, False)
    place_script += ur.sleep(sleep_time)

    place_frames = [above_place_position, position_frame, above_place_position]

    return place_script, place_frames

script = ""
vis_frames = []
way_frames = th.tree_to_list(way_frames)
count_pick = 0

#if value given for tcp measured, then add line to script, otherwise it will take current tcp from robot
for num_wy, sub_wy in enumerate(way_frames):
    # num_wy: index of row of bricks to place
    # sub_wy: nested list of bricks per row    
    for n_way, wy in enumerate(sub_wy):
        # n_way: index of brick/frame
        # wy: way frame
        if tcp_measured is not None:

            # 1. Set to suction tcp and add it to script
            set_suction = set_suction_tcp(script)         
            script += set_suction
            print(count_pick)
            # 2. Picking: Call variables for picking script and frames
            pickingplace = pick_frame[count_pick]
            pickbrick_script, picktray_frames = pickup_brick_tray(script, pickingplace)
            script += pickbrick_script
            vis_frames.extend(picktray_frames)
            count_pick += 1

            # 2. Placing: Call variables for placing script and frames
            placeslide_script, placeslide_frames = place_brick_slide(script, place_slide_frame)
            script += placeslide_script
            vis_frames.extend(placeslide_frames)

            # 4. Set to gripper tcp and add it to script
            set_gripper = set_gripper_tcp(script,orientation[num_wy])
            script += set_gripper

            # 5. Gripping: Call variables for gripping(pick) script and frames
            pickslide_script, pickslide_frames = pick_brick_slide(script, pick_slide_frame, pick_slide_2_frame, orientation[num_wy])
            script += pickslide_script
            vis_frames.extend(pickslide_frames)

            # 6. Positioning: Call variables for positioning script and frames
            place_script, place_frames = place_position(script, wy)
            script += place_script
            vis_frames.extend(place_frames)


# Format the script to make it sendable
script = com.concatenate_script(script)

# Visualize
from compas_rhino import conversions
import Rhino.Geometry as rg

vis_planes = [conversions.frame_to_rhino(frame) for frame in vis_frames]
# ---------- end compas ----------

# ---- group: Send UR script to Robot!
# Send to Robot!
# Convert Planes to URScript
py3_10 = Python3Script(script=compas.script, ip_address=panel, send=Button())  # -> out, a; inputs script: String, ip_address: String, send: Boolean
# ---------- py3_10: Python ----------
import simple_comm as com

if send:
    com.send_script(script,ip_address)
# ---------- end py3_10 ----------

# ----
panel_6 = Panel(compas.script)
polyline = PolyLine(Vertices=compas.vis_planes, Closed=False)  # disabled
compas_draw_10 = COMPASDraw(cg=compas.vis_frames)  # -> rg; same code as compas_draw
custom_preview = CustomPreview(Geometry=polyline, Material=ColourSwatch(SwatchColor=RGB(255, 0, 212)))  # disabled
number_slider_11 = Slider(7, range=0..100)  # disabled
points = PointList(Points=compas.vis_planes, Size=number_slider_11)  # disabled

# ==== cluster LinesPts
C = ClusterInput()
D = ClusterInput()
N = ClusterInput()
offset = OffsetCurve(Curve=C, Distance=expr("-x", D), Corners=1)
cp = ControlPoints(Curve=offset)  # -> Points, Weights, Knots
cull_i = CullIndex(List=cp.Points, Indices="-1", Wrap=True)
index = ItemIndex(List=cull_i, Item=cull_i)
equals = Equality(FirstNumber=expr("x%2", index), SecondNumber=0)  # -> Equality, Inequality
cull = CullPattern(List=cull_i, CullPattern=equals.Equality)
pline = PolyLine(Vertices=cull, Closed=False)
divide = DivideCurve(Curve=pline, Count=N, Kinks=False)  # -> Points, Tangents, Parameters
shift_and_subtract = ShiftAndSubtract(L=divide.Points, I="-1")  # -> L_2, L_3
ln = Line(StartPoint=shift_and_subtract.L_2, EndPoint=shift_and_subtract.L_3)
C_2 = ClusterOutput(offset)
P = ClusterOutput(divide.Points)
L = ClusterOutput(ln)

# ==== cluster Cluster
h1 = ClusterInput()
h2 = ClusterInput()
expression = Expression(h1=h1, h2=h2, Expression="1/2*(abs(h1-h2))")
expression_2 = Expression(h1=h1, h2=h2, Expression="1/2*(h1+h2)")
expression_3 = Expression(h1=h1, h2=h2, Expression="max(h1,h2)")
merge = Merge(Data1=0, Data2=expression, Data3=expression_2, Data4=expression_3)
R = ClusterOutput(merge)

# ==== cluster ShiftAndSubtract
L = ClusterInput()
I = ClusterInput()
shift = ShiftList(List=L, Shift=1, Wrap=True)
cull_i = CullIndex(List=L, Indices=I, Wrap=True)
cull_i_2 = CullIndex(List=shift, Indices=I, Wrap=True)
L_2 = ClusterOutput(cull_i)
L_3 = ClusterOutput(cull_i_2)
