# Grasshopper definition Robotic Tower.gh (Grasshopper 1.0.8)

# ---- group: This is needed only ONCE in the GH definition
enable_auto_reload = Python3Script()  # -> ok
# ---------- enable_auto_reload: Python ----------
"""
------------------------------
Using VS Code as Python editor
------------------------------

The simplest way to start using VS Code as our editor, is
to place our Python code in files located IN THE SAME FOLDER as our Grasshopper file.

After we have done that, we need 2 steps: 

1. Enable the COMPAS reloader on one component. This tells Grasshopper to watch for changes in the Pythoh files and reload if changed.
2. Every other component that uses Python code from external files needs to start with a method to ensure Grasshopper knows where to load the files from.

"""
# r: compas
# venv: mas-2627

from compas_rhino.devtools import DevTools
DevTools.enable_reloader()
# ---------- end enable_auto_reload ----------

# ----
number_slider = Slider(1, range=0..10)
number_slider_2 = Slider(420, range=0..1000)
number_slider_3 = Slider(594, range=0..1000)
offset = Slider(100, range=0..100)
number_slider_4 = Slider(77, range=0..1000)
min_radius = Slider(45.25, range=0..200)
factor = Slider(1.601, range=0..10)
modules = Slider(8, range=0..100)
number_slider_5 = Slider(30, range=0..90)
list = ValueList({"Config 1": 0, "Config 2": 1, "Config 3": 2}, selected="Config 1")
list_2 = ValueList({"Config 1": 0, "Config 2": 1, "Config 3": 2}, selected="Config 2")

# ---- group: Python rebuild
diagrid_and_site = S1Towers(x_bound=number_slider_2, y_bound=number_slider_3, offset=offset, spacing=number_slider_4)  # -> site, points
# ---------- diagrid_and_site: Python ----------
import Rhino.Geometry as rg

# Site boundary
site = rg.Rectangle3d(rg.Plane.WorldXY, x_bound, y_bound).ToNurbsCurve()

# Usable grid snapped to multiples of spacing, centred on the site
x_dim = (x_bound - 2 * offset) // spacing * spacing
y_dim = (y_bound - 2 * offset) // spacing * spacing
off_x = (x_bound - x_dim) / 2
off_y = (y_bound - y_dim) / 2

# Checkerboard cells -> one centre point per tower (row by row)
points = [
    rg.Point3d(off_x + spacing * col, off_y + spacing * row, 0.0)
    for row in range(int(y_dim // spacing) + 1)
    for col in range(int(x_dim // spacing) + 1)
    if col % 2 == row % 2
]
# ---------- end diagrid_and_site ----------
pattern = Panel("""1
2
2
1""")
module_information = S2Modules(configs=[list, list_2], pattern=pattern, modules=modules)  # -> length, lengths, widths, module_h, step, levels, t; inputs configs: list, pattern: list
# ---------- module_information: Python ----------
# r: compas
# venv: mas-2627
from compas_rhino.devtools import DevTools
DevTools.ensure_path()

from brick_wall import Brick

# One brick per config; pattern holds 1-based positions in configs (e.g. 1,2,2,1)
bricks = []
for c in configs:
    b = Brick()
    b.configuration(c)
    bricks.append(b)
slots = [bricks[int(p) - 1] for p in pattern]

length = slots[0].length
lengths = [b.length for b in slots]
widths = [b.width for b in slots]

# Distinct bricks centred on a shared mid-plane: their bottom/top faces are the sub-levels
used = [bricks[i] for i in sorted({int(p) - 1 for p in pattern})]
top = max(b.height for b in used)
module_h = sorted({(top + s * b.height) / 2 for b in used for s in (-1, 1)})
step = sum(b.height for b in used)

# All sub-levels, module by module
n = int(modules)
levels = [m * step + h for m in range(n) for h in module_h]

# Normalised level parameters (0..1) for the Graph Mapper
t = [i / (n - 1) for i in range(n)]
# ---------- end module_information ----------
graph = GraphMapper(module_information.t, x0=0, x1=1, y0=0, y1=1, container_name="Sine", Equation_px=[0, 0.4571428597], Equation_py=[0, 1])
radii_and_rotations = S3Profile(graph=graph, min_radius=min_radius, factor=factor, degrees=number_slider_5)  # -> radii, angles; inputs graph: list
#   port min_radius: Input min_radius
#   port degrees: Input degrees
#   port angles: Output angles
# ---------- radii_and_rotations: Python ----------
import math

# Source domain = actual bounds of the graph values, normalised to 0..1
g_min, g_max = min(graph), max(graph)
norm = [(g - g_min) / (g_max - g_min) for g in graph]

# Remap the profile to a radius and a rotation angle per level
r_max = min_radius * factor
radii = [min_radius + n * (r_max - min_radius) for n in norm]
angles = [math.radians(-degrees + n * 2 * degrees) for n in norm]
# ---------- end radii_and_rotations ----------
rings = S4Rings(
    points=diagrid_and_site.points,
    radii=radii_and_rotations.radii,
    angles=radii_and_rotations.angles,
    step=module_information.step)  # -> rings, ring_angles; inputs points: list, radii: list, angles: list
#   port ring_angles: Output ring_angles
# ---------- rings: Python ----------
import Rhino.Geometry as rg
import ghpythonlib.treehelpers as th

n = len(radii)

# Per tower: profile shifted by the tower index (wrapped, as Shift List with x%z)
rings = th.list_to_tree([
    [rg.Circle(rg.Point3d(p.X, p.Y, k * step), radii[(k + i) % n]) for k in range(n)]
    for i, p in enumerate(points)
])
ring_angles = th.list_to_tree([
    [angles[(k + i) % n] for k in range(n)]
    for i in range(len(points))
])
# ---------- end rings ----------
rotation = Slider(42, range=0..90)
curve_division = S5Division(rings=rings.rings, ring_angles=rings.ring_angles, length=module_information.length, gap=number_slider)  # -> points, tangents, params; inputs rings: tree, ring_angles: tree
#   port ring_angles: Input ring_angles
#   port points: Output points
#   port tangents: Output tangents
#   port params: Output params
# ---------- curve_division: Python ----------
import math
import ghpythonlib.treehelpers as th

ring_list = th.tree_to_list(rings)
angle_list = th.tree_to_list(ring_angles)

# Two division points per projected brick length (+ gap), rounded down to an even count
counts = [
    [int(c.GetLength() / (0.5 * (length * math.cos(a) + gap)) // 2 * 2) for c, a in zip(cs, aa)]
    for cs, aa in zip(ring_list, angle_list)
]
t = [[list(c.DivideByCount(n, True)) for c, n in zip(cs, ns)] for cs, ns in zip(ring_list, counts)]

points = th.list_to_tree([[[c.PointAt(x) for x in ts] for c, ts in zip(cs, tt)] for cs, tt in zip(ring_list, t)])
tangents = th.list_to_tree([[[c.TangentAt(x) for x in ts] for c, ts in zip(cs, tt)] for cs, tt in zip(ring_list, t)])
params = th.list_to_tree(t)
# ---------- end curve_division ----------
rotate_points = RotatePoints(rings=rings.rings, points=curve_division.points, tangents=curve_division.tangents, rotation=rotation)  # -> rot_points, rot_tangents; inputs rings: tree, points: tree, tangents: tree
#   port tangents: Input tangents
#   port rotation: Input rotation
#   port rot_points: Output rot_points
#   port rot_tangents: Output rot_tangents
# ---------- rotate_points: Python ----------
import math
import Rhino.Geometry as rg
import ghpythonlib.treehelpers as th

ring_list = th.tree_to_list(rings)
pt_list = th.tree_to_list(points)
tan_list = th.tree_to_list(tangents)

# Twist: each circle turns rotation / (circles per tower) further than the one below, about its own axis
xforms = [
    [rg.Transform.Rotation(math.radians(rotation / len(cs) * k), c.Arc.Plane.ZAxis, c.Arc.Center) for k, c in enumerate(cs)]
    for cs in ring_list
]

rot_points = th.list_to_tree([[[x * p for p in ps] for x, ps in zip(xs, pss)] for xs, pss in zip(xforms, pt_list)])
rot_tangents = th.list_to_tree([[[x * v for v in vs] for x, vs in zip(xs, vss)] for xs, vss in zip(xforms, tan_list)])
# ---------- end rotate_points ----------
cull_points = S6Cull(
    rings=rings.rings,
    points=rotate_points.rot_points,
    tangents=rotate_points.rot_tangents,
    lengths=module_information.lengths,
    widths=module_information.widths,
    module_h=module_information.module_h,
    gap=number_slider)  # -> kept_points, kept_tangents; inputs rings: tree, points: tree, tangents: tree, lengths: list, widths: list, module_h: list
#   port tangents: Input tangents
#   port lengths: Input lengths
#   port module_h: Input module_h
#   port kept_points: Output kept_points
#   port kept_tangents: Output kept_tangents
# ---------- cull_points: Python ----------
import math
import Rhino.Geometry as rg
import ghpythonlib.treehelpers as th

ring_list = th.tree_to_list(rings)
pt_list = th.tree_to_list(points)
tan_list = th.tree_to_list(tangents)
towers, levels = len(ring_list), len(ring_list[0])

# Clearance between towers: largest brick plan diagonal in the pattern + gap
threshold = max(math.hypot(l, w) for l, w in zip(lengths, widths)) + gap

# Per level, larger rings win: go from largest to smallest radius (ties keep tower order)
# and keep a point only if it clears every point already kept on other rings
keep = [[None] * levels for _ in range(towers)]
for k in range(levels):
    kept = []
    for i in sorted(range(towers), key=lambda i: -ring_list[i][k].Radius):
        keep[i][k] = [all(p.DistanceTo(q) >= threshold for q in kept) for p in pt_list[i][k]]
        kept += [p for p, ok in zip(pt_list[i][k], keep[i][k]) if ok]

# Copy the kept points and tangents to every sub-level of their module
kept_points = th.list_to_tree([
    [[p + rg.Vector3d(0, 0, h) for p, ok in zip(pt_list[i][k], keep[i][k]) if ok] for k in range(levels) for h in module_h]
    for i in range(towers)
])
kept_tangents = th.list_to_tree([
    [[v for v, ok in zip(tan_list[i][k], keep[i][k]) if ok] for k in range(levels) for h in module_h]
    for i in range(towers)
])
# ---------- end cull_points ----------

# ----
lamcp = LAMCPBridge(enable=Toggle(True))  # -> status; inputs enable: Boolean, port: Int32
#   port enable: Toggle to start (True) or stop (False) the local HTTP server.
#   port port: Port to listen on (loopback only). Defaults to 8765.
#   port status: Current server status string.
# ---------- lamcp: Python ----------
"""
LAMCP Bridge: local HTTP server inside Rhino 8 / Grasshopper CPython.

Exposes `POST /exec` (JSON: `{"code": "...", "timeout": 30}`) which
exec()s `code` and returns
`{"stdout": "...", "stderr": "...", "result": "...", "error": null|str}`.

Pair with the `lamcp` FastMCP server, which translates Claude's
`run_python_script` MCP tool calls into POSTs to this endpoint.

Binds to 127.0.0.1 only. NEVER expose beyond localhost â€” it exec()s
arbitrary Python with full Rhino API access.

LAMCP v0.1.0
"""

import contextlib
import io
import json
import threading
import traceback
from http.server import BaseHTTPRequestHandler
from http.server import HTTPServer

import Grasshopper
import scriptcontext as sc


SHARED_GLOBALS_KEY = "_lamcp_bridge_globals"
SERVER_KEY = "_lamcp_bridge_server"


def _exec_code(code, timeout):
    """Run `code` on the HTTP-server thread and capture stdout/stderr/result.

    NOTE: this is intentionally NOT marshalled to Rhino's UI thread for the
    spike â€” `Rhino.RhinoApp.InvokeOnUiThread` was queueing actions that
    never fired in Rhino 8 CPython. Most read-only RhinoCommon access is
    safe cross-thread; mutations may crash. Add Eto-based marshalling
    back here when we need it.
    """
    out = io.StringIO()
    err = io.StringIO()
    g = sc.sticky.setdefault(SHARED_GLOBALS_KEY, {"__name__": "__lamcp_bridge__"})
    error_text = None
    result_repr = None
    try:
        with contextlib.redirect_stdout(out), contextlib.redirect_stderr(err):
            exec(code, g, g)
            result_repr = repr(g.get("_"))
    except BaseException:
        error_text = traceback.format_exc()

    return {
        "stdout": out.getvalue(),
        "stderr": err.getvalue(),
        "result": result_repr,
        "error": error_text,
    }


class _ExecHandler(BaseHTTPRequestHandler):
    # Silence default request logging so it doesn't clog the Rhino command line.
    def log_message(self, fmt, *args):
        pass

    def _send(self, code, payload):
        body = json.dumps(payload).encode("utf-8")
        self.send_response(code)
        self.send_header("Content-Type", "application/json")
        self.send_header("Content-Length", str(len(body)))
        self.end_headers()
        self.wfile.write(body)

    def do_GET(self):
        if self.path == "/health":
            self._send(200, {"status": "ok"})
        else:
            self._send(404, {"error": "not found"})

    def do_POST(self):
        if self.path != "/exec":
            self._send(404, {"error": "not found"})
            return
        length = int(self.headers.get("Content-Length", "0"))
        try:
            raw = self.rfile.read(length).decode("utf-8")
            body = json.loads(raw)
            code = body.get("code", "")
            timeout = float(body.get("timeout", 30.0))
        except Exception as exc:
            self._send(400, {"error": "bad request: " + repr(exc)})
            return
        result = _exec_code(code, timeout)
        self._send(200, result)


def _start_server(port):
    server = HTTPServer(("127.0.0.1", port), _ExecHandler)
    thread = threading.Thread(
        target=server.serve_forever, daemon=True, name="lamcp-bridge"
    )
    thread.start()
    return {"server": server, "thread": thread, "port": port}


def _stop_server(state):
    try:
        state["server"].shutdown()
        state["server"].server_close()
    except Exception:
        pass


class LamcpBridgeComponent(Grasshopper.Kernel.GH_ScriptInstance):
    def RunScript(self, enable: bool, port: int):
        port = int(port) if port else 8765

        state = sc.sticky.get(SERVER_KEY)

        if not enable:
            if state is not None:
                _stop_server(state)
                del sc.sticky[SERVER_KEY]
            return "stopped"

        # Already running on the requested port: no-op.
        if (
            state is not None
            and state.get("port") == port
            and state["thread"].is_alive()
        ):
            return "listening on http://127.0.0.1:{}".format(port)

        # Port changed or server died: tear down and restart.
        if state is not None:
            _stop_server(state)
            del sc.sticky[SERVER_KEY]

        try:
            sc.sticky[SERVER_KEY] = _start_server(port)
        except OSError as exc:
            ghenv.Component.AddRuntimeMessage(  # noqa: F821
                Grasshopper.Kernel.GH_RuntimeMessageLevel.Error,
                "Failed to bind 127.0.0.1:{}: {}".format(port, exc),
            )
            return "error: {}".format(exc)

        return "listening on http://127.0.0.1:{}".format(port)
# ---------- end lamcp ----------
brick_dimensions = Python3Script(orientation=list)  # -> out, length, width, height, orient
# ---------- brick_dimensions: Python ----------
# r: compas
# venv: mas-2627
from compas_rhino.devtools import DevTools
DevTools.ensure_path()

from brick_wall import Brick

samplebrick = Brick()
samplebrick.configuration(orientation)

length = samplebrick.length
width = samplebrick.width
height = samplebrick.height
orient = orientation
# ---------- end brick_dimensions ----------
brick_dimensions_2 = Python3Script(orientation=list_2)  # -> out, length, width, height, orient; same code as brick_dimensions
expression = Expression(x=min_radius, y=factor, Expression="x*y")
pt = ConstructPoint(XCoordinate=expr("x/2", number_slider_2), YCoordinate=expr("x/2", number_slider_3), ZCoordinate=0)
rectangle = Rectangle(Plane=PlaneXY(0, 0, 0), XSize=number_slider_2, YSize=number_slider_3, Radius=0)  # -> Rectangle, Length
panel = Panel(lamcp)
diagrid = Python3Script(x_bound=number_slider_2, y_bound=number_slider_3, offset=offset, spacing=number_slider_4)  # -> out, flatten(pts); inputs x_bound: Double, y_bound: Double
# ---------- diagrid: Python ----------
import math as m
import Rhino.Geometry as rg
import ghpythonlib.treehelpers as th

x_dim = (x_bound - 2*offset)//spacing*spacing
y_dim = (y_bound - 2*offset)//spacing*spacing
off_x = (x_bound - x_dim)/2
off_y = (y_bound - y_dim)/2

x_count = int(x_dim // spacing) + 1
y_count = int(y_dim // spacing) + 1

pts = [
    [
        rg.Point3d(off_x + (spacing * col), off_y + (spacing * row), 0.0)
        for col in range(x_count)
        if col % 2 == row % 2  # Checkerboard condition evaluated per point
    ]
    for row in range(y_count)
]
pts = th.list_to_tree(pts)
# ---------- end diagrid ----------
cluster_heights = ClusterHeights(x=brick_dimensions.height, y=brick_dimensions_2.height)  # -> R, R_2
series = Series(Start=cluster_heights.R, Step=cluster_heights.R_2, Count=modules)
flip = FlipMatrix(Data=series)  # -> flatten(Data)
range = Range(Domain=Domain(0, 1), Steps=expr("x-1", modules))
lng = ListLength(List=diagrid.pts)
index = ItemIndex(List=diagrid.pts, Item=diagrid.pts)
modules_heights = Panel(flip)
module_heights = Panel(cluster_heights.R)
step_between_modules = Panel(cluster_heights.R_2)
pdecon = Deconstruct(Point=graft(diagrid.pts))  # -> XComponent, YComponent, ZComponent
graph_2 = GraphMapper(range, x0=0, x1=1, y0=0, y1=1, container_name="Sine", Equation_px=[0, 0.4571428597], Equation_py=[0, 1])
rad = Radians(Degrees=number_slider_5)
dom = ConstructDomain(DomainStart=expr("-x", rad), DomainEnd=rad)
bnd = Bounds(Numbers=graph_2)
dom_2 = ConstructDomain(DomainStart=min_radius, DomainEnd=expression)
expression_2 = Expression(x=index, z=lng, Expression="x%z")
remap = RemapNumbers(Value=graph_2, Source=bnd, Target=dom_2)  # -> Mapped, Clipped
remap_2 = RemapNumbers(Value=graph_2, Source=bnd, Target=dom)  # -> Mapped, Clipped
shift = ShiftList(List=remap_2.Mapped, Shift=graft(expression_2), Wrap=True)  # -> simplify(List)
series_2 = Series(Start=0, Step=step_between_modules, Count=modules)
shift_2 = ShiftList(List=remap.Mapped, Shift=graft(expression_2), Wrap=True)  # -> simplify(List)
pt_2 = ConstructPoint(XCoordinate=pdecon.XComponent, YCoordinate=pdecon.YComponent, ZCoordinate=series_2)  # -> simplify(Point)
expression_3 = Expression(x=brick_dimensions.length, y=shift, gap=number_slider, Expression="1/2*(x*cos(y)+gap)")
cir = Circle(Plane=pt_2, Radius=shift_2)
len = Length(Curve=cir)
expression_4 = Expression(c=len, p=expression_3, Expression="((c/p)\2)*2")
divide = DivideCurve(Curve=cir, Count=simplify(expression_4), Kinks=False)  # -> Points, Tangents, Parameters

# ==== cluster ClusterHeights
x = ClusterInput()
y = ClusterInput()

# ---- group: 0 = starting height
num = Number(0)

# ---- group: 1 = difference between half heights
expression = Expression(x=x, y=y, Expression="1/2*(abs(x-y))")

# ---- group: 2 = sum of half heights
expression_2 = Expression(x=x, y=y, Expression="1/2*(abs(x+y))")

# ---- group: 3 = height of taller element
expression_3 = Expression(x=x, y=y, Expression="max(x,y)")

# ----
merge = Merge(Data1=num, Data2=expression, Data3=expression_2, Data4=expression_3)

# ---- group: height betwen clusters
expression_4 = Expression(x=x, y=y, Expression="sum(x,y)")

# ----
R = ClusterOutput(merge)
R_2 = ClusterOutput(expression_4)
