# Grasshopper definition 101_brick_to_robot- curved wall.gh (Grasshopper 1.0.8)

# ---- group: not working, too little gaps
curve = Curve(<curve referenced from the Rhino model>)
bricks = Python3Script(crv=curve, num_layers=Slider(17, range=0..30), gap=Slider(2, range=0..30), rotation=Slider(0.2, range=0..1))  # -> out, geometries, bricks, frames; inputs crv: Curve, num_layers: Int32, gap: Int32, rotation: Int32
# ---------- bricks: Python ----------
# r: compas
# venv: mas-2627
from compas_rhino.devtools import DevTools
DevTools.ensure_path()

# Import everything we will need
import math
from compas.geometry import Frame
from compas.geometry import Point
from compas.geometry import Vector

# import curve from compas
from compas_rhino.conversions import curve_to_compas 
from compas.geometry import cross_vectors

from brick_wall import Brick


# creating empty lists 
bricks = []

# convert curve
compas_crv = curve_to_compas(crv)

# spacing, dividing curve into positions
spacing = Brick.LENGTH + gap

params, points = compas_crv.divide_by_length(spacing, True)

# layer patterns
# 1. brick position 01
# 0 brick position 02 

patterns = [
    [1,1,1],
    [1,0,1],
]

# bricks in each layer 
for i in range(num_layers):
    z = i*(Brick.HEIGHT)
    angle = math.radians(i*rotation)

    cos_a = math.cos(angle)
    sin_a = math.sin(angle)

    # pattern for layer
    pattern = patterns[i % len(patterns)]

    for j, (param, pt) in enumerate(zip(params,points)):

        # pattern along the curve
        pattern_index = j % len(pattern)
        place_brick = pattern[pattern_index]

        if place_brick == 0:
            continue

        # original position in curve
        x = pt.x
        y = pt.y

        rotated_x = x*cos_a -y * sin_a
        rotated_y = x*sin_a -y * cos_a

        # position 
        brick_point = Point( rotated_x, rotated_y, z)

        # direction along the curve
        tangent = compas_crv.tangent_at(param)

        # roate tangent by same angle 
        tx = tangent.x*cos_a -tangent.y * sin_a
        ty = tangent.x*sin_a -tangent.y * cos_a

        tangent = Vector(tx, ty, tangent.z)

        # for perpendicular
        normal = cross_vectors(tangent, [0,0,1])

        if (j + i) % 2 == 0:
            xaxis = normal
            yaxis = tangent
        else:
            xaxis = tangent
            yaxis = normal

        # brick frame 
        frame = Frame(brick_point, xaxis=xaxis, yaxis=yaxis)

        # brick and store
        brick = Brick(frame)
        bricks.append(brick)

geometries = []
frames= []

for brick in bricks:
    geometries.append(brick.draw())
    frames.append(brick.get_pick_frame())

    # geometry = brick.draw()
    # geometries.append(geometry)

    # pick_frame = brick.get_pick_frame()
    # frames.append(pick_frame)
# ---------- end bricks ----------
compas_draw = COMPASDraw(cg=bricks.geometries)  # -> rg
#   port cg: The COMPAS geometry or datastructure to be drawn.
#   port rg: The Rhino geometry object.
# ---------- compas_draw: Python ----------
# r: compas>=2.14.1
"""
Draws COMPAS geometry in Grasshopper.
"""

from typing import Any

import Grasshopper

from compas.scene import SceneObject


class CompasToRhinoGeometry(Grasshopper.Kernel.GH_ScriptInstance):
    def RunScript(self, cg):
        if not cg:
            return None

        return SceneObject(item=cg).draw()
# ---------- end compas_draw ----------
compas_draw_2 = COMPASDraw(cg=bricks.frames)  # -> rg; same code as compas_draw

# ---- group: curves on one vertical plane(not working on rotationg?)
curve_2 = Curve(<curve referenced from the Rhino model>)
bricks_2 = Python3Script(crv=curve_2, num_layers=Slider(7, range=0..30), gap=Slider(0, range=0..30), rotation=Slider(0, range=0..30))  # -> out, geometries, bricks, frames; inputs crv: Curve, num_layers: Int32, gap: Int32, rotation: Int32
# ---------- bricks_2: Python ----------
# r: compas
# venv: mas-2627
from compas_rhino.devtools import DevTools
DevTools.ensure_path()

import math
import ghpythonlib.treehelpers as th
from compas.geometry import Frame
from compas.geometry import Point
from compas.geometry import Vector
from compas.geometry import Rotation
from compas.geometry import cross_vectors

from compas_rhino.conversions import curve_to_compas 
from brick_wall import Brick

# brick list
bricks = []
frames = []

# convert curve
compas_crv = curve_to_compas(crv)

# half brick to interlock
full_spacing = Brick.LENGTH + gap 
half_spacing = full_spacing / 2.0
params, points = compas_crv.divide_by_length(half_spacing, True)

# layer patterns
# 1. horizontal
# 2. vertical
patterns = {
    "even": [1, 2],
    "odd":  [2, 1]
}

# bricks in each layer
for i in range(num_layers):
    z = i * Brick.HEIGHT
    
    angle = math.radians(i * rotation) if 'rotation' in globals() else 0.0
    R = Rotation.from_axis_and_angle([0, 0, 1], angle)

    # even, odd
    is_even = (i % 2 == 0)
    pattern = patterns["even"] if is_even else patterns["odd"]
    subbricks = []
    subframes = []

    for j, (param, pt) in enumerate(zip(params, points)):
        
        # interlocking
        if (j % 2 == 0) != is_even:
            continue
            
        # pattern list
        modular_index = (j // 2) % len(pattern)
        brick_type = pattern[modular_index]

        # position
        brick_point = Point(pt.x, pt.y, z)

        # direction and perpendicular
        tangent_base = compas_crv.tangent_at(param)
        normal_base = Vector(*cross_vectors([0, 0, 1], tangent_base))

        # transformation
        tangent = tangent_base.transformed(R)
        normal = normal_base.transformed(R)

        # orientations:
        if brick_type == 1:
            # 1. horizontal (lying flat)
            frame = Frame(brick_point, xaxis=tangent, yaxis=normal)
            frame.point += Vector(0.0, 0.0, 0.5 * Brick.HEIGHT)
            
        elif brick_type == 2:
            # 2. vertical (standing on its edge/side)
            frame = Frame(brick_point, xaxis=-normal, yaxis=tangent)
            
            # Rotate 90 degrees around the local x-axis, anchored locally at the frame point
            R_stand = Rotation.from_axis_and_angle(frame.xaxis, math.radians(90), point=frame.point)
            frame.transform(R_stand)
            
            # Adjust vertical offset for the standing dimension
            frame.point += Vector(0.0, 0.0, 0.5 * Brick.WIDTH)
        
        # brick frame & object
        brick = Brick(frame)
        subbricks.append(brick)
        subframes.append(frame)

    bricks.append(subbricks)
    frames.append(subframes)

geometries = [[b.draw() for b in subb] for subb in bricks]
geometries = th.list_to_tree(geometries)
frames = th.list_to_tree(frames)
# ---------- end bricks_2 ----------
compas_draw_3 = COMPASDraw(cg=bricks_2.geometries)  # -> rg; same code as compas_draw
compas_draw_4 = COMPASDraw(cg=bricks_2.frames)  # -> rg; same code as compas_draw

# ---- group: This is needed only ONCE in the GH definition
enable_auto_reload = Python3Script()  # -> ok
# ---------- enable_auto_reload: Python ----------
"""
------------------------------
Using VS Code as Python editor
------------------------------

The simplest way to start using VS Code as our editor, is
to place our Python code in files located IN THE SAME FOLDER as our Grasshopper file.

After we have done that, we need 2 steps: 

1. Enable the COMPAS reloader on one component. This tells Grasshopper to watch for changes in the Pythoh files and reload if changed.
2. Every other component that uses Python code from external files needs to start with a method to ensure Grasshopper knows where to load the files from.

"""
# r: compas
# venv: mas-2627

from compas_rhino.devtools import DevTools
DevTools.enable_reloader()
# ---------- end enable_auto_reload ----------

# ---- group: works 02
number_slider = Slider(0.2, range=0..1)
curve_3 = Curve(<curve referenced from the Rhino model>)
bricks_3 = Python3Script(crv=curve_3, num_layers=Slider(17, range=0..30), gap=Slider(6, range=0..30), rotation=Slider(5, range=0..30))  # -> out, geometries, bricks, frames; inputs crv: Curve, num_layers: Int32, gap: Int32, rotation: Int32
# ---------- bricks_3: Python ----------
# r: compas
# venv: mas-2627
from compas_rhino.devtools import DevTools
DevTools.ensure_path()

# Import everything we will need
import math
from compas.geometry import Frame
from compas.geometry import Point
from compas.geometry import Vector
from compas.geometry import Rotation


# import curve from compas
from compas_rhino.conversions import curve_to_compas 
from compas.geometry import cross_vectors

from brick_wall import Brick


# creating empty lists 
bricks = []

# convert curve
compas_crv = curve_to_compas(crv)

# spacing, dividing curve into positions
spacing = (Brick.LENGTH + gap) / 1.5

params, points = compas_crv.divide_by_length(spacing, True)

# layer patterns
# 1. brick position 01
# 0 brick position 02 

patterns = [
    [1,0],
    [0,1],
]

# bricks in each layer 
for i in range(num_layers):
    z = i*(Brick.HEIGHT)
    angle = math.radians(i*rotation) if 'rotation' in globals() else 0.0
    R = Rotation.from_axis_and_angle([0, 0, 1], angle)


    # pattern for layer
    pattern = patterns[i % len(patterns)]

    for j, (param, pt) in enumerate(zip(params,points)):

        # pattern along the curve
        pattern_index = j % len(pattern)
        place_brick = pattern[pattern_index]

        # if place_brick == 0:
        #     continue


        # position 
        brick_point = Point(pt.x, pt.y, z)

        # direction along the curve
        tangent_base = compas_crv.tangent_at(param)
        normal_base = Vector(*cross_vectors(tangent_base, [0, 0, 1]))

        # transformation
        tangent = tangent_base.transformed(R)
        normal = normal_base.transformed(R)

        if place_brick == 1:
            frame = Frame(brick_point, xaxis=tangent, yaxis=normal)
        else:
            frame = Frame(brick_point, xaxis=normal, yaxis=tangent)

        # brick and store
        brick = Brick(frame)
        bricks.append(brick)

geometries = []
frames= []

for brick in bricks:
    geometries.append(brick.draw())
    frames.append(brick.get_pick_frame())
# ---------- end bricks_3 ----------
compas_draw_5 = COMPASDraw(cg=bricks_3.geometries)  # -> rg; same code as compas_draw
compas_draw_6 = COMPASDraw(cg=bricks_3.frames)  # -> rg; same code as compas_draw

# ----
gap = Slider(7.9, range=0..10)

curve_4 = Curve(<curve referenced from the Rhino model>)
bricks_4 = Python3Script(crv=curve_4, num_layers=Slider(7, range=0..30), gap=Slider(4, range=0..30), rotation=Slider(0, range=0..30))  # -> out, geometries, bricks, frames; inputs crv: Curve, num_layers: Int32, gap: Int32, rotation: Int32
# ---------- bricks_4: Python ----------
# r: compas
# venv: mas-2627
from compas_rhino.devtools import DevTools
DevTools.ensure_path()

import math
import ghpythonlib.treehelpers as th
from compas.geometry import Frame
from compas.geometry import Point
from compas.geometry import Vector
from compas.geometry import Rotation
from compas.geometry import cross_vectors

from compas_rhino.conversions import curve_to_compas 
from brick_wall import Brick

# brick list
bricks = []
frames = []

# convert curve
compas_crv = curve_to_compas(crv)

# half brick to interloack
full_spacing = Brick.LENGTH + gap 
half_spacing = full_spacing / 2.0
params, points = compas_crv.divide_by_length(half_spacing, True)

# layer patterns
# 1. horizontal
# 2. chnaged
patterns = {
    "even": [1, 2, 1],
    "odd":  [1, 1, 2]
}

# bricks in each layer
for i in range(num_layers):
    z = i * Brick.HEIGHT
    
    angle = math.radians(i * rotation) if 'rotation' in globals() else 0.0
    R = Rotation.from_axis_and_angle([0, 0, 1], angle)

    # even, odd
    is_even = (i % 2 == 0)
    pattern = patterns["even"] if is_even else patterns["odd"]
    subbricks = []
    subframes = []

    for j, (param, pt) in enumerate(zip(params, points)):
        
        # interlocking
        if (j % 2 == 0) != is_even:
            continue
            
        # pattern list
        modular_index = (j // 2) % len(pattern)
        brick_type = pattern[modular_index]

        # position
        brick_point = Point(pt.x, pt.y, z)

        # direction and perpendicular
        tangent_base = compas_crv.tangent_at(param)
        normal_base = Vector(*cross_vectors([0, 0, 1], tangent_base))

        # transformation
        tangent = tangent_base.transformed(R)
        normal = normal_base.transformed(R)

        # orientations:
        if brick_type == 1:
            # 1. horizontal
            frame = Frame(brick_point, xaxis=tangent, yaxis=normal)
        elif brick_type == 2:
            # 2. vertical
            frame = Frame(brick_point, xaxis=-normal, yaxis=tangent)
        
        frame.point += (Vector(0.0,0.0,1/2*Brick.HEIGHT))
        # bruck frame
        brick = Brick(frame)
        subbricks.append(brick)
        subframes.append(frame)

    bricks.append(subbricks)
    frames.append(subframes)

geometries = [[b.draw() for b in subb] for subb in bricks]
# frames = [[b.get_pick_frame() for b in subb] for subb in bricks]
geometries = th.list_to_tree(geometries)
frames = th.list_to_tree(frames)


# geometries = []
# frames = []
# ---------- end bricks_4 ----------
compas_draw_7 = COMPASDraw(cg=bricks_4.geometries)  # -> rg; same code as compas_draw
compas_draw_8 = COMPASDraw(cg=bricks_4.frames)  # -> rg; same code as compas_draw

# ---- group: chnage gap condition
number_slider_2 = Slider(0.2, range=0..1)
curve_5 = Curve(<curve referenced from the Rhino model>)
bricks_5 = Python3Script(crv=curve_5, num_layers=Slider(6, range=0..30), gap=Slider(7, range=0..30), rotation=Slider(2, range=0..30))  # -> out, geometries, bricks, frames; inputs crv: Curve, num_layers: Int32, gap: Int32, rotation: Int32
# ---------- bricks_5: Python ----------
# r: compas
# venv: mas-2627
from compas_rhino.devtools import DevTools
DevTools.ensure_path()

# Import everything we will need
import math
from compas.geometry import Frame
from compas.geometry import Point
from compas.geometry import Vector
from compas.geometry import Rotation


# import curve from compas
from compas_rhino.conversions import curve_to_compas 
from compas.geometry import cross_vectors

from brick_wall import Brick


# creating empty lists 
bricks = []

# convert curve
compas_crv = curve_to_compas(crv)

# spacing, dividing curve into positions
spacing = (Brick.LENGTH + gap) / 1.5

params, points = compas_crv.divide_by_length(spacing, True)

# layer patterns
# 1. brick position 01
# 0 brick position 02 

patterns = [
    [1,2],
    [2,1],
]

# bricks in each layer 
for i in range(num_layers):
    z = i*(Brick.HEIGHT)
    angle = math.radians(i*rotation) if 'rotation' in globals() else 0.0
    R = Rotation.from_axis_and_angle([0, 0, 1], angle)


    # pattern for layer
    pattern = patterns[i % len(patterns)]

    for j, (param, pt) in enumerate(zip(params,points)):

        # pattern along the curve
        pattern_index = (j) % len(pattern)
        brick_type = pattern[pattern_index]


        # position 
        brick_point = Point(pt.x, pt.y, z)

        # direction along the curve
        tangent_base = compas_crv.tangent_at(param)
        normal_base = Vector(*cross_vectors(tangent_base, [0, 0, 1]))

        # transformation
        tangent = tangent_base.transformed(R)
        normal = normal_base.transformed(R)

        if brick_type == 1:
            frame = Frame(brick_point, xaxis=tangent, yaxis=normal)
        elif brick_type == 2:
            frame = Frame(brick_point, xaxis=normal, yaxis=tangent)

        # brick and store
        brick = Brick(frame)
        bricks.append(brick)

geometries = []
frames= []

for brick in bricks:
    geometries.append(brick.draw())
    frames.append(brick.get_pick_frame())
# ---------- end bricks_5 ----------
compas_draw_9 = COMPASDraw(cg=bricks_5.geometries)  # -> rg; same code as compas_draw
compas_draw_10 = COMPASDraw(cg=bricks_5.frames)  # -> rg; same code as compas_draw

# ---- group: can try this
number_slider_3 = Slider(0.2, range=0..1)
curve_6 = Curve(<curve referenced from the Rhino model>)
bricks_6 = Python3Script(crv=curve_6, num_layers=Slider(6, range=0..30), gap=Slider(6, range=0..30), rotation=Slider(2, range=0..30))  # -> out, geometries, bricks, frames; inputs crv: Curve, num_layers: Int32, gap: Int32, rotation: Int32
# ---------- bricks_6: Python ----------
# r: compas
# venv: mas-2627
from compas_rhino.devtools import DevTools
DevTools.ensure_path()

# Import everything we will need
import math
import ghpythonlib.treehelpers as th
from compas.geometry import Frame
from compas.geometry import Point
from compas.geometry import Vector
from compas.geometry import Rotation

# import curve from compas
from compas_rhino.conversions import curve_to_compas 
from compas.geometry import cross_vectors

from brick_wall import Brick


# creating empty lists 
bricks = []
frames = []

# convert curve
compas_crv = curve_to_compas(crv)

# spacing, dividing curve into positions
spacing = (Brick.LENGTH + gap) / 1.5

params, points = compas_crv.divide_by_length(spacing, True)

# layer patterns
patterns = [
    [1, 2],
    [2, 1],
]

# bricks in each layer 
for i in range(num_layers):
    z = i * Brick.HEIGHT
    angle = math.radians(i * rotation) if 'rotation' in globals() else 0.0
    R = Rotation.from_axis_and_angle([0, 0, 1], angle)

    # pattern for layer
    pattern = patterns[i % len(patterns)]
    
    subbricks = []
    subframes = []

    for j, (param, pt) in enumerate(zip(params, points)):

        # pattern along the curve
        pattern_index = j % len(pattern)
        brick_type = pattern[pattern_index]

        # position 
        brick_point = Point(pt.x, pt.y, z)

        # direction along the curve (using [0, 0, 1] cross tangent to ensure Z-up)
        tangent_base = compas_crv.tangent_at(param)
        normal_base = Vector(*cross_vectors([0, 0, 1], tangent_base))

        # transformation
        tangent = tangent_base.transformed(R)
        normal = normal_base.transformed(R)

        # orientations
        if brick_type == 1:
            frame = Frame(brick_point, xaxis=tangent, yaxis=normal)
        elif brick_type == 2:
            frame = Frame(brick_point, xaxis=-normal, yaxis=tangent)

        # Optional: uncomment if you need to shift the frame vertically to the center/top of the brick
        # frame.point += Vector(0.0, 0.0, 0.5 * Brick.HEIGHT)

        # brick and store
        brick = Brick(frame)
        subbricks.append(brick)
        subframes.append(frame)

    bricks.append(subbricks)
    frames.append(subframes)

# Output geometries and frames (as trees for Grasshopper if needed)
geometries = [[b.draw() for b in subb] for subb in bricks]
geometries = th.list_to_tree(geometries)
frames = th.list_to_tree(frames)
# ---------- end bricks_6 ----------
compas_draw_11 = COMPASDraw(cg=bricks_6.geometries)  # -> rg; same code as compas_draw
compas_draw_12 = COMPASDraw(cg=bricks_6.frames)  # -> rg; same code as compas_draw

# ----
# Generate Geometry
number_slider_4 = Slider(6, range=0..30)
gap_2 = Slider(7.9, range=0..10)
curve_7 = Curve(<curve referenced from the Rhino model>)
brick_wall = Python3Script(crv=curve_7, num_layers=number_slider_4, gap=gap_2)  # -> para, T, bricks, geometries, frames, work_area; inputs crv: Curve, num_layers: Int32, gap: Double, work_area: Polyline
# ---------- brick_wall: Python ----------
# r: compas
# venv: mas-2627
from compas_rhino.devtools import DevTools
DevTools.ensure_path()

# 0. Import everything we will need
import math
from compas_rhino.conversions import curve_to_compas
import ghpythonlib.treehelpers as th
from compas.geometry import Curve, Polygon
from compas.geometry import Box
from compas.geometry import Point, Vector
from compas.geometry import Frame, Transformation, Translation
from compas_rhino.conversions import polyline_to_compas
from compas_rhino.conversions import polyline_to_rhino_curve


# ..also import our module "brick_wall.py", that needs to be in the same folder as our GH file
from brick_wall import Brick

# 1. Start with an empty list of bricks to be created
bricks = []
frames = []
# 2. Create points on curve curve
work_area = polyline_to_compas(work_area)

crv = curve_to_compas(crv)
t,p = crv.divide_by_length((Brick.LENGTH + gap)/2, True) # Boolean to set if we also return the exact points as well. If not it will just return params
# Since there is a gap, we would need to include it in length calculation so that our bricks would be placed in the right spots
para = list(t)
work_pt = Point(work_x/2, work_y/2, 0.0)
# mid point of workspace
work_f = Frame(work_pt, Vector.Xaxis(), Vector.Yaxis())
# frame built on midpoint
T = 0

for r in range(num_layers):

    # Ensure odd layers keep odd bricks, even layers keep even bricks 
    tang = [crv.tangent_at(para) for i, para in enumerate(t) if r % 2 == i % 2]
    pts = [pt for j, pt in enumerate(p) if r % 2 == j % 2]
    # or if abs(r - j) % 2 == 0
    # Adjust the height of brick laid given its row

    for pp in pts:
        pp.z = r*Brick.HEIGHT
    # Establish its different qualities based on the values
    norm = Vector.cross_vectors([Vector.Zaxis() for i in range(len(tang))], tang)

    subframes = [Frame(pt, tt, nn) for (pt,tt,nn) in zip(pts,tang,norm)]

    T = Transformation.from_frame_to_frame(Frame.worldXY(), work_f)

    moveframes = [f.transformed(Translation.from_vector(Vector(0.0,0.0,1/2*Brick.HEIGHT))) for f in subframes]

    transframes = [mf.transformed(T) for mf in moveframes]

    subbricks = [Brick(f) for f in transframes]

    bricks.append(subbricks)
    frames.append(transframes)

work_area = polyline_to_rhino_curve(work_area)
geometries = th.list_to_tree([[b.draw() for b in subbricks] for subbricks in bricks])
frames = th.list_to_tree([[f for f in tras] for tras in frames])
# Visualize and store brick data
# ---------- end brick_wall ----------
compas_draw_13 = COMPASDraw(cg=brick_wall.geometries)  # -> rg; same code as compas_draw
compas_draw_14 = COMPASDraw(cg=brick_wall.frames)  # -> rg; same code as compas_draw
crv = Curve(brick_wall.work_area)

curve_8 = Curve(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)
# Generate Geometry
brick_wall_2 = Python3Script(crv=curve_8, num_layers=Slider(9, range=0..30), gap=gap)  # -> para, bricks, geometries, frames; inputs crv: Curve, num_layers: Int32, gap: Double
# ---------- brick_wall_2: Python ----------
# r: compas
# venv: mas-2627
from compas_rhino.devtools import DevTools
DevTools.ensure_path()

# 0. Import everything we will need
import math
from compas.geometry import Box
from compas.geometry import Point
from compas.geometry import Frame


# ..also import our module "brick_wall.py", that needs to be in the same folder as our GH file
from brick_wall import Brick

# 1. Start with an empty list of bricks to be created


# 2. Create points on curve curve


# Visualize and store brick data
# ---------- end brick_wall_2 ----------
compas_draw_15 = COMPASDraw(cg=brick_wall_2.geometries)  # -> rg; same code as compas_draw
compas_draw_16 = COMPASDraw(cg=brick_wall_2.frames)  # -> rg; same code as compas_draw

# ----
# Measure work object
point = ValueList({"origin", "xaxis", "xypoint"}, selected="xypoint")
capture = Button()
capture_wobj = CaptureWobj(robot_ip="192.168.10.10", point_name=point, capture=capture)  # -> wobj_origin, wobj_xaxis, wobj_xypoint, info
# ---------- capture_wobj: Python ----------
"""
Capture the 3 points that define the work object (robot base) plane.

Jog the TCP to a point, pick its name (origin / xaxis / xypoint) and press capture.
The TCP position (robot base frame, mm) is saved to wobj_calibration.json next to
this .ghx file, so the points survive closing Grasshopper.
"""
import os
import sys
import json
import time

import scriptcontext as sc
import Rhino.Geometry as rg

NAMES = ["origin", "xaxis", "xypoint"]

gh_dir = os.path.dirname(ghenv.Component.OnPingDocument().FilePath)
src_dir = os.path.join(gh_dir, "src")
if src_dir not in sys.path:
    sys.path.append(src_dir)
import simple_comm as com

path = os.path.join(gh_dir, "wobj_calibration.json")

data = {}
if os.path.exists(path):
    with open(path) as f:
        data = json.load(f)

# keep the last status in sticky, so the message survives the button being released
status_key = "capture_status_" + str(ghenv.Component.InstanceGuid)

if capture:
    if point_name not in NAMES:
        sc.sticky[status_key] = "pick origin / xaxis / xypoint"
    else:
        try:
            x, y, z = list(com.listen_to_robot(robot_ip)["pose"])[:3]  # metres, robot base frame
            data[point_name] = [round(x * 1000, 2), round(y * 1000, 2), round(z * 1000, 2)]  # -> mm
            with open(path, "w") as f:
                json.dump(data, f, indent=2)
            sc.sticky[status_key] = "{} captured {}".format(point_name, time.strftime("%H:%M:%S"))
        except Exception as e:
            print(e)
            sc.sticky[status_key] = "robot not reachable"

ghenv.Component.Message = sc.sticky.get(status_key, "")

def pt(name):
    return rg.Point3d(*data[name]) if name in data else None

wobj_origin, wobj_xaxis, wobj_xypoint = pt("origin"), pt("xaxis"), pt("xypoint")
info = json.dumps(data, indent=2)
# ---------- end capture_wobj ----------
wobj_calibration = Panel(capture_wobj.info)

fine_adjust_z_mm = Slider(5, range=-5..10)
# Transform from Rhino to Robot Space
transform = Python3Script(
    wobj_origin=capture_wobj.wobj_origin,
    wobj_xaxis=capture_wobj.wobj_xaxis,
    wobj_xypoint=capture_wobj.wobj_xypoint,
    z_safe_margin=fine_adjust_z_mm)  # -> out, transformed_frames; inputs way_planes: tree, wobj_origin: Point3d, wobj_xaxis: Point3d, wobj_xypoint: Point3d, z_safe_margin: Double
# ---------- transform: Python ----------
from compas.geometry import Frame, Transformation, Translation, Vector
#in this step we transform our way planes to robot space
#the rhino co-ordinate system is rather abstract in the physical world
#the robot base plane assumed the base frame of robot is the origin
#but rhino does not know that
#thus we transform things from our design space(Rhino World XY) to Robot Base Plane that we measure

def set_robot_base(origin, xaxis, xypoint):
    """
    set a base plane representing the robot working object plane
    """
    robot_base = Frame(origin, xaxis - origin, xypoint - origin)
    print (robot_base)
    return (robot_base)

def rhino_to_robot_space(rhino_plane,robot_base_plane):
    """
    Transform the objects from Rhino world XY plane to robot work object plane
    """
    T_matrix = Transformation.from_frame_to_frame(Frame.worldXY(), robot_base_plane)
    robot_plane = rhino_plane.transformed(T_matrix)
    return robot_plane

def set_z_safe_margin(planes_to_adjust, safety_margin):
    adjusted = []
    T = Translation.from_vector(Vector(0, 0, safety_margin))
    for f in planes_to_adjust:
        adjusted.append(f.transformed(T))
    return adjusted

# ===== Robot base is set =====
robot_base =  set_robot_base(wobj_origin, wobj_xaxis, wobj_xypoint)

# ===== Set safety margin for Z height ======
safe_planes = set_z_safe_margin(way_planes, z_safe_margin)

# ===== Transforming the rhino planes into robot planes =====
transformed_frames = []
for plane in safe_planes: 
    transformed_frames.append(rhino_to_robot_space(plane, robot_base))
# ---------- end transform ----------

# ----
# Measure pick up location
point_2 = ValueList({"origin", "xaxis", "xypoint"}, selected="origin")
capture_2 = Button()
capture_pick = CapturePick(robot_ip="192.168.10.10", point_name=point_2, capture=capture_2)  # -> origin, xaxis_pt, xy_pt, info
# ---------- capture_pick: Python ----------
"""
Capture the 3 points that define the pick frame at the brick pick-up location.

Jog the TCP to a point, pick its name (origin / xaxis / xypoint) and press capture.
The TCP position (robot base frame, mm) is saved to pick_calibration.json next to
this .ghx file, so the points survive closing Grasshopper.
"""
import os
import sys
import json
import time

import scriptcontext as sc
import Rhino.Geometry as rg

NAMES = ["origin", "xaxis", "xypoint"]

gh_dir = os.path.dirname(ghenv.Component.OnPingDocument().FilePath)
src_dir = os.path.join(gh_dir, "src")
if src_dir not in sys.path:
    sys.path.append(src_dir)
import simple_comm as com

path = os.path.join(gh_dir, "pick_calibration.json")

data = {}
if os.path.exists(path):
    with open(path) as f:
        data = json.load(f)

# keep the last status in sticky, so the message survives the button being released
status_key = "capture_status_" + str(ghenv.Component.InstanceGuid)

if capture:
    if point_name not in NAMES:
        sc.sticky[status_key] = "pick origin / xaxis / xypoint"
    else:
        try:
            x, y, z = list(com.listen_to_robot(robot_ip)["pose"])[:3]  # metres, robot base frame
            data[point_name] = [round(x * 1000, 2), round(y * 1000, 2), round(z * 1000, 2)]  # -> mm
            with open(path, "w") as f:
                json.dump(data, f, indent=2)
            sc.sticky[status_key] = "{} captured {}".format(point_name, time.strftime("%H:%M:%S"))
        except Exception as e:
            print(e)
            sc.sticky[status_key] = "robot not reachable"

ghenv.Component.Message = sc.sticky.get(status_key, "")

def pt(name):
    return rg.Point3d(*data[name]) if name in data else None

origin, xaxis_pt, xy_pt = pt("origin"), pt("xaxis"), pt("xypoint")
info = json.dumps(data, indent=2)
# ---------- end capture_pick ----------
pick_calibration = Panel(capture_pick.info)
py3 = Python3Script(origin=capture_pick.origin, xaxis_pt=capture_pick.xaxis_pt, xy_pt=capture_pick.xy_pt)  # -> out, pick_frame; inputs origin: Point3d, xaxis_pt: Point3d, xy_pt: Point3d
# ---------- py3: Python ----------
from compas.geometry import Frame, Point
from compas.geometry import Rotation

from compas_rhino.conversions import point_to_compas

origin = point_to_compas(origin)
xaxis_pt = point_to_compas(xaxis_pt)
xy_pt = point_to_compas(xy_pt)

#define pick frame
pick_frame = Frame(origin, xaxis_pt - origin, xy_pt - origin)
# ---------- end py3 ----------
compas_draw_17 = COMPASDraw(cg=py3.pick_frame)  # -> rg; same code as compas_draw

compas_draw_18 = COMPASDraw(cg=transform.transformed_frames)  # -> rg; same code as compas_draw
number_slider_5 = Slider(0.1, range=0..0.1)
number_slider_6 = Slider(0.1, range=0..0.1)

# ----
# Convert Planes to URScript
# Measure and set TCP
panel = Panel("0.07")
pt = ConstructPoint(XCoordinate=panel, YCoordinate="-0.06", ZCoordinate="74.33")

compas = Python3Script(
    way_frames=transform.transformed_frames,
    tcp_measured=pt,
    acceleration=number_slider_5,
    velocity=number_slider_6,
    pick_frame=py3.pick_frame)  # -> out, vis_frames, vis_planes, script; inputs way_frames: list, tcp_measured: Point3d, acceleration: Double, velocity: Double
# ---------- compas: Python ----------
from imp import reload
import sys
import os

#get current file path
path = ghenv.Component.OnPingDocument().FilePath
#get parent directory of the parent directory
parentdir = os.path.dirname(path)
#get src folder which contains classes
dire = os.path.join(parentdir,'src')

sys.path.append(dire)

import simple_ur_script as ur
reload(ur)

import utils 
reload(utils)

import simple_comm as com
reload(com)

import compas.geometry as cg
import math as m

# ===== Set global constants =======

IO = 0 # Global constant
SAFE_DIST = 50

# =================================

script = "" #create empty string

def pickup_brick(script,pick_up_frame):
    frames = []
    # Translate frame to "safe" location

    # Move to safe frame

    # Move to pick location

    # Activate gripper

    # Move back to safe plane

    return script, frames


def place_brick(script, place_frame):
    frames = []
    
    # Safe frame for placing

    # Add to the path: go to the safe plane

    # Add to the path: go to the place plane
    
    # Add to the path: turn off the vacuum and wait 1 second (hold the brick)
    
    # Add to the path: go back to the safe plane
    
    return script,frames


#if value given for tcp measured, then add line to script, otherwise it will take current tcp from robot
if tcp_measured is not None:
    script += ur.set_tcp_by_angles(tcp_measured.X, tcp_measured.Y, tcp_measured.Z, m.radians(0.0),m.radians(0.0),m.radians(0))


vis_frames = []
# Generate pick and place sequence
 


# Format the script to make it sendable
script = com.concatenate_script(script)


# Visualize
from compas_rhino import conversions
import Rhino.Geometry as rg

vis_planes = [conversions.frame_to_rhino(frame) for frame in vis_frames]
# ---------- end compas ----------
compas_draw_19 = COMPASDraw(cg=compas.vis_frames)  # -> rg; same code as compas_draw
points = PointList(Points=compas.vis_planes, Size=Slider(7, range=0..100))
panel_2 = Panel(compas.script)

# ---- group: Send UR script to Robot!
# Send to Robot!
py3_2 = Python3Script(script=compas.script, ip_address="192.168.10.10", send=Button())  # -> out, a; inputs script: String, ip_address: String, send: Boolean
# ---------- py3_2: Python ----------
import simple_comm as com

if send:
    com.send_script(script,ip_address)
# ---------- end py3_2 ----------
