# Grasshopper definition 101_brick_to_robot_20261019_b.ghx (Grasshopper 1.0.8)

gap = Slider(7.6, range=0..10)
curve = Curve(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)
# Generate Geometry
curve_2 = Curve(<curve referenced from the Rhino model>)
brick_wall = Python3Script(crv=curve_2, num_layers=Slider(10, range=0..30), gap=gap)  # -> bricks, geometries, frames; inputs crv: Curve, num_layers: Int32, gap: Double
# ---------- brick_wall: Python ----------
# r: compas
# venv: mas-2627
from compas_rhino.devtools import DevTools
DevTools.ensure_path()

# 0. Import everything we will need
import math
from compas.geometry import Box
from compas.geometry import Point
from compas.geometry import Frame

# import curve from compas
from compas_rhino.conversions import curve_to_compas 
from compas.geometry import cross_vectors


# ..also import our module "brick_wall.py", that needs to be in the same folder as our GH file
from brick_wall import Brick


# 1. Start with an empty list of bricks to be created
bricks = []


# 2. Create points on curve curve
print(crv)

# divide by length
compas_crv = curve_to_compas(crv)

length = (Brick.LENGTH + gap)/2
params, points = compas_crv.divide_by_length(length, True)

# frames, points on each of them 
for i in range(num_layers):
    for j,(param, pt) in enumerate(zip(params, points)):
        if i%2 == j%2:
            tangent = compas_crv.tangent_at(param)
            # cross prosuct gives perpendicaular 
            normal = cross_vectors(tangent, [0,0,1])
            pt.z = i*Brick.HEIGHT
            frame = Frame(pt, xaxis = tangent, yaxis = normal)
            # chnage location of frame for z axis / points 


        my_brick = Brick(frame)
        bricks.append(my_brick)



# Visualize and store brick data
geometries = []
frames = []

for brick in bricks:
    geometries.append(brick.draw())
    frames.append(brick.get_pick_frame())


# # list comprehension
# geometries = [brick.draw() for brick in bricks]
# frames = [brick.get_pick_frame() for brick in bricks]

# rot = cos(att_point.distance_to_point(brick_origin)) * rotation_factor
#         brick.frame.rotate(radians(rot), point = brick_origin)
# ---------- end brick_wall ----------

# ----
# Measure work object
point = ValueList({"origin", "xaxis", "xypoint"}, selected="origin")
capture = Button()
capture_wobj = CaptureWobj(robot_ip="192.168.10.10", point_name=point, capture=capture)  # -> wobj_origin, wobj_xaxis, wobj_xypoint, info
# ---------- capture_wobj: Python ----------
"""
Capture the 3 points that define the work object (robot base) plane.

Jog the TCP to a point, pick its name (origin / xaxis / xypoint) and press capture.
The TCP position (robot base frame, mm) is saved to wobj_calibration.json next to
this .ghx file, so the points survive closing Grasshopper.
"""
import os
import sys
import json
import time

import scriptcontext as sc
import Rhino.Geometry as rg

NAMES = ["origin", "xaxis", "xypoint"]

gh_dir = os.path.dirname(ghenv.Component.OnPingDocument().FilePath)
src_dir = os.path.join(gh_dir, "src")
if src_dir not in sys.path:
    sys.path.append(src_dir)
import simple_comm as com

path = os.path.join(gh_dir, "wobj_calibration.json")

data = {}
if os.path.exists(path):
    with open(path) as f:
        data = json.load(f)

# keep the last status in sticky, so the message survives the button being released
status_key = "capture_status_" + str(ghenv.Component.InstanceGuid)

if capture:
    if point_name not in NAMES:
        sc.sticky[status_key] = "pick origin / xaxis / xypoint"
    else:
        try:
            x, y, z = list(com.listen_to_robot(robot_ip)["pose"])[:3]  # metres, robot base frame
            data[point_name] = [round(x * 1000, 2), round(y * 1000, 2), round(z * 1000, 2)]  # -> mm
            with open(path, "w") as f:
                json.dump(data, f, indent=2)
            sc.sticky[status_key] = "{} captured {}".format(point_name, time.strftime("%H:%M:%S"))
        except Exception as e:
            print(e)
            sc.sticky[status_key] = "robot not reachable"

ghenv.Component.Message = sc.sticky.get(status_key, "")

def pt(name):
    return rg.Point3d(*data[name]) if name in data else None

wobj_origin, wobj_xaxis, wobj_xypoint = pt("origin"), pt("xaxis"), pt("xypoint")
info = json.dumps(data, indent=2)
# ---------- end capture_wobj ----------
wobj_calibration = Panel(capture_wobj.info)

compas_draw = COMPASDraw(cg=brick_wall.frames)  # -> rg
#   port cg: The COMPAS geometry or datastructure to be drawn.
#   port rg: The Rhino geometry object.
# ---------- compas_draw: Python ----------
# r: compas>=2.14.1
"""
Draws COMPAS geometry in Grasshopper.
"""

from typing import Any

import Grasshopper

from compas.scene import SceneObject


class CompasToRhinoGeometry(Grasshopper.Kernel.GH_ScriptInstance):
    def RunScript(self, cg):
        if not cg:
            return None

        return SceneObject(item=cg).draw()
# ---------- end compas_draw ----------
compas_draw_2 = COMPASDraw(cg=brick_wall.geometries)  # -> rg; same code as compas_draw
fine_adjust_z_mm = Slider(5, range=-5..10)
# Transform from Rhino to Robot Space
rectangle_3pt = Rectangle3Pt(PointA=capture_wobj.wobj_origin, PointB=capture_wobj.wobj_xaxis, PointC=capture_wobj.wobj_xypoint)  # -> Rectangle, Length
transform = Python3Script(
    way_planes=brick_wall.frames,
    wobj_origin=capture_wobj.wobj_origin,
    wobj_xaxis=capture_wobj.wobj_xaxis,
    wobj_xypoint=capture_wobj.wobj_xypoint,
    z_safe_margin=fine_adjust_z_mm)  # -> out, transformed_frames; inputs way_planes: list, wobj_origin: Point3d, wobj_xaxis: Point3d, wobj_xypoint: Point3d, z_safe_margin: Double
# ---------- transform: Python ----------
from compas.geometry import Frame, Transformation, Translation, Vector
#in this step we transform our way planes to robot space
#the rhino co-ordinate system is rather abstract in the physical world
#the robot base plane assumed the base frame of robot is the origin
#but rhino does not know that
#thus we transform things from our design space(Rhino World XY) to Robot Base Plane that we measure

def set_robot_base(origin, xaxis, xypoint):
    """
    set a base plane representing the robot working object plane
    """
    robot_base = Frame(origin, xaxis - origin, xypoint - origin)
    v = 0.5 * (xaxis - origin) + 0.5 * (xypoint - origin)
    v_move = Translation.from_vector(v)
    robot_base.transform(v_move) #sel.Transform(v)
    print (robot_base)
    return (robot_base)

def rhino_to_robot_space(rhino_plane,robot_base_plane):
    """
    Transform the objects from Rhino world XY plane to robot work object plane
    """
    T_matrix = Transformation.from_frame_to_frame(Frame.worldXY(), robot_base_plane)
    robot_plane = rhino_plane.transformed(T_matrix)
    return robot_plane

def set_z_safe_margin(planes_to_adjust, safety_margin):
    adjusted = []
    T = Translation.from_vector(Vector(0, 0, safety_margin))
    for f in planes_to_adjust:
        adjusted.append(f.transformed(T))
    return adjusted

# ===== Robot base is set =====
robot_base =  set_robot_base(wobj_origin, wobj_xaxis, wobj_xypoint)

# ===== Set safety margin for Z height ======
safe_planes = set_z_safe_margin(way_planes, z_safe_margin)


# ===== Transforming the rhino planes into robot planes =====
transformed_frames = []
for plane in safe_planes: 
    transformed_frames.append(rhino_to_robot_space(plane, robot_base))
# ---------- end transform ----------

# ----
# Measure pick up location
point_2 = ValueList({"origin", "xaxis", "xypoint"}, selected="xypoint")
capture_2 = Button()
capture_pick = CapturePick(robot_ip="192.168.10.10", point_name=point_2, capture=capture_2)  # -> origin, xaxis_pt, xy_pt, info
# ---------- capture_pick: Python ----------
"""
Capture the 3 points that define the pick frame at the brick pick-up location.

Jog the TCP to a point, pick its name (origin / xaxis / xypoint) and press capture.
The TCP position (robot base frame, mm) is saved to pick_calibration.json next to
this .ghx file, so the points survive closing Grasshopper.
"""
import os
import sys
import json
import time

import scriptcontext as sc
import Rhino.Geometry as rg

NAMES = ["origin", "xaxis", "xypoint"]

gh_dir = os.path.dirname(ghenv.Component.OnPingDocument().FilePath)
src_dir = os.path.join(gh_dir, "src")
if src_dir not in sys.path:
    sys.path.append(src_dir)
import simple_comm as com

path = os.path.join(gh_dir, "pick_calibration.json")

data = {}
if os.path.exists(path):
    with open(path) as f:
        data = json.load(f)

# keep the last status in sticky, so the message survives the button being released
status_key = "capture_status_" + str(ghenv.Component.InstanceGuid)

if capture:
    if point_name not in NAMES:
        sc.sticky[status_key] = "pick origin / xaxis / xypoint"
    else:
        try:
            x, y, z = list(com.listen_to_robot(robot_ip)["pose"])[:3]  # metres, robot base frame
            data[point_name] = [round(x * 1000, 2), round(y * 1000, 2), round(z * 1000, 2)]  # -> mm
            with open(path, "w") as f:
                json.dump(data, f, indent=2)
            sc.sticky[status_key] = "{} captured {}".format(point_name, time.strftime("%H:%M:%S"))
        except Exception as e:
            print(e)
            sc.sticky[status_key] = "robot not reachable"

ghenv.Component.Message = sc.sticky.get(status_key, "")

def pt(name):
    return rg.Point3d(*data[name]) if name in data else None

origin, xaxis_pt, xy_pt = pt("origin"), pt("xaxis"), pt("xypoint")
info = json.dumps(data, indent=2)
# ---------- end capture_pick ----------
pick_calibration = Panel(capture_pick.info)
py3 = Python3Script(origin=capture_pick.origin, xaxis_pt=capture_pick.xaxis_pt, xy_pt=capture_pick.xy_pt)  # -> out, pick_frame; inputs origin: Point3d, xaxis_pt: Point3d, xy_pt: Point3d
# ---------- py3: Python ----------
from compas.geometry import Frame, Point
from compas.geometry import Rotation

from compas_rhino.conversions import point_to_compas

origin = point_to_compas(origin)
xaxis_pt = point_to_compas(xaxis_pt)
xy_pt = point_to_compas(xy_pt)

#define pick frame
pick_frame = Frame(origin, xaxis_pt - origin, xy_pt - origin)
# ---------- end py3 ----------
compas_draw_3 = COMPASDraw(cg=py3.pick_frame)  # -> rg; same code as compas_draw

# ----
# Measure slide location
point_3 = ValueList({"origin", "xaxis", "xypoint"}, selected="xypoint")
capture_3 = Button()
capture_pick_2 = CapturePick(robot_ip="192.168.10.10", point_name=point_3, capture=capture_3)  # -> origin, xaxis_pt, xy_pt, info; same code as capture_pick
pick_calibration_2 = Panel(capture_pick_2.info)
py3_2 = Python3Script(origin=capture_pick_2.origin, xaxis_pt=capture_pick_2.xaxis_pt, xy_pt=capture_pick_2.xy_pt)  # -> out, pick_frame; inputs origin: Point3d, xaxis_pt: Point3d, xy_pt: Point3d; same code as py3
compas_draw_4 = COMPASDraw(cg=py3_2.pick_frame)  # -> rg; same code as compas_draw

compas_draw_5 = COMPASDraw(cg=transform.transformed_frames)  # -> rg; same code as compas_draw

# ----
# Measure and set TCP
panel = Panel("-66.53")
pt = ConstructPoint(XCoordinate=panel, YCoordinate="34.83", ZCoordinate="96.41")

number_slider = Slider(0.1, range=0..0.1)
number_slider_2 = Slider(0.1, range=0..0.1)
# Convert Planes to URScript
compas = Python3Script(
    way_frames=transform.transformed_frames,
    tcp_measured=pt,
    acceleration=number_slider,
    velocity=number_slider_2,
    tray_origin=py3.pick_frame,
    slide_frame=py3_2.pick_frame)  # -> out, vis_frames, vis_planes, script; inputs way_frames: list, tcp_measured: Point3d, acceleration: Double, velocity: Double
# ---------- compas: Python ----------
import math
from compas.geometry import Frame, Transformation, Translation, Vector
from compas_rhino import conversions
import Rhino.Geometry as rg

# ==========================================
# CONFIGURATION & CONSTANTS
# ==========================================
IO = 4                 # Digital output port for vacuum/gripper
SAFE_DIST = 40.0       # Vertical safety offset in mm (Approach/Retreat)
VELOCITY = 0.2         # Linear movement velocity (m/s)
ACCELERATION = 0.5     # Linear movement acceleration (m/s^2)

script = ""            # Initialize empty URScript string

# ==========================================
# HELPER FUNCTIONS
# ==========================================
def create_safe_frame(frame, distance=SAFE_DIST):
   #Creates a safety frame offset along the local Z-axis of the input frame
    T = Translation.from_vector(Vector(0, 0, distance))
    return frame.transformed(T) 

def format_ur_movel(frame, accel, vel):
    #Formats a COMPAS Frame into a URScript movel command string (meters)
    x = frame.point[0] / 1000.0
    y = frame.point[1] / 1000.0
    z = frame.point[2] / 1000.0
    return f"movel(p[{x}, {y}, {z}, 0, 0, 3.1415], a={accel}, v={vel})\n"

def execute_motion(script_str, target_frame, do_state, accel, vel):
    #Handles approach, target touch, IO trigger, and retreat sequence
    frames = []
    safe_frame = create_safe_frame(target_frame, SAFE_DIST)
    
    # 1. Move to safe pre-position
    script_str += format_ur_movel(safe_frame, accel, vel)
    # 2. Move down to target
    script_str += format_ur_movel(target_frame, accel, vel)
    # 3. Set Digital Output (Gripper ON/OFF) & wait
    script_str += f"set_digital_out({IO}, {str(do_state)})\n"
    script_str += "sleep(0.8)\n"
    # 4. Retreat to safe height
    script_str += format_ur_movel(safe_frame, accel, vel)
    
    frames.extend([safe_frame, target_frame, safe_frame])
    return script_str, frames

# ==========================================
# MAIN EXECUTION LOOP
# ==========================================
vis_frames = []

# Ensure all required inputs are connected from Grasshopper
if all(k in globals() for k in ('way_frames', 'tray_origin', 'slide_frame')) and way_frames:
    
    cols = 4          # Number of columns in your tray layout
    rows = 2          # Number of rows in your tray layout
    total_layers = 5  # Total number of stacked layers in your physical tray
    
    layer_capacity = cols * rows  # Bricks per layer (4 x 2 = 8 bricks)
    max_tray_capacity = layer_capacity * total_layers  # Total tray capacity (40 bricks)
    
    # Brick physical dimensions (in mm) - adjust height if needed
    BRICK_LENGTH = 32.2
    BRICK_BREATH = 15.16
    BRICK_HEIGHT = 9.84  
    
    for i, place_frame in enumerate(way_frames):
        
        # Safety check: Ensure we don't try to pick more bricks than the tray holds
        if i >= max_tray_capacity:
            print(f"Warning: Brick index {i} exceeds maximum tray capacity of {max_tray_capacity}!")
            break
            
        # --- Step A: Calculate Multi-Layer Grid Position in Tray for Brick [i] ---
        c_idx = i % cols                  # Column index (0 to 3)
        r_idx = (i // cols) % rows        # Row index (0 or 1)
        layer_idx = i // layer_capacity   # Layer/tier index (0 to 4 for 5 layers)
        
        # Step distances based on your brick size
        dx = c_idx * BRICK_BREATH  # Adjust if columns run along length vs breadth
        dy = r_idx * BRICK_LENGTH  
        dz = layer_idx * BRICK_HEIGHT # Steps downward (-dz) by 10mm for each layer tier
        
        # Apply translation vector relative to the tray origin plane
        T_grid = Translation.from_vector(Vector(dx, dy, -dz))
        current_pick_frame = tray_origin.transformed(T_grid)
        print(type(current_pick_frame))
        
        # --- Step B: Pick from Tray ---
        script, f_pick = execute_motion(script, current_pick_frame, True, ACCELERATION, VELOCITY)
        vis_frames.extend(f_pick)
        
        # --- Step C: Place onto Slide (Jig) ---
        script, f_slide_place = execute_motion(script, slide_frame, False, ACCELERATION, VELOCITY)
        vis_frames.extend(f_slide_place)
        
        # --- Step D: Re-pick from Slide (Aligned) ---
        script, f_slide_pick = execute_motion(script, slide_frame, True, ACCELERATION, VELOCITY)
        vis_frames.extend(f_slide_pick)
        
        # --- Step E: Place onto Wall Destination ---
        script, f_wall = execute_motion(script, place_frame, False, ACCELERATION, VELOCITY)
        vis_frames.extend(f_wall)
# ---------- end compas ----------
compas_draw_6 = COMPASDraw(cg=compas.vis_planes)  # -> rg; same code as compas_draw
compas_draw_7 = COMPASDraw(cg=compas.vis_frames)  # -> rg; same code as compas_draw
points = PointList(Points=compas.vis_planes, Size=Slider(7, range=0..100))
panel_2 = Panel(compas.script)

# ---- group: Send UR script to Robot!
# Send to Robot!
py3_3 = Python3Script(script=compas.script, ip_address="192.168.10.10", send=Button())  # -> out, a; inputs script: String, ip_address: String, send: Boolean
# ---------- py3_3: Python ----------
import simple_comm as com

if send:
    com.send_script(script,ip_address)
# ---------- end py3_3 ----------
