# Grasshopper definition Robotic Tower_Lamda.gh (Grasshopper 1.0.8)

list = ValueList({"Config 1": 0, "Config 2": 1, "Config 3": 2}, selected="Config 1")
list_2 = ValueList({"Config 1": 0, "Config 2": 1, "Config 3": 2}, selected="Config 2")
number_slider = Slider(420, range=0..1000)
min_radius = Slider(51.28, range=0..200)
modules = Slider(8, range=0..100)
number_slider_2 = Slider(2, range=0..10)
rotation = Slider(42, range=0..90)
bond = Slider(2, range=1..2)
shift = Slider(1, range=0..4)
number_slider_3 = Slider(594, range=0..1000)
offset = Slider(100, range=0..100)
number_slider_4 = Slider(130, range=0..1000)
factor = Slider(1.43, range=0..10)
number_slider_5 = Slider(15, range=0..90)

brick_dimensions = Python3Script(orientation=list)  # -> out, length, width, height, orient; disabled
# ---------- brick_dimensions: Python ----------
# r: compas
# venv: mas-2627
from compas_rhino.devtools import DevTools
DevTools.ensure_path()

from brick_wall import Brick

samplebrick = Brick()
samplebrick.configuration(orientation)

length = samplebrick.length
width = samplebrick.width
height = samplebrick.height
orient = orientation
# ---------- end brick_dimensions ----------
brick_dimensions_2 = Python3Script(orientation=list_2)  # -> out, length, width, height, orient; disabled; same code as brick_dimensions
expression = Expression(x=min_radius, y=factor, Expression="x*y")  # disabled
pt = ConstructPoint(XCoordinate=expr("x/2", number_slider), YCoordinate=expr("x/2", number_slider_3), ZCoordinate=0)  # disabled
rectangle = Rectangle(Plane=PlaneXY(0, 0, 0), XSize=number_slider, YSize=number_slider_3, Radius=0)  # -> Rectangle, Length; disabled
diagrid = Python3Script(x_bound=number_slider, y_bound=number_slider_3, offset=offset, spacing=number_slider_4)  # -> out, flatten(pts); inputs x_bound: Double, y_bound: Double; disabled
# ---------- diagrid: Python ----------
import math as m
import Rhino.Geometry as rg
import ghpythonlib.treehelpers as th

x_dim = (x_bound - 2*offset)//spacing*spacing
y_dim = (y_bound - 2*offset)//spacing*spacing
off_x = (x_bound - x_dim)/2
off_y = (y_bound - y_dim)/2

x_count = int(x_dim // spacing) + 1
y_count = int(y_dim // spacing) + 1

pts = [
    [
        rg.Point3d(off_x + (spacing * col), off_y + (spacing * row), 0.0)
        for col in range(x_count)
        if col % 2 == row % 2  # Checkerboard condition evaluated per point
    ]
    for row in range(y_count)
]
pts = th.list_to_tree(pts)
# ---------- end diagrid ----------
cluster_heights = ClusterHeights(x=brick_dimensions.height, y=brick_dimensions_2.height)  # -> R, R_2; disabled
series = Series(Start=cluster_heights.R, Step=cluster_heights.R_2, Count=modules)  # disabled
flip = FlipMatrix(Data=series)  # -> flatten(Data); disabled
range = Range(Domain=Domain(0, 1), Steps=expr("x-1", modules))  # disabled
lng = ListLength(List=diagrid.pts)  # disabled
index = ItemIndex(List=diagrid.pts, Item=diagrid.pts)  # disabled
modules_heights = Panel(flip)  # disabled
module_heights = Panel(cluster_heights.R)  # disabled
step_between_modules = Panel(cluster_heights.R_2)  # disabled
pdecon = Deconstruct(Point=graft(diagrid.pts))  # -> XComponent, YComponent, ZComponent; disabled
graph = GraphMapper(range, x0=0, x1=1, y0=0, y1=1, container_name="Sine", Equation_px=[0, 0.4571428597], Equation_py=[0, 1])  # disabled
rad = Radians(Degrees=number_slider_5)  # disabled
dom = ConstructDomain(DomainStart=expr("-x", rad), DomainEnd=rad)  # disabled
bnd = Bounds(Numbers=graph)  # disabled
dom_2 = ConstructDomain(DomainStart=min_radius, DomainEnd=expression)  # disabled
expression_2 = Expression(x=index, z=lng, Expression="x%z")  # disabled
remap = RemapNumbers(Value=graph, Source=bnd, Target=dom_2)  # -> Mapped, Clipped; disabled
remap_2 = RemapNumbers(Value=graph, Source=bnd, Target=dom)  # -> Mapped, Clipped; disabled
shift_2 = ShiftList(List=remap_2.Mapped, Shift=graft(expression_2), Wrap=True)  # -> simplify(List); disabled
series_2 = Series(Start=0, Step=step_between_modules, Count=modules)  # disabled
shift_3 = ShiftList(List=remap.Mapped, Shift=graft(expression_2), Wrap=True)  # -> simplify(List); disabled
pt_2 = ConstructPoint(XCoordinate=pdecon.XComponent, YCoordinate=pdecon.YComponent, ZCoordinate=series_2)  # -> simplify(Point); disabled
expression_3 = Expression(x=brick_dimensions.length, y=shift_2, gap=number_slider_2, Expression="1/2*(x*cos(y)+gap)")  # disabled
cir = Circle(Plane=pt_2, Radius=shift_3)  # disabled
len = Length(Curve=cir)  # disabled
expression_4 = Expression(c=len, p=expression_3, Expression="((c/p)\2)*2")  # disabled
divide = DivideCurve(Curve=cir, Count=simplify(expression_4), Kinks=False)  # -> Points, Tangents, Parameters; disabled

# ---- group: This is needed only ONCE in the GH definition
enable_auto_reload = Python3Script()  # -> ok
# ---------- enable_auto_reload: Python ----------
"""
------------------------------
Using VS Code as Python editor
------------------------------

The simplest way to start using VS Code as our editor, is
to place our Python code in files located IN THE SAME FOLDER as our Grasshopper file.

After we have done that, we need 2 steps: 

1. Enable the COMPAS reloader on one component. This tells Grasshopper to watch for changes in the Pythoh files and reload if changed.
2. Every other component that uses Python code from external files needs to start with a method to ensure Grasshopper knows where to load the files from.

"""
# r: compas
# venv: mas-2627

from compas_rhino.devtools import DevTools
DevTools.enable_reloader()
# ---------- end enable_auto_reload ----------

# ----
lamcp = LAMCPBridge(enable=Toggle(True))  # -> status; inputs enable: Boolean, port: Int32
#   port enable: Toggle to start (True) or stop (False) the local HTTP server.
#   port port: Port to listen on (loopback only). Defaults to 8765.
#   port status: Current server status string.
# ---------- lamcp: Python ----------
"""
LAMCP Bridge: local HTTP server inside Rhino 8 / Grasshopper CPython.

Exposes `POST /exec` (JSON: `{"code": "...", "timeout": 30}`) which
exec()s `code` and returns
`{"stdout": "...", "stderr": "...", "result": "...", "error": null|str}`.

Pair with the `lamcp` FastMCP server, which translates Claude's
`run_python_script` MCP tool calls into POSTs to this endpoint.

Binds to 127.0.0.1 only. NEVER expose beyond localhost â€” it exec()s
arbitrary Python with full Rhino API access.

LAMCP v0.1.0
"""

import contextlib
import io
import json
import threading
import traceback
from http.server import BaseHTTPRequestHandler
from http.server import HTTPServer

import Grasshopper
import scriptcontext as sc


SHARED_GLOBALS_KEY = "_lamcp_bridge_globals"
SERVER_KEY = "_lamcp_bridge_server"


def _exec_code(code, timeout):
    """Run `code` on the HTTP-server thread and capture stdout/stderr/result.

    NOTE: this is intentionally NOT marshalled to Rhino's UI thread for the
    spike â€” `Rhino.RhinoApp.InvokeOnUiThread` was queueing actions that
    never fired in Rhino 8 CPython. Most read-only RhinoCommon access is
    safe cross-thread; mutations may crash. Add Eto-based marshalling
    back here when we need it.
    """
    out = io.StringIO()
    err = io.StringIO()
    g = sc.sticky.setdefault(SHARED_GLOBALS_KEY, {"__name__": "__lamcp_bridge__"})
    error_text = None
    result_repr = None
    try:
        with contextlib.redirect_stdout(out), contextlib.redirect_stderr(err):
            exec(code, g, g)
            result_repr = repr(g.get("_"))
    except BaseException:
        error_text = traceback.format_exc()

    return {
        "stdout": out.getvalue(),
        "stderr": err.getvalue(),
        "result": result_repr,
        "error": error_text,
    }


class _ExecHandler(BaseHTTPRequestHandler):
    # Silence default request logging so it doesn't clog the Rhino command line.
    def log_message(self, fmt, *args):
        pass

    def _send(self, code, payload):
        body = json.dumps(payload).encode("utf-8")
        self.send_response(code)
        self.send_header("Content-Type", "application/json")
        self.send_header("Content-Length", str(len(body)))
        self.end_headers()
        self.wfile.write(body)

    def do_GET(self):
        if self.path == "/health":
            self._send(200, {"status": "ok"})
        else:
            self._send(404, {"error": "not found"})

    def do_POST(self):
        if self.path != "/exec":
            self._send(404, {"error": "not found"})
            return
        length = int(self.headers.get("Content-Length", "0"))
        try:
            raw = self.rfile.read(length).decode("utf-8")
            body = json.loads(raw)
            code = body.get("code", "")
            timeout = float(body.get("timeout", 30.0))
        except Exception as exc:
            self._send(400, {"error": "bad request: " + repr(exc)})
            return
        result = _exec_code(code, timeout)
        self._send(200, result)


def _start_server(port):
    server = HTTPServer(("127.0.0.1", port), _ExecHandler)
    thread = threading.Thread(
        target=server.serve_forever, daemon=True, name="lamcp-bridge"
    )
    thread.start()
    return {"server": server, "thread": thread, "port": port}


def _stop_server(state):
    try:
        state["server"].shutdown()
        state["server"].server_close()
    except Exception:
        pass


class LamcpBridgeComponent(Grasshopper.Kernel.GH_ScriptInstance):
    def RunScript(self, enable: bool, port: int):
        port = int(port) if port else 8765

        state = sc.sticky.get(SERVER_KEY)

        if not enable:
            if state is not None:
                _stop_server(state)
                del sc.sticky[SERVER_KEY]
            return "stopped"

        # Already running on the requested port: no-op.
        if (
            state is not None
            and state.get("port") == port
            and state["thread"].is_alive()
        ):
            return "listening on http://127.0.0.1:{}".format(port)

        # Port changed or server died: tear down and restart.
        if state is not None:
            _stop_server(state)
            del sc.sticky[SERVER_KEY]

        try:
            sc.sticky[SERVER_KEY] = _start_server(port)
        except OSError as exc:
            ghenv.Component.AddRuntimeMessage(  # noqa: F821
                Grasshopper.Kernel.GH_RuntimeMessageLevel.Error,
                "Failed to bind 127.0.0.1:{}: {}".format(port, exc),
            )
            return "error: {}".format(exc)

        return "listening on http://127.0.0.1:{}".format(port)
# ---------- end lamcp ----------

# ---- group: 1 · Site & Towers
# 1 · SITE & TOWERS
# Site rectangle from the x/y bounds. Usable grid = floor((bound - 2*offset) / spacing) * spacing, centred on the site.
# Columns x rows of cell centres (Cross Reference: columns vary fastest, i.e. row by row).
# Checkerboard: keep cells where column % 2 = row % 2  ->  one centre per tower.
# Out: tower centres {0} (flattened). The tower order sets each tower's profile shift.
x_usable = Expression(b=number_slider, o=offset, s=number_slider_4, Expression="Floor((b - 2*o)/s)*s")
y_usable = Expression(b=number_slider_3, o=offset, s=number_slider_4, Expression="Floor((b - 2*o)/s)*s")
site = Rectangle(Plane=PlaneXY(0, 0, 0), XSize=number_slider, YSize=number_slider_3, Radius=0)  # -> Rectangle, Length
columns = Expression(d=x_usable, s=number_slider_4, Expression="Floor(d/s) + 1")
rows = Expression(d=y_usable, s=number_slider_4, Expression="Floor(d/s) + 1")
x_margin = Expression(b=number_slider, d=x_usable, Expression="(b - d)/2")
y_margin = Expression(b=number_slider_3, d=y_usable, Expression="(b - d)/2")
column_index = Series(Start=0, Step=1, Count=columns)  # -> flatten(Series)
row_index = Series(Start=0, Step=1, Count=rows)  # -> flatten(Series)
columns_x_rows = CrossReference(ListA=column_index, ListB=row_index, CrossMode=1)  # -> ListA, ListB
checkerboard = Expression(c=columns_x_rows.ListA, r=columns_x_rows.ListB, Expression="c % 2 = r % 2")
x = Expression(m=x_margin, s=number_slider_4, c=columns_x_rows.ListA, Expression="m + s*c")
y = Expression(m=y_margin, s=number_slider_4, r=columns_x_rows.ListB, Expression="m + s*r")
cell_centres = ConstructPoint(XCoordinate=x, YCoordinate=y, ZCoordinate=0)
tower_centres = CullPattern(List=cell_centres, CullPattern=checkerboard)  # -> flatten(List)

# ---- group: Python rebuild
diagrid_and_site = S1Towers(x_bound=number_slider, y_bound=number_slider_3, offset=offset, spacing=number_slider_4)  # -> site, points
# ---------- diagrid_and_site: Python ----------
import Rhino.Geometry as rg

# Site boundary
site = rg.Rectangle3d(rg.Plane.WorldXY, x_bound, y_bound).ToNurbsCurve()

# Usable grid snapped to multiples of spacing, centred on the site
x_dim = (x_bound - 2 * offset) // spacing * spacing
y_dim = (y_bound - 2 * offset) // spacing * spacing
off_x = (x_bound - x_dim) / 2
off_y = (y_bound - y_dim) / 2

# Checkerboard cells -> one centre point per tower (row by row)
points = [
    rg.Point3d(off_x + spacing * col, off_y + spacing * row, 0.0)
    for row in range(int(y_dim // spacing) + 1)
    for col in range(int(x_dim // spacing) + 1)
    if col % 2 == row % 2
]
# ---------- end diagrid_and_site ----------
pattern = Panel("""1
2
2
1""")
# NATIVE GRASSHOPPER REBUILD (learner version)
# Mirrors the 'Python rebuild' group above, stage by stage, and shares its sliders, value lists and panels.
# Colour = stage. Dark-grey boxes = GH_Python, used only where native components can't do the job:
# Brick Dimensions (brick_wall class), Clash Detection (greedy loop), To COMPAS (compas objects).
# Checked equal to the Python rebuild at every stage: 4 towers, 640 bricks, identical frames.
orient = Panel("""T
R
R
T""")
module_information = S2Modules(configs=[list, list_2], pattern=pattern, modules=modules)  # -> length, lengths, widths, module_h, step, levels, t; inputs configs: list, pattern: list
# ---------- module_information: Python ----------
# r: compas
# venv: mas-2627
from compas_rhino.devtools import DevTools
DevTools.ensure_path()

from brick_wall import Brick

# One brick per config; pattern holds 1-based positions in configs (e.g. 1,2,2,1)
bricks = []
for c in configs:
    b = Brick()
    b.configuration(c)
    bricks.append(b)
slots = [bricks[int(p) - 1] for p in pattern]

length = slots[0].length
lengths = [b.length for b in slots]
widths = [b.width for b in slots]

# Sub-levels as brick top faces: levels 1-2 start on the module base, each level sits on the one two below it
module_h = []
for s, b in enumerate(slots):
    module_h.append((module_h[s - 2] if s >= 2 else 0) + b.height)
used = [bricks[i] for i in sorted({int(p) - 1 for p in pattern})]
step = sum(b.height for b in used)

# All sub-levels, module by module
n = int(modules)
levels = [m * step + h for m in range(n) for h in module_h]

# Normalised level parameters (0..1) for the Graph Mapper
t = [i / (n - 1) for i in range(n)]
# ---------- end module_information ----------
graph_2 = GraphMapper(
    module_information.t,
    x0=0,
    x1=1,
    y0=0,
    y1=1,
    container_name="Bezier",
    cpx=[0, 0.8069118368, 0.3624295005, 1],
    cpy=[0.3868732658, 0.7079046096, 0.8911145944, 0.4580811707])
radii_and_rotations = S3Profile(graph=graph_2, min_radius=min_radius, factor=factor, degrees=number_slider_5)  # -> radii, angles; inputs graph: list
# ---------- radii_and_rotations: Python ----------
import math

# Source domain = actual bounds of the graph values, normalised to 0..1
g_min, g_max = min(graph), max(graph)
norm = [(g - g_min) / (g_max - g_min) for g in graph]

# Remap the profile to a radius and a rotation angle per level
r_max = min_radius * factor
radii = [min_radius + n * (r_max - min_radius) for n in norm]
angles = [math.radians(-degrees + n * 2 * degrees) for n in norm]
# ---------- end radii_and_rotations ----------
rings = S4Rings(
    points=diagrid_and_site.points,
    radii=radii_and_rotations.radii,
    angles=radii_and_rotations.angles,
    step=module_information.step)  # -> rings, ring_angles; inputs points: list, radii: list, angles: list
# ---------- rings: Python ----------
import Rhino.Geometry as rg
import ghpythonlib.treehelpers as th

n = len(radii)

# Per tower: profile shifted by the tower index (wrapped, as Shift List with x%z)
rings = th.list_to_tree([
    [rg.Circle(rg.Point3d(p.X, p.Y, k * step), radii[(k + i) % n]) for k in range(n)]
    for i, p in enumerate(points)
])
ring_angles = th.list_to_tree([
    [angles[(k + i) % n] for k in range(n)]
    for i in range(len(points))
])
# ---------- end rings ----------
curve_division = S5Division(
    rings=rings.rings,
    ring_angles=rings.ring_angles,
    lengths=module_information.lengths,
    widths=module_information.widths,
    orient=orient,
    gap=number_slider_2)  # -> points, tangents, params; inputs rings: tree, ring_angles: tree, lengths: list, widths: list, orient: list
# ---------- curve_division: Python ----------
import math
import ghpythonlib.treehelpers as th

ring_list = th.tree_to_list(rings)
angle_list = th.tree_to_list(ring_angles)

dirs = [o.strip() for o in orient]

# Spacing between neighbouring points: half the footprints along the ring of two consecutive levels, plus gap
# Footprint after the plan turn a: T = length*|cos a| + width*|sin a|, R = length*|sin a| + width*|cos a|
counts = []
for cs, aa in zip(ring_list, angle_list):
    tower = []
    for c, a in zip(cs, aa):
        cos_a, sin_a = abs(math.cos(a)), abs(math.sin(a))
        foot = [l * cos_a + w * sin_a if d == "T" else l * sin_a + w * cos_a for l, w, d in zip(lengths, widths, dirs)]
        spacing = max((foot[s] + foot[s + 1]) / 2 for s in range(len(foot) - 1)) + gap
        tower.append(int(c.GetLength() / spacing // 2 * 2))
    counts.append(tower)

# Same count on every ring of a tower (its smallest), so the points line up between modules
counts = [[min(ns)] * len(ns) for ns in counts]
t = [[list(c.DivideByCount(n, True)) for c, n in zip(cs, ns)] for cs, ns in zip(ring_list, counts)]

points = th.list_to_tree([[[c.PointAt(x) for x in ts] for c, ts in zip(cs, tt)] for cs, tt in zip(ring_list, t)])
tangents = th.list_to_tree([[[c.TangentAt(x) for x in ts] for c, ts in zip(cs, tt)] for cs, tt in zip(ring_list, t)])
params = th.list_to_tree(t)
# ---------- end curve_division ----------
rotate_points = RotatePoints(rings=rings.rings, points=curve_division.points, tangents=curve_division.tangents, shift=shift)  # -> rot_points, rot_tangents; inputs rings: tree, points: tree, tangents: tree
# ---------- rotate_points: Python ----------
import math
import Rhino.Geometry as rg
import ghpythonlib.treehelpers as th

ring_list = th.tree_to_list(rings)
pt_list = th.tree_to_list(points)
tan_list = th.tree_to_list(tangents)

# Twist: each circle turns `shift` point spacings (360 / points on its ring) further than the one below,
# so every module lands on the points of the module below
xforms = [
    [rg.Transform.Rotation(2 * math.pi / len(ps) * shift * k, c.Arc.Plane.ZAxis, c.Arc.Center) for k, (c, ps) in enumerate(zip(cs, pss))]
    for cs, pss in zip(ring_list, pt_list)
]

rot_points = th.list_to_tree([[[x * p for p in ps] for x, ps in zip(xs, pss)] for xs, pss in zip(xforms, pt_list)])
rot_tangents = th.list_to_tree([[[x * v for v in vs] for x, vs in zip(xs, vss)] for xs, vss in zip(xforms, tan_list)])
# ---------- end rotate_points ----------
brick_bond = BrickBond(points=rotate_points.rot_points, tangents=rotate_points.rot_tangents, bond=bond, module_h=module_information.module_h)  # -> bond_points, bond_tangents; inputs points: tree, tangents: tree, module_h: list
# ---------- brick_bond: Python ----------
import Rhino.Geometry as rg
import ghpythonlib.treehelpers as th

pt_list = th.tree_to_list(points)
tan_list = th.tree_to_list(tangents)
n = int(bond)
m = len(module_h)

# Copy each module ring to its sub-levels (brick top faces) and alternate per level, regardless of module:
# level g = module * m + sub-level keeps the points whose index matches g (every n-th point)
bond_points = th.list_to_tree([
    [[p + rg.Vector3d(0, 0, h) for j, p in enumerate(ps) if j % n == (k * m + s) % n] for k, ps in enumerate(pss) for s, h in enumerate(module_h)]
    for pss in pt_list
])
bond_tangents = th.list_to_tree([
    [[v for j, v in enumerate(vs) if j % n == (k * m + s) % n] for k, vs in enumerate(vss) for s in range(m)]
    for vss in tan_list
])
# ---------- end brick_bond ----------
clash_detection = S6Cull(
    rings=rings.rings,
    points=brick_bond.bond_points,
    tangents=brick_bond.bond_tangents,
    lengths=module_information.lengths,
    widths=module_information.widths,
    gap=number_slider_2)  # -> kept_points, kept_tangents; inputs rings: tree, points: tree, tangents: tree, lengths: list, widths: list
# ---------- clash_detection: Python ----------
import math
import ghpythonlib.treehelpers as th

ring_list = th.tree_to_list(rings)
pt_list = th.tree_to_list(points)
tan_list = th.tree_to_list(tangents)
towers, levels = len(ring_list), len(ring_list[0])
m = len(pt_list[0]) // levels

# Clearance between towers: largest brick plan diagonal in the pattern + gap
threshold = max(math.hypot(l, w) for l, w in zip(lengths, widths)) + gap

# Per module, larger rings win: go from largest to smallest radius (ties keep tower order) and keep a point
# only if it clears, in plan, every point already kept on other rings in any sub-level of that module
keep = [[None] * len(pt_list[0]) for _ in range(towers)]
for k in range(levels):
    kept = []
    for i in sorted(range(towers), key=lambda i: -ring_list[i][k].Radius):
        for s in range(k * m, (k + 1) * m):
            keep[i][s] = [all(math.hypot(p.X - q.X, p.Y - q.Y) >= threshold for q in kept) for p in pt_list[i][s]]
        kept += [p for s in range(k * m, (k + 1) * m) for p, ok in zip(pt_list[i][s], keep[i][s]) if ok]

kept_points = th.list_to_tree([[[p for p, ok in zip(ps, ks) if ok] for ps, ks in zip(pss, kss)] for pss, kss in zip(pt_list, keep)])
kept_tangents = th.list_to_tree([[[v for v, ok in zip(vs, ks) if ok] for vs, ks in zip(vss, kss)] for vss, kss in zip(tan_list, keep)])
# ---------- end clash_detection ----------
brick_frames = BrickFrames(
    points=clash_detection.kept_points,
    tangents=clash_detection.kept_tangents,
    ring_angles=rings.ring_angles,
    configs=[list, list_2],
    pattern=pattern,
    orient=orient)  # -> frames, bricks; inputs points: tree, tangents: tree, ring_angles: tree, configs: list, pattern: list, orient: list
# ---------- brick_frames: Python ----------
# r: compas
# venv: mas-2627
from compas_rhino.devtools import DevTools
DevTools.ensure_path()

import math
import ghpythonlib.treehelpers as th
from compas.geometry import Frame, Point, Vector
from brick_wall import Brick

pt_list = th.tree_to_list(points)
tan_list = th.tree_to_list(tangents)
angle_list = th.tree_to_list(ring_angles)

# Pattern slot = sub-level within a module: its config and orientation (T = tangential, R = radial)
slots = [configs[int(p) - 1] for p in pattern]
dirs = [o.strip() for o in orient]
m = len(slots)

z = Vector(0, 0, 1)
frame_list, brick_list = [], []
for i, levels in enumerate(pt_list):
    tower_frames, tower_bricks = [], []
    for s, pts in enumerate(levels):
        a = angle_list[i][s // m]
        level_frames, level_bricks = [], []
        for p, t in zip(pts, tan_list[i][s]):
            b = Brick()
            b.configuration(slots[s % m])
            # Length along the tangent (T) or inward to the ring centre (R), then turned in plan by the ring angle
            x = Vector(t.X, t.Y, 0).unitized()
            if dirs[s % m] == "R":
                x = z.cross(x)
            x = x * math.cos(a) + z.cross(x) * math.sin(a)
            # Points mark the top face: frame sits at the brick centre
            b.frame = Frame(Point(p.X, p.Y, p.Z - b.height / 2), x, z.cross(x))
            level_frames.append(b.frame)
            level_bricks.append(b.draw())
        tower_frames.append(level_frames)
        tower_bricks.append(level_bricks)
    frame_list.append(tower_frames)
    brick_list.append(tower_bricks)

frames = th.list_to_tree(frame_list)
bricks = th.list_to_tree(brick_list)
# ---------- end brick_frames ----------
draw_frames = COMPASDraw(cg=brick_frames.frames)  # -> rg
#   port cg: The COMPAS geometry or datastructure to be drawn.
#   port rg: The Rhino geometry object.
# ---------- draw_frames: Python ----------
# r: compas>=2.14.1
"""
Draws COMPAS geometry in Grasshopper.
"""

from typing import Any

import Grasshopper

from compas.scene import SceneObject


class CompasToRhinoGeometry(Grasshopper.Kernel.GH_ScriptInstance):
    def RunScript(self, cg):
        if not cg:
            return None

        return SceneObject(item=cg).draw()
# ---------- end draw_frames ----------
draw_bricks = COMPASDraw(cg=brick_frames.bricks)  # -> rg; same code as draw_frames

# ----
panel = Panel(lamcp)

# ---- group: 2 · Brick Data / GH_Python · reads brick_wall.Brick (class not available natively)
brick_dimensions_3 = BrickDimensions(configs=[list, list_2])  # -> lengths, widths, heights; inputs configs: list
# ---------- brick_dimensions_3: Python ----------
# r: compas
# venv: mas-2627
from compas_rhino.devtools import DevTools
DevTools.ensure_path()

from brick_wall import Brick

# Length, width and height of each configuration, read from brick_wall.Brick
lengths, widths, heights = [], [], []
for c in configs:
    b = Brick()
    b.configuration(c)
    lengths.append(b.length)
    widths.append(b.width)
    heights.append(b.height)
# ---------- end brick_dimensions_3 ----------

# ---- group: 2 · Brick Data
# 2 · BRICK DATA
# Brick Dimensions [GH_Python] reads length / width / height per configuration from brick_wall.Brick.
# pattern (1-based) picks a configuration per slot (= sub-level)  ->  slot lengths, widths, heights.
# module_h (brick top faces): slots alternate between two point columns (Dispatch True/False);
# running sums per column (Mass Addition partial results) are woven back  ->  [9.85, 15.2, 25.05, 25.05].
# step = sum of the heights of the configurations used (Create Set).   t = Range 0..1 in (Modules - 1) steps.
slot_index = Expression(p=pattern, Expression="p - 1")
modules_1 = Expression(n=modules, Expression="n - 1")
t = Range(Domain=Domain(0, 1), Steps=modules_1)  # -> flatten(Range)
slot_lengths = ListItem(List=brick_dimensions_3.lengths, Index=slot_index, Wrap=True)
slot_widths = ListItem(List=brick_dimensions_3.widths, Index=slot_index, Wrap=True)
slot_heights = ListItem(List=brick_dimensions_3.heights, Index=slot_index, Wrap=True)
configs_used = CreateSet(List=slot_index)  # -> Set, Map
columns_a_b = Panel("""True
False""")
used_heights = ListItem(List=brick_dimensions_3.heights, Index=configs_used.Set, Wrap=True)
split_columns = Dispatch(List=slot_heights, DispatchPattern=columns_a_b)  # -> ListA, ListB
stack_a = MassAddition(Input=split_columns.ListA)  # -> Result, PartialResults
stack_b = MassAddition(Input=split_columns.ListB)  # -> Result, PartialResults
step = MassAddition(Input=used_heights)  # -> Result, PartialResults
weave_a_b = Panel("""0
1""")
module_h = Weave(Pattern=weave_a_b, Stream0=stack_a.PartialResults, Stream1=stack_b.PartialResults, NullGaps=False)

# ---- group: 3 · Profile
# 3 · PROFILE
# Graph Mapper (Bezier; a copy of the Python rebuild's graph, not linked to it) samples the profile at t.
# Bounds -> Remap to [min_radius, min_radius * factor] = radii, and to [-Degrees, +Degrees] -> Radians = ring angles.
# Only the profile's shape matters: it is normalised by its own bounds.
profile = GraphMapper(
    t,
    x0=0,
    x1=1,
    y0=0,
    y1=1,
    container_name="Bezier",
    cpx=[0, 0.8069118368, 0.3624295005, 1],
    cpy=[0.3868732658, 0.7079046096, 0.8911145944, 0.4580811707])
max_radius = Expression(r=min_radius, f=factor, Expression="r * f")
degrees = Expression(d=number_slider_5, Expression="-d")
profile_bounds = Bounds(Numbers=profile)
radius_domain = ConstructDomain(DomainStart=min_radius, DomainEnd=max_radius)
angle_domain = ConstructDomain(DomainStart=degrees, DomainEnd=number_slider_5)
radii = RemapNumbers(Value=profile, Source=profile_bounds, Target=radius_domain)  # -> Mapped, Clipped
angles_deg = RemapNumbers(Value=profile, Source=profile_bounds, Target=angle_domain)  # -> Mapped, Clipped
angles = Radians(Degrees=angles_deg.Mapped)

# ---- group: 4 · Rings
# 4 · RINGS
# Each tower shifts the profile by its index (Shift List, wrap on)  ->  radii and ring angles per tower {0;tower}.
# Trim Tree removes the extra index that Shift List adds.
# Ring centres = tower x, y at module heights 0, step, 2*step ...  ->  Circle = rings {0;tower}(module).
towers = ListLength(List=tower_centres)
tower_x_y = Deconstruct(Point=graft(tower_centres))  # -> XComponent, YComponent, ZComponent
tower_index = Series(Start=0, Step=1, Count=towers)  # -> flatten(Series)
module_heights_2 = Series(Start=0, Step=step.Result, Count=modules)  # -> flatten(Series)
radii_per_tower = ShiftList(List=radii.Mapped, Shift=graft(tower_index), Wrap=True)
ring_angles = ShiftList(List=angles, Shift=graft(tower_index), Wrap=True)
ring_centres = ConstructPoint(XCoordinate=tower_x_y.XComponent, YCoordinate=tower_x_y.YComponent, ZCoordinate=module_heights_2)
radii_0_tower = TrimTree(Tree=radii_per_tower, Depth=1)
ring_angles_0_tower = TrimTree(Tree=ring_angles, Depth=1)
rings_2 = Circle(Plane=ring_centres, Radius=radii_0_tower)

# ---- group: 5 · Curve Division
# 5 · CURVE DIVISION
# Footprint of each slot along the ring after the plan turn a:  T = l*|cos a| + w*|sin a|,  R = l*|sin a| + w*|cos a|.
# Spacing = largest half-sum of two consecutive slots (Shift List -1 / +1 drops the last / first slot) + gap.
# Even count = floor(ring length / spacing / 2) * 2, locked to the smallest count of each tower so points line up between modules.
# Rings are copied to their sub-levels (Duplicate Data + Move by module_h) and divided  ->  points / tangents {0;tower;level}.
is_tangential = MatchText(Text=orient, Pattern="T", Case=True)
footprint_along_ring = Expression(
    a=graft(ring_angles_0_tower),
    l=slot_lengths,
    w=slot_widths,
    t=is_tangential,
    Expression="If(t, l*Abs(Cos(a)) + w*Abs(Sin(a)), l*Abs(Sin(a)) + w*Abs(Cos(a)))")
slots_1_m_1 = ShiftList(List=footprint_along_ring, Shift=-1, Wrap=False)
slots_2_m = ShiftList(List=footprint_along_ring, Shift=1, Wrap=False)
consecutive_pairs = Addition(A=slots_1_m_1, B=slots_2_m)
pair_bounds = Bounds(Numbers=consecutive_pairs)
ring_length = Length(Curve=rings_2)
sub_levels_per_module = ListLength(List=module_h)
largest_pair = DeconstructDomain(Domain=pair_bounds)  # -> Start, End
spacing = Expression(x=largest_pair.End, g=number_slider_2, Expression="x/2 + g")
sub_level_lift = UnitZ(Factor=module_h)
even_count = Expression(c=graft(ring_length), s=spacing, Expression="Floor(c/s/2)*2")
ring_per_sub_level = DuplicateData(Data=rings_2, Number=sub_levels_per_module, Order=False)
lift_per_sub_level = DuplicateData(Data=sub_level_lift, Number=modules, Order=True)
rings_0_tower = TrimTree(Tree=ring_per_sub_level, Depth=1)
counts_per_tower = TrimTree(Tree=even_count, Depth=2)
count_bounds = Bounds(Numbers=counts_per_tower)
sub_level_rings = Move(Geometry=rings_0_tower, Motion=lift_per_sub_level)  # -> Geometry, Transform
smallest_count = DeconstructDomain(Domain=count_bounds)  # -> Start, End
divide_2 = DivideCurve(Curve=sub_level_rings.Geometry, Count=smallest_count.Start, Kinks=False)  # -> Points, Tangents, Parameters

# ---- group: 6 · Rotate Points (twist)
# 6 · ROTATE POINTS (twist)
# Level g belongs to module k = floor(g / m), m = sub-levels per module.
# Twist angle = 2*pi / N * shift * k  (N = points per ring), so each module lands on the points of the module below.
# Points: Rotate about the tower axis.  Tangents: Rotate Vector about Z.
sub_levels_per_tower = ListLength(List=lift_per_sub_level)
level_index_g = Series(Start=0, Step=1, Count=sub_levels_per_tower)  # -> flatten(Series)
tower_axis = ConstructPoint(XCoordinate=tower_x_y.XComponent, YCoordinate=tower_x_y.YComponent, ZCoordinate=0)
twist_angle = Expression(g=level_index_g, N=smallest_count.Start, s=shift, m=sub_levels_per_module, Expression="2*Pi/N*s*Floor(g/m)")
axis_per_level = DuplicateData(Data=tower_axis, Number=sub_levels_per_tower, Order=True)
axis_0_tower = TrimTree(Tree=axis_per_level, Depth=1)
z_axis = UnitZ(Factor=1)
rot_points = Rotate(Geometry=divide_2.Points, Angle=graft(twist_angle), Plane=graft(axis_0_tower))  # -> Geometry, Transform
rot_tangents = Rotate(Vector=divide_2.Tangents, Axis=z_axis, Angle=graft(twist_angle))

# ---- group: 7 · Brick Bond
# 7 · BRICK BOND
# Level g keeps every bond-th point, starting at g % bond: pattern j = g % bond for j = 0 ... bond-1, applied with Cull Pattern.
# bond = 2: L1/L3 keep the even points, L2/L4 the odd points; alternating per level, regardless of module.
# Out: bond points / tangents {0;tower;level}.
levels_per_tower = ListLength(List=sub_level_rings.Geometry)
position_in_bond = Series(Start=0, Step=1, Count=bond)  # -> flatten(Series)
level_index_g_2 = Series(Start=0, Step=1, Count=levels_per_tower)
g_0_tower = TrimTree(Tree=level_index_g_2, Depth=1)
keep_pattern = Expression(j=position_in_bond, g=graft(g_0_tower), n=bond, Expression="j = g % n")
bond_points = CullPattern(List=rot_points.Geometry, CullPattern=keep_pattern)
bond_tangents = CullPattern(List=rot_tangents, CullPattern=keep_pattern)

# ---- group: 8 · Clash Detection [GH_Python] / GH_Python · greedy loop (no loops in native GH)
# 8 · CLASH DETECTION  [GH_Python]
# Why Python: a greedy loop. Per module, towers go from largest to smallest ring; a point is kept only if it clears
# every point already kept on other towers (plan distance >= largest brick diagonal + gap).
# Native Grasshopper has no loops (no looping plugin installed).
# In: module rings {0;tower}, points / tangents {0;tower;level}.  Out: kept points / tangents {0;tower;level}.
clash_detection_2 = ClashDetection(rings=rings_2, points=bond_points, tangents=bond_tangents, lengths=slot_lengths, widths=slot_widths, gap=number_slider_2)  # -> kept_points, kept_tangents; inputs rings: tree, points: tree, tangents: tree, lengths: list, widths: list; same code as clash_detection

# ---- group: 9 · Brick Frames
# 9 · BRICK FRAMES
# Per level: slot s = g % m -> configuration, length, width, height, orientation;  module k = floor(g / m) -> ring angle.
# Frame x = tangent turned by the ring angle (+90 deg for R slots);  y = x turned 90 deg;  origin = top-face point - h/2 (brick centre).
# Construct Plane -> Center Box (half sizes) = bricks (preview on).
# To COMPAS [GH_Python]: planes -> compas Frames, and bricks via brick_wall.Brick (compas objects for the robot workflow).
module_k = Expression(g=g_0_tower, m=sub_levels_per_module, Expression="Floor(g/m)")
slot_s = Expression(g=g_0_tower, m=sub_levels_per_module, Expression="g % m")
slot_configs = ListItem(List=[list, list_2], Index=slot_index, Wrap=True)
is_radial = MatchText(Text=orient, Pattern="R", Case=True)
length_per_level = ListItem(List=slot_lengths, Index=slot_s, Wrap=True)
width_per_level = ListItem(List=slot_widths, Index=slot_s, Wrap=True)
height_per_level = ListItem(List=slot_heights, Index=slot_s, Wrap=True)
radial_per_level = ListItem(List=is_radial, Index=slot_s, Wrap=True)
config_per_level = ListItem(List=slot_configs, Index=slot_s, Wrap=True)
ring_angle_per_level = ListItem(List=ring_angles_0_tower, Index=module_k, Wrap=True)
length_direction = Expression(a=ring_angle_per_level, r=radial_per_level, Expression="If(r, a + Pi/2, a)")
down_half_a_brick = Expression(h=height_per_level, Expression="-h/2")
z_axis_2 = UnitZ(Factor=1)
frame_x = Rotate(Vector=clash_detection_2.kept_tangents, Axis=z_axis_2, Angle=graft(length_direction))
to_brick_centre = UnitZ(Factor=graft(down_half_a_brick))
quarter_turn = Expression(Expression="Pi/2")
half_width = Expression(w=width_per_level, Expression="w/2")
half_height = Expression(h=height_per_level, Expression="h/2")
half_length = Expression(l=length_per_level, Expression="l/2")
brick_centres = Move(Geometry=clash_detection_2.kept_points, Motion=to_brick_centre)  # -> Geometry, Transform
frame_y = Rotate(Vector=frame_x, Axis=z_axis_2, Angle=quarter_turn)
frames_planes = ConstructPlane(Origin=brick_centres.Geometry, XAxis=frame_x, YAxis=frame_y)
bricks = CenterBox(Base=frames_planes, X=graft(half_length), Y=graft(half_width), Z=graft(half_height))

# ---- group: 9 · Brick Frames / GH_Python · compas objects (COMPAS plugin has no constructors)
to_compas = ToCOMPAS(planes=frames_planes, configs=graft(config_per_level))  # -> frames, bricks; inputs planes: tree, configs: tree
# ---------- to_compas: Python ----------
# r: compas
# venv: mas-2627
from compas_rhino.devtools import DevTools
DevTools.ensure_path()

import ghpythonlib.treehelpers as th
from compas_rhino.conversions import plane_to_compas_frame
from brick_wall import Brick

plane_list = th.tree_to_list(planes)
config_list = th.tree_to_list(configs)

# Rhino planes -> compas frames; each brick drawn as a compas Box with its configuration's dimensions
frame_list, brick_list = [], []
for pls, cfs in zip(plane_list, config_list):
    tower_frames, tower_bricks = [], []
    for pl, cf in zip(pls, cfs):
        level_frames, level_bricks = [], []
        for p in pl:
            b = Brick(plane_to_compas_frame(p))
            b.configuration(int(cf[0]))
            level_frames.append(b.frame)
            level_bricks.append(b.draw())
        tower_frames.append(level_frames)
        tower_bricks.append(level_bricks)
    frame_list.append(tower_frames)
    brick_list.append(tower_bricks)

frames = th.list_to_tree(frame_list)
bricks = th.list_to_tree(brick_list)
# ---------- end to_compas ----------

# ==== cluster ClusterHeights
x = ClusterInput()
y = ClusterInput()

# ---- group: 0 = starting height
num = Number(0)

# ---- group: 1 = difference between half heights
expression = Expression(x=x, y=y, Expression="1/2*(abs(x-y))")

# ---- group: 2 = sum of half heights
expression_2 = Expression(x=x, y=y, Expression="1/2*(abs(x+y))")

# ---- group: 3 = height of taller element
expression_3 = Expression(x=x, y=y, Expression="max(x,y)")

# ----
merge = Merge(Data1=num, Data2=expression, Data3=expression_2, Data4=expression_3)

# ---- group: height betwen clusters
expression_4 = Expression(x=x, y=y, Expression="sum(x,y)")

# ----
R = ClusterOutput(merge)
R_2 = ClusterOutput(expression_4)
