# Grasshopper definition Robotic Wall 2.gh (Grasshopper 1.0.8)

list = ValueList({"Config 1": 0, "Config 2": 1, "Config 3": 2}, selected="Config 1")
list_2 = ValueList({"Config 1": 0, "Config 2": 1, "Config 3": 2}, selected="Config 2")
number_slider = Slider(420, range=0..1000)
number_slider_2 = Slider(594, range=0..1000)
no_layers = Slider(6, range=0..10)
brick_dimensions = Python3Script(orientation=list)  # -> out, length, width, height, orient
# ---------- brick_dimensions: Python ----------
# r: compas
# venv: mas-2627
from compas_rhino.devtools import DevTools
DevTools.ensure_path()

from brick_wall import Brick

samplebrick = Brick()
samplebrick.configuration(orientation)

length = samplebrick.length
width = samplebrick.width
height = samplebrick.height
orient = orientation
# ---------- end brick_dimensions ----------
brick_dimensions_2 = Python3Script(orientation=list_2)  # -> out, length, width, height, orient; same code as brick_dimensions

# ---- group: This is needed only ONCE in the GH definition
enable_auto_reload = Python3Script()  # -> ok
# ---------- enable_auto_reload: Python ----------
"""
------------------------------
Using VS Code as Python editor
------------------------------

The simplest way to start using VS Code as our editor, is
to place our Python code in files located IN THE SAME FOLDER as our Grasshopper file.

After we have done that, we need 2 steps: 

1. Enable the COMPAS reloader on one component. This tells Grasshopper to watch for changes in the Pythoh files and reload if changed.
2. Every other component that uses Python code from external files needs to start with a method to ensure Grasshopper knows where to load the files from.

"""
# r: compas
# venv: mas-2627

from compas_rhino.devtools import DevTools
DevTools.enable_reloader()
# ---------- end enable_auto_reload ----------

# ----
lamcp = LAMCPBridge(enable=Toggle(True))  # -> status; inputs enable: Boolean, port: Int32
#   port enable: Toggle to start (True) or stop (False) the local HTTP server.
#   port port: Port to listen on (loopback only). Defaults to 8765.
#   port status: Current server status string.
# ---------- lamcp: Python ----------
"""
LAMCP Bridge: local HTTP server inside Rhino 8 / Grasshopper CPython.

Exposes `POST /exec` (JSON: `{"code": "...", "timeout": 30}`) which
exec()s `code` and returns
`{"stdout": "...", "stderr": "...", "result": "...", "error": null|str}`.

Pair with the `lamcp` FastMCP server, which translates Claude's
`run_python_script` MCP tool calls into POSTs to this endpoint.

Binds to 127.0.0.1 only. NEVER expose beyond localhost â€” it exec()s
arbitrary Python with full Rhino API access.

LAMCP v0.1.0
"""

import contextlib
import io
import json
import threading
import traceback
from http.server import BaseHTTPRequestHandler
from http.server import HTTPServer

import Grasshopper
import scriptcontext as sc


SHARED_GLOBALS_KEY = "_lamcp_bridge_globals"
SERVER_KEY = "_lamcp_bridge_server"


def _exec_code(code, timeout):
    """Run `code` on the HTTP-server thread and capture stdout/stderr/result.

    NOTE: this is intentionally NOT marshalled to Rhino's UI thread for the
    spike â€” `Rhino.RhinoApp.InvokeOnUiThread` was queueing actions that
    never fired in Rhino 8 CPython. Most read-only RhinoCommon access is
    safe cross-thread; mutations may crash. Add Eto-based marshalling
    back here when we need it.
    """
    out = io.StringIO()
    err = io.StringIO()
    g = sc.sticky.setdefault(SHARED_GLOBALS_KEY, {"__name__": "__lamcp_bridge__"})
    error_text = None
    result_repr = None
    try:
        with contextlib.redirect_stdout(out), contextlib.redirect_stderr(err):
            exec(code, g, g)
            result_repr = repr(g.get("_"))
    except BaseException:
        error_text = traceback.format_exc()

    return {
        "stdout": out.getvalue(),
        "stderr": err.getvalue(),
        "result": result_repr,
        "error": error_text,
    }


class _ExecHandler(BaseHTTPRequestHandler):
    # Silence default request logging so it doesn't clog the Rhino command line.
    def log_message(self, fmt, *args):
        pass

    def _send(self, code, payload):
        body = json.dumps(payload).encode("utf-8")
        self.send_response(code)
        self.send_header("Content-Type", "application/json")
        self.send_header("Content-Length", str(len(body)))
        self.end_headers()
        self.wfile.write(body)

    def do_GET(self):
        if self.path == "/health":
            self._send(200, {"status": "ok"})
        else:
            self._send(404, {"error": "not found"})

    def do_POST(self):
        if self.path != "/exec":
            self._send(404, {"error": "not found"})
            return
        length = int(self.headers.get("Content-Length", "0"))
        try:
            raw = self.rfile.read(length).decode("utf-8")
            body = json.loads(raw)
            code = body.get("code", "")
            timeout = float(body.get("timeout", 30.0))
        except Exception as exc:
            self._send(400, {"error": "bad request: " + repr(exc)})
            return
        result = _exec_code(code, timeout)
        self._send(200, result)


def _start_server(port):
    server = HTTPServer(("127.0.0.1", port), _ExecHandler)
    thread = threading.Thread(
        target=server.serve_forever, daemon=True, name="lamcp-bridge"
    )
    thread.start()
    return {"server": server, "thread": thread, "port": port}


def _stop_server(state):
    try:
        state["server"].shutdown()
        state["server"].server_close()
    except Exception:
        pass


class LamcpBridgeComponent(Grasshopper.Kernel.GH_ScriptInstance):
    def RunScript(self, enable: bool, port: int):
        port = int(port) if port else 8765

        state = sc.sticky.get(SERVER_KEY)

        if not enable:
            if state is not None:
                _stop_server(state)
                del sc.sticky[SERVER_KEY]
            return "stopped"

        # Already running on the requested port: no-op.
        if (
            state is not None
            and state.get("port") == port
            and state["thread"].is_alive()
        ):
            return "listening on http://127.0.0.1:{}".format(port)

        # Port changed or server died: tear down and restart.
        if state is not None:
            _stop_server(state)
            del sc.sticky[SERVER_KEY]

        try:
            sc.sticky[SERVER_KEY] = _start_server(port)
        except OSError as exc:
            ghenv.Component.AddRuntimeMessage(  # noqa: F821
                Grasshopper.Kernel.GH_RuntimeMessageLevel.Error,
                "Failed to bind 127.0.0.1:{}: {}".format(port, exc),
            )
            return "error: {}".format(exc)

        return "listening on http://127.0.0.1:{}".format(port)
# ---------- end lamcp ----------
rectangle = Rectangle(Plane=PlaneXY(0, 0, 0), XSize=number_slider, YSize=number_slider_2, Radius=0)  # -> Rectangle, Length
pt = ConstructPoint(XCoordinate=expr("x/2", number_slider), YCoordinate=expr("x/2", number_slider_2), ZCoordinate=0)
panel = Panel(lamcp)
lines_pts = LinesPts(C=rectangle.Rectangle, D=Slider(25, range=0..100), N=Slider(100, range=0..100))  # -> P, L, C_2

rad = Radians(Degrees=Slider(30, range=0..1000))
rad_2 = Radians(Degrees=Slider(0, range=0..1000))
shift_and_subtract = ShiftAndSubtract(L=lines_pts.L, I="-1")  # -> L_2, L_3
clampangle = ClampAngle(LineA=shift_and_subtract.L_2, LineB=shift_and_subtract.L_3, UpperLimit=rad, LowerLimit=rad_2, Strength=1)

shift = ShiftList(List=lines_pts.L, Shift=1, Wrap=True)

boundary = BoundarySurfaces(Edges=lines_pts.C_2)
mesh_uv = MeshSurface(Surface=boundary, UCount=5, VCount=5, Overhang=True, Equalize=False)
onmesh = OnMesh(Points=lines_pts.P, Mesh=mesh_uv, Strength=Slider(100, range=0..100000))

length_line = LengthLine(Line=lines_pts.L, Length=brick_dimensions.length, Strength=Slider(100, range=0..100))

index = ItemIndex(List=lines_pts.P, Item=lines_pts.P)
shift_2 = ShiftList(List=index, Shift=1, Wrap=True)  # -> simplify(List)
collider = Collider(Objects=lines_pts.P, Radii=brick_dimensions.length, IgnoreA=index, IgnoreB=shift_2, Strength=Slider(10, range=0..100))

expression = Expression(
    one_length=brick_dimensions.length,
    two_width=brick_dimensions_2.width,
    gap=Slider(4, range=0..10),
    Expression="one_length+two_width+gap")

# ---- group: Steps between modules
expression_2 = Expression(h1=brick_dimensions.height, h2=brick_dimensions_2.height, Expression="h1+h2")

# ----
merge = Merge(Data1=onmesh, Data2=length_line, Data3=collider, Data4=clampangle)  # -> flatten(Result)
bouncysolver = BouncySolver(
    GoalObjects=flatten(merge),
    Reset=Button(),
    Threshold=1e-15,
    Tolerance=0.0001,
    Damping=Slider(0.084, range=0..1),
    Iterations=10,
    On=Toggle(False))  # -> I, V, O

nurbs = NurbsCurve(Vertices=bouncysolver.V, Degree=3, Periodic=False)  # -> reparameterize(Curve), Length, Domain

# ---- group: Translation Vectors per module
series = Series(Start=0, Step=1, Count=no_layers)
multiplication = Multiplication(A=expression_2, B=series)
Z = UnitZ(Factor=multiplication)

# ----
cluster = Cluster(h1=brick_dimensions.height, h2=brick_dimensions_2.height)
divlength = DivideLength(Curve=nurbs.Curve, Length=expr("x/2", expression))  # -> Points, Tangents, Parameters
shift_and_subtract_2 = ShiftAndSubtract(L=divlength.Parameters, I="-1")  # -> L_2, L_3
subtraction = Subtraction(A=shift_and_subtract_2.L_3, B=shift_and_subtract_2.L_2)
Z_2 = UnitZ(Factor=cluster)
lng = ListLength(List=Z)
number_slider_3 = Slider(4, range=0..10)
avr = Average(Input=subtraction)
move = Move(Geometry=nurbs.Curve, Motion=Z_2)  # -> Geometry, Transform
division = Division(A=avr, B=no_layers)
lng_2 = ListLength(List=Z_2)
move_2 = Move(Geometry=move.Geometry, Motion=graft(Z))  # -> simplify(graft(Geometry)), Transform
series_2 = Series(Start=0, Step=division, Count=lng)  # -> graft(Series)
path_mapper = PathMapper(move_2.Geometry, source="{A;B}", target="{path_index}")
repeat = RepeatData(Data=series_2, Length=lng_2)  # -> simplify(graft(Data))
viewer = ParamViewer(repeat)
path_mapper_2 = PathMapper(repeat, source="{A;B}", target="{path_index}")
expression_3 = Expression(t=divlength.Parameters, dl=path_mapper_2, Expression="(t+dl)")  # -> simplify(R)
path_mapper_3 = PathMapper(expression_3, source="{A}(B)", target="{0;A}(B)")
Z_3 = UnitZ(Factor=1)
py3 = Python3Script(p_list=path_mapper_3)  # -> out, rev_p; inputs p_list: tree of Double
# ---------- py3: Python ----------
import ghpythonlib.treehelpers as th
import math as m
import Rhino.Geometry as rg

p_list = th.tree_to_list(p_list)
rps = [[p for n, p in enumerate(ps) if p <= 1.0] for np, ps in enumerate(p_list)]
rev_p = th.list_to_tree(rps)
# ---------- end py3 ----------
eval = EvaluateCurve(Curve=reparameterize(simplify(path_mapper)), Parameter=simplify(py3.rev_p))  # -> Point, Tangent, Angle
xprod = CrossProduct(VectorA=Z_3, VectorB=eval.Tangent, Unitize=True)  # -> Vector, Length
path_mapper_4 = PathMapper(eval.Point, source="{A}(B)", target="{0;A}(B)")
pl = ConstructPlane(Origin=eval.Point, XAxis=eval.Tangent, YAxis=xprod.Vector)
path_mapper_5 = PathMapper(pl, source="{A}(B)", target="{0;A}(B)")
item = ListItem(List=multiplication, Index=expr("-1", 0), Wrap=True)
py3_2 = Python3Script(pts_list=path_mapper_4, pln_list=path_mapper_5)  # -> out, rev_pts, rev_plns; inputs pts_list: tree of Point3d, pln_list: tree of Plane
# ---------- py3_2: Python ----------
import ghpythonlib.treehelpers as th

pts_list = th.tree_to_list(pts_list)
pln_list = th.tree_to_list(pln_list)

rps = [[p for n, p in enumerate(pts) if n % 2 == np % 2] for np, pts in enumerate(pts_list)]
rplns = [[q for m, q in enumerate(plns) if m % 2 == mp % 2] for mp, plns in enumerate(pln_list)]

rev_pts = th.list_to_tree(rps)
rev_plns = th.list_to_tree(rplns)
# ---------- end py3_2 ----------
py3_3 = Python3Script(pts_list=path_mapper_4)  # -> out, orientations; inputs pts_list: tree of Point3d
# ---------- py3_3: Python ----------
import ghpythonlib.treehelpers as th
import math as m
import Rhino.Geometry as rg

pts_list = th.tree_to_list(pts_list)
ori = []
for n in range(len(pts_list)):
    if n % 4 != 1 and n % 4 != 2:
        ori.append(0)
    else:
        ori.append(1)

orientations = th.list_to_tree(ori)
# ---------- end py3_3 ----------
py3_4 = Python3Script(orientations=py3_3.orientations)  # -> out, rotations; inputs orientations: list of Int32
# ---------- py3_4: Python ----------
import ghpythonlib.treehelpers as th
import math as m
import Rhino.Geometry as rg

orient = []
for o in orientations:
    a = 2
    if o == 0:
        a = 0
    else:
        a = m.pi/2
    orient.append(a)

rotations = th.list_to_tree(orient)
# ---------- end py3_4 ----------
bnd = Bounds(Numbers=py3_2.rev_pts)
dom = ConstructDomain(DomainStart=expr("0.25*x", item), DomainEnd=item)
remap = RemapNumbers(Value=py3_2.rev_pts, Source=bnd, Target=Domain(0, 1))  # -> Mapped, Clipped
pdecon = Deconstruct(Point=py3_2.rev_pts)  # -> XComponent, YComponent, ZComponent
graph = GraphMapper(
    remap.Mapped,
    x0=0,
    x1=1,
    y0=0,
    y1=1,
    container_name="Sinc",
    Equation_X0=0.2585823536,
    Equation_X1=0.4224238694,
    Equation_Y0=0.7358154058,
    Equation_Y1=0.4105070829)
bnd_2 = Bounds(Numbers=graph)
remap_2 = RemapNumbers(Value=graph, Source=bnd_2, Target=dom)  # -> Mapped, Clipped
smaller = SmallerThan(FirstNumber=pdecon.ZComponent, SecondNumber=remap_2.Mapped)  # -> SmallerThan, OrEqualTo
cull = CullPattern(List=py3_2.rev_pts, CullPattern=smaller.OrEqualTo)
cull_2 = CullPattern(List=py3_2.rev_plns, CullPattern=smaller.OrEqualTo)
clean = CleanTree(RemoveNulls=True, RemoveInvalid=True, RemoveEmpty=True, Tree=cull)
clean_2 = CleanTree(RemoveNulls=True, RemoveInvalid=True, RemoveEmpty=True, Tree=cull_2)
py3_5 = Python3Script(planes=clean_2, orient=py3_3.orientations, rotate=py3_4.rotations)  # -> out, way_frames; inputs planes: tree, orient: list, rotate: list
# ---------- py3_5: Python ----------
# r: compas
# venv: mas-2627
from compas_rhino.devtools import DevTools
DevTools.ensure_path()

import Rhino.Geometry as rg
# from
from compas.geometry import Frame, Vector, Point
from compas_rhino.conversions import plane_to_compas_frame
from compas.geometry import Transformation, Translation, Rotation
import math as m
import ghpythonlib.treehelpers as th
from brick_wall import Brick

planes = th.tree_to_list(planes)

way_frames = []
for npl, plns in enumerate(planes):
    sub_rot_frames = []
    ori = orient[npl] * rotate[npl]
    for n, pl in enumerate(plns):
        frame = plane_to_compas_frame(pl)
        rot_frame = frame.rotated(ori, frame.zaxis, frame.point)
        sub_rot_frames.append(rot_frame)
    way_frames.append(sub_rot_frames)

for wayf in way_frames:
    for w in wayf:
        w.point += Vector(0.0,0.0,1/2*Brick.HEIGHT)

way_frames = th.list_to_tree(way_frames)
# ---------- end py3_5 ----------
draw = COMPASDraw(cg=py3_5.way_frames)  # -> rg
#   port cg: The COMPAS geometry or datastructure to be drawn.
#   port rg: The Rhino geometry object.
# ---------- draw: Python ----------
# r: compas>=2.14.1
"""
Draws COMPAS geometry in Grasshopper.
"""

from typing import Any

import Grasshopper

from compas.scene import SceneObject


class CompasToRhinoGeometry(Grasshopper.Kernel.GH_ScriptInstance):
    def RunScript(self, cg):
        if not cg:
            return None

        return SceneObject(item=cg).draw()
# ---------- end draw ----------

# ==== cluster LinesPts
C = ClusterInput()
D = ClusterInput()
N = ClusterInput()
offset = OffsetCurve(Curve=C, Distance=expr("-x", D), Corners=1)
cp = ControlPoints(Curve=offset)  # -> Points, Weights, Knots
cull_i = CullIndex(List=cp.Points, Indices="-1", Wrap=True)
index = ItemIndex(List=cull_i, Item=cull_i)
equals = Equality(FirstNumber=expr("x%2", index), SecondNumber=0)  # -> Equality, Inequality
cull = CullPattern(List=cull_i, CullPattern=equals.Equality)
pline = PolyLine(Vertices=cull, Closed=False)
divide = DivideCurve(Curve=pline, Count=N, Kinks=False)  # -> Points, Tangents, Parameters
shift_and_subtract = ShiftAndSubtract(L=divide.Points, I="-1")  # -> L_2, L_3
ln = Line(StartPoint=shift_and_subtract.L_2, EndPoint=shift_and_subtract.L_3)
C_2 = ClusterOutput(offset)
P = ClusterOutput(divide.Points)
L = ClusterOutput(ln)

# ==== cluster Cluster
h1 = ClusterInput()
h2 = ClusterInput()
expression = Expression(h1=h1, h2=h2, Expression="1/2*(abs(h1-h2))")
expression_2 = Expression(h1=h1, h2=h2, Expression="1/2*(h1+h2)")
expression_3 = Expression(h1=h1, h2=h2, Expression="max(h1,h2)")
merge = Merge(Data1=0, Data2=expression, Data3=expression_2, Data4=expression_3)
R = ClusterOutput(merge)

# ==== cluster ShiftAndSubtract
L = ClusterInput()
I = ClusterInput()
shift = ShiftList(List=L, Shift=1, Wrap=True)
cull_i = CullIndex(List=L, Indices=I, Wrap=True)
cull_i_2 = CullIndex(List=shift, Indices=I, Wrap=True)
L_2 = ClusterOutput(cull_i)
L_3 = ClusterOutput(cull_i_2)
