# Grasshopper definition Robotic Wall.gh (Grasshopper 1.0.8)

resolution_grid = Slider(2, range=0..10)
base_space_curve = Python3Script(
    x_bound=Slider(420, range=0..1000),
    y_bound=Slider(594, range=0..1000),
    offset_x=Slider(50, range=0..1000),
    offset_y=Slider(50, range=0..1000),
    division=Slider(150, range=0..1000))  # -> out, dwg_midpt, base, basecrv, crvpts, crvlines; inputs x_bound: Double, y_bound: Double, offset_x: Double, offset_y: Double, division: Int32
# ---------- base_space_curve: Python ----------
import Rhino.Geometry as rg

length = x_bound - 2*offset_x
height = y_bound - 2*offset_y
basept = rg.Point3d(offset_x, offset_y, 0.0)
base = rg.Rectangle3d(rg.Plane(rg.Point3d(0.0,0.0,0.0),rg.Vector3d.ZAxis),x_bound,y_bound)
base = base.ToNurbsCurve()

# 2. Drawing the Base Curve
dwg_midpt = rg.Point3d(x_bound/2, y_bound/2, 0.0)
basecrv = rg.Ellipse(
    rg.Plane(dwg_midpt,rg.Vector3d.ZAxis), 
    (length - 2*offset_x)/2, 
    (height - 2*offset_y)/2
    )
basecrv = basecrv.ToNurbsCurve()

# 3. Drawing the individual lines and points
basecrv.Domain = rg.Interval(0.0,1.0)
crvpts = [basecrv.PointAt(n/division) for n in range(division)]
ts = [n/division for n in range(division)]
crvlines = [rg.Line(crvpts[i%division], crvpts[(i+1)%division]) for i, p in enumerate(crvpts)]
# ---------- end base_space_curve ----------
crv = Curve(base_space_curve.base)
line = Line(base_space_curve.crvlines)

# ---- group: Restricts Length of the Curve
resolution_guide_curve = Slider(32, range=0..32)
length_line = LengthLine(Line=line, Strength=Slider(100, range=0..100))

# ---- group: Ensures that there is a distance between points
repelling_radii = Slider(32, range=0..50)
number_slider = Slider(3, range=0..10)
index = ItemIndex(List=line, Item=line)
shift = ShiftList(List=index, Shift=1, Wrap=True)  # -> simplify(List)
line_2 = Line(line)
collider = Collider(Objects=line_2, Radii=repelling_radii, IgnoreA=index, IgnoreB=shift, Strength=Slider(10, range=0..100))

# ---- group: Angle Restriction for Curve
rad = Radians(Degrees=Slider(30, range=0..1000))
rad_2 = Radians(Degrees=Slider(0, range=0..1000))
shift_2 = ShiftList(List=line_2, Shift=1, Wrap=True)
clampangle = ClampAngle(LineA=line_2, LineB=shift_2, UpperLimit=rad, LowerLimit=rad_2, Strength=1)

# ----
boundary = BoundarySurfaces(Edges=base_space_curve.base)
dim = Dimensions(Surface=boundary)  # -> UDimension, VDimension
integer_division = IntegerDivision(A=dim.UDimension, B=resolution_grid)
integer_division_2 = IntegerDivision(A=dim.UDimension, B=resolution_grid)
mesh_uv = MeshSurface(Surface=boundary, UCount=integer_division, VCount=integer_division_2, Overhang=True, Equalize=False)
onmesh = OnMesh(Points=base_space_curve.crvpts, Mesh=mesh_uv, Strength=Slider(100, range=0..100000))
merge = Merge(Data1=onmesh, Data2=length_line, Data3=collider, Data4=clampangle)  # -> flatten(Result)

bouncysolver = BouncySolver(
    GoalObjects=flatten(merge),
    Reset=Button(),
    Threshold=1e-15,
    Tolerance=0.0001,
    Damping=Slider(0.084, range=0..1),
    Iterations=10,
    On=Toggle(False))  # -> I, V, O
pt_internalised_from_bouncy_solver = Point([Point(298.3508048, 297, 0), Point(306.6243175, 314.1942612, 0), Point(324.7790851, 321.712578, 0), Point(344.3447677, 324.0414068, 0), Point(363.6687414, 325.9000374, 0), Point(381.5281418, 333.3765712, 0)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])

restricted_height = Panel("700")  # disabled
list = ValueList({"Config 1": 0, "Config 2": 1, "Config 3": 2}, selected="Config 1")  # disabled

# ---- group: Brick Dimensions
number_slider_2 = Slider(32, range=0..100)  # disabled
number_slider_3 = Slider(15.2, range=0..100)  # disabled
number_slider_4 = Slider(9.85, range=0..100)  # disabled

# ----
brick_configurator = Python3Script(h_max=restricted_height, orientation=list, brick_l=number_slider_2, brick_w=number_slider_3, brick_h=number_slider_4)  # -> out, no_layers, samplebrick, new_l, new_w, new_h; inputs h_max: Double, orientation: Int32; disabled
# ---------- brick_configurator: Python ----------
from compas_rhino.devtools import DevTools
DevTools.ensure_path()
DevTools.enable_reloader()

from brick_wall import Brick

samplebrick = Brick()
samplebrick.configuration(orientation)
new_l = samplebrick.length
new_w = samplebrick.width
new_h = samplebrick.height
no_layers = h_max//new_h
print(f"Length:{new_l}; Height:{new_h}; Width:{new_w}")
# ---------- end brick_configurator ----------
dam = DataDam(DataA=pt_internalised_from_bouncy_solver, BufferDelay=10000000, BufferMode=0)
number_slider_5 = Slider(50, range=0..100)  # disabled
number_slider_6 = Slider(1, range=0..10)  # disabled
number_slider_7 = Slider(10, range=0..100)  # disabled
brick_paths = Python3Script(
    pts=dam,
    work_pt=base_space_curve.dwg_midpt,
    no_layers=brick_configurator.no_layers,
    freq=number_slider_6,
    deg=number_slider_7,
    orientation=list)  # -> out, pts, t_v, profile, tree_pts, line_prof, profiles; inputs pts: list of Point3d, work_pt: Point3d, no_layers: Int32, freq: Int32, deg: Int32, orientation: Int32; disabled
# ---------- brick_paths: Python ----------
from compas_rhino.devtools import DevTools
DevTools.ensure_path()
DevTools.enable_reloader()

# 0. Import everything we will need
import math as m
import ghpythonlib.treehelpers as th
from compas_rhino.conversions import point_to_compas
from compas_rhino.geometry import RhinoNurbsCurve
from compas.geometry import Translation
from compas.geometry import Vector, Line
from compas.geometry import Frame
from brick_wall import Brick

# 0. Provide contextual definitions and set up essential variables
def remap(t, omin, omax, nmin, nmax):
    return (t-omin)/(omax-omin)*(nmax-nmin)+nmin

workspace_pt = point_to_compas(work_pt)

pts = [point_to_compas(pt) for pt in pts]
profile = RhinoNurbsCurve.from_points(pts, degree=deg, is_periodic=True)
result = [profile.closest_point(p, True) for p in pts]
cp, ct = list(zip(*result))
samplebrick = Brick()
samplebrick.configuration(orientation)

# 1. Setting up the main variables 
# a) Identify how far each point on curve is from the centre 
d_v = [Vector.from_start_end(p, workspace_pt) for p in cp]
for ddv in d_v:
    ddv.unitize()
# b) Generate essential tangent/normal vectors
t_v = [profile.tangent_at(t) for t in ct]
n_v = Vector.cross_vectors([Vector.Zaxis() for t in ct], t_v)
for n in n_v:
    n.unitize()
# c) Map vector values to possible offsets in subsequent curves
c_v = Vector.cross_vectors(t_v, d_v)
m_v = [mg.length for mg in c_v]
mg_v = [remap(m, min(m_v), max(m_v), 1, samplebrick.width) for m in m_v]
# d) Assign signs to the remapped values
s_v = [c.z / abs(c.z) if c.z != 0 else 1.0 for c in c_v]
amp_v = [s*m for (s,m) in zip(s_v,mg_v)]

# 2. Generating points per layer
# a) Establishing empty list to add point lists into
tree_pts = []
# tree_lines = []
for r in range(no_layers):
    # b1) Create copies of point list per layer
    copypts = [p.copy() for p in cp]
    # b2) Establish formula for calculating sinusoidal angle
    theta = r/(no_layers-1)*2*m.pi
    # b3) Assign force magnitude moving point dependent on position to centre and its index
    f_v = [amp*m.sin(freq*theta+(a)) for a, amp in enumerate(amp_v)]
    # b4) Apply force magnitude on unit normal vector assigned to each point
    m_v = [n*fv for (n,fv) in zip(n_v, f_v)]
    # b5) Translate each point by that force vector
    transf = [Translation.from_vector(v) for v in m_v]
    # b6) Translate each point by the height they belong to (change out list members)
    for p, pp in enumerate(copypts):
        pp.transform(transf[p])
        pp.z = r*samplebrick.height
    # sub_lines = [Line(copypts[ip%len(copypts)], copypts[(ip+1)%len(copypts)]) for ip, p in enumerate(copypts)]       
    # b7) Add new point list to tree_pts
    tree_pts.append(copypts)
    # tree_lines.append(sub_lines)

# 3. Creation of Curves
profiles = [RhinoNurbsCurve.from_points(p, degree=deg, is_periodic=True) for p in tree_pts]
profiles = th.list_to_tree(profiles)
# line_prof = th.list_to_tree(tree_lines)
tree_pts = th.list_to_tree(tree_pts)
# ---------- end brick_paths ----------
draw = COMPASDraw(cg=brick_paths.profiles)  # -> rg; disabled
#   port cg: The COMPAS geometry or datastructure to be drawn.
#   port rg: The Rhino geometry object.
# ---------- draw: Python ----------
# r: compas>=2.14.1
"""
Draws COMPAS geometry in Grasshopper.
"""

from typing import Any

import Grasshopper

from compas.scene import SceneObject


class CompasToRhinoGeometry(Grasshopper.Kernel.GH_ScriptInstance):
    def RunScript(self, cg):
        if not cg:
            return None

        return SceneObject(item=cg).draw()
# ---------- end draw ----------
crv_2 = Curve(reparameterize(draw))  # disabled

lng = ListLength(List=draw)  # disabled
range = Range(Domain=Domain(0, 1), Steps=expr("x-1", lng))  # disabled
graph = GraphMapper(
    range,
    x0=0,
    x1=1,
    y0=0,
    y1=1,
    container_name="Bezier",
    cpx=[0, 0.2521742582, 0.5108695626, 1],
    cpy=[0.2072464228, 0.4043477178, 0.09329712391, 0.07481873035])  # disabled
number_slider_8 = Slider(0.75, range=0..1)  # disabled
xy = XYPlane(Origin=base_space_curve.dwg_midpt)  # disabled
bnd = Bounds(Numbers=graph)  # disabled
dom = ConstructDomain(DomainStart=number_slider_8, DomainEnd=1)  # disabled
remap = RemapNumbers(Value=graph, Source=bnd, Target=dom)  # -> Mapped, Clipped; disabled
scale_nu = ScaleNU(Geometry=crv_2, Plane=xy, ScaleX=remap.Mapped, ScaleY=remap.Mapped, ScaleZ=1)  # -> Geometry, Transform; disabled

crv_3 = Curve(reparameterize(scale_nu.Geometry))  # disabled
number_slider_9 = Slider(30, range=0..100)  # disabled
gap = Slider(5, range=0..10)  # disabled
number_slider_10 = Slider(10, range=0..10)  # disabled
number_slider_11 = Slider(250, range=0..1000)  # disabled
number_slider_12 = Slider(20, range=0..100)  # disabled
toggle = BooleanToggle(True)  # disabled
toggle_2 = BooleanToggle(True)  # disabled
number_slider_13 = Slider(0.618, range=0..1)  # disabled
brick_wall = Python3Script(
    crv=crv_3,
    orientation=list,
    max_ang=number_slider_9,
    gap=gap,
    mid_pt=base_space_curve.dwg_midpt,
    resolution=number_slider_10,
    march_res=number_slider_11,
    sampling=number_slider_12,
    spread=toggle,
    fill=toggle_2,
    fract=number_slider_13)  # -> out, frames, samplebrick, seam_pts, seam_info, timing; inputs crv: list of Curve, max_ang: Double, gap: Double, mid_pt: Point3d, resolution: Int32, sampling: Int32, spread: Boolean, fract: Double; disabled
# ---------- brick_wall: Python ----------
# r: compas
# venv: mas-2627
from compas_rhino.devtools import DevTools
DevTools.ensure_path()
DevTools.enable_reloader()

# 0. Import everything we will need
import math as m
from compas_rhino.conversions import point_to_compas,curve_to_compas
import ghpythonlib.treehelpers as th
from compas.geometry import Polygon
from compas.geometry import Point, Vector
from compas.geometry import Frame
from brick_wall import Brick

# 1. Provide contextual definitions and set up essential variables
def remap(t, omin, omax, nmin, nmax):
    return (t-omin)/(omax-omin)*(nmax-nmin)+nmin

def frame_at(r, t):
    # Essential parts to construct a frame
    target_pt = r.point_at(t)
    tangent_v = r.tangent_at(t)
    direct_v = mid_pt - target_pt
    direct_v.z = 0.0  # Assumption that there is no Z scaling
    direct_v.unitize()

    mag = Vector.cross(tangent_v, direct_v).z
    rot_mag = m.copysign(remap(1 - abs(mag), 0.0, 1.0, 0.0, m.radians(max_ang)), mag)
    # rot_mag will take on the sign of mag

    c, s = m.cos(rot_mag), m.sin(rot_mag)
    x_v = Vector(c * tangent_v.x - s * tangent_v.y, s * tangent_v.x + c * tangent_v.y, 0.0)
    frame_v = Frame(target_pt, x_v, Vector.cross(Vector.Zaxis(), x_v))
    # rather than create a frame and rotate it
    # find the rotated x axis first (x_v), then create the frame
    # reduces the script weight
    
    return frame_v, rot_mag

def blocked(frame_v, list_frames, sx, sy):
    reach = (sx * sx + sy * sy) ** 0.5 
    # pythagoras calculation of diagonal of footprint    
    p = frame_v.point
    return any(Brick.clash(k, frame_v, sx, sy) for k in reversed(list_frames) if k.point.distance_to_point(p) < reach)
    # any function ensures that the moment a clash is found, the search stops
    # list_frames is reversed so that we check the most recently placed brick
    # it only checks if frame is within distance of any frames within the current frame list

fill_angles = [0.0] + [m.radians(a) * sg for a in range(5, 95, 5) for sg in (1, -1)]
# sg accounts for sign to ensure that the brick could also be rotated in the opposite direction
# angle values are filled to 90 since a brick looks the same after a full rotation

def turned(frame_v, thet):
    c, s = m.cos(thet), m.sin(thet)
    x = frame_v.xaxis
    x_v = Vector(c*x.x - s*x.y, s*x.x + c*x.y, 0.0)
    # calculates rotated x-axis first instead of creating a frame and rotating
    return Frame(frame_v.point, x_v, Vector.cross(Vector.Zaxis(), x_v))

def fill_gaps(r, t_start, course, sx, sy, min_gap, samples = 40):
    # samples ensures that there are sufficient spots sample to ensure that
    # narrow curved positions are not skipped
    # r: curve
    # t_start: starting parameter
    # course: collection of list of parameters, rotations and frames
    # sx/sy: change in x/y dimension (associated with brick length and widt)
    # min_gap: minimum gap between 
    # samples: number of samples between 
    sub_t, sub_rot, sub_frm = course # course comes from a place_course output
    n = len(sub_frm) # counts number of frames present on the curve
    t_un = [t_start + ((t - t_start) % 1.0) for t in sub_t] # range of parameters to comb through
    kept = list(sub_frm) # list of frames
    
    new = []
    # initiate empty list to 

    for i in range(n):
        j = (i + 1) % n # gap after brick i
        if Brick.slack(sub_frm[i], sub_frm[j], sx, sy) < min_gap:
            continue 
            # skip since the free space between bricks is too small for min_gap threshold
        
        a = t_un[i]
        # starting parameter where brick is located
        b = t_un[j] if j else t_un[0] + 1.0
        # if j is the same as if j != 0 since 0 is read as false
        cands = [a + (b - a) * k / samples for k in range(1, samples)]
        # number of possible parameter candidates to comb through using samples
        
        for th in fill_angles:
        # combing all possible angles to try
            clear = [tt for tt in cands if not blocked(turned(frame_at(r, tt % 1.0)[0], th), kept, sx, sy)]
            # identifying all parameters that are not blocked by bricks
            if clear:
                tt = clear[len(clear) // 2]
                # take the middle positioned parameter
                f, rot = frame_at(r, tt % 1.0)
                # returns frame and rotation at tt
                f = turned(f, th)
                # returns rotated frame
                kept.append(f)
                new.append((i, tt % 1.0, rot + th, f))
                break
    for i, tt, rot, f in reversed(new):           
        sub_t.insert(i + 1, tt)
        # addes new parameters inside the parameter list
        sub_rot.insert(i + 1, rot)
        # addes new rotations inside the rotations list
        sub_frm.insert(i + 1, f)
        # addes new frames inside the frames list
    return len(new)

def place_course(r, t_start, sx, sy):
    sub_t, sub_rot, sub_frm = ([] for i in range(3))
    # initiate empty lists to add parameters, rotations and frames into
    t = t_start # parameter of brick currently placed
    frame_v, rot_mag = frame_at(r, t % 1.0)
    # we set parameter as t % 1.0 to ensure it is within domain cap
    while True:
        sub_t.append(t % 1.0)
        sub_rot.append(rot_mag)
        sub_frm.append(frame_v)
        # add all the current variables in respective lists

        t_lo, t_hi = t, t
        while t_hi < t_start + 1.0: 
        # ensure loop runs between t_start and t_start + 1.0
            t_lo, t_hi = t_hi, min(t_hi + march_res**(-1), t_start + 1.0)
            # t_hi is set such that it will march all the way to the end
            if not blocked(frame_at(r, t_hi % 1.0)[0], sub_frm, sx, sy):
            # given that a brick is considered unobstructed/unobstructing
                break
        else:
            break

        for _ in range(sampling):
            t_mid = 0.5 * (t_lo + t_hi)
            if blocked(frame_at(r, t_mid % 1.0)[0], sub_frm, sx, sy):
                t_lo = t_mid
            else:
                t_hi = t_mid

        t = t_hi
        frame_v, rot_mag = frame_at(r, t % 1.0)
        
    return sub_t, sub_rot, sub_frm
    # note the position of the output
    # place_course[0] = parameter list
    # place_course[1] = rotation list
    # place_course[2] = frame list

crv = [curve_to_compas(c) for c in crv]

mid_pt = point_to_compas(mid_pt)
frames = []

# 2. Initiating brick configurations and critical sizes
samplebrick = Brick()
samplebrick.configuration(orientation)
size_x = samplebrick.length + gap
size_y = samplebrick.width + gap

def seam_gap(course_frames):
    return Brick.slack(course_frames[-1], course_frames[0], size_x, size_y)
    # measures what the forgivable distance is between bricks in a given set of frames

seam_tol = 0.5
spread_steps = 6
param_list, rot_list, gap_list, fill_list, seam_pts, seam_info = ([] for i in range(6))

import time
timing = []

for ci, r in enumerate(crv):
    
    t_start = (ci * fract) % 1.0 + (ci % resolution) / resolution * (size_x / r.length())
    # ci * fract moves each course's start and seam based on percentage fract

    # 1. walk with the base gap
    t0 = time.perf_counter()
    best = place_course(r, t_start, size_x, size_y)
    # returns the list of parameters, rotations and frames

    t_base = time.perf_counter() - t0
    best_gap = gap
    n0 = len(best[2])
    # n0 returns the list of frames
    best_seam = seam_gap(best[2]) if n0 > 2 else 0.0
    seam_before = best_seam

    # 2. spread the seam remainder: widen this course's gap while it still fits n0 bricks
    trial_times = []
    if spread and n0 > 2 and best_seam > seam_tol:
        # given that the spread function is enabled
        # that there are more than 2 planes in a curve
        # and that the current seam gap is larger than the given seam tolerance

        lo, hi = gap, gap + 2.0 * best_seam / n0
        # lo = normal gap, hi = largest possible gap that a brick cannot fit
        for _ in range(spread_steps):
            g = 0.5 * (lo + hi) # average gap between lo and hi
            t0 = time.perf_counter()
            trial = place_course(
                r, 
                t_start, 
                samplebrick.length + g, 
                samplebrick.width + g
                )
            trial_times.append(time.perf_counter() - t0)


            if len(trial[2]) >= n0:
                lo = g
                s = seam_gap(trial[2])
                if 0.0 <= s < best_seam:           
                    best, best_gap, best_seam = trial, g, s
            else:
                hi = g

    timing.append("course {}: {} bricks | base walk {:.2f}s | {} trial walks {:.2f}s (slowest {:.2f}s) | seam {:.1f} -> {:.1f} mm | gap {:.2f}".format(
        ci, n0, t_base, len(trial_times), sum(trial_times), max(trial_times) if trial_times else 0.0, seam_before, best_seam, best_gap))
        # ci: course number
        # n0: number of frames
        # trial_times = list of trial timings
        # seam_before = 
        # best_seam
        # best_gap

    n_fill = 0
    if fill:
    # if the fill boolean is toggled as true, will enable function to fill gaps
        n_fill = fill_gaps(
            r, 
            t_start, 
            best, 
            samplebrick.length + best_gap, 
            samplebrick.width + best_gap,
            min_gap=min(samplebrick.length, samplebrick.width, samplebrick.height) + best_gap
            )
            # min_gap written to ensure it works for all configurations
    fill_list.append(n_fill)
    f_last, f_first = best[2][-1], best[2][0]

    # identifying the first and last frames from the frame list
    sx_ = 0.5 * (f_last.point.x + f_first.point.x)
    sy_ = 0.5 * (f_last.point.y + f_first.point.y)
    sz_ = 0.5 * (f_last.point.z + f_first.point.z)
    seam_pts.append(Point(sx_, sy_, sz_))

    # calculating the exact position of the seam
    seam_info.append("course {}: seam at ({:.1f}, {:.1f}, {:.1f}) | {:.0f} deg around mid_pt | free space {:.1f} mm".format(
    ci, sx_, sy_, sz_, m.degrees(m.atan2(sy_ - mid_pt.y, sx_ - mid_pt.x)), Brick.slack(f_last, f_first, size_x, size_y)))

    param_list.append(best[0])
    rot_list.append(best[1])
    frames.append(best[2])
    # append variables to their respective matching lists (see course positions for reference)

    gap_list.append(best_gap)

param_list = th.list_to_tree(param_list)
rot_list = th.list_to_tree(rot_list)
frames = th.list_to_tree(frames)
fills = th.list_to_tree(fill_list)
# ---------- end brick_wall ----------
check_script = Python3Script(crv=crv_3)  # -> out, report; inputs crv: list; disabled
# ---------- check_script: Python ----------
# r: compas
# venv: mas-2627
# Inputs : crv (List Access, no type hint) = the same course curves that go into Brick wall
# Outputs: out
import math as m
from compas_rhino.conversions import curve_to_compas, point_to_compas

report = []
for i, rc in enumerate(crv):
    c = curve_to_compas(rc)
    nc = c.native_curve
    d0, d1 = nc.Domain.T0, nc.Domain.T1
    report.append("--- course {} ---".format(i))

    # 1. r.length()
    report.append("compas domain: {} | Rhino domain: {:.4f} .. {:.4f}".format(c.domain, d0, d1))
    try:
        report.append("c.length() = {:.3f} | nc.GetLength() = {:.3f}".format(c.length(), nc.GetLength()))
    except Exception as e:
        report.append("c.length() FAILED ({!r}) -> use nc.GetLength() instead".format(e))

    # 2. is point_at(t) normalised (0..1) or the raw Rhino parameter?
    p = c.point_at(0.5)
    is_norm = p.distance_to_point(point_to_compas(nc.PointAt(d0 + 0.5 * (d1 - d0)))) < 1e-6
    is_raw = p.distance_to_point(point_to_compas(nc.PointAt(0.5))) < 1e-6
    if is_norm and is_raw:
        report.append("point_at(t): Rhino domain is already 0..1, both readings agree (OK)")
    elif is_norm:
        report.append("point_at(t): t is NORMALISED 0..1 (OK, as the script assumes)")
    elif is_raw:
        report.append("point_at(t): t is the RAW Rhino parameter -> the script's t in [0,1] is wrong for this curve")
    else:
        report.append("point_at(t): neither reading matches - stop and inspect")

    # 3. does the course wrap cleanly at the seam?
    report.append("closed: {} | periodic: {}".format(nc.IsClosed, nc.IsPeriodic))
    report.append("gap between point_at(0) and point_at(1): {:.6f} mm".format(
        c.point_at(0.0).distance_to_point(c.point_at(1.0))))
    report.append("tangent angle between t=0 and t=1: {:.4f} deg".format(
        m.degrees(c.tangent_at(0.0).angle(c.tangent_at(1.0)))))
    e = 1e-4
    report.append("chord across seam {:.4f} mm vs chord at t=0.5 {:.4f} mm".format(
        c.point_at(1.0 - e).distance_to_point(c.point_at(e)),
        c.point_at(0.5 - e).distance_to_point(c.point_at(0.5 + e))))
# ---------- end check_script ----------
draw_2 = COMPASDraw(cg=brick_wall.seam_pts)  # -> rg; disabled; same code as draw
brick_drawing = Python3Script(frames=brick_wall.frames, samplebrick=brick_configurator.samplebrick)  # -> out, draw_bricks; inputs frames: tree; disabled
# ---------- brick_drawing: Python ----------
# r: compas
# venv: mas-2627
from compas_rhino.devtools import DevTools
DevTools.ensure_path()

# 0. Import everything we will need
import math as m
from compas_rhino.conversions import point_to_compas,curve_to_compas
import ghpythonlib.treehelpers as th
from compas.geometry import Polygon
from compas.geometry import Point, Vector
from compas.geometry import Frame

from brick_wall import Brick

frames = th.tree_to_list(frames)

bricks = []
for sel_f in frames:
    sub_bricks = []
    for sel_b in sel_f:
        b = Brick(sel_b)
        b.configuration(samplebrick.get_config())
        sub_bricks.append(b)
    bricks.append(sub_bricks)

draw_bricks = [[brick.draw() for brick in sb] for sb in bricks]
draw_bricks = th.list_to_tree(draw_bricks)
# ---------- end brick_drawing ----------
report = Python3Script(frames=brick_wall.frames, samplebrick=brick_configurator.samplebrick, gap=gap)  # -> out, report; inputs frames: tree, gap: Double; disabled
# ---------- report: Python ----------
# r: compas
# venv: mas-2627
from compas_rhino.devtools import DevTools
DevTools.ensure_path()
DevTools.enable_reloader()

import ghpythonlib.treehelpers as th
from brick_wall import Brick

frames = th.tree_to_list(frames)
size_x = samplebrick.length + gap
size_y = samplebrick.width + gap

def slack(f1, f2):
    """Centre distance minus the exact touching distance along the chord (0 = touching)."""
    d = f2.point - f1.point
    u = d.unitized()
    best = None
    for ax in (f1.xaxis, f1.yaxis, f2.xaxis, f2.yaxis):
        c = abs(u.dot(ax))
        if c > 1e-9:
            reach = sum(size_x/2 * abs(ax.dot(f.xaxis)) + size_y/2 * abs(ax.dot(f.yaxis)) for f in (f1, f2))
            best = reach / c if best is None else min(best, reach / c)
    return d.length - best

report = []
for i, c in enumerate(frames):
    n = len(c)
    clashes = sum(Brick.clash(c[a], c[b], size_x, size_y) for a in range(n) for b in range(a + 1, n))
    gaps = [slack(c[a], c[(a + 1) % n]) for a in range(n)]      # last entry = seam (last -> first)
    report.append("course {}: {} bricks | clashing pairs {} | mean gap {:.2f} | worst gap {:.2f} | seam gap {:.2f}".format(
        i, n, clashes, sum(gaps[:-1]) / (n - 1), max(gaps[:-1]), gaps[-1]))
# ---------- end report ----------
draw_3 = COMPASDraw(cg=brick_drawing.draw_bricks)  # -> rg; disabled; same code as draw
curve_report = Panel(check_script.report)  # disabled
walking_report = Panel(brick_wall.timing)  # disabled
clash_and_gap_report = Panel(report.report)  # disabled
draw_4 = COMPASDraw(cg=Tree({0;0}: ["Grasshopper.Kernel.Types.GH_ObjectWrapper", "Grasshopper.Kernel.Types.GH_ObjectWrapper", "Grasshopper.Kernel.Types.GH_ObjectWrapper", "Grasshopper.Kernel.Types.GH_ObjectWrapper", "Grasshopper.Kernel.Types.GH_ObjectWrapper", "Grasshopper.Kernel.Types.GH_ObjectWrapper", "Grasshopper.Kernel.Types.GH_ObjectWrapper", "Grasshopper.Kernel.Types.GH_ObjectWrapper", "Grasshopper.Kernel.Types.GH_ObjectWrapper", "Grasshopper.Kernel.Types.GH_ObjectWrapper", "Grasshopper.Kernel.Types.GH_ObjectWrapper", "Grasshopper.Kernel.Types.GH_ObjectWrapper", "Grasshopper.Kernel.Types.GH_ObjectWrapper", "Grasshopper.Kernel.Types.GH_ObjectWrapper", "Grasshopper.Kernel.Types.GH_ObjectWrapper", "Grasshopper.Kernel.Types.GH_ObjectWrapper", "Grasshopper.Kernel.Types.GH_ObjectWrapper", "Grasshopper.Kernel.Types.GH_ObjectWrapper", "Grasshopper.Kernel.Types.GH_ObjectWrapper", "Grasshopper.Kernel.Types.GH_ObjectWrapper", "Grasshopper.Kernel.Types.GH_ObjectWrapper", "Grasshopper.Kernel.Types.GH_ObjectWrapper", "Grasshopper.Kernel.Types.GH_ObjectWrapper", "Grasshopper.Kernel.Types.GH_ObjectWrapper", "Grasshopper.Kernel.Types.GH_ObjectWrapper", "Grasshopper.Kernel.Types.GH_ObjectWrapper", "Grasshopper.Kernel.Types.GH_ObjectWrapper", "Grasshopper.Kernel.Types.GH_ObjectWrapper", "Grasshopper.Kernel.Types.GH_ObjectWrapper", "Grasshopper.Kernel.Types.GH_ObjectWrapper", "Grasshopper.Kernel.Types.GH_ObjectWrapper", "Grasshopper.Kernel.Types.GH_ObjectWrapper", "Grasshopper.Kernel.Types.GH_ObjectWrapper", "Grasshopper.Kernel.Types.GH_ObjectWrapper", "Grasshopper.Kernel.Types.GH_ObjectWrapper", "Grasshopper.Kernel.Types.GH_ObjectWrapper", "Grasshopper.Kernel.Types.GH_ObjectWrapper", "Grasshopper.Kernel.Types.GH_ObjectWrapper", "Grasshopper.Kernel.Types.GH_ObjectWrapper", "Grasshopper.Kernel.Types.GH_ObjectWrapper", "Grasshopper.Kernel.Types.GH_ObjectWrapper", "Grasshopper.Kernel.Types.GH_ObjectWrapper", "Grasshopper.Kernel.Types.GH_ObjectWrapper", "Grasshopper.Kernel.Types.GH_ObjectWrapper", "Grasshopper.Kernel.Types.GH_ObjectWrapper", "Grasshopper.Kernel.Types.GH_ObjectWrapper", "Grasshopper.Kernel.Types.GH_ObjectWrapper", "Grasshopper.Kernel.Types.GH_ObjectWrapper", "Grasshopper.Kernel.Types.GH_ObjectWrapper", "Grasshopper.Kernel.Types.GH_ObjectWrapper", "Grasshopper.Kernel.Types.GH_ObjectWrapper", "Grasshopper.Kernel.Types.GH_ObjectWrapper", "Grasshopper.Kernel.Types.GH_ObjectWrapper"], {0;1}: ["Grasshopper.Kernel.Types.GH_ObjectWrapper", "Grasshopper.Kernel.Types.GH_ObjectWrapper", "Grasshopper.Kernel.Types.GH_ObjectWrapper", "Grasshopper.Kernel.Types.GH_ObjectWrapper", "Grasshopper.Kernel.Types.GH_ObjectWrapper", "Grasshopper.Kernel.Types.GH_ObjectWrapper", "Grasshopper.Kernel.Types.GH_ObjectWrapper", "Grasshopper.Kernel.Types.GH_ObjectWrapper", "Grasshopper.Kernel.Types.GH_ObjectWrapper", "Grasshopper.Kernel.Types.GH_ObjectWrapper", "Grasshopper.Kernel.Types.GH_ObjectWrapper", "Grasshopper.Kernel.Types.GH_ObjectWrapper", "Grasshopper.Kernel.Types.GH_ObjectWrapper", "Grasshopper.Kernel.Types.GH_ObjectWrapper", "Grasshopper.Kernel.Types.GH_ObjectWrapper", "Grasshopper.Kernel.Types.GH_ObjectWrapper", "Grasshopper.Kernel.Types.GH_ObjectWrapper", "Grasshopper.Kernel.Types.GH_ObjectWrapper", "Grasshopper.Kernel.Types.GH_ObjectWrapper", "Grasshopper.Kernel.Types.GH_ObjectWrapper", "Grasshopper.Kernel.Types.GH_ObjectWrapper", "Grasshopper.Kernel.Types.GH_ObjectWrapper", "Grasshopper.Kernel.Types.GH_ObjectWrapper", "Grasshopper.Kernel.Types.GH_ObjectWrapper", "Grasshopper.Kernel.Types.GH_ObjectWrapper", "Grasshopper.Kernel.Types.GH_ObjectWrapper", "Grasshopper.Kernel.Types.GH_ObjectWrapper", "Grasshopper.Kernel.Types.GH_ObjectWrapper", "Grasshopper.Kernel.Types.GH_ObjectWrapper", "Grasshopper.Kernel.Types.GH_ObjectWrapper", "Grasshopper.Kernel.Types.GH_ObjectWrapper", "Grasshopper.Kernel.Types.GH_ObjectWrapper", "Grasshopper.Kernel.Types.GH_ObjectWrapper", "Grasshopper.Kernel.Types.GH_ObjectWrapper", "Grasshopper.Kernel.Types.GH_ObjectWrapper", "Grasshopper.Kernel.Types.GH_ObjectWrapper", "Grasshopper.Kernel.Types.GH_ObjectWrapper", "Grasshopper.Kernel.Types.GH_ObjectWrapper", "Grasshopper.Kernel.Types.GH_ObjectWrapper", "Grasshopper.Kernel.Types.GH_ObjectWrapper", "Grasshopper.Kernel.Types.GH_ObjectWrapper", "Grasshopper.Kernel.Types.GH_ObjectWrapper", "Grasshopper.Kernel.Types.GH_ObjectWrapper", "Grasshopper.Kernel.Types.GH_ObjectWrapper", "Grasshopper.Kernel.Types.GH_ObjectWrapper", "Grasshopper.Kernel.Types.GH_ObjectWrapper", "Grasshopper.Kernel.Types.GH_ObjectWrapper", "Grasshopper.Kernel.Types.GH_ObjectWrapper", "Grasshopper.Kernel.Types.GH_ObjectWrapper", "Grasshopper.Kernel.Types.GH_ObjectWrapper", "Grasshopper.Kernel.Types.GH_ObjectWrapper", "Grasshopper.Kernel.Types.GH_ObjectWrapper", "Grasshopper.Kernel.Types.GH_ObjectWrapper", "Grasshopper.Kernel.Types.GH_ObjectWrapper", "Grasshopper.Kernel.Types.GH_ObjectWrapper"], {0;2}: ["Grasshopper.Kernel.Types.GH_ObjectWrapper", "Grasshopper.Kernel.Types.GH_ObjectWrapper", "Grasshopper.Kernel.Types.GH_ObjectWrapper", "Grasshopper.Kernel.Types.GH_ObjectWrapper", "Grasshopper.Kernel.Types.GH_ObjectWrapper", "Grasshopper.Kernel.Types.GH_ObjectWrapper", "Grasshopper.Kernel.Types.GH_ObjectWrapper", "Grasshopper.Kernel.Types.GH_ObjectWrapper", "Grasshopper.Kernel.Types.GH_ObjectWrapper", "Grasshopper.Kernel.Types.GH_ObjectWrapper", "Grasshopper.Kernel.Types.GH_ObjectWrapper", "Grasshopper.Kernel.Types.GH_ObjectWrapper", "Grasshopper.Kernel.Types.GH_ObjectWrapper", "Grasshopper.Kernel.Types.GH_ObjectWrapper", "Grasshopper.Kernel.Types.GH_ObjectWrapper", "Grasshopper.Kernel.Types.GH_ObjectWrapper", "Grasshopper.Kernel.Types.GH_ObjectWrapper", "Grasshopper.Kernel.Types.GH_ObjectWrapper", "Grasshopper.Kernel.Types.GH_ObjectWrapper", "Grasshopper.Kernel.Types.GH_ObjectWrapper", "Grasshopper.Kernel.Types.GH_ObjectWrapper", "Grasshopper.Kernel.Types.GH_ObjectWrapper", "Grasshopper.Kernel.Types.GH_ObjectWrapper", "Grasshopper.Kernel.Types.GH_ObjectWrapper", "Grasshopper.Kernel.Types.GH_ObjectWrapper", "Grasshopper.Kernel.Types.GH_ObjectWrapper", "Grasshopper.Kernel.Types.GH_ObjectWrapper", "Grasshopper.Kernel.Types.GH_ObjectWrapper", "Grasshopper.Kernel.Types.GH_ObjectWrapper", "Grasshopper.Kernel.Types.GH_ObjectWrapper", "Grasshopper.Kernel.Types.GH_ObjectWrapper", "Grasshopper.Kernel.Types.GH_ObjectWrapper", "Grasshopper.Kernel.Types.GH_ObjectWrapper", "Grasshopper.Kernel.Types.GH_ObjectWrapper", "Grasshopper.Kernel.Types.GH_ObjectWrapper", "Grasshopper.Kernel.Types.GH_ObjectWrapper", "Grasshopper.Kernel.Types.GH_ObjectWrapper", "Grasshopper.Kernel.Types.GH_ObjectWrapper", "Grasshopper.Kernel.Types.GH_ObjectWrapper", "Grasshopper.Kernel.Types.GH_ObjectWrapper", "Grasshopper.Kernel.Types.GH_ObjectWrapper", "Grasshopper.Kernel.Types.GH_ObjectWrapper", "Grasshopper.Kernel.Types.GH_ObjectWrapper", "Grasshopper.Kernel.Types.GH_ObjectWrapper", "Grasshopper.Kernel.Types.GH_ObjectWrapper", "Grasshopper.Kernel.Types.GH_ObjectWrapper", "Grasshopper.Kernel.Types.GH_ObjectWrapper", "Grasshopper.Kernel.Types.GH_ObjectWrapper", "Grasshopper.Kernel.Types.GH_ObjectWrapper", "Grasshopper.Kernel.Types.GH_ObjectWrapper", "Grasshopper.Kernel.Types.GH_ObjectWrapper", "Grasshopper.Kernel.Types.GH_ObjectWrapper", "Grasshopper.Kernel.Types.GH_ObjectWrapper", "Grasshopper.Kernel.Types.GH_ObjectWrapper", "Grasshopper.Kernel.Types.GH_ObjectWrapper"], {0;3}: ["Grasshopper.Kernel.Types.GH_ObjectWrapper", "Grasshopper.Kernel.Types.GH_ObjectWrapper", "Grasshopper.Kernel.Types.GH_ObjectWrapper", "Grasshopper.Kernel.Types.GH_ObjectWrapper", "Grasshopper.Kernel.Types.GH_ObjectWrapper", "Grasshopper.Kernel.Types.GH_ObjectWrapper", "Grasshopper.Kernel.Types.GH_ObjectWrapper", "Grasshopper.Kernel.Types.GH_ObjectWrapper", "Grasshopper.Kernel.Types.GH_ObjectWrapper", "Grasshopper.Kernel.Types.GH_ObjectWrapper", "Grasshopper.Kernel.Types.GH_ObjectWrapper", "Grasshopper.Kernel.Types.GH_ObjectWrapper", "Grasshopper.Kernel.Types.GH_ObjectWrapper", "Grasshopper.Kernel.Types.GH_ObjectWrapper", "Grasshopper.Kernel.Types.GH_ObjectWrapper", "Grasshopper.Kernel.Types.GH_ObjectWrapper", "Grasshopper.Kernel.Types.GH_ObjectWrapper", "Grasshopper.Kernel.Types.GH_ObjectWrapper", "Grasshopper.Kernel.Types.GH_ObjectWrapper", "Grasshopper.Kernel.Types.GH_ObjectWrapper", "Grasshopper.Kernel.Types.GH_ObjectWrapper", "Grasshopper.Kernel.Types.GH_ObjectWrapper", "Grasshopper.Kernel.Types.GH_ObjectWrapper", "Grasshopper.Kernel.Types.GH_ObjectWrapper", "Grasshopper.Kernel.Types.GH_ObjectWrapper", "Grasshopper.Kernel.Types.GH_ObjectWrapper", "Grasshopper.Kernel.Types.GH_ObjectWrapper", "Grasshopper.Kernel.Types.GH_ObjectWrapper", "Grasshopper.Kernel.Types.GH_ObjectWrapper", "Grasshopper.Kernel.Types.GH_ObjectWrapper", "Grasshopper.Kernel.Types.GH_ObjectWrapper", "Grasshopper.Kernel.Types.GH_ObjectWrapper", "Grasshopper.Kernel.Types.GH_ObjectWrapper", "Grasshopper.Kernel.Types.GH_ObjectWrapper", "Grasshopper.Kernel.Types.GH_ObjectWrapper", "Grasshopper.Kernel.Types.GH_ObjectWrapper", "Grasshopper.Kernel.Types.GH_ObjectWrapper", "Grasshopper.Kernel.Types.GH_ObjectWrapper", "Grasshopper.Kernel.Types.GH_ObjectWrapper", "Grasshopper.Kernel.Types.GH_ObjectWrapper", "Grasshopper.Kernel.Types.GH_ObjectWrapper", "Grasshopper.Kernel.Types.GH_ObjectWrapper", "Grasshopper.Kernel.Types.GH_ObjectWrapper", "Grasshopper.Kernel.Types.GH_ObjectWrapper", "Grasshopper.Kernel.Types.GH_ObjectWrapper", "Grasshopper.Kernel.Types.GH_ObjectWrapper", "Grasshopper.Kernel.Types.GH_ObjectWrapper", "Grasshopper.Kernel.Types.GH_ObjectWrapper", "Grasshopper.Kernel.Types.GH_ObjectWrapper", "Grasshopper.Kernel.Types.GH_ObjectWrapper", "Grasshopper.Kernel.Types.GH_ObjectWrapper", "Grasshopper.Kernel.Types.GH_ObjectWrapper", "Grasshopper.Kernel.Types.GH_ObjectWrapper", "Grasshopper.Kernel.Types.GH_ObjectWrapper", "Grasshopper.Kernel.Types.GH_ObjectWrapper", "Grasshopper.Kernel.Types.GH_ObjectWrapper"], {0;4}: ["Grasshopper.Kernel.Types.GH_ObjectWrapper", "Grasshopper.Kernel.Types.GH_ObjectWrapper", "Grasshopper.Kernel.Types.GH_ObjectWrapper", "Grasshopper.Kernel.Types.GH_ObjectWrapper", "Grasshopper.Kernel.Types.GH_ObjectWrapper", "Grasshopper.Kernel.Types.GH_ObjectWrapper", "Grasshopper.Kernel.Types.GH_ObjectWrapper", "Grasshopper.Kernel.Types.GH_ObjectWrapper", "Grasshopper.Kernel.Types.GH_ObjectWrapper", "Grasshopper.Kernel.Types.GH_ObjectWrapper", "Grasshopper.Kernel.Types.GH_ObjectWrapper", "Grasshopper.Kernel.Types.GH_ObjectWrapper", "Grasshopper.Kernel.Types.GH_ObjectWrapper", "Grasshopper.Kernel.Types.GH_ObjectWrapper", "Grasshopper.Kernel.Types.GH_ObjectWrapper", "Grasshopper.Kernel.Types.GH_ObjectWrapper", "Grasshopper.Kernel.Types.GH_ObjectWrapper", "Grasshopper.Kernel.Types.GH_ObjectWrapper", "Grasshopper.Kernel.Types.GH_ObjectWrapper", "Grasshopper.Kernel.Types.GH_ObjectWrapper", "Grasshopper.Kernel.Types.GH_ObjectWrapper", "Grasshopper.Kernel.Types.GH_ObjectWrapper", "Grasshopper.Kernel.Types.GH_ObjectWrapper", "Grasshopper.Kernel.Types.GH_ObjectWrapper", "Grasshopper.Kernel.Types.GH_ObjectWrapper", "Grasshopper.Kernel.Types.GH_ObjectWrapper", "Grasshopper.Kernel.Types.GH_ObjectWrapper", "Grasshopper.Kernel.Types.GH_ObjectWrapper", "Grasshopper.Kernel.Types.GH_ObjectWrapper", "Grasshopper.Kernel.Types.GH_ObjectWrapper", "Grasshopper.Kernel.Types.GH_ObjectWrapper", "Grasshopper.Kernel.Types.GH_ObjectWrapper", "Grasshopper.Kernel.Types.GH_ObjectWrapper", "Grasshopper.Kernel.Types.GH_ObjectWrapper", "Grasshopper.Kernel.Types.GH_ObjectWrapper", "Grasshopper.Kernel.Types.GH_ObjectWrapper", "Grasshopper.Kernel.Types.GH_ObjectWrapper", "Grasshopper.Kernel.Types.GH_ObjectWrapper", "Grasshopper.Kernel.Types.GH_ObjectWrapper", "Grasshopper.Kernel.Types.GH_ObjectWrapper", "Grasshopper.Kernel.Types.GH_ObjectWrapper", "Grasshopper.Kernel.Types.GH_ObjectWrapper", "Grasshopper.Kernel.Types.GH_ObjectWrapper", "Grasshopper.Kernel.Types.GH_ObjectWrapper", "Grasshopper.Kernel.Types.GH_ObjectWrapper", "Grasshopper.Kernel.Types.GH_ObjectWrapper", "Grasshopper.Kernel.Types.GH_ObjectWrapper", "Grasshopper.Kernel.Types.GH_ObjectWrapper", "Grasshopper.Kernel.Types.GH_ObjectWrapper", "Grasshopper.Kernel.Types.GH_ObjectWrapper", "Grasshopper.Kernel.Types.GH_ObjectWrapper", "Grasshopper.Kernel.Types.GH_ObjectWrapper", "Grasshopper.Kernel.Types.GH_ObjectWrapper", "Grasshopper.Kernel.Types.GH_ObjectWrapper", "Grasshopper.Kernel.Types.GH_ObjectWrapper", "Grasshopper.Kernel.Types.GH_ObjectWrapper", "Grasshopper.Kernel.Types.GH_ObjectWrapper"], {0;5}: ["Grasshopper.Kernel.Types.GH_ObjectWrapper", "Grasshopper.Kernel.Types.GH_ObjectWrapper", "Grasshopper.Kernel.Types.GH_ObjectWrapper", "Grasshopper.Kernel.Types.GH_ObjectWrapper", "Grasshopper.Kernel.Types.GH_ObjectWrapper", "Grasshopper.Kernel.Types.GH_ObjectWrapper", "Grasshopper.Kernel.Types.GH_ObjectWrapper", "Grasshopper.Kernel.Types.GH_ObjectWrapper", "Grasshopper.Kernel.Types.GH_ObjectWrapper", "Grasshopper.Kernel.Types.GH_ObjectWrapper", "Grasshopper.Kernel.Types.GH_ObjectWrapper", "Grasshopper.Kernel.Types.GH_ObjectWrapper", "Grasshopper.Kernel.Types.GH_ObjectWrapper", "Grasshopper.Kernel.Types.GH_ObjectWrapper", "Grasshopper.Kernel.Types.GH_ObjectWrapper", "Grasshopper.Kernel.Types.GH_ObjectWrapper", "Grasshopper.Kernel.Types.GH_ObjectWrapper", "Grasshopper.Kernel.Types.GH_ObjectWrapper", "Grasshopper.Kernel.Types.GH_ObjectWrapper", "Grasshopper.Kernel.Types.GH_ObjectWrapper", "Grasshopper.Kernel.Types.GH_ObjectWrapper", "Grasshopper.Kernel.Types.GH_ObjectWrapper", "Grasshopper.Kernel.Types.GH_ObjectWrapper", "Grasshopper.Kernel.Types.GH_ObjectWrapper", "Grasshopper.Kernel.Types.GH_ObjectWrapper", "Grasshopper.Kernel.Types.GH_ObjectWrapper", "Grasshopper.Kernel.Types.GH_ObjectWrapper", "Grasshopper.Kernel.Types.GH_ObjectWrapper", "Grasshopper.Kernel.Types.GH_ObjectWrapper", "Grasshopper.Kernel.Types.GH_ObjectWrapper", "Grasshopper.Kernel.Types.GH_ObjectWrapper", "Grasshopper.Kernel.Types.GH_ObjectWrapper", "Grasshopper.Kernel.Types.GH_ObjectWrapper", "Grasshopper.Kernel.Types.GH_ObjectWrapper", "Grasshopper.Kernel.Types.GH_ObjectWrapper", "Grasshopper.Kernel.Types.GH_ObjectWrapper", "Grasshopper.Kernel.Types.GH_ObjectWrapper", "Grasshopper.Kernel.Types.GH_ObjectWrapper", "Grasshopper.Kernel.Types.GH_ObjectWrapper", "Grasshopper.Kernel.Types.GH_ObjectWrapper", "Grasshopper.Kernel.Types.GH_ObjectWrapper", "Grasshopper.Kernel.Types.GH_ObjectWrapper", "Grasshopper.Kernel.Types.GH_ObjectWrapper", "Grasshopper.Kernel.Types.GH_ObjectWrapper", "Grasshopper.Kernel.Types.GH_ObjectWrapper", "Grasshopper.Kernel.Types.GH_ObjectWrapper", "Grasshopper.Kernel.Types.GH_ObjectWrapper", "Grasshopper.Kernel.Types.GH_ObjectWrapper", "Grasshopper.Kernel.Types.GH_ObjectWrapper", "Grasshopper.Kernel.Types.GH_ObjectWrapper", "Grasshopper.Kernel.Types.GH_ObjectWrapper", "Grasshopper.Kernel.Types.GH_ObjectWrapper", "Grasshopper.Kernel.Types.GH_ObjectWrapper", "Grasshopper.Kernel.Types.GH_ObjectWrapper", "Grasshopper.Kernel.Types.GH_ObjectWrapper", "Grasshopper.Kernel.Types.GH_ObjectWrapper", "Grasshopper.Kernel.Types.GH_ObjectWrapper", "Grasshopper.Kernel.Types.GH_ObjectWrapper"]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))  # -> rg; same code as draw
