# Grasshopper definition TCP_CHOSEN_weijun.gh (Grasshopper 1.0.8)

python_3_script = Python3Script(
    n_x=Slider(5, range=0..100),
    n_z=Slider(10, range=0..100),
    length=Slider(32, range=0..100),
    width=Slider(15, range=0..100),
    height=Slider(10, range=0..10))  # -> bricks, points, frames; inputs n_x: Int32, n_z: Int32, length: Double, height: Double
# ---------- python_3_script: Python ----------
from compas.geometry import Point, Box, Frame, Translation, Rotation, midpoint_point_point
import math as m


bricks = []
points = []
gap = 1.5

for j in range(n_z):
    # 1. Calculate Z position for the current layer
    z = j * height
    
    
    for i in range(n_x):
        if i % 2 == 0:
            x = ( (i/2 * (length + width)) + length/2 ) + gap*i
        else:
            x = ( (((i+1)/2) * length) + (((i-1)/2) * width) + (width/2) ) + gap*i
            

        # 4. Construct your point or box using (final_x, y, z) here...
        pt = Point(x,width/2 ,j*height,z)
        f = Frame(pt)
        points.append(pt)
        if j % 2 == i % 2:
            b = Box(width, length, height, f) # Stretcher
        else:
            b = Box(length, width, height, f) # Header

        bricks.append(b)


frames = []

for b in bricks:
    pt = b.frame.point
    f = Frame(pt, [1,0,0], [0,-1,0])
    frames.append(f)
# ---------- end python_3_script ----------
compas_draw = COMPASDraw(cg=python_3_script.bricks)  # -> rg
#   port cg: The COMPAS geometry or datastructure to be drawn.
#   port rg: The Rhino geometry object.
# ---------- compas_draw: Python ----------
# r: compas>=2.14.1
"""
Draws COMPAS geometry in Grasshopper.
"""

from typing import Any

import Grasshopper

from compas.scene import SceneObject


class CompasToRhinoGeometry(Grasshopper.Kernel.GH_ScriptInstance):
    def RunScript(self, cg):
        if not cg:
            return None

        return SceneObject(item=cg).draw()
# ---------- end compas_draw ----------
compas_draw_2 = COMPASDraw(cg=python_3_script.points)  # -> rg; same code as compas_draw
compas_draw_3 = COMPASDraw(cg=python_3_script.frames)  # -> rg; same code as compas_draw
custom_preview = CustomPreview(
    Geometry=compas_draw,
    Material={diffuse=RGB(221, 160, 221), emission=RGB(66, 48, 66), shine=0.5, specular=RGB(255, 255, 255), transparency=0})

# ---- group: TCP by gap
tcp_selector = Python3Script(bricks=python_3_script.bricks)  # -> tcp_ids, gaps; inputs bricks: list
#   port bricks: COMPAS Frames
# ---------- tcp_selector: Python ----------
"""
TCP selector: pick a TCP for every brick from the design shape.

The gripper clamps a brick on its two long faces (across the short side).
For each brick, measure the free space beside those two faces, against
all other bricks in the same layer.
    space <  GRIPPER_WIDTH  (fingers do not fit)  -> TCP 1
    space >= GRIPPER_WIDTH  or nothing there      -> TCP 2

    Input:   bricks   (List Access)  COMPAS Boxes, same order as way_frames
    Outputs: tcp_ids  1 or 2 per brick
             gaps     free space beside the clamping faces (mm), -1 = nothing there
"""

GRIPPER_WIDTH = 10  # mm, space one gripper finger needs beside the brick


def footprint(box):
    # 4 corners of the box seen from above
    f = box.frame
    hx = f.xaxis * (box.xsize / 2.0)
    hy = f.yaxis * (box.ysize / 2.0)
    c = f.point
    return [(p.x, p.y) for p in (c + hx + hy, c - hx + hy, c - hx - hy, c + hx - hy)]


def project(poly, axis):
    values = [p[0] * axis[0] + p[1] * axis[1] for p in poly]
    return min(values), max(values)


def clamp_axis(box):
    # the gripper closes across the short side of the brick
    a = box.frame.xaxis if box.xsize <= box.ysize else box.frame.yaxis
    return (a.x, a.y)


def clamp_side_gap(i):
    brick = bricks[i]
    u = clamp_axis(brick)
    v = (-u[1], u[0])
    iu, iv = project(shapes[i], u), project(shapes[i], v)
    best = None
    for j, other in enumerate(bricks):
        if j == i or abs(other.frame.point.z - brick.frame.point.z) >= brick.zsize / 2.0:
            continue  # same brick, or a different layer
        ju, jv = project(shapes[j], u), project(shapes[j], v)
        if min(iv[1], jv[1]) - max(iv[0], jv[0]) <= 1e-6:
            continue  # not beside the clamping faces
        gap = max(ju[0] - iu[1], iu[0] - ju[1], 0.0)
        best = gap if best is None else min(best, gap)
    return best


shapes = [footprint(b) for b in bricks]
tcp_ids = []
gaps = []

for i in range(len(bricks)):
    gap = clamp_side_gap(i)
    gaps.append(-1 if gap is None else gap)
    tcp_ids.append(2 if gap is None or gap >= GRIPPER_WIDTH else 1)

ghenv.Component.Message = "TCP1: {}  TCP2: {}".format(tcp_ids.count(1), tcp_ids.count(2))
# ---------- end tcp_selector ----------

# ----
panel = Panel(tcp_selector.tcp_ids)
