# Grasshopper definition VenturaVirzi_Bricks_02.ghx (Grasshopper 1.0.8)
# plug-ins: RhinoCodePluginGH

# ---- group: This is needed only ONCE in the GH definition
enable_auto_reload = Python3Script()  # -> ok
# ---------- enable_auto_reload: Python ----------
"""
------------------------------
Using VS Code as Python editor
------------------------------

The simplest way to start using VS Code as our editor, is
to place our Python code in files located IN THE SAME FOLDER as our Grasshopper file.

After we have done that, we need 2 steps: 

1. Enable the COMPAS reloader on one component. This tells Grasshopper to watch for changes in the Pythoh files and reload if changed.
2. Every other component that uses Python code from external files needs to start with a method to ensure Grasshopper knows where to load the files from.

"""
# r: compas
# venv: mas-2627

from compas_rhino.devtools import DevTools
DevTools.enable_reloader()
# ---------- end enable_auto_reload ----------

# ----
# 03. CIRCULAR TOWER
number_slider = Slider(40, range=1..50)
# 04. CIRCULAR TOWER_double pillar
number_slider_2 = Slider(40, range=1..50)
# 01. BASIC LATTICE
number_slider_3 = Slider(4, range=1..50)
# 00. BRICKS INSTANCES
number_slider_4 = Slider(15, range=1..50)
# 02. CURVED WALL
curve = Curve(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)
python_3_script = Python3Script(n_columns=number_slider_3, n_rows=Slider(2, range=1..10))  # -> out, geometries, frames, info, columns, v_references, B1, B2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; inputs n_columns: Int32, n_rows: Int32
# ---------- python_3_script: Python ----------
# ============================================================
# STEP 1 — PREPARATIONS
# ============================================================

# IMPORTS
# r: compas
# venv: mas-2627

# COMPAS
from compas_rhino.devtools import DevTools
DevTools.ensure_path()
from compas.geometry import Point, Frame, Line
from compas_rhino.conversions import frame_to_rhino

# MATH
import math

# VSCODE PYTHON
import importlib
import brick_lattice
importlib.reload(brick_lattice)
Brick = brick_lattice.Brick

# BRICK DIMENSIONS

brick_length = Brick.LENGTH
brick_width = Brick.WIDTH
brick_height = Brick.HEIGHT
brick_gap = Brick.GAP

# PARAMETERS

n_columns = int(n_columns)
n_rows = int(n_rows)

dist_between_columns = brick_length + brick_gap
dist_between_rows = brick_length + brick_height * 2 + brick_width * 2

# OUTPUTS

bricks = []

geometries = []
frames = []

info = []

# TEST

info.append("Brick length: {} mm".format(brick_length))
info.append("Brick width: {} mm".format(brick_width))
info.append("Brick height: {} mm".format(brick_height))
info.append("Brick gap: {} mm".format(brick_gap))

info.append("Distance between columns: {} mm".format(dist_between_columns))

info.append("Number of columns: {}".format(n_columns))
info.append("Number of rows: {}".format(n_rows))



# ============================================================
# STEP 2 — COLUMN REFERENCE POINTS
# ============================================================

column_points = []
column_points_double = []

for i in range(n_columns):

    x = i * dist_between_columns
    y = 0
    z = 0

    point = Point(x, y, z)

    column_points.append(point)
    
for i in range(2 * n_columns - 1):

    x = i * dist_between_columns / 2
    y = 0
    z = 0

    point = Point(x, y, z)

    column_points_double.append(point)

# OUTPUT

columns = column_points
columns_double = column_points_double


# ============================================================
# STEP 3 — VERTICAL REFERENCE POSITIONS
# ============================================================

v_offset = (brick_width + brick_gap) / 2.0

v1_y = 0.0
v2_y = v_offset
v3_y = -v_offset

# REFERENCE LINES

v_lines = []

# Total horizontal length of the module
total_length = ((n_columns - 1) * dist_between_columns)

x_start = 0.0 # -brick_length / 2.0
x_end = total_length

for y in [v1_y, v2_y, v3_y]:

    start = Point(x_start, y, 0)
    end = Point(x_end, y, 0)

    line = Line(start, end)

    v_lines.append(line)

# OUTPUT

v_references = v_lines

info.append("V1 Y: {:.1f} mm".format(v1_y))
info.append("V2 Y: {:.1f} mm".format(v2_y))
info.append("V3 Y: {:.1f} mm".format(v3_y))



# ============================================================
# STEP 4 — BRICKS
# ============================================================

b1_bricks = []
b2_bricks = []
b3_bricks = []
b4_bricks = []
b5_bricks = []
b6_bricks = []

# BRICK CREATION FUNCTION

def add_brick(x, y, z, brick_type, brick_list):

    frame = Frame(
        Point(x, y, z),
        xaxis=[1, 0, 0],
        yaxis=[0, 1, 0]
    )

    brick = brick_type(frame)

    brick_list.append(brick)
    bricks.append(brick)

    return brick

# B3_UP AND DOWN
for row in range(n_rows):
    for i, column_point in enumerate(column_points_double):
        # EVEN ROW → EVEN POINT INDICES
        # ODD ROW  → ODD POINT INDICES
        if i % 2 != row % 2:
            continue
        for y in [v3_y, v2_y]:
                x = column_point.x
                z = brick_width * 0.5 + row * dist_between_rows

                add_brick(x, y, z, Brick.b3, b3_bricks)

# B2 AND B4_UP AND DOWN
for row in range(n_rows):
    for i, column_point in enumerate(column_points_double):
        # EVEN ROW → EVEN POINT INDICES
        # ODD ROW  → ODD POINT INDICES
        if i % 2 != row % 2:
            continue
        for z_offset, brick_type, brick_list in zip(
            [
                brick_width * 1.5, 
                brick_height * 1.5 + brick_length + brick_width * 2
            ],
            [Brick.b4, Brick.b2],
            [b4_bricks, b2_bricks]
        ):
            x = column_point.x
            y = v1_y
            z = z_offset + row * dist_between_rows

            add_brick(x, y, z, brick_type, brick_list)

# B1_BACK AND FRONT
for row in range(n_rows):
    for i, column_point in enumerate(column_points_double[:-1]):
        # EVEN ROW → EVEN POINT INDICES
        # ODD ROW  → ODD POINT INDICES
        if i % 2 != row % 2:
            continue
        for y, z_offset in zip(
            [v2_y, v3_y], 
            [
                brick_width * 2 + brick_height * 0.5, 
                brick_width * 2 + brick_length + brick_height * 0.5
            ] 
        ):
            x = column_point.x + dist_between_columns / 2
            z = z_offset + row * dist_between_rows

            add_brick(x, y, z, Brick.b1, b1_bricks)

# B5 AND B6_BACK AND FRONT
for row in range(n_rows):
    for i, column_point in enumerate(column_points_double):
        # EVEN ROW → EVEN POINT INDICES
        # ODD ROW  → ODD POINT INDICES
        if i % 2 != row % 2:
            continue
        for y, z_offset, brick_type, brick_list in zip(
            [v3_y, v2_y], 
            [
                brick_width * 2 + brick_length * 0.5, 
                brick_width * 2 + brick_height + brick_length * 0.5
            ],
            [Brick.b6, Brick.b5],
            [b6_bricks, b5_bricks]
        ):

            x = column_point.x
            z = z_offset + row * dist_between_rows

            add_brick(x, y, z, brick_type, brick_list)



# ============================================================
# OUTPUTS
# ============================================================

B1 = [brick.draw() for brick in b1_bricks]
B2 = [brick.draw() for brick in b2_bricks]
B3 = [brick.draw() for brick in b3_bricks]
B4 = [brick.draw() for brick in b4_bricks]
B5 = [brick.draw() for brick in b5_bricks]
B6 = [brick.draw() for brick in b6_bricks]

geometries = [brick.draw() for brick in bricks]

frames = [frame_to_rhino(f) for f in [brick.get_frame() for brick in bricks]]

info.extend([
    "B1 bricks created: {}".format(len(b1_bricks)),
    "B2 bricks created: {}".format(len(b2_bricks)),
    "B3 bricks created: {}".format(len(b3_bricks)),
    "B4 bricks created: {}".format(len(b4_bricks)),
    "B5 bricks created: {}".format(len(b5_bricks)),
    "B6 bricks created: {}".format(len(b6_bricks))
])
# ---------- end python_3_script ----------
python_3_script_2 = Python3Script(guide_curve=curve, n_columns=Slider(25, range=1..50), n_rows=Slider(2, range=1..10))  # -> out, geometries, frames, info, columns, columns_double, v_references, B1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; inputs n_columns: Int32, n_rows: Int32
# ---------- python_3_script_2: Python ----------
# ============================================================
# STEP 1 — PREPARATIONS
# ============================================================

# IMPORTS
# r: compas
# venv: mas-2627

# COMPAS
from compas_rhino.devtools import DevTools
DevTools.ensure_path()
from compas.geometry import Point, Frame, Line, Circle, Plane, Vector
from compas_rhino.conversions import frame_to_rhino, curve_to_compas

# MATH
import math

# VSCODE PYTHON
import importlib
import brick_lattice
importlib.reload(brick_lattice)
Brick = brick_lattice.Brick

# RHINO GEOMETRY
import Rhino.Geometry as rg

# BRICK DIMENSIONS

brick_length = Brick.LENGTH
brick_width = Brick.WIDTH
brick_height = Brick.HEIGHT
brick_gap = Brick.GAP

# PARAMETERS

n_columns = int(n_columns)
n_rows = int(n_rows)

dist_between_columns = brick_length + brick_gap
dist_between_rows = brick_length + brick_height * 2 + brick_width * 2

# OUTPUTS

bricks = []

geometries = []
frames = []

info = []

# TEST

info.append("Brick length: {} mm".format(brick_length))
info.append("Brick width: {} mm".format(brick_width))
info.append("Brick height: {} mm".format(brick_height))
info.append("Brick gap: {} mm".format(brick_gap))

info.append("Distance between columns: {} mm".format(dist_between_columns))

info.append("Number of columns: {}".format(n_columns))
info.append("Number of rows: {}".format(n_rows))


# OFFSETS
v_offset = (brick_width + brick_gap) / 2.0

# ============================================================
# STEP 2 — FREEFORM CURVE COLUMN POINTS
# ============================================================

column_points = []
column_points_double = []
column_parameters = []
column_parameters_double = []

# STEP 2 — FREEFORM CURVE

if guide_curve is None:
    raise ValueError("Please provide a guide curve.")

curve_length = guide_curve.GetLength()

info.append(
    "Guide curve length: {:.2f} mm".format(curve_length)
)


d = dist_between_columns


if guide_curve.IsClosed:
    raise ValueError("For now, please use an open curve.")

# Work with a curve starting at its domain minimum
curve = guide_curve

t_start = curve.Domain.T0
t_end = curve.Domain.T1

column_parameters.append(t_start)


# First point
first_point = curve.PointAt(t_start)
column_points.append(Point(first_point.X, first_point.Y, first_point.Z))

t_current = t_start

# FIND CONSECUTIVE POINTS AT EXACTLY 34 MM
while True:

    current_point = curve.PointAt(t_current)

    sphere = rg.Sphere(current_point, d)

    intersections = rg.Intersect.Intersection.CurveBrep(
        curve,
        sphere.ToBrep(),
        0.001,
        0.001
    )

    if intersections is None:
        break

    overlap_curves, intersection_parameters = intersections

    candidates = []

    for t in intersection_parameters:

        if t > t_current + 1e-6:
            candidates.append(t)

    if not candidates:
        break

    # First forward intersection
    t_next = min(candidates)

    column_parameters.append(t_next)

    next_point = curve.PointAt(t_next)

    column_points.append(Point(next_point.X, next_point.Y, next_point.Z))

    t_current = t_next

# OUTPUT
columns = column_points


# ============================================================
# DOUBLE COLUMN POINTS
# ============================================================

for i in range(len(column_points)):

    # MAIN COLUMN POINT
    column_points_double.append(column_points[i])
    column_parameters_double.append(column_parameters[i])

    # MIDPOINT BETWEEN CONSECUTIVE COLUMNS
    if i < len(column_points) - 1:

        t0 = column_parameters[i]
        t1 = column_parameters[i + 1]

        segment = curve.Trim(t0, t1)

        if segment is None:
            raise ValueError("Could not extract curve segment.")

        success, t_mid = segment.NormalizedLengthParameter(0.5)

        if not success:
            raise ValueError("Could not calculate midpoint.")

        midpoint = segment.PointAt(t_mid)

        column_points_double.append(
            Point(midpoint.X, midpoint.Y, midpoint.Z)
        )

        column_parameters_double.append(t_mid)

# OUTPUTS
columns = column_points
columns_double = column_points_double



info.append(
    "Columns generated: {}".format(len(column_points))
)




# ============================================================
# STEP 3 — FREEFORM CURVE REFERENCES
# ============================================================

v_offset = (brick_width + brick_gap) / 2.0

v1_y = 0.0
v2_y = v_offset
v3_y = -v_offset

# V1 — ORIGINAL GUIDE CURVE
v1_curve = curve

# V2 — POSITIVE LOCAL Y
v2_offsets = curve.Offset(
    rg.Plane.WorldXY,
    v_offset,
    0.001,
    rg.CurveOffsetCornerStyle.Sharp
)

# V3 — NEGATIVE LOCAL Y
v3_offsets = curve.Offset(
    rg.Plane.WorldXY,
    -v_offset,
    0.001,
    rg.CurveOffsetCornerStyle.Sharp
)

if not v2_offsets or not v3_offsets:
    raise ValueError("Could not create V2/V3 offset curves.")

v2_curve = v2_offsets[0]
v3_curve = v3_offsets[0]

# OUTPUT
v_references = [
    curve_to_compas(v1_curve),
    curve_to_compas(v2_curve),
    curve_to_compas(v3_curve)
]




# ============================================================
# STEP 4 — FREEFORM CURVE FRAMES
# ============================================================

def curved_frame(t, y_offset, z):

    # Position on V1
    point = curve.PointAt(t)

    # Tangent vector
    tangent = curve.TangentAt(t)
    tangent.Unitize()

    # Local X axis — tangent
    xaxis = [
        tangent.X,
        tangent.Y,
        0
    ]

    # Local Y axis — perpendicular
    yaxis = [
        -tangent.Y,
        tangent.X,
        0
    ]

    # Offset from V1 along local Y
    x = point.X + yaxis[0] * y_offset
    y = point.Y + yaxis[1] * y_offset

    return Frame(
        Point(x, y, z),
        xaxis,
        yaxis
    )




# ============================================================
# STEP 4 — BRICKS
# ============================================================

b1_bricks = []
b2_bricks = []
b3_bricks = []
b4_bricks = []
b5_bricks = []
b6_bricks = []

# BRICK CREATION FUNCTION

def add_brick(frame, brick_type, brick_list):

    brick = brick_type(frame)

    brick_list.append(brick)
    bricks.append(brick)

    return brick

# B3_UP AND DOWN
for row in range(n_rows+1):
    for i, t in enumerate(column_parameters_double):
        # EVEN ROW → EVEN POINT INDICES
        # ODD ROW  → ODD POINT INDICES
        if i % 2 != row % 2:
            continue

        for y in [v3_y, v2_y]:
                z = brick_width * 0.5 + row * dist_between_rows

                frame = curved_frame(
                    t,
                    y,
                    z
                )

                add_brick(frame, Brick.b3, b3_bricks)

# B2 AND B4_UP AND DOWN
for row in range(n_rows):
    for i, t in enumerate(column_parameters_double):
        # EVEN ROW → EVEN POINT INDICES
        # ODD ROW  → ODD POINT INDICES
        if i % 2 != row % 2:
            continue

        # B4 — LOWER
        z_b4 = (
            brick_width * 1.5
            + row * dist_between_rows
        )

        frame_b4 = curved_frame(t, v1_y, z_b4)

        add_brick(
            frame_b4,
            Brick.b4,
            b4_bricks
        )

        # B2 — UPPER
        z_b2 = (
            brick_height * 1.5
            + brick_length
            + brick_width * 2
            + row * dist_between_rows
        )

        frame_b2 = curved_frame(t, v1_y, z_b2)

        add_brick(
            frame_b2,
            Brick.b2,
            b2_bricks
        )

# B1_BACK AND FRONT
for row in range(n_rows):

    # EVEN ROWS: indices 0, 2, 4...
    # ODD ROWS: indices 1, 3, 5...
    start_index = row % 2

    for i in range(start_index, len(column_parameters_double) - 2, 2):

        t0 = column_parameters_double[i]
        t1 = column_parameters_double[i + 2]

        # Curve segment between consecutive columns
        segment = curve.Trim(t0, t1)

        if segment is None:
            raise ValueError("Could not extract B1 curve segment.")

        # Midpoint by arc length
        success, t_mid = segment.NormalizedLengthParameter(0.5)

        if not success:
            raise ValueError("Could not calculate B1 midpoint.")

        # B1 — V2 (LOWER)
        z_b1_v2 = (
            brick_width * 2
            + brick_height * 0.5
            + row * dist_between_rows
        )

        frame_v2 = curved_frame(t_mid, v2_y, z_b1_v2)

        add_brick(
            frame_v2,
            Brick.b1,
            b1_bricks
        )

        # B1 — V3 (UPPER)
        z_b1_v3 = (
            brick_width * 2
            + brick_length
            + brick_height * 0.5
            + row * dist_between_rows
        )

        frame_v3 = curved_frame(t_mid, v3_y, z_b1_v3)

        add_brick(
            frame_v3,
            Brick.b1,
            b1_bricks
        )

# B5 AND B6_BACK AND FRONT
for row in range(n_rows):
    for i, t in enumerate(column_parameters_double):
        # EVEN ROW → EVEN POINT INDICES
        # ODD ROW  → ODD POINT INDICES
        if i % 2 != row % 2:
            continue
        
        # B5 — V2
        z_b5 = (
            brick_width * 2
            + brick_height
            + brick_length * 0.5
            + row * dist_between_rows
        )

        frame_b5 = curved_frame(t, v2_y, z_b5)

        add_brick(
            frame_b5,
            Brick.b5,
            b5_bricks
        )

        # B6 — V3
        z_b6 = (
            brick_width * 2
            + brick_length * 0.5
            + row * dist_between_rows
        )

        frame_b6 = curved_frame(t, v3_y, z_b6)

        add_brick(
            frame_b6,
            Brick.b6,
            b6_bricks
        )



# ============================================================
# OUTPUTS
# ============================================================

B1 = [brick.draw() for brick in b1_bricks]
B2 = [brick.draw() for brick in b2_bricks]
B3 = [brick.draw() for brick in b3_bricks]
B4 = [brick.draw() for brick in b4_bricks]
B5 = [brick.draw() for brick in b5_bricks]
B6 = [brick.draw() for brick in b6_bricks]

geometries = [brick.draw() for brick in bricks]

frames = [frame_to_rhino(f) for f in [brick.get_frame() for brick in bricks]]

info.extend([
    "B1 bricks created: {}".format(len(b1_bricks)),
    "B2 bricks created: {}".format(len(b2_bricks)),
    "B3 bricks created: {}".format(len(b3_bricks)),
    "B4 bricks created: {}".format(len(b4_bricks)),
    "B5 bricks created: {}".format(len(b5_bricks)),
    "B6 bricks created: {}".format(len(b6_bricks))
])
# ---------- end python_3_script_2 ----------
python_3_script_3 = Python3Script(n_columns=number_slider, n_rows=Slider(3, range=1..10))  # -> out, geometries, frames, info, columns, v_references, B1, B2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; inputs n_columns: Int32, n_rows: Int32
# ---------- python_3_script_3: Python ----------
# ============================================================
# STEP 1 — PREPARATIONS
# ============================================================

# IMPORTS
# r: compas
# venv: mas-2627

# COMPAS
from compas_rhino.devtools import DevTools
DevTools.ensure_path()
from compas.geometry import Point, Frame, Line, Circle, Plane, Vector
from compas_rhino.conversions import frame_to_rhino

# MATH
import math

# VSCODE PYTHON
import importlib
import brick_lattice
importlib.reload(brick_lattice)
Brick = brick_lattice.Brick

# BRICK DIMENSIONS

brick_length = Brick.LENGTH
brick_width = Brick.WIDTH
brick_height = Brick.HEIGHT
brick_gap = Brick.GAP

# PARAMETERS

n_columns = int(n_columns)
n_rows = int(n_rows)

dist_between_columns = brick_length + brick_gap
dist_between_rows = brick_length + brick_height * 2 + brick_width * 2

# OUTPUTS

bricks = []

geometries = []
frames = []

info = []

# TEST

info.append("Brick length: {} mm".format(brick_length))
info.append("Brick width: {} mm".format(brick_width))
info.append("Brick height: {} mm".format(brick_height))
info.append("Brick gap: {} mm".format(brick_gap))

info.append("Distance between columns: {} mm".format(dist_between_columns))

info.append("Number of columns: {}".format(n_columns))
info.append("Number of rows: {}".format(n_rows))


# OFFSETS
v_offset = (brick_width + brick_gap) / 2.0

# ============================================================
# STEP 2 — COLUMN REFERENCE POINTS
# ============================================================

column_points = []
column_points_double = []

# Distance between main columns
d = dist_between_columns

if n_columns < 3:
    raise ValueError("n_columns must be at least 3.")

# CALCULATE RADIUS
angle_step = 2 * math.pi / n_columns

radius = (
    dist_between_columns / (2 * math.sin(angle_step / 2))
    + v_offset
)
# MAIN COLUMN POINTS
for i in range(n_columns):

    angle = i * angle_step
    x = radius * math.sin(angle)
    y = radius * (1 - math.cos(angle))

    column_points.append(Point(x, y, 0))

# DOUBLE COLUMN POINTS
for i in range(2 * n_columns):

    angle = i * angle_step / 2

    x = radius * math.sin(angle)
    y = radius * (1 - math.cos(angle))

    column_points_double.append(Point(x, y, 0))


# OUTPUTS
columns = column_points
columns_double = column_points_double


# ============================================================
# STEP 3 — CURVED VERTICAL REFERENCES
# ============================================================

v1_y = 0.0
v2_y = v_offset
v3_y = -v_offset

# CIRCLE RADII
v1_radius = radius
v2_radius = radius - v_offset
v3_radius = radius + v_offset

if v2_radius <= 0:
    raise ValueError("V2 radius must be positive.")

# CIRCLE CENTER
circle_center = Point(0, radius, 0)

# REFERENCE CIRCLES
from compas.geometry import Circle, Plane, Vector

v1_circle = Circle(
    v1_radius,
    Frame(
        circle_center,
        [1, 0, 0],
        [0, 1, 0]
    )
)

v2_circle = Circle(
    v2_radius,
    Frame(circle_center, [1, 0, 0], [0, 1, 0])
)

v3_circle = Circle(
    v3_radius,
    Frame(circle_center, [1, 0, 0], [0, 1, 0])
)

# OUTPUT
v_references = [v1_circle, v2_circle, v3_circle]

info.append("V1 radius: {:.2f} mm".format(v1_radius))
info.append("V2 radius: {:.2f} mm".format(v2_radius))
info.append("V3 radius: {:.2f} mm".format(v3_radius))



# ============================================================
# STEP 4 — CURVED BRICK FRAMES
# ============================================================

def curved_frame(angle, y_offset, z):

    # Position on the circle
    r = radius - y_offset

    x = r * math.sin(angle)
    y = radius - r * math.cos(angle)

    # Local axes
    xaxis = [
        math.cos(angle),
        math.sin(angle),
        0
    ]

    yaxis = [
        -math.sin(angle),
        math.cos(angle),
        0
    ]

    return Frame(
        Point(x, y, z),
        xaxis,
        yaxis
    )



# ============================================================
# STEP 4 — BRICKS
# ============================================================

b1_bricks = []
b2_bricks = []
b3_bricks = []
b4_bricks = []
b5_bricks = []
b6_bricks = []

# BRICK CREATION FUNCTION

def add_brick(frame, brick_type, brick_list):

    brick = brick_type(frame)

    brick_list.append(brick)
    bricks.append(brick)

    return brick

# B3_UP AND DOWN
for row in range(n_rows+1):
    for i, column_point in enumerate(column_points_double):
        # EVEN ROW → EVEN POINT INDICES
        # ODD ROW  → ODD POINT INDICES
        if i % 2 != row % 2:
            continue

        # Angular position
        angle = i * angle_step / 2

        for y in [v3_y, v2_y]:
                x = column_point.x
                z = brick_width * 0.5 + row * dist_between_rows

                frame = curved_frame(
                    angle,
                    y,
                    z
                )

                add_brick(frame, Brick.b3, b3_bricks)

# B2 AND B4_UP AND DOWN
for row in range(n_rows):
    for i, column_point in enumerate(column_points_double):
        # EVEN ROW → EVEN POINT INDICES
        # ODD ROW  → ODD POINT INDICES
        if i % 2 != row % 2:
            continue

        angle = i * angle_step / 2

        for z_offset, brick_type, brick_list in zip(
            [
                brick_width * 1.5, 
                brick_height * 1.5 + brick_length + brick_width * 2
            ],
            [Brick.b4, Brick.b2],
            [b4_bricks, b2_bricks]
        ):

            z = z_offset + row * dist_between_rows

            frame = curved_frame(
                angle,
                v1_y,
                z
            )

            add_brick(frame, brick_type, brick_list)

# B1_BACK AND FRONT
for row in range(n_rows):
    for column in range(n_columns):

        # Midpoint angle between consecutive columns
        angle = (column + 0.5 + (row % 2) * 0.5) * angle_step
        
        for y, z_offset in zip(
            [v2_y, v3_y], 
            [
                brick_width * 2 + brick_height * 0.5, 
                brick_width * 2 + brick_length + brick_height * 0.5
            ] 
        ):
            z = z_offset + row * dist_between_rows

            frame = curved_frame(
                angle,
                y,
                z
            )

            if y == v2_y:
                r = radius - y
                chord_radius = r * math.cos(angle_step / 2)

                radial_shift = r - chord_radius

                frame.point.x += radial_shift * math.sin(angle)
                frame.point.y -= radial_shift * math.cos(angle)


            add_brick(frame, Brick.b1, b1_bricks)

# B5 AND B6_BACK AND FRONT
for row in range(n_rows):
    for i, column_point in enumerate(column_points_double):
        # EVEN ROW → EVEN POINT INDICES
        # ODD ROW  → ODD POINT INDICES
        if i % 2 != row % 2:
            continue
        
        # Angular position
        angle = i * angle_step / 2

        for y, z_offset, brick_type, brick_list in zip(
            [v3_y, v2_y], 
            [
                brick_width * 2 + brick_length * 0.5, 
                brick_width * 2 + brick_height + brick_length * 0.5
            ],
            [Brick.b6, Brick.b5],
            [b6_bricks, b5_bricks]
        ):

            z = z_offset + row * dist_between_rows

            frame = curved_frame(
                angle,
                y,
                z
            )

            add_brick(frame, brick_type, brick_list)



# ============================================================
# OUTPUTS
# ============================================================

B1 = [brick.draw() for brick in b1_bricks]
B2 = [brick.draw() for brick in b2_bricks]
B3 = [brick.draw() for brick in b3_bricks]
B4 = [brick.draw() for brick in b4_bricks]
B5 = [brick.draw() for brick in b5_bricks]
B6 = [brick.draw() for brick in b6_bricks]

geometries = [brick.draw() for brick in bricks]

frames = [frame_to_rhino(f) for f in [brick.get_frame() for brick in bricks]]

info.extend([
    "B1 bricks created: {}".format(len(b1_bricks)),
    "B2 bricks created: {}".format(len(b2_bricks)),
    "B3 bricks created: {}".format(len(b3_bricks)),
    "B4 bricks created: {}".format(len(b4_bricks)),
    "B5 bricks created: {}".format(len(b5_bricks)),
    "B6 bricks created: {}".format(len(b6_bricks))
])
# ---------- end python_3_script_3 ----------
python_3_script_4 = Python3Script(n_columns=number_slider_2, n_rows=Slider(2, range=1..10))  # -> out, geometries, frames, info, columns, v_references, B1, B2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; inputs n_columns: Int32, n_rows: Int32
# ---------- python_3_script_4: Python ----------
# ============================================================
# STEP 1 — PREPARATIONS
# ============================================================

# IMPORTS
# r: compas
# venv: mas-2627

# COMPAS
from compas_rhino.devtools import DevTools
DevTools.ensure_path()
from compas.geometry import Point, Frame, Line, Circle, Plane, Vector
from compas_rhino.conversions import frame_to_rhino

# MATH
import math

# VSCODE PYTHON
import importlib
import brick_lattice
importlib.reload(brick_lattice)
Brick = brick_lattice.Brick

# BRICK DIMENSIONS

brick_length = Brick.LENGTH
brick_width = Brick.WIDTH
brick_height = Brick.HEIGHT
brick_gap = Brick.GAP

# PARAMETERS

n_columns = int(n_columns)
n_rows = int(n_rows)

dist_between_columns = brick_length + brick_gap
dist_between_rows = brick_length + brick_height * 2 + brick_width * 2

# OUTPUTS

bricks = []

geometries = []
frames = []

info = []

# TEST

info.append("Brick length: {} mm".format(brick_length))
info.append("Brick width: {} mm".format(brick_width))
info.append("Brick height: {} mm".format(brick_height))
info.append("Brick gap: {} mm".format(brick_gap))

info.append("Distance between columns: {} mm".format(dist_between_columns))

info.append("Number of columns: {}".format(n_columns))
info.append("Number of rows: {}".format(n_rows))


# OFFSETS
v_offset = (brick_width + brick_gap) / 2.0

# ============================================================
# STEP 2 — COLUMN REFERENCE POINTS
# ============================================================

column_points = []
column_points_double = []

# Distance between main columns
d = dist_between_columns

if n_columns < 3:
    raise ValueError("n_columns must be at least 3.")

# CALCULATE RADIUS
angle_step = 2 * math.pi / n_columns

radius = (
    dist_between_columns / (2 * math.sin(angle_step / 2))
    + v_offset
)
# MAIN COLUMN POINTS
for i in range(n_columns):

    angle = i * angle_step
    x = radius * math.sin(angle)
    y = radius * (1 - math.cos(angle))

    column_points.append(Point(x, y, 0))

# DOUBLE COLUMN POINTS
for i in range(2 * n_columns):

    angle = i * angle_step / 2

    x = radius * math.sin(angle)
    y = radius * (1 - math.cos(angle))

    column_points_double.append(Point(x, y, 0))


# OUTPUTS
columns = column_points
columns_double = column_points_double


# ============================================================
# STEP 3 — CURVED VERTICAL REFERENCES
# ============================================================

v1_y = 0.0
v2_y = v_offset
v3_y = -v_offset

# CIRCLE RADII
v1_radius = radius
v2_radius = radius - v_offset
v3_radius = radius + v_offset

if v2_radius <= 0:
    raise ValueError("V2 radius must be positive.")

# CIRCLE CENTER
circle_center = Point(0, radius, 0)

# REFERENCE CIRCLES
from compas.geometry import Circle, Plane, Vector

v1_circle = Circle(
    v1_radius,
    Frame(
        circle_center,
        [1, 0, 0],
        [0, 1, 0]
    )
)

v2_circle = Circle(
    v2_radius,
    Frame(circle_center, [1, 0, 0], [0, 1, 0])
)

v3_circle = Circle(
    v3_radius,
    Frame(circle_center, [1, 0, 0], [0, 1, 0])
)

# OUTPUT
v_references = [v1_circle, v2_circle, v3_circle]

info.append("V1 radius: {:.2f} mm".format(v1_radius))
info.append("V2 radius: {:.2f} mm".format(v2_radius))
info.append("V3 radius: {:.2f} mm".format(v3_radius))



# ============================================================
# STEP 4 — CURVED BRICK FRAMES
# ============================================================

def curved_frame(angle, y_offset, z):

    # Position on the circle
    r = radius - y_offset

    x = r * math.sin(angle)
    y = radius - r * math.cos(angle)

    # Local axes
    xaxis = [
        math.cos(angle),
        math.sin(angle),
        0
    ]

    yaxis = [
        -math.sin(angle),
        math.cos(angle),
        0
    ]

    return Frame(
        Point(x, y, z),
        xaxis,
        yaxis
    )



# ============================================================
# STEP 4 — BRICKS
# ============================================================

b1_bricks = []
b2_bricks = []
b3_bricks = []
b4_bricks = []
b5_bricks = []
b6_bricks = []

# BRICK CREATION FUNCTION

def add_brick(frame, brick_type, brick_list):

    brick = brick_type(frame)

    brick_list.append(brick)
    bricks.append(brick)

    return brick

def add_double_brick(frame, brick_type, brick_list):

    offset = (brick_height + brick_gap) / 2.0

    for direction in [-1, 1]:

        new_frame = frame.copy()

        # Move along the tangential direction
        new_frame.point += new_frame.xaxis * (direction * offset)

        add_brick(
            new_frame,
            brick_type,
            brick_list
        )



# B3_UP AND DOWN
for row in range(n_rows+1):
    for i, column_point in enumerate(column_points_double):
        # EVEN ROW → EVEN POINT INDICES
        # ODD ROW  → ODD POINT INDICES
        if i % 2 != row % 2:
            continue

        # Angular position
        angle = i * angle_step / 2

        for y in [v3_y, v2_y]:
                x = column_point.x
                z = brick_width * 0.5 + row * dist_between_rows

                frame = curved_frame(
                    angle,
                    y,
                    z
                )

                add_brick(frame, Brick.b3, b3_bricks)

# B2 AND B4_UP AND DOWN
for row in range(n_rows):
    for i, column_point in enumerate(column_points_double):
        # EVEN ROW → EVEN POINT INDICES
        # ODD ROW  → ODD POINT INDICES
        if i % 2 != row % 2:
            continue

        angle = i * angle_step / 2

        for z_offset, brick_type, brick_list in zip(
            [
                brick_width * 1.5, 
                brick_height * 1.5 + brick_length + brick_width * 2
            ],
            [Brick.b4, Brick.b2],
            [b4_bricks, b2_bricks]
        ):

            z = z_offset + row * dist_between_rows

            frame = curved_frame(
                angle,
                v1_y,
                z
            )

            if brick_type == Brick.b4:
                column_index = i // 2

                if (column_index - row // 2) % 2 == 0:
                    add_double_brick(frame, brick_type, brick_list)
                else:
                    add_brick(frame, brick_type, brick_list)
            else:
                add_brick(frame, brick_type, brick_list)

# B1_BACK AND FRONT
for row in range(n_rows):
    for column in range(n_columns):

        # Midpoint angle between consecutive columns
        angle = (column + 0.5 + (row % 2) * 0.5) * angle_step
        
        for y, z_offset in zip(
            [v2_y, v3_y], 
            [
                brick_width * 2 + brick_height * 0.5, 
                brick_width * 2 + brick_length + brick_height * 0.5
            ] 
        ):
            z = z_offset + row * dist_between_rows

            frame = curved_frame(
                angle,
                y,
                z
            )

            if y == v2_y:
                r = radius - y
                chord_radius = r * math.cos(angle_step / 2)

                radial_shift = r - chord_radius

                frame.point.x += radial_shift * math.sin(angle)
                frame.point.y -= radial_shift * math.cos(angle)


            add_brick(frame, Brick.b1, b1_bricks)

# B5 AND B6_BACK AND FRONT
for row in range(n_rows):
    for i, column_point in enumerate(column_points_double):
        # EVEN ROW → EVEN POINT INDICES
        # ODD ROW  → ODD POINT INDICES
        if i % 2 != row % 2:
            continue
        
        # Angular position
        angle = i * angle_step / 2

        for y, z_offset, brick_type, brick_list in zip(
            [v3_y, v2_y], 
            [
                brick_width * 2 + brick_length * 0.5, 
                brick_width * 2 + brick_height + brick_length * 0.5
            ],
            [Brick.b6, Brick.b5],
            [b6_bricks, b5_bricks]
        ):

            z = z_offset + row * dist_between_rows

            frame = curved_frame(
                angle,
                y,
                z
            )

            if brick_type == Brick.b6:
                column_index = i // 2

                if (column_index - row // 2) % 2 == 0:
                    add_double_brick(frame, brick_type, brick_list)
                else:
                    add_brick(frame, brick_type, brick_list)
            else:
                add_brick(frame, brick_type, brick_list)



# ============================================================
# OUTPUTS
# ============================================================

B1 = [brick.draw() for brick in b1_bricks]
B2 = [brick.draw() for brick in b2_bricks]
B3 = [brick.draw() for brick in b3_bricks]
B4 = [brick.draw() for brick in b4_bricks]
B5 = [brick.draw() for brick in b5_bricks]
B6 = [brick.draw() for brick in b6_bricks]

geometries = [brick.draw() for brick in bricks]

frames = [frame_to_rhino(f) for f in [brick.get_frame() for brick in bricks]]

info.extend([
    "B1 bricks created: {}".format(len(b1_bricks)),
    "B2 bricks created: {}".format(len(b2_bricks)),
    "B3 bricks created: {}".format(len(b3_bricks)),
    "B4 bricks created: {}".format(len(b4_bricks)),
    "B5 bricks created: {}".format(len(b5_bricks)),
    "B6 bricks created: {}".format(len(b6_bricks))
])
# ---------- end python_3_script_4 ----------
python_3_script_5 = Python3Script(n_columns=number_slider_4, n_rows=Slider(3, range=1..10))  # -> out, geometries, frames, info, columns, v_references, B1, B2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; inputs n_columns: Int32, n_rows: Int32
# ---------- python_3_script_5: Python ----------
# r: compas
# venv: mas-2627

from compas_rhino.devtools import DevTools
DevTools.ensure_path()

from compas.geometry import Point, Frame
from compas_rhino.conversions import frame_to_rhino

import importlib
import brick_lattice
importlib.reload(brick_lattice)

Brick = brick_lattice.Brick


# ============================================================
# BRICK TYPES
# ============================================================

brick_types = [
    Brick.b1,
    Brick.b2,
    Brick.b3,
    Brick.b4,
    Brick.b5,
    Brick.b6
]


# ============================================================
# CREATE BRICKS SIDE BY SIDE
# ============================================================

bricks = []

spacing = Brick.LENGTH + Brick.GAP + 10

for i, brick_type in enumerate(brick_types):

    x = i * spacing

    frame = Frame(
        Point(x, 0, 0),
        [1, 0, 0],
        [0, 1, 0]
    )

    brick = brick_type(frame)

    bricks.append(brick)


# ============================================================
# OUTPUTS
# ============================================================

geometries = [brick.draw() for brick in bricks]

frames = [
    frame_to_rhino(brick.get_frame())
    for brick in bricks
]

names = ["B1", "B2", "B3", "B4", "B5", "B6"]


B1 = [bricks[0].draw()]
B2 = [bricks[1].draw()]
B3 = [bricks[2].draw()]
B4 = [bricks[3].draw()]
B5 = [bricks[4].draw()]
B6 = [bricks[5].draw()]


# ============================================================
# BRICK NAME LABELS
# ============================================================

import Rhino.Geometry as rg

labels = []

for i, brick in enumerate(bricks):

    name = "B{}".format(i + 1)

    point = brick.get_frame().point

    # Position label in front of each brick
    label_position = rg.Point3d(
        point.x,
        point.y - Brick.WIDTH - 20,
        point.z
    )

    label = rg.TextDot(name, label_position)

    labels.append(label)
# ---------- end python_3_script_5 ----------
compas_draw = COMPASDraw(cg=python_3_script.geometries)  # -> rg
#   port cg: The COMPAS geometry or datastructure to be drawn.
#   port rg: The Rhino geometry object.
# ---------- compas_draw: Python ----------
# r: compas>=2.14.1
"""
Draws COMPAS geometry in Grasshopper.
"""

from typing import Any

import Grasshopper

from compas.scene import SceneObject


class CompasToRhinoGeometry(Grasshopper.Kernel.GH_ScriptInstance):
    def RunScript(self, cg):
        if not cg:
            return None

        return SceneObject(item=cg).draw()[0]
# ---------- end compas_draw ----------
compas_draw_2 = COMPASDraw(cg=python_3_script.columns)  # -> rg; same code as compas_draw
compas_draw_3 = COMPASDraw(cg=python_3_script.v_references)  # -> rg; same code as compas_draw
compas_draw_4 = COMPASDraw(cg=python_3_script.B1)  # -> rg; same code as compas_draw
compas_draw_5 = COMPASDraw(cg=python_3_script.B2)  # -> rg; same code as compas_draw
compas_draw_6 = COMPASDraw(cg=python_3_script.B3)  # -> rg; same code as compas_draw
compas_draw_7 = COMPASDraw(cg=python_3_script.B4)  # -> rg; same code as compas_draw
compas_draw_8 = COMPASDraw(cg=python_3_script.B5)  # -> rg; same code as compas_draw
compas_draw_9 = COMPASDraw(cg=python_3_script.B6)  # -> rg; same code as compas_draw
compas_draw_10 = COMPASDraw(cg=python_3_script_3.geometries)  # -> rg; same code as compas_draw
compas_draw_11 = COMPASDraw(cg=python_3_script_3.columns)  # -> rg; same code as compas_draw
compas_draw_12 = COMPASDraw(cg=python_3_script_3.v_references)  # -> rg; same code as compas_draw
compas_draw_13 = COMPASDraw(cg=python_3_script_3.B1)  # -> rg; same code as compas_draw
compas_draw_14 = COMPASDraw(cg=python_3_script_3.B2)  # -> rg; same code as compas_draw
compas_draw_15 = COMPASDraw(cg=python_3_script_3.B3)  # -> rg; same code as compas_draw
compas_draw_16 = COMPASDraw(cg=python_3_script_3.B4)  # -> rg; same code as compas_draw
compas_draw_17 = COMPASDraw(cg=python_3_script_3.B5)  # -> rg; same code as compas_draw
compas_draw_18 = COMPASDraw(cg=python_3_script_3.B6)  # -> rg; same code as compas_draw
compas_draw_19 = COMPASDraw(cg=python_3_script_4.geometries)  # -> rg; same code as compas_draw
compas_draw_20 = COMPASDraw(cg=python_3_script_4.columns)  # -> rg; same code as compas_draw
compas_draw_21 = COMPASDraw(cg=python_3_script_4.v_references)  # -> rg; same code as compas_draw
compas_draw_22 = COMPASDraw(cg=python_3_script_4.B1)  # -> rg; same code as compas_draw
compas_draw_23 = COMPASDraw(cg=python_3_script_4.B2)  # -> rg; same code as compas_draw
compas_draw_24 = COMPASDraw(cg=python_3_script_4.B3)  # -> rg; same code as compas_draw
compas_draw_25 = COMPASDraw(cg=python_3_script_4.B4)  # -> rg; same code as compas_draw
compas_draw_26 = COMPASDraw(cg=python_3_script_4.B5)  # -> rg; same code as compas_draw
compas_draw_27 = COMPASDraw(cg=python_3_script_4.B6)  # -> rg; same code as compas_draw
compas_draw_28 = COMPASDraw(cg=python_3_script_2.v_references)  # -> rg; same code as compas_draw
compas_draw_29 = COMPASDraw(cg=python_3_script_2.B1)  # -> rg; same code as compas_draw
compas_draw_30 = COMPASDraw(cg=python_3_script_2.B2)  # -> rg; same code as compas_draw
compas_draw_31 = COMPASDraw(cg=python_3_script_2.B3)  # -> rg; same code as compas_draw
compas_draw_32 = COMPASDraw(cg=python_3_script_2.B4)  # -> rg; same code as compas_draw
compas_draw_33 = COMPASDraw(cg=python_3_script_2.B5)  # -> rg; same code as compas_draw
compas_draw_34 = COMPASDraw(cg=python_3_script_2.B6)  # -> rg; same code as compas_draw
panel = Panel(python_3_script.info)
plane = Plane(python_3_script.frames)
plane_2 = Plane(python_3_script_3.frames)
compas_draw_35 = COMPASDraw(cg=python_3_script_2.geometries)  # -> rg; same code as compas_draw
compas_draw_36 = COMPASDraw(cg=python_3_script_2.columns)  # -> rg; same code as compas_draw
compas_draw_37 = COMPASDraw(cg=python_3_script_2.columns_double)  # -> rg; same code as compas_draw
plane_3 = Plane(python_3_script_4.frames)
plane_4 = Plane(python_3_script_2.frames)
compas_draw_38 = COMPASDraw(cg=python_3_script_5.geometries)  # -> rg; same code as compas_draw
compas_draw_39 = COMPASDraw(cg=python_3_script_5.columns)  # -> rg; same code as compas_draw
compas_draw_40 = COMPASDraw(cg=python_3_script_5.v_references)  # -> rg; same code as compas_draw
compas_draw_41 = COMPASDraw(cg=python_3_script_5.B1)  # -> rg; same code as compas_draw
compas_draw_42 = COMPASDraw(cg=python_3_script_5.B2)  # -> rg; same code as compas_draw
compas_draw_43 = COMPASDraw(cg=python_3_script_5.B3)  # -> rg; same code as compas_draw
compas_draw_44 = COMPASDraw(cg=python_3_script_5.B4)  # -> rg; same code as compas_draw
compas_draw_45 = COMPASDraw(cg=python_3_script_5.B5)  # -> rg; same code as compas_draw
compas_draw_46 = COMPASDraw(cg=python_3_script_5.B6)  # -> rg; same code as compas_draw
plane_5 = Plane(python_3_script_5.frames)
text = Text(python_3_script_5.labels)
plane_normal = PlaneNormal(Origin=plane, ZAxis=Vector(0, 0, 1))
plane_normal_2 = PlaneNormal(Origin=plane_2, ZAxis=Vector(0, 0, 1))
plane_normal_3 = PlaneNormal(Origin=plane_3, ZAxis=Vector(0, 0, 1))
plane_normal_4 = PlaneNormal(Origin=plane_4, ZAxis=Vector(0, 0, 1))
deconstruct_plane = DeconstructPlane(Plane=plane)  # -> Origin, XAxis, YAxis, ZAxis
deconstruct_plane_2 = DeconstructPlane(Plane=plane_2)  # -> Origin, XAxis, YAxis, ZAxis
deconstruct_plane_3 = DeconstructPlane(Plane=plane_3)  # -> Origin, XAxis, YAxis, ZAxis
deconstruct_plane_4 = DeconstructPlane(Plane=plane_4)  # -> Origin, XAxis, YAxis, ZAxis
custom_preview = CustomPreview(Geometry=compas_draw_4, Material=ColourSwatch(SwatchColor=RGB(255, 0, 255)))
custom_preview_2 = CustomPreview(Geometry=compas_draw_5, Material=ColourSwatch(SwatchColor=RGB(159, 255, 255)))
custom_preview_3 = CustomPreview(Geometry=compas_draw_6, Material=ColourSwatch(SwatchColor=RGB(0, 0, 255)))
custom_preview_4 = CustomPreview(Geometry=compas_draw_7, Material=ColourSwatch(SwatchColor=RGB(87, 255, 79)))
custom_preview_5 = CustomPreview(Geometry=compas_draw_8, Material=ColourSwatch(SwatchColor=RGB(199, 101, 68)))
custom_preview_6 = CustomPreview(Geometry=compas_draw_9, Material=ColourSwatch(SwatchColor=RGB(255, 0, 0)))
custom_preview_7 = CustomPreview(Geometry=compas_draw_13, Material=ColourSwatch(SwatchColor=RGB(255, 0, 255)))
custom_preview_8 = CustomPreview(Geometry=compas_draw_14, Material=ColourSwatch(SwatchColor=RGB(159, 255, 255)))
custom_preview_9 = CustomPreview(Geometry=compas_draw_15, Material=ColourSwatch(SwatchColor=RGB(0, 0, 255)))
custom_preview_10 = CustomPreview(Geometry=compas_draw_16, Material=ColourSwatch(SwatchColor=RGB(87, 255, 79)))
custom_preview_11 = CustomPreview(Geometry=compas_draw_17, Material=ColourSwatch(SwatchColor=RGB(199, 101, 68)))
custom_preview_12 = CustomPreview(Geometry=compas_draw_18, Material=ColourSwatch(SwatchColor=RGB(255, 0, 0)))
custom_preview_13 = CustomPreview(Geometry=compas_draw_22, Material=ColourSwatch(SwatchColor=RGB(255, 0, 255)))
custom_preview_14 = CustomPreview(Geometry=compas_draw_23, Material=ColourSwatch(SwatchColor=RGB(159, 255, 255)))
custom_preview_15 = CustomPreview(Geometry=compas_draw_24, Material=ColourSwatch(SwatchColor=RGB(0, 0, 255)))
custom_preview_16 = CustomPreview(Geometry=compas_draw_25, Material=ColourSwatch(SwatchColor=RGB(87, 255, 79)))
custom_preview_17 = CustomPreview(Geometry=compas_draw_26, Material=ColourSwatch(SwatchColor=RGB(199, 101, 68)))
custom_preview_18 = CustomPreview(Geometry=compas_draw_27, Material=ColourSwatch(SwatchColor=RGB(255, 0, 0)))
custom_preview_19 = CustomPreview(Geometry=compas_draw_29, Material=ColourSwatch(SwatchColor=RGB(255, 0, 255)))
custom_preview_20 = CustomPreview(Geometry=compas_draw_30, Material=ColourSwatch(SwatchColor=RGB(159, 255, 255)))
custom_preview_21 = CustomPreview(Geometry=compas_draw_31, Material=ColourSwatch(SwatchColor=RGB(0, 0, 255)))
custom_preview_22 = CustomPreview(Geometry=compas_draw_32, Material=ColourSwatch(SwatchColor=RGB(87, 255, 79)))
custom_preview_23 = CustomPreview(Geometry=compas_draw_33, Material=ColourSwatch(SwatchColor=RGB(199, 101, 68)))
custom_preview_24 = CustomPreview(Geometry=compas_draw_34, Material=ColourSwatch(SwatchColor=RGB(255, 0, 0)))
plane_normal_5 = PlaneNormal(Origin=plane_5, ZAxis=Vector(0, 0, 1))
deconstruct_plane_5 = DeconstructPlane(Plane=plane_5)  # -> Origin, XAxis, YAxis, ZAxis
custom_preview_25 = CustomPreview(Geometry=compas_draw_41, Material=ColourSwatch(SwatchColor=RGB(255, 0, 255)))
custom_preview_26 = CustomPreview(Geometry=compas_draw_42, Material=ColourSwatch(SwatchColor=RGB(159, 255, 255)))
custom_preview_27 = CustomPreview(Geometry=compas_draw_43, Material=ColourSwatch(SwatchColor=RGB(0, 0, 255)))
custom_preview_28 = CustomPreview(Geometry=compas_draw_44, Material=ColourSwatch(SwatchColor=RGB(87, 255, 79)))
custom_preview_29 = CustomPreview(Geometry=compas_draw_45, Material=ColourSwatch(SwatchColor=RGB(199, 101, 68)))
custom_preview_30 = CustomPreview(Geometry=compas_draw_46, Material=ColourSwatch(SwatchColor=RGB(255, 0, 0)))
data = Data(python_3_script_5.labels)
multiplication = Multiplication(A=deconstruct_plane.ZAxis, B=15)
multiplication_2 = Multiplication(A=deconstruct_plane_2.ZAxis, B=15)
multiplication_3 = Multiplication(A=deconstruct_plane_3.ZAxis, B=15)
multiplication_4 = Multiplication(A=deconstruct_plane_4.ZAxis, B=15)
multiplication_5 = Multiplication(A=deconstruct_plane_5.ZAxis, B=15)
panel_2 = Panel(python_3_script_2.info)
vector_display = VectorDisplay(Anchor=deconstruct_plane.Origin, Vector=multiplication)
vector_display_2 = VectorDisplay(Anchor=deconstruct_plane_2.Origin, Vector=multiplication_2)
vector_display_3 = VectorDisplay(Anchor=deconstruct_plane_3.Origin, Vector=multiplication_3)
vector_display_4 = VectorDisplay(Anchor=deconstruct_plane_4.Origin, Vector=multiplication_4)
panel_3 = Panel(python_3_script_3.info)
panel_4 = Panel(python_3_script_4.info)
vector_display_5 = VectorDisplay(Anchor=deconstruct_plane_5.Origin, Vector=multiplication_5)
