# Grasshopper definition brick_script_ours.gh (Grasshopper 1.0.8)

# ---- group: This is needed only ONCE in the GH definition
enable_auto_reload = Python3Script()  # -> ok
# ---------- enable_auto_reload: Python ----------
"""
------------------------------
Using VS Code as Python editor
------------------------------

The simplest way to start using VS Code as our editor, is
to place our Python code in files located IN THE SAME FOLDER as our Grasshopper file.

After we have done that, we need 2 steps: 

1. Enable the COMPAS reloader on one component. This tells Grasshopper to watch for changes in the Pythoh files and reload if changed.
2. Every other component that uses Python code from external files needs to start with a method to ensure Grasshopper knows where to load the files from.

"""
# r: compas
# venv: mas-2627

from compas_rhino.devtools import DevTools
DevTools.enable_reloader()
# ---------- end enable_auto_reload ----------

# ----
gap = Slider(5.8, range=0..10)
gap_2 = Slider(5.8, range=0..10)
curve = Curve(<curve referenced from the Rhino model>)
curve_2 = Curve(<curve referenced from the Rhino model>)
gap_3 = Slider(7.4, range=0..10)
brick_wall = Python3Script(crv=curve, num_layers=Slider(2, range=0..30), gap=gap)  # -> bricks, geometries, frames; inputs crv: Curve, num_layers: Int32, gap: Double
# ---------- brick_wall: Python ----------
# r: compas
# venv: mas-2627
from compas_rhino.devtools import DevTools
DevTools.ensure_path()

# 0. Import everything we will need
import math
from compas.geometry import Box
from compas.geometry import Point
from compas.geometry import Frame
from compas.geometry import cross_vectors

from compas_rhino.conversions import curve_to_compas


# ..also import our module "brick_wall.py", that needs to be in the same folder as our GH file
from brick_wall import Brick

# 1. Start with an empty list of bricks to be created
bricks = []

# 2. Create points on curve curve
print(crv)
compas_crv = curve_to_compas(crv)

# Divide the curve
length = (Brick.LENGTH + gap)/2
params, points = compas_crv.divide_by_length(length,True)

for i in range(num_layers):
   
    for j, (param, pt) in enumerate(zip(params, points)):
        
        if  i % 2 == j%2:

            tangent = compas_crv.tangent_at(param)
            normal = cross_vectors(tangent, [0,0,1])
            pt.z = i * Brick.HEIGHT
            frame = Frame(pt, xaxis = tangent, yaxis = normal)
            my_brick = Brick(frame)
            bricks.append(my_brick)

# Visualize and store brick data
geometries = []
frames = []
for brick in bricks:
    geometries.append(brick.draw())
    frames.append(brick.get_pick_frame())
# ---------- end brick_wall ----------
# Generate Geometry
curve_3 = Curve(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)
brick_wall_2 = Python3Script(crv=curve_2, num_layers=Slider(2, range=0..30), gap=gap_2)  # -> bricks, geometries, frames; inputs crv: Curve, num_layers: Int32, gap: Double
# ---------- brick_wall_2: Python ----------
# r: compas
# venv: mas-2627
from compas_rhino.devtools import DevTools
DevTools.ensure_path()

# 0. Import everything we will need
import math
from compas.geometry import Box
from compas.geometry import Point
from compas.geometry import Frame
from compas.geometry import cross_vectors

from compas_rhino.conversions import curve_to_compas


# ..also import our module "brick_wall.py", that needs to be in the same folder as our GH file
from brick_wall import Brick

# 1. Start with an empty list of bricks to be created
bricks = []

# 2. Create points on curve curve
print(crv)
compas_crv = curve_to_compas(crv)

# Divide the curve
length = Brick.LENGTH / 200
params, points = compas_crv.divide_by_length(length,True)
tangent_list = []
distance_list = []


for j, (param, pt) in enumerate(zip(params, points)):

    tangent = compas_crv.tangent_at(param)
    tangent = tangent.unitized()
    tangent_list.append(tangent)
    distance = j * length
    distance_list.append(distance)

print(len(points))
print(len(tangent_list))
print(len(distance_list))



# for i in range(num_layers):
   
#     for j, (param, pt) in enumerate(zip(params, points)):
        
#         if  i % 2 == j%2:

#             tangent = compas_crv.tangent_at(param)
#             tangent = tangent.unitized()
#             tangent_list.append(tangent)
#             normal = cross_vectors(tangent, [0,0,1])
#             pt.z = i * Brick.HEIGHT
#             frame = Frame(pt, xaxis = tangent, yaxis = normal)
#             my_brick = Brick(frame)
#             bricks.append(my_brick)

# # Visualize and store brick data
# geometries = []
# frames = []
# for brick in bricks:
#     geometries.append(brick.draw())
#     frames.append(brick.get_pick_frame())
# ---------- end brick_wall_2 ----------
brick_wall_3 = Python3Script(crv=curve_3, num_layers=Slider(9, range=0..30), gap=gap_3)  # -> bricks, geometries, frames; inputs crv: Curve, num_layers: Int32, gap: Double
# ---------- brick_wall_3: Python ----------
# r: compas
# venv: mas-2627
from compas_rhino.devtools import DevTools
DevTools.ensure_path()

# 0. Import everything we will need
import math
from compas.geometry import Box
from compas.geometry import Point
from compas.geometry import Frame
from compas.geometry import cross_vectors

from compas_rhino.conversions import curve_to_compas


# ..also import our module "brick_wall.py", that needs to be in the same folder as our GH file
from brick_wall import Brick

# 1. Start with an empty list of bricks to be created
bricks = []

# 2. Create points on curve curve
print(crv)
compas_crv = curve_to_compas(crv)

# Divide the curve
length = (Brick.LENGTH + gap)/2
params, points = compas_crv.divide_by_length(length,True)

for i in range(num_layers):
   
    for j, (param, pt) in enumerate(zip(params, points)):
        
        if  i % 2 == j%2:

            tangent = compas_crv.tangent_at(param)
            normal = cross_vectors(tangent, [0,0,1])
            pt.z = i * Brick.HEIGHT
            frame = Frame(pt, xaxis = tangent, yaxis = normal)
            my_brick = Brick(frame)
            bricks.append(my_brick)

# Visualize and store brick data
geometries = []
frames = []
for brick in bricks:
    geometries.append(brick.draw())
    frames.append(brick.get_pick_frame())

# List comprehension
grometries = [brick.draw() for brick in bricks]
frames = [brick.get_pick_frame() for brick in bricks]


# # r: compas
# # venv: mas-2627
# from compas_rhino.devtools import DevTools
# DevTools.ensure_path()

# # 0. Import everything we will need
# import math
# from compas.geometry import Box
# from compas.geometry import Point
# from compas.geometry import Frame
# from compas.geometry import cross_vectors

# from compas_rhino.conversions import curve_to_compas


# # ..also import our module "brick_wall.py", that needs to be in the same folder as our GH file
# from brick_wall import Brick

# # 1. Start with an empty list of bricks to be created
# bricks = []

# # 2. Create points on curve curve
# print(crv)
# compas_crv = curve_to_compas(crv)

# # Divide the curve
# length = Brick.LENGTH + gap
# params, points = compas_crv.divide_by_length(length,True)
# params2, points2 = compas_crv.divide_by_length(length/2,True)

# for i in range(num_layers):
#     for j, (param, pt) in enumerate(zip(params, points)):
        
#         if  i % 2 == 1:
#             pt = points2[j*2+1]
#             param = params2[j*2+1]
        

#         tangent = compas_crv.tangent_at(param)
#         normal = cross_vectors(tangent, [0,0,1])
#         pt.z = i * Brick.HEIGHT
#         frame = Frame(pt, xaxis = tangent, yaxis = normal)
#         my_brick = Brick(frame)
#         bricks.append(my_brick)


# # Visualize and store brick data
# geometries = []
# for brick in bricks:
#     geometries.append(brick.draw())
# ---------- end brick_wall_3 ----------
compas_draw = COMPASDraw(cg=brick_wall.geometries)  # -> rg
#   port cg: The COMPAS geometry or datastructure to be drawn.
#   port rg: The Rhino geometry object.
# ---------- compas_draw: Python ----------
# r: compas>=2.14.1
"""
Draws COMPAS geometry in Grasshopper.
"""

from typing import Any

import Grasshopper

from compas.scene import SceneObject


class CompasToRhinoGeometry(Grasshopper.Kernel.GH_ScriptInstance):
    def RunScript(self, cg):
        if not cg:
            return None

        return SceneObject(item=cg).draw()
# ---------- end compas_draw ----------
compas_draw_2 = COMPASDraw(cg=brick_wall.frames)  # -> rg; same code as compas_draw
compas_draw_3 = COMPASDraw(cg=brick_wall_2.geometries)  # -> rg; same code as compas_draw
compas_draw_4 = COMPASDraw(cg=brick_wall_2.frames)  # -> rg; same code as compas_draw
compas_draw_5 = COMPASDraw(cg=brick_wall_3.geometries)  # -> rg; same code as compas_draw
compas_draw_6 = COMPASDraw(cg=brick_wall_3.frames)  # -> rg; same code as compas_draw

# ----
# Measure work object
point = ValueList({"origin", "xaxis", "xypoint"}, selected="xaxis")
capture = Button()
capture_wobj = CaptureWobj(robot_ip="192.168.10.10", point_name=point, capture=capture)  # -> wobj_origin, wobj_xaxis, wobj_xypoint, info
# ---------- capture_wobj: Python ----------
"""
Capture the 3 points that define the work object (robot base) plane.

Jog the TCP to a point, pick its name (origin / xaxis / xypoint) and press capture.
The TCP position (robot base frame, mm) is saved to wobj_calibration.json next to
this .ghx file, so the points survive closing Grasshopper.
"""
import os
import sys
import json
import time

import scriptcontext as sc
import Rhino.Geometry as rg

NAMES = ["origin", "xaxis", "xypoint"]

gh_dir = os.path.dirname(ghenv.Component.OnPingDocument().FilePath)
src_dir = os.path.join(gh_dir, "src")
if src_dir not in sys.path:
    sys.path.append(src_dir)
import simple_comm as com

path = os.path.join(gh_dir, "wobj_calibration.json")

data = {}
if os.path.exists(path):
    with open(path) as f:
        data = json.load(f)

# keep the last status in sticky, so the message survives the button being released
status_key = "capture_status_" + str(ghenv.Component.InstanceGuid)

if capture:
    if point_name not in NAMES:
        sc.sticky[status_key] = "pick origin / xaxis / xypoint"
    else:
        try:
            x, y, z = list(com.listen_to_robot(robot_ip)["pose"])[:3]  # metres, robot base frame
            data[point_name] = [round(x * 1000, 2), round(y * 1000, 2), round(z * 1000, 2)]  # -> mm
            with open(path, "w") as f:
                json.dump(data, f, indent=2)
            sc.sticky[status_key] = "{} captured {}".format(point_name, time.strftime("%H:%M:%S"))
        except Exception as e:
            print(e)
            sc.sticky[status_key] = "robot not reachable"

ghenv.Component.Message = sc.sticky.get(status_key, "")

def pt(name):
    return rg.Point3d(*data[name]) if name in data else None

wobj_origin, wobj_xaxis, wobj_xypoint = pt("origin"), pt("xaxis"), pt("xypoint")
info = json.dumps(data, indent=2)
# ---------- end capture_wobj ----------
wobj_calibration = Panel(capture_wobj.info)

fine_adjust_z_mm = Slider(5, range=-5..10)
# Transform from Rhino to Robot Space
transform = Python3Script(
    way_planes=brick_wall.frames,
    wobj_origin=capture_wobj.wobj_origin,
    wobj_xaxis=capture_wobj.wobj_xaxis,
    wobj_xypoint=capture_wobj.wobj_xypoint,
    z_safe_margin=fine_adjust_z_mm)  # -> out, transformed_frames; inputs way_planes: list, wobj_origin: Point3d, wobj_xaxis: Point3d, wobj_xypoint: Point3d, z_safe_margin: Double
# ---------- transform: Python ----------
from compas.geometry import Frame, Transformation, Translation, Vector
#in this step we transform our way planes to robot space
#the rhino co-ordinate system is rather abstract in the physical world
#the robot base plane assumed the base frame of robot is the origin
#but rhino does not know that
#thus we transform things from our design space(Rhino World XY) to Robot Base Plane that we measure

def set_robot_base(origin, xaxis, xypoint):
    """
    set a base plane representing the robot working object plane
    """
    robot_base = Frame(origin, xaxis - origin, xypoint - origin)
    print (robot_base)
    return (robot_base)

def rhino_to_robot_space(rhino_plane,robot_base_plane):
    """
    Transform the objects from Rhino world XY plane to robot work object plane
    """
    T_matrix = Transformation.from_frame_to_frame(Frame.worldXY(), robot_base_plane)
    robot_plane = rhino_plane.transformed(T_matrix)
    return robot_plane

def set_z_safe_margin(planes_to_adjust, safety_margin):
    adjusted = []
    T = Translation.from_vector(Vector(0, 0, safety_margin))
    for f in planes_to_adjust:
        adjusted.append(f.transformed(T))
    return adjusted

# ===== Robot base is set =====
robot_base =  set_robot_base(wobj_origin, wobj_xaxis, wobj_xypoint)

# ===== Set safety margin for Z height ======
safe_planes = set_z_safe_margin(way_planes, z_safe_margin)


# ===== Transforming the rhino planes into robot planes =====
transformed_frames = []
for plane in safe_planes: 
    transformed_frames.append(rhino_to_robot_space(plane, robot_base))
# ---------- end transform ----------

# ----
# Measure pick up location
point_2 = ValueList({"origin", "xaxis", "xypoint"}, selected="xypoint")
capture_2 = Button()
capture_pick = CapturePick(robot_ip="192.168.10.10", point_name=point_2, capture=capture_2)  # -> origin, xaxis_pt, xy_pt, info
# ---------- capture_pick: Python ----------
"""
Capture the 3 points that define the pick frame at the brick pick-up location.

Jog the TCP to a point, pick its name (origin / xaxis / xypoint) and press capture.
The TCP position (robot base frame, mm) is saved to pick_calibration.json next to
this .ghx file, so the points survive closing Grasshopper.
"""
import os
import sys
import json
import time

import scriptcontext as sc
import Rhino.Geometry as rg

NAMES = ["origin", "xaxis", "xypoint"]

gh_dir = os.path.dirname(ghenv.Component.OnPingDocument().FilePath)
src_dir = os.path.join(gh_dir, "src")
if src_dir not in sys.path:
    sys.path.append(src_dir)
import simple_comm as com

path = os.path.join(gh_dir, "pick_calibration.json")

data = {}
if os.path.exists(path):
    with open(path) as f:
        data = json.load(f)

# keep the last status in sticky, so the message survives the button being released
status_key = "capture_status_" + str(ghenv.Component.InstanceGuid)

if capture:
    if point_name not in NAMES:
        sc.sticky[status_key] = "pick origin / xaxis / xypoint"
    else:
        try:
            x, y, z = list(com.listen_to_robot(robot_ip)["pose"])[:3]  # metres, robot base frame
            data[point_name] = [round(x * 1000, 2), round(y * 1000, 2), round(z * 1000, 2)]  # -> mm
            with open(path, "w") as f:
                json.dump(data, f, indent=2)
            sc.sticky[status_key] = "{} captured {}".format(point_name, time.strftime("%H:%M:%S"))
        except Exception as e:
            print(e)
            sc.sticky[status_key] = "robot not reachable"

ghenv.Component.Message = sc.sticky.get(status_key, "")

def pt(name):
    return rg.Point3d(*data[name]) if name in data else None

origin, xaxis_pt, xy_pt = pt("origin"), pt("xaxis"), pt("xypoint")
info = json.dumps(data, indent=2)
# ---------- end capture_pick ----------
pick_calibration = Panel(capture_pick.info)
py3 = Python3Script(origin=capture_pick.origin, xaxis_pt=capture_pick.xaxis_pt, xy_pt=capture_pick.xy_pt)  # -> out, pick_frame; inputs origin: Point3d, xaxis_pt: Point3d, xy_pt: Point3d
# ---------- py3: Python ----------
from compas.geometry import Frame, Point
from compas.geometry import Rotation

from compas_rhino.conversions import point_to_compas

origin = point_to_compas(origin)
xaxis_pt = point_to_compas(xaxis_pt)
xy_pt = point_to_compas(xy_pt)

#define pick frame
pick_frame = Frame(origin, xaxis_pt - origin, xy_pt - origin)
if pick_frame.zaxis.z>0:
    pick_frame.xaxis = -pick_frame.xaxis
# ---------- end py3 ----------
compas_draw_7 = COMPASDraw(cg=py3.pick_frame)  # -> rg; same code as compas_draw

compas_draw_8 = COMPASDraw(cg=transform.transformed_frames)  # -> rg; same code as compas_draw

# ----
# Measure and set TCP
panel = Panel("-39.58")
pt = ConstructPoint(XCoordinate=panel, YCoordinate="-8.86", ZCoordinate="84.2")

number_slider = Slider(0.4, range=0..2)
number_slider_2 = Slider(0.4, range=0..2)
# Convert Planes to URScript
compas = Python3Script(
    way_frames=transform.transformed_frames,
    tcp_measured=pt,
    acceleration=number_slider,
    velocity=number_slider_2,
    pick_frame=py3.pick_frame)  # -> out, vis_frames, vis_planes, script; inputs way_frames: list, tcp_measured: Point3d, acceleration: Double, velocity: Double
# ---------- compas: Python ----------
from imp import reload
import sys
import os

#get current file path
path = ghenv.Component.OnPingDocument().FilePath
#get parent directory of the parent directory
parentdir = os.path.dirname(path)
#get src folder which contains classes
dire = os.path.join(parentdir,'src')

sys.path.append(dire)

import simple_ur_script as ur
reload(ur)

import utils 
reload(utils)

import simple_comm as com
reload(com)

import compas.geometry as cg
import math as m

# ===== Set global constants =======

IO = 0 # Global constant
SAFE_DIST = 50

# =================================

def safety_plane(plane, distance):
    lifted = plane.copy()
    # move in world Z to lift it
    T = cg.Translation.from_vector(-plane.normal * distance) #cg.Vector.Zaxis() #-plane.normal
    # apply transformation
    lifted.transform(T)
    return lifted

script = "" #create empty string

def pickup_brick(script,pick_up_frame, accel, vel):
    frames = []
    above_brick = safety_plane(pick_up_frame, SAFE_DIST)
    # Translate frame to "safe" location

    # Move to safe frame

    # Move to pick location

    # Activate gripper

    # Move back to safe plane
    script += (ur.move_l(above_brick, accel, vel))
    script += (ur.move_l(pick_up_frame, accel, vel))
    script += ur.set_digital_out(IO, True)
    script += (ur.move_l(above_brick, accel, vel))

    frames = [above_brick, pick_up_frame, above_brick]

    return script, frames


def place_brick(script, place_frame, accel, vel):
    frames = []
    approach = safety_plane(place_frame, SAFE_DIST)
    script += (ur.move_l(approach, acceleration, velocity))
    script += (ur.move_l(place_frame, acceleration, velocity))
    script += ur.set_digital_out(IO, False)
    script += ur.sleep(1.0)
    script += (ur.move_l(approach, acceleration, velocity))
    frames = [approach, place_frame, approach]

    # Safe frame for placing

    # Add to the path: go to the safe plane

    # Add to the path: go to the place plane
    
    # Add to the path: turn off the vacuum and wait 1 second (hold the brick)
    
    # Add to the path: go back to the safe plane
    
    return script,frames


#if value given for tcp measured, then add line to script, otherwise it will take current tcp from robot
if tcp_measured is not None:
    script += ur.set_tcp_by_angles(tcp_measured.X, tcp_measured.Y, tcp_measured.Z, m.radians(0.0),m.radians(0.0),m.radians(0))


vis_frames = []
# Generate pick and place sequence

for i in range(len(way_frames)):
    script, pick_up_planes = pickup_brick(script, pick_frame, acceleration, velocity)
    # script += pick_script
    vis_frames.extend(pick_up_planes)

    script, place_planes = place_brick(script,way_frames[i], acceleration,velocity)
    # script += place_script
    vis_frames.extend(place_planes)

 


# Format the script to make it sendable
script = com.concatenate_script(script)


# Visualize
from compas_rhino import conversions
import Rhino.Geometry as rg

vis_planes = [conversions.frame_to_rhino(frame) for frame in vis_frames]
# ---------- end compas ----------
compas_draw_9 = COMPASDraw(cg=compas.vis_frames)  # -> rg; disabled; same code as compas_draw
points = PointList(Points=compas.vis_planes, Size=Slider(7, range=0..100))
panel_2 = Panel(compas.script)

# ---- group: Send UR script to Robot!
# Send to Robot!
py3_2 = Python3Script(script=compas.script, ip_address="192.168.10.10", send=Button())  # -> out, a; inputs script: String, ip_address: String, send: Boolean
# ---------- py3_2: Python ----------
import simple_comm as com

if send:
    com.send_script(script,ip_address)
# ---------- end py3_2 ----------
