# Grasshopper definition brick_to_robot_1015_weijiun.gh (Grasshopper 1.0.8)
# plug-ins: Moonlight, Bifocals

moonlight = Moonlight(Mode=False)

# ---- group: This is needed only ONCE in the GH definition
enable_auto_reload = Python3Script()  # -> ok
# ---------- enable_auto_reload: Python ----------
"""
------------------------------
Using VS Code as Python editor
------------------------------

The simplest way to start using VS Code as our editor, is
to place our Python code in files located IN THE SAME FOLDER as our Grasshopper file.

After we have done that, we need 2 steps: 

1. Enable the COMPAS reloader on one component. This tells Grasshopper to watch for changes in the Pythoh files and reload if changed.
2. Every other component that uses Python code from external files needs to start with a method to ensure Grasshopper knows where to load the files from.

"""
# r: compas
# venv: mas-2627

from compas_rhino.devtools import DevTools
DevTools.enable_reloader()
# ---------- end enable_auto_reload ----------

# ----
number_slider = Slider(30, range=0..100)  # disabled
number_slider_2 = Slider(10, range=0..10)  # disabled
number_slider_3 = Slider(2, range=0..10)  # disabled
number_slider_4 = Slider(15, range=0..100)  # disabled
number_slider_5 = Slider(32, range=0..100)  # disabled
python_3_script = Python3Script(x=number_slider_3, z=number_slider, w=number_slider_4, h=number_slider_2, l=number_slider_5)  # -> bricks, frames; inputs x: Int32, z: Int32, w: Double, h: Double, l: Double; disabled
# ---------- python_3_script: Python ----------
import Rhino.Geometry as rg
import math as m
from compas.geometry import Box, Frame, Point, Vector

bricks = []
frames = []
gap = 1  # Define your mortar gap thickness here

for k in range(z):
    # Calculate the row's shared center (including the gaps)
    total_row_width = x * w + (x - 1) * gap
    row_center_x = total_row_width / 2.0
    row_center_z = k * h
    row_centroid = Point(row_center_x, 0, row_center_z)
    
    # Calculate rotation angle
    t = k / (z - 1) if z > 1 else 0
    a = t * m.tau
    axis = Vector(0, 0, 1)

    for i in range(x):
        # Shift brick centers outward by the gap amount
        brick_center_x = (i * (w + gap)) + (w / 2.0)
        pt = Point(brick_center_x, 0, k * (h))
        
        f = Frame(pt,[1, 0, 0], [0, -1, 0])
        # Shrink the box width slightly so the physical gap appears
        box = Box(w - gap, l, h, f)
        box.rotate(a, axis, row_centroid)
        f.rotate(a, axis, row_centroid)

        bricks.append(box)
        frames.append(f)
# ---------- end python_3_script ----------
compas_draw = COMPASDraw(cg=python_3_script.bricks)  # -> rg; disabled
#   port cg: The COMPAS geometry or datastructure to be drawn.
#   port rg: The Rhino geometry object.
# ---------- compas_draw: Python ----------
# r: compas>=2.14.1
"""
Draws COMPAS geometry in Grasshopper.
"""

from typing import Any

import Grasshopper

from compas.scene import SceneObject


class CompasToRhinoGeometry(Grasshopper.Kernel.GH_ScriptInstance):
    def RunScript(self, cg):
        if not cg:
            return None

        return SceneObject(item=cg).draw()
# ---------- end compas_draw ----------
preview = CustomPreview(
    Geometry=compas_draw,
    Material={diffuse=RGB(197, 130, 64), emission=RGB(68, 53, 68), shine=0.5, specular=RGB(255, 254, 254), transparency=0})  # disabled

python_3_script_2 = Python3Script(
    x=Slider(2, range=0..10),
    z=Slider(30, range=0..100),
    w=Slider(15, range=0..100),
    h=Slider(10, range=0..10),
    l=Slider(32, range=0..100))  # -> bricks, frames; inputs x: Int32, z: Int32, w: Double, h: Double, l: Double; same code as python_3_script
compas_draw_2 = COMPASDraw(cg=python_3_script_2.bricks)  # -> rg; same code as compas_draw
preview_2 = CustomPreview(
    Geometry=compas_draw_2,
    Material={diffuse=RGB(197, 130, 64), emission=RGB(68, 53, 68), shine=0.5, specular=RGB(255, 254, 254), transparency=0})

# ---- group: This is needed only ONCE in the GH definition
enable_auto_reload_2 = Python3Script()  # -> ok; same code as enable_auto_reload

# ----
python_3_script_3 = Python3Script(
    x=Slider(4, range=0..10),
    z=Slider(30, range=0..100),
    w=Slider(15, range=0..100),
    h=Slider(10, range=0..10),
    l=Slider(32, range=0..100))  # -> bricks, frames; inputs x: Int32, z: Int32, w: Double, h: Double, l: Double
# ---------- python_3_script_3: Python ----------
import Rhino.Geometry as rg
import math as m
from compas.geometry import Box, Frame, Point, Vector

bricks = []
frames = []
gap = 2  # Define your mortar gap thickness here

for k in range(z):
    # Calculate the row's shared center (including the gaps)
    total_row_width = x * w + (x - 1) * gap
    row_center_x = total_row_width / 2.0
    row_center_z = k * h
    row_centroid = Point(row_center_x, 0, row_center_z)
    
    # Calculate rotation angle
    t = k / (z - 1) if z > 1 else 0
    a = t * m.tau
    axis = Vector(0, 0, 1)

    for i in range(x):
        # Shift brick centers outward by the gap amount
        brick_center_x = (i * (w + gap)) + (w / 2.0)
        pt = Point(brick_center_x, 0, k * (h))
        
        f = Frame(pt,[1, 0, 0], [0, -1, 0])
        # Shrink the box width slightly so the physical gap appears
        box = Box(w - gap, l, h, f)
        box.rotate(a, axis, row_centroid)
        f.rotate(a, axis, row_centroid)
        f.rotate(m.radians(90), f.zaxis, f.point)

        bricks.append(box)
        frames.append(f)
# ---------- end python_3_script_3 ----------
compas_draw_3 = COMPASDraw(cg=python_3_script_3.bricks)  # -> rg; same code as compas_draw
compas_draw_4 = COMPASDraw(cg=python_3_script_3.frames)  # -> rg; same code as compas_draw
preview_3 = CustomPreview(
    Geometry=compas_draw_3,
    Material={diffuse=RGB(197, 130, 64), emission=RGB(68, 53, 68), shine=0.5, specular=RGB(255, 254, 254), transparency=0})

lamcp_bridge = LAMCPBridge(enable=Toggle(True))  # -> status; inputs enable: Boolean, port: Int32
#   port enable: Toggle to start (True) or stop (False) the local HTTP server.
#   port port: Port to listen on (loopback only). Defaults to 8765.
#   port status: Current server status string.
# ---------- lamcp_bridge: Python ----------
"""
LAMCP Bridge: local HTTP server inside Rhino 8 / Grasshopper CPython.

Exposes `POST /exec` (JSON: `{"code": "...", "timeout": 30}`) which
exec()s `code` and returns
`{"stdout": "...", "stderr": "...", "result": "...", "error": null|str}`.

Pair with the `lamcp` FastMCP server, which translates Claude's
`run_python_script` MCP tool calls into POSTs to this endpoint.

Binds to 127.0.0.1 only. NEVER expose beyond localhost â€” it exec()s
arbitrary Python with full Rhino API access.

LAMCP v0.1.0
"""

import contextlib
import io
import json
import threading
import traceback
from http.server import BaseHTTPRequestHandler
from http.server import HTTPServer

import Grasshopper
import scriptcontext as sc


SHARED_GLOBALS_KEY = "_lamcp_bridge_globals"
SERVER_KEY = "_lamcp_bridge_server"


def _exec_code(code, timeout):
    """Run `code` on the HTTP-server thread and capture stdout/stderr/result.

    NOTE: this is intentionally NOT marshalled to Rhino's UI thread for the
    spike â€” `Rhino.RhinoApp.InvokeOnUiThread` was queueing actions that
    never fired in Rhino 8 CPython. Most read-only RhinoCommon access is
    safe cross-thread; mutations may crash. Add Eto-based marshalling
    back here when we need it.
    """
    out = io.StringIO()
    err = io.StringIO()
    g = sc.sticky.setdefault(SHARED_GLOBALS_KEY, {"__name__": "__lamcp_bridge__"})
    error_text = None
    result_repr = None
    try:
        with contextlib.redirect_stdout(out), contextlib.redirect_stderr(err):
            exec(code, g, g)
            result_repr = repr(g.get("_"))
    except BaseException:
        error_text = traceback.format_exc()

    return {
        "stdout": out.getvalue(),
        "stderr": err.getvalue(),
        "result": result_repr,
        "error": error_text,
    }


class _ExecHandler(BaseHTTPRequestHandler):
    # Silence default request logging so it doesn't clog the Rhino command line.
    def log_message(self, fmt, *args):
        pass

    def _send(self, code, payload):
        body = json.dumps(payload).encode("utf-8")
        self.send_response(code)
        self.send_header("Content-Type", "application/json")
        self.send_header("Content-Length", str(len(body)))
        self.end_headers()
        self.wfile.write(body)

    def do_GET(self):
        if self.path == "/health":
            self._send(200, {"status": "ok"})
        else:
            self._send(404, {"error": "not found"})

    def do_POST(self):
        if self.path != "/exec":
            self._send(404, {"error": "not found"})
            return
        length = int(self.headers.get("Content-Length", "0"))
        try:
            raw = self.rfile.read(length).decode("utf-8")
            body = json.loads(raw)
            code = body.get("code", "")
            timeout = float(body.get("timeout", 30.0))
        except Exception as exc:
            self._send(400, {"error": "bad request: " + repr(exc)})
            return
        result = _exec_code(code, timeout)
        self._send(200, result)


def _start_server(port):
    server = HTTPServer(("127.0.0.1", port), _ExecHandler)
    thread = threading.Thread(
        target=server.serve_forever, daemon=True, name="lamcp-bridge"
    )
    thread.start()
    return {"server": server, "thread": thread, "port": port}


def _stop_server(state):
    try:
        state["server"].shutdown()
        state["server"].server_close()
    except Exception:
        pass


class LamcpBridgeComponent(Grasshopper.Kernel.GH_ScriptInstance):
    def RunScript(self, enable: bool, port: int):
        port = int(port) if port else 8765

        state = sc.sticky.get(SERVER_KEY)

        if not enable:
            if state is not None:
                _stop_server(state)
                del sc.sticky[SERVER_KEY]
            return "stopped"

        # Already running on the requested port: no-op.
        if (
            state is not None
            and state.get("port") == port
            and state["thread"].is_alive()
        ):
            return "listening on http://127.0.0.1:{}".format(port)

        # Port changed or server died: tear down and restart.
        if state is not None:
            _stop_server(state)
            del sc.sticky[SERVER_KEY]

        try:
            sc.sticky[SERVER_KEY] = _start_server(port)
        except OSError as exc:
            ghenv.Component.AddRuntimeMessage(  # noqa: F821
                Grasshopper.Kernel.GH_RuntimeMessageLevel.Error,
                "Failed to bind 127.0.0.1:{}: {}".format(port, exc),
            )
            return "error: {}".format(exc)

        return "listening on http://127.0.0.1:{}".format(port)
# ---------- end lamcp_bridge ----------
panel = Panel(lamcp_bridge)

number_slider_6 = Slider(20, range=0..30)  # disabled
# Generate Geometry
reference_curve = Curve(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)  # disabled
gap = Slider(5, range=0..10)  # disabled
brick_wall = Python3Script(crv=reference_curve, num_layers=number_slider_6, gap=gap)  # -> bricks, geometries, frames; inputs crv: Curve, num_layers: Int32, gap: Double; disabled
# ---------- brick_wall: Python ----------
# r: compas
# venv: mas-2627
from compas_rhino.devtools import DevTools
DevTools.ensure_path()

# 0. Import everything we will need
import math
from compas.geometry import Box
from compas.geometry import Point
from compas.geometry import Frame
from compas_rhino.conversions import curve_to_compas
from compas_rhino.conversions import curve_to_rhino
from compas.geometry import cross_vectors


# ..also import our module "brick_wall.py", that needs to be in the same folder as our GH file
from brick_wall import Brick

# 1. Start with an empty list of bricks to be created

bricks = []

# 2. Create points on curve curve

# convert the curve to a compas geometry

compas_crv = curve_to_compas(crv)

# divide the curve by the points

length = (Brick.LENGTH + gap)/2
params, points = compas_crv.divide_by_length(length, True) # unpack the list 


for i in range(num_layers):
    for j, (param, pt) in enumerate(zip(params, points)):

        if i % 2 == j % 2:

            tangent = compas_crv.tangent_at(param)
            normal = cross_vectors(tangent, [0,0,1])
            pt.z = i * Brick.HEIGHT + Brick.HEIGHT/2
            f = Frame(pt, xaxis = tangent , yaxis = normal)
            my_brick = Brick(f)
            bricks.append(my_brick)


# Visualize and store brick data

geometries =[]
frames = []

for brick in bricks:

    geometries.append(brick.draw())
    frames.append(brick.get_pick_frame())

# list comprehension

geometries = [brick.draw() for brick in bricks]
frames = [brick.get_pick_frame() for brick in bricks]
# ---------- end brick_wall ----------
compas_draw_5 = COMPASDraw(cg=brick_wall.geometries)  # -> rg; disabled; same code as compas_draw

# ----
# Generate Geometry
reference_curve_2 = Curve(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)
gap_2 = Slider(5, range=0..10)
brick_wall_2 = Python3Script(crv=reference_curve_2, num_layers=Slider(20, range=0..30), gap=gap_2)  # -> bricks, geometries, frames; inputs crv: Curve, num_layers: Int32, gap: Double; same code as brick_wall
compas_draw_6 = COMPASDraw(cg=brick_wall_2.geometries)  # -> rg; same code as compas_draw

number_slider_7 = Slider(9, range=0..100)  # disabled
number_slider_8 = Slider(12, range=0..100)  # disabled
number_slider_9 = Slider(32, range=0..100)  # disabled
number_slider_10 = Slider(15, range=0..100)  # disabled
number_slider_11 = Slider(10, range=0..10)  # disabled
python_3_script_4 = Python3Script(n=number_slider_7, z=number_slider_8, l=number_slider_9, b=number_slider_10, h=number_slider_11)  # -> points, bricks, frame; inputs n: Int32, z: Int32, l: Double, b: Double, h: Double; disabled
# ---------- python_3_script_4: Python ----------
from compas.geometry import Point, Frame, Box
import math as m
from compas_rhino.conversions import box_to_rhino

points = []
bricks = []
frame = []
angle_step = m.tau / n
r = 50

for k in range(z):
    for i in range(n):

        if k%2 == 0:
            angle = angle_step * i

        else:
            angle = (i * angle_step) + angle_step/2

        x = r * m.cos(angle)
        y = r * m.sin(angle)
        z = k *h

        pt = Point(x,y,z)
        points.append(pt)

                # Calculate local orientation vectors so bricks curve with the cylinder
        xaxis = [m.cos(angle + m.pi/2), m.sin(angle + m.pi/2), 0] # Tangent to ring
        yaxis = [m.cos(angle), m.sin(angle), 0]                  # Radial from center
        
        f = Frame(pt, xaxis, yaxis) # Create oriented frame at the point
        brick = Box(l, b, h, f)      # Brick using your GH l, b, h slider variables
        
        # Convert directly to Rhino geometry and append to flat lists
        brick_rhino = box_to_rhino(brick)
        bricks.append(brick_rhino)
        points.append(pt)

        frame.append(f)
# ---------- end python_3_script_4 ----------
preview_4 = CustomPreview(
    Geometry=python_3_script_4.bricks,
    Material={diffuse=RGB(197, 130, 64), emission=RGB(68, 53, 68), shine=0.5, specular=RGB(255, 254, 254), transparency=0})  # disabled

python_3_script_5 = Python3Script(
    n=Slider(9, range=0..100),
    z=Slider(12, range=0..100),
    l=Slider(32, range=0..100),
    b=Slider(15, range=0..100),
    h=Slider(10, range=0..10))  # -> points, bricks, frame; inputs n: Int32, z: Int32, l: Double, b: Double, h: Double; same code as python_3_script_4
preview_5 = CustomPreview(
    Geometry=python_3_script_5.bricks,
    Material={diffuse=RGB(197, 130, 64), emission=RGB(68, 53, 68), shine=0.5, specular=RGB(255, 254, 254), transparency=0})

# ---- group: frame -> plane (preview)
frame_to_plane = Python3Script(frames=python_3_script.frames)  # -> planes; inputs frames: list; disabled
# ---------- frame_to_plane: Python ----------
"""
Convert COMPAS Frames to Rhino Planes for preview.
    Input:  frames (List Access, No Type Hint)
    Output: planes
"""
import Rhino.Geometry as rg
from compas.geometry import Frame
from compas_rhino.conversions import frame_to_rhino_plane


def to_plane(item):
    if item is None:
        return None
    if isinstance(item, rg.Plane):
        return item
    if isinstance(item, Frame):
        return frame_to_rhino_plane(item)
    raise TypeError("Not a COMPAS Frame: {}".format(type(item)))


def flatten(items):
    for item in items:
        if isinstance(item, (list, tuple)):
            for sub in flatten(item):
                yield sub
        else:
            yield item


planes = [to_plane(f) for f in flatten(frames or [])]
ghenv.Component.Message = "{} planes".format(len(planes))
# ---------- end frame_to_plane ----------

frame_to_plane_2 = Python3Script(frames=python_3_script_2.frames)  # -> planes; inputs frames: list; same code as frame_to_plane

# ----
panel_2 = Panel("13.76")
panel_3 = Panel("14.02")
panel_4 = Panel("116.76")

# ----
# BRICK DEPOT
number_slider_12 = Slider(2, range=-20..20)
xypoint = Panel("""-62.52,
367.39,
-4.51""")
origin = Panel("""90.32,
367.78,
-4.14""")
xaxis = Panel("""90.04,
521.78,
-4.83""")
python_3_script_6 = Python3Script(
    pickup_base_origin=origin,
    n_z=Slider(4, range=0..10),
    tol_x=Slider(-0.5, range=-20..20),
    tol_y=Slider(-0.5, range=-20..20),
    tol_z=number_slider_12)  # -> out, frames, points, depot_frame; inputs pickup_base_origin: Point3d, n_z: Int32
# ---------- python_3_script_6: Python ----------
from compas.geometry import Point, Frame, Vector
from compas.geometry import Polygon
from compas_rhino.conversions import point_to_compas
import math as m

# convert the origin point of pickup base to a compas point
ref_pt = point_to_compas(pickup_base_origin)  

frames = [] # empty list for frames w.r.t origin
points = [] # empty list for grid of points w.r.t origin

# brick dimensions
l = 32
w = 15
h = 10

# frame offsets w.r.t the pickup base
offset_x = 17.5 + tol_x
offset_y = 27.5 + tol_y
offset_z = 4 + tol_z

# Depot size
n_x = 3
n_y = 5

#  Loop through Z from top layer down to the bottom layer
for k in reversed(range(n_z)):
    for j in range(n_y):
        for i in range(n_x):

            # Calculate coordinates relative to the original reference point
            x = ref_pt.x - j*30 - offset_x
            y = ref_pt.y + i*50 + offset_y
            z = ref_pt.z + k*12 + offset_z
            
            # Create the grid point and frame
            grid_pt = Point(x, y, z)
            
            # Keeps X normal, flips Y, which forces the Z-axis to point downwards
            f = Frame(grid_pt, [-1, 0, 0], [0, 1, 0])
            # Custom rotation wrt the T.C.P
            f = f.rotated(m.radians(90), axis=f.zaxis, point=f.point)
            
            frames.append(f)
            points.append(grid_pt)


# Dump frames to dump the depot frame. We will create this frame after every 15 points

centroid_frame = frames[7].copy()
centroid_frame.point.z += 12/2
centroid_frame.rotate(m.radians(90), centroid_frame.zaxis, centroid_frame.point)

for i in range(n_z):
#      Copy the centroid frame as dump frame
    dump_frame = centroid_frame.copy()
    dump_frame.point.z -= (12) * (i)   
     # Calculate the exact insertion index
    insert_index = ((i) * 15) + i   
    frames.insert(insert_index, dump_frame)

# for i in range(n_z-1):
# #      Copy the centroid frame as dump frame
#     dump_frame = centroid_frame.copy()
#     dump_frame.point.z -= (12) * (i+1)   
#      # Calculate the exact insertion index
#     insert_index = ((i+1) * 15) + i   
#     frames.insert(insert_index, dump_frame)



 # 3. Re-generate the points list to keep it synchronized with the new frames
points = [f.point for f in frames]
# ---------- end python_3_script_6 ----------
python_3_script_7 = Python3Script(Origin=origin, Xaxis=xaxis, XYpoint=xypoint)  # -> out, Rectangle; inputs Origin: Point3d, Xaxis: Point3d, XYpoint: Point3d
# ---------- python_3_script_7: Python ----------
import Rhino.Geometry as rg

# Create plane from origin and axis vectors
plane = rg.Plane(Origin, Xaxis - Origin, XYpoint - Origin)

# Calculate distances (width and height)
x_size = Origin.DistanceTo(Xaxis)
y_size = Origin.DistanceTo(XYpoint)

# Output the rectangle as a curve to 'Rectangle'
Rectangle = rg.Rectangle3d(plane, x_size, y_size).ToNurbsCurve()
# ---------- end python_3_script_7 ----------
compas_draw_7 = COMPASDraw(cg=python_3_script_6.points)  # -> rg; same code as compas_draw
points = PointList(Points=compas_draw_7, Size=Slider(4, range=0..10))

# ----
# TCP 1
panel_5 = Panel("12.54")
pt = ConstructPoint(XCoordinate=panel_5, YCoordinate="12.48", ZCoordinate="116.01")

# ----
# ROBOT TABLE
fine_adjust_z_mm = Slider(8, range=-5..500)
xaxis_2 = Panel("""535.83,
513.91,
-12.43""")
origin_2 = Panel("""535.77,
-80.72,
-11.6""")
xypoint_2 = Panel("""229.24,
-79.84,
-11.39""")
transform = Python3Script(
    way_planes=python_3_script_3.frames,
    wobj_origin=origin_2,
    wobj_xaxis=xaxis_2,
    wobj_xypoint=xypoint_2,
    z_safe_margin=fine_adjust_z_mm)  # -> out, flatten(transformed_frames); inputs way_planes: list, wobj_origin: Point3d, wobj_xaxis: Point3d, wobj_xypoint: Point3d, z_safe_margin: Double
# ---------- transform: Python ----------
from compas.geometry import Frame, Transformation, Translation, Vector
#in this step we transform our way planes to robot space
#the rhino co-ordinate system is rather abstract in the physical world
#the robot base plane assumed the base frame of robot is the origin
#but rhino does not know that
#thus we transform things from our design space(Rhino World XY) to Robot Base Plane that we measure

def set_robot_base(origin, xaxis, xypoint):
    """
    set a base plane representing the robot working object plane
    """
     # 1. Extracted the vectors from the corner origin
    vec_x =  xaxis - origin
    vec_y =  xypoint - origin
    
    # 2. Calculated the center point (halfway along X and Y)
    center_origin = origin + vec_x * 0.5 + vec_y * 0.5

    robot_base = Frame(center_origin, vec_x, vec_y)
    print (robot_base)
    return (robot_base)

def rhino_to_robot_space(rhino_plane,robot_base_plane):

    """
    Transform the objects from Rhino world XY plane to robot work object plane
    """
    T_matrix = Transformation.from_frame_to_frame(Frame.worldXY(), robot_base_plane)
    robot_plane = rhino_plane.transformed(T_matrix)
    return robot_plane

def set_z_safe_margin(planes_to_adjust, safety_margin):
    adjusted = []
    T = Translation.from_vector(Vector(0, 0, safety_margin))
    for f in planes_to_adjust:
        adjusted.append(f.transformed(T))
    return adjusted

# ===== Robot base is set =====
robot_base =  set_robot_base(wobj_origin, wobj_xaxis, wobj_xypoint)

# ===== Set safety margin for Z height ======
safe_planes = set_z_safe_margin(way_planes, z_safe_margin)


# ===== Transforming the rhino planes into robot planes =====
transformed_frames = []
for plane in safe_planes: 
    transformed_frames.append(rhino_to_robot_space(plane, robot_base))
# ---------- end transform ----------
compas_draw_8 = COMPASDraw(cg=transform.transformed_frames)  # -> rg; same code as compas_draw

# ----
# Measure robo base
point = ValueList({"origin", "xaxis", "xypoint"}, selected="xypoint")  # disabled
capture = Button()  # disabled
panel_6 = Panel("192.168.10.10")  # disabled
capture_wobj = CaptureWobj(robot_ip=panel_6, point_name=point, capture=capture)  # -> wobj_origin, wobj_xaxis, wobj_xypoint, info; disabled
# ---------- capture_wobj: Python ----------
"""
Capture the 3 points that define the work object (robot base) plane.

Jog the TCP to a point, pick its name (origin / xaxis / xypoint) and press capture.
The TCP position (robot base frame, mm) is saved to wobj_calibration.json next to
this .ghx file, so the points survive closing Grasshopper.
"""
import os
import sys
import json
import time

import scriptcontext as sc
import Rhino.Geometry as rg

NAMES = ["origin", "xaxis", "xypoint"]

gh_dir = os.path.dirname(ghenv.Component.OnPingDocument().FilePath)
src_dir = os.path.join(gh_dir, "src")
if src_dir not in sys.path:
    sys.path.append(src_dir)
import simple_comm as com

path = os.path.join(gh_dir, "wobj_calibration.json")

data = {}
if os.path.exists(path):
    with open(path) as f:
        data = json.load(f)

# keep the last status in sticky, so the message survives the button being released
status_key = "capture_status_" + str(ghenv.Component.InstanceGuid)

if capture:
    if point_name not in NAMES:
        sc.sticky[status_key] = "pick origin / xaxis / xypoint"
    else:
        try:
            x, y, z = list(com.listen_to_robot(robot_ip)["pose"])[:3]  # metres, robot base frame
            data[point_name] = [round(x * 1000, 2), round(y * 1000, 2), round(z * 1000, 2)]  # -> mm
            with open(path, "w") as f:
                json.dump(data, f, indent=2)
            sc.sticky[status_key] = "{} captured {}".format(point_name, time.strftime("%H:%M:%S"))
        except Exception as e:
            print(e)
            sc.sticky[status_key] = "robot not reachable"

ghenv.Component.Message = sc.sticky.get(status_key, "")

def pt(name):
    return rg.Point3d(*data[name]) if name in data else None

wobj_origin, wobj_xaxis, wobj_xypoint = pt("origin"), pt("xaxis"), pt("xypoint")
info = json.dumps(data, indent=2)
# ---------- end capture_wobj ----------

# ----
# Measure robo base
point_2 = ValueList({"origin", "xaxis", "xypoint"}, selected="xypoint")
capture_2 = Button()
capture_wobj_2 = CaptureWobj(robot_ip="192.168.10.10", point_name=point_2, capture=capture_2)  # -> wobj_origin, wobj_xaxis, wobj_xypoint, info; same code as capture_wobj

# ----
# TCP 2
panel_7 = Panel("-14.21")
pt_2 = ConstructPoint(XCoordinate=panel_7, YCoordinate="-14.75", ZCoordinate="116.68")

# ----
# DUMP POINT
dump_plane_reference_point = Point(Point(382.5643696, 595.5106151, -12.32440722))
python_3_script_8 = Python3Script(pt=dump_plane_reference_point)  # -> f; inputs pt: Point3d
# ---------- python_3_script_8: Python ----------
from compas.geometry import Point, Frame
from compas_rhino.conversions import point_to_compas

compas_pt = point_to_compas(pt)
f = Frame(compas_pt, [1, 0, 0], [0, -1, 0])
# ---------- end python_3_script_8 ----------

vector_2pt = Vector2Pt(PointA=capture_wobj.wobj_origin, PointB=capture_wobj.wobj_xypoint, Unitize=False)  # -> Vector, Length; disabled
wobj_corner = Move(Geometry=capture_wobj.wobj_xaxis, Motion=vector_2pt.Vector)  # -> Geometry, Transform; disabled
_4point_surface = _4PointSurface(
    CornerA=capture_wobj.wobj_origin,
    CornerB=capture_wobj.wobj_xaxis,
    CornerC=wobj_corner.Geometry,
    CornerD=capture_wobj.wobj_xypoint)  # disabled

vector_2pt_2 = Vector2Pt(PointA=capture_wobj_2.wobj_origin, PointB=capture_wobj_2.wobj_xypoint, Unitize=False)  # -> Vector, Length
wobj_corner_2 = Move(Geometry=capture_wobj_2.wobj_xaxis, Motion=vector_2pt_2.Vector)  # -> Geometry, Transform
_4point_surface_2 = _4PointSurface(
    CornerA=capture_wobj_2.wobj_origin,
    CornerB=capture_wobj_2.wobj_xaxis,
    CornerC=wobj_corner_2.Geometry,
    CornerD=capture_wobj_2.wobj_xypoint)

# ----
# ASSEMBLE CODE
number_slider_13 = Slider(1, range=0..1)
grb_pos = Panel("1")
compas = Python3Script(
    way_frames=transform.transformed_frames,
    pickup_frames=python_3_script_6.frames,
    dump_frame=python_3_script_8,
    tcp_1=pt,
    tcp_2=pt_2,
    a=Slider(0.5, range=0..1),
    v=number_slider_13,
    grb_pos=grb_pos)  # -> out, vis_frames, vis_planes, script; inputs way_frames: list, pickup_frames: list, tcp_1: Point3d, tcp_2: Point3d, a: Double, v: Double, grb_pos: Int32
# ---------- compas: Python ----------
from imp import reload
import sys
import os

#get current file path
path = ghenv.Component.OnPingDocument().FilePath
#get parent directory of the parent directory
parentdir = os.path.dirname(path)
#get src folder which contains classes
dire = os.path.join(parentdir,'src')

sys.path.append(dire)

import simple_ur_script as ur
reload(ur)

import utils 
reload(utils)

import simple_comm as com
reload(com)

import compas.geometry as cg
import math as m

# ===== Set global constants =======

IO = 0 # Global constant
sd = 120

# =================================

script = "" #create empty string

def pickup_brick(script, pick_frame):

    frames = []

    # Translate frame to "safe" location
    safe_pick_frame = pick_frame.copy()
    safe_pick_frame.point.z += sd

    # Move to safe frame
    script += ur.move_l(safe_pick_frame, a, v)

    # Move to pick location
    script += ur.move_l(pick_frame, a, v)

    # Activate gripper
    script += ur.set_digital_out(IO, True)
    script += ur.sleep(1.5)

    # Move back to safe plane
    script += ur.move_l(safe_pick_frame, a, v)

    frames.extend([safe_pick_frame, pick_frame, safe_pick_frame])

    return script, frames


def place_brick(script, place_frame):
    frames = []
    
    # Safe frame for placing
    safe_place_frame = place_frame.copy()
    safe_place_frame.point.z += sd

    # Add to the path: go to the safe plane
    script += ur.move_l(safe_place_frame, a, v)

    # Add to the path: go to the place plane
    script += ur.move_l(place_frame, a, v)
    
    # Add to the path: turn off the vacuum and wait 1 second (hold the brick)
    script += ur.set_digital_out(IO, False)
    script += ur.sleep(1.5)
    
    # Add to the path: go back to the safe plane
    script += ur.move_l(safe_place_frame, a, v)

    frames.extend([safe_place_frame, place_frame, safe_place_frame])
    
    return script, frames


def depot_action(script, depot_frame, dump_frame):
    frames = []

    # 1. & 2. Copy the depot frame and raise its Z position by 20 units
    safe_depot_frame = depot_frame.copy()
    safe_depot_frame.point.z += 120

    # 3. UR Linear motions: approach safe position, then drop down to the depot point
    script += ur.move_l(safe_depot_frame, a, v)
    script += ur.move_l(depot_frame, a, v)

    # 4. Trigger I/O to TRUE (Grip/Activate)
    script += ur.set_digital_out(IO, True)
    script += ur.sleep(1.5)

    # 5. Move back up to the safe depot clearance height
    script += ur.move_l(safe_depot_frame, a, v)
    
    # 6. Move to the custom dump plane inputted from Grasshopper
    script += ur.move_l(dump_frame, a, v)
    
    # 7. Trigger I/O to FALSE (Release/Open)
    script += ur.set_digital_out(IO, False)
    script += ur.sleep(1.5)

    # Keep track of the generated motion sequence path for visual feedback
    frames.extend([safe_depot_frame, depot_frame, safe_depot_frame, dump_frame])

    return script, frames


#if value given for tcp measured, then add line to script, otherwise it will take current tcp from robot

if tcp_1 is not None:
    if grb_pos == 1:
        script += ur.set_tcp_by_angles(tcp_1.X, tcp_1.Y, tcp_1.Z, m.radians(-45), m.radians(0), m.radians(-45))

if tcp_2 is not None:
    if grb_pos == 2:
        script += ur.set_tcp_by_angles(tcp_2.X, tcp_2.Y, tcp_2.Z, m.radians(0), m.radians(-45), m.radians(45))

vis_frames = [] 
place_counter = 0 # Track sequential progress through structural drop planes

# ===== Generate pick, place, and depot sequence =====
for i in range(len(way_frames)):
    
    # 1. TRIGGER DEPOT AFTER EVERY (i*15)+i INTERVAL (0, 16, 32...) AT THE SAME LOCATION
    if i % 16 == 0:
        depot_index = i % len(pickup_frames)
        target_depot_frame = pickup_frames[depot_index]
        
        script, depot_frames_list = depot_action(script, target_depot_frame, dump_frame)
        vis_frames.extend(depot_frames_list)
        
    # 2. RUN NORMAL PICK & PLACE ONLY ON NON-DEPOT ITERATIONS
    else:
        if place_counter < len(way_frames):
            # Target structural planes continuously using the decoupled index pointer
            current_place_frame = way_frames[place_counter]
            
            pickup_index = i % len(pickup_frames)
            current_pick_frame = pickup_frames[pickup_index]
            
            script, pif = pickup_brick(script, current_pick_frame)
            vis_frames.extend(pif)
            
            script, place_frames_list = place_brick(script, current_place_frame)
            vis_frames.extend(place_frames_list)
            
            # Step the structural placement pointer forward
            place_counter += 1

# Format the script to make it sendable
script = com.concatenate_script(script)

# Visualize
from compas_rhino import conversions
import Rhino.Geometry as rg
vis_planes = [conversions.frame_to_rhino(frame) for frame in vis_frames]



# Visualize
from compas_rhino import conversions
import Rhino.Geometry as rg

vis_planes = [conversions.frame_to_rhino(frame) for frame in vis_frames]
# ---------- end compas ----------
compas_draw_9 = COMPASDraw(cg=compas.vis_frames)  # -> rg; same code as compas_draw
pline = PolyLine(Vertices=compas.vis_planes, Closed=False)
points_2 = PointList(Points=compas.vis_planes, Size=Slider(7, range=0..100))

python_3_script_9 = Python3Script(Origin=origin_2, Xaxis=xaxis_2, XYpoint=xypoint_2)  # -> out, Rectangle; inputs Origin: Point3d, Xaxis: Point3d, XYpoint: Point3d; same code as python_3_script_7
panel_8 = Panel(compas.script)

# ----
# RUN CODE
panel_9 = Panel("192.168.10.10")
py3 = Python3Script(script=compas.script, ip_address=panel_9, send=Button())  # -> out, a; inputs script: String, ip_address: String, send: Boolean
# ---------- py3: Python ----------
import simple_comm as com

if send:
    com.send_script(script,ip_address)
# ---------- end py3 ----------

# ----
# Measure pick up location
panel_10 = Panel("192.168.10.10")  # disabled
point_3 = ValueList({"origin", "xaxis", "xypoint"}, selected="xaxis")  # disabled
capture_3 = Button()  # disabled
capture_pick = CapturePick(robot_ip=panel_10, point_name=point_3, capture=capture_3)  # -> origin, xaxis_pt, xy_pt, info
# ---------- capture_pick: Python ----------
"""
Capture the 3 points that define the pick frame at the brick pick-up location.

Jog the TCP to a point, pick its name (origin / xaxis / xypoint) and press capture.
The TCP position (robot base frame, mm) is saved to pick_calibration.json next to
this .ghx file, so the points survive closing Grasshopper.
"""
import os
import sys
import json
import time

import scriptcontext as sc
import Rhino.Geometry as rg

NAMES = ["origin", "xaxis", "xypoint"]

gh_dir = os.path.dirname(ghenv.Component.OnPingDocument().FilePath)
src_dir = os.path.join(gh_dir, "src")
if src_dir not in sys.path:
    sys.path.append(src_dir)
import simple_comm as com

path = os.path.join(gh_dir, "pick_calibration.json")

data = {}
if os.path.exists(path):
    with open(path) as f:
        data = json.load(f)

# keep the last status in sticky, so the message survives the button being released
status_key = "capture_status_" + str(ghenv.Component.InstanceGuid)

if capture:
    if point_name not in NAMES:
        sc.sticky[status_key] = "pick origin / xaxis / xypoint"
    else:
        try:
            x, y, z = list(com.listen_to_robot(robot_ip)["pose"])[:3]  # metres, robot base frame
            data[point_name] = [round(x * 1000, 2), round(y * 1000, 2), round(z * 1000, 2)]  # -> mm
            with open(path, "w") as f:
                json.dump(data, f, indent=2)
            sc.sticky[status_key] = "{} captured {}".format(point_name, time.strftime("%H:%M:%S"))
        except Exception as e:
            print(e)
            sc.sticky[status_key] = "robot not reachable"

ghenv.Component.Message = sc.sticky.get(status_key, "")

def pt(name):
    return rg.Point3d(*data[name]) if name in data else None

origin, xaxis_pt, xy_pt = pt("origin"), pt("xaxis"), pt("xypoint")
info = json.dumps(data, indent=2)
# ---------- end capture_pick ----------

wobj_calibration = Panel(capture_wobj.info)  # disabled
fine_adjust_z_mm_2 = Slider(45, range=-5..500)  # disabled
pick_calibration = Panel(capture_pick.info)
number_slider_14 = Slider(0.5, range=0..1)  # disabled
button = Button()  # disabled

# ----
# Transform geometry to robobase
transform_2 = Python3Script(
    way_planes=python_3_script.frames,
    wobj_origin=capture_wobj.wobj_origin,
    wobj_xaxis=capture_wobj.wobj_xaxis,
    wobj_xypoint=capture_wobj.wobj_xypoint,
    z_safe_margin=fine_adjust_z_mm_2)  # -> out, flatten(transformed_frames); inputs way_planes: list, wobj_origin: Point3d, wobj_xaxis: Point3d, wobj_xypoint: Point3d, z_safe_margin: Double; disabled; same code as transform

# ---- group: frame -> plane (preview)
frame_to_plane_3 = Python3Script(frames=transform_2.transformed_frames)  # -> planes; inputs frames: list; disabled; same code as frame_to_plane

# ----
# Measure pick up location
panel_11 = Panel("192.168.10.10")
point_4 = ValueList({"origin", "xaxis", "xypoint"}, selected="xaxis")
capture_4 = Button()
capture_pick_2 = CapturePick(robot_ip=panel_11, point_name=point_4, capture=capture_4)  # -> origin, xaxis_pt, xy_pt, info; same code as capture_pick

wobj_calibration_2 = Panel(capture_wobj_2.info)
fine_adjust_z_mm_3 = Slider(45, range=-5..500)
pick_calibration_2 = Panel(capture_pick_2.info)
number_slider_15 = Slider(0.5, range=0..1)

# ----
# Transform geometry to robobase
transform_3 = Python3Script(
    way_planes=python_3_script_2.frames,
    wobj_origin=capture_wobj_2.wobj_origin,
    wobj_xaxis=capture_wobj_2.wobj_xaxis,
    wobj_xypoint=capture_wobj_2.wobj_xypoint,
    z_safe_margin=fine_adjust_z_mm_3)  # -> out, flatten(transformed_frames); inputs way_planes: list, wobj_origin: Point3d, wobj_xaxis: Point3d, wobj_xypoint: Point3d, z_safe_margin: Double; same code as transform

# ---- group: frame -> plane (preview)
frame_to_plane_4 = Python3Script(frames=transform_3.transformed_frames)  # -> planes; inputs frames: list; same code as frame_to_plane

# ---- group: Point
point_5 = Point(capture_pick.origin)  # disabled
move_z = Slider(45, range=0..100)  # disabled

# ----
# pickup_base_rhino for reference
vector_2pt_3 = Vector2Pt(PointA=capture_pick.origin, PointB=capture_pick.xy_pt, Unitize=False)  # -> Vector, Length; disabled
pick_corner = Move(Geometry=capture_pick.xaxis_pt, Motion=vector_2pt_3.Vector)  # -> Geometry, Transform; disabled
_4point_surface_3 = _4PointSurface(CornerA=capture_pick.origin, CornerB=capture_pick.xaxis_pt, CornerC=pick_corner.Geometry, CornerD=capture_pick.xy_pt)  # disabled

# ---- group: Point
point_6 = Point(capture_pick_2.origin)
move_z_2 = Slider(45, range=0..100)

# ----
# pickup_base_rhino for reference
vector_2pt_4 = Vector2Pt(PointA=capture_pick_2.origin, PointB=capture_pick_2.xy_pt, Unitize=False)  # -> Vector, Length
pick_corner_2 = Move(Geometry=capture_pick_2.xaxis_pt, Motion=vector_2pt_4.Vector)  # -> Geometry, Transform
_4point_surface_4 = _4PointSurface(
    CornerA=capture_pick_2.origin,
    CornerB=capture_pick_2.xaxis_pt,
    CornerC=pick_corner_2.Geometry,
    CornerD=capture_pick_2.xy_pt)

python_3_script_10 = Python3Script(pt=point_5, move_z=move_z)  # -> out, frames; inputs pt: Point3d; disabled
# ---------- python_3_script_10: Python ----------
from compas.geometry import Point, Frame
from compas_rhino.conversions import point_to_compas

# Reference point = measured pick origin
ref_pt = point_to_compas(pt)

# Grid settings (mm)
num_x = 5         # bricks per row along -X
num_y = 3         # rows along +Y
first_dx = 15   # first brick center, offset in -X
first_dy = 28   # first brick center, offset in +Y
step_x = 30     # brick spacing in -X
step_y = 50     # brick spacing in +Y
# move_z (input) = pick height above the measured point

frames = []

# i (num_y) steps along +Y, j (num_x) steps along -X
for i in range(num_y):
    for j in range(num_x):
        x = ref_pt.x - first_dx - j * step_x
        y = ref_pt.y + first_dy + i * step_y
        z = ref_pt.z + move_z

        # make frame  ->  Z axis points down (gripper faces down)
        frames.append(Frame(Point(x, y, z), [1, 0, 0], [0, -1, 0]))
# ---------- end python_3_script_10 ----------

python_3_script_11 = Python3Script(pt=point_6, move_z=move_z_2)  # -> out, frames; inputs pt: Point3d; same code as python_3_script_10

# ----
# Measure the TCP
panel_12 = Panel("-0.98")
pt_3 = ConstructPoint(XCoordinate="-0.24", YCoordinate=panel_12, ZCoordinate="129.8")

# ----
# Measure the TCP
panel_13 = Panel("-0.98")
pt_4 = ConstructPoint(XCoordinate="-0.24", YCoordinate=panel_13, ZCoordinate="129.8")

# ---- group: frame -> plane (preview)
frame_to_plane_5 = Python3Script(frames=python_3_script_10.frames)  # -> planes; inputs frames: list; disabled; same code as frame_to_plane

frame_to_plane_6 = Python3Script(frames=python_3_script_11.frames)  # -> planes; inputs frames: list; same code as frame_to_plane

# ----
sd = Slider(50, range=0..150)  # disabled
sd_2 = Slider(50, range=0..150)

# ----
# Convert Planes to URScript
compas_2 = Python3Script(
    way_frames=transform_2.transformed_frames,
    tcp_measured=pt_3,
    a=number_slider_14,
    v=number_slider_14,
    pickup_frames=python_3_script_10.frames,
    sd=sd)  # -> out, vis_frames, script; inputs way_frames: list, tcp_measured: Point3d, a: Double, v: Double, pickup_frames: list; disabled
# ---------- compas_2: Python ----------
from imp import reload
import sys
import os

#get current file path
path = ghenv.Component.OnPingDocument().FilePath
#get parent directory of the parent directory
parentdir = os.path.dirname(path)
#get src folder which contains classes
dire = os.path.join(parentdir,'src')

sys.path.append(dire)

import simple_ur_script as ur
reload(ur)

import utils 
reload(utils)

import simple_comm as com
reload(com)

import compas.geometry as cg
import math as m

# ===== Set global constants =======

IO = 0 # Global constant
# sd (input) = safe distance above pick/place frames (mm)

# =================================

script = "" #create empty string

def pickup_brick(script, pick_frame):

    frames = []

    # Translate frame to "safe" location
    safe_pick_frame = pick_frame.copy()
    safe_pick_frame.point.z += sd

    # Move to safe frame
    script += ur.move_l(safe_pick_frame, a, v)

    # Move to pick location
    script += ur.move_l(pick_frame, a, v)

    # Activate gripper
    script += ur.set_digital_out(IO, True)
    script += ur.sleep(1.5)

    # Move back to safe plane
    script += ur.move_l(safe_pick_frame, a, v)

    frames.extend([safe_pick_frame, pick_frame, safe_pick_frame])

    return script, frames


def place_brick(script, place_frame):
    frames = []
    
    # Safe frame for placing
    safe_place_frame = place_frame.copy()
    safe_place_frame.point.z += sd

    # Add to the path: go to the safe plane
    script += ur.move_l(safe_place_frame, a, v)

    # Add to the path: go to the place plane
    script += ur.move_l(place_frame, a, v)
    
    # Add to the path: turn off the vacuum and wait 1 second (hold the brick)
    script += ur.set_digital_out(IO, False)
    script += ur.sleep(1.5)
    
    # Add to the path: go back to the safe plane
    script += ur.move_l(safe_place_frame, a, v)

    frames.extend([safe_place_frame, place_frame, safe_place_frame])
    
    return script, frames


#if value given for tcp measured, then add line to script, otherwise it will take current tcp from robot
if tcp_measured is not None:
    script += ur.set_tcp_by_angles(tcp_measured.X, tcp_measured.Y, tcp_measured.Z, m.radians(0.0), m.radians(0.0), m.radians(45))


vis_frames = []

# ===== Generate pick and place sequence =====
# Loops exactly 220 times (once for each position in way_frames)
for i in range(len(way_frames)):
    
    # 1. Grab the current place frame
    current_place_frame = way_frames[i]
    
    # 2. Cycle through the 40 pickup frames smoothly (0 to 39, then wraps back to 0)
    pickup_index = i % len(pickup_frames)
    current_pick_frame = pickup_frames[pickup_index]

    # 3. Generate the pickup script actions
    script, pif = pickup_brick(script, current_pick_frame)
    vis_frames.extend(pif)
    
    # 4. Generate the placement script actions
    script, place_frames_list = place_brick(script, current_place_frame)
    vis_frames.extend(place_frames_list)
    print(place_frames_list)


# Format the script to make it sendable
script = com.concatenate_script(script)
# ---------- end compas_2 ----------

# ----
# Convert Planes to URScript
compas_3 = Python3Script(
    way_frames=transform_3.transformed_frames,
    tcp_measured=pt_4,
    a=number_slider_15,
    v=number_slider_15,
    pickup_frames=python_3_script_11.frames,
    sd=sd_2)  # -> out, vis_frames, script; inputs way_frames: list, tcp_measured: Point3d, a: Double, v: Double, pickup_frames: list; same code as compas_2

number_slider_16 = Slider(5, range=0..100)  # disabled
frame_to_plane_7 = Python3Script(frames=compas_2.vis_frames)  # -> planes; inputs frames: list; disabled; same code as frame_to_plane
pline_2 = PolyLine(Vertices=frame_to_plane_7, Closed=False)  # disabled
points_3 = PointList(Points=frame_to_plane_7, Size=number_slider_16)  # disabled

# ----
# Send to Robot
panel_14 = Panel("192.168.10.10")  # disabled
py3_2 = Python3Script(script=compas_2.script, ip_address=panel_14, send=button)  # -> out, a; inputs script: String, ip_address: String, send: Boolean; disabled; same code as py3

frame_to_plane_8 = Python3Script(frames=compas_3.vis_frames)  # -> planes; inputs frames: list; same code as frame_to_plane
pline_3 = PolyLine(Vertices=frame_to_plane_8, Closed=False)
points_4 = PointList(Points=frame_to_plane_8, Size=Slider(5, range=0..100))

# ----
# Send to Robot
panel_15 = Panel("192.168.10.10")
py3_3 = Python3Script(script=compas_3.script, ip_address=panel_15, send=Button())  # -> out, a; inputs script: String, ip_address: String, send: Boolean; same code as py3
