# Grasshopper definition kleine_tor_alva_mike.gh (Grasshopper 1.0.8)

py3 = Python3Script(lh=Slider(3, range=0..10))  # -> out, layer_info
# ---------- py3: Python ----------
import Rhino.Geometry as rg
import math as m
import numpy as np


class Column:
    
    def __init__(self, axis: rg.Curve, radius_base: float, radius_top: float):

        self.axis = axis
        self.axis.Domain = rg.Interval(0.0,1.0)
        # define axis and reparameterise it
        self.radius_base = radius_base
        self.radius_top = radius_top
        self.height = axis.PointAtEnd.Z - axis.PointAtStart.Z

    def get_point(self, angle: float, tz: float) -> rg.Point3d:
        """
        Args:
            angle: angle in polar coordinates in radians
            tz: parameter on axis

        Returns:
            rg.Point3d point on the column

        """
        origin = self.axis.PointAt(tz)
        radius = self.get_radius(angle, tz)
        pt = rg.Point3d(
            origin.X + m.cos(angle) * radius,
            origin.Y + m.sin(angle) * radius,
            origin.Z
        )
        return pt

    def get_radius(self, angle: float, tz: float) -> float:
        radius = self.radius_base * (1 - tz) + self.radius_top * tz
        return radius

    def get_radius_wave(self, angle: float, tz: float, freq: int, amp: float) -> float:
        radius = m.cos(angle * freq) * amp
        return radius
    
    def get_layers(self, layer_height: float, res_u: int) -> list[list[rg.Point3d]]:
        layer_count = int(self.height / layer_height) if self.height % layer_height == 0 else int(self.height // layer_height + 1)
        real_layer_height = self.height/layer_count
        # layers = [rg.Polyline([self.get_point(angle, tz) for angle in np.linspace(0, m.tau , res_u)]) for tz in np.linspace(0, 1, layer_count)]
        # above is option if we bake the layers as a list of Polylines instead of Points
        layers = [[self.get_point(angle, tz) for angle in np.linspace(0, m.tau , res_u)] for tz in np.linspace(0, 1, layer_count)]
        
        # for every angle within resolution per layer, for every layer in all layers, create a collection of points, and assign it to a polyline
        # alternate method:
        # layers = []
        # for tz in np.linspace(0, 1, layer_count)[1:]:
            # layer = []
            # for angle in np.linspace(0, m.tau, res_u)[:-1]:
                # pt = self.get_point(angle, tz)
                # layer.append(pt)
            # layers.append(layer)
        # return layer
            
        return layers

if __name__ == "__main__":
    axis = rg.LineCurve(
        rg.Point3d(0.0, 0.0, 0.0),
        rg.Point3d(0.0, 0.0, 300.0)
    )    
    
    col = Column(axis, 20, 40)
    layer_info = col.get_layers(3.0, 100)
    import ghpythonlib.treehelpers as th
    layer_info = th.list_to_tree(layer_info)
# ---------- end py3 ----------
py3_2 = Python3Script()  # -> out, layers, mesh; disabled
# ---------- py3_2: Python ----------
import Rhino.Geometry as rg
import numpy as np
import math as m

class Column:
    def __init__(self, axis: rg.Curve, radius_base: float, radius_top: float):
        self.axis = axis
        # reparameterize axis
        self.axis.Domain = rg.Interval(0,1)
        self.r_base = radius_base
        self.r_top = radius_top
        self.height = axis.PointAtEnd.Z - axis.PointAtStart.Z
        self.radius_bezier = self.gen_radius_bezier()

    def gen_radius_bezier(self) -> rg.BezierCurve:
        pts = [
            rg.Point2d(0, 0),
            rg.Point2d(0.6, 3),
            rg.Point2d(0.9, 5),
            rg.Point2d(1.0, 0.5)
        ]
        return rg.BezierCurve(pts)

    def get_radius(self, tz) -> float:
        # power
        # tz = m.pow(tz, 3)
        # return self.r_base*(1-tz) + self.r_top*(tz)

        # beizer curve
        bezier = self.radius_bezier.PointAt(tz)
        amp = 10
        return self.r_base*(1-tz) + self.r_top*(tz) + bezier.Y*amp

    def get_pattern(self, angle, tz) -> float:
        a = angle
        freq = 4
        amp = 5

        # shift angle
        shift = m.pow(tz, 2.5)
        shift *= m.pi
        
        # fade out amp
        fade = m.pow(tz,1)
        # amp *= fade
        # pattern = m.cos((a+shift)*freq)*amp

        # blend multiple freq
        freqs = [3, 8, 4]
        set_freqs = [m.cos((a+shift)*f)*(amp+3*(1-tz)) for f in freqs]
        t_sets = [t for t in np.linspace(0,1,len(freqs))]
        pattern = np.interp(tz, t_sets, set_freqs)
        
        # add reverse pattern
        set_freqs = [m.cos((a-shift)*f)*(amp+3*tz) for f in freqs]
        r_pattern = np.interp(tz, t_sets, set_freqs)

        # try different blend
        pattern = (pattern + r_pattern)*.5
        pattern = max(pattern, r_pattern)
        # pattern = min(pattern, r_pattern)
        # pattern = pattern*(1-tz) + r_pattern*tz

        return pattern

    def get_point(self, angle, tz) -> rg.Point3d:
        """
        Get point on the column at certain angle and height

        Args:
        angle: angle of the point in radians
        tz: normalize parameter of the height along the axis

        Returns:
        The list of polylinecurve for each layer
        """
        radius = self.get_radius(tz)
        radius += self.get_pattern(angle, tz)
        origin = self.axis.PointAt(tz)
        vector = rg.Vector3d(
            radius*m.cos(angle),
            radius*m.sin(angle),
            0
        )
        return origin+vector

    def print_paths(self, resolution: int, layer_height: float) -> list[int, list[rg.PolylineCurve]]:
        """
        Generate print path of the columns

        Args:
        resolution: division around the circumference
        layer_height: distance between vertical layers in mm.

        Returns:
        The list of polylinecurve for each layer
        """

        lh = int(self.height // layer_height)
        layers = []

        for tz in np.linspace(0, 1, lh+1, endpoint=True)[1:]:
            pts = []
            for angle in np.linspace(0, 2*np.pi, resolution+1, endpoint=True)[:-1]:
                pts.append(self.get_point(angle, tz))
            
            layers.append(
                rg.PolylineCurve(pts)
            )
            # layers.append(pts)
        return lh, layers
    
    @ staticmethod
    def to_mesh(crvs: list[rg.PolylineCurve], closed: bool = True) -> rg.Mesh:
        mesh = rg.Mesh()
        for layer in crvs:
            for pt in layer.ToArray():
                mesh.Vertices.Add(pt)
        
        idx = np.array(range(mesh.Vertices.Count))
        idx = idx.reshape(len(crvs), layer.PointCount)

        if closed:
            faces = np.stack([
                idx[:-1],                             # Top-left
                np.roll(idx[:-1], -1, axis=1),        # Top-right
                idx[1:],                              # Bottom-left
                np.roll(idx[1:], -1, axis=1)          # Bottom-right
            ], axis=-1).reshape(-1, 4)
        else:
            faces = np.lib.stride_tricks.sliding_window_view(
                idx, window_shape=(2, 2)
            ).reshape(-1, 4)
        
        for f in faces:
            mesh.Faces.AddFace(
                int(f[0]),
                int(f[1]),
                int(f[3]),
                int(f[2])
            )

        mesh.Compact()
        mesh.RebuildNormals()
        return mesh

            


if __name__ == "__main__":
    axis = rg.LineCurve(
        rg.Point3d(0,0,0),
        rg.Point3d(10,10,300)
    )
    # axis defining spine of column
    r1 = 10 # value defining first radius
    r2 = 10 # value defining second radius

    column = Column(axis, r1, r2)
    layer_count, layers = column.print_paths(150, 2)
    mesh = Column.to_mesh(layers, closed=True)
# ---------- end py3_2 ----------
faceb = FaceBoundaries(Mesh=py3_2.mesh)  # disabled
cp = ControlPoints(Curve=py3_2.layers)  # -> Points, Weights, Knots; disabled
preview = CustomPreview(
    Geometry=py3_2.mesh,
    Material={diffuse=RGB(221, 160, 221), emission=RGB(66, 48, 66), shine=0.5, specular=RGB(255, 255, 255), transparency=0})  # disabled
