# Grasshopper definition 261106_gh_to_vscode.gh (Grasshopper 1.0.8)

# ---- group: This is needed only ONCE in the GH definition
enable_auto_reload = Python3Script()  # -> ok
# ---------- enable_auto_reload: Python ----------
"""
------------------------------
Using VS Code as Python editor
------------------------------

The simplest way to start using VS Code as our editor, is
to place our Python code in files located IN THE SAME FOLDER as our Grasshopper file.

After we have done that, we need 2 steps: 

1. Enable the COMPAS reloader on one component. This tells Grasshopper to watch for changes in the Pythoh files and reload if changed.
2. Every other component that uses Python code from external files needs to start with a method to ensure Grasshopper knows where to load the files from.

"""
# r: compas
# venv: mas-2627

from compas_rhino.devtools import DevTools
DevTools.enable_reloader()
# ---------- end enable_auto_reload ----------

# ----
# \\ Print sample 01
number_slider = Slider(198, range=0..1000)
construct_point = ConstructPoint(XCoordinate=number_slider, YCoordinate=Slider(150, range=0..1000), ZCoordinate=Slider(0, range=0..10))

# ---- group: Total Height
number_slider_2 = Slider(35, range=0..1000)

# ---- group: Layer thickness
number_slider_3 = Slider(4, range=0..10)

# ---- group: Nozzle thickness
number_slider_4 = Slider(1.4, range=0..10)

# ---- group: base_curve_01
curve_01 = Curve(<curve referenced from the Rhino model>)

# ---- group: layer thickness
number_slider_5 = Slider(1.5, range=0..10)

# ---- group: Base curve from Rhino
# \\ A.T04.01  \\ alternate wavy lines
base_curve = Curve(<curve referenced from the Rhino model>)

# ---- group: Input curve
# \\ A.T03.01  \\ wavy lines
curve = Curve(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)

# ----
# \\ A.T01.01 \\ Isocurves
number_slider_6 = Slider(0.5, range=0..10)
unit_z = UnitZ(Factor=number_slider_6)
move = Move(Geometry=curve_01, Motion=unit_z)  # -> Geometry, Transform

number_slider_7 = Slider(0.75, range=0..10)
unit_z_2 = UnitZ(Factor=number_slider_7)
move_2 = Move(Geometry=curve, Motion=unit_z_2)  # -> Geometry, Transform

# ---- group: moving base curves in z direction / Layer height
number_slider_8 = Slider(1.4, range=0..10)

# ---- group: total height
# Number of print layers
panel = Panel("0 to 35")

# ----
division = Division(A=number_slider_2, B=number_slider_4)
range = Range(Domain=panel, Steps=expr("x-1", division))
unit_z_3 = UnitZ(Factor=range)

# ---- group: Total Height
number_slider_9 = Slider(125, range=0..1000)

# ---- group: Layer thickness
number_slider_10 = Slider(5, range=0..10)

# ----
number_slider_11 = Slider(0.75, range=0..10)
unit_z_4 = UnitZ(Factor=number_slider_11)
move_3 = Move(Geometry=base_curve, Motion=unit_z_4)  # -> Geometry, Transform

# ---- group: moving base curves in z direction
number_slider_12 = Slider(15, range=0..100)
series = Series(Start=0, Step=number_slider_8, Count=number_slider_12)
unit_z_5 = UnitZ(Factor=series)
move_4 = Move(Geometry=move_3.Geometry, Motion=unit_z_5)  # -> Geometry, Transform

# ----
circle = Circle(Plane=construct_point, Radius=Slider(35, range=0..100))

# ---- group: total height
panel_2 = Panel("0 to 125")

# ----
division_2 = Division(A=number_slider_9, B=number_slider_10)
range_2 = Range(Domain=panel_2, Steps=expr("x-1", division_2))
unit_z_6 = UnitZ(Factor=range_2)

# ---- group: base_curve_02
curve_02 = Curve(<curve referenced from the Rhino model>)

# ---- group: Total height
multiplication = Multiplication(A=number_slider_8, B=number_slider_12)
panel_3 = Panel(multiplication)

# ---- group: Input curve
curve_2 = Curve(<curve referenced from the Rhino model>)

# ---- group: Move the layers
move_5 = Move(Geometry=move_2.Geometry, Motion=unit_z_3)  # -> Geometry, Transform

# ---- group: lofted surface
loft = Loft(
    Curves=[move.Geometry, curve_02],
    Options={Adjust=False, Closed=False, LoftEnds=0, LoftSimp=0, LoftType=0, Rebuild=10, Refit=0.01})

# ---- group: Divide the curves into number of points
divide_curve = DivideCurve(Curve=flatten(move_5.Geometry), Count=Slider(50, range=0..100), Kinks=False)  # -> Points, Tangents, Parameters

# ---- group: deconstruct box to get z extents
bounding_box = BoundingBox(Content=loft, Plane=PlaneXY(0, 0, 0))  # -> Box, Box_2
deconstruct_box = DeconstructBox(Box=bounding_box.Box)  # -> Plane, X, Y, Z

# ---- group: creating base curves
series_2 = Series(Start=0, Step=Slider(3, range=0..10), Count=Slider(3, range=0..10))
unit_z_7 = UnitZ(Factor=series_2)
move_6 = Move(Geometry=circle, Motion=unit_z_7)  # -> Geometry, Transform

# ---- group: Select alternate curves
dispatch = Dispatch(List=move_4.Geometry, DispatchPattern=[True, False])  # -> ListA, ListB

# ---- group: Layer thickness
number_slider_13 = Slider(1.25, range=0..10)

# ----
deconstruct_domain = DeconstructDomain(Domain=deconstruct_box.Z)  # -> Start, End
division_3 = Division(A=deconstruct_domain.End, B=number_slider_13)

# ---- group: get normalised parameters to create points
range_3 = Range(Domain=Domain(0, 1), Steps=division_3)

# ---- group: normalised points for surface evaluation
construct_point_2 = ConstructPoint(XCoordinate=range_3, YCoordinate=0, ZCoordinate=0)

# ----
unit_z_8 = UnitZ(Factor=1)
radians = Radians(Degrees=Slider(90, range=0..100))

# ---- group: Isocurves
iso_curve = IsoCurve(Surface=reparameterize(loft), UVPoint=construct_point_2)  # -> UIsocurve, VIsocurve

# ----
# Move the odd points outwards or upwards to get a pattern
number_slider_14 = Slider(4, range=0..10)
unit_z_9 = UnitZ(Factor=number_slider_14)

divide_curve_2 = DivideCurve(Curve=iso_curve.VIsocurve, Count=Slider(150, range=0..1000), Kinks=False)  # -> Points, Tangents, Parameters
polyline = PolyLine(Vertices=divide_curve_2.Points, Closed=Slider(1, range=0..1))  # -> flatten(Polyline)

number_slider_15 = Slider(3, range=0..10)
unit_z_10 = UnitZ(Factor=number_slider_6)
curve_3 = Curve(<curve referenced from the Rhino model>)
move_7 = Move(Geometry=curve_3, Motion=unit_z_10)  # -> Geometry, Transform

radians_2 = Radians(Degrees=Slider(90, range=0..100))
unit_z_11 = UnitZ(Factor=1)

# ---- group: Move factor = layer height
number_slider_16 = Slider(4, range=-11..11.01)
unit_z_12 = UnitZ(Factor=number_slider_16)

# ----
merge = Merge(Data1=move_7.Geometry, Data2=polyline)

python_3_script = Python3Script(r_curves=merge)  # -> flatten(compas_polylines); inputs r_curves: list
# ---------- python_3_script: Python ----------
from compas_rhino.conversions import curve_to_compas
from compas_rhino.conversions import curve_to_compas_polyline


# compas_curves = []

# for curve in r_curves:
#     c_curve = curve_to_compas(curve)
#     compas_curves.append(c_curve)

compas_polylines = []

for c in r_curves:
    p_curve = curve_to_compas_polyline(c)
    compas_polylines.append(p_curve)
# ---------- end python_3_script ----------

# ---- group: Tail for print start
curve_4 = Curve(<curve referenced from the Rhino model>)
unit_z_13 = UnitZ(Factor=number_slider_7)
move_8 = Move(Geometry=curve_4, Motion=unit_z_13)  # -> Geometry, Transform

# ----
speed_mm_s = Slider(22, range=1..50)
safety_distance_mm = Slider(100, range=10..300)
blend_radius_mm = Slider(0.5, range=0..5)
printpath = Printpath(layers=python_3_script, speed=speed_mm_s, blend_radius=blend_radius_mm, safety_distance=safety_distance_mm)  # -> printpath, summary; inputs layers: list
# ---------- printpath: Python ----------
# r: compas
# venv: mas-2627
"""
Turn the layers into printpoints and a PrintPath, in work object coordinates.
Safety points are added here, before any transform to the robot base.
"""
import os
import sys

from compas.geometry import Frame, Vector


# Find source folder
gh_dir = os.path.dirname(ghenv.Component.OnPingDocument().FilePath)
src_dir = os.path.join(gh_dir, "..", "..", "src")
if src_dir not in sys.path:
    sys.path.append(src_dir)
from print_class import PrintPoint, PrintPath

# ===== One printpoint per point =====
# world XY orientation for every point: a tangent frame would turn the wrist 360 degrees each layer
printpoints = []
for layer_index, layer in enumerate(layers):
    for point in layer.points:
        frame = Frame(point, -Vector.Xaxis(), Vector.Yaxis())
        printpoints.append(PrintPoint(frame, layer_index, speed, blend_radius, True))

# ===== Path with a travel point above the start and the end =====
printpath = PrintPath(printpoints)
printpath.add_safety_before(safety_distance, speed)
printpath.add_safety_after(safety_distance, speed)

summary = f"{len(printpoints)} printpoints in {len(layers)} layers, plus 2 safety points"
# ---------- end printpath ----------
panel_4 = Panel(printpath.summary)

save = Button()
save_2 = Save(printpath=printpath.printpath, save=save, out_path="data/out_printpoints_trial02.json")  # -> status
# ---------- save_2: Python ----------
# r: compas
# venv: mas-2627
"""
On button press, write the printpath to data/out_printpoints.json next to this .ghx file.
send_to_robot.py reads that file.
"""
import json
import os

import scriptcontext as sc

gh_dir = os.path.dirname(ghenv.Component.OnPingDocument().FilePath)

# keep the last status in sticky, so the message survives the button being released
status_key = "save_status_" + str(ghenv.Component.InstanceGuid)

if save:
    if printpath is None:
        sc.sticky[status_key] = "nothing to save: no printpath"
    else:
        path = os.path.normpath(os.path.join(gh_dir, out_path))
        os.makedirs(os.path.dirname(path), exist_ok=True)
        with open(path, "w") as f:
            json.dump(printpath.to_dict(), f, indent=2)
        sc.sticky[status_key] = f"saved {len(printpath)} printpoints to {path}"

status = sc.sticky.get(status_key, "")
ghenv.Component.Message = "saved" if status.startswith("saved") else status
# ---------- end save_2 ----------
panel_5 = Panel(save_2)

# ---- group: Tail for print start
curve_5 = Curve(<curve referenced from the Rhino model>)
unit_z_14 = UnitZ(Factor=number_slider_11)
move_9 = Move(Geometry=curve_5, Motion=unit_z_14)  # -> Geometry, Transform

# ----
preview = Preview(printpath=printpath.printpath)  # -> path, travel, planes
# ---------- preview: Python ----------
# r: compas
# venv: mas-2627
"""
Draw the printpath: path = the whole polyline, travel = extruder-off segments,
safety = extruder-off points, axes = small x and y axis of each frame.
"""
import Rhino.Geometry as rg
from compas_rhino.conversions import frame_to_rhino_plane, point_to_rhino

AXIS_LENGTH = 5.0  # mm

points = printpath.printpoints
planes = [frame_to_rhino_plane(printpoint.frame) for printpoint in points]

# ===== Whole path =====
polyline = rg.Polyline()
for plane in planes:
    polyline.Add(plane.Origin.X, plane.Origin.Y, plane.Origin.Z)
path = polyline.ToPolylineCurve()

# ===== Extruder off: a segment prints only if both of its points have the extruder on =====
safety = [point_to_rhino(printpoint.frame.point) for printpoint in points if not printpoint.is_extruder_on]
travel = []
for i in range(len(points) - 1):
    if not (points[i].is_extruder_on and points[i + 1].is_extruder_on):
        travel.append(rg.Line(planes[i].Origin, planes[i + 1].Origin))
# ---------- end preview ----------
plane = Plane(preview.planes)
preview_2 = CustomPreview(Geometry=preview.travel, Material=ColourSwatch(SwatchColor=RGB(230, 40, 40)))
preview_3 = CustomPreview(Geometry=preview.path, Material=ColourSwatch(SwatchColor=RGB(0, 170, 80)))

# ----
# \\ A.T02.01  \\ Scaling lines
base_curve_2 = Curve(<curve referenced from the Rhino model>)
number_slider_17 = Slider(25, range=0..100)
multiplication_2 = Multiplication(A=number_slider_5, B=number_slider_17)

number_slider_18 = Slider(0.85, range=0..10)
unit_z_15 = UnitZ(Factor=number_slider_18)
move_10 = Move(Geometry=base_curve_2, Motion=unit_z_15)  # -> Geometry, Transform

# ---- group: create layers
series_3 = Series(Start=0, Step=number_slider_5, Count=number_slider_17)
unit_z_16 = UnitZ(Factor=series_3)
move_11 = Move(Geometry=move_10.Geometry, Motion=unit_z_16)  # -> Geometry, Transform

# ---- group: number of layers
panel_6 = Panel(multiplication_2)

# ---- group: divide curve into points
divide_curve_3 = DivideCurve(Curve=move_11.Geometry, Count=Slider(100, range=0..100), Kinks=False)  # -> flatten(Points), Tangents, Parameters

# ---- group: closest point distance
attractor_points = Point([<point referenced from the Rhino model> x5])
closest_point = ClosestPoint(Point=divide_curve_3.Points, Cloud=attractor_points)  # -> ClosestPoint, CPIndex, Distance

# ---- group: vector for translation
evaluate_curve = EvaluateCurve(Curve=move_11.Geometry, Parameter=divide_curve_3.Parameters)  # -> Point, Tangent, Angle
radians_3 = Radians(Degrees=Slider(90, range=0..100))
unit_z_17 = UnitZ(Factor=1)
rotate = Rotate(Vector=evaluate_curve.Tangent, Axis=unit_z_17, Angle=radians_3)  # -> flatten(Vector)

# ---- group: remap distance
bounds = Bounds(Numbers=closest_point.Distance)
remap_numbers = RemapNumbers(Value=closest_point.Distance, Source=bounds, Target="-5 to 10")  # -> Mapped, Clipped

# ----
amplitude = Amplitude(Vector=rotate, Amplitude=remap_numbers.Mapped)  # -> flatten(Vector)

# ---- group: transform points using attractor point distance
move_12 = Move(Geometry=divide_curve_3.Points, Motion=amplitude)  # -> Geometry, Transform

# ---- group: create polyline from the transformed points
polyline_2 = PolyLine(Vertices=move_12.Geometry, Closed=Slider(0, range=0..1))

# ---- group: Tail for print start
curve_6 = Curve(<curve referenced from the Rhino model>)
unit_z_18 = UnitZ(Factor=number_slider_18)
move_13 = Move(Geometry=curve_6, Motion=unit_z_18)  # -> Geometry, Transform

# ---- group: All print layers
merge_2 = Merge(Data1=move_13.Geometry, Data2=polyline_2)

# ---- group: convert to compas polylines
python_3_script_2 = Python3Script(r_curves=merge_2)  # -> flatten(compas_polylines); inputs r_curves: list; same code as python_3_script

# ----
speed_mm_s_2 = Slider(15, range=1..50)
safety_distance_mm_2 = Slider(100, range=10..300)
blend_radius_mm_2 = Slider(0.5, range=0..5)
printpath_2 = Printpath(layers=python_3_script_2, speed=speed_mm_s_2, blend_radius=blend_radius_mm_2, safety_distance=safety_distance_mm_2)  # -> printpath, summary; inputs layers: list; same code as printpath
panel_7 = Panel(printpath_2.summary)

save_3 = Button()
save_4 = Save(printpath=printpath_2.printpath, save=save_3, out_path="data/out_printpoints_trial02.json")  # -> status; same code as save_2

preview_4 = Preview(printpath=printpath_2.printpath)  # -> path, travel, planes; same code as preview
plane_2 = Plane(preview_4.planes)
preview_5 = CustomPreview(Geometry=preview_4.travel, Material=ColourSwatch(SwatchColor=RGB(230, 40, 40)))
preview_6 = CustomPreview(Geometry=preview_4.path, Material=ColourSwatch(SwatchColor=RGB(0, 170, 80)))

panel_8 = Panel(save_4)

# ----
# Export
# Move the odd points outwards or upwards to get a pattern
# Dispatch points to list of points at even and odd indices
# Number of print layers
number_slider_19 = Slider(8, range=0..10)
unit_z_19 = UnitZ(Factor=number_slider_19)
move_14 = Move(Geometry=circle, Motion=unit_z_19)  # -> Geometry, Transform
curve_7 = Curve(move_6.Geometry)
divide_curve_4 = DivideCurve(Curve=flatten(curve_7), Count=Slider(10, range=0..100), Kinks=False)  # -> Points, Tangents, Parameters

# ---- group: Move the layers
move_15 = Move(Geometry=move_14.Geometry, Motion=unit_z_6)  # -> Geometry, Transform

# ---- group: Divide the curves into number of points
divide_curve_5 = DivideCurve(Curve=flatten(move_15.Geometry), Count=Slider(20, range=0..100), Kinks=False)  # -> Points, Tangents, Parameters

# ----
evaluate_curve_2 = EvaluateCurve(Curve=graft(move_15.Geometry), Parameter=divide_curve_5.Parameters)  # -> Point, Tangent, Angle
amplitude_2 = Amplitude(Vector=evaluate_curve_2.Tangent, Amplitude=number_slider_16)

# ---- group: base curve
polyline_3 = PolyLine(Vertices=divide_curve_4.Points, Closed=Slider(1, range=0..1))  # -> flatten(Polyline)

# ----
panel_9 = Panel("""True
False""")

# ---- group: Dispatch list to even and odd points
# Dispatch points to list of points at even and odd indices
dispatch_2 = Dispatch(List=divide_curve.Points, DispatchPattern=panel_9)  # -> ListA, ListB

# ----
dispatch_3 = Dispatch(List=divide_curve.Parameters, DispatchPattern=panel_9)  # -> ListA, ListB

odd_points = Point(dispatch_2.ListB)
even_points = Point(dispatch_2.ListA)

odd_curves = Curve(dispatch.ListB)
even_curves = Curve(dispatch.ListA)

# ---- group: Divide curve into points
divide_curve_6 = DivideCurve(Curve=odd_curves, Count=Slider(50, range=0..100), Kinks=False)  # -> Points, Tangents, Parameters

# ---- group: Odd and even points
dispatch_4 = Dispatch(List=divide_curve_6.Points, DispatchPattern=[True, False])  # -> ListA, ListB

# ----
dispatch_5 = Dispatch(List=divide_curve_6.Parameters, DispatchPattern=panel_9)  # -> ListA, ListB
evaluate_curve_3 = EvaluateCurve(Curve=graft(odd_curves), Parameter=dispatch_5.ListB)  # -> Point, Tangent, Angle
rotate_2 = Rotate(Vector=evaluate_curve_3.Tangent, Axis=unit_z_11, Angle=radians_2)

divide_curve_7 = DivideCurve(Curve=even_curves, Count=Slider(200, range=0..2200), Kinks=False)  # -> Points, Tangents, Parameters

amplitude_3 = Amplitude(Vector=rotate_2, Amplitude=number_slider_14)

# ---- group: polyline for odd flat curves
polyline_4 = PolyLine(Vertices=divide_curve_7.Points, Closed=Slider(1, range=0..1))  # -> flatten(Polyline)

# ----
panel_10 = Panel("""True
False""")

# ---- group: Dispatch list to even and odd points
dispatch_6 = Dispatch(List=divide_curve_5.Points, DispatchPattern=panel_10)  # -> ListA, ListB

# ----
odd_points_2 = Point(dispatch_6.ListB)
even_points_2 = Point(dispatch_6.ListA)

move_16 = Move(Geometry=even_points_2, Motion=unit_z_12)  # -> Geometry, Transform

# ---- group: Weave the list back
weave = Weave(Pattern=[0, 1], Stream0=even_points_2, Stream1=move_16.Geometry, NullGaps=False)

# ---- group: Polylines as print path
polyline_5 = PolyLine(Vertices=weave, Closed=Slider(1, range=0..1))  # -> flatten(Polyline)

# ----
merge_3 = Merge(Data1=polyline_3, Data2=polyline_5)  # -> flatten(Result)

# ---- group: convert rhino polyliness to compas lines
python_3_script_3 = Python3Script(r_curves=merge_3)  # -> flatten(compas_polylines); inputs r_curves: list; same code as python_3_script

# ---- group: generaate print paths and print outputs
speed_mm_s_3 = Slider(14, range=1..50)
safety_distance_mm_3 = Slider(100, range=10..300)
blend_radius_mm_3 = Slider(0.5, range=0..5)
printpath_3 = Printpath(layers=python_3_script_3, speed=speed_mm_s_3, blend_radius=blend_radius_mm_3, safety_distance=safety_distance_mm_3)  # -> printpath, summary; inputs layers: list; same code as printpath
panel_11 = Panel(printpath_3.summary)

# ----
save_5 = Button()
preview_7 = Preview(printpath=printpath_3.printpath)  # -> path, travel, planes; same code as preview
save_6 = Save(printpath=printpath_3.printpath, save=save_5, out_path="data/out_printpoints_trial01.json")  # -> status; same code as save_2
plane_3 = Plane(preview_7.planes)
preview_8 = CustomPreview(Geometry=preview_7.travel, Material=ColourSwatch(SwatchColor=RGB(230, 40, 40)))
panel_12 = Panel(save_6)
# TEMP
preview_9 = CustomPreview(Geometry=preview_7.path, Material=ColourSwatch(SwatchColor=RGB(0, 170, 80)))

evaluate_curve_4 = EvaluateCurve(Curve=graft(move_5.Geometry), Parameter=dispatch_3.ListB)  # -> Point, Tangent, Angle

rotate_3 = Rotate(Vector=evaluate_curve_4.Tangent, Axis=unit_z_8, Angle=radians)

amplitude_4 = Amplitude(Vector=rotate_3, Amplitude=number_slider_14)

move_17 = Move(Geometry=odd_points, Motion=amplitude_4)  # -> Geometry, Transform

# ---- group: Weave the list back
weave_2 = Weave(Pattern=[0, 1], Stream0=even_points, Stream1=move_17.Geometry, NullGaps=False)

# ---- group: Interpolate the points to get print path
number_slider_20 = Slider(1, range=0..1)
interpolate = Interpolate(Vertices=weave_2, Degree=3, Periodic=number_slider_20, KnotStyle=1)  # -> Curve, Length, Domain

# ----
polyline_6 = PolyLine(Vertices=weave_2, Closed=number_slider_20)  # -> flatten(Polyline)

# ---- group: All print layers
merge_4 = Merge(Data1=move_8.Geometry, Data2=polyline_6)

# ---- group: convert to compas polylines
python_3_script_4 = Python3Script(r_curves=merge_4)  # -> flatten(compas_polylines); inputs r_curves: list; same code as python_3_script

# ----
safety_distance_mm_4 = Slider(100, range=10..300)
blend_radius_mm_4 = Slider(0.5, range=0..5)
speed_mm_s_4 = Slider(8.5, range=1..50)
printpath_4 = Printpath(layers=python_3_script_4, speed=speed_mm_s_4, blend_radius=blend_radius_mm_4, safety_distance=safety_distance_mm_4)  # -> printpath, summary; inputs layers: list; same code as printpath
panel_13 = Panel(printpath_4.summary)

save_7 = Button()
save_8 = Save(printpath=printpath_4.printpath, save=save_7, out_path="data/out_printpoints_trial02.json")  # -> status; same code as save_2

preview_10 = Preview(printpath=printpath_4.printpath)  # -> path, travel, planes; same code as preview
plane_4 = Plane(preview_10.planes)
preview_11 = CustomPreview(Geometry=preview_10.travel, Material=ColourSwatch(SwatchColor=RGB(230, 40, 40)))
preview_12 = CustomPreview(Geometry=preview_10.path, Material=ColourSwatch(SwatchColor=RGB(0, 170, 80)))

panel_14 = Panel(save_8)

odd_curves_odd_points = Point(dispatch_4.ListB)
odd_curves_even_points = Point(dispatch_4.ListA)

# ---- group: Move alternate points up
number_slider_21 = Slider(4, range=0..10)

# ----
division_4 = Division(A=number_slider_21, B=Slider(2, range=0..10))

# ---- group: MOve alternate points down
unit_z_20 = UnitZ(Factor=expr("-x", division_4))
move_18 = Move(Geometry=odd_curves_odd_points, Motion=amplitude_3)  # -> Geometry, Transform

# ---- group: Move alternate points up (continued)
unit_z_21 = UnitZ(Factor=division_4)
move_19 = Move(Geometry=odd_curves_even_points, Motion=unit_z_21)  # -> Geometry, Transform

# ----
weave_3 = Weave(Pattern=[0, 1], Stream0=odd_curves_even_points, Stream1=move_18.Geometry, NullGaps=False)

# ---- group: polyline for even zig zag curves
polyline_7 = PolyLine(Vertices=weave_3, Closed=Slider(1, range=0..1))  # -> flatten(Polyline)

# ---- group: all curves
merge_5 = Merge(Data1=polyline_4, Data2=polyline_7)  # -> flatten(Result)

# ---- group: Sort curves based on their layer height
evaluate_curve_5 = EvaluateCurve(Curve=merge_5, Parameter=Slider(0.5, range=0..1))  # -> Point, Tangent, Angle
deconstruct = Deconstruct(Point=evaluate_curve_5.Point)  # -> XComponent, YComponent, ZComponent
sort_list = SortList(Keys=deconstruct.ZComponent, ValuesValuesA=merge_5)  # -> Keys, ValuesValuesA

# ---- group: All print layers
merge_6 = Merge(Data1=move_9.Geometry, Data2=sort_list.ValuesValuesA)

# ---- group: convert to compas polylines
python_3_script_5 = Python3Script(r_curves=merge_6)  # -> flatten(compas_polylines); inputs r_curves: list; same code as python_3_script

# ----
safety_distance_mm_5 = Slider(100, range=10..300)
blend_radius_mm_5 = Slider(0.5, range=0..5)
speed_mm_s_5 = Slider(10, range=1..50)
printpath_5 = Printpath(layers=python_3_script_5, speed=speed_mm_s_5, blend_radius=blend_radius_mm_5, safety_distance=safety_distance_mm_5)  # -> printpath, summary; inputs layers: list; same code as printpath
panel_15 = Panel(printpath_5.summary)

save_9 = Button()
save_10 = Save(printpath=printpath_5.printpath, save=save_9, out_path="data/out_printpoints_trial02.json")  # -> status; same code as save_2

preview_13 = Preview(printpath=printpath_5.printpath)  # -> path, travel, planes; same code as preview
plane_5 = Plane(preview_13.planes)
preview_14 = CustomPreview(Geometry=preview_13.travel, Material=ColourSwatch(SwatchColor=RGB(230, 40, 40)))
preview_15 = CustomPreview(Geometry=preview_13.path, Material=ColourSwatch(SwatchColor=RGB(0, 170, 80)))

panel_16 = Panel(save_10)
