# Grasshopper definition 261108_gh_to_vscode.gh (Grasshopper 1.0.8)

# ---- group: This is needed only ONCE in the GH definition
enable_auto_reload = Python3Script()  # -> ok
# ---------- enable_auto_reload: Python ----------
"""
------------------------------
Using VS Code as Python editor
------------------------------

The simplest way to start using VS Code as our editor, is
to place our Python code in files located IN THE SAME FOLDER as our Grasshopper file.

After we have done that, we need 2 steps: 

1. Enable the COMPAS reloader on one component. This tells Grasshopper to watch for changes in the Pythoh files and reload if changed.
2. Every other component that uses Python code from external files needs to start with a method to ensure Grasshopper knows where to load the files from.

"""
# r: compas
# venv: mas-2627

from compas_rhino.devtools import DevTools
DevTools.enable_reloader()
# ---------- end enable_auto_reload ----------

# ---- group: Base curve from Rhino
base_curve = Curve(<curve referenced from the Rhino model>)

# ---- group: base_curve_01
# \\ Print sample 01
curve_01 = Curve(<curve referenced from the Rhino model>)

# ---- group: moving base curves in z direction / Layer height
number_slider = Slider(1.5, range=0..10)

# ----
# \\ A.T01.01 \\ Isocurves
number_slider_2 = Slider(0.75, range=0..10)
unit_z = UnitZ(Factor=number_slider_2)
move = Move(Geometry=curve_01, Motion=unit_z)  # -> Geometry, Transform

number_slider_3 = Slider(0.75, range=0..10)
unit_z_2 = UnitZ(Factor=number_slider_3)
move_2 = Move(Geometry=base_curve, Motion=unit_z_2)  # -> Geometry, Transform

# ---- group: moving base curves in z direction
number_slider_4 = Slider(18, range=0..100)
series = Series(Start=0, Step=number_slider, Count=number_slider_4)
unit_z_3 = UnitZ(Factor=series)
move_3 = Move(Geometry=move_2.Geometry, Motion=unit_z_3)  # -> Geometry, Transform

# ---- group: Base curve from Rhino
# Number of print layers
base_curve_2 = Curve(<curve referenced from the Rhino model>)

# ---- group: Total height
multiplication = Multiplication(A=number_slider, B=number_slider_4)
panel = Panel(multiplication)

# ---- group: base_curve_02
curve_02 = Curve(<curve referenced from the Rhino model>)

# ---- group: moving base curves in z direction / Layer height
number_slider_5 = Slider(3, range=0..10)

# ---- group: moving base curves in z direction
number_slider_6 = Slider(15, range=0..100)
series_2 = Series(Start=0, Step=number_slider_5, Count=number_slider_6)
unit_z_4 = UnitZ(Factor=series_2)
move_4 = Move(Geometry=base_curve_2, Motion=unit_z_4)  # -> Geometry, Transform

# ---- group: lofted surface
loft = Loft(
    Curves=[move.Geometry, curve_02],
    Options={Adjust=False, Closed=False, LoftEnds=0, LoftSimp=0, LoftType=0, Rebuild=10, Refit=0.01})

# ---- group: deconstruct box to get z extents
bounding_box = BoundingBox(Content=loft, Plane=PlaneXY(0, 0, 0))  # -> Box, Box_2
deconstruct_box = DeconstructBox(Box=bounding_box.Box)  # -> Plane, X, Y, Z

# ---- group: Total height
multiplication_2 = Multiplication(A=number_slider_5, B=number_slider_6)
panel_2 = Panel(multiplication_2)

# ----
panel_3 = Panel("""0
1
1
1""")
shift_list = ShiftList(List=move_3.Geometry, Shift=Slider(5, range=0..10), Wrap=True)

# ---- group: layer thickness
number_slider_7 = Slider(1.5, range=0..10)

number_slider_8 = Slider(1.6, range=0..10)

# ----
base_curve_3 = Curve(<curve referenced from the Rhino model>)
number_slider_9 = Slider(30, range=0..100)
multiplication_3 = Multiplication(A=number_slider_8, B=number_slider_9)

# ---- group: Select alternate curves
dispatch = Dispatch(List=shift_list, DispatchPattern=panel_3)  # -> ListA, ListB

# ---- group: Layer thickness
number_slider_10 = Slider(1.45, range=0..10)

# ----
deconstruct_domain = DeconstructDomain(Domain=deconstruct_box.Z)  # -> Start, End
division = Division(A=deconstruct_domain.End, B=number_slider_10)

unit_z_5 = UnitZ(Factor=Slider(0.8, range=0..10))
unit_z_6 = UnitZ(Factor=Slider(0.8, range=0..10))

# ---- group: Select alternate curves
dispatch_2 = Dispatch(List=move_4.Geometry, DispatchPattern=[True, False])  # -> ListA, ListB

# ----
move_5 = Move(Geometry=base_curve_3, Motion=unit_z_5)  # -> Geometry, Transform

# ---- group: create layers
series_3 = Series(Start=0, Step=number_slider_8, Count=number_slider_9)
unit_z_7 = UnitZ(Factor=series_3)
move_6 = Move(Geometry=move_5.Geometry, Motion=unit_z_7)  # -> flatten(Geometry), Transform

# ---- group: get normalised parameters to create points
range = Range(Domain=Domain(0, 1), Steps=division)

# ---- group: number of layers
panel_4 = Panel(multiplication_3)

# ---- group: normalised points for surface evaluation
construct_point = ConstructPoint(XCoordinate=range, YCoordinate=0, ZCoordinate=0)

# ---- group: divide curve into points
number_slider_11 = Slider(100, range=0..100)
divide_curve = DivideCurve(Curve=move_6.Geometry, Count=Slider(100, range=0..1000), Kinks=False)  # -> Points, Tangents, Parameters

# ---- group: Isocurves
iso_curve = IsoCurve(Surface=reparameterize(loft), UVPoint=construct_point)  # -> UIsocurve, VIsocurve

# ----
panel_5 = Panel("""1
0
0""")

divide_curve_2 = DivideCurve(Curve=iso_curve.VIsocurve, Count=Slider(150, range=0..1000), Kinks=False)  # -> Points, Tangents, Parameters
polyline = PolyLine(Vertices=divide_curve_2.Points, Closed=Slider(1, range=0..1))  # -> flatten(Polyline)

number_slider_12 = Slider(3, range=0..10)
unit_z_8 = UnitZ(Factor=number_slider_2)
curve = Curve(<curve referenced from the Rhino model>)
move_7 = Move(Geometry=curve, Motion=unit_z_8)  # -> Geometry, Transform

dispatch_3 = Dispatch(List=divide_curve.Points, DispatchPattern=[True, False])  # -> ListA, ListB
dispatch_4 = Dispatch(List=divide_curve.Parameters, DispatchPattern=[True, False])  # -> ListA, ListB
odd_points = Point(dispatch_3.ListA)
even_parameters = Data(dispatch_4.ListB)
even_points = Point(dispatch_3.ListB)
attractor_points = Point([<point referenced from the Rhino model> x4])
odd_parameters = Data(dispatch_4.ListA)
attractor_curve = Curve(<curve referenced from the Rhino model>)
evaluate_curve = EvaluateCurve(Curve=move_6.Geometry, Parameter=even_parameters)  # -> Point, Tangent, Angle
merge = Merge(Data1=move_7.Geometry, Data2=polyline)
curve_closest_point = CurveClosestPoint(Point=even_points, Curve=attractor_curve)  # -> Point, Parameter, Distance
bounds = Bounds(Numbers=curve_closest_point.Distance)
construct_domain = ConstructDomain(DomainStart=Slider(-3, range=-20..20), DomainEnd=Slider(6, range=-20..20))
closest_points = ClosestPoints(Count=3)  # -> ClosestPoint, CPIndex, Distance

python_3_script = Python3Script(r_curves=merge)  # -> flatten(compas_polylines); inputs r_curves: list
# ---------- python_3_script: Python ----------
from compas_rhino.conversions import curve_to_compas
from compas_rhino.conversions import curve_to_compas_polyline


# compas_curves = []

# for curve in r_curves:
#     c_curve = curve_to_compas(curve)
#     compas_curves.append(c_curve)

compas_polylines = []

for c in r_curves:
    p_curve = curve_to_compas_polyline(c)
    compas_polylines.append(p_curve)
# ---------- end python_3_script ----------

radians = Radians(Degrees=Slider(90, range=0..100))
unit_z_9 = UnitZ(Factor=1)
remap_numbers = RemapNumbers(Value=curve_closest_point.Distance, Source=bounds, Target=construct_domain)  # -> Mapped, Clipped
rotate = Rotate(Vector=evaluate_curve.Tangent, Axis=unit_z_9, Angle=radians)

speed_mm_s = Slider(15, range=1..50)
safety_distance_mm = Slider(100, range=10..300)
blend_radius_mm = Slider(0.5, range=0..5)
printpath = Printpath(layers=python_3_script, speed=speed_mm_s, blend_radius=blend_radius_mm, safety_distance=safety_distance_mm)  # -> printpath, summary; inputs layers: list
# ---------- printpath: Python ----------
# r: compas
# venv: mas-2627
"""
Turn the layers into printpoints and a PrintPath, in work object coordinates.
Safety points are added here, before any transform to the robot base.
"""
import os
import sys

from compas.geometry import Frame, Vector


# Find source folder
gh_dir = os.path.dirname(ghenv.Component.OnPingDocument().FilePath)
src_dir = os.path.join(gh_dir, "..", "..", "src")
if src_dir not in sys.path:
    sys.path.append(src_dir)
from print_class import PrintPoint, PrintPath

# ===== One printpoint per point =====
# world XY orientation for every point: a tangent frame would turn the wrist 360 degrees each layer
printpoints = []
for layer_index, layer in enumerate(layers):
    for point in layer.points:
        frame = Frame(point, -Vector.Xaxis(), Vector.Yaxis())
        printpoints.append(PrintPoint(frame, layer_index, speed, blend_radius, True))

# ===== Path with a travel point above the start and the end =====
printpath = PrintPath(printpoints)
printpath.add_safety_before(safety_distance, speed)
printpath.add_safety_after(safety_distance, speed)

summary = f"{len(printpoints)} printpoints in {len(layers)} layers, plus 2 safety points"
# ---------- end printpath ----------
panel_6 = Panel(printpath.summary)

amplitude = Amplitude(Vector=rotate, Amplitude=remap_numbers.Mapped)
move_8 = Move(Geometry=even_points, Motion=amplitude)  # -> Geometry, Transform
weave = Weave(Pattern=[0, 1], Stream0=odd_points, Stream1=move_8.Geometry, NullGaps=False)

save = Button()
save_2 = Save(printpath=printpath.printpath, save=save, out_path="data/out_printpoints_trial02.json")  # -> status
# ---------- save_2: Python ----------
# r: compas
# venv: mas-2627
"""
On button press, write the printpath to data/out_printpoints.json next to this .ghx file.
send_to_robot.py reads that file.
"""
import json
import os

import scriptcontext as sc

gh_dir = os.path.dirname(ghenv.Component.OnPingDocument().FilePath)

# keep the last status in sticky, so the message survives the button being released
status_key = "save_status_" + str(ghenv.Component.InstanceGuid)

if save:
    if printpath is None:
        sc.sticky[status_key] = "nothing to save: no printpath"
    else:
        path = os.path.normpath(os.path.join(gh_dir, out_path))
        os.makedirs(os.path.dirname(path), exist_ok=True)
        with open(path, "w") as f:
            json.dump(printpath.to_dict(), f, indent=2)
        sc.sticky[status_key] = f"saved {len(printpath)} printpoints to {path}"

status = sc.sticky.get(status_key, "")
ghenv.Component.Message = "saved" if status.startswith("saved") else status
# ---------- end save_2 ----------
panel_7 = Panel(save_2)

preview = Preview(printpath=printpath.printpath)  # -> path, travel, planes
# ---------- preview: Python ----------
# r: compas
# venv: mas-2627
"""
Draw the printpath: path = the whole polyline, travel = extruder-off segments,
safety = extruder-off points, axes = small x and y axis of each frame.
"""
import Rhino.Geometry as rg
from compas_rhino.conversions import frame_to_rhino_plane, point_to_rhino

AXIS_LENGTH = 5.0  # mm

points = printpath.printpoints
planes = [frame_to_rhino_plane(printpoint.frame) for printpoint in points]

# ===== Whole path =====
polyline = rg.Polyline()
for plane in planes:
    polyline.Add(plane.Origin.X, plane.Origin.Y, plane.Origin.Z)
path = polyline.ToPolylineCurve()

# ===== Extruder off: a segment prints only if both of its points have the extruder on =====
safety = [point_to_rhino(printpoint.frame.point) for printpoint in points if not printpoint.is_extruder_on]
travel = []
for i in range(len(points) - 1):
    if not (points[i].is_extruder_on and points[i + 1].is_extruder_on):
        travel.append(rg.Line(planes[i].Origin, planes[i + 1].Origin))
# ---------- end preview ----------
plane = Plane(preview.planes)
preview_2 = CustomPreview(Geometry=preview.travel, Material=ColourSwatch(SwatchColor=RGB(230, 40, 40)))
preview_3 = CustomPreview(Geometry=preview.path, Material=ColourSwatch(SwatchColor=RGB(0, 170, 80)))

polyline_2 = PolyLine(Vertices=weave, Closed=Slider(1, range=0..1))  # -> flatten(Polyline)

# ---- group: Tail for print start
curve_2 = Curve(<curve referenced from the Rhino model>)
unit_z_10 = UnitZ(Factor=number_slider_3)
move_9 = Move(Geometry=curve_2, Motion=unit_z_10)  # -> Geometry, Transform

# ----
python_3_script_2 = Python3Script()  # -> out, layers, flatten(mesh)
# ---------- python_3_script_2: Python ----------
import Rhino.Geometry as rg
import math as m
import numpy as np

class Column:
    
    def __init__(self, axis: rg.Curve, radius_base: float, radius_top: float):

        self.axis = axis
        self.radius_base = radius_base
        self.radius_top = radius_top
        self.height = axis.PointAtEnd.Z - axis.PointAtStart.Z
        # Reparametrize the curve
        self.axis.Domain = rg.Interval(0.0 , 1.0)


    def get_point(self, angle: float, tz: float) -> rg.Point3d:

        """
        Args:
            angle: angle in polar coord.in radians
            tz: parameter on axis

        """

        origin = self.axis.PointAt(tz)
        radius = self.get_radius_wave(angle, tz, 2, 3)

        pt = rg.Point3d(
            origin.X + m.cos(angle) * radius,
            origin.Y + m.sin(angle) * radius,
            origin.Z
        )

        return pt


    def get_radius(self, angle: float, tz: float) -> float:
        return self.radius_base * (1-tz) + self.radius_top * tz

    def get_radius_bezier(self, tz: float) -> float:
        bezier = rg.BezierCurve(
            [
                rg.Point2d(-5,-5),
                rg.Point2d(0.2,8),
                rg.Point2d(0.8,-0.5),
                rg.Point2d(0.2,1)
            ]
        )

        radius = self.radius_base * (1 - tz) + self.radius_top * (tz)
        radius += bezier.PointAt(tz).Y * 5
        return radius

    def get_radius_wave(self, angle: float, tz: float, freq: int, amp: float) -> float:

        # rotate

        # shift = tz * m.radians(135)
        # angle += shift
        
        # fade
        # amp =  m.sqrt(1 - tz) * amp

        # radius = self.get_radius(angle,tz) + (m.cos(angle*freq) * amp)
        # return radius

        # blend wave frequency
        # freq1 = 3
        # freq2 = 5

        # _r1 = m.cos(angle*freq1) * amp
        # _r2 = m.cos(angle*freq2) * amp

        # radius = self.get_radius(angle,tz) + _r1*(1-tz) + _r2*(tz)
        # return radius

        # rotate in both directions
        shift = tz * m.radians(120)

        _r1 = self.get_radius(angle, tz) + m.cos((angle+2*shift)*freq)*amp
        _r2 = self.get_radius(angle, tz) + m.cos((angle-shift) * freq)*amp
        radius =  _r1*(1-tz) + _r2*(tz)
        return radius



    def get_layers(self, layer_height : float, res_u: int) -> list[int, list[rg.Point3d]]:

        layers_count = int(self.height // layer_height) + 1

        layers = []

        for tz in np.linspace(0, 1, layers_count)[: ]:
            layer = []
            for angle in np.linspace(0, m.tau, res_u)[ : -1 ]:
                pt = (self.get_point(angle, tz))
                layer.append(pt)

            layers.append(layer)

        return layers

    @staticmethod
    def get_mesh(layers: list[list[rg.Point3d]], closed: bool) -> rg.Mesh:
        mesh = rg.Mesh()

        for layer in layers:
            for pt in layer:
                mesh.Vertices.Add(pt)

        idx = np.array(range(mesh.Vertices.Count))
        idx = idx.reshape(len(layers),len(layer))

        if closed:
            faces = np.stack([
                idx[:-1],
                np.roll(idx[:-1], -1, axis = 1),
                np.roll(idx[1:], -1, axis = 1),
                idx[1:]

            ], axis = -1).reshape(-1,4)
            print(faces)

        else:
            faces = np.lib.stride_tricks.sliding_window_view(
                idx, window_shape=(2,2)
            ).reshape(-1,4)

            print(faces)

        for face in faces:
            mesh.Faces.AddFace(
            *[int(f) for f in face]
            )

        mesh.Compact()
        mesh.RebuildNormals()
        
        return mesh

        

if __name__ == "__main__":

    axis = rg.LineCurve(
        rg.Point3d(150, 150,0),
        rg.Point3d(150,150,100)
    )


    my_column = Column(axis,40,35)
    layers = my_column.get_layers(2,75)

    mesh = Column.get_mesh(layers, closed = True)

    import ghpythonlib.treehelpers as tree
    layers = tree.list_to_tree(layers)
# ---------- end python_3_script_2 ----------
mesh = Mesh(python_3_script_2.mesh)
polyline_3 = PolyLine(Vertices=python_3_script_2.layers, Closed=False)  # -> flatten(Polyline)
custom_preview = CustomPreview(
    Geometry=mesh,
    Material={diffuse=RGB(221, 160, 221), emission=RGB(66, 48, 66), shine=0.5, specular=RGB(255, 255, 255), transparency=0})
reverse_list = ReverseList(List=polyline_3)
loft_2 = Loft(Curves=reverse_list, Options={Adjust=False, Closed=False, LoftEnds=0, LoftSimp=0, LoftType=0, Rebuild=10, Refit=0.01})
custom_preview_2 = CustomPreview(
    Geometry=loft_2,
    Material={diffuse=RGB(221, 160, 221), emission=RGB(66, 48, 66), shine=0.5, specular=RGB(255, 255, 255), transparency=0})

# ----
# \\ Print sample 10  \\ Wavy lines \\ 2 - Attractor curve
base_curve_4 = Curve(<curve referenced from the Rhino model>)
number_slider_13 = Slider(26, range=0..100)
multiplication_4 = Multiplication(A=number_slider_7, B=number_slider_13)

move_10 = Move(Geometry=base_curve_4, Motion=unit_z_6)  # -> Geometry, Transform

# ---- group: create layers
series_4 = Series(Start=0, Step=number_slider_7, Count=number_slider_13)
unit_z_11 = UnitZ(Factor=series_4)
move_11 = Move(Geometry=move_10.Geometry, Motion=unit_z_11)  # -> flatten(Geometry), Transform

# ---- group: number of layers
panel_8 = Panel(multiplication_4)

# ---- group: divide curve into points
divide_curve_3 = DivideCurve(Curve=move_11.Geometry, Count=Slider(50, range=0..1000), Kinks=False)  # -> Points, Tangents, Parameters

# ----
odd_curves = Curve(dispatch.ListB)
even_curves = Curve(dispatch.ListA)

# ---- group: Divide curve into points
divide_curve_4 = DivideCurve(Curve=odd_curves, Count=Slider(30, range=0..100), Kinks=False)  # -> Points, Tangents, Parameters

# ---- group: Odd and even points
dispatch_5 = Dispatch(List=divide_curve_4.Points, DispatchPattern=[True, False])  # -> ListA, ListB

# ----
dispatch_6 = Dispatch(List=divide_curve_4.Parameters, DispatchPattern=[True, False])  # -> ListA, ListB

evaluate_curve_2 = EvaluateCurve(Curve=graft(odd_curves), Parameter=dispatch_6.ListB)  # -> Point, Tangent, Angle
radians_2 = Radians(Degrees=Slider(90, range=0..100))
unit_z_12 = UnitZ(Factor=1)
rotate_2 = Rotate(Vector=evaluate_curve_2.Tangent, Axis=unit_z_12, Angle=radians_2)
amplitude_2 = Amplitude(Vector=rotate_2, Amplitude=Slider(7, range=0..10))

divide_curve_5 = DivideCurve(Curve=even_curves, Count=Slider(30, range=0..2200), Kinks=False)  # -> Points, Tangents, Parameters

# ---- group: polyline for odd flat curves
polyline_4 = PolyLine(Vertices=divide_curve_5.Points, Closed=Slider(1, range=0..1))  # -> flatten(Polyline)

# ----
odd_curves_2 = Curve(dispatch_2.ListB)
even_curves_2 = Curve(dispatch_2.ListA)

# ---- group: Divide curve into points
divide_curve_6 = DivideCurve(Curve=odd_curves_2, Count=Slider(50, range=0..100), Kinks=False)  # -> Points, Tangents, Parameters

# ---- group: Odd and even points
dispatch_7 = Dispatch(List=divide_curve_6.Points, DispatchPattern=[True, False])  # -> ListA, ListB

# ----
divide_curve_7 = DivideCurve(Curve=even_curves_2, Count=Slider(200, range=0..2200), Kinks=False)  # -> Points, Tangents, Parameters

# ---- group: polyline for odd flat curves
polyline_5 = PolyLine(Vertices=divide_curve_7.Points, Closed=Slider(1, range=0..1))  # -> flatten(Polyline)

# ----
dispatch_8 = Dispatch(List=divide_curve_3.Points, DispatchPattern=[True, False])  # -> ListA, ListB
dispatch_9 = Dispatch(List=divide_curve_3.Parameters, DispatchPattern=[True, False])  # -> ListA, ListB
odd_points_2 = Point(dispatch_8.ListA)
even_points_2 = Point(dispatch_8.ListB)

# ---- group: even parameter for even points
even_parameters_2 = Data(dispatch_9.ListB)

# ----
attractor_curves = Curve(<curve referenced from the Rhino model>)
divide_curve_8 = DivideCurve(Curve=attractor_curves, Count=Slider(50, range=0..100), Kinks=False)  # -> flatten(Points), Tangents, Parameters
closest_point = ClosestPoint(Point=even_points_2, Cloud=divide_curve_8.Points)  # -> ClosestPoint, CPIndex, Distance

# ---- group: remapped distances for the even points
bounds_2 = Bounds(Numbers=closest_point.Distance)
construct_domain_2 = ConstructDomain(DomainStart=Slider(-4, range=-20..20), DomainEnd=Slider(10, range=-20..20))
remap_numbers_2 = RemapNumbers(Value=closest_point.Distance, Source=bounds_2, Target=construct_domain_2)  # -> reverse(Mapped), Clipped

# ---- group: Normals at even points for the movement of even points
evaluate_curve_3 = EvaluateCurve(Curve=move_11.Geometry, Parameter=even_parameters_2)  # -> Point, Tangent, Angle
radians_3 = Radians(Degrees=Slider(90, range=0..100))
unit_z_13 = UnitZ(Factor=1)
rotate_3 = Rotate(Vector=evaluate_curve_3.Tangent, Axis=unit_z_13, Angle=radians_3)

# ----
point = Point(closest_point.ClosestPoint)

# ---- group: scaled normal vectors
amplitude_3 = Amplitude(Vector=rotate_3, Amplitude=remap_numbers_2.Mapped)

# ----
move_12 = Move(Geometry=even_points_2, Motion=amplitude_3)  # -> Geometry, Transform

# ---- group: weave even and odd points back
weave_2 = Weave(Pattern=[0, 1], Stream0=odd_points_2, Stream1=move_12.Geometry, NullGaps=False)

# ---- group: print path rhino polylines
polyline_6 = PolyLine(Vertices=weave_2, Closed=Slider(1, range=0..1))  # -> flatten(Polyline)

# ----
interpolate = Interpolate(Vertices=weave_2, Degree=3, Periodic=False, KnotStyle=1)  # -> flatten(Curve), Length, Domain
loft_3 = Loft(
    Curves=flatten(polyline_6),
    Options={Adjust=False, Closed=False, LoftEnds=0, LoftSimp=0, LoftType=0, Rebuild=10, Refit=0.01})

odd_curves_odd_points = Point(dispatch_5.ListB)
odd_curves_even_points = Point(dispatch_5.ListA)

odd_curves_odd_points_2 = Point(dispatch_7.ListB)
odd_curves_even_points_2 = Point(dispatch_7.ListA)

# ---- group: Move alternate points up
number_slider_14 = Slider(4, range=0..10)

number_slider_15 = Slider(6, range=0..10)

# ----
division_2 = Division(A=number_slider_14, B=Slider(2, range=0..10))

# ---- group: MOve alternate points down
unit_z_14 = UnitZ(Factor=expr("-x", division_2))
move_13 = Move(Geometry=odd_curves_odd_points, Motion=unit_z_14)  # -> Geometry, Transform

# ---- group: Move alternate points up (continued)
unit_z_15 = UnitZ(Factor=division_2)
move_14 = Move(Geometry=odd_curves_even_points, Motion=unit_z_15)  # -> Geometry, Transform

# ----
weave_3 = Weave(Pattern=[0, 1], Stream0=odd_curves_even_points, Stream1=move_13.Geometry, NullGaps=False)

# ---- group: polyline for even zig zag curves
polyline_7 = PolyLine(Vertices=weave_3, Closed=Slider(1, range=0..1))  # -> flatten(Polyline)

# ---- group: all curves
merge_2 = Merge(Data1=polyline_4, Data2=polyline_7)  # -> flatten(Result)

# ---- group: Sort curves based on their layer height
evaluate_curve_4 = EvaluateCurve(Curve=merge_2, Parameter=Slider(0.5, range=0..1))  # -> Point, Tangent, Angle
deconstruct = Deconstruct(Point=evaluate_curve_4.Point)  # -> XComponent, YComponent, ZComponent
sort_list = SortList(Keys=deconstruct.ZComponent, ValuesValuesA=merge_2)  # -> Keys, ValuesValuesA

# ----
division_3 = Division(A=number_slider_15, B=Slider(2, range=0..10))

# ---- group: MOve alternate points down
unit_z_16 = UnitZ(Factor=expr("-x", division_3))
move_15 = Move(Geometry=odd_curves_odd_points_2, Motion=unit_z_16)  # -> Geometry, Transform

# ---- group: Move alternate points up (continued)
unit_z_17 = UnitZ(Factor=division_3)
move_16 = Move(Geometry=odd_curves_even_points_2, Motion=unit_z_17)  # -> Geometry, Transform

# ----
weave_4 = Weave(Pattern=[0, 1], Stream0=move_16.Geometry, Stream1=move_15.Geometry, NullGaps=False)

# ---- group: polyline for even zig zag curves
polyline_8 = PolyLine(Vertices=weave_4, Closed=Slider(1, range=0..1))  # -> flatten(Polyline)

# ---- group: all curves
merge_3 = Merge(Data1=polyline_5, Data2=polyline_8)  # -> flatten(Result)

# ---- group: Sort curves based on their layer height
evaluate_curve_5 = EvaluateCurve(Curve=merge_3, Parameter=Slider(0.5, range=0..1))  # -> Point, Tangent, Angle
deconstruct_2 = Deconstruct(Point=evaluate_curve_5.Point)  # -> XComponent, YComponent, ZComponent
sort_list_2 = SortList(Keys=deconstruct_2.ZComponent, ValuesValuesA=merge_3)  # -> Keys, ValuesValuesA

# ---- group: All print layers
merge_4 = Merge(Data1=move_9.Geometry, Data2=sort_list_2.ValuesValuesA)

# ---- group: convert rhino polylines to compas_polylines
python_3_script_3 = Python3Script(r_curves=sort_list_2.ValuesValuesA)  # -> out, compas_curves; inputs r_curves: list
# ---------- python_3_script_3: Python ----------
from compas_rhino.conversions import curve_to_compas
from compas_rhino.conversions import curve_to_compas_polyline

compas_curves = []

for c in r_curves:
    c_curve = curve_to_compas_polyline(c)
    compas_curves.append(c_curve)
# ---------- end python_3_script_3 ----------

# ----
# Export
list_item = ListItem(List=merge_4, Index=0, Wrap=True)

# ---- group: convert to compas polylines
python_3_script_4 = Python3Script(r_curves=merge_4)  # -> flatten(compas_polylines); inputs r_curves: list; same code as python_3_script

# ----
safety_distance_mm_2 = Slider(100, range=10..300)
blend_radius_mm_2 = Slider(0.5, range=0..5)
speed_mm_s_2 = Slider(3, range=1..50)
printpath_2 = Printpath(layers=python_3_script_4, speed=speed_mm_s_2, blend_radius=blend_radius_mm_2, safety_distance=safety_distance_mm_2)  # -> printpath, summary; inputs layers: list; same code as printpath
panel_9 = Panel(printpath_2.summary)

save_3 = Button()
save_4 = Save(printpath=printpath_2.printpath, save=save_3, out_path="data/out_printpoints_trial02.json")  # -> status; same code as save_2

preview_4 = Preview(printpath=printpath_2.printpath)  # -> path, travel, planes; same code as preview
plane_2 = Plane(preview_4.planes)
preview_5 = CustomPreview(Geometry=preview_4.travel, Material=ColourSwatch(SwatchColor=RGB(230, 40, 40)))
# TEMP
preview_6 = CustomPreview(Geometry=preview_4.path, Material=ColourSwatch(SwatchColor=RGB(0, 170, 80)))

panel_10 = Panel(save_4)
