# Grasshopper definition 261110_gh_to_vscode_IA02.gh (Grasshopper 1.0.8)
# plug-ins: Pufferfish

# ---- group: base_geometry / geometry axis
geometry_axis = Geometry(<curve referenced from the Rhino model>)

# ---- group: base_geometry
unit_z = UnitZ(Factor=Slider(3.5, range=0..10))
move = Move(Geometry=geometry_axis, Motion=unit_z)  # -> Geometry, Transform

# ---- group: base_geometry / geometry
end_points = EndPoints(Curve=move.Geometry)  # -> Start, End
curve_closest_point = CurveClosestPoint(Point=[end_points.Start, end_points.End], Curve=move.Geometry)  # -> Point, Parameter, Distance
pipe_variable = PipeVariable(
    Curve=move.Geometry,
    Parameters=curve_closest_point.Parameter,
    Radii=[Slider(35, range=0..100), Slider(20, range=0..100)],
    Caps=0,
    FitRail=False)

# ---- group: Isocurves / deconstruct box to get z extents
bounding_box = BoundingBox(Content=pipe_variable, Plane=PlaneXY(0, 0, 0))  # -> Box, Box_2
deconstruct_box = DeconstructBox(Box=bounding_box.Box)  # -> Plane, X, Y, Z

# ---- group: Isocurves
number_slider = Slider(0.9, range=0..10)
deconstruct_domain = DeconstructDomain(Domain=deconstruct_box.Z)  # -> Start, End
division = Division(A=deconstruct_domain.End, B=number_slider)

# ---- group: Isocurves / get normalised parameters to create points
range = Range(Domain=Domain(0, 1), Steps=division)

# ---- group: Isocurves / normalised points for surface evaluation
construct_point = ConstructPoint(XCoordinate=range, YCoordinate=0, ZCoordinate=0)

# ---- group: Isocurves
iso_curve = IsoCurve(Surface=reparameterize(pipe_variable), UVPoint=construct_point)  # -> UIsocurve, VIsocurve

# ---- group: change the curve seam
seam = Seam(Curve=iso_curve.VIsocurve, Seam=Slider(0, range=0..1))

# ---- group: Divide curves into points
number_slider_2 = Slider(50, range=0..1000)
divide_curve = DivideCurve(Curve=flatten(seam), Count=number_slider_2, Kinks=False)  # -> Points, Tangents, Parameters

# ---- group: Attractor curve spiral using the division points / spiral using division points
series = Series(Start=0, Step=Slider(3, range=0..10), Count=division)
list_item = ListItem(List=divide_curve.Points, Index=graft(series), Wrap=True)  # -> flatten(Item)
interpolate = Interpolate(Vertices=list_item, Degree=3, Periodic=False, KnotStyle=1)  # -> Curve, Length, Domain

# ---- group: Attractor curve spiral using the division points / middle point of geometry axis
evaluate_curve = EvaluateCurve(Curve=reparameterize(move.Geometry), Parameter=Slider(0.5, range=0..1))  # -> Point, Tangent, Angle

# ---- group: Attractor curve spiral using the division points / Attractor_curve
scale = Scale(Geometry=interpolate.Curve, Center=evaluate_curve.Point, Factor=Slider(1.8, range=0..10))  # -> Geometry, Transform

# ---- group: Attractor curve spiral using the division points / Trim the extra edge for attractor curve
points_trim_curve = PointsTrimCurve(Curve=reparameterize(scale.Geometry), Parameters=Slider(0.983, range=0..1), Flip=False)  # -> Trimmed, SubDomains, Intersected
attractor_curve = Curve(points_trim_curve.Trimmed)

# ---- group: Generate vectors for normal outward movement of the points / create additional point
unit_z_2 = UnitZ(Factor=expr("-x", number_slider))
list_item_2 = ListItem(List=flatten(seam), Index="-1", Wrap=True)
move_2 = Move(Geometry=list_item_2, Motion=unit_z_2)  # -> Geometry, Transform
area = Area(Geometry=flatten(move_2.Geometry))  # -> Area, Centroid

# ---- group: Generate vectors for normal outward movement of the points / Tangents at point on curve
evaluate_curve_2 = EvaluateCurve(Curve=reparameterize(flatten(seam)), Parameter=Slider(0.5, range=0..1))  # -> Point, Tangent, Angle

# ---- group: Generate vectors for normal outward movement of the points / unitize the vectors
unit_vector = UnitVector(Vector=evaluate_curve_2.Tangent)

# ----
point = Point(divide_curve.Points)
# export: preview and save
mode = ValueList({"speed": 0, "overhang": 1}, selected="speed")  # disabled

deconstruct_brep = DeconstructBrep(Brep=pipe_variable)  # -> Faces, Edges, Vertices
safety_distance_mm = Slider(100, range=10..300)
blend_radius_mm = Slider(0.5, range=0..5)
speed_mm_s = Slider(8, range=1..50)

# ---- group: print tail // base of the print
list_item_3 = ListItem(List=deconstruct_brep.Edges, Index=Slider(5, range=0..10), Wrap=True)
offset_curve = OffsetCurve(Curve=list_item_3, Distance=Slider(9, range=0..10), Corners=1)

# ---- group: Generate vectors for normal outward movement of the points / Perpendicular vectors between slice curves
area_2 = Area(Geometry=flatten(seam))  # -> Area, Centroid

# ---- group: Generate vectors for normal outward movement of the points
merge = Merge(Data1=area_2.Centroid, Data2=area.Centroid)  # -> flatten(Result)

# ---- group: Generate vectors for normal outward movement of the points / cull_first_point
cull_index = CullIndex(List=merge, Indices=Slider(0, range=0..100), Wrap=True)

# ---- group: Generate vectors for normal outward movement of the points / Perpendicular vectors between slice curves (continued)
vector_2pt = Vector2Pt(PointA=area_2.Centroid, PointB=cull_index, Unitize=False)  # -> Vector, Length

# ---- group: Generate vectors for normal outward movement of the points / unitize the vectors
unit_vector_2 = UnitVector(Vector=vector_2pt.Vector)

# ---- group: Generate vectors for normal outward movement of the points / Normal vectors for all points
cross_product = CrossProduct(VectorA=unit_vector_2, VectorB=unit_vector, Unitize=False)  # -> graft(Vector), Length

# ---- group: pattern_generation
dispatch = Dispatch(List=divide_curve.Points, DispatchPattern=[True, False])  # -> ListA, ListB
odd_points = Point(dispatch.ListA)
even_points = Point(dispatch.ListB)

attractor_curves = Curve(attractor_curve)
divide_curve_2 = DivideCurve(Curve=attractor_curves, Count=Slider(100, range=0..100), Kinks=False)  # -> flatten(Points), Tangents, Parameters
closest_point = ClosestPoint(Point=even_points, Cloud=divide_curve_2.Points)  # -> ClosestPoint, CPIndex, Distance

# ---- group: pattern_generation / remapped distances for the even points
bounds = Bounds(Numbers=closest_point.Distance)
construct_domain = ConstructDomain(DomainStart=Slider(-1, range=-20..20), DomainEnd=Slider(6, range=-20..20))
remap_numbers = RemapNumbers(Value=closest_point.Distance, Source=bounds, Target=construct_domain)  # -> Mapped, Clipped

# ---- group: pattern_generation / scaled normal vectors
amplitude = Amplitude(Vector=cross_product.Vector, Amplitude=remap_numbers.Mapped)

# ---- group: pattern_generation (continued)
move_3 = Move(Geometry=even_points, Motion=amplitude)  # -> Geometry, Transform

# ---- group: pattern_generation / weave even and odd points back
weave = Weave(Pattern=[0, 1], Stream0=odd_points, Stream1=move_3.Geometry, NullGaps=False)

# ----
flip_matrix = FlipMatrix(Data=weave)
polyline = PolyLine(Vertices=flip_matrix, Closed=False)

# ---- group: Perpendicular distances between the points
explode = Explode(Curve=polyline, Recursive=True)  # -> Segments, Vertices
length = Length(Curve=explode.Segments)
flip_matrix_2 = FlipMatrix(Data=length)

# ---- group: Add average speeds for addtional curves / average distance
average = Average(Input=flatten(length))
repeat_data = RepeatData(Data=average, Length=number_slider_2)

# ---- group: Add average speeds for addtional curves
path_mapper = PathMapper(repeat_data, source="{A;B}", target="{0;0;1;0}")
path_mapper_2 = PathMapper(repeat_data, source="{A;B}", target="{0;0;0;0}")

# ----
flip_curve = FlipCurve(Curve=offset_curve)  # -> Curve, Flag
path_mapper_3 = PathMapper(flip_matrix_2, source="{A;B;C;D}", target="{A;B;C + 2;D}")

# ---- group: polyline for print tail
divide_curve_3 = DivideCurve(Curve=flip_curve.Curve, Count=number_slider_2, Kinks=False)  # -> Points, Tangents, Parameters

# ---- group: merge lists of points
path_mapper_4 = PathMapper(weave, source="{A;B;C}", target="{A;B;C + 1}")
shift_paths = ShiftPaths(Data=divide_curve_3.Points, Offset=Slider(2, range=0..10))
merge_2 = Merge(Data1=shift_paths, Data2=path_mapper_4)

# ---- group: print path rhino polylines
polyline_2 = PolyLine(Vertices=merge_2, Closed=Slider(1, range=0..1))  # -> flatten(Polyline)

# ---- group: convert to compas_polylines
python_3_script = Python3Script(r_curves=polyline_2)  # -> flatten(compas_polylines); inputs r_curves: list
# ---------- python_3_script: Python ----------
from compas_rhino.conversions import curve_to_compas
from compas_rhino.conversions import curve_to_compas_polyline


# compas_curves = []

# for curve in r_curves:
#     c_curve = curve_to_compas(curve)
#     compas_curves.append(c_curve)

compas_polylines = []

for c in r_curves:
    p_curve = curve_to_compas_polyline(c)
    compas_polylines.append(p_curve)
# ---------- end python_3_script ----------

# ---- group: check_sequence
list_item_4 = ListItem(List=polyline_2, Index=Slider(2, range=0..10), Wrap=True)

# ---- group: 128 lists of distances
list = Merge(Data1=path_mapper_2, Data2=path_mapper, Data3=path_mapper_3)

# ----
simplify_tree = SimplifyTree(Tree=list, Front=False)  # -> flatten(Tree)
printpath = Printpath(layers=python_3_script, speed=speed_mm_s, blend_radius=blend_radius_mm, safety_distance=safety_distance_mm)  # -> printpath, summary; inputs layers: list
# ---------- printpath: Python ----------
# r: compas
# venv: mas-2627
"""
Turn the layers into printpoints and a PrintPath, in work object coordinates.
Safety points are added here, before any transform to the robot base.
"""
import os
import sys

from compas.geometry import Frame, Plane, Vector

# Find source folder
gh_dir = os.path.dirname(ghenv.Component.OnPingDocument().FilePath)
src_dir = os.path.join(gh_dir, "..", "..", "src")
if src_dir not in sys.path:
    sys.path.append(src_dir)
from print_class import PrintPoint, PrintPath

# ===== One printpoint per point =====
printpoints = list()
prev_normal = None

for layer_index, layer in enumerate(layers):
    pts = layer.points
    if len(pts) < 3:
        continue

    # Fit slice plane to the closed curve
    slice_normal = Plane.from_points(pts).normal.unitized()

    # Keep normal orientation continuous across the 90-degree arch turn
    if prev_normal is None:
        if slice_normal.z < 0:
            slice_normal = -slice_normal
    else:
        if slice_normal.dot(prev_normal) < 0:
            slice_normal = -slice_normal

    prev_normal = slice_normal
    tool_z = -slice_normal

    # Choose a stable reference vector that is not parallel to tool_z
    ref_x = -Vector.Xaxis() if abs(tool_z.dot(-Vector.Xaxis())) < 0.9 else Vector.Yaxis()

    # Project reference X onto the slice plane so all frames in the layer share the same tilt
    xaxis = (ref_x - tool_z * ref_x.dot(tool_z)).unitized()
    yaxis = tool_z.cross(xaxis).unitized()

    for point in pts:
        frame = Frame(point, xaxis, yaxis)
        printpoints.append(PrintPoint(frame, layer_index, speed, blend_radius, True))

# ===== Path with a travel point above the start and the end =====
printpath = PrintPath(printpoints)
printpath.add_safety_before(safety_distance, speed)
printpath.add_safety_after(safety_distance, speed)

summary = f"{len(printpoints)} printpoints in {len(layers)} layers, plus 2 safety points"
# ---------- end printpath ----------
panel = Panel(simplify_tree)
printpath_2 = Printpath(
    layers=python_3_script,
    min_speed=Slider(3, range=0..20),
    max_speed=Slider(20, range=0..20),
    distances=simplify_tree,
    blend_radius=blend_radius_mm,
    safety_distance=safety_distance_mm)  # -> printpath, summary; inputs layers: list, min_speed: Double, max_speed: Double, distances: list of Double
# ---------- printpath_2: Python ----------
# r: compas
# venv: mas-2627
"""
Turn the layers into printpoints and a PrintPath.
Assign variable print speeds based on a supplied
list of distances, with frames oriented normal to each slice.

Small distance = high speed
Large distance = low speed
"""

import os
import sys

from compas.geometry import Frame, Plane, Vector


# ===== FIND SOURCE FOLDER =====

gh_dir = os.path.dirname(
    ghenv.Component.OnPingDocument().FilePath
)

src_dir = os.path.join(gh_dir, "..", "..", "src")

if src_dir not in sys.path:
    sys.path.append(src_dir)

from print_class import PrintPoint, PrintPath


# ===== COLLECT PRINTPOINT LOCATIONS =====

all_points = []

for layer_index, layer in enumerate(layers):
    for point in layer.points:
        all_points.append((point, layer_index))


# ===== VALIDATE INPUTS =====

distances = [float(d) for d in distances]

if not distances:
    raise ValueError("Distance list is empty")

# Dynamically expand distances per layer for closed polylines
if len(layers) > 0 and len(all_points) > len(distances):
    pts_per_layer = len(distances) // len(layers)

    if len(distances) == len(layers) * pts_per_layer:
        expanded_distances = []
        for i in range(len(layers)):
            chunk = distances[i * pts_per_layer : (i + 1) * pts_per_layer]
            # Repeat first distance for the closing point
            expanded_distances.extend(chunk + [chunk[0]])
        distances = expanded_distances

if len(distances) != len(all_points):
    raise ValueError(
        "Number of distances ({}) must match "
        "number of printpoints ({})".format(
            len(distances),
            len(all_points)
        )
    )

if min_speed > max_speed:
    raise ValueError(
        "min_speed must be <= max_speed"
    )


# ===== FIND DISTANCE RANGE =====

smallest_distance = min(distances)
largest_distance = max(distances)

distance_range = largest_distance - smallest_distance


# ===== MAP DISTANCES TO SPEEDS =====

speeds = []

for distance in distances:

    if distance_range == 0:
        # All distances equal
        local_speed = (min_speed + max_speed) / 2.0

    else:
        # Normalise distance to 0-1
        t = (
            (distance - smallest_distance)
            / distance_range
        )

        # Invert mapping:
        # small gap = fast
        # large gap = slow
        local_speed = (
            max_speed
            - t * (max_speed - min_speed)
        )

    speeds.append(local_speed)


# ===== CREATE PRINTPOINTS (SLICE-NORMAL FRAMES + VARIABLE SPEED) =====

printpoints = []
prev_normal = None
speed_idx = 0

for layer_index, layer in enumerate(layers):
    pts = layer.points

    if len(pts) < 3:
        # Fallback to world axes if slice has fewer than 3 points
        xaxis = -Vector.Xaxis()
        yaxis = Vector.Yaxis()
    else:
        # Fit slice plane to the closed curve
        slice_normal = Plane.from_points(pts).normal.unitized()

        # Keep normal orientation continuous across tilted/arched slices
        if prev_normal is None:
            if slice_normal.z < 0:
                slice_normal = -slice_normal
        else:
            if slice_normal.dot(prev_normal) < 0:
                slice_normal = -slice_normal

        prev_normal = slice_normal
        tool_z = -slice_normal

        # Choose a stable reference vector that is not parallel to tool_z
        ref_x = -Vector.Xaxis() if abs(tool_z.dot(-Vector.Xaxis())) < 0.9 else Vector.Yaxis()

        # Project reference X onto the slice plane so all frames in the layer share the same tilt
        xaxis = (ref_x - tool_z * ref_x.dot(tool_z)).unitized()
        yaxis = tool_z.cross(xaxis).unitized()

    for point in pts:
        frame = Frame(point, xaxis, yaxis)
        local_speed = speeds[speed_idx]
        speed_idx += 1

        printpoints.append(
            PrintPoint(
                frame,
                layer_index,
                local_speed,
                blend_radius,
                True
            )
        )


# ===== CREATE PRINTPATH =====

printpath = PrintPath(printpoints)

# Safety movements use max_speed input
printpath.add_safety_before(safety_distance, max_speed)
printpath.add_safety_after(safety_distance, max_speed)


# ===== SUMMARY =====

summary = (
    "{} printpoints in {} layers, plus 2 safety points\n"
    "Distance range: {:.2f} to {:.2f}\n"
    "Speed range: {:.2f} to {:.2f}"
).format(
    len(printpoints),
    len(layers),
    smallest_distance,
    largest_distance,
    min(speeds),
    max(speeds)
)
# ---------- end printpath_2 ----------

save = Button()
save_2 = Save(printpath=printpath_2.printpath, save=save, out_path="data/out_printpoints_trial02.json")  # -> status
# ---------- save_2: Python ----------
# r: compas
# venv: mas-2627
"""
On button press, write the printpath to data/out_printpoints.json next to this .ghx file.
send_to_robot.py reads that file.
"""
import json
import os

import scriptcontext as sc

gh_dir = os.path.dirname(ghenv.Component.OnPingDocument().FilePath)

# keep the last status in sticky, so the message survives the button being released
status_key = "save_status_" + str(ghenv.Component.InstanceGuid)

if save:
    if printpath is None:
        sc.sticky[status_key] = "nothing to save: no printpath"
    else:
        path = os.path.normpath(os.path.join(gh_dir, out_path))
        os.makedirs(os.path.dirname(path), exist_ok=True)
        with open(path, "w") as f:
            json.dump(printpath.to_dict(), f, indent=2)
        sc.sticky[status_key] = f"saved {len(printpath)} printpoints to {path}"

status = sc.sticky.get(status_key, "")
ghenv.Component.Message = "saved" if status.startswith("saved") else status
# ---------- end save_2 ----------

panel_2 = Panel(printpath_2.summary)
panel_3 = Panel(save_2)

preview = Preview(printpath=printpath_2.printpath)  # -> path, travel, planes
# ---------- preview: Python ----------
# r: compas
# venv: mas-2627
"""
Draw the printpath: path = the whole polyline, travel = extruder-off segments,
safety = extruder-off points, axes = small x and y axis of each frame.
"""
import Rhino.Geometry as rg
from compas_rhino.conversions import frame_to_rhino_plane, point_to_rhino

AXIS_LENGTH = 5.0  # mm

points = printpath.printpoints
planes = [frame_to_rhino_plane(printpoint.frame) for printpoint in points]

# ===== Whole path =====
polyline = rg.Polyline()
for plane in planes:
    polyline.Add(plane.Origin.X, plane.Origin.Y, plane.Origin.Z)
path = polyline.ToPolylineCurve()

# ===== Extruder off: a segment prints only if both of its points have the extruder on =====
safety = [point_to_rhino(printpoint.frame.point) for printpoint in points if not printpoint.is_extruder_on]
travel = []
for i in range(len(points) - 1):
    if not (points[i].is_extruder_on and points[i + 1].is_extruder_on):
        travel.append(rg.Line(planes[i].Origin, planes[i + 1].Origin))
# ---------- end preview ----------
plane = Plane(preview.planes)
preview_2 = CustomPreview(Geometry=preview.travel, Material=ColourSwatch(SwatchColor=RGB(230, 40, 40)))
preview_3 = CustomPreview(Geometry=preview.path, Material=ColourSwatch(SwatchColor=RGB(27, 53, 80)))

# ---- group: check_order
list_item_5 = ListItem(List=plane, Index=Slider(41, range=0..100), Wrap=True)

# ----
check = Check(printpath=printpath_2.printpath, mode=mode)  # -> beads, values, low, high, param_range, report; disabled
# ---------- check: Python ----------
# r: compas
# venv: mas-2627
import math

import Rhino.Geometry as rg
from compas.geometry import closest_point_on_polyline_xy
from compas.geometry import distance_point_point_xy

MODES = ["speed", "overhang"]

mode = int(mode) if mode is not None else 0
points = printpath.printpoints
n = len(points)


# ===== Printed points, grouped per layer (in print order, so each layer is a polyline) =====
layers = {}
for printpoint in points:
    if printpoint.is_extruder_on:
        layers.setdefault(printpoint.layer_index, []).append(printpoint.frame.point)

# ===== Overhang: how far each point sticks out over the layer below it, as an angle from vertical =====
heights = []    # layer height per point (mm), 0 if nothing below
overhangs = []  # overhang per point (degrees), 0 if nothing below
for printpoint in points:
    point = printpoint.frame.point
    points_below = layers.get(printpoint.layer_index - 1)
    if not printpoint.is_extruder_on or not points_below:
        heights.append(0.0)  # travel point or first layer
        overhangs.append(0.0)
        continue
    below = closest_point_on_polyline_xy(point, points_below)  # closest point on the layer below, between its points too
    height = point.z - points_below[0].z  # layers are flat; below[2] would be 0: the _xy function works in plan only
    heights.append(height)
    overhangs.append(math.degrees(math.atan2(distance_point_point_xy(point, below), height)) if height > 0 else 0.0)

# ===== Time: the robot moves to each point at that point's speed. Ignores acceleration =====
print_time = travel_time = 0.0
for i in range(1, n):
    time = points[i - 1].frame.point.distance_to_point(points[i].frame.point) / points[i].speed
    if points[i - 1].is_extruder_on and points[i].is_extruder_on:
        print_time += time
    else:
        travel_time += time

# ===== Colour: one bead (a strip as high as the layer) and one value per printed segment =====
beads, values = [], []
for i in range(1, n):
    a, b = points[i - 1].frame.point, points[i].frame.point
    printing = points[i - 1].is_extruder_on and points[i].is_extruder_on
    if mode == 0:
        # speed: every move as a line, travel included
        beads.append(rg.LineCurve(rg.Point3d(a.x, a.y, a.z), rg.Point3d(b.x, b.y, b.z)))
        values.append(points[i].speed)
    elif printing:
        # overhang: a strip as high as the layer, only where it prints
        ha, hb = (max(0.8 * (h or 0.0), 0.5) for h in (heights[i - 1], heights[i]))  # first layer: 0.5 mm
        bead = rg.Mesh()
        for x, y, z in [(a.x, a.y, a.z), (b.x, b.y, b.z), (b.x, b.y, b.z - hb), (a.x, a.y, a.z - ha)]:
            bead.Vertices.Add(x, y, z)
        bead.Faces.AddFace(0, 1, 2, 3)
        bead.Normals.ComputeNormals()
        beads.append(bead)
        values.append(overhangs[i] or 0.0)  # first layer: nothing below

param_range = rg.Interval(min(values), max(values))
low, high = (min(values), max(values)) if mode == 0 else (0.0, 45.0)
if high <= low:
    high = low + 1.0  # Gradient needs a range

report = "\n".join([
    f"colour: {MODES[mode]}, {low:.2f} to {high:.2f}",
    f"{n} printpoints, {len(layers)} layers",
    f"time: about {(print_time + travel_time) / 60:.1f} min (print {print_time / 60:.1f}, travel {travel_time / 60:.1f})",
])


ghenv.Component.Message = f"{MODES[mode]} mode, print time {(print_time + travel_time) /  60:.0f} min"
# ---------- end check ----------
gradient = Gradient(
    LowerLimit=check.low,
    UpperLimit=check.high,
    Parameter=check.values,
    stops=[0: RGB(45, 75, 170), 0.35: RGB(40, 175, 165), 0.7: RGB(245, 205, 50), 1: RGB(215, 45, 40)])  # disabled
panel_4 = Panel(check.param_range)  # disabled
preview_4 = CustomPreview(Geometry=check.beads, Material=gradient)  # disabled
panel_5 = Panel(check.report)  # disabled
