# Grasshopper definition DLL_PRINTSCRIPT_11.6.2026.gh (Grasshopper 1.0.8)
# plug-ins: Pufferfish

# ---- group: This is needed only ONCE in the GH definition
enable_auto_reload = Python3Script()  # -> ok
# ---------- enable_auto_reload: Python ----------
"""
------------------------------
Using VS Code as Python editor
------------------------------

The simplest way to start using VS Code as our editor, is
to place our Python code in files located IN THE SAME FOLDER as our Grasshopper file.

After we have done that, we need 2 steps: 

1. Enable the COMPAS reloader on one component. This tells Grasshopper to watch for changes in the Pythoh files and reload if changed.
2. Every other component that uses Python code from external files needs to start with a method to ensure Grasshopper knows where to load the files from.

"""
# r: compas
# venv: mas-2627

from compas_rhino.devtools import DevTools
DevTools.enable_reloader()
# ---------- end enable_auto_reload ----------

# ---- group: Object Height
number_slider = Slider(50, range=0..100)

# ---- group: Print Location
number_slider_2 = Slider(198, range=0..1000)
number_slider_3 = Slider(150, range=0..1000)

# ----
point = Point(Point(198, 150, 0))

# ---- group: Self Contour
geometry = Geometry(<brep referenced from the Rhino model>)
contour = Contour(Shape=geometry, Point=Point(0, 0, 0), Direction=Vector(0, 0, 1), Distance=Slider(1.3, range=0..10))
series = Series(Start=0, Step=1, Count=Slider(4, range=0..10))
control_points = ControlPoints(Curve=contour)  # -> Points, Weights, Knots
list_item = ListItem(List=control_points.Points, Index=series, Wrap=True)

# ----
construct_point = ConstructPoint(XCoordinate=number_slider_2, YCoordinate=number_slider_3, ZCoordinate=0)
construct_point_2 = ConstructPoint(XCoordinate=number_slider_2, YCoordinate=number_slider_3, ZCoordinate=number_slider)
line = Line(StartPoint=construct_point, EndPoint=construct_point_2)

geometry_2 = Geometry(<brep referenced from the Rhino model>)

column_2_11_4_26 = Python3Script(
    curve_input=line,
    base=Slider(36, range=0..100),
    top=Slider(21, range=0..100),
    amp=Slider(9, range=0..10),
    top_freq=Slider(8, range=0..100),
    bottom_freq=Slider(8, range=0..100),
    layer_height=Slider(1.3, range=0..10),
    resolution=Slider(250, range=0..1000))  # -> out, layers, mesh, centers; inputs curve_input: Curve, layer_height: Double, resolution: Int32
# ---------- column_2_11_4_26: Python ----------
import Rhino.Geometry as rg
import math as m
import numpy as np



class Column:
    def __init__(self, axis: rg.Curve, radius_base: float, radius_top: float, amp: float, top_freq: int, bottom_freq: int):
        """

        """
        
        self.axis = axis
        self.radius_base = radius_base
        self.radius_top = radius_top
        self.height = axis.PointAtEnd.Z - axis.PointAtStart.Z
        #reparametrize axis
        self.axis.Domain = rg.Interval(0,1)

    def get_point(self, angle: float, tz: float) -> rg.Point3d:

        """
        Args:
            angle: angle in polar coord. in radians
            tz: parameter on axis
        """

        origin = self.axis.PointAt(tz)
        radius = self.get_radius_wave(angle, tz,bottom_freq,top_freq,amp)

        pt = rg.Point3d(
            origin.X + m.cos(angle)*radius,
            origin.Y + m.sin(angle)*radius,
            origin.Z
        )

        return pt
        return radius

    def get_radius(self, angle:float, tz: float) -> float:
        return self.radius_base*(1-tz) + self.radius_top*tz

    def get_radius_bezier(self, tz: float) -> float:
        bezier = rg.BezierCurve(
            [
                rg.Point2d(0,0),
                rg.Point2d(0.2, 5),
                rg.Point2d(0.8, 2),
                rg.Point2d(1,0)
            ]
        )

        radius = self.radius_base*(1-tz) + self.radius_top*tz
        radius += bezier.PointAt(tz).Y *5
        return radius

    def get_radius_wave(self, angle:float, tz: float, freq1: int, freq2: int, amp: float) -> float:
        #rotate
        shift = tz*m.radians(90)
        angle += shift


        #fade
        # amp = m.pow((1-tz),2)*amp

        # freq1 = 3
        # freq2 = 8

        # _r1 = m.cos(angle*freq1)*amp
        # _r2 = m.cos(angle*freq2)*amp

        # radius = self.get_radius(angle,tz) + _r1*(1-tz) + _r2*(tz)
        # return radius

        #rotate in both directions
        shift = tz*m.radians(90)

        _r1 = self.get_radius(angle, tz) + m.cos((angle+shift)*freq1)*amp
        _r2 = self.get_radius(angle, tz) + m.cos((angle-shift)*freq2)*amp

        radius = _r1*(1-tz) + _r2*tz

        radius = min(_r1,_r2)

        return radius
    

    def get_layers(self, layer_height: float, res_u: int) -> list[int, list[list[rg.Point3d]]]:

        layers_count = int(self.height // layer_height) + 1
        layers = []

        for tz in np.linspace(0, 1, layers_count)[1:]:
            layer = []
            for angle in np.linspace(0, m.tau, res_u)[:-1]:
                pt = self.get_point(angle+m.radians(45), tz)
                layer.append(pt)

            layers.append(layer)


       
        return layers
    

    def get_centers(self, layer_height) -> list[rg.Point3d]:
        centers = []
        layers_count = int(self.height // layer_height) + 1


        for tz in np.linspace(0, 1, layers_count)[1:]:
            center = self.axis.PointAt(tz)

            centers.append(center)
       
        return centers

    @ staticmethod
    def get_mesh(layers: list[list[rg.Point3d]], closed: bool) -> rg.Mesh:
        mesh = rg.Mesh()

        for layer in layers:
            for pt in layer:
                mesh.Vertices.Add(pt)

        idx = np.array(range(mesh.Vertices.Count))
        idx = idx.reshape(len(layers), len(layers[0]))

        if closed:
            faces = np.stack([
                idx[:-1],                             # Top-left
                np.roll(idx[:-1], -1, axis=1),        # Top-right
                idx[1:],                              # Bottom-left
                np.roll(idx[1:], -1, axis=1)          # Bottom-right
            ], axis=-1).reshape(-1, 4)
        else:
            faces = np.lib.stride_tricks.sliding_window_view(
                idx, window_shape=(2, 2)
            ).reshape(-1, 4)
            print(faces)

        for f in faces:
            mesh.Faces.AddFace(
                int(f[0]),
                int(f[1]),
                int(f[3]),
                int(f[2])
            )

        mesh.Compact()
        mesh.RebuildNormals()
        return mesh
    

    
if __name__ == "__main__":
    axis = curve_input
    my_column = Column(axis, base, top, amp, top_freq, bottom_freq)
    layers = my_column.get_layers(layer_height, resolution)
    centers = my_column.get_centers(layer_height)

    mesh = Column.get_mesh(layers, closed = True)

    import ghpythonlib.treehelpers as tree
    layers = tree.list_to_tree(layers)
# ---------- end column_2_11_4_26 ----------
point_2 = Point(column_2_11_4_26.centers)

# ---- group: OLD
geometry_3 = Geometry(<extrusion referenced from the Rhino model>)
contour_2 = Contour(Shape=geometry_3, Point=Point(0, 0, 0), Direction=Vector(0, 0, 1), Distance=Slider(4, range=0..10))

# ---- group: Correcting Bad Geometries
contour_3 = Contour(Shape=geometry_2, Point=Point(0, 0, 0), Direction=Vector(0, 0, 1), Distance=Slider(9.3, range=0..10))
graft_tree = GraftTree(Tree=contour_3, IncludeEmptyLists=True, IncludeNullItems=True)
closed = Closed(Curve=graft_tree)  # -> Closed, Periodic
dispatch = Dispatch(List=graft_tree, DispatchPattern=closed.Closed)  # -> ListA, ListB
simplify_tree = SimplifyTree(Tree=dispatch.ListA, Front=False)
prune_tree = PruneTree(Tree=simplify_tree, Minimum=Slider(1, range=0..1), Maximum=0)  # -> simplify(flatten(Tree))
list_item_2 = ListItem(List=prune_tree, Index=Slider(12, range=0..100), Wrap=True)
flip_curve = FlipCurve(Curve=prune_tree, Guide=list_item_2)  # -> Curve, Flag
align_curve_seams = AlignCurveSeams(Curves=flip_curve.Curve, Snap=False, Iterative=True)  # -> Aligned, Points, ResultBoolean

# ----
point_3 = Point(list_item)
list_length = ListLength(List=point_3)  # -> flatten(Length)
list_item_3 = ListItem(List=list_length, Index=0, Wrap=True)
flip_matrix = FlipMatrix(Data=point_3)
construct_domain = ConstructDomain(DomainStart=0, DomainEnd=list_item_3)
series_2 = Series(Start=0, Step=1, Count=list_item_3)
polyline = PolyLine(Vertices=flip_matrix, Closed=False)
remap_numbers = RemapNumbers(Value=series_2, Source=construct_domain, Target=Domain(0, 1))  # -> Mapped, Clipped
explode = Explode(Curve=polyline, Recursive=True)  # -> Segments, Vertices
end_points = EndPoints(Curve=explode.Segments)  # -> Start, End
vector_2pt = Vector2Pt(PointA=end_points.Start, PointB=end_points.End, Unitize=False)  # -> Vector, Length
flip_matrix_2 = FlipMatrix(Data=vector_2pt.Vector)
multiplication = Multiplication(A=flip_matrix_2, B=remap_numbers.Mapped)
move = Move(Geometry=point_3, Motion=multiplication)  # -> Geometry, Transform
polyline_2 = PolyLine(Vertices=flatten(move.Geometry), Closed=False)

mesh = Mesh(column_2_11_4_26.mesh)
interpolate = Interpolate(Vertices=column_2_11_4_26.layers, Degree=3, Periodic=invert(False), KnotStyle=1)  # -> Curve, Length, Domain
deconstruct_mesh = DeconstructMesh(Mesh=mesh)  # -> Vertices, Faces, Colours, Normals
vector = Vector(deconstruct_mesh.Normals)
deconstruct_vector = DeconstructVector(Vector=vector)  # -> XComponent, YComponent, ZComponent
vector_xyz = VectorXYZ(XComponent=deconstruct_vector.XComponent, YComponent=deconstruct_vector.YComponent, ZComponent=0)  # -> Vector, Length
angle = Angle(VectorA=vector_xyz.Vector, VectorB=vector)  # -> Angle, Reflex
max_overhang = Slider(45, range=0..100)
degrees = Degrees(Radians=angle.Angle)
smaller_than = SmallerThan(FirstNumber=degrees, SecondNumber=max_overhang)  # -> SmallerThan, OrEqualTo
dispatch_2 = Dispatch(List=deconstruct_mesh.Faces, DispatchPattern=smaller_than.SmallerThan)  # -> ListA, ListB
construct_mesh = ConstructMesh(Vertices=deconstruct_mesh.Vertices, Faces=dispatch_2.ListB)
custom_preview = CustomPreview(Geometry=construct_mesh, Material=ColourSwatch(SwatchColor=RGB(0, 0, 0)))

# ---- group: OLD
geometry_4 = Geometry(<extrusion referenced from the Rhino model>)
contour_4 = Contour(Shape=geometry_4, Point=Point(0, 0, 0), Direction=Vector(0, 0, 1), Distance=Slider(3, range=0..10))

# ----
bounds = Bounds(Numbers=degrees)
deconstruct_domain = DeconstructDomain(Domain=bounds)  # -> Start, End
gradient = Gradient(
    LowerLimit=0,
    UpperLimit=max_overhang,
    Parameter=degrees,
    stops=[0: RGB(0, 128, 0), 0.5: RGB(255, 255, 0), 1: RGB(255, 0, 0)])
max_overhang_2 = Panel(deconstruct_domain.End)

# ---- group: DESIGN
point_spacing_mm = Slider(2.85, range=1..50)
layer_height_mm = Slider(2, range=0.5..10)
height_mm = Slider(40, range=1..500)
radius_mm = Slider(30, range=5..200)

center_x_mm = Slider(198, range=-500..500)
center_y_mm = Slider(135, range=-500..500)
fine_adjust_z_mm = Slider(0, range=-5..5)

# ----
construct_mesh_2 = ConstructMesh(Vertices=deconstruct_mesh.Vertices, Faces=dispatch_2.ListA, Colours=gradient)

number_slider_4 = Slider(50, range=0..100)
divide_curve = DivideCurve(Curve=contour_4, Count=number_slider_4, Kinks=False)  # -> Points, Tangents, Parameters
construct_domain_2 = ConstructDomain(DomainStart=0, DomainEnd=number_slider_4)
series_3 = Series(Start=0, Step=1, Count=number_slider_4)
flip_matrix_3 = FlipMatrix(Data=divide_curve.Points)
polyline_3 = PolyLine(Vertices=flip_matrix_3, Closed=False)
remap_numbers_2 = RemapNumbers(Value=series_3, Source=construct_domain_2, Target=Domain(0, 1))  # -> Mapped, Clipped
explode_2 = Explode(Curve=polyline_3, Recursive=True)  # -> Segments, Vertices
end_points_2 = EndPoints(Curve=explode_2.Segments)  # -> Start, End
vector_2pt_2 = Vector2Pt(PointA=end_points_2.Start, PointB=end_points_2.End, Unitize=False)  # -> Vector, Length
flip_matrix_4 = FlipMatrix(Data=vector_2pt_2.Vector)
multiplication_2 = Multiplication(A=flip_matrix_4, B=remap_numbers_2.Mapped)
move_2 = Move(Geometry=divide_curve.Points, Motion=multiplication_2)  # -> Geometry, Transform
interpolate_2 = Interpolate(Vertices=flatten(move_2.Geometry), Degree=3, Periodic=False, KnotStyle=1)  # -> Curve, Length, Domain

# ---- group: DESIGN
# design: "slice" a cylinder
slice_cylinder = SliceCylinder(
    radius=radius_mm,
    height=height_mm,
    layer_height=layer_height_mm,
    point_spacing=point_spacing_mm,
    center_x=center_x_mm,
    center_y=center_y_mm,
    fine_adjust_z=fine_adjust_z_mm)  # -> layers
# ---------- slice_cylinder: Python ----------
# r: compas
# venv: mas-2627
"""
Slice a cylinder into layers, in work object coordinates (Rhino world XY = work object).
One closed compas Polyline per layer. Units: mm.
center_x, center_y: where the cylinder stands on the work object.
fine_adjust_z: shifts all layers up/down, to tune the nozzle height above the bed (0 = first layer at z = 0).
"""
import math

from compas.geometry import Point
from compas.geometry import Polyline

# ===== How many layers, how many points per layer =====
layer_count = int(height / layer_height)
points_per_layer = round(2 * math.pi * radius / point_spacing)

# ===== One closed polyline per layer =====
layers = []
for i in range(layer_count):
    z = i * layer_height + fine_adjust_z
    points = []
    for j in range(points_per_layer + 1):  # one extra point: back to the start to close the ring
        angle = 2 * math.pi * (j % points_per_layer) / points_per_layer
        points.append(Point(center_x + radius * math.cos(angle), center_y + radius * math.sin(angle), z))
    layers.append(Polyline(points))
# ---------- end slice_cylinder ----------

# ---- group: Tail Length
number_slider_5 = Slider(0.91, range=0..1)

# ----
point_4 = Point(move.Geometry)
list_item_4 = ListItem(List=flatten(point_4), Index=0, Wrap=True)
list_item_5 = ListItem(List=flatten(column_2_11_4_26.centers), Index=0, Wrap=True)
vector_2pt_3 = Vector2Pt(PointA=list_item_5, PointB=list_item_4, Unitize=False)  # -> Vector, Length
multiplication_3 = Multiplication(A=vector_2pt_3.Vector, B=number_slider_5)
move_3 = Move(Geometry=list_item_4, Motion=multiplication_3)  # -> Geometry, Transform
split_tree = SplitTree(Data=point_4, Masks=flatten("{0;0;0}"))  # -> Positive, Negative
insert_items = InsertItems(List=split_tree.Positive, Item=move_3.Geometry, Indices=0, Wrap=True)
merge = Merge(Data1=insert_items, Data2=split_tree.Negative)

unit_z = UnitZ(Factor=Slider(-1.3, range=-10..10))
move_4 = Move(Geometry=move.Geometry, Motion=unit_z)  # -> Geometry, Transform
polyline_4 = PolyLine(Vertices=flatten(move_4.Geometry), Closed=False)  # -> flatten(Polyline)
convert_to_compas = Python3Script(x=polyline_4)  # -> out, flatten(layers); inputs x: list of Curve
# ---------- convert_to_compas: Python ----------
from compas.geometry import Point, Polyline

layers = []

for curve in x:
    success, rhino_polyline = curve.TryGetPolyline()

    if not success:
        raise ValueError("Input must be a polyline!!!")

    points = []

    for pt in rhino_polyline:
        points.append(Point(pt.X, pt.Y, pt.Z))

    layers.append(Polyline(points))
# ---------- end convert_to_compas ----------

# ---- group: PRINTPATH
# generate printpath: printpoints and path
safety_distance_mm = Slider(80, range=10..300)
blend_radius_mm = Slider(0.5, range=0..5)
speed_mm_s = Slider(10, range=1..50)
printpath = Printpath(layers=convert_to_compas.layers, speed=speed_mm_s, blend_radius=blend_radius_mm, safety_distance=safety_distance_mm)  # -> printpath, summary; inputs layers: list
# ---------- printpath: Python ----------
# r: compas
# venv: mas-2627
"""
Turn the layers into printpoints and a PrintPath, in work object coordinates.
Safety points are added here, before any transform to the robot base.
"""
import os
import sys

from compas.geometry import Frame, Vector


# Find source folder
gh_dir = os.path.dirname(ghenv.Component.OnPingDocument().FilePath)
src_dir = os.path.join(gh_dir, "..", "..", "src")
if src_dir not in sys.path:
    sys.path.append(src_dir)
from print_class import PrintPoint, PrintPath

# ===== One printpoint per point =====
# world XY orientation for every point: a tangent frame would turn the wrist 360 degrees each layer
printpoints = []
for layer_index, layer in enumerate(layers):
    for point in layer.points:
        frame = Frame(point, -Vector.Xaxis(), Vector.Yaxis())
        printpoints.append(PrintPoint(frame, layer_index, speed, blend_radius, True))

# ===== Path with a travel point above the start and the end =====
printpath = PrintPath(printpoints)
printpath.add_safety_before(safety_distance, speed)
printpath.add_safety_after(safety_distance, speed)

summary = f"{len(printpoints)} printpoints in {len(layers)} layers, plus 2 safety points"
# ---------- end printpath ----------
panel = Panel(printpath.summary)

# ---- group: EXPORT
# export: preview and save
panel_2 = Panel("data/out_printpoints.json")
save = Button()
preview = Preview(printpath=printpath.printpath)  # -> path, travel, planes
# ---------- preview: Python ----------
# r: compas
# venv: mas-2627
"""
Draw the printpath: path = the whole polyline, travel = extruder-off segments,
safety = extruder-off points, axes = small x and y axis of each frame.
"""
import Rhino.Geometry as rg
from compas_rhino.conversions import frame_to_rhino_plane, point_to_rhino

AXIS_LENGTH = 5.0  # mm

points = printpath.printpoints
planes = [frame_to_rhino_plane(printpoint.frame) for printpoint in points]

# ===== Whole path =====
polyline = rg.Polyline()
for plane in planes:
    polyline.Add(plane.Origin.X, plane.Origin.Y, plane.Origin.Z)
path = polyline.ToPolylineCurve()

# ===== Extruder off: a segment prints only if both of its points have the extruder on =====
safety = [point_to_rhino(printpoint.frame.point) for printpoint in points if not printpoint.is_extruder_on]
travel = []
for i in range(len(points) - 1):
    if not (points[i].is_extruder_on and points[i + 1].is_extruder_on):
        travel.append(rg.Line(planes[i].Origin, planes[i + 1].Origin))
# ---------- end preview ----------
save_2 = Save(printpath=printpath.printpath, save=save, out_path=panel_2)  # -> status
# ---------- save_2: Python ----------
# r: compas
# venv: mas-2627
"""
On button press, write the printpath to data/out_printpoints.json next to this .ghx file.
send_to_robot.py reads that file.
"""
import json
import os

import scriptcontext as sc

gh_dir = os.path.dirname(ghenv.Component.OnPingDocument().FilePath)

# keep the last status in sticky, so the message survives the button being released
status_key = "save_status_" + str(ghenv.Component.InstanceGuid)

if save:
    if printpath is None:
        sc.sticky[status_key] = "nothing to save: no printpath"
    else:
        path = os.path.normpath(os.path.join(gh_dir, out_path))
        os.makedirs(os.path.dirname(path), exist_ok=True)
        with open(path, "w") as f:
            json.dump(printpath.to_dict(), f, indent=2)
        sc.sticky[status_key] = f"saved {len(printpath)} printpoints to {path}"

status = sc.sticky.get(status_key, "")
ghenv.Component.Message = "saved" if status.startswith("saved") else status
# ---------- end save_2 ----------
panel_3 = Panel(save_2)
preview_2 = CustomPreview(Geometry=preview.path, Material=ColourSwatch(SwatchColor=RGB(0, 170, 80)))
preview_3 = CustomPreview(Geometry=preview.travel, Material=ColourSwatch(SwatchColor=RGB(230, 40, 40)))

# ----
plane = Plane(preview.planes)

integer = Integer(Slider(50, range=0..1000))

# ---- group: Contour and Ramp
divide_curve_2 = DivideCurve(Curve=align_curve_seams.Aligned, Count=integer, Kinks=False)  # -> Points, Tangents, Parameters
flip_matrix_5 = FlipMatrix(Data=divide_curve_2.Points)
polyline_5 = PolyLine(Vertices=flip_matrix_5, Closed=False)
explode_3 = Explode(Curve=polyline_5, Recursive=True)  # -> Segments, Vertices
end_points_3 = EndPoints(Curve=explode_3.Segments)  # -> Start, End
range = Range(Domain=Domain(0, 1), Steps=expr("x-1", integer))
vector_2pt_4 = Vector2Pt(PointA=end_points_3.Start, PointB=end_points_3.End, Unitize=False)  # -> Vector, Length
flip_matrix_6 = FlipMatrix(Data=vector_2pt_4.Vector)
multiplication_4 = Multiplication(A=flip_matrix_6, B=range)
move_5 = Move(Geometry=divide_curve_2.Points, Motion=multiplication_4)  # -> Geometry, Transform

# ----
polyline_6 = PolyLine(Vertices=flatten(move_5.Geometry), Closed=False)
