# Grasshopper definition design.gh (Grasshopper 1.0.8)

# ---- group: This is needed only ONCE in the GH definition
enable_auto_reload = Python3Script()  # -> ok
# ---------- enable_auto_reload: Python ----------
"""
------------------------------
Using VS Code as Python editor
------------------------------

The simplest way to start using VS Code as our editor, is
to place our Python code in files located IN THE SAME FOLDER as our Grasshopper file.

After we have done that, we need 2 steps: 

1. Enable the COMPAS reloader on one component. This tells Grasshopper to watch for changes in the Pythoh files and reload if changed.
2. Every other component that uses Python code from external files needs to start with a method to ensure Grasshopper knows where to load the files from.

"""
# r: compas
# venv: mas-2627

from compas_rhino.devtools import DevTools
DevTools.enable_reloader()
# ---------- end enable_auto_reload ----------

# ----
# \\ Print sample 01
number_slider = Slider(198, range=0..1000)
construct_point = ConstructPoint(XCoordinate=number_slider, YCoordinate=Slider(150, range=0..1000), ZCoordinate=Slider(0, range=0..10))

construct_point_2 = ConstructPoint(XCoordinate=Slider(198, range=0..1000), YCoordinate=Slider(150, range=0..1000), ZCoordinate=Slider(8, range=0..10))

# ---- group: Total Height
number_slider_2 = Slider(125, range=0..1000)

# ---- group: Layer thickness
number_slider_3 = Slider(5, range=0..10)

# ---- group: Nozzle thickness
number_slider_4 = Slider(2, range=0..10)

# ----
number_slider_5 = Slider(35, range=0..100)
circle = Circle(Plane=construct_point_2, Radius=number_slider_5)

number_slider_6 = Slider(50, range=0..100)
circle_2 = Circle(Plane=construct_point, Radius=number_slider_5)

multiplication = Multiplication(A=number_slider_4, B=Slider(4, range=0..10))

# ---- group: total height
# Number of print layers
panel = Panel("0 to 125")

# ----
division = Division(A=number_slider_2, B=number_slider_3)
range = Range(Domain=panel, Steps=expr("x-1", division))
unit_z = UnitZ(Factor=range)

# ---- group: Input curve
curve = Curve(<curve referenced from the Rhino model>)

# ---- group: Move the layers
move = Move(Geometry=circle, Motion=unit_z)  # -> Geometry, Transform

# ----
series = Series(Start=0, Step=Slider(3, range=0..10), Count=Slider(3, range=0..10))
unit_z_2 = UnitZ(Factor=series)

# ---- group: Scale the curves using remapped value from a trignometric function / Scale domain
panel_2 = Panel("0.6 to 1.40")

# ---- group: Scale the curves using remapped value from a trignometric function
area = Area(Geometry=move.Geometry)  # -> Area, Centroid
range_2 = Range(Domain=panel_2, Steps=expr("x-1", Slider(38, range=0..100)))
graph_mapper = GraphMapper(
    range_2,
    x0=0,
    x1=1,
    y0=0,
    y1=1,
    container_name="Sine",
    Equation_px=[0.4746084809, 0.9364801049],
    Equation_py=[0.7751942873, 0.8899792433])
remap_numbers = RemapNumbers(Value=graph_mapper, Source=panel_2, Target=range_2)  # -> reverse(Mapped), Clipped
scale = Scale(Geometry=move.Geometry, Center=area.Centroid, Factor=remap_numbers.Mapped)  # -> Geometry, Transform

# ----
move_2 = Move(Geometry=circle_2, Motion=unit_z_2)  # -> Geometry, Transform

# ---- group: Divide the curves into number of points
divide_curve = DivideCurve(Curve=flatten(move.Geometry), Count=Slider(20, range=0..100), Kinks=False)  # -> Points, Tangents, Parameters

# ---- group: Move factor = layer height
number_slider_7 = Slider(4, range=-11..11.01)
unit_z_3 = UnitZ(Factor=number_slider_7)

# ----
evaluate_curve = EvaluateCurve(Curve=graft(move.Geometry), Parameter=divide_curve.Parameters)  # -> Point, Tangent, Angle
amplitude = Amplitude(Vector=evaluate_curve.Tangent, Amplitude=number_slider_7)

curve_2 = Curve(move_2.Geometry)
# Move the odd points outwards or upwards to get a pattern
number_slider_8 = Slider(10, range=0..100)
divide_curve_2 = DivideCurve(Curve=flatten(curve_2), Count=number_slider_8, Kinks=False)  # -> Points, Tangents, Parameters
number_slider_9 = Slider(1, range=0..1)

# ---- group: DESIGN
fine_adjust_z_mm = Slider(0, range=-5..5)
center_x_mm = Slider(0, range=-500..500)
center_y_mm = Slider(0, range=-500..500)

point_spacing_mm = Slider(6, range=1..50)
layer_height_mm = Slider(1, range=0.5..10)
height_mm = Slider(50, range=1..500)
radius_mm = Slider(50, range=5..200)

# ---- group: base curve
polyline = PolyLine(Vertices=divide_curve_2.Points, Closed=Slider(1, range=0..1))  # -> flatten(Polyline)

# ---- group: DESIGN
# design: "slice" a cylinder
slice_cylinder = SliceCylinder(
    radius=radius_mm,
    height=height_mm,
    layer_height=layer_height_mm,
    point_spacing=point_spacing_mm,
    center_x=center_x_mm,
    center_y=center_y_mm,
    fine_adjust_z=fine_adjust_z_mm)  # -> layers
# ---------- slice_cylinder: Python ----------
# r: compas
# venv: mas-2627
"""
Slice a cylinder into layers, in work object coordinates (Rhino world XY = work object).
One closed compas Polyline per layer. Units: mm.
center_x, center_y: where the cylinder stands on the work object.
fine_adjust_z: shifts all layers up/down, to tune the nozzle height above the bed (0 = first layer at z = 0).
"""
import math

from compas.geometry import Point
from compas.geometry import Polyline

# ===== How many layers, how many points per layer =====
layer_count = int(height / layer_height)
points_per_layer = round(2 * math.pi * radius / point_spacing)

# ===== One closed polyline per layer =====
layers = []
for i in range(layer_count):
    z = i * layer_height + fine_adjust_z
    points = []
    for j in range(points_per_layer + 1):  # one extra point: back to the start to close the ring
        angle = 2 * math.pi * (j % points_per_layer) / points_per_layer
        points.append(Point(center_x + radius * math.cos(angle), center_y + radius * math.sin(angle), z))
    layers.append(Polyline(points))
# ---------- end slice_cylinder ----------

# ----
panel_3 = Panel(slice_cylinder)

range_3 = Range(Domain=" 0 to 1", Steps=Slider(31, range=0..100))
# TEMP
number_slider_10 = Slider(0, range=0..100)
series_2 = Series(Start=0, Step=Slider(0.01, range=0..0.01), Count=Slider(23, range=0..100))
surface = Surface(<surface referenced from the Rhino model>)
construct_point_3 = ConstructPoint(XCoordinate=number_slider_10, YCoordinate=number_slider_10, ZCoordinate=series_2)
concatenate = Concatenate(FragmentA="{", FragmentB="0", FragmentF=", ", FragmentC=range_3, FragmentG=", ", FragmentD="0", FragmentE="}")
panel_4 = Panel(concatenate)
evaluate_surface = EvaluateSurface(Surface=reparameterize(graft(surface)), Point=concatenate)  # -> Point, Normal, UDirection, VDirection, Frame
iso_curve = IsoCurve(Surface=surface, UVPoint=evaluate_surface.Point)  # -> UIsocurve, VIsocurve
md_slider = MDSlider(SliderMode=0, slider_value=Point(0.5, 0.5, 0.5), x_domain=Domain(0, 1), y_domain=Domain(0, 1), z_domain=Domain(0, 1))
panel_6 = Panel(md_slider)

panel_7 = Panel("""True
False""")

# ---- group: Dispatch list to even and odd points
# Dispatch points to list of points at even and odd indices
dispatch = Dispatch(List=divide_curve.Points, DispatchPattern=panel_7)  # -> ListA, ListB

# ----
odd_points = Point(dispatch.ListB)
even_points = Point(dispatch.ListA)

move_3 = Move(Geometry=even_points, Motion=unit_z_3)  # -> Geometry, Transform

# ---- group: Weave the list back
weave = Weave(Pattern=[0, 1], Stream0=even_points, Stream1=move_3.Geometry, NullGaps=False)

# ----
shift_list = ShiftList(List=move_3.Geometry, Shift=Slider(2, range=0..10), Wrap=True)

# ---- group: Polylines as print path
polyline_2 = PolyLine(Vertices=weave, Closed=Slider(1, range=0..1))  # -> flatten(Polyline)

# ---- group: Interpolate the points to get print path
interpolate = Interpolate(Vertices=weave, Degree=3, Periodic=Slider(1, range=0..1), KnotStyle=1)  # -> flatten(Curve), Length, Domain

# ----
merge = Merge(Data1=polyline, Data2=polyline_2)  # -> flatten(Result)
python_3_script = Python3Script(r_curves=interpolate.Curve)  # -> compas_curves; inputs r_curves: list
# ---------- python_3_script: Python ----------
from compas_rhino.conversions import curve_to_compas
from compas_rhino.conversions import curve_to_compas_polyline


compas_curves = []

for curve in r_curves:
    c_curve = curve_to_compas(curve)
    compas_curves.append(c_curve)

# compas_polylines = []

# for c in compas_curves:
#     p_curve = curve_to_compas_polyline(c)
#     compas_polylines.append(p_curve)
# ---------- end python_3_script ----------
list_item = ListItem(List=merge, Index=Slider(0, range=0..10), Wrap=True)

# ---- group: convert rhino polyliness to compas lines
python_3_script_2 = Python3Script(r_curves=merge)  # -> flatten(compas_polylines); inputs r_curves: list
# ---------- python_3_script_2: Python ----------
from compas_rhino.conversions import curve_to_compas
from compas_rhino.conversions import curve_to_compas_polyline


# compas_curves = []

# for curve in r_curves:
#     c_curve = curve_to_compas(curve)
#     compas_curves.append(c_curve)

compas_polylines = []

for c in r_curves:
    p_curve = curve_to_compas_polyline(c)
    compas_polylines.append(p_curve)
# ---------- end python_3_script_2 ----------

# ---- group: PRINTPATH
# generate printpath: printpoints and path
safety_distance_mm = Slider(100, range=10..300)
blend_radius_mm = Slider(0.5, range=0..5)
speed_mm_s = Slider(14, range=1..50)
printpath = Printpath(layers=python_3_script_2, speed=speed_mm_s, blend_radius=blend_radius_mm, safety_distance=safety_distance_mm)  # -> printpath, summary; inputs layers: list
# ---------- printpath: Python ----------
# r: compas
# venv: mas-2627
"""
Turn the layers into printpoints and a PrintPath, in work object coordinates.
Safety points are added here, before any transform to the robot base.
"""
import os
import sys

from compas.geometry import Frame, Vector


# Find source folder
gh_dir = os.path.dirname(ghenv.Component.OnPingDocument().FilePath)
src_dir = os.path.join(gh_dir, "..", "..", "src")
if src_dir not in sys.path:
    sys.path.append(src_dir)
from print_class import PrintPoint, PrintPath

# ===== One printpoint per point =====
# world XY orientation for every point: a tangent frame would turn the wrist 360 degrees each layer
printpoints = []
for layer_index, layer in enumerate(layers):
    for point in layer.points:
        frame = Frame(point, -Vector.Xaxis(), Vector.Yaxis())
        printpoints.append(PrintPoint(frame, layer_index, speed, blend_radius, True))

# ===== Path with a travel point above the start and the end =====
printpath = PrintPath(printpoints)
printpath.add_safety_before(safety_distance, speed)
printpath.add_safety_after(safety_distance, speed)

summary = f"{len(printpoints)} printpoints in {len(layers)} layers, plus 2 safety points"
# ---------- end printpath ----------
panel_8 = Panel(printpath.summary)

# ---- group: EXPORT
# export: preview and save
panel_9 = Panel("data/out_printpoints_trial01.json")
save = Button()
preview = Preview(printpath=printpath.printpath)  # -> path, travel, planes
# ---------- preview: Python ----------
# r: compas
# venv: mas-2627
"""
Draw the printpath: path = the whole polyline, travel = extruder-off segments,
safety = extruder-off points, axes = small x and y axis of each frame.
"""
import Rhino.Geometry as rg
from compas_rhino.conversions import frame_to_rhino_plane, point_to_rhino

AXIS_LENGTH = 5.0  # mm

points = printpath.printpoints
planes = [frame_to_rhino_plane(printpoint.frame) for printpoint in points]

# ===== Whole path =====
polyline = rg.Polyline()
for plane in planes:
    polyline.Add(plane.Origin.X, plane.Origin.Y, plane.Origin.Z)
path = polyline.ToPolylineCurve()

# ===== Extruder off: a segment prints only if both of its points have the extruder on =====
safety = [point_to_rhino(printpoint.frame.point) for printpoint in points if not printpoint.is_extruder_on]
travel = []
for i in range(len(points) - 1):
    if not (points[i].is_extruder_on and points[i + 1].is_extruder_on):
        travel.append(rg.Line(planes[i].Origin, planes[i + 1].Origin))
# ---------- end preview ----------
save_2 = Save(printpath=printpath.printpath, save=save, out_path=panel_9)  # -> status
# ---------- save_2: Python ----------
# r: compas
# venv: mas-2627
"""
On button press, write the printpath to data/out_printpoints.json next to this .ghx file.
send_to_robot.py reads that file.
"""
import json
import os

import scriptcontext as sc

gh_dir = os.path.dirname(ghenv.Component.OnPingDocument().FilePath)

# keep the last status in sticky, so the message survives the button being released
status_key = "save_status_" + str(ghenv.Component.InstanceGuid)

if save:
    if printpath is None:
        sc.sticky[status_key] = "nothing to save: no printpath"
    else:
        path = os.path.normpath(os.path.join(gh_dir, out_path))
        os.makedirs(os.path.dirname(path), exist_ok=True)
        with open(path, "w") as f:
            json.dump(printpath.to_dict(), f, indent=2)
        sc.sticky[status_key] = f"saved {len(printpath)} printpoints to {path}"

status = sc.sticky.get(status_key, "")
ghenv.Component.Message = "saved" if status.startswith("saved") else status
# ---------- end save_2 ----------
panel_10 = Panel(save_2)
preview_2 = CustomPreview(Geometry=preview.travel, Material=ColourSwatch(SwatchColor=RGB(230, 40, 40)))
preview_3 = CustomPreview(Geometry=preview.path, Material=ColourSwatch(SwatchColor=RGB(0, 170, 80)))

# ----
plane = Plane(preview.planes)
