# Grasshopper definition design_non_planar.gh (Grasshopper 1.0.8)

# ---- group: radius_bounds
layer_bounds = GenePool(Decimals=0, Maximum=100, Minimum=0, Value=[50, 70])

# ----
layer_bounds_2 = GenePool(Decimals=2, Maximum=3, Minimum=0, Value=[1.6, 1.95])
n_layers = Slider(50, range=0..1000)
lamcp = LAMCPBridge(enable=Toggle(True))  # -> status; inputs enable: Boolean, port: Int32
#   port enable: Toggle to start (True) or stop (False) the local HTTP server.
#   port port: Port to listen on (loopback only). Defaults to 8765.
#   port status: Current server status string.
# ---------- lamcp: Python ----------
"""
LAMCP Bridge: local HTTP server inside Rhino 8 / Grasshopper CPython.

Exposes `POST /exec` (JSON: `{"code": "...", "timeout": 30}`) which
exec()s `code` and returns
`{"stdout": "...", "stderr": "...", "result": "...", "error": null|str}`.

Pair with the `lamcp` FastMCP server, which translates Claude's
`run_python_script` MCP tool calls into POSTs to this endpoint.

Binds to 127.0.0.1 only. NEVER expose beyond localhost â€” it exec()s
arbitrary Python with full Rhino API access.

LAMCP v0.1.0
"""

import contextlib
import io
import json
import threading
import traceback
from http.server import BaseHTTPRequestHandler
from http.server import HTTPServer

import Grasshopper
import scriptcontext as sc


SHARED_GLOBALS_KEY = "_lamcp_bridge_globals"
SERVER_KEY = "_lamcp_bridge_server"


def _exec_code(code, timeout):
    """Run `code` on the HTTP-server thread and capture stdout/stderr/result.

    NOTE: this is intentionally NOT marshalled to Rhino's UI thread for the
    spike â€” `Rhino.RhinoApp.InvokeOnUiThread` was queueing actions that
    never fired in Rhino 8 CPython. Most read-only RhinoCommon access is
    safe cross-thread; mutations may crash. Add Eto-based marshalling
    back here when we need it.
    """
    out = io.StringIO()
    err = io.StringIO()
    g = sc.sticky.setdefault(SHARED_GLOBALS_KEY, {"__name__": "__lamcp_bridge__"})
    error_text = None
    result_repr = None
    try:
        with contextlib.redirect_stdout(out), contextlib.redirect_stderr(err):
            exec(code, g, g)
            result_repr = repr(g.get("_"))
    except BaseException:
        error_text = traceback.format_exc()

    return {
        "stdout": out.getvalue(),
        "stderr": err.getvalue(),
        "result": result_repr,
        "error": error_text,
    }


class _ExecHandler(BaseHTTPRequestHandler):
    # Silence default request logging so it doesn't clog the Rhino command line.
    def log_message(self, fmt, *args):
        pass

    def _send(self, code, payload):
        body = json.dumps(payload).encode("utf-8")
        self.send_response(code)
        self.send_header("Content-Type", "application/json")
        self.send_header("Content-Length", str(len(body)))
        self.end_headers()
        self.wfile.write(body)

    def do_GET(self):
        if self.path == "/health":
            self._send(200, {"status": "ok"})
        else:
            self._send(404, {"error": "not found"})

    def do_POST(self):
        if self.path != "/exec":
            self._send(404, {"error": "not found"})
            return
        length = int(self.headers.get("Content-Length", "0"))
        try:
            raw = self.rfile.read(length).decode("utf-8")
            body = json.loads(raw)
            code = body.get("code", "")
            timeout = float(body.get("timeout", 30.0))
        except Exception as exc:
            self._send(400, {"error": "bad request: " + repr(exc)})
            return
        result = _exec_code(code, timeout)
        self._send(200, result)


def _start_server(port):
    server = HTTPServer(("127.0.0.1", port), _ExecHandler)
    thread = threading.Thread(
        target=server.serve_forever, daemon=True, name="lamcp-bridge"
    )
    thread.start()
    return {"server": server, "thread": thread, "port": port}


def _stop_server(state):
    try:
        state["server"].shutdown()
        state["server"].server_close()
    except Exception:
        pass


class LamcpBridgeComponent(Grasshopper.Kernel.GH_ScriptInstance):
    def RunScript(self, enable: bool, port: int):
        port = int(port) if port else 8765

        state = sc.sticky.get(SERVER_KEY)

        if not enable:
            if state is not None:
                _stop_server(state)
                del sc.sticky[SERVER_KEY]
            return "stopped"

        # Already running on the requested port: no-op.
        if (
            state is not None
            and state.get("port") == port
            and state["thread"].is_alive()
        ):
            return "listening on http://127.0.0.1:{}".format(port)

        # Port changed or server died: tear down and restart.
        if state is not None:
            _stop_server(state)
            del sc.sticky[SERVER_KEY]

        try:
            sc.sticky[SERVER_KEY] = _start_server(port)
        except OSError as exc:
            ghenv.Component.AddRuntimeMessage(  # noqa: F821
                Grasshopper.Kernel.GH_RuntimeMessageLevel.Error,
                "Failed to bind 127.0.0.1:{}: {}".format(port, exc),
            )
            return "error: {}".format(exc)

        return "listening on http://127.0.0.1:{}".format(port)
# ---------- end lamcp ----------
range = Range(Domain=Domain(0, 1), Steps=expr("x-1", n_layers))
graph = GraphMapper(range, x0=0, x1=1, y0=0, y1=1, container_name="Gaussian", factor=0.2, mean=0.6459159255, sdev=0.1924380362)
graph_2 = GraphMapper(range, x0=0, x1=1, y0=0, y1=1, Gx=0.6701000929, Gy=0.2977625728, container_name="Power", power=3.026164257)
panel = Panel(lamcp)
create_geometry = Python3Script(
    x_range=graph_2,
    y_range=graph,
    rad_bounds=layer_bounds,
    layer_bounds=layer_bounds_2,
    n_layers=n_layers,
    resolution=Slider(100, range=0..1000))  # -> out, pts_tree, vec_tree, z_change; inputs x_range: list of Double, y_range: list of Double, rad_bounds: list of Double, layer_bounds: list of Double, n_layers: Int32, resolution: Int32
# ---------- create_geometry: Python ----------
import math as m
from compas.geometry import Point, Vector

def remap(t, omin, omax, nmin, nmax, power):
    ratio = (t - omin) / (omax - omin)
    return m.pow(ratio, power) * (nmax - nmin) + nmin

# 0. Define global variables
min_rad, max_rad = rad_bounds[0], rad_bounds[1]
min_lay, max_lay = layer_bounds[0], layer_bounds[1]
x_min, x_max = min(x_range), max(x_range)
y_min, y_max = min(y_range), max(y_range)


pts = []
main_v = []
z_change = []
origin = Point(0.0, 0.0, 0.0)
d_ang = m.tau/resolution
for r in range(resolution):
    sub_pts = []
    sub_v = []
    sub_z = []
    tz = 0    
    for n in range(n_layers):
        x_val = remap(x_range[n], x_min, x_max, min_rad, max_rad, 1)
        y_val = remap(y_range[n], y_min, y_max, min_rad, max_rad, 1)
        pt = Point(x_val*m.cos(r * d_ang), y_val*m.sin(r * d_ang), 0.0)
        dist = pt.distance_to_point(origin)

        if n > 0:
            tz += remap(dist, min_rad, max_rad, min_lay, max_lay, 1)
        # Store point at current z height
            sub_z.append(remap(dist, min_rad, max_rad, min_lay, max_lay, 1))
        else:
            sub_z.append(min_lay)

        new_pt = Point(pt.x, pt.y, min_lay + tz)
        sub_pts.append(new_pt)

        if n > 0:
            dv = Vector.from_start_end(new_pt, sub_pts[-2])
            sub_v.append(dv)
        else:
            zv = Vector(0.0, 0.0, -1.0)
            sub_v.append(zv)
        
    pts.append(sub_pts)
    main_v.append(sub_v)
    z_change.append(sub_z)


# Transpose matrix (flips rows and columns)
revised_matrix = [list(col) for col in zip(*pts)]
revised_vectors = [list(cl) for cl in zip(*main_v)]
revised_z = [list(c) for c in zip(*z_change)]

# Convert transposed list to Grasshopper DataTree
import ghpythonlib.treehelpers as th
pts_tree = th.list_to_tree(revised_matrix)
vec_tree = th.list_to_tree(revised_vectors)
z_change = th.list_to_tree(revised_z)
# ---------- end create_geometry ----------
draw = COMPASDraw(cg=create_geometry.pts_tree)  # -> rg
#   port cg: The COMPAS geometry or datastructure to be drawn.
#   port rg: The Rhino geometry object.
# ---------- draw: Python ----------
# r: compas>=2.14.1
"""
Draws COMPAS geometry in Grasshopper.
"""

from typing import Any

import Grasshopper

from compas.scene import SceneObject


class CompasToRhinoGeometry(Grasshopper.Kernel.GH_ScriptInstance):
    def RunScript(self, cg):
        if not cg:
            return None

        return SceneObject(item=cg).draw()
# ---------- end draw ----------
draw_2 = COMPASDraw(cg=create_geometry.vec_tree)  # -> rg; same code as draw
vdisex = VectorDisplayEx(Point=draw, Vector=draw_2, Colour=RGB(0, 0, 0), Width=Slider(1, range=0..10))
frame_generation = Python3Script(pts_tree=create_geometry.pts_tree, vec_tree=create_geometry.vec_tree)  # -> out, rev_frames; inputs pts_tree: tree, vec_tree: tree
# ---------- frame_generation: Python ----------
from compas.geometry import Vector, Frame
import ghpythonlib.treehelpers as th

pts = th.tree_to_list(pts_tree)    # [layer][point]
vecs = th.tree_to_list(vec_tree)   # [layer][vector], same shape as pts

REF = -Vector.Xaxis()              # fixed x direction, same as the original flipped frame


def make_frame(pt, z, ref):
    """Frame at pt whose z-axis is z and whose x-axis stays as close to ref as possible."""
    z = z.unitized()
    # keep only the part of ref perpendicular to z (no spin around z)
    x = ref - z * ref.dot(z)
    if x.length < 1e-6:
        # ref is parallel to z: fall back to world Y
        x = Vector.Yaxis() - z * z.y

    print(x)    
    x.unitize()
    print(x)    

    # x cross (z cross x) = z, so this frame's z-axis comes out exactly as z
    return Frame(pt, x, z.cross(x))


frames = [
    [make_frame(p, v, REF) for p, v in zip(layer_pts, layer_vecs)]
    for layer_pts, layer_vecs in zip(pts, vecs)
]

rev_frames = th.list_to_tree(frames)
# ---------- end frame_generation ----------
frame_generation_2 = Python3Script(pts_tree=create_geometry.pts_tree, vec_tree=create_geometry.vec_tree)  # -> out, rev_frames; inputs pts_tree: tree, vec_tree: tree; disabled
# ---------- frame_generation_2: Python ----------
import math as m
from compas.geometry import Point, Vector, Frame
from compas.geometry import Transformation, Rotation
import ghpythonlib.treehelpers as th

pts = th.tree_to_list(pts_tree)
vecs = th.tree_to_list(vec_tree)

frames = [
    [Frame(
        p,
        -Vector.Xaxis(),
        Vector.Yaxis()
    )
    for p in sub_pts
    ]
    for sub_pts in pts
]

revised_frames = []

for ns, sub_vecs in enumerate(vecs):
    revised_subframes = []
    for nv, vs in enumerate(sub_vecs):
        frame_copy = frames[ns][nv].copy()
        v_u = vs.unitized()
        nx, ny, nz = v_u.x, v_u.y, v_u.z
        ny_clamped = max(-1.0, min(1.0, ny))
        theta_x = m.asin(ny_clamped)
        theta_y = m.atan2(-nx, -nz)
        frame_copy.rotate(theta_x, Vector.Xaxis(), frame_copy.point)
        frame_copy.rotate(theta_y, Vector.Yaxis(), frame_copy.point)
        revised_subframes.append(frame_copy)
    revised_frames.append(revised_subframes)

rev_frames = th.list_to_tree(revised_frames)
# ---------- end frame_generation_2 ----------
flatten = FlattenTree(Tree=frame_generation.rev_frames, Path="{0}")
flatten_2 = FlattenTree(Tree=create_geometry.z_change, Path="{0}")
draw_3 = COMPASDraw(cg=frame_generation_2.rev_frames)  # -> rg; disabled; same code as draw
item = ListItem(List=flatten_2, Index=0, Wrap=True)
add_frame = Python3Script(frames=flatten)  # -> out, rev_frames; inputs frames: list
# ---------- add_frame: Python ----------
from compas.geometry import Vector, Frame

f_origin = frames[0].copy()
f_origin.point += Vector(0.0, -100.0, 0.0)
frames.insert(0, f_origin)
rev_frames = frames
# ---------- end add_frame ----------
lng = ListLength(List=add_frame.rev_frames)
draw_4 = COMPASDraw(cg=add_frame.rev_frames)  # -> rg; same code as draw
merge = Merge(Data1=item, Data2=flatten_2)
repeat = RepeatData(Data=Slider(2, range=0..10), Length=lng)
bounds = Bounds(Numbers=merge)
item_2 = ListItem(List=draw_4, Index=0, Wrap=True)
item_3 = ListItem(List=flatten(item_2), Index=Slider(837, range=0..1000), Wrap=True)
panel_2 = Panel(bounds)

# ---- group: object_position_on_printbed
pt = ConstructPoint(XCoordinate=Slider(0.5, range=0..1), YCoordinate=Slider(0.5, range=0..1), ZCoordinate=0)

# ---- group: object_rotation
number_slider = Slider(75, range=0..360)

# ---- group: printbed_position
printbed_position = _4PointSurface(
    CornerA="535.57,-65.74,-9.79",
    CornerB="535.54,528.09,-10.52",
    CornerC="136.49,527.66,-10.90",
    CornerD="228.17,-67.26,-9.86")

# ----
# generate bed_plane
cluster = Cluster(S=printbed_position, uv=pt, A=degrees(number_slider))

# ----
# generate printpath: printpoints and path
# export: save
blend_radius_mm = Slider(1, range=0..5)
safety_distance_mm = Slider(100, range=10..300)
speed_mm_s = Slider(20, range=1..50)
genes = GenePool(Decimals=2, Maximum=50, Minimum=0, Value=[8, 12])
printpath = Printpath(
    layers=add_frame.rev_frames,
    pt_h=merge,
    pt_class=repeat,
    speed=genes,
    blend_radius=blend_radius_mm,
    safety_distance=safety_distance_mm)  # -> printpath, summary, mapped_speed; inputs layers: list, pt_h: list of Double, pt_class: list, speed: list
# ---------- printpath: Python ----------
# r: compas
# venv: mas-2627
"""
Turn the layers into printpoints and a PrintPath, in work object coordinates.
Safety points are added here, before any transform to the robot base.
"""
import os
import math as m
import sys
import importlib

from compas.geometry import Frame, Vector

def remap(t, omin, omax, nmin, nmax, power):
    ratio = (t - omin) / (omax - omin)
    return m.pow(ratio, power) * (nmax - nmin) + nmin

# Find source folder
gh_dir = os.path.dirname(ghenv.Component.OnPingDocument().FilePath)
print(gh_dir)
src_dir = os.path.join(gh_dir, "src")
print(src_dir)
if src_dir not in sys.path:
    sys.path.append(src_dir)
from print_class_02 import PrintPoint, PrintPath

sum_speed = max(speed) + min(speed)
# ===== One printpoint per point =====
# world XY orientation for every point: a tangent frame would turn the wrist 360 degrees each layer
printpoints = []
mapped_speed = []
for frame_index, fr in enumerate(layers):

    v = sum_speed - remap(pt_h[frame_index], min(pt_h), max(pt_h), min(speed), max(speed), 1)
    mapped_speed.append(v)
    # v = speed[0] * (1 - t) + speed[1] * (t)
    printpoints.append(PrintPoint(fr, frame_index, v, blend_radius, True, pt_class[frame_index]))
    # printpoints.append(PrintPoint(frame, pt_index, speed, blend_radius, True, pt_class[pt_index])) 
    # ABOVE if speed is a single input

# ===== Path with a travel point above the start and the end =====
printpath = PrintPath(printpoints)
printpath.add_safety_before(safety_distance, speed[1])
printpath.add_safety_after(safety_distance, speed[1])

summary = f"{len(printpoints)} printpoints in {len(layers)} layers, plus 2 safety points"
# ---------- end printpath ----------
panel_3 = Panel(printpath.summary)
place_on_bed = Python3Script(printpath=printpath.printpath, bed_plane=cluster)  # -> printpath_on_bed, summary; inputs bed_plane: Plane
# ---------- place_on_bed: Python ----------
# r: compas
# venv: mas-2627
"""
Place the printpath on the print bed.
bed_plane comes from 校正桌面: the bed surface at (u, v), turned by the object angle, z up, raised by the first layer offset.
The printpath is built around world XY, so world XY is moved onto bed_plane.
The output is a normal PrintPath (now in robot base coordinates), so preview and save work as before.
"""
import os
import sys

from compas.geometry import Frame, Transformation
from compas_rhino.conversions import plane_to_compas_frame

# Find source folder
gh_dir = os.path.dirname(ghenv.Component.OnPingDocument().FilePath)
src_dir = os.path.join(gh_dir, "src")
if src_dir not in sys.path:
    sys.path.append(src_dir)
from print_class_02 import PrintPath

# ===== world XY -> bed plane =====
bed = plane_to_compas_frame(bed_plane)
transformation = Transformation.from_frame_to_frame(Frame.worldXY(), bed)

# ===== New printpath, the original stays untouched =====
placed = []
for printpoint in printpath.printpoints:
    new_printpoint = printpoint.copy()
    new_printpoint.frame.transform(transformation)
    placed.append(new_printpoint)
printpath_on_bed = PrintPath(placed)

z_values = [printpoint.frame.point.z for printpoint in placed]
summary = f"bed origin: {[round(v, 2) for v in bed.point]}\nz from {min(z_values):.1f} to {max(z_values):.1f} mm (robot base)"
# ---------- end place_on_bed ----------
save = Button()
save_2 = Save(printpath=place_on_bed.printpath_on_bed, save=save, out_path="data/out_printpoints_mike_3.json")  # -> status
# ---------- save_2: Python ----------
# r: compas
# venv: mas-2627
"""
On button press, write the printpath to data/out_printpoints.json next to this .ghx file.
send_to_robot.py reads that file.
"""
import json
import os

import scriptcontext as sc

gh_dir = os.path.dirname(ghenv.Component.OnPingDocument().FilePath)

# keep the last status in sticky, so the message survives the button being released
status_key = "save_status_" + str(ghenv.Component.InstanceGuid)

if save:
    if printpath is None:
        sc.sticky[status_key] = "nothing to save: no printpath"
    else:
        path = os.path.normpath(os.path.join(gh_dir, out_path))
        os.makedirs(os.path.dirname(path), exist_ok=True)
        with open(path, "w") as f:
            json.dump(printpath.to_dict(), f, indent=2)
        sc.sticky[status_key] = f"saved {len(printpath)} printpoints to {path}"

status = sc.sticky.get(status_key, "")
ghenv.Component.Message = "saved" if status.startswith("saved") else status
# ---------- end save_2 ----------
panel_4 = Panel(place_on_bed.summary)
panel_5 = Panel(save_2)

# ----
# preview
preview = Preview(printpath=place_on_bed.printpath_on_bed)  # -> path, travel, planes
# ---------- preview: Python ----------
# r: compas
# venv: mas-2627
"""
Draw the printpath: path = the whole polyline, travel = extruder-off segments,
safety = extruder-off points, axes = small x and y axis of each frame.
"""
import Rhino.Geometry as rg
from compas_rhino.conversions import frame_to_rhino_plane, point_to_rhino

AXIS_LENGTH = 5.0  # mm

points = printpath.printpoints
planes = [frame_to_rhino_plane(printpoint.frame) for printpoint in points]

# ===== Whole path =====
polyline = rg.Polyline()
for plane in planes:
    polyline.Add(plane.Origin.X, plane.Origin.Y, plane.Origin.Z)
path = polyline.ToPolylineCurve()

# ===== Extruder off: a segment prints only if both of its points have the extruder on =====
safety = [point_to_rhino(printpoint.frame.point) for printpoint in points if not printpoint.is_extruder_on]
travel = []
for i in range(len(points) - 1):
    if not (points[i].is_extruder_on and points[i + 1].is_extruder_on):
        travel.append(rg.Line(planes[i].Origin, planes[i + 1].Origin))
# ---------- end preview ----------
plane = Plane(preview.planes)
preview_2 = CustomPreview(Geometry=preview.travel, Material=ColourSwatch(SwatchColor=RGB(230, 40, 40)))
preview_3 = CustomPreview(Geometry=preview.path, Material=ColourSwatch(SwatchColor=RGB(0, 170, 80)))

# ==== cluster Cluster
S = ClusterInput()
uv = ClusterInput()
A = ClusterInput()
evalsrf = EvaluateSurface(Surface=reparameterize(S), Point=uv)  # -> Point, Normal, UDirection, VDirection, Frame
prot = RotatePlane(Plane=evalsrf.Frame, Angle=degrees(A))
Z = UnitZ(Factor=1)
deplane = DeconstructPlane(Plane=prot)  # -> Origin, XAxis, YAxis, ZAxis
dprod = DotProduct(VectorA=Z, VectorB=deplane.ZAxis, Unitize=False)
pflip = FlipPlane(Plane=prot, ReverseX=False, ReverseY=False, SwapAxes=True)
expression = Expression(x=dprod, Expression="if(x<0,True,False)")
filter = StreamFilter(Gate=expression, Stream0=prot, Stream1=pflip)
s_0 = ClusterOutput(filter)
