# Grasshopper definition design_spirals.gh (Grasshopper 1.0.8)

number_slider = Slider(10, range=0..10)
resolution = Slider(25, range=0..1000)
cycles = Slider(1, range=0..100)
number_slider_2 = Slider(6, range=0..10)
arch_spiral = Python3Script(start_rad=number_slider, gap=Slider(20, range=0..50), reso=resolution, cycles=cycles, segments=number_slider_2)  # -> out, frame_pts, index_list; inputs start_rad: Double, gap: Double, reso: Int32, cycles: Int32, segments: Int32
# ---------- arch_spiral: Python ----------
import math as m
from compas.geometry import Point, Vector, Line, Circle, Frame

# Definitions:

def circle_closest_point(circle, point, t_output = False):
    pt_local = circle.frame.to_local_coordinates(point)
    pt_local.z = 0.0
    dist = (pt_local.x ** 2 + pt_local.y ** 2) ** 0.5

    if dist == 0:
        closest = circle.frame.to_world_coordinates(Point(circle.radius, 0.0, 0.0))
    else:
        scale = circle.radius / dist
        closest = circle.frame.to_world_coordinates(Point(pt_local.x * scale, pt_local.y * scale, 0.0))
    
    if t_output:
        t = m.atan2(pt_local.y, pt_local.x) % m.tau
        return closest, t
    
    return closest


# 0. Define local variables

d_theta = m.tau/reso
d_gap = gap/m.tau
d_seg = m.tau/segments

spiral_pts = [
    [Point(
        (start_rad + d_gap * steps * d_theta) * m.cos(steps * d_theta + d_seg * s),
        (start_rad + d_gap * steps * d_theta) * m.sin(steps * d_theta + d_seg * s),
        0.0
    )
    for steps in range(int(reso * cycles + 1))
    ] 
    for s in range(segments)
]

ref_radius = spiral_pts[-1][-1].distance_to_point(Point(0.0, 0.0, 0.0))
hex_len = 2 * ref_radius / m.sqrt(3)
ref_frame = Frame(Point(0.0, 0.0, 0.0), Vector.Xaxis(), Vector.Yaxis())
hex_scale = 0.8 * hex_len

ref_circle = Circle(ref_radius, ref_frame)

closest_data = [circle_closest_point(ref_circle, p[-1], True) for p in spiral_pts]
circle_pos = [data[0] for data in closest_data] 
t_pts = [data[1] for data in closest_data]

t_v = [Vector(-m.sin(t), m.cos(t), 0.0) for t in t_pts]
for unit_t in t_v:
    unit_t.unitize()

hex_lines = [Line(cp - tv * 0.5 * hex_scale, cp + tv * 0.5 * hex_scale) for (cp, tv) in zip(circle_pos, t_v)]

frame_pts = []
index_list = []
for n_sp, sp in enumerate(spiral_pts):
    hx = hex_lines[n_sp]
    hex_start, hex_end = hx.start, hx.end
    frame_pts.append(hex_start)
    index_list.append(2)
    frame_pts.append(hex_end)
    index_list.append(3)
    for ns, s in enumerate(sp):
        frame_pts.append(s)
        index_list.append(3) if ns == len(sp) - 1 else index_list.append(2)

    
import ghpythonlib.treehelpers as th
spiral_pts = th.list_to_tree(spiral_pts)
hex_sides = th.list_to_tree(hex_lines)
frame_pts = th.list_to_tree(frame_pts)
# ---------- end arch_spiral ----------
log_spiral = Python3Script(start_rad=number_slider, k=Slider(2.783, range=0..10), reso=resolution, cycles=cycles, segments=number_slider_2)  # -> out, spiral_pts, hex_sides, circle_pos, frame_pts, index_list; inputs start_rad: Double, k: Double, reso: Int32, cycles: Int32, segments: Int32
# ---------- log_spiral: Python ----------
import math as m
from compas.geometry import Point, Vector, Line, Circle, Frame

# Definitions:

def circle_closest_point(circle, point, t_output = False):
    pt_local = circle.frame.to_local_coordinates(point)
    pt_local.z = 0.0
    dist = (pt_local.x ** 2 + pt_local.y ** 2) ** 0.5

    if dist == 0:
        closest = circle.frame.to_world_coordinates(Point(circle.radius, 0.0, 0.0))
    else:
        scale = circle.radius / dist
        closest = circle.frame.to_world_coordinates(Point(pt_local.x * scale, pt_local.y * scale, 0.0))
    
    if t_output:
        t = m.atan2(pt_local.y, pt_local.x) % m.tau
        return closest, t
    
    return closest

# 0. Define local variables

d_theta = m.tau/reso
d_gap = k/m.tau
d_seg = m.tau/segments

spiral_pts = [
    [Point(
        (start_rad + m.exp(d_gap * steps * d_theta)) * m.cos(steps * d_theta + d_seg * s),
        (start_rad + m.exp(d_gap * steps * d_theta)) * m.sin(steps * d_theta + d_seg * s),
        0.0
    )
    for steps in range(int(reso * cycles))
    ] 
    for s in range(segments)
]

ref_radius = spiral_pts[-1][-1].distance_to_point(Point(0.0, 0.0, 0.0))
hex_len = 2 * ref_radius / m.sqrt(3)
ref_frame = Frame(Point(0.0, 0.0, 0.0), Vector.Xaxis(), Vector.Yaxis())
hex_scale = 0.8 * hex_len

ref_circle = Circle(ref_radius, ref_frame)

closest_data = [circle_closest_point(ref_circle, p[-1], True) for p in spiral_pts]
circle_pos = [data[0] for data in closest_data] 
t_pts = [data[1] for data in closest_data]

t_v = [Vector(-m.sin(t), m.cos(t), 0.0) for t in t_pts]
for unit_t in t_v:
    unit_t.unitize()

hex_lines = [Line(cp - tv * 0.5 * hex_scale, cp + tv * 0.5 * hex_scale) for (cp, tv) in zip(circle_pos, t_v)]

frame_pts = []
index_list = []
for n_sp, sp in enumerate(spiral_pts):
    hx = hex_lines[n_sp]
    hex_start, hex_end = hx.start, hx.end
    frame_pts.append(hex_start)
    index_list.append(1)
    frame_pts.append(hex_end)
    index_list.append(2)
    for ns, s in enumerate(sp):
        frame_pts.append(s)
        index_list.append(1) if ns == 0 else index_list.append(2)

    
import ghpythonlib.treehelpers as th
spiral_pts = th.list_to_tree(spiral_pts)
hex_sides = th.list_to_tree(hex_lines)
frame_pts = th.list_to_tree(frame_pts)
# ---------- end log_spiral ----------
ferm_spiral = Python3Script(start_rad=number_slider, reso=resolution, cycles=cycles, segments=number_slider_2)  # -> out, spiral_pts, hex_sides, circle_pos, frame_pts, index_list; inputs start_rad: Double, reso: Int32, cycles: Int32, segments: Int32
# ---------- ferm_spiral: Python ----------
import math as m
from compas.geometry import Point, Vector, Line, Circle, Frame

# Definitions:

def circle_closest_point(circle, point, t_output = False):
    pt_local = circle.frame.to_local_coordinates(point)
    pt_local.z = 0.0
    dist = (pt_local.x ** 2 + pt_local.y ** 2) ** 0.5

    if dist == 0:
        closest = circle.frame.to_world_coordinates(Point(circle.radius, 0.0, 0.0))
    else:
        scale = circle.radius / dist
        closest = circle.frame.to_world_coordinates(Point(pt_local.x * scale, pt_local.y * scale, 0.0))
    
    if t_output:
        t = m.atan2(pt_local.y, pt_local.x) % m.tau
        return closest, t
    
    return closest

# 0. Define local variables

d_theta = m.tau/reso
d_seg = m.tau/segments

spiral_pts = [
    [Point(
        (start_rad * m.sqrt(steps * d_theta)) * m.cos(steps * d_theta + d_seg * s),
        (start_rad * m.sqrt(steps * d_theta)) * m.sin(steps * d_theta + d_seg * s),
        0.0
    )
    for steps in range(int(reso * cycles))
    ] 
    for s in range(segments)
]

ref_radius = spiral_pts[-1][-1].distance_to_point(Point(0.0, 0.0, 0.0))
hex_len = 2 * ref_radius / m.sqrt(3)
ref_frame = Frame(Point(0.0, 0.0, 0.0), Vector.Xaxis(), Vector.Yaxis())
hex_scale = 0.8 * hex_len

ref_circle = Circle(ref_radius, ref_frame)

closest_data = [circle_closest_point(ref_circle, p[-1], True) for p in spiral_pts]
circle_pos = [data[0] for data in closest_data] 
t_pts = [data[1] for data in closest_data]

t_v = [Vector(-m.sin(t), m.cos(t), 0.0) for t in t_pts]
for unit_t in t_v:
    unit_t.unitize()

hex_lines = [Line(cp - tv * 0.5 * hex_scale, cp + tv * 0.5 * hex_scale) for (cp, tv) in zip(circle_pos, t_v)]

frame_pts = []
index_list = []
for n_sp, sp in enumerate(spiral_pts):
    hx = hex_lines[n_sp]
    hex_start, hex_end = hx.start, hx.end
    frame_pts.append(hex_start)
    index_list.append(1)
    frame_pts.append(hex_end)
    index_list.append(2)
    for ns, s in enumerate(sp):
        frame_pts.append(s)
        index_list.append(1) if ns == 0 else index_list.append(2)

    
import ghpythonlib.treehelpers as th
spiral_pts = th.list_to_tree(spiral_pts)
hex_sides = th.list_to_tree(hex_lines)
frame_pts = th.list_to_tree(frame_pts)
# ---------- end ferm_spiral ----------
draw = COMPASDraw(cg=arch_spiral.frame_pts)  # -> rg
#   port cg: The COMPAS geometry or datastructure to be drawn.
#   port rg: The Rhino geometry object.
# ---------- draw: Python ----------
# r: compas>=2.14.1
"""
Draws COMPAS geometry in Grasshopper.
"""

from typing import Any

import Grasshopper

from compas.scene import SceneObject


class CompasToRhinoGeometry(Grasshopper.Kernel.GH_ScriptInstance):
    def RunScript(self, cg):
        if not cg:
            return None

        return SceneObject(item=cg).draw()
# ---------- end draw ----------
draw_2 = COMPASDraw(cg=ferm_spiral.spiral_pts)  # -> rg; same code as draw
draw_3 = COMPASDraw(cg=ferm_spiral.circle_pos)  # -> rg; same code as draw
draw_4 = COMPASDraw(cg=ferm_spiral.frame_pts)  # -> rg; same code as draw
draw_5 = COMPASDraw(cg=log_spiral.hex_sides)  # -> rg; same code as draw
draw_6 = COMPASDraw(cg=log_spiral.circle_pos)  # -> rg; same code as draw
draw_7 = COMPASDraw(cg=log_spiral.frame_pts)  # -> rg; same code as draw
frame_and_index = Python3Script(
    hex_pts=arch_spiral.frame_pts,
    index_list=arch_spiral.index_list,
    n_layers=Slider(10, range=0..10),
    layer_h=Slider(1.3, range=0..10))  # -> out, hex_tree, ind_tree; inputs hex_pts: list, index_list: list, n_layers: Int32, layer_h: Double
# ---------- frame_and_index: Python ----------
import math as m
from compas.geometry import Point, Vector, Frame

hex_tree = []
ind_tree = []

start_pt = hex_pts[0] + Vector(0.0, -50.0, 0.0)
hex_tree.append(start_pt)
# start_frame = Frame(start_pt, Vector.Xaxis(), Vector.Yaxis())
# hex_tree.append(start_frame)
ind_tree.append(2)

for n in range(n_layers):
    hex_list = hex_pts[::1] if n % 2 == 0 else hex_pts[::-1]
    ind_list = ind_tree[::1] if n % 2 == 0 else ind_tree[::-1]
    for n_hx, hx in enumerate(hex_list):
        new_hx = hx.copy()
        new_hx.z = (1 + n) * layer_h
        # new_frame = Frame(new_hx, -Vector.Xaxis(), Vector.Yaxis())
        # hex_tree.append(new_frame)
        hex_tree.append(new_hx)
        ind_tree.append(index_list[n_hx])
# ---------- end frame_and_index ----------

# ---- group: object_position_on_printbed
pt = ConstructPoint(XCoordinate=Slider(0.5, range=0..1), YCoordinate=Slider(0.5, range=0..1), ZCoordinate=0)

# ---- group: object_rotation
number_slider_3 = Slider(75, range=0..360)

# ---- group: printbed_position
printbed_position = _4PointSurface(
    CornerA="535.57,-65.74,-9.79",
    CornerB="535.54,528.09,-10.52",
    CornerC="136.49,527.66,-10.90",
    CornerD="228.17,-67.26,-9.86")

# ----
# generate bed_plane
cluster = Cluster(S=printbed_position, uv=pt, A=degrees(number_slider_3))

# ----
# generate printpath: printpoints and path
# export: save
blend_radius_mm = Slider(1, range=0..5)
speed_mm_s = Slider(20, range=1..50)
genes = GenePool(Decimals=0, Maximum=50, Minimum=0, Value=[29.67, 10])
safety_distance_mm = Slider(100, range=10..300)
printpath = Printpath(
    layers=frame_and_index.hex_tree,
    pt_class=frame_and_index.ind_tree,
    speed=genes,
    blend_radius=blend_radius_mm,
    safety_distance=safety_distance_mm)  # -> printpath, summary, mapped_speed; inputs layers: list, pt_class: list, speed: list
# ---------- printpath: Python ----------
# r: compas
# venv: mas-2627
"""
Turn the layers into printpoints and a PrintPath, in work object coordinates.
Safety points are added here, before any transform to the robot base.
"""
import os
import math as m
import sys
import importlib

from compas.geometry import Frame, Vector

def remap(t, omin, omax, nmin, nmax, power):
    ratio = (t - omin) / (omax - omin)
    return m.pow(ratio, power) * (nmax - nmin) + nmin

# Find source folder
gh_dir = os.path.dirname(ghenv.Component.OnPingDocument().FilePath)
print(gh_dir)
src_dir = os.path.join(gh_dir, "src")
print(src_dir)
if src_dir not in sys.path:
    sys.path.append(src_dir)
from print_class_02 import PrintPoint, PrintPath

sum_speed = max(speed) + min(speed)
# ===== One printpoint per point =====
# world XY orientation for every point: a tangent frame would turn the wrist 360 degrees each layer
printpoints = []
mapped_speed = []
for frame_index, pt in enumerate(layers):
    # v = sum_speed - remap(pt_h[frame_index], min(pt_h), max(pt_h), min(speed), max(speed), 1)
    # mapped_speed.append(v)
    # v = speed[0] * (1 - t) + speed[1] * (t)
    v = speed[0] if pt_class[frame_index] == 0 else speed[1]
    frame = Frame(pt, -Vector.Xaxis(), Vector.Yaxis())
    printpoints.append(PrintPoint(frame, frame_index, v, blend_radius, True, pt_class[frame_index]))
    # printpoints.append(PrintPoint(fr, frame_index, v, blend_radius, True, pt_class[frame_index]))
    # printpoints.append(PrintPoint(frame, pt_index, speed, blend_radius, True, pt_class[pt_index])) 
    # ABOVE if speed is a single input

# ===== Path with a travel point above the start and the end =====
printpath = PrintPath(printpoints)
printpath.add_safety_before(safety_distance, speed[1])
printpath.add_safety_after(safety_distance, speed[1])

summary = f"{len(printpoints)} printpoints in {len(layers)} layers, plus 2 safety points"
# ---------- end printpath ----------
panel = Panel(printpath.summary)
place_on_bed = Python3Script(printpath=printpath.printpath, bed_plane=cluster)  # -> printpath_on_bed, summary; inputs bed_plane: Plane
# ---------- place_on_bed: Python ----------
# r: compas
# venv: mas-2627
"""
Place the printpath on the print bed.
bed_plane comes from 校正桌面: the bed surface at (u, v), turned by the object angle, z up, raised by the first layer offset.
The printpath is built around world XY, so world XY is moved onto bed_plane.
The output is a normal PrintPath (now in robot base coordinates), so preview and save work as before.
"""
import os
import sys

from compas.geometry import Frame, Transformation
from compas_rhino.conversions import plane_to_compas_frame

# Find source folder
gh_dir = os.path.dirname(ghenv.Component.OnPingDocument().FilePath)
src_dir = os.path.join(gh_dir, "src")
if src_dir not in sys.path:
    sys.path.append(src_dir)
from print_class_02 import PrintPath

# ===== world XY -> bed plane =====
bed = plane_to_compas_frame(bed_plane)
transformation = Transformation.from_frame_to_frame(Frame.worldXY(), bed)

# ===== New printpath, the original stays untouched =====
placed = []
for printpoint in printpath.printpoints:
    new_printpoint = printpoint.copy()
    new_printpoint.frame.transform(transformation)
    placed.append(new_printpoint)
printpath_on_bed = PrintPath(placed)

z_values = [printpoint.frame.point.z for printpoint in placed]
summary = f"bed origin: {[round(v, 2) for v in bed.point]}\nz from {min(z_values):.1f} to {max(z_values):.1f} mm (robot base)"
# ---------- end place_on_bed ----------
save = Button()
save_2 = Save(printpath=place_on_bed.printpath_on_bed, save=save, out_path="data/out_printpoints_mike_5.json")  # -> status
# ---------- save_2: Python ----------
# r: compas
# venv: mas-2627
"""
On button press, write the printpath to data/out_printpoints.json next to this .ghx file.
send_to_robot.py reads that file.
"""
import json
import os

import scriptcontext as sc

gh_dir = os.path.dirname(ghenv.Component.OnPingDocument().FilePath)

# keep the last status in sticky, so the message survives the button being released
status_key = "save_status_" + str(ghenv.Component.InstanceGuid)

if save:
    if printpath is None:
        sc.sticky[status_key] = "nothing to save: no printpath"
    else:
        path = os.path.normpath(os.path.join(gh_dir, out_path))
        os.makedirs(os.path.dirname(path), exist_ok=True)
        with open(path, "w") as f:
            json.dump(printpath.to_dict(), f, indent=2)
        sc.sticky[status_key] = f"saved {len(printpath)} printpoints to {path}"

status = sc.sticky.get(status_key, "")
ghenv.Component.Message = "saved" if status.startswith("saved") else status
# ---------- end save_2 ----------
panel_2 = Panel(save_2)
panel_3 = Panel(place_on_bed.summary)

# ----
# preview
preview = Preview(printpath=place_on_bed.printpath_on_bed)  # -> path, travel, planes
# ---------- preview: Python ----------
# r: compas
# venv: mas-2627
"""
Draw the printpath: path = the whole polyline, travel = extruder-off segments,
safety = extruder-off points, axes = small x and y axis of each frame.
"""
import Rhino.Geometry as rg
from compas_rhino.conversions import frame_to_rhino_plane, point_to_rhino

AXIS_LENGTH = 5.0  # mm

points = printpath.printpoints
planes = [frame_to_rhino_plane(printpoint.frame) for printpoint in points]

# ===== Whole path =====
polyline = rg.Polyline()
for plane in planes:
    polyline.Add(plane.Origin.X, plane.Origin.Y, plane.Origin.Z)
path = polyline.ToPolylineCurve()

# ===== Extruder off: a segment prints only if both of its points have the extruder on =====
safety = [point_to_rhino(printpoint.frame.point) for printpoint in points if not printpoint.is_extruder_on]
travel = []
for i in range(len(points) - 1):
    if not (points[i].is_extruder_on and points[i + 1].is_extruder_on):
        travel.append(rg.Line(planes[i].Origin, planes[i + 1].Origin))
# ---------- end preview ----------
plane = Plane(preview.planes)
preview_2 = CustomPreview(Geometry=preview.travel, Material=ColourSwatch(SwatchColor=RGB(230, 40, 40)))
preview_3 = CustomPreview(Geometry=preview.path, Material=ColourSwatch(SwatchColor=RGB(0, 170, 80)))

# ==== cluster Cluster
S = ClusterInput()
uv = ClusterInput()
A = ClusterInput()
evalsrf = EvaluateSurface(Surface=reparameterize(S), Point=uv)  # -> Point, Normal, UDirection, VDirection, Frame
prot = RotatePlane(Plane=evalsrf.Frame, Angle=degrees(A))
Z = UnitZ(Factor=1)
deplane = DeconstructPlane(Plane=prot)  # -> Origin, XAxis, YAxis, ZAxis
dprod = DotProduct(VectorA=Z, VectorB=deplane.ZAxis, Unitize=False)
pflip = FlipPlane(Plane=prot, ReverseX=False, ReverseY=False, SwapAxes=True)
expression = Expression(x=dprod, Expression="if(x<0,True,False)")
filter = StreamFilter(Gate=expression, Stream0=prot, Stream1=pflip)
s_0 = ClusterOutput(filter)
