# Grasshopper definition design_wall_infill.gh (Grasshopper 1.0.8)

number_slider = Slider(500, range=0..10000)
number_slider_2 = Slider(10, range=0..100)
number_slider_3 = Slider(100, range=0..200)
number_slider_4 = Slider(2000, range=0..10000)
number_slider_5 = Slider(1.4, range=0..10)
expression = Expression(h=number_slider, scale=number_slider_2, l=number_slider_5, Expression="int((h/scale)/l)")
range = Range(Domain=Domain(0, 1), Steps=expr("x-1", expression))
graph = GraphMapper(
    range,
    x0=0,
    x1=1,
    y0=0,
    y1=1,
    container_name="Bezier",
    cpx=[0, 0.5046025515, 0.5093103647, 1],
    cpy=[0.485509038, 0.1445034146, 0.9167811871, 0.6660417318])
number_slider_6 = Slider(5, range=0..10)
expression_2 = Expression(l=number_slider_4, scale=number_slider_2, s=number_slider_6, Expression="int((l/scale)/s)")
range_2 = Range(Domain=Domain(0, 1), Steps=expression_2)
graph_2 = GraphMapper(
    range_2,
    x0=0,
    x1=1,
    y0=0,
    y1=1,
    container_name="Bezier",
    cpx=[0, 0.4998949468, 0.7891156673, 1],
    cpy=[0.4287412167, 0, 0.8985507488, 0.4202898741])
list = ValueList({"Standard": 0, "Linear Congruent": 1, "Feistel Shuffle": 2}, selected="Standard")
number_slider_7 = Slider(11, range=0..100)
number_slider_8 = Slider(9, range=0..10)
number_slider_9 = Slider(0, range=0..10)
dom = ConstructDomain(DomainStart=Slider(0.25, range=0..1), DomainEnd=Slider(3, range=0..10))
remap = RemapNumbers(Value=graph_2, Source=Domain(0, 1), Target=dom)  # -> Mapped, Clipped
remap_2 = RemapNumbers(Value=graph, Source=Domain(0, 1), Target=dom)  # -> Mapped, Clipped
division = Division(A=number_slider_3, B=number_slider_2)
division_2 = Division(A=number_slider_4, B=number_slider_2)
division_3 = Division(A=number_slider_4, B=number_slider_2)
py3 = Python3Script(
    scale=number_slider_2,
    wall_thick=number_slider_3,
    wall_length=number_slider_4,
    wall_height=number_slider,
    layer_h=number_slider_5,
    spacing=number_slider_6,
    sorting=list,
    seed_1=number_slider_7,
    seed_2=number_slider_7,
    shuf_rounds=Slider(7, range=0..10),
    skip_l=number_slider_8,
    shift=number_slider_9)  # -> out, total_path, total_frames, total_shift; inputs spacing: Double, seed_1: Int32, seed_2: Int32, shuf_rounds: Int32, skip_l: Int32, shift: Int32
# ---------- py3: Python ----------
import math as m
import random
from typing import Optional
from compas.geometry import Point, Vector, Line, Frame

def remap(t, omin, omax, nmin, nmax):
    return (t - omin)/(omax - omin) * (nmax - nmin) + nmin

def get_prime_factors(n: int) -> set:
    factors = set()
    d = 2
    while d * d <= n:
        while n % d == 0:
            factors.add(d)
            n //= d
        d += 1
    if n > 1:
        factors.add(n)
    return factors

def generate_lcg_params(length: int, seed: Optional[int] = None):
    if length <= 1:
        return (1, 0)
    rng = random.Random(seed)
    factors = get_prime_factors(length)
    step = m.prod(factors)
    if length % 4 == 0 and step % 4 != 0:
        step *= 2
    max_k = (length - 1) // step
    if max_k >= 1:
        k = rng.randint(1, max_k)
        a = 1 + k * step
    else:
        a = 1
    while True:
        c = rng.randint(1, length - 1)
        if m.gcd(c, length) == 1:
            break
    return a, c

def lcg_permute_seeded(items: list, seed: Optional[int] = None):
    length = len(items)
    if length <= 1:
        return items.copy()
    a, c = generate_lcg_params(length, seed)
    result = [None] * length
    for i in range(length):
        new_index = (a * i + c) % length
        result[new_index] = items[i]
    return result

def feistel_shuffle(items, key=42, rounds=shuf_rounds):
    n = len(items)
    if n <= 1:
        return items[:]
    bits = (n - 1).bit_length()
    if bits % 2 != 0:
        bits += 1
    half_bits = bits // 2
    mask = (1 << half_bits) - 1
    
    def permute_index(idx):

        while True:

            left = (idx >> half_bits) & mask
            right = idx & mask

            for r in range(rounds):
                f = ((right * 1103515245 + key + r) >> 5) & mask
                left, right = right, left ^ f

            idx = (left << half_bits) | right
            if idx < n:
                return idx

    return [items[permute_index(i)] for i in range(n)]

# World Variables

thk, lngth, height = wall_thick/scale, wall_length/scale, wall_height/scale
n_layers = height//layer_h
height = n_layers * layer_h
lngth_reso = int(lngth//spacing)
dl = lngth/lngth_reso

extrude_off = 1
extrude_on = 2

first_set = [Point(
    p * dl,
    0.0,
    layer_h
) 
for p in range(lngth_reso + 1)
]

second_set = [Point(
    p * dl,
    thk,
    layer_h
) 
for p in range(lngth_reso + 1)
]


index_list = list(range(len(first_set)))
shuffled_1, shuffled_2 = list(), list()

if sorting == 0:
    shift_place = shift
    shuffled_1 = index_list[shift_place:] + index_list[:shift_place]
    shuffled_2 = index_list[shift_place:] + index_list[:shift_place]

elif sorting == 1:
    shuffled_1 = lcg_permute_seeded(index_list, seed = seed_1)
    shuffled_2 = lcg_permute_seeded(index_list, seed = seed_2)

elif sorting == 2:
    shuffled_1 = feistel_shuffle(index_list, seed_1)
    shuffled_2 = feistel_shuffle(index_list, seed_2)

set_1 = [first_set[shuffled_1[i]] for i in range(len(first_set))]
set_2 = [second_set[shuffled_2[j]] for j in range(len(second_set))]


total_path, path_1, path_2 = [], [], []
total_index, index_1, index_2 = [], [], []
total_shift, shift_1, shift_2 = [], [], []

for np, (s1, s2) in enumerate(zip(set_1, set_2)):
    low_range, high_range = skip_l//2, skip_l - 1
    if int(np % skip_l) >= (low_range):
        path_1.append(s1)
        index_1.append(shuffled_1[np])
        path_2.append(s2)
        index_2.append(shuffled_2[np])
        if int(np % skip_l) == high_range or np == len(set_1) - 1:
            shift_1.append(extrude_off)
            shift_2.append(extrude_on)    
        elif int(np % skip_l) == low_range:
            shift_2.append(extrude_off)
            shift_1.append(extrude_on)    
        else:
            shift_1.append(extrude_on)
            shift_2.append(extrude_on)
    else:
        path_1.append(s2)
        index_1.append(shuffled_2[np])
        path_2.append(s1)
        index_2.append(shuffled_1[np])
        if int(np % skip_l) == low_range - 1:
            shift_1.append(extrude_off)
            shift_2.append(extrude_on) 
        elif int(np % skip_l) == 0:
            shift_2.append(extrude_off)
            shift_1.append(extrude_on)  
        else:
            shift_1.append(extrude_on)
            shift_2.append(extrude_on)
    
print(len(shift_1))
print(len(path_1))

total_path = path_1 + path_2[::-1]
total_index = index_1 + index_2[::-1]
total_shift = shift_1 + shift_2[::-1]
total_frames = [Frame(tp, -Vector.Xaxis(), Vector.Yaxis()) for tp in total_path]

prev_path = path_2
prev_shift = shift_2
# ---------- end py3 ----------
py3_2 = Python3Script(
    add_x=remap.Mapped,
    add_y=remap_2.Mapped,
    scale=number_slider_2,
    wall_thick=number_slider_3,
    wall_length=number_slider_4,
    wall_height=number_slider,
    layer_h=number_slider_5,
    spacing=number_slider_6,
    sorting=list,
    seed_1=number_slider_7,
    seed_2=number_slider_7,
    skip_l=number_slider_8,
    shift=number_slider_9)  # -> out, total_path, total_frames, total_shift; inputs add_x: list, add_y: list, spacing: Double, seed_1: Int32, seed_2: Int32, skip_l: Int32, shift: Int32
# ---------- py3_2: Python ----------
import math as m
import random
from typing import Optional
from compas.geometry import Point, Vector, Line, Frame

def remap(t, omin, omax, nmin, nmax):
    return (t - omin)/(omax - omin) * (nmax - nmin) + nmin


# World Variables

thk, lngth, height = wall_thick/scale, wall_length/scale, wall_height/scale
print(height)
n_layers = int(height//layer_h)
print(n_layers)
height = n_layers * layer_h
lngth_reso = int(lngth//spacing)
dl = lngth/lngth_reso

extrude_off = 1
extrude_on = 2

first_set = [
    [Point(
    p * dl,
    0.0,
    layer_h * (n + 1)
) 
for p in range(lngth_reso + 1)
]
for n in range(n_layers)
]

# for p in range(lngth_reso + 1):
#     print(add_x[p])
#     print(add_y[p])

second_set = [
    [Point(
    p * dl,
    (add_x[p] * thk + add_y[n] * thk),
    layer_h * (n + 1)
) 
for p in range(lngth_reso + 1)
]
for n in range(n_layers)
]

pt_count = len(first_set[0])
index_list = list(range(pt_count))
shuffled_1, shuffled_2 = list(), list()

if sorting == 0:
    sp = shift
    shuffled_1 = []
    for n in range(n_layers):
        sub_shuffle = index_list[(sp * n) % pt_count:] + index_list[:(sp * n) % pt_count]
        shuffled_1.append(sub_shuffle)
        # shuffled_1 = [index_list[(sp * n) % pt_count:] + index_list[:(sp * n) % pt_count] for n in range(n_layers)]
    shuffled_2 = shuffled_1


set_1 = [
    [firsts[i] for i in index_1]
    for firsts, index_1 in zip(first_set, shuffled_1)
]
set_2 = [
    [seconds[j] for j in index_2]
    for seconds, index_2 in zip(second_set, shuffled_2)
]


low_range, high_range = skip_l//2, skip_l - 1

total_path, total_shift = [], []
total_shift.append(2)

for n_row, (s1, s2) in enumerate(zip(set_1, set_2)):
    path_1, path_2 = [], []
    shift_1, shift_2 = [], []
    for n_pt, (p1, p2) in enumerate(zip(s1, s2)):
        t = int(n_pt % skip_l)
        if t >= low_range:
            path_1.append(p1)
            path_2.append(p2)
            if t == high_range or n_pt == len(s1) - 1:
                shift_1.append(extrude_off)
                shift_2.append(extrude_on)
            elif t == low_range:
                shift_2.append(extrude_off)
                shift_1.append(extrude_on) 
            else:
                shift_1.append(extrude_on)
                shift_2.append(extrude_on)
        else:
            path_1.append(p2)
            path_2.append(p1)
            if t == low_range - 1:
                shift_1.append(extrude_off)
                shift_2.append(extrude_on) 
            elif t == 0:
                shift_2.append(extrude_off)
                shift_1.append(extrude_on)
            else:
                shift_1.append(extrude_on)
                shift_2.append(extrude_on)
    subpath = path_1 + path_2[::-1]
    subshift = shift_1 + shift_2[::-1]
    # total_path += subpath[::1] if n_row % 2 == 0 else subpath[::-1]
    total_path += subpath[::1]
    # total_shift += subshift[::1] if n_row % 2 == 0 else subshift[::-1]
    total_shift += subshift[::1]
        
first_pt = total_path[0] + Vector(0.0, -100.0, total_path[0].z)
total_frames = [Frame(first_pt, -Vector.Xaxis(), Vector.Yaxis())] + [Frame(p, -Vector.Xaxis(), Vector.Yaxis()) for p in total_path]
# ---------- end py3_2 ----------
print_thickness_mm = Panel(division)
print_length_mm = Panel(division_2)
print_height_mm = Panel(division_3)
draw = COMPASDraw(cg=py3.total_path)  # -> rg
#   port cg: The COMPAS geometry or datastructure to be drawn.
#   port rg: The Rhino geometry object.
# ---------- draw: Python ----------
# r: compas>=2.14.1
"""
Draws COMPAS geometry in Grasshopper.
"""

from typing import Any

import Grasshopper

from compas.scene import SceneObject


class CompasToRhinoGeometry(Grasshopper.Kernel.GH_ScriptInstance):
    def RunScript(self, cg):
        if not cg:
            return None

        return SceneObject(item=cg).draw()
# ---------- end draw ----------
draw_2 = COMPASDraw(cg=py3_2.total_path)  # -> rg; same code as draw
pline = PolyLine(Vertices=draw_2, Closed=False)
pline_2 = PolyLine(Vertices=draw, Closed=False)

# ---- group: object_position_on_printbed
pt = ConstructPoint(XCoordinate=Slider(0.5, range=0..1), YCoordinate=Slider(0.5, range=0..1), ZCoordinate=0)

# ---- group: object_rotation
number_slider_10 = Slider(0, range=0..360)

# ---- group: printbed_position
printbed_position = _4PointSurface(
    CornerA="535.57,-65.74,-9.79",
    CornerB="535.54,528.09,-10.52",
    CornerC="136.49,527.66,-10.90",
    CornerD="228.17,-67.26,-9.86")

# ----
# generate bed_plane
cluster = Cluster(S=printbed_position, uv=pt, A=degrees(number_slider_10))

# ----
# generate printpath: printpoints and path
# export: save
blend_radius_mm = Slider(2, range=0..5)
genes = GenePool(Decimals=0, Maximum=50, Minimum=0, Value=[10, 20])
safety_distance_mm = Slider(100, range=10..300)
speed_mm_s = Slider(20, range=1..50)
printpath = Printpath(
    layers=py3_2.total_frames,
    pt_class=py3_2.total_shift,
    speed=genes,
    blend_radius=blend_radius_mm,
    safety_distance=safety_distance_mm)  # -> printpath, summary, mapped_speed; inputs layers: list, pt_class: list, speed: list
# ---------- printpath: Python ----------
# r: compas
# venv: mas-2627
"""
Turn the layers into printpoints and a PrintPath, in work object coordinates.
Safety points are added here, before any transform to the robot base.
"""
import os
import math as m
import sys
import importlib

from compas.geometry import Frame, Vector

def remap(t, omin, omax, nmin, nmax, power):
    ratio = (t - omin) / (omax - omin)
    return m.pow(ratio, power) * (nmax - nmin) + nmin

# Find source folder
gh_dir = os.path.dirname(ghenv.Component.OnPingDocument().FilePath)
print(gh_dir)
src_dir = os.path.join(gh_dir, "src")
print(src_dir)
if src_dir not in sys.path:
    sys.path.append(src_dir)
from print_class_02 import PrintPoint, PrintPath

sum_speed = max(speed) + min(speed)
# ===== One printpoint per point =====
# world XY orientation for every point: a tangent frame would turn the wrist 360 degrees each layer
printpoints = []
mapped_speed = []
for frame_index, fr in enumerate(layers):
    v = speed[0] if pt_class[frame_index] == 2 else speed[1]
    mapped_speed.append(v)
    printpoints.append(PrintPoint(fr, frame_index, v, blend_radius, True, pt_class[frame_index]))

# ===== Path with a travel point above the start and the end =====
printpath = PrintPath(printpoints)
printpath.add_safety_before(safety_distance, speed[1])
printpath.add_safety_after(safety_distance, speed[1])

summary = f"{len(printpoints)} printpoints in {len(layers)} layers, plus 2 safety points"
# ---------- end printpath ----------
panel = Panel(printpath.summary)
place_on_bed = Python3Script(printpath=printpath.printpath, bed_plane=cluster)  # -> printpath_on_bed, summary; inputs bed_plane: Plane
# ---------- place_on_bed: Python ----------
# r: compas
# venv: mas-2627
"""
Place the printpath on the print bed.
bed_plane comes from 校正桌面: the bed surface at (u, v), turned by the object angle, z up, raised by the first layer offset.
The printpath is built around world XY, so world XY is moved onto bed_plane.
The output is a normal PrintPath (now in robot base coordinates), so preview and save work as before.
"""
import os
import sys

from compas.geometry import Frame, Transformation
from compas_rhino.conversions import plane_to_compas_frame

# Find source folder
gh_dir = os.path.dirname(ghenv.Component.OnPingDocument().FilePath)
src_dir = os.path.join(gh_dir, "src")
if src_dir not in sys.path:
    sys.path.append(src_dir)
from print_class_02 import PrintPath

# ===== world XY -> bed plane =====
bed = plane_to_compas_frame(bed_plane)
transformation = Transformation.from_frame_to_frame(Frame.worldXY(), bed)

# ===== New printpath, the original stays untouched =====
placed = []
for printpoint in printpath.printpoints:
    new_printpoint = printpoint.copy()
    new_printpoint.frame.transform(transformation)
    placed.append(new_printpoint)
printpath_on_bed = PrintPath(placed)

z_values = [printpoint.frame.point.z for printpoint in placed]
summary = f"bed origin: {[round(v, 2) for v in bed.point]}\nz from {min(z_values):.1f} to {max(z_values):.1f} mm (robot base)"
# ---------- end place_on_bed ----------
save = Button()
save_2 = Save(printpath=place_on_bed.printpath_on_bed, save=save, out_path="data/out_printpoints_mike_6.json")  # -> status
# ---------- save_2: Python ----------
# r: compas
# venv: mas-2627
"""
On button press, write the printpath to data/out_printpoints.json next to this .ghx file.
send_to_robot.py reads that file.
"""
import json
import os

import scriptcontext as sc

gh_dir = os.path.dirname(ghenv.Component.OnPingDocument().FilePath)

# keep the last status in sticky, so the message survives the button being released
status_key = "save_status_" + str(ghenv.Component.InstanceGuid)

if save:
    if printpath is None:
        sc.sticky[status_key] = "nothing to save: no printpath"
    else:
        path = os.path.normpath(os.path.join(gh_dir, out_path))
        os.makedirs(os.path.dirname(path), exist_ok=True)
        with open(path, "w") as f:
            json.dump(printpath.to_dict(), f, indent=2)
        sc.sticky[status_key] = f"saved {len(printpath)} printpoints to {path}"

status = sc.sticky.get(status_key, "")
ghenv.Component.Message = "saved" if status.startswith("saved") else status
# ---------- end save_2 ----------
panel_2 = Panel(save_2)
panel_3 = Panel(place_on_bed.summary)

# ----
# preview
preview = Preview(printpath=place_on_bed.printpath_on_bed)  # -> path, travel, planes
# ---------- preview: Python ----------
# r: compas
# venv: mas-2627
"""
Draw the printpath: path = the whole polyline, travel = extruder-off segments,
safety = extruder-off points, axes = small x and y axis of each frame.
"""
import Rhino.Geometry as rg
from compas_rhino.conversions import frame_to_rhino_plane, point_to_rhino

AXIS_LENGTH = 5.0  # mm

points = printpath.printpoints
planes = [frame_to_rhino_plane(printpoint.frame) for printpoint in points]

# ===== Whole path =====
polyline = rg.Polyline()
for plane in planes:
    polyline.Add(plane.Origin.X, plane.Origin.Y, plane.Origin.Z)
path = polyline.ToPolylineCurve()

# ===== Extruder off: a segment prints only if both of its points have the extruder on =====
safety = [point_to_rhino(printpoint.frame.point) for printpoint in points if not printpoint.is_extruder_on]
travel = []
for i in range(len(points) - 1):
    if not (points[i].is_extruder_on and points[i + 1].is_extruder_on):
        travel.append(rg.Line(planes[i].Origin, planes[i + 1].Origin))
# ---------- end preview ----------
plane = Plane(preview.planes)
preview_2 = CustomPreview(Geometry=preview.travel, Material=ColourSwatch(SwatchColor=RGB(230, 40, 40)))
preview_3 = CustomPreview(Geometry=preview.path, Material=ColourSwatch(SwatchColor=RGB(0, 170, 80)))

# ==== cluster Cluster
S = ClusterInput()
uv = ClusterInput()
A = ClusterInput()
evalsrf = EvaluateSurface(Surface=reparameterize(S), Point=uv)  # -> Point, Normal, UDirection, VDirection, Frame
prot = RotatePlane(Plane=evalsrf.Frame, Angle=degrees(A))
Z = UnitZ(Factor=1)
deplane = DeconstructPlane(Plane=prot)  # -> Origin, XAxis, YAxis, ZAxis
dprod = DotProduct(VectorA=Z, VectorB=deplane.ZAxis, Unitize=False)
pflip = FlipPlane(Plane=prot, ReverseX=False, ReverseY=False, SwapAxes=True)
expression = Expression(x=dprod, Expression="if(x<0,True,False)")
filter = StreamFilter(Gate=expression, Stream0=prot, Stream1=pflip)
s_0 = ClusterOutput(filter)
