# Grasshopper definition design_weijiun.gh (Grasshopper 1.0.8)
# plug-ins: Ovenbird 2, Pufferfish, Parakeet, Bifocals

# ---- group: DESIGN
point_spacing_mm = Slider(6, range=1..50)
layer_height_mm = Slider(1.75, range=0.5..10)
height_mm = Slider(50, range=1..500)
radius_mm = Slider(50, range=5..200)

center_x_mm = Slider(0, range=-500..500)
center_y_mm = Slider(0, range=-500..500)
fine_adjust_z_mm = Slider(0, range=-5..5)

# ----
# design: "slice" a cylinder
number_slider = Slider(2, range=0..20)
spiral = Python3Script(
    x_rad=Slider(50, range=0..1000),
    y_rad=Slider(50, range=0..1000),
    layer_h=Slider(1.5, range=0..10),
    h=Slider(100, range=0..1000),
    resolution=Slider(50, range=0..1000),
    step=number_slider,
    dz=Slider(8, range=0..10))  # -> out, pts, layer; inputs resolution: Int32, dz: Double
# ---------- spiral: Python ----------
import math as m
from compas.geometry import Point, Vector, Frame, Polyline

n_turns = int(h//layer_h)
d_ang = m.tau / resolution
d_h = h / (resolution * n_turns)
l_h = h / n_turns

pts = [Point(
    x_rad * m.cos(d_ang * i), 
    y_rad * m.sin(d_ang * i),
    (i//resolution * l_h) + layer_h * (1 + (dz * (i % step)))
    ) 
for i in range(n_turns * resolution)
]


layer = Polyline(pts)
# ---------- end spiral ----------

# ---- group: DESIGN
# design: "slice" a cylinder
slice_cylinder = SliceCylinder(
    radius=radius_mm,
    height=height_mm,
    layer_height=layer_height_mm,
    point_spacing=point_spacing_mm,
    center_x=center_x_mm,
    center_y=center_y_mm,
    fine_adjust_z=fine_adjust_z_mm)  # -> layers
# ---------- slice_cylinder: Python ----------
# r: compas
# venv: mas-2627
"""
Slice a cylinder into layers, in work object coordinates (Rhino world XY = work object).
One closed compas Polyline per layer. Units: mm.
center_x, center_y: where the cylinder stands on the work object.
fine_adjust_z: shifts all layers up/down, to tune the nozzle height above the bed (0 = first layer at z = 0).
"""
import math

from compas.geometry import Point
from compas.geometry import Polyline

# ===== How many layers, how many points per layer =====
layer_count = int(height / layer_height)
points_per_layer = round(2 * math.pi * radius / point_spacing)

# ===== One closed polyline per layer =====
layers = []
for i in range(layer_count):
    z = i * layer_height + fine_adjust_z
    points = []
    for j in range(points_per_layer + 1):  # one extra point: back to the start to close the ring
        angle = 2 * math.pi * (j % points_per_layer) / points_per_layer
        points.append(Point(center_x + radius * math.cos(angle), center_y + radius * math.sin(angle), z))
    layers.append(Polyline(points))
# ---------- end slice_cylinder ----------

# ---- group: This is needed only ONCE in the GH definition
enable_auto_reload = Python3Script()  # -> ok
# ---------- enable_auto_reload: Python ----------
"""
------------------------------
Using VS Code as Python editor
------------------------------

The simplest way to start using VS Code as our editor, is
to place our Python code in files located IN THE SAME FOLDER as our Grasshopper file.

After we have done that, we need 2 steps: 

1. Enable the COMPAS reloader on one component. This tells Grasshopper to watch for changes in the Pythoh files and reload if changed.
2. Every other component that uses Python code from external files needs to start with a method to ensure Grasshopper knows where to load the files from.

"""
# r: compas
# venv: mas-2627

from compas_rhino.devtools import DevTools
DevTools.enable_reloader()
# ---------- end enable_auto_reload ----------

# ---- group: NONPLANAR SLICE
# NONPLANAR + TILT:
# wavy layers (flat first layer),
# print planes tilted normal to the layer
layer_height_mm_2 = Slider(1.5, range=0.5..10)
radius_mm_2 = Slider(25, range=10..150)
height_mm_2 = Slider(60, range=5..300)
point_spacing_mm_2 = Slider(4, range=1..20)
wave_amp_mm = Slider(8, range=0..40)
wave_freq = Slider(3, range=0..12)
center_x_mm_2 = Slider(0, range=-200..200)
center_y_mm_2 = Slider(0, range=-200..200)
fine_adjust_z_mm_2 = Slider(0, range=-10..10)
cluster = Cluster_2(
    B_2=layer_height_mm_2,
    A=height_mm_2,
    B=layer_height_mm_2,
    B_3=wave_amp_mm,
    B_7=fine_adjust_z_mm_2,
    B_4=radius_mm_2,
    B_5=point_spacing_mm_2,
    B_6=wave_freq,
    B_8=radius_mm_2,
    B_9=center_x_mm_2,
    B_10=radius_mm_2,
    B_11=center_y_mm_2,
    B_12=wave_freq)
plane = Plane(cluster)

# ---- group: radius_bounds
layer_bounds = GenePool(Decimals=0, Maximum=100, Minimum=0, Value=[50, 70])

# ----
# generate printpath: printpoints and path
layer_bounds_2 = GenePool(Decimals=2, Maximum=3, Minimum=0, Value=[1.6, 1.95])
n_layers = Slider(50, range=0..1000)
lamcp = LAMCPBridge(enable=Toggle(True))  # -> status; inputs enable: Boolean, port: Int32
#   port enable: Toggle to start (True) or stop (False) the local HTTP server.
#   port port: Port to listen on (loopback only). Defaults to 8765.
#   port status: Current server status string.
# ---------- lamcp: Python ----------
"""
LAMCP Bridge: local HTTP server inside Rhino 8 / Grasshopper CPython.

Exposes `POST /exec` (JSON: `{"code": "...", "timeout": 30}`) which
exec()s `code` and returns
`{"stdout": "...", "stderr": "...", "result": "...", "error": null|str}`.

Pair with the `lamcp` FastMCP server, which translates Claude's
`run_python_script` MCP tool calls into POSTs to this endpoint.

Binds to 127.0.0.1 only. NEVER expose beyond localhost â€” it exec()s
arbitrary Python with full Rhino API access.

LAMCP v0.1.0
"""

import contextlib
import io
import json
import threading
import traceback
from http.server import BaseHTTPRequestHandler
from http.server import HTTPServer

import Grasshopper
import scriptcontext as sc


SHARED_GLOBALS_KEY = "_lamcp_bridge_globals"
SERVER_KEY = "_lamcp_bridge_server"


def _exec_code(code, timeout):
    """Run `code` on the HTTP-server thread and capture stdout/stderr/result.

    NOTE: this is intentionally NOT marshalled to Rhino's UI thread for the
    spike â€” `Rhino.RhinoApp.InvokeOnUiThread` was queueing actions that
    never fired in Rhino 8 CPython. Most read-only RhinoCommon access is
    safe cross-thread; mutations may crash. Add Eto-based marshalling
    back here when we need it.
    """
    out = io.StringIO()
    err = io.StringIO()
    g = sc.sticky.setdefault(SHARED_GLOBALS_KEY, {"__name__": "__lamcp_bridge__"})
    error_text = None
    result_repr = None
    try:
        with contextlib.redirect_stdout(out), contextlib.redirect_stderr(err):
            exec(code, g, g)
            result_repr = repr(g.get("_"))
    except BaseException:
        error_text = traceback.format_exc()

    return {
        "stdout": out.getvalue(),
        "stderr": err.getvalue(),
        "result": result_repr,
        "error": error_text,
    }


class _ExecHandler(BaseHTTPRequestHandler):
    # Silence default request logging so it doesn't clog the Rhino command line.
    def log_message(self, fmt, *args):
        pass

    def _send(self, code, payload):
        body = json.dumps(payload).encode("utf-8")
        self.send_response(code)
        self.send_header("Content-Type", "application/json")
        self.send_header("Content-Length", str(len(body)))
        self.end_headers()
        self.wfile.write(body)

    def do_GET(self):
        if self.path == "/health":
            self._send(200, {"status": "ok"})
        else:
            self._send(404, {"error": "not found"})

    def do_POST(self):
        if self.path != "/exec":
            self._send(404, {"error": "not found"})
            return
        length = int(self.headers.get("Content-Length", "0"))
        try:
            raw = self.rfile.read(length).decode("utf-8")
            body = json.loads(raw)
            code = body.get("code", "")
            timeout = float(body.get("timeout", 30.0))
        except Exception as exc:
            self._send(400, {"error": "bad request: " + repr(exc)})
            return
        result = _exec_code(code, timeout)
        self._send(200, result)


def _start_server(port):
    server = HTTPServer(("127.0.0.1", port), _ExecHandler)
    thread = threading.Thread(
        target=server.serve_forever, daemon=True, name="lamcp-bridge"
    )
    thread.start()
    return {"server": server, "thread": thread, "port": port}


def _stop_server(state):
    try:
        state["server"].shutdown()
        state["server"].server_close()
    except Exception:
        pass


class LamcpBridgeComponent(Grasshopper.Kernel.GH_ScriptInstance):
    def RunScript(self, enable: bool, port: int):
        port = int(port) if port else 8765

        state = sc.sticky.get(SERVER_KEY)

        if not enable:
            if state is not None:
                _stop_server(state)
                del sc.sticky[SERVER_KEY]
            return "stopped"

        # Already running on the requested port: no-op.
        if (
            state is not None
            and state.get("port") == port
            and state["thread"].is_alive()
        ):
            return "listening on http://127.0.0.1:{}".format(port)

        # Port changed or server died: tear down and restart.
        if state is not None:
            _stop_server(state)
            del sc.sticky[SERVER_KEY]

        try:
            sc.sticky[SERVER_KEY] = _start_server(port)
        except OSError as exc:
            ghenv.Component.AddRuntimeMessage(  # noqa: F821
                Grasshopper.Kernel.GH_RuntimeMessageLevel.Error,
                "Failed to bind 127.0.0.1:{}: {}".format(port, exc),
            )
            return "error: {}".format(exc)

        return "listening on http://127.0.0.1:{}".format(port)
# ---------- end lamcp ----------
range = Range(Domain=Domain(0, 1), Steps=expr("x-1", n_layers))
graph = GraphMapper(range, x0=0, x1=1, y0=0, y1=1, container_name="Gaussian", factor=0.2, mean=0.6459159255, sdev=0.1924380362)
graph_2 = GraphMapper(range, x0=0, x1=1, y0=0, y1=1, Gx=0.6701000929, Gy=0.2977625728, container_name="Power", power=3.026164257)
panel = Panel(lamcp)
create_geometry = Python3Script(
    x_range=graph_2,
    y_range=graph,
    rad_bounds=layer_bounds,
    layer_bounds=layer_bounds_2,
    n_layers=n_layers,
    resolution=Slider(100, range=0..1000))  # -> out, pts_tree, vec_tree, z_change; inputs x_range: list of Double, y_range: list of Double, rad_bounds: list of Double, layer_bounds: list of Double, n_layers: Int32, resolution: Int32
# ---------- create_geometry: Python ----------
import math as m
from compas.geometry import Point, Vector

def remap(t, omin, omax, nmin, nmax, power):
    ratio = (t - omin) / (omax - omin)
    return m.pow(ratio, power) * (nmax - nmin) + nmin

# 0. Define global variables
min_rad, max_rad = rad_bounds[0], rad_bounds[1]
min_lay, max_lay = layer_bounds[0], layer_bounds[1]
x_min, x_max = min(x_range), max(x_range)
y_min, y_max = min(y_range), max(y_range)


pts = []
main_v = []
z_change = []
origin = Point(0.0, 0.0, 0.0)
d_ang = m.tau/resolution
for r in range(resolution):
    sub_pts = []
    sub_v = []
    sub_z = []
    tz = 0    
    for n in range(n_layers):
        x_val = remap(x_range[n], x_min, x_max, min_rad, max_rad, 1)
        y_val = remap(y_range[n], y_min, y_max, min_rad, max_rad, 1)
        pt = Point(x_val*m.cos(r * d_ang), y_val*m.sin(r * d_ang), 0.0)
        dist = pt.distance_to_point(origin)

        if n > 0:
            tz += remap(dist, min_rad, max_rad, min_lay, max_lay, 1)
        # Store point at current z height
            sub_z.append(remap(dist, min_rad, max_rad, min_lay, max_lay, 1))
        else:
            sub_z.append(min_lay)

        new_pt = Point(pt.x, pt.y, min_lay + tz)
        sub_pts.append(new_pt)

        if n > 0:
            dv = Vector.from_start_end(new_pt, sub_pts[-2])
            sub_v.append(dv)
        else:
            zv = Vector(0.0, 0.0, -1.0)
            sub_v.append(zv)
        
    pts.append(sub_pts)
    main_v.append(sub_v)
    z_change.append(sub_z)


# Transpose matrix (flips rows and columns)
revised_matrix = [list(col) for col in zip(*pts)]
revised_vectors = [list(cl) for cl in zip(*main_v)]
revised_z = [list(c) for c in zip(*z_change)]

# Convert transposed list to Grasshopper DataTree
import ghpythonlib.treehelpers as th
pts_tree = th.list_to_tree(revised_matrix)
vec_tree = th.list_to_tree(revised_vectors)
z_change = th.list_to_tree(revised_z)
# ---------- end create_geometry ----------
draw = COMPASDraw(cg=create_geometry.pts_tree)  # -> rg
#   port cg: The COMPAS geometry or datastructure to be drawn.
#   port rg: The Rhino geometry object.
# ---------- draw: Python ----------
# r: compas>=2.14.1
"""
Draws COMPAS geometry in Grasshopper.
"""

from typing import Any

import Grasshopper

from compas.scene import SceneObject


class CompasToRhinoGeometry(Grasshopper.Kernel.GH_ScriptInstance):
    def RunScript(self, cg):
        if not cg:
            return None

        return SceneObject(item=cg).draw()
# ---------- end draw ----------
draw_2 = COMPASDraw(cg=create_geometry.vec_tree)  # -> rg; same code as draw
vdisex = VectorDisplayEx(Point=draw, Vector=draw_2, Colour=RGB(0, 0, 0), Width=Slider(1, range=0..10))
frame_generation = Python3Script(pts_tree=create_geometry.pts_tree, vec_tree=create_geometry.vec_tree)  # -> out, rev_frames; inputs pts_tree: tree, vec_tree: tree
# ---------- frame_generation: Python ----------
from compas.geometry import Vector, Frame
import ghpythonlib.treehelpers as th

pts = th.tree_to_list(pts_tree)    # [layer][point]
vecs = th.tree_to_list(vec_tree)   # [layer][vector], same shape as pts

REF = -Vector.Xaxis()              # fixed x direction, same as the original flipped frame


def make_frame(pt, z, ref):
    """Frame at pt whose z-axis is z and whose x-axis stays as close to ref as possible."""
    z = z.unitized()
    # keep only the part of ref perpendicular to z (no spin around z)
    x = ref - z * ref.dot(z)
    if x.length < 1e-6:
        # ref is parallel to z: fall back to world Y
        x = Vector.Yaxis() - z * z.y

    print(x)    
    x.unitize()
    print(x)    

    # x cross (z cross x) = z, so this frame's z-axis comes out exactly as z
    return Frame(pt, x, z.cross(x))


frames = [
    [make_frame(p, v, REF) for p, v in zip(layer_pts, layer_vecs)]
    for layer_pts, layer_vecs in zip(pts, vecs)
]

rev_frames = th.list_to_tree(frames)
# ---------- end frame_generation ----------
frame_generation_2 = Python3Script(pts_tree=create_geometry.pts_tree, vec_tree=create_geometry.vec_tree)  # -> out, rev_frames; inputs pts_tree: tree, vec_tree: tree; disabled
# ---------- frame_generation_2: Python ----------
import math as m
from compas.geometry import Point, Vector, Frame
from compas.geometry import Transformation, Rotation
import ghpythonlib.treehelpers as th

pts = th.tree_to_list(pts_tree)
vecs = th.tree_to_list(vec_tree)

frames = [
    [Frame(
        p,
        -Vector.Xaxis(),
        Vector.Yaxis()
    )
    for p in sub_pts
    ]
    for sub_pts in pts
]

revised_frames = []

for ns, sub_vecs in enumerate(vecs):
    revised_subframes = []
    for nv, vs in enumerate(sub_vecs):
        frame_copy = frames[ns][nv].copy()
        v_u = vs.unitized()
        nx, ny, nz = v_u.x, v_u.y, v_u.z
        ny_clamped = max(-1.0, min(1.0, ny))
        theta_x = m.asin(ny_clamped)
        theta_y = m.atan2(-nx, -nz)
        frame_copy.rotate(theta_x, Vector.Xaxis(), frame_copy.point)
        frame_copy.rotate(theta_y, Vector.Yaxis(), frame_copy.point)
        revised_subframes.append(frame_copy)
    revised_frames.append(revised_subframes)

rev_frames = th.list_to_tree(revised_frames)
# ---------- end frame_generation_2 ----------
flatten = FlattenTree(Tree=frame_generation.rev_frames, Path="{0}")
flatten_2 = FlattenTree(Tree=create_geometry.z_change, Path="{0}")
draw_3 = COMPASDraw(cg=frame_generation_2.rev_frames)  # -> rg; disabled; same code as draw
item = ListItem(List=flatten_2, Index=0, Wrap=True)
add_frame = Python3Script(frames=flatten)  # -> out, rev_frames; inputs frames: list
# ---------- add_frame: Python ----------
from compas.geometry import Vector, Frame

f_origin = frames[0].copy()
f_origin.point += Vector(0.0, -100.0, 0.0)
frames.insert(0, f_origin)
rev_frames = frames
# ---------- end add_frame ----------
lng = ListLength(List=add_frame.rev_frames)
draw_4 = COMPASDraw(cg=add_frame.rev_frames)  # -> rg; same code as draw
merge = Merge(Data1=item, Data2=flatten_2)
repeat = RepeatData(Data=Slider(2, range=0..10), Length=lng)
bounds = Bounds(Numbers=merge)
item_2 = ListItem(List=draw_4, Index=0, Wrap=True)
item_3 = ListItem(List=flatten(item_2), Index=Slider(837, range=0..1000), Wrap=True)
panel_2 = Panel(bounds)
safety_distance_mm = Slider(100, range=10..300)
blend_radius_mm = Slider(1, range=0..5)
genes = GenePool(Decimals=2, Maximum=50, Minimum=0, Value=[8, 12])
printpath = Printpath(
    layers=add_frame.rev_frames,
    pt_h=merge,
    pt_class=repeat,
    speed=genes,
    blend_radius=blend_radius_mm,
    safety_distance=safety_distance_mm)  # -> printpath, summary, mapped_speed; inputs layers: list, pt_h: list of Double, pt_class: list, speed: list
# ---------- printpath: Python ----------
# r: compas
# venv: mas-2627
"""
Turn the layers into printpoints and a PrintPath, in work object coordinates.
Safety points are added here, before any transform to the robot base.
"""
import os
import math as m
import sys
import importlib

from compas.geometry import Frame, Vector

def remap(t, omin, omax, nmin, nmax, power):
    ratio = (t - omin) / (omax - omin)
    return m.pow(ratio, power) * (nmax - nmin) + nmin

# Find source folder
gh_dir = os.path.dirname(ghenv.Component.OnPingDocument().FilePath)
print(gh_dir)
src_dir = os.path.join(gh_dir, "src")
print(src_dir)
if src_dir not in sys.path:
    sys.path.append(src_dir)
from print_class_02 import PrintPoint, PrintPath

sum_speed = max(speed) + min(speed)
# ===== One printpoint per point =====
# world XY orientation for every point: a tangent frame would turn the wrist 360 degrees each layer
printpoints = []
mapped_speed = []
for frame_index, fr in enumerate(layers):

    v = sum_speed - remap(pt_h[frame_index], min(pt_h), max(pt_h), min(speed), max(speed), 1)
    mapped_speed.append(v)
    # v = speed[0] * (1 - t) + speed[1] * (t)
    printpoints.append(PrintPoint(fr, frame_index, v, blend_radius, True, pt_class[frame_index]))
    # printpoints.append(PrintPoint(frame, pt_index, speed, blend_radius, True, pt_class[pt_index])) 
    # ABOVE if speed is a single input

# ===== Path with a travel point above the start and the end =====
printpath = PrintPath(printpoints)
printpath.add_safety_before(safety_distance, speed[1])
printpath.add_safety_after(safety_distance, speed[1])

summary = f"{len(printpoints)} printpoints in {len(layers)} layers, plus 2 safety points"
# ---------- end printpath ----------
panel_3 = Panel(printpath.summary)

lamcp_bridge = LAMCPBridge(enable=Toggle(True))  # -> status; inputs enable: Boolean, port: Int32; same code as lamcp
panel_4 = Panel(lamcp_bridge)

pick_safe_preview = Python3Script()  # -> planes; inputs frames: list
# ---------- pick_safe_preview: Python ----------
"""
Convert COMPAS Frames to Rhino Planes for preview.
    Input:  frames (List Access, No Type Hint)
    Output: planes
"""
import Rhino.Geometry as rg
from compas.geometry import Frame
from compas_rhino.conversions import frame_to_rhino_plane


def to_plane(item):
    if item is None:
        return None
    if isinstance(item, rg.Plane):
        return item
    if isinstance(item, Frame):
        return frame_to_rhino_plane(item)
    raise TypeError("Not a COMPAS Frame: {}".format(type(item)))


def flatten(items):
    for item in items:
        if isinstance(item, (list, tuple)):
            for sub in flatten(item):
                yield sub
        else:
            yield item


planes = [to_plane(f) for f in flatten(frames or [])]
ghenv.Component.Message = "{} planes".format(len(planes))
# ---------- end pick_safe_preview ----------

layer_height_mm_3 = Slider(1.3, range=0.5..10)
python_3_script = Python3Script(layer_height=layer_height_mm_3, b1=Slider(2, range=0..10))  # -> out, layers; inputs b1: Int32
# ---------- python_3_script: Python ----------
import Rhino.Geometry as rg
import numpy as np
import math as m

class Column:
    def __init__(self, axis: rg.Curve, radius_base: float, radius_top: float):
        self.axis = axis
        # reparameterize axis
        self.axis.Domain = rg.Interval(0,1)
        self.radius_base = radius_base
        self.radius_top = radius_top
        self.height = axis.PointAtEnd.Z - axis.PointAtStart.Z

    def get_point(self, angle: float, tz: float) -> rg.Point3d:
        """
        Args:
            angle: angle in polar coord. in radians
            tz: parameter on axis
        """
        origin = self.axis.PointAt(tz)
        radius = self.get_radius_bezier(tz)

        pt = rg.Point3d(
            origin.X + m.cos(angle)*radius,
            origin.Y + m.sin(angle)*radius,
            origin.Z
        )

        return pt


    def get_radius(self, angle: float, tz: float) -> float:
        radius =  self.radius_base*(1-tz) + self.radius_top*tz
        return radius

    def get_radius_bezier(self, tz: float) ->float:
        bezier = rg.BezierCurve(
            [
                rg.Point2d(0, 0),
                rg.Point2d(0.5, b1/2),
                # rg.Point2d(0.75, 3),
                rg.Point2d(0, b1)
            ]
        )

        radius = self.radius_base*(1-tz) + self.radius_top*tz
        radius += bezier.PointAt(tz).Y*5
        return radius

    def get_radius_wave(self, angle: float, tz: float, freq: int, amp: float) -> float:
        # #roatate
        # shift = tz*m.radians(60)
        # angle += shift

        # #fade
        # amp = m.pow(tz, 2)*amp

        
        # # radius = self.get_radius(angle, tz) + m.cos(angle*freq)*amp
        # # return radius

        # #blend wave freq
        # freq1 = 3
        # freq2 = 5

        # _r1 = m.cos(angle*freq1)*amp
        # _r2 = m.cos(angle*freq2)*amp

        # radius = self.get_radius(angle, tz) + _r1*(1-tz) + _r2*(tz)
        # return radius

        # rotate in both direction
        shift = tz*m.radians(100)

        _r1 = self.get_radius(angle, tz) + m.cos((angle+shift)*freq)*amp
        _r2 = self.get_radius(angle, tz) + m.cos((angle-shift)*freq)*amp

        # radius = _r1*(1-tz) + _r2*tz
        # radius = (_r1 + _r2)/2
        # radius = max(_r1, _r2) 
        radius = min(_r1, _r2)

        return radius




    def get_layers(self, layer_height: float, res_u: int):

        layers_count = int(self.height // layer_height) + 1
        layers = []

        for tz in np.linspace(0, 1, layers_count)[0:]:
            layer = []

            for angle in np.linspace(0, m.tau, res_u )[::-1]:
                pt = self.get_point(angle, tz)
                layer.append(pt)

            layers.append(layer)

        return layers

    @staticmethod
    def get_mesh(layers:list[list[rg.Point3d]], closed: bool) -> rg.Mesh:
        mesh  = rg.Mesh()

        for layer in layers:
            for pt in layer:
                mesh.Vertices.Add(pt)

        idx = np.array(range(mesh.Vertices.Count))
        idx = idx.reshape(len(layers), len(layers[0]))

        if closed:
            print(np.roll(idx[:-1], -1, axis=1))
            faces = np.stack([
                idx[:-1],                             # Top-left
                np.roll(idx[:-1], -1, axis=1),        # Top-right
                idx[1:],                              # Bottom-left
                np.roll(idx[1:], -1, axis=1)          # Bottom-right
            ], axis=-1).reshape(-1, 4)
        else:
            faces = np.lib.stride_tricks.sliding_window_view(
                idx, window_shape=(2, 2)
            ).reshape(-1, 4)

            print(faces)

        for face in faces:
            print (face, [int(f)for f in face], *[int(f)for f in face])
            mesh.Faces.AddFace(
                *[int(f)for f in face]
            )

        mesh.Compact()
        mesh.RebuildNormals()

        return mesh
       


if __name__ == "__main__":
    
    axis = rg.LineCurve(
        rg.Point3d(0,0,0),
        rg.Point3d(0,0,30)
    )
    
    mycolumn = Column(axis, 25, 25)
    layers = mycolumn.get_layers(layer_height,100)

    mesh = Column.get_mesh(layers, closed=True)


    import ghpythonlib.treehelpers as tree
    layers = tree.list_to_tree(layers)
# ---------- end python_3_script ----------

python_3_script_2 = Python3Script(
    radius_base=Slider(50, range=0..50),
    radius_top=Slider(50, range=0..50),
    layer_height=Slider(1.3, range=0..100),
    res_u=Slider(91, range=0..100),
    angle=Slider(5.5, range=0..10),
    freq=Slider(5, range=0..10),
    amp=Slider(3.5, range=0..10),
    y1=Slider(2, range=0..20),
    y2=Slider(6, range=0..20))  # -> out, layers, mesh; inputs layer_height: Int32, res_u: Int32, freq: Int32, amp: Int32
# ---------- python_3_script_2: Python ----------
import Rhino.Geometry as rg
import math as m
import numpy as np

class Column:
    def __init__(self, axis: rg.Curve, radius_base: float, radius_top: float):
        """
        Title and description

        """

        self.axis = axis
        self.radius_base = radius_base
        self.radius_top = radius_top
        self.height = axis.PointAtEnd.Z - axis.PointAtStart.Z
        # reparameterize axis
        self.axis.Domain = rg.Interval(0,1)


    def get_point(self, angle: float, tz: float, nz:int) -> rg.Point3d:
    # '->' showing what will be returned

        """
        angle: angle in polar coord. in radius
        tz: parameter on axis

        """

        origin = self.axis.PointAt(tz)
        # radius = self.get_radius_wave(angle, tz, 8, 3)
        radius = self.get_radius_bezier(tz)
        radius += self.get_zigzag(angle, freq, amp, nz)*2

        pt = rg.Point3d(
            origin.X + m.cos(angle)*radius,
            origin.Y + m.sin(angle)*radius,
            origin.Z
        )

        return pt

    
    def get_radius(self, angle: float, tz: float) -> float:
        radius = self.radius_base*(1-tz) + self.radius_top*tz
        return radius

    
    def get_radius_bezier(self, tz: float) -> float:
        bezier = rg.BezierCurve(
            [
                rg.Point2d(0, 0),
                rg.Point2d(0.2,y1),
                rg.Point2d(0.8,y2),
                rg.Point2d(1,0)
            ]
        )

        radius = self.radius_base*(1-tz) + self.radius_top*tz
        radius += bezier.PointAt(tz).Y*5
        return radius

    
    def get_zigzag(self, angle: float, freq: int, amp: float, nz: int) -> float:

        if nz % 2 == 0:
            zigzag = amp * m.cos(angle * 300)
            #  print(zigzag)
            return zigzag
        else:
            shifted_zigzag = -(amp * m.cos(angle * 300))
            return shifted_zigzag


    def get_radius_wave(self, angle: float, tz: float, freq: int, amp: float) -> float:
        # rotate
        shift = tz*m.radians(270)
        angle += shift

        # # fade
        # amp = m.pow((tz), 2) * amp

        # radius = self.get_radius(angle, tz) + m.cos(angle*freq) * amp
        # return radius

        # # blend wave freq
        # freq1 = 2
        # freq2 = 4

        # _r1 = m.cos(angle*freq1)*amp
        # _r2 = m.cos(angle*freq2)*amp

        # radius = self.get_radius(angle, tz) + _r1*(1-tz) + _r2*(tz)
        # return radius

        # rotate in both direction
        shift = tz*m.radians(260)

        a1 = angle + shift
        a2 = angle - shift

        _r1 = self.get_radius(angle, tz) + m.cos(a1 * freq) * amp
        _r2 = self.get_radius(angle, tz) + m.cos(a2 * freq) * amp
        # radius = _r1*(1-tz) + _r2*tz
        radius = (_r1 + _r2) / 2
        # radius = max(_r1, _r2)
        # radius = min(_r1, _r2)

        return radius


    def get_layers(self, layer_height: float, res_u: int) -> list[list[rg.Point3d]]:

        layers_count = int(self.height // layer_height) + 1
        layers = []

        for nz, tz in enumerate(np.linspace(0, 1, layers_count)[1:]):
            layer = []
            for angle in np.linspace(0, m.tau, res_u)[:-1]:
                pt = self.get_point(angle, tz, nz)
                layer.append(pt)

            layers.append(layer)

        return layers


    @staticmethod
    def get_mesh(layers: list[list[rg.Point3d]], closed: bool) -> rg.Mesh:
        mesh = rg.Mesh()

        for layer in layers:
            for pt in layer:
                mesh.Vertices.Add(pt)

        # print(mesh.Vertices.Count)

        # numpy only
        idx = np.array(range(mesh.Vertices.Count))
        idx = idx.reshape(len(layers), len(layers[0]))

        if closed:
            faces = np.stack([
                idx[:-1],                             
                np.roll(idx[:-1], -1, axis=1),    
                np.roll(idx[1:], -1, axis=1),          
                idx[1:],                              
            ], axis=-1).reshape(-1, 4)

            print(faces)

        else:
            faces = np.lib.stride_tricks.sliding_window_view(
                idx, window_shape=(2, 2)
            ).reshape(-1, 4)

            print(faces)

        for face in faces:
            mesh.Faces.AddFace(
                *[int(f) for f in face] # '*' here for unpacking the list
            )

        mesh.Compact()
        mesh.RebuildNormals()
        return mesh

if __name__ == "__main__":
    axis = rg.LineCurve(
        rg.Point3d(0,0,0),
        rg.Point3d(0,0,100)
    )


    mycolumn = Column(axis, radius_base, radius_top)
    layers = mycolumn.get_layers(layer_height, res_u)

    mesh = Column.get_mesh(layers, closed=True)

    import ghpythonlib.treehelpers as tree
    layers = tree.list_to_tree(layers)
# ---------- end python_3_script_2 ----------

python_3_script_3 = Python3Script(
    radius_base=Slider(50, range=0..50),
    radius_top=Slider(50, range=0..50),
    layer_height=Slider(1.5, range=0..100),
    res_u=Slider(91, range=0..100),
    angle=Slider(5.5, range=0..10),
    freq=Slider(443, range=0..1000),
    shift_step=Slider(7, range=0..100),
    amp=Slider(3.15, range=0..10),
    y1=Slider(2, range=0..20),
    y2=Slider(6, range=0..20))  # -> out, layers, mesh; inputs layer_height: Int32, res_u: Int32, freq: Int32, amp: Int32
# ---------- python_3_script_3: Python ----------
import Rhino.Geometry as rg
import math as m
import numpy as np

class Column:
    def __init__(self, axis: rg.Curve, radius_base: float, radius_top: float):
        """
        Title and description

        """

        self.axis = axis
        self.radius_base = radius_base
        self.radius_top = radius_top
        self.height = axis.PointAtEnd.Z - axis.PointAtStart.Z
        # reparameterize axis
        self.axis.Domain = rg.Interval(0,1)


    def get_point(self, angle: float, tz: float, nz:int) -> rg.Point3d:
    # '->' showing what will be returned

        """
        angle: angle in polar coord. in radius
        tz: parameter on axis

        """

        origin = self.axis.PointAt(tz)
        # radius = self.get_radius_wave(angle, tz, 8, 3)
        radius = self.get_radius_bezier(tz)
        radius += self.get_zigzag(angle, freq, amp, nz)
        pt = rg.Point3d(
            origin.X + m.cos(angle)*radius,
            origin.Y + m.sin(angle)*radius,
            origin.Z
        )
        return pt

    
    def get_radius(self, angle: float, tz: float) -> float:
        radius = self.radius_base*(1-tz) + self.radius_top*tz
        return radius

    
    def get_radius_bezier(self, tz: float) -> float:
        bezier = rg.BezierCurve(
            [
                rg.Point2d(0, 0),
                rg.Point2d(0.2,y1),
                rg.Point2d(0.8,y2),
                rg.Point2d(1,0)
            ]
        )

        radius = self.radius_base*(1-tz) + self.radius_top*tz
        radius += bezier.PointAt(tz).Y*5
        return radius


    # # flipped cos function
    # def get_zigzag(self, angle: float, freq: int, amp: float, nz: int) -> float:

    #     if nz % 5 == 0:
    #         zigzag = amp * m.cos(angle * 300)
    #         #  print(zigzag)
    #         return zigzag
    #     else:
    #         flipped_zigzag = -(amp * m.cos(angle * 300))
    #         return flipped_zigzag


    # shifted cos function
    def get_zigzag(self, angle: float, freq: int, amp: float, nz: int) -> float:

        # if nz % 2 == 0:
        #     zigzag = amp * m.cos(angle * 300) 
        #     #  print(zigzag)
        #     return zigzag
        # else:
        #     shifted_zigzag = (amp * m.cos((angle+(m.pi/4)) * 300))
        #     return shifted_zigzag

        shift = nz * (m.pi / (freq*shift_step))
        zigzag = amp * m.cos((angle + shift) * freq)
        return zigzag


    def get_radius_wave(self, angle: float, tz: float, freq: int, amp: float) -> float:
        # rotate
        shift = tz*m.radians(270)
        angle += shift

        # # fade
        # amp = m.pow((tz), 2) * amp

        # radius = self.get_radius(angle, tz) + m.cos(angle*freq) * amp
        # return radius

        # # blend wave freq
        # freq1 = 2
        # freq2 = 4

        # _r1 = m.cos(angle*freq1)*amp
        # _r2 = m.cos(angle*freq2)*amp

        # radius = self.get_radius(angle, tz) + _r1*(1-tz) + _r2*(tz)
        # return radius

        # rotate in both direction
        shift = tz*m.radians(260)

        a1 = angle + shift
        a2 = angle - shift

        _r1 = self.get_radius(angle, tz) + m.cos(a1 * freq) * amp
        _r2 = self.get_radius(angle, tz) + m.cos(a2 * freq) * amp
        # radius = _r1*(1-tz) + _r2*tz
        radius = (_r1 + _r2) / 2
        # radius = max(_r1, _r2)
        # radius = min(_r1, _r2)

        return radius


    def get_layers(self, layer_height: float, res_u: int) -> list[list[rg.Point3d]]:

        layers_count = int(self.height // layer_height) + 1
        layers = []

        for nz, tz in enumerate(np.linspace(0, 1, layers_count)[1:]):
            layer = []
            for angle in np.linspace(0, m.tau, res_u)[:-1]:
                pt = self.get_point(angle, tz, nz)
                layer.append(pt)

            layers.append(layer)

        return layers


    @staticmethod
    def get_mesh(layers: list[list[rg.Point3d]], closed: bool) -> rg.Mesh:
        mesh = rg.Mesh()

        for layer in layers:
            for pt in layer:
                mesh.Vertices.Add(pt)

        # print(mesh.Vertices.Count)

        # numpy only
        idx = np.array(range(mesh.Vertices.Count))
        idx = idx.reshape(len(layers), len(layers[0]))

        if closed:
            faces = np.stack([
                idx[:-1],                             
                np.roll(idx[:-1], -1, axis=1),    
                np.roll(idx[1:], -1, axis=1),          
                idx[1:],                              
            ], axis=-1).reshape(-1, 4)

            print(faces)

        else:
            faces = np.lib.stride_tricks.sliding_window_view(
                idx, window_shape=(2, 2)
            ).reshape(-1, 4)

            print(faces)

        for face in faces:
            mesh.Faces.AddFace(
                *[int(f) for f in face] # '*' here for unpacking the list
            )

        mesh.Compact()
        mesh.RebuildNormals()
        return mesh

if __name__ == "__main__":
    axis = rg.LineCurve(
        rg.Point3d(0,0,0),
        rg.Point3d(0,0,100)
    )


    mycolumn = Column(axis, radius_base, radius_top)
    layers = mycolumn.get_layers(layer_height, res_u)

    mesh = Column.get_mesh(layers, closed=True)

    import ghpythonlib.treehelpers as tree
    layers = tree.list_to_tree(layers)
# ---------- end python_3_script_3 ----------

python_3_script_4 = Python3Script(
    radius_base=Slider(50, range=0..50),
    radius_top=Slider(50, range=0..50),
    layer_height=Slider(1.3, range=0..100),
    res_u=Slider(91, range=0..100),
    angle=Slider(5.5, range=0..10),
    freq=Slider(443, range=0..1000),
    shift_step=Slider(7, range=0..100),
    amp=Slider(3.15, range=0..10),
    y1=Slider(2, range=0..20),
    y2=Slider(6, range=0..20))  # -> out, layers, mesh; inputs layer_height: Int32, res_u: Int32, freq: Int32, amp: Int32
# ---------- python_3_script_4: Python ----------
import Rhino.Geometry as rg
import math as m
import numpy as np

class Column:
    def __init__(self, axis: rg.Curve, radius_base: float, radius_top: float):
        """
        Title and description

        """

        self.axis = axis
        self.radius_base = radius_base
        self.radius_top = radius_top
        self.height = axis.PointAtEnd.Z - axis.PointAtStart.Z
        # reparameterize axis
        self.axis.Domain = rg.Interval(0,1)


    def get_point(self, angle: float, tz: float, nz:int, na: int) -> rg.Point3d:
    # '->' showing what will be returned

        """
        angle: angle in polar coord. in radius
        tz: parameter on axis

        """

        origin = self.axis.PointAt(tz)
        # radius = self.get_radius_wave(angle, tz, 8, 3)
        radius = self.get_radius_bezier(tz)

        if nz % 5 == 0:
            radius += self.get_zigzag(angle, freq, amp, nz)

        pt = rg.Point3d(
            origin.X + m.cos(angle)*radius,
            origin.Y + m.sin(angle)*radius,
            origin.Z
        )
        return pt

    
    def get_radius(self, angle: float, tz: float) -> float:
        radius = self.radius_base*(1-tz) + self.radius_top*tz
        return radius

    
    def get_radius_bezier(self, tz: float) -> float:
        bezier = rg.BezierCurve(
            [
                rg.Point2d(0, 0),
                rg.Point2d(0.2,y1),
                rg.Point2d(0.8,y2),
                rg.Point2d(1,0)
            ]
        )

        radius = self.radius_base*(1-tz) + self.radius_top*tz
        radius += bezier.PointAt(tz).Y*5
        return radius


    # # flipped cos function
    # def get_zigzag(self, angle: float, freq: int, amp: float, nz: int) -> float:

    #     if nz % 5 == 0:
    #         zigzag = amp * m.cos(angle * 300)
    #         #  print(zigzag)
    #         return zigzag
    #     else:
    #         flipped_zigzag = -(amp * m.cos(angle * 300))
    #         return flipped_zigzag


    # shifted cos function
    def get_zigzag(self, angle: float, freq: int, amp: float, nz: int) -> float:

        # if nz % 2 == 0:
        #     zigzag = amp * m.cos(angle * 300) 
        #     #  print(zigzag)
        #     return zigzag
        # else:
        #     shifted_zigzag = (amp * m.cos((angle+(m.pi/4)) * 300))
        #     return shifted_zigzag


        shift = nz * (m.pi / (freq*shift_step))
        zigzag = amp * m.cos((angle + shift) * freq)
        return zigzag


    def get_radius_wave(self, angle: float, tz: float, freq: int, amp: float) -> float:
        # rotate
        shift = tz*m.radians(270)
        angle += shift

        # # fade
        # amp = m.pow((tz), 2) * amp

        # radius = self.get_radius(angle, tz) + m.cos(angle*freq) * amp
        # return radius

        # # blend wave freq
        # freq1 = 2
        # freq2 = 4

        # _r1 = m.cos(angle*freq1)*amp
        # _r2 = m.cos(angle*freq2)*amp

        # radius = self.get_radius(angle, tz) + _r1*(1-tz) + _r2*(tz)
        # return radius

        # rotate in both direction
        shift = tz*m.radians(260)

        a1 = angle + shift
        a2 = angle - shift

        _r1 = self.get_radius(angle, tz) + m.cos(a1 * freq) * amp
        _r2 = self.get_radius(angle, tz) + m.cos(a2 * freq) * amp
        # radius = _r1*(1-tz) + _r2*tz
        radius = (_r1 + _r2) / 2
        # radius = max(_r1, _r2)
        # radius = min(_r1, _r2)

        return radius


    def get_layers(self, layer_height: float, res_u: int) -> list[list[rg.Point3d]]:

        layers_count = int(self.height // layer_height) + 1
        layers = []

        for nz, tz in enumerate(np.linspace(0, 1, layers_count)[1:]):
            layer = []
            for na, angle in enumerate(np.linspace(0, m.tau, res_u)[:-1]):
                pt = self.get_point(angle, tz, nz, na)
                layer.append(pt)

            layers.append(layer)

        return layers


    @staticmethod
    def get_mesh(layers: list[list[rg.Point3d]], closed: bool) -> rg.Mesh:
        mesh = rg.Mesh()

        for layer in layers:
            for pt in layer:
                mesh.Vertices.Add(pt)

        # print(mesh.Vertices.Count)

        # numpy only
        idx = np.array(range(mesh.Vertices.Count))
        idx = idx.reshape(len(layers), len(layers[0]))

        if closed:
            faces = np.stack([
                idx[:-1],                             
                np.roll(idx[:-1], -1, axis=1),    
                np.roll(idx[1:], -1, axis=1),          
                idx[1:],                              
            ], axis=-1).reshape(-1, 4)

            print(faces)

        else:
            faces = np.lib.stride_tricks.sliding_window_view(
                idx, window_shape=(2, 2)
            ).reshape(-1, 4)

            print(faces)

        for face in faces:
            mesh.Faces.AddFace(
                *[int(f) for f in face] # '*' here for unpacking the list
            )

        mesh.Compact()
        mesh.RebuildNormals()
        return mesh

if __name__ == "__main__":
    axis = rg.LineCurve(
        rg.Point3d(0,0,0),
        rg.Point3d(0,0,100)
    )


    mycolumn = Column(axis, radius_base, radius_top)
    layers = mycolumn.get_layers(layer_height, res_u)

    mesh = Column.get_mesh(layers, closed=True)

    import ghpythonlib.treehelpers as tree
    layers = tree.list_to_tree(layers)
# ---------- end python_3_script_4 ----------

python_3_script_5 = Python3Script(
    radius_base=Slider(50, range=0..50),
    radius_top=Slider(50, range=0..50),
    layer_height=Slider(1.3, range=0..100),
    res_u=Slider(91, range=0..100),
    angle=Slider(5.5, range=0..10),
    freq=Slider(6, range=0..10),
    amp=Slider(1.49, range=0..10),
    y1=Slider(3, range=0..20),
    y2=Slider(6, range=0..20))  # -> out, layers, mesh; inputs res_u: Int32
# ---------- python_3_script_5: Python ----------
import Rhino.Geometry as rg
import math as m
import numpy as np

class Column:
    def __init__(self, axis: rg.Curve, radius_base: float, radius_top: float):
        """
        Title and description

        """

        self.axis = axis
        self.radius_base = radius_base
        self.radius_top = radius_top
        self.height = axis.PointAtEnd.Z - axis.PointAtStart.Z
        # reparameterize axis
        self.axis.Domain = rg.Interval(0,1)


    def get_point(self, angle: float, tz: float) -> rg.Point3d:
    # '->' showing what will be returned

        """
        angle: angle in polar coord. in radius
        tz: parameter on axis

        """

        origin = self.axis.PointAt(tz)
        # radius = self.get_radius_wave(angle, tz, 8, 3)
        radius = self.get_radius_bezier(tz)
        radius += self.get_zigzag(angle, freq, amp)*2

        pt = rg.Point3d(
            origin.X + m.cos(angle)*radius,
            origin.Y + m.sin(angle)*radius,
            origin.Z
        )

        return pt

    
    def get_radius(self, angle: float, tz: float) -> float:
        radius = self.radius_base*(1-tz) + self.radius_top*tz
        return radius

    
    def get_radius_bezier(self, tz: float) -> float:
        bezier = rg.BezierCurve(
            [
                rg.Point2d(0, 0),
                rg.Point2d(0.2,y1),
                rg.Point2d(0.8,y2),
                rg.Point2d(1,0)
            ]
        )

        radius = self.radius_base*(1-tz) + self.radius_top*tz
        radius += bezier.PointAt(tz).Y*5
        return radius

    
    def get_zigzag(self, angle: float, freq: int, amp: float) -> float:
        t = (angle * freq / m.tau)
        zigzag = amp * m.cos(angle * 300)
        print(zigzag)
        return zigzag
        

    def get_radius_wave(self, angle: float, tz: float, freq: int, amp: float) -> float:
        # rotate
        shift = tz*m.radians(270)
        angle += shift

        # # fade
        # amp = m.pow((tz), 2) * amp

        # radius = self.get_radius(angle, tz) + m.cos(angle*freq) * amp
        # return radius

        # # blend wave freq
        # freq1 = 2
        # freq2 = 4

        # _r1 = m.cos(angle*freq1)*amp
        # _r2 = m.cos(angle*freq2)*amp

        # radius = self.get_radius(angle, tz) + _r1*(1-tz) + _r2*(tz)
        # return radius

        # rotate in both direction
        shift = tz*m.radians(260)

        a1 = angle + shift
        a2 = angle - shift

        _r1 = self.get_radius(angle, tz) + m.cos(a1 * freq) * amp
        _r2 = self.get_radius(angle, tz) + m.cos(a2 * freq) * amp
        # radius = _r1*(1-tz) + _r2*tz
        radius = (_r1 + _r2) / 2
        # radius = max(_r1, _r2)
        # radius = min(_r1, _r2)

        return radius


    def get_layers(self, layer_height: float, res_u: int) -> list[list[rg.Point3d]]:

        layers_count = int(self.height // layer_height) + 1
        layers = []

        for tz in np.linspace(0, 1, layers_count)[1:]:
            layer = []
            for angle in np.linspace(0, m.tau, res_u)[:-1]:
                pt = self.get_point(angle, tz)
                layer.append(pt)

            layers.append(layer)

        return layers


    @staticmethod
    def get_mesh(layers: list[list[rg.Point3d]], closed: bool) -> rg.Mesh:
        mesh = rg.Mesh()

        for layer in layers:
            for pt in layer:
                mesh.Vertices.Add(pt)

        # print(mesh.Vertices.Count)

        # numpy only
        idx = np.array(range(mesh.Vertices.Count))
        idx = idx.reshape(len(layers), len(layers[0]))

        if closed:
            faces = np.stack([
                idx[:-1],                             
                np.roll(idx[:-1], -1, axis=1),    
                np.roll(idx[1:], -1, axis=1),          
                idx[1:],                              
            ], axis=-1).reshape(-1, 4)

            print(faces)

        else:
            faces = np.lib.stride_tricks.sliding_window_view(
                idx, window_shape=(2, 2)
            ).reshape(-1, 4)

            print(faces)

        for face in faces:
            mesh.Faces.AddFace(
                *[int(f) for f in face] # '*' here for unpacking the list
            )

        mesh.Compact()
        mesh.RebuildNormals()
        return mesh

if __name__ == "__main__":
    axis = rg.LineCurve(
        rg.Point3d(0,0,0),
        rg.Point3d(0,0,100)
    )


    mycolumn = Column(axis, radius_base, radius_top)
    layers = mycolumn.get_layers(layer_height, res_u)

    mesh = Column.get_mesh(layers, closed=True)

    import ghpythonlib.treehelpers as tree
    layers = tree.list_to_tree(layers)
# ---------- end python_3_script_5 ----------

python_3_script_6 = Python3Script(
    radius_base=Slider(50, range=0..50),
    radius_top=Slider(50, range=0..50),
    layer_height=Slider(1.3, range=0..100),
    res_u=Slider(91, range=0..100),
    angle=Slider(5.5, range=0..10),
    freq=Slider(5, range=0..10),
    amp=Slider(3.15, range=0..10),
    y1=Slider(2, range=0..20),
    y2=Slider(6, range=0..20))  # -> out, layers, mesh; inputs layer_height: Int32, res_u: Int32, freq: Int32, amp: Int32
# ---------- python_3_script_6: Python ----------
import Rhino.Geometry as rg
import math as m
import numpy as np

class Column:
    def __init__(self, axis: rg.Curve, radius_base: float, radius_top: float):
        """
        Title and description

        """

        self.axis = axis
        self.radius_base = radius_base
        self.radius_top = radius_top
        self.height = axis.PointAtEnd.Z - axis.PointAtStart.Z
        # reparameterize axis
        self.axis.Domain = rg.Interval(0,1)


    def get_point(self, angle: float, tz: float, nz:int) -> rg.Point3d:
    # '->' showing what will be returned

        """
        angle: angle in polar coord. in radius
        tz: parameter on axis

        """

        origin = self.axis.PointAt(tz)
        # radius = self.get_radius_wave(angle, tz, 8, 3)
        radius = self.get_radius_bezier(tz)
        radius += self.get_zigzag(angle, freq, amp, nz)*2

        pt = rg.Point3d(
            origin.X + m.cos(angle)*radius,
            origin.Y + m.sin(angle)*radius,
            origin.Z
        )

        return pt

    
    def get_radius(self, angle: float, tz: float) -> float:
        radius = self.radius_base*(1-tz) + self.radius_top*tz
        return radius

    
    def get_radius_bezier(self, tz: float) -> float:
        bezier = rg.BezierCurve(
            [
                rg.Point2d(0, 0),
                rg.Point2d(0.2,y1),
                rg.Point2d(0.8,y2),
                rg.Point2d(1,0)
            ]
        )

        radius = self.radius_base*(1-tz) + self.radius_top*tz
        radius += bezier.PointAt(tz).Y*5
        return radius


    # flipped cos function
    def get_zigzag(self, angle: float, freq: int, amp: float, nz: int) -> float:

        if nz % 5 == 0:
            zigzag = amp * m.cos(angle * 300)
            #  print(zigzag)
            return zigzag
        else:
            flipped_zigzag = -(amp * m.cos(angle * 300))
            return flipped_zigzag


    def get_radius_wave(self, angle: float, tz: float, freq: int, amp: float) -> float:
        # rotate
        shift = tz*m.radians(270)
        angle += shift

        # # fade
        # amp = m.pow((tz), 2) * amp

        # radius = self.get_radius(angle, tz) + m.cos(angle*freq) * amp
        # return radius

        # # blend wave freq
        # freq1 = 2
        # freq2 = 4

        # _r1 = m.cos(angle*freq1)*amp
        # _r2 = m.cos(angle*freq2)*amp

        # radius = self.get_radius(angle, tz) + _r1*(1-tz) + _r2*(tz)
        # return radius

        # rotate in both direction
        shift = tz*m.radians(260)

        a1 = angle + shift
        a2 = angle - shift

        _r1 = self.get_radius(angle, tz) + m.cos(a1 * freq) * amp
        _r2 = self.get_radius(angle, tz) + m.cos(a2 * freq) * amp
        # radius = _r1*(1-tz) + _r2*tz
        radius = (_r1 + _r2) / 2
        # radius = max(_r1, _r2)
        # radius = min(_r1, _r2)

        return radius


    def get_layers(self, layer_height: float, res_u: int) -> list[list[rg.Point3d]]:

        layers_count = int(self.height // layer_height) + 1
        layers = []

        for nz, tz in enumerate(np.linspace(0, 1, layers_count)[1:]):
            layer = []
            for angle in np.linspace(0, m.tau, res_u)[:-1]:
                pt = self.get_point(angle, tz, nz)
                layer.append(pt)

            layers.append(layer)

        return layers


    @staticmethod
    def get_mesh(layers: list[list[rg.Point3d]], closed: bool) -> rg.Mesh:
        mesh = rg.Mesh()

        for layer in layers:
            for pt in layer:
                mesh.Vertices.Add(pt)

        # print(mesh.Vertices.Count)

        # numpy only
        idx = np.array(range(mesh.Vertices.Count))
        idx = idx.reshape(len(layers), len(layers[0]))

        if closed:
            faces = np.stack([
                idx[:-1],                             
                np.roll(idx[:-1], -1, axis=1),    
                np.roll(idx[1:], -1, axis=1),          
                idx[1:],                              
            ], axis=-1).reshape(-1, 4)

            print(faces)

        else:
            faces = np.lib.stride_tricks.sliding_window_view(
                idx, window_shape=(2, 2)
            ).reshape(-1, 4)

            print(faces)

        for face in faces:
            mesh.Faces.AddFace(
                *[int(f) for f in face] # '*' here for unpacking the list
            )

        mesh.Compact()
        mesh.RebuildNormals()
        return mesh

if __name__ == "__main__":
    axis = rg.LineCurve(
        rg.Point3d(0,0,0),
        rg.Point3d(0,0,100)
    )


    mycolumn = Column(axis, radius_base, radius_top)
    layers = mycolumn.get_layers(layer_height, res_u)

    mesh = Column.get_mesh(layers, closed=True)

    import ghpythonlib.treehelpers as tree
    layers = tree.list_to_tree(layers)
# ---------- end python_3_script_6 ----------

# ---- group: ② 新電池 (Python，取代 TACO)
# SHORT-0
data = Data(Tree({0}: [Point(1040.048509, 1349.291679, 1), Point(1043.549707, 1358.554695, 1), Point(1047.100916, 1367.798743, 1), Point(1050.600199, 1377.062567, 1), Point(1054.228227, 1386.276501, 1), Point(1057.387147, 1395.654701, 1)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], {1}: [Point(1004.455306, 1603.814151, 5), Point(1006.860015, 1594.979213, 5), Point(1007.775708, 1591.614944, 5), Point(1017.042407, 1590.751148, 5), Point(1026.309107, 1589.887352, 5), Point(1035.575807, 1589.023556, 5)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], {2}: [Point(1012.951897, 1484.693137, 5), Point(1012.542638, 1476.505628, 5), Point(1012.133379, 1468.318118, 5), Point(1012.586394, 1468.268223, 5), Point(1021.000095, 1467.341539, 5), Point(1029.413797, 1466.414855, 5)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], {3}: [Point(1017.153301, 1343.583086, 5), Point(1025.568816, 1342.55994, 5), Point(1033.984331, 1341.536793, 5), Point(1037.235067, 1350.097206, 5), Point(1040.485802, 1358.657619, 5), Point(1043.736538, 1367.218032, 5)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], {4}: [Point(955.6176886, 1238.700968, 5), Point(962.1525361, 1237.284688, 5), Point(968.6873837, 1235.868408, 5), Point(973.873302, 1243.214767, 5), Point(979.0592203, 1250.561126, 5), Point(984.2451386, 1257.907485, 5)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]))

# ---- group: input your COMPAS Data
data_2 = Data(spiral.layer)

# ---- group: input your RHINO Data
data_3 = Data(plane)

# ---- group: ② 新電池 (Python，取代 TACO)
# SHORT-10
data_4 = Data(Tree({0}: [Point(2565.530408, 1505.965362, 1), Point(2564.716708, 1496.061264, 1), Point(2563.904073, 1486.157078, 1), Point(2563.089761, 1476.253028, 1), Point(2562.24257, 1466.35176, 1), Point(2561.34161, 1456.45522, 1)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], {1}: [Point(2772.933286, 1223.337744, 5), Point(2769.233872, 1228.868066, 5), Point(2765.534458, 1234.398389, 5), Point(2764.172794, 1236.45244, 5), Point(2757.118246, 1231.77668, 5), Point(2750.063699, 1227.10092, 5)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], {2}: [Point(2574.250097, 1603.2273, 5), Point(2574.049702, 1593.863994, 5), Point(2573.849306, 1584.500689, 5), Point(2573.760167, 1581.180627, 5), Point(2573.747683, 1580.715636, 5), Point(2577.270146, 1581.337006, 5)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], {3}: [Point(2692.221215, 1327.395872, 5), Point(2687.262537, 1333.146834, 5), Point(2682.303859, 1338.897796, 5), Point(2677.345181, 1344.648758, 5), Point(2668.556484, 1340.747965, 5), Point(2659.767787, 1336.847171, 5)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], {4}: [Point(2581.643377, 1483.670586, 5), Point(2574.173823, 1481.616421, 5), Point(2566.70427, 1479.562257, 5), Point(2565.724033, 1470.264977, 5), Point(2564.743795, 1460.967697, 5), Point(2563.763558, 1451.670417, 5)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]))

# SHORT-2
data_5 = Data(Tree({0}: [Point(1352.317088, 1351.376042, 1), Point(1354.966548, 1360.946093, 1), Point(1356.787147, 1370.711912, 1), Point(1358.594168, 1380.481034, 1), Point(1360.408063, 1390.248918, 1), Point(1362.214365, 1400.018141, 1)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], {1}: [Point(1314.739684, 1612.530807, 5), Point(1316.535011, 1602.803809, 5), Point(1316.565988, 1602.615453, 5), Point(1316.713027, 1602.605022, 5), Point(1326.221508, 1601.930497, 5), Point(1335.729989, 1601.255973, 5)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], {2}: [Point(1312.110797, 1501.098091, 5), Point(1311.031275, 1493.242642, 5), Point(1309.951754, 1485.387192, 5), Point(1309.354857, 1481.347619, 5), Point(1312.019443, 1481.184242, 5), Point(1314.146428, 1481.053827, 5)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], {3}: [Point(1303.343939, 1376.100971, 5), Point(1302.048569, 1367.51949, 5), Point(1300.753198, 1358.938009, 5), Point(1302.122659, 1358.828241, 5), Point(1304.133873, 1358.667033, 5), Point(1313.392512, 1358.016609, 5)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], {4}: [Point(1292.906941, 1257.395362, 5), Point(1299.918751, 1256.417312, 5), Point(1306.93056, 1255.439262, 5), Point(1311.499561, 1264.104742, 5), Point(1316.068562, 1272.770222, 5), Point(1320.637563, 1281.435702, 5)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]))

# SHORT-11
data_6 = Data(Tree({0}: [Point(2726.233119, 1485.009256, 1), Point(2725.652336, 1475.036224, 1), Point(2725.074171, 1465.063039, 1), Point(2724.542441, 1455.087298, 1), Point(2724.114922, 1445.106594, 1), Point(2723.830398, 1435.1208, 1)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], {1}: [Point(2927.483213, 1247.379693, 5), Point(2922.147731, 1252.916733, 5), Point(2916.812249, 1258.453772, 5), Point(2911.476768, 1263.990812, 5), Point(2904.044127, 1258.939409, 5), Point(2896.611487, 1253.888006, 5)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], {2}: [Point(2802.570904, 1365.847094, 5), Point(2795.692907, 1371.985143, 5), Point(2788.814911, 1378.123193, 5), Point(2781.936914, 1384.261243, 5), Point(2773.01551, 1380.190276, 5), Point(2764.094105, 1376.119309, 5)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], {3}: [Point(2734.015763, 1660.897161, 5), Point(2734.139532, 1653.401451, 5), Point(2734.263301, 1645.90574, 5), Point(2734.292367, 1643.052825, 5), Point(2734.301429, 1642.163432, 5), Point(2737.91263, 1642.529608, 5)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], {4}: [Point(2748.05364, 1553.652618, 5), Point(2740.408567, 1552.030828, 5), Point(2732.763494, 1550.409038, 5), Point(2732.338067, 1541.339156, 5), Point(2731.912639, 1532.269273, 5), Point(2731.487212, 1523.199391, 5)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]))

# SHORT-1
data_7 = Data(Tree({0}: [Point(1193.466413, 1345.956397, 1), Point(1196.313477, 1355.421529, 1), Point(1198.963017, 1364.951913, 1), Point(1201.710643, 1374.45517, 1), Point(1204.39969, 1383.97522, 1), Point(1207.172883, 1393.471069, 1)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], {1}: [Point(1144.757497, 1663.222255, 5), Point(1146.757799, 1657.611507, 5), Point(1148.907517, 1651.581653, 5), Point(1157.548662, 1651.162872, 5), Point(1166.189806, 1650.74409, 5), Point(1174.830951, 1650.325309, 5)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], {2}: [Point(1164.719841, 1554.177165, 5), Point(1165.129107, 1546.915242, 5), Point(1165.538372, 1539.653319, 5), Point(1165.590459, 1538.088559, 5), Point(1168.063904, 1537.85037, 5), Point(1177.485212, 1536.943113, 5)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], {3}: [Point(1155.770768, 1430.547827, 5), Point(1154.93031, 1421.685128, 5), Point(1154.089851, 1412.822429, 5), Point(1156.399878, 1412.589634, 5), Point(1158.936079, 1412.334047, 5), Point(1168.568678, 1411.465922, 5)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], {4}: [Point(1151.533005, 1297.504436, 5), Point(1159.11848, 1296.5353, 5), Point(1166.703955, 1295.566164, 5), Point(1170.468796, 1303.509483, 5), Point(1174.233637, 1311.452802, 5), Point(1177.998478, 1319.396122, 5)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]))

# SHORT-3
data_8 = Data(Tree({0}: [Point(1515.821642, 1357.03527, 1), Point(1517.585723, 1366.589285, 1), Point(1518.429648, 1376.271147, 1), Point(1519.134424, 1385.965719, 1), Point(1519.880367, 1395.657357, 1), Point(1520.595471, 1405.351314, 1)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], {1}: [Point(1461.925007, 1666.147017, 5), Point(1463.682678, 1660.167217, 5), Point(1464.623516, 1656.966376, 5), Point(1473.43989, 1656.673068, 5), Point(1482.256264, 1656.379759, 5), Point(1491.072638, 1656.08645, 5)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], {2}: [Point(1471.751545, 1565.109129, 5), Point(1471.513313, 1557.638209, 5), Point(1471.275081, 1550.16729, 5), Point(1471.201423, 1548.608149, 5), Point(1473.083364, 1548.509587, 5), Point(1474.622609, 1548.431109, 5)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], {3}: [Point(1463.299418, 1439.339504, 5), Point(1463.907255, 1432.456269, 5), Point(1464.515092, 1425.573035, 5), Point(1464.964301, 1420.48613, 5), Point(1474.708945, 1420.207492, 5), Point(1484.453588, 1419.928854, 5)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], {4}: [Point(1457.217544, 1325.159134, 5), Point(1455.451891, 1317.299816, 5), Point(1453.686239, 1309.440499, 5), Point(1454.549862, 1309.397575, 5), Point(1456.970521, 1309.277265, 5), Point(1465.624259, 1308.939432, 5)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]))

# ---- group: NOZZLE WIDTH
number_slider_2 = Slider(3, range=0..100)

# ---- group: ② 新電池 (Python，取代 TACO)
# SHORT-9
data_9 = Data(Tree({0}: [Point(2407.955492, 1542.79519, 1), Point(2406.897073, 1532.919369, 1), Point(2405.872139, 1523.040009, 1), Point(2404.838137, 1513.161597, 1), Point(2403.803062, 1503.283299, 1), Point(2402.76646, 1493.405158, 1)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], {1}: [Point(2415.115987, 1663.666048, 5), Point(2415.598071, 1654.399797, 5), Point(2415.6685, 1652.579973, 5), Point(2415.684863, 1652.157181, 5), Point(2418.270334, 1652.348161, 5), Point(2426.822459, 1652.909326, 5)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], {2}: [Point(2555.184089, 1288.297592, 5), Point(2552.483497, 1292.978104, 5), Point(2549.608393, 1297.961069, 5), Point(2546.733289, 1302.944034, 5), Point(2545.490539, 1305.149893, 5), Point(2537.116417, 1301.491959, 5)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], {3}: [Point(2430.113894, 1577.553502, 5), Point(2422.024724, 1576.315815, 5), Point(2413.935555, 1575.078129, 5), Point(2413.149341, 1565.943339, 5), Point(2412.363127, 1556.808548, 5), Point(2411.576913, 1547.673758, 5)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], {4}: [Point(2471.389775, 1409.221259, 5), Point(2467.275808, 1414.525776, 5), Point(2461.616894, 1421.822334, 5), Point(2455.95798, 1429.118892, 5), Point(2447.897783, 1426.793204, 5), Point(2439.837586, 1424.467515, 5)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]))

# SHORT-8
data_10 = Data(Tree({0}: [Point(2360.879347, 1340.862187, 1), Point(2356.81553, 1349.734592, 1), Point(2352.013187, 1358.232274, 1), Point(2347.23981, 1366.747015, 1), Point(2342.488977, 1375.274484, 1), Point(2337.714884, 1383.788973, 1)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], {1}: [Point(2257.019022, 1617.421346, 5), Point(2256.935622, 1609.486421, 5), Point(2256.852221, 1601.551496, 5), Point(2256.804364, 1599.256539, 5), Point(2257.335228, 1599.312438, 5), Point(2259.374695, 1599.527191, 5)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], {2}: [Point(2264.693947, 1514.738026, 5), Point(2256.46579, 1513.343162, 5), Point(2248.237633, 1511.948298, 5), Point(2246.718002, 1502.569832, 5), Point(2245.198371, 1493.191366, 5), Point(2243.678739, 1483.812901, 5)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], {3}: [Point(2346.223696, 1361.565208, 5), Point(2343.250778, 1367.175223, 5), Point(2339.889761, 1373.517599, 5), Point(2336.528743, 1379.859975, 5), Point(2327.151929, 1377.228254, 5), Point(2317.775115, 1374.596532, 5)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], {4}: [Point(2390.538888, 1256.815628, 5), Point(2388.675742, 1263.179868, 5), Point(2386.896813, 1269.256434, 5), Point(2386.577053, 1270.369332, 5), Point(2385.169428, 1269.815503, 5), Point(2377.036021, 1266.550577, 5)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]))

# SHORT-4
data_11 = Data(Tree({0}: [Point(1681.633487, 1354.389788, 1), Point(1682.918372, 1364.095324, 1), Point(1683.265989, 1373.858903, 1), Point(1682.730312, 1383.634326, 1), Point(1682.349966, 1393.417736, 1), Point(1681.942037, 1403.200095, 1)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], {1}: [Point(1627.875423, 1619.32553, 5), Point(1628.88332, 1609.700941, 5), Point(1628.907683, 1609.416562, 5), Point(1632.214558, 1609.333608, 5), Point(1641.164902, 1609.109087, 5), Point(1650.115245, 1608.884565, 5)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], {2}: [Point(1618.76955, 1506.888496, 5), Point(1617.236979, 1498.405507, 5), Point(1615.704409, 1489.922519, 5), Point(1614.846224, 1485.193262, 5), Point(1620.07884, 1485.308457, 5), Point(1620.918761, 1485.310833, 5)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], {3}: [Point(1628.983345, 1374.787412, 5), Point(1629.656762, 1365.045677, 5), Point(1630.019203, 1359.802552, 5), Point(1632.114985, 1359.875715, 5), Point(1641.614513, 1360.184505, 5), Point(1651.11404, 1360.493296, 5)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], {4}: [Point(1619.349856, 1276.345767, 5), Point(1616.965133, 1266.966704, 5), Point(1616.403676, 1264.420315, 5), Point(1619.278099, 1264.431014, 5), Point(1619.737716, 1264.432724, 5), Point(1627.746067, 1264.525408, 5)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]))

# ----
py3 = Python3Script()  # -> out, layers, mesh
# ---------- py3: Python ----------
import Rhino.Geometry as rg
import numpy as np
import math as m

class Column:
    def __init__(self, axis: rg.Curve, radius_base: float, radius_top: float):
        self.axis = axis
        # reparameterize axis
        self.axis.Domain = rg.Interval(0,1)
        self.r_base = radius_base
        self.r_top = radius_top
        self.height = axis.PointAtEnd.Z - axis.PointAtStart.Z
        self.radius_bezier = self.gen_radius_bezier()

    def gen_radius_bezier(self) -> rg.BezierCurve:
        pts = [
            rg.Point2d(0, 0),
            rg.Point2d(0.6, 3),
            rg.Point2d(0.9, 5),
            rg.Point2d(1.0, 0.5)
        ]
        return rg.BezierCurve(pts)

    def get_radius(self, tz) -> float:
        # power
        # tz = m.pow(tz, 3)
        # return self.r_base*(1-tz) + self.r_top*(tz)

        # beizer curve
        bezier = self.radius_bezier.PointAt(tz)
        amp = 10
        return self.r_base*(1-tz) + self.r_top*(tz) + bezier.Y*amp

    def get_pattern(self, angle, tz) -> float:
        a = angle
        freq = 4
        amp = 5

        # shift angle
        shift = m.pow(tz, 2.5)
        shift *= m.pi
        
        # fade out amp
        fade = m.pow(tz,1)
        # amp *= fade
        # pattern = m.cos((a+shift)*freq)*amp

        # blend multiple freq
        freqs = [3, 8, 4]
        set_freqs = [m.cos((a+shift)*f)*(amp+3*(1-tz)) for f in freqs]
        t_sets = [t for t in np.linspace(0,1,len(freqs))]
        pattern = np.interp(tz, t_sets, set_freqs)
        
        # add reverse pattern
        set_freqs = [m.cos((a-shift)*f)*(amp+3*tz) for f in freqs]
        r_pattern = np.interp(tz, t_sets, set_freqs)

        # try different blend
        pattern = (pattern + r_pattern)*.5
        pattern = max(pattern, r_pattern)
        # pattern = min(pattern, r_pattern)
        # pattern = pattern*(1-tz) + r_pattern*tz

        return pattern

    def get_point(self, angle, tz) -> rg.Point3d:
        """
        Get point on the column at certain angle and height

        Args:
        angle: angle of the point in radians
        tz: normalize parameter of the height along the axis

        Returns:
        The list of polylinecurve for each layer
        """
        radius = self.get_radius(tz)
        radius += self.get_pattern(angle, tz)
        origin = self.axis.PointAt(tz)
        vector = rg.Vector3d(
            radius*m.cos(angle),
            radius*m.sin(angle),
            0
        )
        return origin+vector

    def print_paths(self, resolution: int, layer_height: float) -> list[int, list[rg.PolylineCurve]]:
        """
        Generate print path of the columns

        Args:
        resolution: division around the circumference
        layer_height: distance between vertical layers in mm.

        Returns:
        The list of polylinecurve for each layer
        """

        lh = int(self.height // layer_height)
        layers = []

        for tz in np.linspace(0, 1, lh+1, endpoint=True)[1:]:
            pts = []
            for angle in np.linspace(0, 2*np.pi, resolution+1, endpoint=True)[:-1]:
                pts.append(self.get_point(angle, tz))
            
            layers.append(
                rg.PolylineCurve(pts)
            )
        return lh, layers
    
    @ staticmethod
    def to_mesh(crvs: list[rg.PolylineCurve], closed: bool = True) -> rg.Mesh:
        mesh = rg.Mesh()
        for layer in crvs:
            for pt in layer.ToArray():
                mesh.Vertices.Add(pt)
        
        idx = np.array(range(mesh.Vertices.Count))
        idx = idx.reshape(len(crvs), layer.PointCount)

        if closed:
            faces = np.stack([
                idx[:-1],                             # Top-left
                np.roll(idx[:-1], -1, axis=1),        # Top-right
                idx[1:],                              # Bottom-left
                np.roll(idx[1:], -1, axis=1)          # Bottom-right
            ], axis=-1).reshape(-1, 4)
        else:
            faces = np.lib.stride_tricks.sliding_window_view(
                idx, window_shape=(2, 2)
            ).reshape(-1, 4)
        
        for f in faces:
            mesh.Faces.AddFace(
                int(f[0]),
                int(f[1]),
                int(f[3]),
                int(f[2])
            )

        mesh.Compact()
        mesh.RebuildNormals()
        return mesh

            


if __name__ == "__main__":
    axis = rg.LineCurve(
        rg.Point3d(0,0,0),
        rg.Point3d(10,10,300)
    )
    r1 = 10
    r2 = 10

    column = Column(axis, r1, r2)
    layer_count, layers = column.print_paths(150, 2)
    mesh = Column.to_mesh(layers, closed=True)
# ---------- end py3 ----------

# ---- group: ② 新電池 (Python，取代 TACO)
# SHORT-5
data_12 = Data(Tree({0}: [Point(1850.529955, 1349.876834, 1), Point(1850.428994, 1359.824924, 1), Point(1850.031243, 1369.762718, 1), Point(1848.71652, 1379.621114, 1), Point(1847.063718, 1389.431482, 1), Point(1845.473805, 1399.252306, 1)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], {1}: [Point(1779.676504, 1667.686928, 5), Point(1781.240527, 1660.812454, 5), Point(1781.502889, 1659.659273, 5), Point(1790.427239, 1659.616737, 5), Point(1799.351589, 1659.574202, 5), Point(1808.275939, 1659.531666, 5)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], {2}: [Point(1783.184452, 1568.716878, 5), Point(1782.528794, 1560.460012, 5), Point(1781.873135, 1552.203145, 5), Point(1781.680646, 1550.044569, 5), Point(1783.383098, 1550.084028, 5), Point(1784.175756, 1550.1024, 5)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], {3}: [Point(1830.501497, 1451.867445, 5), Point(1828.721806, 1458.831767, 5), Point(1826.942115, 1465.79609, 5), Point(1826.869226, 1466.106289, 5), Point(1825.844224, 1470.468446, 5), Point(1817.485448, 1470.005065, 5)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], {4}: [Point(1847.759225, 1331.250893, 5), Point(1847.915617, 1338.720599, 5), Point(1848.072008, 1346.190304, 5), Point(1848.088879, 1346.663952, 5), Point(1847.474895, 1346.601594, 5), Point(1845.870001, 1346.438273, 5)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]))

# SHORT-7
data_13 = Data(Tree({0}: [Point(2190.235093, 1346.406332, 1), Point(2187.544379, 1356.012389, 1), Point(2184.116269, 1365.371878, 1), Point(2180.170119, 1374.533928, 1), Point(2176.357931, 1383.752778, 1), Point(2172.494264, 1392.95018, 1)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], {1}: [Point(2097.17153, 1666.918196, 5), Point(2098.234712, 1658.888106, 5), Point(2098.326098, 1658.197882, 5), Point(2107.185779, 1658.456834, 5), Point(2116.04546, 1658.715785, 5), Point(2124.90514, 1658.974736, 5)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], {2}: [Point(2195.182139, 1318.621539, 5), Point(2193.120927, 1326.784146, 5), Point(2191.98213, 1331.293897, 5), Point(2191.665682, 1332.624558, 5), Point(2182.612409, 1330.347842, 5), Point(2173.559135, 1328.071126, 5)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], {3}: [Point(2095.679631, 1560.899457, 5), Point(2094.775671, 1551.73264, 5), Point(2093.871711, 1542.565823, 5), Point(2093.548886, 1539.529059, 5), Point(2093.998854, 1539.578213, 5), Point(2096.716273, 1539.875056, 5)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], {4}: [Point(2146.623543, 1440.283044, 5), Point(2142.736233, 1448.172731, 5), Point(2140.411927, 1452.890144, 5), Point(2138.127497, 1457.850382, 5), Point(2129.880642, 1456.508026, 5), Point(2121.633786, 1455.16567, 5)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]))

# SHORT-6
data_14 = Data(Tree({0}: [Point(2020.167152, 1350.334199, 1), Point(2018.753376, 1359.969425, 1), Point(2016.864064, 1369.519974, 1), Point(2014.262468, 1378.903244, 1), Point(2011.545542, 1388.254945, 1), Point(2008.858439, 1397.615325, 1)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], {1}: [Point(1941.927652, 1623.64717, 5), Point(1942.172372, 1616.77086, 5), Point(1942.417091, 1609.89455, 5), Point(1942.441268, 1608.759727, 5), Point(1943.872647, 1608.813113, 5), Point(1944.156279, 1608.823138, 5)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], {2}: [Point(1952.699872, 1531.98562, 5), Point(1943.838834, 1531.334729, 5), Point(1934.977797, 1530.683839, 5), Point(1933.419565, 1522.350181, 5), Point(1931.861334, 1514.016524, 5), Point(1930.303102, 1505.682866, 5)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], {3}: [Point(2008.830779, 1385.147048, 5), Point(2006.514168, 1394.131111, 5), Point(2005.461897, 1398.211927, 5), Point(2004.906525, 1400.471248, 5), Point(1995.151445, 1399.080518, 5), Point(1985.396364, 1397.689787, 5)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], {4}: [Point(2023.004858, 1277.938118, 5), Point(2023.172471, 1284.602756, 5), Point(2023.340084, 1291.267394, 5), Point(2023.35148, 1291.694364, 5), Point(2022.805609, 1291.589053, 5), Point(2022.209367, 1291.47096, 5)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]))

# ----
python_3_script_7 = Python3Script()  # -> out, layers
# ---------- python_3_script_7: Python ----------
import Rhino.Geometry as rg
import numpy as np
import math as m

class Column:
    def __init__(self, axis: rg.Curve, radius_base: float, radius_top: float):
        self.axis = axis
        # reparameterize axis
        self.axis.Domain = rg.Interval(0,1)
        self.radius_base = radius_base
        self.radius_top = radius_top
        self.height = axis.PointAtEnd.Z - axis.PointAtStart.Z

    def get_point(self, angle: float, tz: float) -> rg.Point3d:
        """
        Args:
            angle: angle in polar coord. in radians
            tz: parameter on axis
        """
        origin = self.axis.PointAt(tz)
        radius = self.get_radius_bezier(tz)

        pt = rg.Point3d(
            origin.X + m.cos(angle)*radius,
            origin.Y + m.sin(angle)*radius,
            origin.Z
        )

        return pt


    def get_radius(self, angle: float, tz: float) -> float:
        radius =  self.radius_base*(1-tz) + self.radius_top*tz
        return radius

    def get_radius_bezier(self, tz: float) ->float:
        bezier = rg.BezierCurve(
            [
                rg.Point2d(0, 0),
                rg.Point2d(0.25, 5),
                rg.Point2d(0.75, 3),
                rg.Point2d(1, 0)
            ]
        )

        radius = self.radius_base*(1-tz) + self.radius_top*tz
        radius += bezier.PointAt(tz).Y*5
        return radius

    def get_radius_wave(self, angle: float, tz: float, freq: int, amp: float) -> float:
        # #roatate
        # shift = tz*m.radians(60)
        # angle += shift

        # #fade
        # amp = m.pow(tz, 2)*amp

        
        # # radius = self.get_radius(angle, tz) + m.cos(angle*freq)*amp
        # # return radius

        # #blend wave freq
        # freq1 = 3
        # freq2 = 5

        # _r1 = m.cos(angle*freq1)*amp
        # _r2 = m.cos(angle*freq2)*amp

        # radius = self.get_radius(angle, tz) + _r1*(1-tz) + _r2*(tz)
        # return radius

        # rotate in both direction
        shift = tz*m.radians(100)

        _r1 = self.get_radius(angle, tz) + m.cos((angle+shift)*freq)*amp
        _r2 = self.get_radius(angle, tz) + m.cos((angle-shift)*freq)*amp

        # radius = _r1*(1-tz) + _r2*tz
        # radius = (_r1 + _r2)/2
        # radius = max(_r1, _r2) #둘중에 큰거 써라
        radius = min(_r1, _r2)

        return radius




    def get_layers(self, layer_height: float, res_u: int):

        layers_count = int(self.height // layer_height) + 1
        layers = []

        for tz in np.linspace(0, 1, layers_count)[1::]:
            layer = []

            for angle in np.linspace(0, m.tau, res_u )[::-1]:
                pt = self.get_point(angle, tz)
                layer.append(pt)

            layers.append(layer)

        return layers

    @staticmethod
    def get_mesh(layers:list[list[rg.Point3d]], closed: bool) -> rg.Mesh:
        mesh  = rg.Mesh()

        for layer in layers:
            for pt in layer:
                mesh.Vertices.Add(pt)

        idx = np.array(range(mesh.Vertices.Count))
        idx = idx.reshape(len(layers), len(layers[0]))

        if closed:
            print(np.roll(idx[:-1], -1, axis=1))
            faces = np.stack([
                idx[:-1],                             # Top-left
                np.roll(idx[:-1], -1, axis=1),        # Top-right
                idx[1:],                              # Bottom-left
                np.roll(idx[1:], -1, axis=1)          # Bottom-right
            ], axis=-1).reshape(-1, 4)
        else:
            faces = np.lib.stride_tricks.sliding_window_view(
                idx, window_shape=(2, 2)
            ).reshape(-1, 4)

            print(faces)

        for face in faces:
            print (face, [int(f)for f in face], *[int(f)for f in face])
            mesh.Faces.AddFace(
                *[int(f)for f in face]
            )

        mesh.Compact()
        mesh.RebuildNormals()

        return mesh
       


if __name__ == "__main__":
    
    axis = rg.LineCurve(
        rg.Point3d(0,0,0),
        rg.Point3d(0,0,70)
    )
    
    mycolumn = Column(axis, 15, 15)
    layers = mycolumn.get_layers(3,100)

    mesh = Column.get_mesh(layers, closed=True)


    import ghpythonlib.treehelpers as tree
    layers = tree.list_to_tree(layers)
# ---------- end python_3_script_7 ----------

# ---- group: insert tail point
number_slider_3 = Slider(15, range=0..20)
list_item = ListItem(List=flatten(data_3), Index=0, Wrap=True)
vector_xyz = VectorXYZ(XComponent=number_slider_3, YComponent=number_slider_3, ZComponent=expr("0", 0))  # -> Vector, Length
move = Move(Geometry=list_item, Motion=vector_xyz.Vector)  # -> Geometry, Transform
point = Point(move.Geometry)
insert_items = InsertItems(List=flatten(data_3), Item=point, Indices="0", Wrap=True)  # -> simplify(List)
polyline = PolyLine(Vertices=insert_items, Closed=False)

# ----
pt = ConstructPoint(XCoordinate=Slider(0.5, range=0..1), YCoordinate=Slider(0.5, range=0..1), ZCoordinate=0)

# ---- group: ② 新電池 (Python，取代 TACO) / 物件旋轉
number_slider_4 = Slider(75, range=0..360)

# ----
mesh_overhang = MeshOverhang(Mesh=py3.mesh, Interval=Domain(0, 1.5), paletteI=0, useSmooth=True, useVertex=True)  # -> Mesh, OverhangDistribution
preview = CustomPreview(
    Geometry=py3.mesh,
    Material={diffuse=RGB(221, 160, 221), emission=RGB(66, 48, 66), shine=0.5, specular=RGB(255, 255, 255), transparency=0})
face_boundaries = FaceBoundaries(Mesh=py3.mesh)
curve = Curve(py3.layers)
polyline_2 = PolyLine(Vertices=python_3_script_7.layers, Closed=False)  # -> flatten(Polyline)

# ---- group: ② 新電池 (Python，取代 TACO)
# LONG-0
data_15 = Data(Tree({0}: [Point(1064.968023, 69.61536877, -22.0951418), Point(1060.495361, 78.54753958, -22.0951418), Point(1056.406994, 87.66219445, -22.0951418), Point(1052.673556, 96.92799022, -22.0951418), Point(1049.277483, 106.3227529, -22.0951418), Point(1046.200776, 115.826976, -22.0951418)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], {1}: [Point(1000.048941, 967.2913899, -19.6), Point(1006.72697, 961.6741647, -19.6), Point(1013.404999, 956.0569396, -19.6), Point(1021.834842, 956.8478651, -19.6), Point(1030.264684, 957.6387906, -19.6), Point(1038.694527, 958.4297162, -19.6)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], {2}: [Point(1008.363232, 821.5514862, -19.6), Point(1015.314991, 816.3311464, -19.6), Point(1022.266749, 811.1108067, -19.6), Point(1030.682302, 812.7739567, -19.6), Point(1039.097855, 814.4371068, -19.6), Point(1047.513408, 816.1002568, -19.6)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], {3}: [Point(1017.697416, 675.8015717, -19.6), Point(1025.115927, 671.0735097, -19.6), Point(1032.534438, 666.3454477, -19.6), Point(1041.093693, 668.8661543, -19.6), Point(1049.652949, 671.3868608, -19.6), Point(1058.212204, 673.9075674, -19.6)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], {4}: [Point(1027.273132, 529.8887789, -19.6), Point(1035.274657, 525.7660413, -19.6), Point(1043.276183, 521.6433036, -19.6), Point(1052.310251, 525.0551804, -19.6), Point(1061.344319, 528.4670571, -19.6), Point(1070.378387, 531.8789339, -19.6)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], {5}: [Point(1036.256513, 383.8144017, -19.6), Point(1045.069163, 380.4312345, -19.6), Point(1053.881813, 377.0480672, -19.6), Point(1061.269974, 380.308958, -19.6), Point(1068.658135, 383.5698487, -19.6), Point(1076.046296, 386.8307395, -19.6)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]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))
# test 3
data_16 = Data(Tree({0}: [Point(1024.07389, 301.1756035, -22.0951418), Point(1032.815384, 303.061238, -22.0951418), Point(1041.556877, 304.9468724, -22.0951418), Point(1050.298371, 306.8325068, -22.0951418), Point(1059.039865, 308.7181412, -22.0951418), Point(1067.781359, 310.6037757, -22.0951418)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], {1}: [Point(1004.880058, 680.4668244, -17.15), Point(1005.421219, 672.564773, -17.15), Point(1005.962379, 664.6627216, -17.15), Point(1006.052061, 663.4203733, -17.15), Point(1006.459799, 657.7720464, -17.15), Point(1013.566287, 659.8412513, -17.15)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], {2}: [Point(1014.0881, 533.8447621, -17.15), Point(1014.617446, 525.5468204, -17.15), Point(1015.146793, 517.2488787, -17.15), Point(1015.161346, 517.0116765, -17.15), Point(1015.572855, 510.304592, -17.15), Point(1023.18775, 513.1447919, -17.15)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], {3}: [Point(1022.186681, 387.3341627, -17.15), Point(1022.646024, 378.7825623, -17.15), Point(1023.105366, 370.2309618, -17.15), Point(1023.134076, 369.6964779, -17.15), Point(1023.447343, 362.7650587, -17.15), Point(1031.799748, 366.3952496, -17.15)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]))

# test 2
data_17 = Data(Tree({0}: [Point(1024.07389, 301.1756035, -22.5951418), Point(1032.815384, 303.061238, -22.5951418), Point(1041.556877, 304.9468724, -22.5951418), Point(1050.298371, 306.8325068, -22.5951418), Point(1059.039865, 308.7181412, -22.5951418), Point(1067.781359, 310.6037757, -22.5951418)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], {1}: [Point(1005.433839, 680.2826305, -17.15), Point(1005.987211, 672.2206795, -17.15), Point(1006.540582, 664.1587285, -17.15), Point(1006.626698, 662.9657665, -17.15), Point(1007.049301, 657.1114652, -17.15), Point(1014.007407, 659.2053215, -17.15)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], {2}: [Point(1014.679149, 533.587763, -17.15), Point(1015.221919, 525.1367642, -17.15), Point(1015.76469, 516.6857654, -17.15), Point(1015.774822, 516.5220502, -17.15), Point(1016.204222, 509.5839288, -17.15), Point(1023.658066, 512.4639194, -17.15)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], {3}: [Point(1022.8319, 387.0299414, -17.15), Point(1023.30415, 378.3585165, -17.15), Point(1023.7764, 369.6870916, -17.15), Point(1023.810101, 369.0682738, -17.15), Point(1024.138273, 361.9798626, -17.15), Point(1032.312689, 365.6662676, -17.15)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]))

# test
data_18 = Data(Tree({0}: [Point(1024.07389, 301.1756035, -22.5951418), Point(1032.815384, 303.061238, -22.5951418), Point(1041.556877, 304.9468724, -22.5951418), Point(1050.298371, 306.8325068, -22.5951418), Point(1059.039865, 308.7181412, -22.5951418), Point(1067.781359, 310.6037757, -22.5951418)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], {1}: [Point(1020.84521, 714.277795, -17.15), Point(1012.795176, 711.9985339, -17.15), Point(1004.745141, 709.7192728, -17.15), Point(1005.379202, 700.5161657, -17.15), Point(1006.013263, 691.3130586, -17.15), Point(1006.647324, 682.1099515, -17.15)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], {2}: [Point(1016.118485, 533.3130938, -17.15), Point(1016.675049, 524.7424216, -17.15), Point(1017.23204, 516.1649455, -17.15), Point(1017.687287, 508.9125695, -17.15), Point(1024.744264, 511.8148649, -17.15), Point(1033.69015, 515.5414393, -17.15)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], {3}: [Point(1024.404995, 386.7056417, -17.15), Point(1024.890677, 377.9839369, -17.15), Point(1025.376358, 369.2622321, -17.15), Point(1025.41946, 368.4882226, -17.15), Point(1025.768039, 361.2431799, -17.15), Point(1033.504892, 364.9672551, -17.15)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]))

# ----
loft = Loft(
    Curves=flatten(polyline_2),
    Options={Adjust=False, Closed=False, LoftEnds=0, LoftSimp=0, LoftType=0, Rebuild=10, Refit=0.01})
panel_5 = Panel(polyline_2)
mesh = Mesh(mesh_overhang.Mesh)
preview_2 = CustomPreview(
    Geometry=loft,
    Material={diffuse=RGB(221, 160, 221), emission=RGB(66, 48, 66), shine=0.5, specular=RGB(255, 255, 255), transparency=0})

# ---- group: ② 新電池 (Python，取代 TACO)
# LONG-0
data_19 = Data(Tree({0}: [Point(1064.968023, 69.61536877, -22.0951418), Point(1060.495361, 78.54753958, -22.0951418), Point(1056.406994, 87.66219445, -22.0951418), Point(1052.673556, 96.92799022, -22.0951418), Point(1049.277483, 106.3227529, -22.0951418), Point(1046.200776, 115.826976, -22.0951418)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], {1}: [Point(986.7737388, 973.5282024, -17.15), Point(987.2175103, 966.5098464, -17.15), Point(987.6612818, 959.4914903, -17.15), Point(987.9667147, 955.4815457, -17.15), Point(988.1719646, 952.7868748, -17.15), Point(994.8720503, 953.3730342, -17.15)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], {2}: [Point(995.5294879, 827.0241763, -17.15), Point(996.0316733, 819.5109379, -17.15), Point(996.5338587, 811.9976995, -17.15), Point(996.7225869, 809.528357, -17.15), Point(997.0513303, 805.2270382, -17.15), Point(1003.828128, 806.5380067, -17.15)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], {3}: [Point(1004.880058, 680.4668244, -17.15), Point(1005.421219, 672.564773, -17.15), Point(1005.962379, 664.6627216, -17.15), Point(1006.052061, 663.4203733, -17.15), Point(1006.459799, 657.7720464, -17.15), Point(1013.566287, 659.8412513, -17.15)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], {4}: [Point(1014.0881, 533.8447621, -17.15), Point(1014.617446, 525.5468204, -17.15), Point(1015.146793, 517.2488787, -17.15), Point(1015.161346, 517.0116765, -17.15), Point(1015.572855, 510.304592, -17.15), Point(1023.18775, 513.1447919, -17.15)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], {5}: [Point(1022.186681, 387.3341627, -17.15), Point(1022.646024, 378.7825623, -17.15), Point(1023.105366, 370.2309618, -17.15), Point(1023.134076, 369.6964779, -17.15), Point(1023.447343, 362.7650587, -17.15), Point(1031.799748, 366.3952496, -17.15)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]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))

# LONG-3
data_20 = Data(Tree({0}: [Point(1798.951465, 387.9570392, -22.0951418), Point(1803.759189, 384.5322054, -22.0951418), Point(1808.740787, 381.1251335, -22.0951418), Point(1813.767008, 377.7842346, -22.0951418), Point(1808.862273, 381.1217219, -22.0951418), Point(1803.977604, 384.4885078, -22.0951418)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], {1}: [Point(1352.699377, 1050.962961, -17.15), Point(1354.729385, 1045.543699, -17.15), Point(1357.418838, 1038.363998, -17.15), Point(1365.522166, 1038.859799, -17.15), Point(1373.625494, 1039.355599, -17.15), Point(1381.728823, 1039.8514, -17.15)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], {2}: [Point(1434.483309, 953.4343536, -17.15), Point(1432.526673, 959.0792715, -17.15), Point(1429.935391, 966.5551517, -17.15), Point(1420.705102, 965.3937352, -17.15), Point(1411.474813, 964.2323187, -17.15), Point(1402.244524, 963.0709022, -17.15)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], {3}: [Point(1476.295692, 841.7445744, -17.15), Point(1474.325244, 846.3401796, -17.15), Point(1472.113757, 851.4979504, -17.15), Point(1469.902271, 856.6557211, -17.15), Point(1461.9903, 854.5384587, -17.15), Point(1454.078329, 852.4211963, -17.15)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], {4}: [Point(1498.998064, 712.3620363, -17.15), Point(1502.927951, 705.432818, -17.15), Point(1506.857839, 698.5035998, -17.15), Point(1510.543404, 700.3545577, -17.15), Point(1517.58172, 704.1044417, -17.15), Point(1524.620036, 707.8543257, -17.15)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], {5}: [Point(1562.578909, 608.7769111, -17.15), Point(1566.32522, 603.3581833, -17.15), Point(1570.071531, 597.9394555, -17.15), Point(1573.075488, 593.8289487, -17.15), Point(1576.676951, 596.5346906, -17.15), Point(1583.206369, 601.6387074, -17.15)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]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))

# LONG-2
data_21 = Data(Tree({0}: [Point(1525.058685, 381.0297419, -22.0951418), Point(1530.122925, 372.5492878, -22.0951418), Point(1535.290958, 364.1316983, -22.0951418), Point(1540.572333, 355.7847712, -22.0951418), Point(1545.976507, 347.516839, -22.0951418), Point(1551.512696, 339.3367378, -22.0951418)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], {1}: [Point(1296.251449, 1003.940527, -17.15), Point(1294.210367, 1011.838396, -17.15), Point(1292.962795, 1016.665816, -17.15), Point(1284.161923, 1016.019412, -17.15), Point(1275.36105, 1015.373008, -17.15), Point(1266.560178, 1014.726604, -17.15)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], {2}: [Point(1329.125231, 880.7157732, -17.15), Point(1326.966995, 888.0759533, -17.15), Point(1324.821032, 895.3942788, -17.15), Point(1316.866363, 893.8859979, -17.15), Point(1308.911694, 892.3777171, -17.15), Point(1300.957025, 890.8694362, -17.15)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], {3}: [Point(1328.187269, 736.6511855, -17.15), Point(1330.363629, 730.9424718, -17.15), Point(1332.998185, 724.0318828, -17.15), Point(1335.030642, 719.0309337, -17.15), Point(1339.816537, 720.8141412, -17.15), Point(1349.101926, 724.4238466, -17.15)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], {4}: [Point(1376.752208, 615.8331521, -17.15), Point(1378.910694, 610.9292791, -17.15), Point(1380.927799, 606.3466097, -17.15), Point(1382.944904, 601.7639403, -17.15), Point(1385.262192, 596.7037248, -17.15), Point(1390.047317, 599.3362337, -17.15)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], {5}: [Point(1433.48345, 492.8325957, -17.15), Point(1436.130186, 487.5197632, -17.15), Point(1438.776922, 482.2069306, -17.15), Point(1441.374392, 477.0645836, -17.15), Point(1446.500192, 480.7767282, -17.15), Point(1453.540525, 485.9724377, -17.15)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]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))

# LONG-1
data_22 = Data(Tree({0}: [Point(1346.635911, 203.4134388, -22.0951418), Point(1351.413501, 194.9031848, -22.0951418), Point(1356.473718, 186.5579859, -22.0951418), Point(1361.837475, 178.4046915, -22.0951418), Point(1367.526916, 170.475388, -22.0951418), Point(1373.563674, 162.8073735, -22.0951418)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], {1}: [Point(1107.765638, 1043.790602, -17.15), Point(1109.436883, 1034.309581, -17.15), Point(1110.198054, 1029.991437, -17.15), Point(1119.190449, 1030.451809, -17.15), Point(1128.182845, 1030.912181, -17.15), Point(1137.17524, 1031.372553, -17.15)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], {2}: [Point(1131.192955, 907.3585386, -17.15), Point(1132.988592, 897.7232721, -17.15), Point(1133.009444, 897.6113834, -17.15), Point(1134.200421, 891.7926063, -17.15), Point(1140.267688, 892.6944265, -17.15), Point(1149.232789, 894.1229542, -17.15)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], {3}: [Point(1156.971942, 771.514033, -17.15), Point(1158.882676, 762.3496107, -17.15), Point(1159.404171, 759.8483726, -17.15), Point(1160.719824, 753.9343549, -17.15), Point(1166.697226, 755.578116, -17.15), Point(1175.276211, 757.987671, -17.15)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], {4}: [Point(1185.975389, 636.1345902, -17.15), Point(1187.973766, 627.5184491, -17.15), Point(1189.042847, 622.9090346, -17.15), Point(1190.491201, 616.860613, -17.15), Point(1196.652954, 619.3423157, -17.15), Point(1205.117518, 622.7856749, -17.15)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], {5}: [Point(1217.648507, 501.1241033, -17.15), Point(1219.692042, 492.94468, -17.15), Point(1221.30088, 486.505168, -17.15), Point(1222.83383, 480.378081, -17.15), Point(1229.399436, 483.7803605, -17.15), Point(1238.136911, 488.3603974, -17.15)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]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))

# ----
radius_top_mm = Slider(25, range=5..200)
bulge_mm = Slider(5, range=-50..50)
wave_amp_mm_2 = Slider(4, range=0..20)
twist_deg = Slider(45, range=-360..360)
wave_freq_2 = Slider(6, range=0..12)
height_mm_3 = Slider(50, range=1..500)
radius_mm_3 = Slider(20, range=5..200)

point_spacing_mm_3 = Slider(5, range=1..50)
layer_height_mm_4 = Slider(1, range=0.5..10)

point_spacing_mm_4 = Slider(3, range=1..50)
layer_height_mm_5 = Slider(1, range=0.5..10)

fine_adjust_z_mm_3 = Slider(1, range=-5..5)
center_y_mm_3 = Slider(100, range=-500..500)
center_x_mm_3 = Slider(100, range=-500..500)

fine_adjust_z_mm_4 = Slider(1, range=-5..5)
center_x_mm_4 = Slider(100, range=-500..500)
center_y_mm_4 = Slider(100, range=-500..500)

# ----
# classic slicing
brep = Brep(<brep referenced from the Rhino model>)
slice_brep = SliceBrep(brep=brep, layer_height=layer_height_mm_4, point_spacing=point_spacing_mm_3, fine_adjust_z=fine_adjust_z_mm_3)  # -> layers; inputs brep: Brep
# ---------- slice_brep: Python ----------
# r: compas
# venv: mas-2627
"""
Slice a brep into layers, in work object coordinates (Rhino world XY = work object).
One closed compas Polyline per layer, same as slice cylinder. Units: mm.
The bottom of the brep is placed on the bed: first layer at z = 0, plus fine_adjust_z.
"""
import Rhino
import Rhino.Geometry as rg
from Rhino.Geometry.Intersect import Intersection
from compas.geometry import Point
from compas.geometry import Polyline

tolerance = Rhino.RhinoDoc.ActiveDoc.ModelAbsoluteTolerance
box = brep.GetBoundingBox(True)
layer_count = int((box.Max.Z - box.Min.Z) / layer_height)

layers = []
for i in range(layer_count):
    # ===== Cut the brep in the middle of the layer, keep the longest curve =====
    z_cut = box.Min.Z + (i + 0.5) * layer_height
    ok, curves, points = Intersection.BrepPlane(brep, rg.Plane(rg.Point3d(0, 0, z_cut), rg.Vector3d.ZAxis), tolerance)
    curves = rg.Curve.JoinCurves(curves)
    if not curves:
        continue
    contour = max(curves, key=lambda curve: curve.GetLength())

    # ===== Same direction and same seam (on the +x side) on every layer =====
    if contour.ClosedCurveOrientation(rg.Plane.WorldXY) == rg.CurveOrientation.Clockwise:
        contour.Reverse()
    ok, t = contour.ClosestPoint(rg.Point3d(box.Max.X + 1000, box.Center.Y, z_cut))
    contour.ChangeClosedCurveSeam(t)

    # ===== Points every point_spacing, closed: back to the start =====
    count = round(contour.GetLength() / point_spacing)
    z = i * layer_height + fine_adjust_z
    points = [Point(p.X, p.Y, z) for p in (contour.PointAt(t) for t in contour.DivideByCount(count, True))]
    layers.append(Polyline(points + [points[0]]))
# ---------- end slice_brep ----------

panel_6 = Panel(insert_items)

# ----
# design: tor alva style
interpolated_column = InterpolatedColumn(
    radius=radius_mm_3,
    radius_top=radius_top_mm,
    height=height_mm_3,
    bulge=bulge_mm,
    wave_amp=wave_amp_mm_2,
    wave_freq=wave_freq_2,
    twist=twist_deg,
    layer_height=layer_height_mm_5,
    point_spacing=point_spacing_mm_4,
    center_x=center_x_mm_4,
    center_y=center_y_mm_4,
    fine_adjust_z=fine_adjust_z_mm_4)  # -> layers
# ---------- interpolated_column: Python ----------
# r: compas
# venv: mas-2627
import math

from compas.geometry import Point
from compas.geometry import Polyline


def get_radius(angle, t):
    # base radius to top radius, plus a bulge in the middle, plus a wave that twists up the column
    r = radius * (1 - t) + radius_top * t
    r += bulge * math.sin(math.pi * t)
    r += wave_amp * math.cos(wave_freq * (angle + math.radians(twist) * t))
    return r


# ===== How many layers, how many points per layer =====
layer_count = int(height / layer_height)
points_per_layer = round(2 * math.pi * radius / point_spacing)

# ===== One closed polyline per layer =====
layers = []
for i in range(layer_count):
    z = i * layer_height + fine_adjust_z
    t = i * layer_height / height  # 0 at the bottom, close to 1 at the top
    points = []
    for j in range(points_per_layer + 1):  # one extra point: back to the start to close the ring
        angle = 2 * math.pi * (j % points_per_layer) / points_per_layer
        r = get_radius(angle, t)
        points.append(Point(center_x + r * math.cos(angle), center_y + r * math.sin(angle), z))
    layers.append(Polyline(points))
# ---------- end interpolated_column ----------

panel_7 = Panel(polyline)

# ---- group: TO CONVERT RHINO CURVES TO COMPAS GEOM
python_3_script_8 = Python3Script(layers=polyline)  # -> out, cg; inputs layers: list
# ---------- python_3_script_8: Python ----------
from compas_rhino.conversions import curve_to_compas_polyline

# cg = [curve_to_compas_polyline(layer) for layer in layers]
cg = []
for layer in layers:
    p = curve_to_compas_polyline(layer)
    cg.append(p)
# ---------- end python_3_script_8 ----------

# ----
split = SplitList(List=data_14, Index=Slider(250, range=0..1000))  # -> ListA, ListB
pln = Plane(data_14)
xy = XYPlane(Origin=pln)

# ---- group: PRINTPATH
# generate printpath: printpoints and path
safety_distance_mm_2 = Slider(100, range=10..300)
blend_radius_mm_2 = Slider(0.5, range=0..5)
speed_mm_s = Slider(10, range=1..50)
printpath_2 = Printpath(layers=interpolated_column, speed=speed_mm_s, blend_radius=blend_radius_mm_2, safety_distance=safety_distance_mm_2)  # -> printpath, summary; inputs layers: list
# ---------- printpath_2: Python ----------
# r: compas
# venv: mas-2627
"""
Turn the layers into printpoints and a PrintPath, in work object coordinates.
Safety points are added here, before any transform to the robot base.
"""
import os
import sys

from compas.geometry import Frame, Vector


# Find source folder
gh_dir = os.path.dirname(ghenv.Component.OnPingDocument().FilePath)
src_dir = os.path.join(gh_dir, "..", "..", "src")
if src_dir not in sys.path:
    sys.path.append(src_dir)
from print_class import PrintPoint, PrintPath

# ===== One printpoint per point =====
# world XY orientation for every point: a tangent frame would turn the wrist 360 degrees each layer
printpoints = []
for layer_index, layer in enumerate(layers):
    for point in layer.points:
        frame = Frame(point, -Vector.Xaxis(), Vector.Yaxis())
        printpoints.append(PrintPoint(frame, layer_index, speed, blend_radius, True))

# ===== Path with a travel point above the start and the end =====
printpath = PrintPath(printpoints)

printpath.printpoints[0].speed *= 2
printpath.add_safety_before(safety_distance, speed*2)
printpath.add_safety_after(safety_distance, speed*2)

summary = f"{len(printpoints)} printpoints in {len(layers)} layers, plus 2 safety points"
# ---------- end printpath_2 ----------
panel_8 = Panel(printpath_2.summary)

# ---- group: ⑨ robot speed：geometry 接 COMPAS 或 Rhino data（每層 polyline 或一整條）→ robot_speed → printpath.robot_speed（厚的慢、薄的快）
min_speed_mm_s_thick = Slider(8, range=1..30)
max_speed_mm_s_thin = Slider(12, range=1..30)
layer_height_mm_6 = Slider(1.5, range=0.5..10)

# ---- group: ⑧ 轉 TCP：工具頭繞噴嘴轉，讓鐵片避開已印部分（-45° = 0 碰撞）
tcp_rotate_deg = Slider(-20, range=-180..180)
rotate_tcp = RotatePlane(Plane=plane, Angle=degrees(tcp_rotate_deg))

# ---- group: ⑨ robot speed：geometry 接 COMPAS 或 Rhino data（每層 polyline 或一整條）→ robot_speed → printpath.robot_speed（厚的慢、薄的快）
robot_speed = Python3Script(
    geometry=flatten(python_3_script_8.cg),
    min_speed=min_speed_mm_s_thick,
    max_speed=max_speed_mm_s_thin,
    first_layer=layer_height_mm_6)  # -> robot_speed, thickness, info; inputs geometry: list, min_speed: Double, max_speed: Double, first_layer: Double
# ---------- robot_speed: Python ----------
#! python3
"""Robot speed from layer thickness: thick bead -> slow, thin bead -> fast.

Inputs
    geometry     : the print path as COMPAS data (Polyline / list of Points) or Rhino data
                   (Polyline curves, Polylines, Points). One curve per layer, or one joined curve.
                   The order of the points must be the print order (same as the printpoints).
    min_speed    : speed of the thickest bead (mm/s)
    max_speed    : speed of the thinnest bead (mm/s)
    first_layer  : thickness of the first layer, above the bed (mm)
Outputs
    robot_speed  : one speed per point (mm/s) -> printpath.robot_speed
    thickness    : layer thickness at every point (mm)
    info         : point count, thickness range, speed range

Layer thickness of a point = shortest distance to the path printed before it, leaving out the
part of the path just behind the point (EXCLUDE mm along the path), so the bead it lies on is
found and not the bead it is printing. Points of the first layer: height above the bed.
"""
import math

import Rhino.Geometry as rg
import rhinoscriptsyntax as rs
import System

EXCLUDE = 15.0   # mm along the path behind the point that is still the same bead
CELL = 5.0       # grid size for the search (mm)
MIN_T = 0.2      # closer than this = the same point printed twice (e.g. a closed layer), not a bead below


def to_xyz(p):
    if hasattr(p, "X"):
        return (float(p.X), float(p.Y), float(p.Z))
    if hasattr(p, "x"):
        return (float(p.x), float(p.y), float(p.z))
    return (float(p[0]), float(p[1]), float(p[2]))


def points_of(item):
    """Points of one geometry item, COMPAS or Rhino."""
    if item is None:
        return []
    if isinstance(item, System.Guid):              # Rhino data without a type hint arrives as an id
        item = rs.coercegeometry(item)
        if item is None:
            return []
    if hasattr(item, "points") and not isinstance(item, rg.GeometryBase):     # COMPAS Polyline
        return [to_xyz(p) for p in item.points]
    if isinstance(item, rg.Curve):
        ok, pl = item.TryGetPolyline()
        if ok:
            return [to_xyz(p) for p in pl]
        ts = item.DivideByLength(1.0, True)
        return [to_xyz(item.PointAt(t)) for t in ts] if ts else []
    if isinstance(item, rg.Polyline):
        return [to_xyz(p) for p in item]
    if isinstance(item, (rg.Point3d, rg.Point)) or hasattr(item, "x") or hasattr(item, "X"):
        return [to_xyz(item.Location if isinstance(item, rg.Point) else item)]
    return []


def seg_dist(p, a, b):
    ab = [b[i] - a[i] for i in range(3)]
    ap = [p[i] - a[i] for i in range(3)]
    L2 = sum(v * v for v in ab)
    t = 0.0 if L2 == 0 else max(0.0, min(1.0, sum(ab[i] * ap[i] for i in range(3)) / L2))
    return math.sqrt(sum((ap[i] - ab[i] * t) ** 2 for i in range(3)))


def cell(p):
    return (int(math.floor(p[0] / CELL)), int(math.floor(p[1] / CELL)), int(math.floor(p[2] / CELL)))


pts = []
for g in (geometry or []):
    pts += points_of(g)

robot_speed, thickness = [], []
info = "no geometry (got: {})".format(sorted({type(g).__name__ for g in (geometry or [])}))
if pts:
    lo_v = float(min_speed) if min_speed is not None else 8.0
    hi_v = float(max_speed) if max_speed is not None else 12.0
    first = float(first_layer) if first_layer is not None else 1.5
    z_bed = min(p[2] for p in pts) - first
    # arc length along the path
    s = [0.0]
    for k in range(1, len(pts)):
        s.append(s[-1] + math.dist(pts[k - 1], pts[k]))
    grid = {}                     # cell -> segment indices (segment k = pts[k-1] -> pts[k])
    for k in range(len(pts)):
        p = pts[k]
        best = p[2] - z_bed       # first layer: height above the bed
        cx, cy, cz = cell(p)
        for dx in range(-1, 2):
            for dy in range(-1, 2):
                for dz in range(-1, 1):          # the bead below is at the same height or lower
                    for j in grid.get((cx + dx, cy + dy, cz + dz), ()):
                        if s[k] - s[j] < EXCLUDE:
                            continue
                        d = seg_dist(p, pts[j - 1], pts[j])
                        if MIN_T <= d < best:
                            best = d
        thickness.append(best)
        if k >= 1:                # add segment k to every cell it passes
            a, b = pts[k - 1], pts[k]
            n = max(1, int(math.dist(a, b) / CELL) + 1)
            for c in {cell(tuple(a[i] + (b[i] - a[i]) * t / n for i in range(3))) for t in range(n + 1)}:
                grid.setdefault(c, []).append(k)
    t_lo, t_hi = min(thickness), max(thickness)
    for t in thickness:
        f = 0.0 if t_hi - t_lo < 1e-9 else (t - t_lo) / (t_hi - t_lo)
        robot_speed.append(hi_v + (lo_v - hi_v) * f)       # thick -> slow
    info = ("{} points\nthickness {:.2f} - {:.2f} mm\nspeed {:.1f} - {:.1f} mm/s (thick -> slow)").format(
        len(pts), t_lo, t_hi, min(robot_speed), max(robot_speed))
# ---------- end robot_speed ----------
robot_speed_info = Panel(robot_speed.info)

# ----
pline = PolyLine(Vertices=data_14, Closed=False)
bbox = BoundingBox(Content=pline, Plane=PlaneXY(0, 0, 0), UnionBox=False)  # -> Box, Box_2
debrep = DeconstructBrep(Brep=bbox.Box)  # -> Faces, Edges, Vertices
item_4 = ListItem(List=debrep.Faces, Index="4", Wrap="4")
area = Area(Geometry=item_4)  # -> Area, Centroid
xy_2 = XYPlane(Origin=area.Centroid)
rotate = Rotate(Geometry=xy_2, Angle=degrees(Slider(0, range=0..180)), Plane=xy_2)  # -> Geometry, Transform
pln_2 = Plane(rotate.Geometry)
item_5 = ListItem(List=flatten(pln_2), Index=0, Wrap=True)

# ---- group: FILL BOTTOM
line_width_mm = Slider(2.5, range=0.5..10)
fill_point_spacing_mm = Slider(4, range=1..10)
skip_start = Slider(1, range=0..5)
fill_bottom = Python3Script(layers=python_3_script_8.cg, line_width=line_width_mm, point_spacing=fill_point_spacing_mm, skip_start=skip_start)  # -> layers_filled, summary; inputs layers: list
# ---------- fill_bottom: Python ----------
# r: compas
# venv: mas-2627
"""
Fill the bottom: a spiral from the center outward, printed before the first wall.
The spiral ends at the angle where the wall starts, so the path stays one continuous line
(extruder stays on, no travel move).
layers: the compas polylines that go into printpath (here one long polyline).
line_width: distance between two spiral turns, and between the spiral and the inner side of the wall, mm.
point_spacing: distance between two spiral points, mm.
skip_start: points at the start of the path that are not wall (the lead-in point from Insert Items).
They are dropped, because the spiral now leads into the wall.
"""
import math

from compas.geometry import Point
from compas.geometry import Polyline

# ===== First layer of the wall =====
first = layers[0]
points = list(first.points)[int(skip_start):]
wall_start = points[0]
z = wall_start.z
first_layer = [p for p in points if abs(p.z - z) < 1e-3]

# center and inner radius of the first layer
cx = sum(p.x for p in first_layer) / len(first_layer)
cy = sum(p.y for p in first_layer) / len(first_layer)
inner_radius = min(math.hypot(p.x - cx, p.y - cy) for p in first_layer)
start_angle = math.atan2(wall_start.y - cy, wall_start.x - cx)

# ===== Spiral, center -> outside, whole turns so it ends at start_angle =====
end_radius = inner_radius - line_width
turns = max(1, round(end_radius / line_width))
end_theta = 2 * math.pi * turns
pitch = end_radius / end_theta      # radius grows by line_width-ish per turn

spiral = []
theta = 0.0
while theta < end_theta:
    r = pitch * theta
    spiral.append(Point(cx + r * math.cos(start_angle + theta), cy + r * math.sin(start_angle + theta), z))
    theta += min(point_spacing / max(r, 1e-6), math.pi / 4)   # even spacing, max 45 deg near the center
spiral.append(Point(cx + end_radius * math.cos(start_angle), cy + end_radius * math.sin(start_angle), z))

# ===== New path: spiral, then the wall as before =====
layers_filled = [Polyline(spiral + points)] + list(layers)[1:]

summary = (f"center {cx:.1f}, {cy:.1f}, z {z:.2f}\n"
           f"inner wall radius {inner_radius:.1f} mm, spiral to {end_radius:.1f} mm\n"
           f"{turns} turns, {len(spiral)} points, {int(skip_start)} start point(s) dropped")
# ---------- end fill_bottom ----------
compas_draw = COMPASDraw(cg=fill_bottom.layers_filled)  # -> rg; same code as draw
panel_9 = Panel(fill_bottom.summary)

# ---- group: DISPLAY: check before you print
# export: preview and save
panel_10 = Panel("data/out_printpoints.json")
mode = ValueList({"speed": 0, "overhang": 1}, selected="overhang")
save = Button()
save_2 = Save(printpath=printpath_2.printpath, save=save, out_path=panel_10)  # -> status
# ---------- save_2: Python ----------
# r: compas
# venv: mas-2627
"""
On button press, write the printpath to data/out_printpoints.json next to this .ghx file.
send_to_robot.py reads that file.
"""
import json
import os

import scriptcontext as sc

gh_dir = os.path.dirname(ghenv.Component.OnPingDocument().FilePath)

# keep the last status in sticky, so the message survives the button being released
status_key = "save_status_" + str(ghenv.Component.InstanceGuid)

if save:
    if printpath is None:
        sc.sticky[status_key] = "nothing to save: no printpath"
    else:
        path = os.path.normpath(os.path.join(gh_dir, out_path))
        os.makedirs(os.path.dirname(path), exist_ok=True)
        with open(path, "w") as f:
            json.dump(printpath.to_dict(), f, indent=2)
        sc.sticky[status_key] = f"saved {len(printpath)} printpoints to {path}"

status = sc.sticky.get(status_key, "")
ghenv.Component.Message = "saved" if status.startswith("saved") else status
# ---------- end save_2 ----------
check = Check(printpath=printpath_2.printpath, mode=mode)  # -> beads, values, low, high, param_range, report
# ---------- check: Python ----------
# r: compas
# venv: mas-2627
import math

import Rhino.Geometry as rg
from compas.geometry import closest_point_on_polyline_xy
from compas.geometry import distance_point_point_xy

MODES = ["speed", "overhang"]

mode = int(mode) if mode is not None else 0
points = printpath.printpoints
n = len(points)


# ===== Printed points, grouped per layer (in print order, so each layer is a polyline) =====
layers = {}
for printpoint in points:
    if printpoint.is_extruder_on:
        layers.setdefault(printpoint.layer_index, []).append(printpoint.frame.point)

# ===== Overhang: how far each point sticks out over the layer below it, as an angle from vertical =====
heights = []    # layer height per point (mm), 0 if nothing below
overhangs = []  # overhang per point (degrees), 0 if nothing below
for printpoint in points:
    point = printpoint.frame.point
    points_below = layers.get(printpoint.layer_index - 1)
    if not printpoint.is_extruder_on or not points_below:
        heights.append(0.0)  # travel point or first layer
        overhangs.append(0.0)
        continue
    below = closest_point_on_polyline_xy(point, points_below)  # closest point on the layer below, between its points too
    height = point.z - points_below[0].z  # layers are flat; below[2] would be 0: the _xy function works in plan only
    heights.append(height)
    overhangs.append(math.degrees(math.atan2(distance_point_point_xy(point, below), height)) if height > 0 else 0.0)

# ===== Time: the robot moves to each point at that point's speed. Ignores acceleration =====
print_time = travel_time = 0.0
for i in range(1, n):
    time = points[i - 1].frame.point.distance_to_point(points[i].frame.point) / points[i].speed
    if points[i - 1].is_extruder_on and points[i].is_extruder_on:
        print_time += time
    else:
        travel_time += time

# ===== Colour: one bead (a strip as high as the layer) and one value per printed segment =====
beads, values = [], []
for i in range(1, n):
    a, b = points[i - 1].frame.point, points[i].frame.point
    printing = points[i - 1].is_extruder_on and points[i].is_extruder_on
    if mode == 0:
        # speed: every move as a line, travel included
        beads.append(rg.LineCurve(rg.Point3d(a.x, a.y, a.z), rg.Point3d(b.x, b.y, b.z)))
        values.append(points[i].speed)
    elif printing:
        # overhang: a strip as high as the layer, only where it prints
        ha, hb = (max(0.8 * (h or 0.0), 0.5) for h in (heights[i - 1], heights[i]))  # first layer: 0.5 mm
        bead = rg.Mesh()
        for x, y, z in [(a.x, a.y, a.z), (b.x, b.y, b.z), (b.x, b.y, b.z - hb), (a.x, a.y, a.z - ha)]:
            bead.Vertices.Add(x, y, z)
        bead.Faces.AddFace(0, 1, 2, 3)
        bead.Normals.ComputeNormals()
        beads.append(bead)
        values.append(overhangs[i] or 0.0)  # first layer: nothing below

param_range = rg.Interval(min(values), max(values))
low, high = (min(values), max(values)) if mode == 0 else (0.0, 45.0)
if high <= low:
    high = low + 1.0  # Gradient needs a range

report = "\n".join([
    f"colour: {MODES[mode]}, {low:.2f} to {high:.2f}",
    f"{n} printpoints, {len(layers)} layers",
    f"time: about {(print_time + travel_time) / 60:.1f} min (print {print_time / 60:.1f}, travel {travel_time / 60:.1f})",
])


ghenv.Component.Message = f"{MODES[mode]} mode, print time {(print_time + travel_time) /  60:.0f} min"
# ---------- end check ----------
gradient = Gradient(
    LowerLimit=check.low,
    UpperLimit=check.high,
    Parameter=check.values,
    stops=[0: RGB(45, 75, 170), 0.35: RGB(40, 175, 165), 0.7: RGB(245, 205, 50), 1: RGB(215, 45, 40)])
panel_11 = Panel(save_2)
preview_3 = CustomPreview(Geometry=check.beads, Material=gradient)
panel_12 = Panel(check.report)

# ---- group: PRINTPATH
# generate printpath: printpoints and path
speed_mm_s_2 = Slider(10, range=1..50)
printpath_3 = Printpath(
    layers=python_3_script_8.cg,
    speed=speed_mm_s_2,
    blend_radius="1.0",
    safety_distance="100.0",
    planes=rotate_tcp,
    robot_speed=flatten(robot_speed.robot_speed))  # -> printpath, summary; inputs layers: list, planes: tree, robot_speed: list
# ---------- printpath_3: Python ----------
#! python3
# r: compas
# venv: mas-2627
"""
Turn the layers into printpoints and a PrintPath, in work object coordinates.
Safety points are added here, before any transform to the robot base.
planes (optional, tree: one branch per layer): if connected, every printpoint uses that plane as its frame
(tilted nonplanar printing). If not connected, the layers are used with a vertical nozzle, as before.
speed: one speed for every printpoint (mm/s).
robot_speed (optional list): one speed per printpoint (from the robot speed component); if connected it replaces speed.
"""
import os
import sys

from compas.geometry import Frame, Vector
from compas_rhino.conversions import plane_to_compas_frame


# Find source folder
gh_dir = os.path.dirname(ghenv.Component.OnPingDocument().FilePath)
src_dir = os.path.join(gh_dir, "..", "..", "src")
if src_dir not in sys.path:
    sys.path.append(src_dir)
from print_class import PrintPoint, PrintPath

# ===== Speed: one per printpoint, or one for all =====
per_point = [float(v) for v in (robot_speed or []) if v is not None]
speeds = per_point or [float(speed) if speed is not None else 10.0]


def speed_at(k):
    return speeds[k] if len(speeds) > 1 and k < len(speeds) else speeds[0]


# ===== One printpoint per point =====
printpoints = []
if planes is not None and planes.DataCount > 0:
    # tilted frames: one branch per layer, the plane z axis is the nozzle direction
    layer_count = planes.BranchCount
    for layer_index, branch in enumerate(planes.Branches):
        for plane in branch:
            printpoints.append(PrintPoint(plane_to_compas_frame(plane), layer_index, speed_at(len(printpoints)), blend_radius, True))
    source = "planes (tilted)"
else:
    # world XY orientation for every point: a tangent frame would turn the wrist 360 degrees each layer
    layer_count = len(layers)
    for layer_index, layer in enumerate(layers):
        for point in layer.points:
            frame = Frame(point, -Vector.Xaxis(), Vector.Yaxis())
            printpoints.append(PrintPoint(frame, layer_index, speed_at(len(printpoints)), blend_radius, True))
    source = "layers (vertical nozzle)"

# ===== Path with a travel point above the start and the end =====
printpath = PrintPath(printpoints)
travel = max(speeds)   # safety moves at the fastest print speed
printpath.add_safety_before(safety_distance, travel)
printpath.add_safety_after(safety_distance, travel)

summary = f"{len(printpoints)} printpoints in {layer_count} layers, plus 2 safety points\nfrom {source}"
# ---------- end printpath_3 ----------
panel_13 = Panel(printpath_3.summary)

# ----
data_23 = Data(printpath_3.printpath)
panel_14 = Panel(data_23)
panel_15 = Panel(check.param_range)

# ---- group: printbed_position
printbed_position = _4PointSurface(
    CornerA="535.57,-65.74,-9.79",
    CornerB="535.54,528.09,-10.52",
    CornerC="136.49,527.66,-10.90",
    CornerD="228.17,-67.26,-9.86")

# ---- group: object_position_on_printbed
pt_2 = ConstructPoint(XCoordinate=Slider(0.5, range=0..1), YCoordinate=Slider(0.5, range=0..1), ZCoordinate=0)

# ----
# FINAL INTERLOCK TEST1
data_24 = Data([Point(1491.405012, 3447.758038, -6), Point(1499.820066, 3452.733061, -6), Point(1508.235119, 3457.708084, -6), Point(1516.650172, 3462.683106, -6), Point(1525.065225, 3467.658129, -6), Point(1533.480278, 3472.633152, -6)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])

# ---- group: first_layer_lift
number_slider_5 = Slider(1.5, range=0..10)

# ---- group: object_rotation
number_slider_6 = Slider(75, range=0..360)

# ----
# bed corners (robot base, mm), uv on the bed, angle, first layer offset
cluster_2 = Cluster(S=printbed_position, uv=pt_2, A=degrees(number_slider_6), first_layer_lift_2=number_slider_5)
place_on_bed = Python3Script(printpath=data_23, bed_plane=cluster_2)  # -> printpath_on_bed, summary; inputs bed_plane: Plane
# ---------- place_on_bed: Python ----------
# r: compas
# venv: mas-2627
"""
Place the printpath on the print bed.
bed_plane comes from 校正桌面: the bed surface at (u, v), turned by the object angle, z up, raised by the first layer offset.
The printpath is built around world XY, so world XY is moved onto bed_plane.
The output is a normal PrintPath (now in robot base coordinates), so preview and save work as before.
"""
import os
import sys

from compas.geometry import Frame, Transformation
from compas_rhino.conversions import plane_to_compas_frame

# Find source folder
gh_dir = os.path.dirname(ghenv.Component.OnPingDocument().FilePath)
src_dir = os.path.join(gh_dir, "..", "..", "src")
if src_dir not in sys.path:
    sys.path.append(src_dir)
from print_class import PrintPath

# ===== world XY -> bed plane =====
bed = plane_to_compas_frame(bed_plane)
transformation = Transformation.from_frame_to_frame(Frame.worldXY(), bed)

# ===== New printpath, the original stays untouched =====
placed = []
for printpoint in printpath.printpoints:
    new_printpoint = printpoint.copy()
    new_printpoint.frame.transform(transformation)
    placed.append(new_printpoint)
printpath_on_bed = PrintPath(placed)

z_values = [printpoint.frame.point.z for printpoint in placed]
summary = f"bed origin: {[round(v, 2) for v in bed.point]}\nz from {min(z_values):.1f} to {max(z_values):.1f} mm (robot base)"
# ---------- end place_on_bed ----------

# ---- group: UR5 SIM (取代 TACO)
# UR5 SIM (TACO logic): printpath_on_bed -> IK -> reach / flip / singular / collision -> pose at Index
tool_mesh_edit = ToolMeshEdit([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])
extruder_model = Python3Script()  # -> tool_mesh, collision, info
# ---------- extruder_model: Python ----------
#! python3
"""Extruder model (SAEKI housing + R3DP extruder + gold bracket plate), in the FLANGE frame
(tool0 of the UR: origin = flange centre, z = out of the flange towards the nozzle), mm.
Sizes and positions are read from the photos (2026-11-10): measure them and change the numbers below.
The nozzle tip is placed exactly at the TCP (TOOL_FRAME in send_to_robot.py).

Directions used below (all horizontal, in the flange plane):
  n : normal of the gold plate, pointing from the nozzle towards the plate
  u : along the plate, pointing towards the flange axis side (u = z x n)
Positions of the black parts are (u, n) measured from the FLANGE AXIS, plate outline (u, h) from the NOZZLE.

Outputs
  tool_mesh : meshes for UR5 Robot Pose > ToolMesh (preview of this component is off)
  collision : solids for UR5 Path Solver > Collision
  info      : the numbers that matter for collisions
"""
import math

import Rhino.Geometry as rg

TCP = (-57.08, 44.54, 189.5)        # nozzle tip in the flange frame (TOOL_FRAME)

# ----- gold bracket plate (MEASURE THESE) -----
PLATE_ANGLE = 120.0     # deg: plate normal n = (flange axis -> nozzle direction) turned by this angle about z
PLATE_OFFSET = 44.0     # mm from the nozzle axis to the plate (photo: 44, the plate passes ~8 mm beyond the flange axis)
PLATE_T = 5.0           # plate thickness
PLATE_GAP = 8.0         # lowest edge of the plate above the nozzle tip (raised 5 mm on 2026-11-10)
# plate seen face on: (u from the nozzle, h above the nozzle tip). Narrow tab at the bottom, wide part under the flange
PLATE_OUTLINE = [(8, PLATE_GAP), (50, PLATE_GAP), (50, 38), (99, 84), (99, 173), (27, 173), (27, 125), (8, 60)]

# ----- black parts and brass: (u0, u1), (n0, n1), (z0, z1), from the flange axis -----
RING = (37.0, 10.0)                                          # black ring under the flange: radius, height
HOUSING = ((-47, 8), (-43, 5), [(-47, 10), (8, 10), (8, 102), (-47, 65)])   # SAEKI box, sloped bottom (u, z)
MOTOR = ((-51, -10), (-37, 5), (81, 132))                    # stepper under the housing
EXTRUDER = ((-98, -39), (-62, -8), (78, 132))                # R3DP extruder + fan, away from the flange
HEATER = (15.0, 20.0, 132.0)                                 # brass bar around the nozzle: size along u, along n, top z
NOZZLE_H, NOZZLE_R = 4.5, 4.0                                # cone above the tip


def polyline(points):
    """rg.Polyline from a python list (the list constructor is not picked reliably by every Rhino)."""
    pl = rg.Polyline()
    for p in points:
        pl.Add(p)
    return pl


class Prism(object):
    """Flat outline extruded by its thickness, in the flange frame.
    Outline (x, y) in plane coordinates, thickness centred on the plane (along plane Z)."""

    def __init__(self, name, plane, outline, thickness):
        self.name, self.plane, self.outline, self.thickness = name, plane, outline, thickness

    def mesh(self):
        mesh = rg.Mesh()
        half = self.thickness / 2
        n = len(self.outline)
        for w in (-half, half):
            for x, y in self.outline:
                mesh.Vertices.Add(self.plane.PointAt(x, y, w))
        for k in range(n):                       # sides
            k2 = (k + 1) % n
            mesh.Faces.AddFace(k, k2, n + k2, n + k)
        for w in (-half, half):                  # top and bottom caps
            cap = polyline([self.plane.PointAt(x, y, w) for x, y in self.outline] + [self.plane.PointAt(self.outline[0][0], self.outline[0][1], w)])
            cap_mesh = rg.Mesh.CreateFromClosedPolyline(cap)
            if cap_mesh:
                mesh.Append(cap_mesh)
        mesh.Normals.ComputeNormals()
        mesh.Vertices.CombineIdentical(True, True)   # weld: a closed mesh, so the collision check can test inside
        mesh.Normals.ComputeNormals()
        mesh.Compact()
        return mesh


tip = rg.Point3d(*TCP)
direction = rg.Vector3d(tip.X, tip.Y, 0)     # flange axis -> nozzle
direction.Unitize()
n_axis = rg.Vector3d(direction)
n_axis.Rotate(math.radians(PLATE_ANGLE), rg.Vector3d.ZAxis)
u_axis = rg.Vector3d.CrossProduct(rg.Vector3d.ZAxis, n_axis)


def box_un(name, u, n, z):
    """Box from (u0, u1), (n0, n1), (z0, z1) measured from the flange axis. z may be a (u, z) outline."""
    plane = rg.Plane(rg.Point3d(0, 0, 0) + n_axis * ((n[0] + n[1]) / 2), u_axis, rg.Vector3d.ZAxis)
    outline = z if isinstance(z, list) else [(u[0], z[0]), (u[1], z[0]), (u[1], z[1]), (u[0], z[1])]
    return Prism(name, plane, outline, n[1] - n[0])


# plate: vertical, PLATE_OFFSET from the nozzle on the n side; plane x = u, plane y = up (towards the flange)
plate_plane = rg.Plane(rg.Point3d(tip.X, tip.Y, tip.Z) + n_axis * PLATE_OFFSET, u_axis, -rg.Vector3d.ZAxis)
plate = Prism("bracket", plate_plane, PLATE_OUTLINE, PLATE_T)
housing = box_un("housing", HOUSING[0], HOUSING[1], HOUSING[2])
motor = box_un("motor", *MOTOR)
extruder = box_un("extruder", *EXTRUDER)
nu = rg.Point3d(tip.X, tip.Y, 0)
heater_plane = rg.Plane(nu, u_axis, rg.Vector3d.ZAxis)
heater = Prism("heater", heater_plane, [(-HEATER[0] / 2, HEATER[2]), (HEATER[0] / 2, HEATER[2]),
                                        (HEATER[0] / 2, tip.Z - NOZZLE_H), (-HEATER[0] / 2, tip.Z - NOZZLE_H)], HEATER[1])
ring = rg.Mesh.CreateFromCylinder(rg.Cylinder(rg.Circle(rg.Plane.WorldXY, RING[0]), RING[1]), 1, 32)
nozzle = rg.Mesh.CreateFromCone(rg.Cone(rg.Plane(tip, -rg.Vector3d.ZAxis), NOZZLE_H, NOZZLE_R), 1, 24)

collision = [plate, heater, extruder, motor, housing]
tool_mesh = [ring, nozzle] + [p.mesh() for p in collision]
ghenv.Component.Hidden = True

# check: where the flange axis and the nozzle sit relative to the plate
n_nozzle = (tip - rg.Point3d(0, 0, tip.Z)) * n_axis
u_nozzle = (tip - rg.Point3d(0, 0, tip.Z)) * u_axis
info = (f"tip (TCP): {TCP}\n"
        f"nozzle from the flange axis: u {u_nozzle:.1f}, n {n_nozzle:.1f} (photo: u -63, n -36)\n"
        f"plate: {PLATE_OFFSET:.0f} mm beside the nozzle, {PLATE_OFFSET + n_nozzle:.0f} mm beyond the flange axis, "
        f"lowest edge {PLATE_GAP:.0f} mm above the tip")
# ---------- end extruder_model ----------
ur5_path_solver = Python3Script(Targets=place_on_bed.printpath_on_bed, Collision=extruder_model.collision, ToolMesh=tool_mesh_edit)  # -> Sim, Joints, Reach, Path, Analysis, Info, Collide; inputs Targets: list, Tool: Plane, Base: Plane, Seed: list, Collision: list, ToolMesh: list of Mesh
# ---------- ur5_path_solver: Python ----------
#! python3
"""UR5 (CB3) kinematics, pure python. Units mm / rad inside, degrees outside."""
import math

# UR5 DH parameters (mm), same as Universal Robots publish
D1, A2, A3, D4, D5, D6 = 89.159, -425.0, -392.25, 109.15, 94.65, 82.3
DH_D = [D1, 0.0, 0.0, D4, D5, D6]
DH_A = [0.0, A2, A3, 0.0, 0.0, 0.0]
DH_ALPHA = [math.pi / 2, 0.0, 0.0, math.pi / 2, -math.pi / 2, 0.0]
LIMITS = [(-360.0, 360.0)] * 6   # UR5 CB3: every joint +-360 deg


def _dh(theta, d, a, alpha):
    ct, st, ca, sa = math.cos(theta), math.sin(theta), math.cos(alpha), math.sin(alpha)
    return [[ct, -st * ca, st * sa, a * ct],
            [st, ct * ca, -ct * sa, a * st],
            [0.0, sa, ca, d],
            [0.0, 0.0, 0.0, 1.0]]


def mul(a, b):
    return [[sum(a[i][k] * b[k][j] for k in range(4)) for j in range(4)] for i in range(4)]


def inv(t):
    r = [[t[j][i] for j in range(3)] for i in range(3)]
    p = [-sum(r[i][k] * t[k][3] for k in range(3)) for i in range(3)]
    return [r[0] + [p[0]], r[1] + [p[1]], r[2] + [p[2]], [0.0, 0.0, 0.0, 1.0]]


def frames(q_deg):
    """Base -> frame 1..6 (flange) for joints in degrees."""
    out, t = [], [[1.0 if i == j else 0.0 for j in range(4)] for i in range(4)]
    for i in range(6):
        t = mul(t, _dh(math.radians(q_deg[i]), DH_D[i], DH_A[i], DH_ALPHA[i]))
        out.append(t)
    return out


def fk(q_deg):
    return frames(q_deg)[-1]


def ik(t):
    """All analytic solutions (deg, in [-180, 180)) for a flange pose t (4x4, mm)."""
    sols = []
    p05 = [t[i][3] - D6 * t[i][2] for i in range(3)]
    r = math.hypot(p05[0], p05[1])
    if r < D4:
        return sols
    psi = math.atan2(p05[1], p05[0])
    phi = math.acos(D4 / r)
    for th1 in (psi + phi + math.pi / 2, psi - phi + math.pi / 2):
        s1, c1 = math.sin(th1), math.cos(th1)
        c5 = (t[0][3] * s1 - t[1][3] * c1 - D4) / D6
        if abs(c5) > 1.0 + 1e-9:
            continue
        c5 = max(-1.0, min(1.0, c5))
        for th5 in (math.acos(c5), -math.acos(c5)):
            s5 = math.sin(th5)
            if abs(s5) < 1e-9:
                th6 = 0.0   # wrist singularity: only th4 + th6 is defined
            else:
                th6 = math.atan2((-t[0][1] * s1 + t[1][1] * c1) / s5, (t[0][0] * s1 - t[1][0] * c1) / s5)
            t01 = _dh(th1, DH_D[0], DH_A[0], DH_ALPHA[0])
            t45 = _dh(th5, DH_D[4], DH_A[4], DH_ALPHA[4])
            t56 = _dh(th6, DH_D[5], DH_A[5], DH_ALPHA[5])
            t14 = mul(mul(inv(t01), t), inv(mul(t45, t56)))
            # origin of frame 3 seen from frame 1 (remove the d4 offset along y of frame 4)
            px = t14[0][3] - D4 * t14[0][1]
            py = t14[1][3] - D4 * t14[1][1]
            l = math.hypot(px, py)
            c3 = (l * l - A2 * A2 - A3 * A3) / (2 * A2 * A3)
            if abs(c3) > 1.0 + 1e-9:
                continue
            c3 = max(-1.0, min(1.0, c3))
            for th3 in (math.acos(c3), -math.acos(c3)):
                th2 = math.atan2(-py, -px) - math.asin(max(-1.0, min(1.0, -A3 * math.sin(th3) / l)))
                t12 = _dh(th2, DH_D[1], DH_A[1], DH_ALPHA[1])
                t23 = _dh(th3, DH_D[2], DH_A[2], DH_ALPHA[2])
                t34 = mul(inv(mul(t12, t23)), t14)
                th4 = math.atan2(t34[1][0], t34[0][0])
                sols.append([(math.degrees(v) + 180.0) % 360.0 - 180.0 for v in (th1, th2, th3, th4, th5, th6)])
    return sols


def variants(sol):
    """Every +-360 turn of every joint that stays inside the limits."""
    out = [[]]
    for a, (lo, hi) in zip(sol, LIMITS):
        out = [o + [v] for o in out for v in (a - 360.0, a, a + 360.0) if lo <= v <= hi]
    return out


def cost(q, prev):
    return sum(w * (a - b) ** 2 for w, a, b in zip((1, 1, 1, 0.5, 0.5, 0.25), q, prev))


def solve_path(flanges, seed):
    """Joint values per flange pose, each closest to the previous pose (None if unreachable)."""
    joints, prev = [], seed
    for t in flanges:
        sols = ik(t)
        if not sols:
            joints.append(None)
            continue
        # closest turn of each joint to the previous pose, then the closest solution
        best = None
        for s in sols:
            q = [min((v for v in (a - 360.0, a, a + 360.0) if lo <= v <= hi), key=lambda v: abs(v - p))
                 for a, p, (lo, hi) in zip(s, prev, LIMITS)]
            c = cost(q, prev)
            if best is None or c < best[0]:
                best = (c, q)
        joints.append(best[1])
        prev = best[1]
    return joints




# ====================================================================
# UR5 Path Solver - same idea as the IRB 2600 Path Solver (TACO logic):
# TCP targets (robot base, mm) -> flange poses -> inverse kinematics -> checks.
# Simulation only: nothing is sent to the robot (send_to_robot.py does that).
#
# Inputs
#   Targets : place on bed > printpath_on_bed (PrintPath), or compas Frames, or Rhino Planes (robot base, mm)
#   Tool    : TCP plane in the flange frame. Empty = TOOL_FRAME of send_to_robot.py
#   Base    : robot base plane in Rhino. Empty = World XY (the path is already in robot base coordinates)
#   Seed    : 6 joint values (deg) the first target should stay close to. Empty = robot pose read on 2026-11-05
# Outputs
#   Sim      : solved path for UR5 Robot Pose
#   Joints   : joint values (deg), one branch per target
#   Reach    : True per target if a solution exists
#   Path     : polyline through all TCP positions
#   Analysis : True if every target is reachable, no flip, no singularity
#   Info     : report
# Joint states (colours in Robot Pose)
#   grey = ok, orange = near limit, red = unreachable, yellow = singularity, magenta = joint flip
# ====================================================================
import Grasshopper
import numpy as np
import Rhino.Geometry as rg
import System.Drawing as sd
from ghpythonlib import treehelpers as th

TOOL_XYZ = (-57.08, 44.54, 189.5)                     # TOOL_FRAME in send_to_robot.py (= UR installation TCP)
SEED = [205.43, -84.05, 89.30, -95.24, -89.94, -52.40]  # robot pose read over RTDE on 2026-11-05
FLIP_DEG = 30.0          # joint change between two targets reported as a flip ...
FLIP_DEG_PER_MM = 0.5    # ... when it is also large compared to the TCP travel
NEAR_LIMIT_DEG = 10.0
SINGULAR_DEG = 5.0       # wrist: |sin A5| , elbow: |sin A3| below sin(5 deg)
SHOULDER_MM = 20.0       # wrist centre closer than this to the shoulder singular cylinder

COLORS = {
    "ok": sd.Color.FromArgb(170, 170, 170),
    "near limit": sd.Color.FromArgb(255, 150, 0),
    "limit": sd.Color.FromArgb(230, 30, 30),
    "singular": sd.Color.FromArgb(255, 225, 0),
    "flip": sd.Color.FromArgb(220, 40, 220),
    "collision": sd.Color.FromArgb(255, 0, 0),
}
SEVERITY = ["ok", "near limit", "singular", "flip", "limit", "collision"]


def polyline(points):
    """rg.Polyline from a python list (the list constructor is not picked reliably by every Rhino)."""
    pl = rg.Polyline()
    for p in points:
        pl.Add(p)
    return pl


def plane_to_m(pl):
    x, y, z, o = pl.XAxis, pl.YAxis, pl.ZAxis, pl.Origin
    return [[x.X, y.X, z.X, o.X], [x.Y, y.Y, z.Y, o.Y], [x.Z, y.Z, z.Z, o.Z], [0.0, 0.0, 0.0, 1.0]]


def m_to_plane(m):
    return rg.Plane(rg.Point3d(m[0][3], m[1][3], m[2][3]),
                    rg.Vector3d(m[0][0], m[1][0], m[2][0]), rg.Vector3d(m[0][1], m[1][1], m[2][1]))


def to_plane(t):
    if isinstance(t, rg.Plane):
        return t
    if hasattr(t, "point") and hasattr(t, "xaxis"):   # compas Frame
        p, x, y = t.point, t.xaxis, t.yaxis
        return rg.Plane(rg.Point3d(p[0], p[1], p[2]), rg.Vector3d(x[0], x[1], x[2]), rg.Vector3d(y[0], y[1], y[2]))
    return None


def joint_status(q, prev_q, is_flip, shoulder):
    out = []
    for j, (a, (lo, hi)) in enumerate(zip(q, LIMITS)):
        s = "ok"
        if min(a - lo, hi - a) < NEAR_LIMIT_DEG:
            s = "near limit"
        if j == 4 and abs(math.sin(math.radians(a))) < math.sin(math.radians(SINGULAR_DEG)):
            s = "singular"
        if j == 2 and abs(math.sin(math.radians(a))) < math.sin(math.radians(SINGULAR_DEG)):
            s = "singular"
        if j == 0 and shoulder:
            s = "singular"
        if is_flip and prev_q is not None and abs(a - prev_q[j]) > FLIP_DEG:
            s = "flip"
        if a <= lo or a >= hi:
            s = "limit"
        out.append(s)
    return out


def shoulder_singular(q):
    t = fk(q)
    p05 = [t[i][3] - D6 * t[i][2] for i in range(3)]
    return math.hypot(p05[0], p05[1]) - D4 < SHOULDER_MM


class Simulation(object):
    """Everything UR5 Robot Pose needs that does not depend on Index."""
    colors = COLORS
    severity = SEVERITY
    name = "UR5 (CB3)"

    def __init__(self, targets, joints, tool, base, extruding, layers=None, collisions=None):
        self.joints = joints
        self.tool = tool
        self.tool_m = plane_to_m(tool)
        self.to_world = rg.Transform.PlaneToPlane(rg.Plane.WorldXY, base)
        self.extruding = extruding
        self.layers = layers or []
        self.collisions = collisions or {}     # target index -> name of the part that hits
        self.points = []
        for t in targets:
            p = rg.Point3d(t.Origin)
            p.Transform(self.to_world)
            self.points.append(p)
        self.unreachable = [i for i, q in enumerate(joints) if q is None]
        self.flips, self.prev_of, last = [], {}, None
        for i, q in enumerate(joints):
            if q is None:
                continue
            if last is not None:
                self.prev_of[i] = last
                dq = max(abs(a - b) for a, b in zip(q, joints[last]))
                if dq > FLIP_DEG and dq > FLIP_DEG_PER_MM * targets[i].Origin.DistanceTo(targets[last].Origin):
                    self.flips.append(i)
            last = i
        self.flip_set = set(self.flips)
        self.shoulder = set(i for i, q in enumerate(joints) if q and shoulder_singular(q))
        s5 = math.sin(math.radians(SINGULAR_DEG))
        self.singular = [i for i, q in enumerate(joints)
                         if q and (abs(math.sin(math.radians(q[4]))) < s5 or abs(math.sin(math.radians(q[2]))) < s5
                                   or i in self.shoulder)]
        self.near = [i for i, q in enumerate(joints)
                     if q and any(min(a - lo, hi - a) < NEAR_LIMIT_DEG for a, (lo, hi) in zip(q, LIMITS))]
        self.marks = ([(self.points[i], COLORS["collision"]) for i in sorted(self.collisions)[:3000]] +
                      [(self.points[i], COLORS["limit"]) for i in self.unreachable[:2000]] +
                      [(self.points[i], COLORS["flip"]) for i in self.flips[:2000]] +
                      [(self.points[i], COLORS["singular"]) for i in self.singular[:2000]])
        self.bbox = rg.BoundingBox.Empty
        for p in self.points:
            self.bbox = rg.BoundingBox.Union(self.bbox, rg.BoundingBox(p, p))

    def __len__(self):
        return len(self.joints)

    def __repr__(self):
        return "UR5 Simulation ({} targets)".format(len(self.joints))

    def pose(self, index):
        idx = max(0, min(int(index), len(self.joints) - 1))
        shown = next((k for k in range(idx, -1, -1) if self.joints[k] is not None),
                     next((k for k, j in enumerate(self.joints) if j is not None), None))
        if shown is None:
            return idx, None, None, ["limit"] * 6, False
        q = self.joints[shown]
        if shown != idx:
            return idx, shown, q, ["limit"] * 6, False
        prev_q = self.joints[self.prev_of[idx]] if idx in self.prev_of else None
        return idx, shown, q, joint_status(q, prev_q, idx in self.flip_set, idx in self.shoulder), True

    def link_planes(self, q):
        """Base plane + frame 1..6 (flange) + TCP, in Rhino world."""
        ms = frames(q)
        pls = [rg.Plane.WorldXY] + [m_to_plane(m) for m in ms] + [m_to_plane(mul(ms[-1], self.tool_m))]
        out = []
        for pl in pls:
            pl = rg.Plane(pl)
            pl.Transform(self.to_world)
            out.append(pl)
        return out

    def summary(self):
        return "path: {} collisions, {} unreachable, {} flips, {} singular, {} near limit".format(
            len(self.collisions), len(self.unreachable), len(self.flips), len(self.singular), len(self.near))


# ---------- collision: extruder parts vs printed material and the bed ----------
BEAD_R = 1.0     # half the bead width, mm (margin around the printed path)
STEP = 1.0       # printed path sampled every STEP mm
CELL = 20.0      # grid cell for the neighbour search, mm


def _inside(poly, u, v):
    """Vectorised point in polygon (ray casting). poly: list of (u, v); u, v: numpy arrays."""
    inside = np.zeros(u.shape, dtype=bool)
    n = len(poly)
    for k in range(n):
        (u1, v1), (u2, v2) = poly[k], poly[(k + 1) % n]
        cross = (v1 > v) != (v2 > v)
        with np.errstate(divide="ignore", invalid="ignore"):
            ux = u1 + (v - v1) * (u2 - u1) / (v2 - v1)
        inside ^= cross & (u < ux)
    return inside


def sample_print(targets, extruding):
    """Printed path sampled every STEP mm: points (N, 3) and the target index that prints each one."""
    on = extruding if extruding else [True] * len(targets)
    pts, owner = [], []
    for i in range(1, len(targets)):
        if not (on[i - 1] and on[i]):
            continue
        a, b = targets[i - 1].Origin, targets[i].Origin
        n = max(1, int(a.DistanceTo(b) / STEP))
        for k in range(1, n + 1):
            t = k / n
            pts.append((a.X + (b.X - a.X) * t, a.Y + (b.Y - a.Y) * t, a.Z + (b.Z - a.Z) * t))
            owner.append(i)
    return np.array(pts), np.array(owner)


def check_mesh_collisions(targets, flanges, extruding, meshes, tool):
    """Same check with meshes in the flange frame (Tool Mesh input). The part that holds the TCP
    (the nozzle) is skipped: it touches the print on purpose. Meshes must be closed."""
    pts, owner = sample_print(targets, extruding)
    if not len(pts):
        return {}
    bed_z = pts[:, 2].min() - 0.5
    grid = {}
    for idx, c in enumerate(map(tuple, np.floor(pts / CELL).astype(int))):
        grid.setdefault(c, []).append(idx)
    parts = []
    for k, mesh in enumerate(meshes):
        if mesh is None or mesh.Vertices.Count == 0:
            continue
        if mesh.ClosestPoint(tool.Origin).DistanceTo(tool.Origin) < 1.0:
            continue                                          # nozzle
        verts = np.array([(v.X, v.Y, v.Z) for v in mesh.Vertices])
        parts.append(("tool mesh {}".format(k), mesh, verts, verts.min(0) - BEAD_R, verts.max(0) + BEAD_R))
    hits = {}
    for i, f in enumerate(flanges):
        fm = np.array(f)
        rot, org = fm[:3, :3], fm[:3, 3]
        for name, mesh, verts, lo_l, hi_l in parts:
            world = verts @ rot.T + org
            if world[:, 2].min() < bed_z:
                hits[i] = name + " / bed"
                break
            lo = np.floor((world.min(0) - BEAD_R) / CELL).astype(int)
            hi = np.floor((world.max(0) + BEAD_R) / CELL).astype(int)
            cand = [j for cx in range(lo[0], hi[0] + 1) for cy in range(lo[1], hi[1] + 1)
                    for cz in range(lo[2], hi[2] + 1) for j in grid.get((cx, cy, cz), ())]
            if not cand:
                continue
            cand = np.array(cand)
            cand = cand[owner[cand] <= i]
            if not len(cand):
                continue
            local = (pts[cand] - org) @ rot                   # world -> flange frame
            local = local[np.all((local >= lo_l) & (local <= hi_l), axis=1)]
            for x, y, z in local:
                p = rg.Point3d(x, y, z)
                if mesh.ClosestPoint(p).DistanceTo(p) <= BEAD_R or mesh.IsPointInside(p, 0.01, False):
                    hits[i] = name
                    break
            if i in hits:
                break
    return hits


def check_collisions(targets, flanges, extruding, solids):
    """Target index -> part name, for every pose where a solid touches printed material or the bed."""
    if not solids:
        return {}
    on = extruding if extruding else [True] * len(targets)
    pts, owner = [], []
    for i in range(1, len(targets)):
        if not (on[i - 1] and on[i]):
            continue
        a, b = targets[i - 1].Origin, targets[i].Origin
        n = max(1, int(a.DistanceTo(b) / STEP))
        for k in range(1, n + 1):
            t = k / n
            pts.append((a.X + (b.X - a.X) * t, a.Y + (b.Y - a.Y) * t, a.Z + (b.Z - a.Z) * t))
            owner.append(i)
    if not pts:
        return {}
    pts, owner = np.array(pts), np.array(owner)
    bed_z = pts[:, 2].min() - 0.5
    grid = {}
    for idx, c in enumerate(map(tuple, np.floor(pts / CELL).astype(int))):
        grid.setdefault(c, []).append(idx)
    local = [(s, np.array(plane_to_m(s.plane))) for s in solids]
    hits = {}
    for i, f in enumerate(flanges):
        fm = np.array(f)
        for s, sm in local:
            m = fm @ sm                         # solid frame -> world
            rot, org = m[:3, :3], m[:3, 3]
            half = s.thickness / 2 + BEAD_R
            corners = np.array([org + rot @ (u, h, w) for u, h in s.outline for w in (-half, half)])
            if corners[:, 2].min() < bed_z:
                hits[i] = s.name + " / bed"
                break
            lo, hi = np.floor((corners.min(0) - BEAD_R) / CELL).astype(int), np.floor((corners.max(0) + BEAD_R) / CELL).astype(int)
            cand = [j for cx in range(lo[0], hi[0] + 1) for cy in range(lo[1], hi[1] + 1)
                    for cz in range(lo[2], hi[2] + 1) for j in grid.get((cx, cy, cz), ())]
            if not cand:
                continue
            cand = np.array(cand)
            cand = cand[owner[cand] <= i]       # only what is already printed at this pose
            if not len(cand):
                continue
            p = (pts[cand] - org) @ rot         # world -> solid frame (u, h, w)
            near = np.abs(p[:, 2]) <= half
            if not near.any():
                continue
            u, v = p[near, 0], p[near, 1]
            hit = np.zeros(u.shape, dtype=bool)
            for du, dv in ((0, 0), (BEAD_R, 0), (-BEAD_R, 0), (0, BEAD_R), (0, -BEAD_R)):
                hit |= _inside(s.outline, u + du, v + dv)
            if hit.any():
                hits[i] = s.name
                break
    return hits


# ---------- component ----------
items = [t for t in (Targets or []) if t is not None]
Sim = Joints = Reach = Path = Analysis = Info = Collide = None
extruding, layers, speeds = [], [], []
if len(items) == 1 and hasattr(items[0], "printpoints"):        # a PrintPath
    extruding = [p.is_extruder_on for p in items[0].printpoints]
    layers = [p.layer_index for p in items[0].printpoints]
    speeds = [p.speed for p in items[0].printpoints]
    items = [p.frame for p in items[0].printpoints]
targets = [to_plane(t) for t in items]
targets = [t for t in targets if t is not None]

if targets:
    tool = Tool if isinstance(Tool, rg.Plane) else rg.Plane(rg.Point3d(*TOOL_XYZ), rg.Vector3d.XAxis, rg.Vector3d.YAxis)
    base = Base if isinstance(Base, rg.Plane) else rg.Plane.WorldXY
    seed = [float(v) for v in Seed][:6] if Seed and len(Seed) >= 6 else SEED
    tool_inv = inv(plane_to_m(tool))
    flanges = [mul(plane_to_m(t), tool_inv) for t in targets]
    joints = solve_path(flanges, seed)
    tool_meshes = [m for m in (ToolMesh or []) if isinstance(m, rg.Mesh)]
    solids = [s for s in (Collision or []) if hasattr(s, "outline")]
    if tool_meshes:      # the meshes you can edit win over the Extruder Model solids
        hits = check_mesh_collisions(targets, flanges, extruding, tool_meshes, tool)
        solids = tool_meshes
    else:
        hits = check_collisions(targets, flanges, extruding, solids)
    Sim = Simulation(targets, joints, tool, base, extruding, layers, hits)
    # time at each target: segment length / speed of the target it moves to (10 mm/s if unknown)
    Sim.times = [0.0]
    for i in range(1, len(targets)):
        v = speeds[i] if i < len(speeds) and speeds[i] > 0 else 10.0
        Sim.times.append(Sim.times[-1] + targets[i - 1].Origin.DistanceTo(targets[i].Origin) / v)

    hit_layers = sorted(set(layers[i] + 1 for i in hits)) if layers else []
    first = min(hits) if hits else None
    Info = "\n".join([
        "robot: UR5 (CB3), base = {}".format("World XY" if base == rg.Plane.WorldXY else "custom plane"),
        "targets: {}".format(len(targets)),
        "COLLISIONS: {}{}".format(len(hits), "" if not hits else "  first at index {} ({}){}, parts: {}".format(
            first, hits[first], ", layer {}".format(layers[first] + 1) if layers else "", sorted(set(hits.values())))),
        "  layers with collisions: {}".format(hit_layers[:40]) if hit_layers else ("  (no Collision solids connected)" if not solids else ""),
        "unreachable: {}{}".format(len(Sim.unreachable), " " + str(Sim.unreachable[:20]) if Sim.unreachable else ""),
        "joint flips > {} deg: {}{}".format(FLIP_DEG, len(Sim.flips), " " + str(Sim.flips[:20]) if Sim.flips else ""),
        "singular (wrist A5 / elbow A3 / shoulder): {}{}".format(len(Sim.singular), " " + str(Sim.singular[:20]) if Sim.singular else ""),
        "near limit (< {} deg from +-360): {}".format(NEAR_LIMIT_DEG, len(Sim.near)),
        "A6 range: {:.1f} to {:.1f} deg".format(min(q[5] for q in joints if q), max(q[5] for q in joints if q)) if any(joints) else "",
    ])
    if hits:
        ghenv.Component.AddRuntimeMessage(Grasshopper.Kernel.GH_RuntimeMessageLevel.Error,
                                          "{} collision(s), first at index {} ({})".format(len(hits), first, hits[first]))
    if Sim.unreachable:
        ghenv.Component.AddRuntimeMessage(Grasshopper.Kernel.GH_RuntimeMessageLevel.Warning,
                                          "{} target(s) unreachable".format(len(Sim.unreachable)))
    if Sim.flips or Sim.singular:
        ghenv.Component.AddRuntimeMessage(Grasshopper.Kernel.GH_RuntimeMessageLevel.Warning,
                                          "{} flip(s), {} singular target(s)".format(len(Sim.flips), len(Sim.singular)))
    Joints = th.list_to_tree([q if q is not None else [] for q in joints])
    Reach = [q is not None for q in joints]
    Path = polyline(Sim.points).ToPolylineCurve() if len(Sim.points) > 1 else None
    Collide = [i in hits for i in range(len(targets))]
    Analysis = not hits and not Sim.unreachable and not Sim.flips and not Sim.singular
# ---------- end ur5_path_solver ----------
index = Slider(858, range=0..1601)
play = BooleanToggle(False)
timeline = BooleanToggle(False)
panel_16 = Panel(ur5_path_solver.Info)
panel_17 = Panel(extruder_model.info)
ur5_robot_pose = Python3Script(Sim=ur5_path_solver.Sim, Index=index, ToolMesh=tool_mesh_edit, Play=play, Timeline=timeline)  # -> Robot, TCP, Axis, Status; inputs ToolMesh: list of Mesh, Play: Boolean, Timeline: Boolean
# ---------- ur5_robot_pose: Python ----------
#! python3
"""UR5 Robot Pose - shows the UR5 Path Solver result at one target.
Only this component runs when the Index slider moves.

Inputs
    Sim      : UR5 Path Solver > Sim
    Index    : target to display (connect a Number Slider)
    Play     : Boolean Toggle: True plays the path (moves the Index slider), False pauses
    Timeline : Boolean Toggle: False hides the timeline bar at the top of the viewport (not connected = shown)
    ToolMesh : Extruder Model > tool_mesh (in the flange frame)
Outputs
    Robot  : UR5 meshes posed at Index, coloured by joint status (extruder red on a collision)
    TCP    : TCP plane at Index
    Axis   : 6 joint values at Index (deg)
    Status : joint states at Index

Viewport timeline (top left): play / pause symbol, the line shows where Index is on the path.
Red ticks on the line = collisions, magenta = flips, yellow = singular.
"""
import Grasshopper
import Rhino
import Rhino.Geometry as rg
import scriptcontext as sc
import System
import System.Drawing as sd

# UR5 shape close to the real robot (mm). The arm tubes sit beside the DH axis lines like on the robot:
# upper arm SHOULDER_OFFSET along the shoulder axis, forearm FOREARM_OFFSET, wrist 1 at d4.
SHOULDER_OFFSET = 135.85
FOREARM_OFFSET = 16.15          # 135.85 - 119.70
D1, D4, D5, D6 = 89.159, 109.15, 94.65, 82.3
R_BASE, R_SHOULDER, R_ELBOW, R_WRIST = 45.0, 45.0, 38.0, 32.0
R_UPPER, R_FORE = 31.0, 26.0    # arm tubes
TOOL_R = 14

# colours of the real parts
ALU = sd.Color.FromArgb(200, 202, 206)        # aluminium arm tubes
JOINT = sd.Color.FromArgb(92, 92, 98)         # dark grey joint bodies
CAP = sd.Color.FromArgb(150, 196, 200)        # light blue-green joint caps
BED = sd.Color.FromArgb(178, 180, 182)        # aluminium table
PLATE_COL = sd.Color.FromArgb(150, 152, 156)  # adapter plate under the robot
PRINT_COL = sd.Color.FromArgb(205, 228, 238)  # clear PETG
TRAVEL_COL = sd.Color.FromArgb(120, 200, 200, 210)
# Tool Mesh order: ring, nozzle, plate, heater, extruder, motor, housing
TOOL_COLS = [sd.Color.FromArgb(25, 25, 25), sd.Color.FromArgb(200, 150, 60), sd.Color.FromArgb(205, 165, 55),
             sd.Color.FromArgb(190, 140, 60), sd.Color.FromArgb(30, 30, 32), sd.Color.FromArgb(40, 40, 42),
             sd.Color.FromArgb(28, 28, 30)]
METALLIC = (ALU, CAP, TOOL_COLS[1], TOOL_COLS[2], TOOL_COLS[3])

BLUE = sd.Color.FromArgb(90, 110, 255)
PLAY_SECONDS = 40.0       # the whole path plays in about this time
STATE_KEY = "ur5_timeline"
PATH_KEY = "ur5_print_cache"


def cylinder(origin, axis, r, h, centred=True):
    axis = rg.Vector3d(axis)
    if not axis.Unitize() or h <= 0:
        return None
    start = origin - axis * (h / 2.0) if centred else rg.Point3d(origin)
    c = rg.Cylinder(rg.Circle(rg.Plane(start, axis), r), h)
    return rg.Mesh.CreateFromCylinder(c, 1, 32)


def along(pl, a, b, r):
    """Cylinder on the z axis of plane pl, from a to b (mm along z)."""
    return cylinder(pl.Origin + pl.ZAxis * a, pl.ZAxis, r, b - a, centred=False)


def tube(a, b, r):
    v = b - a
    return cylinder(a, v, r, v.Length, centred=False) if r > 0 and v.Length > 1 else None


def material(c):
    m = Rhino.Display.DisplayMaterial(c)
    if c in METALLIC:
        m.Shine = 0.8
        m.Specular = sd.Color.White
    return m


def robot_parts(pl):
    """(mesh, colour key, joint) for the UR5 in pose pl (base, frame 1..6, TCP).
    colour key: 'alu', 'joint' or 'cap'; joint = index used for the status colour."""
    p = []
    base, f1, f2, f3, f4, f5, f6 = pl[:7]
    so, fo = SHOULDER_OFFSET, FOREARM_OFFSET
    # base: flange ring + joint 1 column up to the shoulder
    p.append((along(base, 0, 12, 75), "joint", 0))
    p.append((along(base, 12, D1 + 25, R_BASE), "joint", 0))
    p.append((along(base, D1 + 25, D1 + 33, R_BASE - 2), "cap", 0))
    # shoulder (joint 2): housing along the shoulder axis, cap outside
    p.append((along(f1, -R_SHOULDER, so + 30, R_SHOULDER), "joint", 1))
    p.append((along(f1, so + 30, so + 38, R_SHOULDER - 2), "cap", 1))
    # upper arm
    p.append((tube(f1.Origin + f1.ZAxis * so, f2.Origin + f2.ZAxis * so, R_UPPER), "alu", 1))
    # elbow (joint 3)
    p.append((along(f2, fo - 28, so + 28, R_ELBOW), "joint", 2))
    p.append((along(f2, so + 28, so + 35, R_ELBOW - 2), "cap", 2))
    # forearm
    p.append((tube(f2.Origin + f2.ZAxis * fo, f3.Origin + f3.ZAxis * fo, R_FORE), "alu", 2))
    # wrist 1 (joint 4) on the forearm end, up to the wrist 2 axis
    p.append((along(f3, fo - 26, D4 + R_WRIST, R_WRIST), "joint", 3))
    p.append((along(f3, fo - 33, fo - 26, R_WRIST - 2), "cap", 3))
    # wrist 2 (joint 5)
    p.append((along(f4, -R_WRIST, D5 - 5, R_WRIST), "joint", 4))
    p.append((along(f4, -R_WRIST - 7, -R_WRIST, R_WRIST - 2), "cap", 4))
    # wrist 3 (joint 6) up to the tool flange
    p.append((along(f5, -R_WRIST, D6 - 8, R_WRIST), "joint", 5))
    p.append((along(f5, -R_WRIST - 7, -R_WRIST, R_WRIST - 2), "cap", 5))
    p.append((along(f5, D6 - 8, D6, 31.5), "alu", 5))           # tool flange
    return p


def polyline(points):
    """rg.Polyline from a python list (the list constructor is not picked reliably)."""
    pl = rg.Polyline()
    for p in points:
        pl.Add(p)
    return pl


def print_cache(Sim):
    """Printed polylines (start index, end index, polyline) and table size, made once per Sim."""
    cache = sc.sticky.get(PATH_KEY)
    if cache and cache[0] is Sim:
        return cache[1]
    pts, on = Sim.points, Sim.extruding or [True] * len(Sim.points)
    runs, start = [], None
    for i in range(1, len(pts) + 1):
        printing = i < len(pts) and on[i - 1] and on[i]
        if printing and start is None:
            start = i - 1
        elif not printing and start is not None:
            runs.append((start, i - 1))
            start = None
    lows = [pts[i].Z for i in range(len(pts)) if on[i]] or [p.Z for p in pts]
    bed_z = min(lows) - 1.0                     # nozzle prints about one layer above the table
    xs = [p.X for p in pts] + [0.0]
    ys = [p.Y for p in pts] + [0.0]
    table = rg.Box(rg.Plane.WorldXY, rg.Interval(min(xs) - 250, max(xs) + 250),
                   rg.Interval(min(ys) - 250, max(ys) + 250), rg.Interval(bed_z - 30, bed_z))
    lines = [polyline(pts[k] for k in range(a, b + 1)) for a, b in runs]
    data = {"runs": runs, "lines": lines, "bed_z": bed_z, "table": rg.Mesh.CreateFromBox(table, 1, 1, 1)}
    sc.sticky[PATH_KEY] = (Sim, data)
    return data


def as_int(value):
    """Slider values are System.Decimal: int() does not take them and Convert.ToDouble picks the
    SByte overload (overflow above 127), so go through the text."""
    return int(round(float(str(value).replace(",", "."))))


def as_decimal(value):
    return System.Decimal.Parse(str(int(value)))


def clock(seconds):
    s = int(round(seconds))
    return "{:d}:{:02d}".format(s // 60, s % 60)


# ---------- timeline (driven by the Index slider and the Play toggle, no mouse hooks) ----------
state = sc.sticky.setdefault(STATE_KEY, {"n": 1, "comp": None, "play": False})


def index_slider():
    comp = state.get("comp")
    if comp is None or comp.Params.Input.Count < 2:
        return None
    for s in comp.Params.Input[1].Sources:
        if isinstance(s, Grasshopper.Kernel.Special.GH_NumberSlider):
            return s
    return None


def _advance(doc):
    s = index_slider()
    if s is None or not state["play"]:
        return
    step = max(1, int(round(state["n"] / (PLAY_SECONDS * 25.0))))
    value = as_int(s.CurrentValue) + step
    if value >= state["n"] - 1:
        value, state["play"] = state["n"] - 1, False
    s.SetSliderValue(as_decimal(value))
    s.ExpireSolution(False)


def _fit_slider(doc):
    s = index_slider()
    if s is not None:
        s.Slider.Minimum = as_decimal(0)
        s.Slider.Maximum = as_decimal(max(state["n"] - 1, 1))
        s.Slider.DecimalPlaces = 0
        s.ExpireSolution(False)


class Script_Instance(Grasshopper.Kernel.GH_ScriptInstance):
    def __init__(self):
        self._draw, self._marks, self._hud = [], [], []
        self._bbox = rg.BoundingBox.Empty
        self._bar = None

    def RunScript(self,
            Sim,
            Index,
            ToolMesh: list[Rhino.Geometry.Mesh],
            Play: bool,
            Timeline: bool):
        self._show_bar = Timeline is not False      # not connected = shown
        try:
            return self._run(Sim, Index, ToolMesh, bool(Play))
        except Exception:
            import traceback
            ghenv.Component.AddRuntimeMessage(Grasshopper.Kernel.GH_RuntimeMessageLevel.Error, traceback.format_exc()[-600:])
            return None, None, None, None

    def _run(self, Sim, Index, ToolMesh, play):
        self._draw, self._marks, self._hud = [], [], []
        self._printed, self._todo = [], []
        self._bbox = rg.BoundingBox.Empty
        self._bar = None
        if Sim is None:
            return None, None, None, None
        colors = Sim.colors
        state["comp"] = ghenv.Component
        state["n"] = len(Sim)
        doc = ghenv.Component.OnPingDocument()
        s = index_slider()
        if s is not None and as_int(s.Slider.Maximum) != len(Sim) - 1:
            doc.ScheduleSolution(1, Grasshopper.Kernel.GH_Document.GH_ScheduleDelegate(_fit_slider))
        state["play"] = play
        if play and s is not None and as_int(s.CurrentValue) < len(Sim) - 1:
            doc.ScheduleSolution(40, Grasshopper.Kernel.GH_Document.GH_ScheduleDelegate(_advance))

        idx, shown, q, status, reachable = Sim.pose(int(round(float(Index or 0))))
        collisions = getattr(Sim, "collisions", {})
        robot, tcp = [], None
        cache = print_cache(Sim)
        hit = collisions.get(idx)
        hit_part = None               # index in Tool Mesh of the part that hits
        if hit and "tool mesh" in str(hit):
            try:
                hit_part = int(str(hit).split("tool mesh")[1].split()[0])
            except ValueError:
                hit_part = None
        if q is not None:
            pl = Sim.link_planes(q)   # base, frame 1..6, TCP
            parts = []                # (mesh, colour)
            look = {"alu": ALU, "joint": JOINT, "cap": CAP}
            for m, key, j in robot_parts(pl):
                st = status[j] if reachable else "limit"
                # natural colours; a joint with a problem shows its status colour
                c = look[key] if st == "ok" or key == "alu" else colors[st]
                parts.append((m, c))
            if ToolMesh:
                to_flange = rg.Transform.PlaneToPlane(rg.Plane.WorldXY, pl[6])
                for k, tm in enumerate(ToolMesh):
                    if tm is None:
                        continue
                    dup = tm.DuplicateMesh()
                    dup.Transform(to_flange)
                    c = TOOL_COLS[k] if k < len(TOOL_COLS) else JOINT
                    if hit and (hit_part is None or hit_part == k):
                        c = colors["collision"]
                    parts.append((dup, c))
            else:
                parts.append((tube(pl[6].Origin, pl[7].Origin, TOOL_R), JOINT))
            # adapter plate between the table and the robot base
            parts.append((cylinder(rg.Point3d(0, 0, cache["bed_z"]), rg.Vector3d.ZAxis, 90,
                                   max(-cache["bed_z"], 1), False), PLATE_COL))
            for m, c in parts:
                if m is None:
                    continue
                m.VertexColors.CreateMonotoneMesh(c)
                robot.append(m)
                self._draw.append((m, c))
                self._bbox = rg.BoundingBox.Union(self._bbox, m.GetBoundingBox(False))
            tcp = pl[7]
        self._draw.insert(0, (cache["table"], BED))
        self._bbox = rg.BoundingBox.Union(self._bbox, cache["table"].GetBoundingBox(False))

        # printed material up to the current index, the rest of the path faint
        self._printed, self._todo = [], []
        pts = Sim.points
        for (a, b), full in zip(cache["runs"], cache["lines"]):
            if a >= idx:
                self._todo.append(full)
            elif b <= idx:
                self._printed.append(full)
            else:
                self._printed.append(polyline(pts[k] for k in range(a, idx + 1)))
                self._todo.append(polyline(pts[k] for k in range(idx, b + 1)))
        self._marks = Sim.marks + [(Sim.points[idx], sd.Color.Black)]
        self._bbox = rg.BoundingBox.Union(self._bbox, Sim.bbox)

        # ----- text -----
        on = Sim.extruding[idx] if idx < len(Sim.extruding) else None
        layers = getattr(Sim, "layers", [])
        layer = "   height {:.1f} mm".format(Sim.points[idx].Z - cache["bed_z"])
        if idx < len(layers) and layers[-1] + 1 < len(Sim) / 5:   # real layers (not one per point)
            layer = "   layer {} / {}".format(layers[idx] + 1, layers[-1] + 1) + layer
        self._hud.append(("PATH SIM  " + Sim.name + layer + ("" if on is None else ("   extruder ON" if on else "   travel")),
                          sd.Color.FromArgb(0, 70, 200)))
        if idx in collisions:
            self._hud.append(("COLLISION: {}".format(collisions[idx]), colors["collision"]))
        if not reachable:
            self._hud.append(("UNREACHABLE  (showing index {})".format(shown), colors["limit"]))
        else:
            for j, (a, st) in enumerate(zip(q, status)):
                self._hud.append(("A{} {:9.2f}  {}".format(j + 1, a, "" if st == "ok" else st),
                                  sd.Color.Black if st == "ok" else colors[st]))
        bad = Sim.unreachable or Sim.flips or Sim.singular or collisions
        self._hud.append((Sim.summary(), colors["limit"] if bad else sd.Color.DimGray))

        # ----- timeline -----
        n = max(len(Sim) - 1, 1)
        marks = []
        for name, items in (("singular", Sim.singular), ("flip", Sim.flips), ("limit", Sim.unreachable),
                            ("collision", sorted(collisions))):
            marks += [(i / float(n), colors[name]) for i in items]
        times = getattr(Sim, "times", None)
        sub = "/ {}".format(n)
        if times:
            sub += "   ({} / {})".format(clock(times[idx]), clock(times[-1]))
        self._bar = (idx / float(n), idx, sub, marks, idx in collisions)

        worst = "limit" if not reachable else max(status, key=Sim.severity.index)
        if idx in collisions:
            worst = "collision"
        if worst != "ok":
            ghenv.Component.AddRuntimeMessage(Grasshopper.Kernel.GH_RuntimeMessageLevel.Remark,
                                              "index {}: {}".format(idx, worst))
        return robot, tcp, (q if reachable else []), ["A{} {}".format(j + 1, st) for j, st in enumerate(status)]

    # ---------- preview ----------
    def get_ClippingBox(self):
        return self._bbox

    def DrawViewportMeshes(self, args):
        for m, c in self._draw:
            args.Display.DrawMeshShaded(m, material(c))

    def DrawViewportWires(self, args):
        d = args.Display
        for run in getattr(self, "_todo", []):
            if run.Count > 1:
                d.DrawPolyline(run, TRAVEL_COL, 1)
        for run in getattr(self, "_printed", []):
            if run.Count > 1:
                d.DrawPolyline(run, PRINT_COL, 4)
        for p, c in self._marks:
            d.DrawPoint(p, Rhino.Display.PointStyle.RoundSimple, 3, c)
        if self._bar and getattr(self, "_show_bar", True):
            self._draw_timeline(args)
        y = 100
        for text, c in self._hud:
            d.Draw2dText(text, c, rg.Point2d(20, y), False, 15, "Consolas")
            y += 20

    def _draw_timeline(self, args):
        d = args.Display
        fraction, idx, sub, marks, hit = self._bar
        width = args.Viewport.Bounds.Width
        bx, by, bs = 20, 30, 30                            # play button
        x0, x1, y = bx + bs + 14, max(bx + bs + 200, width - 170), by + bs // 2

        # play / pause button
        d.Draw2dRectangle(sd.Rectangle(bx, by, bs, bs), BLUE, 2, sd.Color.FromArgb(40, 90, 110, 255))
        if state["play"]:
            for xx in (bx + 10, bx + 18):
                d.Draw2dLine(sd.PointF(xx, by + 8), sd.PointF(xx, by + bs - 8), BLUE, 4)
        else:
            for k in range(0, 13):                         # filled triangle from vertical lines
                h = 14 - k * 14.0 / 13
                d.Draw2dLine(sd.PointF(bx + 10 + k, y - h / 2), sd.PointF(bx + 10 + k, y + h / 2), BLUE, 1.5)
        # track, done part, problem ticks
        d.Draw2dLine(sd.PointF(x0, y), sd.PointF(x1, y), sd.Color.FromArgb(150, 90, 110, 255), 2)
        xi = x0 + (x1 - x0) * fraction
        d.Draw2dLine(sd.PointF(x0, y), sd.PointF(xi, y), BLUE, 4)
        for f, c in marks:
            xm = x0 + (x1 - x0) * f
            d.Draw2dLine(sd.PointF(xm, y + 5), sd.PointF(xm, y + 12), c, 1)
        # handle
        handle = sd.Color.FromArgb(255, 0, 0) if hit else BLUE
        d.Draw2dRectangle(sd.Rectangle(int(xi) - 5, y - 11, 10, 22), handle, 1, handle)
        # index and time
        d.Draw2dText(str(idx), handle, rg.Point2d(x1 + 14, by - 4), False, 26, "Arial")
        d.Draw2dText(sub, BLUE, rg.Point2d(x1 + 14, by + 24), False, 12, "Arial")
# ---------- end ur5_robot_pose ----------
# ---- group: EXPORT
# export: preview and save
# PrintPath= PrintPoint Combination
# (
# 1_compas frame,
# 2_layer_index,
# 3_speed(mm/s),
# 4_blend_radius(mm),
# 5_extruder_IO
# )
panel_18 = Panel("data/out_printpoints_weijiun.json")
save_3 = Button()
preview_4 = Preview(printpath=place_on_bed.printpath_on_bed)  # -> path, travel, planes
# ---------- preview_4: Python ----------
# r: compas
# venv: mas-2627
"""
Draw the printpath: path = the whole polyline, travel = extruder-off segments,
safety = extruder-off points, axes = small x and y axis of each frame.
"""
import Rhino.Geometry as rg
from compas_rhino.conversions import frame_to_rhino_plane, point_to_rhino

AXIS_LENGTH = 5.0  # mm

points = printpath.printpoints
planes = [frame_to_rhino_plane(printpoint.frame) for printpoint in points]

# ===== Whole path =====
polyline = rg.Polyline()
for plane in planes:
    polyline.Add(plane.Origin.X, plane.Origin.Y, plane.Origin.Z)
path = polyline.ToPolylineCurve()

# ===== Extruder off: a segment prints only if both of its points have the extruder on =====
safety = [point_to_rhino(printpoint.frame.point) for printpoint in points if not printpoint.is_extruder_on]
travel = []
for i in range(len(points) - 1):
    if not (points[i].is_extruder_on and points[i + 1].is_extruder_on):
        travel.append(rg.Line(planes[i].Origin, planes[i + 1].Origin))
# ---------- end preview_4 ----------
save_4 = Save(printpath=place_on_bed.printpath_on_bed, save=save_3, out_path=panel_18)  # -> status; same code as save_2
plane_2 = Plane(preview_4.planes)
curve_2 = Curve(preview_4.travel)
curve_3 = Curve(preview_4.path)
panel_19 = Panel(save_4)
point_list = PointList(Points=plane_2, Size=Slider(1, range=0..10))
preview_5 = CustomPreview(Geometry=curve_3, Material=ColourSwatch(SwatchColor=RGB(0, 170, 80)))
preview_6 = CustomPreview(Geometry=curve_2, Material=ColourSwatch(SwatchColor=RGB(230, 40, 40)))
polyline_3 = PolyLine(Vertices=plane_2, Closed=False)

# ---- group: IRB_2600_20165
irb2600_home_meshes = Mesh([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])  # disabled

# ----
# 透過10mm等分的數量 等分線段
mesh_2 = Mesh(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)
unit_z = UnitZ(Factor=1)
contour = Contour(Shape=mesh_2, Point=Point(0, 0, 0), Direction=unit_z, Distance="2")  # -> flatten(Contours)
division = Division(A=number_slider_2, B="2")
panel_20 = Panel(division)
join_curves = JoinCurves(Curves=contour, Preserve=False)
negative = Negative(Value=panel_20)
offset_curve = OffsetCurve(Curve=graft(join_curves), Distance=negative, Corners=1)  # -> simplify(flatten(Curve))
boundary_surfaces = BoundarySurfaces(Edges=offset_curve)

list_item_2 = ListItem(List=offset_curve, Index=0, Wrap=True)
align_curves = AlignCurves(Curves=offset_curve, Guide=list_item_2)

evaluate_length = EvaluateLength(Curve=align_curves, Length=Slider(0.1, range=0..0.1), Normalized=True)  # -> Point, Tangent, Parameter
vector_display = VectorDisplay(Anchor=evaluate_length.Point, Vector=evaluate_length.Tangent)

point_2 = Point(Point(1501.612882, 3537.419671, -1.37087664))
align_curve_seams = AlignCurveSeams(Curves=flatten(align_curves), Guide=point_2, Snap=False, Iterative=True)  # -> Aligned, Points, ResultBoolean
point_3 = Point(align_curve_seams.Points)

explode = Explode(Curve=align_curve_seams.Aligned, Recursive=True)  # -> flatten(Segments), Vertices
divide_length = DivideLength(Curve=graft(explode.Segments), Length="10")  # -> Points, Tangents, Parameters
list_length = ListLength(List=divide_length.Points)
divide_curve = DivideCurve(Curve=graft(explode.Segments), Count=list_length, Kinks=False)  # -> flatten(Points), Tangents, Parameters
cull_duplicates = CullDuplicates(Points=divide_curve.Points, Tolerance=0.1, CullMode=3)  # -> Points, Indices, Valence

flip_curve = FlipCurve(Curve=align_curve_seams.Aligned)  # -> Curve, Flag

point_list_2 = PointList(Points=cull_duplicates.Points, Size=Slider(1, range=0..10))
polyline_4 = PolyLine(Vertices=cull_duplicates.Points, Closed=False)

# ---- group: ② 新電池 (Python，取代 TACO)
panel_21 = Panel("1556.32,-951.12,-368.97")
panel_22 = Panel("1517.62,989.35,-360.76")
panel_23 = Panel("575.35,990.12,-365.06")
panel_24 = Panel("595.68,-963.48,-379.78")
沒有磁磚的高度 = Panel("200")
pln_3 = Plane(Plane(origin=(1143.177612, 56.72019577, -121.1006546), x=(0.9999674455, 0.007892070842, -0.001680227304), y=(0.007985649777, -0.9977942938, 0.06589974777)))  # disabled
panel_25 = Panel("0")  # disabled
number_slider_7 = Slider(50, range=0..100)  # disabled
number_slider_8 = Slider(100, range=0..100)  # disabled
panel_26 = Panel("WaitTime 1;")  # disabled
panel_27 = Panel("SetDO Local_IO_0_DO2,0;")  # disabled
panel_28 = Panel("WaitTime 4;")  # disabled
panel_29 = Panel("WaitTime 1;")  # disabled
panel_30 = Panel("SetDO Local_IO_0_DO2,1;")  # disabled
panel_31 = Panel("fine")  # disabled
panel_32 = Panel("100")  # disabled
Z = UnitZ(Factor=number_slider_7)  # disabled
Z_2 = UnitZ(Factor=number_slider_8)  # disabled
entwine = Entwine(Branch00=panel_26, Branch01=panel_27, FlattenInputs=True)  # -> flatten(Result); disabled
entwine_2 = Entwine(Branch00=panel_29, Branch01=panel_30, Branch02=panel_28, FlattenInputs=True)  # -> flatten(Result); disabled
panel_33 = Panel("WaitTime 1;")  # disabled
panel_34 = Panel("WaitTime 3;")  # disabled
run = Button()  # disabled
stop = Button()  # disabled

# ----
# 校正桌面
srf4pt = _4PointSurface(CornerA=panel_21, CornerB=panel_22, CornerC=panel_23, CornerD=panel_24)

# ---- group: ② 新電池 (Python，取代 TACO) / 加熱桌高度
沒有磁磚的高度_2 = Panel("-14.5")
Z_3 = UnitZ(Factor=沒有磁磚的高度)
move_2 = Move(Geometry=srf4pt, Motion=Z_3)  # -> Geometry, Transform

# ----
evalsrf = EvaluateSurface(Surface=reparameterize(srf4pt), Point=pt)  # -> Point, Normal, UDirection, VDirection, Frame
prot = RotatePlane(Plane=evalsrf.Frame, Angle=degrees(number_slider_4))
第一層提高 = Panel("2")
addition = Addition(A=第一層提高, B="2")

# ---- group: check Z axis
deplane = DeconstructPlane(Plane=prot)  # -> Origin, XAxis, YAxis, ZAxis
Z_4 = UnitZ(Factor=1)
dprod = DotProduct(VectorA=Z_4, VectorB=deplane.ZAxis, Unitize=False)
expression = Expression(x=dprod, Expression="if(x<0,True,False)")
pflip = FlipPlane(Plane=prot, ReverseX=False, ReverseY=False, SwapAxes=True)

# ----
filter = StreamFilter(Gate=expression, Stream0=prot, Stream1=pflip)
deplane_2 = DeconstructPlane(Plane=filter)  # -> Origin, XAxis, YAxis, ZAxis
amp = Amplitude(Vector=deplane_2.ZAxis, Amplitude=addition)
move_3 = Move(Geometry=filter, Motion=amp)  # -> Geometry, Transform

# ---- group: ② 新電池 (Python，取代 TACO) (continued)
orient = Orient(Geometry=xy, Source=item_5, Target=move_3.Geometry)  # -> Geometry, Transform
polyline_5 = PolyLine(Vertices=orient.Geometry, Closed=False)  # disabled
pl_origin = PlaneOrigin(Base=pln_3, Origin=orient.Geometry)  # disabled
rotate_2 = Rotate(Geometry=pl_origin, Angle=panel_25, Plane=pl_origin)  # -> Geometry, Transform; disabled
list_item_3 = ListItem(List=rotate_2.Geometry, Index=0, Wrap=True)  # -> Item1, Item; disabled
move_4 = Move(Geometry=list_item_3.Item1, Motion=Z)  # -> Geometry, Transform; disabled
move_5 = Move(Geometry=list_item_3.Item, Motion=Z_2)  # -> Geometry, Transform; disabled

# ---- group: ② 新電池 (Python，取代 TACO) / Construct TCP
tcp_builder = TCPBuilder(Plane=move_5.Geometry, Speed=panel_32, Zone=panel_31, Command=panel_34, E1="0")  # -> TCP; inputs Plane: list of Plane, Speed: list, Zone: list, Command: list, E1: list; disabled
# ---------- tcp_builder: Python ----------
#! python3
"""TCP Builder - replaces TACO Construct TCP.
Inputs are matched longest-list style (a shorter list repeats its last item),
like TACO / Grasshopper item matching: 1 plane + 3 commands = 3 targets.

Inputs
    Plane   : list of TCP planes in robot base coordinates
    Speed   : mm/s (100 -> v100) or speeddata name (v200 stays v200)
    Zone    : fine, 10 (-> z10) or zonedata name (z5 stays z5)
    Command : extra RAPID line written after the move (empty / NULL = none)
    E1      : external axis value

Output
    TCP     : list of TCP targets for Path Solver (merge several builders in order)
"""
import Grasshopper
import Rhino


class TcpTarget(object):
    """Plane + move settings. Path Solver reads these attributes."""
    __slots__ = ("plane", "speed", "zone", "cmd", "e1")

    def __init__(self, plane, speed, zone, cmd, e1):
        self.plane, self.speed, self.zone, self.cmd, self.e1 = plane, speed, zone, cmd, e1

    def __repr__(self):
        return "TCP {} {}{}".format(self.speed, self.zone, " +cmd" if self.cmd else "")


def _pick(lst, i, default):
    if not lst:
        return default
    v = lst[min(i, len(lst) - 1)]
    return default if v is None else v


class Script_Instance(Grasshopper.Kernel.GH_ScriptInstance):
    def RunScript(self,
            Plane: list[Rhino.Geometry.Plane],
            Speed: list[object],
            Zone: list[object],
            Command: list[object],
            E1: list[object]):
        planes = [p for p in (Plane or []) if p is not None]
        if not planes:
            return []
        # longest list: one plane with three commands gives three targets on that plane
        n = max([len(planes)] + [len(x) for x in (Speed, Zone, Command, E1) if x])
        out = []
        for i in range(n):
            pl = _pick(planes, i, None)
            cmd = str(_pick(Command, i, "")).strip()
            out.append(TcpTarget(pl,
                                 str(_pick(Speed, i, "100")).strip(),
                                 str(_pick(Zone, i, "fine")).strip(),
                                 "" if cmd.upper() in ("", "NULL", "NONE") else cmd,
                                 float(_pick(E1, i, 0) or 0)))
        return out
# ---------- end tcp_builder ----------

tcp_builder_2 = TCPBuilder(Plane=list_item_3.Item, Speed=panel_32, Zone=panel_31, Command=entwine_2, E1="0")  # -> TCP; inputs Plane: list of Plane, Speed: list, Zone: list, Command: list, E1: list; disabled; same code as tcp_builder

tcp_builder_3 = TCPBuilder(Plane=rotate_2.Geometry, Speed=panel_32, Zone="10", Command="NULL ", E1="0")  # -> TCP; inputs Plane: list of Plane, Speed: list, Zone: list, Command: list, E1: list; disabled; same code as tcp_builder

tcp_builder_4 = TCPBuilder(Plane=list_item_3.Item1, Speed=panel_32, Zone=panel_31, Command=panel_27, E1="0")  # -> TCP; inputs Plane: list of Plane, Speed: list, Zone: list, Command: list, E1: list; disabled; same code as tcp_builder

tcp_builder_5 = TCPBuilder(Plane=move_4.Geometry, Speed=panel_32, Zone=panel_31, Command=panel_33, E1="0")  # -> TCP; inputs Plane: list of Plane, Speed: list, Zone: list, Command: list, E1: list; disabled; same code as tcp_builder

# ----
number_slider_9 = Slider(12, range=0..180)  # disabled
_20260527中槍新tcp = Plane(Plane(origin=(-239, -410.9711, 197.6248), x=(0, 0, 1), y=(0.8644493132, -0.5027199865, 0)))  # disabled
_20260527中槍新模型 = Mesh(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)  # disabled
xy_plane = XYPlane(Origin=Point(0, 0, 0))  # disabled
mesh_3 = Mesh(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)  # disabled
plane_3 = Plane(Plane(origin=(-234.48, -412.72, 208.373), x=(0, 0, 1), y=(-0.8290384061, 0.5591916677, 0)))  # disabled
rotate_3 = Rotate(Geometry=mesh_3, Angle=degrees(number_slider_9), Plane=PlaneXY(0, 0, 0))  # -> Geometry, Transform; disabled
panel_35 = Panel("10")  # disabled

# ---- group: pln2euler
plane_convert = PlaneConvert(Plane=plane_3, Ref=xy_plane)  # -> Euler, Quat; inputs Plane: Plane, Ref: Plane; disabled
# ---------- plane_convert: Python ----------
#! python3
"""Plane Convert - replaces TACO pln2euler + plane2Quaternion.

Inputs
    Plane : plane to convert
    Ref   : reference plane (empty = World XY)

Outputs
    Euler : x, y, z, rx, ry, rz of Plane in Ref (Euler ZYX, deg, same as Tool Definition)
    Quat  : ABB quaternion q1..q4 (w, x, y, z) of Plane in Ref
"""
import math

import Grasshopper
import Rhino
import Rhino.Geometry as rg


class Script_Instance(Grasshopper.Kernel.GH_ScriptInstance):
    def RunScript(self, Plane: Rhino.Geometry.Plane, Ref: Rhino.Geometry.Plane):
        if Plane is None:
            return None, None
        ref = Ref if Ref is not None else rg.Plane.WorldXY
        pl = rg.Plane(Plane)
        pl.Transform(rg.Transform.PlaneToPlane(ref, rg.Plane.WorldXY))
        r00, r10, r20 = pl.XAxis.X, pl.XAxis.Y, pl.XAxis.Z
        r01, r11, r21 = pl.YAxis.X, pl.YAxis.Y, pl.YAxis.Z
        r22 = pl.ZAxis.Z
        ry = math.asin(max(-1.0, min(1.0, -r20)))
        if abs(r20) < 1 - 1e-9:
            rx, rz = math.atan2(r21, r22), math.atan2(r10, r00)
        else:  # gimbal lock: rx = 0
            rx, rz = 0.0, math.atan2(-r01, r11)
        euler = [pl.OriginX, pl.OriginY, pl.OriginZ] + [math.degrees(a) for a in (rx, ry, rz)]
        q = rg.Quaternion.Rotation(rg.Plane.WorldXY, pl)
        if q.A < 0:
            q = rg.Quaternion(-q.A, -q.B, -q.C, -q.D)
        return [round(v, 4) for v in euler], [q.A, q.B, q.C, q.D]
# ---------- end plane_convert ----------

# ----
panel_36 = Panel(plane_convert.Euler)  # disabled

# ---- group: Tool Definition
tool_definition_py = ToolDefinitionPy(TCP=panel_36, Geometry=rotate_3.Geometry, Weight=panel_35)  # -> Tool, Plane, ToolData; inputs TCP: list of Double, Geometry: Mesh, Weight: Double; disabled
# ---------- tool_definition_py: Python ----------
#! python3
"""Tool Definition - replaces TACO Tool Definition.

Inputs
    TCP      : x, y, z, rx, ry, rz of the TCP in the flange (tool0) frame, mm / deg,
               Euler ZYX like RobotStudio: R = Rz(rz) * Ry(ry) * Rx(rx)
    Geometry : tool mesh in the flange frame (tool axis = +Z), optional
    Weight   : tool mass in kg

Outputs
    Tool     : tool for Path Solver (TCP plane + mass + mesh)
    Plane    : TCP plane in the flange frame
    ToolData : RAPID tooldata declaration
"""
import math

import Grasshopper
import Rhino
import Rhino.Geometry as rg


class ToolDef(object):
    """Path Solver reads plane / quat / mass / mesh."""

    def __init__(self, plane, quat, mass, mesh):
        self.plane, self.quat, self.mass, self.mesh = plane, quat, mass, mesh

    def __repr__(self):
        return "Tool ({:g} kg)".format(self.mass)


def euler_zyx_plane(x, y, z, rx, ry, rz):
    a, b, c = math.radians(rx), math.radians(ry), math.radians(rz)
    ca, sa, cb, sb, cc, sc = math.cos(a), math.sin(a), math.cos(b), math.sin(b), math.cos(c), math.sin(c)
    # columns of Rz(c) * Ry(b) * Rx(a)
    xa = rg.Vector3d(cc * cb, sc * cb, -sb)
    ya = rg.Vector3d(cc * sb * sa - sc * ca, sc * sb * sa + cc * ca, cb * sa)
    return rg.Plane(rg.Point3d(x, y, z), xa, ya)


def euler_zyx_quat(rx, ry, rz):
    """ABB quaternion (w, x, y, z); half-angle form gives the same digits as TACO."""
    cr, sr = math.cos(math.radians(rx) / 2), math.sin(math.radians(rx) / 2)
    cp, sp = math.cos(math.radians(ry) / 2), math.sin(math.radians(ry) / 2)
    cy, sy = math.cos(math.radians(rz) / 2), math.sin(math.radians(rz) / 2)
    q = (cr * cp * cy + sr * sp * sy, sr * cp * cy - cr * sp * sy,
         cr * sp * cy + sr * cp * sy, cr * cp * sy - sr * sp * cy)
    return q if q[0] >= 0 else tuple(-v for v in q)


class Script_Instance(Grasshopper.Kernel.GH_ScriptInstance):
    def RunScript(self,
            TCP: list[float],
            Geometry: Rhino.Geometry.Mesh,
            Weight: float):
        v = list(TCP or [])
        if len(v) < 6:
            ghenv.Component.AddRuntimeMessage(Grasshopper.Kernel.GH_RuntimeMessageLevel.Warning,
                                              "TCP needs 6 numbers: x, y, z, rx, ry, rz")
            return None, None, None
        plane = euler_zyx_plane(*v[:6])
        quat = euler_zyx_quat(*v[3:6])
        mass = float(Weight) if Weight is not None else 10.0
        tool = ToolDef(plane, quat, mass, Geometry)
        tooldata = ("PERS tooldata custom_tool := [TRUE, [[{:.2f},{:.2f},{:.3f}], [{},{},{},{}]], "
                    "[{:g},[0.10,0.00,0.00],[1,0,0,0],0,0,0]];").format(plane.OriginX, plane.OriginY, plane.OriginZ,
                                                                    *(list(quat) + [mass]))
        return tool, plane, tooldata
# ---------- end tool_definition_py ----------

# ---- group: ② 新電池 (Python，取代 TACO) (continued)
merge_2 = Merge(Data1=tcp_builder, Data2=tcp_builder_2, Data3=tcp_builder_3, Data4=tcp_builder_4, Data5=tcp_builder_5)  # disabled

# ---- group: ② 新電池 (Python，取代 TACO) / Deconstruct TCP
tcp_tools = TCPTools(TCP=flatten(merge_2))  # -> TCP, Target, Speed, RAPID, Zone, E1; inputs TCP: list, Flip: Boolean; disabled
# ---------- tcp_tools: Python ----------
#! python3
"""TCP Tools - replaces TACO Flip TCP + Deconstruct TCP.

Inputs
    TCP  : TCP Builder targets (or plain planes)
    Flip : True = swap X and Y of every plane (Z turns around), like TACO Flip TCP

Outputs
    TCP           : the targets (flipped when Flip is True)
    Target        : planes
    Speed         : speed per target
    RAPID         : extra RAPID line per target (empty = none)
    Zone          : zone per target
    E1            : external axis value per target
"""
import Grasshopper
import Rhino
import Rhino.Geometry as rg


def flip_plane(pl):
    return rg.Plane(pl.Origin, pl.YAxis, pl.XAxis)


class Script_Instance(Grasshopper.Kernel.GH_ScriptInstance):
    def RunScript(self, TCP: list[object], Flip: bool):
        items = [t for t in (TCP or []) if t is not None]
        out = []
        for t in items:
            if hasattr(t, "plane"):
                if Flip:
                    t = type(t)(flip_plane(t.plane), t.speed, t.zone, t.cmd, t.e1)
            elif Flip:
                t = flip_plane(t)
            out.append(t)
        tcp = [t for t in out if hasattr(t, "plane")]
        planes = [t.plane if hasattr(t, "plane") else t for t in out]
        return (out, planes,
                [t.speed for t in tcp], [t.cmd for t in tcp], [t.zone for t in tcp], [t.e1 for t in tcp])
# ---------- end tcp_tools ----------

# ----
number_slider_10 = Slider(88, range=0..3419)  # disabled
boolean_toggle = BooleanToggle(True)  # disabled
button = Button()  # disabled

# ---- group: IK
path_solver = PathSolver(Targets=flatten(merge_2), Tool=tool_definition_py.Tool, Code=boolean_toggle)  # -> Sim, Joints, Reach, Path, Analysis, Info, RAPID; inputs Targets: list, Speed: list, Cmd: list, Zone: list, E1: list, Base: Plane, Seed: list, Code: Boolean; disabled
# ---------- path_solver: Python ----------
#! python3
"""Path Solver - IRB 2600-20/1.65
Same logic as TACO: TCP targets (robot base frame / WObj0) -> inverse kinematics
-> RAPID module (same format as TACO2). Does not depend on Index, so moving the
Index slider of Robot Pose never re-solves the path.

Inputs
    Targets : TCP Builder > TCP, or plain TCP planes in robot base coordinates
    Speed   : only for plain planes: mm/s (100 -> v100) or speeddata (Deconstruct TCP > Speed)
    Cmd     : only for plain planes: RAPID line after each move (Deconstruct TCP > RAPID)
    Zone    : only for plain planes: fine / 10 (-> z10) / z5 (Deconstruct TCP > Zone)
    E1      : only for plain planes: external axis value (Deconstruct TCP > E1)
    Tool    : Tool Definition > Tool, or a TCP plane in the flange frame. Empty = TACO custom_tool
    Base    : robot base plane in Rhino. Empty = World XY (same as TACO)
    Seed    : 6 joint values (deg) the first target should stay close to
    Code    : False = simulate only, no RAPID (like TACO IK Code). Empty = True

Outputs
    Sim      : solved path for Robot Pose
    Joints   : all joint values, one branch per target
    Reach    : True per target if a solution exists inside the joint limits
    Path     : polyline through all TCP positions
    Analysis : True if every target is reachable and there is no joint flip
    Info     : report
    RAPID    : RAPID module

Joint states (used by Robot Pose for colours)
    grey = ok, orange = near limit, red = at limit / unreachable,
    yellow = wrist singularity (axis 5 ~ 0), magenta = joint flip
"""
import math

import Grasshopper
import Rhino
import Rhino.Geometry as rg
import System.Drawing as sd
from ghpythonlib import treehelpers as th

# IRB 2600-20/1.65 (mm), home pose: all joints 0
D1, A1, A2, A3, D4, D6 = 445.0, 150.0, 700.0, 115.0, 795.0, 85.0
LIMITS = [(-180, 180), (-95, 155), (-180, 75), (-400, 400), (-120, 120), (-400, 400)]
FLIP_DEG = 30.0      # joint change between two targets reported as a flip ...
FLIP_DEG_PER_MM = 0.5  # ... when it is also large compared to the TCP travel (not a travel move)
NEAR_LIMIT_DEG = 10.0  # closer than this to a joint limit -> "near limit"
SINGULAR_DEG = 5.0     # |axis 5| below this -> wrist singularity
CONFDATA_LIKE_TACO = False  # True: write TACO's fixed [-1,0,01,0] instead of the real robconf

COLORS = {
    "ok": sd.Color.FromArgb(170, 170, 170),
    "near limit": sd.Color.FromArgb(255, 150, 0),
    "limit": sd.Color.FromArgb(230, 30, 30),
    "singular": sd.Color.FromArgb(255, 225, 0),
    "flip": sd.Color.FromArgb(220, 40, 220),
}
WIRE_COLOR = sd.Color.FromArgb(150, 0, 0)
SEVERITY = ["ok", "near limit", "singular", "flip", "limit"]

# TACO custom_tool
TOOL_XYZ = (-234.48, -412.72, 208.373)
TOOL_QUAT = (0.6243379406472045, 0.3319670704579113, -0.6243379406472045, 0.3319670704579113)

# joint axes at home pose: (point, direction)
AXES = [
    (rg.Point3d(0, 0, 0), rg.Vector3d.ZAxis),
    (rg.Point3d(A1, 0, D1), rg.Vector3d.YAxis),
    (rg.Point3d(A1, 0, D1 + A2), rg.Vector3d.YAxis),
    (rg.Point3d(0, 0, D1 + A2 + A3), rg.Vector3d.XAxis),
    (rg.Point3d(A1 + D4, 0, D1 + A2 + A3), rg.Vector3d.YAxis),
    (rg.Point3d(0, 0, D1 + A2 + A3), rg.Vector3d.XAxis),
]
# tool0 at home: x = -Z, y = +Y, z = +X
FLANGE_HOME = rg.Plane(rg.Point3d(A1 + D4 + D6, 0, D1 + A2 + A3), -rg.Vector3d.ZAxis, rg.Vector3d.YAxis)
WRIST_HOME = rg.Point3d(A1 + D4, 0, D1 + A2 + A3)
L3 = math.hypot(D4, A3)
PHI = math.atan2(D4, A3)


# ---------- geometry helpers ----------

def quat_plane(xyz, quat):
    w, x, y, z = quat
    n = math.sqrt(w * w + x * x + y * y + z * z)
    w, x, y, z = w / n, x / n, y / n, z / n
    xa = rg.Vector3d(1 - 2 * (y * y + z * z), 2 * (x * y + w * z), 2 * (x * z - w * y))
    ya = rg.Vector3d(2 * (x * y - w * z), 1 - 2 * (x * x + z * z), 2 * (y * z + w * x))
    return rg.Plane(rg.Point3d(*xyz), xa, ya)


def abb_quat(pl):
    q = rg.Quaternion.Rotation(rg.Plane.WorldXY, pl)
    if q.A < 0:
        q = rg.Quaternion(-q.A, -q.B, -q.C, -q.D)
    return q.A, q.B, q.C, q.D


def _rot(pl):
    return [[pl.XAxis.X, pl.YAxis.X, pl.ZAxis.X],
            [pl.XAxis.Y, pl.YAxis.Y, pl.ZAxis.Y],
            [pl.XAxis.Z, pl.YAxis.Z, pl.ZAxis.Z]]


def _mul(a, b):
    return [[sum(a[i][k] * b[k][j] for k in range(3)) for j in range(3)] for i in range(3)]


def _tr(a):
    return [[a[j][i] for j in range(3)] for i in range(3)]


def _rz(t):
    c, s = math.cos(t), math.sin(t)
    return [[c, -s, 0], [s, c, 0], [0, 0, 1]]


def _ry(t):
    c, s = math.cos(t), math.sin(t)
    return [[c, 0, s], [0, 1, 0], [-s, 0, c]]


R_HOME_T = _tr(_rot(FLANGE_HOME))


# ---------- kinematics ----------

def link_transforms(q):
    """Cumulative transform of link 1..6 for joints q (deg)."""
    xs, t = [], rg.Transform.Identity
    for (p, d), a in zip(AXES, q):
        t = t * rg.Transform.Rotation(math.radians(a), d, p)
        xs.append(t)
    return xs


def fk(q, tool):
    pl = rg.Plane(tool)
    pl.Transform(link_transforms(q)[-1] * rg.Transform.PlaneToPlane(rg.Plane.WorldXY, FLANGE_HOME))
    return pl


def flange_from_tcp(tcp, tool):
    pl = rg.Plane(rg.Plane.WorldXY)
    pl.Transform(rg.Transform.PlaneToPlane(rg.Plane.WorldXY, tcp) * rg.Transform.PlaneToPlane(tool, rg.Plane.WorldXY))
    return pl


def ik_all(flange):
    """All analytic solutions (deg, wrapped to [-180, 180)) for a flange plane."""
    w = flange.Origin - flange.ZAxis * D6
    rho = math.hypot(w.X, w.Y)
    s = w.Z - D1
    base = math.atan2(w.Y, w.X)
    sols = []
    for q1, r in ((base, rho - A1), (base + math.pi, -rho - A1)):
        c3 = (r * r + s * s - A2 * A2 - L3 * L3) / (2 * A2 * L3)
        if abs(c3) > 1:
            continue
        for e in (1, -1):
            q3 = e * math.acos(c3) - PHI
            px = D4 * math.cos(q3) + A3 * math.sin(q3)
            pz = A2 - D4 * math.sin(q3) + A3 * math.cos(q3)
            q2 = math.atan2(pz, px) - math.atan2(s, r)
            m = _mul(_mul(_tr(_mul(_rz(q1), _ry(q2 + q3))), _rot(flange)), R_HOME_T)
            cb = max(-1.0, min(1.0, m[0][0]))
            for f in (1, -1):
                q5 = f * math.acos(cb)
                if abs(math.sin(q5)) < 1e-9:  # wrist singularity: only q4 + q6 is defined
                    q4, q6 = 0.0, math.atan2(m[2][1], m[1][1])
                else:
                    q4 = math.atan2(f * m[1][0], -f * m[2][0])
                    q6 = math.atan2(f * m[0][1], f * m[0][2])
                sols.append([(math.degrees(v) + 180) % 360 - 180 for v in (q1, q2, q3, q4, q5, q6)])
    return sols


def _variants(sol):
    """Solution plus the +-360 turns of axis 4 and 6 that stay inside the limits."""
    out = []
    for d4 in (-360, 0, 360):
        for d6 in (-360, 0, 360):
            q = list(sol)
            q[3] += d4
            q[5] += d6
            if all(lo <= a <= hi for a, (lo, hi) in zip(q, LIMITS)):
                out.append(q)
    return out


def _cost(q, prev):
    return sum(w * (a - b) ** 2 for w, a, b in zip((1, 1, 1, 0.5, 0.5, 0.25), q, prev))


def solve_path(targets, tool, seed):
    """Joint values per target (None if unreachable), closest to the previous pose."""
    joints, prev = [], seed
    for tp in targets:
        cands = [v for s in ik_all(flange_from_tcp(tp, tool)) for v in _variants(s)]
        if not cands:
            joints.append(None)
            continue
        q = min(cands, key=lambda c: _cost(c, prev))
        joints.append(q)
        prev = q
    return joints


def confdata(q):
    """ABB robconf [cf1, cf4, cf6, cfx]."""
    xs = link_transforms(q)
    wrist = rg.Point3d(WRIST_HOME)
    wrist.Transform(xs[2])
    shoulder = rg.Point3d(A1, 0, D1)
    shoulder.Transform(xs[0])
    lower_arm = rg.Vector3d(rg.Vector3d.ZAxis)
    lower_arm.Transform(xs[1])
    fwd = rg.Vector3d(math.cos(math.radians(q[0])), math.sin(math.radians(q[0])), 0)
    behind_axis1 = wrist.X * fwd.X + wrist.Y * fwd.Y < 0
    v = wrist - shoulder
    behind_lower_arm = (v * fwd) * lower_arm.Z - v.Z * (lower_arm * fwd) < 0
    cfx = 4 * behind_axis1 + 2 * behind_lower_arm + (q[4] < 0)
    return [int(math.floor(q[0] / 90.0)), int(math.floor(q[3] / 90.0)), int(math.floor(q[5] / 90.0)), cfx]


def joint_status(q, prev_q, is_flip):
    """State of each joint: ok / near limit / limit / singular / flip."""
    out = []
    for j, (a, (lo, hi)) in enumerate(zip(q, LIMITS)):
        s = "ok"
        if min(a - lo, hi - a) < NEAR_LIMIT_DEG:
            s = "near limit"
        if j == 4 and abs(a) < SINGULAR_DEG:
            s = "singular"
        if is_flip and prev_q is not None and abs(a - prev_q[j]) > FLIP_DEG:
            s = "flip"
        if a <= lo or a >= hi:
            s = "limit"
        out.append(s)
    return out


# ---------- RAPID ----------

def _item(lst, i, default):
    if not lst:
        return default
    v = lst[min(i, len(lst) - 1)]
    v = "" if v is None else str(v).strip()
    return default if v in ("", "NULL", "None") else v


def _is_number(v):
    return v.replace(".", "", 1).isdigit()


def _speed(v):
    return "v" + v if _is_number(v) else v


def _zone(z):
    return "z" + z if _is_number(z) else z


def rapid_module(targets, joints, tool, tool_quat, mass, speed, extra, zone, e1):
    tq = tool_quat
    lines = [
        "! TACO Target Robot: T_ROB1",
        "MODULE TACO2",
        "PERS tooldata custom_tool := [TRUE, [[{:.2f},{:.2f},{:.3f}], [{},{},{},{}]], "
        "[{:g},[0.10,0.00,0.00],[1,0,0,0],0,0,0]];".format(tool.Origin.X, tool.Origin.Y, tool.Origin.Z,
                                                          *(list(tq) + [mass])),
        "PROC Main()",
        "ConfL \\Off;",
        "ConfJ \\Off;",
    ]
    for i, (tp, q) in enumerate(zip(targets, joints)):
        cf = ["-1", "0", "01", "0"] if CONFDATA_LIKE_TACO else (confdata(q) if q else [0, 0, 0, 0])
        lines.append(
            "MoveL [[{:.2f},{:.2f},{:.2f}],[{:.4f},{:.4f},{:.4f},{:.4f}],[{},{},{},{}],[{},9E9,9E9,9E9,9E9,9E9]],"
            "{},{},custom_tool\\WObj:=WObj0;".format(
                tp.Origin.X, tp.Origin.Y, tp.Origin.Z, *(list(abb_quat(tp)) + cf),
                _item(e1, i, "9E9"), _speed(_item(speed, i, "100")), _zone(_item(zone, i, "fine"))))
        x = _item(extra, i, "")
        if x:
            lines.append(x)
    lines += ["ENDPROC", "ENDMODULE"]
    return "\n".join(lines)


# ---------- solved path ----------

class Simulation(object):
    """Everything Robot Pose needs that does not depend on Index."""

    colors = COLORS
    wire_color = WIRE_COLOR
    severity = SEVERITY

    def __init__(self, targets, joints, tool, base, tool_mesh=None, e1=None):
        self.joints = joints
        self.tool = tool
        self.tool_mesh = tool_mesh  # in the flange frame
        self.e1 = e1 or []
        self.to_world = rg.Transform.PlaneToPlane(rg.Plane.WorldXY, base)
        self.points = []
        for t in targets:
            p = rg.Point3d(t.Origin)
            p.Transform(self.to_world)
            self.points.append(p)

        self.unreachable = [i for i, q in enumerate(joints) if q is None]
        self.flips, self.prev_of = [], {}
        last = None
        for i, q in enumerate(joints):
            if q is None:
                continue
            if last is not None:
                self.prev_of[i] = last
                dq = max(abs(a - b) for a, b in zip(q, joints[last]))
                if dq > FLIP_DEG and dq > FLIP_DEG_PER_MM * targets[i].Origin.DistanceTo(targets[last].Origin):
                    self.flips.append(i)
            last = i
        self.flip_set = set(self.flips)
        self.near = [i for i, q in enumerate(joints)
                     if q and any(min(a - lo, hi - a) < NEAR_LIMIT_DEG for a, (lo, hi) in zip(q, LIMITS))]
        self.singular = [i for i, q in enumerate(joints) if q and abs(q[4]) < SINGULAR_DEG]
        self.marks = ([(self.points[i], COLORS["limit"]) for i in self.unreachable[:2000]] +
                      [(self.points[i], COLORS["flip"]) for i in self.flips[:2000]])
        self.bbox = rg.BoundingBox(self.points)

    def __len__(self):
        return len(self.joints)

    def __repr__(self):
        return "Simulation ({} targets)".format(len(self.joints))

    def pose(self, index):
        """(index, shown index, joints, status per joint, reachable) for a target.
        An unreachable target shows the last reachable pose before it."""
        idx = max(0, min(int(index), len(self.joints) - 1))
        shown = next((k for k in range(idx, -1, -1) if self.joints[k] is not None),
                     next((k for k, j in enumerate(self.joints) if j is not None), None))
        if shown is None:
            return idx, None, None, ["limit"] * 6, False
        q = self.joints[shown]
        if shown != idx:
            return idx, shown, q, ["limit"] * 6, False
        prev_q = self.joints[self.prev_of[idx]] if idx in self.prev_of else None
        return idx, shown, q, joint_status(q, prev_q, idx in self.flip_set), True

    def link_transforms(self, q):
        return [self.to_world * x for x in link_transforms(q)]

    def tool_transform(self, q):
        """Flange frame -> world for joints q (to place the tool mesh)."""
        return self.to_world * link_transforms(q)[-1] * rg.Transform.PlaneToPlane(rg.Plane.WorldXY, FLANGE_HOME)

    def tcp(self, q):
        pl = fk(q, self.tool)
        pl.Transform(self.to_world)
        return pl

    def summary(self):
        return "path: {} unreachable, {} flips, {} near limit, {} singular".format(
            len(self.unreachable), len(self.flips), len(self.near), len(self.singular))


# ---------- component ----------

class Script_Instance(Grasshopper.Kernel.GH_ScriptInstance):
    def RunScript(self,
            Targets: list[object],
            Speed: list[object],
            Cmd: list[object],
            Zone: list[object],
            E1: list[object],
            Tool,
            Base: Rhino.Geometry.Plane,
            Seed: list[object],
            Code: bool):
        items = [t for t in (Targets or []) if t is not None]
        if not items:
            return [None] * 7
        if all(hasattr(t, "plane") for t in items):  # TCP Builder targets
            targets = [t.plane for t in items]
            speed, cmd, zone = [t.speed for t in items], [t.cmd for t in items], [t.zone for t in items]
            e1 = ["{:g}".format(t.e1) for t in items]
        else:
            targets, speed, cmd, zone, e1 = items, Speed, Cmd, Zone, E1

        if hasattr(Tool, "plane"):  # Tool Definition
            tool, tool_quat, mass, tool_mesh = Tool.plane, Tool.quat, Tool.mass, Tool.mesh
        elif isinstance(Tool, rg.Plane):
            tool, tool_quat, mass, tool_mesh = Tool, abb_quat(Tool), 10.0, None
        else:
            tool, tool_quat, mass, tool_mesh = quat_plane(TOOL_XYZ, TOOL_QUAT), TOOL_QUAT, 10.0, None
        base = Base if Base is not None else rg.Plane.WorldXY
        seed = list(Seed)[:6] if Seed and len(Seed) >= 6 else [0, 0, 0, 0, 30, 0]

        joints = solve_path(targets, tool, seed)
        code = rapid_module(targets, joints, tool, tool_quat, mass, speed, cmd, zone, e1) if Code is not False else None
        sim = Simulation(targets, joints, tool, base, tool_mesh, [_item(e1, i, "0") for i in range(len(targets))])

        info = [
            "targets: {}".format(len(targets)),
            "unreachable: {}{}".format(len(sim.unreachable), " " + str(sim.unreachable[:20]) if sim.unreachable else ""),
            "joint flips > {} deg: {}{}".format(FLIP_DEG, len(sim.flips), " " + str(sim.flips[:20]) if sim.flips else ""),
            "near limit (< {} deg): {}".format(NEAR_LIMIT_DEG, len(sim.near)),
            "wrist singular (|A5| < {} deg): {}".format(SINGULAR_DEG, len(sim.singular)),
            "RAPID: {}".format("off (Code = False)" if code is None else "{} lines".format(code.count("\n") + 1)),
        ]
        if sim.unreachable:
            ghenv.Component.AddRuntimeMessage(Grasshopper.Kernel.GH_RuntimeMessageLevel.Warning,
                                              "{} target(s) unreachable".format(len(sim.unreachable)))
        if sim.flips:
            ghenv.Component.AddRuntimeMessage(Grasshopper.Kernel.GH_RuntimeMessageLevel.Remark,
                                              "{} joint flip(s) > {} deg".format(len(sim.flips), FLIP_DEG))

        joint_tree = th.list_to_tree([j if j is not None else [] for j in joints])
        reach = [j is not None for j in joints]
        path = rg.Polyline(sim.points).ToPolylineCurve() if len(sim.points) > 1 else None
        analysis = not sim.unreachable and not sim.flips
        return sim, joint_tree, reach, path, analysis, "\n".join(info), code
# ---------- end path_solver ----------

# ---- group: Display Robot
robot_pose = RobotPose(Sim=path_solver.Sim, Meshes=irb2600_home_meshes, Index=number_slider_10)  # -> Robot, TCP, Axis, AxisText, Status; inputs Meshes: list of Mesh, Index: Int32; disabled
# ---------- robot_pose: Python ----------
#! python3
"""Robot Pose - shows the Path Solver result at one target. Only this component
runs when the Index slider moves.

Inputs
    Sim    : Path Solver > Sim
    Meshes : robot meshes in home pose: base, link1..link6, then tool mesh(es).
             If Path Solver got a Tool Definition with Geometry, that tool mesh is
             used and meshes after link6 are ignored.
    Index  : target to display

Outputs
    Robot    : meshes posed at Index, vertex-coloured by joint status
    TCP      : TCP plane at Index
    Axis     : 6 joint values at Index (deg)
    AxisText : TACO Display Robot format "a1;a2;a3;a4;a5;a6;e1;e2;reachable"
    Status   : joint states at Index

Preview (TACO style): grey robot with mesh edges, each link coloured by the state
of its joint, joint values top-left, unreachable (red) / flip (magenta) targets on
the path.
"""
import Grasshopper
import Rhino
import Rhino.Geometry as rg
import System.Drawing as sd


class Script_Instance(Grasshopper.Kernel.GH_ScriptInstance):
    def __init__(self):
        self._draw = []   # (mesh, colour)
        self._marks = []  # (point, colour)
        self._hud = []    # (text, colour)
        self._bbox = rg.BoundingBox.Empty
        self._wire = sd.Color.Black

    def RunScript(self, Sim, Meshes: list[Rhino.Geometry.Mesh], Index: int):
        self._draw, self._marks, self._hud = [], [], []
        self._bbox = rg.BoundingBox.Empty
        if Sim is None:
            return None, None, None, None, None
        colors = Sim.colors
        self._wire = Sim.wire_color

        idx, shown, q, status, reachable = Sim.pose(Index or 0)
        robot, tcp = [], None
        if q is not None:
            xs = Sim.link_transforms(q)
            meshes = [(m, Sim.to_world if i == 0 else xs[min(i, 6) - 1]) for i, m in enumerate(Meshes or [])]
            if Sim.tool_mesh is not None:
                meshes = meshes[:7] + [(Sim.tool_mesh, Sim.tool_transform(q))]
            for i, (m, xf) in enumerate(meshes):
                if m is None:
                    continue
                dup = m.DuplicateMesh()
                dup.Transform(xf)
                colour = colors["ok"] if i == 0 and reachable else colors[status[min(max(i, 1), 6) - 1]]
                dup.VertexColors.CreateMonotoneMesh(colour)
                robot.append(dup)
                self._draw.append((dup, colour))
                self._bbox = rg.BoundingBox.Union(self._bbox, dup.GetBoundingBox(False))
            tcp = Sim.tcp(q)

        self._marks = Sim.marks + [(Sim.points[idx], sd.Color.Black)]
        self._bbox = rg.BoundingBox.Union(self._bbox, Sim.bbox)

        self._hud.append(("PATH SIM  IRB 2600-20/1.65", sd.Color.FromArgb(0, 70, 200)))
        self._hud.append(("index {} / {}".format(idx, len(Sim) - 1), sd.Color.Black))
        if not reachable:
            self._hud.append(("UNREACHABLE  (showing index {})".format(shown), colors["limit"]))
        else:
            for j, (a, s) in enumerate(zip(q, status)):
                self._hud.append(("A{} {:9.2f}  {}".format(j + 1, a, "" if s == "ok" else s),
                                  sd.Color.Black if s == "ok" else colors[s]))
        bad = Sim.unreachable or Sim.flips
        self._hud.append((Sim.summary(), colors["limit"] if bad else sd.Color.DimGray))

        worst = "limit" if not reachable else max(status, key=Sim.severity.index)
        if worst != "ok":
            ghenv.Component.AddRuntimeMessage(Grasshopper.Kernel.GH_RuntimeMessageLevel.Remark,
                                              "index {}: {}".format(idx, worst))
        axis = q if reachable else []
        e1 = Sim.e1[idx] if idx < len(Sim.e1) else "0"
        axis_text = ";".join(["{:.2f}".format(a) for a in (q or [0] * 6)] + [str(e1), "0", str(bool(reachable)).lower()])
        status_text = ["A{} {}".format(j + 1, s) for j, s in enumerate(status)]
        return robot, tcp, axis, axis_text, status_text

    # ---------- preview ----------

    def get_ClippingBox(self):
        return self._bbox

    def DrawViewportMeshes(self, args):
        for m, c in self._draw:
            args.Display.DrawMeshShaded(m, Rhino.Display.DisplayMaterial(c))

    def DrawViewportWires(self, args):
        for m, c in self._draw:
            args.Display.DrawMeshWires(m, self._wire)
        for p, c in self._marks:
            args.Display.DrawPoint(p, Rhino.Display.PointStyle.RoundSimple, 7, c)
        y = 90
        for text, c in self._hud:
            args.Display.Draw2dText(text, c, rg.Point2d(20, y), False, 15, "Consolas")
            y += 20
# ---------- end robot_pose ----------

# ---- group: ② 新電池 (Python，取代 TACO) (continued)
polyline_6 = PolyLine(Vertices=tcp_tools.Target, Closed=False)  # disabled
index_hud = IndexHUD(Index=number_slider_10, Sim=path_solver.Sim)  # -> Info; inputs Index: Int32, Duration: Double, Color: Color; disabled
# ---------- index_hud: Python ----------
#! python3
"""Index HUD - playback bar in the Rhino viewport for the Index slider (like TACO SliderHUD).

In the viewport: click the play button to play / pause, click or drag on the bar to jump.

Inputs
    Index    : connect the Index slider (the same slider that drives Robot Pose)
    Sim      : Path Solver > Sim (optional) - the slider range follows the number of targets
    Duration : seconds to play the whole path (empty = 30)
    Color    : bar colour (empty = blue)

Output
    Info     : state of the HUD
"""
import Grasshopper
import Rhino
import System
import System.Drawing as sd
import Eto.Forms as ef
import scriptcontext as sc

KEY = "index_hud_"
FPS = 30.0
BOTTOM_OFFSET = 95  # px above the viewport bottom, clear of the TACO SliderHUD bar


def _value(slider):
    return int(round(float(str(slider.CurrentValue))))


def _range(slider):
    return int(round(float(str(slider.Slider.Minimum)))), int(round(float(str(slider.Slider.Maximum))))


class HudMouse(Rhino.UI.MouseCallback):
    def __init__(self, hud):
        super().__init__()
        self.hud = hud

    def OnMouseDown(self, e):
        if e.MouseButton == Rhino.UI.MouseButton.Left and self.hud.mouse_down(e.View.ActiveViewport, e.ViewportPoint):
            e.Cancel = True

    def OnMouseMove(self, e):
        if self.hud.dragging:
            self.hud.jump_to(e.View.ActiveViewport, e.ViewportPoint.X)
            e.Cancel = True

    def OnMouseUp(self, e):
        if self.hud.dragging:
            self.hud.dragging = False
            e.Cancel = True


class SliderHud(Rhino.Display.DisplayConduit):
    def __init__(self):
        super().__init__()
        self.comp = None
        self.slider = None
        self.colour = sd.Color.FromArgb(90, 110, 255)
        self.duration = 30.0
        self.playing = False
        self.dragging = False
        self.play_start, self.play_from = System.DateTime.Now, 0
        self.mouse = HudMouse(self)
        self.timer = ef.UITimer()
        self.timer.Interval = 1.0 / FPS
        self.timer.Elapsed += self._tick

    # ---------- state ----------

    def bind(self, comp, slider, duration, colour):
        self.comp, self.slider = comp, slider
        self.duration = duration if duration and duration > 0 else 30.0
        self.colour = colour if colour is not None and not colour.IsEmpty else sd.Color.FromArgb(90, 110, 255)
        self.Enabled = True
        self.mouse.Enabled = True
        if not self.timer.Started:
            self.timer.Start()

    def shutdown(self):
        self.playing = self.dragging = False
        try:
            self.timer.Stop()
        except Exception:
            pass
        self.mouse.Enabled = False
        self.Enabled = False
        Rhino.RhinoDoc.ActiveDoc.Views.Redraw()

    def alive(self):
        ok = (self.comp is not None and self.slider is not None and self.comp.OnPingDocument() is not None
              and not self.comp.Locked and self.slider.OnPingDocument() is not None)
        if not ok:
            self.shutdown()
        return ok

    def set_value(self, v):
        lo, hi = _range(self.slider)
        v = max(lo, min(hi, int(v)))
        if v != _value(self.slider):
            self.slider.SetSliderValue(System.Decimal(v))
            self.slider.ExpireSolution(True)

    # ---------- layout / drawing ----------

    def layout(self, vp):
        b = vp.Bounds
        y = b.Bottom - BOTTOM_OFFSET
        play = sd.Rectangle(b.Left + 16, y - 15, 30, 30)
        return play, b.Left + 64, b.Right - 110, y

    def DrawForeground(self, e):
        if not self.alive():
            return
        play, x0, x1, y = self.layout(e.Viewport)
        lo, hi = _range(self.slider)
        v = _value(self.slider)
        t = 0.0 if hi <= lo else (v - lo) / float(hi - lo)
        hx = int(x0 + t * (x1 - x0))
        d = e.Display
        faint = sd.Color.FromArgb(110, self.colour)
        d.Draw2dLine(sd.Point(x0, y), sd.Point(x1, y), faint, 3)
        d.Draw2dLine(sd.Point(x0, y), sd.Point(hx, y), self.colour, 5)
        d.Draw2dRectangle(sd.Rectangle(hx - 5, y - 11, 10, 22), self.colour, 1, self.colour)
        d.Draw2dRectangle(play, self.colour, 2, sd.Color.FromArgb(40, self.colour))
        d.Draw2dText("❚❚" if self.playing else "▶", self.colour,
                     Rhino.Geometry.Point2d(play.Left + play.Width / 2.0, play.Top + play.Height / 2.0), True, 18)
        d.Draw2dText(str(v), self.colour, Rhino.Geometry.Point2d(x1 + 14, y - 14), False, 22)
        d.Draw2dText("/ {}  ({:g}s)".format(hi, self.duration), self.colour, Rhino.Geometry.Point2d(x1 + 14, y + 10), False, 11)

    # ---------- interaction ----------

    def mouse_down(self, vp, pt):
        if not self.alive():
            return False
        play, x0, x1, y = self.layout(vp)
        if play.Contains(pt):
            lo, hi = _range(self.slider)
            if not self.playing and _value(self.slider) >= hi:
                self.set_value(lo)  # restart from the beginning
            self.playing = not self.playing
            self.play_start, self.play_from = System.DateTime.Now, _value(self.slider)
            Rhino.RhinoDoc.ActiveDoc.Views.Redraw()
            return True
        if x0 - 8 <= pt.X <= x1 + 8 and abs(pt.Y - y) <= 14:
            self.playing = False
            self.dragging = True
            self.jump_to(vp, pt.X)
            return True
        return False

    def jump_to(self, vp, x):
        _play, x0, x1, _y = self.layout(vp)
        lo, hi = _range(self.slider)
        t = min(1.0, max(0.0, (x - x0) / float(max(1, x1 - x0))))
        self.set_value(round(lo + t * (hi - lo)))

    def _tick(self, sender, e):
        if not self.playing or not self.alive():
            return
        # position from elapsed time, so the whole path takes Duration seconds however slow redraws are
        lo, hi = _range(self.slider)
        elapsed = (System.DateTime.Now - self.play_start).TotalSeconds
        v = self.play_from + int(elapsed / self.duration * (hi - lo))
        if v >= hi:
            v, self.playing = hi, False
        self.set_value(v)


def _fit_slider(slider, last):
    """Slider range follows the path length (done after the solution, not during it)."""
    def fit(doc):
        slider.Slider.Maximum = System.Decimal(last)
        if _value(slider) > last:
            slider.SetSliderValue(System.Decimal(last))
        slider.ExpireSolution(False)
    return fit


class Script_Instance(Grasshopper.Kernel.GH_ScriptInstance):
    def RunScript(self,
            Index: int,
            Sim,
            Duration: float,
            Color: System.Drawing.Color):
        comp = ghenv.Component
        sliders = [s for s in comp.Params.Input[0].Sources if isinstance(s, Grasshopper.Kernel.Special.GH_NumberSlider)]
        key = KEY + str(comp.InstanceGuid)
        hud = sc.sticky.get(key)
        if hud is not None and type(hud) is not SliderHud:  # left over from an older version of this script
            try:
                hud.shutdown()
            except Exception:
                pass
            hud = None
        if not sliders:
            if hud is not None:
                hud.shutdown()
            return "connect the Index slider to Index"
        if hud is None:
            hud = SliderHud()
            sc.sticky[key] = hud
        slider = sliders[0]
        hud.bind(comp, slider, Duration, Color)

        if Sim is not None and len(Sim) > 0:
            lo, hi = _range(slider)
            if hi != len(Sim) - 1:
                comp.OnPingDocument().ScheduleSolution(
                    5, Grasshopper.Kernel.GH_Document.GH_ScheduleDelegate(_fit_slider(slider, len(Sim) - 1)))
        lo, hi = _range(slider)
        return "HUD on: slider '{}' {}..{}, {:g}s for the whole path".format(slider.NickName, lo, hi, hud.duration)
# ---------- end index_hud ----------
robot_colour_preview = RobotColourPreview(Robot=robot_pose.Robot)  # -> Count; inputs Robot: list of Mesh; disabled
# ---------- robot_colour_preview: Python ----------
#! python3
"""Robot Colour Preview
Draws the Path Simulator robot shaded in its joint-status colours, without mesh edges.
Robot : Path Simulator > Robot (vertex-coloured meshes)
Count : number of meshes drawn
"""
import Grasshopper
import Rhino
import Rhino.Geometry as rg


class Script_Instance(Grasshopper.Kernel.GH_ScriptInstance):
    def __init__(self):
        self._draw = []
        self._bbox = rg.BoundingBox.Empty

    def RunScript(self, Robot: list[Rhino.Geometry.Mesh]):
        self._draw = []
        self._bbox = rg.BoundingBox.Empty
        for m in Robot or []:
            if m is None or m.VertexColors.Count == 0:
                continue
            self._draw.append((m, Rhino.Display.DisplayMaterial(m.VertexColors[0])))
            self._bbox = rg.BoundingBox.Union(self._bbox, m.GetBoundingBox(False))
        return len(self._draw)

    def get_ClippingBox(self):
        return self._bbox

    def DrawViewportMeshes(self, args):
        for m, mat in self._draw:
            args.Display.DrawMeshShaded(m, mat)
# ---------- end robot_colour_preview ----------

# ---- group: ABB IRC5 Stream
irc5_upload = IRC5Upload(RAPID=path_solver.RAPID, Upload=button, Run=run, Stop=stop)  # -> Info, Controllers; inputs Controller: String, RAPID: String, Task: String, Upload: Boolean, Run: Boolean, Stop: Boolean; disabled
# ---------- irc5_upload: Python ----------
#! python3
"""IRC5 Upload - replaces the TACO IRC5 Stream cluster (Taco2.dll), using the ABB PC SDK.
Unlike TACO it does not clear the controller event log, so it does not need that grant.

Inputs
    Controller : system name or IP (empty = first controller found on the network)
    RAPID      : RAPID module text (Path Solver > RAPID)
    Task       : RAPID task (empty = T_ROB1)
    Upload     : True = load the module into the task (replaces a module with the same name)
    Run        : True = start RAPID from main (controller in Auto, motors on)
    Stop       : True = stop RAPID

Outputs
    Info        : log of the last action
    Controllers : controllers found on the network
"""
import os
import re
import tempfile

import clr
import Grasshopper

SDK = os.path.expandvars(r"%APPDATA%\Grasshopper\UserObjects\ABB.Robotics.Controllers.PC.dll")
clr.AddReference(SDK)
from ABB.Robotics.Controllers import ControllerFactory, Mastership, UserInfo  # noqa: E402
from ABB.Robotics.Controllers.Discovery import NetworkScanner  # noqa: E402
from ABB.Robotics.Controllers.RapidDomain import ExecutionMode, RapidLoadMode, RegainMode, StopMode  # noqa: E402


def scan():
    s = NetworkScanner()
    s.Scan()
    return list(s.Controllers)


def pick(infos, name):
    if not infos:
        raise RuntimeError("no controller found (network cable / RobotStudio virtual controller running?)")
    if not name:
        if len(infos) > 1:  # never guess which robot gets the program
            raise RuntimeError("{} controllers found ({}): set Controller to the system name".format(
                len(infos), ", ".join(i.SystemName for i in infos)))
        return infos[0]
    for i in infos:
        if name in (i.SystemName, str(i.IPAddress), i.ControllerName):
            return i
    raise RuntimeError("controller '{}' not found".format(name))


def connect(info):
    c = ControllerFactory.CreateFrom(info)
    c.Logon(UserInfo.DefaultUser)
    return c


def upload(c, task_name, code, log):
    m = re.search(r"^\s*MODULE\s+(\w+)", code, re.M)
    module = m.group(1) if m else "TACO2"
    local = os.path.join(tempfile.gettempdir(), module + ".mod")
    with open(local, "w", newline="\r\n") as f:
        f.write(code)
    remote = module + ".mod"
    c.FileSystem.PutFile(local, remote, True)
    log.append("copied {} ({} lines) to {}".format(remote, code.count("\n") + 1, c.FileSystem.RemoteDirectory))
    with Mastership.Request(c.Rapid):
        task = c.Rapid.GetTask(task_name)
        task.LoadModuleFromFile(c.FileSystem.RemoteDirectory + "/" + remote, RapidLoadMode.Replace)
        task.ResetProgramPointer()
    log.append("loaded module {} into {}, program pointer to main".format(module, task_name))


def run(c, log):
    with Mastership.Request(c.Rapid):
        c.Rapid.Start(RegainMode.Continue, ExecutionMode.Continuous)
    log.append("RAPID started")


def stop(c, log):
    with Mastership.Request(c.Rapid):
        c.Rapid.Stop(StopMode.Immediate)
    log.append("RAPID stopped")


class Script_Instance(Grasshopper.Kernel.GH_ScriptInstance):
    def RunScript(self,
            Controller: str,
            RAPID: str,
            Task: str,
            Upload: bool,
            Run: bool,
            Stop: bool):
        log = []
        try:
            infos = scan()
        except Exception as ex:
            return "scan failed: {}".format(ex), []
        found = ["{} ({}){}".format(i.SystemName, i.IPAddress, " virtual" if i.IsVirtual else "") for i in infos]
        if not (Upload or Run or Stop):
            return "idle - press Upload / Run / Stop", found

        c = None
        try:
            info = pick(infos, (Controller or "").strip())
            c = connect(info)
            log.append("connected to {} ({}), mode {}, state {}".format(
                info.SystemName, info.IPAddress, c.OperatingMode, c.State))
            if Stop:
                stop(c, log)
            if Upload:
                if not RAPID:
                    raise RuntimeError("RAPID is empty (Path Solver Code = False?)")
                upload(c, (Task or "T_ROB1").strip(), RAPID, log)
            if Run:
                run(c, log)
        except Exception as ex:
            log.append("ERROR: {}".format(ex))
            ghenv.Component.AddRuntimeMessage(Grasshopper.Kernel.GH_RuntimeMessageLevel.Warning, str(ex)[:200])
        finally:
            if c is not None:
                try:
                    c.Logoff()
                finally:
                    c.Dispose()
        return "\n".join(log), found
# ---------- end irc5_upload ----------

# ----
panel_37 = Panel(path_solver.Analysis)  # disabled
panel_38 = Panel(irc5_upload.Info)  # disabled

# ==== cluster Cluster
first_layer_lift = Panel("1.3")
S = ClusterInput()
uv = ClusterInput()
first_layer_lift_2 = ClusterInput()
evalsrf = EvaluateSurface(Surface=reparameterize(S), Point=uv)  # -> Point, Normal, UDirection, VDirection, Frame
A = ClusterInput()
prot = RotatePlane(Plane=evalsrf.Frame, Angle=degrees(A))
deplane = DeconstructPlane(Plane=prot)  # -> Origin, XAxis, YAxis, ZAxis
Z = UnitZ(Factor=1)
dprod = DotProduct(VectorA=Z, VectorB=deplane.ZAxis, Unitize=False)
expression = Expression(x=dprod, Expression="if(x<0,True,False)")
pflip = FlipPlane(Plane=prot, ReverseX=False, ReverseY=False, SwapAxes=True)
filter = StreamFilter(Gate=expression, Stream0=prot, Stream1=pflip)
deplane_2 = DeconstructPlane(Plane=filter)  # -> Origin, XAxis, YAxis, ZAxis
amp = Amplitude(Vector=deplane_2.ZAxis, First_layer_lift=first_layer_lift_2)
move = Move(Geometry=filter, Motion=amp)  # -> Geometry, Transform
G = ClusterOutput(move.Geometry)

# ==== cluster Cluster_2
A = ClusterInput()
B = ClusterInput()
B_2 = ClusterInput()
B_3 = ClusterInput()
B_4 = ClusterInput()
B_5 = ClusterInput()
B_6 = ClusterInput()
B_7 = ClusterInput()
B_8 = ClusterInput()
B_9 = ClusterInput()
B_10 = ClusterInput()
B_11 = ClusterInput()
B_12 = ClusterInput()

# ---- group: ③ 一圈的角度: 2pi*R/spacing 點, angles 0~2pi
_2_pi = Pi(Factor=2)
multiplication = Multiplication(A=_2_pi, B=B_4)
division = Division(A=multiplication, B=B_5)
round = Round(Number=division)  # -> Nearest, Floor, Ceiling
angles = Range(Domain=_2_pi, Steps=round.Nearest)

# ---- group: ② 層數 + 每層波幅: layer index, base z = i*h, layer amp = wave_amp*i/last
division_2 = Division(A=A, B=B)
round_2 = Round(Number=division_2)  # -> Nearest, Floor, Ceiling
layer_index = Series(Start=0, Step=1, Count=round_2.Floor)
last_layer = Subtraction(A=round_2.Floor, B=1)
base_z = Multiplication(A=layer_index, B=B_2)
multiplication_2 = Multiplication(A=layer_index, B=B_3)
layer_amp = Division(A=multiplication_2, B=last_layer)

# ---- group: ④ 波浪高度: z = base z + layer amp*sin(freq*angle) + fine z
multiplication_3 = Multiplication(A=angles, B=B_6)
sin = Sine(Value=multiplication_3)
wave = Multiplication(A=graft(layer_amp), B=sin)
z = Addition(A=graft(base_z), B=wave)
addition = Addition(A=z, B=B_7)

# ---- group: ⑤ 圓周位置: x = R cos + cx, y = R sin + cy
cos = Cosine(Value=angles)
sin_2 = Sine(Value=angles)
multiplication_4 = Multiplication(A=cos, B=B_8)
multiplication_5 = Multiplication(A=sin_2, B=B_10)
x = Addition(A=multiplication_4, B=B_9)
y = Addition(A=multiplication_5, B=B_11)

# ---- group: ⑥ 點 + 每層曲線 (layers)
points = ConstructPoint(XCoordinate=x, YCoordinate=y, ZCoordinate=addition)
layers = PolyLine(Vertices=points, Closed=False)  # -> flatten(Polyline)

# ---- group: ⑦ 傾斜平面: nozzle axis = 垂直層面的法線 (tilt factor 混合), X 對齊 -X
tilt_factor_0_flat_1_normal = Slider(1, range=0..1)
cos_2 = Cosine(Value=multiplication_3)
multiplication_6 = Multiplication(A=cos_2, B=B_12)
slope_z = Multiplication(A=graft(layer_amp), B=multiplication_6)
neg = Negative(Value=multiplication_5)
_1_tilt = Subtraction(A=1, B=tilt_factor_0_flat_1_normal)
tangent = VectorXYZ(XComponent=neg, YComponent=multiplication_4, ZComponent=slope_z)  # -> Vector, Length
radial = VectorXYZ(XComponent=cos, YComponent=sin_2, ZComponent=0)  # -> Vector, Length
Z = UnitZ(Factor=-1)
layer_normal_down = CrossProduct(VectorA=tangent.Vector, VectorB=radial.Vector, Unitize=True)  # -> Vector, Length
multiplication_7 = Multiplication(A=Z, B=_1_tilt)
multiplication_8 = Multiplication(A=layer_normal_down.Vector, B=tilt_factor_0_flat_1_normal)
nozzle_axis = Addition(A=multiplication_8, B=multiplication_7)
pl = PlaneNormal(Origin=points, ZAxis=nozzle_axis)
X = UnitX(Factor=-1)
print_planes = AlignPlane(Plane=pl, Direction=X)  # -> Plane, Angle

# ----
P = ClusterOutput(print_planes.Plane)
