# Grasshopper definition new_geometry_two_walls.gh (Grasshopper 1.0.8)
# plug-ins: Bifocals

python_3_script = Python3Script(
    radius_base=Slider(50, range=0..50),
    radius_top=Slider(50, range=0..50),
    layer_height=Slider(1.3, range=0..100),
    res_u=Slider(91, range=0..100),
    angle=Slider(5.5, range=0..10),
    freq=Slider(5, range=0..10),
    amp=Slider(3.15, range=0..10),
    y1=Slider(2, range=0..20),
    y2=Slider(6, range=0..20))  # -> out, layers, mesh; inputs layer_height: Int32, res_u: Int32, freq: Int32, amp: Int32
# ---------- python_3_script: Python ----------
import Rhino.Geometry as rg
import math as m
import numpy as np

class Column:
    def __init__(self, axis: rg.Curve, radius_base: float, radius_top: float):
        """
        Title and description

        """

        self.axis = axis
        self.radius_base = radius_base
        self.radius_top = radius_top
        self.height = axis.PointAtEnd.Z - axis.PointAtStart.Z
        # reparameterize axis
        self.axis.Domain = rg.Interval(0,1)


    def get_point(self, angle: float, tz: float, nz:int) -> rg.Point3d:
    # '->' showing what will be returned

        """
        angle: angle in polar coord. in radius
        tz: parameter on axis

        """

        origin = self.axis.PointAt(tz)
        # radius = self.get_radius_wave(angle, tz, 8, 3)
        radius = self.get_radius_bezier(tz)
        radius += self.get_zigzag(angle, freq, amp, nz)*2

        pt = rg.Point3d(
            origin.X + m.cos(angle)*radius,
            origin.Y + m.sin(angle)*radius,
            origin.Z
        )

        return pt

    
    def get_radius(self, angle: float, tz: float) -> float:
        radius = self.radius_base*(1-tz) + self.radius_top*tz
        return radius

    
    def get_radius_bezier(self, tz: float) -> float:
        bezier = rg.BezierCurve(
            [
                rg.Point2d(0, 0),
                rg.Point2d(0.2,y1),
                rg.Point2d(0.8,y2),
                rg.Point2d(1,0)
            ]
        )

        radius = self.radius_base*(1-tz) + self.radius_top*tz
        radius += bezier.PointAt(tz).Y*5
        return radius


    # flipped cos function
    def get_zigzag(self, angle: float, freq: int, amp: float, nz: int) -> float:

        if nz % 5 == 0:
            zigzag = amp * m.cos(angle * 300)
            #  print(zigzag)
            return zigzag
        else:
            flipped_zigzag = -(amp * m.cos(angle * 300))
            return flipped_zigzag


    def get_radius_wave(self, angle: float, tz: float, freq: int, amp: float) -> float:
        # rotate
        shift = tz*m.radians(270)
        angle += shift

        # # fade
        # amp = m.pow((tz), 2) * amp

        # radius = self.get_radius(angle, tz) + m.cos(angle*freq) * amp
        # return radius

        # # blend wave freq
        # freq1 = 2
        # freq2 = 4

        # _r1 = m.cos(angle*freq1)*amp
        # _r2 = m.cos(angle*freq2)*amp

        # radius = self.get_radius(angle, tz) + _r1*(1-tz) + _r2*(tz)
        # return radius

        # rotate in both direction
        shift = tz*m.radians(260)

        a1 = angle + shift
        a2 = angle - shift

        _r1 = self.get_radius(angle, tz) + m.cos(a1 * freq) * amp
        _r2 = self.get_radius(angle, tz) + m.cos(a2 * freq) * amp
        # radius = _r1*(1-tz) + _r2*tz
        radius = (_r1 + _r2) / 2
        # radius = max(_r1, _r2)
        # radius = min(_r1, _r2)

        return radius


    def get_layers(self, layer_height: float, res_u: int) -> list[list[rg.Point3d]]:

        layers_count = int(self.height // layer_height) + 1
        layers = []

        for nz, tz in enumerate(np.linspace(0, 1, layers_count)[1:]):
            layer = []
            for angle in np.linspace(0, m.tau, res_u)[:-1]:
                pt = self.get_point(angle, tz, nz)
                layer.append(pt)

            layers.append(layer)

        return layers


    @staticmethod
    def get_mesh(layers: list[list[rg.Point3d]], closed: bool) -> rg.Mesh:
        mesh = rg.Mesh()

        for layer in layers:
            for pt in layer:
                mesh.Vertices.Add(pt)

        # print(mesh.Vertices.Count)

        # numpy only
        idx = np.array(range(mesh.Vertices.Count))
        idx = idx.reshape(len(layers), len(layers[0]))

        if closed:
            faces = np.stack([
                idx[:-1],                             
                np.roll(idx[:-1], -1, axis=1),    
                np.roll(idx[1:], -1, axis=1),          
                idx[1:],                              
            ], axis=-1).reshape(-1, 4)

            print(faces)

        else:
            faces = np.lib.stride_tricks.sliding_window_view(
                idx, window_shape=(2, 2)
            ).reshape(-1, 4)

            print(faces)

        for face in faces:
            mesh.Faces.AddFace(
                *[int(f) for f in face] # '*' here for unpacking the list
            )

        mesh.Compact()
        mesh.RebuildNormals()
        return mesh

if __name__ == "__main__":
    axis = rg.LineCurve(
        rg.Point3d(0,0,0),
        rg.Point3d(0,0,100)
    )


    mycolumn = Column(axis, radius_base, radius_top)
    layers = mycolumn.get_layers(layer_height, res_u)

    mesh = Column.get_mesh(layers, closed=True)

    import ghpythonlib.treehelpers as tree
    layers = tree.list_to_tree(layers)
# ---------- end python_3_script ----------
data = Data(python_3_script.layers)
custom_preview = CustomPreview(Geometry=python_3_script.mesh, Material=ColourSwatch(SwatchColor=RGB(124, 45, 204)))
polyline = PolyLine(Vertices=python_3_script.layers, Closed=False)
loft = Loft(
    Curves=flatten(polyline),
    Options={Adjust=False, Closed=False, LoftEnds=0, LoftSimp=0, LoftType=0, Rebuild=10, Refit=0.01})

python_3_script_2 = Python3Script(
    radius_base=Slider(50, range=0..50),
    radius_top=Slider(50, range=0..50),
    layer_height=Slider(1.3, range=0..100),
    res_u=Slider(91, range=0..100),
    angle=Slider(5.5, range=0..10),
    freq=Slider(443, range=0..1000),
    shift_step=Slider(7, range=0..100),
    amp=Slider(3.15, range=0..10),
    y1=Slider(2, range=0..20),
    y2=Slider(6, range=0..20))  # -> out, layers, mesh; inputs layer_height: Int32, res_u: Int32, freq: Int32, amp: Int32
# ---------- python_3_script_2: Python ----------
import Rhino.Geometry as rg
import math as m
import numpy as np

class Column:
    def __init__(self, axis: rg.Curve, radius_base: float, radius_top: float):
        """
        Title and description

        """

        self.axis = axis
        self.radius_base = radius_base
        self.radius_top = radius_top
        self.height = axis.PointAtEnd.Z - axis.PointAtStart.Z
        # reparameterize axis
        self.axis.Domain = rg.Interval(0,1)


    def get_point(self, angle: float, tz: float, nz:int, na: int) -> rg.Point3d:
    # '->' showing what will be returned

        """
        angle: angle in polar coord. in radius
        tz: parameter on axis

        """

        origin = self.axis.PointAt(tz)
        # radius = self.get_radius_wave(angle, tz, 8, 3)
        radius = self.get_radius_bezier(tz)

        if nz % 5 == 0:
            radius += self.get_zigzag(angle, freq, amp, nz)

        pt = rg.Point3d(
            origin.X + m.cos(angle)*radius,
            origin.Y + m.sin(angle)*radius,
            origin.Z
        )
        return pt

    
    def get_radius(self, angle: float, tz: float) -> float:
        radius = self.radius_base*(1-tz) + self.radius_top*tz
        return radius

    
    def get_radius_bezier(self, tz: float) -> float:
        bezier = rg.BezierCurve(
            [
                rg.Point2d(0, 0),
                rg.Point2d(0.2,y1),
                rg.Point2d(0.8,y2),
                rg.Point2d(1,0)
            ]
        )

        radius = self.radius_base*(1-tz) + self.radius_top*tz
        radius += bezier.PointAt(tz).Y*5
        return radius


    # # flipped cos function
    # def get_zigzag(self, angle: float, freq: int, amp: float, nz: int) -> float:

    #     if nz % 5 == 0:
    #         zigzag = amp * m.cos(angle * 300)
    #         #  print(zigzag)
    #         return zigzag
    #     else:
    #         flipped_zigzag = -(amp * m.cos(angle * 300))
    #         return flipped_zigzag


    # shifted cos function
    def get_zigzag(self, angle: float, freq: int, amp: float, nz: int) -> float:

        # if nz % 2 == 0:
        #     zigzag = amp * m.cos(angle * 300) 
        #     #  print(zigzag)
        #     return zigzag
        # else:
        #     shifted_zigzag = (amp * m.cos((angle+(m.pi/4)) * 300))
        #     return shifted_zigzag


        shift = nz * (m.pi / (freq*shift_step))
        zigzag = amp * m.cos((angle + shift) * freq)
        return zigzag


    def get_radius_wave(self, angle: float, tz: float, freq: int, amp: float) -> float:
        # rotate
        shift = tz*m.radians(270)
        angle += shift

        # # fade
        # amp = m.pow((tz), 2) * amp

        # radius = self.get_radius(angle, tz) + m.cos(angle*freq) * amp
        # return radius

        # # blend wave freq
        # freq1 = 2
        # freq2 = 4

        # _r1 = m.cos(angle*freq1)*amp
        # _r2 = m.cos(angle*freq2)*amp

        # radius = self.get_radius(angle, tz) + _r1*(1-tz) + _r2*(tz)
        # return radius

        # rotate in both direction
        shift = tz*m.radians(260)

        a1 = angle + shift
        a2 = angle - shift

        _r1 = self.get_radius(angle, tz) + m.cos(a1 * freq) * amp
        _r2 = self.get_radius(angle, tz) + m.cos(a2 * freq) * amp
        # radius = _r1*(1-tz) + _r2*tz
        radius = (_r1 + _r2) / 2
        # radius = max(_r1, _r2)
        # radius = min(_r1, _r2)

        return radius


    def get_layers(self, layer_height: float, res_u: int) -> list[list[rg.Point3d]]:

        layers_count = int(self.height // layer_height) + 1
        layers = []

        for nz, tz in enumerate(np.linspace(0, 1, layers_count)[1:]):
            layer = []
            for na, angle in enumerate(np.linspace(0, m.tau, res_u)[:-1]):
                pt = self.get_point(angle, tz, nz, na)
                layer.append(pt)

            layers.append(layer)

        return layers


    @staticmethod
    def get_mesh(layers: list[list[rg.Point3d]], closed: bool) -> rg.Mesh:
        mesh = rg.Mesh()

        for layer in layers:
            for pt in layer:
                mesh.Vertices.Add(pt)

        # print(mesh.Vertices.Count)

        # numpy only
        idx = np.array(range(mesh.Vertices.Count))
        idx = idx.reshape(len(layers), len(layers[0]))

        if closed:
            faces = np.stack([
                idx[:-1],                             
                np.roll(idx[:-1], -1, axis=1),    
                np.roll(idx[1:], -1, axis=1),          
                idx[1:],                              
            ], axis=-1).reshape(-1, 4)

            print(faces)

        else:
            faces = np.lib.stride_tricks.sliding_window_view(
                idx, window_shape=(2, 2)
            ).reshape(-1, 4)

            print(faces)

        for face in faces:
            mesh.Faces.AddFace(
                *[int(f) for f in face] # '*' here for unpacking the list
            )

        mesh.Compact()
        mesh.RebuildNormals()
        return mesh

if __name__ == "__main__":
    axis = rg.LineCurve(
        rg.Point3d(0,0,0),
        rg.Point3d(0,0,100)
    )


    mycolumn = Column(axis, radius_base, radius_top)
    layers = mycolumn.get_layers(layer_height, res_u)

    mesh = Column.get_mesh(layers, closed=True)

    import ghpythonlib.treehelpers as tree
    layers = tree.list_to_tree(layers)
# ---------- end python_3_script_2 ----------
data_2 = Data(python_3_script_2.layers)  # disabled
custom_preview_2 = CustomPreview(Geometry=python_3_script_2.mesh, Material=ColourSwatch(SwatchColor=RGB(124, 45, 204)))  # disabled
polyline_2 = PolyLine(Vertices=python_3_script_2.layers, Closed=False)
loft_2 = Loft(
    Curves=flatten(polyline_2),
    Options={Adjust=False, Closed=False, LoftEnds=0, LoftSimp=0, LoftType=0, Rebuild=10, Refit=0.01})

py3 = Python3Script()  # -> out, layers, mesh; disabled
# ---------- py3: Python ----------
import Rhino.Geometry as rg
import numpy as np
import math as m

class Column:
    def __init__(self, axis: rg.Curve, radius_base: float, radius_top: float):
        self.axis = axis
        # reparameterize axis
        self.axis.Domain = rg.Interval(0,1)
        self.r_base = radius_base
        self.r_top = radius_top
        self.height = axis.PointAtEnd.Z - axis.PointAtStart.Z
        self.radius_bezier = self.gen_radius_bezier()

    def gen_radius_bezier(self) -> rg.BezierCurve:
        pts = [
            rg.Point2d(0, 0),
            rg.Point2d(0.6, 3),
            rg.Point2d(0.9, 5),
            rg.Point2d(1.0, 0.5)
        ]
        return rg.BezierCurve(pts)

    def get_radius(self, tz) -> float:
        # power
        # tz = m.pow(tz, 3)
        # return self.r_base*(1-tz) + self.r_top*(tz)

        # beizer curve
        bezier = self.radius_bezier.PointAt(tz)
        amp = 10
        return self.r_base*(1-tz) + self.r_top*(tz) + bezier.Y*amp

    def get_pattern(self, angle, tz) -> float:
        a = angle
        freq = 4
        amp = 5

        # shift angle
        shift = m.pow(tz, 2.5)
        shift *= m.pi
        
        # fade out amp
        fade = m.pow(tz,1)
        # amp *= fade
        # pattern = m.cos((a+shift)*freq)*amp

        # blend multiple freq
        freqs = [3, 8, 4]
        set_freqs = [m.cos((a+shift)*f)*(amp+3*(1-tz)) for f in freqs]
        t_sets = [t for t in np.linspace(0,1,len(freqs))]
        pattern = np.interp(tz, t_sets, set_freqs)
        
        # add reverse pattern
        set_freqs = [m.cos((a-shift)*f)*(amp+3*tz) for f in freqs]
        r_pattern = np.interp(tz, t_sets, set_freqs)

        # try different blend
        pattern = (pattern + r_pattern)*.5
        pattern = max(pattern, r_pattern)
        # pattern = min(pattern, r_pattern)
        # pattern = pattern*(1-tz) + r_pattern*tz

        return pattern

    def get_point(self, angle, tz) -> rg.Point3d:
        """
        Get point on the column at certain angle and height

        Args:
        angle: angle of the point in radians
        tz: normalize parameter of the height along the axis

        Returns:
        The list of polylinecurve for each layer
        """
        radius = self.get_radius(tz)
        radius += self.get_pattern(angle, tz)
        origin = self.axis.PointAt(tz)
        vector = rg.Vector3d(
            radius*m.cos(angle),
            radius*m.sin(angle),
            0
        )
        return origin+vector

    def print_paths(self, resolution: int, layer_height: float) -> list[int, list[rg.PolylineCurve]]:
        """
        Generate print path of the columns

        Args:
        resolution: division around the circumference
        layer_height: distance between vertical layers in mm.

        Returns:
        The list of polylinecurve for each layer
        """

        lh = int(self.height // layer_height)
        layers = []

        for tz in np.linspace(0, 1, lh+1, endpoint=True)[1:]:
            pts = []
            for angle in np.linspace(0, 2*np.pi, resolution+1, endpoint=True)[:-1]:
                pts.append(self.get_point(angle, tz))
            
            layers.append(
                rg.PolylineCurve(pts)
            )
        return lh, layers
    
    @ staticmethod
    def to_mesh(crvs: list[rg.PolylineCurve], closed: bool = True) -> rg.Mesh:
        mesh = rg.Mesh()
        for layer in crvs:
            for pt in layer.ToArray():
                mesh.Vertices.Add(pt)
        
        idx = np.array(range(mesh.Vertices.Count))
        idx = idx.reshape(len(crvs), len(layers))

        if closed:
            faces = np.stack([
                idx[:-1],                             # Top-left
                np.roll(idx[:-1], -1, axis=1),        # Top-right
                idx[1:],                              # Bottom-left
                np.roll(idx[1:], -1, axis=1)          # Bottom-right
            ], axis=-1).reshape(-1, 4)
        else:
            faces = np.lib.stride_tricks.sliding_window_view(
                idx, window_shape=(2, 2)
            ).reshape(-1, 4)
        
        for f in faces:
            mesh.Faces.AddFace(
                int(f[0]),
                int(f[1]),
                int(f[3]),
                int(f[2])
            )

        mesh.Compact()
        mesh.RebuildNormals()
        return mesh

            


if __name__ == "__main__":
    axis = rg.LineCurve(
        rg.Point3d(0,0,0),
        rg.Point3d(10,10,300)
    )
    r1 = 10
    r2 = 10

    column = Column(axis, r1, r2)
    layer_count, layers = column.print_paths(150, 2)
    mesh = Column.to_mesh(layers, closed=True)
# ---------- end py3 ----------
preview = CustomPreview(Geometry=py3.mesh, Material=ColourSwatch(SwatchColor=RGB(74, 56, 209)))

python_3_script_3 = Python3Script(
    layer_height=Slider(1.3, range=0..100),
    res_u=Slider(80, range=0..100),
    angle=Slider(5.5, range=0..10),
    freq=Slider(350, range=0..1000),
    shift_step=Slider(10, range=0..100),
    amp=Slider(4.38, range=0..10),
    v1=Slider(0, range=0..20),
    v2=Slider(10, range=0..20),
    window_interval=Slider(10, range=0..40),
    window_width=Slider(2, range=0..20),
    shift_step_2=Slider(0, range=0..20))  # -> out, layers, mesh, extrusion, io_events, points_on, points_off, index; inputs layer_height: Int32, res_u: Int32, freq: Int32, amp: Int32
# ---------- python_3_script_3: Python ----------
import Rhino.Geometry as rg
import math as m
import numpy as np
import ghpythonlib.treehelpers as tree


curve_1 = rg.LineCurve(rg.Point3d(0, 0, 0), rg.Point3d(0, 100, 0))

curve_2 = rg.LineCurve(rg.Point3d(10, 0, 0), rg.Point3d(10, 100, 0))


class Wall:
    def __init__(self, axis, curve_1, curve_2):
        """
        Title and description

        """

        self.axis = axis
        self.curve_1 = curve_1
        self.curve_2 = curve_2
        self.height = axis.PointAtEnd.Z - axis.PointAtStart.Z
        # reparameterize axis
        self.axis.Domain = rg.Interval(0,1)


    def get_point(self, curve_index, t, tz):

        pt1 = self.curve_1.PointAtNormalizedLength(t)
        pt2 = self.curve_2.PointAtNormalizedLength(t)

        width = self.get_radius(t)
        offset = self.get_radius_bezier(tz)

        direction = pt2 - pt1
        direction.Unitize()

        if curve_index == 1:
            pt = pt1
        else:
            pt = pt1 + direction * (width + offset)

        z = self.axis.PointAt(tz).Z

        return rg.Point3d(pt.X, pt.Y, z)

    
    def get_radius(self, t):

        pt1 = self.curve_1.PointAtNormalizedLength(t)
        pt2 = self.curve_2.PointAtNormalizedLength(t)

        return pt1.DistanceTo(pt2)

    
    def get_radius_bezier(self, tz):

        bezier = rg.BezierCurve([
            rg.Point2d(0, 0),
            rg.Point2d(0.2, v1),
            rg.Point2d(0.8, v2),
            rg.Point2d(1, 0)
        ])

        offset = bezier.PointAt(tz).Y * 2

        return offset


    # # flipped cos function
    # def get_zigzag(self, angle: float, freq: int, amp: float, nz: int) -> float:

    #     if nz % 5 == 0:
    #         zigzag = amp * m.cos(angle * 300)
    #         #  print(zigzag)
    #         return zigzag
    #     else:
    #         flipped_zigzag = -(amp * m.cos(angle * 300))
    #         return flipped_zigzag


    # shifted cos function
    def get_zigzag(self, angle, freq, amp, nz):

        # if nz % 2 == 0:
        #     zigzag = amp * m.cos(angle * 300) 
        #     #  print(zigzag)
        #     return zigzag
        # else:
        #     shifted_zigzag = (amp * m.cos((angle+(m.pi/4)) * 300))
        #     return shifted_zigzag


        shift = nz * (m.pi / (freq*shift_step))
        zigzag = amp * m.cos((m.tau + shift) * freq)
        return zigzag


    def get_radius_wave(self, angle, tz, freq, amp):
        # rotate
        shift = tz * m.radians(270)
        angle = t * m.tau

        # # fade
        # amp = m.pow((tz), 2) * amp

        # radius = self.get_radius(angle, tz) + m.cos(angle*freq) * amp
        # return radius

        # # blend wave freq
        # freq1 = 2
        # freq2 = 4

        # _r1 = m.cos(angle*freq1)*amp
        # _r2 = m.cos(angle*freq2)*amp

        # radius = self.get_radius(angle, tz) + _r1*(1-tz) + _r2*(tz)
        # return radius

        _r1 = self.get_radius_bezier(tz) + m.cos(a1 * freq) * amp
        _r2 = self.get_radius_bezier(tz) + m.cos(a2 * freq) * amp
        # radius = _r1*(1-tz) + _r2*tz
        # radius = (_r1 + _r2) / 2
        # radius = max(_r1, _r2)
        # radius = min(_r1, _r2)

        return (_r1 + _r2) / 2


    def get_layers(self, layer_height, res_u):

            if layer_height <= 0:
                raise ValueError("layer_height must be positive.")

            if res_u < 2:
                raise ValueError("res_u must be at least 2.")

            layers_count = int(self.height // layer_height) + 1

            layers = []

            for i in range(layers_count):

                layer = []

                z = i * layer_height
                tz = min(z / self.height, 1.0)

                # Alternate direction for each layer
                indices = (
                    range(res_u)
                    if i % 2 == 0
                    else range(res_u - 1, -1, -1)
                )

                for j in indices:

                    t = j / float(res_u - 1)

                    pt1 = self.curve_1.PointAtNormalizedLength(t)
                    pt2 = self.curve_2.PointAtNormalizedLength(t)

                    # Bezier width deformation
                    offset = self.get_radius_bezier(tz)

                    direction = pt2 - pt1
                    direction.Unitize()

                    pt2 = pt2 + direction * offset

                    # Two points per station
                    layer.append(rg.Point3d(pt1.X, pt1.Y, z))
                    layer.append(rg.Point3d(pt2.X, pt2.Y, z))

                layers.append(layer)

            return layers


    @staticmethod
    def get_extrusion_data(layers, window_interval, window_width):

        if window_interval <= 0:
            raise ValueError("window_interval must be positive.")

        extrusion = []
        io_events = []

        previous_state = None

        for i, layer in enumerate(layers):

            layer_states = []

            # Shift window pattern between layers
            # shift = i / float(shift_step)
            shift = 2

            for j, pt in enumerate(layer):

                station = j // 2

                is_window = (
                    (station + shift) % window_interval) < window_width

                state = not is_window

                layer_states.append(state)

                if previous_state is None or state != previous_state:

                    io_events.append({
                        "layer": i,
                        "point": j,
                        "extrusion": state,
                        "position": pt
                    })

                previous_state = state

            extrusion.append(layer_states)

        return extrusion, io_events



    # @staticmethod
    # def get_mesh(layers: list[list[rg.Point3d]], closed: bool) -> rg.Mesh:

    #     mesh = rg.Mesh()

    #     for layer in layers:
    #         for pt in layer:
    #             mesh.Vertices.Add(pt)

    #     idx = np.array(range(mesh.Vertices.Count))
    #     idx = idx.reshape(len(layers), len(layers[0]))

    #     if closed:

    #         faces = np.stack([
    #             idx[:-1],
    #             np.roll(idx[:-1], -1, axis=1),
    #             np.roll(idx[1:], -1, axis=1),
    #             idx[1:],
    #         ], axis=-1).reshape(-1, 4)

    #     else:

    #         faces = np.lib.stride_tricks.sliding_window_view(
    #             idx, window_shape=(2, 2)
    #         ).reshape(-1, 4)

    #     for face in faces:

    #         mesh.Faces.AddFace(
    #             *[int(f) for f in face]
    #         )

    #     mesh.Compact()
    #     mesh.RebuildNormals()
    #     return mesh


if __name__ == "__main__":

    axis = rg.LineCurve(
        rg.Point3d(0, 0, 0),
        rg.Point3d(0, 0, 100)
    )

    mywall = Wall(axis, curve_1, curve_2)

    layers = mywall.get_layers(
        layer_height,
        res_u
    )

    extrusion, io_events = Wall.get_extrusion_data(
        layers,
        window_interval,
        window_width
    )

    index = []
    points_on = []
    points_off = []

    for i, layer in enumerate(layers):

        layer_index = []

        for j, pt in enumerate(layer):

            if extrusion[i][j]:

                points_on.append(pt)
                layer_index.append(2)

            else:

                points_off.append(pt)
                layer_index.append(1)

        index.append(layer_index)



    # n_turns = int(h // layer_h)
    # d_ang = m.tau / resolution
    # d_h = h / (resolution * n_turns)
    # l_h = h / n_turns

    # # 1. Generate points
    # pts = [
    #     [
    #         Point(
    #             x_rad * m.cos(d_ang * i),
    #             y_rad * m.sin(d_ang * i),
    #             (j * l_h) + first_h
    #         )
    #         for i in range(resolution)
    #     ]
    #     for j in range(n_turns)
    # ]

    # revised_pts = [p[(shift*np)%(len(p)-1):] + p[:(shift*np)%(len(p)-1)] for np, p in enumerate(pts)]
    # # pts_new = []
    # # for np, p in enumerate(pts):
    # #     shifting_index = (shift*np)%(len(p)-1)
    # #     pt_new = p[shifting_index:] + p[:shifting_index]
    # #     pts_new.append(pt_new)
    # index = [[1 if p == 0 else 2 for p in range(len(np))] for np in revised_pts]

    # revised_pts = tree.list_to_tree(revised_pts)
    # index = tree.list_to_tree(index)



    layers = tree.list_to_tree(layers)
    extrusion = tree.list_to_tree(extrusion)
    io_events = tree.list_to_tree(io_events)
    index = tree.list_to_tree(index)

    points_on = tree.list_to_tree(points_on)
    points_off = tree.list_to_tree(points_off)
# ---------- end python_3_script_3 ----------
flatten = FlattenTree(Tree=python_3_script_3.layers, Path="{0}")
custom_preview_3 = CustomPreview(Geometry=python_3_script_3.points_on, Material=ColourSwatch(SwatchColor=RGB(45, 204, 50)))
custom_preview_4 = CustomPreview(Geometry=python_3_script_3.points_off, Material=ColourSwatch(SwatchColor=RGB(204, 45, 45)))
custom_preview_5 = CustomPreview(Geometry=python_3_script_3.mesh, Material=ColourSwatch(SwatchColor=RGB(124, 45, 204)))
data_3 = Data(python_3_script_3.layers)
add_tail_info = Add_tail_info(list=flatten, F="100", list_2=python_3_script_3.index, item="2")  # -> cg, list_3
polyline_3 = PolyLine(Vertices=python_3_script_3.layers, Closed=False)
loft_3 = Loft(
    Curves=flatten(polyline_3),
    Options={Adjust=False, Closed=False, LoftEnds=0, LoftSimp=0, LoftType=0, Rebuild=10, Refit=0.01})

python_3_script_4 = Python3Script(
    radius_base=Slider(50, range=0..50),
    radius_top=Slider(50, range=0..50),
    layer_height=Slider(1.3, range=0..100),
    res_u=Slider(80, range=0..100),
    angle=Slider(5.5, range=0..10),
    freq=Slider(350, range=0..1000),
    shift_step=Slider(10, range=0..100),
    amp=Slider(4.38, range=0..10),
    y1=Slider(2, range=0..20),
    y2=Slider(6, range=0..20),
    window_interval=Slider(10, range=0..40),
    window_width=Slider(3, range=0..20),
    shift_step_2=Slider(7, range=0..20))  # -> out, layers, mesh, extrusion, io_events, points_on, points_off; inputs layer_height: Int32, res_u: Int32, freq: Int32, amp: Int32
# ---------- python_3_script_4: Python ----------
import Rhino.Geometry as rg
import math as m
import numpy as np

class Column:
    def __init__(self, axis: rg.Curve, radius_base: float, radius_top: float):
        """
        Title and description

        """

        self.axis = axis
        self.radius_base = radius_base
        self.radius_top = radius_top
        self.height = axis.PointAtEnd.Z - axis.PointAtStart.Z
        # reparameterize axis
        self.axis.Domain = rg.Interval(0,1)


    def get_point(self, angle: float, tz: float, nz:int, na: int) -> rg.Point3d:
    # '->' showing what will be returned

        """
        angle: angle in polar coord. in radius
        tz: parameter on axis

        """

        origin = self.axis.PointAt(tz)
        # radius = self.get_radius_wave(angle, tz, 8, 3)
        radius = self.get_radius_bezier(tz)

        # if nz % 5 == 0:
        #     radius += self.get_zigzag(angle, freq, amp, nz)

        pt = rg.Point3d(
            origin.X + m.cos(angle)*radius,
            origin.Y + m.sin(angle)*radius,
            origin.Z
        )
        return pt

    
    def get_radius(self, angle: float, tz: float) -> float:
        radius = self.radius_base*(1-tz) + self.radius_top*tz
        return radius

    
    def get_radius_bezier(self, tz: float) -> float:
        bezier = rg.BezierCurve(
            [
                rg.Point2d(0, 0),
                rg.Point2d(0.2,y1),
                rg.Point2d(0.8,y2),
                rg.Point2d(1,0)
            ]
        )

        radius = self.radius_base*(1-tz) + self.radius_top*tz
        radius += bezier.PointAt(tz).Y*5
        return radius


    # # flipped cos function
    # def get_zigzag(self, angle: float, freq: int, amp: float, nz: int) -> float:

    #     if nz % 5 == 0:
    #         zigzag = amp * m.cos(angle * 300)
    #         #  print(zigzag)
    #         return zigzag
    #     else:
    #         flipped_zigzag = -(amp * m.cos(angle * 300))
    #         return flipped_zigzag


    # shifted cos function
    def get_zigzag(self, angle: float, freq: int, amp: float, nz: int) -> float:

        # if nz % 2 == 0:
        #     zigzag = amp * m.cos(angle * 300) 
        #     #  print(zigzag)
        #     return zigzag
        # else:
        #     shifted_zigzag = (amp * m.cos((angle+(m.pi/4)) * 300))
        #     return shifted_zigzag


        shift = nz * (m.pi / (freq*shift_step))
        zigzag = amp * m.cos((angle + shift) * freq)
        return zigzag


    def get_radius_wave(self, angle: float, tz: float, freq: int, amp: float) -> float:
        # rotate
        shift = tz*m.radians(270)
        angle += shift

        # # fade
        # amp = m.pow((tz), 2) * amp

        # radius = self.get_radius(angle, tz) + m.cos(angle*freq) * amp
        # return radius

        # # blend wave freq
        # freq1 = 2
        # freq2 = 4

        # _r1 = m.cos(angle*freq1)*amp
        # _r2 = m.cos(angle*freq2)*amp

        # radius = self.get_radius(angle, tz) + _r1*(1-tz) + _r2*(tz)
        # return radius

        # rotate in both direction
        shift = tz*m.radians(260)

        a1 = angle + shift
        a2 = angle - shift

        _r1 = self.get_radius(angle, tz) + m.cos(a1 * freq) * amp
        _r2 = self.get_radius(angle, tz) + m.cos(a2 * freq) * amp
        # radius = _r1*(1-tz) + _r2*tz
        radius = (_r1 + _r2) / 2
        # radius = max(_r1, _r2)
        # radius = min(_r1, _r2)

        return radius


    def get_layers(self, layer_height: float, res_u: int) -> list[list[rg.Point3d]]:

        layers_count = int(self.height // layer_height) + 1
        layers = []

        for nz, tz in enumerate(np.linspace(0, 1, layers_count)[1:]):
            layer = []
            for na, angle in enumerate(np.linspace(0, m.tau, res_u)[:-1]):
                pt = self.get_point(angle, tz, nz, na)
                layer.append(pt)

            layers.append(layer)

        return layers


    @staticmethod
    def get_extrusion_data(layers, window_interval, window_width):

        interval = max(1, int(window_interval))
        width = max(0, min(interval, int(window_width)))

        extrusion = []
        io_events = []

        for i, layer in enumerate(layers):

            layer_states = []

            for j, pt in enumerate(layer):

                # # straight lines for window
                # is_window = (j % interval) < width

                # rotated/shifted lines for window
                shift = i / shift_step
                is_window = ((j + shift) % interval) < width

                # True = extrusion ON
                # False = extrusion OFF
                state = not is_window

                layer_states.append(state)

                # Record only when IO state changes
                if j == 0 or state != layer_states[j-1]:

                    io_events.append({
                        "layer": i,
                        "point": j,
                        "extrusion": state,
                        "position": pt
                    })

            extrusion.append(layer_states)

        return extrusion, io_events



    @staticmethod
    def get_mesh(layers: list[list[rg.Point3d]], closed: bool) -> rg.Mesh:

        mesh = rg.Mesh()

        for layer in layers:
            for pt in layer:
                mesh.Vertices.Add(pt)

        idx = np.array(range(mesh.Vertices.Count))
        idx = idx.reshape(len(layers), len(layers[0]))

        if closed:

            faces = np.stack([
                idx[:-1],
                np.roll(idx[:-1], -1, axis=1),
                np.roll(idx[1:], -1, axis=1),
                idx[1:],
            ], axis=-1).reshape(-1, 4)

        else:

            faces = np.lib.stride_tricks.sliding_window_view(
                idx, window_shape=(2, 2)
            ).reshape(-1, 4)

        for face in faces:

            mesh.Faces.AddFace(
                *[int(f) for f in face]
            )

        mesh.Compact()
        mesh.RebuildNormals()
        return mesh


if __name__ == "__main__":

    axis = rg.LineCurve(
        rg.Point3d(0, 0, 0),
        rg.Point3d(0, 0, 100)
    )

    mycolumn = Column(axis, radius_base, radius_top)
    layers = mycolumn.get_layers(layer_height, res_u)

    mesh = Column.get_mesh(layers, closed=True)

    extrusion, io_events = Column.get_extrusion_data(
        layers,
        window_interval,
        window_width
    )

    points_on = []
    points_off = []

    for i, layer in enumerate(layers):

        for j, pt in enumerate(layer):

            if extrusion[i][j]:
                points_on.append(pt)

            else:
                points_off.append(pt)

    import ghpythonlib.treehelpers as tree

    layers = tree.list_to_tree(layers)
    extrusion = tree.list_to_tree(extrusion)
    io_events = tree.list_to_tree(io_events)

    points_on = tree.list_to_tree(points_on)
    points_off = tree.list_to_tree(points_off)
# ---------- end python_3_script_4 ----------
custom_preview_6 = CustomPreview(Geometry=python_3_script_4.points_on, Material=ColourSwatch(SwatchColor=RGB(45, 204, 50)))
custom_preview_7 = CustomPreview(Geometry=python_3_script_4.points_off, Material=ColourSwatch(SwatchColor=RGB(204, 45, 45)))
custom_preview_8 = CustomPreview(Geometry=python_3_script_4.mesh, Material=ColourSwatch(SwatchColor=RGB(124, 45, 204)))
data_4 = Data(python_3_script_4.layers)
polyline_4 = PolyLine(Vertices=python_3_script_4.layers, Closed=False)
loft_4 = Loft(
    Curves=flatten(polyline_4),
    Options={Adjust=False, Closed=False, LoftEnds=0, LoftSimp=0, LoftType=0, Rebuild=10, Refit=0.01})

python_3_script_5 = Python3Script(
    radius_base=Slider(50, range=0..50),
    radius_top=Slider(50, range=0..50),
    layer_height=Slider(1.3, range=0..100),
    res_u=Slider(80, range=0..100),
    angle=Slider(5.5, range=0..10),
    freq=Slider(350, range=0..1000),
    shift_step=Slider(10, range=0..100),
    amp=Slider(4.38, range=0..10),
    y1=Slider(0, range=0..20),
    y2=Slider(0, range=0..20),
    window_interval=Slider(15, range=0..40),
    window_width=Slider(2, range=0..20),
    shift_step_2=Slider(2, range=0..20))  # -> out, layers, mesh, extrusion, io_events, points_on, points_off, index; inputs layer_height: Int32, res_u: Int32, freq: Int32, amp: Int32
# ---------- python_3_script_5: Python ----------
import Rhino.Geometry as rg
import math as m
import numpy as np
import ghpythonlib.treehelpers as tree

class Column:
    def __init__(self, axis: rg.Curve, radius_base: float, radius_top: float):
        """
        Title and description

        """

        self.axis = axis
        self.radius_base = radius_base
        self.radius_top = radius_top
        self.height = axis.PointAtEnd.Z - axis.PointAtStart.Z
        # reparameterize axis
        self.axis.Domain = rg.Interval(0,1)


    def get_point(self, angle: float, tz: float, nz:int, na: int) -> rg.Point3d:
    # '->' showing what will be returned

        """
        angle: angle in polar coord. in radius
        tz: parameter on axis

        """

        origin = self.axis.PointAt(tz)
        # radius = self.get_radius_wave(angle, tz, 8, 3)
        radius = self.get_radius_bezier(tz)

        # if nz % 5 == 0:
        #     radius += self.get_zigzag(angle, freq, amp, nz)

        # pt = rg.Point3d(
        #     origin.X + m.cos(angle)*radius,
        #     origin.Y + m.sin(angle)*radius,
        #     origin.Z)

        # Convert circle into square
        x = m.cos(angle)
        y = m.sin(angle)

        scale = max(abs(x), abs(y))

        x = x / scale
        y = y / scale

        pt = rg.Point3d(
            origin.X + x * radius,
            origin.Y + y * radius / 8,
            origin.Z)

        return pt

    
    def get_radius(self, angle: float, tz: float) -> float:
        radius = self.radius_base*(1-tz) + self.radius_top*tz
        return radius

    
    def get_radius_bezier(self, tz: float) -> float:
        bezier = rg.BezierCurve(
            [
                rg.Point2d(0, 0),
                rg.Point2d(0.2,y1),
                rg.Point2d(0.8,y2),
                rg.Point2d(1,0)
            ]
        )

        radius = self.radius_base*(1-tz) + self.radius_top*tz
        radius += bezier.PointAt(tz).Y*5
        return radius


    # # flipped cos function
    # def get_zigzag(self, angle: float, freq: int, amp: float, nz: int) -> float:

    #     if nz % 5 == 0:
    #         zigzag = amp * m.cos(angle * 300)
    #         #  print(zigzag)
    #         return zigzag
    #     else:
    #         flipped_zigzag = -(amp * m.cos(angle * 300))
    #         return flipped_zigzag


    # shifted cos function
    def get_zigzag(self, angle: float, freq: int, amp: float, nz: int) -> float:

        # if nz % 2 == 0:
        #     zigzag = amp * m.cos(angle * 300) 
        #     #  print(zigzag)
        #     return zigzag
        # else:
        #     shifted_zigzag = (amp * m.cos((angle+(m.pi/4)) * 300))
        #     return shifted_zigzag


        shift = nz * (m.pi / (freq*shift_step))
        zigzag = amp * m.cos((angle + shift) * freq)
        return zigzag


    def get_radius_wave(self, angle: float, tz: float, freq: int, amp: float) -> float:
        # rotate
        shift = tz*m.radians(270)
        angle += shift

        # # fade
        # amp = m.pow((tz), 2) * amp

        # radius = self.get_radius(angle, tz) + m.cos(angle*freq) * amp
        # return radius

        # # blend wave freq
        # freq1 = 2
        # freq2 = 4

        # _r1 = m.cos(angle*freq1)*amp
        # _r2 = m.cos(angle*freq2)*amp

        # radius = self.get_radius(angle, tz) + _r1*(1-tz) + _r2*(tz)
        # return radius

        # rotate in both direction
        shift = tz*m.radians(260)

        a1 = angle + shift
        a2 = angle - shift

        _r1 = self.get_radius(angle, tz) + m.cos(a1 * freq) * amp
        _r2 = self.get_radius(angle, tz) + m.cos(a2 * freq) * amp
        # radius = _r1*(1-tz) + _r2*tz
        radius = (_r1 + _r2) / 2
        # radius = max(_r1, _r2)
        # radius = min(_r1, _r2)

        return radius


    def get_layers(self, layer_height: float, res_u: int) -> list[list[rg.Point3d]]:

        layers_count = int(self.height // layer_height) + 1
        layers = []

        for nz, tz in enumerate(np.linspace(0, 1, layers_count)[1:]):
            layer = []
            for na, angle in enumerate(np.linspace(0, m.tau, res_u)[:-1]):
                pt = self.get_point(angle, tz, nz, na)
                layer.append(pt)

            layers.append(layer)

        return layers


    @staticmethod
    def get_extrusion_data(layers, window_interval, window_width):

        extrusion = []
        io_events = []

        for i, layer in enumerate(layers):

            layer_states = []

            # shifted/zigzag lines for window
            zigzag_interval = i % (2 * shift_step)

            if zigzag_interval <= shift_step:
                shift = zigzag_interval
            else:
                shift = (2 * shift_step) - zigzag_interval

            for j, pt in enumerate(layer):

                # # straight lines for window
                # is_window = (j % window_interval) < window_width

                # rotated/shifted lines for window
                shift = i / shift_step
                is_window = ((j + shift) % window_interval) < window_width


                # # zigzag lines for window
                # is_window = ((j + shift) % window_interval) < window_width

                # True = extrusion ON
                # False = extrusion OFF
                state = not is_window

                layer_states.append(state)

                # Record only when IO state changes
                if j == 0 or state != layer_states[j-1]:

                    io_events.append({
                        "layer": i,
                        "point": j,
                        "extrusion": state,
                        "position": pt
                    })

            extrusion.append(layer_states)

        return extrusion, io_events



    @staticmethod
    def get_mesh(layers: list[list[rg.Point3d]], closed: bool) -> rg.Mesh:

        mesh = rg.Mesh()

        for layer in layers:
            for pt in layer:
                mesh.Vertices.Add(pt)

        idx = np.array(range(mesh.Vertices.Count))
        idx = idx.reshape(len(layers), len(layers[0]))

        if closed:

            faces = np.stack([
                idx[:-1],
                np.roll(idx[:-1], -1, axis=1),
                np.roll(idx[1:], -1, axis=1),
                idx[1:],
            ], axis=-1).reshape(-1, 4)

        else:

            faces = np.lib.stride_tricks.sliding_window_view(
                idx, window_shape=(2, 2)
            ).reshape(-1, 4)

        for face in faces:

            mesh.Faces.AddFace(
                *[int(f) for f in face]
            )

        mesh.Compact()
        mesh.RebuildNormals()
        return mesh


if __name__ == "__main__":

    axis = rg.LineCurve(
        rg.Point3d(0, 0, 0),
        rg.Point3d(0, 0, 100)
    )

    mycolumn = Column(axis, radius_base, radius_top)
    layers = mycolumn.get_layers(layer_height, res_u)

    mesh = Column.get_mesh(layers, closed=True)

    extrusion, io_events = Column.get_extrusion_data(
        layers,
        window_interval,
        window_width
    )

    index = []
    points_on = []
    points_off = []

    for i, layer in enumerate(layers):

        for j, pt in enumerate(layer):

            if extrusion[i][j]:
                points_on.append(pt)
                index.append(2)

            else:
                points_off.append(pt)
                index.append(1)


    # n_turns = int(h // layer_h)
    # d_ang = m.tau / resolution
    # d_h = h / (resolution * n_turns)
    # l_h = h / n_turns

    # # 1. Generate points
    # pts = [
    #     [
    #         Point(
    #             x_rad * m.cos(d_ang * i),
    #             y_rad * m.sin(d_ang * i),
    #             (j * l_h) + first_h
    #         )
    #         for i in range(resolution)
    #     ]
    #     for j in range(n_turns)
    # ]

    # revised_pts = [p[(shift*np)%(len(p)-1):] + p[:(shift*np)%(len(p)-1)] for np, p in enumerate(pts)]
    # # pts_new = []
    # # for np, p in enumerate(pts):
    # #     shifting_index = (shift*np)%(len(p)-1)
    # #     pt_new = p[shifting_index:] + p[:shifting_index]
    # #     pts_new.append(pt_new)
    # index = [[1 if p == 0 else 2 for p in range(len(np))] for np in revised_pts]

    # revised_pts = tree.list_to_tree(revised_pts)
    # index = tree.list_to_tree(index)



    layers = tree.list_to_tree(layers)
    extrusion = tree.list_to_tree(extrusion)
    io_events = tree.list_to_tree(io_events)
    index = tree.list_to_tree(index)

    points_on = tree.list_to_tree(points_on)
    points_off = tree.list_to_tree(points_off)
# ---------- end python_3_script_5 ----------
flatten_2 = FlattenTree(Tree=python_3_script_5.layers, Path="{0}")
custom_preview_9 = CustomPreview(Geometry=python_3_script_5.points_on, Material=ColourSwatch(SwatchColor=RGB(45, 204, 50)))
custom_preview_10 = CustomPreview(Geometry=python_3_script_5.points_off, Material=ColourSwatch(SwatchColor=RGB(204, 45, 45)))
custom_preview_11 = CustomPreview(Geometry=python_3_script_5.mesh, Material=ColourSwatch(SwatchColor=RGB(124, 45, 204)))
data_5 = Data(python_3_script_5.layers)
add_tail_info_2 = Add_tail_info(list=flatten_2, F="100", list_2=python_3_script_5.index, item="2")  # -> cg, list_3
polyline_5 = PolyLine(Vertices=python_3_script_5.layers, Closed=False)
loft_5 = Loft(
    Curves=flatten(polyline_5),
    Options={Adjust=False, Closed=False, LoftEnds=0, LoftSimp=0, LoftType=0, Rebuild=10, Refit=0.01})

panel = Panel(python_3_script_4.extrusion)
panel_2 = Panel(python_3_script_4.io_events)
panel_3 = Panel(python_3_script_3.extrusion)
panel_4 = Panel(python_3_script_5.extrusion)
panel_5 = Panel(python_3_script_3.io_events)
panel_6 = Panel(python_3_script_5.io_events)

# ==== cluster Add_tail_info
list = ClusterInput()
F = ClusterInput()
list_2 = ClusterInput()
item = ClusterInput()
Y = UnitY(Factor=expr("-x", F))
item_2 = ListItem(List=list, Index=0, Wrap=True)
move = Move(Geometry=item_2, Motion=Y)  # -> Geometry, Transform
insert_items = InsertItems(List=list, Item=move.Geometry, Indices="0", Wrap=True)  # -> simplify(List)
insert_items_2 = InsertItems(List=list_2, Item=item, Indices="0", Wrap=True)  # -> simplify(List)
python_3_script = Python3Script(layers=insert_items)  # -> out, cg; inputs layers: list
# ---------- python_3_script: Python ----------
from compas_rhino.conversions import point_to_compas

cg = []
for p in layers:
    cg.append(point_to_compas(p))
# ---------- end python_3_script ----------
list_3 = ClusterOutput(insert_items_2)
cg = ClusterOutput(python_3_script.cg)
