# Grasshopper definition 261106_G4_design_DDF.ghx (Grasshopper 1.0.8)
# plug-ins: RhinoCodePluginGH

point = Point(Point(295.6040072, 196.966694, 0))

# ---- group: OFFSET_IN-OUT
# OUTPUT = compas.Polyline Curves(by pts)
number_slider = Slider(50, range=0..100)  # disabled
number_slider_2 = Slider(50, range=0..100)  # disabled
number_slider_3 = Slider(10, range=0..100)  # disabled
number_slider_4 = Slider(20, range=0..100)  # disabled
python_3_script = Python3Script(radius_base=number_slider, radius_top=number_slider_2, layer_height=number_slider_3, res_u=number_slider_4)  # -> out, layers, curves
# ---------- python_3_script: Python ----------
# IMPORTS
import Rhino.Geometry as rg
import math as m
import numpy as np
import ghpythonlib.treehelpers as tree

from compas_rhino.conversions import polyline_to_compas

# PARAMETERS
move_X = 295
move_Y = 197
radius_base = 50
radius_top = 50
layer_height = 0.9
total_height = 50
res_u = 50
offset = 1

# DEFINE THE CLASS
class Column:
    def __init__(self, axis: rg.Curve, radius_base: float, radius_top: float):
        """
        """
        self.axis = axis
        self.radius_base = radius_base
        self.radius_top = radius_top
        self.height = axis.PointAtEnd.Z - axis.PointAtStart.Z

        # Remap Axis Domain / 0-1
        self.axis.Domain = rg.Interval(0,1)

    def get_point(self, angle: float, tz: float, offset_pt: float = 0) -> rg.Point3d:
        """
        Args:
            angle: in polar coord. in radians
        """

        origin = self.axis.PointAt(tz)
        radius = self.radius_base*(1-tz) + self.radius_top*tz + offset_pt

        return rg.Point3d(
            origin.X + m.cos(angle)*radius + move_X,
            origin.Y + m.sin(angle)*radius + move_Y,
            origin.Z
        )

    def get_layers(self, layer_height: float, res_u: int, offset: float) -> list[int, list[list[rg.Point3d]]]:

        layers_count = int(self.height // layer_height) + 1
        # count = int(m.ceil(self.height // layer_height))

        layers = []
        #LAYERS LOOP
        for i, tz in enumerate(np.linspace(0, 1, layers_count)[1:]):
            layer = []
            radius_offset = offset if i% 2 == 1 else 0
            #POINTS LOOP
            for angle in np.linspace(0, m.tau, res_u)[:-1]:
                pt = self.get_point(angle, tz, radius_offset)
                layer.append(pt)

            layers.append(layer)
        
        return layers

    def get_curves(self, layers: list) -> list:
        # Convert each layer of points into a closed curve
        curves = []

        for layer in layers:
            curve = rg.Polyline(layer + [layer[0]])
            compas_polyline = polyline_to_compas(curve)
            curves.append(compas_polyline)

        
        return curves



# RUN THE CODE
if __name__ == "__main__":
    axis = rg.LineCurve(
        rg.Point3d(0,0,0),
        rg.Point3d(0,0,total_height)
    )

    mycolumn = Column(axis, radius_base, radius_top)
    layers = mycolumn.get_layers(layer_height, res_u, offset)
    curves = mycolumn.get_curves(layers)
    # layers = [rg.PolylineCurve(layer) for layer in layers]
    layers = tree.list_to_tree(layers)
    curves = tree.list_to_tree(curves)


# EXPLANATION OF CALCULATION
height = 100.0
lh = 4.5
count = int(height // lh)
print(count)
# ---------- end python_3_script ----------

number_slider_5 = Slider(50, range=0..100)  # disabled
number_slider_6 = Slider(50, range=0..100)  # disabled
number_slider_7 = Slider(10, range=0..100)  # disabled
number_slider_8 = Slider(20, range=0..100)  # disabled
python_3_script_2 = Python3Script(radius_base=number_slider_5, radius_top=number_slider_6, layer_height=number_slider_7, res_u=number_slider_8)  # -> out, layers, curves
# ---------- python_3_script_2: Python ----------
# IMPORTS
import Rhino.Geometry as rg
import math as m
import numpy as np
import ghpythonlib.treehelpers as tree

from compas_rhino.conversions import polyline_to_compas

# PARAMETERS
move_X = 295
move_Y = 197
radius_base = 50
radius_top = 50
layer_height = 1.2
total_height = 30
res_u = 49    #MULTIPLE OF 12 + 1
offset = 0

# DEFINE THE CLASS
class Column:
    def __init__(self, axis: rg.Curve, radius_base: float, radius_top: float):
        """
        """
        self.axis = axis
        self.radius_base = radius_base
        self.radius_top = radius_top
        self.height = axis.PointAtEnd.Z - axis.PointAtStart.Z

        # Remap Axis Domain / 0-1
        self.axis.Domain = rg.Interval(0,1)

    def get_point(self, angle: float, tz: float, offset_pt: float = 0) -> rg.Point3d:
        """
        Args:
            angle: in polar coord. in radians
        """

        origin = self.axis.PointAt(tz)
        radius = self.radius_base*(1-tz) + self.radius_top*tz + offset_pt

        return rg.Point3d(
            origin.X + m.cos(angle)*radius + move_X,
            origin.Y + m.sin(angle)*radius + move_Y,
            origin.Z
        )

    def get_layers(self, layer_height: float, res_u: int, offset: float) -> list[int, list[list[rg.Point3d]]]:

        layers_count = int(self.height // layer_height) + 1
        # count = int(m.ceil(self.height // layer_height))

        layers = []
        #LAYERS LOOP
        for i, tz in enumerate(np.linspace(0, 1, layers_count)[1:]):
            layer = []
            radius_offset = offset if i% 2 == 1 else 0
            #POINTS LOOP
            for angle in np.linspace(0, m.tau, res_u)[:-1]:
                pt = self.get_point(angle, tz, radius_offset)
                layer.append(pt)

            layers.append(layer)
        
        return layers

    def get_curves(self, layers: list) -> list:
        # Convert each layer of points into a closed curve
        curves = []

        for layer in layers:
            curve = rg.Polyline(layer + [layer[0]])
            compas_polyline = polyline_to_compas(curve)
            curves.append(compas_polyline)

        
        return curves


# RUN THE CODE
if __name__ == "__main__":
    axis = rg.LineCurve(
        rg.Point3d(0,0,0),
        rg.Point3d(0,0,total_height)
    )

    mycolumn = Column(axis, radius_base, radius_top)
    layers = mycolumn.get_layers(layer_height, res_u, offset)
    curves = mycolumn.get_curves(layers)
    # layers = [rg.PolylineCurve(layer) for layer in layers]
    layers = tree.list_to_tree(layers)
    curves = tree.list_to_tree(curves)


# # EXPLANATION OF CALCULATION
# height = 100.0
# lh = 4.5
# count = int(height // lh)
# print(count)
# ---------- end python_3_script_2 ----------

number_slider_9 = Slider(50, range=0..100)  # disabled
number_slider_10 = Slider(50, range=0..100)  # disabled
number_slider_11 = Slider(10, range=0..100)  # disabled
number_slider_12 = Slider(20, range=0..100)  # disabled
python_3_script_3 = Python3Script(radius_base=number_slider_9, radius_top=number_slider_10, layer_height=number_slider_11, res_u=number_slider_12)  # -> out, layers, curves
# ---------- python_3_script_3: Python ----------
# IMPORTS
import Rhino.Geometry as rg
import math as m
import numpy as np
import ghpythonlib.treehelpers as tree

from compas_rhino.conversions import polyline_to_compas

# PARAMETERS
move_X = 295
move_Y = 197
radius_base = 75
radius_top = 75
layer_height = 1.2
total_height = 50
res_u = (12 * 6) + 1 #MULTIPLE OF 12 + 1
offset = 0
shift_per_layer = -2
layer_change_every = 3
pt_offset = 3


# DEFINE THE CLASS
class Column:
    def __init__(self, axis: rg.Curve, radius_base: float, radius_top: float):
        """
        """
        self.axis = axis
        self.radius_base = radius_base
        self.radius_top = radius_top
        self.height = axis.PointAtEnd.Z - axis.PointAtStart.Z

        # Remap Axis Domain / 0-1
        self.axis.Domain = rg.Interval(0,1)

    def get_point(self, angle: float, tz: float, offset_pt: float = 0) -> rg.Point3d:
        """
        Args:
            angle: in polar coord. in radians
        """

        origin = self.axis.PointAt(tz)
        radius = self.radius_base*(1-tz) + self.radius_top*tz + offset_pt

        return rg.Point3d(
            origin.X + m.cos(angle)*radius,
            origin.Y + m.sin(angle)*radius,
            origin.Z
        )

    def get_radius(self, angle: float, tz: float) -> float:
        radius = self.radius_base*(1-tz) + self.radius_top*tz
        return radius

    def get_radius_wave(self, angle: float, tz: float, freq: int, amp: float) -> float:
        # ROTATE
        # shift = tz*m.radians(shift_rotation)
        # angle += shift

        # ROTATE BOTH DIRECTIONS
        shift = tz*m.radians(shift_rotation)
        a1 = angle+shift
        a2 = angle-shift
        _r1 = self.get_radius(angle, tz) + m.cos(a1*freq)*amp
        _r2 = self.get_radius(angle, tz) + m.cos(a2*freq)*amp

        # radius = _r1*(1-tz) + _r2*(tz)
        # radius = (_r1 + _r2) / 2
        radius = max(_r1, _r2)
        # radius = min(_r1, _r2)
        return radius

        # FADE
        #fade_from amp to circle
        # amp = (1-tz)*amp
        #fade_from circle to amp
        # amp = (tz)*amp
        #fade_from circle to amp
        # amp = m.pow(tz, 2)*amp

        # BLEND WAVE FREQUENCY
        # _r1 = m.cos(angle*freq1)*amp
        # _r2 = m.cos(angle*freq2)*amp
        # radius = self.get_radius(angle, tz) + _r1*(1-tz) + _r2*(tz)



        # MAIN RETURN
        # radius = self.get_radius(angle, tz) + m.cos(angle*freq)*amp
        # return radius

    def get_radius_bezier(self, tz: float) -> float:
        bezier = rg.BezierCurve(
            [
                rg.Point2d(0, 0),
                rg.Point2d(0.2, 20),
                rg.Point2d(0.8, 20),
                rg.Point2d(1, 0),
            ]
        )

        radius = self.radius_base*(1-tz) + self.radius_top*tz
        radius += bezier.PointAt(tz).Y*5
        return radius

    def get_layers(self, layer_height: float, res_u: int, offset: float) -> list[int, list[list[rg.Point3d]]]:

        layers_count = int(self.height // layer_height) + 1
        # count = int(m.ceil(self.height // layer_height))

        layers = []
        #LAYERS LOOP
        for i, tz in enumerate(np.linspace(0, 1, layers_count)[1:]):
            layer = []
            radius_offset = offset if (i//layer_change_every) % 2 == 1 else 0
            #POINTS LOOP
            for angle in np.linspace(0, m.tau, res_u)[:-1]:
                pt = self.get_point(angle, tz, radius_offset)
                layer.append(pt)

            layer = list(np.roll(layer, (i//layer_change_every) * shift_per_layer))

            for j, pt in enumerate(layer):
                offset_pt = pt_offset if i>= layer_change_every and (j//3) % 2 == 1 else 0
                if offset_pt != 0:
                    angle = m.atan2(
                        pt.Y - move_Y,
                        pt.X - move_X
                    )

                    layer[j] = rg.Point3d(
                        pt.X + m.cos(angle) * offset_pt,
                        pt.Y + m.sin(angle) * offset_pt,
                        pt.Z
                    )

                final_radius = radius_offset + offset_pt


            layers.append(layer)
        
        return layers

    def get_curves(self, layers: list) -> list:
        # Convert each layer of points into a closed curve
        curves = []

        for layer in layers:
            curve = rg.Polyline(layer + [layer[0]])
            compas_polyline = polyline_to_compas(curve)
            curves.append(compas_polyline)

        
        return curves

    @staticmethod
    def get_mesh(layers: list[list[rg.Point3d]], closed: bool) -> rg.Mesh:
        mesh = rg.Mesh()

        for layer in layers:
            for pt in layer:
                mesh.Vertices.Add(pt)

        idx = np.array(range(mesh.Vertices.Count))
        idx = idx.reshape(len(layers), len(layers[0]))
        
        if closed:
            faces = np.stack([
                idx[1:],                       #Bottom_Right
                idx[:-1],                      #Bottom_Left
                np.roll(idx[1:], -1, axis=1),  #Top_Left
                np.roll(idx[:-1], -1, axis=1)  #Top_Right                     
            ], axis = -1).reshape(-1, 4)
        else:
            faces = np.lib.stride_tricks.sliding_window_view(
                idx, window_shape=(2, 2)
            ).reshape(-1, 4)

        for f in faces:
            mesh.Faces.AddFace(
                int(f[0]),
                int(f[1]),
                int(f[3]),
                int(f[2])
            )

        mesh.Compact()
        mesh.RebuildNormals()
        return mesh

        print(faces)

        print(mesh.Vertices.Count)

# RUN THE CODE
if __name__ == "__main__":
    axis = rg.LineCurve(
        rg.Point3d(move_X,move_Y,0),
        rg.Point3d(move_X,move_Y,total_height)
    )

    mycolumn = Column(axis, radius_base, radius_top)
    layers = mycolumn.get_layers(layer_height, res_u, offset)
    curves = mycolumn.get_curves(layers)
    # layers = [rg.PolylineCurve(layer) for layer in layers]
    layers = tree.list_to_tree(layers)
    curves = tree.list_to_tree(curves)


# # EXPLANATION OF CALCULATION
# height = 100.0
# lh = 4.5
# count = int(height // lh)
# print(count)
# ---------- end python_3_script_3 ----------

# ----
number_slider_13 = Slider(50, range=0..100)  # disabled
number_slider_14 = Slider(50, range=0..100)  # disabled
number_slider_15 = Slider(10, range=0..100)  # disabled
number_slider_16 = Slider(20, range=0..100)  # disabled

# ----
# Measure work object
point_2 = ValueList({"origin", "xaxis", "xypoint"}, selected="xypoint")
capture = Button()
capture_wobj = CaptureWobj(robot_ip="192.168.10.10", point_name=point_2, capture=capture)  # -> wobj_origin, wobj_xaxis, wobj_xypoint, info
# ---------- capture_wobj: Python ----------
"""
Capture the 3 points that define the work object (robot base) plane.

Jog the TCP to a point, pick its name (origin / xaxis / xypoint) and press capture.
The TCP position (robot base frame, mm) is saved to wobj_calibration.json next to
this .ghx file, so the points survive closing Grasshopper.
"""
import os
import sys
import json
import time

import scriptcontext as sc
import Rhino.Geometry as rg

NAMES = ["origin", "xaxis", "xypoint"]

gh_dir = os.path.dirname(ghenv.Component.OnPingDocument().FilePath)
src_dir = os.path.join(gh_dir, "src")
if src_dir not in sys.path:
    sys.path.append(src_dir)
import simple_comm as com

path = os.path.join(gh_dir, "wobj_calibration.json")

data = {}
if os.path.exists(path):
    with open(path) as f:
        data = json.load(f)

# keep the last status in sticky, so the message survives the button being released
status_key = "capture_status_" + str(ghenv.Component.InstanceGuid)

if capture:
    if point_name not in NAMES:
        sc.sticky[status_key] = "pick origin / xaxis / xypoint"
    else:
        try:
            x, y, z = list(com.listen_to_robot(robot_ip)["pose"])[:3]  # metres, robot base frame
            data[point_name] = [round(x * 1000, 2), round(y * 1000, 2), round(z * 1000, 2)]  # -> mm
            with open(path, "w") as f:
                json.dump(data, f, indent=2)
            sc.sticky[status_key] = "{} captured {}".format(point_name, time.strftime("%H:%M:%S"))
        except Exception as e:
            print(e)
            sc.sticky[status_key] = "robot not reachable"

ghenv.Component.Message = sc.sticky.get(status_key, "")

def pt(name):
    return rg.Point3d(*data[name]) if name in data else None

wobj_origin, wobj_xaxis, wobj_xypoint = pt("origin"), pt("xaxis"), pt("xypoint")
info = json.dumps(data, indent=2)
# ---------- end capture_wobj ----------
wobj_calibration = Panel(capture_wobj.info)

# ---- group: This is needed only ONCE in the GH definition
enable_auto_reload = Python3Script()  # -> ok
# ---------- enable_auto_reload: Python ----------
"""
------------------------------
Using VS Code as Python editor
------------------------------

The simplest way to start using VS Code as our editor, is
to place our Python code in files located IN THE SAME FOLDER as our Grasshopper file.

After we have done that, we need 2 steps: 

1. Enable the COMPAS reloader on one component. This tells Grasshopper to watch for changes in the Pythoh files and reload if changed.
2. Every other component that uses Python code from external files needs to start with a method to ensure Grasshopper knows where to load the files from.

"""
# r: compas
# venv: mas-2627

from compas_rhino.devtools import DevTools
DevTools.enable_reloader()
# ---------- end enable_auto_reload ----------

# ----
# Geometry
brep = Brep(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)

cylinder = Cylinder(Base=point, Radius=Slider(75, range=0..100), Length=Slider(20, range=0..100))
python_3_script_4 = Python3Script(radius_base=number_slider_13, radius_top=number_slider_14, layer_height=number_slider_15, res_u=number_slider_16)  # -> out, layers, curves
# ---------- python_3_script_4: Python ----------
# IMPORTS
import Rhino.Geometry as rg
import math as m
import numpy as np
import ghpythonlib.treehelpers as tree

from compas_rhino.conversions import polyline_to_compas

# PARAMETERS
move_X = 295
move_Y = 197
radius_base = 50
radius_top = 50
layer_height = 1
total_height = 100
res_u = (12 * 6) + 1 #MULTIPLE OF 12 + 1
offset = 0
shift_per_layer = 0
layer_change_every = 1
pt_offset = 10
first_layers = 10
layers_without_offset = 5
cycle = layers_without_offset + 1


# DEFINE THE CLASS
class Column:
    def __init__(self, axis: rg.Curve, radius_base: float, radius_top: float):
        """
        """
        self.axis = axis
        self.radius_base = radius_base
        self.radius_top = radius_top
        self.height = axis.PointAtEnd.Z - axis.PointAtStart.Z

        # Remap Axis Domain / 0-1
        self.axis.Domain = rg.Interval(0,1)

    def get_point(self, angle: float, tz: float, offset_pt: float = 0) -> rg.Point3d:
        """
        Args:
            angle: in polar coord. in radians
        """

        origin = self.axis.PointAt(tz)
        radius = self.radius_base*(1-tz) + self.radius_top*tz + offset_pt

        return rg.Point3d(
            origin.X + m.cos(angle)*radius,
            origin.Y + m.sin(angle)*radius,
            origin.Z
        )

    def get_radius(self, angle: float, tz: float) -> float:
        radius = self.radius_base*(1-tz) + self.radius_top*tz
        return radius

    def get_radius_wave(self, angle: float, tz: float, freq: int, amp: float) -> float:
        # ROTATE
        # shift = tz*m.radians(shift_rotation)
        # angle += shift

        # ROTATE BOTH DIRECTIONS
        shift = tz*m.radians(shift_rotation)
        a1 = angle+shift
        a2 = angle-shift
        _r1 = self.get_radius(angle, tz) + m.cos(a1*freq)*amp
        _r2 = self.get_radius(angle, tz) + m.cos(a2*freq)*amp

        # radius = _r1*(1-tz) + _r2*(tz)
        # radius = (_r1 + _r2) / 2
        radius = max(_r1, _r2)
        # radius = min(_r1, _r2)
        return radius

        # FADE
        #fade_from amp to circle
        # amp = (1-tz)*amp
        #fade_from circle to amp
        # amp = (tz)*amp
        #fade_from circle to amp
        # amp = m.pow(tz, 2)*amp

        # BLEND WAVE FREQUENCY
        # _r1 = m.cos(angle*freq1)*amp
        # _r2 = m.cos(angle*freq2)*amp
        # radius = self.get_radius(angle, tz) + _r1*(1-tz) + _r2*(tz)



        # MAIN RETURN
        # radius = self.get_radius(angle, tz) + m.cos(angle*freq)*amp
        # return radius

    def get_radius_bezier(self, tz: float) -> float:
        bezier = rg.BezierCurve(
            [
                rg.Point2d(0, 0),
                rg.Point2d(0.2, 20),
                rg.Point2d(0.8, 20),
                rg.Point2d(1, 0),
            ]
        )

        radius = self.radius_base*(1-tz) + self.radius_top*tz
        radius += bezier.PointAt(tz).Y*5
        return radius

    def get_layers(self, layer_height: float, res_u: int, offset: float) -> list[int, list[list[rg.Point3d]]]:

        layers_count = int(self.height // layer_height) + 1
        # count = int(m.ceil(self.height // layer_height))

        layers = []
        #LAYERS LOOP
        for i, tz in enumerate(np.linspace(0, 1, layers_count)[1:]):
            layer = []
            radius_offset = offset if (i//layer_change_every) % 2 == 1 else 0
            #POINTS LOOP
            for angle in np.linspace(0, m.tau, res_u)[:-1]:
                pt = self.get_point(angle, tz, radius_offset)
                layer.append(pt)

            layer = list(np.roll(layer, (i//layer_change_every) * shift_per_layer))

            for j, pt in enumerate(layer):
                active_layer = (
                    i >= first_layers
                    and (i - first_layers) % cycle == 0
                )

                active_index = (i - first_layers) // cycle

                offset_pt = (
                    pt_offset
                    if active_layer and ((j // 2) + active_index) % 2 == 1
                    else 0
                )
                if offset_pt != 0:
                    angle = m.atan2(
                        pt.Y - move_Y,
                        pt.X - move_X
                    )

                    layer[j] = rg.Point3d(
                        pt.X + m.cos(angle) * offset_pt,
                        pt.Y + m.sin(angle) * offset_pt,
                        pt.Z
                    )

                final_radius = radius_offset + offset_pt


            layers.append(layer)
        
        return layers

    def get_curves(self, layers: list) -> list:
        # Convert each layer of points into a closed curve
        curves = []

        for layer in layers:
            curve = rg.Polyline(layer + [layer[0]])
            compas_polyline = polyline_to_compas(curve)
            curves.append(compas_polyline)

        
        return curves

    @staticmethod
    def get_mesh(layers: list[list[rg.Point3d]], closed: bool) -> rg.Mesh:
        mesh = rg.Mesh()

        for layer in layers:
            for pt in layer:
                mesh.Vertices.Add(pt)

        idx = np.array(range(mesh.Vertices.Count))
        idx = idx.reshape(len(layers), len(layers[0]))
        
        if closed:
            faces = np.stack([
                idx[1:],                       #Bottom_Right
                idx[:-1],                      #Bottom_Left
                np.roll(idx[1:], -1, axis=1),  #Top_Left
                np.roll(idx[:-1], -1, axis=1)  #Top_Right                     
            ], axis = -1).reshape(-1, 4)
        else:
            faces = np.lib.stride_tricks.sliding_window_view(
                idx, window_shape=(2, 2)
            ).reshape(-1, 4)

        for f in faces:
            mesh.Faces.AddFace(
                int(f[0]),
                int(f[1]),
                int(f[3]),
                int(f[2])
            )

        mesh.Compact()
        mesh.RebuildNormals()
        return mesh

        print(faces)

        print(mesh.Vertices.Count)

# RUN THE CODE
if __name__ == "__main__":
    axis = rg.LineCurve(
        rg.Point3d(move_X,move_Y,0),
        rg.Point3d(move_X,move_Y,total_height)
    )

    mycolumn = Column(axis, radius_base, radius_top)
    layers = mycolumn.get_layers(layer_height, res_u, offset)
    curves = mycolumn.get_curves(layers)
    # layers = [rg.PolylineCurve(layer) for layer in layers]
    layers = tree.list_to_tree(layers)
    curves = tree.list_to_tree(curves)


# # EXPLANATION OF CALCULATION
# height = 100.0
# lh = 4.5
# count = int(height // lh)
# print(count)
# ---------- end python_3_script_4 ----------

# ----
# Right points of the working space
panel = Panel("614.95,-63.4,16.71")
point_3 = Point(panel)
point_4 = Point("608.95,528.88,16.97")
point_5 = Point("218.39,-65.25,17.22")

point_list = PointList(Points=python_3_script_3.layers, Size=Slider(0.751, range=0..1))
point_list_2 = PointList(Points=python_3_script_4.layers, Size=Slider(1, range=0..1))

# ----
# LAYERS
spacing = Slider(1, range=0.5..5)
rotation = Slider(0, range=0..360)
bottom_offset = Slider(1, range=0.1..5)
layers = Python3Script(brep=cylinder, spacing=spacing, rotation=rotation, bottom_offset=bottom_offset)  # -> out, curves; inputs brep: Brep, spacing: Double, rotation: Double, bottom_offset: Double
# ---------- layers: Python ----------
import Rhino.Geometry as rg
import math

def slice_polysurface(brep, spacing, bottom_offset, rotation):
    """
    Slices a closed polysurface sequentially from bottom to top
    and aligns the start point (seam) of the curves according to the 'rotation' angle.
    
    :param brep: Rhino.Geometry.Brep (input geometry)
    :param spacing: Distance between cutting planes (float > 0)
    :param bottom_offset: Distance from the first cutting plane to the base surface (float >= 0)
    :param rotation: Start angle in degrees (0.0 to 360.0) for the seam / start point
    :return: List of contour curves, sorted from bottom to top
    """
    if not brep or spacing <= 0 or bottom_offset < 0:
        return []

    # 1. Get bounding box & height limits
    bbox = brep.GetBoundingBox(True)
    z_min = bbox.Min.Z
    z_max = bbox.Max.Z

    start_z = z_min + bottom_offset

    if start_z > z_max:
        return []

    # 2. Calculate number of cuts & center data
    num_cuts = int(math.floor((z_max - start_z) / spacing)) + 1
    
    center_x = bbox.Center.X
    center_y = bbox.Center.Y

    # Radius for the alignment vector (+ 50% safety margin)
    dx = max(abs(bbox.Min.X - center_x), abs(bbox.Max.X - center_x))
    dy = max(abs(bbox.Min.Y - center_y), abs(bbox.Max.Y - center_y))
    r_max = math.hypot(dx, dy) * 1.5

    # Convert angle from degrees to radians
    rot_rad = math.radians(rotation)
    dir_x = math.cos(rot_rad)
    dir_y = math.sin(rot_rad)

    sliced_curves = []

    # 3. Iteratively generate cutting planes & adjust seam (start point)
    for i in range(num_cuts):
        current_z = start_z + i * spacing
        cut_plane = rg.Plane(rg.Point3d(center_x, center_y, current_z), rg.Vector3d.ZAxis)
        
        contours = rg.Brep.CreateContourCurves(brep, cut_plane)
        
        if contours:
            # Create target point for the seam at the current height
            target_pt = rg.Point3d(center_x + r_max * dir_x, center_y + r_max * dir_y, current_z)

            for crv in contours:
                if crv.IsClosed:
                    # Find closest point on curve and move seam there
                    success, t_param = crv.ClosestPoint(target_pt)
                    if success:
                        crv.ChangeClosedCurveSeam(t_param)

                sliced_curves.append(crv)

    return sliced_curves

# Assignment to component output parameter
curves = slice_polysurface(brep, spacing, bottom_offset, rotation)
# ---------- end layers ----------

# ----
# PATH
number_slider_17 = Slider(36, range=0..100)

# ----
# SPIRAL
spacing_2 = Slider(1.1, range=0.5..5)
bottom_offset_2 = Slider(1.1, range=0.1..5)
bottom_angle = Slider(279, range=0..360)
rotation_2 = Slider(0, range=0..360)
spiral = Python3Script(
    brep=brep,
    spacing=spacing_2,
    bottom_offset=bottom_offset_2,
    rotation=rotation_2,
    bottom_curve=bottom_angle,
    precision=number_slider_17)  # -> out, curves, curves_to_join; inputs brep: Brep, spacing: Double, bottom_offset: Double, rotation: Double, precision: Int32
# ---------- spiral: Python ----------
import Rhino.Geometry as rg
import math

def spiral_slice_polysurface(brep, spacing, bottom_offset, rotation, bottom_curve=0.0, precision=36):
    """
    Generates a continuously rising spiral slicing curve on a polysurface with an optional 
    horizontal bottom loop.
    
    :param brep: Rhino.Geometry.Brep (input geometry)
    :param spacing: Height gain per 360° turn (float > 0)
    :param bottom_offset: Start height from base surface (float >= 0)
    :param rotation: Start angle of the spiral in degrees (0.0 to 360.0)
    :param bottom_curve: Angular extent of the base curve in degrees (0.0 to 360.0; 0 = no base curve)
    :param precision: Number of control points per 360° turn (int > 0, default: 36)
    :return: List of joined contour curves
    """
    if not brep or spacing <= 0 or bottom_offset < 0 or precision <= 0:
        return []

    # 1. Bounding box & height limits
    bbox = brep.GetBoundingBox(True)
    z_min, z_max = bbox.Min.Z, bbox.Max.Z

    start_z = z_min + bottom_offset
    end_z = z_max - 0.1  # Ends 0.1 units below highest point

    if start_z >= end_z:
        return []

    center_x, center_y = bbox.Center.X, bbox.Center.Y

    # Radius of the cutting helicoid (+ 50% safety margin)
    dx = max(abs(bbox.Min.X - center_x), abs(bbox.Max.X - center_x))
    dy = max(abs(bbox.Min.Y - center_y), abs(bbox.Max.Y - center_y))
    r_max = math.hypot(dx, dy) * 1.5

    # 2. Calculate helicoid parameters
    total_height = end_z - start_z
    turns = total_height / float(spacing)
    total_samples = max(20, int(turns * precision))

    start_angle_rad = math.radians(rotation)
    two_pi = 2.0 * math.pi

    # 3. Construct cutting helicoid geometry
    crv_inner = rg.Line(rg.Point3d(center_x, center_y, start_z), rg.Point3d(center_x, center_y, end_z)).ToNurbsCurve()

    pts_outer = []
    for i in range(total_samples):
        t = i / float(total_samples - 1)
        curr_z = start_z + t * total_height
        angle = start_angle_rad - (t * turns * two_pi)

        xo = center_x + r_max * math.cos(angle)
        yo = center_y + r_max * math.sin(angle)
        pts_outer.append(rg.Point3d(xo, yo, curr_z))

    crv_outer = rg.NurbsCurve.CreateControlPointCurve(pts_outer, 3)
    if not crv_outer:
        return []

    # 4. Create cutting surface & calculate intersection
    helicoid_srf = rg.NurbsSurface.CreateRuledSurface(crv_inner, crv_outer)
    if not helicoid_srf:
        return []

    tol = 0.001
    rc, int_curves, _ = rg.Intersect.Intersection.BrepSurface(brep, helicoid_srf, tol)

    if not rc or not int_curves:
        return []

    # Join spiral segments & sort by height
    joined_spirals = rg.Curve.JoinCurves(int_curves, tol)
    if not joined_spirals:
        return []

    joined_spirals = sorted(joined_spirals, key=lambda c: min(c.PointAtStart.Z, c.PointAtEnd.Z))

    # Orient spiral segments from bottom to top
    spiral_start_pt = None
    for i, sc in enumerate(joined_spirals):
        if sc.PointAtStart.Z > sc.PointAtEnd.Z:
            sc.Reverse()
        if i == 0:
            spiral_start_pt = sc.PointAtStart

    curves_to_join = []

    # 5. Process optional base cut at start height
    if bottom_curve > 0 and spiral_start_pt:
        cut_plane = rg.Plane(rg.Point3d(center_x, center_y, start_z), rg.Vector3d.ZAxis)
        base_contours = rg.Brep.CreateContourCurves(brep, cut_plane)

        if base_contours:
            base_crv = min(
                base_contours,
                key=lambda c: c.PointAt(c.ClosestPoint(spiral_start_pt)[1]).DistanceTo(spiral_start_pt)
            )

            _, t_seam = base_crv.ClosestPoint(spiral_start_pt)
            base_crv.ChangeClosedCurveSeam(t_seam)

            if base_crv.ClosedCurveOrientation(rg.Plane.WorldXY) == rg.CurveOrientation.CounterClockwise:
                base_crv.Reverse()

            angle_clamped = max(0.0, min(360.0, float(bottom_curve)))
            if angle_clamped < 360.0:
                t_end = base_crv.Domain.Max
                t_start = t_end - ((angle_clamped / 360.0) * base_crv.Domain.Length)

                trimmed = base_crv.Trim(t_start, t_end)
                if trimmed:
                    base_crv = trimmed

            curves_to_join.append(base_crv)
            print(base_crv)

    curves_to_join.extend(joined_spirals)

    # 6. Final join step
    final_result = rg.Curve.JoinCurves(curves_to_join, tol)
    return curves_to_join, list(final_result) if final_result else curves_to_join

# Assignment to component output parameter
curves_to_join, curves = spiral_slice_polysurface(brep, spacing, bottom_offset, rotation, bottom_curve, precision)
# ---------- end spiral ----------

point_6 = Point(capture_wobj.wobj_origin)
point_7 = Point(capture_wobj.wobj_xaxis)
point_8 = Point(capture_wobj.wobj_xypoint)

# ---- group: PRINTPATH
# generate printpath: printpoints and path
safety_distance_mm = Slider(100, range=10..300)
blend_radius_mm = Slider(1, range=0..5)
speed_mm_s = Slider(10, range=1..50)
printpath = Printpath(layers=python_3_script.curves, speed=speed_mm_s, blend_radius=blend_radius_mm, safety_distance=safety_distance_mm)  # -> printpath, summary, printpoints; inputs layers: list
# ---------- printpath: Python ----------
# r: compas
# venv: mas-2627
"""
Turn the layers into printpoints and a PrintPath, in work object coordinates.
Safety points are added here, before any transform to the robot base.
"""
import os
import sys

from compas.geometry import Frame, Vector


# Find source folder
gh_dir = os.path.dirname(ghenv.Component.OnPingDocument().FilePath)
src_dir = os.path.join(gh_dir, "src")
if src_dir not in sys.path:
    sys.path.append(src_dir)
from print_class import PrintPoint, PrintPath

# ===== One printpoint per point =====
# world XY orientation for every point: a tangent frame would turn the wrist 360 degrees each layer
printpoints = []
for layer_index, layer in enumerate(layers):
    for point in layer.points:
        frame = Frame(point, -Vector.Xaxis(), Vector.Yaxis())
        printpoints.append(PrintPoint(frame, layer_index, speed, blend_radius, True))

# ===== Path with a travel point above the start and the end =====
printpath = PrintPath(printpoints)
printpath.add_safety_before(safety_distance, speed)
printpath.add_safety_after(safety_distance, speed)

summary = f"{len(printpoints)} printpoints in {len(layers)} layers, plus 2 safety points"
# ---------- end printpath ----------
panel_2 = Panel(printpath.summary)

# ----
blend_radius_mm_2 = Slider(1, range=0..5)
safety_distance_mm_2 = Slider(100, range=10..300)
speed_mm_s_2 = Slider(30, range=1..50)

# ---- group: PRINTPATH_2 speeds
# generate printpath: printpoints and path
blend_radius_mm_3 = Slider(1, range=0..5)
safety_distance_mm_3 = Slider(100, range=10..300)
speed_mm_s_3 = Slider(10, range=1..50)
printpath_2 = Printpath(
    layers=python_3_script_3.curves,
    speed=speed_mm_s_3,
    speed_2=speed_mm_s_2,
    blend_radius=blend_radius_mm_3,
    safety_distance=safety_distance_mm_3)  # -> printpath, summary, printpoints; inputs layers: list
# ---------- printpath_2: Python ----------
# r: compas
# venv: mas-2627
"""
Turn the layers into printpoints and a PrintPath, in work object coordinates.
Safety points are added here, before any transform to the robot base.
"""

# IMPORTS
import os
import sys

from compas.geometry import Frame, Vector


# Find source folder
gh_dir = os.path.dirname(ghenv.Component.OnPingDocument().FilePath)
src_dir = os.path.join(gh_dir, "src")
if src_dir not in sys.path:
    sys.path.append(src_dir)
from print_class import PrintPoint, PrintPath

# PARAMETERS

# ===== One printpoint per point =====
# world XY orientation for every point: a tangent frame would turn the wrist 360 degrees each layer
printpoints = []
for layer_index, layer in enumerate(layers):
    
    for i, point in enumerate(layer.points):
        speed_value = speed if layer_index < 3 or (i // 3) % 2 == 0 else speed_2
        # extrusor_on = False if (i // 2) % 2 == 0 else True
        frame = Frame(point, -Vector.Xaxis(), Vector.Yaxis())
        printpoints.append(PrintPoint(frame, layer_index, speed_value, blend_radius, True))

# printpoints = []
# for layer_index, layer in enumerate(layers):
#     speed_value = speed if layer_index % 2 == 0 else speed_2
#     for point in layer.points:
#         frame = Frame(point, -Vector.Xaxis(), Vector.Yaxis())
#         printpoints.append(PrintPoint(frame, layer_index, speed_value, blend_radius, True))
#     print(printpoints)

# ===== Path with a travel point above the start and the end =====
printpath = PrintPath(printpoints)
printpath.add_safety_before(safety_distance, speed)
printpath.add_safety_after(safety_distance, speed)

summary = f"{len(printpoints)} printpoints in {len(layers)} layers, plus 2 safety points"
# ---------- end printpath_2 ----------
panel_3 = Panel(printpath_2.summary)

# ----
# generate printpath: printpoints and path
speed_mm_s_4 = Slider(15, range=1..50)
speed_mm_s_5 = Slider(15, range=1..50)
curve = Curve(spiral.curves_to_join)
python_3_script_5 = Python3Script(crvs=layers.curves)  # -> out, crvs; inputs crvs: list of Curve
# ---------- python_3_script_5: Python ----------
import Rhino.Geometry as rg 

crv = crvs[0]
starting_pt = crv.PointAt(0)
vec = rg.Vector3d.CrossProduct(crv.TangentAtStart ,rg.Vector3d(0,0,1))

zero_pt = starting_pt + vec * 60

starting_crv = rg.LineCurve(zero_pt, starting_pt)

crvs.insert(0, starting_crv)
# ---------- end python_3_script_5 ----------

# ----
# FRAMES AND PRINTPATH
safety_distance_mm_4 = Slider(100, range=10..300)
point_spacing_mm = Slider(3, range=1..50)
blend_radius_mm_4 = Slider(1, range=0..5)
speed_mm_s_6 = Slider(15, range=1..60)
printpath_3 = Printpath(
    curves=python_3_script.curves,
    speed=speed_mm_s_6,
    blend_radius=blend_radius_mm_4,
    safety_distance=safety_distance_mm_4,
    point_distance=point_spacing_mm)  # -> printpath, summary, frame; inputs curves: list of Curve, speed: Double, blend_radius: Double, safety_distance: Double, point_distance: Double
# ---------- printpath_3: Python ----------
# r: compas
# venv: mas-2627
"""
Turn the curves into printpoints and a PrintPath, in work object coordinates.
Safety points are added here, before any transform to the robot base.
"""
import os
import sys
from compas.geometry import Frame, Vector, Point

# Include source path once
gh_dir = os.path.dirname(ghenv.Component.OnPingDocument().FilePath)
src_dir = os.path.abspath(os.path.join(gh_dir, "src"))
if src_dir not in sys.path:
    sys.path.append(src_dir)

from print_class import PrintPoint, PrintPath

# 1. Validate inputs
if not curves:
    curves = []
elif not isinstance(curves, list):
    curves = [curves]

valid_curves = [c for c in curves if c]
num_curves = len(valid_curves)

# Set default distance (fallback: 2.0)
point_dist = float(point_distance) if ('point_distance' in locals() and point_distance and point_distance > 0) else 2.0

# 2. Define vectors ONCE outside the loops (saves thousands of object creations)
vec_x = -Vector.Xaxis()
vec_y = Vector.Yaxis()

printpoints = []

# 3. Calculate print points per curve
for layer_index, curve in enumerate(valid_curves):
    # Query start point of curve once
    start_pt = curve.PointAtStart

    # Divide curve into segments
    t_params = curve.DivideByLength(point_dist, True)
    if t_params:
        pts = [curve.PointAt(t) for t in t_params]
    else:
        pts = [start_pt]

    # Close layer (except for the very last curve)
    if layer_index < num_curves - 1:
        if layer_index !=0:
            if pts[-1].DistanceTo(start_pt) > 1e-6:
                pts.append(start_pt)

    # Create COMPAS frames & PrintPoints
    for pt in pts:
        frame = Frame(Point(pt.X, pt.Y, pt.Z), vec_x, vec_y)
        printpoints.append(PrintPoint(frame, layer_index, speed, blend_radius, True))

# 4. Generate PrintPath with safety points
printpath = PrintPath(printpoints)
printpath.add_safety_before(safety_distance, speed)
printpath.add_safety_after(safety_distance, speed)

frame = []
for item in printpoints:
    frame.append(item.frame)

summary = f"{len(printpoints)} printpoints in {num_curves} curves, plus 2 safety points"
# ---------- end printpath_3 ----------
panel_4 = Panel(printpath_3.summary)

list_length = ListLength(List=printpath_3.frame)  # -> flatten(Length)
panel_5 = Panel(list_length)
division = Division(A=list_length, B=Slider(100, range=0..100))
integer = Integer(division)
panel_6 = Panel(integer)

number_slider_18 = Slider(20, range=0..100)
printpath_4 = Printpath(
    layers=python_3_script_4.curves,
    speed=speed_mm_s_4,
    speed_2=speed_mm_s_5,
    blend_radius=blend_radius_mm_2,
    safety_distance=safety_distance_mm_2)  # -> printpath, summary, printpoints; inputs layers: list; same code as printpath_2
panel_7 = Panel(printpath_4.summary)
partition_list = PartitionList(List=flatten(printpath_3.frame), Size=integer)
tree_statistics = TreeStatistics(Tree=partition_list)  # -> Paths, Length, Count
compas_draw = COMPASDraw(cg=printpath_3.frame)  # -> rg
#   port cg: The COMPAS geometry or datastructure to be drawn.
#   port rg: The Rhino geometry object.
# ---------- compas_draw: Python ----------
# r: compas>=2.14.1
"""
Draws COMPAS geometry in Grasshopper.
"""

from typing import Any

import Grasshopper

from compas.scene import SceneObject


class CompasToRhinoGeometry(Grasshopper.Kernel.GH_ScriptInstance):
    def RunScript(self, cg):
        if not cg:
            return None

        return SceneObject(item=cg).draw()[0]
# ---------- end compas_draw ----------
list_item = ListItem(List=compas_draw, Index=0, Wrap=True)  # -> flatten(Item)
list_item_2 = ListItem(List=list_item, Index=Slider(9, range=0..50), Wrap=True)
tree_item = TreeItem(Tree=partition_list, Path=tree_statistics.Paths, Index=Slider(30, range=0..30), Wrap=True)

# ----
# EXPORT
save = Button()
preview = Preview(printpath=printpath_4.printpath)  # -> path, travel, planes
# ---------- preview: Python ----------
# r: compas
# venv: mas-2627
"""
Draw the printpath: path = the whole polyline, travel = extruder-off segments,
safety = extruder-off points, axes = small x and y axis of each frame.
"""
import Rhino.Geometry as rg
from compas_rhino.conversions import frame_to_rhino_plane, point_to_rhino

AXIS_LENGTH = 5.0  # mm

points = printpath.printpoints
planes = [frame_to_rhino_plane(printpoint.frame) for printpoint in points]

# ===== Whole path =====
polyline = rg.Polyline()
for plane in planes:
    polyline.Add(plane.Origin.X, plane.Origin.Y, plane.Origin.Z)
path = polyline.ToPolylineCurve()

# ===== Extruder off: a segment prints only if both of its points have the extruder on =====
safety = [point_to_rhino(printpoint.frame.point) for printpoint in points if not printpoint.is_extruder_on]
travel = []
for i in range(len(points) - 1):
    if not (points[i].is_extruder_on and points[i + 1].is_extruder_on):
        travel.append(rg.Line(planes[i].Origin, planes[i + 1].Origin))
# ---------- end preview ----------
save_2 = Save(printpath=printpath_4.printpath, save=save, out_path="data/out_printpoints_trele.json")  # -> status
# ---------- save_2: Python ----------
# r: compas
# venv: mas-2627
"""
On button press, write the printpath to data/out_printpoints.json next to this .ghx file.
send_to_robot.py reads that file.
"""
import json
import os

import scriptcontext as sc

gh_dir = os.path.dirname(ghenv.Component.OnPingDocument().FilePath)

# keep the last status in sticky, so the message survives the button being released
status_key = "save_status_" + str(ghenv.Component.InstanceGuid)

if save:
    if printpath is None:
        sc.sticky[status_key] = "nothing to save: no printpath"
    else:
        path = os.path.normpath(os.path.join(gh_dir, out_path))
        os.makedirs(os.path.dirname(path), exist_ok=True)
        with open(path, "w") as f:
            json.dump(printpath.to_dict(), f, indent=2)
        sc.sticky[status_key] = f"saved {len(printpath)} printpoints to {path}"

status = sc.sticky.get(status_key, "")
ghenv.Component.Message = "saved" if status.startswith("saved") else status
# ---------- end save_2 ----------
plane = Plane(preview.planes)
preview_2 = CustomPreview(Geometry=preview.path, Material=ColourSwatch(SwatchColor=RGB(0, 170, 80)))
preview_3 = CustomPreview(Geometry=preview.travel, Material=ColourSwatch(SwatchColor=RGB(230, 40, 40)))

panel_8 = Panel(printpath_2.printpoints)

# ----
# EXPORT
save_3 = Button()
preview_4 = Preview(printpath=printpath_3.printpath)  # -> path, travel, planes; same code as preview
save_4 = Save(printpath=printpath_3.printpath, save=save_3, out_path="data/out_printpoints.json")  # -> status; same code as save_2
preview_5 = CustomPreview(Geometry=preview_4.path, Material=ColourSwatch(SwatchColor=RGB(0, 170, 80)))
preview_6 = CustomPreview(Geometry=preview_4.travel, Material=ColourSwatch(SwatchColor=RGB(230, 40, 40)))
plane_2 = Plane(preview_4.planes)
