# Grasshopper definition G4_design_Nils.ghx (Grasshopper 1.0.8)

# ---- group: This is needed only ONCE in the GH definition
enable_auto_reload = Python3Script()  # -> ok
# ---------- enable_auto_reload: Python ----------
"""
------------------------------
Using VS Code as Python editor
------------------------------

The simplest way to start using VS Code as our editor, is
to place our Python code in files located IN THE SAME FOLDER as our Grasshopper file.

After we have done that, we need 2 steps: 

1. Enable the COMPAS reloader on one component. This tells Grasshopper to watch for changes in the Pythoh files and reload if changed.
2. Every other component that uses Python code from external files needs to start with a method to ensure Grasshopper knows where to load the files from.

"""
# r: compas
# venv: mas-2627

from compas_rhino.devtools import DevTools
DevTools.enable_reloader()
# ---------- end enable_auto_reload ----------

# ----
# Geometry
brep = Brep(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)
brep_2 = Brep(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)
brep_3 = Brep(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)

curve = Curve(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)
curve_2 = Curve(<curve referenced from the Rhino model>)

# ----
# LAYERS
spacing = Slider(0.6, range=0.5..5)
rotation = Slider(0, range=0..360)
bottom_offset = Slider(0.6, range=0.1..5)
_3d_to_crvs_layers = Python3Script(brep=brep_3, spacing=spacing, rotation=rotation, bottom_offset=bottom_offset)  # -> out, curves; inputs brep: Brep, spacing: Double, rotation: Double, bottom_offset: Double
# ---------- _3d_to_crvs_layers: Python ----------
import Rhino.Geometry as rg
import math

def slice_polysurface(brep, spacing, bottom_offset, rotation):
    """
    Slices a closed polysurface sequentially from bottom to top
    and aligns the start point (seam) of the curves according to the 'rotation' angle.
    
    :param brep: Rhino.Geometry.Brep (input geometry)
    :param spacing: Distance between cutting planes (float > 0)
    :param bottom_offset: Distance from the first cutting plane to the base surface (float >= 0)
    :param rotation: Start angle in degrees (0.0 to 360.0) for the seam / start point
    :return: List of contour curves, sorted from bottom to top
    """
    if not brep or spacing <= 0 or bottom_offset < 0:
        return []

    # 1. Get bounding box & height limits
    bbox = brep.GetBoundingBox(True)
    z_min = bbox.Min.Z
    z_max = bbox.Max.Z

    start_z = z_min + bottom_offset

    if start_z > z_max:
        return []

    # 2. Calculate number of cuts & center data
    num_cuts = int(math.floor((z_max - start_z) / spacing)) + 1
    
    center_x = bbox.Center.X
    center_y = bbox.Center.Y

    # Radius for the alignment vector (+ 50% safety margin)
    dx = max(abs(bbox.Min.X - center_x), abs(bbox.Max.X - center_x))
    dy = max(abs(bbox.Min.Y - center_y), abs(bbox.Max.Y - center_y))
    r_max = math.hypot(dx, dy) * 1.5

    # Convert angle from degrees to radians
    rot_rad = math.radians(rotation)
    dir_x = math.cos(rot_rad)
    dir_y = math.sin(rot_rad)

    sliced_curves = []

    # 3. Iteratively generate cutting planes & adjust seam (start point)
    for i in range(num_cuts):
        current_z = start_z + i * spacing
        cut_plane = rg.Plane(rg.Point3d(center_x, center_y, current_z), rg.Vector3d.ZAxis)
        
        contours = rg.Brep.CreateContourCurves(brep, cut_plane)
        
        if contours:
            # Create target point for the seam at the current height
            target_pt = rg.Point3d(center_x + r_max * dir_x, center_y + r_max * dir_y, current_z)

            for crv in contours:
                if crv.IsClosed:
                    # Find closest point on curve and move seam there
                    success, t_param = crv.ClosestPoint(target_pt)
                    if success:
                        crv.ChangeClosedCurveSeam(t_param)

                sliced_curves.append(crv)

    return sliced_curves

# Assignment to component output parameter
curves = slice_polysurface(brep, spacing, bottom_offset, rotation)
# ---------- end _3d_to_crvs_layers ----------

# ----
# 3D TO CRV
number_slider = Slider(36, range=0..100)

# ----
# SPIRAL
spacing_2 = Slider(1.1, range=0.5..5)
bottom_offset_2 = Slider(1.1, range=0.1..5)
rotation_2 = Slider(0, range=0..360)
bottom_angle = Slider(279, range=0..360)
_3d_to_crvs_spiral = Python3Script(
    brep=brep_3,
    spacing=spacing_2,
    bottom_offset=bottom_offset_2,
    rotation=rotation_2,
    bottom_curve=bottom_angle,
    precision=number_slider)  # -> out, curves, curves_to_join; inputs brep: Brep, spacing: Double, bottom_offset: Double, rotation: Double, precision: Int32
# ---------- _3d_to_crvs_spiral: Python ----------
import Rhino.Geometry as rg
import math

def spiral_slice_polysurface(brep, spacing, bottom_offset, rotation, bottom_curve=0.0, precision=36):
    """
    Generates a continuously rising spiral slicing curve on a polysurface with an optional 
    horizontal bottom loop.
    
    :param brep: Rhino.Geometry.Brep (input geometry)
    :param spacing: Height gain per 360° turn (float > 0)
    :param bottom_offset: Start height from base surface (float >= 0)
    :param rotation: Start angle of the spiral in degrees (0.0 to 360.0)
    :param bottom_curve: Angular extent of the base curve in degrees (0.0 to 360.0; 0 = no base curve)
    :param precision: Number of control points per 360° turn (int > 0, default: 36)
    :return: List of joined contour curves
    """
    if not brep or spacing <= 0 or bottom_offset < 0 or precision <= 0:
        return []

    # 1. Bounding box & height limits
    bbox = brep.GetBoundingBox(True)
    z_min, z_max = bbox.Min.Z, bbox.Max.Z

    start_z = z_min + bottom_offset
    end_z = z_max - 0.1  # Ends 0.1 units below highest point

    if start_z >= end_z:
        return []

    center_x, center_y = bbox.Center.X, bbox.Center.Y

    # Radius of the cutting helicoid (+ 50% safety margin)
    dx = max(abs(bbox.Min.X - center_x), abs(bbox.Max.X - center_x))
    dy = max(abs(bbox.Min.Y - center_y), abs(bbox.Max.Y - center_y))
    r_max = math.hypot(dx, dy) * 1.5

    # 2. Calculate helicoid parameters
    total_height = end_z - start_z
    turns = total_height / float(spacing)
    total_samples = max(20, int(turns * precision))

    start_angle_rad = math.radians(rotation)
    two_pi = 2.0 * math.pi

    # 3. Construct cutting helicoid geometry
    crv_inner = rg.Line(rg.Point3d(center_x, center_y, start_z), rg.Point3d(center_x, center_y, end_z)).ToNurbsCurve()

    pts_outer = []
    for i in range(total_samples):
        t = i / float(total_samples - 1)
        curr_z = start_z + t * total_height
        angle = start_angle_rad - (t * turns * two_pi)

        xo = center_x + r_max * math.cos(angle)
        yo = center_y + r_max * math.sin(angle)
        pts_outer.append(rg.Point3d(xo, yo, curr_z))

    crv_outer = rg.NurbsCurve.CreateControlPointCurve(pts_outer, 3)
    if not crv_outer:
        return []

    # 4. Create cutting surface & calculate intersection
    helicoid_srf = rg.NurbsSurface.CreateRuledSurface(crv_inner, crv_outer)
    if not helicoid_srf:
        return []

    tol = 0.001
    rc, int_curves, _ = rg.Intersect.Intersection.BrepSurface(brep, helicoid_srf, tol)

    if not rc or not int_curves:
        return []

    # Join spiral segments & sort by height
    joined_spirals = rg.Curve.JoinCurves(int_curves, tol)
    if not joined_spirals:
        return []

    joined_spirals = sorted(joined_spirals, key=lambda c: min(c.PointAtStart.Z, c.PointAtEnd.Z))

    # Orient spiral segments from bottom to top
    spiral_start_pt = None
    for i, sc in enumerate(joined_spirals):
        if sc.PointAtStart.Z > sc.PointAtEnd.Z:
            sc.Reverse()
        if i == 0:
            spiral_start_pt = sc.PointAtStart

    curves_to_join = []

    # 5. Process optional base cut at start height
    if bottom_curve > 0 and spiral_start_pt:
        cut_plane = rg.Plane(rg.Point3d(center_x, center_y, start_z), rg.Vector3d.ZAxis)
        base_contours = rg.Brep.CreateContourCurves(brep, cut_plane)

        if base_contours:
            base_crv = min(
                base_contours,
                key=lambda c: c.PointAt(c.ClosestPoint(spiral_start_pt)[1]).DistanceTo(spiral_start_pt)
            )

            _, t_seam = base_crv.ClosestPoint(spiral_start_pt)
            base_crv.ChangeClosedCurveSeam(t_seam)

            if base_crv.ClosedCurveOrientation(rg.Plane.WorldXY) == rg.CurveOrientation.CounterClockwise:
                base_crv.Reverse()

            angle_clamped = max(0.0, min(360.0, float(bottom_curve)))
            if angle_clamped < 360.0:
                t_end = base_crv.Domain.Max
                t_start = t_end - ((angle_clamped / 360.0) * base_crv.Domain.Length)

                trimmed = base_crv.Trim(t_start, t_end)
                if trimmed:
                    base_crv = trimmed

            curves_to_join.append(base_crv)
            print(base_crv)

    curves_to_join.extend(joined_spirals)

    # 6. Final join step
    final_result = rg.Curve.JoinCurves(curves_to_join, tol)
    return curves_to_join, list(final_result) if final_result else curves_to_join

# Assignment to component output parameter
curves_to_join, curves = spiral_slice_polysurface(brep, spacing, bottom_offset, rotation, bottom_curve, precision)
# ---------- end _3d_to_crvs_spiral ----------

python_3_script = Python3Script(
    axis_curve=curve_2,
    resolution=Slider(80, range=10..200),
    radius_1=Slider(50, range=0..100),
    radius_2=Slider(50, range=0..100),
    height=Slider(300, range=0..300),
    layer_height=Slider(0.85, range=0..10),
    offset_x=Slider(0, range=-100..100),
    offset_y=Slider(0, range=-100..100),
    freq1=Slider(0, range=0..10),
    freq2=Slider(0, range=0..10),
    rotation=Slider(0, range=-360..360),
    amplitude=Slider(0, range=0..20))  # -> out, flatten(layers), mesh; inputs axis_curve: Curve, resolution: Int32, radius_1: Double, radius_2: Double, offset_x: Double, offset_y: Double, freq1: Int32, freq2: Int32, rotation: Double, amplitude: Double
# ---------- python_3_script: Python ----------
import Rhino.Geometry as rg
import math as m
import numpy as np

class Column:
    def __init__(
        self, 
        axis: rg.Curve, 
        radius_base: float, 
        radius_top: float,
        amp: float = 0.0,
        rotation: float = 0.0,
        freq1: int = 1,
        freq2: int = 1
    ):
        self.axis = axis
        self.radius_base = radius_base
        self.radius_top = radius_top
        self.amp = amp
        self.rotation = rotation
        self.freq1 = freq1
        self.freq2 = freq2
        
        self.height = self.axis.GetLength()

    def get_radius(self, angle: float, tz: float) -> float:
        return self.radius_base * (1 - tz) + self.radius_top * tz

    def get_radius_wave(self, angle: float, tz: float) -> float:
        shift = tz * m.radians(self.rotation)
        angle_shifted = angle + shift

        _r1 = m.cos(angle_shifted * self.freq1) * self.amp
        _r2 = m.cos(angle_shifted * self.freq2) * self.amp

        return self.get_radius(angle_shifted, tz) + _r1 * (1 - tz) + _r2 * tz

    def get_layer_frames(self, layer_height: float, res_u: int) -> list[list[rg.Plane]]:
        """
        Erstellt für jeden Punkt auf den Schichten einen Frame (rg.Plane):
        - Z-Achse zeigt entlang der Kurvenachse nach unten (-Tangent)
        - X-Achse zeigt für alle Frames einheitlich in die globale X-Richtung (projiziert)
        """
        layers_count = max(2, int(self.height // layer_height) + 1)
        s_values = np.linspace(0.0, 1.0, layers_count)
        
        layers_frames = []

        for tz in s_values:
            rc, t = self.axis.NormalizedLengthParameter(tz)
            if not rc:
                t = tz

            origin_center = self.axis.PointAt(t)
            tangent = self.axis.TangentAt(t)
            
            # 1. Z-Achse nach unten entlang der Achse ausrichten (-Tangent)
            z_axis = -tangent
            z_axis.Unitize()

            # 2. Einheitliche X-Richtung (Welt-X als Hauptreferenz)
            ref_x = rg.Vector3d(1, 0, 0)
            if abs(rg.Vector3d.Multiply(z_axis, ref_x)) > 0.99:
                ref_x = rg.Vector3d(0, 1, 0)

            # 3. Orthogonales Koordinatensystem für die Schnittschicht berechnen
            y_axis = rg.Vector3d.CrossProduct(z_axis, ref_x)
            y_axis.Unitize()

            x_axis = rg.Vector3d.CrossProduct(y_axis, z_axis)
            x_axis.Unitize()

            # Schnittebene der aktuellen Schicht
            section_plane = rg.Plane(origin_center, x_axis, y_axis)

            layer = []
            for angle in np.linspace(0.0, m.tau, res_u)[:-1]:
                radius = self.get_radius_wave(angle, tz)

                # Punkt auf der Schnittebene berechnen
                x_local = m.cos(angle) * radius
                y_local = m.sin(angle) * radius
                pt = section_plane.PointAt(x_local, y_local)

                # Frame an diesem Punkt mit exakt derselben Ebenen-Ausrichtung erstellen
                frame = rg.Plane(pt, x_axis, y_axis)
                layer.append(frame)

            layers_frames.append(layer)

        return layers_frames

    @staticmethod
    def get_mesh(layers_frames: list[list[rg.Plane]], closed: bool) -> rg.Mesh:
        """
        Erzeugt das Mesh aus den Ursprungspunkten (Origin) der Frames.
        """
        mesh = rg.Mesh()

        for layer in layers_frames:
            for frame in layer:
                mesh.Vertices.Add(frame.Origin)

        idx = np.array(range(mesh.Vertices.Count))
        idx = idx.reshape(len(layers_frames), len(layers_frames[0]))

        if closed:
            faces = np.stack([
                idx[:-1],
                np.roll(idx[:-1], -1, axis=1),
                idx[1:],
                np.roll(idx[1:], -1, axis=1)
            ], axis=-1).reshape(-1, 4)
        else:
            faces = np.lib.stride_tricks.sliding_window_view(
                idx, window_shape=(2, 2)
            ).reshape(-1, 4)
    
        for f in faces:
            mesh.Faces.AddFace(
                int(f[0]),
                int(f[1]),
                int(f[3]),
                int(f[2])
            )

        mesh.Compact()
        mesh.RebuildNormals()
        return mesh


# --- GRASSHOPPER INTEGRATION ---
if 'axis_curve' in locals() and axis_curve is not None:
    _r1 = radius_1 if 'radius_1' in locals() else 10.0
    _r2 = radius_2 if 'radius_2' in locals() else 5.0
    _amp = amplitude if 'amplitude' in locals() else 0.0
    _rot = rotation if 'rotation' in locals() else 0.0
    _f1 = freq1 if 'freq1' in locals() else 1
    _f2 = freq2 if 'freq2' in locals() else 1
    _lh = layer_height if 'layer_height' in locals() else 1.0
    _res = int(resolution) if 'resolution' in locals() else 30

    mycolumn = Column(
        axis=axis_curve,
        radius_base=_r1,
        radius_top=_r2,
        amp=_amp,
        rotation=_rot,
        freq1=_f1,
        freq2=_f2
    )

    # Output ist nun eine 2D-Liste aus Rhino.Geometry.Plane Objekten
    layers_list = mycolumn.get_layer_frames(layer_height=_lh, res_u=_res)
    mesh = Column.get_mesh(layers_list, closed=True)

    import ghpythonlib.treehelpers as tree
    layers = tree.list_to_tree(layers_list)
# ---------- end python_3_script ----------
unit_z = UnitZ(Factor=Slider(1, range=0..1))
move = Move(Geometry=python_3_script.layers, Motion=unit_z)  # -> Geometry, Transform

# ----
# PRINTPATH WITH STATIC SPEED
safety_distance_mm = Slider(100, range=10..300)
point_spacing_mm = Slider(2, range=1..50)
blend_radius_mm = Slider(1, range=0..5)
plane = Plane(move.Geometry)
point = Point()
curve_3 = Curve(_3d_to_crvs_layers.curves)
speed_mm_s = Slider(15, range=1..60)
tail_rotation = Slider(180, range=0..360)
crvs_to_print = Printpath(
    curves=curve_3,
    speed=speed_mm_s,
    blend_radius=blend_radius_mm,
    safety_distance=safety_distance_mm,
    point_distance=point_spacing_mm,
    tail_rotation=tail_rotation)  # -> printpath, summary, frame; inputs curves: list of Curve, speed: Double, blend_radius: Double, safety_distance: Double, point_distance: Double
# ---------- crvs_to_print: Python ----------
# r: compas
# venv: mas-2627
"""
Turn the curves into printpoints and a PrintPath, in work object coordinates.
Includes an initial approach line (tail) at layer 0 rotated by tail_rotation.
Safety points are added here, before any transform to the robot base.
"""
import os
import sys
import math
from compas.geometry import Frame, Vector, Point

# Include source path once
gh_dir = os.path.dirname(ghenv.Component.OnPingDocument().FilePath)
src_dir = os.path.abspath(os.path.join(gh_dir, "src"))
if src_dir not in sys.path:
    sys.path.append(src_dir)

from print_class import PrintPoint, PrintPath

# 1. Validate inputs
if not curves:
    curves = []
elif not isinstance(curves, list):
    curves = [curves]

valid_curves = [c for c in curves if c]
num_curves = len(valid_curves)

# Set default distance (fallback: 2.0)
point_dist = float(point_distance) if ('point_distance' in locals() and point_distance and point_distance > 0) else 2.0

# Tail parameters
tail_rot = float(tail_rotation) if ('tail_rotation' in locals() and tail_rotation is not None) else 0.0
tail_len = float(tail_length) if ('tail_length' in locals() and tail_length is not None and float(tail_length) > 0) else 50.0

# 2. Define vectors ONCE outside the loops (saves thousands of object creations)
vec_x = -Vector.Xaxis()
vec_y = Vector.Yaxis()

printpoints = []

# 3. Generate lead-in line (tail) before layer 0
if valid_curves and tail_len > 0:
    start_pt0 = valid_curves[0].PointAtStart
    x0, y0, z0 = start_pt0.X, start_pt0.Y, start_pt0.Z

    # Calculate direction vector pointing away from start point based on tail_rotation
    rad = math.radians(tail_rot)
    dir_x = math.cos(rad)
    dir_y = math.sin(rad)

    tail_start_x = x0 - tail_len * dir_x
    tail_start_y = y0 - tail_len * dir_y

    # Sample points along the tail line up to (excluding) the start point of curve 0
    num_tail_pts = max(2, int(round(tail_len / point_dist)))
    for i in range(num_tail_pts):
        t = i / float(num_tail_pts)
        tx = tail_start_x + t * (x0 - tail_start_x)
        ty = tail_start_y + t * (y0 - tail_start_y)
        tz = z0
        
        frame_obj = Frame(Point(tx, ty, tz), vec_x, vec_y)
        printpoints.append(PrintPoint(frame_obj, 0, speed, blend_radius, True))

# 4. Calculate print points per curve
for layer_index, curve in enumerate(valid_curves):
    # Query start point of curve once
    start_pt = curve.PointAtStart

    # Divide curve into segments
    t_params = curve.DivideByLength(point_dist, True)
    if t_params:
        pts = [curve.PointAt(t) for t in t_params]
    else:
        pts = [start_pt]

    # # Close layer (except layer 0 and the very last curve)
    # if layer_index < num_curves - 1:
    #     if layer_index != 0:
    #         if pts[-1].DistanceTo(start_pt) > 1e-6:
    #             pts.append(start_pt)

    # Create COMPAS frames & PrintPoints
    for pt in pts:
        frame_obj = Frame(Point(pt.X, pt.Y, pt.Z), vec_x, vec_y)
        printpoints.append(PrintPoint(frame_obj, layer_index, speed, blend_radius, True))

# 5. Generate PrintPath with safety points (placed above the start of the tail)
printpath = PrintPath(printpoints)
printpath.add_safety_before(safety_distance, speed)
printpath.add_safety_after(safety_distance, speed)

frame = [item.frame for item in printpoints]

summary = f"{len(printpoints)} printpoints in {num_curves} curves (including approach tail), plus 2 safety points"
# ---------- end crvs_to_print ----------
frames_to_print = Printpath(
    frames=plane,
    speed=speed_mm_s,
    blend_radius=blend_radius_mm,
    safety_distance=safety_distance_mm,
    tail_rotation=tail_rotation)  # -> printpath, summary, frame; inputs frames: list of Plane, speed: Double, blend_radius: Double, safety_distance: Double, tail_rotation: Double
# ---------- frames_to_print: Python ----------
# r: compas
# venv: mas-2627
"""
Turn the frames into printpoints and a PrintPath, in work object coordinates.
Includes an initial approach line (tail) at layer 0 rotated by tail_rotation.
Safety points are added here, before any transform to the robot base.
"""
import math
import os
import sys
from compas.geometry import Frame, Point, Vector

# Include source path once
gh_dir = os.path.dirname(ghenv.Component.OnPingDocument().FilePath)
src_dir = os.path.abspath(os.path.join(gh_dir, "src"))
if src_dir not in sys.path:
    sys.path.append(src_dir)

from print_class import PrintPath, PrintPoint


def get_compas_frame(f):
    """Converts GH_Plane wrappers, Rhino Planes, or COMPAS Frames safely to a COMPAS Frame."""
    if hasattr(f, "Value"):  # Grasshopper GH_Plane wrapper
        f = f.Value

    # Rhino Geometry Plane
    if hasattr(f, "Origin") and hasattr(f, "XAxis") and hasattr(f, "YAxis"):
        pt = Point(float(f.Origin.X), float(f.Origin.Y), float(f.Origin.Z))
        vx = Vector(float(f.XAxis.X), float(f.XAxis.Y), float(f.XAxis.Z))
        vy = Vector(float(f.YAxis.X), float(f.YAxis.Y), float(f.YAxis.Z))
        return Frame(pt, vx, vy)

    # Already a COMPAS Frame
    if hasattr(f, "point") and hasattr(f, "xaxis") and hasattr(f, "yaxis"):
        return f

    return f


def get_origin_xyz(f):
    """Extracts (x, y, z) coordinates from the origin of a frame."""
    cf = get_compas_frame(f)
    return float(cf.point.x), float(cf.point.y), float(cf.point.z)


# 1. Validate inputs and parse layers of frames
if not frames:
    layers_frames = []
elif hasattr(frames, "Branches"):  # Handles Grasshopper DataTree (Tree Access)
    layers_frames = [list(branch) for branch in frames.Branches]
elif isinstance(frames, list):
    if len(frames) > 0 and isinstance(frames[0], list):
        layers_frames = frames
    else:
        layers_frames = [frames]  # Single layer fallback
else:
    layers_frames = [[frames]]

valid_layers = [lf for lf in layers_frames if lf]
num_layers = len(valid_layers)

# Parameters for tail / approach line (with safe fallbacks)
tail_rot = (
    float(tail_rotation)
    if ("tail_rotation" in locals() and tail_rotation is not None)
    else 0.0
)
tail_len = (
    float(tail_length)
    if (
        "tail_length" in locals()
        and tail_length is not None
        and float(tail_length) > 0
    )
    else 50.0
)

printpoints = []

# 2. Generate lead-in line (tail) before layer 0
if valid_layers and tail_len > 0:
    first_frame = get_compas_frame(valid_layers[0][0])
    x0, y0, z0 = (
        float(first_frame.point.x),
        float(first_frame.point.y),
        float(first_frame.point.z),
    )

    # Direction vector pointing away from start frame based on tail_rotation
    rad = math.radians(tail_rot)
    dir_x = math.cos(rad)
    dir_y = math.sin(rad)

    # Calculate tail start position
    tail_start_x = x0 - tail_len * dir_x
    tail_start_y = y0 - tail_len * dir_y

    # Sample points along the tail line using orientation of the first layer frame
    num_tail_pts = max(2, int(round(tail_len / 5)))  # ~5.0 mm step size
    for i in range(num_tail_pts):
        t = i / float(num_tail_pts)
        tx = tail_start_x + t * (x0 - tail_start_x)
        ty = tail_start_y + t * (y0 - tail_start_y)
        tz = z0

        frame_obj = Frame(
            Point(tx, ty, tz), first_frame.xaxis, first_frame.yaxis
        )
        printpoints.append(
            PrintPoint(frame_obj, 0, speed, blend_radius, True)
        )

# 3. Process print points per layer directly from frames
for layer_index, layer_frames in enumerate(valid_layers):
    f_list = list(layer_frames)
    if not f_list:
        continue

    start_frame = f_list[0]

    # Close layer (except layer 0 and the very last layer)
    if layer_index < num_layers - 1:
        if layer_index != 0:
            end_frame = f_list[-1]
            sx, sy, sz = get_origin_xyz(start_frame)
            ex, ey, ez = get_origin_xyz(end_frame)
            d = ((ex - sx) ** 2 + (ey - sy) ** 2 + (ez - sz) ** 2) ** 0.5

            if d > 1e-6:
                f_list.append(start_frame)

    # Convert to COMPAS frames & PrintPoints
    for f in f_list:
        frame_obj = get_compas_frame(f)
        printpoints.append(
            PrintPoint(frame_obj, layer_index, speed, blend_radius, True)
        )

# 4. Generate PrintPath with safety points
printpath = PrintPath(printpoints)
printpath.add_safety_before(safety_distance, speed)
printpath.add_safety_after(safety_distance, speed)

frame = [item.frame for item in printpoints]

summary = f"{len(printpoints)} printpoints in {num_layers} layers (including approach tail), plus 2 safety points"
# ---------- end frames_to_print ----------
pts_to_print = Printpath(
    points=point,
    speed=speed_mm_s,
    blend_radius=blend_radius_mm,
    safety_distance=safety_distance_mm,
    tail_rotation=tail_rotation)  # -> printpath, summary, frame; inputs points: list of Point3d, speed: Double, blend_radius: Double, safety_distance: Double, tail_rotation: Double
# ---------- pts_to_print: Python ----------
# r: compas
# venv: mas-2627
"""
Turn the points into printpoints and a PrintPath, in work object coordinates.
Includes an initial approach line (tail) at layer 0 rotated by tail_rotation.
Safety points are added here, before any transform to the robot base.
"""
import os
import sys
import math
from compas.geometry import Frame, Vector, Point

# Include source path once
gh_dir = os.path.dirname(ghenv.Component.OnPingDocument().FilePath)
src_dir = os.path.abspath(os.path.join(gh_dir, "src"))
if src_dir not in sys.path:
    sys.path.append(src_dir)

from print_class import PrintPoint, PrintPath

def get_xyz(p):
    """Safely extracts (x, y, z) from GH_Point wrappers, Rhino Point3d, COMPAS Point, or lists."""
    if hasattr(p, "Value"):       # Grasshopper GH_Point wrapper
        p = p.Value
    if hasattr(p, "Location"):    # Rhino.Geometry.Point object
        p = p.Location
        
    if hasattr(p, "X"):           # Rhino Point3d / Vector3d
        return float(p.X), float(p.Y), float(p.Z)
    elif hasattr(p, "x"):         # COMPAS Point
        return float(p.x), float(p.y), float(p.z)
    
    return float(p[0]), float(p[1]), float(p[2])

# 1. Validate inputs and parse layers of points
if not points:
    layers_points = []
elif hasattr(points, 'Branches'):  # Handles Grasshopper DataTree (Tree Access)
    layers_points = [list(branch) for branch in points.Branches]
elif isinstance(points, list):
    if len(points) > 0 and isinstance(points[0], list):
        layers_points = points
    else:
        layers_points = [points]   # Single layer fallback
else:
    layers_points = [[points]]

valid_layers = [lp for lp in layers_points if lp]
num_layers = len(valid_layers)

# Parameters for tail / approach line (with safe fallbacks)
tail_rot = float(tail_rotation) if ('tail_rotation' in locals() and tail_rotation is not None) else 0.0
tail_len = float(tail_length) if ('tail_length' in locals() and tail_length is not None and float(tail_length) > 0) else 50.0

# 2. Define orientation vectors ONCE outside the loops
vec_x = -Vector.Xaxis()
vec_y = Vector.Yaxis()

printpoints = []

# 3. Generate lead-in line (tail) before layer 0
if valid_layers and tail_len > 0:
    first_pt = valid_layers[0][0]
    x0, y0, z0 = get_xyz(first_pt)

    # Direction vector pointing away from start point based on tail_rotation
    rad = math.radians(tail_rot)
    dir_x = math.cos(rad)
    dir_y = math.sin(rad)

    # Calculate tail start position
    tail_start_x = x0 - tail_len * dir_x
    tail_start_y = y0 - tail_len * dir_y

    # Sample points along the tail line towards the first point of layer 0
    num_tail_pts = max(2, int(round(tail_len / 5)))  # 2.0 mm step size
    for i in range(num_tail_pts):
        t = i / float(num_tail_pts)
        tx = tail_start_x + t * (x0 - tail_start_x)
        ty = tail_start_y + t * (y0 - tail_start_y)
        tz = z0
        
        frame_obj = Frame(Point(tx, ty, tz), vec_x, vec_y)
        printpoints.append(PrintPoint(frame_obj, 0, speed, blend_radius, True))

# 4. Process print points per layer
for layer_index, layer_pts in enumerate(valid_layers):
    pts = list(layer_pts)
    if not pts:
        continue

    start_pt = pts[0]

    # Close layer (except layer 0 and the very last layer)
    if layer_index < num_layers - 1:
        if layer_index != 0:
            end_pt = pts[-1]
            if hasattr(end_pt, "DistanceTo"):
                d = end_pt.DistanceTo(start_pt)
            else:
                sx, sy, sz = get_xyz(start_pt)
                ex, ey, ez = get_xyz(end_pt)
                d = ((ex - sx)**2 + (ey - sy)**2 + (ez - sz)**2)**0.5
            
            if d > 1e-6:
                pts.append(start_pt)

    # # Create COMPAS frames & PrintPoints
    for pt in pts:
        x, y, z = get_xyz(pt)
        frame_obj = Frame(Point(x, y, z), vec_x, vec_y)
        printpoints.append(PrintPoint(frame_obj, layer_index, speed, blend_radius, True))

# 5. Generate PrintPath with safety points (placed above tail start point)
printpath = PrintPath(printpoints)
printpath.add_safety_before(safety_distance, speed)
printpath.add_safety_after(safety_distance, speed)

frame = [item.frame for item in printpoints]

summary = f"{len(printpoints)} printpoints in {num_layers} layers (including approach tail), plus 2 safety points"
# ---------- end pts_to_print ----------
panel = Panel(frames_to_print.summary)
panel_2 = Panel(pts_to_print.summary)
panel_3 = Panel(crvs_to_print.summary)

compas_draw = COMPASDraw(cg=frames_to_print.frame)  # -> rg
#   port cg: The COMPAS geometry or datastructure to be drawn.
#   port rg: The Rhino geometry object.
# ---------- compas_draw: Python ----------
# r: compas>=2.14.1
"""
Draws COMPAS geometry in Grasshopper.
"""

from typing import Any

import Grasshopper

from compas.scene import SceneObject


class CompasToRhinoGeometry(Grasshopper.Kernel.GH_ScriptInstance):
    def RunScript(self, cg):
        if not cg:
            return None

        return SceneObject(item=cg).draw()
# ---------- end compas_draw ----------
list_item = ListItem(List=compas_draw, Index=0, Wrap=True)  # -> flatten(Item)
list_item_2 = ListItem(List=list_item, Index=Slider(0, range=0..200), Wrap=True)

# ----
# EXPORT
save = Button()
preview = Preview(printpath=frames_to_print.printpath)  # -> path, travel, planes
# ---------- preview: Python ----------
# r: compas
# venv: mas-2627
"""
Draw the printpath: path = the whole polyline, travel = extruder-off segments,
safety = extruder-off points, axes = small x and y axis of each frame.
"""
import Rhino.Geometry as rg
from compas_rhino.conversions import frame_to_rhino_plane, point_to_rhino

AXIS_LENGTH = 5.0  # mm

points = printpath.printpoints
planes = [frame_to_rhino_plane(printpoint.frame) for printpoint in points]

# ===== Whole path =====
polyline = rg.Polyline()
for plane in planes:
    polyline.Add(plane.Origin.X, plane.Origin.Y, plane.Origin.Z)
path = polyline.ToPolylineCurve()

# ===== Extruder off: a segment prints only if both of its points have the extruder on =====
safety = [point_to_rhino(printpoint.frame.point) for printpoint in points if not printpoint.is_extruder_on]
travel = []
for i in range(len(points) - 1):
    if not (points[i].is_extruder_on and points[i + 1].is_extruder_on):
        travel.append(rg.Line(planes[i].Origin, planes[i + 1].Origin))
# ---------- end preview ----------
save_2 = Save(printpath=frames_to_print.printpath, save=save, out_path="data/out_printpoints.json")  # -> status
# ---------- save_2: Python ----------
# r: compas
# venv: mas-2627
"""
On button press, write the printpath to data/out_printpoints.json next to this .ghx file.
send_to_robot.py reads that file.
"""
import json
import os

import scriptcontext as sc

gh_dir = os.path.dirname(ghenv.Component.OnPingDocument().FilePath)

# keep the last status in sticky, so the message survives the button being released
status_key = "save_status_" + str(ghenv.Component.InstanceGuid)

if save:
    if printpath is None:
        sc.sticky[status_key] = "nothing to save: no printpath"
    else:
        path = os.path.normpath(os.path.join(gh_dir, out_path))
        os.makedirs(os.path.dirname(path), exist_ok=True)
        with open(path, "w") as f:
            json.dump(printpath.to_dict(), f, indent=2)
        sc.sticky[status_key] = f"saved {len(printpath)} printpoints to {path}"

status = sc.sticky.get(status_key, "")
ghenv.Component.Message = "saved" if status.startswith("saved") else status
# ---------- end save_2 ----------
preview_2 = CustomPreview(Geometry=preview.path, Material=ColourSwatch(SwatchColor=RGB(0, 170, 80)))
preview_3 = CustomPreview(Geometry=preview.travel, Material=ColourSwatch(SwatchColor=RGB(230, 40, 40)))
plane_2 = Plane(preview.planes)

# ----
# Right points of the working space
panel_4 = Panel("608.95,528.88,16.97")
point_2 = Point("614.95,-63.4,16.71")
point_3 = Point(panel_4)
point_4 = Point("218.39,-65.25,17.22")
