# Grasshopper definition 261109_Branches-Trying.gh (Grasshopper 1.0.8)
# plug-ins: Kangaroo2 Components

curve = Curve([<curve referenced from the Rhino model> x10])
list_length = ListLength(List=curve)  # -> flatten(Length)
value_list = ValueList({"Zero": 0, "One": 1}, selected="One")
series = Series(Start=Slider(5, range=0..10), Step=Slider(2, range=0..10), Count=expr("x-1", list_length))
end_points = EndPoints(Curve=curve)  # -> Start, End
graft_tree = GraftTree(Tree=curve, IncludeEmptyLists=True, IncludeNullItems=True)
# Node/Strut sizing and division options
crv = Curve([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])
multipipe = MultiPipe(
    Curves=graft_tree,
    NodeSize=series,
    SizePoints=end_points.Start,
    EndOffset=Slider(4, range=0..10),
    StrutSize=Slider(2.56, range=0..5),
    Segment=0,
    KinkAngle=0.6,
    CubeFit=Slider(0.45, range=0..1),
    Caps=0)
mp = MultiPipe(
    Curves=curve,
    NodeSize=Slider(3.073, range=0.1..30),
    EndOffset=Slider(13.504, range=0..40),
    StrutSize=Slider(3.776, range=0.1..30),
    Segment=Slider(13.104, range=0.5..100),
    KinkAngle=0.6,
    CubeFit=0)
panel = Panel(graft_tree)
preview = CustomPreview(
    Geometry=mp,
    Material={diffuse=RGB(255, 128, 0), emission=RGB(0, 0, 0), shine=0.5, specular=RGB(255, 255, 255), transparency=0})
point = Point(Point(1540, -100, 3000))

number_slider = Slider(26.527, range=0..40)
number_slider_2 = Slider(4.503, range=0.1..30)
number_slider_3 = Slider(5.039, range=0.1..30)
number_slider_4 = Slider(38.373, range=0.5..100)

# ----
# High valence nodes
number_slider_5 = Slider(187.5, range=0..1000)
number_slider_6 = Slider(100, range=0..1000)
number_slider_7 = Slider(100, range=0..1000)
unit_x = UnitX(Factor=number_slider_5)
construct_domain = ConstructDomain(DomainStart=expr("-x", number_slider_5), DomainEnd=number_slider_5)
construct_domain_2 = ConstructDomain(DomainStart=expr("-x", number_slider_6), DomainEnd=number_slider_6)
construct_domain_3 = ConstructDomain(DomainStart=expr("-x", number_slider_7), DomainEnd=number_slider_7)
point_2 = Point(Point(790, -100, 3000))
move = Move(Geometry=point_2, Motion=unit_x)  # -> Geometry, Transform
xy_plane = XYPlane(Origin=move.Geometry)
domain_box = DomainBox(Base=xy_plane, X=construct_domain, Y=construct_domain_2, Z=construct_domain_3)
point_3 = Point([Point(1165, -170.7106781, 2929.289322), Point(1165, -29.28932188, 3070.710678)])
point_4 = Point([Point(790, -250, 3000), Point(790, 50, 3000), Point(790, -100, 2850), Point(790, -100, 3150)])
popgeo = PopulateGeometry(Geometry=domain_box, Count=Slider(11, range=0..100), Seed=Slider(0, range=0..10))
merge = Merge(Data1=point_3, Data2=point_4, Data3=popgeo)
ln = Line(StartPoint=xy_plane, EndPoint=merge)
mp_2 = MultiPipe(
    Curves=ln,
    NodeSize=number_slider_3,
    EndOffset=number_slider,
    StrutSize=number_slider_2,
    Segment=number_slider_4,
    KinkAngle=0.6,
    CubeFit=0)
preview_2 = CustomPreview(
    Geometry=mp_2,
    Material={diffuse=RGB(0, 255, 0), emission=RGB(0, 0, 0), shine=0.5, specular=RGB(255, 255, 255), transparency=0})

multiplication = Multiplication(A=number_slider_5, B=2)
point_5 = Point(popgeo)

unit_x_2 = UnitX(Factor=multiplication)
merge_2 = Merge(Data1=point_3, Data2=point)

move_2 = Move(Geometry=xy_plane, Motion=unit_x_2)  # -> Geometry, Transform

domain_box_2 = DomainBox(Base=move_2.Geometry, X=construct_domain, Y=construct_domain_2, Z=construct_domain_3)
ln_2 = Line(StartPoint=move_2.Geometry, EndPoint=merge_2)
mp_3 = MultiPipe(
    Curves=ln_2,
    NodeSize=number_slider_3,
    EndOffset=number_slider,
    StrutSize=number_slider_2,
    Segment=number_slider_4,
    KinkAngle=0.6,
    CubeFit=0)
preview_3 = CustomPreview(
    Geometry=mp_3,
    Material={diffuse=RGB(0, 255, 0), emission=RGB(0, 0, 0), shine=0.5, specular=RGB(255, 255, 255), transparency=0})
