# Grasshopper definition 261111_cleaning.ghx (Grasshopper 1.0.8)
# plug-ins: RhinoCodePluginGH

# ---- group: This is needed only ONCE in the GH definition
enable_auto_reload = Python3Script()  # -> ok
# ---------- enable_auto_reload: Python ----------
"""
------------------------------
Using VS Code as Python editor
------------------------------

The simplest way to start using VS Code as our editor, is
to place our Python code in files located IN THE SAME FOLDER as our Grasshopper file.

After we have done that, we need 2 steps: 

1. Enable the COMPAS reloader on one component. This tells Grasshopper to watch for changes in the Pythoh files and reload if changed.
2. Every other component that uses Python code from external files needs to start with a method to ensure Grasshopper knows where to load the files from.

"""
# r: compas
# venv: mas-2627

from compas_rhino.devtools import DevTools
DevTools.enable_reloader()
# ---------- end enable_auto_reload ----------

# ----
# 3D GEOMETRY
# import
_3d_geometry = Brep(<brep referenced from the Rhino model>)

# ---- group: INTERIOR_GEOMETRY
_3d_geometry_2 = Brep(<brep referenced from the Rhino model>)

# ---- group: DESIGN
point_spacing_mm = Slider(3, range=1..50)
layer_height_mm = Slider(1.1, range=0.5..10)

# classic slicing
z_first_layer_mm = Slider(1.1, range=-5..5)
slice_brep = SliceBrep(brep=_3d_geometry, layer_height=layer_height_mm, point_spacing=point_spacing_mm, z_first_layer=z_first_layer_mm)  # -> layers, all_points; inputs brep: Brep
# ---------- slice_brep: Python ----------
# r: compas
# venv: mas-2627
"""
Slice a brep into layers, in work object coordinates (Rhino world XY = work object).
One closed compas Polyline per layer, same as slice cylinder. 
Units: mm.
The bottom of the brep is placed on the bed: first layer at z = 0, plus fine_adjust_z.
"""
# ===== IMPORTS =====
import Rhino
import Rhino.Geometry as rg
from Rhino.Geometry.Intersect import Intersection
from compas.geometry import Point
from compas.geometry import Polyline

# ===== VARIABLES =====
tolerance = Rhino.RhinoDoc.ActiveDoc.ModelAbsoluteTolerance
box = brep.GetBoundingBox(True)
layer_count = int((box.Max.Z - box.Min.Z) / layer_height)

layers = []
all_points = []
for i in range(layer_count):
    # ===== Cut the brep in the middle of the layer, keep the longest curve =====
    z_cut = box.Min.Z + (i + 0.5) * layer_height
    ok, curves, points = Intersection.BrepPlane(brep, rg.Plane(rg.Point3d(0, 0, z_cut), rg.Vector3d.ZAxis), tolerance)
    curves = rg.Curve.JoinCurves(curves)
    if not curves:
        continue
    contour = max(curves, key=lambda curve: curve.GetLength())

    # ===== Same direction and same seam (on the +x side) on every layer =====
    if contour.ClosedCurveOrientation(rg.Plane.WorldXY) == rg.CurveOrientation.Clockwise:
        contour.Reverse()
    ok, t = contour.ClosestPoint(rg.Point3d(box.Max.X + 1000, box.Center.Y, z_cut))
    contour.ChangeClosedCurveSeam(t)

    # ===== Points every point_spacing, closed: back to the start =====
    count = round(contour.GetLength() / point_spacing)
    z = i * layer_height + z_first_layer
    points = [Point(p.X, p.Y, z) for p in (contour.PointAt(t) for t in contour.DivideByCount(count, True))]
    layers.append(Polyline(points + [points[0]]))
    all_points.extend(points)
# ---------- end slice_brep ----------
slice_brep_2 = SliceBrep(brep=_3d_geometry_2, layer_height=layer_height_mm, point_spacing=point_spacing_mm, z_first_layer=z_first_layer_mm)  # -> layers, all_points; inputs brep: Brep; same code as slice_brep

# ---- group: CURVES
# CURVES
compas_draw = COMPASDraw(cg=slice_brep.layers)  # -> rg
#   port cg: The COMPAS geometry or datastructure to be drawn.
#   port rg: The Rhino geometry object.
# ---------- compas_draw: Python ----------
# r: compas>=2.14.1
"""
Draws COMPAS geometry in Grasshopper.
"""

from typing import Any

import Grasshopper

from compas.scene import SceneObject


class CompasToRhinoGeometry(Grasshopper.Kernel.GH_ScriptInstance):
    def RunScript(self, cg):
        if not cg:
            return None

        return SceneObject(item=cg).draw()[0]
# ---------- end compas_draw ----------

# ---- group: POINTS
compas_draw_2 = COMPASDraw(cg=slice_brep.all_points)  # -> rg; same code as compas_draw

# ---- group: CURVES
compas_draw_3 = COMPASDraw(cg=slice_brep_2.layers)  # -> rg; same code as compas_draw

# ---- group: POINTS
compas_draw_4 = COMPASDraw(cg=slice_brep_2.all_points)  # -> rg; same code as compas_draw

# ----
python_3_script = Python3Script(crvs=slice_brep.layers)  # -> out, crvs; inputs crvs: list
# ---------- python_3_script: Python ----------
import Rhino.Geometry as rg
from compas.geometry import Vector, Line, Polyline

crv = crvs[0]

starting_pt = crv.points[0]

# Tangent from first segment
tangent = crv.points[1] - crv.points[0]

# Perpendicular vector
vec = tangent.cross(Vector(0, 0, 1))
vec.unitize()

# Move 60 units
zero_pt = starting_pt + vec * 60

# Create COMPAS Line
starting_crv = Polyline([zero_pt, starting_pt])

crvs.insert(0, starting_crv)


# crv = crvs[0]
# starting_pt = crv.PointAt(0)
# vec = rg.Vector3d.CrossProduct(crv.TangentAtStart ,rg.Vector3d(0,0,1))

# zero_pt = starting_pt + vec * 60

# starting_crv = rg.LineCurve(zero_pt, starting_pt)

# crvs.insert(0, starting_crv)
# ---------- end python_3_script ----------
compas_draw_5 = COMPASDraw(cg=python_3_script.crvs)  # -> rg; same code as compas_draw
speed_mm_s = Slider(30, range=1..50)

# ---- group: PRINTPATH
# generate printpath: printpoints and path
safety_distance_mm = Slider(100, range=10..300)
blend_radius_mm = Slider(0.5, range=0..5)
speed_mm_s_2 = Slider(10, range=1..50)
printpath = Printpath(
    exterior_layers=python_3_script.crvs,
    interior_layers=slice_brep_2.layers,
    speed=speed_mm_s_2,
    speed_2=speed_mm_s,
    blend_radius=blend_radius_mm,
    safety_distance=safety_distance_mm)  # -> printpath, summary, combined; inputs exterior_layers: list, interior_layers: list
# ---------- printpath: Python ----------
# r: compas
# venv: mas-2627
"""
Turn the layers into printpoints and a PrintPath, in work object coordinates.
Safety points are added here, before any transform to the robot base.
"""
import os
import sys
import importlib

# Find source folder
gh_dir = os.path.dirname(ghenv.Component.OnPingDocument().FilePath)
src_dir = os.path.abspath(os.path.join(gh_dir, "..", "src"))

if src_dir not in sys.path:
    sys.path.insert(0, src_dir)

# Import and reload module
import G4_print_class

importlib.reload(G4_print_class)

PrintPoint = G4_print_class.PrintPoint
PrintPath = G4_print_class.PrintPath

from compas.geometry import Frame, Vector
from itertools import zip_longest

# PARAMETERS
aspeed_io_0 = 0
aspeed_io_1 = 1

# COMBINE THE EXTERIOR AND INTERIOR LISTS OF CURVES
combined = [exterior_layers[0]]

for exterior_layer, interior_layer in zip_longest(exterior_layers[1:], interior_layers):
    if exterior_layer is not None:
        combined.append(exterior_layer)
    if interior_layer is not None:
        combined.append(interior_layer)

# ===== One printpoint per point =====
# world XY orientation for every point: a tangent frame would turn the wrist 360 degrees each layer
printpoints = []
for layer_index, layer in enumerate(combined):
    for i, point in enumerate(layer.points):
        current_aspeed_io = aspeed_io_1 if layer_index % 2 == 0 else aspeed_io_0
        current_speed = speed if layer_index % 2 == 0 else speed_2
        frame = Frame(point, -Vector.Xaxis(), Vector.Yaxis())
        printpoints.append(PrintPoint(frame, layer_index, current_speed, blend_radius, True, current_aspeed_io))

# ===== Path with a travel point above the start and the end =====
printpath = PrintPath(printpoints)

printpath.printpoints[0].speed *= 2
printpath.add_safety_before(safety_distance, speed*2)
printpath.add_safety_after(safety_distance, speed*2)

summary = f"{len(printpoints)} printpoints in {len(combined)} layers, plus 2 safety points"
# ---------- end printpath ----------
panel = Panel(printpath.summary)

# ---- group: ALL CURVES
compas_draw_6 = COMPASDraw(cg=printpath.combined)  # -> rg; same code as compas_draw

# ----
list_item = ListItem(List=compas_draw_6, Index=Slider(0, range=0..650), Wrap=True)
data = Data(list_item)
