# Grasshopper definition G4_cleanfile.ghx (Grasshopper 1.0.8)
# plug-ins: RhinoCodePluginGH

# ---- group: This is needed only ONCE in the GH definition
enable_auto_reload = Python3Script()  # -> ok
# ---------- enable_auto_reload: Python ----------
"""
------------------------------
Using VS Code as Python editor
------------------------------

The simplest way to start using VS Code as our editor, is
to place our Python code in files located IN THE SAME FOLDER as our Grasshopper file.

After we have done that, we need 2 steps: 

1. Enable the COMPAS reloader on one component. This tells Grasshopper to watch for changes in the Pythoh files and reload if changed.
2. Every other component that uses Python code from external files needs to start with a method to ensure Grasshopper knows where to load the files from.

"""
# r: compas
# venv: mas-2627

from compas_rhino.devtools import DevTools
DevTools.enable_reloader()
# ---------- end enable_auto_reload ----------

# ----
# 3D GEOMETRY
# import
_3d_geometry = Brep(<brep referenced from the Rhino model>)

# ---- group: INTERIOR_GEOMETRY
_3d_geometry_2 = Brep(<brep referenced from the Rhino model>)

# ---- group: MID
_3d_geometry_3 = Brep(<brep referenced from the Rhino model>)

# ---- group: TOP
_3d_geometry_4 = Brep(<brep referenced from the Rhino model>)

# ---- group: BOTTOM
_3d_geometry_5 = Brep(<brep referenced from the Rhino model>)

_3d_geometry_6 = Brep(<brep referenced from the Rhino model>)

# ---- group: MID
_3d_geometry_7 = Brep(<brep referenced from the Rhino model>)

# ---- group: TOP
_3d_geometry_8 = Brep(<brep referenced from the Rhino model>)

# ---- group: DESIGN
point_spacing_mm = Slider(3, range=1..50)
layer_height_mm = Slider(1.1, range=0.5..10)

# classic slicing
z_first_layer_mm = Slider(1, range=-5..5)
slice_brep = SliceBrep(brep=_3d_geometry_5, layer_height=layer_height_mm, point_spacing=point_spacing_mm, z_first_layer=z_first_layer_mm)  # -> layers, all_points; inputs brep: Brep
# ---------- slice_brep: Python ----------
# r: compas
# venv: mas-2627
"""
Slice a brep into layers, in work object coordinates (Rhino world XY = work object).
One closed compas Polyline per layer, same as slice cylinder. 
Units: mm.
The bottom of the brep is placed on the bed: first layer at z = 0, plus fine_adjust_z.
"""
# ===== IMPORTS =====
import Rhino
import Rhino.Geometry as rg
from Rhino.Geometry.Intersect import Intersection
from compas.geometry import Point
from compas.geometry import Polyline

# ===== VARIABLES =====
tolerance = Rhino.RhinoDoc.ActiveDoc.ModelAbsoluteTolerance
box = brep.GetBoundingBox(True)
layer_count = int((box.Max.Z - box.Min.Z) / layer_height)

layers = []
all_points = []
for i in range(layer_count):
    # ===== Cut the brep in the middle of the layer, keep the longest curve =====
    z_cut = box.Min.Z + (i + 0.5) * layer_height
    ok, curves, points = Intersection.BrepPlane(brep, rg.Plane(rg.Point3d(0, 0, z_cut), rg.Vector3d.ZAxis), tolerance)
    curves = rg.Curve.JoinCurves(curves)
    if not curves:
        continue
    contour = max(curves, key=lambda curve: curve.GetLength())

    # ===== Same direction and same seam (on the +x side) on every layer =====
    if contour.ClosedCurveOrientation(rg.Plane.WorldXY) == rg.CurveOrientation.Clockwise:
        contour.Reverse()
    ok, t = contour.ClosestPoint(rg.Point3d(box.Max.X + 1000, box.Center.Y, z_cut))
    contour.ChangeClosedCurveSeam(t)

    # ===== Points every point_spacing, closed: back to the start =====
    count = round(contour.GetLength() / point_spacing)
    z = i * layer_height + z_first_layer
    points = [Point(p.X, p.Y, z) for p in (contour.PointAt(t) for t in contour.DivideByCount(count, True))]
    layers.append(Polyline(points + [points[0]]))
    all_points.extend(points)
# ---------- end slice_brep ----------
slice_brep_2 = SliceBrep(brep=_3d_geometry_6, layer_height=layer_height_mm, point_spacing=point_spacing_mm, z_first_layer=z_first_layer_mm)  # -> layers, all_points; inputs brep: Brep; same code as slice_brep

# ---- group: CURVES
# CURVES
compas_draw = COMPASDraw(cg=slice_brep.layers)  # -> rg
#   port cg: The COMPAS geometry or datastructure to be drawn.
#   port rg: The Rhino geometry object.
# ---------- compas_draw: Python ----------
# r: compas>=2.14.1
"""
Draws COMPAS geometry in Grasshopper.
"""

from typing import Any

import Grasshopper

from compas.scene import SceneObject


class CompasToRhinoGeometry(Grasshopper.Kernel.GH_ScriptInstance):
    def RunScript(self, cg):
        if not cg:
            return None

        return SceneObject(item=cg).draw()[0]
# ---------- end compas_draw ----------

# ---- group: POINTS
compas_draw_2 = COMPASDraw(cg=slice_brep.all_points)  # -> rg; same code as compas_draw

# ---- group: CURVES
compas_draw_3 = COMPASDraw(cg=slice_brep_2.layers)  # -> rg; same code as compas_draw

# ---- group: POINTS
compas_draw_4 = COMPASDraw(cg=slice_brep_2.all_points)  # -> rg; same code as compas_draw

# ----
# add tail
python_3_script = Python3Script(crvs=slice_brep.layers)  # -> out, crvs; inputs crvs: list
# ---------- python_3_script: Python ----------
import Rhino.Geometry as rg
from compas.geometry import Vector, Line, Polyline

# PARAMETERS
tail_length = 120

crv = crvs[0]

starting_pt = crv.points[0]

# Tangent from first segment
tangent = crv.points[1] - crv.points[0]

# Perpendicular vector
vec = tangent.cross(Vector(0, 0, 1))
vec.unitize()

# Move 60 units
zero_pt = starting_pt + vec * tail_length

# Create COMPAS Line
starting_crv = Polyline([zero_pt, starting_pt])

crvs.insert(0, starting_crv)


# crv = crvs[0]
# starting_pt = crv.PointAt(0)
# vec = rg.Vector3d.CrossProduct(crv.TangentAtStart ,rg.Vector3d(0,0,1))

# zero_pt = starting_pt + vec * 60

# starting_crv = rg.LineCurve(zero_pt, starting_pt)

# crvs.insert(0, starting_crv)
# ---------- end python_3_script ----------

# ---- group: WITH TAIL
compas_draw_5 = COMPASDraw(cg=python_3_script.crvs)  # -> rg; same code as compas_draw

# ----
speed_mm_s = Slider(30, range=1..50)

# ---- group: PRINTPATH
# generate printpath: printpoints and path
safety_distance_mm = Slider(100, range=10..300)
blend_radius_mm = Slider(0.5, range=0..5)
speed_mm_s_2 = Slider(10, range=1..50)
printpath = Printpath(
    exterior_layers=python_3_script.crvs,
    interior_layers=slice_brep_2.layers,
    speed=speed_mm_s_2,
    speed_2=speed_mm_s,
    blend_radius=blend_radius_mm,
    safety_distance=safety_distance_mm)  # -> printpath, summary, combined; inputs exterior_layers: list, interior_layers: list
# ---------- printpath: Python ----------
# r: compas
# venv: mas-2627
"""
Turn the layers into printpoints and a PrintPath, in work object coordinates.
Safety points are added here, before any transform to the robot base.
"""
import os
import sys
import importlib

# Find source folder
gh_dir = os.path.dirname(ghenv.Component.OnPingDocument().FilePath)
src_dir = os.path.abspath(os.path.join(gh_dir, "..", "src"))

if src_dir not in sys.path:
    sys.path.insert(0, src_dir)

# Import and reload module
import G4_print_class

importlib.reload(G4_print_class)

PrintPoint = G4_print_class.PrintPoint
PrintPath = G4_print_class.PrintPath

from compas.geometry import Frame, Vector
from itertools import zip_longest

# PARAMETERS
aspeed_io_0 = 0
aspeed_io_1 = 1

# COMBINE THE EXTERIOR AND INTERIOR LISTS OF CURVES
combined = [exterior_layers[0]]

for exterior_layer, interior_layer in zip_longest(exterior_layers[1:], interior_layers):
    if exterior_layer is not None:
        combined.append(exterior_layer)
    if interior_layer is not None:
        combined.append(interior_layer)

# ===== One printpoint per point =====
# world XY orientation for every point: a tangent frame would turn the wrist 360 degrees each layer
printpoints = []
for layer_index, layer in enumerate(combined):
    for i, point in enumerate(layer.points):
        current_aspeed_io = aspeed_io_1 if layer_index % 2 == 0 else aspeed_io_0
        current_speed = speed if layer_index % 2 == 0 else speed_2
        frame = Frame(point, -Vector.Xaxis(), Vector.Yaxis())
        printpoints.append(PrintPoint(frame, layer_index, current_speed, blend_radius, True, current_aspeed_io))

# ===== Path with a travel point above the start and the end =====
printpath = PrintPath(printpoints)

printpath.printpoints[0].speed = speed
printpath.add_safety_before(safety_distance, speed)
printpath.add_safety_after(safety_distance, speed)

summary = f"{len(printpoints)} printpoints in {len(combined)} layers, plus 2 safety points"
# ---------- end printpath ----------
panel = Panel(printpath.summary)

# ----
printpath_2 = Printpath(
    exterior_layers=python_3_script.crvs,
    interior_layers=slice_brep_2.layers,
    speed=speed_mm_s_2,
    speed_2=speed_mm_s,
    blend_radius=blend_radius_mm,
    safety_distance=safety_distance_mm)  # -> printpath, summary, combined, frames; inputs exterior_layers: list, interior_layers: list
# ---------- printpath_2: Python ----------
# r: compas
# venv: mas-2627
"""
Turn the layers into printpoints and a PrintPath, in work object coordinates.
Safety points are added here, before any transform to the robot base.
"""
import os
import sys
import importlib

# Find source folder
gh_dir = os.path.dirname(ghenv.Component.OnPingDocument().FilePath)
src_dir = os.path.abspath(os.path.join(gh_dir, "..", "src"))

if src_dir not in sys.path:
    sys.path.insert(0, src_dir)

# Import and reload module
import G4_print_class

importlib.reload(G4_print_class)

PrintPoint = G4_print_class.PrintPoint
PrintPath = G4_print_class.PrintPath

from compas.geometry import Frame, Vector
from itertools import zip_longest

# PARAMETERS
aspeed_io_0 = 0
aspeed_io_1 = 1

# COMBINE THE EXTERIOR AND INTERIOR LISTS OF CURVES
combined = [exterior_layers[0]]

for exterior_layer, interior_layer in zip_longest(exterior_layers[1:], interior_layers):
    if exterior_layer is not None:
        combined.append(exterior_layer)
    if interior_layer is not None:
        combined.append(interior_layer)

# ===== One printpoint per point =====
# world XY orientation for every point: a tangent frame would turn the wrist 360 degrees each layer
printpoints = []
frames = []
for layer_index, layer in enumerate(combined):
    for i, point in enumerate(layer.points[:len(layer.points)//2]):
        current_aspeed_io = aspeed_io_1 if layer_index % 2 == 0 else aspeed_io_0
        current_speed = speed if layer_index % 2 == 0 else speed_2
        frame = Frame(point, -Vector.Xaxis(), Vector.Yaxis())
        
        printpoints.append(PrintPoint(frame, layer_index, current_speed, blend_radius, True, current_aspeed_io))

        frames.append(frame)
# ===== Path with a travel point above the start and the end =====
printpath = PrintPath(printpoints)

printpath.printpoints[0].speed = speed
printpath.add_safety_before(safety_distance, speed)
printpath.add_safety_after(safety_distance, speed)

summary = f"{len(printpoints)} printpoints in {len(combined)} layers, plus 2 safety points"
# ---------- end printpath_2 ----------
panel_2 = Panel(printpath_2.summary)
compas_draw_6 = COMPASDraw(cg=printpath_2.frames)  # -> rg; same code as compas_draw

# ---- group: ALL CURVES
compas_draw_7 = COMPASDraw(cg=printpath_2.combined)  # -> rg; same code as compas_draw

# ----
list_item = ListItem(List=compas_draw_7, Index=Slider(116, range=0..650), Wrap=True)
data = Data(list_item)

# ---- group: DISPLAY: check before you print
# export: preview and save
panel_3 = Panel("data/out_printpoints_ZH_bottomb.json")
mode = ValueList({"speed": 0, "overhang": 1}, selected="speed")
save = Button()
check = Check(printpath=printpath_2.printpath, mode=mode)  # -> beads, values, low, high, param_range, report
# ---------- check: Python ----------
# r: compas
# venv: mas-2627
import math

import Rhino.Geometry as rg
from compas.geometry import closest_point_on_polyline_xy
from compas.geometry import distance_point_point_xy

MODES = ["speed", "overhang"]

mode = int(mode) if mode is not None else 0
points = printpath.printpoints
n = len(points)


# ===== Printed points, grouped per layer (in print order, so each layer is a polyline) =====
layers = {}
for printpoint in points:
    if printpoint.is_extruder_on:
        layers.setdefault(printpoint.layer_index, []).append(printpoint.frame.point)

# ===== Overhang: how far each point sticks out over the layer below it, as an angle from vertical =====
heights = []    # layer height per point (mm), 0 if nothing below
overhangs = []  # overhang per point (degrees), 0 if nothing below
for printpoint in points:
    point = printpoint.frame.point
    points_below = layers.get(printpoint.layer_index - 2)
    if not printpoint.is_extruder_on or not points_below:
        heights.append(0.0)  # travel point or first layer
        overhangs.append(0.0)
        continue
    below = closest_point_on_polyline_xy(point, points_below)  # closest point on the layer below, between its points too
    height = point.z - points_below[0].z  # layers are flat; below[2] would be 0: the _xy function works in plan only
    heights.append(height)
    overhangs.append(math.degrees(math.atan2(distance_point_point_xy(point, below), height)) if height > 0 else 0.0)

# ===== Time: the robot moves to each point at that point's speed. Ignores acceleration =====
print_time = travel_time = 0.0
for i in range(1, n):
    time = points[i - 1].frame.point.distance_to_point(points[i].frame.point) / points[i].speed
    if points[i - 1].is_extruder_on and points[i].is_extruder_on:
        print_time += time
    else:
        travel_time += time

# ===== Colour: one bead (a strip as high as the layer) and one value per printed segment =====
beads, values = [], []
for i in range(1, n):
    a, b = points[i - 1].frame.point, points[i].frame.point
    printing = points[i - 1].is_extruder_on and points[i].is_extruder_on
    if mode == 0:
        # speed: every move as a line, travel included
        beads.append(rg.LineCurve(rg.Point3d(a.x, a.y, a.z), rg.Point3d(b.x, b.y, b.z)))
        values.append(points[i].speed)
    elif printing:
        # overhang: a strip as high as the layer, only where it prints
        ha, hb = (max(0.8 * (h or 0.0), 0.5) for h in (heights[i - 1], heights[i]))  # first layer: 0.5 mm
        bead = rg.Mesh()
        for x, y, z in [(a.x, a.y, a.z), (b.x, b.y, b.z), (b.x, b.y, b.z - hb), (a.x, a.y, a.z - ha)]:
            bead.Vertices.Add(x, y, z)
        bead.Faces.AddFace(0, 1, 2, 3)
        bead.Normals.ComputeNormals()
        beads.append(bead)
        values.append(overhangs[i] or 0.0)  # first layer: nothing below

param_range = rg.Interval(min(values), max(values))
low, high = (min(values), max(values)) if mode == 0 else (0.0, 45.0)
if high <= low:
    high = low + 1.0  # Gradient needs a range

report = "\n".join([
    f"colour: {MODES[mode]}, {low:.2f} to {high:.2f}",
    f"{n} printpoints, {len(layers)} layers",
    f"time: about {(print_time + travel_time) / 60:.1f} min (print {print_time / 60:.1f}, travel {travel_time / 60:.1f})",
])


ghenv.Component.Message = f"{MODES[mode]} mode, print time {(print_time + travel_time) /  60:.0f} min"
# ---------- end check ----------
save_2 = Save(printpath=printpath_2.printpath, save=save, out_path=panel_3)  # -> status
# ---------- save_2: Python ----------
# r: compas
# venv: mas-2627
"""
On button press, write the printpath to data/out_printpoints.json next to this .ghx file.
send_to_robot.py reads that file.
"""
import json
import os

import scriptcontext as sc

gh_dir = os.path.abspath(os.path.join(
    os.path.dirname(ghenv.Component.OnPingDocument().FilePath),
    ".."
))

# keep the last status in sticky, so the message survives the button being released
status_key = "save_status_" + str(ghenv.Component.InstanceGuid)

if save:
    if printpath is None:
        sc.sticky[status_key] = "nothing to save: no printpath"
    else:
        path = os.path.normpath(os.path.join(gh_dir, out_path))
        os.makedirs(os.path.dirname(path), exist_ok=True)
        with open(path, "w") as f:
            json.dump(printpath.to_dict(), f, indent=2)
        sc.sticky[status_key] = f"saved {len(printpath)} printpoints to {path}"

status = sc.sticky.get(status_key, "")
ghenv.Component.Message = "saved" if status.startswith("saved") else status
# ---------- end save_2 ----------
gradient = Gradient(
    LowerLimit=check.low,
    UpperLimit=check.high,
    Parameter=check.values,
    stops=[0: RGB(45, 75, 170), 0.35: RGB(40, 175, 165), 0.7: RGB(245, 205, 50), 1: RGB(215, 45, 40)])
panel_4 = Panel(check.report)
panel_5 = Panel(save_2)
preview = CustomPreview(Geometry=check.beads, Material=gradient)

# ----
panel_6 = Panel(check.param_range)
