# Grasshopper definition G4_design_261111_PIECE.ghx (Grasshopper 1.0.8)
# plug-ins: RhinoCodePluginGH, Pufferfish

brep = Brep(<brep referenced from the Rhino model>)
negative = Negative(Value=Slider(4, range=0..100))
xy_plane = XYPlane(Origin=Point(0, 0, 0))

# ----
# LAYERS
spacing = Slider(1, range=0.5..5)
rotation = Slider(0, range=0..360)
bottom_offset = Slider(1.1, range=0.1..5)
# 3D TO CRV
_3d_to_crvs_layers = Python3Script(brep=brep, spacing=spacing, rotation=rotation, bottom_offset=bottom_offset)  # -> out, curves; inputs brep: Brep, spacing: Double, rotation: Double, bottom_offset: Double
# ---------- _3d_to_crvs_layers: Python ----------
import Rhino.Geometry as rg
import math

def slice_polysurface(brep, spacing, bottom_offset, rotation):
    """
    Slices a closed polysurface sequentially from bottom to top
    and aligns the start point (seam) of the curves according to the 'rotation' angle.
    
    :param brep: Rhino.Geometry.Brep (input geometry)
    :param spacing: Distance between cutting planes (float > 0)
    :param bottom_offset: Distance from the first cutting plane to the base surface (float >= 0)
    :param rotation: Start angle in degrees (0.0 to 360.0) for the seam / start point
    :return: List of contour curves, sorted from bottom to top
    """
    if not brep or spacing <= 0 or bottom_offset < 0:
        return []

    # 1. Get bounding box & height limits
    bbox = brep.GetBoundingBox(True)
    z_min = bbox.Min.Z
    z_max = bbox.Max.Z

    start_z = z_min + bottom_offset

    if start_z > z_max:
        return []

    # 2. Calculate number of cuts & center data
    num_cuts = int(math.floor((z_max - start_z) / spacing)) + 1
    
    center_x = bbox.Center.X
    center_y = bbox.Center.Y

    # Radius for the alignment vector (+ 50% safety margin)
    dx = max(abs(bbox.Min.X - center_x), abs(bbox.Max.X - center_x))
    dy = max(abs(bbox.Min.Y - center_y), abs(bbox.Max.Y - center_y))
    r_max = math.hypot(dx, dy) * 1.5

    # Convert angle from degrees to radians
    rot_rad = math.radians(rotation)
    dir_x = math.cos(rot_rad)
    dir_y = math.sin(rot_rad)

    sliced_curves = []

    # 3. Iteratively generate cutting planes & adjust seam (start point)
    for i in range(num_cuts):
        current_z = start_z + i * spacing
        cut_plane = rg.Plane(rg.Point3d(center_x, center_y, current_z), rg.Vector3d.ZAxis)
        
        contours = rg.Brep.CreateContourCurves(brep, cut_plane)
        
        if contours:
            # Create target point for the seam at the current height
            target_pt = rg.Point3d(center_x + r_max * dir_x, center_y + r_max * dir_y, current_z)

            for crv in contours:
                if crv.IsClosed:
                    # Find closest point on curve and move seam there
                    success, t_param = crv.ClosestPoint(target_pt)
                    if success:
                        crv.ChangeClosedCurveSeam(t_param)

                sliced_curves.append(crv)

    return sliced_curves

# Assignment to component output parameter
curves = slice_polysurface(brep, spacing, bottom_offset, rotation)
# ---------- end _3d_to_crvs_layers ----------

number_slider = Slider(5, range=0..500)  # disabled
number_slider_2 = Slider(1.5, range=0..20)
number_slider_3 = Slider(15, range=0..20)  # disabled
number_slider_4 = Slider(30, range=0..100)  # disabled
number_slider_5 = Slider(80, range=0..100)  # disabled
number_slider_6 = Slider(90, range=0..180)  # disabled
number_slider_7 = Slider(2, range=0..2)  # disabled
number_slider_8 = Slider(0, range=0..3)  # disabled
boolean_toggle = BooleanToggle(True)  # disabled
multiplication = Multiplication(A=number_slider, B=12)  # disabled
multiplication_2 = Multiplication(A=Slider(5, range=0..500), B=12)
curve = Curve(_3d_to_crvs_layers.curves)
offset_curve = OffsetCurve(
    Curve=curve,
    Plane=xy_plane,
    Distance=Slider(10, range=0..100),
    BothSides=negative,
    Kinks=0,
    CapType=Slider(0, range=0..3))
dispatch = Dispatch(List=offset_curve, DispatchPattern=[True, False])  # -> ListA, ListB

# ---- group: OUTER_crv
data = Data(dispatch.ListA)

# ---- group: INNER_crv
data_2 = Data(dispatch.ListB)

# ----
python_3_script = Python3Script(
    curves=data,
    resolution=multiplication,
    max_amp=number_slider_3,
    freq1=number_slider_4,
    freq2=number_slider_5,
    shift_rotation=number_slider_6,
    fade_power=number_slider_7,
    wave_mode=number_slider_8,
    blend_frequency=boolean_toggle)  # -> out, wave_curves, wave_points; inputs curves: list; disabled
# ---------- python_3_script: Python ----------
import Rhino.Geometry as rg
import math as m

from Grasshopper import DataTree
from Grasshopper.Kernel.Data import GH_Path


# ============================================================
# OUTPUTS
# ============================================================

wave_curves = []
wave_points = DataTree[rg.Point3d]()
is_closed = []


# ============================================================
# HELPER FUNCTIONS
# ============================================================

def get_amplitude(tz, max_amp, fade_power):
    """
    Fade amplitude from 0 to max_amp.

    fade_power = 1: linear
    fade_power = 2: quadratic
    fade_power = 3: cubic
    """

    return max_amp * (tz ** fade_power)


def get_wave(u, tz, amp):

    # ROTATION ACROSS LAYERS
    shift = tz * m.radians(shift_rotation)

    # TWO OPPOSITE DIRECTIONS
    a1 = 2 * m.pi * u + shift
    a2 = 2 * m.pi * u - shift

    # FREQUENCY BLENDING
    if blend_frequency:

        w1 = m.cos(a1 * freq1) * amp
        w2 = m.cos(a2 * freq2) * amp

    else:

        w1 = m.cos(a1 * freq1) * amp
        w2 = m.cos(a2 * freq1) * amp

    # WAVE COMBINATION
    if wave_mode == 0:
        return max(w1, w2)

    elif wave_mode == 1:
        return min(w1, w2)

    elif wave_mode == 2:
        return (w1 + w2) / 2.0

    elif wave_mode == 3:
        return w1 * (1 - tz) + w2 * tz

    return w1


# ============================================================
# GENERATE WAVES
# ============================================================

total_layers = len(curves)

for layer_index, curve in enumerate(curves):

    if curve is None:
        wave_curves.append(None)
        is_closed.append(False)
        continue

    # NORMALIZED HEIGHT
    tz = (
        layer_index / float(total_layers - 1)
        if total_layers > 1 else 0.0
    )

    # CURRENT AMPLITUDE
    amp = get_amplitude(tz, max_amp, fade_power)

    length = curve.GetLength()
    count = max(20, int(resolution))

    pts = []

    # SAMPLE UNIQUE POINTS
    for i in range(count):

        u = i / float(count)
        s = length * u

        ok, t = curve.LengthParameter(s)

        if not ok:
            continue

        pt = curve.PointAt(t)
        tangent = curve.TangentAt(t)

        # XY NORMAL
        normal = rg.Vector3d(
            -tangent.Y,
            tangent.X,
            0
        )

        if not normal.Unitize():
            continue

        # CALCULATE WAVE
        displacement = get_wave(u, tz, amp)

        new_pt = pt + normal * displacement

        pts.append(new_pt)

        wave_points.Add(
            new_pt,
            GH_Path(layer_index)
        )

    # ========================================================
    # CREATE CLOSED WAVE CURVE
    # ========================================================

    wave = None

    if len(pts) >= 4:

        # Periodic interpolation for smooth closure
        wave = rg.Curve.CreateInterpolatedCurve(
            pts,
            3,
            rg.CurveKnotStyle.ChordPeriodic
        )

    wave_curves.append(wave)

    is_closed.append(
        wave.IsClosed if wave is not None else False
    )
# ---------- end python_3_script ----------
multiplication_3 = Multiplication(A=Slider(7, range=0..500), B=12)
python_3_script_2 = Python3Script(
    curves=data,
    frequency=Slider(80, range=0..2500),
    resolution=multiplication_2,
    phase_shift=Slider(0.1, range=0..1),
    amplitude=Slider(5, range=0..20))  # -> out, wave_curves, wave_points, a; inputs curves: list, frequency: Double, resolution: Int32
# ---------- python_3_script_2: Python ----------
import Rhino.Geometry as rg
import math

from Grasshopper import DataTree
from Grasshopper.Kernel.Data import GH_Path

phase_shift = math.pi

wave_curves = []
wave_points = DataTree[object]()

for layer_index, curve in enumerate(curves):

    length = curve.GetLength()
    count = max(20, int(resolution))

    pts = []

    for i in range(count+1):

        s = length * i / count

        ok, t = curve.LengthParameter(s)
        if not ok:
            continue

        pt = curve.PointAt(t)
        tangent = curve.TangentAt(t)

        normal = rg.Vector3d(
            -tangent.Y,
            tangent.X,
            0
        )

        if not normal.Unitize():
            continue

        u = i / float(count)

        displacement = amplitude * math.sin(
            2 * math.pi * frequency * u
            + layer_index * phase_shift
        )

        new_pt = pt + normal * displacement
        pts.append(new_pt)

        # Store points in a branch for each layer
        wave_points.Add(new_pt, GH_Path(layer_index))

        # CREATE CLOSED CURVE
    wave = None

    if len(pts) >= 4:

        # Create interpolated curve
        wave = rg.Curve.CreateInterpolatedCurve(
            pts, 3
        )

        # Close curve explicitly
        if not wave.IsClosed:
            wave.MakeClosed(0.001)

    wave_curves.append(wave)

    is_closed = [
    wave.IsClosed if wave is not None else False
    for wave in wave_curves
]
# ---------- end python_3_script_2 ----------

# ----
# INPUTS
curve_2 = Curve(_3d_to_crvs_layers.curves)

python_3_script_3 = Python3Script(
    curves=curve,
    amplitude=Slider(1, range=0..20),
    frequency=Slider(50, range=0..2500),
    resolution=multiplication_3,
    phase_shift=Slider(0.1, range=0..1))  # -> out, wave_curves, wave_points; inputs curves: list, amplitude: Double, frequency: Double, resolution: Int32; same code as python_3_script_2
curve_3 = Curve(python_3_script.wave_curves)  # disabled

# ---- group: OUTER_corrugated
curve_4 = Curve(python_3_script_2.wave_curves)

# ---- group: MIXING THE CURVES
python_3_script_4 = Python3Script(crv_inner=data_2, crv_outer=curve_4)  # -> out, combined; inputs crv_inner: tree of Curve, crv_outer: tree of Curve
# ---------- python_3_script_4: Python ----------
import Rhino.Geometry as rg
import math

from Grasshopper import DataTree
from Grasshopper.Kernel.Data import GH_Path

combined = DataTree[object]()

for i in range(crv_inner.BranchCount):
    branch_a = crv_inner.Branch(i)
    branch_b = crv_outer.Branch(i)

    path = crv_inner.Path(i)

    for crv in branch_a:
        combined.Add(crv, path)

    for crv in branch_b:
        combined.Add(crv, path)
# ---------- end python_3_script_4 ----------

# ----
closed = Closed(Curve=python_3_script_3.wave_curves)  # -> Closed, Periodic
panel = Panel(python_3_script_4.combined)
point = Point(python_3_script_3.wave_points)

# ---- group: POINTS ORDER
python_3_script_5 = Python3Script(combined=python_3_script_4.combined, resolution=multiplication_2)  # -> out, points; inputs combined: tree, resolution: Int32
# ---------- python_3_script_5: Python ----------
import Rhino.Geometry as rg
from Grasshopper import DataTree

# OUTPUT
points = DataTree[rg.Point3d]()


def get_curve_points(curve, resolution):

    # Divide closed curve into equal-length segments
    t = curve.DivideByCount(resolution, False)

    return [curve.PointAt(i) for i in t]

def shift_points(pts, shift):

    shift = shift % len(pts)

    return pts[shift:] + pts[:shift]

# PROCESS EACH LAYER
for layer in range(combined.BranchCount):

    path = combined.Path(layer)

    curves = combined.Branch(layer)

    if len(curves) < 2:
        continue

    # GET POINTS
    pts_0 = get_curve_points(curves[0], resolution)
    pts_1 = get_curve_points(curves[1], resolution)

    # # ALTERNATE CURVE ORDER
    # if layer % 2 == 0:

    #     first = pts_0
    #     second = pts_1

    #     shift_first = layer
    #     shift_second = max(0, layer - 1)

    # else:

    #     first = pts_1
    #     second = pts_0

    #     shift_first = layer - 1
    #     shift_second = layer
    
    # ALWAYS CURVE 0 THEN CURVE 1
    first = pts_0
    second = pts_1

    # PROGRESSIVE SPIRAL SHIFT
    shift_first = layer
    shift_second = layer

    # SHIFT STARTING POINT
    first = shift_points(first, shift_first)
    second = shift_points(second, shift_second)

    # FIRST CURVE: INCLUDE CLOSING POINT
    first = first #+ [first[0]]

    # SECOND CURVE: EXCLUDE CLOSING POINT
    # DivideByCount(..., False) already excludes it

    # COMBINE BOTH CURVES
    layer_points = first + second

    # OUTPUT TO ORIGINAL BRANCH
    for pt in layer_points:
        points.Add(pt, path)
# ---------- end python_3_script_5 ----------

# ----
point_2 = Point(python_3_script_5.points)
point_3 = Point(python_3_script_2.wave_points)
list_length = ListLength(List=point_3)
panel_2 = Panel(python_3_script_5.points)
panel_3 = Panel(closed.Closed)

# ----
# Right points of the working space
panel_4 = Panel("608.95,528.88,16.97")
point_4 = Point("614.95,-63.4,16.71")
point_5 = Point(panel_4)
point_6 = Point("218.39,-65.25,17.22")

# ---- group: This is needed only ONCE in the GH definition
enable_auto_reload = Python3Script()  # -> ok
# ---------- enable_auto_reload: Python ----------
"""
------------------------------
Using VS Code as Python editor
------------------------------

The simplest way to start using VS Code as our editor, is
to place our Python code in files located IN THE SAME FOLDER as our Grasshopper file.

After we have done that, we need 2 steps: 

1. Enable the COMPAS reloader on one component. This tells Grasshopper to watch for changes in the Pythoh files and reload if changed.
2. Every other component that uses Python code from external files needs to start with a method to ensure Grasshopper knows where to load the files from.

"""
# r: compas
# venv: mas-2627

from compas_rhino.devtools import DevTools
DevTools.enable_reloader()
# ---------- end enable_auto_reload ----------

# ----
# PRINTPATH WITH STATIC SPEED
point_spacing_mm = Slider(3, range=1..50)
unit_x = UnitX(Factor=1)
safety_distance_mm = Slider(100, range=10..300)
blend_radius_mm = Slider(1, range=0..5)
speed_mm_s = Slider(20, range=1..60)
tail_rotation = Slider(180, range=0..360)
divide_distance = DivideDistance(Curve=curve_2, Distance=point_spacing_mm)  # -> Points, Tangents, Parameters
unit_y = UnitY(Factor=1)
negative_2 = Negative(Value=unit_x)
construct_plane = ConstructPlane(Origin=point_2, XAxis=negative_2, YAxis=unit_y)  # -> flatten(Plane)

frames_to_print = Printpath(
    frames=construct_plane,
    speed=speed_mm_s,
    blend_radius=blend_radius_mm,
    safety_distance=safety_distance_mm,
    tail_rotation=tail_rotation)  # -> printpath, summary, frame; inputs frames: list of Plane, speed: Double, blend_radius: Double, safety_distance: Double, tail_rotation: Double
# ---------- frames_to_print: Python ----------
"""
Turn the frames into printpoints and a PrintPath, in work object coordinates.
Includes an initial approach line (tail) at layer 0 rotated by tail_rotation.
Safety points are added here, before any transform to the robot base.
"""
import math
import os
import sys
from compas.geometry import Frame, Point, Vector

# Include source path once
gh_dir = os.path.dirname(ghenv.Component.OnPingDocument().FilePath)
src_dir = os.path.abspath(os.path.join(gh_dir, "..", "src"))
if src_dir not in sys.path:
    sys.path.append(src_dir)

from print_class import PrintPath, PrintPoint


def to_compas_frame(f):
    """Schnelle Konvertierung von Rhino Plane / GH_Plane zu COMPAS Frame."""
    if hasattr(f, "Value"):  # Grasshopper GH_Plane Wrapper
        f = f.Value

    # Schnellprüfung auf Rhino Plane über Direct Attribute Access
    try:
        o = f.Origin
        x = f.XAxis
        y = f.YAxis
        return Frame(
            Point(float(o.X), float(o.Y), float(o.Z)),
            Vector(float(x.X), float(x.Y), float(x.Z)),
            Vector(float(y.X), float(y.Y), float(y.Z))
        )
    except AttributeError:
        # Ist bereits COMPAS Frame oder ein kompatibles Objekt
        return f


def get_origin_coords(f):
    """Extrahiert (x, y, z) direkt ohne vollständige Frame-Konvertierung."""
    if hasattr(f, "Value"):
        f = f.Value
    if hasattr(f, "Origin"):
        o = f.Origin
        return float(o.X), float(o.Y), float(o.Z)
    elif hasattr(f, "point"):
        p = f.point
        return float(p.x), float(p.y), float(p.z)
    return 0.0, 0.0, 0.0


# 1. Eingaben validieren und Parameter parsen
if not frames:
    layers_frames = []
elif hasattr(frames, "Branches"):  # Grasshopper DataTree
    layers_frames = [list(b) for b in frames.Branches if b]
elif isinstance(frames, list):
    if len(frames) > 0 and isinstance(frames[0], list):
        layers_frames = [lf for lf in frames if lf]
    else:
        layers_frames = [frames] if frames else []
else:
    layers_frames = [[frames]]

valid_layers = layers_frames
num_layers = len(valid_layers)

# Safe Fallbacks für Parameter
tail_rot = float(tail_rotation) if ('tail_rotation' in locals() and tail_rotation is not None) else 0.0
tail_len = float(tail_length) if ('tail_length' in locals() and tail_length is not None and float(tail_length) > 0) else 50.0
sp = speed if 'speed' in locals() else 0.0
br = blend_radius if 'blend_radius' in locals() else 0.0

printpoints = []

# 2. Lead-in Line (Tail) generieren
if valid_layers and tail_len > 0 and len(valid_layers[0]) > 0:
    first_frame = to_compas_frame(valid_layers[0][0])
    x0, y0, z0 = float(first_frame.point.x), float(first_frame.point.y), float(first_frame.point.z)

    rad = math.radians(tail_rot)
    tail_start_x = x0 - tail_len * math.cos(rad)
    tail_start_y = y0 - tail_len * math.sin(rad)

    num_tail_pts = max(2, int(round(tail_len / 5.0)))
    fx, fy = first_frame.xaxis, first_frame.yaxis

    for i in range(num_tail_pts):
        t = i / float(num_tail_pts)
        tx = tail_start_x + t * (x0 - tail_start_x)
        ty = tail_start_y + t * (y0 - tail_start_y)
        
        frame_obj = Frame(Point(tx, ty, z0), fx, fy)
        printpoints.append(PrintPoint(frame_obj, 0, sp, br, True))

# 3. Punkte pro Layer verarbeiten
for layer_index, layer_frames in enumerate(valid_layers):
    if not layer_frames:
        continue

    # Layer schließen (außer Layer 0 und letztes Layer)
    close_layer = False
    if 0 < layer_index < num_layers - 1:
        sx, sy, sz = get_origin_coords(layer_frames[0])
        ex, ey, ez = get_origin_coords(layer_frames[-1])
        if ((ex - sx)**2 + (ey - sy)**2 + (ez - sz)**2) > 1e-12:
            close_layer = True

    # Frames konvertieren
    for f in layer_frames:
        frame_obj = to_compas_frame(f)
        printpoints.append(PrintPoint(frame_obj, layer_index, sp, br, True))

    if close_layer:
        frame_obj = to_compas_frame(layer_frames[0])
        printpoints.append(PrintPoint(frame_obj, layer_index, sp, br, True))

# 4. PrintPath und Output-Listen in einem Rutsch erstellen
printpath = PrintPath(printpoints)
if 'safety_distance' in locals() and safety_distance is not None:
    printpath.add_safety_before(safety_distance, sp)
    printpath.add_safety_after(safety_distance, sp)

# frames-Output für GH extrahieren
frame = [pt.frame for pt in printpoints]

summary = f"{len(printpoints)} printpoints in {num_layers} layers (including approach tail), plus 2 safety points"
# ---------- end frames_to_print ----------

panel_5 = Panel(frames_to_print.summary)

# ----
# PATH
compas_draw = COMPASDraw(cg=frames_to_print.frame)  # -> rg
#   port cg: The COMPAS geometry or datastructure to be drawn.
#   port rg: The Rhino geometry object.
# ---------- compas_draw: Python ----------
# r: compas>=2.14.1
"""
Draws COMPAS geometry in Grasshopper.
"""

from typing import Any

import Grasshopper

from compas.scene import SceneObject


class CompasToRhinoGeometry(Grasshopper.Kernel.GH_ScriptInstance):
    def RunScript(self, cg):
        if not cg:
            return None

        return SceneObject(item=cg).draw()
# ---------- end compas_draw ----------
list_item = ListItem(List=compas_draw, Index=0, Wrap=True)  # -> flatten(Item)
list_item_2 = ListItem(List=list_item, Index=Slider(0, range=0..200), Wrap=True)

# ----
# EXPORT
save = Button()
preview = Preview(printpath=frames_to_print.printpath)  # -> path, travel, planes
# ---------- preview: Python ----------
# r: compas
# venv: mas-2627
"""
Draw the printpath: path = the whole polyline, travel = extruder-off segments,
safety = extruder-off points, axes = small x and y axis of each frame.
"""
import Rhino.Geometry as rg
from compas_rhino.conversions import frame_to_rhino_plane, point_to_rhino

AXIS_LENGTH = 5.0  # mm

points = printpath.printpoints
planes = [frame_to_rhino_plane(printpoint.frame) for printpoint in points]

# ===== Whole path =====
polyline = rg.Polyline()
for plane in planes:
    polyline.Add(plane.Origin.X, plane.Origin.Y, plane.Origin.Z)
path = polyline.ToPolylineCurve()

# ===== Extruder off: a segment prints only if both of its points have the extruder on =====
safety = [point_to_rhino(printpoint.frame.point) for printpoint in points if not printpoint.is_extruder_on]
travel = []
for i in range(len(points) - 1):
    if not (points[i].is_extruder_on and points[i + 1].is_extruder_on):
        travel.append(rg.Line(planes[i].Origin, planes[i + 1].Origin))
# ---------- end preview ----------
save_2 = Save(printpath=frames_to_print.printpath, save=save, out_path="data/out_printpoints_piece_doublewall_bigwaves.json")  # -> status
# ---------- save_2: Python ----------
# r: compas
# venv: mas-2627
"""
On button press, write the printpath to data/out_printpoints.json next to this .ghx file.
send_to_robot.py reads that file.
"""
import json
import os

import scriptcontext as sc

gh_dir = os.path.dirname(ghenv.Component.OnPingDocument().FilePath)
parent_dir = os.path.dirname(gh_dir)

# keep the last status in sticky, so the message survives the button being released
status_key = "save_status_" + str(ghenv.Component.InstanceGuid)

if save:
    if printpath is None:
        sc.sticky[status_key] = "nothing to save: no printpath"
    else:
        path = os.path.normpath(os.path.join(parent_dir, out_path))
        os.makedirs(os.path.dirname(path), exist_ok=True)
        with open(path, "w") as f:
            json.dump(printpath.to_dict(), f, indent=2)
        sc.sticky[status_key] = f"saved {len(printpath)} printpoints to {path}"

status = sc.sticky.get(status_key, "")
ghenv.Component.Message = "saved" if status.startswith("saved") else status
# ---------- end save_2 ----------
preview_2 = CustomPreview(Geometry=preview.path, Material=ColourSwatch(SwatchColor=RGB(0, 170, 80)))
preview_3 = CustomPreview(Geometry=preview.travel, Material=ColourSwatch(SwatchColor=RGB(230, 40, 40)))
plane = Plane(preview.planes)
