# Grasshopper definition G4_design_Nils.ghx (Grasshopper 1.0.8)

# ----
# 90° PIPE
number_slider = Slider(300, range=0..300)  # disabled
number_slider_2 = Slider(0.85, range=0..10)  # disabled
number_slider_3 = Slider(0, range=0..10)  # disabled
number_slider_4 = Slider(0, range=0..20)  # disabled
number_slider_5 = Slider(0, range=-100..100)  # disabled
number_slider_6 = Slider(0, range=0..10)  # disabled
number_slider_7 = Slider(0, range=-360..360)  # disabled
number_slider_8 = Slider(0, range=-100..100)  # disabled
number_slider_9 = Slider(20, range=0..100)  # disabled
number_slider_10 = Slider(80, range=10..200)  # disabled
number_slider_11 = Slider(30, range=0..100)  # disabled
curve = Curve(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)  # disabled
curve_2 = Curve(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)  # disabled
python_3_script = Python3Script(
    axis_curve=curve,
    resolution=number_slider_10,
    radius_1=number_slider_11,
    radius_2=number_slider_9,
    height=number_slider,
    layer_height=number_slider_2,
    offset_x=number_slider_8,
    offset_y=number_slider_5,
    freq1=number_slider_3,
    freq2=number_slider_6,
    rotation=number_slider_7,
    amplitude=number_slider_4)  # -> out, layers, mesh; inputs axis_curve: Curve, resolution: Int32, radius_1: Double, radius_2: Double, offset_x: Double, offset_y: Double, freq1: Int32, freq2: Int32, rotation: Double, amplitude: Double; disabled
# ---------- python_3_script: Python ----------
import math as m
import numpy as np
import Rhino.Geometry as rg


class Column:
    def __init__(
        self, 
        axis: rg.Curve, 
        radius_base: float, 
        radius_top: float,
        amp: float = 0.0,
        rotation: float = 0.0,
        freq1: int = 1,
        freq2: int = 1
    ):
        self.axis = axis
        self.radius_base = radius_base
        self.radius_top = radius_top
        self.amp = amp
        self.rotation = rotation
        self.freq1 = freq1
        self.freq2 = freq2
        
        self.height = self.axis.GetLength()

    def get_radius(self, angle: float, tz: float) -> float:
        return self.radius_base * (1.0 - tz) + self.radius_top * tz

    def get_radius_wave(self, angle: float, tz: float) -> float:
        shift = tz * m.radians(self.rotation)
        angle_shifted = angle + shift

        _r1 = m.cos(angle_shifted * self.freq1) * self.amp
        _r2 = m.cos(angle_shifted * self.freq2) * self.amp

        return self.get_radius(angle_shifted, tz) + _r1 * (1.0 - tz) + _r2 * tz

    def get_layer_frames(self, layer_height: float, res_u: int) -> list[list[rg.Plane]]:
        """
        Generates layer frames along curve arc-length.
        Uses continuous Parallel Transport to prevent coordinate flipping on steep curves.
        """
        layers_count = max(2, int(self.height // layer_height) + 1)
        distances = np.linspace(0.0, self.height, layers_count)
        s_values = np.linspace(0.0, 1.0, layers_count)
        
        layers_frames = []
        prev_z = None
        prev_x = None

        for dist, tz in zip(distances, s_values):
            # Correct RhinoCommon evaluation via curve length parameter
            rc, t = self.axis.LengthParameter(dist)
            if not rc:
                domain = self.axis.Domain
                t = domain.Min + tz * domain.Length

            origin_center = self.axis.PointAt(t)
            tangent = self.axis.TangentAt(t)
            
            z_axis = -tangent
            z_axis.Unitize()

            # Parallel Transport: Transition orientation smoothly between layers
            if prev_z is None:
                ref_x = rg.Vector3d(1, 0, 0)
                if abs(rg.Vector3d.Multiply(z_axis, ref_x)) > 0.9:
                    ref_x = rg.Vector3d(0, 1, 0)

                y_axis = rg.Vector3d.CrossProduct(z_axis, ref_x)
                y_axis.Unitize()
                x_axis = rg.Vector3d.CrossProduct(y_axis, z_axis)
                x_axis.Unitize()
            else:
                rot = rg.Transform.Rotation(prev_z, z_axis, origin_center)
                x_axis = rg.Vector3d(prev_x)
                x_axis.Transform(rot)

                y_axis = rg.Vector3d.CrossProduct(z_axis, x_axis)
                y_axis.Unitize()
                x_axis = rg.Vector3d.CrossProduct(y_axis, z_axis)
                x_axis.Unitize()

            prev_z = z_axis
            prev_x = x_axis

            section_plane = rg.Plane(origin_center, x_axis, y_axis)

            layer = []
            for angle in np.linspace(0.0, m.tau, res_u)[:-1]:
                radius = self.get_radius_wave(angle, tz)

                x_local = m.cos(angle) * radius
                y_local = m.sin(angle) * radius
                pt = section_plane.PointAt(x_local, y_local)

                frame = rg.Plane(pt, x_axis, y_axis)
                layer.append(frame)

            layers_frames.append(layer)

        return layers_frames

    @staticmethod
    def get_mesh(layers_frames: list[list[rg.Plane]], closed: bool) -> rg.Mesh:
        mesh = rg.Mesh()

        for layer in layers_frames:
            for frame in layer:
                mesh.Vertices.Add(frame.Origin)

        idx = np.array(range(mesh.Vertices.Count))
        idx = idx.reshape(len(layers_frames), len(layers_frames[0]))

        if closed:
            faces = np.stack([
                idx[:-1],
                np.roll(idx[:-1], -1, axis=1),
                idx[1:],
                np.roll(idx[1:], -1, axis=1)
            ], axis=-1).reshape(-1, 4)
        else:
            faces = np.lib.stride_tricks.sliding_window_view(
                idx, window_shape=(2, 2)
            ).reshape(-1, 4)
    
        for f in faces:
            mesh.Faces.AddFace(
                int(f[0]),
                int(f[1]),
                int(f[3]),
                int(f[2])
            )

        mesh.Compact()
        mesh.RebuildNormals()
        return mesh


# --- GRASSHOPPER INTEGRATION ---
if 'axis_curve' in locals() and axis_curve is not None:
    _r1 = radius_1 if 'radius_1' in locals() else 10.0
    _r2 = radius_2 if 'radius_2' in locals() else 5.0
    _amp = amplitude if 'amplitude' in locals() else 0.0
    _rot = rotation if 'rotation' in locals() else 0.0
    _f1 = freq1 if 'freq1' in locals() else 1
    _f2 = freq2 if 'freq2' in locals() else 1
    _lh = layer_height if 'layer_height' in locals() else 1.0
    _res = int(resolution) if 'resolution' in locals() else 30

    mycolumn = Column(
        axis=axis_curve,
        radius_base=_r1,
        radius_top=_r2,
        amp=_amp,
        rotation=_rot,
        freq1=_f1,
        freq2=_f2
    )

    layers_list = mycolumn.get_layer_frames(layer_height=_lh, res_u=_res)
    mesh = Column.get_mesh(layers_list, closed=True)

    import ghpythonlib.treehelpers as tree
    layers = tree.list_to_tree(layers_list)
# ---------- end python_3_script ----------
number_slider_12 = Slider(1, range=0..1)  # disabled
unit_z = UnitZ(Factor=number_slider_12)  # disabled
move = Move(Geometry=python_3_script.layers, Motion=unit_z)  # -> Geometry, Transform; disabled

python_3_script_2 = Python3Script(length=Slider(200, range=0..400), amplitude=Slider(1.3, range=-50..50))  # -> out, curve; inputs length: Double, amplitude: Double
# ---------- python_3_script_2: Python ----------
import math
import Rhino.Geometry as rg

def create_vertical_sine_curve(length, amplitude, samples=64):
    if length is None or amplitude is None or length <= 0:
        return None

    points = []

    for i in range(samples + 1):
        t = float(i) / samples
        z = t * length

        # Enforce exact extrema and zero crossings to avoid float precision noise
        if i == 0 or i == samples:
            x = -amplitude
        elif i * 2 == samples:
            x = amplitude
        elif i * 4 == samples or i * 4 == 3 * samples:
            x = 0.0
        else:
            x = -amplitude * math.cos(2.0 * math.pi * t)

        points.append(rg.Point3d(x, 0.0, z))

    # Interpolate a smooth degree-3 NURBS curve through the sampled points
    return rg.Curve.CreateInterpolatedCurve(points, 3, rg.CurveKnotStyle.Chord)

curve = create_vertical_sine_curve(length, amplitude, samples=64)
# ---------- end python_3_script_2 ----------
curve_3 = Curve(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)
curve_4 = Curve(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)
point = Point(Point(-50.79848814, -83.96209346, 0))
point_2 = Point(Point(-50.79848814, 20.09832699, 0))
python_3_script_3 = Python3Script(
    central_axis=python_3_script_2.curve,
    cross_section_1=curve_3,
    cross_section_2=curve_4,
    center_pt_cross_section_1=point,
    center_pt_cross_section_2=point_2)  # -> out, brep; inputs central_axis: Curve, cross_section_1: Curve, cross_section_2: Curve, center_pt_cross_section_1: Point3d, center_pt_cross_section_2: Point3d
# ---------- python_3_script_3: Python ----------
import Rhino
import Rhino.Geometry as rg

def create_sweep_brep(axis, sec1, sec2, pt1, pt2, cap_ends=True):
    if None in (axis, sec1, sec2, pt1, pt2):
        return None
    if not (pt1.IsValid and pt2.IsValid):
        return None

    tol = Rhino.RhinoDoc.ActiveDoc.ModelAbsoluteTolerance if Rhino.RhinoDoc.ActiveDoc else 0.001

    # Get curve parameters for start, exact arc-length midpoint, and end
    t_start = axis.Domain.T0
    ok_mid, t_mid = axis.NormalizedLengthParameter(0.5)
    t_end = axis.Domain.T1

    if not ok_mid:
        t_mid = axis.Domain.Mid

    # Compute perpendicular, twist-free frames along the central axis
    ok0, frame_start = axis.PerpendicularFrameAt(t_start)
    ok1, frame_mid = axis.PerpendicularFrameAt(t_mid)
    ok2, frame_end = axis.PerpendicularFrameAt(t_end)

    if not (ok0 and ok1 and ok2):
        return None

    # Align curve directions in 2D before transforming
    sec2_aligned = sec2.DuplicateCurve()
    if not rg.Curve.DoDirectionsMatch(sec1, sec2_aligned):
        sec2_aligned.Reverse()

    # Define local XY source planes anchored at the respective center points
    base_plane_1 = rg.Plane(pt1, rg.Vector3d.XAxis, rg.Vector3d.YAxis)
    base_plane_2 = rg.Plane(pt2, rg.Vector3d.XAxis, rg.Vector3d.YAxis)

    # Transform cross-sections onto the three target frames along the axis
    base_curves = [sec1, sec2_aligned, sec1]
    base_planes = [base_plane_1, base_plane_2, base_plane_1]
    frames = [frame_start, frame_mid, frame_end]
    sections = []

    for curve, src_plane, dst_frame in zip(base_curves, base_planes, frames):
        s = curve.DuplicateCurve()
        s.Transform(rg.Transform.PlaneToPlane(src_plane, dst_frame))
        sections.append(s)

    # Generate open 1-rail sweep brep
    breps = rg.Brep.CreateFromSweep(axis, sections, False, tol)
    if not breps:
        return None

    result = breps[0]
    if cap_ends:
        capped = result.CapPlanarHoles(tol)
        if capped:
            result = capped

    return result

brep = create_sweep_brep(
    central_axis,
    cross_section_1,
    cross_section_2,
    center_pt_cross_section_1,
    center_pt_cross_section_2,
    cap_ends=True
)
# ---------- end python_3_script_3 ----------

unit_x = UnitX(Factor=Slider(2, range=-100..100))
python_3_script_4 = Python3Script(length=Slider(200, range=0..400), amplitude=Slider(20.6, range=-50..50))  # -> out, curve; inputs length: Double, amplitude: Double; same code as python_3_script_2
move_2 = Move(Geometry=python_3_script_4.curve, Motion=unit_x)  # -> Geometry, Transform

# ----
# Right points of the working space
panel = Panel("608.95,528.88,16.97")
point_3 = Point("614.95,-63.4,16.71")
point_4 = Point(panel)
point_5 = Point("218.39,-65.25,17.22")

# ---- group: This is needed only ONCE in the GH definition
enable_auto_reload = Python3Script()  # -> ok
# ---------- enable_auto_reload: Python ----------
"""
------------------------------
Using VS Code as Python editor
------------------------------

The simplest way to start using VS Code as our editor, is
to place our Python code in files located IN THE SAME FOLDER as our Grasshopper file.

After we have done that, we need 2 steps: 

1. Enable the COMPAS reloader on one component. This tells Grasshopper to watch for changes in the Pythoh files and reload if changed.
2. Every other component that uses Python code from external files needs to start with a method to ensure Grasshopper knows where to load the files from.

"""
# r: compas
# venv: mas-2627

from compas_rhino.devtools import DevTools
DevTools.enable_reloader()
# ---------- end enable_auto_reload ----------

# ----
# Geometry
brep = Brep(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)  # disabled
brep_2 = Brep(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)  # disabled
brep_3 = Brep(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)  # disabled
brep_4 = Brep(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)  # disabled

# ----
# NON-PLANAR WITH SPINE
number_slider_13 = Slider(4.42, range=0..30)
number_slider_14 = Slider(9.66, range=0..10)
number_slider_15 = Slider(1, range=0..10)
number_slider_16 = Slider(15, range=0..135)
number_slider_17 = Slider(0, range=0..360)
brep_to_non_planar = Python3Script(
    brep=python_3_script_3.brep,
    central_axis=move_2.Geometry,
    frame_to_frame=number_slider_13,
    layer_height=number_slider_14,
    first_layer_height=number_slider_15,
    corner_angle=number_slider_16,
    seam_angle=number_slider_17)  # -> out, frames, pt_layer_height; inputs brep: Brep, central_axis: Curve, frame_to_frame: Double, layer_height: Double, first_layer_height: Double, corner_angle: Int32, seam_angle: Double
# ---------- brep_to_non_planar: Python ----------
import math
import Rhino
import Rhino.Geometry as rg
from Grasshopper import DataTree
from Grasshopper.Kernel.Data import GH_Path


# --- 1. Slicing planes along the central axis ---
def get_slice_planes(axis, first_step, layer_step, tol):
    total_len = axis.GetLength()
    t0, t1 = axis.Domain.T0, axis.Domain.T1
    params = []
    dist = first_step
    while dist <= total_len + tol:
        if dist <= tol:
            params.append(t0)
        elif dist >= total_len - tol:
            params.append(t1)
        else:
            ok, t = axis.LengthParameter(dist)
            if ok:
                params.append(t)
        dist += layer_step

    if not params:
        return []
    if len(params) == 1:
        ok, frame = axis.PerpendicularFrameAt(params[0])
        return [frame] if ok else []
    return axis.GetPerpendicularFrames(params) or []


# --- 2. Free seam placement via ray angle ---
def set_seam_by_angle(curve, origin, ray_dir, tol):
    if not curve.IsClosed:
        return
    ray_line = rg.Line(origin, origin + ray_dir)
    events = rg.Intersect.Intersection.CurveLine(curve, ray_line, tol, tol)
    if events and events.Count > 0:
        best_t = max(
            (events[i] for i in range(events.Count)),
            key=lambda ev: (ev.PointA - origin) * ray_dir
        ).ParameterA
    else:
        far_pt = origin + ray_dir * (curve.GetBoundingBox(False).Diagonal.Length + 10.0)
        ok, best_t = curve.ClosestPoint(far_pt)
        if not ok:
            return
    curve.ChangeClosedCurveSeam(best_t)


# --- 3. Corner detection & segmentation into smooth wall sections ---
def _is_sharp(seg_a, seg_b, angle_rad, vec_angle=rg.Vector3d.VectorAngle):
    va, vb = seg_a.TangentAtEnd, seg_b.TangentAtStart
    return va.Unitize() and vb.Unitize() and vec_angle(va, vb) > angle_rad


def split_curve_at_corners(curve, angle_rad, tol):
    # A) Decompose contour at face boundaries and internal NURBS kinks (C1)
    pieces = curve.DuplicateSegments() if isinstance(curve, rg.PolyCurve) else (curve,)
    parts = []
    for p in pieces:
        if p is None or p.IsShort(tol):
            continue
        t, t1 = p.Domain.T0, p.Domain.T1
        cuts = [t]
        while True:
            ok, t_next = p.GetNextDiscontinuity(rg.Continuity.C1_continuous, t, t1)
            if not ok or t_next <= t + 1e-9 or t_next >= t1 - 1e-9:
                break
            cuts.append(t_next)
            t = t_next

        if len(cuts) == 1:
            parts.append(p)
        else:
            cuts.append(t1)
            for i in range(len(cuts) - 1):
                sub = p.Trim(cuts[i], cuts[i + 1])
                if sub is not None and not sub.IsShort(tol):
                    parts.append(sub)

    if not parts:
        return []

    # B) Merge smooth transitions (<= corner_angle) back into continuous sides
    groups = [[parts[0]]]
    for k in range(1, len(parts)):
        if _is_sharp(parts[k - 1], parts[k], angle_rad):
            groups.append([parts[k]])
        else:
            groups[-1].append(parts[k])

    PolyCurve = rg.PolyCurve
    segments = []
    for g in groups:
        if len(g) == 1:
            segments.append(g[0])
        else:
            pc = PolyCurve()
            for item in g:
                pc.Append(item)
            segments.append(pc)

    return segments


# --- 4. Uniform point sampling per smooth wall section ---
def sample_contour_points(segments, frame_step):
    pts = []
    last_idx = len(segments) - 1
    for idx, seg in enumerate(segments):
        seg_len = seg.GetLength()
        if seg_len <= 0.0:
            continue

        if idx < last_idx:
            n_steps = max(1, int(round(seg_len / frame_step)))
            t_params = seg.DivideByCount(n_steps, True)
            if t_params and len(t_params) > 1:
                for i in range(len(t_params) - 1):
                    pts.append(seg.PointAt(t_params[i]))
            else:
                pts.append(seg.PointAtStart)
        else:
            # Keep frame_step clearance before the closed curve end (seam point)
            target_end = seg_len - frame_step
            if target_end < frame_step * 0.5:
                pts.append(seg.PointAtStart)
            else:
                n_steps = max(1, int(round(target_end / frame_step)))
                ok_p, t_end = seg.LengthParameter(target_end)
                sub = seg.Trim(seg.Domain.T0, t_end) if ok_p else None
                t_params = sub.DivideByCount(n_steps, True) if sub else None
                if t_params:
                    for t in t_params:
                        pts.append(sub.PointAt(t))
                else:
                    pts.append(seg.PointAtStart)
    return pts


# --- 5. Layer height measurement via fast polyline proxies ---
def build_polyline_proxy(curve, tol):
    ok, pl = curve.TryGetPolyline()
    if not ok:
        plc = curve.ToPolyline(tol, 0.0, 0.0, 0.0)
        pl = plc.ToPolyline() if plc else None
    return pl if (pl and pl.IsValid) else None


def compute_layer_heights(prev_pts, polylines, fallback_lh, sqrt=math.sqrt):
    if not polylines:
        return [fallback_lh] * len(prev_pts)
    return [
        sqrt(min(pl.ClosestPoint(pt).DistanceToSquared(pt) for pl in polylines))
        for pt in prev_pts
    ]


# --- Main execution function ---
def brep_to_non_planar_frames(brep, axis, frame_step, layer_step, first_layer_step, corner_angle_deg=45.0, seam_angle_deg=0.0):
    frames_tree = DataTree[rg.Plane]()
    heights_tree = DataTree[float]()

    tol = Rhino.RhinoDoc.ActiveDoc.ModelAbsoluteTolerance
    slice_planes = get_slice_planes(axis, first_layer_step, layer_step, tol)
    if not slice_planes:
        return frames_tree, heights_tree

    angle_rad = math.radians(corner_angle_deg)
    seam_rad = math.radians(seam_angle_deg)
    cos_seam, sin_seam = math.cos(seam_rad), math.sin(seam_rad)
    nominal_lh = float(layer_step)

    Plane = rg.Plane
    brep_plane_intersect = rg.Intersect.Intersection.BrepPlane
    join_curves = rg.Curve.JoinCurves
    cw = rg.CurveOrientation.Clockwise
    x_world, y_world = rg.Vector3d.XAxis, rg.Vector3d.YAxis

    layer_idx = 0
    prev_pts = None
    prev_path = None

    for plane in slice_planes:
        ok, int_curves, _ = brep_plane_intersect(brep, plane, tol)
        if not ok or not int_curves:
            continue

        joined = join_curves(int_curves, tol)
        if not joined:
            continue

        # Local frame orientation: Z pointing downwards, X/Y stabilized to world axes
        z_axis = -plane.ZAxis
        ref_x = y_world if abs(z_axis * x_world) > 0.999 else x_world
        x_axis = ref_x - (ref_x * z_axis) * z_axis
        if not x_axis.Unitize():
            continue
        y_axis = rg.Vector3d.CrossProduct(z_axis, x_axis)
        ray_dir = cos_seam * x_axis + sin_seam * y_axis

        layer_pts = []
        layer_polylines = []

        for c in joined:
            if c.IsShort(tol):
                continue
            if c.IsClosed and c.ClosedCurveOrientation(plane) == cw:
                c.Reverse()

            pl = build_polyline_proxy(c, tol)
            if pl:
                layer_polylines.append(pl)

            set_seam_by_angle(c, plane.Origin, ray_dir, tol)

            segments = split_curve_at_corners(c, angle_rad, tol)
            if segments:
                layer_pts.extend(sample_contour_points(segments, frame_step))

        if not layer_pts:
            continue

        if prev_pts is not None:
            heights_tree.AddRange(compute_layer_heights(prev_pts, layer_polylines, nominal_lh), prev_path)

        path = GH_Path(layer_idx)
        frames_tree.AddRange([Plane(pt, x_axis, y_axis) for pt in layer_pts], path)

        prev_pts = layer_pts
        prev_path = path
        layer_idx += 1

    if prev_pts is not None:
        heights_tree.AddRange([nominal_lh] * len(prev_pts), prev_path)

    return frames_tree, heights_tree


frames, pt_layer_height = brep_to_non_planar_frames(
    brep,
    central_axis,
    frame_to_frame,
    layer_height,
    first_layer_height,
    corner_angle,
    seam_angle
)
# ---------- end brep_to_non_planar ----------

# ----
# LAYERS
spacing = Slider(1.1, range=0.5..5)  # disabled
rotation = Slider(0, range=0..360)  # disabled
bottom_offset = Slider(0.8, range=0.1..5)  # disabled
_3d_to_crvs_layers = Python3Script(brep=brep_3, spacing=spacing, rotation=rotation, bottom_offset=bottom_offset)  # -> out, curves; inputs brep: Brep, spacing: Double, rotation: Double, bottom_offset: Double; disabled
# ---------- _3d_to_crvs_layers: Python ----------
import Rhino.Geometry as rg
import math

def slice_polysurface(brep, spacing, bottom_offset, rotation):
    """
    Slices a closed polysurface sequentially from bottom to top
    and aligns the start point (seam) of the curves according to the 'rotation' angle.
    
    :param brep: Rhino.Geometry.Brep (input geometry)
    :param spacing: Distance between cutting planes (float > 0)
    :param bottom_offset: Distance from the first cutting plane to the base surface (float >= 0)
    :param rotation: Start angle in degrees (0.0 to 360.0) for the seam / start point
    :return: List of contour curves, sorted from bottom to top
    """
    if not brep or spacing <= 0 or bottom_offset < 0:
        return []

    # 1. Get bounding box & height limits
    bbox = brep.GetBoundingBox(True)
    z_min = bbox.Min.Z
    z_max = bbox.Max.Z

    start_z = z_min + bottom_offset

    if start_z > z_max:
        return []

    # 2. Calculate number of cuts & center data
    num_cuts = int(math.floor((z_max - start_z) / spacing)) + 1
    
    center_x = bbox.Center.X
    center_y = bbox.Center.Y

    # Radius for the alignment vector (+ 50% safety margin)
    dx = max(abs(bbox.Min.X - center_x), abs(bbox.Max.X - center_x))
    dy = max(abs(bbox.Min.Y - center_y), abs(bbox.Max.Y - center_y))
    r_max = math.hypot(dx, dy) * 1.5

    # Convert angle from degrees to radians
    rot_rad = math.radians(rotation)
    dir_x = math.cos(rot_rad)
    dir_y = math.sin(rot_rad)

    sliced_curves = []

    # 3. Iteratively generate cutting planes & adjust seam (start point)
    for i in range(num_cuts):
        current_z = start_z + i * spacing
        cut_plane = rg.Plane(rg.Point3d(center_x, center_y, current_z), rg.Vector3d.ZAxis)
        
        contours = rg.Brep.CreateContourCurves(brep, cut_plane)
        
        if contours:
            # Create target point for the seam at the current height
            target_pt = rg.Point3d(center_x + r_max * dir_x, center_y + r_max * dir_y, current_z)

            for crv in contours:
                if crv.IsClosed:
                    # Find closest point on curve and move seam there
                    success, t_param = crv.ClosestPoint(target_pt)
                    if success:
                        crv.ChangeClosedCurveSeam(t_param)

                sliced_curves.append(crv)

    return sliced_curves

# Assignment to component output parameter
curves = slice_polysurface(brep, spacing, bottom_offset, rotation)
# ---------- end _3d_to_crvs_layers ----------

# ----
# 3D TO CRV
number_slider_18 = Slider(36, range=0..100)  # disabled

# ----
# SPIRAL
relay = Relay()  # disabled
spacing_2 = Slider(1.1, range=0.5..5)  # disabled
bottom_offset_2 = Slider(1, range=0.1..5)  # disabled
rotation_2 = Slider(162, range=0..360)  # disabled
bottom_angle = Slider(200, range=0..360)  # disabled
_3d_to_crvs_spiral = Python3Script(
    brep=relay,
    spacing=spacing_2,
    bottom_offset=bottom_offset_2,
    rotation=rotation_2,
    bottom_curve=bottom_angle,
    precision=number_slider_18)  # -> out, curves, curves_to_join; inputs brep: Brep, spacing: Double, bottom_offset: Double, rotation: Double, precision: Int32; disabled
# ---------- _3d_to_crvs_spiral: Python ----------
import Rhino.Geometry as rg
import math

def spiral_slice_polysurface(brep, spacing, bottom_offset, rotation, bottom_curve=0.0, precision=36):
    """
    Generates a continuously rising spiral slicing curve on a polysurface with an optional 
    horizontal bottom loop.
    """
    if not brep or spacing <= 0 or bottom_offset < 0 or precision <= 0:
        return []

    # 1. Bounding box & height limits
    bbox = brep.GetBoundingBox(True)
    z_min, z_max = bbox.Min.Z, bbox.Max.Z

    start_z = z_min + bottom_offset
    end_z = z_max - 0.1  # Ends 0.1 units below highest point

    if start_z >= end_z:
        return []

    center_x, center_y = bbox.Center.X, bbox.Center.Y

    # Radius of the cutting helicoid (+ 50% safety margin)
    dx = max(abs(bbox.Min.X - center_x), abs(bbox.Max.X - center_x))
    dy = max(abs(bbox.Min.Y - center_y), abs(bbox.Max.Y - center_y))
    r_max = math.hypot(dx, dy) * 1.5

    # 2. Calculate helicoid parameters
    total_height = end_z - start_z
    turns = total_height / float(spacing)
    total_samples = max(20, int(turns * precision))

    start_angle_rad = math.radians(rotation)
    two_pi = 2.0 * math.pi

    # 3. Construct cutting helicoid geometry
    crv_inner = rg.Line(rg.Point3d(center_x, center_y, start_z), rg.Point3d(center_x, center_y, end_z)).ToNurbsCurve()

    pts_outer = []
    for i in range(total_samples):
        t = i / float(total_samples - 1)
        curr_z = start_z + t * total_height
        angle = start_angle_rad - (t * turns * two_pi)

        xo = center_x + r_max * math.cos(angle)
        yo = center_y + r_max * math.sin(angle)
        pts_outer.append(rg.Point3d(xo, yo, curr_z))

    crv_outer = rg.NurbsCurve.CreateControlPointCurve(pts_outer, 3)
    if not crv_outer:
        return []

    # 4. Create cutting surface & calculate intersection
    helicoid_srf = rg.NurbsSurface.CreateRuledSurface(crv_inner, crv_outer)
    if not helicoid_srf:
        return []

    tol = 0.001
    rc, int_curves, _ = rg.Intersect.Intersection.BrepSurface(brep, helicoid_srf, tol)

    if not rc or not int_curves:
        return []

    # Join spiral segments & sort by height
    joined_spirals = rg.Curve.JoinCurves(int_curves, tol)
    if not joined_spirals:
        return []

    joined_spirals = sorted(joined_spirals, key=lambda c: min(c.PointAtStart.Z, c.PointAtEnd.Z))

    # Orient spiral segments from bottom to top
    spiral_start_pt = None
    for i, sc in enumerate(joined_spirals):
        if sc.PointAtStart.Z > sc.PointAtEnd.Z:
            sc.Reverse()
        if i == 0:
            spiral_start_pt = sc.PointAtStart

    curves_to_join = []

    # 5. Process optional base cut at start height
    if bottom_curve > 0 and spiral_start_pt:
        cut_plane = rg.Plane(rg.Point3d(center_x, center_y, start_z), rg.Vector3d.ZAxis)
        base_contours = rg.Brep.CreateContourCurves(brep, cut_plane)

        if base_contours:
            base_crv = min(
                base_contours,
                key=lambda c: c.PointAt(c.ClosestPoint(spiral_start_pt)[1]).DistanceTo(spiral_start_pt)
            )

            _, t_seam = base_crv.ClosestPoint(spiral_start_pt)
            base_crv.ChangeClosedCurveSeam(t_seam)

            if base_crv.ClosedCurveOrientation(rg.Plane.WorldXY) == rg.CurveOrientation.CounterClockwise:
                base_crv.Reverse()

            angle_clamped = max(0.0, min(360.0, float(bottom_curve)))
            if angle_clamped < 360.0:
                t_end = base_crv.Domain.Max
                t_start = t_end - ((angle_clamped / 360.0) * base_crv.Domain.Length)

                trimmed = base_crv.Trim(t_start, t_end)
                if trimmed:
                    base_crv = trimmed

            curves_to_join.append(base_crv)
            print(base_crv)

    curves_to_join.extend(joined_spirals)

    # 6. Final join step
    final_result = rg.Curve.JoinCurves(curves_to_join, tol)
    return curves_to_join, list(final_result) if final_result else curves_to_join

# Assignment to component output parameter
curves_to_join, curves = spiral_slice_polysurface(brep, spacing, bottom_offset, rotation, bottom_curve, precision)
# ---------- end _3d_to_crvs_spiral ----------

# ----
# NON-PLANAR
number_slider_19 = Slider(4.42, range=0..30)  # disabled
number_slider_20 = Slider(1, range=0..10)  # disabled
number_slider_21 = Slider(15, range=0..135)  # disabled
number_slider_22 = Slider(0, range=0..360)  # disabled
number_slider_23 = Slider(9.66, range=0..10)  # disabled
brep_to_non_planar_2 = Python3Script(
    brep=python_3_script_3.brep,
    central_axis=move_2.Geometry,
    frame_to_frame=number_slider_19,
    layer_height=number_slider_23,
    first_layer_height=number_slider_20,
    corner_angle=number_slider_21,
    seam_angle=number_slider_22)  # -> out, frames, pt_layer_height; inputs brep: Brep, central_axis: Curve, frame_to_frame: Double, layer_height: Double, first_layer_height: Double, corner_angle: Int32, seam_angle: Double; disabled; same code as brep_to_non_planar

# ----
# CRV_TO_POINTS
curve_5 = Curve(_3d_to_crvs_layers.curves)
point_spacing_mm = Slider(3, range=1..50)
# PRINTPATH
divide_distance = DivideDistance(Curve=curve_5, Distance=point_spacing_mm)  # -> Points, Tangents, Parameters

# ----
# POINTS_TO_FRAMES
frame_rotation = Slider(0, range=0..360)
point_6 = Point()
generate_frames = Python3Script(points=divide_distance.Points, rotation=frame_rotation)  # -> out, frames; inputs points: tree
# ---------- generate_frames: Python ----------
"""
Constructs Rhino Planes at input points using fixed orientation vectors
rotated by the specified angle around the Z-axis.

"""
import math
import Rhino.Geometry as rg
from Grasshopper import DataTree
from Grasshopper.Kernel.Data import GH_Path

base_x = rg.Vector3d(-1.0, 0.0, 0.0)
base_y = rg.Vector3d(0.0, 1.0, 0.0)

rot_rad = math.radians(rotation)

x_axis = rg.Vector3d(base_x)
y_axis = rg.Vector3d(base_y)
x_axis.Rotate(rot_rad, rg.Vector3d.ZAxis)
y_axis.Rotate(rot_rad, rg.Vector3d.ZAxis)

frames = DataTree[object]()

for layer_idx, branch in enumerate(points.Branches):
    layer_frames = [rg.Plane(rg.Point3d(p.X, p.Y, p.Z), x_axis, y_axis) for p in branch]
    path = points.Paths[layer_idx]
    frames.AddRange(layer_frames, path)
# ---------- end generate_frames ----------

# ----
# VIS LAYER_HEIGHT
panel_2 = Panel("0.6")
check_layer_height = Check(
    frames=brep_to_non_planar.frames,
    min_layer_height=panel_2,
    max_layer_height="1.15",
    pt_layer_height=brep_to_non_planar.pt_layer_height)  # -> beads, values, low, high, param_range, report; inputs frames: tree of Plane, min_layer_height: Double, max_layer_height: Double, pt_layer_height: tree of Double
# ---------- check_layer_height: Python ----------
import Rhino.Geometry as rg
from Grasshopper import DataTree
from Grasshopper.Kernel.Data import GH_Path

def unwrap(item):
    return item.Value if hasattr(item, "Value") else item

def get_branches(data):
    if data is None:
        return []
    if hasattr(data, "BranchCount"):
        return [
            (data.Paths[i], [unwrap(x) for x in data.Branches[i]])
            for i in range(data.BranchCount)
        ]
    if isinstance(data, (list, tuple)):
        if data and isinstance(data[0], (list, tuple)):
            return [
                (GH_Path(i), [unwrap(x) for x in branch])
                for i, branch in enumerate(data)
            ]
        return [(GH_Path(0), [unwrap(x) for x in data])]
    return []

beads = DataTree[rg.Mesh]()
values = DataTree[float]()
all_vals = []
total_frames = 0
total_length = 0.0
layer_count = 0

frame_branches = get_branches(frames)
height_map = dict(get_branches(pt_layer_height))

for path, layer_frames in frame_branches:
    if path not in height_map:
        continue

    layer_heights = [float(h) for h in height_map[path]]
    n = min(len(layer_frames), len(layer_heights))
    if n == 0:
        continue

    total_frames += n
    layer_count += 1
    out_path = GH_Path(path)

    layer_beads = []
    layer_vals = []

    for j in range(1, n):
        fa = layer_frames[j - 1]
        fb = layer_frames[j]
        a = fa.Origin
        b = fb.Origin

        total_length += a.DistanceTo(b)

        ha = max(layer_heights[j - 1], 0.1)
        hb = max(layer_heights[j], 0.1)

        a_bot = a + fa.ZAxis * ha
        b_bot = b + fb.ZAxis * hb

        bead = rg.Mesh()
        bead.Vertices.Add(a)
        bead.Vertices.Add(b)
        bead.Vertices.Add(b_bot)
        bead.Vertices.Add(a_bot)
        bead.Faces.AddFace(0, 1, 2, 3)
        bead.Normals.ComputeNormals()

        val = layer_heights[j]
        layer_beads.append(bead)
        layer_vals.append(val)
        all_vals.append(val)

    if layer_beads:
        beads.AddRange(layer_beads, out_path)
        values.AddRange(layer_vals, out_path)

measured_min = min(all_vals) if all_vals else 0.0
measured_max = max(all_vals) if all_vals else 1.0

user_min = globals().get("min_layer_height", None)
user_max = globals().get("max_layer_height", None)

low = float(user_min) if user_min is not None else measured_min
high = float(user_max) if user_max is not None else measured_max

if high <= low:
    high = low + 0.01

below_min = sum(1 for v in all_vals if v < low) if user_min is not None else 0
above_max = sum(1 for v in all_vals if v > high) if user_max is not None else 0

param_range = rg.Interval(low, high)
report_lines = [
    f"colour scale: {low:.2f} to {high:.2f} mm",
    f"measured range: {measured_min:.2f} to {measured_max:.2f} mm",
    f"{total_frames} frames, {layer_count} layers, length {total_length:.1f} mm",
]
if user_min is not None or user_max is not None:
    report_lines.append(f"out of limits: {below_min} below min, {above_max} above max")

report = "\n".join(report_lines)

if below_min > 0 or above_max > 0:
    ghenv.Component.Message = f"WARN: {below_min} < min, {above_max} > max"
else:
    ghenv.Component.Message = f"OK ({measured_min:.2f} - {measured_max:.2f} mm)"
# ---------- end check_layer_height ----------
panel_3 = Panel(check_layer_height.report)
gradient = Gradient(
    LowerLimit=check_layer_height.low,
    UpperLimit=check_layer_height.high,
    Parameter=check_layer_height.values,
    stops=[0: RGB(192, 0, 0), 0.0479: RGB(192, 192, 0), 0.499: RGB(0, 192, 0), 0.95: RGB(192, 192, 0), 1: RGB(192, 0, 0)])
preview = CustomPreview(Geometry=check_layer_height.beads, Material=gradient)

# ----
# FRAMES_TO_PRINTPATH
blend_radius_mm = Slider(1, range=0..5)
safety_distance_mm = Slider(100, range=10..300)
tail_rotation = Slider(180, range=0..360)
tail_length = Slider(39, range=0..100)
plane = Plane(brep_to_non_planar.frames)
plane_2 = Plane(plane)

# ----
# ROBOTSPEED
speed_1_pts = Slider(1, range=0..10)
speed_2_pts = Slider(1, range=0..10)
speed_layer_offset = Slider(0, range=0..10)
speed_1_mm_s = Slider(20, range=1..35)
speed_2_mm_s = Slider(20, range=1..40)
generate_speed = Python3Script(
    frames=plane_2,
    speed_1=speed_1_mm_s,
    speed_2=speed_2_mm_s,
    speed_1_pts=speed_1_pts,
    speed_2_pts=speed_2_pts,
    speed_layer_offset=speed_layer_offset,
    pt_layer_height=brep_to_non_planar.pt_layer_height,
    speed_from_height_scaler=Slider(1, range=1..1.5))  # -> out, speed; inputs frames: tree, speed_1: Double, speed_2: Double, speed_1_pts: Int32, speed_2_pts: Int32, speed_layer_offset: Int32, pt_layer_height: tree of Double, speed_from_height_scaler: Double
# ---------- generate_speed: Python ----------
"""
Generates speed profiles alternating between speed_1 and speed_2,
symmetrically modulated by pt_layer_height.
"""
import clr
import Grasshopper
from Grasshopper import DataTree
from Grasshopper.Kernel.Data import GH_Path

# Global min/max layer height across all non-empty branches
non_empty = [b for b in pt_layer_height.Branches if len(b) > 0]
min_h = min(min(b) for b in non_empty) if non_empty else 0.0
max_h = max(max(b) for b in non_empty) if non_empty else 0.0
h_span = max_h - min_h

# Symmetrical deviation around 1.0 (0.0 if scaler == 1.0 or all layers have equal height)
delta = (speed_from_height_scaler - 1.0) if h_span > 1e-9 else 0.0
inv_span = 2.0 / h_span if h_span > 1e-9 else 0.0

pattern_len = speed_1_pts + speed_2_pts
speed = DataTree[object]()

for layer_idx, branch in enumerate(frames.Branches):
    num_pts = len(branch)
    if num_pts == 0:
        continue

    h_branch = pt_layer_height.Branches[layer_idx]
    pattern_offset = (layer_idx * speed_layer_offset) % pattern_len
    layer_speeds = []

    for pt_idx in range(num_pts):
        step = (pt_idx + pattern_offset) % pattern_len
        current_speed = speed_1 if step < speed_1_pts else speed_2

        # t = +1.0 at min_h, 0.0 at midpoint, -1.0 at max_h
        t = 1.0 - (h_branch[pt_idx] - min_h) * inv_span
        layer_speeds.append(current_speed * (1.0 + delta * t))

    path = frames.Paths[layer_idx] if layer_idx < len(frames.Paths) else GH_Path(0, layer_idx)
    speed.AddRange(layer_speeds, path)
# ---------- end generate_speed ----------

frames_to_print = Printpath(
    frames=plane_2,
    speed=generate_speed.speed,
    blend_radius=blend_radius_mm,
    safety_distance=safety_distance_mm,
    tail_rotation=tail_rotation,
    tail_length=tail_length)  # -> printpath, summary, frame; inputs frames: tree, speed: tree, blend_radius: Double, safety_distance: Double, tail_rotation: Double, tail_length: Double
# ---------- frames_to_print: Python ----------
"""
Turns frames into printpoints and a PrintPath in work object coordinates.
Includes approach tail at layer 0 and optional safety points.

"""
import math
import os
import sys
from compas.geometry import Frame, Point, Vector

gh_dir = os.path.dirname(ghenv.Component.OnPingDocument().FilePath)
src_dir = os.path.abspath(os.path.join(gh_dir,"..", "src"))
if src_dir not in sys.path:
    sys.path.append(src_dir)

from print_class import PrintPath, PrintPoint


def to_compas_frame(f):
    """Converts Rhino Plane directly to COMPAS Frame."""
    o, x, y = f.Origin, f.XAxis, f.YAxis
    return Frame(
        Point(o.X, o.Y, o.Z),
        Vector(x.X, x.Y, x.Z),
        Vector(y.X, y.Y, y.Z)
    )


valid_layers = [list(b) for b in frames.Branches if len(b) > 0]
num_layers = len(valid_layers)

parsed_speeds = [list(b) for b in speed.Branches]


def get_speed(l_idx, f_idx):
    if l_idx < len(parsed_speeds):
        branch = parsed_speeds[l_idx]
        return branch[f_idx] if f_idx < len(branch) else branch[-1]
    return 0.0


printpoints = []

# Generate approach tail at layer 0
if valid_layers and tail_length > 0 and valid_layers[0]:
    f0 = to_compas_frame(valid_layers[0][0])
    x0, y0, z0 = f0.point.x, f0.point.y, f0.point.z
    rad = math.radians(tail_rotation)
    st_x, st_y = x0 - tail_length * math.cos(rad), y0 - tail_length * math.sin(rad)
    num_tail = max(2, int(round(tail_length / 5.0)))
    fx, fy = f0.xaxis, f0.yaxis
    t_speed = get_speed(0, 0)

    printpoints.extend(
        PrintPoint(
            Frame(
                Point(
                    st_x + (i / float(num_tail)) * (x0 - st_x),
                    st_y + (i / float(num_tail)) * (y0 - st_y),
                    z0
                ),
                fx, fy
            ),
            0, t_speed, blend_radius, True
        )
        for i in range(num_tail)
    )

# Process layer printpoints
for layer_idx, layer_frames in enumerate(valid_layers):
    printpoints.extend(
        PrintPoint(to_compas_frame(f), layer_idx, get_speed(layer_idx, f_idx), blend_radius, True)
        for f_idx, f in enumerate(layer_frames)
    )

# Build PrintPath and add safety points
printpath = PrintPath(printpoints)
if safety_distance > 0:
    sp_in = get_speed(0, 0)
    sp_out = get_speed(num_layers - 1, -1)
    res_b = printpath.add_safety_before(safety_distance, sp_in)
    if res_b is not None: printpath = res_b
    res_a = printpath.add_safety_after(safety_distance, sp_out)
    if res_a is not None: printpath = res_a

final_pts = printpath.printpoints if hasattr(printpath, "printpoints") and printpath.printpoints else printpoints
frame = [pt.frame for pt in final_pts]
summary = f"PrintPath with {len(final_pts)} printpoints across {num_layers} layers"
# ---------- end frames_to_print ----------
panel_4 = Panel(frames_to_print.summary)

# ----
# EXPORT
panel_5 = Panel("data/out_printpoints.json")
save = Button()
save_2 = Save(printpath=frames_to_print.printpath, save=save, out_path=panel_5)  # -> status
# ---------- save_2: Python ----------
# r: compas
# venv: mas-2627
"""
On button press, write the printpath to data/out_printpoints.json next to this .ghx file.
send_to_robot.py reads that file.
"""
import json
import os

import scriptcontext as sc

gh_dir = os.path.dirname(ghenv.Component.OnPingDocument().FilePath)

# keep the last status in sticky, so the message survives the button being released
status_key = "save_status_" + str(ghenv.Component.InstanceGuid)

if save:
    if printpath is None:
        sc.sticky[status_key] = "nothing to save: no printpath"
    else:
        path = os.path.normpath(os.path.join(gh_dir, out_path))
        os.makedirs(os.path.dirname(path), exist_ok=True)
        with open(path, "w") as f:
            json.dump(printpath.to_dict(), f, indent=2)
        sc.sticky[status_key] = f"saved {len(printpath)} printpoints to {path}"

status = sc.sticky.get(status_key, "")
ghenv.Component.Message = "saved" if status.startswith("saved") else status
# ---------- end save_2 ----------

# ----
# VIS_PATH
preview_2 = Preview(printpath=frames_to_print.printpath)  # -> path, travel, planes
# ---------- preview_2: Python ----------
# r: compas
# venv: mas-2627
"""
Draw the printpath: path = the whole polyline, travel = extruder-off segments,
safety = extruder-off points, axes = small x and y axis of each frame.
"""
import Rhino.Geometry as rg
from compas_rhino.conversions import frame_to_rhino_plane, point_to_rhino

AXIS_LENGTH = 5.0  # mm

points = printpath.printpoints
planes = [frame_to_rhino_plane(printpoint.frame) for printpoint in points]

# ===== Whole path =====
polyline = rg.Polyline()
for plane in planes:
    polyline.Add(plane.Origin.X, plane.Origin.Y, plane.Origin.Z)
path = polyline.ToPolylineCurve()

# ===== Extruder off: a segment prints only if both of its points have the extruder on =====
safety = [point_to_rhino(printpoint.frame.point) for printpoint in points if not printpoint.is_extruder_on]
travel = []
for i in range(len(points) - 1):
    if not (points[i].is_extruder_on and points[i + 1].is_extruder_on):
        travel.append(rg.Line(planes[i].Origin, planes[i + 1].Origin))
# ---------- end preview_2 ----------
preview_3 = CustomPreview(Geometry=preview_2.path, Material=ColourSwatch(SwatchColor=RGB(0, 170, 80)))
preview_4 = CustomPreview(Geometry=preview_2.travel, Material=ColourSwatch(SwatchColor=RGB(230, 40, 40)))
plane_3 = Plane(preview_2.planes)

# ----
# VIS_PT_TO_PT
compas_draw = COMPASDraw(cg=frames_to_print.frame)  # -> rg
#   port cg: The COMPAS geometry or datastructure to be drawn.
#   port rg: The Rhino geometry object.
# ---------- compas_draw: Python ----------
# r: compas>=2.14.1
"""
Draws COMPAS geometry in Grasshopper.
"""

from typing import Any

import Grasshopper

from compas.scene import SceneObject


class CompasToRhinoGeometry(Grasshopper.Kernel.GH_ScriptInstance):
    def RunScript(self, cg):
        if not cg:
            return None

        return SceneObject(item=cg).draw()
# ---------- end compas_draw ----------
list_item = ListItem(List=compas_draw, Index=0, Wrap=True)  # -> flatten(Item)
list_item_2 = ListItem(List=list_item, Index=Slider(100, range=0..100), Wrap=True)
preview_5 = CustomPreview(Geometry=list_item_2, Material=ColourSwatch(SwatchColor=RGB(171, 0, 0)))

# ----
# VIS_SPEED AND OVERHANG
mode = ValueList({"speed": 0, "overhang": 1}, selected="speed")
check = Check(printpath=frames_to_print.printpath, mode=mode)  # -> beads, values, low, high, param_range, report; inputs mode: Int32
# ---------- check: Python ----------
# r: compas
# venv: mas-2627
"""
Analyzes non-planar printpath, calculates 3D layer heights and overhangs,
estimates total print/travel time, and generates local frame-aligned mesh ribbons.
"""
import math
import Rhino.Geometry as rg

MODES = ["speed", "overhang"]
mode_idx = int(mode)

points = printpath.printpoints
n = len(points)

# Pre-convert COMPAS points and downward tool Z-axes to RhinoCommon structs
pts_3d = [rg.Point3d(pp.frame.point.x, pp.frame.point.y, pp.frame.point.z) for pp in points]
z_axes = []
for pp in points:
    za = rg.Vector3d(pp.frame.zaxis.x, pp.frame.zaxis.y, pp.frame.zaxis.z)
    if not za.Unitize():
        za = rg.Vector3d(0.0, 0.0, -1.0)
    z_axes.append(za)

# 1. Group printed 3D points per layer and build closed polyline proxies
layers = {}
for idx, pp in enumerate(points):
    if pp.is_extruder_on:
        layers.setdefault(pp.layer_index, []).append(pts_3d[idx])

layer_polylines = {}
for layer_idx, l_pts in layers.items():
    if len(l_pts) == 1:
        pl = rg.Polyline([l_pts[0], l_pts[0]])
    else:
        pl = rg.Polyline(l_pts)
        # Close seam gap if contour is a closed loop
        if len(l_pts) >= 3:
            gap = l_pts[0].DistanceTo(l_pts[-1])
            if 1e-6 < gap < pl.Length * 0.25:
                pl.Add(l_pts[0])
    layer_polylines[layer_idx] = pl

# 2. Calculate 3D layer heights and local overhangs
heights = []
overhangs = []

for idx, pp in enumerate(points):
    if not pp.is_extruder_on:
        heights.append(0.0)
        overhangs.append(0.0)
        continue

    pt = pts_3d[idx]
    up_vec = -z_axes[idx]  # Local build direction (opposite to downward frame Z)
    poly_below = layer_polylines.get(pp.layer_index - 1)

    if poly_below is not None:
        closest_pt = poly_below.ClosestPoint(pt)
        diff = pt - closest_pt
        dist_3d = diff.Length
        h = diff * up_vec
        lat_dist = (diff - h * up_vec).Length

        if h > 1e-6:
            angle = math.degrees(math.atan2(lat_dist, h))
        else:
            angle = 90.0 if dist_3d > 1e-6 else 0.0

        heights.append(max(h, 0.0))
        overhangs.append(angle)
    else:
        # Bottom layer: measure thickness against layer above if available
        poly_above = layer_polylines.get(pp.layer_index + 1)
        if poly_above is not None:
            closest_above = poly_above.ClosestPoint(pt)
            h = (closest_above - pt) * up_vec
            heights.append(max(h, 0.1))
        else:
            heights.append(1.0)
        overhangs.append(0.0)

# 3. Calculate print time and travel time
print_time = 0.0
travel_time = 0.0

for i in range(1, n):
    spd = points[i].speed if points[i].speed > 0 else 10.0
    dist = pts_3d[i - 1].DistanceTo(pts_3d[i])
    dt = dist / spd

    if points[i - 1].is_extruder_on and points[i].is_extruder_on:
        print_time += dt
    else:
        travel_time += dt

# 4. Generate visual mesh ribbons aligned with frame orientations within each layer
beads = []
values = []

for i in range(1, n):
    printing = points[i - 1].is_extruder_on and points[i].is_extruder_on
    same_layer = points[i - 1].layer_index == points[i].layer_index

    if printing and same_layer:
        a = pts_3d[i - 1]
        b = pts_3d[i]

        ha = max(heights[i - 1], 0.1)
        hb = max(heights[i], 0.1)

        a_bot = a + z_axes[i - 1] * ha
        b_bot = b + z_axes[i] * hb

        bead = rg.Mesh()
        bead.Vertices.Add(a)
        bead.Vertices.Add(b)
        bead.Vertices.Add(b_bot)
        bead.Vertices.Add(a_bot)
        bead.Faces.AddFace(0, 1, 2, 3)
        bead.Normals.ComputeNormals()

        beads.append(bead)

        val = points[i].speed if mode_idx == 0 else overhangs[i]
        values.append(val)

# 5. Legend range and report
if values:
    low, high = (min(values), max(values)) if mode_idx == 0 else (0.0, 45.0)
else:
    low, high = 0.0, 1.0

if high <= low:
    high = low + 1.0

param_range = rg.Interval(low, high)
report = "\n".join([
    f"colour: {MODES[mode_idx]}, {low:.2f} to {high:.2f}",
    f"{n} printpoints, {len(layers)} layers",
    f"time: about {(print_time + travel_time) / 60:.1f} min (print {print_time / 60:.1f}, travel {travel_time / 60:.1f})",
])

ghenv.Component.Message = f"{MODES[mode_idx]} mode, print time {(print_time + travel_time) / 60:.0f} min"
# ---------- end check ----------
gradient_2 = Gradient(
    LowerLimit=check.low,
    UpperLimit=check.high,
    Parameter=check.values,
    stops=[0: RGB(45, 75, 170), 0.35: RGB(40, 175, 165), 0.7: RGB(245, 205, 50), 1: RGB(215, 45, 40)])
panel_6 = Panel(check.report)
panel_7 = Panel(check.param_range)
preview_6 = CustomPreview(Geometry=check.beads, Material=gradient_2)
