# Grasshopper definition sin code_df.ghx (Grasshopper 1.0.8)

length = Panel("1400")
overlap = Slider(0, range=0..350)
modules = Slider(4, range=2..12)
height = Slider(60, range=1..350)
thickness = Slider(8, range=1..350)
belly = Slider(60, range=0..350)
depth = Slider(100, range=0..200)
number_slider = Slider(1000, range=0..1000)
division = Division(A=modules, B=2)
expression = Expression(height=height, thickness=thickness, Expression="height/2 - thickness / 2")
division_2 = Division(A=length, B=2)
multiplication = Multiplication(A=modules, B=2)

# ---- group: pts
data = Data(division)

# ----
negative = Negative(Value=division_2)
construct_domain = ConstructDomain(DomainStart=Slider(0, range=0..1400), DomainEnd=length)
construct_domain_2 = ConstructDomain(DomainStart=negative, DomainEnd=division_2)
multiplication_2 = Multiplication(A=data, B=12)
range = Range(Domain=construct_domain, Steps=multiplication_2)
range_2 = Range(Domain=construct_domain_2, Steps=multiplication_2)
expression_2 = Expression(
    x=range,
    height=expression,
    domain=length,
    thickness=thickness,
    modules=multiplication,
    overlap=overlap,
    Expression="height * -Cos(modules * pi * x / domain) + height + thickness + overlap")
expression_3 = Expression(
    x=range_2,
    height=expression,
    domain=length,
    thickness=thickness,
    modules=multiplication,
    overlap=overlap,
    Expression="height * Cos(modules * pi * x / domain) - height - thickness - overlap")
division_3 = Division(A=length, B=2)
addition = Addition(A=range_2, B=division_3)
addition_2 = Addition(A=expression_3, B=number_slider)
addition_3 = Addition(A=expression_2, B=number_slider)
construct_point = ConstructPoint(XCoordinate=range, YCoordinate=0, ZCoordinate=addition_3)
construct_point_2 = ConstructPoint(XCoordinate=addition, YCoordinate=0, ZCoordinate=addition_2)
interpolate = Interpolate(Vertices=construct_point, Degree=3, Periodic=False, KnotStyle=1)  # -> Curve, Length, Domain
interpolate_2 = Interpolate(Vertices=construct_point_2, Degree=3, Periodic=False, KnotStyle=1)  # -> Curve, Length, Domain
unit_z = UnitZ(Factor=thickness)
move = Move(Geometry=interpolate.Curve, Motion=expr("-x", unit_z))  # -> Geometry, Transform
move_2 = Move(Geometry=interpolate_2.Curve, Motion=unit_z)  # -> Geometry, Transform
unit_y = UnitY(Factor=depth)
curve = Curve(move.Geometry)
curve_2 = Curve(interpolate_2.Curve)
curve_3 = Curve(interpolate.Curve)
curve_4 = Curve(move_2.Geometry)
move_3 = Move(Geometry=construct_point, Motion=unit_y)  # -> Geometry, Transform
move_4 = Move(Geometry=curve_3, Motion=unit_y)  # -> Geometry, Transform
expression_4 = Expression(modules=modules, Expression="modules*2 + 1")
interpolate_3 = Interpolate(Vertices=move_3.Geometry, Degree=3, Periodic=False, KnotStyle=1)  # -> Curve, Length, Domain
series = Series(Start=0, Step="3", Count=expression_4)
list_item = ListItem(List=move_3.Geometry, Index=series, Wrap=True)
list_item_2 = ListItem(List=construct_point, Index=series, Wrap=True)
unit_z_2 = UnitZ(Factor=thickness)
unit_z_3 = UnitZ(Factor=thickness)
line = Line(StartPoint=list_item_2, EndPoint=list_item)
move_5 = Move(Geometry=list_item, Motion=expr("-x", unit_z_2))  # -> Geometry, Transform
move_6 = Move(Geometry=list_item_2, Motion=expr("-x", unit_z_3))  # -> Geometry, Transform
evaluate_curve = EvaluateCurve(Curve=reparameterize(line), Parameter=Slider(1, range=0..1))  # -> Point, Tangent, Angle
list_length = ListLength(List=evaluate_curve.Point)
series_2 = Series(Start=0, Step=1, Count=list_length)
expression_5 = Expression(h=belly, i=series_2, Expression="h * (-1)^i")
expression_6 = Expression(thickness=thickness, i=series_2, Expression="thickness * (-1)^i")
unit_z_4 = UnitZ(Factor=expression_5)
move_7 = Move(Geometry=evaluate_curve.Point, Motion=unit_z_4)  # -> Geometry, Transform
unit_z_5 = UnitZ(Factor=expression_6)
unit_z_6 = UnitZ(Factor=expression_6)

data_2 = Data(list_item_2)
data_3 = Data(move_7.Geometry)
data_4 = Data(list_item)

move_8 = Move(Geometry=data_2, Motion=expr("-x", unit_z_5))  # -> Geometry, Transform
move_9 = Move(Geometry=data_4, Motion=expr("-x", unit_z_6))  # -> Geometry, Transform

data_5 = Data(move_8.Geometry)
data_6 = Data(move_9.Geometry)

division_4 = Division(A=thickness, B=2)
division_5 = Division(A=thickness, B=2)
unit_z_7 = UnitZ(Factor=division_4)
unit_z_8 = UnitZ(Factor=division_5)
entwine = Entwine(Branch00=data_2, Branch01=data_3, Branch02=data_4, FlattenInputs=True)
entwine_2 = Entwine(Branch00=data_2, Branch01=data_5, Branch02=data_6, Branch03=data_4, FlattenInputs=True)
number_slider_2 = Slider(10.45, range=0..20)
line_2 = Line(StartPoint=data_5, EndPoint=data_6)
flip_matrix = FlipMatrix(Data=entwine)
move_10 = Move(Geometry=data_2, Motion=expr("-x", unit_z_7))  # -> Geometry, Transform
move_11 = Move(Geometry=data_4, Motion=expr("-x", unit_z_8))  # -> Geometry, Transform
flip_matrix_2 = FlipMatrix(Data=entwine_2)
unit_y_2 = UnitY(Factor=number_slider_2)
polyline = PolyLine(Vertices=flip_matrix_2, Closed=False)
unit_y_3 = UnitY(Factor=number_slider_2)
evaluate_curve_2 = EvaluateCurve(Curve=line_2, Parameter=0.5)  # -> Point, Tangent, Angle
nurbs_curve = NurbsCurve(Vertices=flip_matrix, Degree=Slider(2, range=0..5), Periodic=False)  # -> Curve, Length, Domain
unit_z_9 = UnitZ(Factor=thickness)
move_12 = Move(Geometry=move_11.Geometry, Motion=expr("-x", unit_y_3))  # -> Geometry, Transform
move_13 = Move(Geometry=move_10.Geometry, Motion=unit_y_2)  # -> Geometry, Transform
dispatch = Dispatch(List=flatten(nurbs_curve.Curve), DispatchPattern=[True, False])  # -> ListA, ListB
dispatch_2 = Dispatch(List=flatten(polyline), DispatchPattern=[True, False])  # -> ListA, ListB
data_7 = Data(evaluate_curve_2.Point)
entwine_3 = Entwine(Branch00=move_13.Geometry, Branch01=data_7, Branch02=move_12.Geometry, FlattenInputs=True)
move_14 = Move(Motion=Vector(0, 0, 10))  # -> Geometry, Transform
flip_matrix_3 = FlipMatrix(Data=entwine_3)
data_8 = Data(dispatch.ListB)
data_9 = Data(dispatch_2.ListB)
join_curves = JoinCurves(Curves=[data_8, data_9], Preserve=False)
join_curves_2 = JoinCurves(Curves=[dispatch.ListA, dispatch_2.ListA], Preserve=False)
interpolate_4 = Interpolate(Vertices=flip_matrix_3, Degree=Slider(3, range=0..5), Periodic=False, KnotStyle=1)  # -> Curve, Length, Domain
data_10 = Data(interpolate_4.Curve)
data_11 = Data(nurbs_curve.Curve)
move_15 = Move(Geometry=join_curves, Motion=expr("-x", unit_z_9))  # -> Geometry, Transform
number_slider_3 = Slider(0, range=0..100)
number_slider_4 = Slider(1, range=0..100)
data_12 = Data(move_15.Geometry)
data_13 = Data(join_curves_2)
evaluate_curve_3 = EvaluateCurve(Curve=reparameterize(data_11), Parameter=number_slider_4)  # -> Point, Tangent, Angle
evaluate_curve_4 = EvaluateCurve(Curve=reparameterize(data_10), Parameter=number_slider_4)  # -> Point, Tangent, Angle
evaluate_curve_5 = EvaluateCurve(Curve=reparameterize(data_11), Parameter=number_slider_3)  # -> Point, Tangent, Angle
evaluate_curve_6 = EvaluateCurve(Curve=reparameterize(data_10), Parameter=number_slider_3)  # -> Point, Tangent, Angle
weave = Weave(Pattern=[0, 1], Stream0=data_13, Stream1=data_12, NullGaps=False)
reverse = Reverse(Vector=evaluate_curve_5.Tangent)
reverse_2 = Reverse(Vector=evaluate_curve_6.Tangent)
sweep2 = Sweep2(Rail1=interpolate.Curve, Rail2=interpolate_3.Curve, Sections=weave, SameHeight=False)
list_item_3 = ListItem(List=data_6, Index=0, Wrap=True)
bezier_span = BezierSpan(StartPoint=evaluate_curve_5.Point, StartTangent=reverse, EndPoint=evaluate_curve_6.Point, EndTangent=reverse_2)  # -> Curve, Length, Domain
bezier_span_2 = BezierSpan(
    StartPoint=evaluate_curve_3.Point,
    StartTangent=evaluate_curve_3.Tangent,
    EndPoint=evaluate_curve_4.Point,
    EndTangent=evaluate_curve_4.Tangent)  # -> Curve, Length, Domain
xy_plane = XYPlane(Origin=list_item_3)
mirror = Mirror(Geometry=sweep2, Plane=xy_plane)  # -> Geometry, Transform

data_14 = Data(bezier_span.Curve)
data_15 = Data(interpolate_4.Curve)
data_16 = Data(bezier_span_2.Curve)

entwine_4 = Entwine(Branch00=data_14, Branch01=data_15, Branch02=data_16, FlattenInputs=True)

data_17 = Data(sweep2)
data_18 = Data(mirror.Geometry)

join_curves_3 = JoinCurves(Curves=entwine_4, Preserve=False)
data_19 = Data(data_11)
data_20 = Data(join_curves_3)
entwine_5 = Entwine(Branch00=data_20, Branch01=data_19, FlattenInputs=True)
join_curves_4 = JoinCurves(Curves=entwine_5, Preserve=False)
