# Grasshopper definition texture_dropping.ghx (Grasshopper 1.0.8)
# plug-ins: Bifocals

# ---- group: This is needed only ONCE in the GH definition
enable_auto_reload = Python3Script()  # -> ok
# ---------- enable_auto_reload: Python ----------
"""
------------------------------
Using VS Code as Python editor
------------------------------

The simplest way to start using VS Code as our editor, is
to place our Python code in files located IN THE SAME FOLDER as our Grasshopper file.

After we have done that, we need 2 steps: 

1. Enable the COMPAS reloader on one component. This tells Grasshopper to watch for changes in the Pythoh files and reload if changed.
2. Every other component that uses Python code from external files needs to start with a method to ensure Grasshopper knows where to load the files from.

"""
# r: compas
# venv: mas-2627

from compas_rhino.devtools import DevTools
DevTools.enable_reloader()
# ---------- end enable_auto_reload ----------

# ----
# Adjustment of points (with tangent)
number_slider = Slider(30, range=0..100)
curve = Curve(<curve referenced from the Rhino model>)
python_3_script = Python3Script(crv=curve, pt_number=number_slider, k=Slider(1, range=0..10), a=Slider(10, range=0..10), layers=Slider(50, range=0..100))  # -> out, new_pts, new_crv, crvs; inputs crv: Curve, pt_number: Int32, layers: Int32
# ---------- python_3_script: Python ----------
import math as m
from compas.geometry import Curve, Point, Vector, NurbsCurve
from compas_rhino.conversions import curve_to_compas

compas_crv = curve_to_compas(crv)
params, pts = compas_crv.divide_by_count(pt_number, True)

new_pts = []
# get x vectors from cross conduct 
v_xs = [compas_crv.tangent_at(param).cross(Vector(0,0,1)) for param in params]

# move points in first lavel
for i, vx in enumerate(v_xs):
    pt = pts[i] +  a * m.sin(k*i) * vx* (-1) **(i) 
    new_pts.append(pt)
    print(pt)

new_pts.append(new_pts[0])

# Generate layers
crvs = []
for i in range(layers):
    nextl_pts = [pt.copy() + i * Vector(0,0,2.5) for pt in new_pts]
    new_crv = NurbsCurve.from_points(nextl_pts, )
    crvs.append(new_crv)
# ---------- end python_3_script ----------
compas_draw = COMPASDraw(cg=python_3_script.new_pts)  # -> rg
#   port cg: The COMPAS geometry or datastructure to be drawn.
#   port rg: The Rhino geometry object.
# ---------- compas_draw: Python ----------
# r: compas>=2.14.1
"""
Draws COMPAS geometry in Grasshopper.
"""

from typing import Any

import Grasshopper

from compas.scene import SceneObject


class CompasToRhinoGeometry(Grasshopper.Kernel.GH_ScriptInstance):
    def RunScript(self, cg):
        if not cg:
            return None

        return SceneObject(item=cg).draw()
# ---------- end compas_draw ----------
compas_draw_2 = COMPASDraw(cg=python_3_script.crvs)  # -> rg; same code as compas_draw
point = Point(compas_draw)
curve_2 = Curve(compas_draw_2)

point_2 = Point(Point(295.6040072, 196.966694, 0))

# ----
# Measure work object
point_3 = ValueList({"origin", "xaxis", "xypoint"}, selected="xypoint")
capture = Button()
capture_wobj = CaptureWobj(robot_ip="192.168.10.10", point_name=point_3, capture=capture)  # -> wobj_origin, wobj_xaxis, wobj_xypoint, info
# ---------- capture_wobj: Python ----------
"""
Capture the 3 points that define the work object (robot base) plane.

Jog the TCP to a point, pick its name (origin / xaxis / xypoint) and press capture.
The TCP position (robot base frame, mm) is saved to wobj_calibration.json next to
this .ghx file, so the points survive closing Grasshopper.
"""
import os
import sys
import json
import time

import scriptcontext as sc
import Rhino.Geometry as rg

NAMES = ["origin", "xaxis", "xypoint"]

gh_dir = os.path.dirname(ghenv.Component.OnPingDocument().FilePath)
src_dir = os.path.join(gh_dir, "src")
if src_dir not in sys.path:
    sys.path.append(src_dir)
import simple_comm as com

path = os.path.join(gh_dir, "wobj_calibration.json")

data = {}
if os.path.exists(path):
    with open(path) as f:
        data = json.load(f)

# keep the last status in sticky, so the message survives the button being released
status_key = "capture_status_" + str(ghenv.Component.InstanceGuid)

if capture:
    if point_name not in NAMES:
        sc.sticky[status_key] = "pick origin / xaxis / xypoint"
    else:
        try:
            x, y, z = list(com.listen_to_robot(robot_ip)["pose"])[:3]  # metres, robot base frame
            data[point_name] = [round(x * 1000, 2), round(y * 1000, 2), round(z * 1000, 2)]  # -> mm
            with open(path, "w") as f:
                json.dump(data, f, indent=2)
            sc.sticky[status_key] = "{} captured {}".format(point_name, time.strftime("%H:%M:%S"))
        except Exception as e:
            print(e)
            sc.sticky[status_key] = "robot not reachable"

ghenv.Component.Message = sc.sticky.get(status_key, "")

def pt(name):
    return rg.Point3d(*data[name]) if name in data else None

wobj_origin, wobj_xaxis, wobj_xypoint = pt("origin"), pt("xaxis"), pt("xypoint")
info = json.dumps(data, indent=2)
# ---------- end capture_wobj ----------
wobj_calibration = Panel(capture_wobj.info)

# ----
# Geometry
brep = Brep(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)

cylinder = Cylinder(Base=point_2, Radius=Slider(50, range=0..100), Length=Slider(20, range=0..100))

point_spacing_mm = Slider(29.28, range=1..50)
layer_height_mm = Slider(1, range=0.5..10)
height_mm = Slider(50, range=1..500)
radius_mm = Slider(50, range=5..200)

center_x_mm = Slider(0, range=-500..500)
center_y_mm = Slider(0, range=-500..500)
fine_adjust_z_mm = Slider(0, range=-5..5)

# ----
# LAYERS
first_layer = Slider(1.5, range=0.1..5)
layer_height = Slider(1.1, range=0.5..5)
rotation = Slider(0, range=0..360)
layers = Python3Script(brep=cylinder, spacing=layer_height, rotation=rotation, bottom_offset=first_layer)  # -> out, curves; inputs brep: Brep, spacing: Double, rotation: Double, bottom_offset: Double
# ---------- layers: Python ----------
import Rhino.Geometry as rg
import math

def slice_polysurface(brep, spacing, bottom_offset, rotation):
    """
    Slices a closed polysurface sequentially from bottom to top
    and aligns the start point (seam) of the curves according to the 'rotation' angle.
    
    :param brep: Rhino.Geometry.Brep (input geometry)
    :param spacing: Distance between cutting planes (float > 0)
    :param bottom_offset: Distance from the first cutting plane to the base surface (float >= 0)
    :param rotation: Start angle in degrees (0.0 to 360.0) for the seam / start point
    :return: List of contour curves, sorted from bottom to top
    """
    if not brep or spacing <= 0 or bottom_offset < 0:
        return []

    # 1. Get bounding box & height limits
    bbox = brep.GetBoundingBox(True)
    z_min = bbox.Min.Z
    z_max = bbox.Max.Z

    start_z = z_min + bottom_offset

    if start_z > z_max:
        return []

    # 2. Calculate number of cuts & center data
    num_cuts = int(math.floor((z_max - start_z) / spacing)) + 1
    
    center_x = bbox.Center.X
    center_y = bbox.Center.Y

    # Radius for the alignment vector (+ 50% safety margin)
    dx = max(abs(bbox.Min.X - center_x), abs(bbox.Max.X - center_x))
    dy = max(abs(bbox.Min.Y - center_y), abs(bbox.Max.Y - center_y))
    r_max = math.hypot(dx, dy) * 1.5

    # Convert angle from degrees to radians
    rot_rad = math.radians(rotation)
    dir_x = math.cos(rot_rad)
    dir_y = math.sin(rot_rad)

    sliced_curves = []

    # 3. Iteratively generate cutting planes & adjust seam (start point)
    for i in range(num_cuts):
        current_z = start_z + i * spacing
        cut_plane = rg.Plane(rg.Point3d(center_x, center_y, current_z), rg.Vector3d.ZAxis)
        
        contours = rg.Brep.CreateContourCurves(brep, cut_plane)
        
        if contours:
            # Create target point for the seam at the current height
            target_pt = rg.Point3d(center_x + r_max * dir_x, center_y + r_max * dir_y, current_z)

            for crv in contours:
                if crv.IsClosed:
                    # Find closest point on curve and move seam there
                    success, t_param = crv.ClosestPoint(target_pt)
                    if success:
                        crv.ChangeClosedCurveSeam(t_param)

                sliced_curves.append(crv)

    return sliced_curves

# Assignment to component output parameter
curves = slice_polysurface(brep, spacing, bottom_offset, rotation)
# ---------- end layers ----------

# ----
# PATH
number_slider_2 = Slider(36, range=0..100)

# ----
# SPIRAL
spacing = Slider(2, range=0.5..5)
bottom_offset = Slider(0.1, range=0.1..5)
rotation_2 = Slider(0, range=0..360)
bottom_angle = Slider(180, range=0..360)
spiral = Python3Script(
    brep=brep,
    spacing=spacing,
    bottom_offset=bottom_offset,
    rotation=rotation_2,
    bottom_curve=bottom_angle,
    precision=number_slider_2)  # -> out, curves, curves_to_join; inputs brep: Brep, spacing: Double, bottom_offset: Double, rotation: Double, precision: Int32
# ---------- spiral: Python ----------
import Rhino.Geometry as rg
import math

def spiral_slice_polysurface(brep, spacing, bottom_offset, rotation, bottom_curve=0.0, precision=36):
    """
    Generates a continuously rising spiral slicing curve on a polysurface with an optional 
    horizontal bottom loop.
    
    :param brep: Rhino.Geometry.Brep (input geometry)
    :param spacing: Height gain per 360° turn (float > 0)
    :param bottom_offset: Start height from base surface (float >= 0)
    :param rotation: Start angle of the spiral in degrees (0.0 to 360.0)
    :param bottom_curve: Angular extent of the base curve in degrees (0.0 to 360.0; 0 = no base curve)
    :param precision: Number of control points per 360° turn (int > 0, default: 36)
    :return: List of joined contour curves
    """
    if not brep or spacing <= 0 or bottom_offset < 0 or precision <= 0:
        return []

    # 1. Bounding box & height limits
    bbox = brep.GetBoundingBox(True)
    z_min, z_max = bbox.Min.Z, bbox.Max.Z

    start_z = z_min + bottom_offset
    end_z = z_max - 0.1  # Ends 0.1 units below highest point

    if start_z >= end_z:
        return []

    center_x, center_y = bbox.Center.X, bbox.Center.Y

    # Radius of the cutting helicoid (+ 50% safety margin)
    dx = max(abs(bbox.Min.X - center_x), abs(bbox.Max.X - center_x))
    dy = max(abs(bbox.Min.Y - center_y), abs(bbox.Max.Y - center_y))
    r_max = math.hypot(dx, dy) * 1.5

    # 2. Calculate helicoid parameters
    total_height = end_z - start_z
    turns = total_height / float(spacing)
    total_samples = max(20, int(turns * precision))

    start_angle_rad = math.radians(rotation)
    two_pi = 2.0 * math.pi

    # 3. Construct cutting helicoid geometry
    crv_inner = rg.Line(rg.Point3d(center_x, center_y, start_z), rg.Point3d(center_x, center_y, end_z)).ToNurbsCurve()

    pts_outer = []
    for i in range(total_samples):
        t = i / float(total_samples - 1)
        curr_z = start_z + t * total_height
        angle = start_angle_rad - (t * turns * two_pi)

        xo = center_x + r_max * math.cos(angle)
        yo = center_y + r_max * math.sin(angle)
        pts_outer.append(rg.Point3d(xo, yo, curr_z))

    crv_outer = rg.NurbsCurve.CreateControlPointCurve(pts_outer, 3)
    if not crv_outer:
        return []

    # 4. Create cutting surface & calculate intersection
    helicoid_srf = rg.NurbsSurface.CreateRuledSurface(crv_inner, crv_outer)
    if not helicoid_srf:
        return []

    tol = 0.001
    rc, int_curves, _ = rg.Intersect.Intersection.BrepSurface(brep, helicoid_srf, tol)

    if not rc or not int_curves:
        return []

    # Join spiral segments & sort by height
    joined_spirals = rg.Curve.JoinCurves(int_curves, tol)
    if not joined_spirals:
        return []

    joined_spirals = sorted(joined_spirals, key=lambda c: min(c.PointAtStart.Z, c.PointAtEnd.Z))

    # Orient spiral segments from bottom to top
    spiral_start_pt = None
    for i, sc in enumerate(joined_spirals):
        if sc.PointAtStart.Z > sc.PointAtEnd.Z:
            sc.Reverse()
        if i == 0:
            spiral_start_pt = sc.PointAtStart

    curves_to_join = []

    # 5. Process optional base cut at start height
    if bottom_curve > 0 and spiral_start_pt:
        cut_plane = rg.Plane(rg.Point3d(center_x, center_y, start_z), rg.Vector3d.ZAxis)
        base_contours = rg.Brep.CreateContourCurves(brep, cut_plane)

        if base_contours:
            base_crv = min(
                base_contours,
                key=lambda c: c.PointAt(c.ClosestPoint(spiral_start_pt)[1]).DistanceTo(spiral_start_pt)
            )

            _, t_seam = base_crv.ClosestPoint(spiral_start_pt)
            base_crv.ChangeClosedCurveSeam(t_seam)

            if base_crv.ClosedCurveOrientation(rg.Plane.WorldXY) == rg.CurveOrientation.CounterClockwise:
                base_crv.Reverse()

            angle_clamped = max(0.0, min(360.0, float(bottom_curve)))
            if angle_clamped < 360.0:
                t_end = base_crv.Domain.Max
                t_start = t_end - ((angle_clamped / 360.0) * base_crv.Domain.Length)

                trimmed = base_crv.Trim(t_start, t_end)
                if trimmed:
                    base_crv = trimmed

            curves_to_join.append(base_crv)
            print(base_crv)

    curves_to_join.extend(joined_spirals)

    # 6. Final join step
    final_result = rg.Curve.JoinCurves(curves_to_join, tol)
    return curves_to_join, list(final_result) if final_result else curves_to_join

# Assignment to component output parameter
curves_to_join, curves = spiral_slice_polysurface(brep, spacing, bottom_offset, rotation, bottom_curve, precision)
# ---------- end spiral ----------

point_4 = Point(capture_wobj.wobj_origin)
point_5 = Point(capture_wobj.wobj_xaxis)
point_6 = Point(capture_wobj.wobj_xypoint)

# ---- group: DESIGN
# design: "slice" a cylinder
slice_cylinder = SliceCylinder(
    radius=radius_mm,
    height=height_mm,
    layer_height=layer_height_mm,
    point_spacing=point_spacing_mm,
    center_x=center_x_mm,
    center_y=center_y_mm,
    fine_adjust_z=fine_adjust_z_mm)  # -> layers
# ---------- slice_cylinder: Python ----------
# r: compas
# venv: mas-2627
"""
Slice a cylinder into layers, in work object coordinates (Rhino world XY = work object).
One closed compas Polyline per layer. Units: mm.
center_x, center_y: where the cylinder stands on the work object.
fine_adjust_z: shifts all layers up/down, to tune the nozzle height above the bed (0 = first layer at z = 0).
"""
import math

from compas.geometry import Point
from compas.geometry import Polyline

# ===== How many layers, how many points per layer =====
layer_count = int(height / layer_height)
points_per_layer = round(2 * math.pi * radius / point_spacing)

# ===== One closed polyline per layer =====
layers = []
for i in range(layer_count):
    z = i * layer_height + fine_adjust_z
    points = []
    for j in range(points_per_layer + 1):  # one extra point: back to the start to close the ring
        angle = 2 * math.pi * (j % points_per_layer) / points_per_layer
        points.append(Point(center_x + radius * math.cos(angle), center_y + radius * math.sin(angle), z))
    layers.append(Polyline(points))
# ---------- end slice_cylinder ----------

# ----
# Alternating dropping outward
# opposite drop (Orthogonal)
# opposite drop (non-orthogonal)
number_slider_3 = Slider(4.35, range=0..10)
# OLD
add_tail_curve = Python3Script(crvs=layers.curves)  # -> out, crvs, starting_crv; inputs crvs: list of Curve
# ---------- add_tail_curve: Python ----------
import Rhino.Geometry as rg 

crv = crvs[0]
starting_pt = crv.PointAt(0)
vec = rg.Vector3d.CrossProduct(crv.TangentAtStart ,rg.Vector3d(0,0,1))

# Where the extruder start
zero_pt = starting_pt + vec * 50

starting_crv = rg.LineCurve(zero_pt, starting_pt)

crvs.insert(0, starting_crv)
# ---------- end add_tail_curve ----------

# ---- group: PRINTPATH
# generate printpath: printpoints and path
safety_distance_mm = Slider(100, range=10..300)
blend_radius_mm = Slider(1.37, range=0..5)
speed_mm_s = Slider(10, range=1..50)
printpath = Printpath(layers=slice_cylinder, speed=speed_mm_s, blend_radius=blend_radius_mm, safety_distance=safety_distance_mm)  # -> printpath, summary; inputs layers: list
# ---------- printpath: Python ----------
# r: compas
# venv: mas-2627
"""
Turn the layers into printpoints and a PrintPath, in work object coordinates.
Safety points are added here, before any transform to the robot base.
"""
import os
import sys

from compas.geometry import Frame, Vector


# Find source folder
gh_dir = os.path.dirname(ghenv.Component.OnPingDocument().FilePath)
src_dir = os.path.join(gh_dir, "..", "..", "src")
if src_dir not in sys.path:
    sys.path.append(src_dir)
from print_class import PrintPoint, PrintPath

# ===== One printpoint per point =====
# world XY orientation for every point: a tangent frame would turn the wrist 360 degrees each layer
printpoints = []
for layer_index, layer in enumerate(layers):
    for point in layer.points:
        frame = Frame(point, -Vector.Xaxis(), Vector.Yaxis())
        printpoints.append(PrintPoint(frame, layer_index, speed, blend_radius, True))

# ===== Path with a travel point above the start and the end =====
printpath = PrintPath(printpoints)
printpath.add_safety_before(safety_distance, speed)
printpath.add_safety_after(safety_distance, speed)

summary = f"{len(printpoints)} printpoints in {len(layers)} layers, plus 2 safety points"
# ---------- end printpath ----------
panel = Panel(printpath.summary)

# ----
# opposite drop (non-orthogonal)
# Right points of the working space
panel_2 = Panel("614.95,-63.4,16.71")
point_7 = Point(panel_2)
point_8 = Point("608.95,528.88,16.97")
point_9 = Point("218.39,-65.25,17.22")

# ----
# FRAMES AND PRINTPATH
safety_distance_mm_2 = Slider(100, range=10..300)
# Odd dropping at both side
# Odd dropping outward
point_spacing_mm_2 = Slider(10, range=1..50)
blend_radius_mm_2 = Slider(1, range=0..5)
speed_mm_s_2 = Slider(10, range=1..50)
printpath_2 = Printpath(
    curves=add_tail_curve.crvs,
    speed=speed_mm_s_2,
    blend_radius=blend_radius_mm_2,
    safety_distance=safety_distance_mm_2,
    point_distance=point_spacing_mm_2)  # -> printpath, summary, frame; inputs curves: list of Curve, speed: Double, blend_radius: Double, safety_distance: Double, point_distance: Double
# ---------- printpath_2: Python ----------
# r: compas
# venv: mas-2627
"""
Turn the curves into printpoints and a PrintPath, in work object coordinates.
Safety points are added here, before any transform to the robot base.
"""
import os
import sys
from compas.geometry import Frame, Vector, Point
import math as m
from Rhino.Geometry import Curve, Vector3d


# Include source path once
gh_dir = os.path.dirname(ghenv.Component.OnPingDocument().FilePath)
src_dir = os.path.abspath(os.path.join(gh_dir, "src"))
if src_dir not in sys.path:
    sys.path.append(src_dir)

from print_class import PrintPoint, PrintPath

# 1. Validate inputs
if not curves:
    curves = []
elif not isinstance(curves, list):
    curves = [curves]

valid_curves = [c for c in curves if c]
num_curves = len(valid_curves)

# Set default distance (fallback: 2.0)
point_dist = float(point_distance) if ('point_distance' in locals() and point_distance and point_distance > 0) else 2.0

# 2. Define vectors ONCE outside the loops (saves thousands of object creations)
vec_x = -Vector.Xaxis()
vec_y = Vector.Yaxis()

printpoints = []

tail_crv = valid_curves.pop(0)
freq = 7.3
amp = 3

# 3. Calculate print points per curve, layer_index means the number of layer
for layer_index, curve in enumerate(valid_curves):
    # Query start point of curve once
    start_pt = curve.PointAtStart

    # Divide curve into segments
    t_params = curve.DivideByLength(point_dist, True)
    if t_params:
        pts = [curve.PointAt(t) for t in t_params]
    else:
        pts = [start_pt]

        # Close layer (except for the very last curve) ->add starting point for each layer
        if layer_index < num_curves - 1:
                if pts[-1].DistanceTo(start_pt) > 1e-6:
                    pts.append(start_pt)

    # Create COMPAS frames & PrintPoints
    for pt in pts:
        frame = Frame(Point(pt.X, pt.Y, pt.Z), vec_x, vec_y)
        printpoints.append(PrintPoint(frame, layer_index, speed, blend_radius, True))


# Add the tail curve
tail_printpoints = []
t_params = tail_crv.DivideByLength(point_dist, True)
tail_pts = [tail_crv.PointAt(t) for t in t_params]
for pt in tail_pts[::-1]:
        frame = Frame(Point(pt.X, pt.Y, pt.Z), vec_x, vec_y)
        tail_printpoints.append(PrintPoint(frame, layer_index, speed, blend_radius, True))
for i in tail_printpoints:
    printpoints.insert(0, i)


# 4. Generate PrintPath with safety points
printpath = PrintPath(printpoints)
printpath.add_safety_before(safety_distance, speed)
printpath.add_safety_after(safety_distance, speed)

frame = []
for item in printpoints:
    frame.append(item.frame)

summary = f"{len(printpoints)} printpoints in {num_curves} curves, plus 2 safety points"
# ---------- end printpath_2 ----------
panel_3 = Panel(printpath_2.summary)

python_3_script_2 = Python3Script(origin=point_7, x=point_8, y=point_9)  # -> out, working_space; inputs origin: Point3d, x: Point3d, y: Point3d
# ---------- python_3_script_2: Python ----------
from compas.geometry import Curve, Point, NurbsCurve
from compas_rhino.conversions import point_to_compas

a = point_to_compas(origin)
b = point_to_compas(x)
c = point_to_compas(y)

d = b + c - a
working_space = NurbsCurve.from_points([a, b, d, c, a], 1)
# ---------- end python_3_script_2 ----------
curve_3 = Curve(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)
printpath_3 = Printpath(
    curves=add_tail_curve.crvs,
    speed=speed_mm_s_2,
    blend_radius=blend_radius_mm_2,
    safety_distance=safety_distance_mm_2,
    point_distance=point_spacing_mm_2,
    amp=number_slider_3)  # -> printpath, summary, frame; inputs curves: list of Curve, speed: Double, blend_radius: Double, safety_distance: Double, point_distance: Double
# ---------- printpath_3: Python ----------
# r: compas
# venv: mas-2627
"""
Turn the curves into printpoints and a PrintPath, in work object coordinates.
Safety points are added here, before any transform to the robot base.
"""
import os
import sys
from compas.geometry import Frame, Vector, Point
import math as m
from Rhino.Geometry import Curve, Vector3d


# Include source path once
gh_dir = os.path.dirname(ghenv.Component.OnPingDocument().FilePath)
src_dir = os.path.abspath(os.path.join(gh_dir, "src"))
if src_dir not in sys.path:
    sys.path.append(src_dir)

from print_class import PrintPoint, PrintPath

# 1. Validate inputs
if not curves:
    curves = []
elif not isinstance(curves, list):
    curves = [curves]

valid_curves = [c for c in curves if c]
num_curves = len(valid_curves)

# Set default distance (fallback: 2.0)
point_dist = float(point_distance) if ('point_distance' in locals() and point_distance and point_distance > 0) else 2.0

# 2. Define vectors ONCE outside the loops (saves thousands of object creations)
vec_x = -Vector.Xaxis()
vec_y = Vector.Yaxis()

printpoints = []

tail_crv = valid_curves.pop(0)
freq = 7.3

# 3. Calculate print points per curve, layer_index means the number of layer
for layer_index, curve in enumerate(valid_curves):
    # Query start point of curve once
    start_pt = curve.PointAtStart

    # Divide curve into segments
    t_params = curve.DivideByLength(point_dist, True)
    if t_params:
        pts = [curve.PointAt(t) for t in t_params]
    else:
        pts = [start_pt]

        # Close layer (except for the very last curve) ->add starting point for each layer
        if layer_index < num_curves - 1:
                if pts[-1].DistanceTo(start_pt) > 1e-6:
                    pts.append(start_pt)
    
    # Modify the points in same layers
    new_pts = []
    for i, pt in enumerate(pts):
        # pt = pts[i] +  amp * m.sin(freq*i) * vx* (-1) **(i) # (1, -1)
        pt = pt +  amp * Vector3d(0,0,1) * (i%2)
        new_pts.append(pt)

    # Create COMPAS frames & PrintPoints
    for pt in new_pts:
        frame = Frame(Point(pt.X, pt.Y, pt.Z), vec_x, vec_y)
        printpoints.append(PrintPoint(frame, layer_index, speed, blend_radius, True))


# Add the tail curve
tail_printpoints = []
t_params = tail_crv.DivideByLength(point_dist, True)
tail_pts = [tail_crv.PointAt(t) for t in t_params]
for pt in tail_pts[::-1]:
        frame = Frame(Point(pt.X, pt.Y, pt.Z), vec_x, vec_y)
        tail_printpoints.append(PrintPoint(frame, layer_index, speed, blend_radius, True))
for i in tail_printpoints:
    printpoints.insert(0, i)


# 4. Generate PrintPath with safety points
printpath = PrintPath(printpoints)
printpath.add_safety_before(safety_distance, speed)
printpath.add_safety_after(safety_distance, speed)

frame = []
for item in printpoints:
    frame.append(item.frame)

summary = f"{len(printpoints)} printpoints in {num_curves} curves, plus 2 safety points"
# ---------- end printpath_3 ----------
printpath_4 = Printpath(
    curves=add_tail_curve.crvs,
    speed=speed_mm_s_2,
    blend_radius=blend_radius_mm_2,
    safety_distance=safety_distance_mm_2,
    point_distance=point_spacing_mm_2,
    amp=number_slider_3)  # -> printpath, summary, frame; inputs curves: list of Curve, speed: Double, blend_radius: Double, safety_distance: Double, point_distance: Double
# ---------- printpath_4: Python ----------
# r: compas
# venv: mas-2627
"""
Turn the curves into printpoints and a PrintPath, in work object coordinates.
Safety points are added here, before any transform to the robot base.
"""
import os
import sys
from compas.geometry import Frame, Vector, Point
import math as m
from Rhino.Geometry import Curve, Vector3d


# Include source path once
gh_dir = os.path.dirname(ghenv.Component.OnPingDocument().FilePath)
src_dir = os.path.abspath(os.path.join(gh_dir, "src"))
if src_dir not in sys.path:
    sys.path.append(src_dir)

from print_class import PrintPoint, PrintPath

# 1. Validate inputs
if not curves:
    curves = []
elif not isinstance(curves, list):
    curves = [curves]

valid_curves = [c for c in curves if c]
num_curves = len(valid_curves)

# Set default distance (fallback: 2.0)
point_dist = float(point_distance) if ('point_distance' in locals() and point_distance and point_distance > 0) else 2.0

# 2. Define vectors ONCE outside the loops (saves thousands of object creations)
vec_x = -Vector.Xaxis()
vec_y = Vector.Yaxis()

printpoints = []

tail_crv = valid_curves.pop(0)
freq = 7.3

# 3. Calculate print points per curve, layer_index means the number of layer
for layer_index, curve in enumerate(valid_curves):
    # Query start point of curve once
    start_pt = curve.PointAtStart

    # Divide curve into segments
    t_params = curve.DivideByLength(point_dist, True)
    if t_params:
        pts = [curve.PointAt(t) for t in t_params]
    else:
        pts = [start_pt]

        # Close layer (except for the very last curve) ->add starting point for each layer
        if layer_index < num_curves - 1:
                if pts[-1].DistanceTo(start_pt) > 1e-6:
                    pts.append(start_pt)
    
    # Modify the points in same layers
    new_pts = []
    if layer_index %2 ==0:
        v_xs = [Vector3d.CrossProduct(valid_curves[layer_index].TangentAt(param) ,Vector3d(0,0,1)) for param in t_params]
        for i, vx in enumerate(v_xs):
            # pt = pts[i] +  amp * m.sin(freq*i) * vx* (-1) **(i) # (1, -1)
            pt = pts[i] +  amp * vx* (-1) **(i) # (1, -1)
            new_pts.append(pt)
    else:
        new_pts = pts


    # Create COMPAS frames & PrintPoints
    for pt in new_pts:
        frame = Frame(Point(pt.X, pt.Y, pt.Z), vec_x, vec_y)
        printpoints.append(PrintPoint(frame, layer_index, speed, blend_radius, True))


# Add the tail curve
tail_printpoints = []
t_params = tail_crv.DivideByLength(point_dist, True)
tail_pts = [tail_crv.PointAt(t) for t in t_params]
for pt in tail_pts[::-1]:
        frame = Frame(Point(pt.X, pt.Y, pt.Z), vec_x, vec_y)
        tail_printpoints.append(PrintPoint(frame, layer_index, speed, blend_radius, True))
for i in tail_printpoints:
    printpoints.insert(0, i)


# 4. Generate PrintPath with safety points
printpath = PrintPath(printpoints)
printpath.add_safety_before(safety_distance, speed)
printpath.add_safety_after(safety_distance, speed)

frame = []
for item in printpoints:
    frame.append(item.frame)

summary = f"{len(printpoints)} printpoints in {num_curves} curves, plus 2 safety points"
# ---------- end printpath_4 ----------
printpath_5 = Printpath(
    curves=add_tail_curve.crvs,
    speed=speed_mm_s_2,
    blend_radius=blend_radius_mm_2,
    safety_distance=safety_distance_mm_2,
    point_distance=point_spacing_mm_2,
    amp=number_slider_3)  # -> printpath, summary, frame; inputs curves: list of Curve, speed: Double, blend_radius: Double, safety_distance: Double, point_distance: Double
# ---------- printpath_5: Python ----------
# r: compas
# venv: mas-2627
"""
Turn the curves into printpoints and a PrintPath, in work object coordinates.
Safety points are added here, before any transform to the robot base.
"""
import os
import sys
from compas.geometry import Frame, Vector, Point
import math as m
from Rhino.Geometry import Curve, Vector3d


# Include source path once
gh_dir = os.path.dirname(ghenv.Component.OnPingDocument().FilePath)
src_dir = os.path.abspath(os.path.join(gh_dir, "src"))
if src_dir not in sys.path:
    sys.path.append(src_dir)

from print_class import PrintPoint, PrintPath

# 1. Validate inputs
if not curves:
    curves = []
elif not isinstance(curves, list):
    curves = [curves]

valid_curves = [c for c in curves if c]
num_curves = len(valid_curves)

# Set default distance (fallback: 2.0)
point_dist = float(point_distance) if ('point_distance' in locals() and point_distance and point_distance > 0) else 2.0

# 2. Define vectors ONCE outside the loops (saves thousands of object creations)
vec_x = -Vector.Xaxis()
vec_y = Vector.Yaxis()

printpoints = []

tail_crv = valid_curves.pop(0)
freq = 7.3


# 3. Calculate print points per curve, layer_index means the number of layer
for layer_index, curve in enumerate(valid_curves):
    # Query start point of curve once
    start_pt = curve.PointAtStart

    # Divide curve into segments
    t_params = curve.DivideByLength(point_dist, True)
    if t_params:
        pts = [curve.PointAt(t) for t in t_params]
    else:
        pts = [start_pt]

        # Close layer (except for the very last curve) ->add starting point for each layer
        if layer_index < num_curves - 1:
                if pts[-1].DistanceTo(start_pt) > 1e-6:
                    pts.append(start_pt)
    
    # Modify the points in same layers
    new_pts = []
    if layer_index %2 ==0:
        v_xs = [Vector3d.CrossProduct(valid_curves[layer_index].TangentAt(param) ,Vector3d(0,0,1)) for param in t_params]
        for i, vx in enumerate(v_xs):
            # pt = pts[i] +  amp * m.sin(freq*i) * vx* (-1) **(i) # (1, -1)
            pt = pts[i] +  amp * vx* (i %2)
            new_pts.append(pt)
    else:
        new_pts = pts


    # Create COMPAS frames & PrintPoints
    for pt in new_pts:
        frame = Frame(Point(pt.X, pt.Y, pt.Z), vec_x, vec_y)
        printpoints.append(PrintPoint(frame, layer_index, speed, blend_radius, True))


# Add the tail curve
tail_printpoints = []
t_params = tail_crv.DivideByLength(point_dist, True)
tail_pts = [tail_crv.PointAt(t) for t in t_params]
for pt in tail_pts[::-1]:
        frame = Frame(Point(pt.X, pt.Y, pt.Z), vec_x, vec_y)
        tail_printpoints.append(PrintPoint(frame, layer_index, speed, blend_radius, True))
for i in tail_printpoints:
    printpoints.insert(0, i)


# 4. Generate PrintPath with safety points
printpath = PrintPath(printpoints)
printpath.add_safety_before(safety_distance, speed)
printpath.add_safety_after(safety_distance, speed)

frame = []
for item in printpoints:
    frame.append(item.frame)

summary = f"{len(printpoints)} printpoints in {num_curves} curves, plus 2 safety points"
# ---------- end printpath_5 ----------
printpath_6 = Printpath(
    curves=add_tail_curve.crvs,
    speed=speed_mm_s_2,
    blend_radius=blend_radius_mm_2,
    safety_distance=safety_distance_mm_2,
    point_distance=point_spacing_mm_2,
    amp=number_slider_3)  # -> printpath, summary, frame; inputs curves: list of Curve, speed: Double, blend_radius: Double, safety_distance: Double, point_distance: Double
# ---------- printpath_6: Python ----------
# r: compas
# venv: mas-2627
"""
Turn the curves into printpoints and a PrintPath, in work object coordinates.
Safety points are added here, before any transform to the robot base.
"""
import os
import sys
from compas.geometry import Frame, Vector, Point
import math as m
from Rhino.Geometry import Curve, Vector3d


# Include source path once
gh_dir = os.path.dirname(ghenv.Component.OnPingDocument().FilePath)
src_dir = os.path.abspath(os.path.join(gh_dir, "src"))
if src_dir not in sys.path:
    sys.path.append(src_dir)

from print_class import PrintPoint, PrintPath

# 1. Validate inputs
if not curves:
    curves = []
elif not isinstance(curves, list):
    curves = [curves]

valid_curves = [c for c in curves if c]
num_curves = len(valid_curves)

# Set default distance (fallback: 2.0)
point_dist = float(point_distance) if ('point_distance' in locals() and point_distance and point_distance > 0) else 2.0

# 2. Define vectors ONCE outside the loops (saves thousands of object creations)
vec_x = -Vector.Xaxis()
vec_y = Vector.Yaxis()

printpoints = []

tail_crv = valid_curves.pop(0)
freq = 7.3

# 3. Calculate print points per curve, layer_index means the number of layer
for layer_index, curve in enumerate(valid_curves):
    # Query start point of curve once
    start_pt = curve.PointAtStart

    # Divide curve into segments
    t_params = curve.DivideByLength(point_dist, True)
    if t_params:
        pts = [curve.PointAt(t) for t in t_params]
    else:
        pts = [start_pt]

        # Close layer (except for the very last curve) ->add starting point for each layer
        if layer_index < num_curves - 1:
                if pts[-1].DistanceTo(start_pt) > 1e-6:
                    pts.append(start_pt)
    
    # Modify the points in same layers
    new_pts = []
    if layer_index %2 ==0:
        v_xs = [Vector3d.CrossProduct(valid_curves[layer_index].TangentAt(param) ,Vector3d(0,0,1)) for param in t_params]
        for i, vx in enumerate(v_xs):
            # pt = pts[i] +  amp * m.sin(freq*i) * vx* (-1) **(i) # (1, -1)
            pt = pts[i] +  amp * vx* (-1) **(i) # (1, -1)
            new_pts.append(pt)
    else:
        v_xs = [Vector3d.CrossProduct(valid_curves[layer_index].TangentAt(param) ,Vector3d(0,0,1)) for param in t_params]
        for i, vx in enumerate(v_xs):
            pt = pts[i] -  amp * vx* (-1) **(i) # (1, -1)
            new_pts.append(pt)

    # Create COMPAS frames & PrintPoints
    for pt in new_pts:
        frame = Frame(Point(pt.X, pt.Y, pt.Z), vec_x, vec_y)
        printpoints.append(PrintPoint(frame, layer_index, speed, blend_radius, True))


# Add the tail curve
tail_printpoints = []
t_params = tail_crv.DivideByLength(point_dist, True)
tail_pts = [tail_crv.PointAt(t) for t in t_params]
for pt in tail_pts[::-1]:
        frame = Frame(Point(pt.X, pt.Y, pt.Z), vec_x, vec_y)
        tail_printpoints.append(PrintPoint(frame, layer_index, speed, blend_radius, True))
for i in tail_printpoints:
    printpoints.insert(0, i)


# 4. Generate PrintPath with safety points
printpath = PrintPath(printpoints)
printpath.add_safety_before(safety_distance, speed)
printpath.add_safety_after(safety_distance, speed)

frame = []
for item in printpoints:
    frame.append(item.frame)

summary = f"{len(printpoints)} printpoints in {num_curves} curves, plus 2 safety points"
# ---------- end printpath_6 ----------
printpath_7 = Printpath(
    curves=add_tail_curve.crvs,
    speed=speed_mm_s_2,
    blend_radius=blend_radius_mm_2,
    safety_distance=safety_distance_mm_2,
    point_distance=point_spacing_mm_2,
    amp=number_slider_3)  # -> printpath, summary, frame; inputs curves: list of Curve, speed: Double, blend_radius: Double, safety_distance: Double, point_distance: Double; same code as printpath_6
printpath_8 = Printpath(
    curves=add_tail_curve.crvs,
    speed=speed_mm_s_2,
    blend_radius=blend_radius_mm_2,
    safety_distance=safety_distance_mm_2,
    point_distance=point_spacing_mm_2,
    amp=number_slider_3)  # -> printpath, summary, frame; inputs curves: list of Curve, speed: Double, blend_radius: Double, safety_distance: Double, point_distance: Double
# ---------- printpath_8: Python ----------
# r: compas
# venv: mas-2627
"""
Turn the curves into printpoints and a PrintPath, in work object coordinates.
Safety points are added here, before any transform to the robot base.
"""
import os
import sys
from compas.geometry import Frame, Vector, Point
import math as m
from Rhino.Geometry import Curve, Vector3d


# Include source path once
gh_dir = os.path.dirname(ghenv.Component.OnPingDocument().FilePath)
src_dir = os.path.abspath(os.path.join(gh_dir, "src"))
if src_dir not in sys.path:
    sys.path.append(src_dir)

from print_class import PrintPoint, PrintPath

# 1. Validate inputs
if not curves:
    curves = []
elif not isinstance(curves, list):
    curves = [curves]

valid_curves = [c for c in curves if c]
num_curves = len(valid_curves)

# Set default distance (fallback: 2.0)
point_dist = float(point_distance) if ('point_distance' in locals() and point_distance and point_distance > 0) else 2.0

# 2. Define vectors ONCE outside the loops (saves thousands of object creations)
vec_x = -Vector.Xaxis()
vec_y = Vector.Yaxis()

printpoints = []

tail_crv = valid_curves.pop(0)
freq = 7.3


# 3. Calculate print points per curve, layer_index means the number of layer
for layer_index, curve in enumerate(valid_curves):
    # Query start point of curve once
    start_pt = curve.PointAtStart

    # Divide curve into segments
    t_params = curve.DivideByLength(point_dist, True)
    if t_params:
        pts = [curve.PointAt(t) for t in t_params]
    else:
        pts = [start_pt]

        # Close layer (except for the very last curve) ->add starting point for each layer
        if layer_index < num_curves - 1:
                if pts[-1].DistanceTo(start_pt) > 1e-6:
                    pts.append(start_pt)
    
    # Modify the points in same layers
    new_pts = []
    if layer_index %2 ==0:
        v_xs = [Vector3d.CrossProduct(valid_curves[layer_index].TangentAt(param) ,Vector3d(0,0,1)) for param in t_params]
        for i, vx in enumerate(v_xs):
            # pt = pts[i] +  amp * m.sin(freq*i) * vx* (-1) **(i) # (1, -1)
            pt = pts[i] +  amp * vx* (i %2)
            new_pts.append(pt)
    else:
        v_xs = [Vector3d.CrossProduct(valid_curves[layer_index].TangentAt(param) ,Vector3d(0,0,1)) for param in t_params]
        for i, vx in enumerate(v_xs):
            pt = pts[i] +  amp * vx * ((i +1)%2)
            new_pts.append(pt)


    # Create COMPAS frames & PrintPoints
    for pt in new_pts:
        frame = Frame(Point(pt.X, pt.Y, pt.Z), vec_x, vec_y)
        printpoints.append(PrintPoint(frame, layer_index, speed, blend_radius, True))


# Add the tail curve
tail_printpoints = []
t_params = tail_crv.DivideByLength(point_dist, True)
tail_pts = [tail_crv.PointAt(t) for t in t_params]
for pt in tail_pts[::-1]:
        frame = Frame(Point(pt.X, pt.Y, pt.Z), vec_x, vec_y)
        tail_printpoints.append(PrintPoint(frame, layer_index, speed, blend_radius, True))
for i in tail_printpoints:
    printpoints.insert(0, i)


# 4. Generate PrintPath with safety points
printpath = PrintPath(printpoints)
printpath.add_safety_before(safety_distance, speed)
printpath.add_safety_after(safety_distance, speed)

frame = []
for item in printpoints:
    frame.append(item.frame)

summary = f"{len(printpoints)} printpoints in {num_curves} curves, plus 2 safety points"
# ---------- end printpath_8 ----------
compas_draw_3 = COMPASDraw(cg=printpath_2.frame)  # -> rg; same code as compas_draw
compas_draw_4 = COMPASDraw(cg=python_3_script_2.working_space)  # -> rg; same code as compas_draw
list_item = ListItem(List=compas_draw_3, Index=0, Wrap=True)  # -> flatten(Item)
list_item_2 = ListItem(List=list_item, Index=Slider(1, range=0..50), Wrap=True)

# ----
# EXPORT
save = Button()
preview = Preview(printpath=printpath_3.printpath)  # -> path, travel, planes
# ---------- preview: Python ----------
# r: compas
# venv: mas-2627
"""
Draw the printpath: path = the whole polyline, travel = extruder-off segments,
safety = extruder-off points, axes = small x and y axis of each frame.
"""
import Rhino.Geometry as rg
from compas_rhino.conversions import frame_to_rhino_plane, point_to_rhino

AXIS_LENGTH = 5.0  # mm

points = printpath.printpoints
planes = [frame_to_rhino_plane(printpoint.frame) for printpoint in points]

# ===== Whole path =====
polyline = rg.Polyline()
for plane in planes:
    polyline.Add(plane.Origin.X, plane.Origin.Y, plane.Origin.Z)
path = polyline.ToPolylineCurve()

# ===== Extruder off: a segment prints only if both of its points have the extruder on =====
safety = [point_to_rhino(printpoint.frame.point) for printpoint in points if not printpoint.is_extruder_on]
travel = []
for i in range(len(points) - 1):
    if not (points[i].is_extruder_on and points[i + 1].is_extruder_on):
        travel.append(rg.Line(planes[i].Origin, planes[i + 1].Origin))
# ---------- end preview ----------
save_2 = Save(printpath=printpath_3.printpath, save=save, out_path="data/out_printpoints.json")  # -> status
# ---------- save_2: Python ----------
# r: compas
# venv: mas-2627
"""
On button press, write the printpath to data/out_printpoints.json next to this .ghx file.
send_to_robot.py reads that file.
"""
import json
import os

import scriptcontext as sc

gh_dir = os.path.dirname(ghenv.Component.OnPingDocument().FilePath)

# keep the last status in sticky, so the message survives the button being released
status_key = "save_status_" + str(ghenv.Component.InstanceGuid)

if save:
    if printpath is None:
        sc.sticky[status_key] = "nothing to save: no printpath"
    else:
        path = os.path.normpath(os.path.join(gh_dir, out_path))
        os.makedirs(os.path.dirname(path), exist_ok=True)
        with open(path, "w") as f:
            json.dump(printpath.to_dict(), f, indent=2)
        sc.sticky[status_key] = f"saved {len(printpath)} printpoints to {path}"

status = sc.sticky.get(status_key, "")
ghenv.Component.Message = "saved" if status.startswith("saved") else status
# ---------- end save_2 ----------
preview_2 = CustomPreview(Geometry=preview.path, Material=ColourSwatch(SwatchColor=RGB(0, 170, 80)))
preview_3 = CustomPreview(Geometry=preview.travel, Material=ColourSwatch(SwatchColor=RGB(230, 40, 40)))
plane = Plane(preview.planes)

panel_4 = Panel("0")
panel_5 = Panel("blend_radius")
panel_6 = Panel("Speed")
panel_7 = Panel("Layer_height")
panel_8 = Panel("Pt Offset")
panel_9 = Panel("Slicing")
panel_11 = Panel("XXX")
