# Grasshopper definition solving _2-1-2 leg issue.ghx (Grasshopper 1.0.8)
# plug-ins: Bifocals

brep = Brep(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)
brep_2 = Brep(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)

scale = Scale(Geometry=brep, Center=Point(0, 0, 0), Factor=Slider(0.6, range=0..1))  # -> Geometry, Transform
bounding_box = BoundingBox(Content=scale.Geometry, Plane=PlaneXY(0, 0, 0))  # -> Box, Box_2

# ----
# LAYERS
spacing = Slider(1.1, range=0.5..5)
rotation = Slider(0, range=0..360)
bottom_offset = Slider(1.5, range=0.1..5)
# 3D TO CRV
_3d_to_crvs_layers = Python3Script(brep=scale.Geometry, spacing=spacing, rotation=rotation, bottom_offset=bottom_offset)  # -> out, curves; inputs brep: Brep, spacing: Double, rotation: Double, bottom_offset: Double
# ---------- _3d_to_crvs_layers: Python ----------
import Rhino.Geometry as rg
import math

def slice_polysurface(brep, spacing, bottom_offset, rotation):
    """
    Slices a closed polysurface sequentially from bottom to top
    and aligns the start point (seam) of the curves according to the 'rotation' angle.
    
    :param brep: Rhino.Geometry.Brep (input geometry)
    :param spacing: Distance between cutting planes (float > 0)
    :param bottom_offset: Distance from the first cutting plane to the base surface (float >= 0)
    :param rotation: Start angle in degrees (0.0 to 360.0) for the seam / start point
    :return: List of contour curves, sorted from bottom to top
    """
    if not brep or spacing <= 0 or bottom_offset < 0:
        return []

    # 1. Get bounding box & height limits
    bbox = brep.GetBoundingBox(True)
    z_min = bbox.Min.Z
    z_max = bbox.Max.Z

    start_z = z_min + bottom_offset

    if start_z > z_max:
        return []

    # 2. Calculate number of cuts & center data
    num_cuts = int(math.floor((z_max - start_z) / spacing)) + 1
    
    center_x = bbox.Center.X
    center_y = bbox.Center.Y

    # Radius for the alignment vector (+ 50% safety margin)
    dx = max(abs(bbox.Min.X - center_x), abs(bbox.Max.X - center_x))
    dy = max(abs(bbox.Min.Y - center_y), abs(bbox.Max.Y - center_y))
    r_max = math.hypot(dx, dy) * 1.5

    # Convert angle from degrees to radians
    rot_rad = math.radians(rotation)
    dir_x = math.cos(rot_rad)
    dir_y = math.sin(rot_rad)

    sliced_curves = []

    # 3. Iteratively generate cutting planes & adjust seam (start point)
    for i in range(num_cuts):
        current_z = start_z + i * spacing
        cut_plane = rg.Plane(rg.Point3d(center_x, center_y, current_z), rg.Vector3d.ZAxis)
        
        contours = rg.Brep.CreateContourCurves(brep, cut_plane)
        
        if contours:
            # Create target point for the seam at the current height
            target_pt = rg.Point3d(center_x + r_max * dir_x, center_y + r_max * dir_y, current_z)

            for crv in contours:
                if crv.IsClosed:
                    # Find closest point on curve and move seam there
                    success, t_param = crv.ClosestPoint(target_pt)
                    if success:
                        crv.ChangeClosedCurveSeam(t_param)

                sliced_curves.append(crv)

    return sliced_curves

# Assignment to component output parameter
curves = slice_polysurface(brep, spacing, bottom_offset, rotation)
# ---------- end _3d_to_crvs_layers ----------

# ----
# Seperate parts with number of crvs in each layer
curve = Curve(_3d_to_crvs_layers.curves)
end_points = EndPoints(Curve=curve)  # -> Start, End
deconstruct = Deconstruct(Point=end_points.End)  # -> XComponent, YComponent, ZComponent
construct_point = ConstructPoint(XCoordinate=0, YCoordinate=0, ZCoordinate=deconstruct.ZComponent)
cull_duplicates = CullDuplicates(Points=construct_point, Tolerance=0.1, CullMode=3)  # -> Points, Indices, Valence
partition_list = PartitionList(List=curve, Size=cull_duplicates.Valence)  # -> simplify(Chunks)

series = Series(Start=Slider(40, range=0..100), Step=1, Count=Slider(37, range=0..100))

number_slider = Slider(80, range=0..200)
tree_statistics = TreeStatistics(Tree=partition_list)  # -> Paths, Length, Count
list_item = ListItem(List=tree_statistics.Paths, Index=series, Wrap=True)
panel = Panel("""0
1""")
tree_item = TreeItem(Tree=partition_list, Path=list_item, Index=panel, Wrap=True)

curve_2 = Curve(partition_list)

# ----
# break down to segment and divide
point_spacing_mm = Slider(2, range=1..50)
explode = Explode(Curve=curve_2, Recursive=True)  # -> Segments, Vertices
divide_distance = DivideDistance(Curve=explode.Segments, Distance=point_spacing_mm)  # -> Points, Tangents, Parameters
trim_tree = TrimTree(Tree=divide_distance.Points, Depth=1)
removeduplicatepts = RemoveDuplicatePts(Points=trim_tree, Tolerance=0.01)

# ----
# FRAMES AND PRINTPATH/ 2-1-2 legs
blend_radius_mm = Slider(1, range=0..5)
safety_distance_mm = Slider(100, range=10..300)
speed_mm_s = Slider(20, range=1..60)
point_spacing_mm_2 = Slider(2, range=1..50)
printpath = Printpath(
    tree=curve_2,
    speed=speed_mm_s,
    blend_radius=blend_radius_mm,
    safety_distance=safety_distance_mm,
    point_distance=point_spacing_mm_2)  # -> printpath, summary, frame, pts, srf; inputs tree: tree of Curve, speed: Double, blend_radius: Double, safety_distance: Double, point_distance: Double
# ---------- printpath: Python ----------
# r: compas
# venv: mas-2627
"""
Turn the curves into printpoints and a PrintPath, in work object coordinates.
Safety points are added here, before any transform to the robot base.
"""
import os
import sys
from compas.geometry import Frame, Vector, Point, Curve
import Rhino.Geometry as rg

# Include source path once
gh_dir = os.path.dirname(ghenv.Component.OnPingDocument().FilePath)
src_dir = os.path.abspath(os.path.join(gh_dir, "src"))
if src_dir not in sys.path:
    sys.path.append(src_dir)

from print_class import PrintPoint, PrintPath

def add_tail(crv, length, point_dist):
    starting_pt = crv.PointAtStart
    vec = rg.Vector3d.CrossProduct(crv.TangentAtStart ,rg.Vector3d(0,0,1))
    vec.Unitize()
    # Where the extruder start

    tail_crv = rg.LineCurve(starting_pt + vec * length, starting_pt)

    # Add the tail curve
    t_params = tail_crv.DivideByLength(point_dist, True)
    tail_pts = [tail_crv.PointAt(t) for t in t_params]

    return tail_pts

curves = [list(branch) for branch in tree.Branches]

# 1. Validate inputs
if not curves:
    curves = []
elif not isinstance(curves, list):
    curves = [curves]

valid_curves = [c for c in curves if c]
num_curves = len(valid_curves)


# Set default distance (fallback: 2.0)
point_dist = float(point_distance) if ('point_distance' in locals() and point_distance and point_distance > 0) else 2.0

# 2. Define vectors ONCE outside the loops (saves thousands of object creations)
vec_x = -Vector.Xaxis()
vec_y = Vector.Yaxis()

printpoints = []


# 2.5 Get central brep to solve intersection with curve 
if len(valid_curves[0]) ==2:
    bot_cent_pts = []
    for crv in valid_curves[0]:
        result = rg.AreaMassProperties.Compute(crv)
        pt = result.Centroid
        bot_cent_pts.append(pt)

    x_v = bot_cent_pts[0] - bot_cent_pts[1]
    y_v = rg.Vector3d.CrossProduct(x_v, rg.Vector3d(0,0,1))
    c = bot_cent_pts[1] + (x_v) /2
else:
    # when there is only one crv in first layer 
    bot_cent_pts = []
    for crv in valid_curves[int(len(valid_curves)//2)+1]:
        result = rg.AreaMassProperties.Compute(crv)
        pt = result.Centroid
        bot_cent_pts.append(pt)

    x_v = bot_cent_pts[0] - bot_cent_pts[1]
    y_v = rg.Vector3d.CrossProduct(x_v, rg.Vector3d(0,0,1))
    c = bot_cent_pts[1] + (x_v) /2            
srf = rg.Surface.CreateExtrusion(rg.LineCurve(c+ y_v * 10-rg.Vector3d(0, 0, 10), c-y_v *10-rg.Vector3d(0, 0, 10)), rg.Vector3d(0, 0, 300))


# 3. Calculate print points per curve
# 3.1 len(curves) == 2
for layer_index, curves in enumerate(valid_curves):
    if len(curves) == 2:

        for curve in curves:
            
            seg_crvs = curve.DuplicateSegments()
            
            pts = []
            for seg in seg_crvs:
                start_pt = seg.PointAtStart
                t_params = seg.DivideByLength(point_dist, True)
                if t_params:
                    pt = [seg.PointAt(t) for t in t_params]
                else:
                    pt = [start_pt]
                pts.extend(pt)
            pts = [p for p in rg.Point3d.CullDuplicates(pts, 0.001)]
            pts.append(pts[0])

            # Create COMPAS frames & PrintPoints
            for i, pt in enumerate(pts):
                frame = Frame(Point(pt.X, pt.Y, pt.Z), vec_x, vec_y)
                
                # Give the first point fast speed to jump to another crv
                if i ==0:
                    printpoints.append(PrintPoint(frame, layer_index, 30, blend_radius, False))
                    printpoints.append(PrintPoint(frame, layer_index, speed, blend_radius, True)) #make sure crv close
                else:
                    printpoints.append(PrintPoint(frame, layer_index, speed, blend_radius, True))

    else: # len(curves) == 1:
        for crv in curves:
            success, lap_crvs, touching_pts = rg.Intersect.Intersection.CurveBrep(crv, srf.ToBrep(), 0.01)

            touching_pts = sorted(touching_pts, key = lambda p: (p-c)* y_v)
            start_pt = touching_pts[layer_index % 2]
            success, start_t = crv.ClosestPoint(start_pt) # here is the starting point

            # set new start point
            crv2  = crv.DuplicateCurve()
            crv2.ChangeClosedCurveSeam(start_t)
            # crvs.append(crv2) # only for preview

            # Divide curve into segments
            t_params = crv2.DivideByLength(point_dist, True)
            if t_params:
                pts = [crv2.PointAt(t) for t in t_params]
            else:
                pts = [start_pt]

            # Close layer (except for the very last curve)
            if layer_index < num_curves - 1:
                if layer_index !=0:
                    if pts[-1].DistanceTo(start_pt) > 1e-6:
                        pts.append(start_pt)

            # Create COMPAS frames & PrintPoints
            for pt in pts:
                frame = Frame(Point(pt.X, pt.Y, pt.Z), vec_x, vec_y)
                printpoints.append(PrintPoint(frame, layer_index, speed, blend_radius, True))


# Create tail
crvs = valid_curves[0]
if len(valid_curves[0]) ==2:
    crv = valid_curves[0][0]
else:
    crv = valid_curves[0]
tail_pts = add_tail(crv, 50, point_dist)
tail_printpoints = []

for pt in tail_pts[::-1]:
        frame = Frame(Point(pt.X, pt.Y, pt.Z), vec_x, vec_y)
        tail_printpoints.append(PrintPoint(frame, layer_index, speed, blend_radius, True))
for i in tail_printpoints:
    printpoints.insert(0, i)

# 4. Generate PrintPath with safety points
printpath = PrintPath(printpoints)
printpath.add_safety_before(safety_distance, speed)
printpath.add_safety_after(safety_distance, speed)

frame = []
speed = []
pts = []
for item in printpoints:
    frame.append(item.frame)
    speed.append(item.speed)
    pts.append(item.frame.point)

summary = f"{len(printpoints)} printpoints in {num_curves} curves, plus 2 safety points"
# ---------- end printpath ----------
panel_2 = Panel(printpath.printpath)

# ----
# EXPORT
save = Button()
preview = Preview(printpath=printpath.printpath)  # -> path, travel, planes
# ---------- preview: Python ----------
# r: compas
# venv: mas-2627
"""
Draw the printpath: path = the whole polyline, travel = extruder-off segments,
safety = extruder-off points, axes = small x and y axis of each frame.
"""
import Rhino.Geometry as rg
from compas_rhino.conversions import frame_to_rhino_plane, point_to_rhino

AXIS_LENGTH = 5.0  # mm

points = printpath.printpoints
planes = [frame_to_rhino_plane(printpoint.frame) for printpoint in points]

# ===== Whole path =====
polyline = rg.Polyline()
for plane in planes:
    polyline.Add(plane.Origin.X, plane.Origin.Y, plane.Origin.Z)
path = polyline.ToPolylineCurve()

# ===== Extruder off: a segment prints only if both of its points have the extruder on =====
safety = [point_to_rhino(printpoint.frame.point) for printpoint in points if not printpoint.is_extruder_on]
travel = []
for i in range(len(points) - 1):
    if not (points[i].is_extruder_on and points[i + 1].is_extruder_on):
        travel.append(rg.Line(planes[i].Origin, planes[i + 1].Origin))
# ---------- end preview ----------
save_2 = Save(printpath=printpath.printpath, save=save, out_path="data/out_printpoints_legs.json")  # -> status
# ---------- save_2: Python ----------
# r: compas
# venv: mas-2627
"""
On button press, write the printpath to data/out_printpoints.json next to this .ghx file.
send_to_robot.py reads that file.
"""
import json
import os

import scriptcontext as sc

gh_dir = os.path.dirname(ghenv.Component.OnPingDocument().FilePath)

# keep the last status in sticky, so the message survives the button being released
status_key = "save_status_" + str(ghenv.Component.InstanceGuid)

if save:
    if printpath is None:
        sc.sticky[status_key] = "nothing to save: no printpath"
    else:
        path = os.path.normpath(os.path.join(gh_dir, out_path))
        os.makedirs(os.path.dirname(path), exist_ok=True)
        with open(path, "w") as f:
            json.dump(printpath.to_dict(), f, indent=2)
        sc.sticky[status_key] = f"saved {len(printpath)} printpoints to {path}"

status = sc.sticky.get(status_key, "")
ghenv.Component.Message = "saved" if status.startswith("saved") else status
# ---------- end save_2 ----------
preview_2 = CustomPreview(Geometry=preview.path, Material=ColourSwatch(SwatchColor=RGB(0, 170, 80)))
preview_3 = CustomPreview(Geometry=preview.travel, Material=ColourSwatch(SwatchColor=RGB(230, 40, 40)))
plane = Plane(preview.planes)

# ----
# Right points of the working space
panel_3 = Panel("608.95,528.88,16.97")
point = Point("614.95,-63.4,16.71")
point_2 = Point("218.39,-65.25,17.22")
point_3 = Point(panel_3)

# ---- group: This is needed only ONCE in the GH definition
enable_auto_reload = Python3Script()  # -> ok
# ---------- enable_auto_reload: Python ----------
"""
------------------------------
Using VS Code as Python editor
------------------------------

The simplest way to start using VS Code as our editor, is
to place our Python code in files located IN THE SAME FOLDER as our Grasshopper file.

After we have done that, we need 2 steps: 

1. Enable the COMPAS reloader on one component. This tells Grasshopper to watch for changes in the Pythoh files and reload if changed.
2. Every other component that uses Python code from external files needs to start with a method to ensure Grasshopper knows where to load the files from.

"""
# r: compas
# venv: mas-2627

from compas_rhino.devtools import DevTools
DevTools.enable_reloader()
# ---------- end enable_auto_reload ----------
