# Grasshopper definition subdiv curve.ghx (Grasshopper 1.0.8)
# plug-ins: RhinoCodePluginGH

python_3_script = Python3Script(max_dist=Slider(3, range=0..3), min_dist=Slider(0.5, range=0..3), tolerance=Slider(0.15, range=0..3))  # -> out, a; inputs curves: list of Curve, max_dist: Double, min_dist: Double, tolerance: Double
# ---------- python_3_script: Python ----------
import Rhino.Geometry as rg
from Grasshopper import DataTree
from Grasshopper.Kernel.Data import GH_Path

all_points = []

def adaptive_points(curve, max_dist, tolerance):

    length = curve.GetLength()
    count = max(1, int(math.ceil(length / max_dist)))

    parameters = curve.DivideByCount(count, True)
    if parameters is None:
        return []

    def subdivide(t0, t1, depth=0):
        p0 = curve.PointAt(t0)
        p1 = curve.PointAt(t1)

        tm = (t0 + t1) / 2.0
        pm = curve.PointAt(tm)

        chord_mid = rg.Point3d(
            (p0.X + p1.X) / 2,
            (p0.Y + p1.Y) / 2,
            (p0.Z + p1.Z) / 2
        )

        error = pm.DistanceTo(chord_mid)

        if error > tolerance and depth < 12:
            return (
                subdivide(t0, tm, depth + 1)[:-1]
                + subdivide(tm, t1, depth + 1)
            )

        return [p0, p1]

    result = []

    for i in range(len(parameters) - 1):
        segment = subdivide(parameters[i], parameters[i + 1])
        result.extend(segment[:-1])

    result.append(curve.PointAt(parameters[-1]))

    if curve.IsClosed and len(result) > 1:
        if result[0].DistanceTo(result[-1]) < 0.001:
            result.pop()

    return result


import math

for curve in curves:
    points = adaptive_points(curve, max_dist, tolerance)
    all_points.append(points)

# Convert nested lists into Grasshopper DataTree
tree = DataTree[object]()

for i, layer_points in enumerate(all_points):
    path = GH_Path(i)

    for pt in layer_points:
        tree.Add(pt, path)

a = tree
# ---------- end python_3_script ----------
point = Point(python_3_script.a)
