# Grasshopper definition design_nikitha_20261109_filament 2(1).gh (Grasshopper 1.0.8)

# ---- group: This is needed only ONCE in the GH definition
enable_auto_reload = Python3Script()  # -> ok
# ---------- enable_auto_reload: Python ----------
"""
------------------------------
Using VS Code as Python editor
------------------------------

The simplest way to start using VS Code as our editor, is
to place our Python code in files located IN THE SAME FOLDER as our Grasshopper file.

After we have done that, we need 2 steps: 

1. Enable the COMPAS reloader on one component. This tells Grasshopper to watch for changes in the Pythoh files and reload if changed.
2. Every other component that uses Python code from external files needs to start with a method to ensure Grasshopper knows where to load the files from.

"""
# r: compas
# venv: mas-2627

from compas_rhino.devtools import DevTools
DevTools.enable_reloader()
# ---------- end enable_auto_reload ----------

# ---- group: amp + radius out + loops
point_spacing_mm = Slider(16, range=1..50)
layer_height_mm = Slider(1.2, range=0.5..10)
height_mm = Slider(50, range=1..500)
radius_mm = Slider(50, range=5..200)

center_x_mm = Slider(140, range=-500..500)
center_y_mm = Slider(131, range=-500..500)
fine_adjust_z_mm = Slider(0.8, range=-5..5)

# ---- group: DESIGN
point_spacing_mm_2 = Slider(10, range=1..50)
layer_height_mm_2 = Slider(0.8, range=0.5..10)
height_mm_2 = Slider(50, range=1..500)
radius_mm_2 = Slider(30, range=5..200)

point_spacing_mm_3 = Slider(6, range=1..50)
layer_height_mm_3 = Slider(1, range=0.5..10)
height_mm_3 = Slider(50, range=1..500)
radius_mm_3 = Slider(30, range=5..200)

center_x_mm_2 = Slider(76.74, range=-500..500)
center_y_mm_2 = Slider(80.39, range=-500..500)
fine_adjust_z_mm_2 = Slider(2, range=-5..5)

point_spacing_mm_4 = Slider(1, range=1..50)
layer_height_mm_4 = Slider(1.2, range=0.5..10)
height_mm_4 = Slider(50, range=1..500)
radius_mm_4 = Slider(30, range=5..200)

center_x_mm_3 = Slider(129.73, range=-500..500)
center_y_mm_3 = Slider(81.01, range=-500..500)
fine_adjust_z_mm_3 = Slider(1, range=-5..5)

# ----
center_x_mm_4 = Slider(107.35, range=-500..500)
center_y_mm_4 = Slider(70.33, range=-500..500)

# ---- group: DESIGN
# design: "slice" a cylinder
fine_adjust_z_mm_4 = Slider(2, range=-5..5)
slice_cylinder = SliceCylinder(
    radius=radius_mm_2,
    height=height_mm_2,
    layer_height=layer_height_mm_2,
    point_spacing=point_spacing_mm_2,
    center_x=center_x_mm_4,
    center_y=center_y_mm_4,
    fine_adjust_z=fine_adjust_z_mm_4,
    amp=Slider(2, range=0.5..2))  # -> layers; inputs amp: Double
# ---------- slice_cylinder: Python ----------
# r: compas
# venv: mas-2627
"""
Slice a cylinder into layers, in work object coordinates (Rhino world XY = work object).
One closed compas Polyline per layer. Units: mm.
center_x, center_y: where the cylinder stands on the work object.
fine_adjust_z: shifts all layers up/down, to tune the nozzle height above the bed (0 = first layer at z = 0).
"""
import math

from compas.geometry import Point
from compas.geometry import Polyline

# ===== How many layers, how many points per layer =====
layer_count = int(height / layer_height)
points_per_layer = round(2 * math.pi * radius / point_spacing)


# ===== One closed polyline per layer =====
layers = []
for i in range(layer_count):
    z = i * layer_height + fine_adjust_z

    points = []
    for j in range(points_per_layer + 1):  # one extra point: back to the start to close the ring
        if i == 0:
            angle = 2 * math.pi * (j % points_per_layer) / points_per_layer

            if  j % 2 == 0 or i % 2 == 0:
                current_radius = radius + amp 
            else:
                current_radius = radius - amp

            points.append(Point(
                center_x + 2 * current_radius * math.cos(angle), 
                center_y + 2 * current_radius * math.sin(angle), 
                z
            ))
        else:
            angle = 2 * math.pi * (j % points_per_layer) / points_per_layer

            if j % 2 == 0 or i % 2 == 0:
                current_radius = radius + amp 
            else:
                current_radius = radius - amp

            points.append(Point(
                center_x + current_radius * math.cos(angle), 
                center_y + current_radius * math.sin(angle), 
                z - layer_height
            ))

    layers.append(Polyline(points))
# ---------- end slice_cylinder ----------

# ---- group: amp + radius out + loops
# design: "slice" a cylinder
slice_cylinder_2 = SliceCylinder(
    radius=radius_mm,
    height=height_mm,
    layer_height=layer_height_mm,
    point_spacing=point_spacing_mm,
    center_x=center_x_mm,
    center_y=center_y_mm,
    fine_adjust_z=fine_adjust_z_mm,
    amp=Slider(3, range=0..10))  # -> layers; inputs amp: Double
# ---------- slice_cylinder_2: Python ----------
# r: compas
# venv: mas-2627
"""
Slice a cylinder into layers, in work object coordinates (Rhino world XY = work object).
One closed compas Polyline per layer. Units: mm.
center_x, center_y: where the cylinder stands on the work object.
fine_adjust_z: shifts all layers up/down, to tune the nozzle height above the bed (0 = first layer at z = 0).
"""
import math

from compas.geometry import Point
from compas.geometry import Polyline

# ===== How many layers, how many points per layer =====
layer_count = int(height / layer_height)
points_per_layer = round(2 * math.pi * radius / point_spacing)


# ===== One closed polyline per layer =====
layers = []
for i in range(layer_count):
    z = i * layer_height + fine_adjust_z

    points = []
    if i == 0:
        for j in range(points_per_layer + 1):  # one extra point: back to the start to close the ring
            angle = 2 * math.pi * (j % points_per_layer) / points_per_layer

            points.append(Point(
                center_x + 2 * radius * math.cos(angle), 
                center_y + 2 * radius * math.sin(angle), 
                z
            ))
        layers.append(Polyline(points))

    else:
        for j in range(points_per_layer + 1):
            angle = 2 * math.pi * (j % points_per_layer) / points_per_layer
            if (i+j ) % 5 == 0 and i % 7 == 0:
                points.append(Point(
                    center_x + (radius + amp)  * 1.15 * math.cos(angle), 
                    center_y + (radius + amp)  * 1.15 * math.sin(angle), 
                    z - layer_height 
            ))

            elif (i + j) % 2 == 0:
                points.append(Point(
                center_x +  (radius + amp) * math.cos(angle), 
                center_y +  (radius + amp) * math.sin(angle), 
                z
            ))

            else:
                points.append(Point(
                    center_x + (radius - amp) * math.cos(angle), 
                    center_y + (radius - amp) * math.sin(angle), 
                    z - layer_height
                ))

        layers.append(Polyline(points))



            # elif j // 4 == 0:
            #     points.append(Point(
            #         center_x + radius * 1.3 * math.cos(angle), 
            #         center_y + radius * 1.3 * math.sin(angle)), 
            #         z - layer_height + 10
            # ))
# ---------- end slice_cylinder_2 ----------

# ---- group: DESIGN
# design: "slice" a cylinder
slice_cylinder_3 = SliceCylinder(
    radius=radius_mm_3,
    height=height_mm_3,
    layer_height=layer_height_mm_3,
    point_spacing=point_spacing_mm_3,
    center_x=center_x_mm_2,
    center_y=center_y_mm_2,
    fine_adjust_z=fine_adjust_z_mm_2,
    amp=Slider(1.5, range=0.5..2))  # -> layers; inputs amp: Double
# ---------- slice_cylinder_3: Python ----------
# r: compas
# venv: mas-2627
"""
Slice a cylinder into layers, in work object coordinates (Rhino world XY = work object).
One closed compas Polyline per layer. Units: mm.
center_x, center_y: where the cylinder stands on the work object.
fine_adjust_z: shifts all layers up/down, to tune the nozzle height above the bed (0 = first layer at z = 0).
"""
import math

from compas.geometry import Point
from compas.geometry import Polyline

# ===== How many layers, how many points per layer =====
layer_count = int(height / layer_height)
points_per_layer = round(2 * math.pi * radius / point_spacing)


# ===== One closed polyline per layer =====
layers = []
for i in range(layer_count):
    z = i * layer_height + fine_adjust_z

    points = []
    for j in range(points_per_layer + 1):  # one extra point: back to the start to close the ring
        if i == 0:
            angle = 2 * math.pi * (j % points_per_layer) / points_per_layer

            if (i + j) % 2 == 0:
                current_radius = radius + amp 
            else:
                current_radius = radius - amp

            points.append(Point(
                center_x + 2 * current_radius * math.cos(angle), 
                center_y + 2 * current_radius * math.sin(angle), 
                z
            ))
        else:
            angle = 2 * math.pi * (j % points_per_layer) / points_per_layer

            if (i + j) % 2 == 0:
                current_radius = radius + amp 
            else:
                current_radius = radius - amp

            points.append(Point(
                center_x + current_radius * math.cos(angle), 
                center_y + current_radius * math.sin(angle), 
                z - layer_height
            ))

    layers.append(Polyline(points))
# ---------- end slice_cylinder_3 ----------

# design: "slice" a cylinder
slice_cylinder_4 = SliceCylinder(
    radius=radius_mm_4,
    height=height_mm_4,
    layer_height=layer_height_mm_4,
    point_spacing=point_spacing_mm_4,
    center_x=center_x_mm_3,
    center_y=center_y_mm_3,
    fine_adjust_z=fine_adjust_z_mm_3)  # -> layers
# ---------- slice_cylinder_4: Python ----------
# r: compas
# venv: mas-2627
"""
Slice a cylinder into layers, in work object coordinates (Rhino world XY = work object).
One closed compas Polyline per layer. Units: mm.
center_x, center_y: where the cylinder stands on the work object.
fine_adjust_z: shifts all layers up/down, to tune the nozzle height above the bed (0 = first layer at z = 0).
"""
import math

from compas.geometry import Point
from compas.geometry import Polyline

# ===== How many layers, how many points per layer =====
layer_count = int(height / layer_height)
points_per_layer = round(2 * math.pi * radius / point_spacing)

# ===== One closed polyline per layer =====
layers = []
for i in range(layer_count):
    z = i * layer_height + fine_adjust_z
    points = []
    if i == 0:
        for j in range(points_per_layer + 1):  # one extra point: back to the start to close the ring
            angle = 2 * math.pi * (j % points_per_layer) / points_per_layer
            points.append(Point(center_x + 2* radius * math.cos(angle), center_y + 2 *radius * math.sin(angle), z))
        layers.append(Polyline(points))
    else:
        for j in range(points_per_layer + 1):  # one extra point: back to the start to close the ring
            angle = 2 * math.pi * (j % points_per_layer) / points_per_layer
            points.append(Point(center_x + radius * math.cos(angle), center_y + radius * math.sin(angle), z - layer_height))

        layers.append(Polyline(points))
# ---------- end slice_cylinder_4 ----------

# ---- group: test_09.11.2026 - radius bulge + texture + amp
point_spacing_mm_5 = Slider(5, range=1..50)
layer_height_mm_5 = Slider(1.2, range=0.5..10)
height_mm_5 = Slider(60, range=1..500)
radius_mm_5 = Slider(30, range=5..200)

center_x_mm_5 = Slider(140, range=-500..500)
center_y_mm_5 = Slider(131, range=-500..500)
fine_adjust_z_mm_5 = Slider(1, range=-5..5)

# ---- group: test_09.11.2026 - radius bulge + texture
point_spacing_mm_6 = Slider(5, range=1..50)
layer_height_mm_6 = Slider(1.2, range=0.5..10)
height_mm_6 = Slider(50, range=1..500)
radius_mm_6 = Slider(30, range=5..200)

center_x_mm_6 = Slider(140, range=-500..500)
center_y_mm_6 = Slider(131, range=-500..500)
fine_adjust_z_mm_6 = Slider(1, range=-5..5)

# ---- group: test_09.11.2026
point_spacing_mm_7 = Slider(10, range=1..50)
layer_height_mm_7 = Slider(1.2, range=0.5..10)
height_mm_7 = Slider(50, range=1..500)
radius_mm_7 = Slider(30, range=5..200)

center_x_mm_7 = Slider(117.37, range=-500..500)
center_y_mm_7 = Slider(80.71, range=-500..500)
fine_adjust_z_mm_7 = Slider(0.8, range=-5..5)

# ---- group: test_09.11.2026 - radius bulge
point_spacing_mm_8 = Slider(16, range=1..50)
layer_height_mm_8 = Slider(1.2, range=0.5..10)
height_mm_8 = Slider(79.52, range=1..500)
radius_mm_8 = Slider(30, range=5..200)

center_x_mm_8 = Slider(140, range=-500..500)
center_y_mm_8 = Slider(131, range=-500..500)
fine_adjust_z_mm_8 = Slider(0.8, range=-5..5)

# ----
number_slider = Slider(1, range=0..10)
speed_mm_s = Slider(10, range=1..50)

# ---- group: test_09.11.2026 - radius bulge + texture + amp
# design: "slice" a cylinder
slice_cylinder_5 = SliceCylinder(
    radius=radius_mm_5,
    height=height_mm_5,
    layer_height=layer_height_mm_5,
    point_spacing=point_spacing_mm_5,
    center_x=center_x_mm_5,
    center_y=center_y_mm_5,
    fine_adjust_z=fine_adjust_z_mm_5,
    amp=Slider(3, range=0..10))  # -> layers
# ---------- slice_cylinder_5: Python ----------
# r: compas
# venv: mas-2627
"""
Slice a cylinder into layers, in work object coordinates (Rhino world XY = work object).
One closed compas Polyline per layer. Units: mm.
center_x, center_y: where the cylinder stands on the work object.
fine_adjust_z: shifts all layers up/down, to tune the nozzle height above the bed (0 = first layer at z = 0).
"""
import math

from compas.geometry import Point
from compas.geometry import Polyline

# ===== How many layers, how many points per layer =====
layer_count = int(height / layer_height)
points_per_layer = round(2 * math.pi * radius / point_spacing)


# ===== One closed polyline per layer =====
layers = []
for i in range(layer_count):
    z = i * layer_height + fine_adjust_z

    # defining angle by layer 
    twist_angle = i *(math.pi /48)

    t = i /layer_count

    current_radius  = radius - 6 * math.sin(t * math.pi)

    points = []
    if i == 0:
        for j in range(points_per_layer + 1):  # one extra point: back to the start to close the ring
            angle = 2 * math.pi * (j % points_per_layer) / points_per_layer

            points.append(Point(
                center_x + 2 * radius * math.cos(angle), 
                center_y + 2 * radius * math.sin(angle), 
                z
            ))
        layers.append(Polyline(points))

    else:
        for j in range(points_per_layer + 1):
            angle = 2 * math.pi * (j % points_per_layer / points_per_layer) + twist_angle 

            if (i+j) % 12 == 0:
                r = current_radius + amp *1.2
            elif (i+j) % 5 == 0:
                r = current_radius
            else:
                r = current_radius - amp

            points.append(Point(
                center_x + r * math.cos(angle), 
                center_y + r  * math.sin(angle), 
                z - layer_height 
            ))
        layers.append(Polyline(points))
# ---------- end slice_cylinder_5 ----------

# ---- group: test_09.11.2026 - radius bulge + texture
# design: "slice" a cylinder
slice_cylinder_6 = SliceCylinder(
    radius=radius_mm_6,
    height=height_mm_6,
    layer_height=layer_height_mm_6,
    point_spacing=point_spacing_mm_6,
    center_x=center_x_mm_6,
    center_y=center_y_mm_6,
    fine_adjust_z=fine_adjust_z_mm_6,
    amp=Slider(3, range=0..10))  # -> layers
# ---------- slice_cylinder_6: Python ----------
# r: compas
# venv: mas-2627
"""
Slice a cylinder into layers, in work object coordinates (Rhino world XY = work object).
One closed compas Polyline per layer. Units: mm.
center_x, center_y: where the cylinder stands on the work object.
fine_adjust_z: shifts all layers up/down, to tune the nozzle height above the bed (0 = first layer at z = 0).
"""
import math

from compas.geometry import Point
from compas.geometry import Polyline

# ===== How many layers, how many points per layer =====
layer_count = int(height / layer_height)
points_per_layer = round(2 * math.pi * radius / point_spacing)


# ===== One closed polyline per layer =====
layers = []
for i in range(layer_count):
    z = i * layer_height + fine_adjust_z

    # defining angle by layer 
    twist_angle = i *(math.pi /48)

    t = i /layer_count

    current_radius  = radius + 10 * math.sin(t * math.pi)

    points = []
    if i == 0:
        for j in range(points_per_layer + 1):  # one extra point: back to the start to close the ring
            angle = 2 * math.pi * (j % points_per_layer) / points_per_layer

            points.append(Point(
                center_x + 2 * radius * math.cos(angle), 
                center_y + 2 * radius * math.sin(angle), 
                z
            ))
        layers.append(Polyline(points))

    else:
        for j in range(points_per_layer + 1):
            angle = 2 * math.pi * (j % points_per_layer / points_per_layer) + twist_angle 

            if (i+j) % 11 == 0:
                r = radius + amp *1.2
            elif (i+j) % 5 == 0:
                r = radius
            else:
                r = radius - amp

            points.append(Point(
                center_x + r * math.cos(angle), 
                center_y + r  * math.sin(angle), 
                z - layer_height 
            ))
        layers.append(Polyline(points))
# ---------- end slice_cylinder_6 ----------

# ---- group: test_09.11.2026
# design: "slice" a cylinder
slice_cylinder_7 = SliceCylinder(
    radius=radius_mm_7,
    height=height_mm_7,
    layer_height=layer_height_mm_7,
    point_spacing=point_spacing_mm_7,
    center_x=center_x_mm_7,
    center_y=center_y_mm_7,
    fine_adjust_z=fine_adjust_z_mm_7,
    amp=number_slider)  # -> layers; inputs amp: Double
# ---------- slice_cylinder_7: Python ----------
# r: compas
# venv: mas-2627
"""
Slice a cylinder into layers, in work object coordinates (Rhino world XY = work object).
One closed compas Polyline per layer. Units: mm.
center_x, center_y: where the cylinder stands on the work object.
fine_adjust_z: shifts all layers up/down, to tune the nozzle height above the bed (0 = first layer at z = 0).
"""
import math

from compas.geometry import Point
from compas.geometry import Polyline

# ===== How many layers, how many points per layer =====
layer_count = int(height / layer_height)
points_per_layer = round(2 * math.pi * radius / point_spacing)


# ===== One closed polyline per layer =====
layers = []
for i in range(layer_count):
    z = i * layer_height + fine_adjust_z

    # defining angle by layer 
    twist_angle = i *(math.pi /72)

    points = []
    if i == 0:
        for j in range(points_per_layer + 1):  # one extra point: back to the start to close the ring
            angle = 2 * math.pi * (j % points_per_layer) / points_per_layer

            points.append(Point(
                center_x + 2 * radius * math.cos(angle), 
                center_y + 2 * radius * math.sin(angle), 
                z
            ))
        layers.append(Polyline(points))

    else:
        for j in range(points_per_layer + 1):
            angle = 2 * math.pi * (j % points_per_layer / points_per_layer) + twist_angle 

            points.append(Point(
                center_x + radius *1.2 * math.cos(angle), 
                center_y + radius *1.2 * math.sin(angle), 
                z - layer_height + 6
            ))
        layers.append(Polyline(points))
# ---------- end slice_cylinder_7 ----------

# ---- group: test_09.11.2026 - radius bulge
# design: "slice" a cylinder
slice_cylinder_8 = SliceCylinder(
    radius=radius_mm_8,
    height=height_mm_8,
    layer_height=layer_height_mm_8,
    point_spacing=point_spacing_mm_8,
    center_x=center_x_mm_8,
    center_y=center_y_mm_8,
    fine_adjust_z=fine_adjust_z_mm_8)  # -> layers
# ---------- slice_cylinder_8: Python ----------
# r: compas
# venv: mas-2627
"""
Slice a cylinder into layers, in work object coordinates (Rhino world XY = work object).
One closed compas Polyline per layer. Units: mm.
center_x, center_y: where the cylinder stands on the work object.
fine_adjust_z: shifts all layers up/down, to tune the nozzle height above the bed (0 = first layer at z = 0).
"""
import math

from compas.geometry import Point
from compas.geometry import Polyline

# ===== How many layers, how many points per layer =====
layer_count = int(height / layer_height)
points_per_layer = round(2 * math.pi * radius / point_spacing)


# ===== One closed polyline per layer =====
layers = []
for i in range(layer_count):
    z = i * layer_height + fine_adjust_z

    # defining angle by layer 
    twist_angle = i *(math.pi /48)

    t = i /layer_count
    current_radius  = radius + 10 * math.sin(t * math.pi)

    points = []
    if i == 0:
        for j in range(points_per_layer + 1):  # one extra point: back to the start to close the ring
            angle = 2 * math.pi * (j % points_per_layer) / points_per_layer

            points.append(Point(
                center_x + 2 * radius * math.cos(angle), 
                center_y + 2 * radius * math.sin(angle), 
                z
            ))
        layers.append(Polyline(points))

    else:
        for j in range(points_per_layer + 1):
            angle = 2 * math.pi * (j % points_per_layer / points_per_layer) + twist_angle 

            points.append(Point(
                center_x + current_radius * math.cos(angle), 
                center_y + current_radius  * math.sin(angle), 
                z - layer_height 
            ))
        layers.append(Polyline(points))
# ---------- end slice_cylinder_8 ----------

# ----
slice_cylinder_9 = SliceCylinder(
    radius=radius_mm_7,
    height=height_mm_7,
    layer_height=layer_height_mm_7,
    point_spacing=point_spacing_mm_7,
    center_x=center_x_mm_7,
    center_y=center_y_mm_7,
    fine_adjust_z=fine_adjust_z_mm_7,
    amp=number_slider)  # -> layers; inputs amp: Double
# ---------- slice_cylinder_9: Python ----------
# r: compas
# venv: mas-2627
"""
Slice a cylinder into layers, in work object coordinates (Rhino world XY = work object).
One closed compas Polyline per layer. Units: mm.
center_x, center_y: where the cylinder stands on the work object.
fine_adjust_z: shifts all layers up/down, to tune the nozzle height above the bed (0 = first layer at z = 0).
"""
import math

from compas.geometry import Point
from compas.geometry import Polyline

# ===== How many layers, how many points per layer =====
layer_count = int(height / layer_height)
points_per_layer = round(2 * math.pi * radius / point_spacing)


# ===== One closed polyline per layer =====
layers = []
for i in range(layer_count):
    z = i * layer_height + fine_adjust_z

    # defining angle by layer 
    twist_angle = i *(math.pi /72)

    points = []
    if i == 0:
        for j in range(points_per_layer + 1):  # one extra point: back to the start to close the ring
            angle = 2 * math.pi * (j % points_per_layer) / points_per_layer

            points.append(Point(
                center_x + 2 * radius * math.cos(angle), 
                center_y + 2 * radius * math.sin(angle), 
                z
            ))
        layers.append(Polyline(points))

    else:
        for j in range(points_per_layer + 1):
            if (j + i *5) % 10 == 0 and i > 4:
                angle = 2 * math.pi * (j % points_per_layer / points_per_layer) + twist_angle 

                points.append(Point(
                    center_x + radius *1.15 * math.cos(angle), 
                    center_y + radius *1.15 * math.sin(angle), 
                    z - layer_height + (i*0.3)
                ))
            else:
                angle = 2 * math.pi * (j % points_per_layer / points_per_layer) + twist_angle 

                points.append(Point(
                    center_x + radius * math.cos(angle), 
                    center_y + radius * math.sin(angle), 
                    z - layer_height 
                ))

        layers.append(Polyline(points))
# ---------- end slice_cylinder_9 ----------

# ---- group: PRINTPATH
# generate printpath: printpoints and path
safety_distance_mm = Slider(100, range=10..300)
blend_radius_mm = Slider(0.5, range=0..5)
speed_mm_s_2 = Slider(5, range=1..50)
printpath = Printpath(
    layers=slice_cylinder_9,
    speed1=speed_mm_s_2,
    speed2=speed_mm_s,
    blend_radius=blend_radius_mm,
    safety_distance=safety_distance_mm)  # -> printpath, summary; inputs layers: list
# ---------- printpath: Python ----------
# r: compas
# venv: mas-2627
"""
Turn the layers into printpoints and a PrintPath, in work object coordinates.
Safety points are added here, before any transform to the robot base.
"""
import os
import sys

from compas.geometry import Frame, Vector


# Find source folder
gh_dir = os.path.dirname(ghenv.Component.OnPingDocument().FilePath)
src_dir = os.path.join(gh_dir, "..", "..", "src")
if src_dir not in sys.path:
    sys.path.append(src_dir)
from print_class import PrintPoint, PrintPath

# ===== One printpoint per point =====
# world XY orientation for every point: a tangent frame would turn the wrist 360 degrees each layer
printpoints = []
for layer_index, layer in enumerate(layers):
    for j ,point in enumerate(layer.points):

        if (layer_index +j) % 5 == 0:
            speed = speed1
        else:
            speed = speed2

        frame = Frame(point, -Vector.Xaxis(), Vector.Yaxis())
        printpoints.append(PrintPoint(frame, layer_index, speed, blend_radius, True))

# ===== Path with a travel point above the start and the end =====
printpath = PrintPath(printpoints)
printpath.add_safety_before(safety_distance, speed1)
printpath.add_safety_after(safety_distance, speed1)

summary = f"{len(printpoints)} printpoints in {len(layers)} layers, plus 2 safety points"
# ---------- end printpath ----------
panel = Panel(printpath.summary)

# ---- group: EXPORT
# export: preview and save
panel_2 = Panel("data/out_printpoints.json")
save = Button()
preview = Preview(printpath=printpath.printpath)  # -> path, travel, planes
# ---------- preview: Python ----------
# r: compas
# venv: mas-2627
"""
Draw the printpath: path = the whole polyline, travel = extruder-off segments,
safety = extruder-off points, axes = small x and y axis of each frame.
"""
import Rhino.Geometry as rg
from compas_rhino.conversions import frame_to_rhino_plane, point_to_rhino

AXIS_LENGTH = 5.0  # mm

points = printpath.printpoints
planes = [frame_to_rhino_plane(printpoint.frame) for printpoint in points]

# ===== Whole path =====
polyline = rg.Polyline()
for plane in planes:
    polyline.Add(plane.Origin.X, plane.Origin.Y, plane.Origin.Z)
path = polyline.ToPolylineCurve()

# ===== Extruder off: a segment prints only if both of its points have the extruder on =====
safety = [point_to_rhino(printpoint.frame.point) for printpoint in points if not printpoint.is_extruder_on]
travel = []
for i in range(len(points) - 1):
    if not (points[i].is_extruder_on and points[i + 1].is_extruder_on):
        travel.append(rg.Line(planes[i].Origin, planes[i + 1].Origin))
# ---------- end preview ----------
save_2 = Save(printpath=printpath.printpath, save=save, out_path=panel_2)  # -> status
# ---------- save_2: Python ----------
# r: compas
# venv: mas-2627
"""
On button press, write the printpath to data/out_printpoints.json next to this .ghx file.
send_to_robot.py reads that file.
"""
import json
import os

import scriptcontext as sc

gh_dir = os.path.dirname(ghenv.Component.OnPingDocument().FilePath)

# keep the last status in sticky, so the message survives the button being released
status_key = "save_status_" + str(ghenv.Component.InstanceGuid)

if save:
    if printpath is None:
        sc.sticky[status_key] = "nothing to save: no printpath"
    else:
        path = os.path.normpath(os.path.join(gh_dir, out_path))
        os.makedirs(os.path.dirname(path), exist_ok=True)
        with open(path, "w") as f:
            json.dump(printpath.to_dict(), f, indent=2)
        sc.sticky[status_key] = f"saved {len(printpath)} printpoints to {path}"

status = sc.sticky.get(status_key, "")
ghenv.Component.Message = "saved" if status.startswith("saved") else status
# ---------- end save_2 ----------
panel_3 = Panel(save_2)
preview_2 = CustomPreview(Geometry=preview.travel, Material=ColourSwatch(SwatchColor=RGB(230, 40, 40)))
preview_3 = CustomPreview(Geometry=preview.path, Material=ColourSwatch(SwatchColor=RGB(0, 170, 80)))

# ----
plane = Plane(preview.planes)
