# Grasshopper definition design_nikitha_20261112_numpy.gh (Grasshopper 1.0.8)

# ---- group: try numpy
point_spacing_mm = Slider(1, range=-1..50)
layer_height_mm = Slider(1.2, range=0.5..10)
height_mm = Slider(90, range=1..500)
radius_mm = Slider(30, range=5..200)

center_x_mm = Slider(140, range=-500..500)
center_y_mm = Slider(131, range=-500..500)
fine_adjust_z_mm = Slider(-0.5, range=-5..5)

# ---- group: twist + layers
point_spacing_mm_2 = Slider(2, range=-1..50)
layer_height_mm_2 = Slider(1.2, range=0.5..10)
height_mm_2 = Slider(90, range=1..500)
radius_mm_2 = Slider(30, range=5..200)

center_x_mm_2 = Slider(140, range=-500..500)
center_y_mm_2 = Slider(131, range=-500..500)
fine_adjust_z_mm_2 = Slider(1, range=-5..5)

# ---- group: This is needed only ONCE in the GH definition
enable_auto_reload = Python3Script()  # -> ok
# ---------- enable_auto_reload: Python ----------
"""
------------------------------
Using VS Code as Python editor
------------------------------

The simplest way to start using VS Code as our editor, is
to place our Python code in files located IN THE SAME FOLDER as our Grasshopper file.

After we have done that, we need 2 steps: 

1. Enable the COMPAS reloader on one component. This tells Grasshopper to watch for changes in the Pythoh files and reload if changed.
2. Every other component that uses Python code from external files needs to start with a method to ensure Grasshopper knows where to load the files from.

"""
# r: compas
# venv: mas-2627

from compas_rhino.devtools import DevTools
DevTools.enable_reloader()
# ---------- end enable_auto_reload ----------

# ---- group: sin+cos+ amp loops
point_spacing_mm_3 = Slider(1, range=-1..50)
layer_height_mm_3 = Slider(1.2, range=0.5..10)
height_mm_3 = Slider(90, range=1..500)
radius_mm_3 = Slider(30, range=5..200)

center_x_mm_3 = Slider(140, range=-500..500)
center_y_mm_3 = Slider(131, range=-500..500)
fine_adjust_z_mm_3 = Slider(-0.5, range=-5..5)

# design: "slice" a cylinder
slice_cylinder = SliceCylinder(
    radius=radius_mm_3,
    height=height_mm_3,
    layer_height=layer_height_mm_3,
    point_spacing=point_spacing_mm_3,
    center_x=center_x_mm_3,
    center_y=center_y_mm_3,
    fine_adjust_z=fine_adjust_z_mm_3,
    amp=Slider(5, range=0..10))  # -> layers
# ---------- slice_cylinder: Python ----------
# r: compas
# venv: mas-2627
"""
Slice a cylinder into layers, in work object coordinates (Rhino world XY = work object).
One closed compas Polyline per layer. Units: mm.
center_x, center_y: where the cylinder stands on the work object.
fine_adjust_z: shifts all layers up/down, to tune the nozzle height above the bed (0 = first layer at z = 0).
"""
import math

from compas.geometry import Point
from compas.geometry import Polyline

# ===== How many layers, how many points per layer =====
layer_count = int(height / layer_height)
points_per_layer = round(2 * math.pi * radius / point_spacing)


# ===== One closed polyline per layer =====
layers = []
for i in range(layer_count):
    z = i * layer_height + fine_adjust_z

    # defining angle by layer 
    twist_angle = i *(math.pi /36)

    t = i /layer_count

    current_radius  = radius +(8 * math.sin(t * math.pi)) + (6 * math.cos(t * math.pi *4))

    points = []
    if i == 0:
        for j in range(points_per_layer + 1):  # one extra point: back to the start to close the ring
            angle = 2 * math.pi * (j % points_per_layer) / points_per_layer

            points.append(Point(
                center_x + 2 * radius * math.cos(angle), 
                center_y + 2 * radius * math.sin(angle), 
                z
            ))
        layers.append(Polyline(points))

    elif i % 2 == 0:
        for j in range(points_per_layer + 1):
            angle = 2 * math.pi * (j % points_per_layer / points_per_layer) 

            if (i+j) % 16 == 0:
                r = current_radius + amp *(0.08*i)
            elif j % 6 == 0:
                r = current_radius + amp
            else:
                r = current_radius

            points.append(Point(
                center_x + r * math.cos(angle), 
                center_y + r  * math.sin(angle), 
                z - layer_height 
            ))
        layers.append(Polyline(points)) 
    else:
        for j in range(points_per_layer + 1):
            angle = 2 * math.pi * (j % points_per_layer / points_per_layer) 
            r = current_radius
            points.append(Point(
                center_x + r * math.cos(angle), 
                center_y + r  * math.sin(angle), 
                z - layer_height 
            ))
        layers.append(Polyline(points))
# ---------- end slice_cylinder ----------

# ---- group: try numpy
# design: "slice" a cylinder
slice_cylinder_2 = SliceCylinder(
    radius=radius_mm,
    height=height_mm,
    layer_height=layer_height_mm,
    point_spacing=point_spacing_mm,
    center_x=center_x_mm,
    center_y=center_y_mm,
    fine_adjust_z=fine_adjust_z_mm,
    amp=Slider(8, range=0..10),
    freq=Slider(4, range=0..10))  # -> layers
# ---------- slice_cylinder_2: Python ----------
# r: compas
# venv: mas-2627
"""
Slice a cylinder into layers, in work object coordinates (Rhino world XY = work object).
One closed compas Polyline per layer. Units: mm.
center_x, center_y: where the cylinder stands on the work object.
fine_adjust_z: shifts all layers up/down, to tune the nozzle height above the bed (0 = first layer at z = 0).
"""
import math

from compas.geometry import Point
from compas.geometry import Polyline
import numpy as np 

# layers and points per layer 
layer_count = int(height/layer_height)
points_per_layer = round(2 * np.pi * radius / point_spacing)

# numpy to generate angles
angle = np.linspace(0, 2 * np.pi, points_per_layer + 1)



# polyline per layer 
layers = []
for i in range(layer_count):
    z = i * layer_height + fine_adjust_z

    # adding twist 
    twist_angle = i *(math.pi/24)

    # normalised height for radius variation
    t = i/ layer_count
    # for bulging radius in the middle 
    current_radius = radius + (8 * math.sin(t * math.pi * 3)) + (8 * math.cos(t * math.pi * 4)) 

    # for outer shape 
    if i == 0: 
        r  = radius *2
        xs_out = center_x + r * np.cos(angle)
        ys_out = center_y + r * np.sin(angle)

        points_out = [Point(xs_out[j], ys_out[j], z) for j in range(len(angle))]
        layers.append(Polyline(points_out))

    else:

        # wave for amplitude and freq
        wave = amp  * np.sin((freq *1.5) *angle + twist_angle) 
        r = current_radius + wave
        xs = center_x + r * np.cos(angle)
        ys = center_y + r * np.sin(angle)

        points = [Point(xs[j], ys[j], z - layer_height) for j in range(len(angle))]
        layers.append(Polyline(points))
# ---------- end slice_cylinder_2 ----------

# ---- group: twist + layers
# design: "slice" a cylinder
slice_cylinder_3 = SliceCylinder(
    radius=radius_mm_2,
    height=height_mm_2,
    layer_height=layer_height_mm_2,
    point_spacing=point_spacing_mm_2,
    center_x=center_x_mm_2,
    center_y=center_y_mm_2,
    fine_adjust_z=fine_adjust_z_mm_2,
    amp=Slider(3, range=0..10))  # -> layers
# ---------- slice_cylinder_3: Python ----------
# r: compas
# venv: mas-2627
"""
Slice a cylinder into layers, in work object coordinates (Rhino world XY = work object).
One closed compas Polyline per layer. Units: mm.
center_x, center_y: where the cylinder stands on the work object.
fine_adjust_z: shifts all layers up/down, to tune the nozzle height above the bed (0 = first layer at z = 0).
"""
import math

from compas.geometry import Point
from compas.geometry import Polyline

# ===== How many layers, how many points per layer =====
layer_count = int(height / layer_height)
points_per_layer = round(2 * math.pi * radius / point_spacing)


# ===== One closed polyline per layer =====
layers = []
for i in range(layer_count):
    z = i * layer_height + fine_adjust_z

    # defining angle by layer 
    twist_angle = i *(math.pi /90)

    t = i /layer_count

    current_radius  = radius +(5 * math.sin(t * math.pi *5 )) - (5 * math.cos(t * math.pi *5))

    points = []
    if i == 0:
        for j in range(points_per_layer + 1):  # one extra point: back to the start to close the ring
            angle = 2 * math.pi * j / points_per_layer

            points.append(Point(
                center_x + 2 * radius * math.cos(angle), 
                center_y + 2 * radius * math.sin(angle), 
                z
            ))
        layers.append(Polyline(points))

    else:
        for j in range(points_per_layer + 1):
            angle = 2 * math.pi * j /points_per_layer + twist_angle

            if j % 10 == 0 and  i > 40 :
                r = current_radius + amp *0.08*i
            elif j % 5 == 0 and i < 30 :
                r = current_radius + amp *3
            else:
                r = current_radius 

            points.append(Point(
                center_x + r * math.cos(angle), 
                center_y + r  * math.sin(angle), 
                z - layer_height 
            ))
        layers.append(Polyline(points))
# ---------- end slice_cylinder_3 ----------

# ----
speed_mm_s = Slider(10, range=1..50)

# ---- group: PRINTPATH
# generate printpath: printpoints and path
safety_distance_mm = Slider(100, range=10..300)
blend_radius_mm = Slider(0.5, range=0..5)
speed_mm_s_2 = Slider(10, range=1..50)
printpath = Printpath(
    layers=slice_cylinder_2,
    speed1=speed_mm_s_2,
    speed2=speed_mm_s,
    blend_radius=blend_radius_mm,
    safety_distance=safety_distance_mm)  # -> printpath, summary; inputs layers: list
# ---------- printpath: Python ----------
# r: compas
# venv: mas-2627
"""
Turn the layers into printpoints and a PrintPath, in work object coordinates.
Safety points are added here, before any transform to the robot base.
"""
import os
import sys

from compas.geometry import Frame, Vector


# Find source folder
gh_dir = os.path.dirname(ghenv.Component.OnPingDocument().FilePath)
src_dir = os.path.join(gh_dir, "..", "..", "src")
if src_dir not in sys.path:
    sys.path.append(src_dir)
from print_class import PrintPoint, PrintPath

# ===== One printpoint per point =====
# world XY orientation for every point: a tangent frame would turn the wrist 360 degrees each layer
printpoints = []
for layer_index, layer in enumerate(layers):
    for j ,point in enumerate(layer.points): 

        if (layer_index +j) % 5 == 0:
            speed = speed1
        else:
            speed = speed2

        frame = Frame(point, -Vector.Xaxis(), Vector.Yaxis())
        printpoints.append(PrintPoint(frame, layer_index, speed, blend_radius, True))

# ===== Path with a travel point above the start and the end =====
printpath = PrintPath(printpoints)
printpath.add_safety_before(safety_distance, speed1)
printpath.add_safety_after(safety_distance, speed1)

summary = f"{len(printpoints)} printpoints in {len(layers)} layers, plus 2 safety points"
# ---------- end printpath ----------
panel = Panel(printpath.summary)

# ---- group: EXPORT
# export: preview and save
panel_2 = Panel("data/out_printpoints.json")
save = Button()
preview = Preview(printpath=printpath.printpath)  # -> path, travel, planes
# ---------- preview: Python ----------
# r: compas
# venv: mas-2627
"""
Draw the printpath: path = the whole polyline, travel = extruder-off segments,
safety = extruder-off points, axes = small x and y axis of each frame.
"""
import Rhino.Geometry as rg
from compas_rhino.conversions import frame_to_rhino_plane, point_to_rhino

AXIS_LENGTH = 5.0  # mm

points = printpath.printpoints
planes = [frame_to_rhino_plane(printpoint.frame) for printpoint in points]

# ===== Whole path =====
polyline = rg.Polyline()
for plane in planes:
    polyline.Add(plane.Origin.X, plane.Origin.Y, plane.Origin.Z)
path = polyline.ToPolylineCurve()

# ===== Extruder off: a segment prints only if both of its points have the extruder on =====
safety = [point_to_rhino(printpoint.frame.point) for printpoint in points if not printpoint.is_extruder_on]
travel = []
for i in range(len(points) - 1):
    if not (points[i].is_extruder_on and points[i + 1].is_extruder_on):
        travel.append(rg.Line(planes[i].Origin, planes[i + 1].Origin))
# ---------- end preview ----------
save_2 = Save(printpath=printpath.printpath, save=save, out_path=panel_2)  # -> status
# ---------- save_2: Python ----------
# r: compas
# venv: mas-2627
"""
On button press, write the printpath to data/out_printpoints.json next to this .ghx file.
send_to_robot.py reads that file.
"""
import json
import os

import scriptcontext as sc

gh_dir = os.path.dirname(ghenv.Component.OnPingDocument().FilePath)

# keep the last status in sticky, so the message survives the button being released
status_key = "save_status_" + str(ghenv.Component.InstanceGuid)

if save:
    if printpath is None:
        sc.sticky[status_key] = "nothing to save: no printpath"
    else:
        path = os.path.normpath(os.path.join(gh_dir, out_path))
        os.makedirs(os.path.dirname(path), exist_ok=True)
        with open(path, "w") as f:
            json.dump(printpath.to_dict(), f, indent=2)
        sc.sticky[status_key] = f"saved {len(printpath)} printpoints to {path}"

status = sc.sticky.get(status_key, "")
ghenv.Component.Message = "saved" if status.startswith("saved") else status
# ---------- end save_2 ----------
panel_3 = Panel(save_2)
preview_2 = CustomPreview(Geometry=preview.travel, Material=ColourSwatch(SwatchColor=RGB(230, 40, 40)))
preview_3 = CustomPreview(Geometry=preview.path, Material=ColourSwatch(SwatchColor=RGB(0, 170, 80)))

# ----
plane = Plane(preview.planes)
