# Grasshopper definition design_viz.gh (Grasshopper 1.0.8)

# ---- group: This is needed only ONCE in the GH definition
enable_auto_reload = Python3Script()  # -> ok
# ---------- enable_auto_reload: Python ----------
"""
------------------------------
Using VS Code as Python editor
------------------------------

The simplest way to start using VS Code as our editor, is
to place our Python code in files located IN THE SAME FOLDER as our Grasshopper file.

After we have done that, we need 2 steps: 

1. Enable the COMPAS reloader on one component. This tells Grasshopper to watch for changes in the Pythoh files and reload if changed.
2. Every other component that uses Python code from external files needs to start with a method to ensure Grasshopper knows where to load the files from.

"""
# r: compas
# venv: mas-2627

from compas_rhino.devtools import DevTools
DevTools.enable_reloader()
# ---------- end enable_auto_reload ----------

# ---- group: DESIGN
radius_top_mm = Slider(25, range=5..200)
bulge_mm = Slider(10, range=-50..50)
wave_amp_mm = Slider(4, range=0..20)
twist_deg = Slider(20, range=-360..360)
wave_freq = Slider(10, range=0..12)
height_mm = Slider(50, range=1..500)
radius_mm = Slider(20, range=5..200)

point_spacing_mm = Slider(3, range=1..50)
layer_height_mm = Slider(1.2, range=0.5..10)

point_spacing_mm_2 = Slider(5, range=1..50)
layer_height_mm_2 = Slider(1.2, range=0.5..10)

fine_adjust_z_mm = Slider(-0.5, range=-5..5)
center_x_mm = Slider(150, range=-500..500)
center_y_mm = Slider(150, range=-500..500)

fine_adjust_z_mm_2 = Slider(-0.5, range=-5..5)
center_y_mm_2 = Slider(150, range=-500..500)
center_x_mm_2 = Slider(150, range=-500..500)

# ----
brep = Brep(<brep referenced from the Rhino model>)

# ---- group: DESIGN
# classic slicing
slice_brep = SliceBrep(brep=brep, layer_height=layer_height_mm_2, point_spacing=point_spacing_mm_2, fine_adjust_z=fine_adjust_z_mm_2)  # -> layers; inputs brep: Brep
# ---------- slice_brep: Python ----------
# r: compas
# venv: mas-2627
"""
Slice a brep into layers, in work object coordinates (Rhino world XY = work object).
One closed compas Polyline per layer, same as slice cylinder. Units: mm.
The bottom of the brep is placed on the bed: first layer at z = 0, plus fine_adjust_z.
"""
import Rhino
import Rhino.Geometry as rg
from Rhino.Geometry.Intersect import Intersection
from compas.geometry import Point
from compas.geometry import Polyline

tolerance = Rhino.RhinoDoc.ActiveDoc.ModelAbsoluteTolerance
box = brep.GetBoundingBox(True)
layer_count = int((box.Max.Z - box.Min.Z) / layer_height)

layers = []
for i in range(layer_count):
    # ===== Cut the brep in the middle of the layer, keep the longest curve =====
    z_cut = box.Min.Z + (i + 0.5) * layer_height
    ok, curves, points = Intersection.BrepPlane(brep, rg.Plane(rg.Point3d(0, 0, z_cut), rg.Vector3d.ZAxis), tolerance)
    curves = rg.Curve.JoinCurves(curves)
    if not curves:
        continue
    contour = max(curves, key=lambda curve: curve.GetLength())

    # ===== Same direction and same seam (on the +x side) on every layer =====
    if contour.ClosedCurveOrientation(rg.Plane.WorldXY) == rg.CurveOrientation.Clockwise:
        contour.Reverse()
    ok, t = contour.ClosestPoint(rg.Point3d(box.Max.X + 1000, box.Center.Y, z_cut))
    contour.ChangeClosedCurveSeam(t)

    # ===== Points every point_spacing, closed: back to the start =====
    count = round(contour.GetLength() / point_spacing)
    z = i * layer_height + fine_adjust_z
    points = [Point(p.X, p.Y, z) for p in (contour.PointAt(t) for t in contour.DivideByCount(count, True))]


    layers.append(Polyline(points + [points[0]]))
# ---------- end slice_brep ----------

# design: tor alva style
interpolated_column = InterpolatedColumn(
    radius=radius_mm,
    radius_top=radius_top_mm,
    height=height_mm,
    bulge=bulge_mm,
    wave_amp=wave_amp_mm,
    wave_freq=wave_freq,
    twist=twist_deg,
    layer_height=layer_height_mm,
    point_spacing=point_spacing_mm,
    center_x=center_x_mm,
    center_y=center_y_mm,
    fine_adjust_z=fine_adjust_z_mm)  # -> layers
# ---------- interpolated_column: Python ----------
# r: compas
# venv: mas-2627
import math

from compas.geometry import Point
from compas.geometry import Polyline


def get_radius(angle, t):
    # base radius to top radius, plus a bulge in the middle, plus a wave that twists up the column
    r = radius * (1 - t) + radius_top * t
    r += bulge * math.sin(math.pi * t)
    r += wave_amp * math.cos(wave_freq * (angle + math.radians(twist) * t))
    return r


# ===== How many layers, how many points per layer =====
layer_count = int(height / layer_height)
points_per_layer = round(2 * math.pi * radius / point_spacing)

# ===== One closed polyline per layer =====
layers = []
for i in range(layer_count):
    z = i * layer_height + fine_adjust_z
    t = i * layer_height / height  # 0 at the bottom, close to 1 at the top
    points = []
    for j in range(points_per_layer + 1):  # one extra point: back to the start to close the ring
        angle = 2 * math.pi * (j % points_per_layer) / points_per_layer
        r = get_radius(angle, t)
        if j % 4 == 0 and i % 5 == 0:
            points.append(Point(center_x + r * 1.5 * math.cos(angle), center_y + r * 1.5 * math.sin(angle), z))
        else:
            points.append(Point(center_x + r * math.cos(angle), center_y + r * math.sin(angle), z))
    layers.append(Polyline(points))
# ---------- end interpolated_column ----------

# ---- group: PRINTPATH
# generate printpath: printpoints and path
safety_distance_mm = Slider(100, range=10..300)
blend_radius_mm = Slider(0.5, range=0..5)
speed_mm_s = Slider(10, range=1..50)
printpath = Printpath(layers=interpolated_column, speed=speed_mm_s, blend_radius=blend_radius_mm, safety_distance=safety_distance_mm)  # -> printpath, summary; inputs layers: list
# ---------- printpath: Python ----------
# r: compas
# venv: mas-2627
"""
Turn the layers into printpoints and a PrintPath, in work object coordinates.
Safety points are added here, before any transform to the robot base.
"""
import os
import sys

from compas.geometry import Frame, Vector


# Find source folder
gh_dir = os.path.dirname(ghenv.Component.OnPingDocument().FilePath)
src_dir = os.path.join(gh_dir, "..", "..", "src")
if src_dir not in sys.path:
    sys.path.append(src_dir)
from print_class import PrintPoint, PrintPath

# ===== One printpoint per point =====
# world XY orientation for every point: a tangent frame would turn the wrist 360 degrees each layer
printpoints = []
for layer_index, layer in enumerate(layers):
    for point in layer.points:
        frame = Frame(point, -Vector.Xaxis(), Vector.Yaxis())
        printpoints.append(PrintPoint(frame, layer_index, speed, blend_radius, True))

# ===== Path with a travel point above the start and the end =====
printpath = PrintPath(printpoints)

printpath.printpoints[0].speed *= 2
printpath.add_safety_before(safety_distance, speed*2)
printpath.add_safety_after(safety_distance, speed*2)

summary = f"{len(printpoints)} printpoints in {len(layers)} layers, plus 2 safety points"
# ---------- end printpath ----------
panel = Panel(printpath.summary)

# ---- group: DISPLAY: check before you print
# export: preview and save
panel_2 = Panel("data/out_printpoints.json")
mode = ValueList({"speed": 0, "overhang": 1}, selected="overhang")
save = Button()
save_2 = Save(printpath=printpath.printpath, save=save, out_path=panel_2)  # -> status
# ---------- save_2: Python ----------
# r: compas
# venv: mas-2627
"""
On button press, write the printpath to data/out_printpoints.json next to this .ghx file.
send_to_robot.py reads that file.
"""
import json
import os

import scriptcontext as sc

gh_dir = os.path.dirname(ghenv.Component.OnPingDocument().FilePath)

# keep the last status in sticky, so the message survives the button being released
status_key = "save_status_" + str(ghenv.Component.InstanceGuid)

if save:
    if printpath is None:
        sc.sticky[status_key] = "nothing to save: no printpath"
    else:
        path = os.path.normpath(os.path.join(gh_dir, out_path))
        os.makedirs(os.path.dirname(path), exist_ok=True)
        with open(path, "w") as f:
            json.dump(printpath.to_dict(), f, indent=2)
        sc.sticky[status_key] = f"saved {len(printpath)} printpoints to {path}"

status = sc.sticky.get(status_key, "")
ghenv.Component.Message = "saved" if status.startswith("saved") else status
# ---------- end save_2 ----------
check = Check(printpath=printpath.printpath, mode=mode)  # -> beads, values, low, high, param_range, report
# ---------- check: Python ----------
# r: compas
# venv: mas-2627
import math

import Rhino.Geometry as rg
from compas.geometry import closest_point_on_polyline_xy
from compas.geometry import distance_point_point_xy

MODES = ["speed", "overhang"]

mode = int(mode) if mode is not None else 0
points = printpath.printpoints
n = len(points)


# ===== Printed points, grouped per layer (in print order, so each layer is a polyline) =====
layers = {}
for printpoint in points:
    if printpoint.is_extruder_on:
        layers.setdefault(printpoint.layer_index, []).append(printpoint.frame.point)

# ===== Overhang: how far each point sticks out over the layer below it, as an angle from vertical =====
heights = []    # layer height per point (mm), 0 if nothing below
overhangs = []  # overhang per point (degrees), 0 if nothing below
for printpoint in points:
    point = printpoint.frame.point
    points_below = layers.get(printpoint.layer_index - 1)
    if not printpoint.is_extruder_on or not points_below:
        heights.append(0.0)  # travel point or first layer
        overhangs.append(0.0)
        continue
    below = closest_point_on_polyline_xy(point, points_below)  # closest point on the layer below, between its points too
    height = point.z - points_below[0].z  # layers are flat; below[2] would be 0: the _xy function works in plan only
    heights.append(height)
    overhangs.append(math.degrees(math.atan2(distance_point_point_xy(point, below), height)) if height > 0 else 0.0)

# ===== Time: the robot moves to each point at that point's speed. Ignores acceleration =====
print_time = travel_time = 0.0
for i in range(1, n):
    time = points[i - 1].frame.point.distance_to_point(points[i].frame.point) / points[i].speed
    if points[i - 1].is_extruder_on and points[i].is_extruder_on:
        print_time += time
    else:
        travel_time += time

# ===== Colour: one bead (a strip as high as the layer) and one value per printed segment =====
beads, values = [], []
for i in range(1, n):
    a, b = points[i - 1].frame.point, points[i].frame.point
    printing = points[i - 1].is_extruder_on and points[i].is_extruder_on
    if mode == 0:
        # speed: every move as a line, travel included
        beads.append(rg.LineCurve(rg.Point3d(a.x, a.y, a.z), rg.Point3d(b.x, b.y, b.z)))
        values.append(points[i].speed)
    elif printing:
        # overhang: a strip as high as the layer, only where it prints
        ha, hb = (max(0.8 * (h or 0.0), 0.5) for h in (heights[i - 1], heights[i]))  # first layer: 0.5 mm
        bead = rg.Mesh()
        for x, y, z in [(a.x, a.y, a.z), (b.x, b.y, b.z), (b.x, b.y, b.z - hb), (a.x, a.y, a.z - ha)]:
            bead.Vertices.Add(x, y, z)
        bead.Faces.AddFace(0, 1, 2, 3)
        bead.Normals.ComputeNormals()
        beads.append(bead)
        values.append(overhangs[i] or 0.0)  # first layer: nothing below

param_range = rg.Interval(min(values), max(values))
low, high = (min(values), max(values)) if mode == 0 else (0.0, 45.0)
if high <= low:
    high = low + 1.0  # Gradient needs a range

report = "\n".join([
    f"colour: {MODES[mode]}, {low:.2f} to {high:.2f}",
    f"{n} printpoints, {len(layers)} layers",
    f"time: about {(print_time + travel_time) / 60:.1f} min (print {print_time / 60:.1f}, travel {travel_time / 60:.1f})",
])


ghenv.Component.Message = f"{MODES[mode]} mode, print time {(print_time + travel_time) /  60:.0f} min"
# ---------- end check ----------
gradient = Gradient(
    LowerLimit=check.low,
    UpperLimit=check.high,
    Parameter=check.values,
    stops=[0: RGB(45, 75, 170), 0.35: RGB(40, 175, 165), 0.7: RGB(245, 205, 50), 1: RGB(215, 45, 40)])
panel_3 = Panel(save_2)
preview = CustomPreview(Geometry=check.beads, Material=gradient)
panel_4 = Panel(check.report)

# ----
panel_5 = Panel(check.param_range)
