# Grasshopper definition HR_design_stage2_even_cycles.ghx (Grasshopper 1.0.8)

# ---- group: This is needed only ONCE in the GH definition
enable_auto_reload = Python3Script()  # -> ok
# ---------- enable_auto_reload: Python ----------
"""
------------------------------
Using VS Code as Python editor
------------------------------

The simplest way to start using VS Code as our editor, is
to place our Python code in files located IN THE SAME FOLDER as our Grasshopper file.

After we have done that, we need 2 steps: 

1. Enable the COMPAS reloader on one component. This tells Grasshopper to watch for changes in the Pythoh files and reload if changed.
2. Every other component that uses Python code from external files needs to start with a method to ensure Grasshopper knows where to load the files from.

"""
# r: compas
# venv: mas-2627

from compas_rhino.devtools import DevTools
DevTools.enable_reloader()
# ---------- end enable_auto_reload ----------

# ---- group: DESIGN
center_x_mm = Slider(180, range=-500..500)
center_y_mm = Slider(70, range=-500..500)
fine_adjust_z_mm = Slider(1, range=-5..5)

point_spacing_mm = Slider(50, range=1..50)
layer_height_mm = Slider(0.8, range=0.5..10)

height_mm = Slider(45, range=1..500)
radius_mm = Slider(30, range=5..200)

# design: "slice" a cylinder
slice_cylinder = SliceCylinder(
    radius=radius_mm,
    height=height_mm,
    layer_height=layer_height_mm,
    point_spacing=point_spacing_mm,
    center_x=center_x_mm,
    center_y=center_y_mm,
    fine_adjust_z=fine_adjust_z_mm)  # -> layers
# ---------- slice_cylinder: Python ----------
# r: compas
# venv: mas-2627
"""Stage 2: interval boundaries and circular geometry are generated in GH.
layers contains dictionaries consumed by stage2_printpath.py.
Requested lengths are proportionally fitted to complete circular repeats.
Lengths refer to ideal arc length; robot moves use chords.
"""
import math
from compas.geometry import Point

# Edit these values to change the ASPEED intervals (mm).
GAP_LENGTH = 20.0       # ASPEED0; Arduino value 0
PRINT_LENGTH = 5.0     # ASPEED1; Arduino value 5
START_MODE = 1        # 1 = begin each body ring with ASPEED1; 0 = ASPEED0
PRIMING_POINTS = 25

if type(START_MODE) is not int or START_MODE not in (0, 1):
    raise ValueError("START_MODE must be 0 or 1")

for name, value in (("radius", radius), ("height", height),
                    ("layer_height", layer_height), ("point_spacing", point_spacing),
                    ("GAP_LENGTH", GAP_LENGTH), ("PRINT_LENGTH", PRINT_LENGTH)):
    if not math.isfinite(value) or value <= 0:
        raise ValueError(name + " must be finite and positive")
count = int(height / layer_height)  # includes priming, like the original
if count < 2:
    raise ValueError("Need priming and at least one body ring")

def circle_point(r, angle, z):
    return Point(center_x+r*math.cos(angle), center_y+r*math.sin(angle), z)

layers = []
prime = [circle_point(2*radius, 2*math.pi*(j % PRIMING_POINTS)/PRIMING_POINTS,
                      fine_adjust_z) for j in range(PRIMING_POINTS+1)]
layers.append({"points": prime, "modes": [1]*PRIMING_POINTS})
circumference = 2*math.pi*radius


# Fit complete repeats around the circle. Preserve the requested gap/print ratio.
repeat_count = max(1, int(math.floor(circumference / (GAP_LENGTH + PRINT_LENGTH) + 0.5)))
period = circumference / repeat_count
actual_gap = period * GAP_LENGTH / (GAP_LENGTH + PRINT_LENGTH)
actual_print = period * PRINT_LENGTH / (GAP_LENGTH + PRINT_LENGTH)
order = (START_MODE, 1-START_MODE)

for body_index in range(count-1):
    z = fine_adjust_z + body_index*layer_height
    points = [circle_point(radius, 0.0, z)]
    modes = []
    for cycle in range(repeat_count):
        s = cycle * period
        for section_index, mode in enumerate(order):
            length = actual_gap if mode == 0 else actual_print
            subdivisions = max(1, int(math.ceil(length / point_spacing)))
            for j in range(1, subdivisions+1):
                arc = s + length*j/subdivisions
                last = (cycle == repeat_count-1 and section_index == 1 and j == subdivisions)
                angle = 0.0 if last else arc/radius
                points.append(circle_point(radius, angle, z))
                modes.append(mode)
            s += length
    layers.append({"points": points, "modes": modes})

path_info = {"repeat_count": repeat_count,
             "actual_gap_mm": actual_gap, "actual_print_mm": actual_print}
if "ghenv" in globals():
    ghenv.Component.Message = "N={} | 0={:.2f} / 1={:.2f} mm".format(
        repeat_count, actual_gap, actual_print)
# ---------- end slice_cylinder ----------

# ---- group: PRINTPATH
blend_radius_mm = Slider(0, range=0..5)
speed_mm_s = Slider(10, range=1..50)

# generate printpath: printpoints and path
safety_distance_mm = Slider(90, range=10..300)
printpath = Printpath(layers=slice_cylinder, speed=speed_mm_s, blend_radius=blend_radius_mm, safety_distance=safety_distance_mm)  # -> printpath, summary; inputs layers: list
# ---------- printpath: Python ----------
# r: compas
# venv: mas-2627
"""Stage 2: carry GH segment modes into JSON without editing print_class.py."""
import os
import sys
import Rhino.Geometry as rg
from compas.geometry import Frame, Vector

gh_dir = os.path.dirname(ghenv.Component.OnPingDocument().FilePath)
src_dir = os.path.abspath(os.path.join(gh_dir, "..", "..", "..", "src"))
if src_dir not in sys.path:
    sys.path.insert(0, src_dir)
from print_class import PrintPoint, PrintPath

class ASpeedPrintPoint(PrintPoint):
    def __init__(self, frame, layer_index, speed, blend_radius, mode):
        super().__init__(frame, layer_index, speed, blend_radius, True)
        # Outgoing segment: None = travel; 0/1 = selected ASPEED.
        self.aspeed_mode = mode

    def to_dict(self):
        data = super().to_dict()
        data["aspeed_mode"] = self.aspeed_mode
        return data

printpoints = []
zero_lines, five_lines = [], []
for layer_index, layer in enumerate(layers):
    points, modes = layer["points"], layer["modes"]
    if len(modes) != len(points)-1:
        raise ValueError("Layer mode count mismatch")
    for j, point in enumerate(points):
        mode = modes[j] if j < len(modes) else None
        frame = Frame(point, -Vector.Xaxis(), Vector.Yaxis())
        printpoints.append(ASpeedPrintPoint(frame, layer_index, speed, blend_radius, mode))
        if j < len(modes):
            a, b = points[j], points[j+1]
            line = rg.Line(rg.Point3d(*a), rg.Point3d(*b))
            (zero_lines if mode == 0 else five_lines).append(line)

printpath = PrintPath(printpoints)
printpath.add_safety_before(safety_distance, speed)
printpath.add_safety_after(safety_distance, speed)
summary = "{} points; body ASPEED0/1 lengths set in slice cylinder".format(len(printpath))

# Optional previews: add outputs zero_lines and five_lines to this component
# and connect each to a Custom Preview with different colours.
# ---------- end printpath ----------
panel = Panel(printpath.summary)

# ---- group: EXPORT
# export: preview and save
panel_2 = Panel("data/out_printpoints.json")
save = Button()
preview = Preview(printpath=printpath.printpath)  # -> path, travel, planes
# ---------- preview: Python ----------
# r: compas
# venv: mas-2627
"""
Draw the printpath: path = the whole polyline, travel = extruder-off segments,
safety = extruder-off points, axes = small x and y axis of each frame.
"""
import Rhino.Geometry as rg
from compas_rhino.conversions import frame_to_rhino_plane, point_to_rhino

AXIS_LENGTH = 5.0  # mm

points = printpath.printpoints
planes = [frame_to_rhino_plane(printpoint.frame) for printpoint in points]

# ===== Whole path =====
polyline = rg.Polyline()
for plane in planes:
    polyline.Add(plane.Origin.X, plane.Origin.Y, plane.Origin.Z)
path = polyline.ToPolylineCurve()

# ===== Extruder off: a segment prints only if both of its points have the extruder on =====
safety = [point_to_rhino(printpoint.frame.point) for printpoint in points if not printpoint.is_extruder_on]
travel = []
for i in range(len(points) - 1):
    if getattr(points[i], "aspeed_mode", None) is None or not (points[i].is_extruder_on and points[i + 1].is_extruder_on):
        travel.append(rg.Line(planes[i].Origin, planes[i + 1].Origin))
# ---------- end preview ----------
save_2 = Save(printpath=printpath.printpath, save=save, out_path=panel_2)  # -> status
# ---------- save_2: Python ----------
# r: compas
# venv: mas-2627
"""
On button press, write the printpath to data/out_printpoints.json next to this .ghx file.
send_to_robot.py reads that file.
"""
import json
import os

import scriptcontext as sc

gh_dir = os.path.dirname(ghenv.Component.OnPingDocument().FilePath)

# keep the last status in sticky, so the message survives the button being released
status_key = "save_status_" + str(ghenv.Component.InstanceGuid)

if save:
    if printpath is None:
        sc.sticky[status_key] = "nothing to save: no printpath"
    else:
        path = os.path.normpath(os.path.join(gh_dir, out_path))
        os.makedirs(os.path.dirname(path), exist_ok=True)
        with open(path, "w") as f:
            json.dump(printpath.to_dict(), f, indent=2)
        sc.sticky[status_key] = f"saved {len(printpath)} printpoints to {path}"

status = sc.sticky.get(status_key, "")
ghenv.Component.Message = "saved" if status.startswith("saved") else status
# ---------- end save_2 ----------
panel_3 = Panel(save_2)
preview_2 = CustomPreview(Geometry=preview.travel, Material=ColourSwatch(SwatchColor=RGB(230, 40, 40)))
preview_3 = CustomPreview(Geometry=preview.path, Material=ColourSwatch(SwatchColor=RGB(0, 170, 80)))

# ----
plane = Plane(preview.planes)
