# Grasshopper definition HR_design_test_layer change.ghx (Grasshopper 1.0.8)

# ---- group: This is needed only ONCE in the GH definition
enable_auto_reload = Python3Script()  # -> ok
# ---------- enable_auto_reload: Python ----------
"""
------------------------------
Using VS Code as Python editor
------------------------------

The simplest way to start using VS Code as our editor, is
to place our Python code in files located IN THE SAME FOLDER as our Grasshopper file.

After we have done that, we need 2 steps: 

1. Enable the COMPAS reloader on one component. This tells Grasshopper to watch for changes in the Pythoh files and reload if changed.
2. Every other component that uses Python code from external files needs to start with a method to ensure Grasshopper knows where to load the files from.

"""
# r: compas
# venv: mas-2627

from compas_rhino.devtools import DevTools
DevTools.enable_reloader()
# ---------- end enable_auto_reload ----------

# ---- group: DESIGN
center_x_mm = Slider(180, range=-500..500)
center_y_mm = Slider(70, range=-500..500)
fine_adjust_z_mm = Slider(2, range=-5..5)

layer_height_mm = Slider(1.5, range=0.5..10)
point_spacing_mm = Slider(1, range=1..50)

height_mm = Slider(45, range=1..500)
radius_mm = Slider(30, range=5..200)

# design: "slice" a cylinder
layer_change = SliceCylinder(
    radius=radius_mm,
    height=height_mm,
    layer_height=layer_height_mm,
    point_spacing=point_spacing_mm,
    center_x=center_x_mm,
    center_y=center_y_mm,
    fine_adjust_z=fine_adjust_z_mm)  # -> layers
# ---------- layer_change: Python ----------
# r: compas
# venv: mas-2627
"""
Slice a cylinder into layers, in work object coordinates (Rhino world XY = work object).
One closed compas Polyline per layer. Units: mm.
center_x, center_y: where the cylinder stands on the work object.
fine_adjust_z: shifts all layers up/down, to tune the nozzle height above the bed (0 = first layer at z = 0).
"""
import math

from compas.geometry import Point
from compas.geometry import Polyline

# ===== How many layers, how many points per layer =====
layer_count = int(height / layer_height)
points_per_layer = round(2 * math.pi * radius / point_spacing)

# ===== One closed polyline per layer =====
layers = []
for i in range(layer_count):
    z = i * layer_height + fine_adjust_z
    points = []
    if i == 0:
        for j in range(points_per_layer + 1):  # priming layer
            angle = 2 * math.pi * (j % points_per_layer) / points_per_layer
            points.append(Point(center_x + 2 * radius * math.cos(angle), center_y + 2 * radius * math.sin(angle), z))
        layers.append(Polyline(points))
    else: 
        for j in range(points_per_layer + 1):  # one extra point: back to the start to close the ring
            angle = 2 * math.pi * (j % points_per_layer) / points_per_layer
            points.append(Point(center_x + radius * math.cos(angle), center_y + radius * math.sin(angle), z - layer_height))
        layers.append(Polyline(points))
# ---------- end layer_change ----------

# ---- group: PRINTPATH
blend_radius_mm = Slider(0.6, range=0..5)
speed_mm_s = Slider(10, range=1..50)

# generate printpath: printpoints and path
safety_distance_mm = Slider(90, range=10..300)
printpath_layer_aspeed_change = Printpath(layers=layer_change, speed=speed_mm_s, blend_radius=blend_radius_mm, safety_distance=safety_distance_mm)  # -> printpath, summary; inputs layers: list
# ---------- printpath_layer_aspeed_change: Python ----------
# r: compas
# venv: mas-2627

"""
레이어별 ASPEED 교대.

- Priming Circle: PRIMING_MODE 사용
- 본체: LAYER_PATTERN 순서 반복
- 레이어 사이 연결: 압출 OFF
- 본체 Pause 없음
"""

import os
import sys

from compas.geometry import Frame, Vector


# ==========================================
# 1. 압출 설정
# ==========================================

# Arduino 속도값이 아니라 ASPEED 모드 번호.
LAYER_PATTERN = [0, 1]

# 바깥 Priming Circle에 사용할 모드.
PRIMING_MODE = 1


# ==========================================
# 2. 입력 확인
# ==========================================

if not LAYER_PATTERN or any(
    type(mode) is not int or mode not in (0, 1)
    for mode in LAYER_PATTERN
):
    raise ValueError(
        "LAYER_PATTERN must contain only 0 or 1."
    )

if (
    type(PRIMING_MODE) is not int
    or PRIMING_MODE not in (0, 1)
):
    raise ValueError("PRIMING_MODE must be 0 or 1.")


# ==========================================
# 3. 공통 클래스 불러오기
# ==========================================

gh_dir = os.path.dirname(
    ghenv.Component.OnPingDocument().FilePath
)

src_dir = os.path.abspath(
    os.path.join(
        gh_dir, "..", "..", "..", "src"
    )
)

if src_dir not in sys.path:
    sys.path.insert(0, src_dir)

from print_class import PrintPoint, PrintPath


# ==========================================
# 4. ASPEED 정보를 저장하는 PrintPoint
# ==========================================

class LayerPrintPoint(PrintPoint):

    def __init__(
        self,
        frame,
        layer_index,
        speed,
        blend_radius,
        mode,
    ):
        super().__init__(
            frame,
            layer_index,
            speed,
            blend_radius,
            True,
        )

        # 현재 점에서 다음 점으로 가는 구간의 모드.
        # None이면 압출 OFF 이동.
        self.aspeed_mode = mode

    def to_dict(self):
        data = super().to_dict()
        data["aspeed_mode"] = self.aspeed_mode
        return data


# ==========================================
# 5. 레이어별 PrintPoint 생성
# ==========================================

if not layers:
    raise ValueError(
        "No layers. Check the geometry component."
    )

printpoints = []

for layer_index, layer in enumerate(layers):

    points = list(layer.points)

    if len(points) < 2:
        raise ValueError(
            "Each layer needs at least two points."
        )

    if layer_index == 0:
        # 첫 레이어는 바깥 Priming Circle.
        layer_mode = PRIMING_MODE

    else:
        # 본체 첫 레이어 번호는 0.
        body_index = layer_index - 1

        layer_mode = LAYER_PATTERN[
            body_index % len(LAYER_PATTERN)
        ]

    for j, point in enumerate(points):

        if j < len(points) - 1:
            # 레이어 안에서는 같은 모드 유지.
            mode = layer_mode

        else:
            # 마지막 점에서 다음 레이어로 이동할 때 OFF.
            mode = None

        # 기존 툴 방향 유지.
        frame = Frame(
            point,
            -Vector.Xaxis(),
            Vector.Yaxis(),
        )

        printpoints.append(
            LayerPrintPoint(
                frame,
                layer_index,
                speed,
                blend_radius,
                mode,
            )
        )


# ==========================================
# 6. 접근·이탈점 추가
# ==========================================

printpath = PrintPath(printpoints)

printpath.add_safety_before(
    safety_distance,
    speed,
)

printpath.add_safety_after(
    safety_distance,
    speed,
)

summary = (
    "{} points; {} body layers; ASPEED pattern {}"
).format(
    len(printpath),
    len(layers) - 1,
    LAYER_PATTERN,
)
# ---------- end printpath_layer_aspeed_change ----------
panel = Panel(printpath_layer_aspeed_change.summary)

# ---- group: EXPORT
# export: preview and save
panel_2 = Panel("data/out_printpoints.json")
save = Button()
preview = Preview(printpath=printpath_layer_aspeed_change.printpath)  # -> path, travel, planes
# ---------- preview: Python ----------
# r: compas
# venv: mas-2627
"""
Draw the printpath: path = the whole polyline, travel = extruder-off segments,
safety = extruder-off points, axes = small x and y axis of each frame.
"""
import Rhino.Geometry as rg
from compas_rhino.conversions import frame_to_rhino_plane, point_to_rhino

AXIS_LENGTH = 5.0  # mm

points = printpath.printpoints
planes = [frame_to_rhino_plane(printpoint.frame) for printpoint in points]

# ===== Whole path =====
polyline = rg.Polyline()
for plane in planes:
    polyline.Add(plane.Origin.X, plane.Origin.Y, plane.Origin.Z)
path = polyline.ToPolylineCurve()

# ===== Extruder off: a segment prints only if both of its points have the extruder on =====
safety = [point_to_rhino(printpoint.frame.point) for printpoint in points if not printpoint.is_extruder_on]
travel = []
for i in range(len(points) - 1):
    if getattr(points[i], "aspeed_mode", None) is None or not (points[i].is_extruder_on and points[i + 1].is_extruder_on):
        travel.append(rg.Line(planes[i].Origin, planes[i + 1].Origin))
# ---------- end preview ----------
save_2 = Save(printpath=printpath_layer_aspeed_change.printpath, save=save, out_path=panel_2)  # -> status
# ---------- save_2: Python ----------
# r: compas
# venv: mas-2627
"""
On button press, write the printpath to data/out_printpoints.json next to this .ghx file.
send_to_robot.py reads that file.
"""
import json
import os

import scriptcontext as sc

gh_dir = os.path.dirname(ghenv.Component.OnPingDocument().FilePath)

# keep the last status in sticky, so the message survives the button being released
status_key = "save_status_" + str(ghenv.Component.InstanceGuid)

if save:
    if printpath is None:
        sc.sticky[status_key] = "nothing to save: no printpath"
    else:
        path = os.path.normpath(os.path.join(gh_dir, out_path))
        os.makedirs(os.path.dirname(path), exist_ok=True)
        with open(path, "w") as f:
            json.dump(printpath.to_dict(), f, indent=2)
        sc.sticky[status_key] = f"saved {len(printpath)} printpoints to {path}"

status = sc.sticky.get(status_key, "")
ghenv.Component.Message = "saved" if status.startswith("saved") else status
# ---------- end save_2 ----------
panel_3 = Panel(save_2)
preview_2 = CustomPreview(Geometry=preview.travel, Material=ColourSwatch(SwatchColor=RGB(230, 40, 40)))
preview_3 = CustomPreview(Geometry=preview.path, Material=ColourSwatch(SwatchColor=RGB(0, 170, 80)))

# ----
plane = Plane(preview.planes)
