# Grasshopper definition HR_design_test_update_starting circle.ghx (Grasshopper 1.0.8)

# ---- group: This is needed only ONCE in the GH definition
enable_auto_reload = Python3Script()  # -> ok
# ---------- enable_auto_reload: Python ----------
"""
------------------------------
Using VS Code as Python editor
------------------------------

The simplest way to start using VS Code as our editor, is
to place our Python code in files located IN THE SAME FOLDER as our Grasshopper file.

After we have done that, we need 2 steps: 

1. Enable the COMPAS reloader on one component. This tells Grasshopper to watch for changes in the Pythoh files and reload if changed.
2. Every other component that uses Python code from external files needs to start with a method to ensure Grasshopper knows where to load the files from.

"""
# r: compas
# venv: mas-2627

from compas_rhino.devtools import DevTools
DevTools.enable_reloader()
# ---------- end enable_auto_reload ----------

# ---- group: DESIGN
center_x_mm = Slider(180, range=-500..500)
center_y_mm = Slider(70, range=-500..500)
fine_adjust_z_mm = Slider(1, range=-5..5)

center_x_mm_2 = Slider(180, range=-500..500)
center_y_mm_2 = Slider(70, range=-500..500)
fine_adjust_z_mm_2 = Slider(1, range=-5..5)

layer_height_mm = Slider(1.2, range=0.5..10)
point_spacing_mm = Slider(1, range=1..50)

point_spacing_mm_2 = Slider(1, range=1..50)
layer_height_mm_2 = Slider(0.8, range=0.5..10)

height_mm = Slider(45, range=1..500)
radius_mm = Slider(30, range=5..200)

height_mm_2 = Slider(45, range=1..500)
radius_mm_2 = Slider(30, range=5..200)

# design: "slice" a cylinder
zigzag = SliceCylinder(
    radius=radius_mm,
    height=height_mm,
    layer_height=layer_height_mm,
    point_spacing=point_spacing_mm,
    center_x=center_x_mm,
    center_y=center_y_mm,
    fine_adjust_z=fine_adjust_z_mm)  # -> layers
# ---------- zigzag: Python ----------
# r: compas
# venv: mas-2627
"""
Slice a cylinder into layers, in work object coordinates (Rhino world XY = work object).
One closed compas Polyline per layer. Units: mm.
center_x, center_y: where the cylinder stands on the work object.
fine_adjust_z: shifts all layers up/down, to tune the nozzle height above the bed (0 = first layer at z = 0).
"""
import math

from compas.geometry import Point
from compas.geometry import Polyline

# ===== How many layers, how many points per layer =====
layer_count = int(height / layer_height)
points_per_layer = round(2 * math.pi * radius / point_spacing)

# ===== One closed polyline per layer =====
layers = []
for i in range(layer_count):
    z = i * layer_height + fine_adjust_z
    points = []
    if i == 0:
        for j in range(points_per_layer + 1):  # priming layer
            angle = 2 * math.pi * (j % points_per_layer) / points_per_layer
            points.append(Point(center_x + 2 * radius * math.cos(angle), center_y + 2 * radius * math.sin(angle), z))
        layers.append(Polyline(points))
    else: 
        for j in range(points_per_layer + 1):  # one extra point: back to the start to close the ring
            angle = 2 * math.pi * (j % points_per_layer) / points_per_layer
            points.append(Point(center_x + radius * math.cos(angle), center_y + radius * math.sin(angle), z - layer_height))
        layers.append(Polyline(points))
# ---------- end zigzag ----------

# design: "slice" a cylinder
zigzag_2 = SliceCylinder(
    radius=radius_mm_2,
    height=height_mm_2,
    layer_height=layer_height_mm_2,
    point_spacing=point_spacing_mm_2,
    center_x=center_x_mm_2,
    center_y=center_y_mm_2,
    fine_adjust_z=fine_adjust_z_mm_2)  # -> layers
# ---------- zigzag_2: Python ----------
# r: compas
# venv: mas-2627

"""
STAGGERED FACETED TEXTURE

Create alternating polygonal layers.
The original cylinder radius and center remain unchanged.

Texture is generated by changing the number of
vertices in each layer.

Units: mm
"""

import math

from compas.geometry import Point
from compas.geometry import Polyline


# ==========================================
# TEXTURE SETTINGS
# ==========================================

# Number of polygon sides for each layer
FACET_PATTERN = [8, 14, 10, 14]

# Number of points for the outer priming circle
PRIMING_POINTS = 25

# ==========================================
# LAYER GENERATION
# ==========================================

layer_count = int(height / layer_height)

layers = []

for i in range(layer_count):

    points = []

    # --------------------------------------
    # FIRST LAYER: PRIMING CIRCLE
    # --------------------------------------

    if i == 0:

        current_radius = radius * 2
        current_z = fine_adjust_z
        current_facets = PRIMING_POINTS

    # --------------------------------------
    # OTHER LAYERS: FACETED TEXTURE
    # --------------------------------------

    else:

        current_radius = radius
        current_z = (i - 1) * layer_height + fine_adjust_z

        # Repeat the facet pattern
        pattern_index = (i - 1) % len(FACET_PATTERN)
        current_facets = FACET_PATTERN[pattern_index]

    # --------------------------------------
    # CREATE POLYGON POINTS
    # --------------------------------------

    for j in range(current_facets + 1):

        angle = 2 * math.pi * j / current_facets

        x = center_x + current_radius * math.cos(angle)
        y = center_y + current_radius * math.sin(angle)
        z = current_z

        pt = Point(x, y, z)

        points.append(pt)

    # Create one closed polygon per layer
    layers.append(Polyline(points))
# ---------- end zigzag_2 ----------

# ---- group: PRINTPATH
blend_radius_mm = Slider(0, range=0..5)
speed_mm_s = Slider(10, range=1..50)

# generate printpath: printpoints and path
safety_distance_mm = Slider(90, range=10..300)
printpath = Printpath(layers=zigzag_2, speed=speed_mm_s, blend_radius=blend_radius_mm, safety_distance=safety_distance_mm)  # -> printpath, summary; inputs layers: list
# ---------- printpath: Python ----------
# r: compas
# venv: mas-2627
"""
Turn the layers into printpoints and a PrintPath, in work object coordinates.
Safety points are added here, before any transform to the robot base.
"""
import os
import sys

from compas.geometry import Frame, Vector


# Find source folder
gh_dir = os.path.dirname(ghenv.Component.OnPingDocument().FilePath)
src_dir = os.path.abspath(
    os.path.join(gh_dir, "..", "..", "..", "src")
)
if src_dir not in sys.path:
    sys.path.append(src_dir)
from print_class import PrintPoint, PrintPath

# ===== One printpoint per point =====
# world XY orientation for every point: a tangent frame would turn the wrist 360 degrees each layer
printpoints = []
for layer_index, layer in enumerate(layers):
    for point in layer.points:
        frame = Frame(point, -Vector.Xaxis(), Vector.Yaxis())
        printpoints.append(PrintPoint(frame, layer_index, speed, blend_radius, True))

# ===== Path with a travel point above the start and the end =====
printpath = PrintPath(printpoints)
printpath.add_safety_before(safety_distance, speed)
printpath.add_safety_after(safety_distance, speed)

summary = f"{len(printpoints)} printpoints in {len(layers)} layers, plus 2 safety points"
# ---------- end printpath ----------
panel = Panel(printpath.summary)

# ---- group: EXPORT
# export: preview and save
panel_2 = Panel("data/out_printpoints.json")
save = Button()
preview = Preview(printpath=printpath.printpath)  # -> path, travel, planes
# ---------- preview: Python ----------
# r: compas
# venv: mas-2627
"""
Draw the printpath: path = the whole polyline, travel = extruder-off segments,
safety = extruder-off points, axes = small x and y axis of each frame.
"""
import Rhino.Geometry as rg
from compas_rhino.conversions import frame_to_rhino_plane, point_to_rhino

AXIS_LENGTH = 5.0  # mm

points = printpath.printpoints
planes = [frame_to_rhino_plane(printpoint.frame) for printpoint in points]

# ===== Whole path =====
polyline = rg.Polyline()
for plane in planes:
    polyline.Add(plane.Origin.X, plane.Origin.Y, plane.Origin.Z)
path = polyline.ToPolylineCurve()

# ===== Extruder off: a segment prints only if both of its points have the extruder on =====
safety = [point_to_rhino(printpoint.frame.point) for printpoint in points if not printpoint.is_extruder_on]
travel = []
for i in range(len(points) - 1):
    if not (points[i].is_extruder_on and points[i + 1].is_extruder_on):
        travel.append(rg.Line(planes[i].Origin, planes[i + 1].Origin))
# ---------- end preview ----------
save_2 = Save(printpath=printpath.printpath, save=save, out_path=panel_2)  # -> status
# ---------- save_2: Python ----------
# r: compas
# venv: mas-2627
"""
On button press, write the printpath to data/out_printpoints.json next to this .ghx file.
send_to_robot.py reads that file.
"""
import json
import os

import scriptcontext as sc

gh_dir = os.path.dirname(ghenv.Component.OnPingDocument().FilePath)

# keep the last status in sticky, so the message survives the button being released
status_key = "save_status_" + str(ghenv.Component.InstanceGuid)

if save:
    if printpath is None:
        sc.sticky[status_key] = "nothing to save: no printpath"
    else:
        path = os.path.normpath(os.path.join(gh_dir, out_path))
        os.makedirs(os.path.dirname(path), exist_ok=True)
        with open(path, "w") as f:
            json.dump(printpath.to_dict(), f, indent=2)
        sc.sticky[status_key] = f"saved {len(printpath)} printpoints to {path}"

status = sc.sticky.get(status_key, "")
ghenv.Component.Message = "saved" if status.startswith("saved") else status
# ---------- end save_2 ----------
panel_3 = Panel(save_2)
preview_2 = CustomPreview(Geometry=preview.travel, Material=ColourSwatch(SwatchColor=RGB(230, 40, 40)))
preview_3 = CustomPreview(Geometry=preview.path, Material=ColourSwatch(SwatchColor=RGB(0, 170, 80)))

# ----
plane = Plane(preview.planes)
