# Grasshopper definition design_viz_test1_pair_nonplanar_print_amp_spacing_fixed.ghx (Grasshopper 1.0.8)

radius = Slider(30, range=24..42)
height = Slider(45, range=40..65)
waist = Slider(10, range=0..15)
wave_amp = Slider(5, range=0..8)

center_x = Slider(120, range=0..300)
center_y = Slider(130, range=0..300)
fine_adjust_z = Slider(0, range=0..5)

sketch_identical_pair = SketchIdenticalOpenPair(
    radius=radius,
    height=height,
    waist=waist,
    wave_amp=wave_amp,
    center_x=center_x,
    center_y=center_y,
    fine_adjust_z=fine_adjust_z)  # -> model, report
# ---------- sketch_identical_pair: Python ----------
"""One open surface, printed twice, flipped once. No shell offset or cap.
Inputs: radius, height, waist, wave_amp, view_mode,
center_x, center_y, fine_adjust_z. Units mm.
"""
import math
import Rhino
import Rhino.Geometry as rg

defaults=dict(radius=32.,height=50.,waist=10.,wave_amp=4.,view_mode=0,
              center_x=180.,center_y=70.,fine_adjust_z=2.)
for name,default in defaults.items():
    value=globals().get(name)
    globals()[name]=float(default if value is None else value)
if not all(math.isfinite(globals()[n]) for n in defaults):
    raise ValueError("All parameters must be finite.")
if radius<=0 or not 0<=waist<0.7*radius or not 0<=wave_amp<height/3:
    raise ValueError("Use radius>0, waist<0.7*radius and wave_amp<height/3.")
if height<=0 or view_mode not in (0,1):
    raise ValueError("height must be positive; view_mode 0 pair / 1 single.")

WAVES=3  # fixed for this first prototype; sin has flip-compatible symmetry
N=96
ROWS=32
sections=[]
for k in range(ROWS+1):
    t=k/float(ROWS)
    r=radius*(1.1*(1-t)+t)-waist*math.sin(math.pi*t)
    pts=[]
    for j in range(N):
        a=2*math.pi*j/N
        pts.append(rg.Point3d(r*math.cos(a),r*math.sin(a),
            height*t+wave_amp*t**3*math.sin(WAVES*a)))
    sections.append(rg.NurbsCurve.Create(True,3,pts))

surfaces=rg.Brep.CreateFromLoft(sections,rg.Point3d.Unset,rg.Point3d.Unset,
                             rg.LoftType.Normal,False)
tol=max(Rhino.RhinoDoc.ActiveDoc.ModelAbsoluteTolerance,0.001)
joined=rg.Brep.JoinBreps(surfaces,tol) if surfaces else None
if not joined or len(joined)!=1 or not joined[0].IsValid:
    raise ValueError("Open body loft failed.")
part=joined[0]
# Do not cap. Both the flat starting opening and wavy joining opening stay open.
if part.IsSolid:
    raise ValueError("Unexpected closed body: this study must remain open-ended.")

lower=part.DuplicateBrep()
upper=part.DuplicateBrep()
flip=rg.Transform.Rotation(math.pi,rg.Vector3d.XAxis,rg.Point3d(0,0,height))
upper.Transform(flip)

model=[lower,upper] if view_mode==0 else [lower]
for brep in model:
    brep.Transform(rg.Transform.Translation(center_x,center_y,fine_adjust_z))

report="\n".join([
    "SKETCH STUDY: ONE open-ended part, duplicated and flipped.",
    "view_mode 0=assembled pair / 1=single upright print geometry",
    "No Boolean trimming, pins, collar, lid or inner offset wall.",
    "Flat starting radius={:.1f}; joining radius={:.1f} mm".format(1.1*radius,radius),
    "Joining curve Z = height + wave_amp * sin(3*angle).",
    "Flip around X through Z=height maps the joining curve onto itself.",
    "Pair height={:.1f} mm; two copies of EXACTLY the same geometry.".format(2*height),
    "Only geometry here. Wavy last layers need a new path strategy, not the old horizontal slicer.",
    "Actual bead-width contact, clearance, stability and nozzle motion are unverified.",
])
if "ghenv" in globals():ghenv.Component.Message="IDENTICAL x2 | OPEN RIMS"
# ---------- end sketch_identical_pair ----------
sketch_pair_report = Panel(sketch_identical_pair.report)

speed_mm_s = Slider(10, range=1..50)
blend_radius_mm = Slider(0.6, range=0..5)

point_spacing_mm = Slider(2, range=1..50)
layer_height_mm = Slider(1.5, range=0.5..10)

safety_distance_mm = Slider(90, range=10..300)
amp = Slider(2, range=0..5)
bumps_per_turn = Slider(32, range=4..64)
sketch_dense_bumps_sliders = SketchDenseBumpsSliders(
    radius=radius,
    height=height,
    waist=waist,
    wave_amp=wave_amp,
    center_x=center_x,
    center_y=center_y,
    fine_adjust_z=fine_adjust_z,
    layer_height=layer_height_mm,
    point_spacing=point_spacing_mm,
    speed=speed_mm_s,
    blend_radius=blend_radius_mm,
    safety_distance=safety_distance_mm,
    amp=amp,
    bumps_per_turn=bumps_per_turn)  # -> printpath, path_curves, report
#   port amp: Maximum outward bump amplitude in mm
#   port bumps_per_turn: Bump count around one turn
# ---------- sketch_dense_bumps_sliders: Python ----------
# r: compas
# venv: mas-2627
"""Alternate outward textured rings; preserve body Z and fixed tool axes.
Add a flat outer priming circle at the first-layer Z. No elevated travel ring.
"""
import math,os,sys
import Rhino.Geometry as rg
from compas.geometry import Point,Polyline,Frame,Vector
gh_dir=os.path.dirname(ghenv.Component.OnPingDocument().FilePath)
src_dir=os.path.abspath(os.path.join(gh_dir,"..","..","..","src"))
if src_dir not in sys.path:sys.path.insert(0,src_dir)
from print_class import PrintPoint,PrintPath

# Texture settings: outward radial bumps on body layers 2, 4, 6...
# Connected Grasshopper sliders: amp (mm), bumps_per_turn (integer).
AMP_MAX = float(amp)
AMP_MIN = 0.25 * AMP_MAX   # preserve the previous 1:4 amplitude variation
count = float(bumps_per_turn)
if not math.isfinite(count) or count != int(count) or not 4 <= count <= 64:
    raise ValueError("bumps_per_turn must be an integer from 4 to 64")
BUMPS_PER_TURN = int(count)
SIZE_CYCLES = 2
if not math.isfinite(AMP_MAX) or not 0 <= AMP_MAX <= 5:
    raise ValueError("amp must be between 0 and 5 mm")

if not (math.isfinite(AMP_MIN) and math.isfinite(AMP_MAX) and 0 <= AMP_MIN <= AMP_MAX):
    raise ValueError("Use 0 <= AMP_MIN <= AMP_MAX")
if any(type(n) is not int or n < 1 for n in (BUMPS_PER_TURN, SIZE_CYCLES)):
    raise ValueError("Bump count and size cycles must be positive integers")

def texture_offset(i, intervals, angle):
    if i % 2 == 0:
        return 0.0
    # Fade in/out across two layer intervals; preserve bed and mating rim.
    edge = max(0.0, min(1.0, i / 2.0, (intervals - i) / 2.0))
    edge = edge * edge * (3.0 - 2.0 * edge)
    bump = (1.0 - math.cos(BUMPS_PER_TURN * angle)) / 2.0
    envelope = AMP_MIN + (AMP_MAX - AMP_MIN) * (1.0 + math.sin(SIZE_CYCLES * angle)) / 2.0
    return edge * envelope * bump

def make_layers(radius,height,waist,wave_amp,layer_height,point_spacing,cx,cy,z0):
    for name,v in (("radius",radius),("height",height),("layer_height",layer_height),("point_spacing",point_spacing)):
        if not math.isfinite(v) or v<=0:raise ValueError(name+" must be finite and positive")
    if not math.isfinite(waist) or not 0<=waist<0.7*radius:raise ValueError("Check waist")
    if not math.isfinite(wave_amp) or not 0<=wave_amp<height/3:raise ValueError("Check wave_amp < height/3")
    if not all(math.isfinite(v) for v in (cx,cy,z0)):raise ValueError("XYZ must be finite")
    intervals=max(1,int(math.ceil(height/layer_height)))
    # Approximate spacing on the reference smooth ring; no texture-driven floor.
    # Large spacing can under-resolve bumps: report it rather than adding points.
    segments=max(3,int(math.ceil(2*math.pi*math.hypot(1.1*radius,3*wave_amp)/point_spacing)))
    rings=[]
    for i in range(intervals+1):
        t=i/float(intervals)
        r=radius*(1.1*(1-t)+t)-waist*math.sin(math.pi*t)
        points=[]
        for j in range(segments+1):
            a=2*math.pi*(j%segments)/segments
            textured_r = r + texture_offset(i, intervals, a)
            points.append(Point(cx+textured_r*math.cos(a),cy+textured_r*math.sin(a),
                                z0+height*t+wave_amp*t**3*math.sin(3*a)))
        rings.append(Polyline(points))
    return rings

def layer_frame(point,t,a,r,amplitude):
    # Same body points as the tilted test, with the original fixed tool axes.
    return Frame(point,-Vector.Xaxis(),Vector.Yaxis())

if not math.isfinite(speed) or speed<=0 or not math.isfinite(blend_radius) or blend_radius<0:
    raise ValueError("Check speed / blend_radius")
if not math.isfinite(safety_distance) or safety_distance<=0 or fine_adjust_z<0:
    raise ValueError("Check safety distance / first-layer Z")
layers=make_layers(radius,height,waist,wave_amp,layer_height,point_spacing,
                   center_x,center_y,fine_adjust_z)
segments=len(layers[0].points)-1
prime_radius=2*radius
if prime_radius <= 1.1*radius + AMP_MAX:
    raise ValueError("Bumps may reach the priming ring; reduce amp")
prime_segments=max(3,int(math.ceil(2*math.pi*prime_radius/point_spacing)))
priming=[];points=[]
for j in range(prime_segments+1):
    a=2*math.pi*(j%prime_segments)/prime_segments
    p=Point(center_x+prime_radius*math.cos(a),center_y+prime_radius*math.sin(a),fine_adjust_z)
    priming.append(p)
    # Stop at priming end before switching OFF for the direct inward travel.
    points.append(PrintPoint(Frame(p,-Vector.Xaxis(),Vector.Yaxis()),0,
                             speed,0.0 if j==prime_segments else blend_radius,True))
prime_end_index=len(points)-1

body_start_index=len(points)
for i,ring in enumerate(layers):
    t=i/float(len(layers)-1)
    r=radius*(1.1*(1-t)+t)-waist*math.sin(math.pi*t)
    for j,p in enumerate(ring.points):
        a=2*math.pi*(j%segments)/segments
        frame=layer_frame(p,t,a,r,wave_amp)
        points.append(PrintPoint(frame,i+1,speed,
            0.0 if i==0 and j==0 else (min(blend_radius, 0.1) if i%2==1 and AMP_MAX>0 else blend_radius),True))

printpath=PrintPath(points)
printpath.add_safety_before(safety_distance,speed)
printpath.add_safety_after(safety_distance,speed)
# Added safety-before shifts the priming-end index by one.
prime_end_index+=1
body_start_index+=1
printpath.printpoints[-2].blend_radius=0.0
for i,p in enumerate(printpath.printpoints):
    p.aspeed_mode=1 if (i+1<len(printpath.printpoints) and p.is_extruder_on
                       and printpath.printpoints[i+1].is_extruder_on) else None
printpath.printpoints[prime_end_index].aspeed_mode=None

body_points=printpath.printpoints[body_start_index:-1]
body=[p.frame.point for p in body_points]
top=max(p.z for p in body)
if min(printpath.printpoints[0].frame.point.z,printpath.printpoints[-1].frame.point.z)<=top:
    raise ValueError("Approach/retract points must clear the part")
tilts=[math.degrees(math.acos(max(-1.,min(1.,p.frame.zaxis.dot(-Vector.Zaxis()))))) for p in body_points]
steps=[]
for a,b in zip(body_points,body_points[1:]):
    # Full Frame rotation angle, not only the change in tool Z.
    trace=sum(x.dot(y) for x,y in zip((a.frame.xaxis,a.frame.yaxis,a.frame.zaxis),
                                      (b.frame.xaxis,b.frame.yaxis,b.frame.zaxis)))
    steps.append(math.degrees(math.acos(max(-1.,min(1.,(trace-1)/2)))))
gaps=[]
for previous,current in zip(layers,layers[1:]):
    gaps.extend(b.z-a.z for a,b in zip(previous.points[:-1],current.points[:-1]))
if min(gaps)<=0:raise ValueError("Nonpositive same-angle rise")

def bounds(pts):
    return [[min(getattr(p,k) for p in pts) for k in ('x','y','z')],
            [max(getattr(p,k) for p in pts) for k in ('x','y','z')]]
printpath.workflow_meta={
    "schema":"sketch_nonplanar_fixed_priming_v1",
    "tool_orientation":"fixed_course_minusX_plusY",
    "texture":{"type":"alternating_radial_bumps", "amp_min":AMP_MIN,
               "amp_max":AMP_MAX,"bumps_per_turn":BUMPS_PER_TURN,"size_cycles":SIZE_CYCLES,
               "textured_body_layers":"2,4,6... (1-based)","edge_fade_intervals":2,
               "texture_blend_cap_mm":0.1},
    "shape":{"radius":radius,"height":height,"waist":waist,"wave_amp":wave_amp},
    "body_bounds":bounds(body),"priming_bounds":bounds(priming),
    "layer_height_requested":layer_height,"nominal_layer_height":height/(len(layers)-1),
    "min_same_angle_rise":min(gaps),"max_same_angle_rise":max(gaps),
    "max_tool_tilt_deg":max(tilts),"max_frame_step_deg":max(steps),
    "body_start_index":body_start_index,"priming_end_index":prime_end_index,
    "point_spacing_requested":point_spacing,
    "body_segments":segments,"priming_segments":prime_segments,
    "sampling_policy":"reference_ring_spacing_no_texture_floor",
}
path_curves=[rg.Polyline([rg.Point3d(p.x,p.y,p.z) for p in priming]).ToPolylineCurve()]
path_curves += [rg.Polyline([rg.Point3d(p.x,p.y,p.z) for p in ring.points]).ToPolylineCurve() for ring in layers]
report="\n".join([
    "POINT SPACING CONTROLS TARGET COUNT | no 48 / 12-per-bump floor",
    "point_spacing {:.2f} mm (approx. reference ring); body {} segments/ring; priming {}".format(point_spacing,segments,prime_segments),
    "Samples per requested bump: {:.2f}; {} total targets".format(segments/float(BUMPS_PER_TURN),len(printpath.printpoints)),
    ("WARNING: fewer than 4 samples/bump: bumps may shrink, alias or disappear. Reduce point_spacing or bump count." if AMP_MAX>0 and segments<4*BUMPS_PER_TURN else "Bump sampling >=4 samples/bump, or amplitude zero."),
    "Bumps {} / turn; amplitude {:.2f}..{:.2f} mm; envelope {} cycles".format(BUMPS_PER_TURN,AMP_MIN,AMP_MAX,SIZE_CYCLES),
    "Body layers 2,4,6... textured; 2-interval edge fade; bed and mating rim unchanged.",
    "ASPEED1 preserved; texture-layer blend capped at 0.1 mm.",
    "amp slider = max outward displacement; bumps_per_turn slider = density.",
    "Priming circle R={:.1f} at first-layer Z={:.2f}; then inward travel OFF".format(prime_radius,fine_adjust_z),
    "{} body rings; max tilt {:.2f} deg; max target-to-target frame change {:.2f} deg".format(len(layers),max(tilts),max(steps)),
    "All tool Frames retain the original minusX / plusY axes.",
    "Priming and body use the same fixed vertical orientation.",
    "Only initial approach and final retract are elevated. No sky-circle path.",
    "TCP/Work Object unchanged. Robot IK, flange sweep, nozzle clearance and material behaviour NOT verified.",
])
if "ghenv" in globals():ghenv.Component.Message="BUMPS | {:.2f} mm".format(AMP_MAX)
# ---------- end sketch_dense_bumps_sliders ----------
path_checks = Panel(sketch_dense_bumps_sliders.report)
save_sketch_json = Button()
save_sketch_path = SaveSketchPath(printpath=sketch_dense_bumps_sliders.printpath, save=save_sketch_json)  # -> status
# ---------- save_sketch_path: Python ----------
# r: compas
# venv: mas-2627
"""Save the current path to data/out_printpoints.json."""
import json
import os
import scriptcontext as sc

gh_dir=os.path.dirname(ghenv.Component.OnPingDocument().FilePath)
key="sketch_spacing_fixed_save_"+str(ghenv.Component.InstanceGuid)
if save:
    if printpath is None or not hasattr(printpath,"workflow_meta"):
        raise ValueError("Generate the sketch path first")
    data=printpath.to_dict()
    data["workflow_meta"]=printpath.workflow_meta
    points=printpath.printpoints
    for i,item in enumerate(data["printpoints"]):
        item["aspeed_mode"]=getattr(points[i], "aspeed_mode", None)
    path=os.path.join(gh_dir,"data","out_printpoints.json")
    os.makedirs(os.path.dirname(path),exist_ok=True)
    temporary=path+".tmp"
    with open(temporary,"w") as f:json.dump(data,f,indent=2,allow_nan=False)
    os.replace(temporary,path)
    sc.sticky[key]="Saved {} points to {}".format(len(points),path)
status=sc.sticky.get(key,"Not saved yet")
ghenv.Component.Message="sketch JSON" if status.startswith("Saved") else "not saved"
# ---------- end save_sketch_path ----------
saved_json = Panel(save_sketch_path)
preview = Preview(printpath=sketch_dense_bumps_sliders.printpath)  # -> path, travel, planes
# ---------- preview: Python ----------
# r: compas
# venv: mas-2627
"""
Draw the printpath: path = the whole polyline, travel = extruder-off segments,
safety = extruder-off points, axes = small x and y axis of each frame.
"""
import Rhino.Geometry as rg
from compas_rhino.conversions import frame_to_rhino_plane, point_to_rhino

AXIS_LENGTH = 5.0  # mm

points = printpath.printpoints
planes = [frame_to_rhino_plane(printpoint.frame) for printpoint in points]

# ===== Whole path =====
polyline = rg.Polyline()
for plane in planes:
    polyline.Add(plane.Origin.X, plane.Origin.Y, plane.Origin.Z)
path = polyline.ToPolylineCurve()

# ===== Extruder off: a segment prints only if both of its points have the extruder on =====
safety = [point_to_rhino(printpoint.frame.point) for printpoint in points if not printpoint.is_extruder_on]
travel = []
for i in range(len(points) - 1):
    if getattr(points[i], "aspeed_mode", None) is None or not (points[i].is_extruder_on and points[i + 1].is_extruder_on):
        travel.append(rg.Line(planes[i].Origin, planes[i + 1].Origin))


# Display fewer Frame planes only; path and saved robot targets remain complete.
import math
planes = planes[::max(1, int(math.ceil(len(planes) / 120.0)))]
# ---------- end preview ----------
plane = Plane(preview.planes)
preview_2 = CustomPreview(Geometry=preview.travel, Material=ColourSwatch(SwatchColor=RGB(230, 40, 40)))
preview_3 = CustomPreview(Geometry=preview.path, Material=ColourSwatch(SwatchColor=RGB(0, 170, 80)))
