# Grasshopper definition design_viz_test1_pair_planar_print_r_speed_distance.ghx (Grasshopper 1.0.8)

radius = Slider(42, range=24..50)
height = Slider(45, range=40..65)
waist = Slider(10, range=0..15)
wave_amp = Slider(5, range=0..8)

center_x = Slider(120, range=0..300)
center_y = Slider(130, range=0..300)
fine_adjust_z = Slider(0, range=-1..5)

sketch_identical_pair = SketchIdenticalOpenPair(
    radius=radius,
    height=height,
    waist=waist,
    wave_amp=wave_amp,
    center_x=center_x,
    center_y=center_y,
    fine_adjust_z=fine_adjust_z)  # -> model, report
# ---------- sketch_identical_pair: Python ----------
"""One open surface, printed twice, flipped once. No shell offset or cap.
Inputs: radius, height, waist, wave_amp, view_mode,
center_x, center_y, fine_adjust_z. Units mm.
"""
import math
import Rhino
import Rhino.Geometry as rg

defaults=dict(radius=32.,height=50.,waist=10.,wave_amp=4.,view_mode=0,
              center_x=180.,center_y=70.,fine_adjust_z=2.)
for name,default in defaults.items():
    value=globals().get(name)
    globals()[name]=float(default if value is None else value)
if not all(math.isfinite(globals()[n]) for n in defaults):
    raise ValueError("All parameters must be finite.")
if radius<=0 or not 0<=waist<0.7*radius or not 0<=wave_amp<height/3:
    raise ValueError("Use radius>0, waist<0.7*radius and wave_amp<height/3.")
if height<=0 or view_mode not in (0,1):
    raise ValueError("height must be positive; view_mode 0 pair / 1 single.")

WAVES=3  # fixed for this first prototype; sin has flip-compatible symmetry
N=96
ROWS=32
sections=[]
for k in range(ROWS+1):
    t=k/float(ROWS)
    r=radius*(1.1*(1-t)+t)-waist*math.sin(math.pi*t)
    pts=[]
    for j in range(N):
        a=2*math.pi*j/N
        pts.append(rg.Point3d(r*math.cos(a),r*math.sin(a),
            height*t+wave_amp*t**3*math.sin(WAVES*a)))
    sections.append(rg.NurbsCurve.Create(True,3,pts))

surfaces=rg.Brep.CreateFromLoft(sections,rg.Point3d.Unset,rg.Point3d.Unset,
                             rg.LoftType.Normal,False)
tol=max(Rhino.RhinoDoc.ActiveDoc.ModelAbsoluteTolerance,0.001)
joined=rg.Brep.JoinBreps(surfaces,tol) if surfaces else None
if not joined or len(joined)!=1 or not joined[0].IsValid:
    raise ValueError("Open body loft failed.")
part=joined[0]
# Do not cap. Both the flat starting opening and wavy joining opening stay open.
if part.IsSolid:
    raise ValueError("Unexpected closed body: this study must remain open-ended.")

lower=part.DuplicateBrep()
upper=part.DuplicateBrep()
flip=rg.Transform.Rotation(math.pi,rg.Vector3d.XAxis,rg.Point3d(0,0,height))
upper.Transform(flip)

model=[lower,upper] if view_mode==0 else [lower]
for brep in model:
    brep.Transform(rg.Transform.Translation(center_x,center_y,fine_adjust_z))

report="\n".join([
    "SKETCH STUDY: ONE open-ended part, duplicated and flipped.",
    "view_mode 0=assembled pair / 1=single upright print geometry",
    "No Boolean trimming, pins, collar, lid or inner offset wall.",
    "Flat starting radius={:.1f}; joining radius={:.1f} mm".format(1.1*radius,radius),
    "Joining curve Z = height + wave_amp * sin(3*angle).",
    "Flip around X through Z=height maps the joining curve onto itself.",
    "Pair height={:.1f} mm; two copies of EXACTLY the same geometry.".format(2*height),
    "Only geometry here. Wavy last layers need a new path strategy, not the old horizontal slicer.",
    "Actual bead-width contact, clearance, stability and nozzle motion are unverified.",
])
if "ghenv" in globals():ghenv.Component.Message="IDENTICAL x2 | OPEN RIMS"
# ---------- end sketch_identical_pair ----------
sketch_pair_report = Panel(sketch_identical_pair.report)

speed_mm_s = Slider(10, range=1..50)
blend_radius_mm = Slider(0.6, range=0..5)

point_spacing_mm = Slider(5, range=1..50)
layer_height_mm = Slider(1.5, range=0.5..10)

safety_distance_mm = Slider(90, range=10..300)
sketch_tilted_frames_speed = SketchTiltedFramesSpeed(
    radius=radius,
    height=height,
    waist=waist,
    wave_amp=wave_amp,
    center_x=center_x,
    center_y=center_y,
    fine_adjust_z=fine_adjust_z,
    layer_height=layer_height_mm,
    point_spacing=point_spacing_mm,
    speed=speed_mm_s,
    blend_radius=blend_radius_mm,
    safety_distance=safety_distance_mm)  # -> printpath, path_curves, report
# ---------- sketch_tilted_frames_speed: Python ----------
# r: compas
# venv: mas-2627
"""Preserve the approved body formula and tilted Frames; boost speed where layers are closer.
Add a flat outer priming circle at the first-layer Z. No elevated travel ring.
"""
import math,os,sys
import Rhino.Geometry as rg
from compas.geometry import Point,Polyline,Frame,Vector
gh_dir=os.path.dirname(ghenv.Component.OnPingDocument().FilePath)
src_dir=os.path.abspath(os.path.join(gh_dir,"..","..","..","src"))
if src_dir not in sys.path:sys.path.insert(0,src_dir)
from print_class import PrintPoint,PrintPath

# Compare the same angular position in consecutive BODY layers (3D distance).
# This is not the nearest distance to the whole previous ring, nor TCP feedback.
MAX_SPEED_MULTIPLIER = 2.0  # limit boost to 2x base speed
MAX_ROBOT_SPEED = 50.0     # mm/s, user-tested upper limit
if not math.isfinite(MAX_SPEED_MULTIPLIER) or MAX_SPEED_MULTIPLIER < 1:
    raise ValueError("MAX_SPEED_MULTIPLIER must be >= 1")
if not math.isfinite(MAX_ROBOT_SPEED) or not 0 < speed <= MAX_ROBOT_SPEED <= 50:
    raise ValueError("Use 0 < speed <= MAX_ROBOT_SPEED <= 50")

def requested_gap_speed(gap, reference_gap):
    if gap <= 1e-9:
        raise ValueError("Coincident consecutive layers")
    multiplier = min(MAX_SPEED_MULTIPLIER, max(1.0, reference_gap / gap))
    return min(MAX_ROBOT_SPEED, speed * multiplier)

def make_layers(radius,height,waist,wave_amp,layer_height,point_spacing,cx,cy,z0):
    for name,v in (("radius",radius),("height",height),("layer_height",layer_height),("point_spacing",point_spacing)):
        if not math.isfinite(v) or v<=0:raise ValueError(name+" must be finite and positive")
    if not math.isfinite(waist) or not 0<=waist<0.7*radius:raise ValueError("Check waist")
    if not math.isfinite(wave_amp) or not 0<=wave_amp<height/3:raise ValueError("Check wave_amp < height/3")
    if not all(math.isfinite(v) for v in (cx,cy,z0)):raise ValueError("XYZ must be finite")
    intervals=max(1,int(math.ceil(height/layer_height)))
    segments=max(3,int(math.ceil(2*math.pi*math.hypot(1.1*radius,3*wave_amp)/point_spacing)))
    rings=[]
    for i in range(intervals+1):
        t=i/float(intervals)
        r=radius*(1.1*(1-t)+t)-waist*math.sin(math.pi*t)
        points=[]
        for j in range(segments+1):
            a=2*math.pi*(j%segments)/segments
            points.append(Point(cx+r*math.cos(a),cy+r*math.sin(a),
                                z0+height*t+wave_amp*t**3*math.sin(3*a)))
        rings.append(Polyline(points))
    return rings

def layer_frame(point,t,a,r,amplitude):
    # Tangent along the ring: (-r*sin(a), r*cos(a), dz/da).
    # Extend its local layer surface horizontally in the radial direction.
    # The upward normal is radial x ring_tangent. It is NOT the shell normal.
    dz_da=3*amplitude*t**3*math.cos(3*a)
    normal=Vector(dz_da*math.sin(a)/r,-dz_da*math.cos(a)/r,1.).unitized()
    tool_z=-normal
    # Keep an approximately world-fixed heading; no tangent-following 360 roll.
    reference=-Vector.Xaxis()
    tool_x=reference-tool_z*reference.dot(tool_z)
    if tool_x.length<1e-8:raise ValueError("Tool heading projection singular")
    tool_x.unitize()
    tool_y=tool_z.cross(tool_x)
    return Frame(point,tool_x,tool_y)

if not math.isfinite(speed) or speed<=0 or not math.isfinite(blend_radius) or blend_radius<0:
    raise ValueError("Check speed / blend_radius")
if not math.isfinite(safety_distance) or safety_distance<=0 or fine_adjust_z<0:
    raise ValueError("Check safety distance / first-layer Z")
layers=make_layers(radius,height,waist,wave_amp,layer_height,point_spacing,
                   center_x,center_y,fine_adjust_z)
segments=len(layers[0].points)-1
prime_radius=2*radius
prime_segments=max(3,int(math.ceil(2*math.pi*prime_radius/point_spacing)))
priming=[];points=[]
for j in range(prime_segments+1):
    a=2*math.pi*(j%prime_segments)/prime_segments
    p=Point(center_x+prime_radius*math.cos(a),center_y+prime_radius*math.sin(a),fine_adjust_z)
    priming.append(p)
    # Stop at priming end before switching OFF for the direct inward travel.
    points.append(PrintPoint(Frame(p,-Vector.Xaxis(),Vector.Yaxis()),0,
                             speed,0.0 if j==prime_segments else blend_radius,True))
prime_end_index=len(points)-1

body_start_index=len(points)
layer_distances=[]
for i,ring in enumerate(layers):
    t=i/float(len(layers)-1)
    r=radius*(1.1*(1-t)+t)-waist*math.sin(math.pi*t)
    for j,p in enumerate(ring.points):
        a=2*math.pi*(j%segments)/segments
        frame=layer_frame(p,t,a,r,wave_amp)
        point_speed = speed
        if i > 0:
            previous = layers[i-1].points[j]
            gap = p.distance_to_point(previous)
            # Reference: same radial shift, but nominal vertical layer rise.
            nominal_rise = height / (len(layers)-1)
            reference_gap = math.sqrt((p.x-previous.x)**2 + (p.y-previous.y)**2 + nominal_rise**2)
            point_speed = requested_gap_speed(gap, reference_gap)
            layer_distances.append(gap)
        points.append(PrintPoint(frame,i+1,point_speed,
            0.0 if i==0 and j==0 else blend_radius,True))

printpath=PrintPath(points)
printpath.add_safety_before(safety_distance,speed)
printpath.add_safety_after(safety_distance,speed)
# Added safety-before shifts the priming-end index by one.
prime_end_index+=1
body_start_index+=1
printpath.printpoints[-2].blend_radius=0.0
for i,p in enumerate(printpath.printpoints):
    p.aspeed_mode=1 if (i+1<len(printpath.printpoints) and p.is_extruder_on
                       and printpath.printpoints[i+1].is_extruder_on) else None
printpath.printpoints[prime_end_index].aspeed_mode=None

body_points=printpath.printpoints[body_start_index:-1]
body=[p.frame.point for p in body_points]
top=max(p.z for p in body)
if min(printpath.printpoints[0].frame.point.z,printpath.printpoints[-1].frame.point.z)<=top:
    raise ValueError("Approach/retract points must clear the part")
tilts=[math.degrees(math.acos(max(-1.,min(1.,p.frame.zaxis.dot(-Vector.Zaxis()))))) for p in body_points]
steps=[]
for a,b in zip(body_points,body_points[1:]):
    # Full Frame rotation angle, not only the change in tool Z.
    trace=sum(x.dot(y) for x,y in zip((a.frame.xaxis,a.frame.yaxis,a.frame.zaxis),
                                      (b.frame.xaxis,b.frame.yaxis,b.frame.zaxis)))
    steps.append(math.degrees(math.acos(max(-1.,min(1.,(trace-1)/2)))))
gaps=[]
for previous,current in zip(layers,layers[1:]):
    gaps.extend(b.z-a.z for a,b in zip(previous.points[:-1],current.points[:-1]))
if min(gaps)<=0:raise ValueError("Nonpositive same-angle rise")

def bounds(pts):
    return [[min(getattr(p,k) for p in pts) for k in ('x','y','z')],
            [max(getattr(p,k) for p in pts) for k in ('x','y','z')]]
printpath.workflow_meta={
    "schema":"sketch_nonplanar_tilted_tool_v1",
    "tool_orientation":"local_layer_radial_tangent_normal",
    "speed_policy":{"type":"same_angle_previous_layer_distance", "max_multiplier":MAX_SPEED_MULTIPLIER,
                    "reference":"same radial shift plus nominal Z rise",
                    "gap_min_mm":min(layer_distances),"gap_max_mm":max(layer_distances),
                    "cap_mm_s":MAX_ROBOT_SPEED,"base_mm_s":speed,
                    "body_min_mm_s":min(p.speed for p in body_points),
                    "body_max_mm_s":max(p.speed for p in body_points)},
    "shape":{"radius":radius,"height":height,"waist":waist,"wave_amp":wave_amp},
    "body_bounds":bounds(body),"priming_bounds":bounds(priming),
    "layer_height_requested":layer_height,"nominal_layer_height":height/(len(layers)-1),
    "min_same_angle_rise":min(gaps),"max_same_angle_rise":max(gaps),
    "max_tool_tilt_deg":max(tilts),"max_frame_step_deg":max(steps),
    "body_start_index":body_start_index,"priming_end_index":prime_end_index,
    "point_spacing_requested":point_spacing,
    "body_segments":segments,"priming_segments":prime_segments,
}
path_curves=[rg.Polyline([rg.Point3d(p.x,p.y,p.z) for p in priming]).ToPolylineCurve()]
path_curves += [rg.Polyline([rg.Point3d(p.x,p.y,p.z) for p in ring.points]).ToPolylineCurve() for ring in layers]
report="\n".join([
    "PREVIOUS BODY LAYER DISTANCE -> REQUESTED SPEED",
    "Body speed {:.2f}..{:.2f} mm/s; cap {:.1f}; priming/travel unchanged".format(min(p.speed for p in body_points),max(p.speed for p in body_points),MAX_ROBOT_SPEED),
    "Priming circle R={:.1f} at first-layer Z={:.2f}; then inward travel OFF".format(prime_radius,fine_adjust_z),
    "{} body rings; max tilt {:.2f} deg; max target-to-target frame change {:.2f} deg".format(len(layers),max(tilts),max(steps)),
    "Spacing {:.2f} mm (approx. reference ring); body {} / priming {} segments".format(point_spacing,segments,prime_segments),
    "Same-angle previous-layer gap {:.3f}..{:.3f} mm".format(min(layer_distances),max(layer_distances)),
    "Frame Z follows local layer normal (opposite/upward sign); not the shell's side normal.",
    "Priming is vertical. First body ring is vertical; tilt grows with the wave amplitude.",
    "Only initial approach and final retract are elevated. No sky-circle path.",
    "TCP/Work Object unchanged. Robot IK, flange sweep, nozzle clearance and material behaviour NOT verified.",
])
if "ghenv" in globals():ghenv.Component.Message="LAYER GAP SPEED | {:.1f}-{:.1f}".format(min(p.speed for p in body_points),max(p.speed for p in body_points))
# ---------- end sketch_tilted_frames_speed ----------
path_checks = Panel(sketch_tilted_frames_speed.report)
save_sketch_json = Button()
save_sketch_path = SaveSketchPath(printpath=sketch_tilted_frames_speed.printpath, save=save_sketch_json)  # -> status
# ---------- save_sketch_path: Python ----------
# r: compas
# venv: mas-2627
"""Save the current path to data/out_printpoints.json."""
import json
import os
import scriptcontext as sc

gh_dir=os.path.dirname(ghenv.Component.OnPingDocument().FilePath)
key="sketch_tilt_speed_save_"+str(ghenv.Component.InstanceGuid)
if save:
    if printpath is None or not hasattr(printpath,"workflow_meta"):
        raise ValueError("Generate the sketch path first")
    data=printpath.to_dict()
    data["workflow_meta"]=printpath.workflow_meta
    points=printpath.printpoints
    for i,item in enumerate(data["printpoints"]):
        item["aspeed_mode"]=getattr(points[i], "aspeed_mode", None)
    path=os.path.join(gh_dir,"data","out_printpoints.json")
    os.makedirs(os.path.dirname(path),exist_ok=True)
    temporary=path+".tmp"
    with open(temporary,"w") as f:json.dump(data,f,indent=2,allow_nan=False)
    os.replace(temporary,path)
    sc.sticky[key]="Saved {} points to {}".format(len(points),path)
status=sc.sticky.get(key,"Not saved yet")
ghenv.Component.Message="sketch JSON" if status.startswith("Saved") else "not saved"
# ---------- end save_sketch_path ----------
saved_json = Panel(save_sketch_path)
preview = Preview(printpath=sketch_tilted_frames_speed.printpath)  # -> path, travel, planes
# ---------- preview: Python ----------
# r: compas
# venv: mas-2627
"""
Draw the printpath: path = the whole polyline, travel = extruder-off segments,
safety = extruder-off points, axes = small x and y axis of each frame.
"""
import Rhino.Geometry as rg
from compas_rhino.conversions import frame_to_rhino_plane, point_to_rhino

AXIS_LENGTH = 5.0  # mm

points = printpath.printpoints
planes = [frame_to_rhino_plane(printpoint.frame) for printpoint in points]

# ===== Whole path =====
polyline = rg.Polyline()
for plane in planes:
    polyline.Add(plane.Origin.X, plane.Origin.Y, plane.Origin.Z)
path = polyline.ToPolylineCurve()

# ===== Extruder off: a segment prints only if both of its points have the extruder on =====
safety = [point_to_rhino(printpoint.frame.point) for printpoint in points if not printpoint.is_extruder_on]
travel = []
for i in range(len(points) - 1):
    if getattr(points[i], "aspeed_mode", None) is None or not (points[i].is_extruder_on and points[i + 1].is_extruder_on):
        travel.append(rg.Line(planes[i].Origin, planes[i + 1].Origin))


# Limit Frame display only; saved robot targets remain complete.
import math
planes=planes[::max(1,int(math.ceil(len(planes)/120.0)))]
# ---------- end preview ----------
plane = Plane(preview.planes)
preview_2 = CustomPreview(Geometry=preview.travel, Material=ColourSwatch(SwatchColor=RGB(230, 40, 40)))
preview_3 = CustomPreview(Geometry=preview.path, Material=ColourSwatch(SwatchColor=RGB(0, 170, 80)))
