# Grasshopper definition design_viz_test1_pair_planar_print_spiral.ghx (Grasshopper 1.0.8)

radius = Slider(50, range=24..50)
waist = Slider(10, range=0..15)
wave_amp = Slider(5, range=0..8)

center_x = Slider(140, range=0..300)
center_y = Slider(180, range=0..300)
fine_adjust_z = Slider(0, range=-10..5)

height = Slider(45, range=10..65)
sketch_identical_pair = SketchIdenticalOpenPair(
    radius=radius,
    height=height,
    waist=waist,
    wave_amp=wave_amp,
    center_x=center_x,
    center_y=center_y,
    fine_adjust_z=fine_adjust_z)  # -> model, report
# ---------- sketch_identical_pair: Python ----------
"""One open surface, printed twice, flipped once. No shell offset or cap.
Inputs: radius, height, waist, wave_amp, view_mode,
center_x, center_y, fine_adjust_z. Units mm.
"""
import math
import Rhino
import Rhino.Geometry as rg

defaults=dict(radius=32.,height=50.,waist=10.,wave_amp=4.,view_mode=0,
              center_x=180.,center_y=70.,fine_adjust_z=2.)
for name,default in defaults.items():
    value=globals().get(name)
    globals()[name]=float(default if value is None else value)
if not all(math.isfinite(globals()[n]) for n in defaults):
    raise ValueError("All parameters must be finite.")
if radius<=0 or not 0<=waist<0.7*radius or not 0<=wave_amp<height/3:
    raise ValueError("Use radius>0, waist<0.7*radius and wave_amp<height/3.")
if height<=0 or view_mode not in (0,1):
    raise ValueError("height must be positive; view_mode 0 pair / 1 single.")

WAVES=3  # fixed for this first prototype; sin has flip-compatible symmetry
N=96
ROWS=32
sections=[]
for k in range(ROWS+1):
    t=k/float(ROWS)
    r=radius*(1.1*(1-t)+t)-waist*math.sin(math.pi*t)
    pts=[]
    for j in range(N):
        a=2*math.pi*j/N
        pts.append(rg.Point3d(r*math.cos(a),r*math.sin(a),
            height*t+wave_amp*t**3*math.sin(WAVES*a)))
    sections.append(rg.NurbsCurve.Create(True,3,pts))

surfaces=rg.Brep.CreateFromLoft(sections,rg.Point3d.Unset,rg.Point3d.Unset,
                             rg.LoftType.Normal,False)
tol=max(Rhino.RhinoDoc.ActiveDoc.ModelAbsoluteTolerance,0.001)
joined=rg.Brep.JoinBreps(surfaces,tol) if surfaces else None
if not joined or len(joined)!=1 or not joined[0].IsValid:
    raise ValueError("Open body loft failed.")
part=joined[0]
# Do not cap. Both the flat starting opening and wavy joining opening stay open.
if part.IsSolid:
    raise ValueError("Unexpected closed body: this study must remain open-ended.")

lower=part.DuplicateBrep()
upper=part.DuplicateBrep()
flip=rg.Transform.Rotation(math.pi,rg.Vector3d.XAxis,rg.Point3d(0,0,height))
upper.Transform(flip)

model=[lower,upper] if view_mode==0 else [lower]
for brep in model:
    brep.Transform(rg.Transform.Translation(center_x,center_y,fine_adjust_z))

report="\n".join([
    "SKETCH STUDY: ONE open-ended part, duplicated and flipped.",
    "view_mode 0=assembled pair / 1=single upright print geometry",
    "No Boolean trimming, pins, collar, lid or inner offset wall.",
    "Flat starting radius={:.1f}; joining radius={:.1f} mm".format(1.1*radius,radius),
    "Joining curve Z = height + wave_amp * sin(3*angle).",
    "Flip around X through Z=height maps the joining curve onto itself.",
    "Pair height={:.1f} mm; two copies of EXACTLY the same geometry.".format(2*height),
    "Only geometry here. Wavy last layers need a new path strategy, not the old horizontal slicer.",
    "Actual bead-width contact, clearance, stability and nozzle motion are unverified.",
])
if "ghenv" in globals():ghenv.Component.Message="IDENTICAL x2 | OPEN RIMS"
# ---------- end sketch_identical_pair ----------
sketch_pair_report = Panel(sketch_identical_pair.report)

speed_mm_s = Slider(10, range=1..50)
blend_radius_mm = Slider(5, range=0..5)

point_spacing_mm = Slider(5, range=1..50)
layer_height_mm = Slider(1.2, range=0.5..10)

safety_distance_mm = Slider(90, range=10..300)
sketch_continuous_spiral = SketchContinuousSpiral(
    radius=radius,
    height=height,
    waist=waist,
    wave_amp=wave_amp,
    center_x=center_x,
    center_y=center_y,
    fine_adjust_z=fine_adjust_z,
    layer_height=layer_height_mm,
    point_spacing=point_spacing_mm,
    speed=speed_mm_s,
    blend_radius=blend_radius_mm,
    safety_distance=safety_distance_mm)  # -> printpath, path_curves, report
# ---------- sketch_continuous_spiral: Python ----------
# r: compas
# venv: mas-2627
"""Ground priming, one base ring, continuous wavy spiral, exact mating rim.
No layer jumps in the body. Units mm and mm/s.
"""
import math,os,sys
import Rhino.Geometry as rg
from compas.geometry import Point,Vector,Frame
gh_dir=os.path.dirname(ghenv.Component.OnPingDocument().FilePath)
src_dir=os.path.abspath(os.path.join(gh_dir,'..','..','..','src'))
if src_dir not in sys.path:sys.path.insert(0,src_dir)
from print_class import PrintPoint,PrintPath

for name,value in [('radius',radius),('height',height),('layer_height',layer_height),
                   ('point_spacing',point_spacing),('speed',speed),('safety_distance',safety_distance)]:
    if not math.isfinite(value) or value<=0:raise ValueError(name+' must be finite and positive')
if speed>50:raise ValueError('speed must not exceed 50 mm/s')
if not all(math.isfinite(v) for v in (waist,wave_amp,center_x,center_y,fine_adjust_z,blend_radius)):
    raise ValueError('Nonfinite parameter')
if not 0<=waist<0.7*radius or not 0<=wave_amp<height/3:
    raise ValueError('Check waist and wave amplitude')
if fine_adjust_z<0 or blend_radius<0:raise ValueError('Check first-layer Z and blend')

turns=max(1,int(math.ceil(height/layer_height)))
segments=max(3,int(math.ceil(2*math.pi*math.hypot(1.1*radius,3*wave_amp)/point_spacing)))
prime_segments=max(3,int(math.ceil(4*math.pi*radius/point_spacing)))
phase=math.pi/6 # start at a crest; gentle base/spiral/rim orientation junctions

def surface_point(t,a):
    r=radius*(1.1*(1-t)+t)-waist*math.sin(math.pi*t)
    return Point(center_x+r*math.cos(a),center_y+r*math.sin(a),
                 fine_adjust_z+height*t+wave_amp*t**3*math.sin(3*a))

def tool_frame(p,t,a,rising):
    r=radius*(1.1*(1-t)+t)-waist*math.sin(math.pi*t)
    dz_da=3*wave_amp*t**3*math.cos(3*a)
    if rising:
        dz_da+=(height+3*wave_amp*t*t*math.sin(3*a))/(2*math.pi*turns)
    # Radial horizontal direction x actual path tangent gives upward normal.
    normal=Vector(dz_da*math.sin(a)/r,-dz_da*math.cos(a)/r,1).unitized()
    z=-normal;reference=-Vector.Xaxis()
    x=reference-z*reference.dot(z);x.unitize()
    return Frame(p,x,z.cross(x))

points=[];prime=[];body=[]
for j in range(prime_segments+1):
    a=phase+2*math.pi*(j%prime_segments)/prime_segments
    p=Point(center_x+2*radius*math.cos(a),center_y+2*radius*math.sin(a),fine_adjust_z)
    prime.append(p);points.append(PrintPoint(Frame(p,-Vector.Xaxis(),Vector.Yaxis()),0,speed,
                                 0.0 if j==prime_segments else blend_radius,True))
prime_end=len(points)-1
body_start=len(points)
for j in range(segments+1):
    a=phase+2*math.pi*(j%segments)/segments
    p=surface_point(0,a);body.append(p)
    points.append(PrintPoint(tool_frame(p,0,a,False),1,speed,0.0 if j==0 else blend_radius,True))
# Do not duplicate the shared base/spiral target.
for k in range(1,turns*segments+1):
    t=k/float(turns*segments);a=phase+2*math.pi*(k%segments)/segments
    p=surface_point(t,a);body.append(p)
    points.append(PrintPoint(tool_frame(p,t,a,True),2+(k-1)//segments,speed,blend_radius,True))
rim_start=len(points)-1 # shared last spiral point / first point of exact top rim
for j in range(1,segments+1):
    a=phase+2*math.pi*(j%segments)/segments
    p=surface_point(1,a);body.append(p)
    points.append(PrintPoint(tool_frame(p,1,a,False),turns+2,speed,blend_radius,True))
points[-1].blend_radius=0.0
printpath=PrintPath(points)
printpath.add_safety_before(safety_distance,speed)
printpath.add_safety_after(safety_distance,speed)
prime_end+=1;body_start+=1;rim_start+=1
for i,p in enumerate(printpath.printpoints):
    p.aspeed_mode=1 if i+1<len(printpath.printpoints) and p.is_extruder_on and printpath.printpoints[i+1].is_extruder_on else None
printpath.printpoints[prime_end].aspeed_mode=None
if min(printpath.printpoints[0].frame.point.z,printpath.printpoints[-1].frame.point.z)<=max(p.z for p in body):
    raise ValueError('Approach/retract points must clear the body')

def bounds(ps):
    return [[min(getattr(p,k) for p in ps) for k in ('x','y','z')],
            [max(getattr(p,k) for p in ps) for k in ('x','y','z')]]
tilts=[math.degrees(math.acos(max(-1,min(1,p.frame.zaxis.dot(-Vector.Zaxis()))))) for p in printpath.printpoints[body_start:-1]]
frame_steps=[]
for p,q in zip(printpath.printpoints[body_start:-2],printpath.printpoints[body_start+1:-1]):
    trace=sum(x.dot(y) for x,y in zip((p.frame.xaxis,p.frame.yaxis,p.frame.zaxis),(q.frame.xaxis,q.frame.yaxis,q.frame.zaxis)))
    frame_steps.append(math.degrees(math.acos(max(-1,min(1,(trace-1)/2)))))
rise_min=(height-3*wave_amp)/turns;rise_max=(height+3*wave_amp)/turns
printpath.workflow_meta={
    'schema':'sketch_continuous_spiral_v1','tool_orientation':'spiral_radial_tangent_normal',
    'continuous_body':True,'shape':{'radius':radius,'height':height,'waist':waist,'wave_amp':wave_amp},
    'body_bounds':bounds(body),'priming_bounds':bounds(prime),
    'body_start_index':body_start,'priming_end_index':prime_end,'rim_start_index':rim_start,
    'spiral_turns':turns,'body_segments':segments,'priming_segments':prime_segments,
    'point_spacing_requested':point_spacing,'layer_height_requested':layer_height,
    'nominal_layer_height':height/turns,'min_same_angle_rise':rise_min,'max_same_angle_rise':rise_max,
    'rise_values_are_conservative_bounds':True,'max_tool_tilt_deg':max(tilts),
    'max_frame_step_deg':max(frame_steps),
    'finish_rim':'one full exact mating ring; overlap/gap varies against last spiral turn',
}
path_curves=[rg.Polyline([rg.Point3d(p.x,p.y,p.z) for p in prime]).ToPolylineCurve(),
             rg.Polyline([rg.Point3d(p.x,p.y,p.z) for p in body]).ToPolylineCurve()]
report='\n'.join([
    'CONTINUOUS WAVY SPIRAL | full tool tilt | no body layer jumps',
    '{} rising turns; {} segments/turn; {} total targets'.format(turns,segments,len(printpath.printpoints)),
    'Flat base ring -> continuous spiral -> exact wavy mating rim, without duplicate junction targets.',
    'R Speed {:.1f} mm/s; ASPEED1 constant; no distance/tilt speed compensation.'.format(speed),
    'point_spacing controls count (approximate reference-ring spacing); no 48-point floor.',
    'Final rim is exact as a target curve, but printed contact/finish thickness NOT validated.',
    'Use the SPIRAL sender: the ring sender would stop on every layer_index change.',
    'TCP clearance, IK, real speed and extrusion behaviour require physical verification.',
])
ghenv.Component.Message='SPIRAL | {} turns'.format(turns)
# ---------- end sketch_continuous_spiral ----------
path_checks = Panel(sketch_continuous_spiral.report)
save_sketch_json = Button()
save_sketch_path = SaveSketchPath(printpath=sketch_continuous_spiral.printpath, save=save_sketch_json)  # -> status
# ---------- save_sketch_path: Python ----------
# r: compas
# venv: mas-2627
"""Save current spiral to data/out_printpoints.json."""
import json
import os
import scriptcontext as sc

gh_dir=os.path.dirname(ghenv.Component.OnPingDocument().FilePath)
key="sketch_spiral_save_"+str(ghenv.Component.InstanceGuid)
if save:
    if printpath is None or not hasattr(printpath,"workflow_meta"):
        raise ValueError("Generate the sketch path first")
    data=printpath.to_dict()
    data["workflow_meta"]=printpath.workflow_meta
    points=printpath.printpoints
    for i,item in enumerate(data["printpoints"]):
        item["aspeed_mode"]=getattr(points[i], "aspeed_mode", None)
    path=os.path.join(gh_dir,"data","out_printpoints.json")
    os.makedirs(os.path.dirname(path),exist_ok=True)
    temporary=path+".tmp"
    with open(temporary,"w") as f:json.dump(data,f,indent=2,allow_nan=False)
    os.replace(temporary,path)
    sc.sticky[key]="Saved {} points to {}".format(len(points),path)
status=sc.sticky.get(key,"Not saved yet")
ghenv.Component.Message="sketch JSON" if status.startswith("Saved") else "not saved"
# ---------- end save_sketch_path ----------
saved_json = Panel(save_sketch_path)
preview = Preview(printpath=sketch_continuous_spiral.printpath)  # -> path, travel, planes
# ---------- preview: Python ----------
# r: compas
# venv: mas-2627
"""
Draw the printpath: path = the whole polyline, travel = extruder-off segments,
safety = extruder-off points, axes = small x and y axis of each frame.
"""
import Rhino.Geometry as rg
from compas_rhino.conversions import frame_to_rhino_plane, point_to_rhino

AXIS_LENGTH = 5.0  # mm

points = printpath.printpoints
planes = [frame_to_rhino_plane(printpoint.frame) for printpoint in points]

# ===== Whole path =====
polyline = rg.Polyline()
for plane in planes:
    polyline.Add(plane.Origin.X, plane.Origin.Y, plane.Origin.Z)
path = polyline.ToPolylineCurve()

# ===== Extruder off: a segment prints only if both of its points have the extruder on =====
safety = [point_to_rhino(printpoint.frame.point) for printpoint in points if not printpoint.is_extruder_on]
travel = []
for i in range(len(points) - 1):
    if getattr(points[i], "aspeed_mode", None) is None or not (points[i].is_extruder_on and points[i + 1].is_extruder_on):
        travel.append(rg.Line(planes[i].Origin, planes[i + 1].Origin))


# Thin only the displayed Frame planes, never saved robot targets.
import math
planes=planes[::max(1,int(math.ceil(len(planes)/120.0)))]
# ---------- end preview ----------
plane = Plane(preview.planes)
preview_2 = CustomPreview(Geometry=preview.travel, Material=ColourSwatch(SwatchColor=RGB(230, 40, 40)))
preview_3 = CustomPreview(Geometry=preview.path, Material=ColourSwatch(SwatchColor=RGB(0, 170, 80)))
