# Grasshopper definition design_viz_test1_pair_sketch.ghx (Grasshopper 1.0.8)

radius = Slider(35.3, range=24..42)
height = Slider(45.5, range=40..65)
waist = Slider(11.9, range=0..15)
wave_amp = Slider(4, range=0..8)
view_mode = Slider(1, range=0..1)
center_x = Slider(180, range=0..300)
center_y = Slider(95.2, range=0..300)
fine_adjust_z = Slider(2, range=0..5)
sketch_identical_pair = SketchIdenticalOpenPair(
    radius=radius,
    height=height,
    waist=waist,
    wave_amp=wave_amp,
    view_mode=view_mode,
    center_x=center_x,
    center_y=center_y,
    fine_adjust_z=fine_adjust_z)  # -> model, report
# ---------- sketch_identical_pair: Python ----------
"""One open surface, printed twice, flipped once. No shell offset or cap.
Inputs: radius, height, waist, wave_amp, view_mode,
center_x, center_y, fine_adjust_z. Units mm.
"""
import math
import Rhino
import Rhino.Geometry as rg

defaults=dict(radius=32.,height=50.,waist=10.,wave_amp=4.,view_mode=0,
              center_x=180.,center_y=70.,fine_adjust_z=2.)
for name,default in defaults.items():
    value=globals().get(name)
    globals()[name]=float(default if value is None else value)
if not all(math.isfinite(globals()[n]) for n in defaults):
    raise ValueError("All parameters must be finite.")
if radius<=0 or not 0<=waist<0.7*radius or not 0<=wave_amp<height/3:
    raise ValueError("Use radius>0, waist<0.7*radius and wave_amp<height/3.")
if height<=0 or view_mode not in (0,1):
    raise ValueError("height must be positive; view_mode 0 pair / 1 single.")

WAVES=3  # fixed for this first prototype; sin has flip-compatible symmetry
N=96
ROWS=32
sections=[]
for k in range(ROWS+1):
    t=k/float(ROWS)
    r=radius*(1.1*(1-t)+t)-waist*math.sin(math.pi*t)
    pts=[]
    for j in range(N):
        a=2*math.pi*j/N
        pts.append(rg.Point3d(r*math.cos(a),r*math.sin(a),
            height*t+wave_amp*t**3*math.sin(WAVES*a)))
    sections.append(rg.NurbsCurve.Create(True,3,pts))

surfaces=rg.Brep.CreateFromLoft(sections,rg.Point3d.Unset,rg.Point3d.Unset,
                             rg.LoftType.Normal,False)
tol=max(Rhino.RhinoDoc.ActiveDoc.ModelAbsoluteTolerance,0.001)
joined=rg.Brep.JoinBreps(surfaces,tol) if surfaces else None
if not joined or len(joined)!=1 or not joined[0].IsValid:
    raise ValueError("Open body loft failed.")
part=joined[0]
# Do not cap. Both the flat starting opening and wavy joining opening stay open.
if part.IsSolid:
    raise ValueError("Unexpected closed body: this study must remain open-ended.")

lower=part.DuplicateBrep()
upper=part.DuplicateBrep()
flip=rg.Transform.Rotation(math.pi,rg.Vector3d.XAxis,rg.Point3d(0,0,height))
upper.Transform(flip)

model=[lower,upper] if view_mode==0 else [lower]
for brep in model:
    brep.Transform(rg.Transform.Translation(center_x,center_y,fine_adjust_z))

report="\n".join([
    "SKETCH STUDY: ONE open-ended part, duplicated and flipped.",
    "view_mode 0=assembled pair / 1=single upright print geometry",
    "No Boolean trimming, pins, collar, lid or inner offset wall.",
    "Flat starting radius={:.1f}; joining radius={:.1f} mm".format(1.1*radius,radius),
    "Joining curve Z = height + wave_amp * sin(3*angle).",
    "Flip around X through Z=height maps the joining curve onto itself.",
    "Pair height={:.1f} mm; two copies of EXACTLY the same geometry.".format(2*height),
    "Only geometry here. Wavy last layers need a new path strategy, not the old horizontal slicer.",
    "Actual bead-width contact, clearance, stability and nozzle motion are unverified.",
])
if "ghenv" in globals():ghenv.Component.Message="IDENTICAL x2 | OPEN RIMS"
# ---------- end sketch_identical_pair ----------
sketch_pair_report = Panel(sketch_identical_pair.report)
