# Grasshopper definition design_gloopy_lamp.gh (Grasshopper 1.0.8)

# ---- group: This is needed only ONCE in the GH definition
enable_auto_reload = Python3Script()  # -> ok
# ---------- enable_auto_reload: Python ----------
"""
------------------------------
Using VS Code as Python editor
------------------------------

The simplest way to start using VS Code as our editor, is
to place our Python code in files located IN THE SAME FOLDER as our Grasshopper file.

After we have done that, we need 2 steps: 

1. Enable the COMPAS reloader on one component. This tells Grasshopper to watch for changes in the Pythoh files and reload if changed.
2. Every other component that uses Python code from external files needs to start with a method to ensure Grasshopper knows where to load the files from.

"""
# r: compas
# venv: mas-2627

from compas_rhino.devtools import DevTools
DevTools.enable_reloader()
# ---------- end enable_auto_reload ----------

# ---- group: DESIGN
point_spacing_mm = Slider(0.5, range=0.5..50)
height_mm = Slider(100, range=1..500)
radius_mm = Slider(30, range=5..200)

center_x_mm = Slider(150, range=-500..500)
center_y_mm = Slider(150, range=-500..500)
fine_adjust_z_mm = Slider(-0.5, range=-5..5)

# design: "slice" a cylinder
slice_cylinder = SliceCylinder(
    radius=radius_mm,
    height=height_mm,
    layer_height=Slider(1.2, range=0.5..2),
    point_spacing=point_spacing_mm,
    center_x=center_x_mm,
    center_y=center_y_mm,
    fine_adjust_z=fine_adjust_z_mm)  # -> layers
# ---------- slice_cylinder: Python ----------
# r: compas
# venv: mas-2627
"""
Slice a cylinder into layers, in work object coordinates (Rhino world XY = work object).
One closed compas Polyline per layer. Units: mm.
center_x, center_y: where the cylinder stands on the work object.
fine_adjust_z: shifts all layers up/down, to tune the nozzle height above the bed (0 = first layer at z = 0).
"""
import math
import random as r

from compas.geometry import Point
from compas.geometry import Polyline

# ===== How many layers, how many points per layer =====
layer_count = int(height / layer_height)
points_per_layer = round(2 * math.pi * radius / point_spacing)
print(points_per_layer)

# ===== One closed polyline per layer =====
layers = []

for i in range(layer_count):
    z = i * layer_height + fine_adjust_z
    
    points = []
    
    if i == 0:
        for j in range(points_per_layer + 1):  # priming layer
            angle = 2 * math.pi * (j % points_per_layer) / points_per_layer
            points.append(Point(center_x + 3 * radius * math.cos(angle), center_y + 3 * radius * math.sin(angle), z))
        layers.append(Polyline(points))
        
    
    elif i > ((2/3) * layer_count):
        for j in range(points_per_layer + 1):  # priming layer
            angle = 2 * math.pi * (j % points_per_layer) / points_per_layer

            if j % r.randint(5, 15) == 0 and i > 10 and i % r.randint(3, 10) == 0:
                angle = 2 * math.pi * (j % points_per_layer) / points_per_layer
                points.append(Point(
                    center_x + radius * r.uniform(1, 2.5) * math.cos(angle), 
                    center_y + radius * r.uniform(1, 2.5) * math.sin(angle), 
                    z - layer_height)
                )
            
            else: 
                points.append(Point(
                center_x + (layer_count-i)/layer_count * 3 * radius * math.cos(angle), 
                center_y + (layer_count-i)/layer_count * 3 * radius * math.sin(angle), 
                z
                ))

        layers.append(Polyline(points))

    else: 
        for j in range(points_per_layer + 1):  # one extra point: back to the start to close the ring
            
            if j % r.randint(5, 15) == 0 and i > 10 and i % r.randint(3, 10) == 0:
                angle = 2 * math.pi * (j % points_per_layer) / points_per_layer
                points.append(Point(
                    center_x + radius * r.uniform(1, 2.5) * math.cos(angle), 
                    center_y + radius * r.uniform(1, 2.5) * math.sin(angle), 
                    z - layer_height)
                )
            else:
                angle = 2 * math.pi * (j % points_per_layer) / points_per_layer
                points.append(Point(center_x + radius * math.cos(angle), center_y + radius * math.sin(angle), z - layer_height))
        
        layers.append(Polyline(points))

r.shuffle(layers[10])
r.shuffle(layers[20])

del layers[10].points[15:]
del layers[20].points[15:]
# ---------- end slice_cylinder ----------

# ---- group: PRINTPATH
# generate printpath: printpoints and path
safety_distance_mm = Slider(100, range=10..300)
blend_radius_mm = Slider(1, range=0..5)
speed_mm_s = Slider(10, range=1..50)
printpath = Printpath(layers=slice_cylinder, speed=speed_mm_s, blend_radius=blend_radius_mm, safety_distance=safety_distance_mm)  # -> printpath, summary; inputs layers: list
# ---------- printpath: Python ----------
# r: compas
# venv: mas-2627
"""
Turn the layers into printpoints and a PrintPath, in work object coordinates.
Safety points are added here, before any transform to the robot base.
"""
import os
import sys

from compas.geometry import Frame, Vector


# Find source folder
gh_dir = os.path.dirname(ghenv.Component.OnPingDocument().FilePath)
src_dir = os.path.join(gh_dir, "..", "..", "src")
if src_dir not in sys.path:
    sys.path.append(src_dir)
from print_class import PrintPoint, PrintPath

# ===== One printpoint per point =====
# world XY orientation for every point: a tangent frame would turn the wrist 360 degrees each layer
printpoints = []
for layer_index, layer in enumerate(layers):
    for point in layer.points:
        frame = Frame(point, -Vector.Xaxis(), Vector.Yaxis())
        printpoints.append(PrintPoint(frame, layer_index, speed, blend_radius, True))

# ===== Path with a travel point above the start and the end =====
printpath = PrintPath(printpoints)
printpath.add_safety_before(safety_distance, speed)
printpath.add_safety_after(safety_distance, speed)

summary = f"{len(printpoints)} printpoints in {len(layers)} layers, plus 2 safety points"
# ---------- end printpath ----------
panel = Panel(printpath.summary)

# ---- group: EXPORT
# export: preview and save
panel_2 = Panel("data/out_printpoints.json")
save = Button()
preview = Preview(printpath=printpath.printpath)  # -> path, travel, planes
# ---------- preview: Python ----------
# r: compas
# venv: mas-2627
"""
Draw the printpath: path = the whole polyline, travel = extruder-off segments,
safety = extruder-off points, axes = small x and y axis of each frame.
"""
import Rhino.Geometry as rg
from compas_rhino.conversions import frame_to_rhino_plane, point_to_rhino

AXIS_LENGTH = 5.0  # mm

points = printpath.printpoints
planes = [frame_to_rhino_plane(printpoint.frame) for printpoint in points]

# ===== Whole path =====
polyline = rg.Polyline()
for plane in planes:
    polyline.Add(plane.Origin.X, plane.Origin.Y, plane.Origin.Z)
path = polyline.ToPolylineCurve()

# ===== Extruder off: a segment prints only if both of its points have the extruder on =====
safety = [point_to_rhino(printpoint.frame.point) for printpoint in points if not printpoint.is_extruder_on]
travel = []
for i in range(len(points) - 1):
    if not (points[i].is_extruder_on and points[i + 1].is_extruder_on):
        travel.append(rg.Line(planes[i].Origin, planes[i + 1].Origin))
# ---------- end preview ----------
save_2 = Save(printpath=printpath.printpath, save=save, out_path=panel_2)  # -> status
# ---------- save_2: Python ----------
# r: compas
# venv: mas-2627
"""
On button press, write the printpath to data/out_printpoints.json next to this .ghx file.
send_to_robot.py reads that file.
"""
import json
import os

import scriptcontext as sc

gh_dir = os.path.dirname(ghenv.Component.OnPingDocument().FilePath)

# keep the last status in sticky, so the message survives the button being released
status_key = "save_status_" + str(ghenv.Component.InstanceGuid)

if save:
    if printpath is None:
        sc.sticky[status_key] = "nothing to save: no printpath"
    else:
        path = os.path.normpath(os.path.join(gh_dir, out_path))
        os.makedirs(os.path.dirname(path), exist_ok=True)
        with open(path, "w") as f:
            json.dump(printpath.to_dict(), f, indent=2)
        sc.sticky[status_key] = f"saved {len(printpath)} printpoints to {path}"

status = sc.sticky.get(status_key, "")
ghenv.Component.Message = "saved" if status.startswith("saved") else status
# ---------- end save_2 ----------
panel_3 = Panel(save_2)
preview_2 = CustomPreview(Geometry=preview.travel, Material=ColourSwatch(SwatchColor=RGB(230, 40, 40)))
preview_3 = CustomPreview(Geometry=preview.path, Material=ColourSwatch(SwatchColor=RGB(0, 170, 80)))

# ----
plane = Plane(preview.planes)
